# Grasshopper definition 202_robot_painting.ghx (Grasshopper 1.0.8)

pt = ConstructPoint(XCoordinate="100", YCoordinate="100", ZCoordinate=0)
# Generate Geometry
rhino = Python3Script(origin=pt, square_size=Slider(80, range=75..100))  # -> out, my_way_planes; inputs origin: Point3d, square_size: Double
# ---------- rhino: Python ----------
import Rhino.Geometry as rg

def create_square_way_planes(origin, size):
    """
    Define a square with a point3d as origin and 
    size as a float for the width and length
    """
    # Calculate the coordinates for the four corners of the square
    x, y = origin.X, origin.Y

    # Define the four corners of the square
    corner1 = rg.Point3d(x - size / 2, y - size / 2, 0)
    corner2 = rg.Point3d(x + size / 2, y - size / 2, 0)
    corner3 = rg.Point3d(x + size / 2, y + size / 2, 0)
    corner4 = rg.Point3d(x - size / 2, y + size / 2, 0)
    
    # Make plane from corner points
    plane1 = rg.Plane(corner1, rg.Vector3d.XAxis, rg.Vector3d.YAxis)
    plane2 = rg.Plane(corner2, rg.Vector3d.XAxis, rg.Vector3d.YAxis)
    plane3 = rg.Plane(corner3, rg.Vector3d.XAxis, rg.Vector3d.YAxis)
    plane4 = rg.Plane(corner4, rg.Vector3d.XAxis, rg.Vector3d.YAxis)

    # Add the corners to the list of square planes
    square_planes = [plane1, plane2, plane3, plane4, plane1]

    # Return the list of square points
    return square_planes

my_way_planes = create_square_way_planes(origin, square_size)
# ---------- end rhino ----------
pt_2 = ConstructPoint(XCoordinate="478.39", YCoordinate="486.41", ZCoordinate="-10.29")
pt_3 = ConstructPoint(XCoordinate="264.47", YCoordinate="114.90", ZCoordinate="-10.43")
# Transform from Rhino to Robot Space
pt_4 = ConstructPoint(XCoordinate="475.33", YCoordinate="113.77", ZCoordinate="-10.67")
rhino_2 = Python3Script(
    way_planes=rhino.my_way_planes,
    wobj_origin=pt_4,
    wobj_xaxis=pt_2,
    wobj_xypoint=pt_3,
    z_safe_margin=Slider(1, range=0..100))  # -> out, transformed_planes; inputs way_planes: list of Plane, wobj_origin: Point3d, wobj_xaxis: Point3d, wobj_xypoint: Point3d, z_safe_margin: Double
# ---------- rhino_2: Python ----------
import Rhino.Geometry as rg
import math

#in this step we transform our way planes to robot space
#the rhino co-ordinate system is rather abstract in the physical world
#the robot base plane assumed the base frame of robot is the origin
#but rhino does not know that
#thus we transform things from our design space(Rhino World XY) to Robot Base Plane that we measure

def set_robot_base(origin, xaxis, xypoint):
    """
    set a base plane representing the robot working object plane
    """
    robot_base = rg.Plane(origin, xaxis - origin, xypoint - origin)
    print (robot_base)
    return (robot_base)

def rhino_to_robot_space(rhino_plane,robot_base_plane):
    """
    Transform the objects from Rhino world XY plane to robot work object plane
    """
    T_matrix = rg.Transform.PlaneToPlane(rg.Plane.WorldXY,robot_base_plane)
    robot_plane = rhino_plane.Clone()
    # Invert plane to face Z down
    R = rg.Transform.Rotation(math.pi, rhino_plane.XAxis, rhino_plane.Origin)
    robot_plane.Transform(R)
    robot_plane.Transform(T_matrix)
    return robot_plane

def set_z_safe_margin(planes_to_adjust, safety_margin):
    adjusted_way_planes = []
    for plane in planes_to_adjust:
        plane.OriginZ += safety_margin
        adjusted_way_planes.append(plane)
    return adjusted_way_planes

# ===== Robot base is set =====
robot_base =  set_robot_base(wobj_origin, wobj_xaxis, wobj_xypoint)

# ===== Set safety margin for Z height ======
safer_planes = set_z_safe_margin(way_planes, z_safe_margin)

# ===== Transforming the rhino planes into robot planes =====
transformed_planes = []
for plane in way_planes: 
    transformed_planes.append(rhino_to_robot_space(plane, robot_base))
# ---------- end rhino_2 ----------
# Measure in paint location
panel = Panel("264.47")
pt_5 = ConstructPoint(XCoordinate=panel, YCoordinate="114.90", ZCoordinate="-10.43")
python_3_script = Python3Script(inputplanes=rhino_2.transformed_planes, paint_point=pt_5, safety_distance=Slider(100, range=0..100))  # -> out, way_planes; inputs inputplanes: list of Plane, paint_point: Point3d, safety_distance: Double
# ---------- python_3_script: Python ----------
# Input
# Planes for painting
# Location of paint refill point
import Rhino.Geometry as rg

# 0. Create new empty list
way_planes = []
paint_plane = rg.Plane(paint_point, rg.Vector3d.YAxis, rg.Vector3d.XAxis)
T = rg.Transform.Translation(rg.Vector3d.ZAxis * safety_distance)

copy_plane = paint_plane.Clone()
copy_plane.Transform(T)

# 1. Go to safe plane
way_planes.append(copy_plane)
# 2. Go to paint dip point
way_planes.append(paint_plane)
# 3. Go back to safe plane
way_planes.append(copy_plane)
# 4. Go to way_planes
way_planes.extend(inputplanes)

# 5. Add safety point to the end
last_plane = inputplanes[-1].Clone()
last_plane.Transform(T)
way_planes.append(last_plane)



# my_list = [1,2,3]
# my_other_list = [6,7,8]

# my_list.append(6)
# print(my_list)

# my_list.append(my_other_list)
# print(my_list)
# ---------- end python_3_script ----------
polyline = PolyLine(Vertices=python_3_script.way_planes, Closed=False)
point_list = PointList(Points=python_3_script.way_planes, Size=Slider(10, range=0..10))
number_slider = Slider(0.1, range=0..0.1)
number_slider_2 = Slider(0.1, range=0..0.1)
# Convert Planes to URScript
pt_6 = ConstructPoint(XCoordinate="-0.41", YCoordinate="0.38", ZCoordinate="74.38")
rhino_3 = Python3Script(way_planes=rhino_2.transformed_planes, tcp_measured=pt_6, acceleration=number_slider, velocity=number_slider_2)  # -> out, script; inputs way_planes: list of Plane, tcp_measured: Point3d, acceleration: Double, velocity: Double
# ---------- rhino_3: Python ----------
from imp import reload
import sys

sys.path.append("C:\Users\Juste\Documents\_facade_tools\projects\T1\discretization_experiments\_02_roboticdrawing")

import simple_ur_script as ur
reload(ur)

import utils 
reload(utils)

import simple_comm as com
reload(com)

import Rhino.Geometry as rg
import math as m

script = "" #create empty string

print("1", script)
#if value given for tcp measured, then add line to script, otherwise it will take current tcp from robot
if tcp_measured is not None:
    script += ur.set_tcp_by_angles(tcp_measured.X, tcp_measured.Y, tcp_measured.Z, m.radians(0.0),m.radians(0.0),m.radians(0))
print("2", script)
#calculate blend
blend_radii = utils.calculate_blend_radius(way_planes, 25.0)
#add move_l commands to script for each way plane
for plane, radius in zip(way_planes, blend_radii):
    script += ur.move_l_blend(plane, acceleration, velocity, radius)
    print("3...",script)


#format the script to make it sendable
script = com.concatenate_script(script)
# ---------- end rhino_3 ----------

# ---- group: Send UR script to Robot!
py3 = Python3Script(script=rhino_3.script, ip_address="192.168.10.10", send=Button())  # -> out, a; inputs script: String, ip_address: String, send: Boolean
# ---------- py3: Python ----------
import simple_comm as com
import imp

if send:
    com.send_script(script,ip_address)
# ---------- end py3 ----------

# ----
# Send to Robot!
panel_2 = Panel(rhino_3.script)
