# Grasshopper definition 101_brick_to_robot_CORRECT TCP.ghx (Grasshopper 1.0.8)

# ---- group: This is needed only ONCE in the GH definition
enable_auto_reload = Python3Script()  # -> ok
# ---------- enable_auto_reload: Python ----------
"""
------------------------------
Using VS Code as Python editor
------------------------------

The simplest way to start using VS Code as our editor, is
to place our Python code in files located IN THE SAME FOLDER as our Grasshopper file.

After we have done that, we need 2 steps: 

1. Enable the COMPAS reloader on one component. This tells Grasshopper to watch for changes in the Pythoh files and reload if changed.
2. Every other component that uses Python code from external files needs to start with a method to ensure Grasshopper knows where to load the files from.

"""
# r: compas
# venv: mas-2526

from compas_rhino.devtools import DevTools
DevTools.enable_reloader()
# ---------- end enable_auto_reload ----------

# ----
crv = Curve(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)
end = EndPoints(Curve=crv)  # -> Start, End
pl = ConstructPlane(Origin=end.Start, XAxis=Vector(1, 0, 0), YAxis=Vector(0, 1, 0))
python_3_script = Python3Script(rows=Slider(33, range=0..100), cols=Slider(22, range=0..100), u=Slider(30, range=0..50), scale=Slider(0, range=0..1))  # -> out, bricks, wall_brep, way_planes, geometries; inputs rows: Int32, cols: Int32
# ---------- python_3_script: Python ----------
import math
import compas.geometry as cg
from compas.geometry import Vector, Translation, Brep, Point, Plane, Frame, Box, Point
from compas_rhino.conversions import point_to_compas

from brick_wall import Brick

x = 31.94
y = 15.24
z = 9.98
pt1 = cg.Point(0,0,0)
pt2 = cg.Point(cols*x*0.25, u, 0)
pt3 = cg.Point(cols*x*0.5, 0, 0)
pt4 = cg.Point(cols*x*0.75, -u, 0)
pt5 = cg.Point(cols*x,0,0)
pts = [pt1,pt2,pt3,pt4,pt5]
base_crv = cg.NurbsCurve.from_interpolation(pts)

atr1 = cg.Point(cols*x*0.25, 0, 0)
atr2 = cg.Point(cols*x*0.75, 0, 0)

crv = cg.Line(pt1,pt5)
top_crv = cg.NurbsCurve.from_line(crv)
top_crv.translate(Vector(0,0,rows*z-z))

crvs = [top_crv, base_crv]
wall_brep = cg.Brep.from_loft(crvs)

row_crvs = []
for i in range(rows):
    slice_plane = cg.Plane(Point(0, 0, i*z), Vector(0, 0, 1))
    row_crv = wall_brep.slice(slice_plane)
    row_crvs.extend(row_crv)

bricks = []

for j, crv in enumerate(row_crvs):
    params = crv.divide_by_count(cols)

    if j % 2 == 1:
        offset = x / 2
        params = [t + offset for t in params]
        params = params[:-1]

    pts = [crv.point_at(t) for t in params]
    tans = [crv.tangent_at(t) for t in params]
    
    distances = []
    for pt, tan in zip(pts, tans):
        brk = Brick(pt)        
        angle_radians = math.atan2(tan.y, tan.x) #!!!!!!!!!!!!!!!!!!!!!!!!!!!!!!!!!!!!!!!
        dist = atr1.distance_to_point(pt)
        distances.append(dist)
        maxx = max(distances)
        rot_degrees = math.degrees(angle_radians+((dist/maxx)*scale))
        brk.rotate(rot_degrees)
        
        brk_geo = brk.draw()
        bricks.append(brk_geo)

geometries = []
way_planes = []

for brick in bricks:
    geometries.append(brick.draw())
    way_planes.append(brick.get_pick_frame())
# ---------- end python_3_script ----------
gap = Slider(2.5, range=0..10)
rotate = Rotate(Geometry=crv, Angle=degrees(Slider(90, range=0..100)), Plane=pl)  # -> Geometry, Transform
panel = Panel(python_3_script.wall_brep)
# Generate Geometry
brick_wall = Python3Script(crv=rotate.Geometry, num_layers=Slider(9, range=0..30), gap=gap)  # -> bricks, geometries, way_planes; inputs crv: Curve, num_layers: Int32, gap: Double
# ---------- brick_wall: Python ----------
# r: compas
# venv: mas-2526
from compas_rhino.devtools import DevTools
DevTools.ensure_path()

# 0. Import everything we will need
import math
from compas.geometry import Box
from compas.geometry import Point
from compas.geometry import Frame
from compas.geometry import cross_vectors
from compas_rhino.conversions import curve_to_compas

# ..also import our module "brick_wall.py", that needs to be in the same folder as our GH file
from brick_wall import Brick

# 1. Start with an empty list of bricks to be created
#    make sure to match the name of this list to the output of this component!
bricks = []

# 2. Create points on each curve
curve = curve_to_compas(crv)
print(curve.length())

# divide curve twice as fine
num_divs = int(curve.length() / (Brick.LENGTH+gap)) * 2
params, div_pts = curve.divide_by_count(num_divs, True)

for row in range(num_layers):
    for col, param in enumerate(params,):
        pt = curve.point_at(param)
        pt = pt.translated([0,0,Brick.HEIGHT * row])
        tangent = curve.tangent_at(param)
        normal = cross_vectors(tangent, [0,0,1])
        # only place bricks on alternating divisions depending on the row
        if row % 2 == 0:  
            # even rows 
            if col % 2 == 0:
                b = Brick(frame = Frame(pt, tangent, normal))
                bricks.append(b)
        else:  
            # odd rows 
            if col % 2 == 1:
                b = Brick(frame = Frame(pt, tangent, normal))
                bricks.append(b)

# Visualize and store brick data
geometries = []
way_planes = []

for brick in bricks:
    geometries.append(brick.draw())
    way_planes.append(brick.get_pick_frame())
# ---------- end brick_wall ----------
py3 = Python3Script(x=brick_wall.way_planes)  # -> out, a; inputs x: list
# ---------- py3: Python ----------
from compas_rhino.conversions import frame_to_rhino_plane

a = [frame_to_rhino_plane(f) for f in x]
# ---------- end py3 ----------
compas_draw = COMPASDraw(cg=brick_wall.geometries)  # -> rg
#   port cg: The COMPAS geometry or datastructure to be drawn.
#   port rg: The Rhino geometry object.
# ---------- compas_draw: Python ----------
# r: compas>=2.14.1
"""
Draws COMPAS geometry in Grasshopper.
"""

from typing import Any

import Grasshopper

from compas.scene import SceneObject


class CompasToRhinoGeometry(Grasshopper.Kernel.GH_ScriptInstance):
    def RunScript(self, cg):
        if not cg:
            return None

        return SceneObject(item=cg).draw()
# ---------- end compas_draw ----------
compas_draw_2 = COMPASDraw(cg=brick_wall.way_planes)  # -> rg; same code as compas_draw
panel_2 = Panel("520.86")
pt = ConstructPoint(XCoordinate="526.99", YCoordinate="56.91", ZCoordinate="-23.76")
pt_2 = ConstructPoint(XCoordinate="303.78", YCoordinate="476.27", ZCoordinate="-22.11")
pt_3 = ConstructPoint(XCoordinate="303.78", YCoordinate="56.76", ZCoordinate="-21.99")
# Transform from Rhino to Robot Space
srf4pt = _4PointSurface(CornerA=pt, CornerB=pt_3, CornerC=pt_2)
compas = Python3Script(
    way_planes=brick_wall.way_planes,
    wobj_origin=pt_3,
    wobj_xaxis=pt,
    wobj_xypoint=pt_2,
    z_safe_margin=Slider(3.5, range=0..100))  # -> out, transformed_planes; inputs way_planes: list, wobj_origin: Point3d, wobj_xaxis: Point3d, wobj_xypoint: Point3d, z_safe_margin: Double
# ---------- compas: Python ----------
import compas.geometry as cg

#in this step we transform our way planes to robot space
#the rhino co-ordinate system is rather abstract in the physical world
#the robot base plane assumed the base frame of robot is the origin
#but rhino does not know that
#thus we transform things from our design space(Rhino World XY) to Robot Base Plane that we measure

def set_robot_base(origin, xaxis, xypoint):
    """
    set a base plane representing the robot working object plane
    """
    robot_base = cg.Frame(origin, xaxis - origin, xypoint - origin)
    print (robot_base)
    return (robot_base)

def rhino_to_robot_space(rhino_plane,robot_base_plane):
    """
    Transform the objects from Rhino world XY plane to robot work object plane
    """
    T_matrix = cg.Transformation.from_frame_to_frame(cg.Frame.worldXY(), robot_base_plane)
    robot_plane = rhino_plane.transformed(T_matrix)
    return robot_plane

def set_z_safe_margin(planes_to_adjust, safety_margin):
    adjusted = []
    T = cg.Translation.from_vector(cg.Vector(0, 0, safety_margin))
    for f in planes_to_adjust:
        adjusted.append(f.transformed(T))
    return adjusted

# ===== Robot base is set =====
robot_base =  set_robot_base(wobj_origin, wobj_xaxis, wobj_xypoint)
print(robot_base)

# ===== Set safety margin for Z height ======
safe_planes = set_z_safe_margin(way_planes, z_safe_margin)

# ===== Transforming the rhino planes into robot planes =====
transformed_planes = []
for plane in safe_planes: 
    transformed_planes.append(rhino_to_robot_space(plane, robot_base))
# ---------- end compas ----------
compas_draw_3 = COMPASDraw(cg=compas.transformed_planes)  # -> rg; same code as compas_draw
pt_4 = ConstructPoint(XCoordinate="-18.04", YCoordinate="442.29", ZCoordinate="36.95")
pt_5 = ConstructPoint(XCoordinate="10.31", YCoordinate="452.95", ZCoordinate="5.85")
pt_6 = ConstructPoint(XCoordinate="11.40", YCoordinate="444.62", ZCoordinate="3.12")
item = ListItem(List=compas_draw_3, Index=0, Wrap=True)  # -> flatten(Item)

pt_7 = ConstructPoint(XCoordinate="-2.22", YCoordinate="1.36", ZCoordinate="83.85")

py3_2 = Python3Script(origin=pt_6, xaxis_pt=pt_4, xy_pt=pt_5)  # -> out, pick_frame; inputs origin: Point3d, xaxis_pt: Point3d, xy_pt: Point3d
# ---------- py3_2: Python ----------
from compas.geometry import Frame, Point
from compas.geometry import Rotation

from compas_rhino.conversions import point_to_compas
import math

origin = point_to_compas(origin)
xaxis_pt = point_to_compas(xaxis_pt)
xy_pt = point_to_compas(xy_pt)

#define pick frame
angle = math.radians(90)
pick_frame = Frame(origin, xaxis_pt - origin, xy_pt - origin)
pick_frame.rotate(angle, axis=pick_frame.normal, point=pick_frame.point)
# ---------- end py3_2 ----------
points = PointList(Points=item, Size=Slider(4, range=0..10))
item_2 = ListItem(List=item, Index=Slider(25, range=0..100), Wrap=True)
compas_draw_4 = COMPASDraw(cg=py3_2.pick_frame)  # -> rg; same code as compas_draw
# Convert Planes to URScript
number_slider = Slider(0.1, range=0..0.1)
number_slider_2 = Slider(0.1, range=0..0.1)
compas_2 = Python3Script(
    way_frames=compas.transformed_planes,
    tcp_measured=pt_7,
    acceleration=Slider(1, range=0..3),
    velocity=Slider(2, range=0..3),
    pick_frame=py3_2.pick_frame)  # -> out, vis_frames, vis_planes, script; inputs way_frames: list, tcp_measured: Point3d, acceleration: Double, velocity: Double
# ---------- compas_2: Python ----------
from imp import reload
import sys
import os

#get current file path
path = ghenv.Component.OnPingDocument().FilePath
#get parent directory of the parent directory
parentdir = os.path.dirname(path)
#get src folder which contains classes
dire = os.path.join(parentdir,'src')

sys.path.append(dire)

import simple_ur_script as ur
reload(ur)

import utils 
reload(utils)

import simple_comm as com
reload(com)

import compas.geometry as cg
import math as m

# ===== Set global constants =======

IO = 4 #Global constant
SAFE_DIST = 50

# =================================

script = "" #create empty string

def pickup_brick(script,pick_up_frame):
    frames = []
    
    safe_pick_up_frame = pick_up_frame.translated(-pick_up_frame.normal*SAFE_DIST)
    
    ## add to the path: go to the safe plane
    script += ur.move_l(safe_pick_up_frame, acceleration, velocity)
    frames.append(safe_pick_up_frame)
    
    ## add to the path: go to the pick up plane
    script += ur.move_l(pick_up_frame, acceleration, velocity)
    frames.append(pick_up_frame)
    
    ## add to the path: turn on the vacuum and wait 1 sec.
    script += ur.set_digital_out(IO,True)
    script += ur.sleep(1)

    # add to the path: go back to the safe_plane
    script += ur.move_l(safe_pick_up_frame, acceleration, velocity)
    frames.append(safe_pick_up_frame)
    
    return script, frames


def place_brick(script, place_frame):
    
    frames = []
    
    safe_place_frame = place_frame.translated(cg.Vector(0,0,1)*SAFE_DIST)
    
    # add to the path: go to the safe plane
    script += ur.move_l(safe_place_frame, acceleration, velocity)
    frames.append(safe_place_frame)
    
    # add to the path: go to the place plane
    script += ur.move_l(place_frame, acceleration, velocity)
    frames.append(place_frame)
    
    ## add to the path: turn off the vacuum and wait 1 second (hold the brick)
    script += ur.set_digital_out(IO,False)
    script += ur.sleep(1)
    
    # add to the path: go back to the safe plane
    script += ur.move_l(safe_place_frame, acceleration, velocity)
    frames.append(safe_place_frame)
    
    return script,frames


#if value given for tcp measured, then add line to script, otherwise it will take current tcp from robot
if tcp_measured is not None:
    script += ur.set_tcp_by_angles(tcp_measured.X, tcp_measured.Y, tcp_measured.Z, m.radians(0.0),m.radians(0.0),m.radians(0))


vis_frames = []
#add move_l commands in sequence to script for each way plane
for brick_frame in way_frames:
    script, p = pickup_brick(script,pick_frame)
    vis_frames.extend(p) #only to visualize the planes
    script, p = place_brick(script,brick_frame)
    vis_frames.extend(p)


#format the script to make it sendable
script = com.concatenate_script(script)

from compas_rhino import conversions
import Rhino.Geometry as rg

vis_planes = [conversions.frame_to_rhino(frame) for frame in vis_frames]
# ---------- end compas_2 ----------
points_2 = PointList(Points=compas_2.vis_planes, Size=Slider(6, range=0..100))
compas_draw_5 = COMPASDraw(cg=compas_2.vis_frames)  # -> rg; same code as compas_draw
pline = PolyLine(Vertices=compas_2.vis_planes, Closed=False)
panel_3 = Panel(compas_2.script)

# ---- group: Send UR script to Robot!
# Send to Robot!
py3_3 = Python3Script(script=compas_2.script, ip_address="192.168.10.10", send=Button())  # -> out, a; inputs script: String, ip_address: String, send: Boolean
# ---------- py3_3: Python ----------
import simple_comm as com

if send:
    com.send_script(script,ip_address)
# ---------- end py3_3 ----------
