# Grasshopper definition 101_brick_to_robot_nadja.gh (Grasshopper 1.0.8)

gap = Slider(3, range=0..10)

# ---- group: test 1
number_slider = Slider(4, range=0..30)
number_slider_2 = Slider(38, range=0..100)
gap_2 = Slider(3, range=0..10)
multiplication = Multiplication(A=number_slider_2, B=number_slider)
panel = Panel(multiplication)
py3 = Python3Script(num_layers=number_slider_2, gap=gap_2, num_bricks=number_slider)  # -> out, geometry, poly, polylines, center, frames; inputs num_layers: Int32, gap: Double, num_bricks: Int32
# ---------- py3: Python ----------
# r: compas
# venv: mas-2526

from compas_rhino.devtools import DevTools
DevTools.enable_reloader()

# STEP 1: Import everything we will need
import math
from compas.geometry import Box
from compas.geometry import Point
from compas.geometry import Frame
from compas.geometry import Polygon, Polyline, Vector
import compas_rhino.conversions 


from brick_wall import Brick

# geometry = compas_rhino.conversions.brep_to_compas(brep)

# Make curve as a triangle that is equal to the brick size


division = Brick.LENGTH + gap
x = division * num_bricks
y = x * math.sin(math.radians(60))

print(x, y)

pt_one = Point(0,0,0)
pt_two = Point(x, 0, 0)
pt_three = Point(x/2, y, 0)
center = Point(x/2, y/3, 0)

pt_list = [pt_one, pt_two, pt_three, pt_one]

poly = Polyline(pt_list)

vectors = []
bricks = []

polylines = []
height = Brick.HEIGHT
for row in range(num_layers):
    polyline = poly.translated([0,0,height*row])
    polyline.rotate(math.radians(3*row), axis=Vector(0,0,1), point=center)
    polylines.append(polyline)
    points_list = polyline.divide_by_length(division/2)
    for i, pt in enumerate(points_list):
        if i % 2 != 0:
            tan = polyline.tangent_at_point(pt)
            vectors.append(tan)
            cross = tan.cross(Vector(0,0,1))
            cross.unitize()
            cross.scale(Brick.WIDTH/2)
            new_pt = pt.translated(cross)
            brick = Brick(frame = Frame(new_pt, tan, cross))
            bricks.append(brick)

geometry = []
frames = []
for brick in bricks:
    b = brick.draw()
    frame = b.frame
    geometry.append(b)
    frames.append(frame)
# ---------- end py3 ----------
draw = COMPASDraw(cg=py3.geometry)  # -> rg
#   port cg: The COMPAS geometry or datastructure to be drawn.
#   port rg: The Rhino geometry object.
# ---------- draw: Python ----------
# r: compas>=2.14.1
"""
Draws COMPAS geometry in Grasshopper.
"""

from typing import Any

import Grasshopper

from compas.scene import SceneObject


class CompasToRhinoGeometry(Grasshopper.Kernel.GH_ScriptInstance):
    def RunScript(self, cg):
        if not cg:
            return None

        return SceneObject(item=cg).draw()
# ---------- end draw ----------
draw_2 = COMPASDraw(cg=py3.polylines)  # -> rg; same code as draw
draw_3 = COMPASDraw(cg=py3.center)  # -> rg; same code as draw
draw_4 = COMPASDraw(cg=py3.frames)  # -> rg; same code as draw

# ----
number_slider_3 = Slider(4, range=0..30)

# ---- group: This is needed only ONCE in the GH definition
enable_auto_reload = Python3Script()  # -> ok
# ---------- enable_auto_reload: Python ----------
"""
------------------------------
Using VS Code as Python editor
------------------------------

The simplest way to start using VS Code as our editor, is
to place our Python code in files located IN THE SAME FOLDER as our Grasshopper file.

After we have done that, we need 2 steps: 

1. Enable the COMPAS reloader on one component. This tells Grasshopper to watch for changes in the Pythoh files and reload if changed.
2. Every other component that uses Python code from external files needs to start with a method to ensure Grasshopper knows where to load the files from.

"""
# r: compas
# venv: mas-2526

from compas_rhino.devtools import DevTools
DevTools.enable_reloader()
# ---------- end enable_auto_reload ----------

# ----
number_slider_4 = Slider(38, range=0..100)
gap_3 = Slider(3, range=0..10)
curve = Curve(<curve referenced from the Rhino model>)
multiplication_2 = Multiplication(A=number_slider_4, B=number_slider_3)
brick_wall = Python3Script(crv=curve, num_layers=Slider(9, range=0..30), gap=gap)  # -> bricks, geometries, way_planes; inputs crv: Curve, num_layers: Int32, gap: Double
# ---------- brick_wall: Python ----------
# r: compas
# venv: mas-2526
from compas_rhino.devtools import DevTools
DevTools.ensure_path()

# 0. Import everything we will need
import math
from compas.geometry import Box
from compas.geometry import Point
from compas.geometry import Frame
from compas.geometry import cross_vectors
from compas_rhino.conversions import curve_to_compas

# ..also import our module "brick_wall.py", that needs to be in the same folder as our GH file
from brick_wall import Brick

# 1. Start with an empty list of bricks to be created
#    make sure to match the name of this list to the output of this component!
bricks = []

# 2. Create points on each curve
curve = curve_to_compas(crv)
print(curve.length())

# divide curve twice as fine
num_divs = int(curve.length() / (Brick.LENGTH+gap)) * 2
params, div_pts = curve.divide_by_count(num_divs, True)

for row in range(num_layers):
    for col, param in enumerate(params,):
        pt = curve.point_at(param)
        pt = pt.translated([0,0,Brick.HEIGHT * row])
        tangent = curve.tangent_at(param)
        normal = cross_vectors(tangent, [0,0,1])
        # only place bricks on alternating divisions depending on the row
        if row % 2 == 0:  
            # even rows 
            if col % 2 == 0:
                b = Brick(frame = Frame(pt, tangent, normal))
                bricks.append(b)
        else:  
            # odd rows 
            if col % 2 == 1:
                b = Brick(frame = Frame(pt, tangent, normal))
                bricks.append(b)

# Visualize and store brick data
geometries = []
way_planes = []

for brick in bricks:
    geometries.append(brick.draw())
    way_planes.append(brick.get_pick_frame())
# ---------- end brick_wall ----------
panel_2 = Panel(multiplication_2)
py3_2 = Python3Script(num_layers=number_slider_4, gap=gap_3, num_bricks=number_slider_3)  # -> out, geometry, poly, polylines, center, frames, points_inside, points_outside; inputs num_layers: Int32, gap: Double, num_bricks: Int32
# ---------- py3_2: Python ----------
# r: compas
# venv: mas-2526

from compas_rhino.devtools import DevTools
DevTools.enable_reloader()

# STEP 1: Import everything we will need
import math
from compas.geometry import Box
from compas.geometry import Point
from compas.geometry import Frame
from compas.geometry import Polygon, Polyline, Vector
import compas_rhino.conversions 


from brick_wall import Brick

# geometry = compas_rhino.conversions.brep_to_compas(brep)

# Make curve as a triangle that is equal to the brick size


division = Brick.LENGTH + gap
x = division * num_bricks
y = x * math.sin(math.radians(60))

print(x, y)

pt_one = Point(0,0,0)
pt_two = Point(x, 0, 0)
pt_three = Point(x/2, y, 0)
center = Point(x/2, y/3, 0)

pt_list = [pt_one, pt_two, pt_three, pt_one]

poly = Polyline(pt_list)

vectors = []
bricks = []

polylines = []
height = Brick.HEIGHT
for row in range(num_layers):
    polyline = poly.translated([0,0,height*row])
    polyline.rotate(math.radians(5*row), axis=Vector(0,0,1), point=center)
    polylines.append(polyline)
    points_list = polyline.divide_by_length(division/2)
    for i, pt in enumerate(points_list):
        if i % 2 != 0:
            tan = polyline.tangent_at_point(pt)
            vectors.append(tan)
            cross = tan.cross(Vector(0,0,1))
            cross.unitize()
            cross.scale(Brick.WIDTH/2)
            new_pt = pt.translated(cross)
            brick = Brick(frame = Frame(new_pt, tan, cross))
            bricks.append(brick)

geometry = []
frames = []
for brick in bricks:
    b = brick.draw()
    frame = b.frame
    geometry.append(b)
    frames.append(frame)



def circle_points(center, radius=5.0, num_points=10):
    points = []
    for i in range(num_points):
        theta = 2 * math.pi * i / num_points  # angle from 0 to 2π
        x = center.x + radius * math.cos(theta)
        y = center.y + radius * math.sin(theta)
        points.append(Point(x, y, center.z))
    return points


r_in = (x/2)*math.tan(math.radians(60/2))
r_out = (x/2)/math.cos(math.radians(60/2))
points_inside = circle_points(center, radius=r_in, num_points=6)
points_inside.append(points_inside[0])
points_outside = circle_points(center, radius=r_out, num_points=3)
points_outside.append(points_outside[0])
points_in = circle_points(center, radius=r_in, num_points=3)
points_in.append(points_in[0])

polylines = [Polyline(points_inside), Polyline(points_outside), Polyline(points_in)]
# ---------- end py3_2 ----------
compas_draw = COMPASDraw(cg=brick_wall.geometries)  # -> simplify(rg); same code as draw
draw_5 = COMPASDraw(cg=py3_2.poly)  # -> rg; same code as draw
draw_6 = COMPASDraw(cg=py3_2.geometry)  # -> rg; same code as draw
draw_7 = COMPASDraw(cg=py3_2.polylines)  # -> rg; same code as draw
draw_8 = COMPASDraw(cg=py3_2.center)  # -> rg; same code as draw
draw_9 = COMPASDraw(cg=py3_2.points_inside)  # -> rg; same code as draw
draw_10 = COMPASDraw(cg=py3_2.points_outside)  # -> rg; same code as draw
