# Grasshopper definition 101_brick_to_robot_sharon.gh (Grasshopper 1.0.8)
# plug-ins: Robots, Pufferfish

number_slider = Slider(100, range=0..100)  # disabled
number_slider_2 = Slider(95, range=0..100)  # disabled
crv = Curve([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])  # disabled
py3 = Python3Script(curves=crv, x=number_slider, y=number_slider_2)  # -> out, points, way_frame, polar_bricks, moved_bricks; inputs curves: list of Curve, x: Double, y: Double; disabled
# ---------- py3: Python ----------
# r: compas
# venv: mas-2526
from compas_rhino.devtools import DevTools
DevTools.ensure_path()

import math
from compas.geometry import Box, Point, Frame, Vector, cross_vectors, Rotation, Translation
from compas_rhino.conversions import curve_to_compas
from brick_wall_2 import Brick

crvs = []
points = []
frames = []
bricks = []

for c in curves:
    cc = curve_to_compas(c)
    crvs.append(cc)


def param_list(curve, num_div):
    params = curve.divide_by_count(num_div)
    return params


def get_h_brick(curve, param):  # horizontal bricks
    pt = curve.point_at(param)
    points.append(pt)
    tan = crv.tangent_at(param)
    nor = tan.cross(Vector(0, 0, 1))
    frame = Frame(pt, tan, nor)
    frames.append(frame)
    b = Brick(frame)
    return b


def get_v_brick(curve, param):  # vertical bricks
    pt = curve.point_at(param)
    points.append(pt)
    tan = crv.tangent_at(param)
    nor = tan.cross(Vector(0, 0, 1))
    frame = Frame(pt, nor, tan)
    frames.append(frame)
    b = Brick(frame)
    return b


# === Polar Array 基本參數設定 ===
center = Point(0, 0, 0)
axis = Vector(0, 0, 1)
angle = math.radians(360 / 3)  # 每次旋轉角度 = 120°

polar_bricks = []

# === 逐層排磚（每一層先 polar array）===
for i_c, crv in enumerate(crvs):

    layer_bricks = []  # 暫存該層原始磚

    params = param_list(crv, 6)
    if i_c % 2 == 0:  # even row
        for i_p, param in enumerate(params):
            if i_p % 7 == 1 or i_p % 7 == 5:  # horizontal bricks
                b = get_h_brick(crv, param)
                layer_bricks.append(b)
            if i_p % 7 == 3:  # vertical bricks
                b = get_v_brick(crv, param)
                layer_bricks.append(b)

    if i_c % 2 == 1:  # odd row
        for i_p, param in enumerate(params):
            if i_p % 7 == 2 or i_p % 7 == 6:  # horizontal bricks
                b = get_h_brick(crv, param)
                layer_bricks.append(b)
            if i_p % 7 == 4:  # vertical bricks
                b = get_v_brick(crv, param)
                layer_bricks.append(b)

    # === 該層 polar array ===
    for i in range(3):  # 共 3 組 (0°,120°,240°)
        R = Rotation.from_axis_and_angle(axis, angle * i, point=center)
        for b in layer_bricks:
            fr = b.frame
            r_fr = fr.transformed(R)
            bb = Brick(r_fr)
            polar_bricks.append(bb.draw())

# === 新增：移動整體結構 ===
# 設定移動向量
move_vec = Vector(x, y, 0)
T = Translation.from_vector(move_vec)

moved_bricks = []
for b in polar_bricks:
    fr = b.frame
    m_fr = fr.transformed(T)
    moved_bricks.append(Brick(m_fr).draw())

# === Flip frame 方向 ===
way_frame = []
for b in moved_bricks:
    fr = b.frame
    if fr.zaxis.z > 0:
        fr.flip()
    way_frame.append(fr)

print("Total bricks after layered polar array:", len(polar_bricks))
# ---------- end py3 ----------
draw = COMPASDraw(cg=py3.points)  # -> rg; disabled
#   port cg: The COMPAS geometry or datastructure to be drawn.
#   port rg: The Rhino geometry object.
# ---------- draw: Python ----------
# r: compas>=2.14.1
"""
Draws COMPAS geometry in Grasshopper.
"""

from typing import Any

import Grasshopper

from compas.scene import SceneObject


class CompasToRhinoGeometry(Grasshopper.Kernel.GH_ScriptInstance):
    def RunScript(self, cg):
        if not cg:
            return None

        return SceneObject(item=cg).draw()
# ---------- end draw ----------
draw_2 = COMPASDraw(cg=py3.way_frame)  # -> rg; disabled; same code as draw
draw_3 = COMPASDraw(cg=py3.polar_bricks)  # -> rg; disabled; same code as draw
draw_4 = COMPASDraw(cg=py3.moved_bricks)  # -> rg; disabled; same code as draw
number_slider_3 = Slider(0, range=0..100)  # disabled
item = ListItem(List=draw_2, Index=0, Wrap=True)  # -> Item, Item1, Item2; disabled
swatch = ColourSwatch(SwatchColor=RGB(186, 98, 39))  # disabled
swatch_2 = ColourSwatch(SwatchColor=RGB(186, 98, 39))  # disabled
pl = ConstructPlane(Origin=item.Item, XAxis=item.Item1, YAxis=item.Item2)  # disabled
item_2 = ListItem(List=flatten(pl), Index=number_slider_3, Wrap=True)  # disabled
preview = CustomPreview(Geometry=draw_3, Material=swatch)  # disabled
preview_2 = CustomPreview(Geometry=draw_4, Material=swatch_2)  # disabled

# ---- group: This is needed only ONCE in the GH definition
enable_auto_reload = Python3Script()  # -> ok
# ---------- enable_auto_reload: Python ----------
"""
------------------------------
Using VS Code as Python editor
------------------------------

The simplest way to start using VS Code as our editor, is
to place our Python code in files located IN THE SAME FOLDER as our Grasshopper file.

After we have done that, we need 2 steps: 

1. Enable the COMPAS reloader on one component. This tells Grasshopper to watch for changes in the Pythoh files and reload if changed.
2. Every other component that uses Python code from external files needs to start with a method to ensure Grasshopper knows where to load the files from.

"""
# r: compas
# venv: mas-2526

from compas_rhino.devtools import DevTools
DevTools.enable_reloader()
# ---------- end enable_auto_reload ----------

# ----
# Brick wal_5
#  (U-curve + rotate at a stable number)
crv_u_2 = Curve(<curve referenced from the Rhino model>)  # disabled
number_slider_4 = Slider(10, range=0..30)  # disabled
number_slider_5 = Slider(1.5, range=0..10)  # disabled
number_slider_6 = Slider(10, range=0..30)  # disabled
number_slider_7 = Slider(36, range=0..180)  # disabled
py3_2 = Python3Script(crv=crv_u_2, num_layers=number_slider_4, gap=number_slider_5, cols=number_slider_6, rotation=number_slider_7)  # -> out, geometries, way_planes; inputs crv: Curve, num_layers: Int32, gap: Double, cols: Int32, rotation: Double; disabled
# ---------- py3_2: Python ----------
# r: compas
# venv: mas-2526

from compas_rhino.devtools import DevTools
DevTools.ensure_path()

import math
from compas.geometry import Box, Point, Frame, cross_vectors, Vector
from compas_rhino.conversions import curve_to_compas
from brick_wall_2 import Brick

bricks = []

curve = curve_to_compas(crv)
print(curve.length())

num_divs = int(curve.length())/(Brick.LENGTH+gap) * 2
params, div_pts = curve.divide_by_count(num_divs, True)

for row in range(num_layers):
    for col, param in enumerate(params):
        pt = curve.point_at(param)
        pt = pt.translated([0,0, Brick.HEIGHT * row])
        tangent = curve.tangent_at(param)
        normal = cross_vectors(tangent, [0,0,1])

        # dispatch A,B row
        if row % 2 == 0:
            if col % 2 == 0:
                b = Brick(Frame(pt, tangent, normal)) 
                bricks.append(b)               
        else:
            if row % 2 == 1 and col == 1:
                b_left = Brick(Frame(pt, tangent, normal))
                b_left.rotate(90)
                b_left.frame.translate(-tangent.unitized()*(Brick.LENGTH + Brick.WIDTH + gap)* 4/7)
                bricks.append(b_left)

            if col % 2 == 1:                
                b = Brick(Frame(pt, tangent, normal))
                bricks.append(b)
                
            if row % 2 == 1 and col == len(params)-2:
                b_right = Brick(Frame(pt, tangent, normal))
                b_right.rotate(90)
                b_right.frame.translate(tangent.unitized()* 1/2 *(Brick.LENGTH + Brick.WIDTH + gap*4))
                bricks.append(b_right)


        # rotation
        if row % 3 == 0 and col % 3 == 0:
            b.rotate(rotation)

# visualize and store brick data
geometries = []
way_planes = []

for brick in bricks:
    geometries.append(brick.draw())
    way_planes.append(brick.get_pick_frame())
# ---------- end py3_2 ----------
draw_5 = COMPASDraw(cg=py3_2.way_planes)  # -> rg; disabled; same code as draw
draw_6 = COMPASDraw(cg=py3_2.geometries)  # -> rg; disabled; same code as draw
number_slider_8 = Slider(10, range=0..10)  # disabled
number_slider_9 = Slider(45, range=0..100)  # disabled
item_3 = ListItem(List=draw_5, Index=0, Wrap=True)  # -> Item, Item1, Item2; disabled
preview_3 = CustomPreview(
    Geometry=draw_6,
    Material={diffuse=RGB(221, 160, 221), emission=RGB(66, 48, 66), shine=0.5, specular=RGB(255, 255, 255), transparency=0})  # disabled
pl_2 = ConstructPlane(Origin=item_3.Item, XAxis=item_3.Item1, YAxis=item_3.Item2)  # disabled
item_4 = ListItem(List=draw_6, Index=number_slider_9, Wrap=True)  # disabled
pln = Plane(pl_2)  # disabled

# ---- group: Brick wal_5 (rotate stable)
# Brick wal_5
#  (U-curve + rotate at a stable number)
crv_u_2_2 = Curve(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)  # disabled
crv_u_3 = Curve(<curve referenced from the Rhino model>)  # disabled
number_slider_10 = Slider(9, range=0..30)  # disabled
number_slider_11 = Slider(3, range=0..10)  # disabled
number_slider_12 = Slider(9, range=0..180)  # disabled
number_slider_13 = Slider(10, range=0..30)  # disabled
py3_3 = Python3Script(crv=crv_u_3, num_layers=number_slider_10, gap=number_slider_11, cols=number_slider_13, rotation=number_slider_12)  # -> out, geometries, way_planes; inputs crv: Curve, num_layers: Int32, gap: Double, cols: Int32, rotation: Double; disabled
# ---------- py3_3: Python ----------
# r: compas
# venv: mas-2526

from compas_rhino.devtools import DevTools
DevTools.ensure_path()

import math
from compas.geometry import Box, Point, Frame, cross_vectors
from compas_rhino.conversions import curve_to_compas
from brick_wall_2 import Brick

bricks = []

curve = curve_to_compas(crv)
print(curve.length())

num_divs = int(curve.length())/(Brick.LENGTH+gap) * 2
params, div_pts = curve.divide_by_count(num_divs, True)

for row in range(num_layers):
    for col, param in enumerate(params):
        pt = curve.point_at(param)
        pt = pt.translated([0,0, Brick.HEIGHT * row])
        tangent = curve.tangent_at(param)
        normal = cross_vectors(tangent, [0,0,1])

        # dispatch A,B row
        if row % 2 == 0:
            if col % 2 == 0:
                bricks.append(Brick(frame = Frame(pt, tangent, normal)))
        else:
            if col % 2 == 1:
                bricks.append(Brick(frame = Frame(pt, tangent, normal)))

for b in bricks:
    b.rotate(rotation)

# visualize and store brick data
geometries = []
way_planes = []

for brick in bricks:
    geometries.append(brick.draw())
    way_planes.append(brick.get_pick_frame())
# ---------- end py3_3 ----------
draw_7 = COMPASDraw(cg=py3_3.way_planes)  # -> rg; disabled; same code as draw
draw_8 = COMPASDraw(cg=py3_3.geometries)  # -> rg; disabled; same code as draw
item_5 = ListItem(List=draw_7, Index=0, Wrap=True)  # -> Item, Item1, Item2; disabled
preview_4 = CustomPreview(
    Geometry=draw_8,
    Material={diffuse=RGB(221, 160, 221), emission=RGB(66, 48, 66), shine=0.5, specular=RGB(255, 255, 255), transparency=0})  # disabled
pl_3 = ConstructPlane(Origin=item_5.Item, XAxis=item_5.Item1, YAxis=item_5.Item2)  # disabled
pln_2 = Plane(pl_3)  # disabled

# ----
# Brick wal_5
#  (U-curve + rotate at a stable number)
crv_u_2_3 = Curve(<curve referenced from the Rhino model>)
py3_4 = Python3Script(
    crv=crv_u_2_3,
    num_layers=Slider(10, range=0..30),
    gap=Slider(3, range=0..10),
    cols=Slider(10, range=0..30),
    rotation=Slider(48, range=0..180))  # -> out, geometries, way_planes; inputs crv: Curve, num_layers: Int32, gap: Double, cols: Int32, rotation: Double
# ---------- py3_4: Python ----------
# r: compas
# venv: mas-2526

from compas_rhino.devtools import DevTools
DevTools.ensure_path()

import math
from compas.geometry import Box, Point, Frame, cross_vectors, Vector
from compas_rhino.conversions import curve_to_compas
from brick_wall_2 import Brick

bricks = []

curve = curve_to_compas(crv)
print(curve.length())

num_divs = int(curve.length())/(Brick.LENGTH+gap) * 2
params, div_pts = curve.divide_by_count(num_divs, True)

for row in range(num_layers):
    for col, param in enumerate(params):
        pt = curve.point_at(param)
        pt = pt.translated([0,0, Brick.HEIGHT * row])
        tangent = curve.tangent_at(param)
        normal = cross_vectors(tangent, [0,0,1])

        # dispatch A,B row
        if row % 2 == 0:
            if col % 2 == 0:
                b = Brick(Frame(pt, tangent, normal)) 
                bricks.append(b)
            if row % 2 == 0 and col == len(params)-2:
                b_right = Brick(Frame(pt, tangent, normal))
                b_right.rotate(90)
                b_right.frame.translate(tangent.unitized()* 1/2 *(Brick.LENGTH + Brick.WIDTH + gap*3))
                bricks.append(b_right)               
        else:
            if row % 2 == 1 and col == 1:
                b_left = Brick(Frame(pt, tangent, normal))
                b_left.rotate(90)
                b_left.frame.translate(-tangent.unitized()*(Brick.LENGTH + Brick.WIDTH + gap)* 4/7)
                bricks.append(b_left)

            if col % 2 == 1:                
                b = Brick(Frame(pt, tangent, normal))
                bricks.append(b)
                
            # if row % 2 == 1 and col == len(params)-2:
            #     b_right = Brick(Frame(pt, tangent, normal))
            #     b_right.rotate(90)
            #     b_right.frame.translate(tangent.unitized()* 1/2 *(Brick.LENGTH + Brick.WIDTH + gap*4))
            #     bricks.append(b_right)


        # rotation
        if row % 3 == 0 and col % 4 == 0:
            b.rotate(90)
        if row % 2 != 0 and col % 3 == 0:
            b.rotate(rotation)

# visualize and store brick data
geometries = []
way_planes = []

for brick in bricks:
    geometries.append(brick.draw())
    way_planes.append(brick.get_pick_frame())
# ---------- end py3_4 ----------
draw_9 = COMPASDraw(cg=py3_4.way_planes)  # -> rg; same code as draw
draw_10 = COMPASDraw(cg=py3_4.geometries)  # -> rg; same code as draw
number_slider_14 = Slider(10, range=0..10)
item_6 = ListItem(List=draw_9, Index=0, Wrap=True)  # -> Item, Item1, Item2
preview_5 = CustomPreview(
    Geometry=draw_10,
    Material={diffuse=RGB(221, 160, 221), emission=RGB(66, 48, 66), shine=0.5, specular=RGB(255, 255, 255), transparency=0})
pl_4 = ConstructPlane(Origin=item_6.Item, XAxis=item_6.Item1, YAxis=item_6.Item2)
item_7 = ListItem(List=draw_10, Index=Slider(0, range=0..100), Wrap=True)
pln_3 = Plane(pl_4)

# ----
# polar array location???
number_slider_15 = Slider(100, range=0..100)  # disabled
number_slider_16 = Slider(85, range=0..200)  # disabled
crv_2 = Curve([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])  # disabled
py3_5 = Python3Script(curves=crv_2, x=number_slider_15, y=number_slider_16)  # -> out, points, primitive_bricks, way_frame, polar_bricks, moved_bricks; inputs curves: list of Curve, x: Double, y: Double; disabled
# ---------- py3_5: Python ----------
# r: compas
# venv: mas-2526
from compas_rhino.devtools import DevTools
DevTools.ensure_path()

import math
from compas.geometry import Box, Point, Frame, Vector, cross_vectors, Rotation, Translation
from compas_rhino.conversions import curve_to_compas
from brick_wall_2 import Brick

crvs = []
points = []
bricks = []

# convert curves to compas
for c in curves:
    crvs.append(curve_to_compas(c))

# build param list for curves
def param_list(curve, num_div):
    params = curve.divide_by_count(num_div)
    return params

def get_h_brick(curve, param):  # horizontal bricks
    pt = curve.point_at(param)
    points.append(pt)
    tan = crv.tangent_at(param)
    nor = tan.cross(Vector(0, 0, 1))
    frame = Frame(pt, tan, nor)
    b = Brick(frame)
    return b


def get_v_brick(curve, param):  # vertical bricks
    pt = curve.point_at(param)
    points.append(pt)
    tan = crv.tangent_at(param)
    nor = tan.cross(Vector(0, 0, 1))
    frame = Frame(pt, nor, tan)
    b = Brick(frame)
    return b


# === Polar Array_basic parameter setting ===
center = Point(-9, 9, 0)

axis = Vector(0, 0, 1)
angle = math.radians(360 / 3)  # rotatie 120° every time
polar_bricks = []

# === lay bricks layer by layer（polar array first）===
for i_c, crv in enumerate(crvs):
    layer_bricks = []  # temporary save the primitive bricks

    n = 5
    params = param_list(crv, n)
    if i_c % 2 == 0:  # even row
        for i_p, param in enumerate(params):
            if i_p % (n+1) == 1 or i_p % (n+1) == 5:  # horizontal bricks
                b = get_h_brick(crv, param)
                layer_bricks.append(b)
            if i_p % (n+1) == 3:  # vertical bricks
                b = get_v_brick(crv, param)
                layer_bricks.append(b)

    if i_c % 2 == 1:  # odd row
        for i_p, param in enumerate(params):
            if i_p % (n+1) == 1 or i_p % (n+1) == 5:  # horizontal bricks
                b = get_v_brick(crv, param)
                layer_bricks.append(b)
            if i_p % (n+1) == 3:  # vertical bricks
                b = get_h_brick(crv, param)
                layer_bricks.append(b)

    # === polar array ===
    for i in range(3):  # 3 groups (0°,120°,240°)
        R = Rotation.from_axis_and_angle(axis, angle * i, point=center)
        for b in layer_bricks:
            fr = b.frame
            r_fr = fr.transformed(R)
            bb = Brick(r_fr)
            polar_bricks.append(bb.draw())
        
# === move the whole structure ===
# moving vector setting
move_vec = Vector(x, y, 0)
T = Translation.from_vector(move_vec)

moved_bricks = []
for b in polar_bricks:
    fr = b.frame
    m_fr = fr.transformed(T)
    moved_bricks.append(Brick(m_fr).draw())

# === Flip frames  ===
way_frame = []
for b in moved_bricks:
    fr = b.frame
    if fr.zaxis.z > 0:
        fr.flip()
    way_frame.append(fr)

print("Total bricks after layered polar array:", len(moved_bricks))
# ---------- end py3_5 ----------
draw_11 = COMPASDraw(cg=py3_5.primitive_bricks)  # -> rg; disabled; same code as draw
draw_12 = COMPASDraw(cg=py3_5.points)  # -> rg; disabled; same code as draw
draw_13 = COMPASDraw(cg=py3_5.polar_bricks)  # -> rg; disabled; same code as draw
draw_14 = COMPASDraw(cg=py3_5.way_frame)  # -> rg; disabled; same code as draw
draw_15 = COMPASDraw(cg=py3_5.moved_bricks)  # -> rg; disabled; same code as draw
number_slider_17 = Slider(0, range=0..100)  # disabled
item_8 = ListItem(List=draw_14, Index=0, Wrap=True)  # -> Item, Item1, Item2; disabled
swatch_3 = ColourSwatch(SwatchColor=RGB(186, 98, 39))  # disabled
swatch_4 = ColourSwatch(SwatchColor=RGB(186, 98, 39))  # disabled
pl_5 = ConstructPlane(Origin=item_8.Item, XAxis=item_8.Item1, YAxis=item_8.Item2)  # disabled
preview_6 = CustomPreview(Geometry=draw_13, Material=swatch_3)  # disabled
item_9 = ListItem(List=flatten(pl_5), Index=number_slider_17, Wrap=True)  # disabled
preview_7 = CustomPreview(Geometry=draw_15, Material=swatch_4)  # disabled

# ----
# Brick wal_5
#  (U-curve + rotate at a stable number)
crv_u_2_4 = Curve(<curve referenced from the Rhino model>)
py3_6 = Python3Script(
    crv=crv_u_2_4,
    num_layers=Slider(10, range=0..30),
    gap=Slider(3, range=0..10),
    cols=Slider(10, range=0..30),
    rotation=Slider(48, range=0..180))  # -> out, geometries, way_planes; inputs crv: Curve, num_layers: Int32, gap: Double, cols: Int32, rotation: Double
# ---------- py3_6: Python ----------
# r: compas
# venv: mas-2526

from compas_rhino.devtools import DevTools
DevTools.ensure_path()

import math
from compas.geometry import Box, Point, Frame, cross_vectors, Vector
from compas_rhino.conversions import curve_to_compas
from brick_wall_2 import Brick

bricks = []

curve = curve_to_compas(crv)
print(curve.length())

num_divs = int(curve.length())/(Brick.LENGTH+gap) * 2
params, div_pts = curve.divide_by_count(num_divs, True)

for row in range(num_layers):
    for col, param in enumerate(params):
        pt = curve.point_at(param)
        pt = pt.translated([0,0, Brick.HEIGHT * row])
        tangent = curve.tangent_at(param)
        normal = cross_vectors(tangent, [0,0,1])

        # dispatch A,B row
        if row % 2 == 0: # even row
            if col % 2 == 0:
                b = Brick(Frame(pt, tangent, normal)) 
                bricks.append(b)
            if col == len(params)-2: # vertical brick in the end
                b_right = Brick(Frame(pt, tangent, normal))
                b_right.rotate(90)
                b_right.frame.translate(tangent.unitized() * (Brick.LENGTH + Brick.WIDTH + gap) * 1/2)
                bricks.append(b_right)               
        else: # odd row
            if col == 1: # vertical brick in the first
                b_left = Brick(Frame(pt, tangent, normal))
                b_left.rotate(90)
                b_left.frame.translate(-tangent.unitized()*(Brick.LENGTH + Brick.WIDTH + gap)* 1/2)
                bricks.append(b_left)

            if col % 2 == 1:                
                b = Brick(Frame(pt, tangent, normal))
                bricks.append(b)

        # rotation
        if row % 2 != 0:
            b.rotate(col*4.5)
        if row % 2 == 0 and col % 4 == 0:
            b.rotate(col*1.5)
        # if row % 3 == 0 and col % 4 == 0:
        #     b.rotate(90)
        # if row % 2 != 0 and col % 3 == 0:
        #     b.rotate(rotation)
        # if row % 2 == 0:
        #     b.rotate(col*6)

# visualize and store brick data
geometries = []
way_planes = []

for brick in bricks:
    geometries.append(brick.draw())
    way_planes.append(brick.get_pick_frame())
# ---------- end py3_6 ----------
draw_16 = COMPASDraw(cg=py3_6.way_planes)  # -> rg; same code as draw
draw_17 = COMPASDraw(cg=py3_6.geometries)  # -> rg; same code as draw
number_slider_18 = Slider(10, range=0..10)
item_10 = ListItem(List=draw_16, Index=0, Wrap=True)  # -> Item, Item1, Item2
preview_8 = CustomPreview(
    Geometry=draw_17,
    Material={diffuse=RGB(221, 160, 221), emission=RGB(66, 48, 66), shine=0.5, specular=RGB(255, 255, 255), transparency=0})
pl_6 = ConstructPlane(Origin=item_10.Item, XAxis=item_10.Item1, YAxis=item_10.Item2)
item_11 = ListItem(List=draw_17, Index=Slider(0, range=0..100), Wrap=True)
pln_4 = Plane(pl_6)

# ---- group: cross_MiniBrick
# MiniBrick
number_slider_19 = Slider(3, range=0..10)  # disabled
number_slider_20 = Slider(0, range=0..100)  # disabled
number_slider_21 = Slider(1.5, range=0..50)  # disabled
number_slider_22 = Slider(5, range=0..10)  # disabled
number_slider_23 = Slider(23, range=0..50)  # disabled
number_slider_24 = Slider(90, range=0..100)  # disabled
number_slider_25 = Slider(90, range=0..100)  # disabled
number_slider_26 = Slider(3, range=0..50)  # disabled
number_slider_27 = Slider(3, range=0..50)  # disabled
gap = Slider(5, range=0..100)  # disabled
py3_7 = Python3Script(
    num_layers=number_slider_23,
    gap=gap,
    h_num_bricks=number_slider_22,
    v_num_bricks=number_slider_19,
    rot_1=number_slider_27,
    rot_2=number_slider_26,
    rot_3=number_slider_21,
    u=number_slider_24,
    v=number_slider_25)  # -> out, lines, frames, Bricks; inputs num_layers: Int32, gap: Double, h_num_bricks: Int32, v_num_bricks: Int32, rot_1: Double, rot_2: Double, rot_3: Double, u: Double, v: Double; disabled
# ---------- py3_7: Python ----------
# r: compas
# venv: mas-2526

from compas_rhino.devtools import DevTools
DevTools.enable_reloader()

import math
from compas.geometry import Box, Point, Frame, Line, Vector
from brick_wall import Brick, BigBrick

# === statistic calculation ===
unit_div = ((Brick.LENGTH + Brick.WIDTH) / 2) + gap

h_total_length = unit_div * h_num_bricks
v_total_length = unit_div * v_num_bricks
x = h_total_length / 2
y = v_total_length / 2

# horizontal line & vertical line
h_l = Line(Point(-x+u, 0+v, 0), Point(x+u, 0+v, 0))
v_l = Line(Point(0+u, -y+v, 0), Point(0+u, y+v, 0))

# === functions ===
def paras(num_divs): # parameters in division points
    actual_num_divs = (num_divs * 2) + 1
    return [1/(actual_num_divs - 1) * d for d in range(actual_num_divs)]

def lns(line, row, rotation = 0): # creating multi lines (zaxis*)
    ln = line.translated([0, 0, Brick.HEIGHT * row])
    ln = ln.rotated(math.radians(rotation * row), axis = Vector(0,0,1), point = ln.midpoint)
    return ln

def h_brick(line, param): # horizontal bricks
    pt = line.point_at(param)
    tan = Vector(*line.direction) 
    """*line.direction"""
    cross = tan.cross(Vector(0, 0, 1))
    fr = Frame(pt, xaxis=tan, yaxis=cross)
    return Brick(fr)

def v_brick(line, param): # vertical bricks
    pt = line.point_at(param)
    tan = Vector(*line.direction)
    cross = tan.cross(Vector(0, 0, 1))
    fr = Frame(pt, xaxis=cross, yaxis=tan)
    return Brick(fr)

# === main loop：creating cross wall ===
lines = []
bricks = []
frs = []
for row in range(num_layers): # producing hor & ver lines on every layer
    h_ln = lns(h_l, row, rot_1)
    lines.append(h_ln)
    v_ln = lns(v_l, row, rot_1)
    lines.append(v_ln)

    h_para_list = paras(h_num_bricks)
    v_para_list = paras(v_num_bricks)

    n = 0.5
    e_para = 0.02 * n
    o_para_h = 0.025 * n
    o_para_v = 0.125 * n
    if row % 2 == 0: # even row
        for i, par in enumerate(h_para_list): # hor line bricks
            if i % 4 == 1:
                bricks.append(h_brick(h_ln, par))
            if i % 4 == 3:
                bricks.append(v_brick(h_ln, par + e_para))
        for i, par in enumerate(v_para_list): # ver line bricks
            if i == 1:
                # bricks.append(v_brick(v_ln, par + e_para))
                br = v_brick(v_ln, par + e_para)
                br.rotate(rot_2 * row)
                bricks.append(br)
            if i == 5:
                # bricks.append(v_brick(v_ln, par - e_para))
                br = v_brick(v_ln, par - e_para)
                br.rotate(rot_3 * row)
                bricks.append(br)
            
    else: # odd row
        for i, par in enumerate(h_para_list): # hor line bricks
            if i == 1:
                bricks.append(v_brick(h_ln, par))
            if i % 4 == 3:
                bricks.append(h_brick(h_ln, par))
            if i == 9:
                bricks.append(v_brick(h_ln, par + o_para_h))
        for i, par in enumerate(v_para_list): # ver line bricks
            if i == 1:
                bricks.append(h_brick(v_ln, par + o_para_v))
            if i == 5:
                bricks.append(h_brick(v_ln, par - o_para_v))

# === frames' zaxis（facing down）===
frames = []
for b in bricks:
    if b.frame.zaxis.z > 0:
        b.frame.flip()
    frames.append(b.frame)

# === draw brick in rhino ===
Bricks = []
for br in bricks:
    Bricks.append(br.draw())
# ---------- end py3_7 ----------
draw_18 = COMPASDraw(cg=py3_7.lines)  # -> rg; disabled; same code as draw
draw_19 = COMPASDraw(cg=py3_7.frames)  # -> rg; disabled; same code as draw
draw_20 = COMPASDraw(cg=py3_7.Bricks)  # -> rg; disabled; same code as draw
number_slider_28 = Slider(3, range=0..10)  # disabled
number_slider_29 = Slider(12, range=0..20)  # disabled
item_12 = ListItem(List=draw_19, Index=0, Wrap=True)  # -> Item, Item1, Item2; disabled
swatch_5 = ColourSwatch(SwatchColor=RGB(196, 175, 106))  # disabled
lng = ListLength(List=draw_20)  # disabled
num_bricks = Panel(lng)  # disabled
item_13 = ListItem(List=draw_20, Index=number_slider_29, Wrap=True)  # disabled
item_14 = ListItem(List=draw_18, Index=number_slider_28, Wrap=True)  # disabled
pl_7 = ConstructPlane(Origin=item_12.Item, XAxis=item_12.Item1, YAxis=item_12.Item2)  # disabled
preview_9 = CustomPreview(Geometry=draw_20, Material=swatch_5)  # disabled

# ---- group: triangle tower_hor, ver_holes
number_slider_30 = Slider(4, range=0..30)
number_slider_31 = Slider(30, range=0..100)
gap_2 = Slider(4.5, range=0..10)
py3_8 = Python3Script(num_layers=number_slider_31, gap=gap_2, num_bricks=number_slider_30, rot=Slider(15, range=0..100))  # -> out, poly, polylines, center, frames, bricks; inputs num_layers: Int32, gap: Double, num_bricks: Int32, rot: Double
# ---------- py3_8: Python ----------
# r: compas
# venv: mas-2526

from compas_rhino.devtools import DevTools
DevTools.enable_reloader()

import math
from compas.geometry import Box, Point, Frame
from compas.geometry import Polygon, Polyline, Vector, Line
from brick_wall_2 import Brick

# Make curve as a triangle that is equal to the brick size
unit_div = ((Brick.LENGTH + Brick.WIDTH)/2) + gap
x = unit_div * num_bricks
y = x * math.sin(math.radians(60))

u = 18 # 45
v = 60 #72
pt_1 = Point(0+u,0+v,0)
pt_2 = Point(x+u, 0+v, 0)
pt_3 = Point(x/2+u, y+v, 0)
center = Point(x/2+u, y/3+v, 0)

pt_list = [pt_1, pt_2, pt_3, pt_1]
poly = Polyline(pt_list)

# make skeleton curves & primitive bricks
vectors = []
bricks = []
polylines = []
p_l = []

def horizontal_brick(point, move=0, rotation=0):
    tan = polyline.tangent_at_point(point)
    tan.unitize()
    cross = tan.cross(Vector(0,0,1))
    cross.unitize()
    new_pt = pt.translated(tan*move)
    cross.scale(Brick.WIDTH/2)
    c_new_pt = new_pt.translated(cross)
    b = Brick(Frame(c_new_pt, tan, cross))
    b.rotate(rotation)
    bricks.append(b.draw())
    return bricks

def vertical_brick(point, move=0, rotation=0):
    tan = polyline.tangent_at_point(point)
    cross = tan.cross(Vector(0,0,1))
    cross.unitize()
    new_pt = pt.translated(cross*move)
    cross.scale(Brick.WIDTH/2)
    c_new_pt = new_pt.translated(cross)
    b = Brick(Frame(c_new_pt, cross, tan))
    b.rotate(rotation)
    bricks.append(b.draw())
    return bricks

height = Brick.HEIGHT
for row in range(num_layers):
    polyline = poly.translated([0,0,height*row])
    polyline.rotate(math.radians(3*row), axis=Vector(0,0,1), point=center)
    polylines.append(polyline)
    points_list = polyline.divide_by_length(unit_div/2)
    print(len(points_list))

    for i, pt in enumerate(points_list):
        if row % 2 == 0: # even row
            if i % 8 == 0: # vertical
                vertical_brick(pt, move=3)
            if i % 8 == 4: # vertical
                vertical_brick(pt)
            if i % 4 == 2: # horizontal
                horizontal_brick(pt)
        else: # odd row
            if i % 8 == 1: # horizontal
                horizontal_brick(pt, move=3)
            if i % 8 == 5: # horizontal
                horizontal_brick(pt)
            if i % 8 == 7: # vertical
                vertical_brick(pt, rotation=rot)               
frames = []
for b in bricks:
    frame = b.frame
    if frame.zaxis.z > 0:
        frame.flip()
    frames.append(frame)
# ---------- end py3_8 ----------
multiplication = Multiplication(A=number_slider_31, B=number_slider_30)
panel = Panel(multiplication)
draw_21 = COMPASDraw(cg=py3_8.bricks)  # -> rg; same code as draw
draw_22 = COMPASDraw(cg=py3_8.poly)  # -> rg; same code as draw
draw_23 = COMPASDraw(cg=py3_8.polylines)  # -> rg; same code as draw
draw_24 = COMPASDraw(cg=py3_8.center)  # -> rg; same code as draw
draw_25 = COMPASDraw(cg=py3_8.frames)  # -> rg; same code as draw
item_15 = ListItem(List=draw_25, Index=0, Wrap=True)  # -> Item, Item1, Item2
pl_8 = ConstructPlane(Origin=item_15.Item, XAxis=item_15.Item1, YAxis=item_15.Item2)
preview_10 = CustomPreview(Geometry=draw_21, Material=ColourSwatch(SwatchColor=RGB(196, 175, 106)))

# ---- group: Generate Geometry
crv_3 = Curve(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)  # disabled
number_slider_32 = Slider(9, range=0..30)  # disabled
gap_3 = Slider(2.5, range=0..10)  # disabled
brick_wall = Python3Script(crv=crv_3, num_layers=number_slider_32, gap=gap_3)  # -> bricks, geometries, way_planes; inputs crv: Curve, num_layers: Int32, gap: Double; disabled
# ---------- brick_wall: Python ----------
# r: compas
# venv: mas-2526
from compas_rhino.devtools import DevTools
DevTools.ensure_path()

# 0. Import everything we will need
import math
from compas.geometry import Box
from compas.geometry import Point
from compas.geometry import Frame
from compas.geometry import cross_vectors
from compas_rhino.conversions import curve_to_compas

# ..also import our module "brick_wall.py", that needs to be in the same folder as our GH file
from brick_wall import Brick

# 1. Start with an empty list of bricks to be created
#    make sure to match the name of this list to the output of this component!
bricks = []

# 2. Create points on each curve
curve = curve_to_compas(crv)
print(curve.length())

# divide curve twice as fine
num_divs = int(curve.length() / (Brick.LENGTH+gap)) * 2
params, div_pts = curve.divide_by_count(num_divs, True)

for row in range(num_layers):
    for col, param in enumerate(params,):
        pt = curve.point_at(param)
        pt = pt.translated([0,0,Brick.HEIGHT * row])
        tangent = curve.tangent_at(param)
        normal = cross_vectors(tangent, [0,0,1])
        # only place bricks on alternating divisions depending on the row
        if row % 2 == 0:  
            # even rows 
            if col % 2 == 0:
                b = Brick(frame = Frame(pt, tangent, normal))
                bricks.append(b)
        else:  
            # odd rows 
            if col % 2 == 1:
                b = Brick(frame = Frame(pt, tangent, normal))
                bricks.append(b)

# Visualize and store brick data
geometries = []
way_planes = []

for brick in bricks:
    geometries.append(brick.draw())
    way_planes.append(brick.get_pick_frame())
# ---------- end brick_wall ----------
compas_draw = COMPASDraw(cg=brick_wall.geometries)  # -> rg; disabled; same code as draw
compas_draw_2 = COMPASDraw(cg=brick_wall.way_planes)  # -> rg; disabled; same code as draw
py3_9 = Python3Script(x=brick_wall.way_planes)  # -> out, a; inputs x: list; disabled
# ---------- py3_9: Python ----------
from compas_rhino.conversions import frame_to_rhino_plane

a = [frame_to_rhino_plane(f) for f in x]
# ---------- end py3_9 ----------

# ----
pln_5 = Plane([PlaneXY(22.995, 0, 0), PlaneXY(50.985, 0, 0), PlaneXY(78.975, 0, 0), Plane(origin=(-11.4975, 19.91425416, 0), x=(-0.5, 0.8660254038, 0), y=(-0.8660254038, -0.5, 0)), Plane(origin=(-25.4925, 44.15430521, 0), x=(-0.5, 0.8660254038, 0), y=(-0.8660254038, -0.5, 0)), Plane(origin=(-39.4875, 68.39435626, 0), x=(-0.5, 0.8660254038, 0), y=(-0.8660254038, -0.5, 0))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])
flippln = FlipPlane(Plane=pln_5, FlipX=False, FlipY=False, FlipZ=True)  # -> Flipped, R

py3_10 = Python3Script(planes=flippln.Flipped)  # -> out, way_planes; inputs planes: Plane
# ---------- py3_10: Python ----------
# r: compas
# venv: mas-2526

from compas_rhino.devtools import DevTools
DevTools.enable_reloader()

from compas.geometry import Box, Point, Frame
from compas_rhino.conversions import plane_to_compas

frames = []
way_planes = []

for pl in planes:
    print(type(pl))
    fr = Frame(pl, pl.x, pl.y)
#     way_planes.append(plane_to_compas(pl))

# way_planes.append(plane_to_compas(planes))
# ---------- end py3_10 ----------

number_slider_33 = Slider(100, range=0..100)  # disabled
number_slider_34 = Slider(95, range=0..100)  # disabled
crv_2_2 = Curve(flatten([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]))  # disabled
crv_1 = Curve([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])  # disabled
py3_11 = Python3Script(curves=crv_2_2, x=number_slider_33, y=number_slider_34)  # -> out, points, primitive_bricks, way_frame, polar_bricks, moved_bricks; inputs curves: list of Curve, x: Double, y: Double; disabled
# ---------- py3_11: Python ----------
# r: compas
# venv: mas-2526
from compas_rhino.devtools import DevTools
DevTools.ensure_path()

import math
from compas.geometry import Box, Point, Frame, Vector, cross_vectors, Rotation, Translation
from compas_rhino.conversions import curve_to_compas
from brick_wall_2 import Brick

crvs = []
points = []
bricks = []

# convert curves to compas
for c in curves:
    crvs.append(curve_to_compas(c))

# build param list for curves
def param_list(curve, num_div):
    params = curve.divide_by_count(num_div)
    return params

def get_h_brick(curve, param):  # horizontal bricks
    pt = curve.point_at(param)
    points.append(pt)
    tan = crv.tangent_at(param)
    nor = tan.cross(Vector(0, 0, 1))
    frame = Frame(pt, tan, nor)
    b = Brick(frame)
    return b


def get_v_brick(curve, param):  # vertical bricks
    pt = curve.point_at(param)
    points.append(pt)
    tan = crv.tangent_at(param)
    nor = tan.cross(Vector(0, 0, 1))
    frame = Frame(pt, nor, tan)
    b = Brick(frame)
    return b


# === Polar Array_basic parameter setting ===
center = Point(0, 0, 0)
axis = Vector(0, 0, 1)
angle = math.radians(360 / 3)  # rotatie 120° every time
polar_bricks = []

# === lay bricks layer by layer（polar array first）===
for i_c, crv in enumerate(crvs):
    layer_bricks = []  # temporary save the primitive bricks

    params = param_list(crv, 6)
    if i_c % 2 == 0:  # even row
        for i_p, param in enumerate(params):
            if i_p % 7 == 1 or i_p % 7 == 5:  # horizontal bricks
                b = get_h_brick(crv, param)
                layer_bricks.append(b)
            if i_p % 7 == 3:  # vertical bricks
                b = get_v_brick(crv, param)
                layer_bricks.append(b)

    if i_c % 2 == 1:  # odd row
        for i_p, param in enumerate(params):
            if i_p % 7 == 2 or i_p % 7 == 6:  # horizontal bricks
                b = get_h_brick(crv, param-4)
                layer_bricks.append(b)
            if i_p % 7 == 4:  # vertical bricks
                b = get_v_brick(crv, param-5)
                layer_bricks.append(b)

    # === polar array ===
    for i in range(3):  # 3 groups (0°,120°,240°)
        R = Rotation.from_axis_and_angle(axis, angle * i, point=center)
        for b in layer_bricks:
            fr = b.frame
            r_fr = fr.transformed(R)
            bb = Brick(r_fr)
            polar_bricks.append(bb.draw())
        
# === move the whole structure ===
# moving vector setting
move_vec = Vector(x, y, 0)
T = Translation.from_vector(move_vec)

moved_bricks = []
for b in polar_bricks:
    fr = b.frame
    m_fr = fr.transformed(T)
    moved_bricks.append(Brick(m_fr).draw())

# === Flip frames  ===
way_frame = []
for b in moved_bricks:
    fr = b.frame
    if fr.zaxis.z > 0:
        fr.flip()
    way_frame.append(fr)

print("Total bricks after layered polar array:", len(moved_bricks))
# ---------- end py3_11 ----------
draw_26 = COMPASDraw(cg=py3_11.points)  # -> rg; disabled; same code as draw
draw_27 = COMPASDraw(cg=py3_11.way_frame)  # -> rg; disabled; same code as draw
draw_28 = COMPASDraw(cg=py3_11.polar_bricks)  # -> rg; disabled; same code as draw
draw_29 = COMPASDraw(cg=py3_11.moved_bricks)  # -> rg; disabled; same code as draw
number_slider_35 = Slider(0, range=0..100)  # disabled
item_16 = ListItem(List=draw_27, Index=0, Wrap=True)  # -> Item, Item1, Item2; disabled
swatch_6 = ColourSwatch(SwatchColor=RGB(186, 98, 39))  # disabled
swatch_7 = ColourSwatch(SwatchColor=RGB(186, 98, 39))  # disabled
pl_9 = ConstructPlane(Origin=item_16.Item, XAxis=item_16.Item1, YAxis=item_16.Item2)  # disabled
item_17 = ListItem(List=flatten(pl_9), Index=number_slider_35, Wrap=True)  # disabled
preview_11 = CustomPreview(Geometry=draw_28, Material=swatch_6)  # disabled
preview_12 = CustomPreview(Geometry=draw_29, Material=swatch_7)  # disabled

# ---- group: cross_MiniBrick
# MiniBrick
number_slider_36 = Slider(3, range=0..10)
number_slider_37 = Slider(0, range=0..100)
gap_4 = Slider(5, range=0..100)
py3_12 = Python3Script(
    num_layers=Slider(23, range=0..30),
    gap=gap_4,
    h_num_bricks=Slider(5, range=0..10),
    v_num_bricks=number_slider_36,
    rot_1=Slider(3, range=0..50),
    rot_2=Slider(3, range=0..50),
    rot_3=Slider(1.5, range=0..50),
    u=Slider(90, range=0..100),
    v=Slider(90, range=0..100))  # -> out, lines, frames, Bricks; inputs num_layers: Int32, gap: Double, h_num_bricks: Int32, v_num_bricks: Int32, rot_1: Double, rot_2: Double, rot_3: Double, u: Double, v: Double
# ---------- py3_12: Python ----------
# r: compas
# venv: mas-2526

from compas_rhino.devtools import DevTools
DevTools.enable_reloader()

import math
from compas.geometry import Box, Point, Frame, Line, Vector
from brick_wall import Brick, BigBrick

# === statistic calculation ===
unit_div = ((Brick.LENGTH + Brick.WIDTH) / 2) + gap

h_total_length = unit_div * h_num_bricks
v_total_length = unit_div * v_num_bricks
x = h_total_length / 2
y = v_total_length / 2

# horizontal line & vertical line
h_l = Line(Point(-x+u, 0+v, 0), Point(x+u, 0+v, 0))
v_l = Line(Point(0+u, -y+v, 0), Point(0+u, y+v, 0))

# === functions ===
def paras(num_divs): # parameters in division points
    actual_num_divs = (num_divs * 2) + 1
    return [1/(actual_num_divs - 1) * d for d in range(actual_num_divs)]

def lns(line, row, rotation = 0): # creating multi lines (zaxis*)
    ln = line.translated([0, 0, Brick.HEIGHT * row])
    ln = ln.rotated(math.radians(rotation * row), axis = Vector(0,0,1), point = ln.midpoint)
    return ln

def h_brick(line, param): # horizontal bricks
    pt = line.point_at(param)
    tan = Vector(*line.direction) 
    """*line.direction"""
    cross = tan.cross(Vector(0, 0, 1))
    fr = Frame(pt, xaxis=tan, yaxis=cross)
    return Brick(fr)

def v_brick(line, param): # vertical bricks
    pt = line.point_at(param)
    tan = Vector(*line.direction)
    cross = tan.cross(Vector(0, 0, 1))
    fr = Frame(pt, xaxis=cross, yaxis=tan)
    return Brick(fr)

# === main loop：creating cross wall ===
lines = []
bricks = []
frs = []
for row in range(num_layers): # producing hor & ver lines on every layer
    h_ln = lns(h_l, row, rot_1)
    lines.append(h_ln)
    v_ln = lns(v_l, row, rot_1)
    lines.append(v_ln)

    h_para_list = paras(h_num_bricks)
    v_para_list = paras(v_num_bricks)

    n = 0.5
    e_para = 0.02 * n
    o_para_h = 0.025 * n
    o_para_v = 0.25 * n
    if row % 2 == 0: # even row
        for i, par in enumerate(h_para_list): # hor line bricks
            if i % 4 == 1:
                bricks.append(h_brick(h_ln, par))
            if i % 4 == 3:
                bricks.append(v_brick(h_ln, par + e_para))
        for i, par in enumerate(v_para_list): # ver line bricks
            if i == 1:
                # bricks.append(v_brick(v_ln, par + e_para))
                br = v_brick(v_ln, par + e_para)
                br.rotate(rot_2 * row)
                bricks.append(br)
            if i == 5:
                # bricks.append(v_brick(v_ln, par - e_para))
                br = v_brick(v_ln, par - e_para)
                br.rotate(rot_3 * row)
                bricks.append(br)
            
    else: # odd row
        for i, par in enumerate(h_para_list): # hor line bricks
            if i == 1:
                bricks.append(v_brick(h_ln, par))
            if i % 4 == 3:
                bricks.append(h_brick(h_ln, par))
            if i == 9:
                bricks.append(v_brick(h_ln, par + o_para_h))
        for i, par in enumerate(v_para_list): # ver line bricks
            if i == 1:
                bricks.append(h_brick(v_ln, par + o_para_v))
            if i == 5:
                bricks.append(h_brick(v_ln, par - o_para_v))

# === frames' zaxis（facing down）===
frames = []
for b in bricks:
    if b.frame.zaxis.z > 0:
        b.frame.flip()
    frames.append(b.frame)

# === draw brick in rhino ===
Bricks = []
for br in bricks:
    Bricks.append(br.draw())
# ---------- end py3_12 ----------
draw_30 = COMPASDraw(cg=py3_12.lines)  # -> rg; same code as draw
draw_31 = COMPASDraw(cg=py3_12.frames)  # -> rg; same code as draw
draw_32 = COMPASDraw(cg=py3_12.Bricks)  # -> rg; same code as draw
item_18 = ListItem(List=draw_31, Index=0, Wrap=True)  # -> Item, Item1, Item2
lng_2 = ListLength(List=draw_32)
item_19 = ListItem(List=draw_32, Index=Slider(12, range=0..20), Wrap=True)
num_bricks_2 = Panel(lng_2)
item_20 = ListItem(List=draw_30, Index=Slider(3, range=0..10), Wrap=True)
pl_10 = ConstructPlane(Origin=item_18.Item, XAxis=item_18.Item1, YAxis=item_18.Item2)
preview_13 = CustomPreview(Geometry=draw_32, Material=ColourSwatch(SwatchColor=RGB(196, 175, 106)))

# ----
draw_33 = COMPASDraw(cg=py3_10.way_planes)  # -> rg; same code as draw
panel_2 = Panel(py3_10.way_planes)

# ----
# polar array location???
number_slider_38 = Slider(100, range=0..100)  # disabled
number_slider_39 = Slider(95, range=0..100)  # disabled
crv_4 = Curve([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])  # disabled
py3_13 = Python3Script(curves=crv_4, x=number_slider_38, y=number_slider_39)  # -> out, points, primitive_bricks, way_frame, polar_bricks, moved_bricks; inputs curves: list of Curve, x: Double, y: Double; disabled; same code as py3_5
draw_34 = COMPASDraw(cg=py3_13.primitive_bricks)  # -> rg; disabled; same code as draw
draw_35 = COMPASDraw(cg=py3_13.points)  # -> rg; disabled; same code as draw
draw_36 = COMPASDraw(cg=py3_13.polar_bricks)  # -> rg; disabled; same code as draw
draw_37 = COMPASDraw(cg=py3_13.way_frame)  # -> rg; disabled; same code as draw
draw_38 = COMPASDraw(cg=py3_13.moved_bricks)  # -> rg; disabled; same code as draw
number_slider_40 = Slider(0, range=0..100)  # disabled
item_21 = ListItem(List=draw_37, Index=0, Wrap=True)  # -> Item, Item1, Item2; disabled
swatch_8 = ColourSwatch(SwatchColor=RGB(186, 98, 39))  # disabled
swatch_9 = ColourSwatch(SwatchColor=RGB(186, 98, 39))  # disabled
pl_11 = ConstructPlane(Origin=item_21.Item, XAxis=item_21.Item1, YAxis=item_21.Item2)  # disabled
item_22 = ListItem(List=flatten(pl_11), Index=number_slider_40, Wrap=True)  # disabled
preview_14 = CustomPreview(Geometry=draw_36, Material=swatch_8)  # disabled
preview_15 = CustomPreview(Geometry=draw_38, Material=swatch_9)  # disabled

item_23 = ListItem(List=draw_33, Index=0, Wrap=True)  # -> Item, Item1, Item2
panel_3 = Panel("327.75")
panel_4 = Panel("-47.33")
panel_5 = Panel("-5.55")
panel_6 = Panel("584.15")
panel_10 = Panel("433.50")
item_24 = ListItem(List=draw_21, Index=Slider(12, range=0..20), Wrap=True)
pl_12 = ConstructPlane(Origin=item_23.Item, XAxis=item_23.Item1, YAxis=item_23.Item2)

# ---- group: Transform from Rhino to Robot Space
pt = ConstructPoint(XCoordinate="472.50", YCoordinate="484.95", ZCoordinate="-23.40")
pt_2 = ConstructPoint(XCoordinate="290.50", YCoordinate="214.95", ZCoordinate="-23.40")
pt_3 = ConstructPoint(XCoordinate="290.50", YCoordinate="441.75", ZCoordinate="-23.40")
rec_3pt = Rectangle3Pt(PointA=pt_3, PointB=pt_2, PointC=pt)  # -> Rectangle, Length
compas = Python3Script(way_planes=py3_12.frames, wobj_origin=pt_3, wobj_xaxis=pt_2, wobj_xypoint=pt, z_safe_margin=Slider(10.5, range=0..100))  # -> out, transformed_planes; inputs way_planes: list, wobj_origin: Point3d, wobj_xaxis: Point3d, wobj_xypoint: Point3d, z_safe_margin: Double
# ---------- compas: Python ----------
import compas.geometry as cg

#in this step we transform our way planes to robot space
#the rhino co-ordinate system is rather abstract in the physical world
#the robot base plane assumed the base frame of robot is the origin
#but rhino does not know that
#thus we transform things from our design space(Rhino World XY) to Robot Base Plane that we measure

def set_robot_base(origin, xaxis, xypoint):
    """
    set a base plane representing the robot working object plane
    """
    robot_base = cg.Frame(origin, xaxis - origin, xypoint - origin)
    print (robot_base)
    return (robot_base)

def rhino_to_robot_space(rhino_plane,robot_base_plane):
    """
    Transform the objects from Rhino world XY plane to robot work object plane
    """
    T_matrix = cg.Transformation.from_frame_to_frame(cg.Frame.worldXY(), robot_base_plane)
    robot_plane = rhino_plane.transformed(T_matrix)
    return robot_plane

def set_z_safe_margin(planes_to_adjust, safety_margin):
    adjusted = []
    T = cg.Translation.from_vector(cg.Vector(0, 0, safety_margin))
    for f in planes_to_adjust:
        adjusted.append(f.transformed(T))
    return adjusted

# ===== Robot base is set =====
robot_base =  set_robot_base(wobj_origin, wobj_xaxis, wobj_xypoint)
print(robot_base)

# ===== Set safety margin for Z height ======
safe_planes = set_z_safe_margin(way_planes, z_safe_margin)

# ===== Transforming the rhino planes into robot planes =====
transformed_planes = []
for plane in safe_planes: 
    transformed_planes.append(rhino_to_robot_space(plane, robot_base))
# ---------- end compas ----------
compas_draw_3 = COMPASDraw(cg=compas.transformed_planes)  # -> rg; same code as draw
item_25 = ListItem(List=compas_draw_3, Index=0, Wrap=True)  # -> flatten(Item)
item_26 = ListItem(List=item_25, Index=Slider(25, range=0..100), Wrap=True)
points = PointList(Points=item_25, Size=Slider(4, range=0..10))

# ----
number_slider_41 = Slider(3.5, range=0..100)
number_slider_42 = Slider(15, range=0..100)
draw_39 = COMPASDraw(cg=py3_11.primitive_bricks)  # -> rg; disabled; same code as draw

number_slider_43 = Slider(100, range=0..100)  # disabled
number_slider_44 = Slider(95, range=0..100)  # disabled
crv_2_3 = Curve(flatten([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]))  # disabled
crv_1_2 = Curve([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])  # disabled
py3_14 = Python3Script(curves=crv_2_3, x=number_slider_43, y=number_slider_44)  # -> out, points, primitive_bricks, way_frame, polar_bricks, moved_bricks; inputs curves: list of Curve, x: Double, y: Double; disabled
# ---------- py3_14: Python ----------
# r: compas
# venv: mas-2526
from compas_rhino.devtools import DevTools
DevTools.ensure_path()

import math
from compas.geometry import Box, Point, Frame, Vector, cross_vectors, Rotation, Translation
from compas_rhino.conversions import curve_to_compas
from brick_wall_2 import Brick

crvs = []
points = []
bricks = []

# convert curves to compas
for c in curves:
    crvs.append(curve_to_compas(c))

# build param list for curves
def param_list(curve, num_div):
    params = curve.divide_by_count(num_div)
    return params

def get_h_brick(curve, param):  # horizontal bricks
    pt = curve.point_at(param)
    points.append(pt)
    tan = crv.tangent_at(param)
    nor = tan.cross(Vector(0, 0, 1))
    frame = Frame(pt, tan, nor)
    b = Brick(frame)
    return b


def get_v_brick(curve, param):  # vertical bricks
    pt = curve.point_at(param)
    points.append(pt)
    tan = crv.tangent_at(param)
    nor = tan.cross(Vector(0, 0, 1))
    frame = Frame(pt, nor, tan)
    b = Brick(frame)
    return b


# === Polar Array_basic parameter setting ===
center = Point(0, 0, 0)
axis = Vector(0, 0, 1)
angle = math.radians(360 / 3)  # rotatie 120° every time
polar_bricks = []

# === lay bricks layer by layer（polar array first）===
for i_c, crv in enumerate(crvs):
    layer_bricks = []  # temporary save the primitive bricks

    params = param_list(crv, 6)
    if i_c % 2 == 0:  # even row
        for i_p, param in enumerate(params):
            if i_p % 7 == 1 or i_p % 7 == 5:  # horizontal bricks
                b = get_h_brick(crv, param)
                layer_bricks.append(b)
            if i_p % 7 == 3:  # vertical bricks
                b = get_v_brick(crv, param)
                layer_bricks.append(b)

    if i_c % 2 == 1:  # odd row
        for i_p, param in enumerate(params):
            if i_p % 7 == 1 or i_p % 7 == 5:  # horizontal bricks
                b = get_v_brick(crv, param-4)
                layer_bricks.append(b)
            if i_p % 7 == 3:  # vertical bricks
                b = get_h_brick(crv, param-5)
                layer_bricks.append(b)

    # === polar array ===
    for i in range(3):  # 3 groups (0°,120°,240°)
        R = Rotation.from_axis_and_angle(axis, angle * i, point=center)
        for b in layer_bricks:
            fr = b.frame
            r_fr = fr.transformed(R)
            bb = Brick(r_fr)
            polar_bricks.append(bb.draw())
        
# === move the whole structure ===
# moving vector setting
move_vec = Vector(x, y, 0)
T = Translation.from_vector(move_vec)

moved_bricks = []
for b in polar_bricks:
    fr = b.frame
    m_fr = fr.transformed(T)
    moved_bricks.append(Brick(m_fr).draw())

# === Flip frames  ===
way_frame = []
for b in moved_bricks:
    fr = b.frame
    if fr.zaxis.z > 0:
        fr.flip()
    way_frame.append(fr)

print("Total bricks after layered polar array:", len(moved_bricks))
# ---------- end py3_14 ----------
draw_40 = COMPASDraw(cg=py3_14.points)  # -> rg; disabled; same code as draw
draw_41 = COMPASDraw(cg=py3_14.way_frame)  # -> rg; disabled; same code as draw
draw_42 = COMPASDraw(cg=py3_14.polar_bricks)  # -> rg; disabled; same code as draw
draw_43 = COMPASDraw(cg=py3_14.moved_bricks)  # -> rg; disabled; same code as draw
number_slider_45 = Slider(0, range=0..100)  # disabled
item_27 = ListItem(List=draw_41, Index=0, Wrap=True)  # -> Item, Item1, Item2; disabled
swatch_10 = ColourSwatch(SwatchColor=RGB(186, 98, 39))  # disabled
swatch_11 = ColourSwatch(SwatchColor=RGB(186, 98, 39))  # disabled
pl_13 = ConstructPlane(Origin=item_27.Item, XAxis=item_27.Item1, YAxis=item_27.Item2)  # disabled
item_28 = ListItem(List=flatten(pl_13), Index=number_slider_45, Wrap=True)  # disabled
preview_16 = CustomPreview(Geometry=draw_42, Material=swatch_10)  # disabled
preview_17 = CustomPreview(Geometry=draw_43, Material=swatch_11)  # disabled

# ---- group: final tri pod
# polar array location???
number_slider_46 = Slider(100, range=0..100)
crv_v2 = Curve([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])
crv_v1 = Curve([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])
py3_15 = Python3Script(curves=crv_v2, x=number_slider_46, y=Slider(95, range=0..100))  # -> out, points, primitive_bricks, way_frame, polar_bricks, moved_bricks; inputs curves: list of Curve, x: Double, y: Double
# ---------- py3_15: Python ----------
# r: compas
# venv: mas-2526
from compas_rhino.devtools import DevTools
DevTools.ensure_path()

import math
from compas.geometry import Box, Point, Frame, Vector, cross_vectors, Rotation, Translation
from compas_rhino.conversions import curve_to_compas
from brick_wall_2 import Brick

crvs = []
points = []
bricks = []

# convert curves to compas
for c in curves:
    crvs.append(curve_to_compas(c))

# build param list for curves
def param_list(curve, num_div):
    params = curve.divide_by_count(num_div)
    return params

def get_h_brick(curve, param):  # horizontal bricks
    pt = curve.point_at(param)
    points.append(pt)
    tan = crv.tangent_at(param)
    nor = tan.cross(Vector(0, 0, 1))
    frame = Frame(pt, tan, nor)
    b = Brick(frame)
    return b


def get_v_brick(curve, param):  # vertical bricks
    pt = curve.point_at(param)
    points.append(pt)
    tan = crv.tangent_at(param)
    nor = tan.cross(Vector(0, 0, 1))
    frame = Frame(pt, nor, tan)
    b = Brick(frame)
    return b


# === Polar Array_basic parameter setting ===
center = Point(-7.5, 7.5, 0)

axis = Vector(0, 0, 1)
angle = math.radians(360 / 3)  # rotatie 120° every time
polar_bricks = []

# === lay bricks layer by layer（polar array first）===
for i_c, crv in enumerate(crvs):
    layer_bricks = []  # temporary save the primitive bricks

    n = 5
    params = param_list(crv, n)
    if i_c % 2 == 0:  # even row
        for i_p, param in enumerate(params):
            if i_p % (n+1) == 1 or i_p % (n+1) == 5:  # horizontal bricks
                b = get_h_brick(crv, param)
                layer_bricks.append(b)
            if i_p % (n+1) == 3:  # vertical bricks
                b = get_v_brick(crv, param)
                layer_bricks.append(b)

    if i_c % 2 == 1:  # odd row
        for i_p, param in enumerate(params):
            if i_p % (n+1) == 1 or i_p % (n+1) == 5:  # horizontal bricks
                b = get_v_brick(crv, param)
                layer_bricks.append(b)
            if i_p % (n+1) == 3:  # vertical bricks
                b = get_h_brick(crv, param)
                layer_bricks.append(b)

    # === polar array ===
    for i in range(3):  # 3 groups (0°,120°,240°)
        R = Rotation.from_axis_and_angle(axis, angle * i, point=center)
        for b in layer_bricks:
            fr = b.frame
            r_fr = fr.transformed(R)
            bb = Brick(r_fr)
            polar_bricks.append(bb.draw())
        
# === move the whole structure ===
# moving vector setting
move_vec = Vector(x, y, 0)
T = Translation.from_vector(move_vec)

moved_bricks = []
for b in polar_bricks:
    fr = b.frame
    m_fr = fr.transformed(T)
    moved_bricks.append(Brick(m_fr).draw())

# === Flip frames  ===
way_frame = []
for b in moved_bricks:
    fr = b.frame
    if fr.zaxis.z > 0:
        fr.flip()
    way_frame.append(fr)

print("Total bricks after layered polar array:", len(moved_bricks))
# ---------- end py3_15 ----------
draw_44 = COMPASDraw(cg=py3_15.primitive_bricks)  # -> rg; same code as draw
draw_45 = COMPASDraw(cg=py3_15.points)  # -> rg; same code as draw
draw_46 = COMPASDraw(cg=py3_15.polar_bricks)  # -> rg; same code as draw
draw_47 = COMPASDraw(cg=py3_15.way_frame)  # -> rg; same code as draw
draw_48 = COMPASDraw(cg=py3_15.moved_bricks)  # -> rg; same code as draw
item_29 = ListItem(List=draw_47, Index=0, Wrap=True)  # -> Item, Item1, Item2
pl_14 = ConstructPlane(Origin=item_29.Item, XAxis=item_29.Item1, YAxis=item_29.Item2)
item_30 = ListItem(List=flatten(pl_14), Index=Slider(0, range=0..100), Wrap=True)
preview_18 = CustomPreview(Geometry=draw_46, Material=ColourSwatch(SwatchColor=RGB(186, 98, 39)))
preview_19 = CustomPreview(Geometry=draw_48, Material=ColourSwatch(SwatchColor=RGB(186, 98, 39)))

# ----
draw_49 = COMPASDraw(cg=py3_14.primitive_bricks)  # -> rg; disabled; same code as draw

# ---- group: Convert Planes to URScript / TCP
pt_4 = ConstructPoint(XCoordinate="-2.22", YCoordinate="1.36", ZCoordinate="83.85")

# ---- group: Sim
create_tool = CreateTool(Name="Brick_Gripper", TCP=pt_4, Weight=Slider(0.5, range=0..10))  # -> Tool, TCP

# ---- group: Convert Planes to URScript
pt_5 = ConstructPoint(XCoordinate="11.40", YCoordinate="444.62", ZCoordinate="3.12")
pt_6 = ConstructPoint(XCoordinate="-18.04", YCoordinate="442.29", ZCoordinate="36.95")
pt_7 = ConstructPoint(XCoordinate="10.31", YCoordinate="452.95", ZCoordinate="5.85")
number_slider_47 = Slider(2, range=0..3)
number_slider_48 = Slider(2, range=0..3)
number_slider_49 = Slider(0.5, range=0..3)
number_slider_50 = Slider(0.5, range=0..3)
py3_16 = Python3Script(origin=pt_5, xaxis_pt=pt_6, xy_pt=pt_7)  # -> out, pick_frame; inputs origin: Point3d, xaxis_pt: Point3d, xy_pt: Point3d
# ---------- py3_16: Python ----------
from compas.geometry import Frame, Point
from compas.geometry import Rotation

from compas_rhino.conversions import point_to_compas
import math

origin = point_to_compas(origin)
xaxis_pt = point_to_compas(xaxis_pt)
xy_pt = point_to_compas(xy_pt)

#define pick frame
angle = math.radians(90)
pick_frame = Frame(origin, xaxis_pt - origin, xy_pt - origin)
pick_frame.rotate(angle, axis=pick_frame.normal, point=pick_frame.point)
# ---------- end py3_16 ----------
py3_17 = Python3Script(
    origin=pt_5,
    xaxis_pt=pt_6,
    xy_pt=pt_7,
    x=Slider(0.2, range=0..1),
    y=Slider(0.2, range=0..1),
    z=Slider(0.2, range=0..1),
    Flip=Toggle(False))  # -> out, pick_frame; inputs origin: Point3d, xaxis_pt: Point3d, xy_pt: Point3d, x: Double, y: Double, z: Double, Flip: Boolean
# ---------- py3_17: Python ----------
from compas.geometry import Frame, Point, Transformation, Vector, Translation
from compas.geometry import Rotation
import math as m

from compas_rhino.conversions import point_to_compas

origin = point_to_compas(origin)
xaxis_pt = point_to_compas(xaxis_pt)
xy_pt = point_to_compas(xy_pt)

#define pick frame
pick_frame = Frame(origin, xaxis_pt - origin, xy_pt - origin)

Vector_1 = pick_frame.xaxis
Vector_2 = pick_frame.yaxis
Vector_3 = pick_frame.normal

#pick_frame adjustments
T_1 = Translation.from_vector(Vector_1 * x)
T_2 = Translation.from_vector(Vector_2 * y)
T_3 = Translation.from_vector(Vector_3 * z)

R = Rotation.from_axis_and_angle(pick_frame.normal, m.radians(90), pick_frame.point)
R_Flip = Rotation.from_axis_and_angle(Vector_1, m.radians(180), pick_frame.point)

if Flip == True:
    pick_frame.transform(R_Flip)

pick_frame.transform(T_3 * T_2 * T_1 * R)

from compas_rhino import conversions
pick_frame_plane = conversions.frame_to_rhino(pick_frame)
# ---------- end py3_17 ----------
compas_draw_4 = COMPASDraw(cg=py3_17.pick_frame)  # -> rg; same code as draw
item_31 = ListItem(List=compas_draw_4, Index=0, Wrap=True)  # -> Item, Item1, Item2
compas_2 = Python3Script(
    way_frames=compas.transformed_planes,
    tcp_measured=pt_4,
    acceleration=number_slider_47,
    velocity=number_slider_48,
    pick_frame=py3_17.pick_frame)  # -> out, vis_frames, vis_planes, script; inputs way_frames: list, tcp_measured: Point3d, acceleration: Double, velocity: Double
# ---------- compas_2: Python ----------
from imp import reload
import sys
import os

#get current file path
path = ghenv.Component.OnPingDocument().FilePath
#get parent directory of the parent directory
parentdir = os.path.dirname(path)
#get src folder which contains classes
dire = os.path.join(parentdir,'src')

sys.path.append(dire)

import simple_ur_script as ur
reload(ur)

import utils 
reload(utils)

import simple_comm as com
reload(com)

import compas.geometry as cg
import math as m

# ===== Set global constants =======

IO = 4 #Global constant
PICK_SAFE_DIST = 50
SAFE_DIST = 125 # 75
# SAFE_DIST = 50

# =================================

script = "" #create empty string

def pickup_brick(script,pick_up_frame):
    frames = []
    
    safe_pick_up_frame = pick_up_frame.translated(-pick_up_frame.normal*PICK_SAFE_DIST)
    
    ## add to the path: go to the safe plane
    script += ur.move_l(safe_pick_up_frame, acceleration, velocity)
    frames.append(safe_pick_up_frame)
    
    ## add to the path: go to the pick up plane
    script += ur.move_l(pick_up_frame, acceleration, velocity)
    frames.append(pick_up_frame)
    
    ## add to the path: turn on the vacuum and wait 1 sec.
    script += ur.set_digital_out(IO,True)
    script += ur.sleep(1)

    # add to the path: go back to the safe_plane
    script += ur.move_l(safe_pick_up_frame, acceleration, velocity)
    frames.append(safe_pick_up_frame)
    
    return script, frames


def place_brick(script, place_frame):
    
    frames = []
    
    safe_place_frame = place_frame.translated(cg.Vector(0,0,1)*SAFE_DIST)
    
    # add to the path: go to the safe plane
    script += ur.move_l(safe_place_frame, acceleration, velocity)
    frames.append(safe_place_frame)
    
    # add to the path: go to the place plane
    script += ur.move_l(place_frame, acceleration, velocity)
    frames.append(place_frame)
    
    ## add to the path: turn off the vacuum and wait 1 second (hold the brick)
    script += ur.set_digital_out(IO,False)
    script += ur.sleep(1)
    
    # add to the path: go back to the safe plane
    script += ur.move_l(safe_place_frame, acceleration, velocity)
    frames.append(safe_place_frame)
    
    return script,frames


#if value given for tcp measured, then add line to script, otherwise it will take current tcp from robot
if tcp_measured is not None:
    script += ur.set_tcp_by_angles(tcp_measured.X, tcp_measured.Y, tcp_measured.Z, m.radians(0.0),m.radians(0.0),m.radians(0))


vis_frames = []
#add move_l commands in sequence to script for each way plane
for brick_frame in way_frames:
    script, p = pickup_brick(script,pick_frame)
    vis_frames.extend(p) #only to visualize the planes
    script, p = place_brick(script,brick_frame)
    vis_frames.extend(p)


#format the script to make it sendable
script = com.concatenate_script(script)

from compas_rhino import conversions
import Rhino.Geometry as rg

vis_planes = [conversions.frame_to_rhino(frame) for frame in vis_frames]
# ---------- end compas_2 ----------
pl_15 = ConstructPlane(Origin=item_31.Item, XAxis=item_31.Item1, YAxis=item_31.Item2)
compas_draw_5 = COMPASDraw(cg=compas_2.vis_frames)  # -> rg; same code as draw
pline = PolyLine(Vertices=compas_2.vis_planes, Closed=False)
points_2 = PointList(Points=compas_2.vis_planes, Size=Slider(4, range=0..10))

# ---- group: Sim / Approach
create_target = CreateTarget(Plane=compas_2.vis_planes, Tool=create_tool.Tool, IsCartesian=True)

# ---- group: Sim
robots_library = RobotsLibrary({"UR3e", "UR5e", "UR10e", "UR16e", "UR3", "UR5", "UR10", "UR20", "UR30"}, selected="UR10", Type=0)
load_robot_system = LoadRobotSystem(Name=robots_library, Base=PlaneXY(0, 0, 0))
number_slider_51 = Slider(0.343, range=0..1)
create_program = CreateProgram(Name="DefaultProgram", RobotSystem=load_robot_system, Targets=create_target, StepSize=1)  # -> Program, Code, Duration, Warnings, Errors
program_simulation = ProgramSimulation(Program=create_program.Program, Time=Slider(0.144, range=0..1), Normalized=True)  # -> SystemMeshes, JointRotations, Plane, Index, Time, Program, Errors
panel_12 = Panel(create_program.Warnings)
panel_13 = Panel(program_simulation.Errors)

# ----
geo = Geometry(program_simulation.Plane)

number_slider_52 = Slider(100, range=0..100)  # disabled
number_slider_53 = Slider(95, range=0..100)  # disabled
crv_4_2 = Curve(flatten([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]))  # disabled
crv_2_4 = Curve(flatten([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]))  # disabled
crv_3_2 = Curve(flatten([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]))  # disabled
crv_4_3 = Curve(flatten([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]))  # disabled
crv_1_3 = Curve([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])  # disabled
py3_18 = Python3Script(curves=crv_4_3, x=number_slider_52, y=number_slider_53)  # -> out, points, primitive_bricks, way_frame, polar_bricks, moved_bricks; inputs curves: list of Curve, x: Double, y: Double; disabled
# ---------- py3_18: Python ----------
# r: compas
# venv: mas-2526
from compas_rhino.devtools import DevTools
DevTools.ensure_path()

import math
from compas.geometry import Box, Point, Frame, Vector, cross_vectors, Rotation, Translation
from compas_rhino.conversions import curve_to_compas
from brick_wall_2 import Brick

crvs = []
points = []
bricks = []

# convert curves to compas
for c in curves:
    crvs.append(curve_to_compas(c))

# build param list for curves
def param_list(curve, num_div):
    params = curve.divide_by_count(num_div)
    return params

def get_h_brick(curve, param):  # horizontal bricks
    pt = curve.point_at(param)
    points.append(pt)
    tan = crv.tangent_at(param)
    nor = tan.cross(Vector(0, 0, 1))
    frame = Frame(pt, tan, nor)
    b = Brick(frame)
    return b


def get_v_brick(curve, param):  # vertical bricks
    pt = curve.point_at(param)
    points.append(pt)
    tan = crv.tangent_at(param)
    nor = tan.cross(Vector(0, 0, 1))
    frame = Frame(pt, nor, tan)
    b = Brick(frame)
    return b


# === Polar Array_basic parameter setting ===
center = Point(0, 0, 0)
axis = Vector(0, 0, 1)
angle = math.radians(360 / 3)  # rotatie 120° every time
polar_bricks = []

# === lay bricks layer by layer（polar array first）===
for i_c, crv in enumerate(crvs):
    layer_bricks = []  # temporary save the primitive bricks

    params = param_list(crv, 6)
    if i_c % 2 == 0:  # even row
        for i_p, param in enumerate(params):
            if i_p % 7 == 1 or i_p % 7 == 5:  # horizontal bricks
                b = get_h_brick(crv, param)
                layer_bricks.append(b)
            if i_p % 7 == 3:  # vertical bricks
                b = get_v_brick(crv, param)
                layer_bricks.append(b)

    if i_c % 2 == 1:  # odd row
        for i_p, param in enumerate(params):
            if i_p % 7 == 2 or i_p % 7 == 6:  # horizontal bricks
                b = get_h_brick(crv, param-6)
                layer_bricks.append(b)
            if i_p % 7 == 4:  # vertical bricks
                b = get_v_brick(crv, param-7)
                layer_bricks.append(b)

    # === polar array ===
    for i in range(3):  # 3 groups (0°,120°,240°)
        R = Rotation.from_axis_and_angle(axis, angle * i, point=center)
        for b in layer_bricks:
            fr = b.frame
            r_fr = fr.transformed(R)
            bb = Brick(r_fr)
            polar_bricks.append(bb.draw())
        
# === move the whole structure ===
# moving vector setting
move_vec = Vector(x, y, 0)
T = Translation.from_vector(move_vec)

moved_bricks = []
for b in polar_bricks:
    fr = b.frame
    m_fr = fr.transformed(T)
    moved_bricks.append(Brick(m_fr).draw())

# === Flip frames  ===
way_frame = []
for b in moved_bricks:
    fr = b.frame
    if fr.zaxis.z > 0:
        fr.flip()
    way_frame.append(fr)

print("Total bricks after layered polar array:", len(moved_bricks))
# ---------- end py3_18 ----------
draw_50 = COMPASDraw(cg=py3_18.primitive_bricks)  # -> rg; disabled; same code as draw
draw_51 = COMPASDraw(cg=py3_18.points)  # -> rg; disabled; same code as draw
draw_52 = COMPASDraw(cg=py3_18.polar_bricks)  # -> rg; disabled; same code as draw
draw_53 = COMPASDraw(cg=py3_18.way_frame)  # -> rg; disabled; same code as draw
draw_54 = COMPASDraw(cg=py3_18.moved_bricks)  # -> rg; disabled; same code as draw
number_slider_54 = Slider(0, range=0..100)  # disabled
item_32 = ListItem(List=draw_53, Index=0, Wrap=True)  # -> Item, Item1, Item2; disabled
swatch_12 = ColourSwatch(SwatchColor=RGB(186, 98, 39))  # disabled
swatch_13 = ColourSwatch(SwatchColor=RGB(186, 98, 39))  # disabled
pl_16 = ConstructPlane(Origin=item_32.Item, XAxis=item_32.Item1, YAxis=item_32.Item2)  # disabled
item_33 = ListItem(List=flatten(pl_16), Index=number_slider_54, Wrap=True)  # disabled
preview_20 = CustomPreview(Geometry=draw_52, Material=swatch_12)  # disabled
preview_21 = CustomPreview(Geometry=draw_54, Material=swatch_13)  # disabled

compas_3 = Python3Script(
    way_frames=compas.transformed_planes,
    tcp_measured=pt_4,
    acceleration=number_slider_47,
    velocity=number_slider_48,
    pick_frame=py3_17.pick_frame)  # -> out, vis_frames, vis_planes, script; inputs way_frames: list, tcp_measured: Point3d, acceleration: Double, velocity: Double; disabled
# ---------- compas_3: Python ----------
from imp import reload
import sys
import os

#get current file path
path = ghenv.Component.OnPingDocument().FilePath
#get parent directory of the parent directory
parentdir = os.path.dirname(path)
#get src folder which contains classes
dire = os.path.join(parentdir,'src')

sys.path.append(dire)

import simple_ur_script as ur
reload(ur)

import utils 
reload(utils)

import simple_comm as com
reload(com)

import compas.geometry as cg
import math as m
from compas.geometry import Frame

# ===== Set global constants =======

IO = 4 #Global constant
SAFE_DIST = 50
LIFT_DIST = 50

# =================================

script = "" #create empty string

def pickup_brick(script, pick_up_frame):
    frames = []
    
    # define safe pick plane
    safe_pick_up_frame = pick_up_frame.translated(-pick_up_frame.normal * SAFE_DIST)
    
    # define safe lift plane（lift after picking bricks）
    safe_lift_frame = Frame(
        [
        safe_pick_up_frame.point.x, 
        safe_pick_up_frame.point.y, 
        safe_pick_up_frame.point.z + LIFT_DIST],
        safe_pick_up_frame.xaxis,
        safe_pick_up_frame.yaxis
    )


    # === execution steps ===

    # 1️. go to safe pick up plane
    script += ur.move_l(safe_pick_up_frame, acceleration, velocity)
    frames.append(safe_pick_up_frame)

    # 2️. go down to pick up plane
    script += ur.move_l(pick_up_frame, acceleration, velocity)
    frames.append(pick_up_frame)

    # 3️. open suction cup
    script += ur.set_digital_out(IO, True)
    script += ur.sleep(1)

    # 4️. lift up to safe pick up plane
    script += ur.move_l(safe_pick_up_frame, acceleration, velocity)
    frames.append(safe_pick_up_frame)

    # 5️. lift up to safe lift plane
    script += ur.move_l(safe_lift_frame, acceleration, velocity)
    frames.append(safe_lift_frame)

    return script, frames

def place_brick(script, place_frame):
    
    frames = []
    
    safe_place_frame = place_frame.translated(cg.Vector(0,0,1)*SAFE_DIST)
    
    # add to the path: go to the safe plane
    script += ur.move_l(safe_place_frame, acceleration, velocity)
    frames.append(safe_place_frame)
    
    # add to the path: go to the place plane
    script += ur.move_l(place_frame, acceleration, velocity)
    frames.append(place_frame)
    
    ## add to the path: turn off the vacuum and wait 1 second (hold the brick)
    script += ur.set_digital_out(IO,False)
    script += ur.sleep(1)
    
    # add to the path: go back to the safe plane
    script += ur.move_l(safe_place_frame, acceleration, velocity)
    frames.append(safe_place_frame)
    
    return script,frames


#if value given for tcp measured, then add line to script, otherwise it will take current tcp from robot
if tcp_measured is not None:
    script += ur.set_tcp_by_angles(tcp_measured.X, tcp_measured.Y, tcp_measured.Z, m.radians(0.0),m.radians(0.0),m.radians(0))

vis_frames = []
# add move_l commands in sequence to script for each way plane
for brick_frame in way_frames:
    script, p = pickup_brick(script, pick_frame)
    vis_frames.extend(p)  # only to visualize the planes
    script, p = place_brick(script, brick_frame)
    vis_frames.extend(p)


#format the script to make it sendable
script = com.concatenate_script(script)

from compas_rhino import conversions
import Rhino.Geometry as rg

vis_planes = [conversions.frame_to_rhino(frame) for frame in vis_frames]
# ---------- end compas_3 ----------
compas_draw_6 = COMPASDraw(cg=compas_3.vis_frames)  # -> rg; disabled; same code as draw
item_34 = ListItem(List=compas_draw_6, Index=0, Wrap=True)  # -> flatten(Item); disabled
number_slider_55 = Slider(2, range=0..10)  # disabled
item_35 = ListItem(List=compas_draw_5, Index=0, Wrap=True)  # -> Item, Item1, Item2
pline_2 = PolyLine(Closed=False)

number_slider_56 = Slider(100, range=0..100)  # disabled
number_slider_57 = Slider(95, range=0..100)  # disabled
crv_5 = Curve(flatten([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]))  # disabled
crv_2_5 = Curve(flatten([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]))  # disabled
crv_3_3 = Curve(flatten([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]))  # disabled
crv_4_4 = Curve(flatten([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]))  # disabled
crv_1_4 = Curve([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])  # disabled
py3_19 = Python3Script(curves=crv_5, x=number_slider_56, y=number_slider_57)  # -> out, points, primitive_bricks, way_frame, polar_bricks, moved_bricks; inputs curves: list of Curve, x: Double, y: Double; disabled
# ---------- py3_19: Python ----------
# r: compas
# venv: mas-2526
from compas_rhino.devtools import DevTools
DevTools.ensure_path()

import math
from compas.geometry import Box, Point, Frame, Vector, cross_vectors, Rotation, Translation
from compas_rhino.conversions import curve_to_compas
from brick_wall_2 import Brick

crvs = []
points = []
bricks = []

# convert curves to compas
for c in curves:
    crvs.append(curve_to_compas(c))

# build param list for curves
def param_list(curve, num_div):
    params = curve.divide_by_count(num_div)
    return params

def get_h_brick(curve, param):  # horizontal bricks
    pt = curve.point_at(param)
    points.append(pt)
    tan = crv.tangent_at(param)
    nor = tan.cross(Vector(0, 0, 1))
    frame = Frame(pt, tan, nor)
    b = Brick(frame)
    return b


def get_v_brick(curve, param):  # vertical bricks
    pt = curve.point_at(param)
    points.append(pt)
    tan = crv.tangent_at(param)
    nor = tan.cross(Vector(0, 0, 1))
    frame = Frame(pt, nor, tan)
    b = Brick(frame)
    return b


# === Polar Array_basic parameter setting ===
center = Point(0, 0, 0)
axis = Vector(0, 0, 1)
angle = math.radians(360 / 3)  # rotatie 120° every time
polar_bricks = []

# === lay bricks layer by layer（polar array first）===
for i_c, crv in enumerate(crvs):
    layer_bricks = []  # temporary save the primitive bricks

    params = param_list(crv, 6)
    if i_c % 2 == 0:  # even row
        for i_p, param in enumerate(params):
            if i_p % 7 == 1 or i_p % 7 == 5:  # horizontal bricks
                b = get_h_brick(crv, param)
                layer_bricks.append(b)
            if i_p % 7 == 3:  # vertical bricks
                b = get_v_brick(crv, param)
                layer_bricks.append(b)

    if i_c % 2 == 1:  # odd row
        for i_p, param in enumerate(params):
            if i_p % 7 == 2 or i_p % 7 == 6:  # horizontal bricks
                b = get_v_brick(crv, param-14)
                layer_bricks.append(b)
            if i_p % 7 == 4:  # vertical bricks
                b = get_h_brick(crv, param-14)
                layer_bricks.append(b)

    # === polar array ===
    for i in range(3):  # 3 groups (0°,120°,240°)
        R = Rotation.from_axis_and_angle(axis, angle * i, point=center)
        for b in layer_bricks:
            fr = b.frame
            r_fr = fr.transformed(R)
            bb = Brick(r_fr)
            polar_bricks.append(bb.draw())
        
# === move the whole structure ===
# moving vector setting
move_vec = Vector(x, y, 0)
T = Translation.from_vector(move_vec)

moved_bricks = []
for b in polar_bricks:
    fr = b.frame
    m_fr = fr.transformed(T)
    moved_bricks.append(Brick(m_fr).draw())

# === Flip frames  ===
way_frame = []
for b in moved_bricks:
    fr = b.frame
    if fr.zaxis.z > 0:
        fr.flip()
    way_frame.append(fr)

print("Total bricks after layered polar array:", len(moved_bricks))
# ---------- end py3_19 ----------
draw_55 = COMPASDraw(cg=py3_19.primitive_bricks)  # -> rg; disabled; same code as draw
draw_56 = COMPASDraw(cg=py3_19.points)  # -> rg; disabled; same code as draw
draw_57 = COMPASDraw(cg=py3_19.polar_bricks)  # -> rg; disabled; same code as draw
draw_58 = COMPASDraw(cg=py3_19.way_frame)  # -> rg; disabled; same code as draw
draw_59 = COMPASDraw(cg=py3_19.moved_bricks)  # -> rg; disabled; same code as draw
number_slider_58 = Slider(0, range=0..100)  # disabled
item_36 = ListItem(List=draw_58, Index=0, Wrap=True)  # -> Item, Item1, Item2; disabled
swatch_14 = ColourSwatch(SwatchColor=RGB(186, 98, 39))  # disabled
swatch_15 = ColourSwatch(SwatchColor=RGB(186, 98, 39))  # disabled
pl_17 = ConstructPlane(Origin=item_36.Item, XAxis=item_36.Item1, YAxis=item_36.Item2)  # disabled
item_37 = ListItem(List=flatten(pl_17), Index=number_slider_58, Wrap=True)  # disabled
preview_22 = CustomPreview(Geometry=draw_57, Material=swatch_14)  # disabled
preview_23 = CustomPreview(Geometry=draw_59, Material=swatch_15)  # disabled

# ---- group: Send to Robot!
panel_14 = Panel(compas_2.script)

# ----
pl_18 = ConstructPlane(Origin=item_35.Item, XAxis=item_35.Item1, YAxis=item_35.Item2)
number_slider_59 = Slider(0, range=0..100)
points_3 = PointList(Points=item_34, Size=number_slider_55)  # disabled

# ---- group: Send to Robot! / Send UR script to Robot!
py3_20 = Python3Script(script=compas_2.script, ip_address="192.168.10.10", send=Button())  # -> out, a; inputs script: String, ip_address: String, send: Boolean
# ---------- py3_20: Python ----------
import simple_comm as com

if send:
    com.send_script(script,ip_address)
# ---------- end py3_20 ----------

# ----
pln_6 = Plane(flatten(pl_18))
item_38 = ListItem(List=pln_6, Index=Slider(13, range=0..20), Wrap=True)
