# Grasshopper definition 101_brick_to_robot_testing_2.gh (Grasshopper 1.0.8)

# ----
# Brick wal_5
#  (U-curve + rotate at a stable number)
crv_u_3 = Curve(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)
crv_u_2 = Curve(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)
crv_u_4 = Curve(<curve referenced from the Rhino model>)

end = EndPoints(Curve=crv_u_3)  # -> Start, End
ln = Line(StartPoint=end.Start, EndPoint=end.End)
midpt = CurveMiddle(Curve=ln)

py3 = Python3Script(
    crv=crv_u_3,
    cpt=midpt,
    num_layers=Slider(10, range=0..30),
    gap=Slider(1.5, range=0..10),
    cols=Slider(10, range=0..30),
    rotation=Slider(9, range=0..180))  # -> out, geometries, way_planes; inputs crv: Curve, cpt: Point3d, num_layers: Int32, gap: Double, cols: Int32, rotation: Double
# ---------- py3: Python ----------
# r: compas
# venv: mas-2526

from compas_rhino.devtools import DevTools
DevTools.ensure_path()

import math
from compas.geometry import Box, Point, Frame, Vector, cross_vectors, angle_vectors
from compas_rhino.conversions import curve_to_compas, point_to_compas
from brick_wall_2 import Brick

bricks = []

curve = curve_to_compas(crv)
print(curve.length())

num_divs = int(curve.length())/(Brick.LENGTH+gap) * 2
params, div_pts = curve.divide_by_count(num_divs, True)

for row in range(num_layers):
    for col, param in enumerate(params):
        pt = curve.point_at(param)
        pt = pt.translated([0,0, Brick.HEIGHT * row])
        tangent = curve.tangent_at(param)
        normal = cross_vectors(tangent, [0,0,1])

        # dispatch A,B row
        if row % 2 == 0:
            if col % 2 == 0:
                b = Brick(Frame(pt, tangent, normal))                
        else:
            if col % 2 == 1:                
                b = Brick(Frame(pt, tangent, normal))

        # rotation
        ccpt = point_to_compas(cpt)
        r_vec = Point(ccpt.x, ccpt.y, b.point.z) - (b.point)
        if row % 2 == 0 and col % 4 == 0:
            r_radian = angle_vectors(r_vec, b.frame.normal)
            r_degree = math.degrees(r_radian)
            b.rotate(r_degree)
        else:
            b.rotate(rotation)
        bricks.append(b)

# visualize and store brick data
geometries = []
way_planes = []

for brick in bricks:
    geometries.append(brick.draw())
    way_planes.append(brick.get_pick_frame())
# ---------- end py3 ----------
draw = COMPASDraw(cg=py3.way_planes)  # -> rg
#   port cg: The COMPAS geometry or datastructure to be drawn.
#   port rg: The Rhino geometry object.
# ---------- draw: Python ----------
# r: compas>=2.14.1
"""
Draws COMPAS geometry in Grasshopper.
"""

from typing import Any

import Grasshopper

from compas.scene import SceneObject


class CompasToRhinoGeometry(Grasshopper.Kernel.GH_ScriptInstance):
    def RunScript(self, cg):
        if not cg:
            return None

        return SceneObject(item=cg).draw()
# ---------- end draw ----------
draw_2 = COMPASDraw(cg=py3.geometries)  # -> rg; same code as draw
item = ListItem(List=draw, Index=0, Wrap=True)  # -> Item, Item1, Item2
preview = CustomPreview(
    Geometry=draw_2,
    Material={diffuse=RGB(221, 160, 221), emission=RGB(66, 48, 66), shine=0.5, specular=RGB(255, 255, 255), transparency=0})
pl = ConstructPlane(Origin=item.Item, XAxis=item.Item1, YAxis=item.Item2)
pln = Plane(pl)
