# Grasshopper definition 102_design_cross_column.gh (Grasshopper 1.0.8)

pt = ConstructPoint(XCoordinate=Slider(0, range=0..300), YCoordinate=Slider(0, range=0..200), ZCoordinate=0)
rectangle = Rectangle(Plane=pt, XSize="-600 to 600", YSize="-380 to 380", Radius=0)  # -> Rectangle, Length

rotate = Rotate(Geometry=rectangle.Rectangle, Angle=degrees(Slider(30, range=0..100)), Plane=PlaneXY(0, 0, 0))  # -> Geometry, Transform

# ---- group: This is needed only ONCE in the GH definition
enable_auto_reload = Python3Script()  # -> ok
# ---------- enable_auto_reload: Python ----------
"""
------------------------------
Using VS Code as Python editor
------------------------------

The simplest way to start using VS Code as our editor, is
to place our Python code in files located IN THE SAME FOLDER as our Grasshopper file.

After we have done that, we need 2 steps: 

1. Enable the COMPAS reloader on one component. This tells Grasshopper to watch for changes in the Pythoh files and reload if changed.
2. Every other component that uses Python code from external files needs to start with a method to ensure Grasshopper knows where to load the files from.

"""
# r: compas
# venv: mas-2526

from compas_rhino.devtools import DevTools
DevTools.enable_reloader()
# ---------- end enable_auto_reload ----------

# ----
number_slider = Slider(3, range=0..10)  # disabled
number_slider_2 = Slider(5, range=0..10)  # disabled
number_slider_3 = Slider(4, range=0..50)  # disabled
number_slider_4 = Slider(18, range=0..100)  # disabled
number_slider_5 = Slider(60, range=0..100)  # disabled
number_slider_6 = Slider(15, range=0..100)  # disabled
gap = Slider(15, range=0..30)  # disabled
py3 = Python3Script(
    num_layers=number_slider_3,
    gap=gap,
    h_num_bricks=number_slider_2,
    v_num_bricks=number_slider,
    rot=number_slider_6,
    u=number_slider_4,
    v=number_slider_5)  # -> out, lines, polylines, center, frames, geo, h_l; inputs num_layers: Int32, gap: Double, h_num_bricks: Int32, v_num_bricks: Int32, rot: Double, u: Double, v: Double; disabled
# ---------- py3: Python ----------
# r: compas
# venv: mas-2526

from compas_rhino.devtools import DevTools
DevTools.enable_reloader()

import math
from compas.geometry import Box, Point, Frame
from compas.geometry import Polygon, Polyline, Vector, Line
from brick_wall import BigBrick, Brick

# Make curve as a triangle that is equal to the brick size
unit_div = ((BigBrick.LENGTH + BigBrick.WIDTH)/2) + gap

h_total_length = unit_div * h_num_bricks
v_total_length = unit_div * v_num_bricks
x = (h_total_length) / 2
y = (v_total_length) / 2

p1 = (-x, 0, 0)
p2 = (x, 0, 0)
p3 = (0, y, 0)
p4 = (0, -y, 0)
h_l = Line(p1, p2)
v_l = Line(p3, p4)

h_pl = h_l.to_polyline()
h_num_divs = int(h_l.length / unit_div)
v_pl = v_l.to_polyline()
v_num_divs = int(v_l.length / unit_div)


h_para_list = []
for d in range(h_num_divs):
    h_para_list.append(1 / h_num_divs * d)
print(h_para_list)

v_para_list = []
for d in range(v_num_divs):
    v_para_list.append(1 / v_num_divs * d)
print(v_para_list)

para_list = []
def paras(num_divs):
    for d in range(num_divs):
        para_list.append(1 / num_divs * d)
    return para_list
    
bricks = []
def h_brick(line, param): # horizontal brick
        pt = line.point_at(param)
        tan = h_pl.tangent_at(param)
        cross = tan.cross(Vector(0,0,1))
        fr = Frame(pt, xaxis = tan, yaxis = cross)
        b = BigBrick(fr)
        bricks.append(b)
        return bricks

def v_brick(line, param): # vertical brick
        pt = line.point_at(param)
        tan = v_pl.tangent_at(param)
        cross = tan.cross(Vector(0,0,1))
        fr = Frame(pt, xaxis = cross, yaxis = tan)
        b = BigBrick(fr)
        bricks.append(b)
        return bricks

def lns(ln_1, row):
    ln = ln_1.translated([0,0,BigBrick.HEIGHT * row])
    return ln

lines = []
for row in range(num_layers):
    h_ln = lns(h_l, row)
    lines.append(h_ln)
    v_ln = lns(v_l, row)
    lines.append(v_ln)
    h_para_list = paras(h_num_bricks)
    v_para_list = paras(v_num_bricks)
    if row % 2 == 0:        
        for i, par in zip(h_para_list, v_para_list):
            if i % 2 == 0: # horizontal
                h_brick(h_ln,par)
                h_brick(v_ln,par)
            else: # vertical
                v_brick(h_ln,par)
                v_brick(v_ln,par)
    else:
        for i, par in enumerate(h_para_list):
            if i % 2 == 0: # vertical
                v_brick(h_ln,par)
                v_brick(v_ln,par)
            else: # horizontal
                h_brick(h_ln,par)
                h_brick(v_ln,par)

geo = []
for br in bricks:
    geo.append(br.draw())

               
frames = []
for b in bricks:
    fr = b.frame
    if fr.zaxis.z > 0:
        fr.flip()
    frames.append(fr)
# ---------- end py3 ----------
multiplication = Multiplication(A=number_slider_3, B=number_slider)  # disabled
panel = Panel(multiplication)  # disabled
number_slider_7 = Slider(3, range=0..10)  # disabled
draw = COMPASDraw(cg=py3.lines)  # -> rg; disabled
#   port cg: The COMPAS geometry or datastructure to be drawn.
#   port rg: The Rhino geometry object.
# ---------- draw: Python ----------
# r: compas>=2.14.1
"""
Draws COMPAS geometry in Grasshopper.
"""

from typing import Any

import Grasshopper

from compas.scene import SceneObject


class CompasToRhinoGeometry(Grasshopper.Kernel.GH_ScriptInstance):
    def RunScript(self, cg):
        if not cg:
            return None

        return SceneObject(item=cg).draw()
# ---------- end draw ----------
draw_2 = COMPASDraw(cg=py3.polylines)  # -> rg; disabled; same code as draw
draw_3 = COMPASDraw(cg=py3.center)  # -> rg; disabled; same code as draw
draw_4 = COMPASDraw(cg=py3.frames)  # -> rg; disabled; same code as draw
draw_5 = COMPASDraw(cg=py3.geo)  # -> rg; disabled; same code as draw
draw_6 = COMPASDraw(cg=py3.h_l)  # -> rg; disabled; same code as draw
item = ListItem(List=draw_4, Index=0, Wrap=True)  # -> Item, Item1, Item2; disabled
swatch = ColourSwatch(SwatchColor=RGB(196, 175, 106))  # disabled
item_2 = ListItem(List=draw_5, Index=number_slider_7, Wrap=True)  # disabled
pl = ConstructPlane(Origin=item.Item, XAxis=item.Item1, YAxis=item.Item2)  # disabled
preview = CustomPreview(Geometry=draw_5, Material=swatch)  # disabled
number_slider_8 = Slider(12, range=0..20)  # disabled
item_3 = ListItem(List=draw_5, Index=number_slider_8, Wrap=True)  # disabled

number_slider_9 = Slider(7, range=0..10)  # disabled
item_4 = ListItem(List=draw, Index=number_slider_9, Wrap=True)  # disabled

number_slider_10 = Slider(3, range=0..10)  # disabled
number_slider_11 = Slider(5, range=0..10)  # disabled
number_slider_12 = Slider(4, range=0..50)  # disabled
number_slider_13 = Slider(18, range=0..100)  # disabled
number_slider_14 = Slider(60, range=0..100)  # disabled
number_slider_15 = Slider(15, range=0..100)  # disabled
gap_2 = Slider(15, range=0..30)  # disabled
py3_2 = Python3Script(
    num_layers=number_slider_12,
    gap=gap_2,
    h_num_bricks=number_slider_11,
    v_num_bricks=number_slider_10,
    rot=number_slider_15,
    u=number_slider_13,
    v=number_slider_14)  # -> out, lines, polylines, center, frames, geo, h_l; inputs num_layers: Int32, gap: Double, h_num_bricks: Int32, v_num_bricks: Int32, rot: Double, u: Double, v: Double; disabled
# ---------- py3_2: Python ----------
# r: compas
# venv: mas-2526

from compas_rhino.devtools import DevTools
DevTools.enable_reloader()

import math
from compas.geometry import Box, Point, Frame, Line, Vector
from brick_wall import BigBrick

# === statistic calculation ===
unit_div = ((BigBrick.LENGTH + BigBrick.WIDTH) / 2) + gap

h_total_length = unit_div * h_num_bricks
v_total_length = unit_div * v_num_bricks
x = h_total_length / 2
y = v_total_length / 2

# horizontal line & vertical line
h_l = Line(Point(-x, 0, 0), Point(x, 0, 0))
v_l = Line(Point(0, -y, 0), Point(0, y, 0))

# === functions ===
def paras(num_divs): # parameters in division points
    return [d / num_divs for d in range(num_divs)]

def lns(line, row): # creating multi lines (zaxis*)
    return line.translated([0, 0, BigBrick.HEIGHT * row])

def h_brick(line, param): # horizontal bricks
    pt = line.point_at(param)
    tan = Vector(*line.direction) 
    """*line.direction"""
    cross = tan.cross(Vector(0, 0, 1))
    fr = Frame(pt, xaxis=tan, yaxis=cross)
    return BigBrick(fr)

def v_brick(line, param): # vertical bricks
    pt = line.point_at(param)
    tan = Vector(*line.direction)
    cross = tan.cross(Vector(0, 0, 1))
    fr = Frame(pt, xaxis=cross, yaxis=tan)
    return BigBrick(fr)

# === main loop：creating cross wall ===
bricks = []

for row in range(num_layers): # producing hor & ver lines on every layer
    h_ln = lns(h_l, row)
    v_ln = lns(v_l, row)

    h_para_list = paras(h_num_bricks)
    v_para_list = paras(v_num_bricks)

    if row % 2 == 0: # even row
        for par in h_para_list: # hor bricks
            bricks.append(h_brick(h_ln, par))
    else: # odd row
        for par in v_para_list: # ver bricks
            bricks.append(v_brick(v_ln, par))

# === frames' zaxis（facing down）===
frames = []
for b in bricks:
    if b.frame.zaxis.z > 0:
        b.frame.flip()
    frames.append(b.frame)

# === draw brick in rhino ===
geo = []
for br in bricks:
    geo.append(br.draw())
# ---------- end py3_2 ----------
multiplication_2 = Multiplication(A=number_slider_12, B=number_slider_10)  # disabled
panel_2 = Panel(multiplication_2)  # disabled
number_slider_16 = Slider(3, range=0..10)  # disabled
draw_7 = COMPASDraw(cg=py3_2.lines)  # -> rg; disabled; same code as draw
draw_8 = COMPASDraw(cg=py3_2.polylines)  # -> rg; disabled; same code as draw
draw_9 = COMPASDraw(cg=py3_2.center)  # -> rg; disabled; same code as draw
draw_10 = COMPASDraw(cg=py3_2.frames)  # -> rg; disabled; same code as draw
draw_11 = COMPASDraw(cg=py3_2.geo)  # -> rg; disabled; same code as draw
draw_12 = COMPASDraw(cg=py3_2.h_l)  # -> rg; disabled; same code as draw
item_5 = ListItem(List=draw_10, Index=0, Wrap=True)  # -> Item, Item1, Item2; disabled
swatch_2 = ColourSwatch(SwatchColor=RGB(196, 175, 106))  # disabled
item_6 = ListItem(List=draw_11, Index=number_slider_16, Wrap=True)  # disabled
pl_2 = ConstructPlane(Origin=item_5.Item, XAxis=item_5.Item1, YAxis=item_5.Item2)  # disabled
preview_2 = CustomPreview(Geometry=draw_11, Material=swatch_2)  # disabled
number_slider_17 = Slider(12, range=0..20)  # disabled
item_7 = ListItem(List=draw_11, Index=number_slider_17, Wrap=True)  # disabled

number_slider_18 = Slider(7, range=0..10)  # disabled
item_8 = ListItem(List=draw_7, Index=number_slider_18, Wrap=True)  # disabled

number_slider_19 = Slider(3, range=0..10)  # disabled
number_slider_20 = Slider(5, range=0..10)  # disabled
number_slider_21 = Slider(4, range=0..50)  # disabled
number_slider_22 = Slider(18, range=0..100)  # disabled
number_slider_23 = Slider(60, range=0..100)  # disabled
number_slider_24 = Slider(15, range=0..100)  # disabled
gap_3 = Slider(15, range=0..30)  # disabled
py3_3 = Python3Script(
    num_layers=number_slider_21,
    gap=gap_3,
    h_num_bricks=number_slider_20,
    v_num_bricks=number_slider_19,
    rot=number_slider_24,
    u=number_slider_22,
    v=number_slider_23)  # -> out, lines, polylines, center, frames, geo, h_l; inputs num_layers: Int32, gap: Double, h_num_bricks: Int32, v_num_bricks: Int32, rot: Double, u: Double, v: Double; disabled
# ---------- py3_3: Python ----------
# r: compas
# venv: mas-2526

from compas_rhino.devtools import DevTools
DevTools.enable_reloader()

import math
from compas.geometry import Box, Point, Frame, Line, Vector
from brick_wall import BigBrick

# === statistic calculation ===
unit_div = ((BigBrick.LENGTH + BigBrick.WIDTH) / 2) + gap

h_total_length = unit_div * h_num_bricks
v_total_length = unit_div * v_num_bricks
x = h_total_length / 2
y = v_total_length / 2

# horizontal line & vertical line
h_l = Line(Point(-x, 0, 0), Point(x, 0, 0))
v_l = Line(Point(0, -y, 0), Point(0, y, 0))

# === functions ===
def paras(num_divs): # parameters in division points
    return [d / num_divs for d in range(num_divs)]

def lns(line, row): # creating multi lines (zaxis*)
    return line.translated([0, 0, BigBrick.HEIGHT * row])

def h_brick(line, param): # horizontal bricks
    pt = line.point_at(param)
    tan = Vector(*line.direction) 
    """*line.direction"""
    cross = tan.cross(Vector(0, 0, 1))
    fr = Frame(pt, xaxis=tan, yaxis=cross)
    return BigBrick(fr)

def v_brick(line, param): # vertical bricks
    pt = line.point_at(param)
    tan = Vector(*line.direction)
    cross = tan.cross(Vector(0, 0, 1))
    fr = Frame(pt, xaxis=cross, yaxis=tan)
    return BigBrick(fr)

# === main loop：creating cross wall ===
bricks = []

for row in range(num_layers): # producing hor & ver lines on every layer
    h_ln = lns(h_l, row)
    v_ln = lns(v_l, row)

    h_para_list = paras(h_num_bricks)
    v_para_list = paras(v_num_bricks)

    if row % 2 == 0: # even row
        for i, par in enumerate(h_para_list): # hor line bricks
            if i % 2 == 0:
                bricks.append(h_brick(h_ln, par))
            else:
                bricks.append(v_brick(h_ln, par))
        for i, par in enumerate(v_para_list): # ver line bricks
            print(v_para_list)
            bricks.append(h_brick(v_ln, 0.2))
            bricks.append(h_brick(v_ln, 0.8))
    # else: # odd row
    #     for i, par in enumerate(v_para_list): # ver bricks
    #         bricks.append(v_brick(v_ln, par))

# === frames' zaxis（facing down）===
frames = []
for b in bricks:
    if b.frame.zaxis.z > 0:
        b.frame.flip()
    frames.append(b.frame)

# === draw brick in rhino ===
geo = []
for br in bricks:
    geo.append(br.draw())
# ---------- end py3_3 ----------
multiplication_3 = Multiplication(A=number_slider_21, B=number_slider_19)  # disabled
panel_3 = Panel(multiplication_3)  # disabled
number_slider_25 = Slider(3, range=0..10)  # disabled
draw_13 = COMPASDraw(cg=py3_3.lines)  # -> rg; disabled; same code as draw
draw_14 = COMPASDraw(cg=py3_3.polylines)  # -> rg; disabled; same code as draw
draw_15 = COMPASDraw(cg=py3_3.center)  # -> rg; disabled; same code as draw
draw_16 = COMPASDraw(cg=py3_3.frames)  # -> rg; disabled; same code as draw
draw_17 = COMPASDraw(cg=py3_3.geo)  # -> rg; disabled; same code as draw
draw_18 = COMPASDraw(cg=py3_3.h_l)  # -> rg; disabled; same code as draw
item_9 = ListItem(List=draw_16, Index=0, Wrap=True)  # -> Item, Item1, Item2; disabled
swatch_3 = ColourSwatch(SwatchColor=RGB(196, 175, 106))  # disabled
item_10 = ListItem(List=draw_17, Index=number_slider_25, Wrap=True)  # disabled
pl_3 = ConstructPlane(Origin=item_9.Item, XAxis=item_9.Item1, YAxis=item_9.Item2)  # disabled
preview_3 = CustomPreview(Geometry=draw_17, Material=swatch_3)  # disabled
number_slider_26 = Slider(12, range=0..20)  # disabled
item_11 = ListItem(List=draw_17, Index=number_slider_26, Wrap=True)  # disabled

number_slider_27 = Slider(7, range=0..10)  # disabled
item_12 = ListItem(List=draw_13, Index=number_slider_27, Wrap=True)  # disabled

number_slider_28 = Slider(2, range=0..50)  # disabled
gap_4 = Slider(30, range=0..100)  # disabled
number_slider_29 = Slider(5, range=0..10)  # disabled
number_slider_30 = Slider(3, range=0..10)  # disabled
py3_4 = Python3Script(num_layers=number_slider_28, gap=gap_4, h_num_bricks=number_slider_29, v_num_bricks=number_slider_30)  # -> out, lines, frames, Bricks; inputs num_layers: Int32, gap: Double, h_num_bricks: Int32, v_num_bricks: Int32; disabled
# ---------- py3_4: Python ----------
# r: compas
# venv: mas-2526

from compas_rhino.devtools import DevTools
DevTools.enable_reloader()

import math
from compas.geometry import Box, Point, Frame, Line, Vector
from brick_wall import BigBrick

# === statistic calculation ===
unit_div = ((BigBrick.LENGTH + BigBrick.WIDTH) / 2) + gap

h_total_length = unit_div * h_num_bricks
v_total_length = unit_div * v_num_bricks
x = h_total_length / 2
y = v_total_length / 2

# horizontal line & vertical line
h_l = Line(Point(-x, 0, 0), Point(x, 0, 0))
v_l = Line(Point(0, -y, 0), Point(0, y, 0))

# === functions ===
def paras(num_divs): # parameters in division points
    actual_num_divs = (num_divs * 2) + 1
    return [1/(actual_num_divs - 1) * d for d in range(actual_num_divs)]

def lns(line, row): # creating multi lines (zaxis*)
    return line.translated([0, 0, BigBrick.HEIGHT * row])

def h_brick(line, param): # horizontal bricks
    pt = line.point_at(param)
    tan = Vector(*line.direction) 
    """*line.direction"""
    cross = tan.cross(Vector(0, 0, 1))
    fr = Frame(pt, xaxis=tan, yaxis=cross)
    return BigBrick(fr)

def v_brick(line, param): # vertical bricks
    pt = line.point_at(param)
    tan = Vector(*line.direction)
    cross = tan.cross(Vector(0, 0, 1))
    fr = Frame(pt, xaxis=cross, yaxis=tan)
    return BigBrick(fr)

# === main loop：creating cross wall ===
lines = []
bricks = []
for row in range(num_layers): # producing hor & ver lines on every layer
    h_ln = lns(h_l, row)
    lines.append(h_ln)
    v_ln = lns(v_l, row)
    lines.append(v_ln)

    h_para_list = paras(h_num_bricks)
    v_para_list = paras(v_num_bricks)

    if row % 2 == 0: # even row
        for i, par in enumerate(h_para_list): # hor line bricks
            if i % 4 == 1:
                bricks.append(h_brick(h_ln, par))
            if i % 4 == 3:
                bricks.append(v_brick(h_ln, par))
        for i, par in enumerate(v_para_list): # ver line bricks
            if i % 4 == 1:
                bricks.append(h_brick(v_ln, par))
            if i != 3 and i % 4 == 3:
                bricks.append(v_brick(h_ln, par))
    else: # odd row
        for i, par in enumerate(h_para_list): # hor line bricks
            if i % 4 == 1:
                bricks.append(v_brick(h_ln, par))
            if i % 4 == 3:
                bricks.append(h_brick(h_ln, par))
        for i, par in enumerate(v_para_list): # ver line bricks
            if i % 4 == 1:
                bricks.append(v_brick(v_ln, par))
            if i != 3 and i % 4 == 3:
                bricks.append(h_brick(h_ln, par))

# === frames' zaxis（facing down）===
frames = []
for b in bricks:
    if b.frame.zaxis.z > 0:
        b.frame.flip()
    frames.append(b.frame)

# === draw brick in rhino ===
Bricks = []
for br in bricks:
    Bricks.append(br.draw())
# ---------- end py3_4 ----------
draw_19 = COMPASDraw(cg=py3_4.lines)  # -> rg; disabled; same code as draw
number_slider_31 = Slider(3, range=0..10)  # disabled
draw_20 = COMPASDraw(cg=py3_4.frames)  # -> rg; disabled; same code as draw
draw_21 = COMPASDraw(cg=py3_4.Bricks)  # -> rg; disabled; same code as draw
number_slider_32 = Slider(10, range=0..10)  # disabled
item_13 = ListItem(List=draw_20, Index=0, Wrap=True)  # -> Item, Item1, Item2; disabled
swatch_4 = ColourSwatch(SwatchColor=RGB(196, 175, 106))  # disabled
lng = ListLength(List=draw_21)  # disabled
num_bricks = Panel(lng)  # disabled
item_14 = ListItem(List=draw_21, Index=number_slider_32, Wrap=True)  # disabled
item_15 = ListItem(List=draw_19, Index=number_slider_31, Wrap=True)  # disabled
pl_4 = ConstructPlane(Origin=item_13.Item, XAxis=item_13.Item1, YAxis=item_13.Item2)  # disabled
preview_4 = CustomPreview(Geometry=draw_21, Material=swatch_4)  # disabled

gap_5 = Slider(60, range=0..100)
py3_5 = Python3Script(
    num_layers=Slider(10, range=0..50),
    gap=gap_5,
    h_num_bricks=Slider(5, range=0..10),
    v_num_bricks=Slider(3, range=0..10),
    rot=Slider(0, range=0..50),
    u=Slider(18, range=0..100),
    v=Slider(60, range=0..100))  # -> out, lines, frames, Bricks; inputs num_layers: Int32, gap: Double, h_num_bricks: Int32, v_num_bricks: Int32, rot: Double, u: Double, v: Double
# ---------- py3_5: Python ----------
# r: compas
# venv: mas-2526

from compas_rhino.devtools import DevTools
DevTools.enable_reloader()

import math
from compas.geometry import Box, Point, Frame, Line, Vector
from brick_wall import BigBrick

# === statistic calculation ===
unit_div = ((BigBrick.LENGTH + BigBrick.WIDTH) / 2) + gap

h_total_length = unit_div * h_num_bricks
v_total_length = unit_div * v_num_bricks
x = h_total_length / 2
y = v_total_length / 2

# horizontal line & vertical line
h_l = Line(Point(-x, 0, 0), Point(x, 0, 0))
v_l = Line(Point(0, -y, 0), Point(0, y, 0))

# === functions ===
def paras(num_divs): # parameters in division points
    actual_num_divs = (num_divs * 2) + 1
    return [1/(actual_num_divs - 1) * d for d in range(actual_num_divs)]

def lns(line, row, rotation = 0): # creating multi lines (zaxis*)
    ln = line.translated([0, 0, BigBrick.HEIGHT * row])
    ln = ln.rotated(math.radians(rotation * row), axis = Vector(0,0,1), point = ln.midpoint)
    return ln

def h_brick(line, param): # horizontal bricks
    pt = line.point_at(param)
    tan = Vector(*line.direction) 
    """*line.direction"""
    cross = tan.cross(Vector(0, 0, 1))
    fr = Frame(pt, xaxis=tan, yaxis=cross)
    return BigBrick(fr)

def v_brick(line, param): # vertical bricks
    pt = line.point_at(param)
    tan = Vector(*line.direction)
    cross = tan.cross(Vector(0, 0, 1))
    fr = Frame(pt, xaxis=cross, yaxis=tan)
    return BigBrick(fr)

# === main loop：creating cross wall ===
lines = []
bricks = []
for row in range(num_layers): # producing hor & ver lines on every layer
    h_ln = lns(h_l, row, rot)
    lines.append(h_ln)
    v_ln = lns(v_l, row, rot)
    lines.append(v_ln)

    h_para_list = paras(h_num_bricks)
    v_para_list = paras(v_num_bricks)
    print(len(v_para_list))

    e_h = 0.00
    if row % 2 == 0: # even row
        for i, par in enumerate(h_para_list): # hor line bricks
            if i % 4 == 1:
                bricks.append(h_brick(h_ln, par + e_h))
            if i % 4 == 3:
                bricks.append(v_brick(h_ln, par + 0.01 + e_h))
        for i, par in enumerate(v_para_list): # ver line bricks
            if i == 1:
                bricks.append(v_brick(v_ln, par + 0.02))
            if i == 5:
                bricks.append(v_brick(v_ln, par - 0.02))
            
    else: # odd row
        for i, par in enumerate(h_para_list): # hor line bricks
            if i != 5 and i % 4 == 1:
                bricks.append(v_brick(h_ln, par + 0.01))
            if i % 4 == 3:
                bricks.append(h_brick(h_ln, par))
        for i, par in enumerate(v_para_list): # ver line bricks
            if i == 1:
                bricks.append(h_brick(v_ln, par + 0.15))
            if i == 5:
                bricks.append(h_brick(v_ln, par - 0.15))

# === rotation ===


# === frames' zaxis（facing down）===
frames = []
for b in bricks:
    if b.frame.zaxis.z > 0:
        b.frame.flip()
    frames.append(b.frame)

# === draw brick in rhino ===
Bricks = []
for br in bricks:
    Bricks.append(br.draw())
# ---------- end py3_5 ----------
draw_22 = COMPASDraw(cg=py3_5.lines)  # -> rg; same code as draw
draw_23 = COMPASDraw(cg=py3_5.frames)  # -> rg; same code as draw
draw_24 = COMPASDraw(cg=py3_5.Bricks)  # -> rg; same code as draw
item_16 = ListItem(List=draw_23, Index=0, Wrap=True)  # -> Item, Item1, Item2
lng_2 = ListLength(List=draw_24)
num_bricks_2 = Panel(lng_2)
item_17 = ListItem(List=draw_24, Index=Slider(12, range=0..20), Wrap=True)
item_18 = ListItem(List=draw_22, Index=Slider(3, range=0..10), Wrap=True)
pl_5 = ConstructPlane(Origin=item_16.Item, XAxis=item_16.Item1, YAxis=item_16.Item2)
preview_5 = CustomPreview(Geometry=draw_24, Material=ColourSwatch(SwatchColor=RGB(196, 175, 106)))

# ---- group: cross_BigBrick
# BigBrick
number_slider_33 = Slider(3, range=0..10)
gap_6 = Slider(50, range=0..100)
py3_6 = Python3Script(
    num_layers=Slider(23, range=0..50),
    gap=gap_6,
    h_num_bricks=Slider(5, range=0..10),
    v_num_bricks=number_slider_33,
    rot_1=Slider(3, range=0..50),
    rot_2=Slider(3, range=0..50),
    rot_3=Slider(1.5, range=0..50),
    u=Slider(90, range=0..100),
    v=Slider(90, range=0..100))  # -> out, lines, frames, Bricks; inputs num_layers: Int32, gap: Double, h_num_bricks: Int32, v_num_bricks: Int32, rot_1: Double, rot_2: Double, rot_3: Double, u: Double, v: Double
# ---------- py3_6: Python ----------
# r: compas
# venv: mas-2526

from compas_rhino.devtools import DevTools
DevTools.enable_reloader()

import math
from compas.geometry import Box, Point, Frame, Line, Vector
from brick_wall import BigBrick

# === statistic calculation ===
unit_div = ((BigBrick.LENGTH + BigBrick.WIDTH) / 2) + gap

h_total_length = unit_div * h_num_bricks
v_total_length = unit_div * v_num_bricks
x = h_total_length / 2
y = v_total_length / 2

# horizontal line & vertical line
h_l = Line(Point(-x, 0, 0), Point(x, 0, 0))
v_l = Line(Point(0, -y, 0), Point(0, y, 0))

# === functions ===
def paras(num_divs): # parameters in division points
    actual_num_divs = (num_divs * 2) + 1
    return [1/(actual_num_divs - 1) * d for d in range(actual_num_divs)]

def lns(line, row, rotation = 0): # creating multi lines (zaxis*)
    ln = line.translated([0, 0, BigBrick.HEIGHT * row])
    ln = ln.rotated(math.radians(rotation * row), axis = Vector(0,0,1), point = ln.midpoint)
    return ln

def h_brick(line, param): # horizontal bricks
    pt = line.point_at(param)
    tan = Vector(*line.direction) 
    """*line.direction"""
    cross = tan.cross(Vector(0, 0, 1))
    fr = Frame(pt, xaxis=tan, yaxis=cross)
    return BigBrick(fr)

def v_brick(line, param): # vertical bricks
    pt = line.point_at(param)
    tan = Vector(*line.direction)
    cross = tan.cross(Vector(0, 0, 1))
    fr = Frame(pt, xaxis=cross, yaxis=tan)
    return BigBrick(fr)

# === main loop：creating cross wall ===
lines = []
bricks = []
frs = []
for row in range(num_layers): # producing hor & ver lines on every layer
    h_ln = lns(h_l, row, rot_1)
    lines.append(h_ln)
    v_ln = lns(v_l, row, rot_1)
    lines.append(v_ln)

    h_para_list = paras(h_num_bricks)
    v_para_list = paras(v_num_bricks)

    if row % 2 == 0: # even row
        for i, par in enumerate(h_para_list): # hor line bricks
            if i % 4 == 1:
                bricks.append(h_brick(h_ln, par))
            if i % 4 == 3:
                bricks.append(v_brick(h_ln, par + 0.02))
        for i, par in enumerate(v_para_list): # ver line bricks
            if i == 1:
                # bricks.append(v_brick(v_ln, par + 0.02))
                br = v_brick(v_ln, par + 0.02)
                br.rotate(rot_2 * row)
                bricks.append(br)
            if i == 5:
                # bricks.append(v_brick(v_ln, par - 0.02))
                br = v_brick(v_ln, par - 0.02)
                br.rotate(rot_3 * row)
                bricks.append(br)
            
    else: # odd row
        for i, par in enumerate(h_para_list): # hor line bricks
            if i == 1:
                bricks.append(v_brick(h_ln, par))
            if i % 4 == 3:
                bricks.append(h_brick(h_ln, par))
            if i == 9:
                bricks.append(v_brick(h_ln, par + 0.025))
        for i, par in enumerate(v_para_list): # ver line bricks
            if i == 1:
                bricks.append(h_brick(v_ln, par + 0.125))
            if i == 5:
                bricks.append(h_brick(v_ln, par - 0.125))

# === frames' zaxis（facing down）===
frames = []
for b in bricks:
    if b.frame.zaxis.z > 0:
        b.frame.flip()
    frames.append(b.frame)

# === draw brick in rhino ===
Bricks = []
for br in bricks:
    Bricks.append(br.draw())
# ---------- end py3_6 ----------
draw_25 = COMPASDraw(cg=py3_6.lines)  # -> rg; same code as draw
draw_26 = COMPASDraw(cg=py3_6.frames)  # -> rg; same code as draw
draw_27 = COMPASDraw(cg=py3_6.Bricks)  # -> rg; same code as draw
item_19 = ListItem(List=draw_26, Index=0, Wrap=True)  # -> Item, Item1, Item2
lng_3 = ListLength(List=draw_27)
num_bricks_3 = Panel(lng_3)
item_20 = ListItem(List=draw_27, Index=Slider(12, range=0..20), Wrap=True)
item_21 = ListItem(List=draw_25, Index=Slider(3, range=0..10), Wrap=True)
pl_6 = ConstructPlane(Origin=item_19.Item, XAxis=item_19.Item1, YAxis=item_19.Item2)
preview_6 = CustomPreview(Geometry=draw_27, Material=ColourSwatch(SwatchColor=RGB(196, 175, 106)))

# ----
gap_7 = Slider(70, range=0..100)
py3_7 = Python3Script(
    num_layers=Slider(20, range=0..50),
    gap=gap_7,
    h_num_bricks=Slider(5, range=0..10),
    v_num_bricks=Slider(3, range=0..10),
    rot=Slider(0, range=0..50),
    u=Slider(18, range=0..100),
    v=Slider(60, range=0..100))  # -> out, lines, frames, Bricks; inputs num_layers: Int32, gap: Double, h_num_bricks: Int32, v_num_bricks: Int32, rot: Double, u: Double, v: Double
# ---------- py3_7: Python ----------
# r: compas
# venv: mas-2526

from compas_rhino.devtools import DevTools
DevTools.enable_reloader()

import math
from compas.geometry import Box, Point, Frame, Line, Vector
from brick_wall import BigBrick

# === statistic calculation ===
unit_div = ((BigBrick.LENGTH + BigBrick.WIDTH) / 2) + gap

h_total_length = unit_div * h_num_bricks
v_total_length = unit_div * v_num_bricks
x = h_total_length / 2
y = v_total_length / 2

# horizontal line & vertical line
h_l = Line(Point(-x, 0, 0), Point(x, 0, 0))
v_l = Line(Point(0, -y, 0), Point(0, y, 0))

# === functions ===
def paras(num_divs): # parameters in division points
    actual_num_divs = (num_divs * 2) + 1
    return [1/(actual_num_divs - 1) * d for d in range(actual_num_divs)]

def lns(line, row, rotation = 0): # creating multi lines (zaxis*)
    ln = line.translated([0, 0, BigBrick.HEIGHT * row])
    ln = ln.rotated(math.radians(rotation * row), axis = Vector(0,0,1), point = ln.midpoint)
    return ln

def h_brick(line, param): # horizontal bricks
    pt = line.point_at(param)
    tan = Vector(*line.direction) 
    """*line.direction"""
    cross = tan.cross(Vector(0, 0, 1))
    fr = Frame(pt, xaxis=tan, yaxis=cross)
    return BigBrick(fr)

def v_brick(line, param): # vertical bricks
    pt = line.point_at(param)
    tan = Vector(*line.direction)
    cross = tan.cross(Vector(0, 0, 1))
    fr = Frame(pt, xaxis=cross, yaxis=tan)
    return BigBrick(fr)

# === main loop：creating cross wall ===
lines = []
bricks = []
for row in range(num_layers): # producing hor & ver lines on every layer
    h_ln = lns(h_l, row, rot)
    lines.append(h_ln)
    v_ln = lns(v_l, row, rot)
    lines.append(v_ln)

    h_para_list = paras(h_num_bricks)
    v_para_list = paras(v_num_bricks)

    if row % 2 == 0: # even row
        for i, par in enumerate(h_para_list): # hor line bricks
            if i % 4 == 1:
                bricks.append(h_brick(h_ln, par))
            if i % 4 == 3:
                bricks.append(v_brick(h_ln, par))
        for i, par in enumerate(v_para_list): # ver line bricks
            if i % 4 == 1:
                bricks.append(h_brick(v_ln, par))
            if i != 3 and i % 4 == 3:
                bricks.append(v_brick(v_ln, par))
    else: # odd row
        for i, par in enumerate(h_para_list): # hor line bricks
            if i % 4 == 1:
                bricks.append(v_brick(h_ln, par))
            if i % 4 == 3:
                bricks.append(h_brick(h_ln, par))
        for i, par in enumerate(v_para_list): # ver line bricks
            if i % 4 == 1:
                bricks.append(v_brick(v_ln, par))
            if i != 3 and i % 4 == 3:
                bricks.append(h_brick(v_ln, par))

# === rotation ===


# === frames' zaxis（facing down）===
frames = []
for b in bricks:
    if b.frame.zaxis.z > 0:
        b.frame.flip()
    frames.append(b.frame)

# === draw brick in rhino ===
Bricks = []
for br in bricks:
    Bricks.append(br.draw())
# ---------- end py3_7 ----------
draw_28 = COMPASDraw(cg=py3_7.lines)  # -> rg; same code as draw
draw_29 = COMPASDraw(cg=py3_7.frames)  # -> rg; same code as draw
draw_30 = COMPASDraw(cg=py3_7.Bricks)  # -> rg; same code as draw
item_22 = ListItem(List=draw_29, Index=0, Wrap=True)  # -> Item, Item1, Item2
lng_4 = ListLength(List=draw_30)
num_bricks_4 = Panel(lng_4)
item_23 = ListItem(List=draw_30, Index=Slider(10, range=0..10), Wrap=True)
item_24 = ListItem(List=draw_28, Index=Slider(3, range=0..10), Wrap=True)
pl_7 = ConstructPlane(Origin=item_22.Item, XAxis=item_22.Item1, YAxis=item_22.Item2)
preview_7 = CustomPreview(Geometry=draw_30, Material=ColourSwatch(SwatchColor=RGB(196, 175, 106)))

gap_8 = Slider(55, range=0..100)
py3_8 = Python3Script(
    num_layers=Slider(20, range=0..50),
    gap=gap_8,
    h_num_bricks=Slider(5, range=0..10),
    v_num_bricks=Slider(3, range=0..10),
    rot=Slider(0, range=0..50),
    u=Slider(18, range=0..100),
    v=Slider(60, range=0..100))  # -> out, lines, frames, Bricks; inputs num_layers: Int32, gap: Double, h_num_bricks: Int32, v_num_bricks: Int32, rot: Double, u: Double, v: Double
# ---------- py3_8: Python ----------
# r: compas
# venv: mas-2526

from compas_rhino.devtools import DevTools
DevTools.enable_reloader()

import math
from compas.geometry import Box, Point, Frame, Line, Vector
from brick_wall import BigBrick

# === statistic calculation ===
unit_div = ((BigBrick.LENGTH + BigBrick.WIDTH) / 2) + gap

h_total_length = unit_div * h_num_bricks
v_total_length = unit_div * v_num_bricks
x = h_total_length / 2
y = v_total_length / 2

# horizontal line & vertical line
h_l = Line(Point(-x, 0, 0), Point(x, 0, 0))
v_l = Line(Point(0, -y, 0), Point(0, y, 0))

# === functions ===
def paras(num_divs): # parameters in division points
    actual_num_divs = (num_divs * 2) + 1
    return [1/(actual_num_divs - 1) * d for d in range(actual_num_divs)]

def lns(line, row, rotation = 0): # creating multi lines (zaxis*)
    ln = line.translated([0, 0, BigBrick.HEIGHT * row])
    ln = ln.rotated(math.radians(rotation * row), axis = Vector(0,0,1), point = ln.midpoint)
    return ln

def h_brick(line, param): # horizontal bricks
    pt = line.point_at(param)
    tan = Vector(*line.direction) 
    """*line.direction"""
    cross = tan.cross(Vector(0, 0, 1))
    fr = Frame(pt, xaxis=tan, yaxis=cross)
    return BigBrick(fr)

def v_brick(line, param): # vertical bricks
    pt = line.point_at(param)
    tan = Vector(*line.direction)
    cross = tan.cross(Vector(0, 0, 1))
    fr = Frame(pt, xaxis=cross, yaxis=tan)
    return BigBrick(fr)

# === main loop：creating cross wall ===
lines = []
bricks = []
for row in range(num_layers): # producing hor & ver lines on every layer
    h_ln = lns(h_l, row, rot)
    lines.append(h_ln)
    v_ln = lns(v_l, row, rot)
    lines.append(v_ln)

    h_para_list = paras(h_num_bricks)
    v_para_list = paras(v_num_bricks)

    if row % 2 == 0: # even row
        for i, par in enumerate(h_para_list): # hor line bricks
            if i % 4 == 1:
                bricks.append(h_brick(h_ln, par))
            if i % 4 == 3:
                bricks.append(v_brick(h_ln, par))
        for i, par in enumerate(v_para_list): # ver line bricks
            if i % 4 == 1:
                bricks.append(h_brick(v_ln, par))
            if i != 3 and i % 4 == 3:
                bricks.append(v_brick(v_ln, par))
    else: # odd row
        for i, par in enumerate(h_para_list): # hor line bricks
            if i % 4 == 0:
                bricks.append(v_brick(h_ln, par))
            if i % 4 == 2:
                bricks.append(h_brick(h_ln, par))
        for i, par in enumerate(v_para_list): # ver line bricks
            if i % 4 == 1:
                bricks.append(v_brick(v_ln, par))
            if i != 3 and i % 4 == 3:
                bricks.append(h_brick(v_ln, par))

# === rotation ===


# === frames' zaxis（facing down）===
frames = []
for b in bricks:
    if b.frame.zaxis.z > 0:
        b.frame.flip()
    frames.append(b.frame)

# === draw brick in rhino ===
Bricks = []
for br in bricks:
    Bricks.append(br.draw())
# ---------- end py3_8 ----------
draw_31 = COMPASDraw(cg=py3_8.lines)  # -> rg; same code as draw
draw_32 = COMPASDraw(cg=py3_8.frames)  # -> rg; same code as draw
draw_33 = COMPASDraw(cg=py3_8.Bricks)  # -> rg; same code as draw
item_25 = ListItem(List=draw_32, Index=0, Wrap=True)  # -> Item, Item1, Item2
lng_5 = ListLength(List=draw_33)
num_bricks_5 = Panel(lng_5)
item_26 = ListItem(List=draw_33, Index=Slider(10, range=0..10), Wrap=True)
item_27 = ListItem(List=draw_31, Index=Slider(3, range=0..10), Wrap=True)
pl_8 = ConstructPlane(Origin=item_25.Item, XAxis=item_25.Item1, YAxis=item_25.Item2)
preview_8 = CustomPreview(Geometry=draw_33, Material=ColourSwatch(SwatchColor=RGB(196, 175, 106)))

number_slider_34 = Slider(3, range=0..10)  # disabled
number_slider_35 = Slider(5, range=0..10)  # disabled
number_slider_36 = Slider(4, range=0..50)  # disabled
number_slider_37 = Slider(18, range=0..100)  # disabled
number_slider_38 = Slider(60, range=0..100)  # disabled
number_slider_39 = Slider(0, range=0..50)  # disabled
gap_9 = Slider(60, range=0..100)  # disabled
py3_9 = Python3Script(
    num_layers=number_slider_36,
    gap=gap_9,
    h_num_bricks=number_slider_35,
    v_num_bricks=number_slider_34,
    rot=number_slider_39,
    u=number_slider_37,
    v=number_slider_38)  # -> out, lines, frames, Bricks; inputs num_layers: Int32, gap: Double, h_num_bricks: Int32, v_num_bricks: Int32, rot: Double, u: Double, v: Double; disabled
# ---------- py3_9: Python ----------
# r: compas
# venv: mas-2526

from compas_rhino.devtools import DevTools
DevTools.enable_reloader()

import math
from compas.geometry import Box, Point, Frame, Line, Vector
from brick_wall import BigBrick

# === statistic calculation ===
unit_div = ((BigBrick.LENGTH + BigBrick.WIDTH) / 2) + gap

h_total_length = unit_div * h_num_bricks
v_total_length = unit_div * v_num_bricks
x = h_total_length / 2
y = v_total_length / 2

# horizontal line & vertical line
h_l = Line(Point(-x, 0, 0), Point(x, 0, 0))
v_l = Line(Point(0, -y, 0), Point(0, y, 0))

# === functions ===
def paras(num_divs): # parameters in division points
    actual_num_divs = (num_divs * 2) + 1
    return [1/(actual_num_divs - 1) * d for d in range(actual_num_divs)]

def even_paras(num_divs): # parameters in division points
    actual_num_divs = (num_divs * 2) + 1
    return [1/(actual_num_divs - 1) * d for d in range(actual_num_divs)]

def odd_paras(num_divs): # parameters in division points
    actual_num_divs = (num_divs * 2) + 1
    unit = (9.8-0.3)/(actual_num_divs - 1)
    return [1/(actual_num_divs - 1) * d * unit for d in range(actual_num_divs)]

def lns(line, row, rotation = 0): # creating multi lines (zaxis*)
    ln = line.translated([0, 0, BigBrick.HEIGHT * row])
    ln = ln.rotated(math.radians(rotation * row), axis = Vector(0,0,1), point = ln.midpoint)
    return ln

def h_brick(line, param): # horizontal bricks
    pt = line.point_at(param)
    tan = Vector(*line.direction) 
    """*line.direction"""
    cross = tan.cross(Vector(0, 0, 1))
    fr = Frame(pt, xaxis=tan, yaxis=cross)
    return BigBrick(fr)

def v_brick(line, param): # vertical bricks
    pt = line.point_at(param)
    tan = Vector(*line.direction)
    cross = tan.cross(Vector(0, 0, 1))
    fr = Frame(pt, xaxis=cross, yaxis=tan)
    return BigBrick(fr)

# === main loop：creating cross wall ===
lines = []
bricks = []
for row in range(num_layers): # producing hor & ver lines on every layer
    h_ln = lns(h_l, row, rot)
    lines.append(h_ln)
    v_ln = lns(v_l, row, rot)
    lines.append(v_ln)

    # h_para_list = paras(h_num_bricks)
    e_h_para_list = even_paras(h_num_bricks)
    o_h_para_list = odd_paras(h_num_bricks)
    v_para_list = paras(v_num_bricks)

    if row % 2 == 0: # even row
        for i, par in enumerate(e_h_para_list): # hor line bricks
            if i % 4 == 1:
                bricks.append(h_brick(h_ln, par))
            if i % 4 == 3:
                bricks.append(v_brick(h_ln, par))
        for i, par in enumerate(v_para_list): # ver line bricks
            if i % 4 == 1:
                bricks.append(h_brick(v_ln, par))
            if i != 3 and i % 4 == 3:
                bricks.append(v_brick(v_ln, par))
    else: # odd row
        h_n = 0.025
        v_n = 0.1
        for i, par in enumerate(o_h_para_list): # hor line bricks
            if i == 0:
                bricks.append(v_brick(h_ln, par + h_n))
            if i != 0 and i % 4 == 0:
                bricks.append(v_brick(h_ln, par))
            if i % 4 == 2:
                bricks.append(h_brick(h_ln, par))
        for i, par in enumerate(v_para_list): # ver line bricks
            if i == 2:
                bricks.append(h_brick(v_ln, par - v_n))
            if i == 4:
                bricks.append(h_brick(v_ln, par + v_n))

# === rotation ===


# === frames' zaxis（facing down）===
frames = []
for b in bricks:
    if b.frame.zaxis.z > 0:
        b.frame.flip()
    frames.append(b.frame)

# === draw brick in rhino ===
Bricks = []
for br in bricks:
    Bricks.append(br.draw())
# ---------- end py3_9 ----------
draw_34 = COMPASDraw(cg=py3_9.lines)  # -> rg; disabled; same code as draw
draw_35 = COMPASDraw(cg=py3_9.frames)  # -> rg; disabled; same code as draw
draw_36 = COMPASDraw(cg=py3_9.Bricks)  # -> rg; disabled; same code as draw
number_slider_40 = Slider(3, range=0..10)  # disabled
number_slider_41 = Slider(7, range=0..10)  # disabled
item_28 = ListItem(List=draw_35, Index=0, Wrap=True)  # -> Item, Item1, Item2; disabled
swatch_5 = ColourSwatch(SwatchColor=RGB(196, 175, 106))  # disabled
lng_6 = ListLength(List=draw_36)  # disabled
num_bricks_6 = Panel(lng_6)  # disabled
item_29 = ListItem(List=draw_36, Index=number_slider_41, Wrap=True)  # disabled
item_30 = ListItem(List=draw_34, Index=number_slider_40, Wrap=True)  # disabled
pl_9 = ConstructPlane(Origin=item_28.Item, XAxis=item_28.Item1, YAxis=item_28.Item2)  # disabled
preview_9 = CustomPreview(Geometry=draw_36, Material=swatch_5)  # disabled

# ---- group: cross_MiniBrick
# MiniBrick
number_slider_42 = Slider(3, range=0..10)
number_slider_43 = Slider(0, range=0..100)
gap_10 = Slider(5, range=0..100)
py3_10 = Python3Script(
    num_layers=Slider(23, range=0..30),
    gap=gap_10,
    h_num_bricks=Slider(5, range=0..10),
    v_num_bricks=number_slider_42,
    rot_1=Slider(3, range=0..50),
    rot_2=Slider(3, range=0..50),
    rot_3=Slider(1.5, range=0..50),
    u=Slider(90, range=0..100),
    v=Slider(90, range=0..100))  # -> out, lines, frames, Bricks; inputs num_layers: Int32, gap: Double, h_num_bricks: Int32, v_num_bricks: Int32, rot_1: Double, rot_2: Double, rot_3: Double, u: Double, v: Double
# ---------- py3_10: Python ----------
# r: compas
# venv: mas-2526

from compas_rhino.devtools import DevTools
DevTools.enable_reloader()

import math
from compas.geometry import Box, Point, Frame, Line, Vector
from brick_wall import Brick, BigBrick

# === statistic calculation ===
unit_div = ((Brick.LENGTH + Brick.WIDTH) / 2) + gap

h_total_length = unit_div * h_num_bricks
v_total_length = unit_div * v_num_bricks
x = h_total_length / 2
y = v_total_length / 2

# horizontal line & vertical line
h_l = Line(Point(-x+u, 0+v, 0), Point(x+u, 0+v, 0))
v_l = Line(Point(0+u, -y+v, 0), Point(0+u, y+v, 0))

# === functions ===
def paras(num_divs): # parameters in division points
    actual_num_divs = (num_divs * 2) + 1
    return [1/(actual_num_divs - 1) * d for d in range(actual_num_divs)]

def lns(line, row, rotation = 0): # creating multi lines (zaxis*)
    ln = line.translated([0, 0, Brick.HEIGHT * row])
    ln = ln.rotated(math.radians(rotation * row), axis = Vector(0,0,1), point = ln.midpoint)
    return ln

def h_brick(line, param): # horizontal bricks
    pt = line.point_at(param)
    tan = Vector(*line.direction) 
    """*line.direction"""
    cross = tan.cross(Vector(0, 0, 1))
    fr = Frame(pt, xaxis=tan, yaxis=cross)
    return Brick(fr)

def v_brick(line, param): # vertical bricks
    pt = line.point_at(param)
    tan = Vector(*line.direction)
    cross = tan.cross(Vector(0, 0, 1))
    fr = Frame(pt, xaxis=cross, yaxis=tan)
    return Brick(fr)

# === main loop：creating cross wall ===
lines = []
bricks = []
frs = []
for row in range(num_layers): # producing hor & ver lines on every layer
    h_ln = lns(h_l, row, rot_1)
    lines.append(h_ln)
    v_ln = lns(v_l, row, rot_1)
    lines.append(v_ln)

    h_para_list = paras(h_num_bricks)
    v_para_list = paras(v_num_bricks)

    n = 0.5
    e_para = 0.02 * n
    o_para_h = 0.025 * n
    o_para_v = 0.25 * n
    if row % 2 == 0: # even row
        for i, par in enumerate(h_para_list): # hor line bricks
            if i % 4 == 1:
                bricks.append(h_brick(h_ln, par))
            if i % 4 == 3:
                bricks.append(v_brick(h_ln, par + e_para))
        for i, par in enumerate(v_para_list): # ver line bricks
            if i == 1:
                # bricks.append(v_brick(v_ln, par + e_para))
                br = v_brick(v_ln, par + e_para)
                br.rotate(rot_2 * row)
                bricks.append(br)
            if i == 5:
                # bricks.append(v_brick(v_ln, par - e_para))
                br = v_brick(v_ln, par - e_para)
                br.rotate(rot_3 * row)
                bricks.append(br)
            
    else: # odd row
        for i, par in enumerate(h_para_list): # hor line bricks
            if i == 1:
                bricks.append(v_brick(h_ln, par))
            if i % 4 == 3:
                bricks.append(h_brick(h_ln, par))
            if i == 9:
                bricks.append(v_brick(h_ln, par + o_para_h))
        for i, par in enumerate(v_para_list): # ver line bricks
            if i == 1:
                bricks.append(h_brick(v_ln, par + o_para_v))
            if i == 5:
                bricks.append(h_brick(v_ln, par - o_para_v))

# === frames' zaxis（facing down）===
frames = []
for b in bricks:
    if b.frame.zaxis.z > 0:
        b.frame.flip()
    frames.append(b.frame)

# === draw brick in rhino ===
Bricks = []
for br in bricks:
    Bricks.append(br.draw())
# ---------- end py3_10 ----------
draw_37 = COMPASDraw(cg=py3_10.lines)  # -> rg; same code as draw
draw_38 = COMPASDraw(cg=py3_10.frames)  # -> rg; same code as draw
draw_39 = COMPASDraw(cg=py3_10.Bricks)  # -> rg; same code as draw
item_31 = ListItem(List=draw_38, Index=0, Wrap=True)  # -> Item, Item1, Item2
lng_7 = ListLength(List=draw_39)
num_bricks_7 = Panel(lng_7)
item_32 = ListItem(List=draw_39, Index=Slider(12, range=0..20), Wrap=True)
item_33 = ListItem(List=draw_37, Index=Slider(3, range=0..10), Wrap=True)
pl_10 = ConstructPlane(Origin=item_31.Item, XAxis=item_31.Item1, YAxis=item_31.Item2)
preview_10 = CustomPreview(Geometry=draw_39, Material=ColourSwatch(SwatchColor=RGB(196, 175, 106)))
