# Grasshopper definition 102_design_triangle_column.gh (Grasshopper 1.0.8)

py3 = Python3Script()  # -> out, a; disabled
# ---------- py3: Python ----------
# r: compas
# venv: mas-2526

from compas_rhino.devtools import DevTools
DevTools.enable_reloader()

import math
from brick_wall import Brick
# ---------- end py3 ----------

# ---- group: triangle tower_hor, ver_holes
number_slider = Slider(4, range=0..30)  # disabled
number_slider_2 = Slider(6, range=0..100)  # disabled
gap = Slider(4.5, range=0..10)  # disabled
number_slider_3 = Slider(0, range=0..100)  # disabled
py3_2 = Python3Script(num_layers=number_slider_2, gap=gap, num_bricks=number_slider, rot_ver=number_slider_3)  # -> out, poly, polylines, center, frames, bricks; inputs num_layers: Int32, gap: Double, num_bricks: Int32, rot_ver: Double; disabled
# ---------- py3_2: Python ----------
# r: compas
# venv: mas-2526

from compas_rhino.devtools import DevTools
DevTools.enable_reloader()

import math
from compas.geometry import Box, Point, Frame
from compas.geometry import Polygon, Polyline, Vector, Line
from brick_wall_2 import Brick

# Make curve as a triangle that is equal to the brick size
unit_div = ((Brick.LENGTH + Brick.WIDTH)/2) + gap
x = unit_div * num_bricks
y = x * math.sin(math.radians(60))

u = 45
v = 72
pt_1 = Point(0+u,0+v,0)
pt_2 = Point(x+u, 0+v, 0)
pt_3 = Point(x/2+u, y+v, 0)
center = Point(x/2+u, y/3+v, 0)

pt_list = [pt_1, pt_2, pt_3, pt_1]
poly = Polyline(pt_list)

# make skeleton curves & primitive bricks
vectors = []
bricks = []
polylines = []
p_l = []

def horizontal_brick(point):
    tan = polyline.tangent_at_point(point)
    cross = tan.cross(Vector(0,0,1))
    cross.unitize()
    cross.scale(Brick.WIDTH/2)
    new_pt = pt.translated(cross)
    b = Brick(Frame(new_pt, tan, cross))
    bricks.append(b.draw())
    return bricks

def vertical_brick(point):
    tan = polyline.tangent_at_point(point)
    cross = tan.cross(Vector(0,0,1))
    cross.unitize()
    cross.scale(Brick.WIDTH/2)
    new_pt = pt.translated(cross)
    b = Brick(Frame(new_pt, cross, tan))
    bricks.append(b.draw())
    return bricks

height = Brick.HEIGHT
for row in range(num_layers):
    polyline = poly.translated([0,0,height*row])
    polyline.rotate(math.radians(3*row), axis=Vector(0,0,1), point=center)
    polylines.append(polyline)
    points_list = polyline.divide_by_length(unit_div/2)
    print(len(points_list))

    for i, pt in enumerate(points_list):
        if row % 2 == 0:
            if i % 4 == 0: # vertical
                vertical_brick(pt)
            if i % 4 == 2: # horizontal
                horizontal_brick(pt)
        else:
            if i % 4 == 1: # horizontal
                horizontal_brick(pt)
            if i % 4 == 3: # vertical
                vertical_brick(pt)               
frames = []
for b in bricks:
    frame = b.frame
    if frame.zaxis.z > 0:
        frame.flip()
    frames.append(frame)
# ---------- end py3_2 ----------
multiplication = Multiplication(A=number_slider_2, B=number_slider)  # disabled
panel = Panel(multiplication)  # disabled
draw = COMPASDraw(cg=py3_2.poly)  # -> rg; disabled
#   port cg: The COMPAS geometry or datastructure to be drawn.
#   port rg: The Rhino geometry object.
# ---------- draw: Python ----------
# r: compas>=2.14.1
"""
Draws COMPAS geometry in Grasshopper.
"""

from typing import Any

import Grasshopper

from compas.scene import SceneObject


class CompasToRhinoGeometry(Grasshopper.Kernel.GH_ScriptInstance):
    def RunScript(self, cg):
        if not cg:
            return None

        return SceneObject(item=cg).draw()
# ---------- end draw ----------
draw_2 = COMPASDraw(cg=py3_2.polylines)  # -> rg; disabled; same code as draw
draw_3 = COMPASDraw(cg=py3_2.center)  # -> rg; disabled; same code as draw
draw_4 = COMPASDraw(cg=py3_2.frames)  # -> rg; disabled; same code as draw
draw_5 = COMPASDraw(cg=py3_2.bricks)  # -> rg; disabled; same code as draw
item = ListItem(List=draw_4, Index=0, Wrap=True)  # -> Item, Item1, Item2; disabled
swatch = ColourSwatch(SwatchColor=RGB(196, 175, 106))  # disabled
preview = CustomPreview(Geometry=draw_5, Material=swatch)  # disabled
pl = ConstructPlane(Origin=item.Item, XAxis=item.Item1, YAxis=item.Item2)  # disabled

# ----
number_slider_4 = Slider(9, range=0..30)  # disabled
gap_2 = Slider(3, range=0..10)  # disabled
curve = Curve(<curve referenced from the Rhino model>)  # disabled
brick_wall = Python3Script(crv=curve, num_layers=number_slider_4, gap=gap_2)  # -> bricks, geometries, way_planes; inputs crv: Curve, num_layers: Int32, gap: Double; disabled
# ---------- brick_wall: Python ----------
# r: compas
# venv: mas-2526
from compas_rhino.devtools import DevTools
DevTools.ensure_path()

# 0. Import everything we will need
import math
from compas.geometry import Box
from compas.geometry import Point
from compas.geometry import Frame
from compas.geometry import cross_vectors
from compas_rhino.conversions import curve_to_compas

# ..also import our module "brick_wall.py", that needs to be in the same folder as our GH file
from brick_wall import Brick

# 1. Start with an empty list of bricks to be created
#    make sure to match the name of this list to the output of this component!
bricks = []

# 2. Create points on each curve
curve = curve_to_compas(crv)
print(curve.length())

# divide curve twice as fine
num_divs = int(curve.length() / (Brick.LENGTH+gap)) * 2
params, div_pts = curve.divide_by_count(num_divs, True)

for row in range(num_layers):
    for col, param in enumerate(params,):
        pt = curve.point_at(param)
        pt = pt.translated([0,0,Brick.HEIGHT * row])
        tangent = curve.tangent_at(param)
        normal = cross_vectors(tangent, [0,0,1])
        # only place bricks on alternating divisions depending on the row
        if row % 2 == 0:  
            # even rows 
            if col % 2 == 0:
                b = Brick(frame = Frame(pt, tangent, normal))
                bricks.append(b)
        else:  
            # odd rows 
            if col % 2 == 1:
                b = Brick(frame = Frame(pt, tangent, normal))
                bricks.append(b)

# Visualize and store brick data
geometries = []
way_planes = []

for brick in bricks:
    geometries.append(brick.draw())
    way_planes.append(brick.get_pick_frame())
# ---------- end brick_wall ----------
compas_draw = COMPASDraw(cg=brick_wall.geometries)  # -> rg; disabled; same code as draw
compas_draw_2 = COMPASDraw(cg=brick_wall.way_planes)  # -> rg; disabled; same code as draw

# ---- group: test 1
number_slider_5 = Slider(4, range=0..30)  # disabled
number_slider_6 = Slider(38, range=0..100)  # disabled
gap_3 = Slider(3, range=0..10)  # disabled
py3_3 = Python3Script(num_layers=number_slider_6, gap=gap_3, num_bricks=number_slider_5)  # -> out, geometry, poly, polylines, center, frames; inputs num_layers: Int32, gap: Double, num_bricks: Int32; disabled
# ---------- py3_3: Python ----------
# r: compas
# venv: mas-2526

from compas_rhino.devtools import DevTools
DevTools.enable_reloader()

import math
from compas.geometry import Box, Point, Frame
from compas.geometry import Polygon, Polyline, Vector
from brick_wall import Brick

# Make curve as a triangle that is equal to the brick size
unit_div = Brick.LENGTH + gap
x = unit_div * num_bricks
y = x * math.sin(math.radians(60))
print(x, y)

pt_1 = Point(0,0,0)
pt_2 = Point(x, 0, 0)
pt_3 = Point(x/2, y, 0)
center = Point(x/2, y/3, 0)

pt_list = [pt_1, pt_2, pt_3, pt_1]
poly = Polyline(pt_list)

vectors = []
bricks = []
polylines = []

# make skeleton curves & primitive bricks
height = Brick.HEIGHT
for row in range(num_layers):
    polyline = poly.translated([0,0,height*row])
    polyline.rotate(math.radians(6*row), axis=Vector(0,0,1), point=center)
    polylines.append(polyline)
    points_list = polyline.divide_by_length(unit_div/2)
    for i, pt in enumerate(points_list):
        if i % 2 != 0:
            tan = polyline.tangent_at_point(pt)
            vectors.append(tan)
            cross = tan.cross(Vector(0,0,1))
            cross.unitize()
            cross.scale(Brick.WIDTH/2)
            new_pt = pt.translated(cross)
            brick = Brick(frame = Frame(new_pt, tan, cross))
            bricks.append(brick)

geometry = []
frames = []
for brick in bricks:
    b = brick.draw()
    frame = b.frame
    geometry.append(b)
    frames.append(frame)
# ---------- end py3_3 ----------
multiplication_2 = Multiplication(A=number_slider_6, B=number_slider_5)  # disabled
panel_2 = Panel(multiplication_2)  # disabled
draw_6 = COMPASDraw(cg=py3_3.geometry)  # -> rg; disabled; same code as draw
draw_7 = COMPASDraw(cg=py3_3.polylines)  # -> rg; disabled; same code as draw
draw_8 = COMPASDraw(cg=py3_3.center)  # -> rg; disabled; same code as draw
draw_9 = COMPASDraw(cg=py3_3.frames)  # -> rg; disabled; same code as draw
swatch_2 = ColourSwatch(SwatchColor=RGB(196, 175, 106))  # disabled
preview_2 = CustomPreview(Geometry=draw_6, Material=swatch_2)  # disabled

# ----
number_slider_7 = Slider(4, range=0..30)  # disabled
number_slider_8 = Slider(38, range=0..100)  # disabled
gap_4 = Slider(3, range=0..10)  # disabled
py3_4 = Python3Script(num_layers=number_slider_8, gap=gap_4, num_bricks=number_slider_7)  # -> out, geometry, poly, polylines, center, frames, points_inside, points_outside; inputs num_layers: Int32, gap: Double, num_bricks: Int32; disabled
# ---------- py3_4: Python ----------
# r: compas
# venv: mas-2526

from compas_rhino.devtools import DevTools
DevTools.enable_reloader()

import math
from compas.geometry import Box, Point, Frame
from compas.geometry import Polygon, Polyline, Vector
from brick_wall import Brick

# Make curve as a triangle that is equal to the brick size
unit_div = Brick.LENGTH + gap
x = unit_div * num_bricks
y = x * math.sin(math.radians(60))
print(x, y)

pt_1 = Point(0,0,0)
pt_2 = Point(x, 0, 0)
pt_3 = Point(x/2, y, 0)
center = Point(x/2, y/3, 0)

pt_list = [pt_1, pt_2, pt_3, pt_1]
poly = Polyline(pt_list)

# skeleton curves & primitive bricks
vectors = []
bricks = []
polylines = []

height = Brick.HEIGHT
for row in range(num_layers):
    polyline = poly.translated([0,0,height*row])
    polyline.rotate(math.radians(5*row), axis=Vector(0,0,1), point=center)
    polylines.append(polyline)
    points_list = polyline.divide_by_length(unit_div/2)
    for i, pt in enumerate(points_list):
        if i % 2 != 0:
            tan = polyline.tangent_at_point(pt)
            vectors.append(tan)
            cross = tan.cross(Vector(0,0,1))
            cross.unitize()
            cross.scale(Brick.WIDTH/2)
            new_pt = pt.translated(cross)
            brick = Brick(frame = Frame(new_pt, tan, cross))
            bricks.append(brick)

# draw bricks & frames
geometry = []
frames = []
for brick in bricks:
    b = brick.draw()
    frame = b.frame
    geometry.append(b)
    frames.append(frame)

def circle_points(center, radius=5.0, num_points=10):
    points = []
    for i in range(num_points):
        theta = 2 * math.pi * i / num_points  # angle from 0 to 2π
        x = center.x + radius * math.cos(theta)
        y = center.y + radius * math.sin(theta)
        points.append(Point(x, y, center.z))
    return points

r_in = (x/2)*math.tan(math.radians(60/2))
r_out = (x/2)/math.cos(math.radians(60/2))
points_inside = circle_points(center, radius=r_in, num_points=6)
points_inside.append(points_inside[0])
points_outside = circle_points(center, radius=r_out, num_points=3)
points_outside.append(points_outside[0])
points_in = circle_points(center, radius=r_in, num_points=3)
points_in.append(points_in[0])

polylines = [Polyline(points_inside), Polyline(points_outside), Polyline(points_in)]
# ---------- end py3_4 ----------
multiplication_3 = Multiplication(A=number_slider_8, B=number_slider_7)  # disabled
panel_3 = Panel(multiplication_3)  # disabled
draw_10 = COMPASDraw(cg=py3_4.geometry)  # -> rg; disabled; same code as draw
draw_11 = COMPASDraw(cg=py3_4.poly)  # -> rg; disabled; same code as draw
draw_12 = COMPASDraw(cg=py3_4.polylines)  # -> rg; disabled; same code as draw
draw_13 = COMPASDraw(cg=py3_4.center)  # -> rg; disabled; same code as draw
draw_14 = COMPASDraw(cg=py3_4.points_outside)  # -> rg; disabled; same code as draw
draw_15 = COMPASDraw(cg=py3_4.points_inside)  # -> rg; disabled; same code as draw
swatch_3 = ColourSwatch(SwatchColor=RGB(196, 175, 106))  # disabled
preview_3 = CustomPreview(Geometry=draw_10, Material=swatch_3)  # disabled

# ---- group: This is needed only ONCE in the GH definition
enable_auto_reload = Python3Script()  # -> ok
# ---------- enable_auto_reload: Python ----------
"""
------------------------------
Using VS Code as Python editor
------------------------------

The simplest way to start using VS Code as our editor, is
to place our Python code in files located IN THE SAME FOLDER as our Grasshopper file.

After we have done that, we need 2 steps: 

1. Enable the COMPAS reloader on one component. This tells Grasshopper to watch for changes in the Pythoh files and reload if changed.
2. Every other component that uses Python code from external files needs to start with a method to ensure Grasshopper knows where to load the files from.

"""
# r: compas
# venv: mas-2526

from compas_rhino.devtools import DevTools
DevTools.enable_reloader()
# ---------- end enable_auto_reload ----------

# ---- group: triangle tower_hor, ver_holes
number_slider_9 = Slider(4, range=0..30)  # disabled
number_slider_10 = Slider(1, range=0..100)  # disabled
gap_5 = Slider(4.5, range=0..10)  # disabled
number_slider_11 = Slider(15, range=0..100)  # disabled
py3_5 = Python3Script(num_layers=number_slider_10, gap=gap_5, num_bricks=number_slider_9, rot=number_slider_11)  # -> out, poly, polylines, center, frames, bricks; inputs num_layers: Int32, gap: Double, num_bricks: Int32, rot: Double; disabled
# ---------- py3_5: Python ----------
# r: compas
# venv: mas-2526

from compas_rhino.devtools import DevTools
DevTools.enable_reloader()

import math
from compas.geometry import Box, Point, Frame
from compas.geometry import Polygon, Polyline, Vector, Line
from brick_wall_2 import Brick

# Make curve as a triangle that is equal to the brick size
unit_div = ((Brick.LENGTH + Brick.WIDTH)/2) + gap
x = unit_div * num_bricks
y = x * math.sin(math.radians(60))

u = 45
v = 72
pt_1 = Point(0+u,0+v,0)
pt_2 = Point(x+u, 0+v, 0)
pt_3 = Point(x/2+u, y+v, 0)
center = Point(x/2+u, y/3+v, 0)

pt_list = [pt_1, pt_2, pt_3, pt_1]
poly = Polyline(pt_list)

# make skeleton curves & primitive bricks
vectors = []
bricks = []
polylines = []
p_l = []

def horizontal_brick(point, rotation=0):
    tan = polyline.tangent_at_point(point)
    cross = tan.cross(Vector(0,0,1))
    cross.unitize()
    cross.scale(Brick.WIDTH/2)
    new_pt = pt.translated(cross)
    b = Brick(Frame(new_pt, tan, cross))
    b.rotate(rotation)
    bricks.append(b.draw())
    return bricks

def vertical_brick(point, rotation=0):
    tan = polyline.tangent_at_point(point)
    cross = tan.cross(Vector(0,0,1))
    cross.unitize()
    cross.scale(Brick.WIDTH/2)
    new_pt = pt.translated(cross)
    b = Brick(Frame(new_pt, cross, tan))
    b.rotate(rotation)
    bricks.append(b.draw())
    return bricks

height = Brick.HEIGHT
for row in range(num_layers):
    polyline = poly.translated([0,0,height*row])
    polyline.rotate(math.radians(3*row), axis=Vector(0,0,1), point=center)
    polylines.append(polyline)
    points_list = polyline.divide_by_length(unit_div/2)
    print(len(points_list))

    for i, pt in enumerate(points_list):
        if row % 2 == 0:
            if i % 4 == 0: # vertical
                vertical_brick(pt)
            if i % 4 == 2: # horizontal
                horizontal_brick(pt)
        else:
            if i % 4 == 1: # horizontal
                horizontal_brick(pt)
            if i % 8 == 7: # vertical
                vertical_brick(pt, rot)               
frames = []
for b in bricks:
    frame = b.frame
    if frame.zaxis.z > 0:
        frame.flip()
    frames.append(frame)
# ---------- end py3_5 ----------
multiplication_4 = Multiplication(A=number_slider_10, B=number_slider_9)  # disabled
panel_4 = Panel(multiplication_4)  # disabled
draw_16 = COMPASDraw(cg=py3_5.bricks)  # -> rg; disabled; same code as draw
draw_17 = COMPASDraw(cg=py3_5.poly)  # -> rg; disabled; same code as draw
draw_18 = COMPASDraw(cg=py3_5.polylines)  # -> rg; disabled; same code as draw
draw_19 = COMPASDraw(cg=py3_5.center)  # -> rg; disabled; same code as draw
draw_20 = COMPASDraw(cg=py3_5.frames)  # -> rg; disabled; same code as draw
item_2 = ListItem(List=draw_20, Index=0, Wrap=True)  # -> Item, Item1, Item2; disabled
swatch_4 = ColourSwatch(SwatchColor=RGB(196, 175, 106))  # disabled
preview_4 = CustomPreview(Geometry=draw_16, Material=swatch_4)  # disabled
pl_2 = ConstructPlane(Origin=item_2.Item, XAxis=item_2.Item1, YAxis=item_2.Item2)  # disabled

# ---- group: test 2_hor, ver
number_slider_12 = Slider(4, range=0..30)  # disabled
number_slider_13 = Slider(37, range=0..100)  # disabled
gap_6 = Slider(3, range=0..10)  # disabled
number_slider_14 = Slider(15, range=0..100)  # disabled
py3_6 = Python3Script(num_layers=number_slider_13, gap=gap_6, num_bricks=number_slider_12, rot_ver=number_slider_14)  # -> out, poly, polylines, center, frames, bricks; inputs num_layers: Int32, gap: Double, num_bricks: Int32, rot_ver: Double; disabled
# ---------- py3_6: Python ----------
# r: compas
# venv: mas-2526

from compas_rhino.devtools import DevTools
DevTools.enable_reloader()

import math
from compas.geometry import Box, Point, Frame
from compas.geometry import Polygon, Polyline, Vector
from brick_wall import Brick

# Make curve as a triangle that is equal to the brick size
unit_div = (Brick.LENGTH + Brick.WIDTH)/2 + gap
x = unit_div * num_bricks
y = x * math.sin(math.radians(60))
# print(x, y)

pt_1 = Point(0,0,0)
pt_2 = Point(x, 0, 0)
pt_3 = Point(x/2, y, 0)
center = Point(x/2, y/3, 0)

pt_list = [pt_1, pt_2, pt_3, pt_1]
poly = Polyline(pt_list)

# make skeleton curves & primitive bricks
vectors = []
bricks = []
polylines = []
p_l = []

height = Brick.HEIGHT
for row in range(num_layers):
    polyline = poly.translated([0,0,height*row])
    polyline.rotate(math.radians(3*row), axis=Vector(0,0,1), point=center)
    polylines.append(polyline)
    points_list = polyline.divide_by_length(unit_div/2)

    for i, pt in enumerate(points_list):
        if row % 2 == 0:
            if i % 4 == 1: # horizontal bricks
                tan = polyline.tangent_at_point(pt)
                cross = tan.cross(Vector(0,0,1))
                cross.unitize()
                cross.scale(Brick.WIDTH/2)
                new_pt = pt.translated(cross)
                b = Brick(Frame(new_pt, tan, cross))
                bricks.append(b.draw())
            if i % 4 == 3: # vertical bricks
                tan = polyline.tangent_at_point(pt)
                cross = tan.cross(Vector(0,0,1))
                cross.unitize()
                cross.scale(Brick.WIDTH/2)
                new_pt = pt.translated(cross)
                b = Brick(Frame(new_pt, cross, tan))
                b.rotate(rot_ver)
                bricks.append(b.draw())
        else:
            if i % 4 == 2: # horizontal bricks
                tan = polyline.tangent_at_point(pt)
                cross = tan.cross(Vector(0,0,1))
                cross.unitize()
                cross.scale(Brick.WIDTH/2)
                new_pt = pt.translated(cross)
                b = Brick(Frame(new_pt, tan, cross))
                bricks.append(b.draw())
            if i % 4 == 0: # vertical bricks
                tan = polyline.tangent_at_point(pt)
                cross = tan.cross(Vector(0,0,1))
                cross.unitize()
                cross.scale(Brick.WIDTH/2)
                new_pt = pt.translated(cross)
                b = Brick(Frame(new_pt, cross, tan))
                bricks.append(b.draw())

frames = []
for b in bricks:
    frame = b.frame
    frames.append(frame)
# ---------- end py3_6 ----------
multiplication_5 = Multiplication(A=number_slider_13, B=number_slider_12)  # disabled
panel_5 = Panel(multiplication_5)  # disabled
draw_21 = COMPASDraw(cg=py3_6.poly)  # -> rg; disabled; same code as draw
draw_22 = COMPASDraw(cg=py3_6.polylines)  # -> rg; disabled; same code as draw
draw_23 = COMPASDraw(cg=py3_6.center)  # -> rg; disabled; same code as draw
draw_24 = COMPASDraw(cg=py3_6.frames)  # -> rg; disabled; same code as draw
draw_25 = COMPASDraw(cg=py3_6.bricks)  # -> rg; disabled; same code as draw
swatch_5 = ColourSwatch(SwatchColor=RGB(196, 175, 106))  # disabled
preview_5 = CustomPreview(Geometry=draw_25, Material=swatch_5)  # disabled

# ---- group: triangle tower_hor, ver_holes
number_slider_15 = Slider(4, range=0..30)  # disabled
number_slider_16 = Slider(2, range=0..100)  # disabled
gap_7 = Slider(4.5, range=0..10)  # disabled
number_slider_17 = Slider(15, range=0..100)  # disabled
py3_7 = Python3Script(num_layers=number_slider_16, gap=gap_7, num_bricks=number_slider_15, rot=number_slider_17)  # -> out, poly, polylines, center, frames, bricks; inputs num_layers: Int32, gap: Double, num_bricks: Int32, rot: Double; disabled
# ---------- py3_7: Python ----------
# r: compas
# venv: mas-2526

from compas_rhino.devtools import DevTools
DevTools.enable_reloader()

import math
from compas.geometry import Box, Point, Frame
from compas.geometry import Polygon, Polyline, Vector, Line
from brick_wall_2 import Brick

# Make curve as a triangle that is equal to the brick size
unit_div = ((Brick.LENGTH + Brick.WIDTH)/2) + gap
x = unit_div * num_bricks
y = x * math.sin(math.radians(60))

u = 45
v = 72
pt_1 = Point(0+u,0+v,0)
pt_2 = Point(x+u, 0+v, 0)
pt_3 = Point(x/2+u, y+v, 0)
center = Point(x/2+u, y/3+v, 0)

pt_list = [pt_1, pt_2, pt_3, pt_1]
poly = Polyline(pt_list)

# make skeleton curves & primitive bricks
vectors = []
bricks = []
polylines = []
p_l = []

def horizontal_brick(point, rotation=0):
    tan = polyline.tangent_at_point(point)
    cross = tan.cross(Vector(0,0,1))
    cross.unitize()
    cross.scale(Brick.WIDTH/2)
    new_pt = pt.translated(cross)
    b = Brick(Frame(new_pt, tan, cross))
    b.rotate(rotation)
    bricks.append(b.draw())
    return bricks

def vertical_brick(point, move=0, rotation=0):
    tan = polyline.tangent_at_point(point)
    cross = tan.cross(Vector(0,0,1))
    cross.unitize()
    new_pt = pt.translated(cross*move)
    cross.scale(Brick.WIDTH/2)
    c_new_pt = new_pt.translated(cross)
    b = Brick(Frame(c_new_pt, cross, tan))
    b.rotate(rotation)
    bricks.append(b.draw())
    return bricks

height = Brick.HEIGHT
for row in range(num_layers):
    polyline = poly.translated([0,0,height*row])
    polyline.rotate(math.radians(3*row), axis=Vector(0,0,1), point=center)
    polylines.append(polyline)
    points_list = polyline.divide_by_length(unit_div/2)
    print(len(points_list))

    for i, pt in enumerate(points_list):
        if row % 2 == 0: # even row
            if i % 8 == 0: # vertical
                vertical_brick(pt, move=3)
            if i % 8 == 4: # vertical
                vertical_brick(pt)
            if i % 4 == 2: # horizontal
                horizontal_brick(pt)
        else: # odd row
            if i % 4 == 1: # horizontal
                horizontal_brick(pt)
            if i % 8 == 7: # vertical
                vertical_brick(pt, rotation=rot)               
frames = []
for b in bricks:
    frame = b.frame
    if frame.zaxis.z > 0:
        frame.flip()
    frames.append(frame)
# ---------- end py3_7 ----------
multiplication_6 = Multiplication(A=number_slider_16, B=number_slider_15)  # disabled
panel_6 = Panel(multiplication_6)  # disabled
draw_26 = COMPASDraw(cg=py3_7.bricks)  # -> rg; disabled; same code as draw
draw_27 = COMPASDraw(cg=py3_7.poly)  # -> rg; disabled; same code as draw
draw_28 = COMPASDraw(cg=py3_7.polylines)  # -> rg; disabled; same code as draw
draw_29 = COMPASDraw(cg=py3_7.center)  # -> rg; disabled; same code as draw
draw_30 = COMPASDraw(cg=py3_7.frames)  # -> rg; disabled; same code as draw
item_3 = ListItem(List=draw_30, Index=0, Wrap=True)  # -> Item, Item1, Item2; disabled
swatch_6 = ColourSwatch(SwatchColor=RGB(196, 175, 106))  # disabled
preview_6 = CustomPreview(Geometry=draw_26, Material=swatch_6)  # disabled
pl_3 = ConstructPlane(Origin=item_3.Item, XAxis=item_3.Item1, YAxis=item_3.Item2)  # disabled

number_slider_18 = Slider(4, range=0..30)  # disabled
number_slider_19 = Slider(37, range=0..100)  # disabled
gap_8 = Slider(3, range=0..10)  # disabled
number_slider_20 = Slider(0, range=0..100)  # disabled
py3_8 = Python3Script(num_layers=number_slider_19, gap=gap_8, num_bricks=number_slider_18, rot_ver=number_slider_20)  # -> out, poly, polylines, center, frames, bricks; inputs num_layers: Int32, gap: Double, num_bricks: Int32, rot_ver: Double; disabled
# ---------- py3_8: Python ----------
# r: compas
# venv: mas-2526

from compas_rhino.devtools import DevTools
DevTools.enable_reloader()

import math
from compas.geometry import Box, Point, Frame
from compas.geometry import Polygon, Polyline, Vector
from brick_wall_2 import Brick

# Make curve as a triangle that is equal to the brick size
unit_div = (Brick.LENGTH + Brick.WIDTH)/2 + gap
x = unit_div * num_bricks
y = x * math.sin(math.radians(60))
# print(x, y)

pt_1 = Point(0,0,0)
pt_2 = Point(x, 0, 0)
pt_3 = Point(x/2, y, 0)
center = Point(x/2, y/3, 0)

pt_list = [pt_1, pt_2, pt_3, pt_1]
poly = Polyline(pt_list)

# make skeleton curves & primitive bricks
vectors = []
bricks = []
polylines = []
p_l = []

height = Brick.HEIGHT
for row in range(num_layers):
    polyline = poly.translated([0,0,height*row])
    polyline.rotate(math.radians(3*row), axis=Vector(0,0,1), point=center)
    polylines.append(polyline)
    points_list = polyline.divide_by_length(unit_div/2)
    print(len(points_list))

    for i, pt in enumerate(points_list):
        if row % 2 == 0:
            if i % 4 == 1: # horizontal bricks
                tan = polyline.tangent_at_point(pt)
                cross = tan.cross(Vector(0,0,1))
                cross.unitize()
                cross.scale(Brick.WIDTH/2)
                new_pt = pt.translated(cross)
                t_new_pt = new_pt.translated(Vector(-0, 0, 0))
                b = Brick(Frame(t_new_pt, tan, cross))
                bricks.append(b.draw())
            if i % 8 == 7: # vertical bricks
                tan = polyline.tangent_at_point(pt)
                cross = tan.cross(Vector(0,0,1))
                cross.unitize()
                cross.scale(Brick.WIDTH/2)
                new_pt = pt.translated(cross)
                b = Brick(Frame(new_pt, cross, tan))
                b.rotate(rot_ver)
                bricks.append(b.draw())
        else:
            if i % 4 == 2: # horizontal bricks
                tan = polyline.tangent_at_point(pt)
                cross = tan.cross(Vector(0,0,1))
                cross.unitize()
                cross.scale(Brick.WIDTH/2)
                new_pt = pt.translated(cross)
                b = Brick(Frame(new_pt, tan, cross))
                bricks.append(b.draw())
            if i % 4 == 0: # vertical bricks
                tan = polyline.tangent_at_point(pt)
                cross = tan.cross(Vector(0,0,1))
                cross.unitize()
                cross.scale(Brick.WIDTH/2)
                new_pt = pt.translated(cross)
                b = Brick(Frame(new_pt, cross, tan))
                bricks.append(b.draw())

frames = []
for b in bricks:
    frame = b.frame
    frames.append(frame)
# ---------- end py3_8 ----------
multiplication_7 = Multiplication(A=number_slider_19, B=number_slider_18)  # disabled
panel_7 = Panel(multiplication_7)  # disabled
draw_31 = COMPASDraw(cg=py3_8.poly)  # -> rg; disabled; same code as draw
draw_32 = COMPASDraw(cg=py3_8.polylines)  # -> rg; disabled; same code as draw
draw_33 = COMPASDraw(cg=py3_8.center)  # -> rg; disabled; same code as draw
draw_34 = COMPASDraw(cg=py3_8.frames)  # -> rg; disabled; same code as draw
draw_35 = COMPASDraw(cg=py3_8.bricks)  # -> rg; disabled; same code as draw
swatch_7 = ColourSwatch(SwatchColor=RGB(196, 175, 106))  # disabled
preview_7 = CustomPreview(Geometry=draw_35, Material=swatch_7)  # disabled

# ----
number_slider_21 = Slider(12, range=0..20)  # disabled

# ---- group: triangle tower_hor, ver_holes
number_slider_22 = Slider(4, range=0..30)  # disabled
number_slider_23 = Slider(2, range=0..50)  # disabled
gap_9 = Slider(3, range=0..10)  # disabled
number_slider_24 = Slider(30, range=0..100)  # disabled
py3_9 = Python3Script(num_layers=number_slider_23, gap=gap_9, num_bricks=number_slider_22, rot_ver=number_slider_24)  # -> out, poly, polylines, center, frames, bricks; inputs num_layers: Int32, gap: Double, num_bricks: Int32, rot_ver: Double; disabled
# ---------- py3_9: Python ----------
# r: compas
# venv: mas-2526

from compas_rhino.devtools import DevTools
DevTools.enable_reloader()

import math
from compas.geometry import Box, Point, Frame
from compas.geometry import Polygon, Polyline, Vector
from brick_wall_2 import Brick

# Make curve as a triangle that is equal to the brick size
unit_div = (Brick.LENGTH + Brick.WIDTH)/2 + gap
x = unit_div * num_bricks
y = x * math.sin(math.radians(60))

u = 45
v = 72
pt_1 = Point(0+u,0+v,0)
pt_2 = Point(x+u, 0+v, 0)
pt_3 = Point(x/2+u, y+v, 0)
center = Point(x/2+u, y/3+v, 0)

pt_list = [pt_1, pt_2, pt_3, pt_1]
poly = Polyline(pt_list)

# make skeleton curves & primitive bricks
vectors = []
bricks = []
polylines = []
p_l = []

height = Brick.HEIGHT
for row in range(num_layers):
    polyline = poly.translated([0,0,height*row])
    polyline.rotate(math.radians(3*row), axis=Vector(0,0,1), point=center)
    polylines.append(polyline)
    points_list = polyline.divide_by_length(unit_div/2)
    print(len(points_list))

    for i, pt in enumerate(points_list):
        if row % 2 == 0:
            if i % 8 == 1 or i % 8 ==4: # horizontal bricks
                tan = polyline.tangent_at_point(pt)
                cross = tan.cross(Vector(0,0,1))
                cross.unitize()
                cross.scale(Brick.WIDTH/2)
                new_pt = pt.translated(cross)
                b = Brick(Frame(new_pt, tan, cross))
                bricks.append(b.draw())

            if i % 8 == 7: # vertical bricks
                tan = polyline.tangent_at_point(pt)
                cross = tan.cross(Vector(0,0,1))
                cross.unitize()
                cross.scale(Brick.WIDTH/2)
                new_pt = pt.translated(cross)
                t_new_pt = new_pt.translated(Vector(-3,-3,0))
                b = Brick(Frame(new_pt, cross, tan))
                b.rotate(rot_ver)
                bricks.append(b.draw())
        else:
            if i % 4 == 2: # horizontal bricks
                tan = polyline.tangent_at_point(pt)
                cross = tan.cross(Vector(0,0,1))
                cross.unitize()
                cross.scale(Brick.WIDTH/2)
                new_pt = pt.translated(cross)
                b = Brick(Frame(new_pt, tan, cross))
                bricks.append(b.draw())
            if i % 4 == 0: # vertical bricks
                tan = polyline.tangent_at_point(pt)
                cross = tan.cross(Vector(0,0,1))
                cross.unitize()
                cross.scale(Brick.WIDTH/2)
                new_pt = pt.translated(cross)
                b = Brick(Frame(new_pt, cross, tan))
                bricks.append(b.draw())

frames = []
for b in bricks:
    frame = b.frame
    if frame.zaxis.z > 0:
        frame.flip()
    frames.append(frame)
# ---------- end py3_9 ----------
multiplication_8 = Multiplication(A=number_slider_23, B=number_slider_22)  # disabled
panel_8 = Panel(multiplication_8)  # disabled
draw_36 = COMPASDraw(cg=py3_9.poly)  # -> rg; disabled; same code as draw
draw_37 = COMPASDraw(cg=py3_9.polylines)  # -> rg; disabled; same code as draw
draw_38 = COMPASDraw(cg=py3_9.center)  # -> rg; disabled; same code as draw
draw_39 = COMPASDraw(cg=py3_9.frames)  # -> rg; disabled; same code as draw
draw_40 = COMPASDraw(cg=py3_9.bricks)  # -> rg; disabled; same code as draw
item_4 = ListItem(List=draw_39, Index=0, Wrap=True)  # -> Item, Item1, Item2; disabled
swatch_8 = ColourSwatch(SwatchColor=RGB(196, 175, 106))  # disabled
preview_8 = CustomPreview(Geometry=draw_40, Material=swatch_8)  # disabled
pl_4 = ConstructPlane(Origin=item_4.Item, XAxis=item_4.Item1, YAxis=item_4.Item2)  # disabled

# ----
item_5 = ListItem(List=draw_26, Index=number_slider_21, Wrap=True)  # disabled

# ---- group: final_triangle tower_hor, ver_holes
number_slider_25 = Slider(4, range=0..30)  # disabled
number_slider_26 = Slider(14, range=0..100)  # disabled
gap_10 = Slider(4.5, range=0..10)  # disabled
number_slider_27 = Slider(15, range=0..100)  # disabled
py3_10 = Python3Script(num_layers=number_slider_26, gap=gap_10, num_bricks=number_slider_25, rot=number_slider_27)  # -> out, poly, polylines, center, frames, bricks; inputs num_layers: Int32, gap: Double, num_bricks: Int32, rot: Double; disabled
# ---------- py3_10: Python ----------
# r: compas
# venv: mas-2526

from compas_rhino.devtools import DevTools
DevTools.enable_reloader()

import math
from compas.geometry import Box, Point, Frame
from compas.geometry import Polygon, Polyline, Vector, Line
from brick_wall_2 import Brick

# Make curve as a triangle that is equal to the brick size
unit_div = ((Brick.LENGTH + Brick.WIDTH)/2) + gap
x = unit_div * num_bricks
y = x * math.sin(math.radians(60))

u = 18 # 45
v = 60 #72
pt_1 = Point(0+u,0+v,0)
pt_2 = Point(x+u, 0+v, 0)
pt_3 = Point(x/2+u, y+v, 0)
center = Point(x/2+u, y/3+v, 0)

pt_list = [pt_1, pt_2, pt_3, pt_1]
poly = Polyline(pt_list)

# make skeleton curves & primitive bricks
vectors = []
bricks = []
polylines = []
p_l = []

def horizontal_brick(point, move=0, rotation=0):
    tan = polyline.tangent_at_point(point)
    tan.unitize()
    cross = tan.cross(Vector(0,0,1))
    cross.unitize()
    new_pt = pt.translated(tan*move)
    cross.scale(Brick.WIDTH/2)
    c_new_pt = new_pt.translated(cross)
    b = Brick(Frame(c_new_pt, tan, cross))
    b.rotate(rotation)
    bricks.append(b.draw())
    return bricks

def vertical_brick(point, move=0, rotation=0):
    tan = polyline.tangent_at_point(point)
    cross = tan.cross(Vector(0,0,1))
    cross.unitize()
    new_pt = pt.translated(cross*move)
    cross.scale(Brick.WIDTH/2)
    c_new_pt = new_pt.translated(cross)
    b = Brick(Frame(c_new_pt, cross, tan))
    b.rotate(rotation)
    bricks.append(b.draw())
    return bricks

height = Brick.HEIGHT
for row in range(num_layers):
    polyline = poly.translated([0,0,height*row])
    polyline.rotate(math.radians(3*row), axis=Vector(0,0,1), point=center)
    polylines.append(polyline)
    points_list = polyline.divide_by_length(unit_div/2)
    print(len(points_list))

    for i, pt in enumerate(points_list):
        if row % 2 == 0: # even row
            if i % 8 == 0: # vertical
                vertical_brick(pt, move=3)
            if i % 8 == 4: # vertical
                vertical_brick(pt)
            if i % 4 == 2: # horizontal
                horizontal_brick(pt)
        else: # odd row
            if i % 8 == 1: # horizontal
                horizontal_brick(pt, move=3)
            if i % 8 == 5: # horizontal
                horizontal_brick(pt)
            if i % 8 == 7: # vertical
                vertical_brick(pt, rotation=rot)               
frames = []
for b in bricks:
    frame = b.frame
    if frame.zaxis.z > 0:
        frame.flip()
    frames.append(frame)
# ---------- end py3_10 ----------
multiplication_9 = Multiplication(A=number_slider_26, B=number_slider_25)  # disabled
panel_9 = Panel(multiplication_9)  # disabled
draw_41 = COMPASDraw(cg=py3_10.bricks)  # -> rg; disabled; same code as draw
draw_42 = COMPASDraw(cg=py3_10.poly)  # -> rg; disabled; same code as draw
draw_43 = COMPASDraw(cg=py3_10.polylines)  # -> rg; disabled; same code as draw
draw_44 = COMPASDraw(cg=py3_10.center)  # -> rg; disabled; same code as draw
draw_45 = COMPASDraw(cg=py3_10.frames)  # -> rg; disabled; same code as draw
item_6 = ListItem(List=draw_45, Index=0, Wrap=True)  # -> Item, Item1, Item2; disabled
swatch_9 = ColourSwatch(SwatchColor=RGB(196, 175, 106))  # disabled
preview_9 = CustomPreview(Geometry=draw_41, Material=swatch_9)  # disabled
pl_5 = ConstructPlane(Origin=item_6.Item, XAxis=item_6.Item1, YAxis=item_6.Item2)  # disabled

# ---- group: triangle tower_hor, ver_holes
number_slider_28 = Slider(1, range=0..50)
number_slider_29 = Slider(4, range=0..30)
gap_11 = Slider(3, range=0..10)
py3_11 = Python3Script(num_layers=number_slider_28, gap=gap_11, num_bricks=number_slider_29, rot_ver=Slider(30, range=0..100))  # -> out, poly, polylines, center, frames, bricks, points_lists; inputs num_layers: Int32, gap: Double, num_bricks: Int32, rot_ver: Double
# ---------- py3_11: Python ----------
# r: compas
# venv: mas-2526

from compas_rhino.devtools import DevTools
DevTools.enable_reloader()

import math
from compas.geometry import Box, Point, Frame
from compas.geometry import Polygon, Polyline, Vector
from brick_wall_2 import Brick

# Make curve as a triangle that is equal to the brick size
unit_div = (Brick.LENGTH + Brick.WIDTH)/2 + gap
x = unit_div * num_bricks
y = x * math.sin(math.radians(60))

u = 45
v = 72
pt_1 = Point(0+u,0+v,0)
pt_2 = Point(x+u, 0+v, 0)
pt_3 = Point(x/2+u, y+v, 0)
center = Point(x/2+u, y/3+v, 0)

pt_list = [pt_1, pt_2, pt_3, pt_1]
poly = Polyline(pt_list)

# make skeleton curves & primitive bricks
vectors = []
bricks = []
polylines = []
p_l = []
points_lists = []

height = Brick.HEIGHT
for row in range(num_layers):
    polyline = poly.translated([0,0,height*row])
    polyline.rotate(math.radians(3*row), axis=Vector(0,0,1), point=center)
    polylines.append(polyline)
    points_list = polyline.divide_by_length(unit_div/2)
    print(len(points_list))
    points_lists.extend(points_list)

    for i, pt in enumerate(points_list):
        if row % 2 == 0:
            if i % 8 == 1 or i % 8 ==4: # horizontal bricks
                tan = polyline.tangent_at_point(pt)
                cross = tan.cross(Vector(0,0,1))
                cross.unitize()
                cross.scale(Brick.WIDTH/2)
                new_pt = pt.translated(cross)
                b = Brick(Frame(new_pt, tan, cross))
                bricks.append(b.draw())

            # if i % 4 == 1: # horizontal bricks
            #     tan = polyline.tangent_at_point(pt)
            #     cross = tan.cross(Vector(0,0,1))
            #     cross.unitize()
            #     cross.scale(Brick.WIDTH/2)
            #     new_pt = pt.translated(cross)
            #     b = Brick(Frame(new_pt, tan, cross))
            #     bricks.append(b.draw())

            if i % 8 == 7: # vertical bricks
                tan = polyline.tangent_at_point(pt)
                cross = tan.cross(Vector(0,0,1))
                cross.unitize()
                cross.scale(Brick.WIDTH/2)
                new_pt = pt.translated(cross)
                t_new_pt = new_pt.translated(Vector(-3,-3,0))
                b = Brick(Frame(new_pt, cross, tan))
                b.rotate(rot_ver)
                bricks.append(b.draw())
        else:
            if i % 4 == 2: # horizontal bricks
                tan = polyline.tangent_at_point(pt)
                cross = tan.cross(Vector(0,0,1))
                cross.unitize()
                cross.scale(Brick.WIDTH/2)
                new_pt = pt.translated(cross)
                b = Brick(Frame(new_pt, tan, cross))
                bricks.append(b.draw())
            if i % 4 == 0: # vertical bricks
                tan = polyline.tangent_at_point(pt)
                cross = tan.cross(Vector(0,0,1))
                cross.unitize()
                cross.scale(Brick.WIDTH/2)
                new_pt = pt.translated(cross)
                b = Brick(Frame(new_pt, cross, tan))
                bricks.append(b.draw())

frames = []
for b in bricks:
    frame = b.frame
    if frame.zaxis.z > 0:
        frame.flip()
    frames.append(frame)
# ---------- end py3_11 ----------
multiplication_10 = Multiplication(A=number_slider_28, B=number_slider_29)
panel_10 = Panel(multiplication_10)
draw_46 = COMPASDraw(cg=py3_11.poly)  # -> rg; same code as draw
draw_47 = COMPASDraw(cg=py3_11.polylines)  # -> rg; same code as draw
draw_48 = COMPASDraw(cg=py3_11.center)  # -> rg; same code as draw
draw_49 = COMPASDraw(cg=py3_11.frames)  # -> rg; same code as draw
draw_50 = COMPASDraw(cg=py3_11.bricks)  # -> rg; same code as draw
item_7 = ListItem(List=draw_49, Index=0, Wrap=True)  # -> Item, Item1, Item2
pl_6 = ConstructPlane(Origin=item_7.Item, XAxis=item_7.Item1, YAxis=item_7.Item2)
preview_10 = CustomPreview(Geometry=draw_50, Material=ColourSwatch(SwatchColor=RGB(196, 175, 106)))

# ----
number_slider_30 = Slider(12, range=0..20)  # disabled
item_8 = ListItem(List=draw_41, Index=number_slider_30, Wrap=True)  # disabled
draw_51 = COMPASDraw(cg=py3_11.points_lists)  # -> rg; same code as draw

# ---- group: final_triangle tower_hor, ver_holes
number_slider_31 = Slider(3, range=0..30)  # disabled
number_slider_32 = Slider(18, range=0..100)  # disabled
number_slider_33 = Slider(18, range=0..100)  # disabled
gap_12 = Slider(4.5, range=0..10)  # disabled
number_slider_34 = Slider(15, range=0..100)  # disabled
number_slider_35 = Slider(60, range=0..100)  # disabled
py3_12 = Python3Script(
    num_layers=number_slider_32,
    gap=gap_12,
    num_bricks=number_slider_31,
    rot=number_slider_34,
    u=number_slider_33,
    v=number_slider_35)  # -> out, poly, polylines, center, frames, bricks; inputs num_layers: Int32, gap: Double, num_bricks: Int32, rot: Double, u: Double, v: Double; disabled
# ---------- py3_12: Python ----------
# r: compas
# venv: mas-2526

from compas_rhino.devtools import DevTools
DevTools.enable_reloader()

import math
from compas.geometry import Box, Point, Frame
from compas.geometry import Polygon, Polyline, Vector, Line
from brick_wall import Brick, BigBrick

# Make curve as a triangle that is equal to the brick size
unit_div = ((BigBrick.LENGTH + BigBrick.WIDTH)/2) + gap
x = unit_div * num_bricks
y = x * math.sin(math.radians(60))

pt_1 = Point(0+u,0+v,0)
pt_2 = Point(x+u, 0+v, 0)
pt_3 = Point(x/2+u, y+v, 0)
center = Point(x/2+u, y/3+v, 0)

pt_list = [pt_1, pt_2, pt_3, pt_1]
poly = Polyline(pt_list)

# make skeleton curves & primitive bricks
vectors = []
bricks = []
polylines = []
p_l = []

def h_brick(point, move=0, rotation=0): # horizontal brick
    tan = polyline.tangent_at_point(point)
    tan.unitize()
    cross = tan.cross(Vector(0,0,1))
    cross.unitize()
    new_pt = pt.translated(tan*move)
    cross.scale(BigBrick.WIDTH/2)
    c_new_pt = new_pt.translated(cross)
    b = BigBrick(Frame(c_new_pt, tan, cross))
    b.rotate(rotation)
    bricks.append(b.draw())
    return bricks

def v_brick(point, move=0, rotation=0): # vertical brick
    tan = polyline.tangent_at_point(point)
    cross = tan.cross(Vector(0,0,1))
    cross.unitize()
    new_pt = pt.translated(cross*move)
    cross.scale(Brick.WIDTH/2)
    c_new_pt = new_pt.translated(cross)
    b = BigBrick(Frame(c_new_pt, cross, tan))
    b.rotate(rotation)
    bricks.append(b.draw())
    return bricks

height = BigBrick.HEIGHT
for row in range(num_layers):
    polyline = poly.translated([0,0,height*row])
    polyline.rotate(math.radians(3*row), axis=Vector(0,0,1), point=center)
    polylines.append(polyline)
    points_list = polyline.divide_by_length(unit_div/2)
    print(len(points_list))

    for i, pt in enumerate(points_list):
        if row % 2 == 0: # even row
            if i % 8 == 0: # vertical
                v_brick(pt, move=3)
            if i % 8 == 4: # vertical
                v_brick(pt)
            if i % 4 == 2: # horizontal
                h_brick(pt)
        else: # odd row
            if i % 8 == 1: # horizontal
                h_brick(pt, move=3)
            if i % 8 == 5: # horizontal
                h_brick(pt)
            if i % 8 == 7: # vertical
                v_brick(pt, rotation=rot)               
frames = []
for b in bricks:
    frame = b.frame
    if frame.zaxis.z > 0:
        frame.flip()
    frames.append(frame)
# ---------- end py3_12 ----------
multiplication_11 = Multiplication(A=number_slider_32, B=number_slider_31)  # disabled
panel_11 = Panel(multiplication_11)  # disabled
draw_52 = COMPASDraw(cg=py3_12.bricks)  # -> rg; disabled; same code as draw
draw_53 = COMPASDraw(cg=py3_12.poly)  # -> rg; disabled; same code as draw
draw_54 = COMPASDraw(cg=py3_12.polylines)  # -> rg; disabled; same code as draw
draw_55 = COMPASDraw(cg=py3_12.center)  # -> rg; disabled; same code as draw
draw_56 = COMPASDraw(cg=py3_12.frames)  # -> rg; disabled; same code as draw
item_9 = ListItem(List=draw_56, Index=0, Wrap=True)  # -> Item, Item1, Item2; disabled
swatch_10 = ColourSwatch(SwatchColor=RGB(196, 175, 106))  # disabled
preview_11 = CustomPreview(Geometry=draw_52, Material=swatch_10)  # disabled
pl_7 = ConstructPlane(Origin=item_9.Item, XAxis=item_9.Item1, YAxis=item_9.Item2)  # disabled

# ----
panel_12 = Panel("-600 to 600")  # disabled
panel_13 = Panel("-380 to 380")  # disabled
rectangle = Rectangle(Plane=PlaneXY(0, 0, 0), XSize=panel_12, YSize=panel_13, Radius=0)  # -> Rectangle, Length; disabled
number_slider_36 = Slider(200, range=0..200)  # disabled
number_slider_37 = Slider(281, range=0..300)  # disabled
pt = ConstructPoint(XCoordinate=number_slider_36, YCoordinate=number_slider_37, ZCoordinate=0)  # disabled
move = Move(Geometry=rectangle.Rectangle, Motion=pt)  # -> Geometry, Transform; disabled

number_slider_38 = Slider(12, range=0..20)  # disabled
item_10 = ListItem(List=draw_52, Index=number_slider_38, Wrap=True)  # disabled

# ---- group: final_triangle tower_hor, ver_holes
number_slider_39 = Slider(2, range=0..30)
number_slider_40 = Slider(18, range=0..100)
gap_13 = Slider(3, range=0..10)
py3_13 = Python3Script(
    num_layers=number_slider_40,
    gap=gap_13,
    num_bricks=number_slider_39,
    rot=Slider(15, range=0..100),
    u=Slider(18, range=0..100),
    v=Slider(60, range=0..100))  # -> out, poly, polylines, center, frames, bricks; inputs num_layers: Int32, gap: Double, num_bricks: Int32, rot: Double, u: Double, v: Double
# ---------- py3_13: Python ----------
# r: compas
# venv: mas-2526

from compas_rhino.devtools import DevTools
DevTools.enable_reloader()

import math
from compas.geometry import Box, Point, Frame
from compas.geometry import Polygon, Polyline, Vector, Line
from brick_wall import Brick, BigBrick

# Make curve as a triangle that is equal to the brick size
unit_div = ((BigBrick.LENGTH + BigBrick.WIDTH)/2) + gap
x = unit_div * num_bricks
y = x * math.sin(math.radians(60))

pt_1 = Point(0+u,0+v,0)
pt_2 = Point(x+u, 0+v, 0)
pt_3 = Point(x/2+u, y+v, 0)
center = Point(x/2+u, y/3+v, 0)

pt_list = [pt_1, pt_2, pt_3, pt_1]
poly = Polyline(pt_list)

# make skeleton curves & primitive bricks
vectors = []
bricks = []
polylines = []
p_l = []

def h_brick(point, move=0, rotation=0): # horizontal brick
    tan = polyline.tangent_at_point(point)
    tan.unitize()
    cross = tan.cross(Vector(0,0,1))
    cross.unitize()
    new_pt = pt.translated(tan*move)
    cross.scale(BigBrick.WIDTH/2)
    c_new_pt = new_pt.translated(cross)
    b = BigBrick(Frame(c_new_pt, tan, cross))
    b.rotate(rotation)
    bricks.append(b.draw())
    return bricks

def v_brick(point, move=0, rotation=0): # vertical brick
    tan = polyline.tangent_at_point(point)
    cross = tan.cross(Vector(0,0,1))
    cross.unitize()
    new_pt = pt.translated(cross*move)
    cross.scale(Brick.WIDTH/2)
    c_new_pt = new_pt.translated(cross)
    b = BigBrick(Frame(c_new_pt, cross, tan))
    b.rotate(rotation)
    bricks.append(b.draw())
    return bricks

height = BigBrick.HEIGHT
for row in range(num_layers):
    polyline = poly.translated([0,0,height*row])
    # polyline.rotate(math.radians(3*row), axis=Vector(0,0,1), point=center)
    polylines.append(polyline)
    points_list = polyline.divide_by_length(unit_div)
    print(len(points_list))

    n = 7
    for i, pt in enumerate(points_list):
        if row % 2 == 0: # even row
            if i % n == 0 or i % n == 4: # horizontal
                h_brick(pt)
            if i % n == 2: # vertical
                v_brick(pt)
            # if i % 8 == 0: # vertical
            #     v_brick(pt, move=3)
            # if i % 8 == 4: # vertical
            #     v_brick(pt)
            # if i % 4 == 2: # horizontal
            #     h_brick(pt)
        else: # odd row
            if i % n == 1 or i % n == 5: # horizontal
                h_brick(pt)
            if i % n == 3: # vertical
                v_brick(pt)
            # if i % 8 == 1: # horizontal
            #     h_brick(pt, move=3)
            # if i % 8 == 5: # horizontal
            #     h_brick(pt)
            # if i % 8 == 7: # vertical
            #     v_brick(pt, rotation=rot)               
frames = []
for b in bricks:
    frame = b.frame
    if frame.zaxis.z > 0:
        frame.flip()
    frames.append(frame)
# ---------- end py3_13 ----------
multiplication_12 = Multiplication(A=number_slider_40, B=number_slider_39)
panel_14 = Panel(multiplication_12)
draw_57 = COMPASDraw(cg=py3_13.bricks)  # -> rg; same code as draw
draw_58 = COMPASDraw(cg=py3_13.poly)  # -> rg; same code as draw
draw_59 = COMPASDraw(cg=py3_13.polylines)  # -> rg; same code as draw
draw_60 = COMPASDraw(cg=py3_13.center)  # -> rg; same code as draw
draw_61 = COMPASDraw(cg=py3_13.frames)  # -> rg; same code as draw
item_11 = ListItem(List=draw_61, Index=0, Wrap=True)  # -> Item, Item1, Item2
preview_12 = CustomPreview(Geometry=draw_57, Material=ColourSwatch(SwatchColor=RGB(196, 175, 106)))
pl_8 = ConstructPlane(Origin=item_11.Item, XAxis=item_11.Item1, YAxis=item_11.Item2)

# ----
item_12 = ListItem(List=draw_57, Index=Slider(3, range=0..10), Wrap=True)
item_13 = ListItem(List=draw_57, Index=Slider(12, range=0..20), Wrap=True)

# ---- group: final_triangle tower_hor, ver_holes
number_slider_41 = Slider(2, range=0..30)
number_slider_42 = Slider(17, range=0..100)
gap_14 = Slider(3, range=0..10)
py3_14 = Python3Script(
    num_layers=number_slider_42,
    gap=gap_14,
    num_bricks=number_slider_41,
    rot=Slider(15, range=0..100),
    u=Slider(18, range=0..100),
    v=Slider(60, range=0..100))  # -> out, poly, polylines, center, frames, bricks; inputs num_layers: Int32, gap: Double, num_bricks: Int32, rot: Double, u: Double, v: Double
# ---------- py3_14: Python ----------
# r: compas
# venv: mas-2526

from compas_rhino.devtools import DevTools
DevTools.enable_reloader()

import math
from compas.geometry import Box, Point, Frame
from compas.geometry import Polygon, Polyline, Vector, Line
from brick_wall import Brick, BigBrick

# Make curve as a triangle that is equal to the brick size
unit_div = ((BigBrick.LENGTH + BigBrick.WIDTH)/2) + gap
total_bricks = num_bricks * 3
total_length = unit_div * total_bricks
x = unit_div * num_bricks
y = x * math.sin(math.radians(60))

pt_1 = Point(0+u,0+v,0)
pt_2 = Point(x+u, 0+v, 0)
pt_3 = Point(x/2+u, y+v, 0)
center = Point(x/2+u, y/3+v, 0)

pt_list = [pt_1, pt_2, pt_3, pt_1]
poly = Polyline(pt_list)

# make skeleton curves & primitive bricks
vectors = []
bricks = []
polylines = []
p_l = []

def h_brick(point, move=0, rotation=0): # horizontal brick
    tan = polyline.tangent_at_point(point)
    tan.unitize()
    cross = tan.cross(Vector(0,0,1))
    cross.unitize()
    new_pt = pt.translated(tan*move)
    cross.scale(BigBrick.WIDTH/2)
    c_new_pt = new_pt.translated(cross)
    b = BigBrick(Frame(c_new_pt, tan, cross))
    b.rotate(rotation)
    bricks.append(b.draw())
    return bricks

def v_brick(point, move=0, rotation=0): # vertical brick
    tan = polyline.tangent_at_point(point)
    tan.unitize()
    cross = tan.cross(Vector(0,0,1))
    cross.unitize()
    new_pt = pt.translated(cross*move)
    cross.scale(Brick.WIDTH/2)
    c_new_pt = new_pt.translated(cross)
    b = BigBrick(Frame(c_new_pt, cross, tan))
    b.rotate(rotation)
    bricks.append(b.draw())
    return bricks

height = BigBrick.HEIGHT
para_list = []
for row in range(num_layers):
    polyline = poly.translated([0,0,height*row])
    points_list = polyline.divide(total_bricks)
    # print(len(points_list))
    for pt in points_list:
        para = polyline.parameter_at(pt)
        para_list.append(para)
    print(len(para_list))
    # polyline.rotate(math.radians(3*row), axis=Vector(0,0,1), point=center)
    polylines.append(polyline)

    # points_list = polyline.divide_by_length(unit_div)

    n = 7
    for i, pt in enumerate(points_list):
        if row % 2 == 0: # even row
            if i % n == 0 or i % n == 2 or i % n == 4: # horizontal
                h_brick(pt)
            if i % n == 1 or i % n == 3 or i % n == 5: # vertical
                v_brick(pt)
            # if i % 8 == 0: # vertical
            #     v_brick(pt, move=3)
            # if i % 8 == 4: # vertical
            #     v_brick(pt)
            # if i % 4 == 2: # horizontal
            #     h_brick(pt)
        else: # odd row
            if i % n == 1 or i % n == 5: # horizontal
                h_brick(pt)
            if i % n == 3: # vertical
                v_brick(pt)
            # if i % 8 == 1: # horizontal
            #     h_brick(pt, move=3)
            # if i % 8 == 5: # horizontal
            #     h_brick(pt)
            # if i % 8 == 7: # vertical
            #     v_brick(pt, rotation=rot)               
frames = []
for b in bricks:
    frame = b.frame
    if frame.zaxis.z > 0:
        frame.flip()
    frames.append(frame)
# ---------- end py3_14 ----------
multiplication_13 = Multiplication(A=number_slider_42, B=number_slider_41)
panel_15 = Panel(multiplication_13)
draw_62 = COMPASDraw(cg=py3_14.bricks)  # -> rg; same code as draw
draw_63 = COMPASDraw(cg=py3_14.poly)  # -> rg; same code as draw
draw_64 = COMPASDraw(cg=py3_14.polylines)  # -> rg; same code as draw
draw_65 = COMPASDraw(cg=py3_14.center)  # -> rg; same code as draw
draw_66 = COMPASDraw(cg=py3_14.frames)  # -> rg; same code as draw
item_14 = ListItem(List=draw_66, Index=0, Wrap=True)  # -> Item, Item1, Item2
preview_13 = CustomPreview(Geometry=draw_62, Material=ColourSwatch(SwatchColor=RGB(196, 175, 106)))
pl_9 = ConstructPlane(Origin=item_14.Item, XAxis=item_14.Item1, YAxis=item_14.Item2)

number_slider_43 = Slider(2, range=0..30)
number_slider_44 = Slider(17, range=0..100)
gap_15 = Slider(15, range=0..30)
py3_15 = Python3Script(
    num_layers=number_slider_44,
    gap=gap_15,
    num_bricks=number_slider_43,
    rot=Slider(15, range=0..100),
    u=Slider(18, range=0..100),
    v=Slider(60, range=0..100))  # -> out, poly, polylines, center, frames, bricks; inputs num_layers: Int32, gap: Double, num_bricks: Int32, rot: Double, u: Double, v: Double
# ---------- py3_15: Python ----------
# r: compas
# venv: mas-2526

from compas_rhino.devtools import DevTools
DevTools.enable_reloader()

import math
from compas.geometry import Box, Point, Frame
from compas.geometry import Polygon, Polyline, Vector, Line
from brick_wall import BigBrick

# Make curve as a triangle that is equal to the brick size
unit_div = ((BigBrick.LENGTH + BigBrick.WIDTH)/2) + gap
h_total_bricks = num_bricks * 5
v_total_bricks = num_bricks * 3
h_total_length = unit_div * h_total_bricks
v_total_length = unit_div * v_total_bricks
x = (unit_div * h_total_length) / 2
y = (unit_div * v_total_length) / 2

p1 = (-x, 0, 0)
p2 = (x, 0, 0)
p3 = (0, y, 0)
p4 = (0, -y, 0)
h_l = Line(p1, p2)
v_l = Line(p3, p4)
print(h_l)

# h_num_divs = int(h_l.length() / unit_div)
# h_para, pts = h_l.divide_by_count(h_num_divs, True)
# divide curve twice as fine
# num_divs = int(curve.length() / (Brick.LENGTH+gap)) * 2
# params, div_pts = curve.divide_by_count(num_divs, True)

# pt_1 = Point(0+u,0+v,0)
# pt_2 = Point(x+u, 0+v, 0)
# pt_3 = Point(x/2+u, y+v, 0)
# center = Point(x/2+u, y/3+v, 0)

# pt_list = [pt_1, pt_2, pt_3, pt_1]
# poly = Polyline(pt_list)

# # make skeleton curves & primitive bricks
# vectors = []
# bricks = []
# polylines = []
# p_l = []

# def h_brick(point, move=0, rotation=0): # horizontal brick
#     tan = polyline.tangent_at_point(point)
#     tan.unitize()
#     cross = tan.cross(Vector(0,0,1))
#     cross.unitize()
#     new_pt = pt.translated(tan*move)
#     cross.scale(BigBrick.WIDTH/2)
#     c_new_pt = new_pt.translated(cross)
#     b = BigBrick(Frame(c_new_pt, tan, cross))
#     b.rotate(rotation)
#     bricks.append(b.draw())
#     return bricks

# def v_brick(point, move=0, rotation=0): # vertical brick
#     tan = polyline.tangent_at_point(point)
#     tan.unitize()
#     cross = tan.cross(Vector(0,0,1))
#     cross.unitize()
#     new_pt = pt.translated(cross*move)
#     cross.scale(Brick.WIDTH/2)
#     c_new_pt = new_pt.translated(cross)
#     b = BigBrick(Frame(c_new_pt, cross, tan))
#     b.rotate(rotation)
#     bricks.append(b.draw())
#     return bricks

# height = BigBrick.HEIGHT
# para_list = []
# for row in range(num_layers):
#     polyline = poly.translated([0,0,height*row])
#     points_list = polyline.divide(total_bricks)
#     # print(len(points_list))
#     for pt in points_list:
#         para = polyline.parameter_at(pt)
#         para_list.append(para)
#     print(len(para_list))
#     # polyline.rotate(math.radians(3*row), axis=Vector(0,0,1), point=center)
#     polylines.append(polyline)

#     # points_list = polyline.divide_by_length(unit_div)

#     n = 7
#     for i, pt in enumerate(points_list):
#         if row % 2 == 0: # even row
#             if i % n == 0 or i % n == 2 or i % n == 4: # horizontal
#                 h_brick(pt)
#             if i % n == 1 or i % n == 3 or i % n == 5: # vertical
#                 v_brick(pt)

#         else: # odd row
#             if i % n == 1 or i % n == 5: # horizontal
#                 h_brick(pt)
#             if i % n == 3: # vertical
#                 v_brick(pt)
               
# frames = []
# for b in bricks:
#     frame = b.frame
#     if frame.zaxis.z > 0:
#         frame.flip()
#     frames.append(frame)
# ---------- end py3_15 ----------
multiplication_14 = Multiplication(A=number_slider_44, B=number_slider_43)
panel_16 = Panel(multiplication_14)
draw_67 = COMPASDraw(cg=py3_15.bricks)  # -> rg; same code as draw
draw_68 = COMPASDraw(cg=py3_15.poly)  # -> rg; same code as draw
draw_69 = COMPASDraw(cg=py3_15.polylines)  # -> rg; same code as draw
draw_70 = COMPASDraw(cg=py3_15.center)  # -> rg; same code as draw
draw_71 = COMPASDraw(cg=py3_15.frames)  # -> rg; same code as draw
item_15 = ListItem(List=draw_71, Index=0, Wrap=True)  # -> Item, Item1, Item2
preview_14 = CustomPreview(Geometry=draw_67, Material=ColourSwatch(SwatchColor=RGB(196, 175, 106)))
pl_10 = ConstructPlane(Origin=item_15.Item, XAxis=item_15.Item1, YAxis=item_15.Item2)

# ----
pt_2 = ConstructPoint(XCoordinate=Slider(258, range=0..300), YCoordinate=Slider(196, range=0..200), ZCoordinate=0)
rectangle_2 = Rectangle(Plane=pt_2, XSize="-600 to 600", YSize="-380 to 380", Radius=0)  # -> Rectangle, Length
item_16 = ListItem(List=draw_62, Index=Slider(3, range=0..10), Wrap=True)
item_17 = ListItem(List=draw_67, Index=Slider(3, range=0..10), Wrap=True)
item_18 = ListItem(List=draw_62, Index=Slider(12, range=0..20), Wrap=True)
item_19 = ListItem(List=draw_67, Index=Slider(12, range=0..20), Wrap=True)
