# Grasshopper definition 102_design_tripod_column.gh (Grasshopper 1.0.8)
# plug-ins: treesloth01, Pufferfish

# ----
# LENGTH = 31.74
# WIDTH = 15.24
# HEIGHT = 9.98
panel = Panel("24")
panel_2 = Panel("12")
panel_3 = Panel("6")
length = Panel("31.74")
width = Panel("15.24")
height = Panel("9.98")

# ---- group: final_triangle tower_hor, ver_holes
number_slider = Slider(4, range=0..30)
number_slider_2 = Slider(1, range=0..100)
gap = Slider(4.5, range=0..10)
py3 = Python3Script(num_layers=number_slider_2, gap=gap, num_bricks=number_slider, rot=Slider(15, range=0..100))  # -> out, poly, polylines, center, frames, bricks; inputs num_layers: Int32, gap: Double, num_bricks: Int32, rot: Double
# ---------- py3: Python ----------
# r: compas
# venv: mas-2526

from compas_rhino.devtools import DevTools
DevTools.enable_reloader()

import math
from compas.geometry import Box, Point, Frame
from compas.geometry import Polygon, Polyline, Vector, Line
from brick_wall_2 import Brick

# Make curve as a triangle that is equal to the brick size
unit_div = ((Brick.LENGTH + Brick.WIDTH)/2) + gap
x = unit_div * num_bricks
y = x * math.sin(math.radians(60))

u = 18 # 45
v = 60 #72
pt_1 = Point(0+u,0+v,0)
pt_2 = Point(x+u, 0+v, 0)
pt_3 = Point(x/2+u, y+v, 0)
center = Point(x/2+u, y/3+v, 0)

pt_list = [pt_1, pt_2, pt_3, pt_1]
poly = Polyline(pt_list)

# make skeleton curves & primitive bricks
vectors = []
bricks = []
polylines = []
p_l = []

def horizontal_brick(point, move=0, rotation=0):
    tan = polyline.tangent_at_point(point)
    tan.unitize()
    cross = tan.cross(Vector(0,0,1))
    cross.unitize()
    new_pt = pt.translated(tan*move)
    cross.scale(Brick.WIDTH/2)
    c_new_pt = new_pt.translated(cross)
    b = Brick(Frame(c_new_pt, tan, cross))
    b.rotate(rotation)
    bricks.append(b.draw())
    return bricks

def vertical_brick(point, move=0, rotation=0):
    tan = polyline.tangent_at_point(point)
    cross = tan.cross(Vector(0,0,1))
    cross.unitize()
    new_pt = pt.translated(cross*move)
    cross.scale(Brick.WIDTH/2)
    c_new_pt = new_pt.translated(cross)
    b = Brick(Frame(c_new_pt, cross, tan))
    b.rotate(rotation)
    bricks.append(b.draw())
    return bricks

height = Brick.HEIGHT
for row in range(num_layers):
    polyline = poly.translated([0,0,height*row])
    polyline.rotate(math.radians(3*row), axis=Vector(0,0,1), point=center)
    polylines.append(polyline)
    points_list = polyline.divide_by_length(unit_div/2)
    print(len(points_list))

    for i, pt in enumerate(points_list):
        if row % 2 == 0: # even row
            if i % 8 == 0: # vertical
                vertical_brick(pt, move=3)
            if i % 8 == 4: # vertical
                vertical_brick(pt)
            if i % 4 == 2: # horizontal
                horizontal_brick(pt)
        else: # odd row
            if i % 8 == 1: # horizontal
                horizontal_brick(pt, move=3)
            if i % 8 == 5: # horizontal
                horizontal_brick(pt)
            if i % 8 == 7: # vertical
                vertical_brick(pt, rotation=rot)               
frames = []
for b in bricks:
    frame = b.frame
    if frame.zaxis.z > 0:
        frame.flip()
    frames.append(frame)
# ---------- end py3 ----------
multiplication = Multiplication(A=number_slider_2, B=number_slider)
panel_4 = Panel(multiplication)
draw = COMPASDraw(cg=py3.bricks)  # -> rg
#   port cg: The COMPAS geometry or datastructure to be drawn.
#   port rg: The Rhino geometry object.
# ---------- draw: Python ----------
# r: compas>=2.14.1
"""
Draws COMPAS geometry in Grasshopper.
"""

from typing import Any

import Grasshopper

from compas.scene import SceneObject


class CompasToRhinoGeometry(Grasshopper.Kernel.GH_ScriptInstance):
    def RunScript(self, cg):
        if not cg:
            return None

        return SceneObject(item=cg).draw()
# ---------- end draw ----------
draw_2 = COMPASDraw(cg=py3.poly)  # -> rg; same code as draw
draw_3 = COMPASDraw(cg=py3.polylines)  # -> rg; same code as draw
draw_4 = COMPASDraw(cg=py3.center)  # -> rg; same code as draw
draw_5 = COMPASDraw(cg=py3.frames)  # -> rg; same code as draw
item = ListItem(List=draw_5, Index=0, Wrap=True)  # -> Item, Item1, Item2
preview = CustomPreview(Geometry=draw, Material=ColourSwatch(SwatchColor=RGB(196, 175, 106)))
pl = ConstructPlane(Origin=item.Item, XAxis=item.Item1, YAxis=item.Item2)

# ----
number_slider_3 = Slider(9, range=0..10)
number_slider_4 = Slider(15, range=0..30)
pt = ConstructPoint(XCoordinate=0, YCoordinate=0, ZCoordinate=0)
gap_2 = Slider(3, range=0..10)
gap_3 = Slider(2, range=0..10)
addition = Addition(A=length, B=width)
h_brick = CenterBox(Base=pt, X=expr("x/2", length), Y=expr("x/2", width), Z=expr("x/2", height))
v_brick = CenterBox(Base=pt, X=expr("x/2", width), Y=expr("x/2", length), Z=expr("x/2", height))
division = Division(A=addition, B="2")
number_slider_5 = Slider(3, range=0..10)
number_slider_6 = Slider(0, range=0..180)
addition_2 = Addition(A=division, Gap=gap_3)
pt_2 = ConstructPoint(XCoordinate=number_slider_4, YCoordinate=0, ZCoordinate=0)
twist = Twist(Angle=1.570796327, Infinite=False, Rigid=False)
multiplication_2 = Multiplication(A=number_slider_5, B="2")
multiplication_3 = Multiplication(A=addition_2, B=number_slider_5)

pt_3 = ConstructPoint(XCoordinate=0, YCoordinate=Slider(12, range=0..100), ZCoordinate=0)
pt_4 = ConstructPoint(XCoordinate=0, YCoordinate="1", ZCoordinate=0)
number_slider_7 = Slider(120, range=0..180)
line = LineSDL(Start=pt_3, Direction=pt_4, Length=multiplication_3)
rotate = Rotate(Geometry=line, Angle=degrees(number_slider_7), Plane=pt_3)  # -> Geometry, Transform

addition_3 = Addition(A=number_slider_4, B=multiplication_3)
division_2 = Division(A=multiplication_3, B="1.732051")
pt_5 = ConstructPoint(XCoordinate=addition_3, YCoordinate=0, ZCoordinate=0)
polygon = Polygon(Plane=PlaneXY(0, 0, 0), Radius=division_2, Segments="3", FilletRadius=0)  # -> Polygon, Length

end = EndPoints(Curve=rotate.Geometry)  # -> Start, End
reparamcrv = ReparameterizeCurve(Curve=rotate.Geometry)  # -> Reparameterized, Original
eval = EvaluateCurve(Curve=reparamcrv.Reparameterized, Parameter=Slider(0.2, range=0..1))  # -> Point, Tangent, Angle
vec2pt = Vector2Pt(PointA=end.Start, PointB=eval.Point, Unitize=False)  # -> Vector, Length
move = Move(Geometry=rotate.Geometry, Motion=vec2pt.Vector)  # -> Geometry, Transform
end_2 = EndPoints(Curve=move.Geometry)  # -> Start, End
rotate_2 = Rotate(Geometry=move.Geometry, Angle=degrees(number_slider_7), Plane=end_2.Start)  # -> Geometry, Transform

explode = Explode(Curve=polygon.Polygon, Recursive=True)  # -> Segments, Vertices
hframe = HorizontalFrame(Curve=reparameterize(explode.Segments), Parameter="0.5")
ln = Line(StartPoint=pt_2, EndPoint=pt_5)
rotate_3 = Rotate(Geometry=polygon.Polygon, Angle=degrees(Slider(30, range=0..180)), Plane=PlaneXY(0, 0, 0))  # -> Geometry, Transform
pt_6 = ConstructPoint(XCoordinate=multiplication_3, YCoordinate=0, ZCoordinate=0)
pt_7 = ConstructPoint(XCoordinate=0, YCoordinate=0, ZCoordinate=0)
deplane = DeconstructPlane(Plane=hframe)  # -> Origin, XAxis, YAxis, ZAxis
len = Length(Curve=explode.Segments)
arrpolar = PolarArray(Geometry=ln, Plane=PlaneXY(0, 0, 0), Count="3", Angle=6.283185307)  # -> Geometry, Transform
explode_2 = Explode(Curve=rotate_3.Geometry, Recursive=True)  # -> Segments, Vertices
ln_2 = Line(StartPoint=pt_7, EndPoint=pt_6)
panel_5 = Panel(len)
neg = Negative(Value=number_slider_4)
item_2 = ListItem(List=explode_2.Segments, Index="-1", Wrap=True)
item_3 = ListItem(List=arrpolar.Geometry, Index=0, Wrap=True)
amp = Amplitude(Vector=deplane.YAxis, Amplitude=neg)
Z = UnitZ(Factor=height)

number_slider_8 = Slider(30, range=0..180)

move_2 = Move(Geometry=explode.Segments, Motion=amp)  # -> Geometry, Transform
neg_2 = Negative(Value=Slider(120, range=0..180))
item_4 = ListItem(List=draw, Index=Slider(12, range=0..20), Wrap=True)

end_3 = EndPoints(Curve=rotate_2.Geometry)  # -> Start, End
reparamcrv_2 = ReparameterizeCurve(Curve=rotate_2.Geometry)  # -> Reparameterized, Original
eval_2 = EvaluateCurve(Curve=reparamcrv_2.Reparameterized, Parameter=Slider(0.2, range=0..1))  # -> Point, Tangent, Angle
vec2pt_2 = Vector2Pt(PointA=end_3.Start, PointB=eval_2.Point, Unitize=False)  # -> Vector, Length
move_3 = Move(Geometry=rotate_2.Geometry, Motion=vec2pt_2.Vector)  # -> Geometry, Transform
end_4 = EndPoints(Curve=move_3.Geometry)  # -> Start, End
rotate_4 = Rotate(Geometry=move_3.Geometry, Angle=degrees(number_slider_7), Plane=end_4.Start)  # -> Geometry, Transform

pt_8 = ConstructPoint(XCoordinate=0, YCoordinate=0, ZCoordinate=0)
P = Plane(PlaneXY(0, 0, 0))
number_slider_9 = Slider(0, range=0..360)
panel_6 = Panel("""0
1
2""")

number_slider_10 = Slider(0, range=0..360)
neg_3 = Negative(Value=Slider(30, range=0..100))

pt_9 = ConstructPoint(XCoordinate=0, YCoordinate=0, ZCoordinate=0)
P_2 = Plane(PlaneXY(0, 0, 0))
merge = Merge(Data1=rotate.Geometry, Data2=rotate_2.Geometry, Data3=rotate_4.Geometry)
end_5 = EndPoints(Curve=merge)  # -> Start, End
pline = PolyLine(Vertices=end_5.End, Closed=invert(False))
number_slider_11 = Slider(9, range=0..10)
area = Area(Geometry=pline)  # -> Area, Centroid
rotate_5 = Rotate(Geometry=merge, Angle=degrees(Slider(120, range=0..180)), Plane=area.Centroid)  # -> simplify(graft(Geometry)), Transform
rotate_6 = Rotate(Geometry=merge, Angle=degrees(Slider(60, range=0..100)), Plane=area.Centroid)  # -> Geometry, Transform
pdecon = Deconstruct(Point=area.Centroid)  # -> XComponent, YComponent, ZComponent
panel_7 = Panel(area.Centroid)
item_5 = ListItem(List=rotate_6.Geometry, Index=Slider(1, range=0..2), Wrap=True)

relay = Relay()
tstat = TreeStatistics(Tree=relay)  # -> Paths, Length, Count
item_6 = ListItem(List=tstat.Paths, Index=Slider(1, range=0..10), Wrap=True)
branch = TreeBranch(Tree=relay, Path=item_6, MaintainPaths=True)
item_7 = ListItem(List=branch, Index=Slider(0, range=0..10), Wrap=True)

midpt = CurveMiddle(Curve=item_5)
end_6 = EndPoints(Curve=item_5)  # -> Start, End
end_7 = EndPoints(Curve=rotate_5.Geometry)  # -> Start, End
midpt_2 = CurveMiddle(Curve=rotate_5.Geometry)
pt_10 = Point(end_6.Start)
pt_11 = Point(end_7.Start)
number_slider_12 = Slider(30, range=0..100)
end_8 = EndPoints(Curve=rotate_5.Geometry)  # -> Start, End
vec2pt_3 = Vector2Pt(PointA=end_8.Start, PointB=end_8.End, Unitize=False)  # -> Vector, Length
neg_4 = Negative(Value=Slider(0, range=0..120))
amp_2 = Amplitude(Vector=vec2pt_3.Vector, Amplitude=Slider(12, range=0..50))
orient = Orient(Source=PlaneXY(0, 0, 0), Target=PlaneXY(0, 0, 0))  # -> Geometry, Transform
number_slider_13 = Slider(42, range=0..100)
number_slider_14 = Slider(90, range=0..100)

# ---- group: final_tri_pod
# polar array location???
number_slider_15 = Slider(100, range=0..100)
crv_v2 = Curve([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])
py3_2 = Python3Script(curves=crv_v2, x=number_slider_15, y=Slider(95, range=0..100))  # -> out, points, primitive_bricks, way_frame, polar_bricks, moved_bricks; inputs curves: list of Curve, x: Double, y: Double
# ---------- py3_2: Python ----------
# r: compas
# venv: mas-2526
from compas_rhino.devtools import DevTools
DevTools.ensure_path()

import math
from compas.geometry import Box, Point, Frame, Vector, cross_vectors, Rotation, Translation
from compas_rhino.conversions import curve_to_compas
from brick_wall_2 import Brick

crvs = []
points = []
bricks = []

# convert curves to compas
for c in curves:
    crvs.append(curve_to_compas(c))

# build param list for curves
def param_list(curve, num_div):
    params = curve.divide_by_count(num_div)
    return params

def get_h_brick(curve, param):  # horizontal bricks
    pt = curve.point_at(param)
    points.append(pt)
    tan = crv.tangent_at(param)
    nor = tan.cross(Vector(0, 0, 1))
    frame = Frame(pt, tan, nor)
    b = Brick(frame)
    return b


def get_v_brick(curve, param):  # vertical bricks
    pt = curve.point_at(param)
    points.append(pt)
    tan = crv.tangent_at(param)
    nor = tan.cross(Vector(0, 0, 1))
    frame = Frame(pt, nor, tan)
    b = Brick(frame)
    return b


# === Polar Array_basic parameter setting ===
center = Point(-7.5, 7.5, 0)

axis = Vector(0, 0, 1)
angle = math.radians(360 / 3)  # rotatie 120° every time
polar_bricks = []

# === lay bricks layer by layer（polar array first）===
for i_c, crv in enumerate(crvs):
    layer_bricks = []  # temporary save the primitive bricks

    n = 5
    params = param_list(crv, n)
    if i_c % 2 == 0:  # even row
        for i_p, param in enumerate(params):
            if i_p % (n+1) == 1 or i_p % (n+1) == 5:  # horizontal bricks
                b = get_h_brick(crv, param)
                layer_bricks.append(b)
            if i_p % (n+1) == 3:  # vertical bricks
                b = get_v_brick(crv, param)
                layer_bricks.append(b)

    if i_c % 2 == 1:  # odd row
        for i_p, param in enumerate(params):
            if i_p % (n+1) == 1 or i_p % (n+1) == 5:  # horizontal bricks
                b = get_v_brick(crv, param)
                layer_bricks.append(b)
            if i_p % (n+1) == 3:  # vertical bricks
                b = get_h_brick(crv, param)
                layer_bricks.append(b)

    # === polar array ===
    for i in range(3):  # 3 groups (0°,120°,240°)
        R = Rotation.from_axis_and_angle(axis, angle * i, point=center)
        for b in layer_bricks:
            fr = b.frame
            r_fr = fr.transformed(R)
            bb = Brick(r_fr)
            polar_bricks.append(bb.draw())
        
# === move the whole structure ===
# moving vector setting
move_vec = Vector(x, y, 0)
T = Translation.from_vector(move_vec)

moved_bricks = []
for b in polar_bricks:
    fr = b.frame
    m_fr = fr.transformed(T)
    moved_bricks.append(Brick(m_fr).draw())

# === Flip frames  ===
way_frame = []
for b in moved_bricks:
    fr = b.frame
    if fr.zaxis.z > 0:
        fr.flip()
    way_frame.append(fr)

print("Total bricks after layered polar array:", len(moved_bricks))
# ---------- end py3_2 ----------
draw_6 = COMPASDraw(cg=py3_2.primitive_bricks)  # -> rg; same code as draw
draw_7 = COMPASDraw(cg=py3_2.points)  # -> rg; same code as draw
draw_8 = COMPASDraw(cg=py3_2.polar_bricks)  # -> rg; same code as draw
draw_9 = COMPASDraw(cg=py3_2.way_frame)  # -> rg; same code as draw
draw_10 = COMPASDraw(cg=py3_2.moved_bricks)  # -> rg; same code as draw
item_8 = ListItem(List=draw_9, Index=0, Wrap=True)  # -> Item, Item1, Item2
pl_2 = ConstructPlane(Origin=item_8.Item, XAxis=item_8.Item1, YAxis=item_8.Item2)
item_9 = ListItem(List=flatten(pl_2), Index=Slider(0, range=0..100), Wrap=True)
preview_2 = CustomPreview(Geometry=draw_8, Material=ColourSwatch(SwatchColor=RGB(186, 98, 39)))
preview_3 = CustomPreview(Geometry=draw_10, Material=ColourSwatch(SwatchColor=RGB(186, 98, 39)))

# ----
dom = ConstructDomain(DomainStart=expr("-x", number_slider_14), DomainEnd=number_slider_14)
crv_v1 = Curve([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])
panel_8 = Panel("""0
-1""")

number_slider_16 = Slider(100, range=0..100)  # disabled
number_slider_17 = Slider(95, range=0..100)  # disabled
crv = Curve([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])  # disabled
py3_3 = Python3Script(curves=crv, x=number_slider_16, y=number_slider_17)  # -> out, points, way_frame, polar_bricks, moved_bricks; inputs curves: list of Curve, x: Double, y: Double; disabled
# ---------- py3_3: Python ----------
# r: compas
# venv: mas-2526
from compas_rhino.devtools import DevTools
DevTools.ensure_path()

import math
from compas.geometry import Box, Point, Frame, Vector, cross_vectors, Rotation, Translation
from compas_rhino.conversions import curve_to_compas
from brick_wall_2 import Brick

crvs = []
points = []
frames = []
bricks = []

# convert curves to compas
for c in curves:
    crvs.append(curve_to_compas(c))

# build param list for curves
def param_list(curve, num_div):
    params = curve.divide_by_count(num_div)
    return params

def get_h_brick(curve, param):  # horizontal bricks
    pt = curve.point_at(param)
    points.append(pt)
    tan = crv.tangent_at(param)
    nor = tan.cross(Vector(0, 0, 1))
    frame = Frame(pt, tan, nor)
    frames.append(frame)
    b = Brick(frame)
    return b


def get_v_brick(curve, param):  # vertical bricks
    pt = curve.point_at(param)
    points.append(pt)
    tan = crv.tangent_at(param)
    nor = tan.cross(Vector(0, 0, 1))
    frame = Frame(pt, nor, tan)
    frames.append(frame)
    b = Brick(frame)
    return b


# === Polar Array_basic parameter setting ===
center = Point(0, 0, 0)
axis = Vector(0, 0, 1)
angle = math.radians(360 / 3)  # rotatie 120° every time
polar_bricks = []

# === lay bricks layer by layer（polar array first）===
for i_c, crv in enumerate(crvs):
    layer_bricks = []  # temporary save the primitive bricks

    params = param_list(crv, 6)
    if i_c % 2 == 0:  # even row
        for i_p, param in enumerate(params):
            if i_p % 7 == 1 or i_p % 7 == 5:  # horizontal bricks
                b = get_h_brick(crv, param)
                layer_bricks.append(b)
            if i_p % 7 == 3:  # vertical bricks
                b = get_v_brick(crv, param)
                layer_bricks.append(b)

    if i_c % 2 == 1:  # odd row
        for i_p, param in enumerate(params):
            if i_p % 7 == 2 or i_p % 7 == 6:  # horizontal bricks
                b = get_h_brick(crv, param)
                layer_bricks.append(b)
            if i_p % 7 == 4:  # vertical bricks
                b = get_v_brick(crv, param)
                layer_bricks.append(b)

    # === polar array ===
    for i in range(3):  # 3 groups (0°,120°,240°)
        R = Rotation.from_axis_and_angle(axis, angle * i, point=center)
        for b in layer_bricks:
            fr = b.frame
            r_fr = fr.transformed(R)
            bb = Brick(r_fr)
            polar_bricks.append(bb.draw())

# === move the whole structure ===
# moving vector setting
move_vec = Vector(x, y, 0)
T = Translation.from_vector(move_vec)

moved_bricks = []
for b in polar_bricks:
    fr = b.frame
    m_fr = fr.transformed(T)
    moved_bricks.append(Brick(m_fr).draw())

# === Flip frames  ===
way_frame = []
for b in moved_bricks:
    fr = b.frame
    if fr.zaxis.z > 0:
        fr.flip()
    way_frame.append(fr)

print("Total bricks after layered polar array:", len(moved_bricks))
# ---------- end py3_3 ----------
draw_11 = COMPASDraw(cg=py3_3.points)  # -> rg; disabled; same code as draw
draw_12 = COMPASDraw(cg=py3_3.way_frame)  # -> rg; disabled; same code as draw
draw_13 = COMPASDraw(cg=py3_3.polar_bricks)  # -> rg; disabled; same code as draw
draw_14 = COMPASDraw(cg=py3_3.moved_bricks)  # -> rg; disabled; same code as draw
number_slider_18 = Slider(0, range=0..100)  # disabled
item_10 = ListItem(List=draw_12, Index=0, Wrap=True)  # -> Item, Item1, Item2; disabled
swatch = ColourSwatch(SwatchColor=RGB(186, 98, 39))  # disabled
swatch_2 = ColourSwatch(SwatchColor=RGB(186, 98, 39))  # disabled
pl_3 = ConstructPlane(Origin=item_10.Item, XAxis=item_10.Item1, YAxis=item_10.Item2)  # disabled
item_11 = ListItem(List=flatten(pl_3), Index=number_slider_18, Wrap=True)  # disabled
preview_4 = CustomPreview(Geometry=draw_13, Material=swatch)  # disabled
preview_5 = CustomPreview(Geometry=draw_14, Material=swatch_2)  # disabled

crv_2 = Curve([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])  # disabled

number_slider_19 = Slider(100, range=0..100)  # disabled
number_slider_20 = Slider(95, range=0..100)  # disabled
crv_3 = Curve([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])  # disabled
py3_4 = Python3Script(curves=crv_3, x=number_slider_19, y=number_slider_20)  # -> out, points, primitive_bricks, way_frame, polar_bricks, moved_bricks; inputs curves: list of Curve, x: Double, y: Double; disabled
# ---------- py3_4: Python ----------
# r: compas
# venv: mas-2526
from compas_rhino.devtools import DevTools
DevTools.ensure_path()

import math
from compas.geometry import Box, Point, Frame, Vector, cross_vectors, Rotation, Translation
from compas_rhino.conversions import curve_to_compas
from brick_wall_2 import Brick

crvs = []
points = []
bricks = []

# convert curves to compas
for c in curves:
    crvs.append(curve_to_compas(c))

# build param list for curves
def param_list(curve, num_div):
    params = curve.divide_by_count(num_div)
    return params

def get_h_brick(curve, param):  # horizontal bricks
    pt = curve.point_at(param)
    points.append(pt)
    tan = crv.tangent_at(param)
    nor = tan.cross(Vector(0, 0, 1))
    frame = Frame(pt, tan, nor)
    b = Brick(frame)
    return b


def get_v_brick(curve, param):  # vertical bricks
    pt = curve.point_at(param)
    points.append(pt)
    tan = crv.tangent_at(param)
    nor = tan.cross(Vector(0, 0, 1))
    frame = Frame(pt, nor, tan)
    b = Brick(frame)
    return b


# === Polar Array_basic parameter setting ===
center = Point(0, 0, 0)
axis = Vector(0, 0, 1)
angle = math.radians(360 / 3)  # rotatie 120° every time
polar_bricks = []

# === lay bricks layer by layer（polar array first）===
for i_c, crv in enumerate(crvs):
    layer_bricks = []  # temporary save the primitive bricks

    params = param_list(crv, 6)
    if i_c % 2 == 0:  # even row
        for i_p, param in enumerate(params):
            if i_p % 7 == 1 or i_p % 7 == 5:  # horizontal bricks
                b = get_h_brick(crv, param)
                layer_bricks.append(b)
            if i_p % 7 == 3:  # vertical bricks
                b = get_v_brick(crv, param)
                layer_bricks.append(b)

    if i_c % 2 == 1:  # odd row
        for i_p, param in enumerate(params):
            if i_p % 7 == 2 or i_p % 7 == 6:  # horizontal bricks
                b = get_h_brick(crv, param)
                layer_bricks.append(b)
            if i_p % 7 == 4:  # vertical bricks
                b = get_v_brick(crv, param)
                layer_bricks.append(b)

    # === polar array ===
    for i in range(3):  # 3 groups (0°,120°,240°)
        R = Rotation.from_axis_and_angle(axis, angle * i, point=center)
        for b in layer_bricks:
            fr = b.frame
            r_fr = fr.transformed(R)
            bb = Brick(r_fr)
            polar_bricks.append(bb.draw())
        
# === move the whole structure ===
# moving vector setting
move_vec = Vector(x, y, 0)
T = Translation.from_vector(move_vec)

moved_bricks = []
for b in polar_bricks:
    fr = b.frame
    m_fr = fr.transformed(T)
    moved_bricks.append(Brick(m_fr).draw())

# === Flip frames  ===
way_frame = []
for b in moved_bricks:
    fr = b.frame
    if fr.zaxis.z > 0:
        fr.flip()
    way_frame.append(fr)

print("Total bricks after layered polar array:", len(moved_bricks))
# ---------- end py3_4 ----------
draw_15 = COMPASDraw(cg=py3_4.points)  # -> rg; disabled; same code as draw
draw_16 = COMPASDraw(cg=py3_4.polar_bricks)  # -> rg; disabled; same code as draw
draw_17 = COMPASDraw(cg=py3_4.way_frame)  # -> rg; disabled; same code as draw
draw_18 = COMPASDraw(cg=py3_4.moved_bricks)  # -> rg; disabled; same code as draw
number_slider_21 = Slider(0, range=0..100)  # disabled
item_12 = ListItem(List=draw_17, Index=0, Wrap=True)  # -> Item, Item1, Item2; disabled
swatch_3 = ColourSwatch(SwatchColor=RGB(186, 98, 39))  # disabled
swatch_4 = ColourSwatch(SwatchColor=RGB(186, 98, 39))  # disabled
pl_4 = ConstructPlane(Origin=item_12.Item, XAxis=item_12.Item1, YAxis=item_12.Item2)  # disabled
item_13 = ListItem(List=flatten(pl_4), Index=number_slider_21, Wrap=True)  # disabled
preview_6 = CustomPreview(Geometry=draw_16, Material=swatch_3)  # disabled
preview_7 = CustomPreview(Geometry=draw_18, Material=swatch_4)  # disabled

draw_19 = COMPASDraw(cg=py3_4.primitive_bricks)  # -> rg; disabled; same code as draw

number_slider_22 = Slider(100, range=0..100)  # disabled
number_slider_23 = Slider(95, range=0..100)  # disabled
crv_2_2 = Curve(flatten([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]))  # disabled
crv_1 = Curve([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])  # disabled
py3_5 = Python3Script(curves=crv_2_2, x=number_slider_22, y=number_slider_23)  # -> out, points, primitive_bricks, way_frame, polar_bricks, moved_bricks; inputs curves: list of Curve, x: Double, y: Double; disabled
# ---------- py3_5: Python ----------
# r: compas
# venv: mas-2526
from compas_rhino.devtools import DevTools
DevTools.ensure_path()

import math
from compas.geometry import Box, Point, Frame, Vector, cross_vectors, Rotation, Translation
from compas_rhino.conversions import curve_to_compas
from brick_wall_2 import Brick

crvs = []
points = []
bricks = []

# convert curves to compas
for c in curves:
    crvs.append(curve_to_compas(c))

# build param list for curves
def param_list(curve, num_div):
    params = curve.divide_by_count(num_div)
    return params

def get_h_brick(curve, param):  # horizontal bricks
    pt = curve.point_at(param)
    points.append(pt)
    tan = crv.tangent_at(param)
    nor = tan.cross(Vector(0, 0, 1))
    frame = Frame(pt, tan, nor)
    b = Brick(frame)
    return b


def get_v_brick(curve, param):  # vertical bricks
    pt = curve.point_at(param)
    points.append(pt)
    tan = crv.tangent_at(param)
    nor = tan.cross(Vector(0, 0, 1))
    frame = Frame(pt, nor, tan)
    b = Brick(frame)
    return b


# === Polar Array_basic parameter setting ===
center = Point(0, 0, 0)
axis = Vector(0, 0, 1)
angle = math.radians(360 / 3)  # rotatie 120° every time
polar_bricks = []

# === lay bricks layer by layer（polar array first）===
for i_c, crv in enumerate(crvs):
    layer_bricks = []  # temporary save the primitive bricks

    params = param_list(crv, 6)
    if i_c % 2 == 0:  # even row
        for i_p, param in enumerate(params):
            if i_p % 7 == 1 or i_p % 7 == 5:  # horizontal bricks
                b = get_h_brick(crv, param)
                layer_bricks.append(b)
            if i_p % 7 == 3:  # vertical bricks
                b = get_v_brick(crv, param)
                layer_bricks.append(b)

    if i_c % 2 == 1:  # odd row
        for i_p, param in enumerate(params):
            if i_p % 7 == 2 or i_p % 7 == 6:  # horizontal bricks
                b = get_h_brick(crv, param-3)
                layer_bricks.append(b)
            if i_p % 7 == 4:  # vertical bricks
                b = get_v_brick(crv, param-4)
                layer_bricks.append(b)

    # === polar array ===
    for i in range(3):  # 3 groups (0°,120°,240°)
        R = Rotation.from_axis_and_angle(axis, angle * i, point=center)
        for b in layer_bricks:
            fr = b.frame
            r_fr = fr.transformed(R)
            bb = Brick(r_fr)
            polar_bricks.append(bb.draw())
        
# === move the whole structure ===
# moving vector setting
move_vec = Vector(x, y, 0)
T = Translation.from_vector(move_vec)

moved_bricks = []
for b in polar_bricks:
    fr = b.frame
    m_fr = fr.transformed(T)
    moved_bricks.append(Brick(m_fr).draw())

# === Flip frames  ===
way_frame = []
for b in moved_bricks:
    fr = b.frame
    if fr.zaxis.z > 0:
        fr.flip()
    way_frame.append(fr)

print("Total bricks after layered polar array:", len(moved_bricks))
# ---------- end py3_5 ----------
draw_20 = COMPASDraw(cg=py3_5.primitive_bricks)  # -> rg; disabled; same code as draw
draw_21 = COMPASDraw(cg=py3_5.points)  # -> rg; disabled; same code as draw
draw_22 = COMPASDraw(cg=py3_5.polar_bricks)  # -> rg; disabled; same code as draw
draw_23 = COMPASDraw(cg=py3_5.way_frame)  # -> rg; disabled; same code as draw
draw_24 = COMPASDraw(cg=py3_5.moved_bricks)  # -> rg; disabled; same code as draw
number_slider_24 = Slider(0, range=0..100)  # disabled
item_14 = ListItem(List=draw_23, Index=0, Wrap=True)  # -> Item, Item1, Item2; disabled
swatch_5 = ColourSwatch(SwatchColor=RGB(186, 98, 39))  # disabled
swatch_6 = ColourSwatch(SwatchColor=RGB(186, 98, 39))  # disabled
pl_5 = ConstructPlane(Origin=item_14.Item, XAxis=item_14.Item1, YAxis=item_14.Item2)  # disabled
item_15 = ListItem(List=flatten(pl_5), Index=number_slider_24, Wrap=True)  # disabled
preview_8 = CustomPreview(Geometry=draw_22, Material=swatch_5)  # disabled
preview_9 = CustomPreview(Geometry=draw_24, Material=swatch_6)  # disabled

number_slider_25 = Slider(100, range=0..100)  # disabled
number_slider_26 = Slider(95, range=0..100)  # disabled
crv_5 = Curve(flatten([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]))  # disabled
crv_2_3 = Curve(flatten([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]))  # disabled
crv_3_2 = Curve(flatten([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]))  # disabled
crv_4 = Curve(flatten([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]))  # disabled
crv_1_2 = Curve([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])  # disabled
py3_6 = Python3Script(curves=crv_5, x=number_slider_25, y=number_slider_26)  # -> out, points, primitive_bricks, way_frame, polar_bricks, moved_bricks; inputs curves: list of Curve, x: Double, y: Double; disabled
# ---------- py3_6: Python ----------
# r: compas
# venv: mas-2526
from compas_rhino.devtools import DevTools
DevTools.ensure_path()

import math
from compas.geometry import Box, Point, Frame, Vector, cross_vectors, Rotation, Translation
from compas_rhino.conversions import curve_to_compas
from brick_wall_2 import Brick

crvs = []
points = []
bricks = []

# convert curves to compas
for c in curves:
    crvs.append(curve_to_compas(c))

# build param list for curves
def param_list(curve, num_div):
    params = curve.divide_by_count(num_div)
    return params

def get_h_brick(curve, param):  # horizontal bricks
    pt = curve.point_at(param)
    points.append(pt)
    tan = crv.tangent_at(param)
    nor = tan.cross(Vector(0, 0, 1))
    frame = Frame(pt, tan, nor)
    b = Brick(frame)
    return b


def get_v_brick(curve, param):  # vertical bricks
    pt = curve.point_at(param)
    points.append(pt)
    tan = crv.tangent_at(param)
    nor = tan.cross(Vector(0, 0, 1))
    frame = Frame(pt, nor, tan)
    b = Brick(frame)
    return b


# === Polar Array_basic parameter setting ===
center = Point(0, 0, 0)
axis = Vector(0, 0, 1)
angle = math.radians(360 / 3)  # rotatie 120° every time
polar_bricks = []

# === lay bricks layer by layer（polar array first）===
for i_c, crv in enumerate(crvs):
    layer_bricks = []  # temporary save the primitive bricks

    params = param_list(crv, 6)
    if i_c % 2 == 0:  # even row
        for i_p, param in enumerate(params):
            if i_p % 7 == 1 or i_p % 7 == 5:  # horizontal bricks
                b = get_h_brick(crv, param)
                layer_bricks.append(b)
            if i_p % 7 == 3:  # vertical bricks
                b = get_v_brick(crv, param)
                layer_bricks.append(b)

    if i_c % 2 == 1:  # odd row
        for i_p, param in enumerate(params):
            if i_p % 7 == 2 or i_p % 7 == 6:  # horizontal bricks
                b = get_v_brick(crv, param-14)
                layer_bricks.append(b)
            if i_p % 7 == 4:  # vertical bricks
                b = get_h_brick(crv, param-14)
                layer_bricks.append(b)

    # === polar array ===
    for i in range(3):  # 3 groups (0°,120°,240°)
        R = Rotation.from_axis_and_angle(axis, angle * i, point=center)
        for b in layer_bricks:
            fr = b.frame
            r_fr = fr.transformed(R)
            bb = Brick(r_fr)
            polar_bricks.append(bb.draw())
        
# === move the whole structure ===
# moving vector setting
move_vec = Vector(x, y, 0)
T = Translation.from_vector(move_vec)

moved_bricks = []
for b in polar_bricks:
    fr = b.frame
    m_fr = fr.transformed(T)
    moved_bricks.append(Brick(m_fr).draw())

# === Flip frames  ===
way_frame = []
for b in moved_bricks:
    fr = b.frame
    if fr.zaxis.z > 0:
        fr.flip()
    way_frame.append(fr)

print("Total bricks after layered polar array:", len(moved_bricks))
# ---------- end py3_6 ----------
draw_25 = COMPASDraw(cg=py3_6.primitive_bricks)  # -> rg; disabled; same code as draw
draw_26 = COMPASDraw(cg=py3_6.points)  # -> rg; disabled; same code as draw
draw_27 = COMPASDraw(cg=py3_6.polar_bricks)  # -> rg; disabled; same code as draw
draw_28 = COMPASDraw(cg=py3_6.way_frame)  # -> rg; disabled; same code as draw
draw_29 = COMPASDraw(cg=py3_6.moved_bricks)  # -> rg; disabled; same code as draw
number_slider_27 = Slider(0, range=0..100)  # disabled
item_16 = ListItem(List=draw_28, Index=0, Wrap=True)  # -> Item, Item1, Item2; disabled
swatch_7 = ColourSwatch(SwatchColor=RGB(186, 98, 39))  # disabled
swatch_8 = ColourSwatch(SwatchColor=RGB(186, 98, 39))  # disabled
pl_6 = ConstructPlane(Origin=item_16.Item, XAxis=item_16.Item1, YAxis=item_16.Item2)  # disabled
item_17 = ListItem(List=flatten(pl_6), Index=number_slider_27, Wrap=True)  # disabled
preview_10 = CustomPreview(Geometry=draw_27, Material=swatch_7)  # disabled
preview_11 = CustomPreview(Geometry=draw_29, Material=swatch_8)  # disabled

pt_12 = ConstructPoint(XCoordinate=multiplication_3, YCoordinate=0, ZCoordinate=0)
ln_3 = Line(StartPoint=pt, EndPoint=pt_12)
X = UnitX(Factor=Slider(6, range=0..100))
move_4 = Move(Geometry=ln_3, Motion=X)  # -> Geometry, Transform
midpt_3 = CurveMiddle(Curve=move_4.Geometry)
number_slider_28 = Slider(30, range=0..720)

divide = DivideCurve(Curve=move_4.Geometry, Count=multiplication_2, Kinks=False)  # -> Points, Tangents, Parameters
cull_i = CullIndex(List=divide.Points, Indices="-1", Wrap=True)
dispatch = Dispatch(List=cull_i, DispatchPattern=[True, False])  # -> ListA, ListB
move_5 = Move(Geometry=dispatch.ListB, Motion=Z)  # -> Geometry, Transform
dispatch_2 = Dispatch(List=dispatch.ListA, DispatchPattern=[True, False])  # -> ListA, ListB
dispatch_3 = Dispatch(List=move_5.Geometry, DispatchPattern=[True, False])  # -> ListA, ListB
merge_2 = Merge(Data1=dispatch_2.ListA, Data2=dispatch_3.ListA)
merge_3 = Merge(Data1=dispatch_2.ListB, Data2=dispatch_3.ListB)
h_brick_2 = CenterBox(Base=merge_2, X=expr("x/2", length), Y=expr("x/2", width), Z=expr("x/2", height))
v_brick_2 = CenterBox(Base=merge_3, X=expr("x/2", width), Y=expr("x/2", length), Z=expr("x/2", height))

row = Slider(3, range=0..10)
P_3 = Plane(PlaneXY(0, 0, 0))
panel_9 = Panel("""0
1
2""")

multiplication_4 = Multiplication(Col="3", Row=row)
division_3 = Division(A="150", B=multiplication_4)
round = Round(Number=division_3)  # -> Nearest, Floor, Ceiling
multiplication_5 = Multiplication(A=height, B=round.Floor)
height_column = Panel(multiplication_5)

Z_2 = UnitZ(Factor=multiplication_5)
move_6 = Move(Geometry=move_4.Geometry, Motion=Z_2)  # -> Geometry, Transform
line_2 = LineSDL(Start=midpt_3, Direction=Vector(0, 0, 1), Length=multiplication_5)
loft = Loft(
    Curves=[move_4.Geometry, move_6.Geometry],
    Options={Adjust=False, Closed=False, LoftEnds=0, LoftSimp=0, LoftType=0, Rebuild=10, Refit=0.01})
twist_2 = Twist(Geometry=loft, Axis=line_2, Angle=degrees(Slider(90, range=0..720)), Infinite=False, Rigid=False)

Z_3 = UnitZ(Factor=multiplication_5)
move_7 = Move(Geometry=item_2, Motion=Z_3)  # -> Geometry, Transform
Z_4 = UnitZ(Factor=multiplication_5)

arrpolar_2 = PolarArray(Geometry=twist_2, Plane=P_3, Count=row, Angle=6.283185307)  # -> Geometry, Transform
contour = Contour(Shape=arrpolar_2.Geometry, Point=Point(0, 0, 0), Direction=Vector(0, 0, 1), Distance=height)
reparamcrv_3 = ReparameterizeCurve(Curve=contour)  # -> Reparameterized, Original
trim = TrimTree(Tree=reparamcrv_3.Reparameterized, Depth=1)  # -> simplify(Tree)
bang = ExplodeTree(Data=trim)  # -> Branch0, Branch1, Branch2
weave = Weave(Pattern=panel_9, Stream0=bang.Branch0, Stream1=bang.Branch1, Stream2=bang.Branch2, NullGaps=False)

move_8 = Move(Geometry=move_2.Geometry, Motion=Z_4)  # -> Geometry, Transform
loft_2 = Loft(
    Curves=[move_7.Geometry, item_3],
    Options={Adjust=False, Closed=False, LoftEnds=0, LoftSimp=0, LoftType=0, Rebuild=10, Refit=0.01})
rotate_7 = Rotate(Geometry=move_8.Geometry, Angle=degrees(neg_2), Plane=PlaneXY(0, 0, 0))  # -> Geometry, Transform
arrpolar_3 = PolarArray(Geometry=loft_2, Plane=P, Count="3", Angle=6.283185307)  # -> Geometry, Transform
ln_4 = Line(StartPoint=pt_8, EndPoint=Z_3)
dispatch_4 = Dispatch(List=trim, DispatchPattern=[True, False])  # -> ListA, ListB
item_18 = ListItem(List=rotate_7.Geometry, Index=0, Wrap=True)
bang_2 = ExplodeTree(Data=dispatch_4.ListA)  # -> Branch0, Branch1, Branch2
bang_3 = ExplodeTree(Data=dispatch_4.ListB)  # -> Branch0, Branch1, Branch2
loft_3 = Loft(
    Curves=[item_18, item_3],
    Options={Adjust=False, Closed=False, LoftEnds=0, LoftSimp=0, LoftType=0, Rebuild=10, Refit=0.01})
twist_3 = Twist(Geometry=arrpolar_3.Geometry, Axis=ln_4, Angle=degrees(Slider(60, range=0..360)), Infinite=False, Rigid=False)
weave_2 = Weave(Pattern=panel_6, Stream0=bang_2.Branch0, Stream1=bang_2.Branch1, Stream2=bang_2.Branch2, NullGaps=False)
weave_3 = Weave(Pattern=panel_6, Stream0=bang_3.Branch0, Stream1=bang_3.Branch1, Stream2=bang_3.Branch2, NullGaps=False)
arrpolar_4 = PolarArray(Geometry=loft_3, Plane=P_2, Count="3", Angle=6.283185307)  # -> Geometry, Transform
ln_5 = Line(StartPoint=pt_9, EndPoint=Z_3)

multiplication_6 = Multiplication(A=number_slider_5, B="2")
hframes = HorizontalFrames(Curve=weave_2, Count=multiplication_6)  # -> simplify(Frames), Parameters
cull_i_2 = CullIndex(List=hframes.Frames, Indices="-1", Wrap=True)  # -> simplify(List)

multiplication_7 = Multiplication(A=number_slider_5, B="2")
hframes_2 = HorizontalFrames(Curve=weave, Count=multiplication_7)  # -> simplify(Frames), Parameters
cull_i_3 = CullIndex(List=hframes_2.Frames, Indices="-1", Wrap=True)  # -> simplify(List)

multiplication_8 = Multiplication(A=number_slider_5, B="2")
hframes_3 = HorizontalFrames(Curve=weave_3, Count=multiplication_8)  # -> simplify(Frames), Parameters
cull_i_4 = CullIndex(List=hframes_3.Frames, Indices="-1", Wrap=True)  # -> simplify(flatten(List))

preview_12 = CustomPreview(Geometry=twist_3, Material=ColourSwatch(SwatchColor=RGB(186, 98, 39)))
twist_4 = Twist(Geometry=arrpolar_4.Geometry, Axis=ln_5, Angle=degrees(neg_3), Infinite=False, Rigid=False)
cull_i_5 = CullIndex(List=hframes.Frames, Indices="-1", Wrap=True)  # -> simplify(flatten(List))
cull_i_6 = CullIndex(List=hframes.Frames, Indices="-1", Wrap=True)  # -> simplify(List)
cull_i_7 = CullIndex(List=hframes_3.Frames, Indices="-1", Wrap=True)  # -> simplify(List)
preview_13 = CustomPreview(Geometry=twist_4, Material=ColourSwatch(SwatchColor=RGB(186, 98, 39)))
dispatch_5 = Dispatch(List=cull_i_5, DispatchPattern=[True, False])  # -> ListA, ListB
dispatch_6 = Dispatch(List=cull_i_4, DispatchPattern=[True, False])  # -> ListA, ListB
dispatch_7 = Dispatch(List=cull_i_6, DispatchPattern=[True, False])  # -> ListA, ListB
dispatch_8 = Dispatch(List=cull_i_7, DispatchPattern=[True, False])  # -> ListA, ListB
graft = GraftTree(Tree=rotate_7.Geometry, IncludeEmptyLists=True, IncludeNullItems=True)  # -> simplify(Tree)
dispatch_9 = Dispatch(List=dispatch_8.ListA, DispatchPattern=[True, False])  # -> ListA, ListB
dispatch_10 = Dispatch(List=dispatch_7.ListB, DispatchPattern=[True, False])  # -> ListA, ListB

divide_branches = DivideBranches(DataTree=cull_i_2, DivisionPattern=[0, 1], RenumberPaths=False)  # -> Data0, Data1
dispatch_11 = Dispatch(List=divide_branches.Data0, DispatchPattern=[True, False])  # -> ListA, ListB
dispatch_12 = Dispatch(List=divide_branches.Data1, DispatchPattern=[True, False])  # -> ListA, ListB
dispatch_13 = Dispatch(List=dispatch_11.ListB, DispatchPattern=[True, False])  # -> ListA, ListB
dispatch_14 = Dispatch(List=dispatch_12.ListA, DispatchPattern=[True, False])  # -> ListA, ListB
pln_v = Plane(dispatch_13.ListB)
pln_h = Plane(dispatch_13.ListA)
pln_h_2 = Plane(dispatch_14.ListA)
pln_v_2 = Plane(dispatch_14.ListB)
merge_4 = Merge(Data1=pln_h, Data2=pln_h_2)
merge_5 = Merge(Data1=pln_v, Data2=pln_v_2)
h_brick_3 = CenterBox(Base=merge_4, X=expr("x/2", length), Y=expr("x/2", width), Z=expr("x/2", height))
v_brick_3 = CenterBox(Base=merge_5, X=expr("x/2", width), Y=expr("x/2", length), Z=expr("x/2", height))
preview_14 = CustomPreview(Geometry=[h_brick_3, v_brick_3], Material=ColourSwatch(SwatchColor=RGB(186, 98, 39)))

divide_branches_2 = DivideBranches(DataTree=cull_i_3, DivisionPattern=[0, 1], RenumberPaths=False)  # -> Data0, Data1
dispatch_15 = Dispatch(List=divide_branches_2.Data0, DispatchPattern=[True, False])  # -> ListA, ListB
dispatch_16 = Dispatch(List=divide_branches_2.Data1, DispatchPattern=[True, False])  # -> ListA, ListB
dispatch_17 = Dispatch(List=dispatch_15.ListB, DispatchPattern=[True, False])  # -> ListA, ListB
dispatch_18 = Dispatch(List=dispatch_16.ListA, DispatchPattern=[True, False])  # -> ListA, ListB
pln_h_3 = Plane(dispatch_17.ListA)
pln_v_3 = Plane(dispatch_17.ListB)
pln_h_4 = Plane(dispatch_18.ListA)
pln_v_4 = Plane(dispatch_18.ListB)
merge_6 = Merge(Data1=pln_h_3, Data2=pln_h_4)
merge_7 = Merge(Data1=pln_v_3, Data2=pln_v_4)
h_brick_4 = CenterBox(Base=merge_6, X=expr("x/2", length), Y=expr("x/2", width), Z=expr("x/2", height))
v_brick_4 = CenterBox(Base=merge_7, X=expr("x/2", width), Y=expr("x/2", length), Z=expr("x/2", height))
preview_15 = CustomPreview(Geometry=[h_brick_4, v_brick_4], Material=ColourSwatch(SwatchColor=RGB(186, 98, 39)))

partition = PartitionList(List=dispatch_5.ListA, Size=number_slider_11)  # -> simplify(Chunks)
partition_2 = PartitionList(List=dispatch_6.ListB, Size=number_slider_11)  # -> simplify(Chunks)
merge_8 = Merge(Data1=rotate_5.Geometry, Data2=graft)
pln_h_5 = Plane([dispatch_10.ListA, dispatch_9.ListA])
pln_v_5 = Plane([dispatch_10.ListB, dispatch_9.ListB])
end_9 = EndPoints(Curve=item_18)  # -> Start, End
midpt_4 = CurveMiddle(Curve=item_18)
end_10 = EndPoints(Curve=graft)  # -> Start, End
merge_9 = Merge(Data1=partition, Data2=partition_2)
midpt_5 = CurveMiddle(Curve=graft)
item_19 = ListItem(List=merge_8, Index=0, Wrap=True)  # -> Item, Item1
h_brick_5 = CenterBox(Base=pln_h_5, X=expr("x/2", length), Y=expr("x/2", width), Z=expr("x/2", height))
v_brick_5 = CenterBox(Base=pln_v_5, X=expr("x/2", width), Y=expr("x/2", length), Z=expr("x/2", height))
end_11 = EndPoints(Curve=merge_8)  # -> Start, End
pdecon_2 = Deconstruct(Point=end_9.Start)  # -> XComponent, YComponent, ZComponent
pt_13 = ConstructPoint(XCoordinate=pdecon.XComponent, YCoordinate=pdecon.YComponent, ZCoordinate=pdecon_2.ZComponent)
midpt_6 = CurveMiddle(Curve=merge_8)
pt_14 = Point(end_9.Start)
pt_15 = Point(end_10.Start)
item_20 = ListItem(List=flatten(merge_9), Index=Slider(20, range=0..20), Wrap=True)
ln_6 = Line(StartPoint=pt_14, EndPoint=pt_10)
item_21 = ListItem(List=end_11.Start, Index=0, Wrap=True)  # -> Item, Item1
merge_10 = Merge(Data1=h_brick_5, Data2=v_brick_5)
item_22 = ListItem(List=midpt_6, Index=0, Wrap=True)  # -> Item, Item1
ln_7 = Line(StartPoint=midpt_4, EndPoint=midpt)
ln_8 = Line(StartPoint=area.Centroid, EndPoint=pt_13)
ln_9 = Line(StartPoint=pt_15, EndPoint=pt_11)
ln_10 = Line(StartPoint=midpt_5, EndPoint=midpt_2)
item_23 = ListItem(List=twist_4, Index=0, Wrap=True)
swp2 = Sweep2(Rail1=item_5, Rail2=item_18, Sections=ln_6, SameHeight=False)
ln_11 = Line(StartPoint=item_22.Item, EndPoint=item_22.Item1)
ln_12 = Line(StartPoint=item_21.Item, EndPoint=item_21.Item1)
swp2_2 = Sweep2(Rail1=rotate_5.Geometry, Rail2=graft, Sections=ln_9, SameHeight=False)
debrep = DeconstructBrep(Brep=item_23)  # -> Faces, Edges, Vertices
contour_2 = Contour(Shape=item_23, Point=Point(0, 0, 0), Direction=Vector(0, 0, 1), Distance=height)  # -> simplify(Contours)
item_24 = ListItem(List=flatten(merge_10), Index=Slider(0, range=0..20), Wrap=True)
swp2_3 = Sweep2(Rail1=item_19.Item, Rail2=item_19.Item1, Sections=ln_12, SameHeight=invert(False))
twist_5 = Twist(Geometry=swp2, Axis=ln_8, Angle=degrees(number_slider_12), Infinite=False, Rigid=False)
preview_16 = CustomPreview(Geometry=merge_10, Material=ColourSwatch(SwatchColor=RGB(186, 98, 39)))
len_2 = Length(Curve=flatten(contour_2))
twist_6 = Twist(Geometry=swp2, Axis=ln_7, Angle=degrees(number_slider_12), Infinite=False, Rigid=False)
twist_7 = Twist(Geometry=swp2_2, Axis=ln_10, Angle=degrees(number_slider_12), Infinite=False, Rigid=False)
divide_branches_3 = DivideBranches(DataTree=contour_2, DivisionPattern=[0, 1], RenumberPaths=False)  # -> Data0, Data1
item_25 = ListItem(List=debrep.Edges, Index=0, Wrap=True)  # -> Item, Item1, Item2, Item3
twist_8 = Twist(Geometry=swp2_3, Axis=ln_11, Angle=degrees(neg_4), Infinite=False, Rigid=False)
panel_10 = Panel(len_2)
item_26 = ListItem(List=debrep.Edges, Index=0, Wrap=True)  # -> Item, Item1
hframe_2 = HorizontalFrame(Curve=reparameterize(item_25.Item2), Parameter="0.5")
end_12 = EndPoints(Curve=item_25.Item2)  # -> Start, End
move_9 = Move(Geometry=twist_8, Motion=amp_2)  # -> Geometry, Transform

multiplication_9 = Multiplication(A=number_slider_5, B="2")
hframes_4 = HorizontalFrames(Curve=divide_branches_3.Data0, Count=multiplication_9)  # -> simplify(Frames), Parameters
cull_i_8 = CullIndex(List=hframes_4.Frames, Indices="0", Wrap=True)  # -> simplify(List)

multiplication_10 = Multiplication(A=number_slider_5, B="2")
hframes_5 = HorizontalFrames(Curve=divide_branches_3.Data1, Count=multiplication_10)  # -> simplify(Frames), Parameters
cull_i_9 = CullIndex(List=hframes_5.Frames, Indices="0", Wrap=True)  # -> simplify(List)

len_3 = Length(Curve=item_26.Item)
geo = Geometry(item_26.Item1)
deplane_2 = DeconstructPlane(Plane=hframe_2)  # -> Origin, XAxis, YAxis, ZAxis
contour_3 = Contour(Shape=move_9.Geometry, Point=Point(0, 0, 0), Direction=Vector(0, 0, 1), Distance=height)
trim_2 = TrimTree(Tree=contour_3, Depth=1)
division_4 = Division(A=len_3, B=height)
tstat_2 = TreeStatistics(Tree=trim_2)  # -> Paths, Length, Count
len_4 = Length(Curve=contour_3)
amp_3 = Amplitude(Vector=deplane_2.YAxis, Amplitude=expr("-x", Slider(0, range=0..100)))
round_2 = Round(Number=division_4)  # -> Nearest, expr("x-1", Floor), Ceiling
round_3 = Round(Number=division_4)  # -> Nearest, Floor, Ceiling
item_27 = ListItem(List=tstat_2.Paths, Index=0, Wrap=True)
bnd = Bounds(Numbers=flatten(len_4))
move_10 = Move(Geometry=deplane_2.Origin, Motion=amp_3)  # -> Geometry, Transform
branch_2 = TreeBranch(Tree=trim_2, Path=item_27, MaintainPaths=True)
divide_2 = DivideCurve(Curve=item_26.Item, Count=round_2.Floor, Kinks=False)  # -> Points, Tangents, Parameters
panel_11 = Panel(bnd)
merge_11 = Merge(Data1=end_12.Start, Data2=move_10.Geometry, Data3=end_12.End)
dispatch_19 = Dispatch(List=cull_i_8, DispatchPattern=[True, False])  # -> ListA, ListB
dispatch_20 = Dispatch(List=cull_i_9, DispatchPattern=[True, False])  # -> ListA, ListB
planesrf = PlaneSurface(Plane=divide_2.Points, XSize=dom, YSize=dom)
intcrv = Interpolate(Vertices=merge_11, Degree=3, Periodic=False, KnotStyle=1)  # -> Curve, Length, Domain
dispatch_21 = Dispatch(List=dispatch_19.ListA, DispatchPattern=[True, False])  # -> ListA, ListB
dispatch_22 = Dispatch(List=dispatch_20.ListB, DispatchPattern=[True, False])  # -> ListA, ListB
cull_i_10 = CullIndex(List=planesrf, Indices=panel_8, Wrap=True)
merge_12 = Merge(Data1=intcrv.Curve, Data2=item_25.Item, Data3=item_25.Item1, Data4=item_25.Item3)
geo_2 = Geometry([dispatch_21.ListA, dispatch_22.ListA])
geo_3 = Geometry([dispatch_21.ListB, dispatch_22.ListB])
join = JoinCurves(Curves=merge_12, Preserve=False)
patch = Patch(Curves=join, Spans=20, Flexibility=1, Trim=True)
h_brick_6 = CenterBox(Base=geo_2, X=expr("x/2", length), Y=expr("x/2", width), Z=expr("x/2", height))
v_brick_6 = CenterBox(Base=geo_3, X=expr("x/2", width), Y=expr("x/2", length), Z=expr("x/2", height))
bbx = BrepBrep(BrepA=graft(patch), BrepB=cull_i_10)  # -> flatten(Curves), Points
weave_4 = Weave(Pattern=[0, 1], Stream0=h_brick_6, Stream1=v_brick_6, NullGaps=False)
group = Group(Geometry=weave_4)
ins = InsertItems(List=reverse(bbx.Curves), Item=geo, Indices="0", Wrap=True)
arrpolar_5 = PolarArray(Geometry=group, Plane=PlaneXY(0, 0, 0), Count="3", Angle=6.283185307)  # -> Geometry, Transform
crv_6 = Curve(simplify(graft(ins)))
ungroup = Ungroup(Group=arrpolar_5.Geometry)  # -> simplify(Geometry)
len_5 = Length(Curve=flatten(crv_6))
item_28 = ListItem(List=flatten(ungroup), Index=Slider(10, range=0..10), Wrap=True)
preview_17 = CustomPreview(Geometry=ungroup, Material=ColourSwatch(SwatchColor=RGB(186, 98, 39)))
bnd_2 = Bounds(Numbers=len_5)
panel_12 = Panel(bnd_2)
panel_13 = Panel(len_5)

flatten = FlattenTree(Tree=crv_6, Path="{0}")  # disabled
py3_7 = Python3Script(curves=crv_2)  # -> out, points, bricks, way_frame, polar_bricks; inputs curves: list of Curve; disabled
# ---------- py3_7: Python ----------
# r: compas
# venv: mas-2526
from compas_rhino.devtools import DevTools
DevTools.ensure_path()

import math
from compas.geometry import Box, Point, Frame, Vector, cross_vectors, Rotation
from compas_rhino.conversions import curve_to_compas
from brick_wall_2 import Brick

crvs = []
points = []
frames = []
bricks = []

for c in curves:
    cc = curve_to_compas(c)
    crvs.append(cc)


def param_list(curve, num_div):
    params = curve.divide_by_count(num_div)
    return params


def get_h_brick(curve, param):  # horizontal bricks
    pt = curve.point_at(param)
    points.append(pt)
    tan = crv.tangent_at(param)
    nor = tan.cross(Vector(0, 0, 1))
    frame = Frame(pt, tan, nor)
    frames.append(frame)
    b = Brick(frame)
    return b


def get_v_brick(curve, param):  # vertical bricks
    pt = curve.point_at(param)
    points.append(pt)
    tan = crv.tangent_at(param)
    nor = tan.cross(Vector(0, 0, 1))
    frame = Frame(pt, nor, tan)
    frames.append(frame)
    b = Brick(frame)
    return b


# === Polar Array 基本參數設定 ===
center = Point(0, 0, 0)
axis = Vector(0, 0, 1)
angle = math.radians(360 / 3)  # 每次旋轉角度 = 120°

polar_bricks = []

# === 逐層排磚（每一層先 polar array）===
for i_c, crv in enumerate(crvs):

    layer_bricks = []  # 暫存該層原始磚

    params = param_list(crv, 6)
    if i_c % 2 == 0:  # even row
        for i_p, param in enumerate(params):
            if i_p % 7 == 1 or i_p % 7 == 5:  # horizontal bricks
                b = get_h_brick(crv, param)
                layer_bricks.append(b)
            if i_p % 7 == 3:  # vertical bricks
                b = get_v_brick(crv, param)
                layer_bricks.append(b)

    if i_c % 2 == 1:  # odd row
        for i_p, param in enumerate(params):
            if i_p % 7 == 2 or i_p % 7 == 6:  # horizontal bricks
                b = get_h_brick(crv, param)
                layer_bricks.append(b)
            if i_p % 7 == 4:  # vertical bricks
                b = get_v_brick(crv, param)
                layer_bricks.append(b)

    # === 該層 polar array ===
    for i in range(3):  # 共 3 組 (0°,120°,240°)
        R = Rotation.from_axis_and_angle(axis, angle * i, point=center)
        for b in layer_bricks:
            fr = b.frame
            r_fr = fr.transformed(R)
            bb = Brick(r_fr)
            polar_bricks.append(bb.draw())

# === Flip frame 方向 ===

way_frame = []
for b in polar_bricks:
    fr = b.frame
    if fr.zaxis.z > 0:
        fr.flip()
    way_frame.append(fr)

print("Total bricks after layered polar array:", len(polar_bricks))
# ---------- end py3_7 ----------
draw_30 = COMPASDraw(cg=py3_7.points)  # -> rg; disabled; same code as draw
draw_31 = COMPASDraw(cg=py3_7.polar_bricks)  # -> rg; disabled; same code as draw
draw_32 = COMPASDraw(cg=py3_7.way_frame)  # -> rg; disabled; same code as draw
draw_33 = COMPASDraw(cg=py3_7.bricks)  # -> rg; disabled; same code as draw
number_slider_29 = Slider(21, range=0..100)  # disabled
item_29 = ListItem(List=draw_32, Index=0, Wrap=True)  # -> Item, Item1, Item2; disabled
swatch_9 = ColourSwatch(SwatchColor=RGB(186, 98, 39))  # disabled
swatch_10 = ColourSwatch(SwatchColor=RGB(186, 98, 39))  # disabled
pl_7 = ConstructPlane(Origin=item_29.Item, XAxis=item_29.Item1, YAxis=item_29.Item2)  # disabled
preview_18 = CustomPreview(Geometry=draw_31, Material=swatch_9)  # disabled
preview_19 = CustomPreview(Geometry=draw_33, Material=swatch_10)  # disabled
item_30 = ListItem(List=draw_31, Index=number_slider_29, Wrap=True)  # disabled

flatten_2 = FlattenTree(Tree=crv_6, Path="{0}")  # disabled
py3_8 = Python3Script(curves=flatten_2)  # -> out, points, bricks, way_frame, polar_bricks; inputs curves: list of Curve; disabled
# ---------- py3_8: Python ----------
# r: compas
# venv: mas-2526
from compas_rhino.devtools import DevTools
DevTools.ensure_path()

import math
from compas.geometry import Box, Point, Frame, Vector, cross_vectors
from compas_rhino.conversions import curve_to_compas
from brick_wall_2 import Brick

crvs = []
points = []
frames = []
bricks = []

for c in curves:
    cc = curve_to_compas(c)
    crvs.append(cc)

def param_list(curve, num_div):
    params = curve.divide_by_count(num_div)
    return params

def get_h_brick(curve, param): # horizontal bricks
        pt = curve.point_at(param)
        points.append(pt)
        tan = crv.tangent_at(param)
        nor = tan.cross(Vector(0,0,1))
        frame = Frame(pt, tan, nor)
        frames.append(frame)
        b = Brick(frame)
        return bricks.append(b.draw())

def get_v_brick(curve, param): # vertical bricks
        pt = curve.point_at(param)
        points.append(pt)
        tan = crv.tangent_at(param)
        nor = tan.cross(Vector(0,0,1))
        frame = Frame(pt, nor, tan)
        frames.append(frame)
        b = Brick(frame)
        return bricks.append(b.draw())

for i_c, crv in enumerate(crvs):
    params = param_list(crv,6)
    if i_c % 2 == 0: # even row
        for i_p, param in enumerate(params):
            if i_p % 7 == 1 or i_p % 7 == 5: # horizontal bricks
                get_h_brick(crv, param)
                # nor = crv.normal_at(param)

            if i_p % 7 == 3: # vertical bricks
                get_v_brick(crv, param)
    
    if i_c % 2 == 1: # odd row
        for i_p, param in enumerate(params):
            if i_p % 7 == 2 or i_p % 7 == 6: # horizontal bricks
                get_h_brick(crv, param)

            if i_p % 7 == 4: # vertical bricks
                get_v_brick(crv, param)

# way_frame = []
# for f in frames:
#     if f.zaxis.z > 0:
#         f.flip()
#     way_frame.append(f)    

from compas.geometry import Rotation, Point

# === 新增：Polar Array (以 0,0,0 為中心，分佈 3 個) ===

# 定義旋轉中心與旋轉軸
center = Point(0, 0, 0)
axis = Vector(0, 0, 1)
angle = math.radians(360 / 3)  # 每次旋轉角度 = 120°

# 建立一個新的清單，包含原本與複製的磚
polar_bricks = []

# 原始的磚
polar_bricks.extend(bricks)

# 重複產生另外兩組
for i in range(1, 3):  # 產生 2 次 → 共 3 組
    R = Rotation.from_axis_and_angle(axis, angle * i, point=center)
    rotated_bricks = []

    for b in bricks:
        # 將每個磚的幾何以 R 旋轉（需 Brick 支援 transformation）
        bb = b.transformed(R)
        rotated_bricks.append(bb)
    polar_bricks.extend(rotated_bricks)

way_frame = []
for b in polar_bricks:
    fr = b.frame
    if fr.zaxis.z > 0:
        fr.flip()
    way_frame.append(fr)

# 最終所有磚都存在 polar_bricks 中
print("Total bricks after polar array:", len(polar_bricks))
# ---------- end py3_8 ----------
draw_34 = COMPASDraw(cg=py3_8.points)  # -> rg; disabled; same code as draw
draw_35 = COMPASDraw(cg=py3_8.polar_bricks)  # -> rg; disabled; same code as draw
draw_36 = COMPASDraw(cg=py3_8.way_frame)  # -> rg; disabled; same code as draw
draw_37 = COMPASDraw(cg=py3_8.bricks)  # -> rg; disabled; same code as draw
number_slider_30 = Slider(0, range=0..100)  # disabled
item_31 = ListItem(List=draw_36, Index=0, Wrap=True)  # -> Item, Item1, Item2; disabled
swatch_11 = ColourSwatch(SwatchColor=RGB(186, 98, 39))  # disabled
swatch_12 = ColourSwatch(SwatchColor=RGB(186, 98, 39))  # disabled
pl_8 = ConstructPlane(Origin=item_31.Item, XAxis=item_31.Item1, YAxis=item_31.Item2)  # disabled
preview_20 = CustomPreview(Geometry=draw_35, Material=swatch_11)  # disabled
preview_21 = CustomPreview(Geometry=draw_37, Material=swatch_12)  # disabled
item_32 = ListItem(List=draw_35, Index=number_slider_30, Wrap=True)  # disabled

flatten_3 = FlattenTree(Tree=crv_6, Path="{0}")  # disabled
py3_9 = Python3Script(curves=flatten_3)  # -> out, points, bricks, way_frame; inputs curves: list of Curve; disabled
# ---------- py3_9: Python ----------
# r: compas
# venv: mas-2526
from compas_rhino.devtools import DevTools
DevTools.ensure_path()

import math
from compas.geometry import Box, Point, Frame, Vector, cross_vectors
from compas_rhino.conversions import curve_to_compas
from brick_wall_2 import Brick

crvs = []
points = []
frames = []
bricks = []

for c in curves:
    cc = curve_to_compas(c)
    crvs.append(cc)

def param_list(curve, num_div):
    params = curve.divide_by_count(num_div)
    return params

def get_h_brick(curve, param): # horizontal bricks
        pt = curve.point_at(param)
        points.append(pt)
        tan = crv.tangent_at(param)
        nor = tan.cross(Vector(0,0,1))
        frame = Frame(pt, tan, nor)
        frames.append(frame)
        b = Brick(frame)
        return bricks.append(b.draw())

def get_v_brick(curve, param): # vertical bricks
        pt = curve.point_at(param)
        points.append(pt)
        tan = crv.tangent_at(param)
        nor = tan.cross(Vector(0,0,1))
        frame = Frame(pt, nor, tan)
        frames.append(frame)
        b = Brick(frame)
        return bricks.append(b.draw())

for i_c, crv in enumerate(crvs):
    params = param_list(crv,6)
    if i_c % 2 == 0: # even row
        for i_p, param in enumerate(params):
            if i_p % 7 == 1 or i_p % 7 == 5: # horizontal bricks
                get_h_brick(crv, param)
                # nor = crv.normal_at(param)

            if i_p % 7 == 3: # vertical bricks
                get_v_brick(crv, param)
    
    if i_c % 2 == 1: # odd row
        for i_p, param in enumerate(params):
            if i_p % 7 == 2 or i_p % 7 == 6: # horizontal bricks
                get_h_brick(crv, param)

            if i_p % 7 == 4: # vertical bricks
                get_v_brick(crv, param)

way_frame = []
for f in frames:
    if f.zaxis.z > 0:
        f.flip()
    way_frame.append(f)
# ---------- end py3_9 ----------
draw_38 = COMPASDraw(cg=py3_9.points)  # -> rg; disabled; same code as draw
draw_39 = COMPASDraw(cg=py3_9.way_frame)  # -> rg; disabled; same code as draw
draw_40 = COMPASDraw(cg=py3_9.bricks)  # -> rg; disabled; same code as draw
item_33 = ListItem(List=draw_39, Index=0, Wrap=True)  # -> Item, Item1, Item2; disabled
swatch_13 = ColourSwatch(SwatchColor=RGB(186, 98, 39))  # disabled
pl_9 = ConstructPlane(Origin=item_33.Item, XAxis=item_33.Item1, YAxis=item_33.Item2)  # disabled
preview_22 = CustomPreview(Geometry=draw_40, Material=swatch_13)  # disabled

crv_3_3 = Curve(flatten(crv_6))  # disabled

number_slider_31 = Slider(100, range=0..100)  # disabled
number_slider_32 = Slider(95, range=0..100)  # disabled
crv_4_2 = Curve(flatten(crv_6))  # disabled
crv_2_4 = Curve(flatten([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]))  # disabled
crv_3_4 = Curve(flatten([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]))  # disabled
crv_4_3 = Curve(flatten([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]))  # disabled
crv_1_3 = Curve([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])  # disabled
py3_10 = Python3Script(curves=crv_4_3, x=number_slider_31, y=number_slider_32)  # -> out, points, primitive_bricks, way_frame, polar_bricks, moved_bricks; inputs curves: list of Curve, x: Double, y: Double; disabled
# ---------- py3_10: Python ----------
# r: compas
# venv: mas-2526
from compas_rhino.devtools import DevTools
DevTools.ensure_path()

import math
from compas.geometry import Box, Point, Frame, Vector, cross_vectors, Rotation, Translation
from compas_rhino.conversions import curve_to_compas
from brick_wall_2 import Brick

crvs = []
points = []
bricks = []

# convert curves to compas
for c in curves:
    crvs.append(curve_to_compas(c))

# build param list for curves
def param_list(curve, num_div):
    params = curve.divide_by_count(num_div)
    return params

def get_h_brick(curve, param):  # horizontal bricks
    pt = curve.point_at(param)
    points.append(pt)
    tan = crv.tangent_at(param)
    nor = tan.cross(Vector(0, 0, 1))
    frame = Frame(pt, tan, nor)
    b = Brick(frame)
    return b


def get_v_brick(curve, param):  # vertical bricks
    pt = curve.point_at(param)
    points.append(pt)
    tan = crv.tangent_at(param)
    nor = tan.cross(Vector(0, 0, 1))
    frame = Frame(pt, nor, tan)
    b = Brick(frame)
    return b


# === Polar Array_basic parameter setting ===
center = Point(0, 0, 0)
axis = Vector(0, 0, 1)
angle = math.radians(360 / 3)  # rotatie 120° every time
polar_bricks = []

# === lay bricks layer by layer（polar array first）===
for i_c, crv in enumerate(crvs):
    layer_bricks = []  # temporary save the primitive bricks

    params = param_list(crv, 6)
    if i_c % 2 == 0:  # even row
        for i_p, param in enumerate(params):
            if i_p % 7 == 1 or i_p % 7 == 5:  # horizontal bricks
                b = get_h_brick(crv, param)
                layer_bricks.append(b)
            if i_p % 7 == 3:  # vertical bricks
                b = get_v_brick(crv, param)
                layer_bricks.append(b)

    if i_c % 2 == 1:  # odd row
        for i_p, param in enumerate(params):
            if i_p % 7 == 2 or i_p % 7 == 6:  # horizontal bricks
                b = get_h_brick(crv, param-6)
                layer_bricks.append(b)
            if i_p % 7 == 4:  # vertical bricks
                b = get_v_brick(crv, param-7)
                layer_bricks.append(b)

    # === polar array ===
    for i in range(3):  # 3 groups (0°,120°,240°)
        R = Rotation.from_axis_and_angle(axis, angle * i, point=center)
        for b in layer_bricks:
            fr = b.frame
            r_fr = fr.transformed(R)
            bb = Brick(r_fr)
            polar_bricks.append(bb.draw())
        
# === move the whole structure ===
# moving vector setting
move_vec = Vector(x, y, 0)
T = Translation.from_vector(move_vec)

moved_bricks = []
for b in polar_bricks:
    fr = b.frame
    m_fr = fr.transformed(T)
    moved_bricks.append(Brick(m_fr).draw())

# === Flip frames  ===
way_frame = []
for b in moved_bricks:
    fr = b.frame
    if fr.zaxis.z > 0:
        fr.flip()
    way_frame.append(fr)

print("Total bricks after layered polar array:", len(moved_bricks))
# ---------- end py3_10 ----------
draw_41 = COMPASDraw(cg=py3_10.primitive_bricks)  # -> rg; disabled; same code as draw
draw_42 = COMPASDraw(cg=py3_10.points)  # -> rg; disabled; same code as draw
draw_43 = COMPASDraw(cg=py3_10.polar_bricks)  # -> rg; disabled; same code as draw
draw_44 = COMPASDraw(cg=py3_10.way_frame)  # -> rg; disabled; same code as draw
draw_45 = COMPASDraw(cg=py3_10.moved_bricks)  # -> rg; disabled; same code as draw
number_slider_33 = Slider(0, range=0..100)  # disabled
item_34 = ListItem(List=draw_44, Index=0, Wrap=True)  # -> Item, Item1, Item2; disabled
swatch_14 = ColourSwatch(SwatchColor=RGB(186, 98, 39))  # disabled
swatch_15 = ColourSwatch(SwatchColor=RGB(186, 98, 39))  # disabled
pl_10 = ConstructPlane(Origin=item_34.Item, XAxis=item_34.Item1, YAxis=item_34.Item2)  # disabled
item_35 = ListItem(List=flatten(pl_10), Index=number_slider_33, Wrap=True)  # disabled
preview_23 = CustomPreview(Geometry=draw_43, Material=swatch_14)  # disabled
preview_24 = CustomPreview(Geometry=draw_45, Material=swatch_15)  # disabled

divide_branches_4 = DivideBranches(DataTree=crv_6, DivisionPattern=[0, 1], RenumberPaths=False)  # -> Data0, Data1

multiplication_11 = Multiplication(A=number_slider_5, B="2")
hframes_6 = HorizontalFrames(Curve=divide_branches_4.Data0, Count=multiplication_11)  # -> simplify(Frames), Parameters
cull_i_11 = CullIndex(List=hframes_6.Frames, Indices="0", Wrap=True)  # -> simplify(List)

multiplication_12 = Multiplication(A=number_slider_5, B="2")
hframes_7 = HorizontalFrames(Curve=divide_branches_4.Data1, Count=multiplication_12)  # -> simplify(Frames), Parameters
cull_i_12 = CullIndex(List=hframes_7.Frames, Indices="0", Wrap=True)  # -> simplify(List)

divide_branches_5 = DivideBranches(DataTree=crv_6, DivisionPattern=[0, 1], RenumberPaths=False)  # -> Data0, Data1; disabled
panel_14 = Panel("3")  # disabled
number_slider_34 = Slider(10, range=0..10)  # disabled
swatch_16 = ColourSwatch(SwatchColor=RGB(186, 98, 39))  # disabled

panel_15 = Panel("2")  # disabled
multiplication_13 = Multiplication(A=number_slider_5, B=panel_15)  # disabled
hframes_8 = HorizontalFrames(Curve=divide_branches_5.Data0, Count=multiplication_13)  # -> simplify(Frames), Parameters; disabled
panel_16 = Panel("0")  # disabled
cull_i_13 = CullIndex(List=hframes_8.Frames, Indices=panel_16, Wrap=True)  # -> simplify(List); disabled

panel_17 = Panel("2")  # disabled
multiplication_14 = Multiplication(A=number_slider_5, B=panel_17)  # disabled
hframes_9 = HorizontalFrames(Curve=divide_branches_5.Data1, Count=multiplication_14)  # -> simplify(Frames), Parameters; disabled
panel_18 = Panel("0")  # disabled
cull_i_14 = CullIndex(List=hframes_9.Frames, Indices=panel_18, Wrap=True)  # -> simplify(List); disabled

dispatch_23 = Dispatch(List=cull_i_13, DispatchPattern=[True, False])  # -> ListA, ListB; disabled
dispatch_24 = Dispatch(List=cull_i_14, DispatchPattern=[True, False])  # -> ListA, ListB; disabled
dispatch_25 = Dispatch(List=dispatch_23.ListA, DispatchPattern=[True, False])  # -> ListA, ListB; disabled
dispatch_26 = Dispatch(List=dispatch_24.ListB, DispatchPattern=[True, False])  # -> ListA, ListB; disabled
geo_4 = Geometry([dispatch_25.ListA, dispatch_26.ListA])  # disabled
geo_5 = Geometry([dispatch_25.ListB, dispatch_26.ListB])  # disabled
h_brick_7 = CenterBox(Base=geo_4, X=expr("x/2", length), Y=expr("x/2", width), Z=expr("x/2", height))  # disabled
v_brick_7 = CenterBox(Base=geo_5, X=expr("x/2", width), Y=expr("x/2", length), Z=expr("x/2", height))  # disabled
weave_5 = Weave(Pattern=[0, 1], Stream0=h_brick_7, Stream1=v_brick_7, NullGaps=False)  # disabled
group_2 = Group(Geometry=weave_5)  # disabled
arrpolar_6 = PolarArray(Geometry=group_2, Plane=PlaneXY(0, 0, 0), Count=panel_14, Angle=6.283185307)  # -> Geometry, Transform; disabled
ungroup_2 = Ungroup(Group=arrpolar_6.Geometry)  # -> simplify(Geometry); disabled
item_36 = ListItem(List=flatten(ungroup_2), Index=number_slider_34, Wrap=True)  # disabled
preview_25 = CustomPreview(Geometry=group_2, Material=swatch_16)  # disabled

geo_6 = Geometry([dispatch_25.ListA, dispatch_26.ListA])  # disabled
item_37 = ListItem(List=geo_6, Index=0, Wrap=True)  # -> Item, Item1; disabled
ln_13 = Line(StartPoint=item_37.Item, EndPoint=item_37.Item1)  # disabled
panel_19 = Panel("0.5")  # disabled
hframe_3 = HorizontalFrame(Curve=reparameterize(ln_13), Parameter=panel_19)  # disabled
h_brick_8 = CenterBox(Base=geo_6, X=expr("x/2", length), Y=expr("x/2", width), Z=expr("x/2", height))  # disabled
v_brick_8 = CenterBox(Base=hframe_3, X=expr("x/2", width), Y=expr("x/2", length), Z=expr("x/2", height))  # disabled
weave_6 = Weave(Pattern=[0, 1], Stream0=h_brick_8, Stream1=v_brick_8, NullGaps=False)  # disabled
group_3 = Group(Geometry=weave_6)  # disabled
panel_20 = Panel("3")  # disabled
arrpolar_7 = PolarArray(Geometry=group_3, Plane=PlaneXY(0, 0, 0), Count=panel_20, Angle=6.283185307)  # -> Geometry, Transform; disabled
number_slider_35 = Slider(0, range=0..20)  # disabled
ungroup_3 = Ungroup(Group=arrpolar_7.Geometry)  # -> simplify(flatten(Geometry)); disabled
swatch_17 = ColourSwatch(SwatchColor=RGB(186, 98, 39))  # disabled
item_38 = ListItem(List=flatten(ungroup_3), Index=number_slider_35, Wrap=True)  # disabled
preview_26 = CustomPreview(Geometry=ungroup_3, Material=swatch_17)  # disabled
pln = Plane(ungroup_3)  # disabled

number_slider_36 = Slider(1, range=0..15)  # disabled
tstat_3 = TreeStatistics(Tree=weave_5)  # -> Paths, Length, Count; disabled
item_39 = ListItem(List=tstat_3.Paths, Index=number_slider_36, Wrap=True)  # disabled
branch_3 = TreeBranch(Tree=weave_5, Path=item_39, MaintainPaths=True)  # disabled

number_slider_37 = Slider(15, range=0..15)  # disabled
tstat_4 = TreeStatistics(Tree=weave_6)  # -> Paths, Length, Count; disabled
item_40 = ListItem(List=tstat_4.Paths, Index=number_slider_37, Wrap=True)  # disabled
branch_4 = TreeBranch(Tree=weave_6, Path=item_40, MaintainPaths=True)  # disabled

dispatch_27 = Dispatch(List=cull_i_11, DispatchPattern=[True, False])  # -> ListA, ListB
dispatch_28 = Dispatch(List=cull_i_12, DispatchPattern=[True, False])  # -> ListA, ListB
dispatch_29 = Dispatch(List=dispatch_27.ListA, DispatchPattern=[True, False])  # -> ListA, ListB
dispatch_30 = Dispatch(List=dispatch_28.ListB, DispatchPattern=[True, False])  # -> ListA, ListB
geo_7 = Geometry([dispatch_29.ListA, dispatch_30.ListA])
geo_8 = Geometry([dispatch_29.ListB, dispatch_30.ListB])
h_brick_9 = CenterBox(Base=geo_7, X=expr("x/2", length), Y=expr("x/2", width), Z=expr("x/2", height))
v_brick_9 = CenterBox(Base=geo_8, X=expr("x/2", width), Y=expr("x/2", length), Z=expr("x/2", height))
weave_7 = Weave(Pattern=[0, 1], Stream0=h_brick_9, Stream1=v_brick_9, NullGaps=False)
group_4 = Group(Geometry=weave_7)
arrpolar_8 = PolarArray(Geometry=group_4, Plane=PlaneXY(0, 0, 0), Count="3", Angle=6.283185307)  # -> Geometry, Transform
ungroup_4 = Ungroup(Group=arrpolar_8.Geometry)  # -> simplify(Geometry)
item_41 = ListItem(List=flatten(ungroup_4), Index=Slider(10, range=0..10), Wrap=True)

tstat_5 = TreeStatistics(Tree=weave_7)  # -> Paths, Length, Count
item_42 = ListItem(List=tstat_5.Paths, Index=Slider(1, range=0..15), Wrap=True)
branch_5 = TreeBranch(Tree=weave_7, Path=item_42, MaintainPaths=True)

preview_27 = CustomPreview(Geometry=branch_5, Material=ColourSwatch(SwatchColor=RGB(186, 98, 39)))
