# Grasshopper definition 101_brick_to_robot.ghx (Grasshopper 1.0.8)
# plug-ins: Robots, Human

# ---- group: Stretcher Bond & along curve
script = Script(
    wall_height=Slider(2000, range=0..10000),
    top_crv_amplitude=Slider(1000, range=0..1000),
    wall_length=Slider(4000, range=0..10000),
    bottom_crv_amplitude=Slider(1000, range=0..1000),
    x=Slider(215, range=0..1000),
    y=Slider(112.5, range=0..1000),
    z=Slider(65, range=0..100))  # -> points, wall_profile; inputs wall_height: Double, top_crv_amplitude: Double, wall_length: Double, bottom_crv_amplitude: Double, x: Double, y: Double, z: Double
# ---------- script: Python ----------
from compas_rhino.devtools import DevTools

DevTools.ensure_path()
DevTools.enable_reloader()

from compas.geometry import Point, Rotation, Bezier, NurbsCurve, Line, Translation, Vector, Transformation, Brep
from compas_rhino.geometry import RhinoNurbsCurve
import math as m

from bricks import Brick

bed = 10
attractor = Point (0,0,0)

points = []
bricks = []

bottom_crv_ctps = []
top_crv_ctps = []

bottom_line = Line(Point(0, 0, 0),Point(wall_length, 0, 0))
bottom_crv = NurbsCurve.from_line(bottom_line)
param, bottom_crv_pts = bottom_crv.divide_by_count(4,True)

top_line = Line(Point(0, 0, wall_height),Point(wall_length, 0, wall_height))
top_crv = NurbsCurve.from_line(top_line)
top_crv_pts = top_crv.divide_by_count(8,True)[1]

B_T = Translation.from_vector(Vector(0,bottom_crv_amplitude/2,0))
B_T_2 = Translation.from_vector(Vector(0,-1 * bottom_crv_amplitude/2,0))

#create bottom curve profile
for i, pt in enumerate (bottom_crv_pts):
    if i == 1:
        pt.transform(B_T)
    
    elif i == 3:
        pt.transform(B_T_2)
    
    bottom_crv_ctps.append(pt)

T_T = Translation.from_vector(Vector(0,top_crv_amplitude/2,0))
T_T_2 = Translation.from_vector(Vector(0,-1 * top_crv_amplitude/2,0))

for i, pt in enumerate (top_crv_pts):
    if i == 1 or i == 5:
        pt.transform(T_T)
    
    elif i == 3 or i == 7:
        pt.transform(T_T_2)
    
    top_crv_ctps.append(pt)

bottom_crv = RhinoNurbsCurve.from_interpolation(bottom_crv_ctps)
top_crv = RhinoNurbsCurve.from_interpolation(top_crv_ctps)

wall_profile = Brep.from_loft([bottom_crv, top_crv])
# ---------- end script ----------

# ----
panel = Panel(script.wall_profile)
curve = Curve(<curve referenced from the Rhino model>)
compas_draw = COMPASDraw(cg=script.wall_profile)  # -> rg
#   port cg: The COMPAS geometry or datastructure to be drawn.
#   port rg: The Rhino geometry object.
# ---------- compas_draw: Python ----------
# r: compas>=2.14.1
"""
Draws COMPAS geometry in Grasshopper.
"""

from typing import Any

import Grasshopper

from compas.scene import SceneObject


class CompasToRhinoGeometry(Grasshopper.Kernel.GH_ScriptInstance):
    def RunScript(self, cg):
        if not cg:
            return None

        return SceneObject(item=cg).draw()
# ---------- end compas_draw ----------
# Multiple pick up points
number_slider = Slider(9, range=0..30)
gap = Slider(2.5, range=0..10)
script_2 = Script(
    length=Slider(90, range=0..250),
    divisions=Slider(8, range=0..20),
    row_height=Slider(32, range=0..50),
    row_count=Slider(6, range=0..20),
    concave=Toggle(False),
    degree=Slider(0, range=0..10))  # -> bricks, geometries, way_planes; inputs curve: Curve, length: Double, divisions: Int32, row_height: Double, concave: Boolean, degree: Int32
# ---------- script_2: Python ----------
# r:compas
# venv: mas-2526

from compas_rhino.devtools import DevTools
DevTools.ensure_path()

import math as m
from compas.geometry import Box, Point, Bezier, NurbsCurve, Line, Frame
from compas.geometry import Transformation, Vector, cross_vectors
from compas_rhino.conversions import curve_to_compas

from brick_wall import Brick

bricks = []

# #import curve
# wall_crv = curve_to_compas(curve)

#generate wall_crv
wall_line = Line(Point(0,0,0), Point(length,0,0))
wall_crv = NurbsCurve.from_line(wall_line)

#curve parameter and points @
param, wall_crv_pts = wall_crv.divide_by_count(divisions, True)
tangent = wall_crv.tangent_at(param)
normal = cross_vectors(tangent, [0,0,1])

#iterate layers
for r in range (row_count):
    #manipulate curve and obtain parameters
    T = Translation.from_vector(normal * r)
    T_2 = Translation.from_vector(-normal * r)

    row_curves = []
    row_crv_pts = []
    for i, pt in enumerate (wall_crv_pts,):
        if i == 0 or i == len(wall_crv_pts) or i % 2 == 0:
            row_crv_pts.append(pt)
        elif i % 3 == 0:
            pt = pt.transformed(T)
            row_crv_pts.append(pt)
        elif i % 2 != 0:
            pt = pt.trasnformed(T_2)
            row_crv_pts.append(pt)
    row_curve = Nurbs.Curve,from_interpolation(row_crv_pts)

    # for c, params in enumerate (params,):
# ---------- end script_2 ----------

# ---- group: Generate Geometry
brick_wall = Python3Script(crv=curve, num_layers=number_slider, gap=gap)  # -> bricks, geometries, way_planes; inputs crv: Curve, num_layers: Int32, gap: Double
# ---------- brick_wall: Python ----------
# r: compas
# venv: mas-2526
from compas_rhino.devtools import DevTools
DevTools.ensure_path()

# 0. Import everything we will need
import math
from compas.geometry import Box
from compas.geometry import Point
from compas.geometry import Frame
from compas.geometry import cross_vectors
from compas_rhino.conversions import curve_to_compas

# ..also import our module "brick_wall.py", that needs to be in the same folder as our GH file
from brick_wall import Brick

# 1. Start with an empty list of bricks to be created
#    make sure to match the name of this list to the output of this component!
bricks = []

# 2. Create changing curves
curve = curve_to_compas(crv)
print(curve.length())

# divide curve twice as fine
num_divs = int(curve.length() / (Brick.LENGTH+gap)) * 2
# print(num_divs) 
params, div_pts = curve.divide_by_count(num_divs, True)

#duplicate same curve by amount - num_layers
for row in range(num_layers):
    for col, param in enumerate(params,):
        pt = curve.point_at(param)
        pt = pt.translated([0,0,Brick.HEIGHT * row])
        tangent = curve.tangent_at(param)
        normal = cross_vectors(tangent, [0,0,1])
        # only place bricks on alternating divisions depending on the row
        if row % 2 == 0:
            # even rows 
            if col % 2 == 0:
                b = Brick(frame = Frame(pt, tangent, normal))
                bricks.append(b)
        else:  
            # odd rows 
            if col % 2 == 1:
                b = Brick(frame = Frame(pt, tangent, normal))
                bricks.append(b)

# Visualize and store brick data
geometries = []
way_planes = []

for brick in bricks:
    geometries.append(brick.draw())
    way_planes.append(brick.get_pick_frame())
# ---------- end brick_wall ----------

# ---- group: This is needed only ONCE in the GH definition
enable_auto_reload = Python3Script()  # -> ok
# ---------- enable_auto_reload: Python ----------
"""
------------------------------
Using VS Code as Python editor
------------------------------

The simplest way to start using VS Code as our editor, is
to place our Python code in files located IN THE SAME FOLDER as our Grasshopper file.

After we have done that, we need 2 steps: 

1. Enable the COMPAS reloader on one component. This tells Grasshopper to watch for changes in the Pythoh files and reload if changed.
2. Every other component that uses Python code from external files needs to start with a method to ensure Grasshopper knows where to load the files from.

"""
# r: compas
# venv: mas-2526

from compas_rhino.devtools import DevTools
DevTools.enable_reloader()
# ---------- end enable_auto_reload ----------

# ----
python_3_script = Python3Script(x=brick_wall.way_planes)  # -> out, a; inputs x: list
# ---------- python_3_script: Python ----------
from compas_rhino.conversions import frame_to_rhino_plane

a = [frame_to_rhino_plane(f) for f in x]
# ---------- end python_3_script ----------
compas_draw_2 = COMPASDraw(cg=brick_wall.geometries)  # -> rg; same code as compas_draw
compas_draw_3 = COMPASDraw(cg=brick_wall.way_planes)  # -> rg; same code as compas_draw

# ---- group: World Object
pt = ConstructPoint(
    XCoordinate=Slider(500, range=-1000..1000),
    YCoordinate=Slider(250, range=-1000..1000),
    ZCoordinate=Slider(-10, range=-1000..1000))
pt_2 = ConstructPoint(
    XCoordinate=Slider(535, range=-1000..1000),
    YCoordinate=Slider(500, range=-1000..1000),
    ZCoordinate=Slider(-10, range=-1000..1000))
pt_3 = ConstructPoint(
    XCoordinate=Slider(250, range=-1000..1000),
    YCoordinate=Slider(250, range=-1000..1000),
    ZCoordinate=Slider(-10, range=-1000..1000))

# ----
fine_adjust_z_mm = Slider(5, range=-5..10)

# ---- group: Transform from Rhino to Robot Space
compas = Python3Script(way_planes=brick_wall.way_planes, wobj_origin=pt, wobj_xaxis=pt_2, wobj_xypoint=pt_3, z_safe_margin=fine_adjust_z_mm)  # -> out, transformed_planes; inputs way_planes: list, wobj_origin: Point3d, wobj_xaxis: Point3d, wobj_xypoint: Point3d, z_safe_margin: Double
# ---------- compas: Python ----------
import compas.geometry as cg

#in this step we transform our way planes to robot space
#the rhino co-ordinate system is rather abstract in the physical world
#the robot base plane assumed the base frame of robot is the origin
#but rhino does not know that
#thus we transform things from our design space(Rhino World XY) to Robot Base Plane that we measure

def set_robot_base(origin, xaxis, xypoint):
    """
    set a base plane representing the robot working object plane
    """
    robot_base = cg.Frame(origin, xaxis - origin, xypoint - origin)
    print (robot_base)
    return (robot_base)

def rhino_to_robot_space(rhino_plane,robot_base_plane):
    """
    Transform the objects from Rhino world XY plane to robot work object plane
    """
    T_matrix = cg.Transformation.from_frame_to_frame(cg.Frame.worldXY(), robot_base_plane)
    robot_plane = rhino_plane.transformed(T_matrix)
    return robot_plane

def set_z_safe_margin(planes_to_adjust, safety_margin):
    adjusted = []
    T = cg.Translation.from_vector(cg.Vector(0, 0, safety_margin))
    for f in planes_to_adjust:
        adjusted.append(f.transformed(T))
    return adjusted

# ===== Robot base is set =====
robot_base =  set_robot_base(wobj_origin, wobj_xaxis, wobj_xypoint)
print(robot_base)

# ===== Set safety margin for Z height ======
safe_planes = set_z_safe_margin(way_planes, z_safe_margin)

# ===== Transforming the rhino planes into robot planes =====
transformed_planes = []
for plane in safe_planes: 
    transformed_planes.append(rhino_to_robot_space(plane, robot_base))
# ---------- end compas ----------

# ---- group: Brick pick-up point
pt_4 = ConstructPoint(
    XCoordinate=Slider(500, range=-1000..1000),
    YCoordinate=Slider(600, range=-1000..1000),
    ZCoordinate=Slider(50, range=-1000..1000))
pt_5 = ConstructPoint(
    XCoordinate=Slider(535, range=-1000..1000),
    YCoordinate=Slider(500, range=-1000..1000),
    ZCoordinate=Slider(50, range=-1000..1000))
pt_6 = ConstructPoint(
    XCoordinate=Slider(250, range=-1000..1000),
    YCoordinate=Slider(600, range=-1000..1000),
    ZCoordinate=Slider(50, range=-1000..1000))

pt_7 = ConstructPoint(
    XCoordinate=Slider(500, range=-1000..1000),
    YCoordinate=Slider(600, range=-1000..1000),
    ZCoordinate=Slider(50, range=-1000..1000))
pt_8 = ConstructPoint(
    XCoordinate=Slider(535, range=-1000..1000),
    YCoordinate=Slider(500, range=-1000..1000),
    ZCoordinate=Slider(50, range=-1000..1000))
pt_9 = ConstructPoint(
    XCoordinate=Slider(250, range=-1000..1000),
    YCoordinate=Slider(600, range=-1000..1000),
    ZCoordinate=Slider(50, range=-1000..1000))

pt_10 = ConstructPoint(
    XCoordinate=Slider(500, range=-1000..1000),
    YCoordinate=Slider(600, range=-1000..1000),
    ZCoordinate=Slider(50, range=-1000..1000))
pt_11 = ConstructPoint(
    XCoordinate=Slider(535, range=-1000..1000),
    YCoordinate=Slider(500, range=-1000..1000),
    ZCoordinate=Slider(50, range=-1000..1000))
pt_12 = ConstructPoint(
    XCoordinate=Slider(250, range=-1000..1000),
    YCoordinate=Slider(600, range=-1000..1000),
    ZCoordinate=Slider(50, range=-1000..1000))

# ---- group: Frame Adjustmnets
number_slider_2 = Slider(0, range=-10..10)
number_slider_3 = Slider(0, range=-10..10)
number_slider_4 = Slider(0, range=-10..10)
boolean_toggle = BooleanToggle(False)

number_slider_5 = Slider(0, range=-10..10)
number_slider_6 = Slider(0, range=-10..10)
number_slider_7 = Slider(0, range=-10..10)
boolean_toggle_2 = BooleanToggle(False)

# ----
compas_draw_4 = COMPASDraw(cg=compas.transformed_planes)  # -> rg; same code as compas_draw

# ---- group: Frame Adjustmnets
number_slider_8 = Slider(0, range=-10..10)
number_slider_9 = Slider(0, range=-10..10)
number_slider_10 = Slider(0, range=-10..10)
boolean_toggle_3 = BooleanToggle(False)

# ---- group: Create pick up frame
py3 = Python3Script(origin=pt_4, xaxis_pt=pt_5, xy_pt=pt_6, x=number_slider_2, y=number_slider_3, z=number_slider_4, Flip=boolean_toggle)  # -> out, pick_frame, pick_frame_plane; inputs origin: Point3d, xaxis_pt: Point3d, xy_pt: Point3d, x: Double, y: Double, z: Double, Flip: Boolean
# ---------- py3: Python ----------
from compas.geometry import Frame, Point, Transformation, Vector, Translation
from compas.geometry import Rotation
import math as m

from compas_rhino.conversions import point_to_compas

origin = point_to_compas(origin)
xaxis_pt = point_to_compas(xaxis_pt)
xy_pt = point_to_compas(xy_pt)

#define pick frame
# pick_frame = Frame(origin, xaxis_pt - origin, xy_pt - origin)
pick_frame = Frame(origin, xaxis_pt - origin, xy_pt - origin)

Vector_1 = pick_frame.xaxis
Vector_2 = pick_frame.yaxis
Vector_3 = pick_frame.normal

#pick_frame adjustments
T_1 = Translation.from_vector(Vector_1 * x)
T_2 = Translation.from_vector(Vector_2 * y)
T_3 = Translation.from_vector(Vector_3 * z)

R = Rotation.from_axis_and_angle(pick_frame.normal, m.radians(90), pick_frame.point)
R_Flip = Rotation.from_axis_and_angle(Vector_1, m.radians(180), pick_frame.point)

if Flip == True:
    pick_frame.transform(R_Flip)

pick_frame.transform(T_3 * T_2 * T_1 * R)

from compas_rhino import conversions
pick_frame_plane = conversions.frame_to_rhino(pick_frame)
# ---------- end py3 ----------

# ---- group: TCP
pt_13 = ConstructPoint(XCoordinate=Slider(0, range=-100..100), YCoordinate=Slider(0, range=-100..100), ZCoordinate=Slider(75, range=-100..100))

# ---- group: Sim
create_tool = CreateTool(Name="Suction", TCP=pt_13, Weight=Slider(0.5, range=0..10))  # -> Tool, TCP

# ---- group: Create pick up frame
py3_2 = Python3Script(origin=pt_7, xaxis_pt=pt_8, xy_pt=pt_9, x=number_slider_5, y=number_slider_6, z=number_slider_7, Flip=boolean_toggle_2)  # -> out, pick_frame, pick_frame_plane; inputs origin: Point3d, xaxis_pt: Point3d, xy_pt: Point3d, x: Double, y: Double, z: Double, Flip: Boolean
# ---------- py3_2: Python ----------
from compas.geometry import Frame, Point, Transformation, Vector, Translation
from compas.geometry import Rotation
import math as m

from compas_rhino.conversions import point_to_compas

origin = point_to_compas(origin)
xaxis_pt = point_to_compas(xaxis_pt)
xy_pt = point_to_compas(xy_pt)

#define pick frame
# pick_frame = Frame(origin, xaxis_pt - origin, xy_pt - origin)
pick_frame = Frame(origin, xaxis_pt - origin, xy_pt - origin)

Vector_1 = pick_frame.xaxis
Vector_2 = pick_frame.yaxis
Vector_3 = pick_frame.zaxis

#pick_frame adjustments
T_1 = Translation.from_vector(Vector_1 * x)
T_2 = Translation.from_vector(Vector_2 * y)
T_3 = Translation.from_vector(Vector_3 * z)
R = Rotation.from_axis_and_angle(pick_frame.normal, m.radians(90), pick_frame.point)
R_Flip = Rotation.from_axis_and_angle(Vector_1, m.radians(180), pick_frame.point)

if Flip == True:
    pick_frame.transform(R_Flip)

pick_frame.transform(T_2 * T_1 * R)

from compas_rhino import conversions
pick_frame_plane = conversions.frame_to_rhino(pick_frame)
# ---------- end py3_2 ----------

py3_3 = Python3Script(
    origin=pt_10,
    xaxis_pt=pt_11,
    xy_pt=pt_12,
    x=number_slider_8,
    y=number_slider_9,
    z=number_slider_10,
    Flip=boolean_toggle_3)  # -> out, pick_frame, pick_frame_plane; inputs origin: Point3d, xaxis_pt: Point3d, xy_pt: Point3d, x: Double, y: Double, z: Double, Flip: Boolean; same code as py3_2

# ----
compas_draw_5 = COMPASDraw(cg=py3.pick_frame)  # -> rg; same code as compas_draw
compas_draw_6 = COMPASDraw(cg=py3_2.pick_frame)  # -> rg; same code as compas_draw
compas_draw_7 = COMPASDraw(cg=py3_3.pick_frame)  # -> rg; same code as compas_draw
merge = Merge(Data1=py3.pick_frame, Data2=py3_2.pick_frame, Data3=py3_3.pick_frame)

# ---- group: Convert Planes to URScript
compas_2 = Python3Script(
    way_frames=compas.transformed_planes,
    tcp_measured=pt_13,
    acceleration=Slider(0.4, range=0..3),
    velocity=Slider(1, range=0..4),
    travel_acc=Slider(0.4, range=0..3),
    travel_vel=Slider(1, range=0..4),
    pick_frame=merge)  # -> out, vis_frames, vis_planes, script; inputs way_frames: list, tcp_measured: Point3d, acceleration: Double, velocity: Double, pick_frame: list
# ---------- compas_2: Python ----------
from imp import reload
import sys
import os

#get current file path
path = ghenv.Component.OnPingDocument().FilePath
#get parent directory of the parent directory
parentdir = os.path.dirname(path)
#get src folder which contains classes
dire = os.path.join(parentdir,'src')

sys.path.append(dire)

import simple_ur_script as ur
reload(ur)

import utils 
reload(utils)

import simple_comm as com
reload(com)

import compas.geometry as cg
import math as m

# ===== Set global constants =======

IO = 0 #Global constant
SAFE_DIST = 50

# =================================

script = "" #create empty string

def pickup_brick(script,pick_up_frame):
    frames = []
    
    safe_pick_up_frame = pick_up_frame.translated(pick_up_frame.normal*SAFE_DIST)
    
    ## add to the path: go to the safe plane
    script += ur.move_l(safe_pick_up_frame, travel_acc, travel_vel)
    frames.append(safe_pick_up_frame)
    
    ## add to the path: go to the pick up plane
    script += ur.move_l(pick_up_frame, acceleration, velocity)
    frames.append(pick_up_frame)
    
    ## add to the path: turn on the vacuum and wait 1 sec.
    script += ur.set_digital_out(IO,True)
    script += ur.sleep(1)

    # add to the path: go back to the safe_plane
    script += ur.move_l(safe_pick_up_frame, acceleration, velocity)
    frames.append(safe_pick_up_frame)
    
    return script, frames


def place_brick(script, place_frame):
    
    frames = []
    
    safe_place_frame = place_frame.translated(cg.Vector(0,0,1)*SAFE_DIST)
    
    # add to the path: go to the safe plane
    script += ur.move_l(safe_place_frame, travel_acc, travel_vel)
    frames.append(safe_place_frame)
    
    # add to the path: go to the place plane
    script += ur.move_l(place_frame, acceleration, velocity)
    frames.append(place_frame)
    
    ## add to the path: turn off the vacuum and wait 1 second (hold the brick)
    script += ur.set_digital_out(IO,False)
    script += ur.sleep(1)
    
    # add to the path: go back to the safe plane
    script += ur.move_l(safe_place_frame, acceleration, velocity)
    frames.append(safe_place_frame)
    
    return script,frames


#if value given for tcp measured, then add line to script, otherwise it will take current tcp from robot
if tcp_measured is not None:
    script += ur.set_tcp_by_angles(tcp_measured.X, tcp_measured.Y, tcp_measured.Z, m.radians(0.0),m.radians(0.0),m.radians(0))


vis_frames = []
#add move_l commands in sequence to script for each way plane
for brick_frame in way_frames:
    script, p = pickup_brick(script,pick_frame[0])
    vis_frames.extend(p) #only to visualize the planes
    script, p = place_brick(script,brick_frame)
    vis_frames.extend(p)


#format the script to make it sendable
script = com.concatenate_script(script)

from compas_rhino import conversions
import Rhino.Geometry as rg

vis_planes = [conversions.frame_to_rhino(frame) for frame in vis_frames]
# ---------- end compas_2 ----------

# ----
compas_draw_8 = COMPASDraw(cg=compas_2.vis_frames)  # -> rg; same code as compas_draw
points = PointList(Points=compas_2.vis_planes, Size=Slider(7, range=0..100))
panel_2 = Panel(compas_2.script)

# ---- group: Send UR script to Robot!
py3_4 = Python3Script(script=compas_2.script, ip_address="192.168.10.10", send=Button())  # -> out, a; inputs script: String, ip_address: String, send: Boolean
# ---------- py3_4: Python ----------
import simple_comm as com

if send:
    com.send_script(script,ip_address)
# ---------- end py3_4 ----------

# ---- group: Sim
robots_library = RobotsLibrary(
    {"UR3e", "UR5e", "UR10e", "UR16e", "UR3", "UR5", "UR10", "UR20", "UR30", "UniMelb-IRB120", "UniMelb-IRB1200", "ETH-Gantry"}, selected="UR5",
    Type=0)
load_robot_system = LoadRobotSystem(Name=robots_library, Base=PlaneXY(0, 0, 0))

# ---- group: Preview
number_slider_11 = Slider(25, range=0..100)
rectangle_3pt = Rectangle3Pt(PointA=pt, PointB=pt_2, PointC=pt_3)  # -> graft(Rectangle), Length
center_box = CenterBox(Base=py3.pick_frame_plane, X=number_slider_11, Y=number_slider_11, Z=Slider(40, range=0..100))
plane = Plane(compas_2.vis_planes)
polyline = PolyLine(Vertices=plane, Closed=False)
deconstruct_plane = DeconstructPlane(Plane=plane)  # -> Origin, XAxis, YAxis, ZAxis
custom_preview_lineweights = CustomPreviewLineweights(Geometry=polyline, Shader=ColourSwatch(SwatchColor=RGB(0, 254, 0)), Thickness=Slider(3, range=0..10), Absolute=False)
vector_display = VectorDisplay(Anchor=deconstruct_plane.Origin, Vector=deconstruct_plane.XAxis)
point_list = PointList(Points=plane, Size=Slider(3, range=0..10))

# ---- group: Sim / Approach
create_target = CreateTarget(Plane=plane, Tool=create_tool.Tool, IsCartesian=True)

# ---- group: Sim (continued)
create_program = CreateProgram(Name="DefaultProgram", RobotSystem=load_robot_system, Targets=create_target, StepSize=1)  # -> Program, Code, Duration, Warnings, Errors
program_simulation = ProgramSimulation(Program=create_program.Program, Time=Slider(0.047, range=0..1), Normalized=True)  # -> SystemMeshes, JointRotations, Plane, Index, Time, Program, Errors
panel_3 = Panel(create_program.Warnings)
panel_4 = Panel(program_simulation.Errors)

# ---- group: Preview (continued)
custom_preview = CustomPreview(
    Geometry=[program_simulation.SystemMeshes, rectangle_3pt.Rectangle, center_box],
    Material=ColourSwatch(SwatchColor=RGBA(255, 111, 9, 150)))
