# Grasshopper definition JW_Brick_151025.gh (Grasshopper 1.0.8)
# plug-ins: Robots

number_slider = Slider(0.07, range=0..1)
number_slider_2 = Slider(0, range=0..1)
number_slider_3 = Slider(4, range=0..10)

# ---- group: This is needed only ONCE in the GH definition
enable_auto_reload = Python3Script()  # -> ok
# ---------- enable_auto_reload: Python ----------
"""
------------------------------
Using VS Code as Python editor
------------------------------

The simplest way to start using VS Code as our editor, is
to place our Python code in files located IN THE SAME FOLDER as our Grasshopper file.

After we have done that, we need 2 steps: 

1. Enable the COMPAS reloader on one component. This tells Grasshopper to watch for changes in the Pythoh files and reload if changed.
2. Every other component that uses Python code from external files needs to start with a method to ensure Grasshopper knows where to load the files from.

"""
# r: compas
# venv: mas-2526

from compas_rhino.devtools import DevTools
DevTools.enable_reloader()
# ---------- end enable_auto_reload ----------

# ----
number_slider_4 = Slider(1.9, range=0..20)
number_slider_5 = Slider(19, range=0..50)
list = ValueList({"0", "90", "180", "270", "360"}, selected="90")
list_2 = ValueList({"0", "90", "180", "270", "360"}, selected="180")
list_3 = ValueList({"0", "90", "180", "270", "360"}, selected="270")
list_4 = ValueList({"0", "90", "180", "270", "360"}, selected="360")
gap = Slider(2.5, range=0..10)
# Generate Geometry
crv = Curve(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)
py3 = Python3Script(
    segments=number_slider_3,
    offsets=number_slider_4,
    levels=number_slider_5,
    Max_rotation=list,
    tolorence_xy=number_slider,
    tolorence_z=number_slider_2)  # -> out, bricks, frames; inputs segments: Int32, offsets: Double, levels: Int32, Max_rotation: Double, tolorence_xy: Double, tolorence_z: Double
# ---------- py3: Python ----------
# r: compas
# venv: mas-226
from compas_rhino.devtools import DevTools
DevTools.ensure_path()

import compas.geometry as cg
import ghpythonlib.treehelpers as th
import math

from brick_wall import Brick

#----#
x, y, z = Brick.LENGTH, Brick.WIDTH, Brick.HEIGHT

frames = []
bricks = []
for i in range(levels):
    z -= tolorence_z
    print (z)
    centroid = cg.Point(0, 0, i*z)
    pt2 = cg.Point(x, y, i*z)

    frames_branch = []
    bricks_branch = []
    for j in range(segments):
        # Create Original Brick
        brick = cg.Box.from_corner_corner_height(centroid, pt2, z)
        # Add Tolorence
        brick.translate([tolorence_xy, tolorence_xy, 0])
        # Offset Original Brick
        brick.translate([-offsets, offsets, 0])

        # Rotate Brick
        radian = (2*math.pi) / segments * j
        brick.rotate(radian)    
        # Rotate Unit(Brick*segment counts)
        angle = (math.radians(Max_rotation)) / (levels-1) * i
        brick.rotate(angle)

        # Get Frames
        frame = Brick.get_pick_frame(brick)

        frames_branch.append(frame)
        bricks_branch.append(brick)

    frames.append(frames_branch)
    bricks.append(bricks_branch)



#--------------#------------#

frames = th.list_to_tree(frames)
bricks = th.list_to_tree(bricks)
# ---------- end py3 ----------
py3_2 = Python3Script(
    segments=number_slider_3,
    offsets=number_slider_4,
    levels=number_slider_5,
    Max_rotation=list_2,
    tolorence_xy=number_slider,
    tolorence_z=number_slider_2)  # -> out, bricks, frames; inputs segments: Int32, offsets: Double, levels: Int32, Max_rotation: Double, tolorence_xy: Double, tolorence_z: Double; same code as py3
py3_3 = Python3Script(
    segments=number_slider_3,
    offsets=number_slider_4,
    levels=number_slider_5,
    Max_rotation=list_3,
    tolorence_xy=number_slider,
    tolorence_z=number_slider_2)  # -> out, bricks, frames; inputs segments: Int32, offsets: Double, levels: Int32, Max_rotation: Double, tolorence_xy: Double, tolorence_z: Double; same code as py3
py3_4 = Python3Script(
    segments=number_slider_3,
    offsets=number_slider_4,
    levels=number_slider_5,
    Max_rotation=list_4,
    tolorence_xy=number_slider,
    tolorence_z=number_slider_2)  # -> out, bricks, frames; inputs segments: Int32, offsets: Double, levels: Int32, Max_rotation: Double, tolorence_xy: Double, tolorence_z: Double; same code as py3
brick_wall = Python3Script(crv=crv, num_layers=Slider(9, range=0..30), gap=gap)  # -> bricks, geometries, way_planes; inputs crv: Curve, num_layers: Int32, gap: Double
# ---------- brick_wall: Python ----------
# r: compas
# venv: mas-2526
from compas_rhino.devtools import DevTools
DevTools.ensure_path()

# 0. Import everything we will need
import math
from compas.geometry import Box
from compas.geometry import Point
from compas.geometry import Frame
from compas.geometry import cross_vectors
from compas_rhino.conversions import curve_to_compas

# ..also import our module "brick_wall.py", that needs to be in the same folder as our GH file
from brick_wall import Brick

# 1. Start with an empty list of bricks to be created
#    make sure to match the name of this list to the output of this component!
bricks = []

# 2. Create points on each curve
curve = curve_to_compas(crv)
print(curve.length())

# divide curve twice as fine
num_divs = int(curve.length() / (Brick.LENGTH+gap)) * 2
params, div_pts = curve.divide_by_count(num_divs, True)

for row in range(num_layers):
    for col, param in enumerate(params,):
        pt = curve.point_at(param)
        pt = pt.translated([0,0,Brick.HEIGHT * row])
        tangent = curve.tangent_at(param)
        normal = cross_vectors(tangent, [0,0,1])
        # only place bricks on alternating divisions depending on the row
        if row % 2 == 0:  
            # even rows 
            if col % 2 == 0:
                b = Brick(frame = Frame(pt, tangent, normal))
                bricks.append(b)
        else:  
            # odd rows 
            if col % 2 == 1:
                b = Brick(frame = Frame(pt, tangent, normal))
                bricks.append(b)

# Visualize and store brick data
geometries = []
way_planes = []

for brick in bricks:
    geometries.append(brick.draw())
    way_planes.append(brick.get_pick_frame())
# ---------- end brick_wall ----------
py3_5 = Python3Script(x=py3.frames)  # -> out, a; inputs x: list
# ---------- py3_5: Python ----------
from compas_rhino.conversions import frame_to_rhino_plane

a = [frame_to_rhino_plane(f) for f in x]
# ---------- end py3_5 ----------
py3_6 = Python3Script(x=py3_2.frames)  # -> out, a; inputs x: list; same code as py3_5
py3_7 = Python3Script(x=py3_3.frames)  # -> out, a; inputs x: list; same code as py3_5
py3_8 = Python3Script(x=py3_4.frames)  # -> out, a; inputs x: list; same code as py3_5
compas_draw = COMPASDraw(cg=py3.bricks)  # -> rg
#   port cg: The COMPAS geometry or datastructure to be drawn.
#   port rg: The Rhino geometry object.
# ---------- compas_draw: Python ----------
# r: compas>=2.14.1
"""
Draws COMPAS geometry in Grasshopper.
"""

from typing import Any

import Grasshopper

from compas.scene import SceneObject


class CompasToRhinoGeometry(Grasshopper.Kernel.GH_ScriptInstance):
    def RunScript(self, cg):
        if not cg:
            return None

        return SceneObject(item=cg).draw()
# ---------- end compas_draw ----------
compas_draw_2 = COMPASDraw(cg=py3.frames)  # -> rg; same code as compas_draw
py3_9 = Python3Script(x=brick_wall.way_planes)  # -> out, a; inputs x: list; same code as py3_5
compas_draw_3 = COMPASDraw(cg=brick_wall.geometries)  # -> rg; same code as compas_draw
compas_draw_4 = COMPASDraw(cg=brick_wall.way_planes)  # -> rg; same code as compas_draw
number_slider_6 = Slider(99, range=0..100)
number_slider_7 = Slider(58, range=0..100)
pt = Point(Point(142.1152792, 419.4459918, 0))
pdecon = Deconstruct(Point=pt)  # -> XComponent, YComponent, ZComponent
neg = Negative(Value=Slider(120, range=0..1000))
xy = XYPlane(Origin=pt)
neg_2 = Negative(Value=number_slider_7)
prot = RotatePlane(Plane=xy, Angle=degrees("0"))
series = Series(Start=pdecon.YComponent, Step=neg, Count=number_slider_3)
dom = ConstructDomain(DomainStart=neg_2, DomainEnd=number_slider_7)
pt_2 = ConstructPoint(XCoordinate=pdecon.XComponent, YCoordinate=series, ZCoordinate=pdecon.ZComponent)  # -> graft(Point)
rectangle = Rectangle(Plane=prot, XSize=dom, YSize=dom, Radius=0)  # -> Rectangle, Length
entwine = Entwine(Branch00=py3.bricks, Branch01=py3_2.bricks, Branch02=py3_3.bricks, Branch03=py3_4.bricks, FlattenInputs=True)
entwine_2 = Entwine(Branch00=py3_5.a, Branch01=py3_6.a, Branch02=py3_7.a, Branch03=py3_8.a, FlattenInputs=True)
disc = Discontinuity(Curve=rectangle.Rectangle, Level=1)  # -> graft(Points), Parameters
compas_draw_5 = COMPASDraw(cg=entwine)  # -> rg; same code as compas_draw
orient = Orient(Geometry=compas_draw_5, Source=PlaneXY(0, 0, 0), Target=pt_2)  # -> Geometry, Transform
orient_2 = Orient(Geometry=entwine_2, Source=PlaneXY(0, 0, 0), Target=pt_2)  # -> Geometry, Transform
series_2 = Series(Start=0, Step=1, Count=number_slider_5)
series_3 = Series(Start=0, Step=1, Count=number_slider_3)
partition = PartitionList(List=orient_2.Geometry, Size=number_slider_3)  # -> simplify(Chunks)
preview = CustomPreview(Geometry=orient.Geometry, Material=ColourSwatch(SwatchColor=RGB(255, 209, 156)))
concat = Concatenate(FragmentA="{", FragmentB=series_3, FragmentC=";", FragmentD=graft(series_2), FragmentE="}")
branch = TreeBranch(Tree=partition, Path=concat, MaintainPaths=False)  # -> flatten(Branch)
panel = Panel(concat)
order = PointOrder(Points=branch)
data = Data(branch)
fine_adjust_z_mm = Slider(0, range=-5..10)
pln = Plane()
# Transform from Rhino to Robot Space
py3_10 = Python3Script(plns=data)  # -> out, frames; inputs plns: list of Plane
# ---------- py3_10: Python ----------
import compas_rhino.conversions as crc
frames = [crc.plane_to_compas_frame(pln) for pln in plns]
print (type(plns[0]))
# ---------- end py3_10 ----------
pt_3 = Point("{462.02, 465.69, 4.06}")
pt_4 = Point("{109.25, 464.14, 5.11}")
pt_5 = Point("{462.19, -132.33, 5.03}")
compas = Python3Script(way_planes=py3_10.frames, wobj_origin=pt_3, wobj_xaxis=pt_4, wobj_xypoint=pt_5, z_safe_margin=fine_adjust_z_mm)  # -> out, transformed_planes; inputs way_planes: list, wobj_origin: Point3d, wobj_xaxis: Point3d, wobj_xypoint: Point3d, z_safe_margin: Double
# ---------- compas: Python ----------
import compas.geometry as cg

#in this step we transform our way planes to robot space
#the rhino co-ordinate system is rather abstract in the physical world
#the robot base plane assumed the base frame of robot is the origin
#but rhino does not know that
#thus we transform things from our design space(Rhino World XY) to Robot Base Plane that we measure

def set_robot_base(origin, xaxis, xypoint):
    """
    set a base plane representing the robot working object plane
    """
    robot_base = cg.Frame(origin, xaxis - origin, xypoint - origin)
    print (robot_base)
    return (robot_base)

def rhino_to_robot_space(rhino_plane,robot_base_plane):
    """
    Transform the objects from Rhino world XY plane to robot work object plane
    """
    T_matrix = cg.Transformation.from_frame_to_frame(cg.Frame.worldXY(), robot_base_plane)
    robot_plane = rhino_plane.transformed(T_matrix)
    return robot_plane

def set_z_safe_margin(planes_to_adjust, safety_margin):
    adjusted = []
    T = cg.Translation.from_vector(cg.Vector(0, 0, safety_margin))
    for f in planes_to_adjust:
        adjusted.append(f.transformed(T))
    return adjusted

# ===== Robot base is set =====
robot_base =  set_robot_base(wobj_origin, wobj_xaxis, wobj_xypoint)
print(robot_base)

# ===== Set safety margin for Z height ======
safe_planes = set_z_safe_margin(way_planes, z_safe_margin)

# ===== Transforming the rhino planes into robot planes =====
transformed_planes = []
for plane in safe_planes: 
    transformed_planes.append(rhino_to_robot_space(plane, robot_base))
# ---------- end compas ----------
compas_draw_6 = COMPASDraw(cg=compas.transformed_planes)  # -> rg; same code as compas_draw

# ---- group: *Visualize Pln XYZ
cluster = Cluster(pln=compas_draw_6, num=Slider(8.2, range=0..10))

# ----
cluster_2 = Cluster(pln=compas_draw_6, num=Slider(8.2, range=0..10))
pt_6 = Point("{-23.736745, 438.885287, 47.558923}")
pt_7 = Point("{-19.501521, 420.444605, 39.878472}")
pt_8 = Point("{-30.431521, 437.504605, 54.198472}")
py3_11 = Python3Script(origin=pt_6, xaxis_pt=pt_7, xy_pt=pt_8)  # -> out, pick_frame; inputs origin: Point3d, xaxis_pt: Point3d, xy_pt: Point3d
# ---------- py3_11: Python ----------
from compas.geometry import Frame, Point
from compas.geometry import Rotation

from compas_rhino.conversions import point_to_compas

origin = point_to_compas(origin)
xaxis_pt = point_to_compas(xaxis_pt)
xy_pt = point_to_compas(xy_pt)

#define pick frame
pick_frame = Frame(origin, xaxis_pt - origin, xy_pt - origin)
# ---------- end py3_11 ----------

# ---- group: TCP
# Convert Planes to URScript
pt_9 = ConstructPoint(XCoordinate="-2.72", YCoordinate="4.86", ZCoordinate="88.08")

# ----
number_slider_8 = Slider(3, range=0..10)
compas_draw_7 = COMPASDraw(cg=py3_11.pick_frame)  # -> rg; same code as compas_draw

# ---- group: NEW
compas_2 = Python3Script(
    way_frames=compas.transformed_planes,
    tcp_measured=pt_9,
    acceleration=number_slider_8,
    velocity=number_slider_8,
    pick_frame=py3_11.pick_frame)  # -> out, vis_frames, vis_planes, script; inputs way_frames: list, tcp_measured: Point3d, acceleration: Double, velocity: Double
# ---------- compas_2: Python ----------
from imp import reload
import sys
import os

#get current file path
path = ghenv.Component.OnPingDocument().FilePath
#get parent directory of the parent directory
parentdir = os.path.dirname(path)
#get src folder which contains classes
dire = os.path.join(parentdir,'src')

sys.path.append(dire)

import simple_ur_script as ur
reload(ur)

import utils 
reload(utils)

import simple_comm as com
reload(com)

import compas.geometry as cg
import math as m

# ===== Set global constants =======

IO = 4 #Global constant
SAFE_DIST = 50

# =================================

script = "" #create empty string

def pickup_brick(script,pick_up_frame, brick_frame):
    frames = []
    safe_pick_up_frame = pick_up_frame.translated(-pick_up_frame.normal*SAFE_DIST)

    # # add to th path: first vertical_safe_plane
    z = brick_frame.point.z + SAFE_DIST
    pt = safe_pick_up_frame.point
    xaxis = cg.Vector(safe_pick_up_frame.xaxis.x, safe_pick_up_frame.xaxis.y, 0)
    yaxis = cg.Vector(safe_pick_up_frame.yaxis.x, safe_pick_up_frame.yaxis.y, 0)
    vertical_safe_plane = cg.Frame(pt, xaxis, yaxis)
    vertical_safe_plane = vertical_safe_plane.translated([0, 0, z])

    script += ur.move_l(vertical_safe_plane, acceleration, velocity)
    frames.append(vertical_safe_plane)
    
    ## add to the path: go to the safe plane
    script += ur.move_l(safe_pick_up_frame, acceleration, velocity)
    frames.append(safe_pick_up_frame)
    
    ## add to the path: go to the pick up plane
    script += ur.move_l(pick_up_frame, acceleration, velocity)
    frames.append(pick_up_frame)
    
    ## add to the path: turn on the vacuum and wait .5 sec.
    script += ur.set_digital_out(IO,True)
    script += ur.sleep(.5)

    # add to the path: go back to the safe_plane
    script += ur.move_l(safe_pick_up_frame, acceleration, velocity)
    frames.append(safe_pick_up_frame)
    
    # add to th path: go up to vertical_safe_plane
    script += ur.move_l(vertical_safe_plane, acceleration, velocity)
    frames.append(vertical_safe_plane)
    
    return script, frames


def place_brick(script, place_frame):
    
    frames = []
    
    safe_place_frame = place_frame.translated(cg.Vector(0,0,1)*SAFE_DIST)
    
    # add to the path: go to the safe plane
    script += ur.move_l(safe_place_frame, acceleration, velocity)
    frames.append(safe_place_frame)
    
    # add to the path: go to the place plane
    script += ur.move_l(place_frame, acceleration, velocity)
    frames.append(place_frame)
    
    ## add to the path: turn off the vacuum and wait .5 second (hold the brick)
    script += ur.set_digital_out(IO,False)
    script += ur.sleep(.5)
    
    # add to the path: go back to the safe plane
    script += ur.move_l(safe_place_frame, acceleration, velocity)
    frames.append(safe_place_frame)
    
    return script,frames


#if value given for tcp measured, then add line to script, otherwise it will take current tcp from robot
if tcp_measured is not None:
    script += ur.set_tcp_by_angles(tcp_measured.X, tcp_measured.Y, tcp_measured.Z, m.radians(0.0),m.radians(0.0),m.radians(0))


vis_frames = []
#add move_l commands in sequence to script for each way plane
for brick_frame in way_frames:
    script, p = pickup_brick(script, pick_frame, brick_frame)
    vis_frames.extend(p) #only to visualize the planes
    script, p = place_brick(script,brick_frame)
    vis_frames.extend(p)


#format the script to make it sendable
script = com.concatenate_script(script)

from compas_rhino import conversions
import Rhino.Geometry as rg

vis_planes = [conversions.frame_to_rhino(frame) for frame in vis_frames]
# ---------- end compas_2 ----------

# ----
list_5 = RobotsLibrary(
    {"AA-KR60", "AA-KR30", "AA-KR60_KR30", "Franka Emika Panda", "Bartlett-IRB120", "Bartlett-IRB1600", "Bartlett-KR6", "Bartlett-KR60-A", "Bartlett-KR60-B", "Bartlett-KR500"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}, selected="UR5",
    Type=0)
py3_12 = Python3Script(x=compas_2.vis_frames)  # -> out, a; inputs x: list; same code as py3_5
loadrobot = LoadRobotSystem(Name=list_5, Base=PlaneXY(0, 0, 0))
tool = CreateTool(Name="DefaultGHTool", TCP=pt_9, Weight=0)  # -> Tool, TCP
target = CreateTarget(Plane=py3_12.a, Tool=tool.Tool, IsCartesian=True)
# Send to Robot!
number_slider_9 = Slider(0, range=0..1)
program = CreateProgram(Name="DefaultProgram", RobotSystem=loadrobot, Targets=target, StepSize=1)  # -> Program, Code, Duration, Warnings, Errors
sim = ProgramSimulation(Program=program.Program, Time=number_slider_9, Normalized=True)  # -> SystemMeshes, JointRotations, Plane, Index, Time, Program, Errors

compas_3 = Python3Script(
    way_frames=compas.transformed_planes,
    tcp_measured=pt_9,
    acceleration=number_slider_8,
    velocity=number_slider_8,
    pick_frame=py3_11.pick_frame)  # -> out, vis_frames, vis_planes, script; inputs way_frames: list, tcp_measured: Point3d, acceleration: Double, velocity: Double; disabled
# ---------- compas_3: Python ----------
from imp import reload
import sys
import os

#get current file path
path = ghenv.Component.OnPingDocument().FilePath
#get parent directory of the parent directory
parentdir = os.path.dirname(path)
#get src folder which contains classes
dire = os.path.join(parentdir,'src')

sys.path.append(dire)

import simple_ur_script as ur
reload(ur)

import utils 
reload(utils)

import simple_comm as com
reload(com)

import compas.geometry as cg
import math as m

# ===== Set global constants =======

IO = 4 #Global constant
SAFE_DIST = 50

# =================================

script = "" #create empty string

def pickup_brick(script,pick_up_frame):
    frames = []
    
    safe_pick_up_frame = pick_up_frame.translated(-pick_up_frame.normal*SAFE_DIST)
    
    ## add to the path: go to the safe plane
    script += ur.move_l(safe_pick_up_frame, acceleration, velocity)
    frames.append(safe_pick_up_frame)
    
    ## add to the path: go to the pick up plane
    script += ur.move_l(pick_up_frame, acceleration, velocity)
    frames.append(pick_up_frame)
    
    ## add to the path: turn on the vacuum and wait 1 sec.
    script += ur.set_digital_out(IO,True)
    script += ur.sleep(1)

    # add to the path: go back to the safe_plane
    script += ur.move_l(safe_pick_up_frame, acceleration, velocity)
    frames.append(safe_pick_up_frame)
    
    return script, frames


def place_brick(script, place_frame):
    
    frames = []
    
    safe_place_frame = place_frame.translated(cg.Vector(0,0,1)*SAFE_DIST)
    
    # add to the path: go to the safe plane
    script += ur.move_l(safe_place_frame, acceleration, velocity)
    frames.append(safe_place_frame)
    
    # add to the path: go to the place plane
    script += ur.move_l(place_frame, acceleration, velocity)
    frames.append(place_frame)
    
    ## add to the path: turn off the vacuum and wait 1 second (hold the brick)
    script += ur.set_digital_out(IO,False)
    script += ur.sleep(1)
    
    # add to the path: go back to the safe plane
    script += ur.move_l(safe_place_frame, acceleration, velocity)
    frames.append(safe_place_frame)
    
    return script,frames


#if value given for tcp measured, then add line to script, otherwise it will take current tcp from robot
if tcp_measured is not None:
    script += ur.set_tcp_by_angles(tcp_measured.X, tcp_measured.Y, tcp_measured.Z, m.radians(0.0),m.radians(0.0),m.radians(0))


vis_frames = []
#add move_l commands in sequence to script for each way plane
for brick_frame in way_frames:
    script, p = pickup_brick(script,pick_frame)
    vis_frames.extend(p) #only to visualize the planes
    script, p = place_brick(script,brick_frame)
    vis_frames.extend(p)


#format the script to make it sendable
script = com.concatenate_script(script)

from compas_rhino import conversions
import Rhino.Geometry as rg

vis_planes = [conversions.frame_to_rhino(frame) for frame in vis_frames]
# ---------- end compas_3 ----------
points = PointList(Points=compas_2.vis_planes, Size=Slider(7, range=0..100))
pline = PolyLine(Vertices=compas_2.vis_planes, Closed=False)
compas_draw_8 = COMPASDraw(cg=compas_3.vis_frames)  # -> rg; disabled; same code as compas_draw

# ---- group: Send UR script to Robot!
py3_13 = Python3Script(script=compas_2.script, ip_address="192.168.10.10", send=Button())  # -> out, a; inputs script: String, ip_address: String, send: Boolean
# ---------- py3_13: Python ----------
import simple_comm as com

if send:
    com.send_script(script,ip_address)
# ---------- end py3_13 ----------

# ==== cluster Cluster
pln = ClusterInput()
num = ClusterInput()
pln_2 = Plane(graft(pln))
num_2 = Number(num)
deplane = DeconstructPlane(Plane=pln_2)  # -> flatten(Origin), XAxis, YAxis, ZAxis
entwine = Entwine(Branch00=deplane.XAxis, Branch01=deplane.YAxis, Branch02=deplane.ZAxis, FlattenInputs=True)
merge = Merge(
    Data1=ColourSwatch(SwatchColor=RGB(255, 0, 0)),
    Data2=ColourSwatch(SwatchColor=RGB(0, 255, 0)),
    Data3=ColourSwatch(SwatchColor=RGB(0, 0, 255)))  # -> graft(Result)
multiplication = Multiplication(A=entwine, B=num_2)
vdisex = VectorDisplayEx(Point=deplane.Origin, Vector=multiplication, Colour=merge, Width=2)
