# Grasshopper definition JW_Brick_161025.gh (Grasshopper 1.0.8)
# plug-ins: Robots

number_slider = Slider(2, range=0..10)
number_slider_2 = Slider(10, range=0..10)
list = ValueList({"0", "90", "180", "270", "360"}, selected="90")
py3 = Python3Script(
    segments=Slider(3, range=0..10),
    half_loops=number_slider,
    half_loop_counts=Slider(13, range=0..100),
    tolorence_single=Slider(1, range=0..1),
    tolorence_xy=Slider(10, range=0..30),
    val_inward=Slider(0, range=0..10),
    rrr=Slider(90, range=0..90))  # -> out, bricks_out, c, frames_tree, final_bricks, all_new_frames, final_frames; inputs segments: Int32, half_loops: Int32, half_loop_counts: Int32, tolorence_xy: Double
# ---------- py3: Python ----------
from compas_rhino.devtools import DevTools
DevTools.ensure_path()

import compas.geometry as cg
import ghpythonlib.treehelpers as th
import math

from brick_wall import Brick


# def get_avg_pts(pts):
#     avgs = []
    
#     for j in range(half_loops):
#         if j % 2 == 0:
#             shifted = pts[-1:] + pts[:-1]
#         else:
#             shifted = pts
#     for i in range(0, len(shifted), 2):
#         two_pts = [shifted[i], shifted[i+1]]
#         avg = cg.Point(*cg.centroid_points(two_pts))
#         avgs.append(avg)
#         avgs.append(avg)
#     for j in range(half_loops):
#         if j % 2 == 0:        
#             shifted_avgs = avgs[1:] + avgs[:1]
#         else:
#             shifted_avgs = avgs
#     return shifted_avgs
    

#--------#-------#
x, y, z = Brick.LENGTH, Brick.WIDTH, Brick.HEIGHT

# Base Boxs
corner1 = cg.Point(0, 0, 0)
corner2 = cg.Point(x, -y, 0)
corner3 = cg.Point(x, y, 0)
box1 = cg.Box.from_corner_corner_height(corner1, corner2, z)
box1.translate([0,-tolorence_single,0])
box2 = cg.Box.from_corner_corner_height(corner1, corner3, z)
box2.translate([0,tolorence_single,0])
two_boxs = [box1, box2]

# Find Polygon Radius
r_translate_value = Brick.WIDTH / (math.tan(math.pi/segments)) + tolorence_xy

bricks = []
for i in range(half_loop_counts):
    bricks_branch = []
    centroids_branch = []
    for j in range(segments):
        # Create Ground Box Values
        radian_xy = ((2*math.pi) / segments) * j
        radian_z = math.radians((-(180/segments) / (half_loop_counts-1)) * i)
        vector = cg.Vector(-1,0,0).rotated(radian_xy)*val_inward
        two_centroids = []
        # Transform Boxs
        new_two_boxs = []
        for count, b in enumerate(two_boxs):
            if count == 0:
                radian_z = radian_z
            elif count == 1:
                radian_z = -radian_z
            newb = b.translated([r_translate_value, 0, z*i])
            # Self Rotate
            newb.rotate(radian_z, [0,0,1], newb.points[0])  #First Corner of the Box
            # Polar Array Boxs
            newb.rotate(radian_xy)
            # Translate Inward
            newb.translate(vector*i)
            new_two_boxs.append(newb)
            
            # Find Top Bricks Centroids
            # if i == (half_loop_counts-1):
            #     two_centroids.append(newb.frame.point)
            # else:
            #     continue

        bricks_branch.append(new_two_boxs)    
        # centroids_branch.append(two_centroids)
    bricks.append(bricks_branch)

print (len(bricks))
# print (bricks)
"""for i, branch in enumerate(bricks):
    print (len(branch))
    if i == (len(bricks)-1):
        avgs = get_avg_pts(centroids_branch)
        print (avgs)

        all_boxes = [b for two_b in branch for b in two_b]
        for avg, b in zip(avgs, all_boxes):
            b.rotate(math.pi/2, [0, 0, 1], avg)
    else:
        continue

pty = avgs"""

# print (len(bricks_branch[-1]))
# print (len(centroids_branch))

def process_brick(objs):
    frame1 = cg.Frame([0, 0, step/2*(i+1)])
    frame2 = frame1.flipped()
    # Mirror Transformation
    M = cg.Transformation.from_frame_to_frame(frame1, frame2)
    new_objs = []
    for count, branch in enumerate(objs):
        new_objs_branch = []
        for two_objs in branch:
            new_two_objs = []
            two_centroids = []

            for obj in two_objs:
                new_obj = obj.translated([0,0,step*i])
                # Mirror Odd levels
                if i % 2 != 0:
                    new_obj = obj.transformed(M)
                    
                    # Rotate Itself
                    if hasattr(new_obj, "frame"):
                        axis = new_obj.frame.xaxis
                        point = new_obj.frame.point
                        new_obj = new_obj.rotated(math.pi, axis, point)
                    if isinstance(new_obj, cg.Frame):
                        axis = new_obj.xaxis
                        point = new_obj.point.translated([0,0,z/2])
                        new_obj = new_obj.rotated(math.pi, axis, point)
                else:
                    pass

                new_two_objs.append(new_obj)
            new_objs_branch.append(new_two_objs)
        new_objs.append(new_objs_branch)
    return new_objs


# def rotate_tops(objs):
#     for count, branch in enumerate(objs):
#         if count == (len(objs)-1):
#             avgs = get_avg_pts(centroids_branch)

#             all_boxes = [obj for two_objs in branch for obj in two_objs]
#             for avg, obj in zip(avgs, all_boxes):
#                 obj.rotate(math.pi/2, [0, 0, 1], avg)
#         else:
#             continue
#     return [objs, len(objs)-1]
    
# Mirror Brick
step = z*half_loop_counts
all_new_bricks = []
all_new_frames = []
for i in range(half_loops):
    # Stack Bricks
    new_bricks = process_brick(bricks)
    all_new_bricks.append(new_bricks)

    # Nested List Comprehension
    # Find Frame for Each Brick
    frames = [
        [
            [Brick.get_pick_frame(brick) for brick in two_bricks]
            for two_bricks in branch
        ]
        for branch in bricks
    ]
    new_frames = process_brick(frames)
    all_new_frames.append(new_frames)
    
print ("all,", len(all_new_bricks))


def reverse_order(objects):
    final_objs = []
    for i, branch in enumerate(objects):
        print ("branch,", len(branch)) if i == 0 else None
        if i % 2 != 0:
            # Record Tree Structure
            lens1 = len(branch)
            print (lens1)
            lens2 = len(branch[0])
            print (lens2)
            lens3 = len(branch[0][0])
            print (lens3)

            # Flatten Tree
            branch = [b for flat in branch for two in flat for b in two]
            # Reverse Order
            branch.reverse()
            # Unflatten Tree
            flat = [branch[i:i+lens3] for i in range(0, len(branch), lens3)]
            branch = [flat[i:i+lens2] for i in range(0, len(flat), lens2)]
        else:
            pass
        final_objs.append(branch)
    return final_objs

final_bricks = reverse_order(all_new_bricks)
final_frames = reverse_order(all_new_frames)

def rotate_tops(final_objs):
    for i, branch in enumerate(final_objs):
        flat = branch[-1]
        print ("a,", len(flat)) if i == 0 else None
        objs = [b for two in flat for b in two]
        # pts = [obj.frame.point for obj in objs]
        pts = []
        for obj in objs:
            if hasattr(obj, "frame"):
                pt = obj.frame.point
                pts.append(pt)
            elif isinstance(obj, cg.Frame):
                pt = obj.point
                pts.append(pt)
                print (len(pts))

        # average points
        avgs = []
        if i % 2 == 0:
            shifted = pts[-1:] + pts[:-1]
            for i in range(0, len(shifted), 2):
                two_pts = [shifted[i], shifted[i+1]]
                avg = cg.Point(*cg.centroid_points(two_pts))
                avgs.append(avg)
                avgs.append(avg)
            shifted_avgs = avgs[1:] + avgs[:1]
        elif i % 2 == 1:
            shifted = pts
            for i in range(0, len(shifted), 2):
                two_pts = [shifted[i], shifted[i+1]]
                avg = cg.Point(*cg.centroid_points(two_pts))
                avgs.append(avg)
                avgs.append(avg)   
            shifted_avgs = avgs

        print (len(avgs))
        new_flat = []
        b = [b for two in flat for b in two]
        for index, avg in enumerate(shifted_avgs):
            b[index].rotate(math.radians(rrr), [0, 0, 1], avg)
            print (b[index]) if index == 0 else None
    return final_objs

final_bricks = rotate_tops(final_bricks)
final_frames = rotate_tops(final_frames)


# a = th.list_to_tree(two_boxs_column)
bricks_out = th.list_to_tree(bricks)

final_bricks = th.list_to_tree(final_bricks)
final_frames = th.list_to_tree(final_frames)
all_new_frames = th.list_to_tree(all_new_frames)
# ---------- end py3 ----------
py3_2 = Python3Script(
    segments=Slider(4, range=0..10),
    offsets=Slider(1.9, range=0..20),
    levels=Slider(19, range=0..50),
    Max_rotation=list,
    tolorence_xy=Slider(0.03, range=0..1),
    tolorence_z=Slider(0, range=0..1))  # -> out, bricks, frames; inputs segments: Int32, offsets: Double, levels: Int32, Max_rotation: Double, tolorence_xy: Double, tolorence_z: Double
# ---------- py3_2: Python ----------
from compas_rhino.devtools import DevTools
DevTools.ensure_path()

import compas.geometry as cg
import ghpythonlib.treehelpers as th
import math

from brick_wall import Brick

#----#
x, y, z = Brick.LENGTH, Brick.WIDTH, Brick.HEIGHT

frames = []
bricks = []
for i in range(levels):
    z -= tolorence_z
    print (z)
    centroid = cg.Point(0, 0, i*z)
    pt2 = cg.Point(x, y, i*z)

    frames_branch = []
    bricks_branch = []
    for j in range(segments):
        # Create Original Brick
        brick = cg.Box.from_corner_corner_height(centroid, pt2, z)
        # Add Tolorence
        brick.translate([tolorence_xy, tolorence_xy, 0])
        # Offset Original Brick
        brick.translate([-offsets, offsets, 0])

        # Rotate Brick
        radian = (2*math.pi) / segments * j
        brick.rotate(radian)    
        # Rotate Unit(Brick*segment counts)
        angle = (math.radians(Max_rotation)) / (levels-1) * i
        brick.rotate(angle)

        # Get Frames
        frame = Brick.get_pick_frame(brick)

        frames_branch.append(frame)
        bricks_branch.append(brick)

    frames.append(frames_branch)
    bricks.append(bricks_branch)



#--------------#------------#

frames = th.list_to_tree(frames)
bricks = th.list_to_tree(bricks)
# ---------- end py3_2 ----------
compas_draw = COMPASDraw()  # -> rg
#   port cg: The COMPAS geometry or datastructure to be drawn.
#   port rg: The Rhino geometry object.
# ---------- compas_draw: Python ----------
# r: compas>=2.14.1
"""
Draws COMPAS geometry in Grasshopper.
"""

from typing import Any

import Grasshopper

from compas.scene import SceneObject


class CompasToRhinoGeometry(Grasshopper.Kernel.GH_ScriptInstance):
    def RunScript(self, cg):
        if not cg:
            return None

        return SceneObject(item=cg).draw()
# ---------- end compas_draw ----------
points = PointList(Points=compas_draw, Size=Slider(5, range=0..10))
py3_3 = Python3Script(x=py3_2.frames)  # -> out, a; inputs x: list
# ---------- py3_3: Python ----------
from compas_rhino.conversions import frame_to_rhino_plane

a = [frame_to_rhino_plane(f) for f in x]
# ---------- end py3_3 ----------
compas_draw_2 = COMPASDraw(cg=py3.bricks_out)  # -> rg; same code as compas_draw

geo = Geometry(flatten(compas_draw_2))  # disabled
bbox = BoundingBox(Content=geo, Plane=PlaneXY(0, 0, 0), UnionBox=True)  # -> Box, Box_2; disabled
debox = DeconstructBox(Box=bbox.Box)  # -> Plane, X, Y, Z; disabled
dedomain = DeconstructDomain(Domain=debox.Z)  # -> Start, End; disabled
subtraction = Subtraction(A=dedomain.End, B=dedomain.Start)  # disabled
series = Series(Start=0, Step=subtraction, Count=number_slider)  # disabled
Z = UnitZ(Factor=series)  # -> graft(UnitVector); disabled
move = Move(Geometry=geo, Motion=Z)  # -> Geometry, Transform; disabled
tstat = TreeStatistics(Tree=move.Geometry)  # -> Paths, Length, Count; disabled
dispatch = Dispatch(List=tstat.Paths, DispatchPattern=[True, False])  # -> ListA, ListB; disabled
split = SplitTree(Data=move.Geometry, Masks=flatten(dispatch.ListA))  # -> Positive, Negative; disabled
bbox_2 = BoundingBox(Content=split.Negative, Plane=PlaneXY(0, 0, 0), UnionBox=True)  # -> Box, Box_2; disabled
area = Area(Geometry=bbox_2.Box)  # disabled
xy = XYPlane(Origin=area)  # disabled
mirror = Mirror(Geometry=split.Negative, Plane=xy)  # -> Geometry, Transform; disabled
merge = Merge(Data1=split.Positive, Data2=mirror.Geometry)  # disabled

compas_draw_3 = COMPASDraw(cg=py3.c)  # -> rg; same code as compas_draw
compas_draw_4 = COMPASDraw(cg=py3.final_bricks)  # -> rg; same code as compas_draw
panel = Panel(compas_draw_4)
compas_draw_5 = COMPASDraw(cg=py3_2.bricks)  # -> rg; same code as compas_draw
viewer = ParamViewer(compas_draw_4)
py3_4 = Python3Script(x=py3.final_frames)  # -> out, rg_plns; inputs x: list
# ---------- py3_4: Python ----------
from compas_rhino.conversions import frame_to_rhino_plane

rg_plns = [frame_to_rhino_plane(f) for f in x]
# ---------- end py3_4 ----------
viewer_2 = ParamViewer(py3_4.rg_plns)
preview = CustomPreview(Geometry=compas_draw_5, Material=ColourSwatch(SwatchColor=RGB(255, 209, 156)))
preview_2 = CustomPreview(Geometry=compas_draw_4, Material=ColourSwatch(SwatchColor=RGB(255, 209, 156)))
deplane = DeconstructPlane(Plane=py3_4.rg_plns)  # -> Origin, XAxis, YAxis, ZAxis
X = UnitX(Factor=1)
angle = Angle(VectorA=deplane.XAxis, VectorB=X)  # -> Angle, Reflex
trim = TrimTree(Tree=compas_draw_4, Depth=Slider(1, range=0..10))
deg = Degrees(Radians=angle.Angle)
pt = Point(Point(98.67214085, 320.2053935, 0))
number_slider_3 = Slider(10, range=0..10)
larger = LargerThan(FirstNumber=deg, SecondNumber="90")  # -> LargerThan, OrEqualTo
tstat_2 = TreeStatistics(Tree=trim)  # -> Paths, Length, Count
panel_2 = Panel(larger.OrEqualTo)
dispatch_2 = Dispatch(List=py3_4.rg_plns, DispatchPattern=larger.OrEqualTo)  # -> ListA, ListB
item = ListItem(List=tstat_2.Paths, Index=Slider(13, range=0..100), Wrap=True)
branch = TreeBranch(Tree=trim, Path=item, MaintainPaths=True)
prot = RotatePlane(Plane=dispatch_2.ListA, Angle=degrees("180"))
not = GateNot(A=larger.OrEqualTo)
area_2 = Area(Geometry=branch)
weave = Weave(Pattern=not, Stream0=prot, Stream1=dispatch_2.ListB, NullGaps=False)

# ---- group: *Visualize Pln XYZ
cluster = Cluster(pln=weave, num=Slider(8.2, range=0..10))

# ----
orient = Orient(Geometry=weave, Source=PlaneXY(0, 0, 0), Target=pt)  # -> flatten(Geometry), Transform
order = PointOrder(Points=orient.Geometry)
points_2 = PointList(Points=area_2, Size=Slider(5, range=0..10))
data = Data(orient.Geometry)
data_2 = Data(data)
fine_adjust_z_mm = Slider(0, range=-5..10)
# Transform from Rhino to Robot Space
py3_5 = Python3Script(plns=data_2)  # -> out, frames; inputs plns: list of Plane
# ---------- py3_5: Python ----------
import compas_rhino.conversions as crc
frames = [crc.plane_to_compas_frame(pln) for pln in plns]
print (type(plns[0]))
# ---------- end py3_5 ----------
pt_2 = Point("{462.02, 465.69, 4.06}")
pt_3 = Point("{109.25, 464.14, 5.11}")
pt_4 = Point("{462.19, -132.33, 5.03}")
compas = Python3Script(way_planes=py3_5.frames, wobj_origin=pt_2, wobj_xaxis=pt_3, wobj_xypoint=pt_4, z_safe_margin=fine_adjust_z_mm)  # -> out, transformed_planes; inputs way_planes: list, wobj_origin: Point3d, wobj_xaxis: Point3d, wobj_xypoint: Point3d, z_safe_margin: Double
# ---------- compas: Python ----------
import compas.geometry as cg

#in this step we transform our way planes to robot space
#the rhino co-ordinate system is rather abstract in the physical world
#the robot base plane assumed the base frame of robot is the origin
#but rhino does not know that
#thus we transform things from our design space(Rhino World XY) to Robot Base Plane that we measure

def set_robot_base(origin, xaxis, xypoint):
    """
    set a base plane representing the robot working object plane
    """
    robot_base = cg.Frame(origin, xaxis - origin, xypoint - origin)
    print (robot_base)
    return (robot_base)

def rhino_to_robot_space(rhino_plane,robot_base_plane):
    """
    Transform the objects from Rhino world XY plane to robot work object plane
    """
    T_matrix = cg.Transformation.from_frame_to_frame(cg.Frame.worldXY(), robot_base_plane)
    robot_plane = rhino_plane.transformed(T_matrix)
    return robot_plane

def set_z_safe_margin(planes_to_adjust, safety_margin):
    adjusted = []
    T = cg.Translation.from_vector(cg.Vector(0, 0, safety_margin))
    for f in planes_to_adjust:
        adjusted.append(f.transformed(T))
    return adjusted

# ===== Robot base is set =====
robot_base =  set_robot_base(wobj_origin, wobj_xaxis, wobj_xypoint)
print(robot_base)

# ===== Set safety margin for Z height ======
safe_planes = set_z_safe_margin(way_planes, z_safe_margin)

# ===== Transforming the rhino planes into robot planes =====
transformed_planes = []
for plane in safe_planes: 
    transformed_planes.append(rhino_to_robot_space(plane, robot_base))
# ---------- end compas ----------
compas_draw_6 = COMPASDraw(cg=compas.transformed_planes)  # -> rg; same code as compas_draw

# ---- group: *Visualize Pln XYZ
cluster_2 = Cluster(pln=compas_draw_6, num=Slider(8.2, range=0..10))

# ----
cluster_3 = Cluster(pln=compas_draw_6, num=Slider(8.2, range=0..10))
pt_5 = Point("{-23.68, 438.87, 47.63}")
pt_6 = Point("{-23.65, 424.70, 45.49}")
pt_7 = Point("{-36.52, 437.71, 61.48}")
pt_8 = Point("{-20.8, 439.6, 47.6}")
pt_9 = Point("{-20.9, 422.2, 45.1}")
pt_10 = Point("{-32.5, 439.1, 59.5}")

# ---- group: TCP
pt_11 = ConstructPoint(XCoordinate="-2.72", YCoordinate="4.86", ZCoordinate="88.08")

pt_12 = ConstructPoint(XCoordinate="-2.71", YCoordinate="3.23", ZCoordinate="86.39")

# ----
py3_6 = Python3Script(origin=pt_8, xaxis_pt=pt_9, xy_pt=pt_10)  # -> out, pick_frame; inputs origin: Point3d, xaxis_pt: Point3d, xy_pt: Point3d
# ---------- py3_6: Python ----------
from compas.geometry import Frame, Point
from compas.geometry import Rotation

from compas_rhino.conversions import point_to_compas

origin = point_to_compas(origin)
xaxis_pt = point_to_compas(xaxis_pt)
xy_pt = point_to_compas(xy_pt)

#define pick frame
pick_frame = Frame(origin, xaxis_pt - origin, xy_pt - origin)
# ---------- end py3_6 ----------
compas_draw_7 = COMPASDraw(cg=py3_6.pick_frame)  # -> rg; same code as compas_draw

# ---- group: NEW
# Convert Planes to URScript
compas_2 = Python3Script(
    way_frames=compas.transformed_planes,
    tcp_measured=pt_12,
    acceleration=Slider(2, range=0..10),
    velocity=Slider(2, range=0..10),
    pick_frame=py3_6.pick_frame)  # -> out, vis_frames, vis_planes, script; inputs way_frames: list, tcp_measured: Point3d, acceleration: Double, velocity: Double
# ---------- compas_2: Python ----------
from imp import reload
import sys
import os

#get current file path
path = ghenv.Component.OnPingDocument().FilePath
#get parent directory of the parent directory
parentdir = os.path.dirname(path)
#get src folder which contains classes
dire = os.path.join(parentdir,'src')

sys.path.append(dire)

import simple_ur_script as ur
reload(ur)

import utils 
reload(utils)

import simple_comm as com
reload(com)

import compas.geometry as cg
import math as m

# ===== Set global constants =======

IO = 4 #Global constant
SAFE_DIST = 50

# =================================

script = "" #create empty string

def pickup_brick(script,pick_up_frame, brick_frame):
    frames = []
    safe_pick_up_frame = pick_up_frame.translated(-pick_up_frame.normal*SAFE_DIST)

    # # add to th path: first vertical_safe_plane
    z = brick_frame.point.z + SAFE_DIST
    pt = safe_pick_up_frame.point
    xaxis = cg.Vector(safe_pick_up_frame.xaxis.x, safe_pick_up_frame.xaxis.y, 0)
    yaxis = cg.Vector(safe_pick_up_frame.yaxis.x, safe_pick_up_frame.yaxis.y, 0)
    vertical_safe_plane = cg.Frame(pt, xaxis, yaxis)
    vertical_safe_plane = vertical_safe_plane.translated([0, 0, z])

    script += ur.move_l(vertical_safe_plane, acceleration, velocity)
    frames.append(vertical_safe_plane)
    
    ## add to the path: go to the safe plane
    script += ur.move_l(safe_pick_up_frame, acceleration, velocity)
    frames.append(safe_pick_up_frame)
    
    ## add to the path: go to the pick up plane
    script += ur.move_l(pick_up_frame, acceleration, velocity)
    frames.append(pick_up_frame)
    
    ## add to the path: turn on the vacuum and wait .5 sec.
    script += ur.set_digital_out(IO,True)
    script += ur.sleep(.5)

    # add to the path: go back to the safe_plane
    script += ur.move_l(safe_pick_up_frame, acceleration, velocity)
    frames.append(safe_pick_up_frame)
    
    # add to th path: go up to vertical_safe_plane
    script += ur.move_l(vertical_safe_plane, acceleration, velocity)
    frames.append(vertical_safe_plane)
    
    return script, frames


def place_brick(script, place_frame):
    
    frames = []
    
    safe_place_frame = place_frame.translated(cg.Vector(0,0,1)*SAFE_DIST)
    
    # add to the path: go to the safe plane
    script += ur.move_l(safe_place_frame, acceleration, velocity)
    frames.append(safe_place_frame)
    
    # add to the path: go to the place plane
    script += ur.move_l(place_frame, acceleration, velocity)
    frames.append(place_frame)
    
    ## add to the path: turn off the vacuum and wait .5 second (hold the brick)
    script += ur.set_digital_out(IO,False)
    script += ur.sleep(.5)
    
    # add to the path: go back to the safe plane
    script += ur.move_l(safe_place_frame, acceleration, velocity)
    frames.append(safe_place_frame)
    
    return script,frames


#if value given for tcp measured, then add line to script, otherwise it will take current tcp from robot
if tcp_measured is not None:
    script += ur.set_tcp_by_angles(tcp_measured.X, tcp_measured.Y, tcp_measured.Z, m.radians(0.0),m.radians(0.0),m.radians(0))


vis_frames = []
#add move_l commands in sequence to script for each way plane
for brick_frame in way_frames:
    script, p = pickup_brick(script, pick_frame, brick_frame)
    vis_frames.extend(p) #only to visualize the planes
    script, p = place_brick(script,brick_frame)
    vis_frames.extend(p)


#format the script to make it sendable
script = com.concatenate_script(script)

from compas_rhino import conversions
import Rhino.Geometry as rg

vis_planes = [conversions.frame_to_rhino(frame) for frame in vis_frames]
# ---------- end compas_2 ----------

# ----
list_2 = RobotsLibrary(
    {"AA-KR60", "AA-KR30", "AA-KR60_KR30", "Franka Emika Panda", "Bartlett-IRB120", "Bartlett-IRB1600", "Bartlett-KR6", "Bartlett-KR60-A", "Bartlett-KR60-B", "Bartlett-KR500"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}, selected="UR5",
    Type=0)
py3_7 = Python3Script(x=compas_2.vis_frames)  # -> out, a; inputs x: list; same code as py3_3
loadrobot = LoadRobotSystem(Name=list_2, Base=PlaneXY(0, 0, 0))
tool = CreateTool(Name="DefaultGHTool", TCP=pt_12, Weight=0)  # -> Tool, TCP
target = CreateTarget(Plane=py3_7.a, Tool=tool.Tool, IsCartesian=True)
program = CreateProgram(Name="DefaultProgram", RobotSystem=loadrobot, Targets=target, StepSize=1)  # -> Program, Code, Duration, Warnings, Errors
sim = ProgramSimulation(Program=program.Program, Time=Slider(0.296648, range=0..1), Normalized=True)  # -> SystemMeshes, JointRotations, Plane, Index, Time, Program, Errors

pline = PolyLine(Vertices=compas_2.vis_planes, Closed=False)
points_3 = PointList(Points=compas_2.vis_planes, Size=Slider(7, range=0..100))

# ---- group: Send UR script to Robot!
# Send to Robot!
py3_8 = Python3Script(script=compas_2.script, ip_address="192.168.10.10", send=Button())  # -> out, a; inputs script: String, ip_address: String, send: Boolean
# ---------- py3_8: Python ----------
import simple_comm as com

if send:
    com.send_script(script,ip_address)
# ---------- end py3_8 ----------

# ==== cluster Cluster
pln = ClusterInput()
num = ClusterInput()
pln_2 = Plane(graft(pln))
num_2 = Number(num)
deplane = DeconstructPlane(Plane=pln_2)  # -> flatten(Origin), XAxis, YAxis, ZAxis
entwine = Entwine(Branch00=deplane.XAxis, Branch01=deplane.YAxis, Branch02=deplane.ZAxis, FlattenInputs=True)
merge = Merge(
    Data1=ColourSwatch(SwatchColor=RGB(255, 0, 0)),
    Data2=ColourSwatch(SwatchColor=RGB(0, 255, 0)),
    Data3=ColourSwatch(SwatchColor=RGB(0, 0, 255)))  # -> graft(Result)
multiplication = Multiplication(A=entwine, B=num_2)
vdisex = VectorDisplayEx(Point=deplane.Origin, Vector=multiplication, Colour=merge, Width=2)
