# Grasshopper definition JW_Brick_231025.gh (Grasshopper 1.0.8)
# plug-ins: Robots

number_slider = Slider(2, range=0..10)
number_slider_2 = Slider(5, range=0..10)
py3 = Python3Script(
    segments=Slider(3, range=0..10),
    half_loops=number_slider,
    half_loop_counts=Slider(11, range=0..20),
    tolorence_single=Slider(30, range=0..100),
    tolorence_xy=Slider(47, range=0..100),
    val_inward=Slider(0, range=0..10),
    rrr=Slider(90, range=0..90),
    pre_angle=Slider(0, range=0..90),
    xval=Slider(9, range=0..90),
    yval=Slider(4.5, range=0..10),
    vecv=Slider(12, range=0..90))  # -> out, bricks_out, cc, frames_tree, final_bricks, all_new_frames, final_frames; inputs segments: Int32, half_loops: Int32, half_loop_counts: Int32, tolorence_xy: Double
# ---------- py3: Python ----------
from compas_rhino.devtools import DevTools
DevTools.ensure_path()

import compas.geometry as cg
import ghpythonlib.treehelpers as th
import math

from brick_wall import BigBrick


#--------#-------#
x, y, z = BigBrick.LENGTH, BigBrick.WIDTH, BigBrick.HEIGHT

# Base Boxs
corner1 = cg.Point(0, 0, 0)
corner2 = cg.Point(x, -y, 0)
corner3 = cg.Point(x, y, 0)
box1 = cg.Box.from_corner_corner_height(corner1, corner2, z)
box1.translate([0,-tolorence_single,0])
box1.rotate(math.radians(-pre_angle), [0,0,1], box1.points[0])

box2 = cg.Box.from_corner_corner_height(corner1, corner3, z)
box2.translate([0,tolorence_single,0])
box2.rotate(math.radians(pre_angle), [0,0,1], box2.points[0])
two_boxs = [box1, box2]

# Find Polygon Radius
r_translate_value = BigBrick.WIDTH / (math.tan(math.pi/segments)) + tolorence_xy

bricks = []
for i in range(half_loop_counts):
    bricks_branch = []
    for j in range(segments):
        # Create Ground Box Values
        radian_xy = ((2*math.pi) / segments) * j
        radian_z = math.radians((-(180/segments-pre_angle) / (half_loop_counts-1)) * i)
        vector = cg.Vector(-1,0,0).rotated(radian_xy)*val_inward
        two_centroids = []
        # Transform Boxs
        new_two_boxs = []
        for count, b in enumerate(two_boxs):
            if count == 0:
                radian_z = radian_z
                Yval = yval
            elif count == 1:
                radian_z = -radian_z
                Yval = -yval
            newb = b.translated([r_translate_value, 0, z*i])
            # Self Rotate
            newb.rotate(radian_z, [0,0,1], newb.points[0])  #First Corner of the Box
            #
            newb.translate([xval*i, Yval*i, 0])
            # Polar Array Boxs
            newb.rotate(radian_xy)
            # Translate Inward
            newb.translate(vector*i)
            new_two_boxs.append(newb)
            
            # Find Top Bricks Centroids
            # if i == (half_loop_counts-1):
            #     two_centroids.append(newb.frame.point)
            # else:
            #     continue

        bricks_branch.append(new_two_boxs)    
        # centroids_branch.append(two_centroids)
    bricks.append(bricks_branch)

# print (len(bricks))
# print (bricks)
"""for i, branch in enumerate(bricks):
    print (len(branch))
    if i == (len(bricks)-1):
        avgs = get_avg_pts(centroids_branch)
        print (avgs)

        all_boxes = [b for two_b in branch for b in two_b]
        for avg, b in zip(avgs, all_boxes):
            b.rotate(math.pi/2, [0, 0, 1], avg)
    else:
        continue

pty = avgs"""

# print (len(bricks_branch[-1]))
# print (len(centroids_branch))

def process_brick(objs):
    frame1 = cg.Frame([0, 0, step/2*(i+1)])
    frame2 = frame1.flipped()
    # Mirror Transformation
    M = cg.Transformation.from_frame_to_frame(frame1, frame2)
    new_objs = []
    for count, branch in enumerate(objs):
        new_objs_branch = []
        for two_objs in branch:
            new_two_objs = []
            two_centroids = []

            for obj in two_objs:
                new_obj = obj.translated([0,0,step*i])
                new_obj.translate([xval*i, 0, 0])
                # Mirror Odd levels
                if i % 2 != 0:
                    new_obj = obj.transformed(M)
                    
                    # Rotate Itself
                    if hasattr(new_obj, "frame"):
                        axis = new_obj.frame.xaxis
                        point = new_obj.frame.point
                        new_obj = new_obj.rotated(math.pi, axis, point)
                    if isinstance(new_obj, cg.Frame):
                        axis = new_obj.xaxis
                        point = new_obj.point.translated([0,0,-z/2])
                        new_obj = new_obj.rotated(math.pi, axis, point)
                else:
                    pass

                new_two_objs.append(new_obj)
            new_objs_branch.append(new_two_objs)
        new_objs.append(new_objs_branch)
    return new_objs


# Mirror Brick
step = z*half_loop_counts
all_new_bricks = []
all_new_frames = []
for i in range(half_loops):
    # Stack Bricks
    new_bricks = process_brick(bricks)
    all_new_bricks.append(new_bricks)

    # Nested List Comprehension
    # Find Frame for Each Brick
    frames = [
        [
            [BigBrick.get_pick_frame(brick) for brick in two_bricks]
            for two_bricks in branch
        ]
        for branch in bricks
    ]
    new_frames = process_brick(frames)
    all_new_frames.append(new_frames)
    
print ("all,", len(all_new_bricks))


def reverse_order(objects):
    final_objs = []
    for i, branch in enumerate(objects):
        print ("branch,", len(branch)) if i == 0 else None
        if i % 2 != 0:
            # Record Tree Structure
            lens1 = len(branch)
            print (lens1)
            lens2 = len(branch[0])
            print (lens2)
            lens3 = len(branch[0][0])
            print (lens3)

            # Flatten Tree
            branch = [b for flat in branch for two in flat for b in two]
            # Reverse Order
            branch.reverse()
            # Unflatten Tree
            flat = [branch[i:i+lens3] for i in range(0, len(branch), lens3)]
            branch = [flat[i:i+lens2] for i in range(0, len(flat), lens2)]
        else:
            pass
        final_objs.append(branch)
    return final_objs



def rotate_tops(final_objs):
    for i, branch in enumerate(final_objs):
        flat = branch[-1]
        # print ("a,", len(flat)) if i == 0 else None
        objs = [b for two in flat for b in two]
        # pts = [obj.frame.point for obj in objs]
        pts = []
        for obj in objs:
            if hasattr(obj, "frame"):
                pt = obj.frame.point
                pts.append(pt)
                
            elif isinstance(obj, cg.Frame):
                pt = obj.point
                pts.append(pt)
                # print (len(pts))

        # average points
        avgs = []
        if i % 2 == 0:
            shifted = pts[-1:] + pts[:-1]
            for j in range(0, len(shifted), 2):
                two_pts = [shifted[j], shifted[j+1]]
                vec = cg.Vector.from_start_end(two_pts[0], two_pts[1])
                vec.unitize()
                vec.rotate(-math.pi/4)

                avg = cg.Point(*cg.centroid_points(two_pts))

                avg.translate(vec*vecv)

                avgs.append(avg)
                avgs.append(avg)
            shifted_avgs = avgs[1:] + avgs[:1]
        elif i % 2 == 1:
            shifted = pts
            for j in range(0, len(shifted), 2):
                two_pts = [shifted[j], shifted[j+1]]
                vec = cg.Vector.from_start_end(two_pts[0], two_pts[1])
                vec.unitize()
                vec.rotate(-math.pi/4)

                avg = cg.Point(*cg.centroid_points(two_pts))
                # avg.translate(vec*vecv)
                avgs.append(avg)
                avgs.append(avg)   
            shifted_avgs = avgs

        # print (len(avgs))

        bs = [b for two in flat for b in two]
        
        if hasattr(obj, "frame"):
            dist1 = cg.distance_point_point(bs[0].frame.point, bs[1].frame.point)
            dist2 = cg.distance_point_point(bs[1].frame.point, bs[2].frame.point)
            dist = min(dist1, dist2)
            dist -= y
            print (dist)
            if dist < 70:
                for b in bs[::2]:
                    vec = b.frame.yaxis
                    vec.unitize
                    b.translate(vec*(dist-70)/2)
        elif isinstance(obj, cg.Frame):
            dist1 = cg.distance_point_point(bs[0].point, bs[1].point)
            dist2 = cg.distance_point_point(bs[1].point, bs[2].point)
            dist = min(dist1, dist2)
            dist -= y
            if dist < 70:
                for b in bs[::2]:
                    vec = b.yaxis
                    vec.unitize
                    b.translate(vec*(dist-70)/2)


        for index, avg in enumerate(shifted_avgs):
            bs[index].rotate(math.radians(rrr), [0, 0, 1], avg)
            # print (b[index]) if index == 0 else None
        
    return final_objs
#--------------------------------------------#----------------------------#
def align_frames(frames):
    for branch in frames:
        for flat in branch:
            for two in flat:
                two[1].rotate(math.pi, [0,0,1], two[1].point)
    return frames

#------#------#_------#_------#
final_bricks = reverse_order(all_new_bricks)
final_frames = reverse_order(all_new_frames)

final_bricks = rotate_tops(final_bricks)
final_frames = rotate_tops(final_frames)
# final_frames = align_frames(final_frames)

# Output
# a = th.list_to_tree(two_boxs_column)
bricks_out = th.list_to_tree(bricks)

final_bricks = th.list_to_tree(final_bricks)
final_frames = th.list_to_tree(final_frames)
all_new_frames = th.list_to_tree(all_new_frames)
# ---------- end py3 ----------
compas_draw = COMPASDraw(cg=py3.bricks_out)  # -> rg
#   port cg: The COMPAS geometry or datastructure to be drawn.
#   port rg: The Rhino geometry object.
# ---------- compas_draw: Python ----------
# r: compas>=2.14.1
"""
Draws COMPAS geometry in Grasshopper.
"""

from typing import Any

import Grasshopper

from compas.scene import SceneObject


class CompasToRhinoGeometry(Grasshopper.Kernel.GH_ScriptInstance):
    def RunScript(self, cg):
        if not cg:
            return None

        return SceneObject(item=cg).draw()
# ---------- end compas_draw ----------

geo = Geometry(flatten(compas_draw))  # disabled
bbox = BoundingBox(Content=geo, Plane=PlaneXY(0, 0, 0), UnionBox=True)  # -> Box, Box_2; disabled
debox = DeconstructBox(Box=bbox.Box)  # -> Plane, X, Y, Z; disabled
dedomain = DeconstructDomain(Domain=debox.Z)  # -> Start, End; disabled
subtraction = Subtraction(A=dedomain.End, B=dedomain.Start)  # disabled
series = Series(Start=0, Step=subtraction, Count=number_slider)  # disabled
Z = UnitZ(Factor=series)  # -> graft(UnitVector); disabled
move = Move(Geometry=geo, Motion=Z)  # -> Geometry, Transform; disabled
tstat = TreeStatistics(Tree=move.Geometry)  # -> Paths, Length, Count; disabled
dispatch = Dispatch(List=tstat.Paths, DispatchPattern=[True, False])  # -> ListA, ListB; disabled
split = SplitTree(Data=move.Geometry, Masks=flatten(dispatch.ListA))  # -> Positive, Negative; disabled
bbox_2 = BoundingBox(Content=split.Negative, Plane=PlaneXY(0, 0, 0), UnionBox=True)  # -> Box, Box_2; disabled
area = Area(Geometry=bbox_2.Box)  # disabled
xy = XYPlane(Origin=area)  # disabled
mirror = Mirror(Geometry=split.Negative, Plane=xy)  # -> Geometry, Transform; disabled
merge = Merge(Data1=split.Positive, Data2=mirror.Geometry)  # disabled

compas_draw_2 = COMPASDraw(cg=py3.final_bricks)  # -> rg; same code as compas_draw
panel = Panel(compas_draw_2)
compas_draw_3 = COMPASDraw(cg=py3.cc)  # -> rg; same code as compas_draw
py3_2 = Python3Script(x=py3.final_frames)  # -> out, rg_plns; inputs x: list
# ---------- py3_2: Python ----------
from compas_rhino.conversions import frame_to_rhino_plane

rg_plns = [frame_to_rhino_plane(f) for f in x]
# ---------- end py3_2 ----------
pt = Point(Point(600, 400, 0))
orient = Orient(Geometry=compas_draw_2, Source=PlaneXY(0, 0, 0), Target=pt)  # -> Geometry, Transform
deconstruct_brep = DeconstructBrep(Brep=orient.Geometry)  # -> Faces, Edges, Vertices
data = Data(py3_2.rg_plns)
number_slider_3 = Slider(0, range=0..10)
list_item = ListItem(List=deconstruct_brep.Faces, Index=Slider(4, range=0..5), Wrap=True)
swatch = ColourSwatch(SwatchColor=RGB(255, 209, 156))  # disabled
trim = TrimTree(Tree=data, Depth=1)
trim_2 = TrimTree(Tree=orient.Geometry, Depth=1)
preview = CustomPreview(Geometry=orient.Geometry, Material=ColourSwatch(SwatchColor=RGB(255, 209, 156)))
preview_2 = CustomPreview(Geometry=merge, Material=swatch)  # disabled
multiplication = Multiplication(A=number_slider_3, B="52")
tstat_2 = TreeStatistics(Tree=trim)  # -> Paths, Length, Count
series_2 = Series(Start=0, Step=1, Count=number_slider_3)
Z_2 = UnitZ(Factor=multiplication)
cull_i = CullIndex(List=tstat_2.Paths, Indices=series_2, Wrap=True)
rev = Reverse(Vector=Z_2)
branch = TreeBranch(Tree=trim, Path=cull_i, MaintainPaths=True)
branch_2 = TreeBranch(Tree=trim_2, Path=cull_i, MaintainPaths=True)
move_2 = Move(Geometry=branch, Motion=rev)  # -> Geometry, Transform
move_3 = Move(Geometry=branch_2, Motion=rev)  # -> Geometry, Transform
preview_3 = CustomPreview(Geometry=move_3.Geometry, Material=ColourSwatch(SwatchColor=RGB(255, 209, 156)))
data_2 = Data(move_2.Geometry)
data_3 = Data()  # disabled
number_slider_4 = Slider(12, range=0..30)  # disabled
number_slider_5 = Slider(100, range=0..100)  # disabled
orient_2 = Orient(Geometry=data_3, Source=PlaneXY(0, 0, 0), Target=pt)  # -> Geometry, Transform; disabled

# ---- group: *Visualize Pln XYZ
cluster = Cluster(pln=orient_2.Geometry, num=30)  # disabled

# ----
# Generate Geometry
curve = Curve(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)  # disabled
order = PointOrder(Points=orient_2.Geometry)  # disabled
brick_wall = Python3Script(crv=curve, num_layers=number_slider_4, gap=number_slider_5)  # -> bricks, geometries, way_planes; inputs crv: Curve, num_layers: Int32, gap: Double; disabled
# ---------- brick_wall: Python ----------
# r: compas
# venv: mas-2526
from compas_rhino.devtools import DevTools
DevTools.ensure_path()

# 0. Import everything we will need
import math
from compas.geometry import Box
from compas.geometry import Point
from compas.geometry import Frame
from compas.geometry import cross_vectors
from compas.geometry import Vector
from compas_rhino.conversions import curve_to_compas

# ..also import our module "brick_wall.py", that needs to be in the same folder as our GH file
from brick_wall import BigBrick

# 1. Start with an empty list of bricks to be created
#    make sure to match the name of this list to the output of this component!
bricks = []

# 2. Create points on each curve
curve = curve_to_compas(crv)
print(curve.length())

# divide curve twice as fine
num_divs = int(curve.length() / (BigBrick.LENGTH+gap)) * 2
params, div_pts = curve.divide_by_count(num_divs, True)

for row in range(num_layers):
    for col, param in enumerate(params,):
        pt = curve.point_at(param)
        pt = pt.translated([0,0,BigBrick.HEIGHT * row])
        tangent = curve.tangent_at(param)
        normal = cross_vectors(tangent, [0,0,1])
        # only place bricks on alternating divisions depending on the row
        if row % 2 == 0:  
            # even rows 
            if col % 2 == 0:
                b = BigBrick(frame = Frame(pt, tangent, normal))
                bricks.append(b)
        else:  
            # odd rows 
            if col % 2 == 1:
                b = BigBrick(frame = Frame(pt, tangent, normal))
                bricks.append(b)

# Move all above Z = 0
for brick in bricks:
    brick.frame = brick.frame.translated(Vector(0,0,BigBrick.HEIGHT/2))

# Visualize and store brick data
geometries = []
way_planes = []

for brick in bricks:
    geometries.append(brick.draw())
    way_planes.append(brick.get_pick_frame())
# ---------- end brick_wall ----------
panel_2 = Panel(brick_wall.way_planes)  # disabled
py3_3 = Python3Script(plns=orient_2.Geometry)  # -> out, frames; inputs plns: list of Plane; disabled
# ---------- py3_3: Python ----------
import compas_rhino.conversions as crc
frames = [crc.plane_to_compas_frame(pln) for pln in plns]
print (type(plns[0]))
# ---------- end py3_3 ----------

list = RobotsLibrary(
    {"AA-KR60", "AA-KR30", "AA-KR60_KR30", "Franka Emika Panda", "Bartlett-IRB120", "Bartlett-IRB1600", "Bartlett-KR6", "Bartlett-KR60-A", "Bartlett-KR60-B", "Bartlett-KR500"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}, selected="Bartlett-KR60-B",
    Type=0)
py3_4 = Python3Script()  # -> out, a; inputs x: list
# ---------- py3_4: Python ----------
from compas_rhino.conversions import frame_to_rhino_plane

a = [frame_to_rhino_plane(f) for f in x]
# ---------- end py3_4 ----------
loadrobot = LoadRobotSystem(Name=list, Base=PlaneXY(0, 0, 0))
tool = CreateTool(Name="DefaultGHTool", TCP=PlaneXY(0, 0, 0), Weight=0)  # -> Tool, TCP
target = CreateTarget(Plane=py3_4.a, Tool=tool.Tool, IsCartesian=True)
program = CreateProgram(Name="DefaultProgram", RobotSystem=loadrobot, Targets=target, StepSize=1)  # -> Program, Code, Duration, Warnings, Errors
sim = ProgramSimulation(Program=program.Program, Time=Slider(0, range=0..1), Normalized=True)  # -> SystemMeshes, JointRotations, Plane, Index, Time, Program, Errors

button = Button()  # disabled
panel_3 = Panel("w_pallet2")  # disabled

compas_draw_4 = COMPASDraw(cg=brick_wall.geometries)  # -> rg; disabled; same code as compas_draw
compas_draw_5 = COMPASDraw(cg=brick_wall.way_planes)  # -> rg; disabled; same code as compas_draw
drawframe = Python3Script(x=brick_wall.way_planes)  # -> a; inputs x: list; disabled; same code as py3_4
python_3_script = Python3Script(frames=py3_3.frames, pallet_number=panel_3, save=button)  # inputs frames: list, pallet_number: String; disabled
# ---------- python_3_script: Python ----------
from compas.data import json_dump
import sys
import os

data = {}

data["wobj"] = pallet_number
data["frames"] = frames

#get current file path
path = ghenv.Component.OnPingDocument().FilePath
#get parent directory of the parent directory
parentdir = os.path.dirname(path)
#get src folder which contains classes
dire = os.path.join(parentdir,'data')


filepath = os.path.join(dire, "out_brickframes_JW.json")

if save:
    json_dump(data, filepath)
# ---------- end python_3_script ----------

# ==== cluster Cluster
pln = ClusterInput()
num = ClusterInput()
pln_2 = Plane(graft(pln))
num_2 = Number(num)
deplane = DeconstructPlane(Plane=pln_2)  # -> flatten(Origin), XAxis, YAxis, ZAxis
entwine = Entwine(Branch00=deplane.XAxis, Branch01=deplane.YAxis, Branch02=deplane.ZAxis, FlattenInputs=True)
merge = Merge(
    Data1=ColourSwatch(SwatchColor=RGB(255, 0, 0)),
    Data2=ColourSwatch(SwatchColor=RGB(0, 255, 0)),
    Data3=ColourSwatch(SwatchColor=RGB(0, 0, 255)))  # -> graft(Result)
multiplication = Multiplication(A=entwine, B=num_2)
vdisex = VectorDisplayEx(Point=deplane.Origin, Vector=multiplication, Colour=merge, Width=2)
