# Grasshopper definition JW_Small_Brick_231025.gh (Grasshopper 1.0.8)
# plug-ins: Robots

number_slider = Slider(5, range=0..10)
py3 = Python3Script(
    segments=Slider(5, range=0..10),
    half_loops=Slider(8, range=0..10),
    half_loop_counts=Slider(7, range=0..20),
    tolerance_single=Slider(2.4, range=0..10),
    tolorence_xy=Slider(9, range=0..100),
    val_inward=Slider(0, range=0..10),
    rrr=Slider(90, range=0..90),
    pre_angle=Slider(0, range=0..90),
    xval=Slider(0.47, range=0..1),
    yval=Slider(0.4, range=0..1),
    vecv=Slider(0.34, range=0..1))  # -> out, bricks_out, cc, frames_tree, final_bricks, all_new_frames, final_frames; inputs segments: Int32, half_loops: Int32, half_loop_counts: Int32, tolorence_xy: Double
# ---------- py3: Python ----------
from compas_rhino.devtools import DevTools
DevTools.ensure_path()

import compas.geometry as cg
import ghpythonlib.treehelpers as th
import math

from brick_wall import Brick


#--------#-------#
x, y, z = Brick.LENGTH, Brick.WIDTH, Brick.HEIGHT

# Base Boxes
corner1 = cg.Point(0, 0, 0)
corner2 = cg.Point(x, -y, 0)
corner3 = cg.Point(x, y, 0)
box1 = cg.Box.from_corner_corner_height(corner1, corner2, z)
box1.translate([0,-tolerance_single,0])
box1.rotate(math.radians(-pre_angle), [0,0,1], box1.points[0])

box2 = cg.Box.from_corner_corner_height(corner1, corner3, z)
box2.translate([0,tolerance_single,0])
box2.rotate(math.radians(pre_angle), [0,0,1], box2.points[0])
two_boxes = [box1, box2]

# Find Polygon Radius
r_translate_value = Brick.WIDTH / (math.tan(math.pi/segments)) + tolorence_xy

bricks = []
for i in range(half_loop_counts):
    bricks_branch = []
    for j in range(segments):
        # Create Ground Box Values
        radian_xy = ((2*math.pi) / segments) * j
        radian_z = math.radians((-(180/segments-pre_angle) / (half_loop_counts-1)) * i)
        vector = cg.Vector(-1,0,0).rotated(radian_xy)*val_inward
        two_centroids = []
        # Transform Boxs
        new_two_boxes = []
        for count, b in enumerate(two_boxes):
            if count == 0:
                radian_z = radian_z
                Yval = yval
            elif count == 1:
                radian_z = -radian_z
                Yval = -yval
            newb = b.translated([r_translate_value, 0, z*i])
            # Self Rotate
            newb.rotate(radian_z, [0,0,1], newb.points[0])  #First Corner of the Box
            #
            newb.translate([xval*i, Yval*i, 0])
            # Polar Array Boxs
            newb.rotate(radian_xy)
            # Translate Inward
            newb.translate(vector*i)
            new_two_boxes.append(newb)
            
            # Find Top Bricks Centroids
            # if i == (half_loop_counts-1):
            #     two_centroids.append(newb.frame.point)
            # else:
            #     continue

        bricks_branch.append(new_two_boxes)    
        # centroids_branch.append(two_centroids)
    bricks.append(bricks_branch)

# print (len(bricks))
# print (bricks)

def process_brick(objs):
    step = z*half_loop_counts
    new_objs = []
    for count, branch in enumerate(objs):
        new_objs_branch = []
        for two_objs in branch:
            new_two_objs = []

            for obj in two_objs:
                new_obj = obj.translated([0,0,step*i])
                new_obj.translate([xval*i, 0, 0])
                # Rotata Odd levels
                if i % 2 != 0:
                    new_obj.rotate(math.pi/segments)
                else:
                    pass

                new_two_objs.append(new_obj)
            new_objs_branch.append(new_two_objs)
        new_objs.append(new_objs_branch)
    return new_objs


all_new_bricks = []
all_new_frames = []
for i in range(half_loops):
    # Stack Bricks
    new_bricks = process_brick(bricks)
    all_new_bricks.append(new_bricks)

    # Nested List Comprehension
    # Find Frame for Each Brick
    frames = [
        [
            [Brick.get_pick_frame(brick) for brick in two_bricks]
            for two_bricks in branch
        ]
        for branch in bricks
    ]
    new_frames = process_brick(frames)
    all_new_frames.append(new_frames)
    
print ("all,", len(all_new_bricks))


def rotate_tops(final_objs):
    for i, branch in enumerate(final_objs):
        flat = branch[-1]
        # print ("a,", len(flat)) if i == 0 else None
        objs = [b for two in flat for b in two]
        # pts = [obj.frame.point for obj in objs]
        pts = []
        for obj in objs:
            if hasattr(obj, "frame"):
                pt = obj.frame.point
                pts.append(pt)
                
            elif isinstance(obj, cg.Frame):
                pt = obj.point
                pts.append(pt)
                # print (len(pts))

        # average points
        avgs = []
        shifted = pts[-1:] + pts[:-1]
        for j in range(0, len(shifted), 2):
            two_pts = [shifted[j], shifted[j+1]]
            vec = cg.Vector.from_start_end(two_pts[0], two_pts[1])
            vec.unitize()
            vec.rotate(-math.pi/4)

            avg = cg.Point(*cg.centroid_points(two_pts))

            avg.translate(vec*vecv)

            avgs.append(avg)
            avgs.append(avg)
        shifted_avgs = avgs[1:] + avgs[:1]


        # print (len(avgs))

        bs = [b for two in flat for b in two]
        
        if hasattr(obj, "frame"):
            dist1 = cg.distance_point_point(bs[0].frame.point, bs[1].frame.point)
            dist2 = cg.distance_point_point(bs[1].frame.point, bs[2].frame.point)
            dist = min(dist1, dist2)
            dist -= y
            print (dist)
            if dist > tolerance_single:
                for b in bs[::2]:
                    vec = b.frame.yaxis
                    vec.unitize
                    b.translate(vec*(dist-tolerance_single)/2)
        elif isinstance(obj, cg.Frame):
            dist1 = cg.distance_point_point(bs[0].point, bs[1].point)
            dist2 = cg.distance_point_point(bs[1].point, bs[2].point)
            dist = min(dist1, dist2)
            dist -= y
            if dist > tolerance_single:
                for b in bs[::2]:
                    vec = b.yaxis
                    vec.unitize
                    b.translate(vec*(dist-tolerance_single)/2)
        

        for index, avg in enumerate(shifted_avgs):
            bs[index].rotate(math.radians(rrr), [0, 0, 1], avg)
            # print (b[index]) if index == 0 else None
        
    return final_objs
#--------------------------------------------#----------------------------#
def align_frames(frames):
    for branch in frames:
        for flat in branch:
            for two in flat:
                two[1].rotate(math.pi, [0,0,1], two[1].point)
    return frames

#------#------#_------#_------#
final_bricks = all_new_bricks
final_frames = all_new_frames

final_bricks = rotate_tops(final_bricks)
final_frames = rotate_tops(final_frames)
# final_frames = align_frames(final_frames)

# Output
# a = th.list_to_tree(two_boxes_column)
bricks_out = th.list_to_tree(bricks)

final_bricks = th.list_to_tree(final_bricks)
final_frames = th.list_to_tree(final_frames)
all_new_frames = th.list_to_tree(all_new_frames)
# ---------- end py3 ----------
py3_2 = Python3Script(x=py3.final_frames)  # -> out, rg_plns; inputs x: list
# ---------- py3_2: Python ----------
from compas_rhino.conversions import frame_to_rhino_plane

rg_plns = [frame_to_rhino_plane(f) for f in x]
# ---------- end py3_2 ----------
compas_draw = COMPASDraw(cg=py3.bricks_out)  # -> rg
#   port cg: The COMPAS geometry or datastructure to be drawn.
#   port rg: The Rhino geometry object.
# ---------- compas_draw: Python ----------
# r: compas>=2.14.1
"""
Draws COMPAS geometry in Grasshopper.
"""

from typing import Any

import Grasshopper

from compas.scene import SceneObject


class CompasToRhinoGeometry(Grasshopper.Kernel.GH_ScriptInstance):
    def RunScript(self, cg):
        if not cg:
            return None

        return SceneObject(item=cg).draw()
# ---------- end compas_draw ----------
compas_draw_2 = COMPASDraw(cg=py3.final_bricks)  # -> rg; same code as compas_draw
compas_draw_3 = COMPASDraw(cg=py3.cc)  # -> rg; same code as compas_draw
pi = Pi(Factor=1)
dispatch = Dispatch(List=py3_2.rg_plns, DispatchPattern=[True, False])  # -> ListA, ListB
prot = RotatePlane(Plane=dispatch.ListA, Angle=pi)
weave = Weave(Pattern=[0, 1], Stream0=prot, Stream1=dispatch.ListB, NullGaps=False)
preview = CustomPreview(Geometry=compas_draw_2, Material=ColourSwatch(SwatchColor=RGB(255, 209, 156)))

# ---- group: *Visualize Pln XYZ
cluster = Cluster(pln=weave, num=Slider(8.2, range=0..10))

# ----
trim = TrimTree(Tree=simplify(weave), Depth="2")
tstat = TreeStatistics(Tree=trim)  # -> Paths, Length, Count
series = Series(Start=0, Step=1, Count=Slider(7, range=0..10))
pt = Point(Point(124.4704743, 151.1304265, 0))
item = ListItem(List=tstat.Paths, Index=series, Wrap=True)
split = SplitTree(Data=trim, Masks=flatten(item))  # -> Positive, Negative
orient = Orient(Geometry=split.Negative, Source=PlaneXY(0, 0, 0), Target=pt)  # -> Geometry, Transform
orient_2 = Orient(Geometry=compas_draw_2, Source=PlaneXY(0, 0, 0), Target=pt)  # -> Geometry, Transform
data = Data(orient.Geometry)

number_slider_2 = Slider(0, range=0..10)
trim_2 = TrimTree(Tree=data, Depth=1)
trim_3 = TrimTree(Tree=orient_2.Geometry, Depth=1)
multiplication = Multiplication(A=number_slider_2, B="52")
tstat_2 = TreeStatistics(Tree=trim_2)  # -> Paths, Length, Count
series_2 = Series(Start=0, Step=1, Count=number_slider_2)
Z = UnitZ(Factor=multiplication)
cull_i = CullIndex(List=tstat_2.Paths, Indices=series_2, Wrap=True)
branch = TreeBranch(Tree=trim_3, Path=cull_i, MaintainPaths=True)
rev = Reverse(Vector=Z)
branch_2 = TreeBranch(Tree=trim_2, Path=cull_i, MaintainPaths=True)
move = Move(Geometry=branch, Motion=rev)  # -> Geometry, Transform
move_2 = Move(Geometry=branch_2, Motion=rev)  # -> Geometry, Transform
preview_2 = CustomPreview(Geometry=move.Geometry, Material=ColourSwatch(SwatchColor=RGB(255, 209, 156)))

preview_3 = CustomPreview(Geometry=orient_2.Geometry, Material=ColourSwatch(SwatchColor=RGB(255, 209, 156)))
data_2 = Data(data)
data_3 = Data(flatten(data_2))
series_3 = Series(Start=0, Step=1, Count=Slider(5, range=0..10))
cull_i_2 = CullIndex(List=data_3, Indices=series_3, Wrap=True)
fine_adjust_z_mm = Slider(0, range=-5..10)
# Transform from Rhino to Robot Space
py3_3 = Python3Script(plns=data_3)  # -> out, frames; inputs plns: list of Plane
# ---------- py3_3: Python ----------
import compas_rhino.conversions as crc
frames = [crc.plane_to_compas_frame(pln) for pln in plns]
print (type(plns[0]))
# ---------- end py3_3 ----------
pt_2 = Point("{462.02, 465.69, 4.06}")
pt_3 = Point("{109.25, 464.14, 5.11}")
pt_4 = Point("{462.19, -132.33, 5.03}")
compas = Python3Script(way_planes=py3_3.frames, wobj_origin=pt_2, wobj_xaxis=pt_3, wobj_xypoint=pt_4, z_safe_margin=fine_adjust_z_mm)  # -> out, transformed_planes; inputs way_planes: list, wobj_origin: Point3d, wobj_xaxis: Point3d, wobj_xypoint: Point3d, z_safe_margin: Double
# ---------- compas: Python ----------
import compas.geometry as cg

#in this step we transform our way planes to robot space
#the rhino co-ordinate system is rather abstract in the physical world
#the robot base plane assumed the base frame of robot is the origin
#but rhino does not know that
#thus we transform things from our design space(Rhino World XY) to Robot Base Plane that we measure

def set_robot_base(origin, xaxis, xypoint):
    """
    set a base plane representing the robot working object plane
    """
    robot_base = cg.Frame(origin, xaxis - origin, xypoint - origin)
    print (robot_base)
    return (robot_base)

def rhino_to_robot_space(rhino_plane,robot_base_plane):
    """
    Transform the objects from Rhino world XY plane to robot work object plane
    """
    T_matrix = cg.Transformation.from_frame_to_frame(cg.Frame.worldXY(), robot_base_plane)
    robot_plane = rhino_plane.transformed(T_matrix)
    return robot_plane

def set_z_safe_margin(planes_to_adjust, safety_margin):
    adjusted = []
    T = cg.Translation.from_vector(cg.Vector(0, 0, safety_margin))
    for f in planes_to_adjust:
        adjusted.append(f.transformed(T))
    return adjusted

# ===== Robot base is set =====
robot_base =  set_robot_base(wobj_origin, wobj_xaxis, wobj_xypoint)
print(robot_base)

# ===== Set safety margin for Z height ======
safe_planes = set_z_safe_margin(way_planes, z_safe_margin)

# ===== Transforming the rhino planes into robot planes =====
transformed_planes = []
for plane in safe_planes: 
    transformed_planes.append(rhino_to_robot_space(plane, robot_base))
# ---------- end compas ----------
py3_4 = Python3Script(x=compas.transformed_planes)  # -> out, rg_plns; inputs x: list; same code as py3_2
compas_draw_4 = COMPASDraw(cg=compas.transformed_planes)  # -> rg; same code as compas_draw

# ---- group: *Visualize Pln XYZ
cluster_2 = Cluster(pln=py3_4.rg_plns, num=Slider(8.2, range=0..10))

# ----
pt_5 = Point("{-23.68, 438.87, 47.63}")
pt_6 = Point("{-23.65, 424.70, 45.49}")
pt_7 = Point("{-36.52, 437.71, 61.48}")
pt_8 = Point("{-20.8, 439.6, 47.6}")
pt_9 = Point("{-20.9, 422.2, 45.1}")
pt_10 = Point("{-32.5, 439.1, 59.5}")

# ---- group: TCP
pt_11 = ConstructPoint(XCoordinate="-2.72", YCoordinate="4.86", ZCoordinate="88.08")

pt_12 = ConstructPoint(XCoordinate="-2.71", YCoordinate="3.23", ZCoordinate="86.39")

# ----
py3_5 = Python3Script(origin=pt_8, xaxis_pt=pt_9, xy_pt=pt_10)  # -> out, pick_frame; inputs origin: Point3d, xaxis_pt: Point3d, xy_pt: Point3d
# ---------- py3_5: Python ----------
from compas.geometry import Frame, Point
from compas.geometry import Rotation

from compas_rhino.conversions import point_to_compas

origin = point_to_compas(origin)
xaxis_pt = point_to_compas(xaxis_pt)
xy_pt = point_to_compas(xy_pt)

#define pick frame
pick_frame = Frame(origin, xaxis_pt - origin, xy_pt - origin)
# ---------- end py3_5 ----------
compas_draw_5 = COMPASDraw(cg=py3_5.pick_frame)  # -> rg; same code as compas_draw

# ---- group: NEW
# Convert Planes to URScript
compas_2 = Python3Script(
    way_frames=compas.transformed_planes,
    tcp_measured=pt_12,
    acceleration=Slider(1, range=0..10),
    velocity=Slider(2, range=0..10),
    pick_frame=py3_5.pick_frame)  # -> out, vis_frames, vis_planes, script; inputs way_frames: list, tcp_measured: Point3d, acceleration: Double, velocity: Double
# ---------- compas_2: Python ----------
from imp import reload
import sys
import os

#get current file path
path = ghenv.Component.OnPingDocument().FilePath
#get parent directory of the parent directory
parentdir = os.path.dirname(path)
#get src folder which contains classes
dire = os.path.join(parentdir,'src')

sys.path.append(dire)

import simple_ur_script as ur
reload(ur)

import utils 
reload(utils)

import simple_comm as com
reload(com)

import compas.geometry as cg
import math as m

# ===== Set global constants =======

IO = 4 #Global constant
SAFE_DIST = 30

# =================================

script = "" #create empty string

def pickup_brick(script,pick_up_frame, brick_frame):
    frames = []
    safe_pick_up_frame = pick_up_frame.translated(-pick_up_frame.normal*SAFE_DIST)

    # # add to th path: first vertical_safe_plane
    z = brick_frame.point.z + SAFE_DIST
    pt = safe_pick_up_frame.point
    xaxis = cg.Vector(safe_pick_up_frame.xaxis.x, safe_pick_up_frame.xaxis.y, 0)
    yaxis = cg.Vector(safe_pick_up_frame.yaxis.x, safe_pick_up_frame.yaxis.y, 0)
    vertical_safe_plane = cg.Frame(pt, xaxis, yaxis)
    vertical_safe_plane = vertical_safe_plane.translated([0, 0, z])

    script += ur.move_l(vertical_safe_plane, acceleration, velocity)
    frames.append(vertical_safe_plane)
    
    ## add to the path: go to the safe plane
    script += ur.move_l(safe_pick_up_frame, acceleration, velocity)
    frames.append(safe_pick_up_frame)
    
    ## add to the path: go to the pick up plane
    script += ur.move_l(pick_up_frame, acceleration, velocity)
    frames.append(pick_up_frame)
    
    ## add to the path: turn on the vacuum and wait .5 sec.
    script += ur.set_digital_out(IO,True)
    script += ur.sleep(.5)

    # add to the path: go back to the safe_plane
    script += ur.move_l(safe_pick_up_frame, acceleration, velocity)
    frames.append(safe_pick_up_frame)
    
    # add to th path: go up to vertical_safe_plane
    script += ur.move_l(vertical_safe_plane, acceleration, velocity)
    frames.append(vertical_safe_plane)
    
    return script, frames


def place_brick(script, place_frame):
    
    frames = []
    
    safe_place_frame = place_frame.translated(cg.Vector(0,0,1)*SAFE_DIST)
    
    # add to the path: go to the safe plane
    script += ur.move_l(safe_place_frame, acceleration, velocity)
    frames.append(safe_place_frame)
    
    # add to the path: go to the place plane
    script += ur.move_l(place_frame, acceleration, velocity)
    frames.append(place_frame)
    
    ## add to the path: turn off the vacuum and wait .5 second (hold the brick)
    script += ur.set_digital_out(IO,False)
    script += ur.sleep(.5)
    
    # add to the path: go back to the safe plane
    script += ur.move_l(safe_place_frame, acceleration, velocity)
    frames.append(safe_place_frame)
    
    return script,frames


#if value given for tcp measured, then add line to script, otherwise it will take current tcp from robot
if tcp_measured is not None:
    script += ur.set_tcp_by_angles(tcp_measured.X, tcp_measured.Y, tcp_measured.Z, m.radians(0.0),m.radians(0.0),m.radians(0))


vis_frames = []
#add move_l commands in sequence to script for each way plane
for brick_frame in way_frames:
    script, p = pickup_brick(script, pick_frame, brick_frame)
    vis_frames.extend(p) #only to visualize the planes
    script, p = place_brick(script,brick_frame)
    vis_frames.extend(p)


#format the script to make it sendable
script = com.concatenate_script(script)

from compas_rhino import conversions
import Rhino.Geometry as rg

vis_planes = [conversions.frame_to_rhino(frame) for frame in vis_frames]
# ---------- end compas_2 ----------

# ----
list = RobotsLibrary(
    {"AA-KR60", "AA-KR30", "AA-KR60_KR30", "Franka Emika Panda", "Bartlett-IRB120", "Bartlett-IRB1600", "Bartlett-KR6", "Bartlett-KR60-A", "Bartlett-KR60-B", "Bartlett-KR500"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}, selected="UR5",
    Type=0)  # disabled
py3_6 = Python3Script(x=compas_2.vis_frames)  # -> out, a; inputs x: list; disabled
# ---------- py3_6: Python ----------
from compas_rhino.conversions import frame_to_rhino_plane

a = [frame_to_rhino_plane(f) for f in x]
# ---------- end py3_6 ----------
loadrobot = LoadRobotSystem(Name=list, Base=PlaneXY(0, 0, 0))  # disabled
number_slider_3 = Slider(0, range=0..1)  # disabled
tool = CreateTool(Name="DefaultGHTool", TCP=pt_12, Weight=0)  # -> Tool, TCP; disabled
target = CreateTarget(Plane=py3_6.a, Tool=tool.Tool, IsCartesian=True)  # disabled
program = CreateProgram(Name="DefaultProgram", RobotSystem=loadrobot, Targets=target, StepSize=1)  # -> Program, Code, Duration, Warnings, Errors; disabled
sim = ProgramSimulation(Program=program.Program, Time=number_slider_3, Normalized=True)  # -> SystemMeshes, JointRotations, Plane, Index, Time, Program, Errors; disabled

pline = PolyLine(Vertices=compas_2.vis_planes, Closed=False)
points = PointList(Points=compas_2.vis_planes, Size=Slider(7, range=0..100))

# ---- group: Send UR script to Robot!
# Send to Robot!
py3_7 = Python3Script(script=compas_2.script, ip_address="192.168.10.10", send=Button())  # -> out, a; inputs script: String, ip_address: String, send: Boolean
# ---------- py3_7: Python ----------
import simple_comm as com

if send:
    com.send_script(script,ip_address)
# ---------- end py3_7 ----------

# ==== cluster Cluster
pln = ClusterInput()
num = ClusterInput()
pln_2 = Plane(graft(pln))
num_2 = Number(num)
deplane = DeconstructPlane(Plane=pln_2)  # -> flatten(Origin), XAxis, YAxis, ZAxis
entwine = Entwine(Branch00=deplane.XAxis, Branch01=deplane.YAxis, Branch02=deplane.ZAxis, FlattenInputs=True)
merge = Merge(
    Data1=ColourSwatch(SwatchColor=RGB(255, 0, 0)),
    Data2=ColourSwatch(SwatchColor=RGB(0, 255, 0)),
    Data3=ColourSwatch(SwatchColor=RGB(0, 0, 255)))  # -> graft(Result)
multiplication = Multiplication(A=entwine, B=num_2)
vdisex = VectorDisplayEx(Point=deplane.Origin, Vector=multiplication, Colour=merge, Width=2)
