# Grasshopper definition ZX_Brick_251016.gh (Grasshopper 1.0.8)
# plug-ins: Robots

# ---- group: 底小頂大圓柱塔
python_3_script = Python3Script(
    rows=Slider(11, range=0..100),
    angle_degree=Slider(0, range=0..1),
    radius_bottom=Slider(150, range=0..1000),
    radius_top=Slider(486, range=0..1000),
    cols_bottom=Slider(3, range=0..100),
    cols_top=Slider(10, range=0..100))  # -> out, way_planes, geometries; inputs rows: Int32, angle_degree: Double, radius_bottom: Int32, radius_top: Int32, cols_bottom: Int32, cols_top: Int32
# ---------- python_3_script: Python ----------
# r: compas
# venv: mas-2526
from compas_rhino.devtools import DevTools
DevTools.ensure_path()

from compas.geometry import Frame, Vector, Point, Rotation
from brick_wall import BigBrick
import math


angle_step = math.radians(angle_degree)

bricks = []

for row in range(rows):
    t = row / (rows+1)
    radius_row = radius_bottom * (1 - t) + radius_top * t
    cols_row = max(1, round(cols_bottom * (1 - t) + cols_top * t))

    twist_angle = row * angle_step

    for col in range(cols_row):
        # angle_around = (2.0 * math.pi / cols_row) * (cols_top+cols_bottom)
        angle_around = (2* math.pi/cols_row)*col + (row % 2)/2*(2 * math.pi/cols_row)  #每層半磚交錯


        px = radius_row * math.cos(angle_around)
        py = radius_row * math.sin(angle_around)
        pz = row * BigBrick.HEIGHT

        center_pt = Point(px, py, pz)

        xaxis = Vector(-math.sin(angle_around), math.cos(angle_around), 0.0)
        zaxis = Vector(0.0, 0.0, 1.0)
        yaxis = zaxis.cross(xaxis)


        # --- 朝向中心點 ---
        # layer_center = Point(0, 0, pz)

        # # --- 朝向該層的中心點 ---
        # dir_to_layer_center = layer_center - center_pt   # 由磚中心指向該層中心
        # xaxis = dir_to_layer_center.unitized()           # X軸指向該層圓心
        # zaxis = Vector(0.0, 0.0, 1.0)
        # yaxis = zaxis.cross(xaxis)

        frame = Frame(center_pt, xaxis, yaxis)

        brick = BigBrick(frame)

        brick.rotate(math.degrees(twist_angle))

        bricks.append(brick)


# Visualize and store brick data
way_planes = []
geometries = []

for brick in bricks:
    geometries.append(brick.draw())
    way_planes.append(brick.get_pick_frame())
# ---------- end python_3_script ----------
draw = COMPASDraw(cg=python_3_script.way_planes)  # -> rg
#   port cg: The COMPAS geometry or datastructure to be drawn.
#   port rg: The Rhino geometry object.
# ---------- draw: Python ----------
# r: compas>=2.14.1
"""
Draws COMPAS geometry in Grasshopper.
"""

from typing import Any

import Grasshopper

from compas.scene import SceneObject


class CompasToRhinoGeometry(Grasshopper.Kernel.GH_ScriptInstance):
    def RunScript(self, cg):
        if not cg:
            return None

        return SceneObject(item=cg).draw()
# ---------- end draw ----------
draw_2 = COMPASDraw(cg=python_3_script.geometries)  # -> rg; same code as draw

# ---- group: This is needed only ONCE in the GH definition
enable_auto_reload = Python3Script()  # -> ok
# ---------- enable_auto_reload: Python ----------
"""
------------------------------
Using VS Code as Python editor
------------------------------

The simplest way to start using VS Code as our editor, is
to place our Python code in files located IN THE SAME FOLDER as our Grasshopper file.

After we have done that, we need 2 steps: 

1. Enable the COMPAS reloader on one component. This tells Grasshopper to watch for changes in the Pythoh files and reload if changed.
2. Every other component that uses Python code from external files needs to start with a method to ensure Grasshopper knows where to load the files from.

"""
# r: compas
# venv: mas-2526

from compas_rhino.devtools import DevTools
DevTools.enable_reloader()
# ---------- end enable_auto_reload ----------

# ---- group: original_brick_logic
py3 = Python3Script(rows=Slider(9, range=0..100), cols=Slider(9, range=0..100))  # -> out, geometries, way_planes; inputs rows: Int32, cols: Int32
# ---------- py3: Python ----------
# r: compas
# venv: mas-2526
from compas_rhino.devtools import DevTools
DevTools.ensure_path()

from compas.geometry import Frame, Vector, Point, Rotation
from brick_wall import Brick
import math

bricks = []
for row in range (rows):
    for col in range (cols):
        if row % 2 == 0:
            offset = Brick.LENGTH/2
        else:
            offset = 0
       
        px = col * Brick.LENGTH + offset
        py = 0
        pz = row * Brick.HEIGHT

        pt = Point(px, py, pz)
        frame = Frame(pt, Vector(1,0,0), Vector(0,1,0))
        brick = Brick(frame)
        bricks.append(brick)
        brick.rotate(0)  # 旋轉 


geometries = []
way_planes = []

for brick in bricks:
    geometries.append(brick.draw())
    way_planes.append(brick.get_pick_frame())
# ---------- end py3 ----------
draw_3 = COMPASDraw(cg=py3.geometries)  # -> rg; same code as draw
draw_4 = COMPASDraw(cg=py3.way_planes)  # -> rg; same code as draw

# ---- group: DNA_rotate_column
python_3_script_2 = Python3Script(
    rows=Slider(20, range=0..100),
    cols=Slider(3, range=0..100),
    angle_degree=Slider(0, range=0..180),
    radius=Slider(18, range=0..180))  # -> out, way_planes, geometries; inputs rows: Int32, cols: Int32, angle_degree: Int32, radius: Int32
# ---------- python_3_script_2: Python ----------
# r: compas
# venv: mas-2526
from compas_rhino.devtools import DevTools
DevTools.ensure_path()

from compas.geometry import Frame, Vector, Point, Rotation
from brick_wall import Brick
import math


angle_step = math.radians(angle_degree)


bricks = []

for row in range(rows):
    twist_angle = row * angle_step

    for col in range(cols):
        # angle_around = (2.0 * math.pi / cols) * col
        angle_around = (2* math.pi/cols)*col + (row % 2)/2*(2 * math.pi/cols)  #每層半磚交錯

        px = radius * math.cos(angle_around)
        py = radius * math.sin(angle_around)
        pz = row * Brick.HEIGHT

        center_pt = Point(px, py, pz)

        xaxis = Vector(-math.sin(angle_around), math.cos(angle_around), 0.0)
        zaxis = Vector(0.0, 0.0, 1.0)
        yaxis = zaxis.cross(xaxis)

        frame = Frame(center_pt, xaxis, yaxis)

        brick = Brick(frame)
        brick.rotate(0)
        brick.rotate(math.degrees(twist_angle))

        bricks.append(brick)


# Visualize and store brick data
way_planes = []
geometries = []

for brick in bricks:
    geometries.append(brick.draw())
    way_planes.append(brick.get_pick_frame())
# ---------- end python_3_script_2 ----------
draw_5 = COMPASDraw(cg=python_3_script_2.geometries)  # -> rg; same code as draw
draw_6 = COMPASDraw(cg=python_3_script_2.way_planes)  # -> rg; same code as draw

# ---- group: rotate_tower
py3_2 = Python3Script(rows=Slider(25, range=0..100), angle_step=Slider(5, range=0..100))  # -> out, way_planes, geometries; inputs rows: Int32
# ---------- py3_2: Python ----------
# r: compas
# venv: mas-2526
from compas_rhino.devtools import DevTools
DevTools.ensure_path()

from compas.geometry import Frame, Vector, Point, Rotation
from brick_wall import Brick
import math

bricks = []

offsets = [
    (0, 0, 0, 0),   # A (dx, dy, dz, rotation)
    (0.76, 0.6, 0, 90),  # B
    (1.0, -1.0, 0, 180),   # C
    (0.24, -1.6, 0, 270), # D
]
'''
for row in range(rows):
    for col in range(cols):
        px = col * Brick.LENGTH
        py = 0
        pz = row * Brick.HEIGHT

        for (dx, dy, dz, rot) in offsets:
            pt = Point(px + dx * Brick.LENGTH, py + dy * Brick.WIDTH, pz + dz)

            xaxis = Vector(1, 0, 0)
            yaxis = Vector(0, 1, 0)
            frame = Frame(pt, xaxis, yaxis)

            brick = Brick(frame)
            brick.rotate(rot)
            bricks.append(brick)'''

L = Brick.LENGTH
W = Brick.WIDTH
H = Brick.HEIGHT

for row in range(rows):
    
    for (dx, dy, dz, rot) in offsets:

        layer_angle = row * angle_step
        px = dx * L
        py = dy * W
        pz = row * H  

        pt = Point(px, py, pz)

        frame = Frame(pt, Vector(1,0,0), Vector(0,1,0))
        brick = Brick(frame)

        brick.rotate(rot)

        R_layer = Rotation.from_axis_and_angle(
            Vector(0,0,1),
            math.radians(layer_angle),
            point=Point(0,0,pz)
        )
        brick.frame.transform(R_layer)
        bricks.append(brick)


geometries = []
way_planes = []

for brick in bricks:
    geometries.append(brick.draw())
    way_planes.append(brick.get_pick_frame())
# ---------- end py3_2 ----------
draw_7 = COMPASDraw(cg=py3_2.way_planes)  # -> rg; same code as draw
draw_8 = COMPASDraw(cg=py3_2.geometries)  # -> rg; same code as draw

# ---- group: 沿著曲線生成磚
curve = Curve(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)
pt = Point(Point(-95.87540825, 6.248147936, 6.91674266))
python_3_script_3 = Python3Script(rows=Slider(11, range=0..100), cols=Slider(15, range=0..100), curve=curve, attractor=pt)  # -> out, bricks, way_planes; inputs rows: Int32, cols: Int32, curve: Curve, attractor: Point3d
# ---------- python_3_script_3: Python ----------
from compas_rhino.devtools import DevTools
DevTools.ensure_path()

from compas_rhino.conversions import curve_to_compas, point_to_compas
from compas.geometry import Frame, Vector, Rotation, angle_vectors
from brick_wall import Brick

crv = curve_to_compas(curve)
div_crv = crv.divide_by_count(cols)

attractor = point_to_compas(attractor)

bricks = []
geometries = []
way_planes = []

for row in range(rows):
    for t in div_crv:
        pt = crv.point_at(t)
        tan = crv.tangent_at(t)

        xaxis = Vector(*tan).unitized()
        zaxis = Vector(0, 0, 1)
        yaxis = zaxis.cross(xaxis)

        new_pt = pt + zaxis * (row * Brick.HEIGHT)
        if row % 2 == 1:
            new_pt = new_pt + xaxis * (Brick.LENGTH / 2)

        frame = Frame(new_pt, xaxis, yaxis)
        brick = Brick(frame)

        angle = angle_vectors(brick.frame.xaxis, frame.xaxis)
        cross_vec = brick.frame.xaxis.cross(frame.xaxis)
        if cross_vec.dot(brick.frame.zaxis) < 0:
            angle = -angle

        R = Rotation.from_axis_and_angle(brick.frame.zaxis, angle, point=brick.frame.point)
        brick.frame.transform(R)

        # dist = attractor.distance_to_point(frame.point)
        # brick.rotate(dist)



        brick_geo = brick.draw()
        bricks.append(brick_geo)
        way_planes.append(brick.get_pick_frame())
# ---------- end python_3_script_3 ----------
draw_9 = COMPASDraw(cg=python_3_script_3.bricks)  # -> rg; same code as draw
draw_10 = COMPASDraw(cg=python_3_script_3.way_planes)  # -> rg; same code as draw

# ----
gap = Slider(2.5, range=0..10)
pt_2 = Point(Point(28.54295149, 6.248147936, 6.91674266))
python_3_script_4 = Python3Script(rows=Slider(50, range=0..100), cols=Slider(5, range=0..100), attractor=pt_2)  # -> out, way_planes, geometries, bricks; inputs rows: Int32, cols: Int32, attractor: Point3d
# ---------- python_3_script_4: Python ----------
# r: compas
# venv: mas-2526
from compas_rhino.devtools import DevTools
DevTools.ensure_path()

from compas.geometry import Frame, Vector, Point
from brick_wall import Brick

import compas.geometry as cg


bricks = []
for r in range(rows):
    z  = Brick.HEIGHT
    cent = Point(0,0,r*z)
    pt2 = Point (Brick.LENGTH, Brick.WIDTH, r*z)
    
    for c in range (cols):
        brick = cg.Box.from_corner_corner_height(cent, pt2, z)
bricks.append(brick)

print(cent)
# ---------- end python_3_script_4 ----------
# Generate Geometry
curve_2 = Curve(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)
brick_wall = Python3Script(crv=curve_2, num_layers=Slider(9, range=0..30), gap=gap)  # -> bricks, geometries, way_planes; inputs crv: Curve, num_layers: Int32, gap: Double
# ---------- brick_wall: Python ----------
# r: compas
# venv: mas-2526
from compas_rhino.devtools import DevTools
DevTools.ensure_path()

# 0. Import everything we will need
import math
from compas.geometry import Box
from compas.geometry import Point
from compas.geometry import Frame
from compas.geometry import cross_vectors
from compas_rhino.conversions import curve_to_compas

# ..also import our module "brick_wall.py", that needs to be in the same folder as our GH file
from brick_wall import Brick

# 1. Start with an empty list of bricks to be created
#    make sure to match the name of this list to the output of this component!
bricks = []

# 2. Create points on each curve
curve = curve_to_compas(crv)
print(curve.length())

# divide curve twice as fine
num_divs = int(curve.length() / (Brick.LENGTH+gap)) * 2
params, div_pts = curve.divide_by_count(num_divs, True)

for row in range(num_layers):
    for col, param in enumerate(params,):
        pt = curve.point_at(param)
        pt = pt.translated([0,0,Brick.HEIGHT * row])
        tangent = curve.tangent_at(param)
        normal = cross_vectors(tangent, [0,0,1])
        # only place bricks on alternating divisions depending on the row
        if row % 2 == 0:  
            # even rows 
            if col % 2 == 0:
                b = Brick(frame = Frame(pt, tangent, normal))
                bricks.append(b)
        else:  
            # odd rows 
            if col % 2 == 1:
                b = Brick(frame = Frame(pt, tangent, normal))
                bricks.append(b)

# Visualize and store brick data
geometries = []
way_planes = []

for brick in bricks:
    geometries.append(brick.draw())
    way_planes.append(brick.get_pick_frame())
# ---------- end brick_wall ----------
draw_11 = COMPASDraw(cg=python_3_script_4.bricks)  # -> rg; same code as draw
draw_12 = COMPASDraw(cg=python_3_script_4.way_planes)  # -> rg; same code as draw

# ---- group: 在X軸上排列的多邊形漸變
py3_3 = Python3Script()  # -> out, a, b
# ---------- py3_3: Python ----------
import Rhino.Geometry as rg
import math

# === 參數 ===
R =  10.0                  # 半徑
C =  rg.Point3d(0,0,0)     # 中心
Rot =  0.0             # 旋轉角度 (度)

Spacing =  22  # 多邊形之間的距離
rot_rad = math.radians(Rot)
# === 建立正多邊形 ===
def regular_ngon(n, center, radius, rot_rad):
    pts = []
    for i in range(n):
        ang = rot_rad + 2.0*math.pi * (float(i)/n)
        x = center.X + radius * math.cos(ang)
        y = center.Y + radius * math.sin(ang)
        pts.append(rg.Point3d(x, y, center.Z))
    pts.append(pts[0])  # 關閉
    return rg.PolylineCurve(rg.Polyline(pts))

Polys = []
Centers = []

for idx, n in enumerate(range(3, 13)):   # 3 到 12 邊
    shift = rg.Vector3d(idx * 22, 0, 0)  # 每個往 X 方向平移
    center = C + shift
    
    crv = regular_ngon(n, center, R, rot_rad)
    Polys.append(crv)
    Centers.append(center)

# === 提取所有邊的端點 ===
points = []   # 最終輸出點位
for crv in Polys:
    pl = crv.ToPolyline()
    for i in range(pl.Count-1):   # -1 去掉最後重複點
        p1 = pl[i]
        p2 = pl[i+1]
        points.append(p1)
        points.append(p2)

# === 輸出 ===
a = Polys       # 多邊形
b = points  # 每個邊的端點
  # 每個邊的中點
# ---------- end py3_3 ----------

# ----
python_3_script_5 = Python3Script(x=brick_wall.way_planes)  # -> out, a; inputs x: list
# ---------- python_3_script_5: Python ----------
from compas_rhino.conversions import frame_to_rhino_plane

a = [frame_to_rhino_plane(f) for f in x]
# ---------- end python_3_script_5 ----------
compas_draw = COMPASDraw(cg=brick_wall.geometries)  # -> rg; same code as draw
compas_draw_2 = COMPASDraw(cg=brick_wall.way_planes)  # -> rg; same code as draw
fine_adjust_z_mm = Slider(5, range=-5..10)
py3_4 = Python3Script(rows=Slider(1, range=0..100), cols=Slider(1, range=0..100))  # -> out, geometries, way_planes; inputs rows: Int32, cols: Int32
# ---------- py3_4: Python ----------
# r: compas
# venv: mas-2526
from compas_rhino.devtools import DevTools
DevTools.ensure_path()

from compas.geometry import Frame, Vector, Point, Rotation
from brick_wall import Brick
import math

bricks = []
for row in range (rows):
    for col in range (cols):
       
       
        px = col * Brick.LENGTH 
        py = 0
        pz = row * Brick.HEIGHT

        pt = Point(px, py, pz)
        frame = Frame(pt, Vector(1,0,0), Vector(0,1,0))
        brick = Brick(frame)
        bricks.append(brick)
        brick.rotate(0)  # 旋轉 


geometries = []
way_planes = []

for brick in bricks:
    geometries.append(brick.draw())
    way_planes.append(brick.get_pick_frame())
# ---------- end py3_4 ----------
draw_13 = COMPASDraw(cg=py3_4.way_planes)  # -> rg; same code as draw
draw_14 = COMPASDraw(cg=py3_4.geometries)  # -> rg; same code as draw
# Transform from Rhino to Robot Space
pt_3 = Point("{462.02, 465.69, 4.06}")
pt_4 = Point("{109.25, 464.14, 5.11}")
pt_5 = Point("{462.19, -132.33, 5.03}")
rec_3pt = Rectangle3Pt(PointA=pt_3, PointB=pt_4, PointC=pt_5)  # -> Rectangle, Length
compas = Python3Script(
    way_planes=python_3_script.way_planes,
    wobj_origin=pt_3,
    wobj_xaxis=pt_4,
    wobj_xypoint=pt_5,
    z_safe_margin=fine_adjust_z_mm)  # -> out, transformed_planes; inputs way_planes: list, wobj_origin: Point3d, wobj_xaxis: Point3d, wobj_xypoint: Point3d, z_safe_margin: Double
# ---------- compas: Python ----------
import compas.geometry as cg

#in this step we transform our way planes to robot space
#the rhino co-ordinate system is rather abstract in the physical world
#the robot base plane assumed the base frame of robot is the origin
#but rhino does not know that
#thus we transform things from our design space(Rhino World XY) to Robot Base Plane that we measure

def set_robot_base(origin, xaxis, xypoint):
    """
    set a base plane representing the robot working object plane
    """
    robot_base = cg.Frame(origin, xaxis - origin, xypoint - origin)
    print (robot_base)
    return (robot_base)

def rhino_to_robot_space(rhino_plane,robot_base_plane):
    """
    Transform the objects from Rhino world XY plane to robot work object plane
    """
    T_matrix = cg.Transformation.from_frame_to_frame(cg.Frame.worldXY(), robot_base_plane)
    robot_plane = rhino_plane.transformed(T_matrix)
    return robot_plane

def set_z_safe_margin(planes_to_adjust, safety_margin):
    adjusted = []
    T = cg.Translation.from_vector(cg.Vector(0, 0, safety_margin))
    for f in planes_to_adjust:
        adjusted.append(f.transformed(T))
    return adjusted

# ===== Robot base is set =====
robot_base =  set_robot_base(wobj_origin, wobj_xaxis, wobj_xypoint)
print(robot_base)

# ===== Set safety margin for Z height ======
safe_planes = set_z_safe_margin(way_planes, z_safe_margin)

# ===== Transforming the rhino planes into robot planes =====
transformed_planes = []
for plane in safe_planes: 
    transformed_planes.append(rhino_to_robot_space(plane, robot_base))
# ---------- end compas ----------
compas_draw_3 = COMPASDraw(cg=compas.transformed_planes)  # -> rg; same code as draw

# ---- group: *Visualize Pln XYZ
cluster = Cluster(pln=compas_draw_3, num=Slider(8.2, range=0..10))

# ----
pt_6 = Point("{-23.736745, 438.885287, 47.558923}")
pt_7 = Point("{-19.501521, 420.444605, 39.878472}")
pt_8 = Point("{-30.431521, 437.504605, 54.198472}")

pt_9 = ConstructPoint(XCoordinate="-2.72", YCoordinate="4.86", ZCoordinate="88.08")

py3_5 = Python3Script(origin=pt_6, xaxis_pt=pt_7, xy_pt=pt_8)  # -> out, pick_frame; inputs origin: Point3d, xaxis_pt: Point3d, xy_pt: Point3d
# ---------- py3_5: Python ----------
from compas.geometry import Frame, Point
from compas.geometry import Rotation

from compas_rhino.conversions import point_to_compas

origin = point_to_compas(origin)
xaxis_pt = point_to_compas(xaxis_pt)
xy_pt = point_to_compas(xy_pt)

#define pick frame
pick_frame = Frame(origin, xaxis_pt - origin, xy_pt - origin)
# ---------- end py3_5 ----------
number_slider = Slider(1, range=0..1)
compas_draw_4 = COMPASDraw(cg=py3_5.pick_frame)  # -> rg; same code as draw
number_slider_2 = Slider(0.1, range=0..0.1)
number_slider_3 = Slider(0.1, range=0..0.1)

create_tool = CreateTool(Name="brick", TCP=pt_9, Weight=Slider(1.5, range=0..10))  # -> Tool, TCP

# ----
# Convert Planes to URScript
compas_2 = Python3Script(
    way_frames=compas.transformed_planes,
    tcp_measured=pt_9,
    acceleration=number_slider,
    velocity=number_slider,
    pick_frame=py3_5.pick_frame)  # -> out, vis_frames, vis_planes, script; inputs way_frames: list, tcp_measured: Point3d, acceleration: Double, velocity: Double
# ---------- compas_2: Python ----------
from imp import reload
import sys
import os

#get current file path
path = ghenv.Component.OnPingDocument().FilePath
#get parent directory of the parent directory
parentdir = os.path.dirname(path)
#get src folder which contains classes
dire = os.path.join(parentdir,'src')

sys.path.append(dire)

import simple_ur_script as ur
reload(ur)

import utils 
reload(utils)

import simple_comm as com
reload(com)

import compas.geometry as cg
import math as m

# ===== Set global constants =======

IO = 4 #Global constant
SAFE_DIST = 50

# =================================

script = "" #create empty string

def pickup_brick(script,pick_up_frame):
    frames = []
    
    safe_pick_up_frame = pick_up_frame.translated(-pick_up_frame.normal*SAFE_DIST)
    
    ## add to the path: go to the safe plane
    script += ur.move_l(safe_pick_up_frame, acceleration, velocity)
    frames.append(safe_pick_up_frame)
    
    ## add to the path: go to the pick up plane
    script += ur.move_l(pick_up_frame, acceleration, velocity)
    frames.append(pick_up_frame)
    
    ## add to the path: turn on the vacuum and wait 1 sec.
    script += ur.set_digital_out(IO,True)
    script += ur.sleep(1)

    # add to the path: go back to the safe_plane
    script += ur.move_l(safe_pick_up_frame, acceleration, velocity)
    frames.append(safe_pick_up_frame)
    
    return script, frames


def place_brick(script, place_frame):
    
    frames = []
    
    safe_place_frame = place_frame.translated(cg.Vector(0,0,1)*SAFE_DIST)
    
    # add to the path: go to the safe plane
    script += ur.move_l(safe_place_frame, acceleration, velocity)
    frames.append(safe_place_frame)
    
    # add to the path: go to the place plane
    script += ur.move_l(place_frame, acceleration, velocity)
    frames.append(place_frame)
    
    ## add to the path: turn off the vacuum and wait 1 second (hold the brick)
    script += ur.set_digital_out(IO,False)
    script += ur.sleep(1)
    
    # add to the path: go back to the safe plane
    script += ur.move_l(safe_place_frame, acceleration, velocity)
    frames.append(safe_place_frame)
    
    return script,frames


#if value given for tcp measured, then add line to script, otherwise it will take current tcp from robot
if tcp_measured is not None:
    script += ur.set_tcp_by_angles(tcp_measured.X, tcp_measured.Y, tcp_measured.Z, m.radians(0.0),m.radians(0.0),m.radians(0))


vis_frames = []
#add move_l commands in sequence to script for each way plane
for brick_frame in way_frames:
    script, p = pickup_brick(script,pick_frame)
    vis_frames.extend(p) #only to visualize the planes
    script, p = place_brick(script,brick_frame)
    vis_frames.extend(p)


#format the script to make it sendable
script = com.concatenate_script(script)

from compas_rhino import conversions
import Rhino.Geometry as rg

vis_planes = [conversions.frame_to_rhino(frame) for frame in vis_frames]
# ---------- end compas_2 ----------

# ---- group: NEW_JW
compas_3 = Python3Script(
    way_frames=compas.transformed_planes,
    tcp_measured=pt_9,
    acceleration=number_slider,
    velocity=number_slider,
    pick_frame=py3_5.pick_frame)  # -> out, vis_frames, vis_planes, script; inputs way_frames: list, tcp_measured: Point3d, acceleration: Double, velocity: Double
# ---------- compas_3: Python ----------
from imp import reload
import sys
import os

#get current file path
path = ghenv.Component.OnPingDocument().FilePath
#get parent directory of the parent directory
parentdir = os.path.dirname(path)
#get src folder which contains classes
dire = os.path.join(parentdir,'src')

sys.path.append(dire)

import simple_ur_script as ur
reload(ur)

import utils 
reload(utils)

import simple_comm as com
reload(com)

import compas.geometry as cg
import math as m

# ===== Set global constants =======

IO = 4 #Global constant
SAFE_DIST = 50

# =================================

script = "" #create empty string

def pickup_brick(script,pick_up_frame, brick_frame):
    frames = []
    safe_pick_up_frame = pick_up_frame.translated(-pick_up_frame.normal*SAFE_DIST)

    # # add to th path: first vertical_safe_plane
    z = brick_frame.point.z + SAFE_DIST
    pt = safe_pick_up_frame.point
    xaxis = cg.Vector(safe_pick_up_frame.xaxis.x, safe_pick_up_frame.xaxis.y, 0)
    yaxis = cg.Vector(safe_pick_up_frame.yaxis.x, safe_pick_up_frame.yaxis.y, 0)
    vertical_safe_plane = cg.Frame(pt, xaxis, yaxis)
    vertical_safe_plane = vertical_safe_plane.translated([0, 0, z])

    script += ur.move_l(vertical_safe_plane, acceleration, velocity)
    frames.append(vertical_safe_plane)
    
    ## add to the path: go to the safe plane
    script += ur.move_l(safe_pick_up_frame, acceleration, velocity)
    frames.append(safe_pick_up_frame)
    
    ## add to the path: go to the pick up plane
    script += ur.move_l(pick_up_frame, acceleration, velocity)
    frames.append(pick_up_frame)
    
    ## add to the path: turn on the vacuum and wait .5 sec.
    script += ur.set_digital_out(IO,True)
    script += ur.sleep(.5)

    # add to the path: go back to the safe_plane
    script += ur.move_l(safe_pick_up_frame, acceleration, velocity)
    frames.append(safe_pick_up_frame)
    
    # add to th path: go up to vertical_safe_plane
    script += ur.move_l(vertical_safe_plane, acceleration, velocity)
    frames.append(vertical_safe_plane)
    
    return script, frames


def place_brick(script, place_frame):
    
    frames = []
    
    safe_place_frame = place_frame.translated(cg.Vector(0,0,1)*SAFE_DIST)
    
    # add to the path: go to the safe plane
    script += ur.move_l(safe_place_frame, acceleration, velocity)
    frames.append(safe_place_frame)
    
    # add to the path: go to the place plane
    script += ur.move_l(place_frame, acceleration, velocity)
    frames.append(place_frame)
    
    ## add to the path: turn off the vacuum and wait .5 second (hold the brick)
    script += ur.set_digital_out(IO,False)
    script += ur.sleep(.5)
    
    # add to the path: go back to the safe plane
    script += ur.move_l(safe_place_frame, acceleration, velocity)
    frames.append(safe_place_frame)
    
    return script,frames


#if value given for tcp measured, then add line to script, otherwise it will take current tcp from robot
if tcp_measured is not None:
    script += ur.set_tcp_by_angles(tcp_measured.X, tcp_measured.Y, tcp_measured.Z, m.radians(0.0),m.radians(0.0),m.radians(0))


vis_frames = []
#add move_l commands in sequence to script for each way plane
for brick_frame in way_frames:
    script, p = pickup_brick(script, pick_frame, brick_frame)
    vis_frames.extend(p) #only to visualize the planes
    script, p = place_brick(script,brick_frame)
    vis_frames.extend(p)


#format the script to make it sendable
script = com.concatenate_script(script)

from compas_rhino import conversions
import Rhino.Geometry as rg

vis_planes = [conversions.frame_to_rhino(frame) for frame in vis_frames]
# ---------- end compas_3 ----------

# ---- group: Tool DO
set_do = SetDO(DO=Slider(1, range=0..1), Value=Toggle(False))

# ----
compas_draw_5 = COMPASDraw(cg=compas_2.vis_frames)  # -> rg; same code as draw
points = PointList(Points=compas_3.vis_planes, Size=Slider(7, range=0..100))

# ---- group: Approach
create_target = CreateTarget(Plane=compas_3.vis_planes, Tool=create_tool.Tool, IsCartesian=True)

# ----
robots_library = RobotsLibrary(
    {"TTDA-KR6", "TTDA-KR60", "TTDA-IIWA14", "Taiwan-IRB1600", "Taiwan-KR6", "Taiwan-KR10", "UR3e", "UR5e", "UR10e", "UR16e", "UR3", "UR5", "UR10", "UR20", "UR30"}, selected="UR5",
    Type=0)
load_robot_system = LoadRobotSystem(Name=robots_library, Base=PlaneXY(0, 0, 0))
create_program = CreateProgram(Name="DefaultProgram", RobotSystem=load_robot_system, Targets=create_target, InitCommands=set_do, StepSize=1)  # -> Program, Code, Duration, Warnings, Errors
program_simulation = ProgramSimulation(Program=create_program.Program, Time=Slider(0, range=0..1), Normalized=True)  # -> SystemMeshes, JointRotations, Plane, Index, Time, Program, Errors
panel = Panel(create_program.Warnings)
panel_2 = Panel(program_simulation.Errors)
remote_connection = RemoteConnection(Program=create_program.Program, IP="192.168.2.1", Upload=Toggle(False), Play=Toggle(False), Pause=Toggle(False))

pline = PolyLine(Vertices=compas_3.vis_planes, Closed=False)
panel_3 = Panel(compas_3.script)

# ---- group: Send UR script to Robot!
# Send to Robot!
py3_6 = Python3Script(script=compas_3.script, ip_address="192.168.10.10", send=Button())  # -> out, a; inputs script: String, ip_address: String, send: Boolean
# ---------- py3_6: Python ----------
import simple_comm as com

if send:
    com.send_script(script,ip_address)
# ---------- end py3_6 ----------

# ----
gap_2 = Slider(2.5, range=0..10)
attractor_point = Point(Point(172.1222425, -142.7513646, 130.9570846))
curve_3 = Curve(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)

# ---- group: wanchen_wave_brick wall
brick_wall_2 = Python3Script(
    crv=curve_3,
    num_layers=Slider(6, range=0..30),
    gap=gap_2,
    attractor=attractor_point,
    freq=Slider(2, range=0..10),
    amp=Slider(50, range=0..100),
    amp_layers=Slider(4, range=0..10),
    phase=Slider(0, range=0..10))  # -> bricks, geometries, way_planes; inputs crv: Curve, num_layers: Int32, gap: Double, attractor: Point3d, freq: Int32, amp: Int32, amp_layers: Int32, phase: Int32
# ---------- brick_wall_2: Python ----------
# r: compas
# venv: mas-2526
from compas_rhino.devtools import DevTools
DevTools.ensure_path()

#from compas_ghpython.utilities import list_to_ghtree, ghtree_to_list
from ghpythonlib.treehelpers import list_to_tree, tree_to_list

from compas_rhino.conversions import frame_to_rhino_plane

# 0. Import everything we will need
import math
from compas.geometry import Box
from compas.geometry import Point
from compas.geometry import Frame
from compas.geometry import cross_vectors
from compas_rhino.conversions import curve_to_compas
from compas_rhino.conversions import point_to_compas


# ..also import our module "brick_wall.py", that needs to be in the same folder as our GH file
from brick_wall import Brick

attractor = point_to_compas(attractor)

# 1. Start with an empty list of bricks to be created
#    make sure to match the name of this list to the output of this component!
bricks = []

# 2. Create points on each curve
curve = curve_to_compas(crv)
print(curve.length())

# divide curve twice as fine
num_divs = int(curve.length() / (Brick.LENGTH+gap)) * 2
params, div_pts = curve.divide_by_count(num_divs, True)



def remap(val, old_min, old_max, new_min, new_max):
    return (new_max - new_min) * (val - old_min) / (old_max - old_min) + new_min

for col, param in enumerate(params):
    pt = curve.point_at(param)
    tangent = curve.tangent_at(param)
    normal = cross_vectors(tangent, [0,0,1])
    wave_h = remap(col, 0, len(params)-1, 0,1)
    dist = attractor.distance_to_point(pt)
    wave_val = math.sin(wave_h * freq * 2 * math.pi+ phase) 
    wave_val = wave_val + 1

    total_layers = int(num_layers + amp_layers* wave_val)
    for i in range(total_layers):
        z_extra = Brick.HEIGHT * i
        pt_extra = pt.translated([0, 0, z_extra]) 

        if (num_layers + i) % 2 == 0:  
            if col % 2 == 0:
                b_extra = Brick(frame=Frame(pt_extra, tangent, normal))
                bricks.append(b_extra)
        else:
            if col % 2 == 1:
                b_extra = Brick(frame=Frame(pt_extra, tangent, normal))
                bricks.append(b_extra)

# Get all heights            
heights = [round(brick.frame.point.z / Brick.HEIGHT, 3) for brick in bricks]

# Get unique heights and sort
unique_heights = sorted(list(set(heights)))  # 从下到上排列

# Collect bricks in rows
sorted_bricks = []
for h in unique_heights:
    # Find all bricks at the current height
    row_bricks = [b for b, z in zip(bricks, heights) if z == h]
    # Sort by column order
    row_bricks.sort(key=lambda b: b.frame.point.x)  # Sort column by x
    sorted_bricks.extend(row_bricks)
geometries = [b.draw() for b in sorted_bricks]
way_planes = [b.get_pick_frame() for b in sorted_bricks]
# Problem Unsolved: The index of each row is jumping!
# ---------- end brick_wall_2 ----------

# ----
draw_15 = COMPASDraw(cg=brick_wall_2.geometries)  # -> rg; same code as draw
draw_16 = COMPASDraw(cg=brick_wall_2.way_planes)  # -> rg; same code as draw

list = ValueList({"0", "90", "180", "270", "360"}, selected="90")

# ---- group: JW_柱列
py3_7 = Python3Script(
    segments=Slider(4, range=0..10),
    offsets=Slider(0, range=0..20),
    levels=Slider(2, range=0..50),
    Max_rotation=list,
    tolorence_xy=Slider(0, range=0..1),
    tolorence_z=Slider(0, range=0..1))  # -> out, bricks, frames; inputs segments: Int32, offsets: Double, levels: Int32, Max_rotation: Double, tolorence_xy: Double, tolorence_z: Double
# ---------- py3_7: Python ----------
# r: compas
# venv: mas-226
from compas_rhino.devtools import DevTools
DevTools.ensure_path()

import compas.geometry as cg
import ghpythonlib.treehelpers as th
import math

from brick_wall import Brick

#----#
x, y, z = Brick.LENGTH, Brick.WIDTH, Brick.HEIGHT

frames = []
bricks = []
for i in range(levels):
    z -= tolorence_z
    print (z)
    centroid = cg.Point(0, 0, i*z)
    pt2 = cg.Point(x, y, i*z)

    frames_branch = []
    bricks_branch = []
    for j in range(segments):
        # Create Original Brick
        brick = cg.Box.from_corner_corner_height(centroid, pt2, z)
        # Add Tolorence
        brick.translate([tolorence_xy, tolorence_xy, 0])
        # Offset Original Brick
        brick.translate([-offsets, offsets, 0])

        # Rotate Brick
        radian = (2*math.pi) / segments * j
        brick.rotate(radian)    
        # Rotate Unit(Brick*segment counts)
        angle = (math.radians(Max_rotation)) / (levels-1) * i
        brick.rotate(angle)

        # Get Frames
        frame = Brick.get_pick_frame(brick)

        frames_branch.append(frame)
        bricks_branch.append(brick)

    frames.append(frames_branch)
    bricks.append(bricks_branch)



#--------------#------------#

frames = th.list_to_tree(frames)
bricks = th.list_to_tree(bricks)
# ---------- end py3_7 ----------

# ----
draw_17 = COMPASDraw(cg=py3_7.bricks)  # -> rg; same code as draw

# ==== cluster Cluster
pln = ClusterInput()
num = ClusterInput()
pln_2 = Plane(graft(pln))
num_2 = Number(num)
deplane = DeconstructPlane(Plane=pln_2)  # -> flatten(Origin), XAxis, YAxis, ZAxis
entwine = Entwine(Branch00=deplane.XAxis, Branch01=deplane.YAxis, Branch02=deplane.ZAxis, FlattenInputs=True)
merge = Merge(
    Data1=ColourSwatch(SwatchColor=RGB(255, 0, 0)),
    Data2=ColourSwatch(SwatchColor=RGB(0, 255, 0)),
    Data3=ColourSwatch(SwatchColor=RGB(0, 0, 255)))  # -> graft(Result)
multiplication = Multiplication(A=entwine, B=num_2)
vdisex = VectorDisplayEx(Point=deplane.Origin, Vector=multiplication, Colour=merge, Width=2)
