# Grasshopper definition ZX_planB.gh (Grasshopper 1.0.8)

# ---- group: 底小頂大圓柱塔
python_3_script = Python3Script(
    rows=Slider(25, range=0..100),
    angle_degree=Slider(1, range=0..1),
    radius_bottom=Slider(150, range=0..1000),
    radius_top=Slider(320, range=0..1000),
    cols_bottom=Slider(3, range=0..100),
    cols_top=Slider(7, range=0..100))  # -> out, way_planes, geometries; inputs rows: Int32, angle_degree: Double, radius_bottom: Int32, radius_top: Int32, cols_bottom: Int32, cols_top: Int32
# ---------- python_3_script: Python ----------
# r: compas
# venv: mas-2526
from compas_rhino.devtools import DevTools
DevTools.ensure_path()

from compas.geometry import Frame, Vector, Point, Rotation
from brick_wall import BigBrick
import math


angle_step = math.radians(angle_degree)

bricks = []

for row in range(rows):
    t = row / (rows+1)
    radius_row = radius_bottom * (1 - t) + radius_top * t
    cols_row = max(1, int(cols_bottom * (1 - t) + cols_top * t))

    twist_angle = row * angle_step

    for col in range(cols_row):
        # angle_around = (2.0 * math.pi / cols_row) * (cols_top+cols_bottom)
        angle_around = (2* math.pi/cols_row)*col + (row % 2)/2*(2 * math.pi/cols_row)  #每層半磚交錯

        px = radius_row * math.cos(angle_around)
        py = radius_row * math.sin(angle_around)
        pz = row * BigBrick.HEIGHT

        center_pt = Point(px, py, pz)

        xaxis = Vector(-math.sin(angle_around), math.cos(angle_around), 0.0)
        zaxis = Vector(0.0, 0.0, 1.0)
        yaxis = zaxis.cross(xaxis)


        # --- 朝向中心點 ---
        # layer_center = Point(0, 0, pz)

        # # --- 朝向該層的中心點 ---
        # dir_to_layer_center = layer_center - center_pt   # 由磚中心指向該層中心
        # xaxis = dir_to_layer_center.unitized()           # X軸指向該層圓心
        # zaxis = Vector(0.0, 0.0, 1.0)
        # yaxis = zaxis.cross(xaxis)

        frame = Frame(center_pt, xaxis, yaxis)

        brick = BigBrick(frame)

        brick.rotate(math.degrees(twist_angle))

        bricks.append(brick)


# Visualize and store brick data
way_planes = []
geometries = []

for brick in bricks:
    geometries.append(brick.draw())
    way_planes.append(brick.get_pick_frame())
# ---------- end python_3_script ----------
draw = COMPASDraw(cg=python_3_script.way_planes)  # -> rg
#   port cg: The COMPAS geometry or datastructure to be drawn.
#   port rg: The Rhino geometry object.
# ---------- draw: Python ----------
# r: compas>=2.14.1
"""
Draws COMPAS geometry in Grasshopper.
"""

from typing import Any

import Grasshopper

from compas.scene import SceneObject


class CompasToRhinoGeometry(Grasshopper.Kernel.GH_ScriptInstance):
    def RunScript(self, cg):
        if not cg:
            return None

        return SceneObject(item=cg).draw()
# ---------- end draw ----------
draw_2 = COMPASDraw(cg=python_3_script.geometries)  # -> rg; same code as draw
