# Grasshopper definition wanchen_column_4corners.gh (Grasshopper 1.0.8)
# plug-ins: Robots

# ---- group: This is needed only ONCE in the GH definition
enable_auto_reload = Python3Script()  # -> ok
# ---------- enable_auto_reload: Python ----------
"""
------------------------------
Using VS Code as Python editor
------------------------------

The simplest way to start using VS Code as our editor, is
to place our Python code in files located IN THE SAME FOLDER as our Grasshopper file.

After we have done that, we need 2 steps: 

1. Enable the COMPAS reloader on one component. This tells Grasshopper to watch for changes in the Pythoh files and reload if changed.
2. Every other component that uses Python code from external files needs to start with a method to ensure Grasshopper knows where to load the files from.

"""
# r: compas
# venv: mas-2526

from compas_rhino.devtools import DevTools
DevTools.enable_reloader()
# ---------- end enable_auto_reload ----------

# ----
number_slider = Slider(0, range=0..1)
number_slider_2 = Slider(0, range=0..1)
number_slider_3 = Slider(0, range=0..1)
number_slider_4 = Slider(0, range=0..1)
number_slider_5 = Slider(4, range=0..10)
list = ValueList({"0", "90", "180", "270", "360"}, selected="180")
list_2 = ValueList({"0", "90", "180", "270", "360"}, selected="180")
list_3 = ValueList({"0", "90", "180", "270", "360"}, selected="180")
pt = ConstructPoint(XCoordinate=Slider(200, range=0..1000), YCoordinate=Slider(430, range=0..1000), ZCoordinate="0")
list_4 = ValueList({"0", "90", "180", "270", "360"}, selected="90")
py3 = Python3Script(
    segments=Slider(4, range=0..10),
    levels=Slider(38, range=0..100),
    gap_x=Slider(0, range=0..1),
    Max_rotation=list,
    offset_x=Slider(0, range=0..10),
    offset_y=Slider(0, range=0..10))  # -> out, bricks, frames; inputs segments: Int32, levels: Int32, gap_x: Double, Max_rotation: Int32, offset_x: Double
# ---------- py3: Python ----------
# r: compas
# venv: mas-226
from compas_rhino.devtools import DevTools
DevTools.ensure_path()

import math
import compas.geometry as cg
import ghpythonlib.treehelpers as th

from brick_wall import Brick

brick_x, brick_y, brick_z = Brick.LENGTH, Brick.WIDTH, Brick.HEIGHT
switch_height = levels/2  
angle_per_level = math.radians(Max_rotation)/switch_height


frames = []
bricks = []
#rotate center

# brick center
cx = (brick_x - brick_y + gap_x) - offset_x
cy = (brick_x - brick_y) + offset_y
centers = [
    cg.Point(cx, cy, 0),
    cg.Point(-cx, cy + (brick_x - brick_y)/2, 0),
    cg.Point(-cx -(brick_x - brick_y)/2, -cy + (brick_x - brick_y)/2, 0),
    cg.Point(cx -(brick_x - brick_y)/2 , -cy , 0)
]
print(centers)
base_angles = [math.pi/2, math.pi, math.radians(270),0]
for level in range(levels):
    # calculte rotate direction
    sign = 1 if level < switch_height else -1
    layer_angle = sign * level * angle_per_level
    z = level * brick_z

    for i, c in enumerate(centers):
        pos = cg.Point(c.x, c.y, z)
    
        angle = base_angles[i] + layer_angle
        
        #define brick frame
        
        x_dir = cg.Vector(math.cos(angle), math.sin(angle), 0)
        z_dir = cg.Vector(0, 0, 1)
        y_dir = z_dir.cross(x_dir)


        frame = cg.Frame(pos, x_dir, y_dir)
        brick = cg.Box(brick_x, brick_y, brick_z, frame)
        
        frame_brick = Brick.get_pick_frame(brick)
        bricks.append(brick)
        frames.append(frame_brick)
# ---------- end py3 ----------
py3_2 = Python3Script(
    segments=Slider(4, range=0..10),
    levels=Slider(38, range=0..100),
    gap_x=Slider(0, range=0..1),
    Max_rotation=list_2,
    offset_x=Slider(0, range=0..10),
    offset_y=Slider(0.69, range=0..10))  # -> out, bricks, frames; inputs segments: Int32, levels: Int32, gap_x: Double, Max_rotation: Int32, offset_x: Double
# ---------- py3_2: Python ----------
# r: compas
# venv: mas-226
from compas_rhino.devtools import DevTools
DevTools.ensure_path()

import math
import compas.geometry as cg
import ghpythonlib.treehelpers as th
from brick_wall import Brick


brick_x, brick_y, brick_z = Brick.LENGTH, Brick.WIDTH, Brick.HEIGHT
switch_height = levels / 2
angle_per_level = math.radians(Max_rotation) / switch_height

frames = []
bricks = []

# === 你提供的风车底层排法 ===
cx = (brick_x - brick_y + gap_x) - offset_x
cy = (brick_x - brick_y) + offset_y
centers = [
    cg.Point(cx, cy, 0),                                                # 右上
    cg.Point(-cx, cy + (brick_x - brick_y)/2, 0),                       # 左上
    cg.Point(-cx - (brick_x - brick_y)/2, -cy + (brick_x - brick_y)/2, 0),  # 左下
    cg.Point(cx - (brick_x - brick_y)/2, -cy, 0)                        # 右下
]
base_angles = [math.pi/2, math.pi, math.radians(270), 0]  # 对应每个砖的朝向


# === 分组（每两块砖一组）===
# 左上 + 左下 → Group A
# 右上 + 右下 → Group B
group_A_ids = [1, 2]
group_B_ids = [0, 3]

# 各组旋转中心（位于两块砖交接处靠外一点）
center_A = cg.Point(-cx - (brick_x - brick_y)/4, 0, 0)
center_B = cg.Point(cx + (brick_x - brick_y)/4, 0, 0)


# === 主循环 ===
for level in range(levels):
    z = level * brick_z

    # ---- 控制旋转角度：前半外张、后半回收 ----
    if level < switch_height:
        layer_angle = level * angle_per_level
    else:
        layer_angle = (levels - level - 1) * angle_per_level

    # ---- A组砖块（左侧两块）----
    for i in group_A_ids:
        c = centers[i]
        rel = c - center_A
        rot = cg.Rotation.from_axis_and_angle(cg.Vector(0, 0, 1), layer_angle)
        rel_rot = rel.transformed(rot)
        pos = center_A + rel_rot
        pos.z = z

        angle = base_angles[i] + layer_angle
        x_dir = cg.Vector(math.cos(angle), math.sin(angle), 0)
        z_dir = cg.Vector(0, 0, 1)
        y_dir = z_dir.cross(x_dir)

        frame = cg.Frame(pos, x_dir, y_dir)
        brick = cg.Box(brick_x, brick_y, brick_z, frame)
        frame_brick = Brick.get_pick_frame(brick)
        frames.append(frame_brick)
        bricks.append(brick)

    # ---- B组砖块（右侧两块）----
    for i in group_B_ids:
        c = centers[i]
        rel = c - center_B
        rot = cg.Rotation.from_axis_and_angle(cg.Vector(0, 0, 1), layer_angle)
        rel_rot = rel.transformed(rot)
        pos = center_B + rel_rot
        pos.z = z

        angle = base_angles[i] + layer_angle
        x_dir = cg.Vector(math.cos(angle), math.sin(angle), 0)
        z_dir = cg.Vector(0, 0, 1)
        y_dir = z_dir.cross(x_dir)

        frame = cg.Frame(pos, x_dir, y_dir)
        brick = cg.Box(brick_x, brick_y, brick_z, frame)
        frame_brick = Brick.get_pick_frame(brick)
        frames.append(frame_brick)
        bricks.append(brick)
# ---------- end py3_2 ----------
py3_3 = Python3Script(
    segments=Slider(4, range=0..10),
    levels=Slider(38, range=0..100),
    gap_x=Slider(0, range=0..1),
    Max_rotation=list_3,
    offset_x=Slider(0, range=0..10),
    offset_y=Slider(10, range=0..10))  # -> out, bricks, frames, center_A, center_B; inputs segments: Int32, levels: Int32, gap_x: Double, Max_rotation: Int32, offset_x: Double
# ---------- py3_3: Python ----------
# r: compas
# venv: mas-226
from compas_rhino.devtools import DevTools
DevTools.ensure_path()

import math
import compas.geometry as cg
import ghpythonlib.treehelpers as th
from brick_wall import Brick


brick_x, brick_y, brick_z = Brick.LENGTH, Brick.WIDTH, Brick.HEIGHT
switch_height = levels / 2  
angle_per_level = math.radians(Max_rotation) / switch_height

frames = []
bricks = []

# brick center point
cx = (brick_x - brick_y + gap_x) - offset_x
cy = (brick_x - brick_y) + offset_y
centers = [
    cg.Point(cx, cy, 0),                                                        # 右上
    cg.Point(-cx, cy + (brick_x - brick_y)/2, 0),                               # 左上
    cg.Point(-cx - (brick_x - brick_y)/2, -cy + (brick_x - brick_y)/2, 0),      # 左下
    cg.Point(cx - (brick_x - brick_y)/2, -cy, 0)                                # 右下
]
base_angles = [math.pi/2, math.pi, math.radians(270), 0]

# 2 groups
group_A_ids = [1, 2]   # 左上 + 左下
group_B_ids = [0, 3]   # 右上 + 右下

# rotate center
center_A = cg.Point(- (brick_x - brick_y)/2, (brick_x - brick_y)/2, 0)
center_B = cg.Point((brick_x - brick_y)/2, - (brick_x - brick_y)/2, 0)
print(center_A, center_B)
for level in range(levels):
    # rotate from outside to inside
    if level < switch_height:
        layer_angle = level * angle_per_level     # 向外旋转
    else:
        layer_angle = (levels - level - 1) * angle_per_level  # 向内旋转回去
    
    z = level * brick_z

    # === Group A ===
    for i in group_A_ids:
        c = centers[i]
        base_angle = base_angles[i]
        angle = base_angle + layer_angle
        cos_a, sin_a = math.cos(layer_angle), math.sin(layer_angle)

        # Rotate along Center A
        local_x = c.x - center_A.x
        local_y = c.y - center_A.y
        rotated_x = local_x * cos_a - local_y * sin_a
        rotated_y = local_x * sin_a + local_y * cos_a
        pos = cg.Point(rotated_x + center_A.x, rotated_y + center_A.y, z)

        x_dir = cg.Vector(math.cos(angle), math.sin(angle), 0)
        z_dir = cg.Vector(0, 0, 1)
        y_dir = z_dir.cross(x_dir)
        frame = cg.Frame(pos, x_dir, y_dir)

        brick = cg.Box(brick_x, brick_y, brick_z, frame)
        frames.append(Brick.get_pick_frame(brick))
        bricks.append(brick)

    # === Group B ===
    for i in group_B_ids:
        c = centers[i]
        base_angle = base_angles[i]
        angle = base_angle + layer_angle
        cos_a, sin_a = math.cos(layer_angle), math.sin(layer_angle)

        # Rotate along Center B
        local_x = c.x - center_B.x
        local_y = c.y - center_B.y
        rotated_x = local_x * cos_a - local_y * sin_a
        rotated_y = local_x * sin_a + local_y * cos_a
        pos = cg.Point(rotated_x + center_B.x, rotated_y + center_B.y, z)

        x_dir = cg.Vector(math.cos(angle), math.sin(angle), 0)
        z_dir = cg.Vector(0, 0, 1)
        y_dir = z_dir.cross(x_dir)
        frame = cg.Frame(pos, x_dir, y_dir)

        brick = cg.Box(brick_x, brick_y, brick_z, frame)
        frames.append(Brick.get_pick_frame(brick))
        bricks.append(brick)
# ---------- end py3_3 ----------
# Generate Geometry
windwill_tower = Python3Script(
    segments=Slider(4, range=0..10),
    levels=Slider(28, range=0..100),
    gap=Slider(0, range=0..1),
    Max_rotation=Slider(100, range=0..1000),
    offset_x=Slider(3, range=0..100),
    offset_y=Slider(3.89, range=0..100),
    Pt_start=pt,
    Shrink_factor=Slider(0.5, range=0..1))  # -> out, bricks, frames, center_A, center_B; inputs segments: Int32, levels: Int32, gap: Double, Max_rotation: Int32, offset_x: Double, Pt_start: Point3d, Shrink_factor: Double
# ---------- windwill_tower: Python ----------
# r: compas
# venv: mas-226
from compas_rhino.devtools import DevTools
DevTools.ensure_path()
from compas_rhino.conversions import point_to_compas

import math
import compas.geometry as cg
import ghpythonlib.treehelpers as th
from brick_wall import Brick


bx, by, bz = Brick.LENGTH, Brick.WIDTH, Brick.HEIGHT
switch_height = levels / 2  
angle_per_level = math.radians(Max_rotation) / switch_height

frames = []
bricks = []
pt = point_to_compas(Pt_start)
# brick center point
#cx = (brick_x - brick_y + gap_x) - offset_x
#cy = (brick_x - brick_y) + offset_y
centers = [
    cg.Point(pt.x + bx/2, pt.y - by/2 - offset_y, 0), # 左上
    cg.Point(pt.x + by/2, pt.y + bx/2, 0), # 左下
    cg.Point(pt.x + by+bx/2 + offset_x, pt.y + by/2, 0), # 右下
    cg.Point(pt.x + bx+by/2 + offset_x, pt.y -by - offset_y, 0) # 右上
]
base_angles = [0, math.pi/2, math.pi, math.radians(270)]

# 2 groups
group_A_ids = [0, 3]   # 左上 + 左下
group_B_ids = [1, 2]   # 右下 + 右上

# rotate center
center_A = cg.Point(pt.x + bx, pt.y - gap - offset_y, 0)
center_B = cg.Point(pt.x + by, pt.y - gap, 0)

for level in range(levels):
    # staggered layers
    #offset_shift = (bx/8 if level % 2 == 1 else 0)
    # rotate from outside to inside
    if level < switch_height:
        layer_angle = level * angle_per_level     # 向外旋转
    else:
        layer_angle = (levels - level - 1) * angle_per_level  # 向内旋转回去
    
    z = level * bz
    #extra_angle = 0
    #if (level+1) % 6 == 0:
        #extra_angle = math.radians(90)
    
    # === Group A ===
    for i in group_A_ids:
        c = centers[i]
        base_angle = base_angles[i]
        angle = base_angle + layer_angle 
        cos_a, sin_a = math.cos(layer_angle), math.sin(layer_angle)

        # Rotate along Center A
        local_x = c.x - center_A.x
        local_y = c.y - center_A.y
        rotated_x = local_x * cos_a - local_y * sin_a
        rotated_y = local_x * sin_a + local_y * cos_a
        pos = cg.Point(rotated_x + center_A.x, rotated_y + center_A.y, z)

        x_dir = cg.Vector(math.cos(angle), math.sin(angle), 0)
        z_dir = cg.Vector(0, 0, 1)
        y_dir = z_dir.cross(x_dir)
        frame = cg.Frame(pos, x_dir, y_dir)

        brick = cg.Box(bx, by, bz, frame)
        frames.append(Brick.get_pick_frame(brick))
        bricks.append(brick)

    # === Group B ===
    for i in group_B_ids:
        c = centers[i]
        base_angle = base_angles[i]
        angle = base_angle + layer_angle 
        cos_a, sin_a = math.cos(layer_angle), math.sin(layer_angle)

        # Rotate along Center B
        local_x = c.x - center_B.x
        local_y = c.y - center_B.y
        rotated_x = local_x * cos_a - local_y * sin_a
        rotated_y = local_x * sin_a + local_y * cos_a
        pos = cg.Point(rotated_x + center_B.x, rotated_y + center_B.y, z)

        x_dir = cg.Vector(math.cos(angle), math.sin(angle), 0)
        z_dir = cg.Vector(0, 0, 1)
        y_dir = z_dir.cross(x_dir)
        frame = cg.Frame(pos, x_dir, y_dir)

        brick = cg.Box(bx, by, bz, frame)
        frames.append(Brick.get_pick_frame(brick))
        bricks.append(brick)
# ---------- end windwill_tower ----------
windmill_tower = Python3Script(
    segments=number_slider_5,
    offsets=Slider(0, range=0..20),
    levels=Slider(19, range=0..50),
    Max_rotation=list_4,
    tolorence_xy=Slider(1, range=0..1),
    tolorence_z=Slider(0, range=0..1))  # -> out, bricks, frames; inputs segments: Int32, offsets: Double, levels: Int32, Max_rotation: Double, tolorence_xy: Double, tolorence_z: Double
# ---------- windmill_tower: Python ----------
# r: compas
# venv: mas-226
from compas_rhino.devtools import DevTools
DevTools.ensure_path()

import compas.geometry as cg
import ghpythonlib.treehelpers as th
import math

from brick_wall import Brick

#----#
x, y, z = Brick.LENGTH, Brick.WIDTH, Brick.HEIGHT

frames = []
bricks = []
for i in range(levels):
    centroid = cg.Point(0, 0, i*z)
    pt2 = cg.Point(x, y, i*z)

    frames_branch = []
    bricks_branch = []
    for j in range(segments):
        # Create Original Brick
        brick = cg.Box.from_corner_corner_height(centroid, pt2, z)
        # Add Tolorence
        brick.translate([tolorence_xy, tolorence_xy, 0])
        # Offset Original Brick
        brick.translate([-offsets, offsets, 0])

        # Rotate Brick
        radian = (2*math.pi) / segments * j
        brick.rotate(radian)    
        # Rotate Unit(Brick*segment counts)
        angle = (math.radians(Max_rotation)) / (levels-1) * i
        brick.rotate(angle)

        # Get Frames
        frame = Brick.get_pick_frame(brick)

        frames_branch.append(frame)
        bricks_branch.append(brick)

    frames.append(frames_branch)
    bricks.append(bricks_branch)


frames = th.list_to_tree(frames)
bricks = th.list_to_tree(bricks)
# ---------- end windmill_tower ----------
py3_4 = Python3Script(
    segments=Slider(4, range=0..10),
    levels=Slider(28, range=0..100),
    gap_x=Slider(0, range=0..1),
    Max_rotation=Slider(72, range=0..100),
    offset_x=Slider(3.85, range=0..10),
    offset_y=Slider(0.69, range=0..10))  # -> out, bricks, frames; inputs segments: Int32, levels: Int32, gap_x: Double, Max_rotation: Int32, offset_x: Double
# ---------- py3_4: Python ----------
# r: compas
# venv: mas-226
from compas_rhino.devtools import DevTools
DevTools.ensure_path()

import math
import compas.geometry as cg
import ghpythonlib.treehelpers as th
from brick_wall import Brick

brick_x, brick_y, brick_z = Brick.LENGTH, Brick.WIDTH, Brick.HEIGHT
switch_height = levels / 2
angle_per_level = math.radians(Max_rotation) / switch_height

frames = []
bricks = []

# center point
cx = (brick_x - brick_y + gap_x) - offset_x
cy = (brick_x - brick_y) + offset_y
centers = [
    cg.Point(cx, cy, 0),                                                        # 右上
    cg.Point(-cx, cy + (brick_x - brick_y)/2, 0),                               # 左上
    cg.Point(-cx - (brick_x - brick_y)/2, -cy + (brick_x - brick_y)/2, 0),      # 左下
    cg.Point(cx - (brick_x - brick_y)/2, -cy, 0)                                # 右下
]
base_angles = [math.pi/2, math.pi, math.radians(270), 0]

# rotate center
center_O = cg.Point(0, 0, 0)

for level in range(levels):
    # rotate logic from outside to inside
    if level < switch_height:
        layer_angle = level * angle_per_level
    else:
        layer_angle = (levels - level - 1) * angle_per_level

    z = level * brick_z

    extra_angle = 0
    if (level+1) % 6 == 0:
        extra_angle = math.radians(45)

    # all bricks rotate
    for i, c in enumerate(centers):
        base_angle = base_angles[i]
        angle = base_angle + layer_angle + extra_angle    

        cos_a, sin_a = math.cos(layer_angle), math.sin(layer_angle)

        # rotate along center
        local_x = c.x - center_O.x
        local_y = c.y - center_O.y
        rotated_x = local_x * cos_a - local_y * sin_a
        rotated_y = local_x * sin_a + local_y * cos_a
        pos = cg.Point(rotated_x + center_O.x, rotated_y + center_O.y, z)

        # define rotate direction
        x_dir = cg.Vector(math.cos(angle), math.sin(angle), 0)
        z_dir = cg.Vector(0, 0, 1)
        y_dir = z_dir.cross(x_dir)

        

        frame = cg.Frame(pos, x_dir, y_dir)
        brick = cg.Box(brick_x, brick_y, brick_z, frame)

        frames.append(Brick.get_pick_frame(brick))
        bricks.append(brick)
# ---------- end py3_4 ----------
windmill_tower_2 = Python3Script(segments=number_slider_5)  # -> out, bricks, frames; inputs segments: Int32
# ---------- windmill_tower_2: Python ----------
# r: compas
# venv: mas-226
from compas_rhino.devtools import DevTools
DevTools.ensure_path()

import compas.geometry as cg
import ghpythonlib.treehelpers as th
import math

from brick_wall import Brick

#----#
from compas_rhino.devtools import DevTools
DevTools.ensure_path()

import compas.geometry as cg
import ghpythonlib.treehelpers as th
import math
from brick_wall import Brick

# ---- 基本参数 ---- #
x, y, z = Brick.LENGTH, Brick.WIDTH, Brick.HEIGHT

levels = 15                            # 上半层数，下半会镜像
rotation_per_level = math.radians(10)  # 每层旋转角度

# ⬇️ 控制底面矩形比例
radius_x = 3 * x   # X方向的半径（控制矩形长边）
radius_y = 2 * x   # Y方向的半径（控制矩形短边）

frames = []
bricks = []

# ---- 生成上下两部分 ---- #
for direction in [1, -1]:  # 上下两部分：1=上, -1=下
    for i in range(levels):
        z_height = direction * i * z
        level_angle = direction * i * rotation_per_level

        frames_branch = []
        bricks_branch = []

        for j in range(4):  # 每层四块砖
            base_angle = j * math.pi / 2
            angle = level_angle + base_angle

            # 根据角度和矩形比例生成位置
            pos = cg.Point(math.cos(angle) * radius_x,
                           math.sin(angle) * radius_y,
                           z_height)

            # 砖块朝外的方向（单位向量）
            xaxis = cg.Vector(math.cos(angle), math.sin(angle), 0)
            frame = cg.Frame(pos, xaxis, cg.Vector(0, 0, 1))

            # 生成砖体
            brick = cg.Box(x, y, z, frame)

            frames_branch.append(frame)
            bricks_branch.append(brick)

        frames.append(frames_branch)
        bricks.append(bricks_branch)

# ---- 输出到Grasshopper ---- #
frames = th.list_to_tree(frames)
bricks = th.list_to_tree(bricks)
# ---------- end windmill_tower_2 ----------
compas_draw = COMPASDraw(cg=windmill_tower_2.bricks)  # -> rg
#   port cg: The COMPAS geometry or datastructure to be drawn.
#   port rg: The Rhino geometry object.
# ---------- compas_draw: Python ----------
# r: compas>=2.14.1
"""
Draws COMPAS geometry in Grasshopper.
"""

from typing import Any

import Grasshopper

from compas.scene import SceneObject


class CompasToRhinoGeometry(Grasshopper.Kernel.GH_ScriptInstance):
    def RunScript(self, cg):
        if not cg:
            return None

        return SceneObject(item=cg).draw()
# ---------- end compas_draw ----------
compas_draw_2 = COMPASDraw(cg=py3.frames)  # -> rg; same code as compas_draw
compas_draw_3 = COMPASDraw(cg=py3.bricks)  # -> rg; same code as compas_draw
number_slider_6 = Slider(6, range=0..100)
compas_draw_4 = COMPASDraw(cg=py3_2.frames)  # -> rg; same code as compas_draw
compas_draw_5 = COMPASDraw(cg=py3_2.bricks)  # -> rg; same code as compas_draw
compas_draw_6 = COMPASDraw(cg=py3_3.center_B)  # -> rg; same code as compas_draw
compas_draw_7 = COMPASDraw(cg=py3_3.center_A)  # -> rg; same code as compas_draw
compas_draw_8 = COMPASDraw(cg=windwill_tower.center_B)  # -> rg; same code as compas_draw
compas_draw_9 = COMPASDraw(cg=windwill_tower.center_A)  # -> rg; same code as compas_draw
preview = CustomPreview(
    Geometry=compas_draw_3,
    Material={diffuse=RGB(221, 160, 221), emission=RGB(66, 48, 66), shine=0.5, specular=RGB(255, 255, 255), transparency=0})
number_slider_7 = Slider(6, range=0..100)
compas_draw_10 = COMPASDraw(cg=py3_4.frames)  # -> rg; same code as compas_draw
compas_draw_11 = COMPASDraw(cg=py3_4.bricks)  # -> rg; same code as compas_draw
preview_2 = CustomPreview(
    Geometry=compas_draw_5,
    Material={diffuse=RGB(221, 160, 221), emission=RGB(66, 48, 66), shine=0.5, specular=RGB(255, 255, 255), transparency=0})
compas_draw_12 = COMPASDraw(cg=windmill_tower_2.frames)  # -> rg; same code as compas_draw
python_3_script = Python3Script(x=py3.frames)  # -> out, a; inputs x: list
# ---------- python_3_script: Python ----------
from compas_rhino.conversions import frame_to_rhino_plane

a = [frame_to_rhino_plane(f) for f in x]
# ---------- end python_3_script ----------
compas_draw_13 = COMPASDraw(cg=windmill_tower.frames)  # -> rg; same code as compas_draw
number_slider_8 = Slider(6, range=0..100)
compas_draw_14 = COMPASDraw(cg=py3_3.frames)  # -> rg; same code as compas_draw
compas_draw_15 = COMPASDraw(cg=py3_3.bricks)  # -> rg; same code as compas_draw
python_3_script_2 = Python3Script(x=py3_2.frames)  # -> out, a; inputs x: list; same code as python_3_script
number_slider_9 = Slider(6, range=0..100)
compas_draw_16 = COMPASDraw(cg=windmill_tower.bricks)  # -> rg; same code as compas_draw
preview_3 = CustomPreview(
    Geometry=compas_draw_16,
    Material={diffuse=RGB(221, 160, 221), emission=RGB(66, 48, 66), shine=0.5, specular=RGB(255, 255, 255), transparency=0})
python_3_script_3 = Python3Script(x=windmill_tower.frames)  # -> out, a; inputs x: list; same code as python_3_script
compas_draw_17 = COMPASDraw(cg=windwill_tower.frames)  # -> rg; same code as compas_draw
compas_draw_18 = COMPASDraw(cg=windwill_tower.bricks)  # -> rg; same code as compas_draw
preview_4 = CustomPreview(
    Geometry=compas_draw_11,
    Material={diffuse=RGB(221, 160, 221), emission=RGB(66, 48, 66), shine=0.5, specular=RGB(255, 255, 255), transparency=0})
python_3_script_4 = Python3Script(x=py3_4.frames)  # -> out, a; inputs x: list; same code as python_3_script
preview_5 = CustomPreview(
    Geometry=compas_draw_15,
    Material={diffuse=RGB(221, 160, 221), emission=RGB(66, 48, 66), shine=0.5, specular=RGB(255, 255, 255), transparency=0})
preview_6 = CustomPreview(
    Geometry=compas_draw_18,
    Material={diffuse=RGB(221, 160, 221), emission=RGB(66, 48, 66), shine=0.5, specular=RGB(255, 255, 255), transparency=0})
python_3_script_5 = Python3Script(x=py3_3.frames)  # -> out, a; inputs x: list; same code as python_3_script
python_3_script_6 = Python3Script(x=windwill_tower.frames)  # -> out, a; inputs x: list; same code as python_3_script
points = PointList(Points=python_3_script.a, Size=Slider(6, range=0..100))
points_2 = PointList(Points=python_3_script_3.a, Size=Slider(6, range=0..100))
fine_adjust_z_mm = Slider(5, range=-5..10)
pt_2 = ConstructPoint(XCoordinate="109.25", YCoordinate="464.14", ZCoordinate="5.11")
pt_3 = ConstructPoint(XCoordinate="462.19", YCoordinate="-132.33", ZCoordinate="5.03")
# Transform from Rhino to Robot Space
pt_4 = ConstructPoint(XCoordinate="462.03", YCoordinate="465.66", ZCoordinate="4.05")
compas = Python3Script(
    way_planes=windwill_tower.frames,
    wobj_origin=pt_4,
    wobj_xaxis=pt_2,
    wobj_xypoint=pt_3,
    z_safe_margin=fine_adjust_z_mm,
    lift_height=Slider(400, range=0..1000))  # -> out, transformed_planes; inputs way_planes: list, wobj_origin: Point3d, wobj_xaxis: Point3d, wobj_xypoint: Point3d, z_safe_margin: Double
# ---------- compas: Python ----------
import compas.geometry as cg

#in this step we transform our way planes to robot space
#the rhino co-ordinate system is rather abstract in the physical world
#the robot base plane assumed the base frame of robot is the origin
#but rhino does not know that
#thus we transform things from our design space(Rhino World XY) to Robot Base Plane that we measure

def set_robot_base(origin, xaxis, xypoint):
    """
    set a base plane representing the robot working object plane
    """
    robot_base = cg.Frame(origin, xaxis - origin, xypoint - origin)
    print (robot_base)
    return (robot_base)

def rhino_to_robot_space(rhino_plane,robot_base_plane):
    """
    Transform the objects from Rhino world XY plane to robot work object plane
    """
    T_matrix = cg.Transformation.from_frame_to_frame(cg.Frame.worldXY(), robot_base_plane)
    robot_plane = rhino_plane.transformed(T_matrix)
    return robot_plane

def set_z_safe_margin(planes_to_adjust, safety_margin):
    adjusted = []
    T = cg.Translation.from_vector(cg.Vector(0, 0, safety_margin))
    for f in planes_to_adjust:
        adjusted.append(f.transformed(T))
    return adjusted

# ===== Robot base is set =====
robot_base =  set_robot_base(wobj_origin, wobj_xaxis, wobj_xypoint)
print(robot_base)

# ===== Set safety margin for Z height ======
safe_planes = set_z_safe_margin(way_planes, z_safe_margin)

# ===== Transforming the rhino planes into robot planes =====
transformed_planes = []

for plane in safe_planes:
    transformed_planes.append(rhino_to_robot_space(plane, robot_base))
# ---------- end compas ----------
compas_draw_19 = COMPASDraw(cg=compas.transformed_planes)  # -> rg; same code as compas_draw
pt_5 = ConstructPoint(XCoordinate="-19.50", YCoordinate="420.44", ZCoordinate="39.88")
pt_6 = ConstructPoint(XCoordinate="-30.43", YCoordinate="437.50", ZCoordinate="54.20")
pt_7 = ConstructPoint(XCoordinate="-23.74", YCoordinate="438.89", ZCoordinate="47.56")

pt_8 = ConstructPoint(XCoordinate="-2.72", YCoordinate="4.86", ZCoordinate="88.08")

py3_5 = Python3Script(origin=pt_7, xaxis_pt=pt_5, xy_pt=pt_6)  # -> out, pick_frame; inputs origin: Point3d, xaxis_pt: Point3d, xy_pt: Point3d
# ---------- py3_5: Python ----------
from compas.geometry import Frame, Point
from compas.geometry import Rotation

from compas_rhino.conversions import point_to_compas

origin = point_to_compas(origin)
xaxis_pt = point_to_compas(xaxis_pt)
xy_pt = point_to_compas(xy_pt)

#define pick frame
pick_frame = Frame(origin, xaxis_pt - origin, xy_pt - origin)
# ---------- end py3_5 ----------
compas_draw_20 = COMPASDraw(cg=py3_5.pick_frame)  # -> rg; same code as compas_draw
# Convert Planes to URScript
number_slider_10 = Slider(1, range=0..5)
number_slider_11 = Slider(1.4, range=0..5)
compas_2 = Python3Script(
    way_frames=compas.transformed_planes,
    tcp_measured=pt_8,
    acceleration=number_slider_10,
    velocity=number_slider_11,
    pick_frame=py3_5.pick_frame)  # -> out, vis_frames, vis_planes, script; inputs way_frames: list, tcp_measured: Point3d, acceleration: Double, velocity: Double
# ---------- compas_2: Python ----------
from imp import reload
import sys
import os

#get current file path
path = ghenv.Component.OnPingDocument().FilePath
#get parent directory of the parent directory
parentdir = os.path.dirname(path)
#get src folder which contains classes
dire = os.path.join(parentdir,'src')

sys.path.append(dire)

import simple_ur_script as ur
reload(ur)

import utils 
reload(utils)

import simple_comm as com
reload(com)

import compas.geometry as cg
import math as m

# ===== Set global constants =======

IO = 4 #Global constant
SAFE_DIST = 50

# =================================

script = "" #create empty string

def pickup_brick(script,pick_up_frame):
    frames = []
    
    safe_pick_up_frame = pick_up_frame.translated(-pick_up_frame.normal*SAFE_DIST)
    
    ## add to the path: go to the safe plane
    script += ur.move_l(safe_pick_up_frame, acceleration, velocity)
    frames.append(safe_pick_up_frame)
    
    ## add to the path: go to the pick up plane
    script += ur.move_l(pick_up_frame, acceleration, velocity)
    frames.append(pick_up_frame)
    
    ## add to the path: turn on the vacuum and wait 1 sec.
    script += ur.set_digital_out(IO,True)
    script += ur.sleep(1)

    # add to the path: go back to the safe_plane
    script += ur.move_l(safe_pick_up_frame, acceleration, velocity)
    frames.append(safe_pick_up_frame)
    
    return script, frames


def place_brick(script, place_frame):
    
    frames = []
    
    safe_place_frame = place_frame.translated(cg.Vector(0,0,1)*SAFE_DIST)
    
    # add to the path: go to the safe plane
    script += ur.move_l(safe_place_frame, acceleration, velocity)
    frames.append(safe_place_frame)
    
    # add to the path: go to the place plane
    script += ur.move_l(place_frame, acceleration, velocity)
    frames.append(place_frame)
    
    ## add to the path: turn off the vacuum and wait 1 second (hold the brick)
    script += ur.set_digital_out(IO,False)
    script += ur.sleep(1)
    
    # add to the path: go back to the safe plane
    script += ur.move_l(safe_place_frame, acceleration, velocity)
    frames.append(safe_place_frame)
    
    return script,frames


#if value given for tcp measured, then add line to script, otherwise it will take current tcp from robot
if tcp_measured is not None:
    script += ur.set_tcp_by_angles(tcp_measured.X, tcp_measured.Y, tcp_measured.Z, m.radians(0.0),m.radians(0.0),m.radians(0))


vis_frames = []
#add move_l commands in sequence to script for each way plane
for brick_frame in way_frames:
    script, p = pickup_brick(script,pick_frame)
    vis_frames.extend(p) #only to visualize the planes
    script, p = place_brick(script,brick_frame)
    vis_frames.extend(p)


#format the script to make it sendable
script = com.concatenate_script(script)

from compas_rhino import conversions
import Rhino.Geometry as rg

vis_planes = [conversions.frame_to_rhino(frame) for frame in vis_frames]
# ---------- end compas_2 ----------

# ----
# Robot Visulization
number_slider_12 = Slider(1, range=0..1)
list_5 = RobotsLibrary({"ETH-Gantry", "UR3e", "UR5e", "UR10e", "UR16e", "UR3", "UR5", "UR10", "UR20", "UR30"}, selected="UR5", Type=0)
setdo = SetDO(DO=number_slider_12, Value=Toggle(False))
loadrobot = LoadRobotSystem(Name=list_5, Base=PlaneXY(0, 0, 0))
tool = CreateTool(Name="DefaultGHTool", TCP=pt_8, Weight=Slider(1.5, range=0..10))  # -> Tool, TCP
target = CreateTarget(Plane=compas_2.vis_planes, Tool=tool.Tool, IsCartesian=True)
program = CreateProgram(Name="DefaultProgram", RobotSystem=loadrobot, Targets=target, InitCommands=setdo, StepSize=1)  # -> Program, Code, Duration, Warnings, Errors
sim = ProgramSimulation(Program=program.Program, Time=Slider(0.25, range=0..1), Normalized=True)  # -> SystemMeshes, JointRotations, Plane, Index, Time, Program, Errors

points_3 = PointList(Points=compas_2.vis_planes, Size=Slider(3, range=0..100))
compas_draw_21 = COMPASDraw(cg=compas_2.vis_frames)  # -> rg; same code as compas_draw
pline = PolyLine(Vertices=compas_2.vis_planes, Closed=False)
panel = Panel(compas_2.script)

# ---- group: Send UR script to Robot!
# Send to Robot!
py3_6 = Python3Script(script=compas_2.script, ip_address="192.168.10.10", send=Button())  # -> out, a; inputs script: String, ip_address: String, send: Boolean
# ---------- py3_6: Python ----------
import simple_comm as com

if send:
    com.send_script(script,ip_address)
# ---------- end py3_6 ----------
