# Grasshopper definition wanchen_wavy.gh (Grasshopper 1.0.8)
# plug-ins: Robots

# ---- group: This is needed only ONCE in the GH definition
enable_auto_reload = Python3Script()  # -> ok
# ---------- enable_auto_reload: Python ----------
"""
------------------------------
Using VS Code as Python editor
------------------------------

The simplest way to start using VS Code as our editor, is
to place our Python code in files located IN THE SAME FOLDER as our Grasshopper file.

After we have done that, we need 2 steps: 

1. Enable the COMPAS reloader on one component. This tells Grasshopper to watch for changes in the Pythoh files and reload if changed.
2. Every other component that uses Python code from external files needs to start with a method to ensure Grasshopper knows where to load the files from.

"""
# r: compas
# venv: mas-2526

from compas_rhino.devtools import DevTools
DevTools.enable_reloader()
# ---------- end enable_auto_reload ----------

# ----
gap = Slider(2.5, range=0..10)
attractor_point = Point(Point(172.1222425, -142.7513646, 130.9570846))
# Generate Geometry
curve = Curve(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)
brick_wall = Python3Script(
    crv=curve,
    num_layers=Slider(6, range=0..30),
    gap=gap,
    attractor=attractor_point,
    freq=Slider(2, range=0..10),
    amp=Slider(50, range=0..100),
    amp_layers=Slider(4, range=0..10),
    phase=Slider(0, range=0..10))  # -> bricks, geometries, way_planes; inputs crv: Curve, num_layers: Int32, gap: Double, attractor: Point3d, freq: Int32, amp: Int32, amp_layers: Int32, phase: Int32
# ---------- brick_wall: Python ----------
# r: compas
# venv: mas-2526
from compas_rhino.devtools import DevTools
DevTools.ensure_path()

#from compas_ghpython.utilities import list_to_ghtree, ghtree_to_list
from ghpythonlib.treehelpers import list_to_tree, tree_to_list

from compas_rhino.conversions import frame_to_rhino_plane

# 0. Import everything we will need
import math
from compas.geometry import Box
from compas.geometry import Point
from compas.geometry import Frame
from compas.geometry import cross_vectors
from compas_rhino.conversions import curve_to_compas
from compas_rhino.conversions import point_to_compas


# ..also import our module "brick_wall.py", that needs to be in the same folder as our GH file
from brick_wall import Brick

attractor = point_to_compas(attractor)

# 1. Start with an empty list of bricks to be created
#    make sure to match the name of this list to the output of this component!
bricks = []

# 2. Create points on each curve
curve = curve_to_compas(crv)
print(curve.length())

# divide curve twice as fine
num_divs = int(curve.length() / (Brick.LENGTH+gap)) * 2
params, div_pts = curve.divide_by_count(num_divs, True)



def remap(val, old_min, old_max, new_min, new_max):
    return (new_max - new_min) * (val - old_min) / (old_max - old_min) + new_min

for col, param in enumerate(params):
    pt = curve.point_at(param)
    tangent = curve.tangent_at(param)
    normal = cross_vectors(tangent, [0,0,1])
    wave_h = remap(col, 0, len(params)-1, 0,1)
    dist = attractor.distance_to_point(pt)
    wave_val = math.sin(wave_h * freq * 2 * math.pi+ phase) 
    wave_val = wave_val + 1

    total_layers = int(num_layers + amp_layers* wave_val)
    for i in range(total_layers):
        z_extra = Brick.HEIGHT * i
        pt_extra = pt.translated([0, 0, z_extra]) 

        if (num_layers + i) % 2 == 0:  
            if col % 2 == 0:
                b_extra = Brick(frame=Frame(pt_extra, tangent, normal))
                b_extra.param = param
                bricks.append(b_extra)
        else:
            if col % 2 == 1:
                b_extra = Brick(frame=Frame(pt_extra, tangent, normal))
                b_extra.param = param 
                bricks.append(b_extra)

# Get all heights            
heights = [round(brick.frame.point.z / Brick.HEIGHT, 3) for brick in bricks]

# Get unique heights and sort
unique_heights = sorted(list(set(heights)))  # from smallest to largest height

# Collect bricks in rows
sorted_bricks = []
for h in unique_heights:
    # Find all bricks at the current height
    row_bricks = [b for b, z in zip(bricks, heights) if z == h]
    # Sort by column order
    row_bricks.sort(key=lambda b: b.param)  # Sort column by x
    sorted_bricks.extend(row_bricks)
geometries = [b.draw() for b in sorted_bricks]
way_planes = [b.get_pick_frame() for b in sorted_bricks]
# ---------- end brick_wall ----------
panel = Panel(brick_wall.way_planes)
compas_draw = COMPASDraw(cg=brick_wall.geometries)  # -> rg
#   port cg: The COMPAS geometry or datastructure to be drawn.
#   port rg: The Rhino geometry object.
# ---------- compas_draw: Python ----------
# r: compas>=2.14.1
"""
Draws COMPAS geometry in Grasshopper.
"""

from typing import Any

import Grasshopper

from compas.scene import SceneObject


class CompasToRhinoGeometry(Grasshopper.Kernel.GH_ScriptInstance):
    def RunScript(self, cg):
        if not cg:
            return None

        return SceneObject(item=cg).draw()
# ---------- end compas_draw ----------
compas_draw_2 = COMPASDraw(cg=brick_wall.way_planes)  # -> rg; same code as compas_draw
python_3_script = Python3Script(x=brick_wall.way_planes)  # -> out, a; inputs x: list
# ---------- python_3_script: Python ----------
from compas_rhino.conversions import frame_to_rhino_plane

a = [frame_to_rhino_plane(f) for f in x]
# ---------- end python_3_script ----------
points = PointList(Points=python_3_script.a, Size=Slider(6, range=0..100))
fine_adjust_z_mm = Slider(5, range=-5..10)
pt = ConstructPoint(XCoordinate="109.25", YCoordinate="464.14", ZCoordinate="5.11")
pt_2 = ConstructPoint(XCoordinate="462.19", YCoordinate="-132.33", ZCoordinate="5.03")
# Transform from Rhino to Robot Space
pt_3 = ConstructPoint(XCoordinate="462.03", YCoordinate="465.66", ZCoordinate="4.05")
compas = Python3Script(way_planes=brick_wall.way_planes, wobj_origin=pt_3, wobj_xaxis=pt, wobj_xypoint=pt_2, z_safe_margin=fine_adjust_z_mm)  # -> out, transformed_planes; inputs way_planes: list, wobj_origin: Point3d, wobj_xaxis: Point3d, wobj_xypoint: Point3d, z_safe_margin: Double
# ---------- compas: Python ----------
import compas.geometry as cg

#in this step we transform our way planes to robot space
#the rhino co-ordinate system is rather abstract in the physical world
#the robot base plane assumed the base frame of robot is the origin
#but rhino does not know that
#thus we transform things from our design space(Rhino World XY) to Robot Base Plane that we measure

def set_robot_base(origin, xaxis, xypoint):
    """
    set a base plane representing the robot working object plane
    """
    robot_base = cg.Frame(origin, xaxis - origin, xypoint - origin)
    print (robot_base)
    return (robot_base)

def rhino_to_robot_space(rhino_plane,robot_base_plane):
    """
    Transform the objects from Rhino world XY plane to robot work object plane
    """
    T_matrix = cg.Transformation.from_frame_to_frame(cg.Frame.worldXY(), robot_base_plane)
    robot_plane = rhino_plane.transformed(T_matrix)
    return robot_plane

def set_z_safe_margin(planes_to_adjust, safety_margin):
    adjusted = []
    T = cg.Translation.from_vector(cg.Vector(0, 0, safety_margin))
    for f in planes_to_adjust:
        adjusted.append(f.transformed(T))
    return adjusted

# ===== Robot base is set =====
robot_base =  set_robot_base(wobj_origin, wobj_xaxis, wobj_xypoint)
print(robot_base)

# ===== Set safety margin for Z height ======
safe_planes = set_z_safe_margin(way_planes, z_safe_margin)

# ===== Transforming the rhino planes into robot planes =====
transformed_planes = []
for plane in safe_planes: 
    transformed_planes.append(rhino_to_robot_space(plane, robot_base))
# ---------- end compas ----------
compas_draw_3 = COMPASDraw(cg=compas.transformed_planes)  # -> rg; same code as compas_draw
pt_4 = ConstructPoint(XCoordinate="-19.50", YCoordinate="420.44", ZCoordinate="39.88")
pt_5 = ConstructPoint(XCoordinate="-30.43", YCoordinate="437.50", ZCoordinate="54.20")
pt_6 = ConstructPoint(XCoordinate="-23.74", YCoordinate="438.89", ZCoordinate="47.56")

pt_7 = ConstructPoint(XCoordinate="-2.72", YCoordinate="4.86", ZCoordinate="88.08")

py3 = Python3Script(origin=pt_6, xaxis_pt=pt_4, xy_pt=pt_5)  # -> out, pick_frame; inputs origin: Point3d, xaxis_pt: Point3d, xy_pt: Point3d
# ---------- py3: Python ----------
from compas.geometry import Frame, Point
from compas.geometry import Rotation

from compas_rhino.conversions import point_to_compas

origin = point_to_compas(origin)
xaxis_pt = point_to_compas(xaxis_pt)
xy_pt = point_to_compas(xy_pt)

#define pick frame
pick_frame = Frame(origin, xaxis_pt - origin, xy_pt - origin)
# ---------- end py3 ----------
compas_draw_4 = COMPASDraw(cg=py3.pick_frame)  # -> rg; same code as compas_draw
# Convert Planes to URScript
number_slider = Slider(0.5, range=0..1)
number_slider_2 = Slider(0.5, range=0..1)
compas_2 = Python3Script(
    way_frames=compas.transformed_planes,
    tcp_measured=pt_7,
    acceleration=number_slider,
    velocity=number_slider_2,
    pick_frame=py3.pick_frame)  # -> out, vis_frames, vis_planes, script; inputs way_frames: list, tcp_measured: Point3d, acceleration: Double, velocity: Double
# ---------- compas_2: Python ----------
from imp import reload
import sys
import os

#get current file path
path = ghenv.Component.OnPingDocument().FilePath
#get parent directory of the parent directory
parentdir = os.path.dirname(path)
#get src folder which contains classes
dire = os.path.join(parentdir,'src')

sys.path.append(dire)

import simple_ur_script as ur
reload(ur)

import utils 
reload(utils)

import simple_comm as com
reload(com)

import compas.geometry as cg
import math as m

# ===== Set global constants =======

IO = 4 #Global constant
SAFE_DIST = 50

# =================================

script = "" #create empty string

def pickup_brick(script,pick_up_frame):
    frames = []
    
    safe_pick_up_frame = pick_up_frame.translated(-pick_up_frame.normal*SAFE_DIST)
    
    ## add to the path: go to the safe plane
    script += ur.move_l(safe_pick_up_frame, acceleration, velocity)
    frames.append(safe_pick_up_frame)
    
    ## add to the path: go to the pick up plane
    script += ur.move_l(pick_up_frame, acceleration, velocity)
    frames.append(pick_up_frame)
    
    ## add to the path: turn on the vacuum and wait 1 sec.
    script += ur.set_digital_out(IO,True)
    script += ur.sleep(1)

    # add to the path: go back to the safe_plane
    script += ur.move_l(safe_pick_up_frame, acceleration, velocity)
    frames.append(safe_pick_up_frame)
    
    return script, frames


def place_brick(script, place_frame):
    
    frames = []
    
    safe_place_frame = place_frame.translated(cg.Vector(0,0,1)*SAFE_DIST)
    
    # add to the path: go to the safe plane
    script += ur.move_l(safe_place_frame, acceleration, velocity)
    frames.append(safe_place_frame)
    
    # add to the path: go to the place plane
    script += ur.move_l(place_frame, acceleration, velocity)
    frames.append(place_frame)
    
    ## add to the path: turn off the vacuum and wait 1 second (hold the brick)
    script += ur.set_digital_out(IO,False)
    script += ur.sleep(1)
    
    # add to the path: go back to the safe plane
    script += ur.move_l(safe_place_frame, acceleration, velocity)
    frames.append(safe_place_frame)
    
    return script,frames


#if value given for tcp measured, then add line to script, otherwise it will take current tcp from robot
if tcp_measured is not None:
    script += ur.set_tcp_by_angles(tcp_measured.X, tcp_measured.Y, tcp_measured.Z, m.radians(0.0),m.radians(0.0),m.radians(0))


vis_frames = []
#add move_l commands in sequence to script for each way plane
for brick_frame in way_frames:
    script, p = pickup_brick(script,pick_frame)
    vis_frames.extend(p) #only to visualize the planes
    script, p = place_brick(script,brick_frame)
    vis_frames.extend(p)


#format the script to make it sendable
script = com.concatenate_script(script)

from compas_rhino import conversions
import Rhino.Geometry as rg

vis_planes = [conversions.frame_to_rhino(frame) for frame in vis_frames]
# ---------- end compas_2 ----------

# ----
# Robot Visulization
number_slider_3 = Slider(1, range=0..1)
list = RobotsLibrary({"ETH-Gantry", "UR3e", "UR5e", "UR10e", "UR16e", "UR3", "UR5", "UR10", "UR20", "UR30"}, selected="UR5", Type=0)
setdo = SetDO(DO=number_slider_3, Value=Toggle(False))
loadrobot = LoadRobotSystem(Name=list, Base=PlaneXY(0, 0, 0))
tool = CreateTool(Name="DefaultGHTool", TCP=pt_7, Weight=Slider(1.5, range=0..10))  # -> Tool, TCP
target = CreateTarget(Plane=compas_2.vis_planes, Tool=tool.Tool, IsCartesian=True)
program = CreateProgram(Name="DefaultProgram", RobotSystem=loadrobot, Targets=target, InitCommands=setdo, StepSize=1)  # -> Program, Code, Duration, Warnings, Errors
sim = ProgramSimulation(Program=program.Program, Time=Slider(0.25, range=0..1), Normalized=True)  # -> SystemMeshes, JointRotations, Plane, Index, Time, Program, Errors

points_2 = PointList(Points=compas_2.vis_planes, Size=Slider(3, range=0..100))
compas_draw_5 = COMPASDraw(cg=compas_2.vis_frames)  # -> rg; same code as compas_draw
pline = PolyLine(Vertices=compas_2.vis_planes, Closed=False)
panel_2 = Panel(compas_2.script)

# ---- group: Send UR script to Robot!
# Send to Robot!
py3_2 = Python3Script(script=compas_2.script, ip_address="192.168.10.10", send=Button())  # -> out, a; inputs script: String, ip_address: String, send: Boolean
# ---------- py3_2: Python ----------
import simple_comm as com

if send:
    com.send_script(script,ip_address)
# ---------- end py3_2 ----------
