# Grasshopper definition 101_brick_to_robot.ghx (Grasshopper 1.0.8)
# plug-ins: Robots, Human

construct_point = ConstructPoint(XCoordinate=Slider(200, range=-1000..1000), YCoordinate=Slider(325, range=-1000..1000), ZCoordinate=0)
circle = Circle(Plane=construct_point, Radius=Slider(50, range=0..100))
script = Script(
    curve=circle,
    rotation=Slider(270, range=0..360),
    divisions=Slider(12, range=0..100),
    row_count=Slider(35, range=0..100),
    degree=Slider(0.9, range=0..100),
    gap=Slider(9.5, range=0..100))  # -> bricks, geometries, way_planes, all_points, all_points_2, all_points_3, row_curves; inputs curve: Curve, divisions: Int32, row_count: Int32, degree: Double, gap: Double
# ---------- script: Python ----------
# r:compas
# venv: mas-2526
from compas_rhino.devtools import DevTools
DevTools.ensure_path()

import math as m
from compas.geometry import Box, Point, Bezier, NurbsCurve, Line, Frame
from compas.geometry import Transformation, Vector, cross_vectors, Translation, Rotation
from compas_rhino.conversions import curve_to_compas, point_to_rhino, curve_to_rhino
from Rhino.Geometry import BoundingBox

from brick_wall import Brick

bricks = []

# #import curve
wall_crv = curve_to_compas(curve)

#rotate curve
R_crv = Rotation.from_axis_and_angle([0,0,1], m.radians(rotation),(200,325,0))
wall_crv.transform(R_crv)

row_curves = []
all_points = []
all_points_2 = []
all_points_3 = []

for r in range (row_count):
    #Exponential function for Rotation
    R_ex = pow(1.5, 0.4 * r) / 6
    #Exponential function for Translation
    T_ex = (pow(1.1, 1.01 * r) - int(row_count * 1/4)) / 10

    #create new row
    crv = wall_crv.translated([0,0,Brick.HEIGHT * r])
    R_row = Rotation.from_axis_and_angle([0,0,1], m.radians(R_ex), (200,325,0))
    crv.transform(R_row)

    #row division
    params = crv.divide_by_count(divisions)
    params_2 = crv.divide_by_count(divisions)

    row_crv_pts = []
    row_brick_pts = []
    
    #manipulate each row
    if r > 25:
        for i, param in enumerate(params_2):
            pt = crv.point_at(param)
            tangent = crv.tangent_at(param)
            normal = tangent.cross([0,0,1])
            T = Translation.from_vector(normal * (r + T_ex - int(row_count * 1/4))  * degree)
            T_2 = Translation.from_vector(-normal * (r + T_ex - int(row_count * 1/4)) * degree)

            if i == len(params) -1:
                pt_c = pt.copy()
                pt_c.transform(T)
                row_crv_pts.insert(0,pt_c)
                pt.transform(T)
                row_crv_pts.append(pt)
            
            elif i == 0 or i % 2 == 0:
                row_crv_pts.append(pt)

            elif (i + 3) % 4 == 0:
                pt.transform(T_2)
                row_crv_pts.append(pt)
            
            elif i % 2 != 0:
                pt.transform(T)
                row_crv_pts.append(pt)
    
    elif r < int(row_count * 1/5) + 1:
        for i, param in enumerate(params):
            pt = crv.point_at(param)
            tangent = crv.tangent_at(param)
            normal = tangent.cross([0,0,1])
            T = Translation.from_vector(normal * (int(row_count * 1/4) - r) * degree)
            T_2 = Translation.from_vector(-normal * (int(row_count * 1/4) - r) * degree)

            if i == len(params) -1:
                pt_c = pt.copy()
                pt_c.transform(T_2)
                row_crv_pts.insert(0,pt_c)
                pt.transform(T_2)
                row_crv_pts.append(pt)
            
            elif i == 0 or i % 2 == 0:
                row_crv_pts.append(pt)

            elif (i + 3) % 4 == 0:
                pt.transform(T)
                row_crv_pts.append(pt)
            
            elif i % 2 != 0:
                pt.transform(T_2)
                row_crv_pts.append(pt)
    
    else:
        for i, param in enumerate(params):
            pt = crv.point_at(param)
            tangent = crv.tangent_at(param)
            normal = tangent.cross([0,0,1])
            T = Translation.from_vector(normal * (r + T_ex - int(row_count * 1/4))  * degree)
            T_2 = Translation.from_vector(-normal * (r + T_ex - int(row_count * 1/4)) * degree)

            if i == len(params) -1:
                pt_c = pt.copy()
                pt_c.transform(T)
                row_crv_pts.insert(0,pt_c)
                pt.transform(T)
                row_crv_pts.append(pt)
            
            elif i == 0 or i % 2 == 0:
                row_crv_pts.append(pt)

            elif (i + 3) % 4 == 0:
                pt.transform(T_2)
                row_crv_pts.append(pt)
            
            elif i % 2 != 0:
                pt.transform(T)
                row_crv_pts.append(pt)

    from Rhino.Geometry import Curve
    
    #conversion between rhino_crv to create period crv
    row_crv = curve_to_rhino(NurbsCurve.from_interpolation(row_crv_pts))
    row_crv = curve_to_compas (Curve.CreatePeriodicCurve(row_crv))
    row_curves.append(row_crv)

    num_divs = int(row_crv.length() / (Brick.LENGTH+gap)) * 2
    params = row_crv.divide_by_count(num_divs)

    for col, param in enumerate(params):
        pt = row_crv.point_at(param)
        tangent = row_crv.tangent_at(param)
        normal = cross_vectors(tangent, [0,0,1])
        # only place bricks on alternating divisions depending on the row
        row_brick_pts.append(pt)

        if r % 2 == 0:
            # even rows 
            if col % 2 == 0:
                b = Brick(frame = Frame(pt, tangent, normal))
                bricks.append(b)
                all_points_2.append(b.frame.point)
        else:  
            # odd rows 
            if col % 2 == 1:
                b = Brick(frame = Frame(pt, tangent, normal))
                bricks.append(b)
                all_points_3.append(b.frame.point)

    all_points.extend(row_brick_pts)

geometries = []
way_planes = []

for brick in bricks:
    geometries.append(brick.draw())
    way_planes.append(brick.get_pick_frame())
# ---------- end script ----------

# ---- group: This is needed only ONCE in the GH definition
enable_auto_reload = Python3Script()  # -> ok
# ---------- enable_auto_reload: Python ----------
"""
------------------------------
Using VS Code as Python editor
------------------------------

The simplest way to start using VS Code as our editor, is
to place our Python code in files located IN THE SAME FOLDER as our Grasshopper file.

After we have done that, we need 2 steps: 

1. Enable the COMPAS reloader on one component. This tells Grasshopper to watch for changes in the Pythoh files and reload if changed.
2. Every other component that uses Python code from external files needs to start with a method to ensure Grasshopper knows where to load the files from.

"""
# r: compas
# venv: mas-2526

from compas_rhino.devtools import DevTools
DevTools.enable_reloader()
# ---------- end enable_auto_reload ----------

# ----
compas_draw = COMPASDraw(cg=script.geometries)  # -> rg
#   port cg: The COMPAS geometry or datastructure to be drawn.
#   port rg: The Rhino geometry object.
# ---------- compas_draw: Python ----------
# r: compas>=2.14.1
"""
Draws COMPAS geometry in Grasshopper.
"""

from typing import Any

import Grasshopper

from compas.scene import SceneObject


class CompasToRhinoGeometry(Grasshopper.Kernel.GH_ScriptInstance):
    def RunScript(self, cg):
        if not cg:
            return None

        return SceneObject(item=cg).draw()
# ---------- end compas_draw ----------
compas_draw_2 = COMPASDraw(cg=script.row_curves)  # -> rg; same code as compas_draw
drawframe = Python3Script(x=script.way_planes)  # -> a; inputs x: list
# ---------- drawframe: Python ----------
from compas_rhino.conversions import frame_to_rhino_plane

a = [frame_to_rhino_plane(f) for f in x[:141]]
# ---------- end drawframe ----------
compas_draw_3 = COMPASDraw(cg=script.all_points_3)  # -> rg; same code as compas_draw
compas_draw_4 = COMPASDraw(cg=script.all_points_2)  # -> rg; same code as compas_draw

# ---- group: World Object
pt = ConstructPoint(
    XCoordinate=Slider(212.4, range=-1000..1000),
    YCoordinate=Slider(114.4, range=-1000..1000),
    ZCoordinate=Slider(-10, range=-1000..1000))
pt_2 = ConstructPoint(
    XCoordinate=Slider(508.5, range=-1000..1000),
    YCoordinate=Slider(114.6, range=-1000..1000),
    ZCoordinate=Slider(-10, range=-1000..1000))
pt_3 = ConstructPoint(
    XCoordinate=Slider(213.4, range=-1000..1000),
    YCoordinate=Slider(535.2, range=-1000..1000),
    ZCoordinate=Slider(-10, range=-1000..1000))

# ----
fine_adjust_z_mm = Slider(5, range=-5..10)

# ---- group: Transform from Rhino to Robot Space
compas = Python3Script(way_planes=script.way_planes, wobj_origin=pt, wobj_xaxis=pt_2, wobj_xypoint=pt_3, z_safe_margin=fine_adjust_z_mm)  # -> out, transformed_planes; inputs way_planes: list, wobj_origin: Point3d, wobj_xaxis: Point3d, wobj_xypoint: Point3d, z_safe_margin: Double
# ---------- compas: Python ----------
import compas.geometry as cg

#in this step we transform our way planes to robot space
#the rhino co-ordinate system is rather abstract in the physical world
#the robot base plane assumed the base frame of robot is the origin
#but rhino does not know that
#thus we transform things from our design space(Rhino World XY) to Robot Base Plane that we measure

def set_robot_base(origin, xaxis, xypoint):
    """
    set a base plane representing the robot working object plane
    """
    robot_base = cg.Frame(origin, xaxis - origin, xypoint - origin)
    print (robot_base)
    return (robot_base)

def rhino_to_robot_space(rhino_plane,robot_base_plane):
    """
    Transform the objects from Rhino world XY plane to robot work object plane
    """
    T_matrix = cg.Transformation.from_frame_to_frame(cg.Frame.worldXY(), robot_base_plane)
    robot_plane = rhino_plane.transformed(T_matrix)
    return robot_plane

def set_z_safe_margin(planes_to_adjust, safety_margin):
    adjusted = []
    T = cg.Translation.from_vector(cg.Vector(0, 0, safety_margin))
    for f in planes_to_adjust:
        adjusted.append(f.transformed(T))
    return adjusted

# ===== Robot base is set =====
robot_base =  set_robot_base(wobj_origin, wobj_xaxis, wobj_xypoint)
print(robot_base)

# ===== Set safety margin for Z height ======
safe_planes = set_z_safe_margin(way_planes, z_safe_margin)

# ===== Transforming the rhino planes into robot planes =====
transformed_planes = []
for plane in safe_planes: 
    transformed_planes.append(rhino_to_robot_space(plane, robot_base))
# ---------- end compas ----------

# ---- group: Brick pick-up point
pt_4 = ConstructPoint(
    XCoordinate=Slider(-14, range=-1000..1000),
    YCoordinate=Slider(425.8, range=-1000..1000),
    ZCoordinate=Slider(31, range=-1000..1000))
pt_5 = ConstructPoint(
    XCoordinate=Slider(-14.1, range=-1000..1000),
    YCoordinate=Slider(455.9, range=-1000..1000),
    ZCoordinate=Slider(37, range=-1000..1000))
pt_6 = ConstructPoint(
    XCoordinate=Slider(-23.9, range=-1000..1000),
    YCoordinate=Slider(424.1, range=-1000..1000),
    ZCoordinate=Slider(41, range=-1000..1000))

# ---- group: Dimensions
bounding_box = BoundingBox(Content=compas_draw, Plane=PlaneXY(0, 0, 0), UnionBox=True)  # -> Box, Box_2
deconstruct_brep = DeconstructBrep(Brep=bounding_box.Box)  # -> Faces, Edges, Vertices
list_item = ListItem(List=deconstruct_brep.Edges, Index=Slider(8, range=0..10), Wrap=True)  # -> Item4, Item3, Item2, Item1, Item
line_dimension = LineDimension(Line=[list_item.Item, list_item.Item4, list_item.Item1], Text="{0:0.00}", Size=Slider(30, range=0..100))

# ---- group: check for collision and brick count
shift_list = ShiftList(List=compas_draw, Shift=1, Wrap=True)
brep_brep = BrepBrep(BrepA=compas_draw, BrepB=shift_list)  # -> Curves, Points
python_3_script = Python3Script(intersections=flatten(brep_brep.Curves), y=compas_draw)  # -> Red, instance, too_many_bricks; inputs intersections: list of Curve, y: list
# ---------- python_3_script: Python ----------
import math
import Rhino.Geometry as rg

instances = []
for i in intersections:
    pt_e = i.PointAtEnd
    pt_m = i.PointAtMid
    pt_s = i.PointAtStart
    x = rg.BoundingBox([pt_e, pt_m, pt_s])
    x_box = rg.Box(x)
    v = x_box.Z

    if int(v.Length) > 0.0:
        instances.append("yes")
    else:
        pass

Red = 255
instance = 100
too_many_bricks = []

if len(instances) > 0:
    instance = 50

for i in range(len(y)):
    if i > 150:
        too_many_bricks.append(255)
    else:
        too_many_bricks.append(0)
# ---------- end python_3_script ----------
colour_rgb = ColourRGB(
    Alpha=Slider(175, range=0..1000),
    Red=python_3_script.Red,
    Green=python_3_script.instance,
    Blue=python_3_script.too_many_bricks)
custom_preview = CustomPreview(Geometry=compas_draw, Material=colour_rgb)

# ---- group: Brick 'number'
volume = Volume(Geometry=compas_draw)  # -> Volume, Centroid
points = PointList(Points=volume.Centroid, Size=Slider(30, range=0..100))

# ---- group: Frame Adjustmnets
number_slider = Slider(14, range=-10..20)
number_slider_2 = Slider(8, range=-10..10)
number_slider_3 = Slider(-1, range=-10..10)
boolean_toggle = BooleanToggle(True)

# ----
compas_draw_5 = COMPASDraw(cg=compas.transformed_planes)  # -> rg; same code as compas_draw

# ---- group: Create pick up frame
py3 = Python3Script(origin=pt_4, xaxis_pt=pt_5, xy_pt=pt_6, x=number_slider, y=number_slider_2, z=number_slider_3, Flip=boolean_toggle)  # -> out, pick_frame, pick_frame_plane; inputs origin: Point3d, xaxis_pt: Point3d, xy_pt: Point3d, x: Double, y: Double, z: Double, Flip: Boolean
# ---------- py3: Python ----------
from compas.geometry import Frame, Point, Transformation, Vector, Translation
from compas.geometry import Rotation
import math as m

from compas_rhino.conversions import point_to_compas

origin = point_to_compas(origin)
xaxis_pt = point_to_compas(xaxis_pt)
xy_pt = point_to_compas(xy_pt)

#define pick frame
# pick_frame = Frame(origin, xaxis_pt - origin, xy_pt - origin)
pick_frame = Frame(origin, xaxis_pt - origin, xy_pt - origin)

Vector_1 = pick_frame.xaxis
Vector_2 = pick_frame.yaxis
Vector_3 = pick_frame.normal

#pick_frame adjustments
T_1 = Translation.from_vector(Vector_1 * x)
T_2 = Translation.from_vector(Vector_2 * y)
T_3 = Translation.from_vector(Vector_3 * z)

R = Rotation.from_axis_and_angle(pick_frame.normal, m.radians(0), pick_frame.point)
R_Flip = Rotation.from_axis_and_angle(Vector_1, m.radians(180), pick_frame.point)

if Flip == True:
    pick_frame.transform(R_Flip)

pick_frame.transform(T_3 * T_2 * T_1 * R)

from compas_rhino import conversions
pick_frame_plane = conversions.frame_to_rhino(pick_frame)
# ---------- end py3 ----------

# ---- group: TCP
pt_7 = ConstructPoint(
    XCoordinate=Slider(0.2, range=-100..100),
    YCoordinate=Slider(-1, range=-100..100),
    ZCoordinate=Slider(85, range=-100..100))

# ---- group: Sim
create_tool = CreateTool(Name="Suction", TCP=pt_7, Weight=Slider(0.5, range=0..10))  # -> Tool, TCP

# ----
compas_draw_6 = COMPASDraw(cg=py3.pick_frame)  # -> rg; same code as compas_draw

# ---- group: Convert Planes to URScript
compas_2 = Python3Script(
    way_frames=compas.transformed_planes,
    tcp_measured=pt_7,
    acceleration=Slider(0.8, range=0..3),
    velocity=Slider(1.5, range=0..4),
    travel_acc=Slider(3, range=0..3),
    travel_vel=Slider(4, range=0..4),
    pick_frame=py3.pick_frame)  # -> out, vis_frames, vis_planes, script; inputs way_frames: list, tcp_measured: Point3d, acceleration: Double, velocity: Double
# ---------- compas_2: Python ----------
from imp import reload
import sys
import os

#get current file path
path = ghenv.Component.OnPingDocument().FilePath
#get parent directory of the parent directory
parentdir = os.path.dirname(path)
#get src folder which contains classes
dire = os.path.join(parentdir,'src')

sys.path.append(dire)

import simple_ur_script as ur
reload(ur)

import utils 
reload(utils)

import simple_comm as com
reload(com)

import compas.geometry as cg
import math as m

# ===== Set global constants =======

IO = 0 #Global constant
SAFE_DIST = 50

# =================================

script = "" #create empty string

def pickup_brick(script,pick_up_frame):
    frames = []
    
    safe_pick_up_frame = pick_up_frame.translated(-pick_up_frame.normal*SAFE_DIST)
    
    ## add to the path: go to the safe plane
    script += ur.move_l(safe_pick_up_frame, travel_acc, travel_vel)
    frames.append(safe_pick_up_frame)
    
    ## add to the path: go to the pick up plane
    script += ur.move_l(pick_up_frame, acceleration, velocity)
    frames.append(pick_up_frame)
    
    ## add to the path: turn on the vacuum and wait 1 sec.
    script += ur.set_digital_out(IO,True)
    script += ur.sleep(1)

    # add to the path: go back to the safe_plane
    script += ur.move_l(safe_pick_up_frame, acceleration, velocity)
    frames.append(safe_pick_up_frame)
    
    return script, frames

def pickup_brick_high(script,pick_up_frame):
    frames = []
    
    safe_pick_up_frame = pick_up_frame.translated(-pick_up_frame.normal*SAFE_DIST)
    travel_frame = safe_pick_up_frame.translated(cg.Vector.Zaxis() * 200)

    ## add to the path: go to the travel plane
    script += ur.move_l(travel_frame, travel_acc, travel_vel)
    frames.append(travel_frame)

    ## add to the path: go to the safe plane
    script += ur.move_l(safe_pick_up_frame, travel_acc, travel_vel)
    frames.append(safe_pick_up_frame)
    
    ## add to the path: go to the pick up plane
    script += ur.move_l(pick_up_frame, acceleration, velocity)
    frames.append(pick_up_frame)
    
    ## add to the path: turn on the vacuum and wait 1 sec.
    script += ur.set_digital_out(IO,True)
    script += ur.sleep(1)

    # add to the path: go back to the safe_plane
    script += ur.move_l(safe_pick_up_frame, acceleration, velocity)
    frames.append(safe_pick_up_frame)

    ## add to the path: go to the travel plane
    script += ur.move_l(travel_frame, travel_acc, travel_vel)
    frames.append(travel_frame)
    
    return script, frames

def pickup_brick_high_2(script,pick_up_frame):
    frames = []
    
    safe_pick_up_frame = pick_up_frame.translated(-pick_up_frame.normal*SAFE_DIST)
    travel_frame = safe_pick_up_frame.translated(cg.Vector.Zaxis() * 400)

    ## add to the path: go to the travel plane
    script += ur.move_l(travel_frame, travel_acc, travel_vel)
    frames.append(travel_frame)

    ## add to the path: go to the safe plane
    script += ur.move_l(safe_pick_up_frame, travel_acc, travel_vel)
    frames.append(safe_pick_up_frame)
    
    ## add to the path: go to the pick up plane
    script += ur.move_l(pick_up_frame, acceleration, velocity)
    frames.append(pick_up_frame)
    
    ## add to the path: turn on the vacuum and wait 1 sec.
    script += ur.set_digital_out(IO,True)
    script += ur.sleep(1)

    # add to the path: go back to the safe_plane
    script += ur.move_l(safe_pick_up_frame, acceleration, velocity)
    frames.append(safe_pick_up_frame)

    ## add to the path: go to the travel plane
    script += ur.move_l(travel_frame, travel_acc, travel_vel)
    frames.append(travel_frame)
    
    return script, frames

def place_brick(script, place_frame):
    
    frames = []
    
    safe_place_frame = place_frame.translated(cg.Vector(0,0,1)*SAFE_DIST)
    
    # add to the path: go to the safe plane
    script += ur.move_l(safe_place_frame, travel_acc, travel_vel)
    frames.append(safe_place_frame)
    
    # add to the path: go to the place plane
    script += ur.move_l(place_frame, acceleration, velocity)
    frames.append(place_frame)
    
    ## add to the path: turn off the vacuum and wait 1 second (hold the brick)
    script += ur.set_digital_out(IO,False)
    script += ur.sleep(1)
    
    # add to the path: go back to the safe plane
    script += ur.move_l(safe_place_frame, acceleration, velocity)
    frames.append(safe_place_frame)
    
    return script,frames


#if value given for tcp measured, then add line to script, otherwise it will take current tcp from robot
if tcp_measured is not None:
    script += ur.set_tcp_by_angles(tcp_measured.X, tcp_measured.Y, tcp_measured.Z, m.radians(0.0),m.radians(0.0),m.radians(0))


vis_frames = []
#add move_l commands in sequence to script for each way plane
for i, brick_frame in enumerate (way_frames):
    if i < int(len(way_frames)/ 3):
        script, p = pickup_brick(script,pick_frame)
        vis_frames.extend(p) #only to visualize the planes
        script, p = place_brick(script,brick_frame)
        vis_frames.extend(p)
    
    elif i < int(len(way_frames) * 2/3):
        script, p = pickup_brick_high(script, pick_frame)
        vis_frames.extend(p)
        script, p = place_brick(script, brick_frame)
        vis_frames.extend(p)
    else:
        script, p = pickup_brick_high_2(script,pick_frame)
        vis_frames.extend(p) #only to visualize the planes
        script, p = place_brick(script,brick_frame)
        vis_frames.extend(p)


#format the script to make it sendable
script = com.concatenate_script(script)

from compas_rhino import conversions
import Rhino.Geometry as rg

vis_planes = [conversions.frame_to_rhino(frame) for frame in vis_frames]
# ---------- end compas_2 ----------

# ----
compas_draw_7 = COMPASDraw(cg=compas_2.vis_frames)  # -> rg; same code as compas_draw
points_2 = PointList(Points=compas_2.vis_planes, Size=Slider(7, range=0..100))
panel = Panel(compas_2.script)

# ---- group: Send UR script to Robot!
py3_2 = Python3Script(script=compas_2.script, ip_address="192.168.10.10", send=Button())  # -> out, a; inputs script: String, ip_address: String, send: Boolean
# ---------- py3_2: Python ----------
import simple_comm as com

if send:
    com.send_script(script,ip_address)
# ---------- end py3_2 ----------

# ----
# Multiple pick up points
number_slider_4 = Slider(12, range=0..20)

# ---- group: Concave
script_2 = Script(
    curve=circle,
    divisions=number_slider_4,
    row_count=Slider(25, range=0..30),
    degree=Slider(0.9, range=0..5),
    gap=Slider(8, range=0..100))  # -> bricks, geometries, way_planes, row_crv_pts, row_curves; inputs curve: Curve, divisions: Int32, row_count: Int32, degree: Double, gap: Double
# ---------- script_2: Python ----------
# r:compas
# venv: mas-2526
from compas_rhino.devtools import DevTools
DevTools.ensure_path()

import math as m
from compas.geometry import Box, Point, Bezier, NurbsCurve, Line, Frame
from compas.geometry import Transformation, Vector, cross_vectors, Translation
from compas_rhino.conversions import curve_to_compas, point_to_rhino, curve_to_rhino

from brick_wall import Brick

bricks = []

# #import curve
wall_crv = curve_to_compas(curve)

row_curves = []

for r in range (row_count):
    #create new row
    crv = wall_crv.translated([0,0,Brick.HEIGHT * r])
    #row division
    params = crv.divide_by_count(divisions)

    row_crv_pts = []
    #manipulate each row
    if r < row_count * 2/3:
        for i, param in enumerate(params):
            pt = crv.point_at(param)
            tangent = crv.tangent_at(param)
            normal = tangent.cross([0,0,1])
            T = Translation.from_vector(normal * r * degree)
            T_2 = Translation.from_vector(-normal * r * degree)

            if i == len(params) -1:
                pt_c = pt.copy()
                pt_c.transform(T_2)
                row_crv_pts.insert(0,pt_c)
                pt.transform(T_2)
                row_crv_pts.append(pt)
            
            elif i == 0 or i % 2 == 0:
                row_crv_pts.append(pt)

            elif (i + 3) % 4 == 0:
                pt.transform(T)
                row_crv_pts.append(pt)
            
            elif i % 2 != 0:
                pt.transform(T_2)
                row_crv_pts.append(pt)
    
    else:
        for i, param in enumerate(params):
            pt = crv.point_at(param)
            tangent = crv.tangent_at(param)
            normal = tangent.cross([0,0,1])
            T = Translation.from_vector(normal * (row_count - (r - 1) * 2/3) * degree)
            T_2 = Translation.from_vector(-normal * (row_count - (r - 1) * 2/3) * degree)

            if i == len(params) -1:
                pt_c = pt.copy()
                pt_c.transform(T_2)
                row_crv_pts.insert(0,pt_c)
                pt.transform(T_2)
                row_crv_pts.append(pt)
            
            elif i == 0 or i % 2 == 0:
                row_crv_pts.append(pt)

            elif (i + 3) % 4 == 0:
                pt.transform(T)
                row_crv_pts.append(pt)
            
            elif i % 2 != 0:
                pt.transform(T_2)
                row_crv_pts.append(pt)

    from Rhino.Geometry import Curve
    
    #conversion between rhino_crv to create period crv
    row_crv = curve_to_rhino(NurbsCurve.from_interpolation(row_crv_pts))
    row_crv = curve_to_compas (Curve.CreatePeriodicCurve(row_crv))
    row_curves.append(row_crv)

    num_divs = int(row_crv.length() / (Brick.LENGTH+gap)) * 2
    params = row_crv.divide_by_count(num_divs)

    for col, param in enumerate(params):
        pt = row_crv.point_at(param)
        tangent = row_crv.tangent_at(param)
        normal = cross_vectors(tangent, [0,0,1])
        # only place bricks on alternating divisions depending on the row
        if r % 2 == 0:
            # even rows 
            if col % 2 == 0:
                b = Brick(frame = Frame(pt, tangent, normal))
                bricks.append(b)
        else:  
            # odd rows 
            if col % 2 == 1:
                b = Brick(frame = Frame(pt, tangent, normal))
                bricks.append(b)

geometries = []
way_planes = []

for brick in bricks:
    geometries.append(brick.draw())
    way_planes.append(brick.get_pick_frame())
# ---------- end script_2 ----------

# ----
list_length = ListLength(List=script_2.geometries)
panel_2 = Panel(list_length)
compas_draw_8 = COMPASDraw(cg=script_2.geometries)  # -> rg; same code as compas_draw
shift_list_2 = ShiftList(List=compas_draw_8, Shift=1, Wrap=True)
brep_brep_2 = BrepBrep(BrepA=compas_draw_8, BrepB=shift_list_2)  # -> Curves, Points
compas_draw_9 = COMPASDraw(cg=script_2.row_curves)  # -> rg; same code as compas_draw

# ---- group: Convex
script_3 = Script(
    curve=circle,
    divisions=Slider(12, range=0..20),
    row_count=Slider(40, range=0..100),
    degree=Slider(0.9, range=0..5),
    gap=Slider(5, range=0..100))  # -> bricks, geometries, way_planes, row_crv_pts, row_curves; inputs curve: Curve, divisions: Int32, row_count: Int32, degree: Double, gap: Double
# ---------- script_3: Python ----------
# r:compas
# venv: mas-2526
from compas_rhino.devtools import DevTools
DevTools.ensure_path()

import math as m
from compas.geometry import Box, Point, Bezier, NurbsCurve, Line, Frame
from compas.geometry import Transformation, Vector, cross_vectors, Translation
from compas_rhino.conversions import curve_to_compas, point_to_rhino, curve_to_rhino

from brick_wall import Brick

bricks = []

# #import curve
wall_crv = curve_to_compas(curve)

row_curves = []

for r in range (row_count):
    #create new row
    crv = wall_crv.translated([0,0,Brick.HEIGHT * r])
    #row division
    params = crv.divide_by_count(divisions)

    row_crv_pts = []
    #manipulate each row
    if r < int(row_count * 2/3) + 1:
        for i, param in enumerate(params):
            pt = crv.point_at(param)
            tangent = crv.tangent_at(param)
            normal = tangent.cross([0,0,1])
            T = Translation.from_vector(normal * (int(row_count * 2/3) - r) * degree)
            T_2 = Translation.from_vector(-normal * (int(row_count * 2/3) - r) * degree)

            if i == len(params) -1:
                pt_c = pt.copy()
                pt_c.transform(T_2)
                row_crv_pts.insert(0,pt_c)
                pt.transform(T_2)
                row_crv_pts.append(pt)
            
            elif i == 0 or i % 2 == 0:
                row_crv_pts.append(pt)

            elif (i + 3) % 4 == 0:
                pt.transform(T)
                row_crv_pts.append(pt)
            
            elif i % 2 != 0:
                pt.transform(T_2)
                row_crv_pts.append(pt)
    
    else:
        for i, param in enumerate(params):
            pt = crv.point_at(param)
            tangent = crv.tangent_at(param)
            normal = tangent.cross([0,0,1])
            T = Translation.from_vector(normal * (r - int(row_count * 2/3) - 1)  * degree)
            T_2 = Translation.from_vector(-normal * (r - int(row_count * 2/3) - 1) * degree)

            if i == len(params) -1:
                pt_c = pt.copy()
                pt_c.transform(T)
                row_crv_pts.insert(0,pt_c)
                pt.transform(T)
                row_crv_pts.append(pt)
            
            elif i == 0 or i % 2 == 0:
                row_crv_pts.append(pt)

            elif (i + 3) % 4 == 0:
                pt.transform(T_2)
                row_crv_pts.append(pt)
            
            elif i % 2 != 0:
                pt.transform(T)
                row_crv_pts.append(pt)

    from Rhino.Geometry import Curve
    
    #conversion between rhino_crv to create period crv
    row_crv = curve_to_rhino(NurbsCurve.from_interpolation(row_crv_pts))
    row_crv = curve_to_compas (Curve.CreatePeriodicCurve(row_crv))
    row_curves.append(row_crv)

    num_divs = int(row_crv.length() / (Brick.LENGTH+gap)) * 2
    params = row_crv.divide_by_count(num_divs)

    for col, param in enumerate(params):
        pt = row_crv.point_at(param)
        tangent = row_crv.tangent_at(param)
        normal = cross_vectors(tangent, [0,0,1])
        # only place bricks on alternating divisions depending on the row
        if r % 2 == 0:
            # even rows 
            if col % 2 == 0:
                b = Brick(frame = Frame(pt, tangent, normal))
                bricks.append(b)
        else:  
            # odd rows 
            if col % 2 == 1:
                b = Brick(frame = Frame(pt, tangent, normal))
                bricks.append(b)

geometries = []
way_planes = []

for brick in bricks:
    geometries.append(brick.draw())
    way_planes.append(brick.get_pick_frame())
# ---------- end script_3 ----------

# ----
list_length_2 = ListLength(List=script_3.geometries)
panel_3 = Panel(list_length_2)
compas_draw_10 = COMPASDraw(cg=script_3.geometries)  # -> rg; same code as compas_draw
shift_list_3 = ShiftList(List=compas_draw_10, Shift=1, Wrap=True)
brep_brep_3 = BrepBrep(BrepA=compas_draw_10, BrepB=shift_list_3)  # -> Curves, Points
compas_draw_11 = COMPASDraw(cg=script_3.row_curves)  # -> rg; same code as compas_draw

volume_2 = Volume(Geometry=compas_draw_10)  # -> Volume, Centroid
points_3 = PointList(Points=volume_2.Centroid, Size=Slider(7, range=0..100))
custom_preview_2 = CustomPreview(Geometry=compas_draw_10, Material=ColourSwatch(SwatchColor=RGB(255, 111, 9)))

# ---- group: Sim
robots_library = RobotsLibrary(
    {"UR3e", "UR5e", "UR10e", "UR16e", "UR3", "UR5", "UR10", "UR20", "UR30", "UniMelb-IRB120", "UniMelb-IRB1200", "ETH-Gantry"}, selected="UR5",
    Type=0)
load_robot_system = LoadRobotSystem(Name=robots_library, Base=PlaneXY(0, 0, 0))

# ---- group: Preview
rectangle_3pt = Rectangle3Pt(PointA=pt, PointB=pt_2, PointC=pt_3)  # -> graft(Rectangle), Length
center_box = CenterBox(Base=py3.pick_frame_plane, X=Slider(32, range=0..100), Y=Slider(15, range=0..100), Z=Slider(10, range=0..100))
plane = Plane(compas_2.vis_planes)
polyline = PolyLine(Vertices=plane, Closed=False)
deconstruct_plane = DeconstructPlane(Plane=plane)  # -> Origin, XAxis, YAxis, ZAxis
custom_preview_lineweights = CustomPreviewLineweights(Geometry=polyline, Shader=ColourSwatch(SwatchColor=RGB(0, 254, 0)), Thickness=Slider(3, range=0..10), Absolute=False)
vector_display = VectorDisplay(Anchor=deconstruct_plane.Origin, Vector=deconstruct_plane.XAxis)
point_list = PointList(Points=plane, Size=Slider(3, range=0..10))

# ---- group: Sim / Approach
create_target = CreateTarget(Plane=plane, Tool=create_tool.Tool, IsCartesian=True)

# ---- group: Sim (continued)
create_program = CreateProgram(Name="DefaultProgram", RobotSystem=load_robot_system, Targets=create_target, StepSize=1)  # -> Program, Code, Duration, Warnings, Errors
program_simulation = ProgramSimulation(Program=create_program.Program, Time=Slider(1, range=0..1), Normalized=True)  # -> SystemMeshes, JointRotations, Plane, Index, Time, Program, Errors
panel_4 = Panel(create_program.Warnings)
panel_5 = Panel(program_simulation.Errors)

# ----
pipe = Pipe(Curve=rectangle_3pt.Rectangle, Radius=1, Caps=0)

# ---- group: Preview (continued)
custom_preview_3 = CustomPreview(
    Geometry=[program_simulation.SystemMeshes, rectangle_3pt.Rectangle, center_box, pipe],
    Material=ColourSwatch(SwatchColor=RGBA(255, 111, 9, 150)))
