# Grasshopper definition 301_somebricks_are_bigger_than_others_m.ghx (Grasshopper 1.0.8)
# plug-ins: Human

construct_point = ConstructPoint(
    XCoordinate=Slider(600, range=-1000..1000),
    YCoordinate=Slider(400, range=-1000..1000),
    ZCoordinate=Slider(29, range=0..100))

# ---- group: Frankenstein
brep = Brep([<brep referenced from the Rhino model> x12])
cluster = Cluster(geometry=brep, brep=brep)
script = Script(x=cluster)  # -> out, way_planes; inputs x: list of Plane
# ---------- script: Python ----------
# r:compas
# venv: mas-2526
from compas_rhino.devtools import DevTools
from compas.geometry import Frame, Box

DevTools.ensure_path()

from compas_rhino.conversions import plane_to_compas_frame

from brick_wall import BigBrick


way_planes = [plane_to_compas_frame(f) for f in x]

# for frame in frames:
#     box_frame = box.Frame
# ---------- end script ----------
drawframe = Python3Script(x=script.way_planes)  # -> a; inputs x: list
# ---------- drawframe: Python ----------
from compas_rhino.conversions import frame_to_rhino_plane

a = [frame_to_rhino_plane(f) for f in x[:141]]
# ---------- end drawframe ----------

# ----
number_slider = Slider(-1, range=-1..0)
circle = Circle(Plane=construct_point, Radius=Slider(235, range=0..1000))
number_slider_2 = Slider(8, range=0..10)
series = Series(Start=number_slider, Step=number_slider, Count=Slider(32, range=0..100))

# ---- group: Convex
# #### TO DO
# 
# 2) Resove brick intersection
script_2 = Script(
    curve=circle,
    rotation=Slider(270, range=0..360),
    divisions=Slider(8, range=0..20),
    row_count=Slider(29, range=0..100),
    degree=Slider(0, range=0..100),
    gap=Slider(55, range=0..100))  # -> bricks, geometries, way_planes, all_points, all_points_2, all_points_3, row_curves; inputs curve: Curve, divisions: Int32, row_count: Int32, degree: Double, gap: Double
# ---------- script_2: Python ----------
# r:compas
# venv: mas-2526
from compas_rhino.devtools import DevTools
DevTools.ensure_path()

import math as m
from compas.geometry import Box, Point, Bezier, NurbsCurve, Line, Frame
from compas.geometry import Transformation, Vector, cross_vectors, Translation, Rotation
from compas_rhino.conversions import curve_to_compas, point_to_rhino, curve_to_rhino
from Rhino.Geometry import BoundingBox

from brick_wall import BigBrick

bricks = []

# #import curve
wall_crv = curve_to_compas(curve)

#rotate curve
R_crv = Rotation.from_axis_and_angle([0,0,1], m.radians(rotation),(600,400,0))
wall_crv.transform(R_crv)

row_curves = []
all_points = []
all_points_2 = []
all_points_3 = []

for r in range (row_count):
    #Exponential function for Rotation
    R_ex = pow(1.5, 0.35 * r) * 0
    #Exponential function for Translation
    T_ex = (pow(1.1, 1.01 * r) - int(row_count * 1/5)) / 10

    #create new row
    crv = wall_crv.translated([0,0,BigBrick.HEIGHT * r])
    R_row = Rotation.from_axis_and_angle([0,0,1], m.radians(R_ex), (600,400,0))
    crv.transform(R_row)

    #row division
    params = crv.divide_by_count(divisions)
    params_2 = crv.divide_by_count(divisions)

    row_crv_pts = []
    row_brick_pts = []
    
    #manipulate each row
    if r > 25:
        for i, param in enumerate(params_2):
            pt = crv.point_at(param)
            tangent = crv.tangent_at(param)
            normal = tangent.cross([0,0,1])
            T = Translation.from_vector(normal * (r + T_ex - int(row_count * 1/5))  * degree)
            T_2 = Translation.from_vector(-normal * (r + T_ex - int(row_count * 1/5)) * degree)

            if i == len(params) -1:
                pt_c = pt.copy()
                pt_c.transform(T)
                row_crv_pts.insert(0,pt_c)
                pt.transform(T)
                row_crv_pts.append(pt)
            
            elif i == 0 or i % 2 == 0:
                row_crv_pts.append(pt)

            elif (i + 3) % 4 == 0:
                pt.transform(T_2)
                row_crv_pts.append(pt)
            
            elif i % 2 != 0:
                pt.transform(T)
                row_crv_pts.append(pt)
    
    elif r < int(row_count * 1/5) + 1:
        for i, param in enumerate(params):
            pt = crv.point_at(param)
            tangent = crv.tangent_at(param)
            normal = tangent.cross([0,0,1])
            T = Translation.from_vector(normal * (int(row_count * 1/5) - r) * degree)
            T_2 = Translation.from_vector(-normal * (int(row_count * 1/5) - r) * degree)

            if i == len(params) -1:
                pt_c = pt.copy()
                pt_c.transform(T_2)
                row_crv_pts.insert(0,pt_c)
                pt.transform(T_2)
                row_crv_pts.append(pt)
            
            elif i == 0 or i % 2 == 0:
                row_crv_pts.append(pt)

            elif (i + 3) % 4 == 0:
                pt.transform(T)
                row_crv_pts.append(pt)
            
            elif i % 2 != 0:
                pt.transform(T_2)
                row_crv_pts.append(pt)
    
    else:
        for i, param in enumerate(params):
            pt = crv.point_at(param)
            tangent = crv.tangent_at(param)
            normal = tangent.cross([0,0,1])
            T = Translation.from_vector(normal * (r + T_ex - int(row_count * 1/5))  * degree)
            T_2 = Translation.from_vector(-normal * (r + T_ex - int(row_count * 1/5)) * degree)

            if i == len(params) -1:
                pt_c = pt.copy()
                pt_c.transform(T)
                row_crv_pts.insert(0,pt_c)
                pt.transform(T)
                row_crv_pts.append(pt)
            
            elif i == 0 or i % 2 == 0:
                row_crv_pts.append(pt)

            elif (i + 3) % 4 == 0:
                pt.transform(T_2)
                row_crv_pts.append(pt)
            
            elif i % 2 != 0:
                pt.transform(T)
                row_crv_pts.append(pt)

    from Rhino.Geometry import Curve
    
    #conversion between rhino_crv to create period crv
    row_crv = curve_to_rhino(NurbsCurve.from_interpolation(row_crv_pts))
    row_crv = curve_to_compas (Curve.CreatePeriodicCurve(row_crv))
    row_curves.append(row_crv)

    num_divs = int(row_crv.length() / (BigBrick.LENGTH+gap)) * 2
    params = row_crv.divide_by_count(num_divs)

    for col, param in enumerate(params):
        pt = row_crv.point_at(param)
        tangent = row_crv.tangent_at(param)
        normal = cross_vectors(tangent, [0,0,1])
        # only place bricks on alternating divisions depending on the row
        row_brick_pts.append(pt)

        if r % 2 == 0:
            # even rows 
            if col % 2 == 0:
                b = BigBrick(frame = Frame(pt, tangent, normal))
                bricks.append(b)
                all_points_2.append(b.frame.point)
        else:  
            # odd rows 
            if col % 2 == 1:
                b = BigBrick(frame = Frame(pt, tangent, normal))
                bricks.append(b)
                all_points_3.append(b.frame.point)

    all_points.extend(row_brick_pts)

geometries = []
way_planes = []

for brick in bricks:
    geometries.append(brick.draw())
    way_planes.append(brick.get_pick_frame())
# ---------- end script_2 ----------

# ----
compas_draw = COMPASDraw(cg=script_2.all_points)  # -> rg
#   port cg: The COMPAS geometry or datastructure to be drawn.
#   port rg: The Rhino geometry object.
# ---------- compas_draw: Python ----------
# r: compas>=2.14.1
"""
Draws COMPAS geometry in Grasshopper.
"""

from typing import Any

import Grasshopper

from compas.scene import SceneObject


class CompasToRhinoGeometry(Grasshopper.Kernel.GH_ScriptInstance):
    def RunScript(self, cg):
        if not cg:
            return None

        return SceneObject(item=cg).draw()
# ---------- end compas_draw ----------
cull_index = CullIndex(List=compas_draw, Indices=series, Wrap=True)
number_slider_3 = Slider(10, range=0..100)
colour_swatch = ColourSwatch(SwatchColor=RGB(0, 255, 0))
compas_draw_2 = COMPASDraw(cg=script_2.geometries)  # -> rg; same code as compas_draw
point = Point(cluster)
compas_draw_3 = COMPASDraw(cg=script_2.row_curves)  # -> rg; same code as compas_draw
list_item = ListItem(List=compas_draw_3, Index=Slider(-1, range=-1..0), Wrap=True)  # -> Item, Item1

divide_curve = DivideCurve(Curve=list_item.Item, Count=number_slider_2, Kinks=False)  # -> Points, Tangents, Parameters
offset_curve = OffsetCurve(Curve=[list_item.Item, list_item.Item1], Distance=Slider(150, range=0..500), Corners=1)
divide_curve_2 = DivideCurve(Curve=offset_curve, Count=number_slider_2, Kinks=False)  # -> Points, Tangents, Parameters
point_list = PointList(Points=divide_curve_2.Points, Size=Slider(49, range=0..100))

list_item_2 = ListItem(List=compas_draw_3, Index=Slider(5, range=0..29), Wrap=True)
number_slider_4 = Slider(-1, range=-1..0)
divide_curve_3 = DivideCurve(Curve=list_item.Item1, Count=Slider(8, range=0..10), Kinks=False)  # -> Points, Tangents, Parameters
compas_draw_4 = COMPASDraw(cg=script_2.all_points_3)  # -> rg; same code as compas_draw
compas_draw_5 = COMPASDraw(cg=script_2.all_points_2)  # -> rg; same code as compas_draw
drawframe_2 = Python3Script(x=script_2.way_planes)  # -> a; inputs x: list; same code as drawframe

# ---- group: Pallet
unit_z = UnitZ(Factor=Slider(-125, range=-200..0))
construct_point_2 = ConstructPoint(XCoordinate=Slider(0, range=-1000..1000), YCoordinate=Slider(0, range=-1000..1000), ZCoordinate=Slider(0, range=-200..0))
rectangle = Rectangle(Plane=construct_point_2, XSize=Slider(1200, range=0..10000), YSize=Slider(800, range=0..1000), Radius=0)  # -> Rectangle, Length
bounding_box = BoundingBox(Content=[rectangle.Rectangle, unit_z], Plane=PlaneXY(0, 0, 0), UnionBox=True)  # -> Box, Box_2
custom_preview = CustomPreview(Geometry=bounding_box.Box, Material=ColourSwatch(SwatchColor=RGBA(130, 130, 130, 150)))

# ----
split_list = SplitList(List=point, Index=Slider(6, range=0..10))  # -> ListA, ListB
number_slider_5 = Slider(10, range=0..100)
sphere = Sphere(Base=[point, cull_index], Radius=number_slider_5)
number_slider_6 = Slider(-1, range=-1..0)
series_2 = Series(Start=number_slider_4, Step=number_slider_4, Count=Slider(8, range=0..10))
list_length = ListLength(List=script_2.way_planes)
cull_index_2 = CullIndex(List=compas_draw_5, Indices=series_2, Wrap=True)
offset_curve_2 = OffsetCurve(Curve=list_item_2, Distance=Slider(100, range=0..500), Corners=1)
panel = Panel(list_length)
sphere_2 = Sphere(Base=[split_list.ListB, cull_index_2], Radius=number_slider_5)
series_3 = Series(Start=number_slider_6, Step=number_slider_6, Count=Slider(8, range=0..10))
divide_curve_4 = DivideCurve(Curve=offset_curve_2, Count=Slider(4, range=0..10), Kinks=False)  # -> Points, Tangents, Parameters
cull_index_3 = CullIndex(List=compas_draw_4, Indices=series_3, Wrap=True)
sphere_3 = Sphere(Base=[split_list.ListA, cull_index_3], Radius=number_slider_5)
custom_preview_lineweights = CustomPreviewLineweights(Geometry=sphere_3, Shader=ColourSwatch(SwatchColor=RGB(0, 0, 255)), Absolute=False)
custom_preview_lineweights_2 = CustomPreviewLineweights(Geometry=sphere_2, Shader=ColourSwatch(SwatchColor=RGB(255, 0, 0)), Absolute=False)
multiplication = Multiplication(A=divide_curve_4.Tangents, B=Slider(100, range=0..100))
vector_display_ex = VectorDisplayEx(Point=divide_curve_4.Points, Vector=multiplication, Colour=colour_swatch, Width=Slider(3, range=0..10))

# ---- group: Dimensions
bounding_box_2 = BoundingBox(Content=compas_draw_2, Plane=PlaneXY(0, 0, 0), UnionBox=True)  # -> Box, Box_2
deconstruct_brep = DeconstructBrep(Brep=bounding_box_2.Box)  # -> Faces, Edges, Vertices
number_slider_7 = Slider(30, range=0..100)
list_item_3 = ListItem(List=deconstruct_brep.Edges, Index=Slider(8, range=0..10), Wrap=True)  # -> Item4, Item3, Item2, Item1, Item
line_dimension = LineDimension(Line=[list_item_3.Item, list_item_3.Item4, list_item_3.Item1], Text="{0:0.00}", Size=number_slider_7)

# ---- group: check for collision and brick count
shift_list = ShiftList(List=compas_draw_2, Shift=1, Wrap=True)
brep_brep = BrepBrep(BrepA=compas_draw_2, BrepB=shift_list)  # -> Curves, Points
python_3_script = Python3Script(intersections=flatten(brep_brep.Curves), y=compas_draw_2)  # -> Red, instance, too_many_bricks; inputs intersections: list of Curve, y: list
# ---------- python_3_script: Python ----------
import math
import Rhino.Geometry as rg

instances = []
for i in intersections:
    pt_e = i.PointAtEnd
    pt_m = i.PointAtMid
    pt_s = i.PointAtStart
    x = rg.BoundingBox([pt_e, pt_m, pt_s])
    x_box = rg.Box(x)
    v = x_box.Z

    if int(v.Length) > 0.0:
        instances.append("yes")
    else:
        pass

Red = 255
instance = 100
too_many_bricks = []

if len(instances) > 0:
    instance = 50

for i in range(len(y)):
    if i > 150:
        too_many_bricks.append(255)
    else:
        too_many_bricks.append(0)
# ---------- end python_3_script ----------
colour_rgb = ColourRGB(
    Alpha=Slider(175, range=0..1000),
    Red=python_3_script.Red,
    Green=python_3_script.instance,
    Blue=python_3_script.too_many_bricks)
custom_preview_2 = CustomPreview(Geometry=compas_draw_2, Material=colour_rgb)

# ---- group: Brick 'number'
volume = Volume(Geometry=compas_draw_2)  # -> Volume, Centroid
points = PointList(Points=volume.Centroid, Size=Slider(30, range=0..100))

# ----
deconstruct_brep_2 = DeconstructBrep(Brep=bounding_box.Box)  # -> Faces, Edges, Vertices

# ---- group: Export .JSON
button = Button()
panel_2 = Panel("w_pallet1")

# ----
panel_3 = Panel("""1
3
5
7""")
list_item_4 = ListItem(List=deconstruct_brep_2.Edges, Index=Slider(8, range=0..10), Wrap=True)  # -> Item4, Item3, Item2, Item1, Item

# ---- group: Export .JSON
python_3_script_2 = Python3Script(frames=script.way_planes, pallet_number=panel_2, save=button)  # inputs frames: list, pallet_number: String
# ---------- python_3_script_2: Python ----------
from compas.data import json_dump
import sys
import os

data = {}

data["wobj"] = pallet_number
data["frames"] = frames

#get current file path
path = ghenv.Component.OnPingDocument().FilePath
#get parent directory of the parent directory
parentdir = os.path.dirname(path)
#get src folder which contains classes
dire = os.path.join(parentdir,'data')


filepath = os.path.join(dire, "out_brickframes.json")

if save:
    json_dump(data, filepath)
# ---------- end python_3_script_2 ----------

# ----
panel_4 = Panel("""1
3
5
7""")
offset_curve_3 = OffsetCurve(Curve=[list_item_4.Item4, list_item_4.Item1], Distance=Slider(-25, range=-50..100), Corners=1)
panel_5 = Panel(script_2.way_planes)
line_dimension_2 = LineDimension(Line=offset_curve_3, Text="{0:0.00}", Size=number_slider_7)
colour_swatch_2 = ColourSwatch(SwatchColor=RGB(255, 255, 255))
panel_6 = Panel("#652D2D")
brep_2 = Brep([<brep referenced from the Rhino model> x16])
brep_3 = Brep([<brep referenced from the Rhino model> x79])
brep_4 = Brep([<brep referenced from the Rhino model> x74])
brep_edges = BrepEdges(Brep=brep_2)  # -> Naked, Interior, NonManifold
custom_preview_lineweights_3 = CustomPreviewLineweights(Geometry=brep_3, Shader=ColourSwatch(SwatchColor=RGBA(255, 0, 0, 0)), Absolute=False)
custom_preview_lineweights_4 = CustomPreviewLineweights(Geometry=brep_4, Shader=ColourSwatch(SwatchColor=RGBA(0, 0, 255, 0)), Absolute=False)
curve = Curve(brep_edges.Interior)
custom_preview_lineweights_5 = CustomPreviewLineweights(Geometry=curve, Shader=ColourSwatch(SwatchColor=RGBA(51, 51, 51, 143)), Thickness=Slider(1, range=0..10), Absolute=False)

evaluate_curve = EvaluateCurve(Curve=list_item.Item, Parameter=divide_curve.Parameters)  # -> Point, Tangent, Angle
unit_z_2 = UnitZ(Factor=1)
list_item_5 = ListItem(List=evaluate_curve.Point, Index=[Slider(0, range=0..10), Slider(4, range=0..10)], Wrap=True)
colour_swatch_3 = ColourSwatch(SwatchColor=RGB(255, 0, 0))
boolean_toggle = BooleanToggle(True)
list_item_6 = ListItem(List=evaluate_curve.Point, Index=[Slider(2, range=0..10), Slider(6, range=0..10)], Wrap=True)
colour_swatch_4 = ColourSwatch(SwatchColor=RGB(0, 0, 255))
cross_product = CrossProduct(VectorA=evaluate_curve.Tangent, VectorB=unit_z_2, Unitize=False)  # -> Vector, Length
list_item_7 = ListItem(List=cross_product.Vector, Index=[Slider(0, range=0..10), Slider(4, range=0..10)], Wrap=True)
list_item_8 = ListItem(List=cross_product.Vector, Index=[Slider(2, range=0..10), Slider(6, range=0..10)], Wrap=True)
multiplication_2 = Multiplication(A=list_item_7, B=Slider(100, range=0..100))
multiplication_3 = Multiplication(A=list_item_8, B=Slider(-100, range=-100..100))
move = Move(Geometry=list_item_5, Motion=multiplication_2)  # -> Geometry, Transform
move_2 = Move(Geometry=list_item_6, Motion=multiplication_3)  # -> Geometry, Transform
multiplication_4 = Multiplication(A=multiplication_2, B=Slider(0.8, range=0..1))
multiplication_5 = Multiplication(A=multiplication_3, B=Slider(0.8, range=0..1))
vector_display_ex_2 = VectorDisplayEx(Point=list_item_5, Vector=multiplication_4, Colour=colour_swatch_3, Width=2)
vector_display_ex_3 = VectorDisplayEx(Point=list_item_6, Vector=multiplication_5, Colour=colour_swatch_4, Width=2)

custom_preview_lineweights_6 = CustomPreviewLineweights(Geometry=list_item_2, Shader=colour_swatch, Thickness=number_slider_3, Absolute=boolean_toggle)
custom_preview_lineweights_7 = CustomPreviewLineweights(Geometry=list_item_2, Shader=colour_swatch, Thickness=number_slider_3, Absolute=boolean_toggle)
sphere_4 = Sphere(Base=[move.Geometry, list_item_5], Radius=number_slider_5)
sphere_5 = Sphere(Base=[list_item_6, move_2.Geometry], Radius=number_slider_5)

custom_preview_lineweights_8 = CustomPreviewLineweights(Geometry=sphere_4, Shader=colour_swatch_3, Absolute=boolean_toggle)
custom_preview_lineweights_9 = CustomPreviewLineweights(Geometry=sphere_5, Shader=colour_swatch_4, Absolute=Toggle(False))

list_item_9 = ListItem(List=evaluate_curve.Point, Index=panel_3, Wrap=True)
sphere_6 = Sphere(Base=list_item_9, Radius=number_slider_5)

evaluate_curve_2 = EvaluateCurve(Curve=list_item.Item1, Parameter=divide_curve_3.Parameters)  # -> Point, Tangent, Angle
unit_z_3 = UnitZ(Factor=1)
list_item_10 = ListItem(List=evaluate_curve_2.Point, Index=[Slider(0, range=0..10), Slider(4, range=0..10)], Wrap=True)
colour_swatch_5 = ColourSwatch(SwatchColor=RGB(0, 0, 255))
cross_product_2 = CrossProduct(VectorA=evaluate_curve_2.Tangent, VectorB=expr("-x", unit_z_3), Unitize=False)  # -> Vector, Length
list_item_11 = ListItem(List=cross_product_2.Vector, Index=[Slider(0, range=0..10), Slider(4, range=0..10)], Wrap=True)
list_item_12 = ListItem(List=evaluate_curve_2.Point, Index=[Slider(2, range=0..10), Slider(6, range=0..10)], Wrap=True)
colour_swatch_6 = ColourSwatch(SwatchColor=RGB(255, 0, 0))
list_item_13 = ListItem(List=cross_product_2.Vector, Index=[Slider(2, range=0..10), Slider(6, range=0..10)], Wrap=True)
multiplication_6 = Multiplication(A=list_item_11, B=Slider(100, range=0..100))
multiplication_7 = Multiplication(A=list_item_13, B=Slider(-100, range=-100..100))
move_3 = Move(Geometry=list_item_10, Motion=multiplication_6)  # -> Geometry, Transform
move_4 = Move(Geometry=list_item_12, Motion=multiplication_7)  # -> Geometry, Transform
multiplication_8 = Multiplication(A=multiplication_6, B=Slider(0.8, range=0..1))
multiplication_9 = Multiplication(A=multiplication_7, B=Slider(0.8, range=0..1))
vector_display_ex_4 = VectorDisplayEx(Point=list_item_10, Vector=multiplication_8, Colour=colour_swatch_5, Width=2)
vector_display_ex_5 = VectorDisplayEx(Point=list_item_12, Vector=multiplication_9, Colour=colour_swatch_6, Width=2)

sphere_7 = Sphere(Base=[list_item_10, move_3.Geometry], Radius=number_slider_5)
list_item_14 = ListItem(List=evaluate_curve_2.Point, Index=panel_4, Wrap=True)
sphere_8 = Sphere(Base=[move_4.Geometry, list_item_12], Radius=number_slider_5)

custom_preview_lineweights_10 = CustomPreviewLineweights(Geometry=sphere_7, Shader=colour_swatch_5, Absolute=Toggle(False))
custom_preview_lineweights_11 = CustomPreviewLineweights(Geometry=sphere_8, Shader=colour_swatch_6, Absolute=Toggle(False))

sphere_9 = Sphere(Base=list_item_14, Radius=number_slider_5)

# ==== cluster Cluster
brep = ClusterInput()
deconstruct_brep = DeconstructBrep(Brep=brep)  # -> Faces, Edges, Vertices
list_item = ListItem(List=deconstruct_brep.Faces, Index=Slider(5, range=0..6), Wrap=True)  # -> Item, Item1, Item2
geometry = ClusterInput()
volume = Volume(Geometry=geometry)  # -> Volume, Centroid
area = Area(Geometry=list_item.Item1)  # -> Area, flatten(Centroid)
area_2 = Area(Geometry=list_item.Item2)  # -> Area, flatten(Centroid)
plane_3pt = Plane3Pt(PointA=volume.Centroid, PointB=area_2.Centroid, PointC=area.Centroid)
center_box = CenterBox(Base=plane_3pt, X=Slider(120, range=0..1000), Y=Slider(57.5, range=0..100), Z=Slider(26, range=0..100))
vector_2pt = Vector2Pt(PointA=volume.Centroid, PointB=area.Centroid, Unitize=False)  # -> Vector, Length
rotate_3d = Rotate3D(Geometry=plane_3pt, Angle=degrees(Slider(180, range=0..1000)), Center=volume.Centroid, Axis=vector_2pt.Vector)  # -> Geometry, Transform
rotate = Rotate(Geometry=rotate_3d.Geometry, Angle=degrees(Slider(180, range=0..1000)), Plane=plane_3pt)  # -> Geometry, Transform
plane = Plane(rotate.Geometry)
unit_z = UnitZ(Factor=Slider(0, range=0..10))
move = Move(Geometry=plane, Motion=unit_z)  # -> Geometry, Transform
box = Box(center_box)
geometry_2 = ClusterOutput(move.Geometry)
