# Grasshopper definition full_scale_column.ghx (Grasshopper 1.0.8)

construct_point = ConstructPoint(XCoordinate=Slider(0, range=-1000..1000), YCoordinate=Slider(0, range=-1000..1000), ZCoordinate=0)
circle = Circle(Plane=construct_point, Radius=Slider(250, range=0..1000))

unit_z = UnitZ(Factor=Slider(-125, range=-200..0))
construct_point_2 = ConstructPoint(
    XCoordinate=Slider(-600, range=-1000..1000),
    YCoordinate=Slider(-400, range=-1000..1000),
    ZCoordinate=Slider(-32.5, range=-200..0))
rectangle = Rectangle(Plane=construct_point_2, XSize=Slider(1200, range=0..10000), YSize=Slider(800, range=0..1000), Radius=0)  # -> Rectangle, Length
bounding_box = BoundingBox(Content=[rectangle.Rectangle, unit_z], Plane=PlaneXY(0, 0, 0), UnionBox=True)  # -> Box, Box_2

custom_preview = CustomPreview(Geometry=bounding_box.Box, Material=ColourSwatch(SwatchColor=RGB(191, 191, 191)))

# ---- group: Concave
script = Script(
    curve=circle,
    divisions=Slider(12, range=0..20),
    row_count=Slider(30, range=0..30),
    degree=Slider(0.9, range=0..5),
    gap=Slider(8, range=0..100))  # -> bricks, geometries, way_planes, row_crv_pts, row_curves; inputs curve: Curve, divisions: Int32, row_count: Int32, degree: Double, gap: Double
# ---------- script: Python ----------
# r:compas
# venv: mas-2526
from compas_rhino.devtools import DevTools
DevTools.ensure_path()

import math as m
from compas.geometry import Box, Point, Bezier, NurbsCurve, Line, Frame
from compas.geometry import Transformation, Vector, cross_vectors, Translation
from compas_rhino.conversions import curve_to_compas, point_to_rhino, curve_to_rhino

from brick_wall_full_scale import Brick

bricks = []

# #import curve
wall_crv = curve_to_compas(curve)

row_curves = []

for r in range (row_count):
    #create new row
    crv = wall_crv.translated([0,0,Brick.HEIGHT * r])
    #row division
    params = crv.divide_by_count(divisions)

    row_crv_pts = []
    #manipulate each row
    if r < row_count * 2/3:
        for i, param in enumerate(params):
            pt = crv.point_at(param)
            tangent = crv.tangent_at(param)
            normal = tangent.cross([0,0,1])
            T = Translation.from_vector(normal * r * degree)
            T_2 = Translation.from_vector(-normal * r * degree)

            if i == len(params) -1:
                pt_c = pt.copy()
                pt_c.transform(T_2)
                row_crv_pts.insert(0,pt_c)
                pt.transform(T_2)
                row_crv_pts.append(pt)
            
            elif i == 0 or i % 2 == 0:
                row_crv_pts.append(pt)

            elif (i + 3) % 4 == 0:
                pt.transform(T)
                row_crv_pts.append(pt)
            
            elif i % 2 != 0:
                pt.transform(T_2)
                row_crv_pts.append(pt)
    
    else:
        for i, param in enumerate(params):
            pt = crv.point_at(param)
            tangent = crv.tangent_at(param)
            normal = tangent.cross([0,0,1])
            T = Translation.from_vector(normal * (row_count - (r - 1) * 2/3) * degree)
            T_2 = Translation.from_vector(-normal * (row_count - (r - 1) * 2/3) * degree)

            if i == len(params) -1:
                pt_c = pt.copy()
                pt_c.transform(T_2)
                row_crv_pts.insert(0,pt_c)
                pt.transform(T_2)
                row_crv_pts.append(pt)
            
            elif i == 0 or i % 2 == 0:
                row_crv_pts.append(pt)

            elif (i + 3) % 4 == 0:
                pt.transform(T)
                row_crv_pts.append(pt)
            
            elif i % 2 != 0:
                pt.transform(T_2)
                row_crv_pts.append(pt)

    from Rhino.Geometry import Curve
    
    #conversion between rhino_crv to create period crv
    row_crv = curve_to_rhino(NurbsCurve.from_interpolation(row_crv_pts))
    row_crv = curve_to_compas (Curve.CreatePeriodicCurve(row_crv))
    row_curves.append(row_crv)

    num_divs = int(row_crv.length() / (Brick.LENGTH+gap)) * 2
    params = row_crv.divide_by_count(num_divs)

    for col, param in enumerate(params):
        pt = row_crv.point_at(param)
        tangent = row_crv.tangent_at(param)
        normal = cross_vectors(tangent, [0,0,1])
        # only place bricks on alternating divisions depending on the row
        if r % 2 == 0:
            # even rows 
            if col % 2 == 0:
                b = Brick(frame = Frame(pt, tangent, normal))
                bricks.append(b)
        else:  
            # odd rows 
            if col % 2 == 1:
                b = Brick(frame = Frame(pt, tangent, normal))
                bricks.append(b)

geometries = []
way_planes = []

for brick in bricks:
    geometries.append(brick.draw())
    way_planes.append(brick.get_pick_frame())
# ---------- end script ----------

# ----
list_length = ListLength(List=script.geometries)
panel = Panel(list_length)
compas_draw = COMPASDraw(cg=script.geometries)  # -> rg
#   port cg: The COMPAS geometry or datastructure to be drawn.
#   port rg: The Rhino geometry object.
# ---------- compas_draw: Python ----------
# r: compas>=2.14.1
"""
Draws COMPAS geometry in Grasshopper.
"""

from typing import Any

import Grasshopper

from compas.scene import SceneObject


class CompasToRhinoGeometry(Grasshopper.Kernel.GH_ScriptInstance):
    def RunScript(self, cg):
        if not cg:
            return None

        return SceneObject(item=cg).draw()
# ---------- end compas_draw ----------
shift_list = ShiftList(List=compas_draw, Shift=1, Wrap=True)
brep_brep = BrepBrep(BrepA=compas_draw, BrepB=shift_list)  # -> Curves, Points
compas_draw_2 = COMPASDraw(cg=script.row_curves)  # -> rg; same code as compas_draw

# ---- group: Convex
script_2 = Script(
    curve=circle,
    divisions=Slider(12, range=0..20),
    row_count=Slider(30, range=0..100),
    degree=Slider(3, range=0..5),
    gap=Slider(36, range=0..100))  # -> bricks, geometries, way_planes, row_crv_pts, row_curves; inputs curve: Curve, divisions: Int32, row_count: Int32, degree: Double, gap: Double
# ---------- script_2: Python ----------
# r:compas
# venv: mas-2526
from compas_rhino.devtools import DevTools
DevTools.ensure_path()

import math as m
from compas.geometry import Box, Point, Bezier, NurbsCurve, Line, Frame
from compas.geometry import Transformation, Vector, cross_vectors, Translation
from compas_rhino.conversions import curve_to_compas, point_to_rhino, curve_to_rhino

from brick_wall_full_scale import Brick

bricks = []

# #import curve
wall_crv = curve_to_compas(curve)

row_curves = []

for r in range (row_count):
    #create new row
    crv = wall_crv.translated([0,0,Brick.HEIGHT * r])
    #row division
    params = crv.divide_by_count(divisions)

    row_crv_pts = []
    #manipulate each row
    if r < int(row_count * 2/3) + 1:
        for i, param in enumerate(params):
            pt = crv.point_at(param)
            tangent = crv.tangent_at(param)
            normal = tangent.cross([0,0,1])
            T = Translation.from_vector(normal * (int(row_count * 2/3) - r) * degree)
            T_2 = Translation.from_vector(-normal * (int(row_count * 2/3) - r) * degree)

            if i == len(params) -1:
                pt_c = pt.copy()
                pt_c.transform(T_2)
                row_crv_pts.insert(0,pt_c)
                pt.transform(T_2)
                row_crv_pts.append(pt)
            
            elif i == 0 or i % 2 == 0:
                row_crv_pts.append(pt)

            elif (i + 3) % 4 == 0:
                pt.transform(T)
                row_crv_pts.append(pt)
            
            elif i % 2 != 0:
                pt.transform(T_2)
                row_crv_pts.append(pt)
    
    else:
        for i, param in enumerate(params):
            pt = crv.point_at(param)
            tangent = crv.tangent_at(param)
            normal = tangent.cross([0,0,1])
            T = Translation.from_vector(normal * (r - int(row_count * 2/3) - 1)  * degree)
            T_2 = Translation.from_vector(-normal * (r - int(row_count * 2/3) - 1) * degree)

            if i == len(params) -1:
                pt_c = pt.copy()
                pt_c.transform(T)
                row_crv_pts.insert(0,pt_c)
                pt.transform(T)
                row_crv_pts.append(pt)
            
            elif i == 0 or i % 2 == 0:
                row_crv_pts.append(pt)

            elif (i + 3) % 4 == 0:
                pt.transform(T_2)
                row_crv_pts.append(pt)
            
            elif i % 2 != 0:
                pt.transform(T)
                row_crv_pts.append(pt)

    from Rhino.Geometry import Curve
    
    #conversion between rhino_crv to create period crv
    row_crv = curve_to_rhino(NurbsCurve.from_interpolation(row_crv_pts))
    row_crv = curve_to_compas (Curve.CreatePeriodicCurve(row_crv))
    row_curves.append(row_crv)

    num_divs = int(row_crv.length() / (Brick.LENGTH+gap)) * 2
    params = row_crv.divide_by_count(num_divs)

    for col, param in enumerate(params):
        pt = row_crv.point_at(param)
        tangent = row_crv.tangent_at(param)
        normal = cross_vectors(tangent, [0,0,1])
        # only place bricks on alternating divisions depending on the row
        if r % 2 == 0:
            # even rows 
            if col % 2 == 0:
                b = Brick(frame = Frame(pt, tangent, normal))
                bricks.append(b)
        else:  
            # odd rows 
            if col % 2 == 1:
                b = Brick(frame = Frame(pt, tangent, normal))
                bricks.append(b)

geometries = []
way_planes = []

for brick in bricks:
    geometries.append(brick.draw())
    way_planes.append(brick.get_pick_frame())
# ---------- end script_2 ----------

# ----
list_length_2 = ListLength(List=script_2.geometries)
panel_2 = Panel(list_length_2)
compas_draw_3 = COMPASDraw(cg=script_2.geometries)  # -> rg; same code as compas_draw
shift_list_2 = ShiftList(List=compas_draw_3, Shift=1, Wrap=True)
brep_brep_2 = BrepBrep(BrepA=compas_draw_3, BrepB=shift_list_2)  # -> Curves, Points
compas_draw_4 = COMPASDraw(cg=script_2.row_curves)  # -> rg; same code as compas_draw

volume = Volume(Geometry=compas_draw_3)  # -> Volume, Centroid
points = PointList(Points=volume.Centroid, Size=Slider(25, range=0..100))

# ---- group: check for collision and brick count
python_3_script = Python3Script(intersections=flatten(brep_brep_2.Curves), y=list_length_2)  # -> Red, instance, too_many_bricks; inputs intersections: list of Curve
# ---------- python_3_script: Python ----------
import math
import Rhino.Geometry as rg

instances = []
for i in intersections:
    pt_e = i.PointAtEnd
    pt_m = i.PointAtMid
    pt_s = i.PointAtStart
    x = rg.BoundingBox([pt_e, pt_m, pt_s])
    x_box = rg.Box(x)
    v = x_box.Z

    if int(v.Length) > 0.0:
        instances.append("yes")
    else:
        pass

Red = 255
instance = 125
too_many_bricks = []

if len(instances) > 0:
    instance = 0

for i in range(y):
    if i > 150:
        too_many_bricks.append(255)
    else:
        too_many_bricks.append(0)
# ---------- end python_3_script ----------
colour_rgb = ColourRGB(
    Alpha=Slider(200, range=0..1000),
    Red=python_3_script.Red,
    Green=python_3_script.instance,
    Blue=python_3_script.too_many_bricks)
custom_preview_2 = CustomPreview(Geometry=compas_draw_3, Material=colour_rgb)
