# Grasshopper definition Wallumn_brick_to_robot_New workspace.gh (Grasshopper 1.0.8)
# plug-ins: Pufferfish

# ---- group: This is needed only ONCE in the GH definition
enable_auto_reload = Python3Script()  # -> ok
# ---------- enable_auto_reload: Python ----------
"""
------------------------------
Using VS Code as Python editor
------------------------------

The simplest way to start using VS Code as our editor, is
to place our Python code in files located IN THE SAME FOLDER as our Grasshopper file.

After we have done that, we need 2 steps: 

1. Enable the COMPAS reloader on one component. This tells Grasshopper to watch for changes in the Pythoh files and reload if changed.
2. Every other component that uses Python code from external files needs to start with a method to ensure Grasshopper knows where to load the files from.

"""
# r: compas
# venv: mas-2526

from compas_rhino.devtools import DevTools
DevTools.enable_reloader()
# ---------- end enable_auto_reload ----------

# ----
# V1
# D-count!!!!!!!!!!!!!!!!!!!!!!!!!!!!!!
# end-supported pockets
number_slider = Slider(20, range=0..100)
pt = Point(<point referenced from the Rhino model>)
pt_2 = Point(<point referenced from the Rhino model>)
pt_3 = Point(<point referenced from the Rhino model>)
pt_4 = Point(<point referenced from the Rhino model>)
pt_5 = Point(<point referenced from the Rhino model>)
pt_6 = Point(<point referenced from the Rhino model>)
python_3_script = Python3Script(
    pt1=pt_2,
    pt2=pt_3,
    pt3=pt_6,
    pt4=pt,
    pt5=pt_4,
    pt6=pt_5,
    rows=number_slider,
    cols=Slider(3, range=0..100),
    xo=Slider(0, range=0..1000),
    yo=Slider(0, range=0..100),
    max_degree=Slider(15, range=-45..45),
    ex=Slider(28, range=0..100))  # -> out, geometries, wall_brep, way_planes, geometries_2; inputs pt1: Point3d, pt2: Point3d, pt3: Point3d, pt4: Point3d, pt5: Point3d, pt6: Point3d, rows: Int32, cols: Int32, xo: Int32
# ---------- python_3_script: Python ----------
import math
import compas.geometry as cg
from compas.geometry import Vector, Translation, Brep, Point, Plane, Frame, Box
from compas_rhino.conversions import point_to_compas

class Brick:
    LENGTH = 31.94
    WIDTH = 15.24
    HEIGHT = 10

    def __init__(self, frame=None):
        self.length = Brick.LENGTH
        self.width = Brick.WIDTH
        self.height = Brick.HEIGHT
        self.frame = frame if frame is not None else Frame.worldXY()

    def __str__(self):
        return f"Brick of {self.length}cm x {self.width}cm x {self.height}cm (frame: {self.frame})"

    def draw(self):
        box = Box(self.length, self.width, self.height)
        box.frame = self.frame.copy()
        return box

    def rotate(self, rotation_in_degrees):
        self.frame.rotate(math.radians(rotation_in_degrees), (0, 0, 1), self.frame.point)

    def get_pick_frame(self):
        pick_frame = self.frame.copy()
        pick_frame.point.z += self.height / 2

        if pick_frame.zaxis.z > 0:
            pick_frame.xaxis = -pick_frame.xaxis
        return pick_frame

x = 31.94
y = 15.24
z = 10.25
"""
pt1 = cg.Point(xo,yo,0)
pt2 = cg.Point(xo+u, yo+(cols*x*0.25),0)
pt3 = cg.Point(xo+u, yo+(cols*x*0.5), 0)
pt4 = cg.Point(xo-u, yo+(cols*x*0.75), 0)
pt5 = cg.Point(xo, yo+(cols*x),0)
"""
pts = [pt1, pt2, pt3]
base_crv = cg.NurbsCurve.from_interpolation(pts)

pts2 = [pt4, pt5, pt6]
top_crv = cg.NurbsCurve.from_interpolation(pts2)
top_crv.translate(Vector(0,0,rows*z-z))

crvs = [top_crv, base_crv]
wall_brep = cg.Brep.from_loft(crvs)

row_crvs = []
for i in range(rows):
    slice_plane = cg.Plane(Point(0, 0, i*z), Vector(0, 0, 1))
    row_crv = wall_brep.slice(slice_plane)
    row_crvs.extend(row_crv)

bricks = []

for j, crv in enumerate(row_crvs):
    params = crv.divide_by_count(cols)

    if j % 2 == 1:
        offset = (x*0.5) + 7
        params = [t + offset for t in params]
        params = params[:-1]

    pts = [crv.point_at(t) for t in params]
    tans = [crv.tangent_at(t) for t in params]
        
    if rows > 1:
        row_rotation = (j / (rows - 1)) * max_degree
    else:
        row_rotation = 0
    
    for pt, tan in zip(pts, tans):
        brick_frame = Frame(pt, Vector(1, 0, 0), Vector(0, 1, 0))
        brk = Brick(brick_frame)
                
        angle_radians = math.atan2(tan.y, tan.x)
        rot_degrees = math.degrees(angle_radians) + row_rotation
        brk.rotate(rot_degrees)
        
        bricks.append(brk)
    
    # end-supports # !!!!!!!!!!!!!!!!!!!!!!!!!!!!!!!!!!!!!!!!!!!!!!!!!!!!!!!!!!!!!!!!!!!!!!!!!!!!!!!!!!!!!!!!!!
    if j % 2 == 1:        
        first_tan = tans[0]
        first_tan_normalized = first_tan.unitized()        
        
        last_tan = tans[-1]
        last_tan_normalized = last_tan.unitized()
        
        first_edge_pt = pts[0] - first_tan_normalized * ex
        first_edge_frame = Frame(first_edge_pt, Vector(1, 0, 0), Vector(0, 1, 0))
        first_edge_brick = Brick(first_edge_frame)
        
        first_angle_radians = math.atan2(first_tan.y, first_tan.x)
        first_edge_brick.rotate(math.degrees(first_angle_radians) + 90 + row_rotation)
        bricks.append(first_edge_brick)        
        
        last_edge_pt = pts[-1] + last_tan_normalized * ex
        last_edge_frame = Frame(last_edge_pt, Vector(1, 0, 0), Vector(0, 1, 0))
        last_edge_brick = Brick(last_edge_frame)
        
        last_angle_radians = math.atan2(last_tan.y, last_tan.x)
        last_edge_brick.rotate(math.degrees(last_angle_radians) + 90 + row_rotation)
        bricks.append(last_edge_brick)

geometries = []
way_planes = []

for brick in bricks:
    geometries.append(brick.draw())
    way_planes.append(brick.get_pick_frame())
# ---------- end python_3_script ----------
draw = COMPASDraw(cg=python_3_script.wall_brep)  # -> rg
#   port cg: The COMPAS geometry or datastructure to be drawn.
#   port rg: The Rhino geometry object.
# ---------- draw: Python ----------
# r: compas>=2.14.1
"""
Draws COMPAS geometry in Grasshopper.
"""

from typing import Any

import Grasshopper

from compas.scene import SceneObject


class CompasToRhinoGeometry(Grasshopper.Kernel.GH_ScriptInstance):
    def RunScript(self, cg):
        if not cg:
            return None

        return SceneObject(item=cg).draw()
# ---------- end draw ----------
draw_2 = COMPASDraw(cg=python_3_script.geometries)  # -> rg; same code as draw
py3 = Python3Script(x=python_3_script.way_planes)  # -> out, a; inputs x: list
# ---------- py3: Python ----------
from compas_rhino.conversions import frame_to_rhino_plane

a = [frame_to_rhino_plane(f) for f in x]
# ---------- end py3 ----------
compas_draw = COMPASDraw(cg=python_3_script.way_planes)  # -> rg; same code as draw
preview = CustomPreview(
    Geometry=draw_2,
    Material={diffuse=RGB(221, 160, 221), emission=RGB(66, 48, 66), shine=0.5, specular=RGB(255, 255, 255), transparency=0})

# ----
# V1
# D-count!!!!!!!!!!!!!!!!!!!!!!!!!!!!!!
# end-supported pockets
number_slider_2 = Slider(20, range=0..100)
# Generate Geometry
pt_7 = Point(<point referenced from the Rhino model>)
pt_8 = Point(<point referenced from the Rhino model>)
pt_9 = Point(<point referenced from the Rhino model>)
pt_10 = Point(<point referenced from the Rhino model>)
pt_11 = Point(<point referenced from the Rhino model>)
pt_12 = Point(<point referenced from the Rhino model>)
python_3_script_2 = Python3Script(
    pt1=pt_7,
    pt2=pt_9,
    pt3=pt_12,
    pt4=pt_8,
    pt5=pt_10,
    pt6=pt_11,
    rows=number_slider_2,
    cols=Slider(3, range=0..100),
    xo=Slider(0, range=0..1000),
    yo=Slider(0, range=0..100),
    max_degree=Slider(15, range=-45..45),
    ex=Slider(28, range=0..100))  # -> out, geometries, wall_brep, way_planes, geometries_2; inputs pt1: Point3d, pt2: Point3d, pt3: Point3d, pt4: Point3d, pt5: Point3d, pt6: Point3d, rows: Int32, cols: Int32, xo: Int32; same code as python_3_script
draw_3 = COMPASDraw(cg=python_3_script_2.wall_brep)  # -> rg; same code as draw
draw_4 = COMPASDraw(cg=python_3_script_2.geometries)  # -> rg; same code as draw
py3_2 = Python3Script(x=python_3_script_2.way_planes)  # -> out, a; inputs x: list; same code as py3
compas_draw_2 = COMPASDraw(cg=python_3_script_2.way_planes)  # -> rg; same code as draw
preview_2 = CustomPreview(
    Geometry=draw_4,
    Material={diffuse=RGB(221, 160, 221), emission=RGB(66, 48, 66), shine=0.5, specular=RGB(255, 255, 255), transparency=0})

# ----
# simple pockets
number_slider_3 = Slider(14, range=0..100)
python_3_script_3 = Python3Script(
    rows=number_slider_3,
    cols=Slider(10, range=0..100),
    xo=Slider(100, range=0..100),
    yo=Slider(50, range=0..100),
    u=Slider(40, range=0..50),
    scale=Slider(0, range=0..1))  # -> out, geometries, wall_brep, way_planes, geometries_2; inputs rows: Int32, cols: Int32, xo: Int32
# ---------- python_3_script_3: Python ----------
import math
import compas.geometry as cg
from compas.geometry import Vector, Translation, Brep, Point, Plane, Frame, Box
from compas_rhino.conversions import point_to_compas

class Brick:
    # Class attribute for default brick dimensions
    LENGTH = 31.94
    WIDTH = 15.24
    HEIGHT = 9.98

    def __init__(self, frame=None):
        self.length = Brick.LENGTH
        self.width = Brick.WIDTH
        self.height = Brick.HEIGHT
        self.frame = frame if frame is not None else Frame.worldXY()

    def __str__(self):
        return f"Brick of {self.length}cm x {self.width}cm x {self.height}cm (frame: {self.frame})"

    def draw(self):
        box = Box(self.length, self.width, self.height)
        box.frame = self.frame.copy()
        return box

    def rotate(self, rotation_in_degrees):
        self.frame.rotate(math.radians(rotation_in_degrees), (0, 0, 1), self.frame.point)

    def get_pick_frame(self):
        pick_frame = self.frame.copy()
        pick_frame.point.z += self.height / 2

        if pick_frame.zaxis.z > 0:
            pick_frame.xaxis = -pick_frame.xaxis
        return pick_frame

x = 31.94
y = 15.24
z = 9.98
pt1 = cg.Point(xo,yo,0)
pt2 = cg.Point(xo+u, yo+(cols*x*0.25),0)
pt3 = cg.Point(xo, yo+(cols*x*0.5), 0)
pt4 = cg.Point(xo-u, yo+(cols*x*0.75), 0)
pt5 = cg.Point(xo, yo+(cols*x),0)
pts = [pt1,pt2,pt3,pt4,pt5]
base_crv = cg.NurbsCurve.from_interpolation(pts)

atr1 = cg.Point(cols*x*0.25, 0, 0)
atr2 = cg.Point(cols*x*0.75, 0, 0)

crv = cg.Line(pt1,pt5)
top_crv = cg.NurbsCurve.from_line(crv)
top_crv.translate(Vector(0,0,rows*z-z))

crvs = [top_crv, base_crv]
wall_brep = cg.Brep.from_loft(crvs)

row_crvs = []
for i in range(rows):
    slice_plane = cg.Plane(Point(0, 0, i*z), Vector(0, 0, 1))
    row_crv = wall_brep.slice(slice_plane)
    row_crvs.extend(row_crv)

bricks = []

for j, crv in enumerate(row_crvs):
    params = crv.divide_by_count(cols-1)

    if j % 2 == 1:
        offset = x / 2
        params = [t + offset for t in params]
        params = params[:-1]

    pts = [crv.point_at(t) for t in params]
    tans = [crv.tangent_at(t) for t in params]
    
    distances = []
    for pt, tan in zip(pts, tans):
        # Create frame at brick position
        brick_frame = Frame(pt, Vector(1, 0, 0), Vector(0, 1, 0))
        brk = Brick(brick_frame)
        
        angle_radians = math.atan2(tan.y, tan.x)
        
        dist = atr1.distance_to_point(pt)
        distances.append(dist)
        maxx = max(distances)
        rot_degrees = math.degrees(angle_radians + ((dist/maxx)*scale))
        
        brk.rotate(rot_degrees)
        
        bricks.append(brk)

geometries = []
way_planes = []

for brick in bricks:
    geometries.append(brick.draw())
    way_planes.append(brick.get_pick_frame())
# ---------- end python_3_script_3 ----------
draw_5 = COMPASDraw(cg=python_3_script_3.geometries)  # -> rg; same code as draw
draw_6 = COMPASDraw(cg=python_3_script_3.wall_brep)  # -> rg; same code as draw
py3_3 = Python3Script(x=python_3_script_3.way_planes)  # -> out, a; inputs x: list; same code as py3
compas_draw_3 = COMPASDraw(cg=python_3_script_3.way_planes)  # -> rg; same code as draw

# ----
# end-supported pockets
number_slider_4 = Slider(13, range=0..100)
python_3_script_4 = Python3Script(
    rows=number_slider_4,
    cols=Slider(9, range=0..100),
    xo=Slider(150, range=0..1000),
    yo=Slider(20, range=0..100),
    u=Slider(40, range=0..50),
    scale=Slider(0, range=0..1),
    ex=Slider(25, range=0..100))  # -> out, geometries, wall_brep, way_planes, geometries_2; inputs rows: Int32, cols: Int32, xo: Int32
# ---------- python_3_script_4: Python ----------
import math
import compas.geometry as cg
from compas.geometry import Vector, Translation, Brep, Point, Plane, Frame, Box
from compas_rhino.conversions import point_to_compas

class Brick:
    # Class attribute for default brick dimensions
    LENGTH = 31.94
    WIDTH = 15.24
    HEIGHT = 9.98

    def __init__(self, frame=None):
        self.length = Brick.LENGTH
        self.width = Brick.WIDTH
        self.height = Brick.HEIGHT
        self.frame = frame if frame is not None else Frame.worldXY()

    def __str__(self):
        return f"Brick of {self.length}cm x {self.width}cm x {self.height}cm (frame: {self.frame})"

    def draw(self):
        box = Box(self.length, self.width, self.height)
        box.frame = self.frame.copy()
        return box

    def rotate(self, rotation_in_degrees):
        self.frame.rotate(math.radians(rotation_in_degrees), (0, 0, 1), self.frame.point)

    def get_pick_frame(self):
        pick_frame = self.frame.copy()
        pick_frame.point.z += self.height / 2

        if pick_frame.zaxis.z > 0:
            pick_frame.xaxis = -pick_frame.xaxis
        return pick_frame

x = 31.94
y = 15.24
z = 9.98


pt1 = cg.Point(xo,yo,0)
pt2 = cg.Point(xo+u, yo+(cols*x*0.25),0)
pt3 = cg.Point(xo, yo+(cols*x*0.5), 0)
pt4 = cg.Point(xo-u, yo+(cols*x*0.75), 0)
pt5 = cg.Point(xo, yo+(cols*x),0)
pts = [pt1,pt2,pt3,pt4,pt5]
base_crv = cg.NurbsCurve.from_interpolation(pts)

atr1 = cg.Point(cols*x*0.25, 0, 0)
atr2 = cg.Point(cols*x*0.75, 0, 0)

crv = cg.Line(pt1,pt5)
top_crv = cg.NurbsCurve.from_line(crv)
top_crv.translate(Vector(0,0,rows*z-z))

crvs = [top_crv, base_crv]
wall_brep = cg.Brep.from_loft(crvs)

row_crvs = []
for i in range(rows):
    slice_plane = cg.Plane(Point(0, 0, i*z), Vector(0, 0, 1))
    row_crv = wall_brep.slice(slice_plane)
    row_crvs.extend(row_crv)

bricks = []

for j, crv in enumerate(row_crvs):
    params = crv.divide_by_count(cols-1)

    if j % 2 == 1:
        offset = x / 2
        params = [t + offset for t in params]
        params = params[:-1]

    pts = [crv.point_at(t) for t in params]
    tans = [crv.tangent_at(t) for t in params]
    
    distances = []
    for pt, tan in zip(pts, tans):
        brick_frame = Frame(pt, Vector(1, 0, 0), Vector(0, 1, 0))
        brk = Brick(brick_frame)
        
        angle_radians = math.atan2(tan.y, tan.x)
        dist = atr1.distance_to_point(pt)
        distances.append(dist)
        maxx = max(distances)
        rot_degrees = math.degrees(angle_radians + ((dist/maxx)*scale))
        brk.rotate(rot_degrees)
        
        bricks.append(brk)
    
    if j % 2 == 1 and len(pts) > 0:
        first_tan = tans[0]
        first_tan_normalized = first_tan.unitized()
        
        
        last_tan = tans[-1]
        last_tan_normalized = last_tan.unitized()
        
        
        first_edge_pt = pts[0] - first_tan_normalized * ex
        first_edge_frame = Frame(first_edge_pt, Vector(1, 0, 0), Vector(0, 1, 0))
        first_edge_brick = Brick(first_edge_frame)
        
        first_angle_radians = math.atan2(first_tan.y, first_tan.x)
        first_edge_brick.rotate(math.degrees(first_angle_radians) + 90)
        bricks.append(first_edge_brick)
        
        
        last_edge_pt = pts[-1] + last_tan_normalized * ex
        last_edge_frame = Frame(last_edge_pt, Vector(1, 0, 0), Vector(0, 1, 0))
        last_edge_brick = Brick(last_edge_frame)
        
        last_angle_radians = math.atan2(last_tan.y, last_tan.x)
        last_edge_brick.rotate(math.degrees(last_angle_radians) + 90)
        bricks.append(last_edge_brick)

geometries = []
way_planes = []

for brick in bricks:
    geometries.append(brick.draw())
    way_planes.append(brick.get_pick_frame())
# ---------- end python_3_script_4 ----------
draw_7 = COMPASDraw(cg=python_3_script_4.geometries)  # -> rg; same code as draw
py3_4 = Python3Script(x=python_3_script_4.way_planes)  # -> out, a; inputs x: list; same code as py3
compas_draw_4 = COMPASDraw(cg=python_3_script_4.way_planes)  # -> rg; same code as draw

# ----
# DIVIDE BY LENGTH
# end-supported pockets
number_slider_5 = Slider(20, range=0..100)
python_3_script_5 = Python3Script(
    rows=number_slider_5,
    cols=Slider(5, range=0..100),
    xo=Slider(200, range=0..1000),
    yo=Slider(50, range=0..100),
    u=Slider(25, range=0..50),
    max_degree=Slider(0, range=-45..45),
    ex=Slider(27, range=0..100))  # -> out, geometries, wall_brep, way_planes, geometries_2; inputs rows: Int32, cols: Int32, xo: Int32
# ---------- python_3_script_5: Python ----------
import math
import compas.geometry as cg
from compas.geometry import Vector, Translation, Brep, Point, Plane, Frame, Box
from compas_rhino.conversions import point_to_compas

class Brick:
    LENGTH = 31.94
    WIDTH = 15.24
    HEIGHT = 9.98

    def __init__(self, frame=None):
        self.length = Brick.LENGTH
        self.width = Brick.WIDTH
        self.height = Brick.HEIGHT
        self.frame = frame if frame is not None else Frame.worldXY()

    def __str__(self):
        return f"Brick of {self.length}cm x {self.width}cm x {self.height}cm (frame: {self.frame})"

    def draw(self):
        box = Box(self.length, self.width, self.height)
        box.frame = self.frame.copy()
        return box

    def rotate(self, rotation_in_degrees):
        self.frame.rotate(math.radians(rotation_in_degrees), (0, 0, 1), self.frame.point)

    def get_pick_frame(self):
        pick_frame = self.frame.copy()
        pick_frame.point.z += self.height / 2

        if pick_frame.zaxis.z > 0:
            pick_frame.xaxis = -pick_frame.xaxis
        return pick_frame

x = 31.94
y = 15.24
z = 9.98

pt1 = cg.Point(xo,yo,0)
pt2 = cg.Point(xo+u, yo+(cols*x*0.25),0)
pt3 = cg.Point(xo, yo+(cols*x*0.5), 0)
pt4 = cg.Point(xo-u, yo+(cols*x*0.75), 0)
pt5 = cg.Point(xo, yo+(cols*x),0)
pts = [pt1,pt2,pt3,pt4,pt5]
base_crv = cg.NurbsCurve.from_interpolation(pts)

crv = cg.Line(pt1,pt5)
top_crv = cg.NurbsCurve.from_line(crv)
top_crv.translate(Vector(0,0,rows*z-z))

crvs = [top_crv, base_crv]
wall_brep = cg.Brep.from_loft(crvs)

row_crvs = []
for i in range(rows):
    slice_plane = cg.Plane(Point(0, 0, i*z), Vector(0, 0, 1))
    row_crv = wall_brep.slice(slice_plane)
    row_crvs.extend(row_crv)

bricks = []

for j, crv in enumerate(row_crvs):
    params = crv.divide_by_length(x+5)

    if j % 2 == 1:
        offset = x / 2
        params = [t + offset for t in params]
        params = params[:-1]

    pts = [crv.point_at(t) for t in params]
    tans = [crv.tangent_at(t) for t in params]
        
    if rows > 1:
        row_rotation = (j / (rows - 1)) * max_degree
    else:
        row_rotation = 0
    
    for pt, tan in zip(pts, tans):
        brick_frame = Frame(pt, Vector(1, 0, 0), Vector(0, 1, 0))
        brk = Brick(brick_frame)
                
        angle_radians = math.atan2(tan.y, tan.x)
        rot_degrees = math.degrees(angle_radians) + row_rotation
        brk.rotate(rot_degrees)
        
        bricks.append(brk)
    
    # end-supports # !!!!!!!!!!!!!!!!!!!!!!!!!!!!!!!!!!!!!!!!!!!!!!!!!!!!!!!!!!!!!!!!!!!!!!!!!!!!!!!!!!!!!!!!!!
    if j % 2 == 1:        
        first_tan = tans[0]
        first_tan_normalized = first_tan.unitized()        
        
        last_tan = tans[-1]
        last_tan_normalized = last_tan.unitized()
        
        first_edge_pt = pts[0] - first_tan_normalized * ex
        first_edge_frame = Frame(first_edge_pt, Vector(1, 0, 0), Vector(0, 1, 0))
        first_edge_brick = Brick(first_edge_frame)
        
        first_angle_radians = math.atan2(first_tan.y, first_tan.x)
        first_edge_brick.rotate(math.degrees(first_angle_radians) + 90 + row_rotation)
        bricks.append(first_edge_brick)        
        
        last_edge_pt = pts[-1] + last_tan_normalized * ex
        last_edge_frame = Frame(last_edge_pt, Vector(1, 0, 0), Vector(0, 1, 0))
        last_edge_brick = Brick(last_edge_frame)
        
        last_angle_radians = math.atan2(last_tan.y, last_tan.x)
        last_edge_brick.rotate(math.degrees(last_angle_radians) + 90 + row_rotation)
        bricks.append(last_edge_brick)

geometries = []
way_planes = []

for brick in bricks:
    geometries.append(brick.draw())
    way_planes.append(brick.get_pick_frame())
# ---------- end python_3_script_5 ----------
draw_8 = COMPASDraw(cg=python_3_script_5.wall_brep)  # -> rg; same code as draw
draw_9 = COMPASDraw(cg=python_3_script_5.geometries)  # -> rg; same code as draw
py3_5 = Python3Script(x=python_3_script_5.way_planes)  # -> out, a; inputs x: list; same code as py3
compas_draw_5 = COMPASDraw(cg=python_3_script_5.way_planes)  # -> rg; same code as draw

pt_13 = Point(<point referenced from the Rhino model>)
pt_14 = Point(<point referenced from the Rhino model>)
pt_15 = Point(<point referenced from the Rhino model>)
pt_16 = Point(<point referenced from the Rhino model>)
pt_17 = Point(<point referenced from the Rhino model>)
pt_18 = Point(<point referenced from the Rhino model>)

# ----
# LINEAR ROTATION
# end-supported pockets
number_slider_6 = Slider(25, range=0..100)
python_3_script_6 = Python3Script(
    pt1=pt_14,
    pt2=pt_15,
    pt3=pt_18,
    pt4=pt_13,
    pt5=pt_16,
    pt6=pt_17,
    rows=number_slider_6,
    cols=Slider(9, range=0..100),
    xo=Slider(0, range=0..1000),
    yo=Slider(0, range=0..100),
    u=Slider(60, range=0..100),
    max_degree=Slider(15, range=-45..45),
    ex=Slider(27, range=0..100))  # -> out, geometries, wall_brep, way_planes, geometries_2; inputs pt1: Point3d, pt2: Point3d, pt3: Point3d, pt4: Point3d, pt5: Point3d, pt6: Point3d, rows: Int32, cols: Int32, xo: Int32
# ---------- python_3_script_6: Python ----------
import math
import compas.geometry as cg
from compas.geometry import Vector, Translation, Brep, Point, Plane, Frame, Box
from compas_rhino.conversions import point_to_compas

class Brick:
    LENGTH = 31.94
    WIDTH = 15.24
    HEIGHT = 10

    def __init__(self, frame=None):
        self.length = Brick.LENGTH
        self.width = Brick.WIDTH
        self.height = Brick.HEIGHT
        self.frame = frame if frame is not None else Frame.worldXY()

    def __str__(self):
        return f"Brick of {self.length}cm x {self.width}cm x {self.height}cm (frame: {self.frame})"

    def draw(self):
        box = Box(self.length, self.width, self.height)
        box.frame = self.frame.copy()
        return box

    def rotate(self, rotation_in_degrees):
        self.frame.rotate(math.radians(rotation_in_degrees), (0, 0, 1), self.frame.point)

    def get_pick_frame(self):
        pick_frame = self.frame.copy()
        pick_frame.point.z += self.height / 2

        if pick_frame.zaxis.z > 0:
            pick_frame.xaxis = -pick_frame.xaxis
        return pick_frame

x = 31.94
y = 15.24
z = 10
"""
pt1 = cg.Point(xo,yo,0)
pt2 = cg.Point(xo+u, yo+(cols*x*0.25),0)
pt3 = cg.Point(xo+u, yo+(cols*x*0.5), 0)
pt4 = cg.Point(xo-u, yo+(cols*x*0.75), 0)
pt5 = cg.Point(xo, yo+(cols*x),0)
"""
pts = [pt1, pt2, pt3, pt4]
base_crv = cg.NurbsCurve.from_interpolation(pts)

crv = cg.Line(pt5, pt6)
top_crv = cg.NurbsCurve.from_line(crv)
top_crv.translate(Vector(0,0,rows*z-z))

crvs = [top_crv, base_crv]
wall_brep = cg.Brep.from_loft(crvs)

row_crvs = []
for i in range(rows):
    slice_plane = cg.Plane(Point(0, 0, i*z), Vector(0, 0, 1))
    row_crv = wall_brep.slice(slice_plane)
    row_crvs.extend(row_crv)

bricks = []

for j, crv in enumerate(row_crvs):
    params = crv.divide_by_count(cols-1)

    if j % 2 == 1:
        offset = x / 2
        params = [t + offset for t in params]
        params = params[:-1]

    pts = [crv.point_at(t) for t in params]
    tans = [crv.tangent_at(t) for t in params]
        
    if rows > 1:
        row_rotation = (j / (rows - 1)) * max_degree
    else:
        row_rotation = 0
    
    for pt, tan in zip(pts, tans):
        brick_frame = Frame(pt, Vector(1, 0, 0), Vector(0, 1, 0))
        brk = Brick(brick_frame)
                
        angle_radians = math.atan2(tan.y, tan.x)
        rot_degrees = math.degrees(angle_radians) + row_rotation
        brk.rotate(rot_degrees)
        
        bricks.append(brk)
    
    # end-supports # !!!!!!!!!!!!!!!!!!!!!!!!!!!!!!!!!!!!!!!!!!!!!!!!!!!!!!!!!!!!!!!!!!!!!!!!!!!!!!!!!!!!!!!!!!
    if j % 2 == 1:        
        first_tan = tans[0]
        first_tan_normalized = first_tan.unitized()        
        
        last_tan = tans[-1]
        last_tan_normalized = last_tan.unitized()
        
        first_edge_pt = pts[0] - first_tan_normalized * ex
        first_edge_frame = Frame(first_edge_pt, Vector(1, 0, 0), Vector(0, 1, 0))
        first_edge_brick = Brick(first_edge_frame)
        
        first_angle_radians = math.atan2(first_tan.y, first_tan.x)
        first_edge_brick.rotate(math.degrees(first_angle_radians) + 90 + row_rotation)
        bricks.append(first_edge_brick)        
        
        last_edge_pt = pts[-1] + last_tan_normalized * ex
        last_edge_frame = Frame(last_edge_pt, Vector(1, 0, 0), Vector(0, 1, 0))
        last_edge_brick = Brick(last_edge_frame)
        
        last_angle_radians = math.atan2(last_tan.y, last_tan.x)
        last_edge_brick.rotate(math.degrees(last_angle_radians) + 90 + row_rotation)
        bricks.append(last_edge_brick)

geometries = []
way_planes = []

for brick in bricks:
    geometries.append(brick.draw())
    way_planes.append(brick.get_pick_frame())
# ---------- end python_3_script_6 ----------
draw_10 = COMPASDraw()  # -> rg; same code as draw
draw_11 = COMPASDraw(cg=python_3_script_6.geometries)  # -> rg; same code as draw
py3_6 = Python3Script(x=python_3_script_6.way_planes)  # -> out, a; inputs x: list; same code as py3
compas_draw_6 = COMPASDraw(cg=python_3_script_6.way_planes)  # -> rg; same code as draw

pt_19 = Point(<point referenced from the Rhino model>)
pt_20 = Point(<point referenced from the Rhino model>)
pt_21 = Point(<point referenced from the Rhino model>)
pt_22 = Point(<point referenced from the Rhino model>)
pt_23 = Point(<point referenced from the Rhino model>)
pt_24 = Point(<point referenced from the Rhino model>)
pt_25 = Point(<point referenced from the Rhino model>)

# ----
# D-length!!!!!!!!!!!!!!!!!!!!!!
# end-supported pockets
number_slider_7 = Slider(20, range=0..100)
python_3_script_7 = Python3Script(
    pt1=pt_20,
    pt2=pt_21,
    pt3=pt_25,
    pt4=pt_19,
    pt5=pt_22,
    pt6=pt_23,
    ptm=pt_24,
    rows=number_slider_7,
    cols=Slider(7, range=0..100),
    xo=Slider(0, range=0..1000),
    yo=Slider(0, range=0..100),
    u=Slider(60, range=0..100),
    max_degree=Slider(15, range=-45..45),
    ex=Slider(27, range=0..100))  # -> out, geometries, wall_brep, way_planes, geometries_2; inputs pt1: Point3d, pt2: Point3d, pt3: Point3d, pt4: Point3d, pt5: Point3d, pt6: Point3d, ptm: Point3d, rows: Int32, cols: Int32, xo: Int32
# ---------- python_3_script_7: Python ----------
import math
import compas.geometry as cg
from compas.geometry import Vector, Translation, Brep, Point, Plane, Frame, Box
from compas_rhino.conversions import point_to_compas

class Brick:
    LENGTH = 31.94
    WIDTH = 15.24
    HEIGHT = 10

    def __init__(self, frame=None):
        self.length = Brick.LENGTH
        self.width = Brick.WIDTH
        self.height = Brick.HEIGHT
        self.frame = frame if frame is not None else Frame.worldXY()

    def __str__(self):
        return f"Brick of {self.length}cm x {self.width}cm x {self.height}cm (frame: {self.frame})"

    def draw(self):
        box = Box(self.length, self.width, self.height)
        box.frame = self.frame.copy()
        return box

    def rotate(self, rotation_in_degrees):
        self.frame.rotate(math.radians(rotation_in_degrees), (0, 0, 1), self.frame.point)

    def get_pick_frame(self):
        pick_frame = self.frame.copy()
        pick_frame.point.z += self.height / 2

        if pick_frame.zaxis.z > 0:
            pick_frame.xaxis = -pick_frame.xaxis
        return pick_frame

x = 31.94
y = 15.24
z = 10
"""
pt1 = cg.Point(xo,yo,0)
pt2 = cg.Point(xo+u, yo+(cols*x*0.25),0)
pt3 = cg.Point(xo+u, yo+(cols*x*0.5), 0)
pt4 = cg.Point(xo-u, yo+(cols*x*0.75), 0)
pt5 = cg.Point(xo, yo+(cols*x),0)
"""
pts = [pt1, pt2, pt3, pt4]
base_crv = cg.NurbsCurve.from_interpolation(pts)

pts2 = [pt5, ptm, pt6]
top_crv = cg.NurbsCurve.from_interpolation(pts2)
top_crv.translate(Vector(0,0,rows*z-z))

crvs = [top_crv, base_crv]
wall_brep = cg.Brep.from_loft(crvs)

row_crvs = []
for i in range(rows):
    slice_plane = cg.Plane(Point(0, 0, i*z), Vector(0, 0, 1))
    row_crv = wall_brep.slice(slice_plane)
    row_crvs.extend(row_crv)

bricks = []

for j, crv in enumerate(row_crvs):
    params = crv.divide_by_length(x+5)

    if j % 2 == 1:
        offset = x / 2
        params = [t + offset for t in params]
        params = params[:-1]

    pts = [crv.point_at(t) for t in params]
    tans = [crv.tangent_at(t) for t in params]
        
    if rows > 1:
        row_rotation = (j / (rows - 1)) * max_degree
    else:
        row_rotation = 0
    
    for pt, tan in zip(pts, tans):
        brick_frame = Frame(pt, Vector(1, 0, 0), Vector(0, 1, 0))
        brk = Brick(brick_frame)
                
        angle_radians = math.atan2(tan.y, tan.x)
        rot_degrees = math.degrees(angle_radians) + row_rotation
        brk.rotate(rot_degrees)
        
        bricks.append(brk)
    
    # end-supports # !!!!!!!!!!!!!!!!!!!!!!!!!!!!!!!!!!!!!!!!!!!!!!!!!!!!!!!!!!!!!!!!!!!!!!!!!!!!!!!!!!!!!!!!!!
    if j % 2 == 1:        
        first_tan = tans[0]
        first_tan_normalized = first_tan.unitized()        
        
        last_tan = tans[-1]
        last_tan_normalized = last_tan.unitized()
        
        first_edge_pt = pts[0] - first_tan_normalized * ex
        first_edge_frame = Frame(first_edge_pt, Vector(1, 0, 0), Vector(0, 1, 0))
        first_edge_brick = Brick(first_edge_frame)
        
        first_angle_radians = math.atan2(first_tan.y, first_tan.x)
        first_edge_brick.rotate(math.degrees(first_angle_radians) + 90 + row_rotation)
        bricks.append(first_edge_brick)        
        
        last_edge_pt = pts[-1] + last_tan_normalized * ex
        last_edge_frame = Frame(last_edge_pt, Vector(1, 0, 0), Vector(0, 1, 0))
        last_edge_brick = Brick(last_edge_frame)
        
        last_angle_radians = math.atan2(last_tan.y, last_tan.x)
        last_edge_brick.rotate(math.degrees(last_angle_radians) + 90 + row_rotation)
        bricks.append(last_edge_brick)

geometries = []
way_planes = []

for brick in bricks:
    geometries.append(brick.draw())
    way_planes.append(brick.get_pick_frame())
# ---------- end python_3_script_7 ----------
draw_12 = COMPASDraw()  # -> rg; same code as draw
draw_13 = COMPASDraw(cg=python_3_script_7.geometries)  # -> rg; same code as draw
py3_7 = Python3Script(x=python_3_script_7.way_planes)  # -> out, a; inputs x: list; same code as py3
compas_draw_7 = COMPASDraw(cg=python_3_script_7.way_planes)  # -> rg; same code as draw

pt_26 = ConstructPoint(XCoordinate="290.5", YCoordinate="441.75", ZCoordinate="-23.4")
pt_27 = ConstructPoint(XCoordinate="472.5", YCoordinate="484.95", ZCoordinate="-23.4")
pt_28 = ConstructPoint(XCoordinate="290.5", YCoordinate="214.95", ZCoordinate="-23.4")
brec = BoundingRectangle(Geometry=[pt_26, pt_28, pt_27], Plane=PlaneXY(0, 0, 0), Axis=0, Slide=0, Union=True)  # -> Bounding, DimensionX, DimensionY

# ----
# Transform from Rhino to Robot Space
compas = Python3Script(
    way_planes=python_3_script.way_planes,
    wobj_origin=pt_26,
    wobj_xaxis=pt_28,
    wobj_xypoint=pt_27,
    z_safe_margin=Slider(4, range=0..10))  # -> out, transformed_planes; inputs way_planes: list, wobj_origin: Point3d, wobj_xaxis: Point3d, wobj_xypoint: Point3d, z_safe_margin: Double
# ---------- compas: Python ----------
import compas.geometry as cg

#in this step we transform our way planes to robot space
#the rhino co-ordinate system is rather abstract in the physical world
#the robot base plane assumed the base frame of robot is the origin
#but rhino does not know that
#thus we transform things from our design space(Rhino World XY) to Robot Base Plane that we measure

def set_robot_base(origin, xaxis, xypoint):
    """
    set a base plane representing the robot working object plane
    """
    robot_base = cg.Frame(origin, xaxis - origin, xypoint - origin)
    print (robot_base)
    return (robot_base)

def rhino_to_robot_space(rhino_plane,robot_base_plane):
    """
    Transform the objects from Rhino world XY plane to robot work object plane
    """
    T_matrix = cg.Transformation.from_frame_to_frame(cg.Frame.worldXY(), robot_base_plane)
    robot_plane = rhino_plane.transformed(T_matrix)
    return robot_plane

def set_z_safe_margin(planes_to_adjust, safety_margin):
    adjusted = []
    T = cg.Translation.from_vector(cg.Vector(0, 0, safety_margin))
    for f in planes_to_adjust:
        adjusted.append(f.transformed(T))
    return adjusted

# ===== Robot base is set =====
robot_base =  set_robot_base(wobj_origin, wobj_xaxis, wobj_xypoint)
print(robot_base)

# ===== Set safety margin for Z height ======
safe_planes = set_z_safe_margin(way_planes, z_safe_margin)

# ===== Transforming the rhino planes into robot planes =====
transformed_planes = []
for plane in safe_planes: 
    transformed_planes.append(rhino_to_robot_space(plane, robot_base))
# ---------- end compas ----------

compas_draw_8 = COMPASDraw(cg=compas.transformed_planes)  # -> rg; same code as draw
pt_29 = ConstructPoint(XCoordinate="11.40", YCoordinate="444.62", ZCoordinate="3.12")
pt_30 = ConstructPoint(XCoordinate="-18.04", YCoordinate="442.29", ZCoordinate="36.95")
pt_31 = ConstructPoint(XCoordinate="10.31", YCoordinate="452.95", ZCoordinate="5.85")
item = ListItem(List=compas_draw_8, Index=0, Wrap=True)  # -> flatten(Item)

# ----
# BRICK COUNT
number_slider_8 = Slider(5, range=0..10)
points = PointList(Points=item, Size=number_slider_8)

py3_8 = Python3Script(origin=pt_29, xaxis_pt=pt_30, xy_pt=pt_31)  # -> out, pick_frame; inputs origin: Point3d, xaxis_pt: Point3d, xy_pt: Point3d
# ---------- py3_8: Python ----------
from compas.geometry import Frame, Point
from compas.geometry import Rotation

from compas_rhino.conversions import point_to_compas
import math

origin = point_to_compas(origin)
xaxis_pt = point_to_compas(xaxis_pt)
xy_pt = point_to_compas(xy_pt)

#define pick frame
angle = math.radians(90)
pick_frame = Frame(origin, xaxis_pt - origin, xy_pt - origin)
pick_frame.rotate(angle, axis=pick_frame.normal, point=pick_frame.point)
# ---------- end py3_8 ----------
# Pick-up frame
py3_9 = Python3Script(
    origin=pt_29,
    xaxis_pt=pt_30,
    xy_pt=pt_31,
    x=Slider(0.2, range=0..1),
    y=Slider(0.2, range=0..1),
    z=Slider(0.2, range=0..1),
    Flip=Toggle(False))  # -> out, pick_frame; inputs origin: Point3d, xaxis_pt: Point3d, xy_pt: Point3d, x: Double, y: Double, z: Double, Flip: Boolean
# ---------- py3_9: Python ----------
from compas.geometry import Frame, Point, Transformation, Vector, Translation
from compas.geometry import Rotation
import math as m

from compas_rhino.conversions import point_to_compas

origin = point_to_compas(origin)
xaxis_pt = point_to_compas(xaxis_pt)
xy_pt = point_to_compas(xy_pt)

#define pick frame
pick_frame = Frame(origin, xaxis_pt - origin, xy_pt - origin)

Vector_1 = pick_frame.xaxis
Vector_2 = pick_frame.yaxis
Vector_3 = pick_frame.normal

#pick_frame adjustments
T_1 = Translation.from_vector(Vector_1 * x)
T_2 = Translation.from_vector(Vector_2 * y)
T_3 = Translation.from_vector(Vector_3 * z)

R = Rotation.from_axis_and_angle(pick_frame.normal, m.radians(90), pick_frame.point)
R_Flip = Rotation.from_axis_and_angle(Vector_1, m.radians(180), pick_frame.point)

if Flip == True:
    pick_frame.transform(R_Flip)

pick_frame.transform(T_3 * T_2 * T_1 * R)

from compas_rhino import conversions
pick_frame_plane = conversions.frame_to_rhino(pick_frame)
# ---------- end py3_9 ----------
item_2 = ListItem(List=item, Index=Slider(52, range=0..100), Wrap=True)
panel = Panel(py3_9.pick_frame)
compas_draw_9 = COMPASDraw(cg=py3_9.pick_frame)  # -> rg; same code as draw

pt_32 = ConstructPoint(XCoordinate="-2.22", YCoordinate="1.36", ZCoordinate="83.85")

# ----
# Convert Planes to URScript
number_slider_9 = Slider(2, range=0..3)
number_slider_10 = Slider(0.1, range=0..0.1)
number_slider_11 = Slider(0.1, range=0..0.1)
compas_2 = Python3Script(
    way_frames=compas.transformed_planes,
    tcp_measured=pt_32,
    acceleration=Slider(2.5, range=0..3),
    velocity=number_slider_9,
    pick_frame=py3_9.pick_frame)  # -> out, vis_frames, vis_planes, script; inputs way_frames: list, tcp_measured: Point3d, acceleration: Double, velocity: Double
# ---------- compas_2: Python ----------
from imp import reload
import sys
import os

#get current file path
path = ghenv.Component.OnPingDocument().FilePath
#get parent directory of the parent directory
parentdir = os.path.dirname(path)
#get src folder which contains classes
dire = os.path.join(parentdir,'src')

sys.path.append(dire)

import simple_ur_script as ur
reload(ur)

import utils 
reload(utils)

import simple_comm as com
reload(com)

import compas.geometry as cg
import math as m

# ===== Set global constants =======

IO = 4 #Global constant
SAFE_DIST = 50

# =================================

script = "" #create empty string

def pickup_brick(script,pick_up_frame):
    frames = []
    
    safe_pick_up_frame = pick_up_frame.translated(-pick_up_frame.normal*SAFE_DIST)
    
    ## add to the path: go to the safe plane
    script += ur.move_l(safe_pick_up_frame, acceleration, velocity)
    frames.append(safe_pick_up_frame)
    
    ## add to the path: go to the pick up plane
    script += ur.move_l(pick_up_frame, acceleration, velocity)
    frames.append(pick_up_frame)
    
    ## add to the path: turn on the vacuum and wait 1 sec.
    script += ur.set_digital_out(IO,True)
    script += ur.sleep(1)

    # add to the path: go back to the safe_plane
    script += ur.move_l(safe_pick_up_frame, acceleration, velocity)
    frames.append(safe_pick_up_frame)
    
    return script, frames


def place_brick(script, place_frame):
    
    frames = []
    
    safe_place_frame = place_frame.translated(cg.Vector(0,0,1)*SAFE_DIST)
    
    # add to the path: go to the safe plane
    script += ur.move_l(safe_place_frame, acceleration, velocity)
    frames.append(safe_place_frame)
    
    # add to the path: go to the place plane
    script += ur.move_l(place_frame, acceleration, velocity)
    frames.append(place_frame)
    
    ## add to the path: turn off the vacuum and wait 1 second (hold the brick)
    script += ur.set_digital_out(IO,False)
    script += ur.sleep(1)
    
    # add to the path: go back to the safe plane
    script += ur.move_l(safe_place_frame, acceleration, velocity)
    frames.append(safe_place_frame)
    
    return script,frames


#if value given for tcp measured, then add line to script, otherwise it will take current tcp from robot
if tcp_measured is not None:
    script += ur.set_tcp_by_angles(tcp_measured.X, tcp_measured.Y, tcp_measured.Z, m.radians(0.0),m.radians(0.0),m.radians(0))


vis_frames = []
#add move_l commands in sequence to script for each way plane
for brick_frame in way_frames:
    script, p = pickup_brick(script,pick_frame)
    vis_frames.extend(p) #only to visualize the planes
    script, p = place_brick(script,brick_frame)
    vis_frames.extend(p)


#format the script to make it sendable
script = com.concatenate_script(script)

from compas_rhino import conversions
import Rhino.Geometry as rg

vis_planes = [conversions.frame_to_rhino(frame) for frame in vis_frames]
# ---------- end compas_2 ----------
compas_draw_10 = COMPASDraw(cg=compas_2.vis_frames)  # -> rg; same code as draw
pline = PolyLine(Vertices=compas_2.vis_planes, Closed=False)

item_3 = ListItem(List=compas_draw_9, Index=0, Wrap=True)  # -> Item, Item1, Item2
pl = ConstructPlane(Origin=item_3.Item, XAxis=item_3.Item1, YAxis=item_3.Item2)

points_2 = PointList(Points=compas_2.vis_planes, Size=Slider(2, range=0..100))

panel_2 = Panel(compas_2.script)

# ---- group: Send UR script to Robot!
# Send to Robot!
panel_3 = Panel("192.168.10.10")
py3_10 = Python3Script(script=compas_2.script, ip_address=panel_3, send=Button())  # -> out, a; inputs script: String, ip_address: String, send: Boolean
# ---------- py3_10: Python ----------
import simple_comm as com

if send:
    com.send_script(script,ip_address)
# ---------- end py3_10 ----------
