# Grasshopper definition brick_wall_by_nadja.gh (Grasshopper 1.0.8)

number_slider = Slider(4, range=0..100)
gap = Slider(2, range=0..10)
pt = Point(<point referenced from the Rhino model>)
py3 = Python3Script(
    num_layers=Slider(22, range=0..100),
    gap=gap,
    num_bricks=Slider(100, range=0..100),
    up=Slider(20, range=0..100),
    down=Slider(11.37, range=0..100),
    width=Slider(3.5, range=0..100),
    length=Slider(0.0084, range=0..0.01),
    scale=Slider(3, range=0..10),
    position=pt)  # -> out, geometry, polylines, frames, circle, div_pts, geometries, way_planes; inputs num_layers: Int32, gap: Double, num_bricks: Int32, up: Double, down: Double, width: Double, length: Double, scale: Double, position: Point3d
# ---------- py3: Python ----------
# r: compas
# venv: mas-2526

from compas_rhino.devtools import DevTools
DevTools.enable_reloader()

# STEP 1: Import everything we will need
import math
from compas.geometry import Box
from compas.geometry import Point
from compas.geometry import Frame
from compas.geometry import Polygon, Polyline, Vector, Curve
import compas_rhino.conversions 
from compas.geometry import cross_vectors
from compas_rhino.conversions import curve_to_compas
from ghpythonlib.treehelpers import list_to_tree, tree_to_list


from brick_wall import Brick
from brick_wall import BigBrick

# Inputs and lists

division = Brick.LENGTH
height = Brick.HEIGHT

vectors = []
bricks = []

position = compas_rhino.conversions.point_to_compas(position)

def circle_points(center, num_points, mod, cir=Brick.LENGTH, up=up, down=down, width=width, length=length, scale=scale):
    points = []
    theta = 2 * math.pi / num_points # M1: angle of the polygon
    radius = 120 # M2: radius of the polygon acording to the lenght of the brick
    for i in range(num_points):
        theta = 2 * math.pi * i / num_points  # angle from 0 to 2π
        x = center.x + radius * math.cos(theta)*((mod+down)*length)*scale
        y = center.y + radius * math.sin(theta)/((mod+up)/width)*scale
        points.append(Point(x, y, center.z))
    return points

polylines = []
for n in range(num_layers):
    circle = circle_points(position, num_bricks, mod=n)
    circle.append(circle[0])
    polyline = Polyline(circle)
    polylines.append(polyline)


# 1. Start with an empty list of bricks to be created
#    make sure to match the name of this list to the output of this component!
bricks = []
all_points = []

for row, curve in enumerate(polylines):
    # divide curve twice as fine
    num_divs = int(curve.length / (Brick.LENGTH+gap))
    ### change the script so that num of bricks in the row
    if num_divs % 2 != 0:
        num_divs = num_divs - 1

    leng = curve.length / (num_divs*2)
    div_pts = curve.divide_by_length(leng)

    if len(div_pts) % 2 != 0:
        div_pts.pop(-1)


    for col, pt in enumerate(div_pts):
        param = curve.parameter_at(pt)
        pt = pt.translated([0,0,Brick.HEIGHT * row])
        tangent = curve.tangent_at(param)
        normal = cross_vectors(tangent, [0,0,1])

        # vector 
        vec = Vector(normal[0], normal[1], normal[2])
        vec.unitize()

        if row % 2 == 0:  
            # even rows 
            # print("perpendicular bricks")
            if col % 2 == 0:
                vec.scale(Brick.WIDTH/2)
                new_pt = pt.translated(vec)
                b = Brick(frame = Frame(new_pt, tangent, normal))
                bricks.append(b)
        else:  
            # odd rows 
            # print("paralel bricks")
            if col % 2 == 1:
                vec.scale(Brick.WIDTH/2)
                new_pt = pt.translated(vec)
                b = Brick(frame = Frame(new_pt, tangent, normal))
                bricks.append(b)
    all_points.append(div_pts)
# Visualize and store brick data
geometries = []
way_planes = []

# for brick in bricks:
#     brick.frame = brick.frame.translated(Vector(0,0,Brick.HEIGHT/2))

for br in bricks:
    geometries.append(br.draw())
    # fr = br.frame
    # fr = fr.translated(Vector(0,0,-(Brick.HEIGHT / 2)))
    # way_planes.append(fr)
    way_planes.append(br.get_pick_frame())


all_points = list_to_tree(all_points)
# ---------- end py3 ----------
python_3_script = Python3Script(x=py3.way_planes)  # -> out, a; inputs x: list
# ---------- python_3_script: Python ----------
from compas_rhino.conversions import frame_to_rhino_plane

a = [frame_to_rhino_plane(f) for f in x]
# ---------- end python_3_script ----------
draw = COMPASDraw(cg=py3.polylines)  # -> rg
#   port cg: The COMPAS geometry or datastructure to be drawn.
#   port rg: The Rhino geometry object.
# ---------- draw: Python ----------
# r: compas>=2.14.1
"""
Draws COMPAS geometry in Grasshopper.
"""

from typing import Any

import Grasshopper

from compas.scene import SceneObject


class CompasToRhinoGeometry(Grasshopper.Kernel.GH_ScriptInstance):
    def RunScript(self, cg):
        if not cg:
            return None

        return SceneObject(item=cg).draw()
# ---------- end draw ----------
draw_2 = COMPASDraw(cg=py3.circle)  # -> rg; same code as draw
draw_3 = COMPASDraw(cg=py3.div_pts)  # -> rg; same code as draw
draw_4 = COMPASDraw(cg=py3.geometry)  # -> rg; same code as draw
draw_5 = COMPASDraw(cg=py3.way_planes)  # -> rg; same code as draw
crv = Curve(draw)
draw_6 = COMPASDraw(cg=py3.geometries)  # -> rg; same code as draw
item = ListItem(List=draw_5, Index=0, Wrap=True)  # -> Item, Item1, Item2
pl = ConstructPlane(Origin=item.Item, XAxis=item.Item1, YAxis=item.Item2)
preview = CustomPreview(
    Geometry=draw_6,
    Material={diffuse=RGB(221, 160, 221), emission=RGB(66, 48, 66), shine=0.5, specular=RGB(255, 255, 255), transparency=0})
pln = Plane(flatten(pl))
item_2 = ListItem(List=pln, Index=Slider(14, range=0..100), Wrap=True)
number_slider_2 = Slider(4, range=0..100)
panel = Panel("520.86")
pt_2 = ConstructPoint(XCoordinate="526.99", YCoordinate="56.91", ZCoordinate="-23.76")
pt_3 = ConstructPoint(XCoordinate="303.78", YCoordinate="476.27", ZCoordinate="-22.11")
pt_4 = ConstructPoint(XCoordinate="303.78", YCoordinate="56.76", ZCoordinate="-21.99")
srf4pt = _4PointSurface(CornerA=pt_2, CornerB=pt_4, CornerC=pt_3)
compas = Python3Script(way_planes=py3.way_planes, wobj_origin=pt_4, wobj_xaxis=pt_2, wobj_xypoint=pt_3, z_safe_margin=Slider(4.5, range=0..10))  # -> out, transformed_planes; inputs way_planes: list, wobj_origin: Point3d, wobj_xaxis: Point3d, wobj_xypoint: Point3d, z_safe_margin: Double
# ---------- compas: Python ----------
import compas.geometry as cg

#in this step we transform our way planes to robot space
#the rhino co-ordinate system is rather abstract in the physical world
#the robot base plane assumed the base frame of robot is the origin
#but rhino does not know that
#thus we transform things from our design space(Rhino World XY) to Robot Base Plane that we measure

def set_robot_base(origin, xaxis, xypoint):
    """
    set a base plane representing the robot working object plane
    """
    robot_base = cg.Frame(origin, xaxis - origin, xypoint - origin)
    print (robot_base)
    return (robot_base)

def rhino_to_robot_space(rhino_plane,robot_base_plane):
    """
    Transform the objects from Rhino world XY plane to robot work object plane
    """
    T_matrix = cg.Transformation.from_frame_to_frame(cg.Frame.worldXY(), robot_base_plane)
    robot_plane = rhino_plane.transformed(T_matrix)
    return robot_plane

def set_z_safe_margin(planes_to_adjust, safety_margin):
    adjusted = []
    T = cg.Translation.from_vector(cg.Vector(0, 0, safety_margin))
    for f in planes_to_adjust:
        adjusted.append(f.transformed(T))
    return adjusted

# ===== Robot base is set =====
robot_base =  set_robot_base(wobj_origin, wobj_xaxis, wobj_xypoint)
print(robot_base)

# ===== Set safety margin for Z height ======
safe_planes = set_z_safe_margin(way_planes, z_safe_margin)

# ===== Transforming the rhino planes into robot planes =====
transformed_planes = []
for plane in safe_planes: 
    transformed_planes.append(rhino_to_robot_space(plane, robot_base))
# ---------- end compas ----------
compas_draw = COMPASDraw(cg=compas.transformed_planes)  # -> rg; same code as draw
pt_5 = ConstructPoint(XCoordinate="11.40", YCoordinate="444.62", ZCoordinate="2.12")
pt_6 = ConstructPoint(XCoordinate="-18.04", YCoordinate="442.29", ZCoordinate="36.95")
pt_7 = ConstructPoint(XCoordinate="10.31", YCoordinate="452.95", ZCoordinate="5.85")
pt_8 = ConstructPoint(XCoordinate="-18.04", YCoordinate="442.29", ZCoordinate="36.95")
pt_9 = ConstructPoint(XCoordinate="10.31", YCoordinate="452.95", ZCoordinate="5.85")
pt_10 = ConstructPoint(XCoordinate="11.40", YCoordinate="444.62", ZCoordinate="3.12")
item_3 = ListItem(List=compas_draw, Index=0, Wrap=True)  # -> flatten(Item)
py3_2 = Python3Script(origin=pt_5, xaxis_pt=pt_6, xy_pt=pt_7)  # -> out, pick_frame; inputs origin: Point3d, xaxis_pt: Point3d, xy_pt: Point3d
# ---------- py3_2: Python ----------
from compas.geometry import Frame, Point
from compas.geometry import Rotation

from compas_rhino.conversions import point_to_compas
import math

origin = point_to_compas(origin)
xaxis_pt = point_to_compas(xaxis_pt)
xy_pt = point_to_compas(xy_pt)

#define pick frame
angle = math.radians(90)
pick_frame = Frame(origin, xaxis_pt - origin, xy_pt - origin)
pick_frame.rotate(angle, axis=pick_frame.normal, point=pick_frame.point)
# ---------- end py3_2 ----------

pt_11 = ConstructPoint(XCoordinate="-2.22", YCoordinate="1.36", ZCoordinate="83.9")

py3_3 = Python3Script(origin=pt_10, xaxis_pt=pt_8, xy_pt=pt_9)  # -> out, pick_frame; inputs origin: Point3d, xaxis_pt: Point3d, xy_pt: Point3d; same code as py3_2
points = PointList(Points=item_3, Size=Slider(4, range=0..10))
# Pick-up frame
py3_4 = Python3Script(
    origin=pt_5,
    xaxis_pt=pt_6,
    xy_pt=pt_7,
    x=Slider(0.2, range=0..1),
    y=Slider(0.2, range=0..1),
    z=Slider(0.2, range=0..1),
    Flip=Toggle(False))  # -> out, pick_frame; inputs origin: Point3d, xaxis_pt: Point3d, xy_pt: Point3d, x: Double, y: Double, z: Double, Flip: Boolean
# ---------- py3_4: Python ----------
from compas.geometry import Frame, Point, Transformation, Vector, Translation
from compas.geometry import Rotation
import math as m

from compas_rhino.conversions import point_to_compas

origin = point_to_compas(origin)
xaxis_pt = point_to_compas(xaxis_pt)
xy_pt = point_to_compas(xy_pt)

#define pick frame
pick_frame = Frame(origin, xaxis_pt - origin, xy_pt - origin)

Vector_1 = pick_frame.xaxis
Vector_2 = pick_frame.yaxis
Vector_3 = pick_frame.normal

#pick_frame adjustments
T_1 = Translation.from_vector(Vector_1 * x)
T_2 = Translation.from_vector(Vector_2 * y)
T_3 = Translation.from_vector(Vector_3 * z)

R = Rotation.from_axis_and_angle(pick_frame.normal, m.radians(90), pick_frame.point)
R_Flip = Rotation.from_axis_and_angle(Vector_1, m.radians(180), pick_frame.point)

if Flip == True:
    pick_frame.transform(R_Flip)

pick_frame.transform(T_3 * T_2 * T_1 * R)

from compas_rhino import conversions
pick_frame_plane = conversions.frame_to_rhino(pick_frame)
# ---------- end py3_4 ----------
item_4 = ListItem(List=item_3, Index=Slider(25, range=0..100), Wrap=True)
panel_2 = Panel(py3_4.pick_frame)
compas_draw_2 = COMPASDraw(cg=py3_4.pick_frame)  # -> rg; same code as draw
compas_draw_3 = COMPASDraw(cg=py3_3.pick_frame)  # -> rg; same code as draw
number_slider_3 = Slider(0.1, range=0..0.1)
number_slider_4 = Slider(0.1, range=0..0.1)
item_5 = ListItem(List=compas_draw_2, Index=0, Wrap=True)  # -> Item, Item1, Item2
pl_2 = ConstructPlane(Origin=item_5.Item, XAxis=item_5.Item1, YAxis=item_5.Item2)
compas_2 = Python3Script(
    way_frames=compas.transformed_planes,
    tcp_measured=pt_11,
    acceleration=Slider(1, range=0..3),
    velocity=Slider(2, range=0..3),
    pick_frame=py3_4.pick_frame)  # -> out, vis_frames, vis_planes, script; inputs way_frames: list, tcp_measured: Point3d, acceleration: Double, velocity: Double
# ---------- compas_2: Python ----------
from imp import reload
import sys
import os

#get current file path
path = ghenv.Component.OnPingDocument().FilePath
#get parent directory of the parent directory
parentdir = os.path.dirname(path)
#get src folder which contains classes
dire = os.path.join(parentdir,'src')

sys.path.append(dire)

import simple_ur_script as ur
reload(ur)

import utils 
reload(utils)

import simple_comm as com
reload(com)

import compas.geometry as cg
import math as m

# ===== Set global constants =======

IO = 4 #Global constant
SAFE_DIST = 100
PICK_SAFE_DIST = 100

# =================================

script = "" #create empty string

def pickup_brick(script,pick_up_frame):
    frames = []
    
    safe_pick_up_frame = pick_up_frame.translated(-pick_up_frame.normal*SAFE_DIST)
    
    ## add to the path: go to the safe plane
    script += ur.move_l(safe_pick_up_frame, acceleration, velocity)
    frames.append(safe_pick_up_frame)
    
    ## add to the path: go to the pick up plane
    script += ur.move_l(pick_up_frame, acceleration, velocity)
    frames.append(pick_up_frame)
    
    ## add to the path: turn on the vacuum and wait 1 sec.
    script += ur.set_digital_out(IO,True)
    script += ur.sleep(1)

    # add to the path: go back to the safe_plane
    script += ur.move_l(safe_pick_up_frame, acceleration, velocity)
    frames.append(safe_pick_up_frame)
    
    return script, frames


def place_brick(script, place_frame):
    
    frames = []
    
    safe_place_frame = place_frame.translated(cg.Vector(0,0,1)*PICK_SAFE_DIST)
    
    # add to the path: go to the safe plane
    script += ur.move_l(safe_place_frame, acceleration, velocity)
    frames.append(safe_place_frame)
    
    # add to the path: go to the place plane
    script += ur.move_l(place_frame, acceleration, velocity)
    frames.append(place_frame)
    
    ## add to the path: turn off the vacuum and wait 1 second (hold the brick)
    script += ur.set_digital_out(IO,False)
    script += ur.sleep(1)
    
    # add to the path: go back to the safe plane
    script += ur.move_l(safe_place_frame, acceleration, velocity)
    frames.append(safe_place_frame)
    
    return script,frames


#if value given for tcp measured, then add line to script, otherwise it will take current tcp from robot
if tcp_measured is not None:
    script += ur.set_tcp_by_angles(tcp_measured.X, tcp_measured.Y, tcp_measured.Z, m.radians(0.0),m.radians(0.0),m.radians(0))


vis_frames = []
#add move_l commands in sequence to script for each way plane
for brick_frame in way_frames:
    script, p = pickup_brick(script,pick_frame)
    vis_frames.extend(p) #only to visualize the planes
    script, p = place_brick(script,brick_frame)
    vis_frames.extend(p)


#format the script to make it sendable
script = com.concatenate_script(script)

from compas_rhino import conversions
import Rhino.Geometry as rg

vis_planes = [conversions.frame_to_rhino(frame) for frame in vis_frames]
# ---------- end compas_2 ----------
compas_draw_4 = COMPASDraw(cg=compas_2.vis_frames)  # -> rg; same code as draw
points_2 = PointList(Points=compas_2.vis_planes, Size=Slider(6, range=0..100))
item_6 = ListItem(List=compas_draw_4, Index=0, Wrap=True)  # -> Item, Item1, Item2
pline = PolyLine(Vertices=compas_2.vis_planes, Closed=False)
pl_3 = ConstructPlane(Origin=item_6.Item, XAxis=item_6.Item1, YAxis=item_6.Item2)
panel_3 = Panel(compas_2.script)

# ---- group: Send UR script to Robot!
py3_5 = Python3Script(script=compas_2.script, ip_address="192.168.10.10", send=Button())  # -> out, a; inputs script: String, ip_address: String, send: Boolean
# ---------- py3_5: Python ----------
import simple_comm as com

if send:
    com.send_script(script,ip_address)
# ---------- end py3_5 ----------
