# Grasshopper definition 101_brick_to_robot_CORRECT TCP.ghx (Grasshopper 1.0.8)
# plug-ins: Pufferfish

# ---- group: This is needed only ONCE in the GH definition
enable_auto_reload = Python3Script()  # -> ok
# ---------- enable_auto_reload: Python ----------
"""
------------------------------
Using VS Code as Python editor
------------------------------

The simplest way to start using VS Code as our editor, is
to place our Python code in files located IN THE SAME FOLDER as our Grasshopper file.

After we have done that, we need 2 steps: 

1. Enable the COMPAS reloader on one component. This tells Grasshopper to watch for changes in the Pythoh files and reload if changed.
2. Every other component that uses Python code from external files needs to start with a method to ensure Grasshopper knows where to load the files from.

"""
# r: compas
# venv: mas-2526

from compas_rhino.devtools import DevTools
DevTools.enable_reloader()
# ---------- end enable_auto_reload ----------

# ----
crv = Curve(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)

# ----
# Brick wal_5
#  (U-curve + rotate at a stable number)
crv_u_2 = Curve(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)
crv_u_3 = Curve(<curve referenced from the Rhino model>)
py3 = Python3Script(
    crv=crv_u_3,
    num_layers=Slider(9, range=0..30),
    gap=Slider(3, range=0..10),
    cols=Slider(10, range=0..30),
    rotation=Slider(9, range=0..180))  # -> out, geometries, way_planes; inputs crv: Curve, num_layers: Int32, gap: Double, cols: Int32, rotation: Double
# ---------- py3: Python ----------
# r: compas
# venv: mas-2526

from compas_rhino.devtools import DevTools
DevTools.ensure_path()

import math
from compas.geometry import Box, Point, Frame, cross_vectors
from compas_rhino.conversions import curve_to_compas
from brick_wall_2 import Brick

bricks = []

curve = curve_to_compas(crv)
print(curve.length())

num_divs = int(curve.length())/(Brick.LENGTH+gap) * 2
params, div_pts = curve.divide_by_count(num_divs, True)

for row in range(num_layers):
    for col, param in enumerate(params):
        pt = curve.point_at(param)
        pt = pt.translated([0,0, Brick.HEIGHT * row])
        tangent = curve.tangent_at(param)
        normal = cross_vectors(tangent, [0,0,1])

        # dispatch A,B row
        if row % 2 == 0:
            if col % 2 == 0:
                bricks.append(Brick(frame = Frame(pt, tangent, normal)))
        else:
            if col % 2 == 1:
                bricks.append(Brick(frame = Frame(pt, tangent, normal)))

for b in bricks:
    b.rotate(rotation)

# visualize and store brick data
geometries = []
way_planes = []

for brick in bricks:
    geometries.append(brick.draw())
    way_planes.append(brick.get_pick_frame())
# ---------- end py3 ----------
draw = COMPASDraw(cg=py3.way_planes)  # -> rg
#   port cg: The COMPAS geometry or datastructure to be drawn.
#   port rg: The Rhino geometry object.
# ---------- draw: Python ----------
# r: compas>=2.14.1
"""
Draws COMPAS geometry in Grasshopper.
"""

from typing import Any

import Grasshopper

from compas.scene import SceneObject


class CompasToRhinoGeometry(Grasshopper.Kernel.GH_ScriptInstance):
    def RunScript(self, cg):
        if not cg:
            return None

        return SceneObject(item=cg).draw()
# ---------- end draw ----------
draw_2 = COMPASDraw(cg=py3.geometries)  # -> rg; same code as draw
item = ListItem(List=draw, Index=0, Wrap=True)  # -> Item, Item1, Item2
preview = CustomPreview(
    Geometry=draw_2,
    Material={diffuse=RGB(221, 160, 221), emission=RGB(66, 48, 66), shine=0.5, specular=RGB(255, 255, 255), transparency=0})
pl = ConstructPlane(Origin=item.Item, XAxis=item.Item1, YAxis=item.Item2)
pln = Plane(pl)

end = EndPoints(Curve=crv)  # -> Start, End
pl_2 = ConstructPlane(Origin=end.Start, XAxis=Vector(1, 0, 0), YAxis=Vector(0, 1, 0))
gap = Slider(2.5, range=0..10)
rotate = Rotate(Geometry=crv, Angle=degrees(Slider(90, range=0..100)), Plane=pl_2)  # -> Geometry, Transform
# Generate Geometry
brick_wall = Python3Script(crv=rotate.Geometry, num_layers=Slider(9, range=0..30), gap=gap)  # -> bricks, geometries, way_planes; inputs crv: Curve, num_layers: Int32, gap: Double
# ---------- brick_wall: Python ----------
# r: compas
# venv: mas-2526
from compas_rhino.devtools import DevTools
DevTools.ensure_path()

# 0. Import everything we will need
import math
from compas.geometry import Box
from compas.geometry import Point
from compas.geometry import Frame
from compas.geometry import cross_vectors
from compas_rhino.conversions import curve_to_compas

# ..also import our module "brick_wall.py", that needs to be in the same folder as our GH file
from brick_wall import Brick

# 1. Start with an empty list of bricks to be created
#    make sure to match the name of this list to the output of this component!
bricks = []

# 2. Create points on each curve
curve = curve_to_compas(crv)
print(curve.length())

# divide curve twice as fine
num_divs = int(curve.length() / (Brick.LENGTH+gap)) * 2
params, div_pts = curve.divide_by_count(num_divs, True)

for row in range(num_layers):
    for col, param in enumerate(params,):
        pt = curve.point_at(param)
        pt = pt.translated([0,0,Brick.HEIGHT * row])
        tangent = curve.tangent_at(param)
        normal = cross_vectors(tangent, [0,0,1])
        # only place bricks on alternating divisions depending on the row
        if row % 2 == 0:  
            # even rows 
            if col % 2 == 0:
                b = Brick(frame = Frame(pt, tangent, normal))
                bricks.append(b)
        else:  
            # odd rows 
            if col % 2 == 1:
                b = Brick(frame = Frame(pt, tangent, normal))
                bricks.append(b)

# Visualize and store brick data
geometries = []
way_planes = []

for brick in bricks:
    geometries.append(brick.draw())
    way_planes.append(brick.get_pick_frame())
# ---------- end brick_wall ----------
py3_2 = Python3Script(x=brick_wall.way_planes)  # -> out, a; inputs x: list
# ---------- py3_2: Python ----------
from compas_rhino.conversions import frame_to_rhino_plane

a = [frame_to_rhino_plane(f) for f in x]
# ---------- end py3_2 ----------
compas_draw = COMPASDraw(cg=brick_wall.geometries)  # -> rg; same code as draw
compas_draw_2 = COMPASDraw(cg=brick_wall.way_planes)  # -> rg; same code as draw
number_slider = Slider(3.5, range=0..100)
pt = ConstructPoint(XCoordinate="327.75", YCoordinate="-47.33", ZCoordinate="-5.55")
pt_2 = ConstructPoint(XCoordinate="327.75", YCoordinate="433.50", ZCoordinate="-5.55")
pt_3 = ConstructPoint(XCoordinate="584.15", YCoordinate="-47.33", ZCoordinate="-5.55")
brec = BoundingRectangle(Geometry=[pt, pt_3, pt_2], Plane=PlaneXY(0, 0, 0), Axis=0, Slide=0, Union=True)  # -> Bounding, DimensionX, DimensionY
# Transform from Rhino to Robot Space
compas = Python3Script(way_planes=py3.way_planes, wobj_origin=pt, wobj_xaxis=pt_3, wobj_xypoint=pt_2, z_safe_margin=Slider(3, range=0..10))  # -> out, transformed_planes; inputs way_planes: list, wobj_origin: Point3d, wobj_xaxis: Point3d, wobj_xypoint: Point3d, z_safe_margin: Double
# ---------- compas: Python ----------
import compas.geometry as cg

#in this step we transform our way planes to robot space
#the rhino co-ordinate system is rather abstract in the physical world
#the robot base plane assumed the base frame of robot is the origin
#but rhino does not know that
#thus we transform things from our design space(Rhino World XY) to Robot Base Plane that we measure

def set_robot_base(origin, xaxis, xypoint):
    """
    set a base plane representing the robot working object plane
    """
    robot_base = cg.Frame(origin, xaxis - origin, xypoint - origin)
    print (robot_base)
    return (robot_base)

def rhino_to_robot_space(rhino_plane,robot_base_plane):
    """
    Transform the objects from Rhino world XY plane to robot work object plane
    """
    T_matrix = cg.Transformation.from_frame_to_frame(cg.Frame.worldXY(), robot_base_plane)
    robot_plane = rhino_plane.transformed(T_matrix)
    return robot_plane

def set_z_safe_margin(planes_to_adjust, safety_margin):
    adjusted = []
    T = cg.Translation.from_vector(cg.Vector(0, 0, safety_margin))
    for f in planes_to_adjust:
        adjusted.append(f.transformed(T))
    return adjusted

# ===== Robot base is set =====
robot_base =  set_robot_base(wobj_origin, wobj_xaxis, wobj_xypoint)
print(robot_base)

# ===== Set safety margin for Z height ======
safe_planes = set_z_safe_margin(way_planes, z_safe_margin)

# ===== Transforming the rhino planes into robot planes =====
transformed_planes = []
for plane in safe_planes: 
    transformed_planes.append(rhino_to_robot_space(plane, robot_base))
# ---------- end compas ----------
compas_draw_3 = COMPASDraw(cg=compas.transformed_planes)  # -> rg; same code as draw
pt_4 = ConstructPoint(XCoordinate="11.40", YCoordinate="444.62", ZCoordinate="3.12")
pt_5 = ConstructPoint(XCoordinate="-18.04", YCoordinate="442.29", ZCoordinate="36.95")
pt_6 = ConstructPoint(XCoordinate="10.31", YCoordinate="452.95", ZCoordinate="5.85")
item_2 = ListItem(List=compas_draw_3, Index=0, Wrap=True)  # -> flatten(Item)

pt_7 = ConstructPoint(XCoordinate="-2.22", YCoordinate="1.36", ZCoordinate="83.85")

py3_3 = Python3Script(origin=pt_4, xaxis_pt=pt_5, xy_pt=pt_6)  # -> out, pick_frame; inputs origin: Point3d, xaxis_pt: Point3d, xy_pt: Point3d
# ---------- py3_3: Python ----------
from compas.geometry import Frame, Point
from compas.geometry import Rotation

from compas_rhino.conversions import point_to_compas
import math

origin = point_to_compas(origin)
xaxis_pt = point_to_compas(xaxis_pt)
xy_pt = point_to_compas(xy_pt)

#define pick frame
angle = math.radians(90)
pick_frame = Frame(origin, xaxis_pt - origin, xy_pt - origin)
pick_frame.rotate(angle, axis=pick_frame.normal, point=pick_frame.point)
# ---------- end py3_3 ----------
py3_4 = Python3Script(
    origin=pt_4,
    xaxis_pt=pt_5,
    xy_pt=pt_6,
    x=Slider(0.2, range=0..1),
    y=Slider(0.2, range=0..1),
    z=Slider(0.2, range=0..1),
    Flip=Toggle(False))  # -> out, pick_frame; inputs origin: Point3d, xaxis_pt: Point3d, xy_pt: Point3d, x: Double, y: Double, z: Double, Flip: Boolean
# ---------- py3_4: Python ----------
from compas.geometry import Frame, Point, Transformation, Vector, Translation
from compas.geometry import Rotation
import math as m

from compas_rhino.conversions import point_to_compas

origin = point_to_compas(origin)
xaxis_pt = point_to_compas(xaxis_pt)
xy_pt = point_to_compas(xy_pt)

#define pick frame
pick_frame = Frame(origin, xaxis_pt - origin, xy_pt - origin)

Vector_1 = pick_frame.xaxis
Vector_2 = pick_frame.yaxis
Vector_3 = pick_frame.normal

#pick_frame adjustments
T_1 = Translation.from_vector(Vector_1 * x)
T_2 = Translation.from_vector(Vector_2 * y)
T_3 = Translation.from_vector(Vector_3 * z)

R = Rotation.from_axis_and_angle(pick_frame.normal, m.radians(90), pick_frame.point)
R_Flip = Rotation.from_axis_and_angle(Vector_1, m.radians(180), pick_frame.point)

if Flip == True:
    pick_frame.transform(R_Flip)

pick_frame.transform(T_3 * T_2 * T_1 * R)

from compas_rhino import conversions
pick_frame_plane = conversions.frame_to_rhino(pick_frame)
# ---------- end py3_4 ----------
points = PointList(Points=item_2, Size=Slider(4, range=0..10))
item_3 = ListItem(List=item_2, Index=Slider(25, range=0..100), Wrap=True)
panel = Panel(py3_4.pick_frame)
compas_draw_4 = COMPASDraw(cg=py3_4.pick_frame)  # -> rg; same code as draw
item_4 = ListItem(List=compas_draw_4, Index=0, Wrap=True)  # -> Item, Item1, Item2
# Convert Planes to URScript
number_slider_2 = Slider(0.1, range=0..0.1)
number_slider_3 = Slider(0.1, range=0..0.1)
pl_3 = ConstructPlane(Origin=item_4.Item, XAxis=item_4.Item1, YAxis=item_4.Item2)
compas_2 = Python3Script(
    way_frames=compas.transformed_planes,
    tcp_measured=pt_7,
    acceleration=Slider(1, range=0..3),
    velocity=Slider(2, range=0..3),
    pick_frame=py3_4.pick_frame)  # -> out, vis_frames, vis_planes, script; inputs way_frames: list, tcp_measured: Point3d, acceleration: Double, velocity: Double
# ---------- compas_2: Python ----------
from imp import reload
import sys
import os

#get current file path
path = ghenv.Component.OnPingDocument().FilePath
#get parent directory of the parent directory
parentdir = os.path.dirname(path)
#get src folder which contains classes
dire = os.path.join(parentdir,'src')

sys.path.append(dire)

import simple_ur_script as ur
reload(ur)

import utils 
reload(utils)

import simple_comm as com
reload(com)

import compas.geometry as cg
import math as m

# ===== Set global constants =======

IO = 4 #Global constant
SAFE_DIST = 50

# =================================

script = "" #create empty string

def pickup_brick(script,pick_up_frame):
    frames = []
    
    safe_pick_up_frame = pick_up_frame.translated(-pick_up_frame.normal*SAFE_DIST)
    
    ## add to the path: go to the safe plane
    script += ur.move_l(safe_pick_up_frame, acceleration, velocity)
    frames.append(safe_pick_up_frame)
    
    ## add to the path: go to the pick up plane
    script += ur.move_l(pick_up_frame, acceleration, velocity)
    frames.append(pick_up_frame)
    
    ## add to the path: turn on the vacuum and wait 1 sec.
    script += ur.set_digital_out(IO,True)
    script += ur.sleep(1)

    # add to the path: go back to the safe_plane
    script += ur.move_l(safe_pick_up_frame, acceleration, velocity)
    frames.append(safe_pick_up_frame)
    
    return script, frames


def place_brick(script, place_frame):
    
    frames = []
    
    safe_place_frame = place_frame.translated(cg.Vector(0,0,1)*SAFE_DIST)
    
    # add to the path: go to the safe plane
    script += ur.move_l(safe_place_frame, acceleration, velocity)
    frames.append(safe_place_frame)
    
    # add to the path: go to the place plane
    script += ur.move_l(place_frame, acceleration, velocity)
    frames.append(place_frame)
    
    ## add to the path: turn off the vacuum and wait 1 second (hold the brick)
    script += ur.set_digital_out(IO,False)
    script += ur.sleep(1)
    
    # add to the path: go back to the safe plane
    script += ur.move_l(safe_place_frame, acceleration, velocity)
    frames.append(safe_place_frame)
    
    return script,frames


#if value given for tcp measured, then add line to script, otherwise it will take current tcp from robot
if tcp_measured is not None:
    script += ur.set_tcp_by_angles(tcp_measured.X, tcp_measured.Y, tcp_measured.Z, m.radians(0.0),m.radians(0.0),m.radians(0))


vis_frames = []
#add move_l commands in sequence to script for each way plane
for brick_frame in way_frames:
    script, p = pickup_brick(script,pick_frame)
    vis_frames.extend(p) #only to visualize the planes
    script, p = place_brick(script,brick_frame)
    vis_frames.extend(p)


#format the script to make it sendable
script = com.concatenate_script(script)

from compas_rhino import conversions
import Rhino.Geometry as rg

vis_planes = [conversions.frame_to_rhino(frame) for frame in vis_frames]
# ---------- end compas_2 ----------
points_2 = PointList(Points=compas_2.vis_planes, Size=Slider(6, range=0..100))
compas_draw_5 = COMPASDraw(cg=compas_2.vis_frames)  # -> rg; same code as draw
pline = PolyLine(Vertices=compas_2.vis_planes, Closed=False)
panel_2 = Panel(compas_2.script)

# ---- group: Send UR script to Robot!
# Send to Robot!
panel_3 = Panel("192.168.10.10")
py3_5 = Python3Script(script=compas_2.script, ip_address=panel_3, send=Button())  # -> out, a; inputs script: String, ip_address: String, send: Boolean
# ---------- py3_5: Python ----------
import simple_comm as com

if send:
    com.send_script(script,ip_address)
# ---------- end py3_5 ----------
