# Grasshopper definition 101_brick_to_robot_nadja (tests).gh (Grasshopper 1.0.8)

# ---- group: test 1
number_slider = Slider(3, range=0..10)  # disabled
number_slider_2 = Slider(3, range=0..30)  # disabled
number_slider_3 = Slider(25, range=0..100)  # disabled
gap = Slider(3, range=0..10)  # disabled
multiplication = Multiplication(A=number_slider_2, B=number_slider)  # disabled
multiplication_2 = Multiplication(A=number_slider_3, B=multiplication)  # disabled
panel = Panel(multiplication_2)  # disabled
py3 = Python3Script(num_layers=number_slider_3, gap=gap, num_bricks=number_slider_2)  # -> out, geometry, poly, polylines, center, frames; inputs num_layers: Int32, gap: Double, num_bricks: Int32; disabled
# ---------- py3: Python ----------
# r: compas
# venv: mas-2526

from compas_rhino.devtools import DevTools
DevTools.enable_reloader()

# STEP 1: Import everything we will need
import math
from compas.geometry import Box
from compas.geometry import Point
from compas.geometry import Frame
from compas.geometry import Polygon, Polyline, Vector
import compas_rhino.conversions 


from brick_wall import Brick

# geometry = compas_rhino.conversions.brep_to_compas(brep)

# Make curve as a triangle that is equal to the brick size


division = Brick.LENGTH + gap
x = division * num_bricks
y = x * math.sin(math.radians(60))

print(x, y)

pt_one = Point(0,0,0)
pt_two = Point(x, 0, 0)
pt_three = Point(x/2, y, 0)
center = Point(x/2, y/3, 0)

pt_list = [pt_one, pt_two, pt_three, pt_one]

poly = Polyline(pt_list)

vectors = []
bricks = []

polylines = []
height = Brick.HEIGHT
for row in range(num_layers):
    polyline = poly.translated([0,0,height*row])
    polyline.rotate(math.radians(3*row), axis=Vector(0,0,1), point=center)
    polylines.append(polyline)
    points_list = polyline.divide_by_length(division/2)
    for i, pt in enumerate(points_list):
        if i % 2 != 0:
            tan = polyline.tangent_at_point(pt)
            vectors.append(tan)
            cross = tan.cross(Vector(0,0,1))
            cross.unitize()
            cross.scale(Brick.WIDTH/2)
            new_pt = pt.translated(cross)
            brick = Brick(frame = Frame(new_pt, tan, cross))
            bricks.append(brick)

geometry = []
frames = []
for brick in bricks:
    b = brick.draw()
    frame = b.frame
    geometry.append(b)
    frames.append(frame)
# ---------- end py3 ----------
draw = COMPASDraw(cg=py3.geometry)  # -> rg; disabled
#   port cg: The COMPAS geometry or datastructure to be drawn.
#   port rg: The Rhino geometry object.
# ---------- draw: Python ----------
# r: compas>=2.14.1
"""
Draws COMPAS geometry in Grasshopper.
"""

from typing import Any

import Grasshopper

from compas.scene import SceneObject


class CompasToRhinoGeometry(Grasshopper.Kernel.GH_ScriptInstance):
    def RunScript(self, cg):
        if not cg:
            return None

        return SceneObject(item=cg).draw()
# ---------- end draw ----------
draw_2 = COMPASDraw(cg=py3.polylines)  # -> rg; disabled; same code as draw
draw_3 = COMPASDraw(cg=py3.center)  # -> rg; disabled; same code as draw
draw_4 = COMPASDraw(cg=py3.frames)  # -> rg; disabled; same code as draw

# ----
number_slider_4 = Slider(40, range=0..100)
gap_2 = Slider(3, range=0..10)
gap_3 = Slider(2, range=0..10)

# ---- group: test 3
number_slider_5 = Slider(6, range=0..30)
number_slider_6 = Slider(25, range=0..100)
gap_4 = Slider(3, range=0..10)
multiplication_3 = Multiplication(A=number_slider_6, B=number_slider_5)
py3_2 = Python3Script(num_layers=number_slider_6, gap=gap_4, num_bricks=number_slider_5)  # -> out, geometry, polylines, frames, circle; inputs num_layers: Int32, gap: Double, num_bricks: Int32
# ---------- py3_2: Python ----------
# r: compas
# venv: mas-2526

from compas_rhino.devtools import DevTools
DevTools.enable_reloader()

# STEP 1: Import everything we will need
import math
from compas.geometry import Box
from compas.geometry import Point
from compas.geometry import Frame
from compas.geometry import Polygon, Polyline, Vector
import compas_rhino.conversions 


from brick_wall import Brick

# Inputs and lists

division = Brick.LENGTH + gap
height = Brick.HEIGHT

vectors = []
bricks = []


def circle_points(center, num_points, cir=Brick.LENGTH + gap):
    points = []
    theta = 2 * math.pi / num_points # M1: angle of the polygon
    radius = (cir/2)/(math.sin(theta/2)) # M2: radius of the polygon acording to the lenght of the brick
    for i in range(num_points):
        theta = 2 * math.pi * i / num_points  # angle from 0 to 2π
        x = center.x + radius * math.cos(theta)
        y = center.y + radius * math.sin(theta)
        points.append(Point(x, y, center.z))
    return points


circle = circle_points(Point(0,0,0), num_bricks)
circle.append(circle[0])
polyline = Polyline(circle)


min_brick_num = 4
layers = int(num_bricks - min_brick_num)
print(layers)
layer_crv_num = int(num_layers / (layers + 1))
print(layer_crv_num)

change = [0]
for i in range(layers):
    num = change[i] + layer_crv_num
    change.append(num)
print(change)
num_layers = int(layer_crv_num * (layers + 1))
print(num_layers)
circle_size = []
for n in range(-num_bricks, -min_brick_num + 1):
    circle_size.append(abs(n))
print(circle_size)


polylines = []
for n, i in zip(circle_size, change):
    circle = circle_points(Point(0,0,0), abs(n))
    circle.append(circle[0])
    polyline = Polyline(circle)
    polyline.translate([0,0,height*i])
    theta = 2 * math.pi / abs(n)
    polyline.rotate((theta/2), axis=Vector(0,0,1), point=Point(0,0,0))
    for row in range(layer_crv_num):
        crv = polyline.translated([0,0,height*row])
        crv.rotate((theta/2)*row, axis=Vector(0,0,1), point=Point(0,0,0))
        polylines.append(crv)
        points_list = crv.divide_by_length(division/2)
        for i, pt in enumerate(points_list):
            if i % 2 != 0:
                tan = crv.tangent_at_point(pt)
                vectors.append(tan)
                cross = tan.cross(Vector(0,0,1))
                cross.unitize()
                cross.scale(Brick.WIDTH/2)
                new_pt = pt.translated(cross)
                brick = Brick(frame = Frame(new_pt, tan, cross))
                bricks.append(brick)


geometry = []
frames = []
for brick in bricks:
    b = brick.draw()
    frame = b.frame
    geometry.append(b)
    frames.append(frame)
# ---------- end py3_2 ----------
panel_2 = Panel(multiplication_3)
draw_5 = COMPASDraw(cg=py3_2.geometry)  # -> rg; same code as draw
draw_6 = COMPASDraw(cg=py3_2.polylines)  # -> rg; same code as draw
draw_7 = COMPASDraw(cg=py3_2.circle)  # -> rg; same code as draw

# ---- group: test 4
number_slider_7 = Slider(5, range=0..30)
number_slider_8 = Slider(25, range=0..100)
gap_5 = Slider(3, range=0..10)
multiplication_4 = Multiplication(A=number_slider_8, B=number_slider_7)
py3_3 = Python3Script(num_layers=number_slider_8, gap=gap_5, num_bricks=number_slider_7)  # -> out, geometry, polylines, frames, circle; inputs num_layers: Int32, gap: Double, num_bricks: Int32
# ---------- py3_3: Python ----------
# r: compas
# venv: mas-2526

from compas_rhino.devtools import DevTools
DevTools.enable_reloader()

# STEP 1: Import everything we will need
import math
from compas.geometry import Box
from compas.geometry import Point
from compas.geometry import Frame
from compas.geometry import Polygon, Polyline, Vector
import compas_rhino.conversions 


from brick_wall import Brick

# Inputs and lists

division = Brick.LENGTH
height = Brick.HEIGHT

vectors = []
bricks = []


def circle_points(center, num_points, cir=Brick.LENGTH):
    points = []
    theta = 2 * math.pi / num_points # M1: angle of the polygon
    radius = (cir/2)/(math.sin(theta/2)) # M2: radius of the polygon acording to the lenght of the brick
    for i in range(num_points):
        theta = 2 * math.pi * i / num_points  # angle from 0 to 2π
        x = center.x + radius * math.cos(theta)
        y = center.y + radius * math.sin(theta)
        points.append(Point(x, y, center.z))
    return points


circle = circle_points(Point(0,0,0), num_bricks)
circle.append(circle[0])
polyline = Polyline(circle)


min_brick_num = 3
layers = int(num_bricks - min_brick_num)
print(layers)
layer_crv_num = int(num_layers / (layers + 1))
print(layer_crv_num)

change = [0]
for i in range(layers):
    num = change[i] + layer_crv_num
    change.append(num)
print(change)
num_layers = int(layer_crv_num * (layers + 1))
print(num_layers)

circle_size = []
for n in range(-num_bricks, -min_brick_num + 1):
    circle_size.append(abs(n))
print(circle_size)


polylines = []
for n, i in zip(circle_size, change):
    circle = circle_points(Point(0,0,0), abs(n))
    circle.append(circle[0])
    polyline = Polyline(circle)
    polyline.translate([0,0,height*i])
    theta = 2 * math.pi / abs(n)
    for row in range(layer_crv_num):
        crv = polyline.translated([0,0,height*row])
        crv.rotate((theta/6)*row, axis=Vector(0,0,1), point=Point(0,0,0))
        polylines.append(crv)
        points_list = crv.divide_by_length(division/2)
        for i, pt in enumerate(points_list):
            if i % 2 != 0:
                tan = crv.tangent_at_point(pt)
                vectors.append(tan)
                cross = tan.cross(Vector(0,0,1))
                cross.unitize()
                cross.scale(Brick.WIDTH/2)
                new_pt = pt.translated(cross)
                brick = Brick(frame = Frame(new_pt, tan, cross))
                bricks.append(brick)


geometry = []
frames = []
for brick in bricks:
    b = brick.draw()
    frame = b.frame
    geometry.append(b)
    frames.append(frame)
# ---------- end py3_3 ----------
panel_3 = Panel(multiplication_4)
draw_8 = COMPASDraw(cg=py3_3.geometry)  # -> rg; same code as draw
draw_9 = COMPASDraw(cg=py3_3.polylines)  # -> rg; same code as draw
draw_10 = COMPASDraw(cg=py3_3.circle)  # -> rg; same code as draw

# ---- group: test 2
number_slider_9 = Slider(8, range=0..30)  # disabled
number_slider_10 = Slider(25, range=0..100)  # disabled
gap_6 = Slider(3, range=0..10)  # disabled
multiplication_5 = Multiplication(A=number_slider_10, B=number_slider_9)  # disabled
py3_4 = Python3Script(num_layers=number_slider_10, gap=gap_6, num_bricks=number_slider_9)  # -> out, geometry, poly, polylines, center, frames, points_inside, points_outside, circle, polyline; inputs num_layers: Int32, gap: Double, num_bricks: Int32; disabled
# ---------- py3_4: Python ----------
# r: compas
# venv: mas-2526

from compas_rhino.devtools import DevTools
DevTools.enable_reloader()

# STEP 1: Import everything we will need
import math
from compas.geometry import Box
from compas.geometry import Point
from compas.geometry import Frame
from compas.geometry import Polygon, Polyline, Vector
import compas_rhino.conversions 


from brick_wall import Brick

# Inputs and lists

division = Brick.LENGTH + gap
vectors = []
bricks = []


def circle_points(center, num_points, cir=Brick.LENGTH + gap):
    points = []
    theta = 2 * math.pi / num_points # M1: angle of the polygon
    radius = (cir/2)/(math.sin(theta/2)) # M2: radius of the polygon acording to the lenght of the brick
    for i in range(num_points):
        theta = 2 * math.pi * i / num_points  # angle from 0 to 2π
        x = center.x + radius * math.cos(theta)
        y = center.y + radius * math.sin(theta)
        points.append(Point(x, y, center.z))
    return points



circle = circle_points(Point(0,0,0), num_bricks)
circle.append(circle[0])

polyline = Polyline(circle)
theta = 2 * math.pi / num_bricks

polylines = []
height = Brick.HEIGHT
for row in range(num_layers):
    crv = polyline.translated([0,0,height*row])
    crv.rotate((theta/2)*row, axis=Vector(0,0,1), point=Point(0,0,0))
    polylines.append(crv)
    points_list = crv.divide_by_length(division/2)
    for i, pt in enumerate(points_list):
        if i % 2 != 0:
            tan = crv.tangent_at_point(pt)
            vectors.append(tan)
            cross = tan.cross(Vector(0,0,1))
            cross.unitize()
            cross.scale(Brick.WIDTH/2)
            new_pt = pt.translated(cross)
            brick = Brick(frame = Frame(new_pt, tan, cross))
            bricks.append(brick)

geometry = []
frames = []
for brick in bricks:
    b = brick.draw()
    frame = b.frame
    geometry.append(b)
    frames.append(frame)
# ---------- end py3_4 ----------
panel_4 = Panel(multiplication_5)  # disabled
draw_11 = COMPASDraw(cg=py3_4.geometry)  # -> rg; disabled; same code as draw
draw_12 = COMPASDraw(cg=py3_4.polylines)  # -> rg; disabled; same code as draw
draw_13 = COMPASDraw(cg=py3_4.polyline)  # -> rg; disabled; same code as draw

# ---- group: This is needed only ONCE in the GH definition
enable_auto_reload = Python3Script()  # -> ok
# ---------- enable_auto_reload: Python ----------
"""
------------------------------
Using VS Code as Python editor
------------------------------

The simplest way to start using VS Code as our editor, is
to place our Python code in files located IN THE SAME FOLDER as our Grasshopper file.

After we have done that, we need 2 steps: 

1. Enable the COMPAS reloader on one component. This tells Grasshopper to watch for changes in the Pythoh files and reload if changed.
2. Every other component that uses Python code from external files needs to start with a method to ensure Grasshopper knows where to load the files from.

"""
# r: compas
# venv: mas-2526

from compas_rhino.devtools import DevTools
DevTools.enable_reloader()
# ---------- end enable_auto_reload ----------

# ----
number_slider_11 = Slider(10, range=0..10)
curve = Curve(<curve referenced from the Rhino model>)
brick_wall = Python3Script(crv=curve, num_layers=Slider(9, range=0..30), gap=gap_2)  # -> bricks, geometries, way_planes; inputs crv: Curve, num_layers: Int32, gap: Double
# ---------- brick_wall: Python ----------
# r: compas
# venv: mas-2526
from compas_rhino.devtools import DevTools
DevTools.ensure_path()

# 0. Import everything we will need
import math
from compas.geometry import Box
from compas.geometry import Point
from compas.geometry import Frame
from compas.geometry import cross_vectors
from compas_rhino.conversions import curve_to_compas

# ..also import our module "brick_wall.py", that needs to be in the same folder as our GH file
from brick_wall import Brick

# 1. Start with an empty list of bricks to be created
#    make sure to match the name of this list to the output of this component!
bricks = []

# 2. Create points on each curve
curve = curve_to_compas(crv)
print(curve.length())

# divide curve twice as fine
num_divs = int(curve.length() / (Brick.LENGTH+gap)) * 2
params, div_pts = curve.divide_by_count(num_divs, True)

for row in range(num_layers):
    for col, param in enumerate(params,):
        pt = curve.point_at(param)
        pt = pt.translated([0,0,Brick.HEIGHT * row])
        tangent = curve.tangent_at(param)
        normal = cross_vectors(tangent, [0,0,1])
        # only place bricks on alternating divisions depending on the row
        if row % 2 == 0:  
            # even rows 
            if col % 2 == 0:
                b = Brick(frame = Frame(pt, tangent, normal))
                bricks.append(b)
        else:  
            # odd rows 
            if col % 2 == 1:
                b = Brick(frame = Frame(pt, tangent, normal))
                bricks.append(b)

# Visualize and store brick data
geometries = []
way_planes = []

for brick in bricks:
    geometries.append(brick.draw())
    way_planes.append(brick.get_pick_frame())
# ---------- end brick_wall ----------
py3_5 = Python3Script(
    num_layers=number_slider_4,
    gap=gap_3,
    num_bricks=Slider(100, range=0..100),
    up=Slider(30, range=0..100),
    down=Slider(30, range=0..100),
    width=Slider(3, range=0..100),
    length=Slider(0.0015, range=0..0.01),
    scale=Slider(20, range=0..100))  # -> out, geometry, polylines, frames, circle, div_pts, geometries, all_points; inputs num_layers: Int32, gap: Double, num_bricks: Int32, up: Double, down: Double, width: Double, length: Double, scale: Double
# ---------- py3_5: Python ----------
# r: compas
# venv: mas-2526

from compas_rhino.devtools import DevTools
DevTools.enable_reloader()

# STEP 1: Import everything we will need
import math
from compas.geometry import Box
from compas.geometry import Point
from compas.geometry import Frame
from compas.geometry import Polygon, Polyline, Vector, Curve
import compas_rhino.conversions 
from compas.geometry import cross_vectors
from compas_rhino.conversions import curve_to_compas
from ghpythonlib.treehelpers import list_to_tree, tree_to_list


from brick_wall import Brick

# Inputs and lists

division = Brick.LENGTH
height = Brick.HEIGHT

vectors = []
bricks = []


def circle_points(center, num_points, mod, cir=Brick.LENGTH, up=up, down=down, width=width, length=length, scale=scale):
    points = []
    theta = 2 * math.pi / num_points # M1: angle of the polygon
    radius = 60 # M2: radius of the polygon acording to the lenght of the brick
    for i in range(num_points):
        theta = 2 * math.pi * i / num_points  # angle from 0 to 2π
        x = center.x + radius * math.cos(theta)/((mod+up)/width)*scale
        y = center.y + radius * math.sin(theta)*((mod+down)*length)*scale
        points.append(Point(x, y, center.z))
    return points

polylines = []
for n in range(num_layers):
    circle = circle_points(Point(0,0,0), num_bricks, mod=n)
    circle.append(circle[0])
    polyline = Polyline(circle)
    polylines.append(polyline)


# 1. Start with an empty list of bricks to be created
#    make sure to match the name of this list to the output of this component!
bricks = []
all_points = []

for row, curve in enumerate(polylines):
    # divide curve twice as fine
    num_divs = int(curve.length / (Brick.WIDTH*2+gap)) * 4
    leng = curve.length / num_divs
    div_pts = curve.divide_by_length(leng)
    print(num_divs)
    for col, pt in enumerate(div_pts):
        param = curve.parameter_at(pt)
        pt = pt.translated([0,0,Brick.HEIGHT * row])
        tangent = curve.tangent_at(param)
        normal = cross_vectors(tangent, [0,0,1])

        # vector 
        vec = Vector(normal[0], normal[1], normal[2])
        vec.unitize()

        if row % 2 == 0:  
            # even rows 
            # print("perpendicular bricks")
            if col % 2 == 0:
                vec.scale(Brick.LENGTH/2)
                new_pt = pt.translated(vec)
                b = Brick(frame = Frame(new_pt, normal, tangent))
                bricks.append(b)
        else:  
            # odd rows 
            # print("paralel bricks")
            if col % 4 == 1:
                vec.scale(Brick.LENGTH/2)
                new_pt = pt.translated(vec)
                b = Brick(frame = Frame(new_pt, tangent, normal))
                bricks.append(b)
    all_points.append(div_pts)
# Visualize and store brick data
geometries = []
way_planes = []

for brick in bricks:
    geometries.append(brick.draw())
    way_planes.append(brick.get_pick_frame())


all_points = list_to_tree(all_points)
print(all_points)
# ---------- end py3_5 ----------
multiplication_6 = Multiplication(A=number_slider_4, B=Slider(30, range=0..30))
panel_5 = Panel(multiplication_6)
compas_draw = COMPASDraw(cg=brick_wall.geometries)  # -> simplify(rg); same code as draw
draw_14 = COMPASDraw(cg=py3_5.geometries)  # -> rg; same code as draw
draw_15 = COMPASDraw(cg=py3_5.all_points)  # -> rg; same code as draw
draw_16 = COMPASDraw(cg=py3_5.polylines)  # -> rg; same code as draw
draw_17 = COMPASDraw(cg=py3_5.circle)  # -> rg; same code as draw
draw_18 = COMPASDraw(cg=py3_5.div_pts)  # -> rg; same code as draw
draw_19 = COMPASDraw(cg=py3_5.geometry)  # -> rg; same code as draw
crv = Curve(draw_16)
preview = CustomPreview(
    Geometry=draw_11,
    Material={diffuse=RGB(221, 160, 221), emission=RGB(66, 48, 66), shine=0.5, specular=RGB(255, 255, 255), transparency=0})  # disabled
preview_2 = CustomPreview(
    Geometry=draw,
    Material={diffuse=RGB(221, 160, 221), emission=RGB(66, 48, 66), shine=0.5, specular=RGB(255, 255, 255), transparency=0})  # disabled
item = ListItem(List=draw_15, Index=0, Wrap=True)
preview_3 = CustomPreview(
    Geometry=draw_5,
    Material={diffuse=RGB(221, 160, 221), emission=RGB(66, 48, 66), shine=0.5, specular=RGB(255, 255, 255), transparency=0})
preview_4 = CustomPreview(
    Geometry=draw_8,
    Material={diffuse=RGB(221, 160, 221), emission=RGB(66, 48, 66), shine=0.5, specular=RGB(255, 255, 255), transparency=0})
preview_5 = CustomPreview(
    Geometry=draw_14,
    Material={diffuse=RGB(221, 160, 221), emission=RGB(66, 48, 66), shine=0.5, specular=RGB(255, 255, 255), transparency=0})
item_2 = ListItem(List=draw_16, Index=Slider(9, range=0..100), Wrap=True)
item_3 = ListItem(List=draw_9, Index=Slider(9, range=0..100), Wrap=True)
