# Grasshopper definition 101_brick_to_robot_nadja_25 23 10(1).gh (Grasshopper 1.0.8)

pt = Point([<point referenced from the Rhino model> x6])  # disabled

# ---- group: test 4
number_slider = Slider(8, range=0..30)  # disabled
number_slider_2 = Slider(15, range=0..100)  # disabled
gap = Slider(4, range=0..10)  # disabled
multiplication = Multiplication(A=number_slider_2, B=number_slider)  # disabled
py3 = Python3Script(num_layers=number_slider_2, gap=gap, num_bricks=number_slider, position=pt)  # -> out, geometry, polylines, frames, circle, height; inputs num_layers: Int32, gap: Double, num_bricks: Int32, position: list of Point3d; disabled
# ---------- py3: Python ----------
# r: compas
# venv: mas-2526

from compas_rhino.devtools import DevTools
DevTools.enable_reloader()

# STEP 1: Import everything we will need
import math
from compas.geometry import Box
from compas.geometry import Point
from compas.geometry import Frame
from compas.geometry import Polygon, Polyline, Vector
import compas_rhino.conversions 

from ghpythonlib.treehelpers import list_to_tree, tree_to_list

from brick_wall import Brick
from brick_wall import BigBrick

# Inputs and lists


# position = tree_to_list(position)
position_list = []
for p in position:
    compas_point = compas_rhino.conversions.point_to_compas(p)
    position_list.append(compas_point)

print(position_list)

division = BigBrick.LENGTH + gap
height = BigBrick.HEIGHT

vectors = []
bricks = []


def circle_points(center, num_points, cir=division):
    points = []
    theta = 2 * math.pi / num_points # M1: angle of the polygon
    radius = (cir/2)/(math.sin(theta/2)) # M2: radius of the polygon acording to the lenght of the brick
    for i in range(num_points):
        theta = 2 * math.pi * i / num_points  # angle from 0 to 2π
        x = center.x + radius * math.cos(theta)
        y = center.y + radius * math.sin(theta)
        points.append(Point(x, y, center.z))
    return points


# circle = circle_points(position, num_bricks)
# circle.append(circle[0])
# polyline = Polyline(circle)


min_brick_num = 3
layers = int(num_bricks - min_brick_num)
# print(layers)
layer_crv_num = int(num_layers / (layers + 1))
# print(layer_crv_num)

change = [0]
for i in range(layers):
    num = change[i] + layer_crv_num
    change.append(num)
# print(change)
num_layers = int(layer_crv_num * (layers + 1))
# print(num_layers)

circle_size = []
for n in range(-num_bricks, -min_brick_num + 1):
    circle_size.append(abs(n))
print(circle_size)


palet_position = Point(600, 400, 0)


polylines = []
for n, i, p in zip(circle_size, change, position_list):
    circle = circle_points(p, abs(n))
    circle.append(circle[0])
    polyline = Polyline(circle)
    polyline.translate([0,0,height*i])
    theta = 2 * math.pi / abs(n)
    for row in range(layer_crv_num):
        crv = polyline.translated([0,0,height*row])
        crv.rotate((theta/2)*row, axis=Vector(0,0,1), point=p)
        polylines.append(crv)
        points_list = crv.divide_by_length(division/2)
        for i, pt in enumerate(points_list):
            if i % 2 != 0:
                tan = crv.tangent_at_point(pt)
                vectors.append(tan)
                cross = tan.cross(Vector(0,0,1))
                cross.unitize()
                cross.scale(BigBrick.WIDTH/2)
                new_pt = pt.translated(cross)
                brick = BigBrick(frame = Frame(new_pt, tan, cross))
                bricks.append(brick)


geometry = []
frames = []
for brick in bricks:
    b = brick.draw()
    frame = b.frame
    geometry.append(b)
    frames.append(frame)
# ---------- end py3 ----------
panel = Panel(multiplication)  # disabled
draw = COMPASDraw(cg=py3.geometry)  # -> rg; disabled
#   port cg: The COMPAS geometry or datastructure to be drawn.
#   port rg: The Rhino geometry object.
# ---------- draw: Python ----------
# r: compas>=2.14.1
"""
Draws COMPAS geometry in Grasshopper.
"""

from typing import Any

import Grasshopper

from compas.scene import SceneObject


class CompasToRhinoGeometry(Grasshopper.Kernel.GH_ScriptInstance):
    def RunScript(self, cg):
        if not cg:
            return None

        return SceneObject(item=cg).draw()
# ---------- end draw ----------
draw_2 = COMPASDraw(cg=py3.polylines)  # -> rg; disabled; same code as draw
draw_3 = COMPASDraw(cg=py3.circle)  # -> rg; disabled; same code as draw

# ----
pt_2 = Point([<point referenced from the Rhino model> x6])  # disabled

# ---- group: test 4
number_slider_3 = Slider(8, range=0..30)  # disabled
number_slider_4 = Slider(40, range=0..100)  # disabled
gap_2 = Slider(4, range=0..10)  # disabled
multiplication_2 = Multiplication(A=number_slider_4, B=number_slider_3)  # disabled
py3_2 = Python3Script(num_layers=number_slider_4, gap=gap_2, num_bricks=number_slider_3, position=pt_2)  # -> out, geometry, polylines, frames, circle, height; inputs num_layers: Int32, gap: Double, num_bricks: Int32, position: list of Point3d; disabled
# ---------- py3_2: Python ----------
# r: compas
# venv: mas-2526

from compas_rhino.devtools import DevTools
DevTools.enable_reloader()

# STEP 1: Import everything we will need
import math
from compas.geometry import Box
from compas.geometry import Point
from compas.geometry import Frame
from compas.geometry import Polygon, Polyline, Vector
import compas_rhino.conversions 

from ghpythonlib.treehelpers import list_to_tree, tree_to_list

from brick_wall import Brick
from brick_wall import BigBrick

# Inputs and lists


# position = tree_to_list(position)
position_list = []
for p in position:
    compas_point = compas_rhino.conversions.point_to_compas(p)
    position_list.append(compas_point)


division = BigBrick.LENGTH + gap
height = BigBrick.HEIGHT

vectors = []
bricks = []


def circle_points(center, num_points, cir=division):
    points = []
    theta = 2 * math.pi / num_points # M1: angle of the polygon
    radius = (cir/2)/(math.sin(theta/2)) # M2: radius of the polygon acording to the lenght of the brick
    for i in range(num_points):
        theta = 2 * math.pi * i / num_points  # angle from 0 to 2π
        x = center.x + radius * math.cos(theta)
        y = center.y + radius * math.sin(theta)
        points.append(Point(x, y, center.z))
    return points


# circle = circle_points(position, num_bricks)
# circle.append(circle[0])
# polyline = Polyline(circle)

min_brick_num = 3
circle_size = []
for n in range(-num_bricks, -min_brick_num + 1):
    if n % 2 == 0:
        circle_size.append(abs(n))
print(circle_size)


layers = int(num_bricks - min_brick_num)
# print(layers)
layer_crv_num = int(num_layers / (layers + 1))
# print(layer_crv_num)

change = [0]
for i in range(layers):
    num = change[i] + layer_crv_num
    change.append(num)
# print(change)
num_layers = int(layer_crv_num * (layers + 1))
# print(num_layers)



palet_position = Point(600, 400, 0)


polylines = []
for n, i, p in zip(circle_size, change, position_list):
    circle = circle_points(palet_position, abs(n))
    circle.append(circle[0])
    polyline = Polyline(circle)
    polyline.translate([0,0,height*i])
    theta = 2 * math.pi / abs(n)
    for row in range(layer_crv_num):
        crv = polyline.translated([0,0,height*row])
        crv.rotate((theta/2)*row, axis=Vector(0,0,1), point=palet_position)
        polylines.append(crv)
        points_list = crv.divide_by_length(division/2)
        for i, pt in enumerate(points_list):
            if i % 2 != 0:
                tan = crv.tangent_at_point(pt)
                vectors.append(tan)
                cross = tan.cross(Vector(0,0,1))
                cross.unitize()
                cross.scale(BigBrick.WIDTH/2)
                new_pt = pt.translated(cross)
                brick = BigBrick(frame = Frame(new_pt, tan, cross))
                bricks.append(brick)


geometry = []
frames = []
for brick in bricks:
    b = brick.draw()
    frame = b.frame
    geometry.append(b)
    frames.append(frame)
# ---------- end py3_2 ----------
panel_2 = Panel(multiplication_2)  # disabled
draw_4 = COMPASDraw(cg=py3_2.geometry)  # -> rg; disabled; same code as draw
draw_5 = COMPASDraw(cg=py3_2.polylines)  # -> rg; disabled; same code as draw
draw_6 = COMPASDraw(cg=py3_2.circle)  # -> rg; disabled; same code as draw

# ----
number_slider_5 = Slider(20, range=0..100)
gap_3 = Slider(2, range=0..10)
number_slider_6 = Slider(10, range=0..10)
py3_3 = Python3Script(
    num_layers=number_slider_5,
    gap=gap_3,
    num_bricks=Slider(100, range=0..100),
    up=Slider(13.39, range=0..100),
    down=Slider(11.37, range=0..100),
    width=Slider(3.5, range=0..100),
    length=Slider(0.0084, range=0..0.01),
    scale=Slider(16, range=0..100))  # -> out, geometry, polylines, frames, circle, div_pts, geometries, all_points; inputs num_layers: Int32, gap: Double, num_bricks: Int32, up: Double, down: Double, width: Double, length: Double, scale: Double
# ---------- py3_3: Python ----------
# r: compas
# venv: mas-2526

from compas_rhino.devtools import DevTools
DevTools.enable_reloader()

# STEP 1: Import everything we will need
import math
from compas.geometry import Box
from compas.geometry import Point
from compas.geometry import Frame
from compas.geometry import Polygon, Polyline, Vector, Curve
import compas_rhino.conversions 
from compas.geometry import cross_vectors
from compas_rhino.conversions import curve_to_compas
from ghpythonlib.treehelpers import list_to_tree, tree_to_list


from brick_wall import Brick
from brick_wall import BigBrick

# Inputs and lists

division = BigBrick.LENGTH
height = BigBrick.HEIGHT

vectors = []
bricks = []


def circle_points(center, num_points, mod, cir=BigBrick.LENGTH, up=up, down=down, width=width, length=length, scale=scale):
    points = []
    theta = 2 * math.pi / num_points # M1: angle of the polygon
    radius = 120 # M2: radius of the polygon acording to the lenght of the brick
    for i in range(num_points):
        theta = 2 * math.pi * i / num_points  # angle from 0 to 2π
        x = center.x + radius * math.cos(theta)/((mod+up)/width)*scale
        y = center.y + radius * math.sin(theta)*((mod+down)*length)*scale
        points.append(Point(x, y, center.z))
    return points

polylines = []
for n in range(num_layers):
    circle = circle_points(Point(600,400,0), num_bricks, mod=n)
    circle.append(circle[0])
    polyline = Polyline(circle)
    polylines.append(polyline)


# 1. Start with an empty list of bricks to be created
#    make sure to match the name of this list to the output of this component!
bricks = []
all_points = []

for row, curve in enumerate(polylines):
    # divide curve twice as fine
    num_divs = int(curve.length / (BigBrick.LENGTH+gap))
    ### change the script so that num of bricks in the row
    if num_divs % 2 != 0:
        num_divs = num_divs - 1

    leng = curve.length / (num_divs*2)
    div_pts = curve.divide_by_length(leng)

    print(num_divs)

    for col, pt in enumerate(div_pts):
        param = curve.parameter_at(pt)
        pt = pt.translated([0,0,BigBrick.HEIGHT * row])
        tangent = curve.tangent_at(param)
        normal = cross_vectors(tangent, [0,0,1])

        # vector 
        vec = Vector(normal[0], normal[1], normal[2])
        vec.unitize()

        if row % 2 == 0:  
            # even rows 
            # print("perpendicular bricks")
            if col % 2 == 0:
                vec.scale(Brick.LENGTH)
                new_pt = pt.translated(vec)
                b = BigBrick(frame = Frame(new_pt, tangent, normal))
                bricks.append(b)
        else:  
            # odd rows 
            # print("paralel bricks")
            if col % 2 == 1:
                vec.scale(BigBrick.WIDTH/2)
                new_pt = pt.translated(vec)
                b = BigBrick(frame = Frame(new_pt, tangent, normal))
                bricks.append(b)
    all_points.append(div_pts)
# Visualize and store brick data
geometries = []
way_planes = []

for brick in bricks:
    geometries.append(brick.draw())
    way_planes.append(brick.get_pick_frame())


all_points = list_to_tree(all_points)
print(all_points)
# ---------- end py3_3 ----------
multiplication_3 = Multiplication(A=number_slider_5, B=Slider(30, range=0..30))
draw_7 = COMPASDraw(cg=py3_3.geometries)  # -> rg; same code as draw
draw_8 = COMPASDraw(cg=py3_3.all_points)  # -> rg; same code as draw
draw_9 = COMPASDraw(cg=py3_3.polylines)  # -> rg; same code as draw
draw_10 = COMPASDraw(cg=py3_3.circle)  # -> rg; same code as draw
draw_11 = COMPASDraw(cg=py3_3.div_pts)  # -> rg; same code as draw
panel_3 = Panel(multiplication_3)
draw_12 = COMPASDraw(cg=py3_3.geometry)  # -> rg; same code as draw
number_slider_7 = Slider(9, range=0..100)  # disabled
number_slider_8 = Slider(9, range=0..100)  # disabled
preview = CustomPreview(
    Geometry=draw,
    Material={diffuse=RGB(221, 160, 221), emission=RGB(66, 48, 66), shine=0.5, specular=RGB(255, 255, 255), transparency=0})  # disabled
preview_2 = CustomPreview(
    Geometry=draw_4,
    Material={diffuse=RGB(221, 160, 221), emission=RGB(66, 48, 66), shine=0.5, specular=RGB(255, 255, 255), transparency=0})  # disabled
crv = Curve(draw_9)
item = ListItem(List=draw_8, Index=0, Wrap=True)
item_2 = ListItem(List=draw_2, Index=number_slider_7, Wrap=True)  # disabled
preview_3 = CustomPreview(
    Geometry=draw_7,
    Material={diffuse=RGB(221, 160, 221), emission=RGB(66, 48, 66), shine=0.5, specular=RGB(255, 255, 255), transparency=0})
item_3 = ListItem(List=draw_5, Index=number_slider_8, Wrap=True)  # disabled
item_4 = ListItem(List=draw_9, Index=Slider(9, range=0..100), Wrap=True)
