# Grasshopper definition 101_brick_to_robot_nadja_25 23 10.gh (Grasshopper 1.0.8)

# ---- group: test 4
number_slider = Slider(5, range=0..30)
number_slider_2 = Slider(25, range=0..100)
gap = Slider(3, range=0..10)
multiplication = Multiplication(A=number_slider_2, B=number_slider)
py3 = Python3Script(num_layers=number_slider_2, gap=gap, num_bricks=number_slider)  # -> out, geometry, polylines, frames, circle; inputs num_layers: Int32, gap: Double, num_bricks: Int32
# ---------- py3: Python ----------
# r: compas
# venv: mas-2526

from compas_rhino.devtools import DevTools
DevTools.enable_reloader()

# STEP 1: Import everything we will need
import math
from compas.geometry import Box
from compas.geometry import Point
from compas.geometry import Frame
from compas.geometry import Polygon, Polyline, Vector
import compas_rhino.conversions 


from brick_wall import Brick

# Inputs and lists

division = Brick.LENGTH
height = Brick.HEIGHT

vectors = []
bricks = []


def circle_points(center, num_points, cir=Brick.LENGTH):
    points = []
    theta = 2 * math.pi / num_points # M1: angle of the polygon
    radius = (cir/2)/(math.sin(theta/2)) # M2: radius of the polygon acording to the lenght of the brick
    for i in range(num_points):
        theta = 2 * math.pi * i / num_points  # angle from 0 to 2π
        x = center.x + radius * math.cos(theta)
        y = center.y + radius * math.sin(theta)
        points.append(Point(x, y, center.z))
    return points


circle = circle_points(Point(0,0,0), num_bricks)
circle.append(circle[0])
polyline = Polyline(circle)


min_brick_num = 3
layers = int(num_bricks - min_brick_num)
print(layers)
layer_crv_num = int(num_layers / (layers + 1))
print(layer_crv_num)

change = [0]
for i in range(layers):
    num = change[i] + layer_crv_num
    change.append(num)
print(change)
num_layers = int(layer_crv_num * (layers + 1))
print(num_layers)

circle_size = []
for n in range(-num_bricks, -min_brick_num + 1):
    circle_size.append(abs(n))
print(circle_size)


polylines = []
for n, i in zip(circle_size, change):
    circle = circle_points(Point(0,0,0), abs(n))
    circle.append(circle[0])
    polyline = Polyline(circle)
    polyline.translate([0,0,height*i])
    theta = 2 * math.pi / abs(n)
    for row in range(layer_crv_num):
        crv = polyline.translated([0,0,height*row])
        crv.rotate((theta/6)*row, axis=Vector(0,0,1), point=Point(0,0,0))
        polylines.append(crv)
        points_list = crv.divide_by_length(division/2)
        for i, pt in enumerate(points_list):
            if i % 2 != 0:
                tan = crv.tangent_at_point(pt)
                vectors.append(tan)
                cross = tan.cross(Vector(0,0,1))
                cross.unitize()
                cross.scale(Brick.WIDTH/2)
                new_pt = pt.translated(cross)
                brick = Brick(frame = Frame(new_pt, tan, cross))
                bricks.append(brick)


geometry = []
frames = []
for brick in bricks:
    b = brick.draw()
    frame = b.frame
    geometry.append(b)
    frames.append(frame)
# ---------- end py3 ----------
panel = Panel(multiplication)
draw = COMPASDraw(cg=py3.geometry)  # -> rg
#   port cg: The COMPAS geometry or datastructure to be drawn.
#   port rg: The Rhino geometry object.
# ---------- draw: Python ----------
# r: compas>=2.14.1
"""
Draws COMPAS geometry in Grasshopper.
"""

from typing import Any

import Grasshopper

from compas.scene import SceneObject


class CompasToRhinoGeometry(Grasshopper.Kernel.GH_ScriptInstance):
    def RunScript(self, cg):
        if not cg:
            return None

        return SceneObject(item=cg).draw()
# ---------- end draw ----------
draw_2 = COMPASDraw(cg=py3.polylines)  # -> rg; same code as draw
draw_3 = COMPASDraw(cg=py3.circle)  # -> rg; same code as draw

# ----
preview = CustomPreview(
    Geometry=draw,
    Material={diffuse=RGB(221, 160, 221), emission=RGB(66, 48, 66), shine=0.5, specular=RGB(255, 255, 255), transparency=0})
item = ListItem(List=draw_2, Index=Slider(9, range=0..100), Wrap=True)
