# Grasshopper definition 102_design_brick_wall_1.gh (Grasshopper 1.0.8)
# plug-ins: Pufferfish

# ----
# Brick wal_5
#  (U-curve + rotate at a stable number)
crv_u_2 = Curve(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)  # disabled
crv_u_3 = Curve(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)  # disabled
number_slider = Slider(9, range=0..30)  # disabled
number_slider_2 = Slider(1.5, range=0..10)  # disabled
number_slider_3 = Slider(10, range=0..30)  # disabled
number_slider_4 = Slider(18, range=0..180)  # disabled
py3 = Python3Script(crv=crv_u_3, num_layers=number_slider, gap=number_slider_2, cols=number_slider_3, rotation=number_slider_4)  # -> out, geometries, way_planes; inputs crv: Curve, num_layers: Int32, gap: Double, cols: Int32, rotation: Double; disabled
# ---------- py3: Python ----------
# r: compas
# venv: mas-2526

from compas_rhino.devtools import DevTools
DevTools.ensure_path()

import math
from compas.geometry import Box, Point, Frame, cross_vectors
from compas_rhino.conversions import curve_to_compas
from brick_wall_2 import Brick

bricks = []

curve = curve_to_compas(crv)
print(curve.length())

num_divs = int(curve.length())/(Brick.LENGTH+gap) * 2
params, div_pts = curve.divide_by_count(num_divs, True)

for row in range(num_layers):
    for col, param in enumerate(params):
        pt = curve.point_at(param)
        pt = pt.translated([0,0, Brick.HEIGHT * row])
        tangent = curve.tangent_at(param)
        normal = cross_vectors(tangent, [0,0,1])

        # dispatch A,B row
        if row % 2 == 0:
            if col % 2 == 0:
                bricks.append(Brick(frame = Frame(pt, tangent, normal)))
        else:
            if col % 2 == 1:
                bricks.append(Brick(frame = Frame(pt, tangent, normal)))

for b in bricks:
    b.rotate(rotation)

# visualize and store brick data
geometries = []
way_planes = []

for brick in bricks:
    geometries.append(brick.draw())
    way_planes.append(brick.get_pick_frame())
# ---------- end py3 ----------
draw = COMPASDraw(cg=py3.way_planes)  # -> rg; disabled
#   port cg: The COMPAS geometry or datastructure to be drawn.
#   port rg: The Rhino geometry object.
# ---------- draw: Python ----------
# r: compas>=2.14.1
"""
Draws COMPAS geometry in Grasshopper.
"""

from typing import Any

import Grasshopper

from compas.scene import SceneObject


class CompasToRhinoGeometry(Grasshopper.Kernel.GH_ScriptInstance):
    def RunScript(self, cg):
        if not cg:
            return None

        return SceneObject(item=cg).draw()
# ---------- end draw ----------
draw_2 = COMPASDraw(cg=py3.geometries)  # -> rg; disabled; same code as draw
item = ListItem(List=draw, Index=0, Wrap=True)  # -> Item, Item1, Item2; disabled
preview = CustomPreview(
    Geometry=draw_2,
    Material={diffuse=RGB(221, 160, 221), emission=RGB(66, 48, 66), shine=0.5, specular=RGB(255, 255, 255), transparency=0})  # disabled
pl = ConstructPlane(Origin=item.Item, XAxis=item.Item1, YAxis=item.Item2)  # disabled
pln = Plane(pl)  # disabled

# ----
# Brick wal_5
#  (U-curve + rotate at a stable number)
crv_u_2_2 = Curve(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)  # disabled
number_slider_5 = Slider(10, range=0..30)  # disabled
number_slider_6 = Slider(1.5, range=0..10)  # disabled
number_slider_7 = Slider(10, range=0..30)  # disabled
number_slider_8 = Slider(36, range=0..180)  # disabled
py3_2 = Python3Script(crv=crv_u_2_2, num_layers=number_slider_5, gap=number_slider_6, cols=number_slider_7, rotation=number_slider_8)  # -> out, geometries, way_planes; inputs crv: Curve, num_layers: Int32, gap: Double, cols: Int32, rotation: Double; disabled
# ---------- py3_2: Python ----------
# r: compas
# venv: mas-2526

from compas_rhino.devtools import DevTools
DevTools.ensure_path()

import math
from compas.geometry import Box, Point, Frame, cross_vectors
from compas_rhino.conversions import curve_to_compas
from brick_wall_2 import Brick

bricks = []

curve = curve_to_compas(crv)
print(curve.length())

num_divs = int(curve.length())/(Brick.LENGTH+gap) * 2
params, div_pts = curve.divide_by_count(num_divs, True)

for row in range(num_layers):
    for col, param in enumerate(params):
        pt = curve.point_at(param)
        pt = pt.translated([0,0, Brick.HEIGHT * row])
        tangent = curve.tangent_at(param)
        normal = cross_vectors(tangent, [0,0,1])

        # dispatch A,B row
        if row % 2 == 0:
            if col % 2 == 0:
                b = Brick(Frame(pt, tangent, normal))                
        else:
            if col % 2 == 1:                
                b = Brick(Frame(pt, tangent, normal))

        # rotation
        if row % 3 == 0 and col % 3 == 0:
            b.rotate(rotation)
        bricks.append(b)

# visualize and store brick data
geometries = []
way_planes = []

for brick in bricks:
    geometries.append(brick.draw())
    way_planes.append(brick.get_pick_frame())
# ---------- end py3_2 ----------
draw_3 = COMPASDraw(cg=py3_2.way_planes)  # -> rg; disabled; same code as draw
draw_4 = COMPASDraw(cg=py3_2.geometries)  # -> rg; disabled; same code as draw
item_2 = ListItem(List=draw_3, Index=0, Wrap=True)  # -> Item, Item1, Item2; disabled
preview_2 = CustomPreview(
    Geometry=draw_4,
    Material={diffuse=RGB(221, 160, 221), emission=RGB(66, 48, 66), shine=0.5, specular=RGB(255, 255, 255), transparency=0})  # disabled
pl_2 = ConstructPlane(Origin=item_2.Item, XAxis=item_2.Item1, YAxis=item_2.Item2)  # disabled
pln_2 = Plane(pl_2)  # disabled

# ---- group: This is needed only ONCE in the GH definition
enable_auto_reload = Python3Script()  # -> ok
# ---------- enable_auto_reload: Python ----------
"""
------------------------------
Using VS Code as Python editor
------------------------------

The simplest way to start using VS Code as our editor, is
to place our Python code in files located IN THE SAME FOLDER as our Grasshopper file.

After we have done that, we need 2 steps: 

1. Enable the COMPAS reloader on one component. This tells Grasshopper to watch for changes in the Pythoh files and reload if changed.
2. Every other component that uses Python code from external files needs to start with a method to ensure Grasshopper knows where to load the files from.

"""
# r: compas
# venv: mas-2526

from compas_rhino.devtools import DevTools
DevTools.enable_reloader()
# ---------- end enable_auto_reload ----------

# ----
# Generate Geometry
number_slider_9 = Slider(9, range=0..30)
gap = Slider(2.5, range=0..10)
curve = Curve(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)
brick_wall = Python3Script(crv=curve, num_layers=number_slider_9, gap=gap)  # -> bricks, geometries, way_planes; inputs crv: Curve, num_layers: Int32, gap: Double
# ---------- brick_wall: Python ----------
# r: compas
# venv: mas-2526
from compas_rhino.devtools import DevTools
DevTools.ensure_path()

# 0. Import everything we will need
import math
from compas.geometry import Box
from compas.geometry import Point
from compas.geometry import Frame
from compas.geometry import cross_vectors
from compas_rhino.conversions import curve_to_compas

# ..also import our module "brick_wall.py", that needs to be in the same folder as our GH file
from brick_wall import Brick

# 1. Start with an empty list of bricks to be created
#    make sure to match the name of this list to the output of this component!
bricks = []

# 2. Create points on each curve
curve = curve_to_compas(crv)
print(curve.length())

# divide curve twice as fine
num_divs = int(curve.length() / (Brick.LENGTH+gap)) * 2
params, div_pts = curve.divide_by_count(num_divs, True)

for row in range(num_layers):
    for col, param in enumerate(params):
        pt = curve.point_at(param)
        pt = pt.translated([0,0,Brick.HEIGHT * row])
        tangent = curve.tangent_at(param)
        normal = cross_vectors(tangent, [0,0,1])
        # only place bricks on alternating divisions depending on the row
        if row % 2 == 0:  
            # even rows 
            if col % 2 == 0:
                b = Brick(frame = Frame(pt, tangent, normal))
                bricks.append(b)
        else:  
            # odd rows 
            if col % 2 == 1:
                b = Brick(frame = Frame(pt, tangent, normal))
                bricks.append(b)

# Visualize and store brick data
geometries = []
way_planes = []

for brick in bricks:
    geometries.append(brick.draw())
    way_planes.append(brick.get_pick_frame())
# ---------- end brick_wall ----------
compas_draw = COMPASDraw(cg=brick_wall.way_planes)  # -> rg; same code as draw
compas_draw_2 = COMPASDraw(cg=brick_wall.geometries)  # -> rg; same code as draw
python_3_script = Python3Script(x=brick_wall.way_planes)  # -> out, a; inputs x: list
# ---------- python_3_script: Python ----------
from compas_rhino.conversions import frame_to_rhino_plane

a = [frame_to_rhino_plane(f) for f in x]
# ---------- end python_3_script ----------

crv_u_4 = Curve(<curve referenced from the Rhino model>)

# ----
# Brick wal_5
#  (U-curve + rotate at a stable number)
crv_u_2_3 = Curve(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)
py3_3 = Python3Script(
    crv=crv_u_2_3,
    num_layers=Slider(10, range=0..30),
    gap=Slider(1.5, range=0..10),
    cols=Slider(10, range=0..30),
    rotation=Slider(36, range=0..180))  # -> out, geometries, way_planes; inputs crv: Curve, num_layers: Int32, gap: Double, cols: Int32, rotation: Double
# ---------- py3_3: Python ----------
# r: compas
# venv: mas-2526

from compas_rhino.devtools import DevTools
DevTools.ensure_path()

import math
from compas.geometry import Box, Point, Frame, cross_vectors, Vector
from compas_rhino.conversions import curve_to_compas
from brick_wall_2 import Brick

bricks = []

curve = curve_to_compas(crv)
print(curve.length())

num_divs = int(curve.length())/(Brick.LENGTH+gap) * 2
params, div_pts = curve.divide_by_count(num_divs, True)

for row in range(num_layers):
    for col, param in enumerate(params):
        pt = curve.point_at(param)
        pt = pt.translated([0,0, Brick.HEIGHT * row])
        tangent = curve.tangent_at(param)
        normal = cross_vectors(tangent, [0,0,1])

        # dispatch A,B row
        if row % 2 == 0:
            if col % 2 == 0:
                b = Brick(Frame(pt, tangent, normal)) 
                bricks.append(b)               
        else:
            if row % 2 == 1 and col == 1:
                b_left = Brick(Frame(pt, tangent, normal))
                b_left.rotate(90)
                b_left.frame.translate(-tangent.unitized()*(Brick.LENGTH + Brick.WIDTH + gap)* 4/7)
                bricks.append(b_left)

            if col % 2 == 1:                
                b = Brick(Frame(pt, tangent, normal))
                bricks.append(b)
                
            if row % 2 == 1 and col == len(params)-2:
                b_right = Brick(Frame(pt, tangent, normal))
                b_right.rotate(90)
                b_right.frame.translate(tangent.unitized()* 1/2 *(Brick.LENGTH + Brick.WIDTH + gap*4))
                bricks.append(b_right)


        # rotation
        if row % 3 == 0 and col % 3 == 0:
            b.rotate(rotation)

# visualize and store brick data
geometries = []
way_planes = []

for brick in bricks:
    geometries.append(brick.draw())
    way_planes.append(brick.get_pick_frame())
# ---------- end py3_3 ----------
draw_5 = COMPASDraw(cg=py3_3.way_planes)  # -> rg; same code as draw
draw_6 = COMPASDraw(cg=py3_3.geometries)  # -> rg; same code as draw
number_slider_10 = Slider(10, range=0..10)
item_3 = ListItem(List=draw_5, Index=0, Wrap=True)  # -> Item, Item1, Item2
pl_3 = ConstructPlane(Origin=item_3.Item, XAxis=item_3.Item1, YAxis=item_3.Item2)
item_4 = ListItem(List=draw_6, Index=Slider(60, range=0..100), Wrap=True)
preview_3 = CustomPreview(Geometry=draw_6, Material=ColourSwatch(SwatchColor=RGB(255, 173, 92)))
pln_3 = Plane(pl_3)

# ----
# pick frame
panel = Panel("-314.78")
pt = ConstructPoint(XCoordinate="534.35", YCoordinate="-315.60", ZCoordinate="-9.96")
pt_2 = ConstructPoint(XCoordinate="535.90", YCoordinate="101.40", ZCoordinate="-9.39")
pt_3 = ConstructPoint(XCoordinate="246.86", YCoordinate=panel, ZCoordinate="-10.85")
py3_4 = Python3Script(origin=pt, xaxis_pt=pt_2, xy_pt=pt_3)  # -> out, pick_frame; inputs origin: Point3d, xaxis_pt: Point3d, xy_pt: Point3d
# ---------- py3_4: Python ----------
from compas.geometry import Frame, Point
from compas.geometry import Rotation

from compas_rhino.conversions import point_to_compas

origin = point_to_compas(origin)
xaxis_pt = point_to_compas(xaxis_pt)
xy_pt = point_to_compas(xy_pt)

#define pick frame
pick_frame = Frame(origin, xaxis_pt - origin, xy_pt - origin)
# ---------- end py3_4 ----------
compas_draw_3 = COMPASDraw(cg=py3_4.pick_frame)  # -> rg; same code as draw

pt_4 = ConstructPoint(XCoordinate="0.07", YCoordinate="-0.06", ZCoordinate="74.33")

pline = PolyLine(Closed=False)

# ----
# Brick wal_5
#  (U-curve + rotate at a stable number)
crv_u_2_4 = Curve(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)  # disabled
number_slider_11 = Slider(10, range=0..30)  # disabled
number_slider_12 = Slider(1.5, range=0..10)  # disabled
number_slider_13 = Slider(10, range=0..30)  # disabled
number_slider_14 = Slider(36, range=0..180)  # disabled

end = EndPoints(Curve=crv_u_2_4)  # -> Start, End; disabled
ln = Line(StartPoint=end.Start, EndPoint=end.End)  # disabled
midpt = CurveMiddle(Curve=ln)  # disabled

py3_5 = Python3Script(
    crv=crv_u_2_4,
    cpt=midpt,
    num_layers=number_slider_11,
    gap=number_slider_12,
    cols=number_slider_13,
    rotation=number_slider_14)  # -> out, geometries, way_planes; inputs crv: Curve, cpt: Point3d, num_layers: Int32, gap: Double, cols: Int32, rotation: Double; disabled
# ---------- py3_5: Python ----------
# r: compas
# venv: mas-2526

from compas_rhino.devtools import DevTools
DevTools.ensure_path()

import math
from compas.geometry import Box, Point, Frame, Vector, cross_vectors, angle_vectors
from compas_rhino.conversions import curve_to_compas, point_to_compas
from brick_wall_2 import Brick

bricks = []

curve = curve_to_compas(crv)
print(curve.length())

num_divs = int(curve.length())/(Brick.LENGTH+gap) * 2
params, div_pts = curve.divide_by_count(num_divs, True)

for row in range(num_layers):
    for col, param in enumerate(params):
        pt = curve.point_at(param)
        pt = pt.translated([0,0, Brick.HEIGHT * row])
        tangent = curve.tangent_at(param)
        normal = cross_vectors(tangent, [0,0,1])

        # dispatch A,B row
        if row % 2 == 0:
            if col % 2 == 0:
                b = Brick(Frame(pt, tangent, normal))                
        else:
            if col % 2 == 1:                
                b = Brick(Frame(pt, tangent, normal))

        # rotation
        ccpt = point_to_compas(cpt)
        # r_vec = ccpt - b.point
        r_vec = Point(ccpt.x, ccpt.y, b.point.z) - (b.point)
        if row % 2 == 0 and col % 4 == 0:
            r_radian = angle_vectors(r_vec, b.frame.normal)
            r_degree = math.degrees(r_radian)
            b.rotate(r_degree)
        bricks.append(b)

# visualize and store brick data
geometries = []
way_planes = []

for brick in bricks:
    geometries.append(brick.draw())
    way_planes.append(brick.get_pick_frame())
# ---------- end py3_5 ----------
draw_7 = COMPASDraw(cg=py3_5.way_planes)  # -> rg; disabled; same code as draw
draw_8 = COMPASDraw(cg=py3_5.geometries)  # -> rg; disabled; same code as draw
item_5 = ListItem(List=draw_7, Index=0, Wrap=True)  # -> Item, Item1, Item2; disabled
preview_4 = CustomPreview(
    Geometry=draw_8,
    Material={diffuse=RGB(221, 160, 221), emission=RGB(66, 48, 66), shine=0.5, specular=RGB(255, 255, 255), transparency=0})  # disabled
pl_4 = ConstructPlane(Origin=item_5.Item, XAxis=item_5.Item1, YAxis=item_5.Item2)  # disabled
pln_4 = Plane(pl_4)  # disabled

# ----
# Brick wal_5
#  (U-curve + rotate at a stable number)
crv_u_3_2 = Curve(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)
crv_u_2_5 = Curve(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)

end_2 = EndPoints(Curve=crv_u_3_2)  # -> Start, End
ln_2 = Line(StartPoint=end_2.Start, EndPoint=end_2.End)
midpt_2 = CurveMiddle(Curve=ln_2)

py3_6 = Python3Script(
    crv=crv_u_3_2,
    cpt=midpt_2,
    num_layers=Slider(10, range=0..30),
    gap=Slider(4.5, range=0..10),
    cols=Slider(10, range=0..30),
    rotation=Slider(9, range=0..180))  # -> out, geometries, way_planes; inputs crv: Curve, cpt: Point3d, num_layers: Int32, gap: Double, cols: Int32, rotation: Double
# ---------- py3_6: Python ----------
# r: compas
# venv: mas-2526

from compas_rhino.devtools import DevTools
DevTools.ensure_path()

import math
from compas.geometry import Box, Point, Frame, Vector, cross_vectors, angle_vectors
from compas_rhino.conversions import curve_to_compas, point_to_compas
from brick_wall_2 import Brick

bricks = []

curve = curve_to_compas(crv)
print(curve.length())

num_divs = int(curve.length())/(Brick.LENGTH+gap) * 2
params, div_pts = curve.divide_by_count(num_divs, True)

for row in range(num_layers):
    for col, param in enumerate(params):
        pt = curve.point_at(param)
        pt = pt.translated([0,0, Brick.HEIGHT * row])
        tangent = curve.tangent_at(param)
        normal = cross_vectors(tangent, [0,0,1])

        # dispatch A,B row
        if row % 2 == 0:
            if col % 2 == 0:
                b = Brick(Frame(pt, tangent, normal))                
        else:
            if col % 2 == 1:                
                b = Brick(Frame(pt, tangent, normal))

        # rotation
        ccpt = point_to_compas(cpt)
        r_vec = Point(ccpt.x, ccpt.y, b.point.z) - (b.point)
        if row % 2 == 0 and col % 4 == 0:
            r_radian = angle_vectors(r_vec, b.frame.normal)
            r_degree = math.degrees(r_radian)
            b.rotate(r_degree)
        else:
            b.rotate(rotation)
        bricks.append(b)

# visualize and store brick data
geometries = []
way_planes = []

for brick in bricks:
    geometries.append(brick.draw())
    way_planes.append(brick.get_pick_frame())
# ---------- end py3_6 ----------
draw_9 = COMPASDraw(cg=py3_6.way_planes)  # -> rg; same code as draw
draw_10 = COMPASDraw(cg=py3_6.geometries)  # -> rg; same code as draw
item_6 = ListItem(List=draw_9, Index=0, Wrap=True)  # -> Item, Item1, Item2
preview_5 = CustomPreview(Geometry=draw_10, Material=ColourSwatch(SwatchColor=RGB(255, 173, 92)))
pl_5 = ConstructPlane(Origin=item_6.Item, XAxis=item_6.Item1, YAxis=item_6.Item2)
pln_5 = Plane(pl_5)

# ----
# Transform from Rhino to Robot Space
panel_2 = Panel("-314.78")
fine_adjust_z_mm = Slider(5, range=-5..10)
pt_5 = ConstructPoint(XCoordinate="535.90", YCoordinate="101.40", ZCoordinate="-9.39")
pt_6 = ConstructPoint(XCoordinate="246.86", YCoordinate=panel_2, ZCoordinate="-10.85")
pt_7 = ConstructPoint(XCoordinate="534.35", YCoordinate="-315.60", ZCoordinate="-9.96")
brec = BoundingRectangle(Geometry=[pt_7, pt_5, pt_6], Plane=PlaneXY(0, 0, 0), Axis=0, Slide=0, Union=True)  # -> Bounding, DimensionX, DimensionY

# ----
# transformation, transformed
compas = Python3Script(way_planes=py3.way_planes, wobj_origin=pt_7, wobj_xaxis=pt_5, wobj_xypoint=pt_6, z_safe_margin=fine_adjust_z_mm)  # -> out, transformed_planes; inputs way_planes: list, wobj_origin: Point3d, wobj_xaxis: Point3d, wobj_xypoint: Point3d, z_safe_margin: Double
# ---------- compas: Python ----------
import compas.geometry as cg

#in this step we transform our way planes to robot space
#the rhino co-ordinate system is rather abstract in the physical world
#the robot base plane assumed the base frame of robot is the origin
#but rhino does not know that
#thus we transform things from our design space(Rhino World XY) to Robot Base Plane that we measure

def set_robot_base(origin, xaxis, xypoint):
    """
    set a base plane representing the robot working object plane
    """
    robot_base = cg.Frame(origin, xaxis - origin, xypoint - origin)
    print (robot_base)
    return (robot_base)

def rhino_to_robot_space(rhino_plane, robot_base_plane):
    """
    Transform the objects from Rhino world XY plane to robot work object plane
    """
    T_matrix = cg.Transformation.from_frame_to_frame(cg.Frame.worldXY(), robot_base_plane)
    robot_plane = rhino_plane.transformed(T_matrix)
    return robot_plane

def set_z_safe_margin(planes_to_adjust, safety_margin):
    adjusted = []
    T = cg.Translation.from_vector(cg.Vector(0, 0, safety_margin))
    for f in planes_to_adjust:
        adjusted.append(f.transformed(T))
    return adjusted
    """    T = cg.Translation.from_vector(cg.Vector(0, 0, safety_margin))
    for f in planes_to_adjust:
        adjusted.append(f.transformed(T))"""

# ===== Robot base is set =====
robot_base =  set_robot_base(wobj_origin, wobj_xaxis, wobj_xypoint)
print(robot_base)

# ===== Set safety margin for Z height ======
safe_planes = set_z_safe_margin(way_planes, z_safe_margin)

# ===== Transforming the rhino planes into robot planes =====
transformed_planes = []
for plane in safe_planes: 
    transformed_planes.append(rhino_to_robot_space(plane, robot_base))
# ---------- end compas ----------

compas_draw_4 = COMPASDraw(cg=compas.transformed_planes)  # -> rg; same code as draw
panel_3 = Panel(compas_draw_4)
item_7 = ListItem(List=compas_draw_4, Index=0, Wrap=True)  # -> flatten(Item)
points = PointList(Points=item_7, Size=Slider(5, range=0..10))
item_8 = ListItem(List=item_7, Index=Slider(12, range=0..100), Wrap=True)

# ----
# Convert Planes to URScript
number_slider_15 = Slider(0.1, range=0..0.1)
number_slider_16 = Slider(0.1, range=0..0.1)
compas_2 = Python3Script(
    way_frames=compas.transformed_planes,
    tcp_measured=pt_4,
    acceleration=number_slider_15,
    velocity=number_slider_16,
    pick_frame=py3_4.pick_frame)  # -> out, vis_frames, vis_planes, script; inputs way_frames: list, tcp_measured: Point3d, acceleration: Double, velocity: Double
# ---------- compas_2: Python ----------
from imp import reload
import sys
import os

#get current file path
path = ghenv.Component.OnPingDocument().FilePath
#get parent directory of the parent directory
parentdir = os.path.dirname(path)
#get src folder which contains classes
dire = os.path.join(parentdir,'src')

sys.path.append(dire)

import simple_ur_script as ur

import utils 

import simple_comm as com


import compas.geometry as cg
import math as m

# ===== Set global constants =======

IO = 4 #Global constant
SAFE_DIST = 50

# =================================

script = "" #create empty string

def pickup_brick(script,pick_up_frame):
    frames = []
    
    safe_pick_up_frame = pick_up_frame.translated(-pick_up_frame.normal*SAFE_DIST)
    
    ## add to the path: go to the safe plane
    script += ur.move_l(safe_pick_up_frame, acceleration, velocity)
    frames.append(safe_pick_up_frame)
    
    ## add to the path: go to the pick up plane
    script += ur.move_l(pick_up_frame, acceleration, velocity)
    frames.append(pick_up_frame)
    
    ## add to the path: turn on the vacuum and wait 1 sec.
    script += ur.set_digital_out(IO,True)
    script += ur.sleep(1)

    # add to the path: go back to the safe_plane
    script += ur.move_l(safe_pick_up_frame, acceleration, velocity)
    frames.append(safe_pick_up_frame)
    
    return script, frames


def place_brick(script, place_frame):
    
    frames = []
    
    safe_place_frame = place_frame.translated(cg.Vector(0,0,1)*SAFE_DIST)
    
    # add to the path: go to the safe plane
    script += ur.move_l(safe_place_frame, acceleration, velocity)
    frames.append(safe_place_frame)
    
    # add to the path: go to the place plane
    script += ur.move_l(place_frame, acceleration, velocity)
    frames.append(place_frame)
    
    ## add to the path: turn off the vacuum and wait 1 second (hold the brick)
    script += ur.set_digital_out(IO,False)
    script += ur.sleep(1)
    
    # add to the path: go back to the safe plane
    script += ur.move_l(safe_place_frame, acceleration, velocity)
    frames.append(safe_place_frame)
    
    return script,frames


#if value given for tcp measured, then add line to script, otherwise it will take current tcp from robot
if tcp_measured is not None:
    script += ur.set_tcp_by_angles(tcp_measured.X, tcp_measured.Y, tcp_measured.Z, m.radians(0.0),m.radians(0.0),m.radians(0))


vis_frames = []
#add move_l commands in sequence to script for each way plane
for brick_frame in way_frames:
    script, p = pickup_brick(script,pick_frame)
    vis_frames.extend(p) #only to visualize the planes
    script, p = place_brick(script,brick_frame)
    vis_frames.extend(p)


#format the script to make it sendable
script = com.concatenate_script(script)

from compas_rhino import conversions
import Rhino.Geometry as rg

vis_planes = [conversions.frame_to_rhino(frame) for frame in vis_frames]
# ---------- end compas_2 ----------
pline_2 = PolyLine(Vertices=compas_2.vis_planes, Closed=False)
points_2 = PointList(Points=compas_2.vis_planes, Size=Slider(5, range=0..100))
compas_draw_5 = COMPASDraw(cg=compas_2.vis_frames)  # -> rg; same code as draw

panel_4 = Panel(compas_2.script)

# ---- group: Send UR script to Robot!
# Send to Robot!
panel_5 = Panel("192.168.10.10")
py3_7 = Python3Script(script=compas_2.script, ip_address=panel_5, send=Button())  # -> out, a; inputs script: String, ip_address: String, send: Boolean
# ---------- py3_7: Python ----------
import simple_comm as com

if send:
    com.send_script(script,ip_address)
# ---------- end py3_7 ----------
