# Grasshopper definition brick_wall_nadja (option 1).gh (Grasshopper 1.0.8)

gap = Slider(2, range=0..10)
py3 = Python3Script(
    num_layers=Slider(20, range=0..100),
    gap=gap,
    num_bricks=Slider(100, range=0..100),
    up=Slider(13.39, range=0..100),
    down=Slider(11.37, range=0..100),
    width=Slider(3.5, range=0..100),
    length=Slider(0.0084, range=0..0.01),
    scale=Slider(16, range=0..100))  # -> out, geometry, polylines, frames, circle, div_pts, geometries, all_points; inputs num_layers: Int32, gap: Double, num_bricks: Int32, up: Double, down: Double, width: Double, length: Double, scale: Double
# ---------- py3: Python ----------
# r: compas
# venv: mas-2526

from compas_rhino.devtools import DevTools
DevTools.enable_reloader()

# STEP 1: Import everything we will need
import math
from compas.geometry import Box
from compas.geometry import Point
from compas.geometry import Frame
from compas.geometry import Polygon, Polyline, Vector, Curve
import compas_rhino.conversions 
from compas.geometry import cross_vectors
from compas_rhino.conversions import curve_to_compas
from ghpythonlib.treehelpers import list_to_tree, tree_to_list


# from brick_wall import Brick
from brick_wall import BigBrick

# Inputs and lists

division = BigBrick.LENGTH
height = BigBrick.HEIGHT

vectors = []
bricks = []


def circle_points(center, num_points, mod, cir=BigBrick.LENGTH, up=up, down=down, width=width, length=length, scale=scale):
    points = []
    theta = 2 * math.pi / num_points # M1: angle of the polygon
    radius = 120 # M2: radius of the polygon acording to the lenght of the brick
    for i in range(num_points):
        theta = 2 * math.pi * i / num_points  # angle from 0 to 2π
        x = center.x + radius * math.cos(theta)/((mod+up)/width)*scale
        y = center.y + radius * math.sin(theta)*((mod+down)*length)*scale
        points.append(Point(x, y, center.z))
    return points

polylines = []
for n in range(num_layers):
    circle = circle_points(Point(600,400,0), num_bricks, mod=n)
    circle.append(circle[0])
    polyline = Polyline(circle)
    polylines.append(polyline)


# 1. Start with an empty list of bricks to be created
#    make sure to match the name of this list to the output of this component!
bricks = []
all_points = []

for row, curve in enumerate(polylines):
    # divide curve twice as fine
    num_divs = int(curve.length / (BigBrick.LENGTH+gap))
    ### change the script so that num of bricks in the row
    if num_divs % 2 != 0:
        num_divs = num_divs - 1

    leng = curve.length / (num_divs*2)
    div_pts = curve.divide_by_length(leng)

    if len(div_pts) % 2 != 0:
        div_pts.pop(-1)

    for col, pt in enumerate(div_pts):
        param = curve.parameter_at(pt)
        pt = pt.translated([0,0,BigBrick.HEIGHT * row])
        tangent = curve.tangent_at(param)
        normal = cross_vectors(tangent, [0,0,1])

        # vector 
        vec = Vector(normal[0], normal[1], normal[2])
        vec.unitize()

        if row % 2 == 0:  
            # even rows 
            # print("perpendicular bricks")
            if col % 2 == 0:
                vec.scale(BigBrick.WIDTH/3)
                new_pt = pt.translated(vec)
                b = BigBrick(frame = Frame(new_pt, tangent, normal))
                bricks.append(b)
        else:  
            # odd rows 
            # print("paralel bricks")
            if col % 2 == 1:
                vec.scale(BigBrick.WIDTH/3)
                new_pt = pt.translated(vec)
                b = BigBrick(frame = Frame(new_pt, tangent, normal))
                bricks.append(b)
    all_points.append(div_pts)
# Visualize and store brick data
geometries = []
way_planes = []

for brick in bricks:
    geometries.append(brick.draw())
    way_planes.append(brick.get_pick_frame())


all_points = list_to_tree(all_points)
print(all_points)
# ---------- end py3 ----------
draw = COMPASDraw(cg=py3.geometries)  # -> rg
#   port cg: The COMPAS geometry or datastructure to be drawn.
#   port rg: The Rhino geometry object.
# ---------- draw: Python ----------
# r: compas>=2.14.1
"""
Draws COMPAS geometry in Grasshopper.
"""

from typing import Any

import Grasshopper

from compas.scene import SceneObject


class CompasToRhinoGeometry(Grasshopper.Kernel.GH_ScriptInstance):
    def RunScript(self, cg):
        if not cg:
            return None

        return SceneObject(item=cg).draw()
# ---------- end draw ----------
draw_2 = COMPASDraw(cg=py3.polylines)  # -> rg; same code as draw
draw_3 = COMPASDraw(cg=py3.circle)  # -> rg; same code as draw
draw_4 = COMPASDraw(cg=py3.div_pts)  # -> rg; same code as draw
draw_5 = COMPASDraw(cg=py3.geometry)  # -> rg; same code as draw
crv = Curve(draw_2)
preview = CustomPreview(
    Geometry=draw,
    Material={diffuse=RGB(221, 160, 221), emission=RGB(66, 48, 66), shine=0.5, specular=RGB(255, 255, 255), transparency=0})
