# Grasshopper definition my_brick_to_robot (nadja)(1).gh (Grasshopper 1.0.8)
# plug-ins: Robots

crv = Curve(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)
number_slider = Slider(4, range=0..100)
gap = Slider(2, range=0..10)
number_slider_2 = Slider(4, range=0..100)
end = EndPoints(Curve=crv)  # -> Start, End
gap_2 = Slider(2, range=0..10)

# ---- group: This is needed only ONCE in the GH definition
enable_auto_reload = Python3Script()  # -> ok
# ---------- enable_auto_reload: Python ----------
"""
------------------------------
Using VS Code as Python editor
------------------------------

The simplest way to start using VS Code as our editor, is
to place our Python code in files located IN THE SAME FOLDER as our Grasshopper file.

After we have done that, we need 2 steps: 

1. Enable the COMPAS reloader on one component. This tells Grasshopper to watch for changes in the Pythoh files and reload if changed.
2. Every other component that uses Python code from external files needs to start with a method to ensure Grasshopper knows where to load the files from.

"""
# r: compas
# venv: mas-2526

from compas_rhino.devtools import DevTools
DevTools.enable_reloader()
# ---------- end enable_auto_reload ----------

# ----
pt = ConstructPoint(XCoordinate="-2.22", YCoordinate="1.36", ZCoordinate="83.85")

pt_2 = Point(<point referenced from the Rhino model>)
list = RobotsLibrary({"UR3e", "UR5e", "UR10e", "UR16e", "UR3", "UR5", "UR10", "UR20", "UR30"}, selected="UR10", Type=0)
pl = ConstructPlane(Origin=end.Start, XAxis=Vector(1, 0, 0), YAxis=Vector(0, 1, 0))
pt_3 = Point(<point referenced from the Rhino model>)
gap_3 = Slider(2.5, range=0..10)
py3 = Python3Script(
    num_layers=Slider(20, range=0..100),
    gap=gap,
    num_bricks=Slider(100, range=0..100),
    up=Slider(20, range=0..100),
    down=Slider(11.37, range=0..100),
    width=Slider(3.5, range=0..100),
    length=Slider(0.0084, range=0..0.01),
    scale=Slider(3, range=0..10),
    position=pt_2)  # -> out, geometry, polylines, frames, circle, div_pts, geometries, way_planes; inputs num_layers: Int32, gap: Double, num_bricks: Int32, up: Double, down: Double, width: Double, length: Double, scale: Double, position: Point3d
# ---------- py3: Python ----------
# r: compas
# venv: mas-2526

from compas_rhino.devtools import DevTools
DevTools.enable_reloader()

# STEP 1: Import everything we will need
import math
from compas.geometry import Box
from compas.geometry import Point
from compas.geometry import Frame
from compas.geometry import Polygon, Polyline, Vector, Curve
import compas_rhino.conversions 
from compas.geometry import cross_vectors
from compas_rhino.conversions import curve_to_compas
from ghpythonlib.treehelpers import list_to_tree, tree_to_list


from brick_wall import Brick
from brick_wall import BigBrick

# Inputs and lists

division = Brick.LENGTH
height = Brick.HEIGHT

vectors = []
bricks = []

position = compas_rhino.conversions.point_to_compas(position)

def circle_points(center, num_points, mod, cir=Brick.LENGTH, up=up, down=down, width=width, length=length, scale=scale):
    points = []
    theta = 2 * math.pi / num_points # M1: angle of the polygon
    radius = 120 # M2: radius of the polygon acording to the lenght of the brick
    for i in range(num_points):
        theta = 2 * math.pi * i / num_points  # angle from 0 to 2π
        x = center.x + radius * math.cos(theta)*((mod+down)*length)*scale
        y = center.y + radius * math.sin(theta)/((mod+up)/width)*scale
        points.append(Point(x, y, center.z))
    return points

polylines = []
for n in range(num_layers):
    circle = circle_points(position, num_bricks, mod=n)
    circle.append(circle[0])
    polyline = Polyline(circle)
    polylines.append(polyline)


# 1. Start with an empty list of bricks to be created
#    make sure to match the name of this list to the output of this component!
bricks = []
all_points = []

for row, curve in enumerate(polylines):
    # divide curve twice as fine
    num_divs = int(curve.length / (Brick.LENGTH+gap))
    ### change the script so that num of bricks in the row
    if num_divs % 2 != 0:
        num_divs = num_divs - 1

    leng = curve.length / (num_divs*2)
    div_pts = curve.divide_by_length(leng)

    if len(div_pts) % 2 != 0:
        div_pts.pop(-1)


    for col, pt in enumerate(div_pts):
        param = curve.parameter_at(pt)
        pt = pt.translated([0,0,Brick.HEIGHT * row])
        tangent = curve.tangent_at(param)
        normal = cross_vectors(tangent, [0,0,1])

        # vector 
        vec = Vector(normal[0], normal[1], normal[2])
        vec.unitize()

        if row % 2 == 0:  
            # even rows 
            # print("perpendicular bricks")
            if col % 2 == 0:
                vec.scale(Brick.WIDTH/2)
                new_pt = pt.translated(vec)
                b = Brick(frame = Frame(new_pt, tangent, normal))
                bricks.append(b)
        else:  
            # odd rows 
            # print("paralel bricks")
            if col % 2 == 1:
                vec.scale(Brick.WIDTH/2)
                new_pt = pt.translated(vec)
                b = Brick(frame = Frame(new_pt, tangent, normal))
                bricks.append(b)
    all_points.append(div_pts)
# Visualize and store brick data
geometries = []
way_planes = []

# for brick in bricks:
#     brick.frame = brick.frame.translated(Vector(0,0,Brick.HEIGHT/2))

for br in bricks:
    geometries.append(br.draw())
    # fr = br.frame
    # fr = fr.translated(Vector(0,0,-(Brick.HEIGHT / 2)))
    # way_planes.append(fr)
    way_planes.append(br.get_pick_frame())


all_points = list_to_tree(all_points)
# ---------- end py3 ----------
rotate = Rotate(Geometry=crv, Angle=degrees(Slider(90, range=0..100)), Plane=pl)  # -> Geometry, Transform
xy = XYPlane(Origin=pt)

# ---- group: tool or end effector
# orientation relative to flange
# (use world origin as flange)
# no spaces
# tool center point (tcp)
# tool geometry
# (must be a single mesh)
tool_name = Panel("extruder")
pt_4 = Point(Point(137.8363948, 2.467293384e-06, 44.59797803))
weight = Panel("2.0")
mesh = Mesh(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)
pl_2 = ConstructPlane(Origin=pt_4, XAxis="0,0,-1", YAxis=Vector(0, 1, 0))
tool = CreateTool(Name=tool_name, TCP=xy, Weight=weight)  # -> Tool, TCP

# ----
py3_2 = Python3Script(
    num_layers=Slider(20, range=0..100),
    gap=gap_2,
    num_bricks=Slider(100, range=0..100),
    up=Slider(13.39, range=0..100),
    down=Slider(11.37, range=0..100),
    width=Slider(3.5, range=0..100),
    length=Slider(0.0084, range=0..0.01),
    scale=Slider(3.5, range=0..10),
    position=pt_3)  # -> out, geometry, polylines, frames, circle, div_pts, geometries, way_planes; inputs num_layers: Int32, gap: Double, num_bricks: Int32, up: Double, down: Double, width: Double, length: Double, scale: Double, position: Point3d
# ---------- py3_2: Python ----------
# r: compas
# venv: mas-2526

from compas_rhino.devtools import DevTools
DevTools.enable_reloader()

# STEP 1: Import everything we will need
import math
from compas.geometry import Box
from compas.geometry import Point
from compas.geometry import Frame
from compas.geometry import Polygon, Polyline, Vector, Curve
import compas_rhino.conversions 
from compas.geometry import cross_vectors
from compas_rhino.conversions import curve_to_compas
from ghpythonlib.treehelpers import list_to_tree, tree_to_list


from brick_wall import Brick
from brick_wall import BigBrick

# Inputs and lists

division = Brick.LENGTH
height = Brick.HEIGHT

vectors = []
bricks = []

position = compas_rhino.conversions.point_to_compas(position)

def circle_points(center, num_points, mod, cir=Brick.LENGTH, up=up, down=down, width=width, length=length, scale=scale):
    points = []
    theta = 2 * math.pi / num_points # M1: angle of the polygon
    radius = 120 # M2: radius of the polygon acording to the lenght of the brick
    for i in range(num_points):
        theta = 2 * math.pi * i / num_points  # angle from 0 to 2π
        x = center.x + radius * math.cos(theta)*((mod+down)*length)*scale
        y = center.y + radius * math.sin(theta)/((mod+up)/width)*scale
        points.append(Point(x, y, center.z))
    return points

polylines = []
for n in range(num_layers):
    circle = circle_points(position, num_bricks, mod=n)
    circle.append(circle[0])
    polyline = Polyline(circle)
    polylines.append(polyline)


# 1. Start with an empty list of bricks to be created
#    make sure to match the name of this list to the output of this component!
bricks = []
all_points = []

for row, curve in enumerate(polylines):
    # divide curve twice as fine
    num_divs = int(curve.length / (Brick.LENGTH+gap))
    ### change the script so that num of bricks in the row
    if num_divs % 2 != 0:
        num_divs = num_divs - 1

    leng = curve.length / (num_divs*2)
    div_pts = curve.divide_by_length(leng)

    if len(div_pts) % 2 != 0:
        div_pts.pop(-1)


    for col, pt in enumerate(div_pts):
        param = curve.parameter_at(pt)
        pt = pt.translated([0,0,Brick.HEIGHT * row])
        tangent = curve.tangent_at(param)
        normal = cross_vectors(tangent, [0,0,1])

        # vector 
        vec = Vector(normal[0], normal[1], normal[2])
        vec.unitize()

        if row % 2 == 0:  
            # even rows 
            # print("perpendicular bricks")
            if col % 2 == 0:
                vec.scale(Brick.WIDTH/2)
                new_pt = pt.translated(vec)
                b = Brick(frame = Frame(new_pt, tangent, normal))
                bricks.append(b)
        else:  
            # odd rows 
            # print("paralel bricks")
            if col % 2 == 1:
                vec.scale(Brick.WIDTH/2)
                new_pt = pt.translated(vec)
                b = Brick(frame = Frame(new_pt, tangent, normal))
                bricks.append(b)
    all_points.append(div_pts)
# Visualize and store brick data
geometries = []
way_planes = []

for brick in bricks:
    brick.frame = brick.frame.translated(Vector(0,0,Brick.HEIGHT/2))

for br in bricks:
    geometries.append(br.draw())
    way_planes.append(br.get_pick_frame())


all_points = list_to_tree(all_points)
# ---------- end py3_2 ----------

# ---- group: robot
# list of models included in library
# more can be added manually
load_robot = LoadRobotSystem(Name=list, Base=PlaneXY(0, 0, 0))

# ----
deplane = DeconstructPlane(Plane=xy)  # -> Origin, XAxis, YAxis, ZAxis
# Generate Geometry
brick_wall = Python3Script(crv=rotate.Geometry, num_layers=Slider(9, range=0..30), gap=gap_3)  # -> bricks, geometries, way_planes; inputs crv: Curve, num_layers: Int32, gap: Double
# ---------- brick_wall: Python ----------
# r: compas
# venv: mas-2526
from compas_rhino.devtools import DevTools
DevTools.ensure_path()

# 0. Import everything we will need
import math
from compas.geometry import Box
from compas.geometry import Point
from compas.geometry import Frame
from compas.geometry import cross_vectors
from compas_rhino.conversions import curve_to_compas

# ..also import our module "brick_wall.py", that needs to be in the same folder as our GH file
from brick_wall import Brick

# 1. Start with an empty list of bricks to be created
#    make sure to match the name of this list to the output of this component!
bricks = []

# 2. Create points on each curve
curve = curve_to_compas(crv)
print(curve.length())

# divide curve twice as fine
num_divs = int(curve.length() / (Brick.LENGTH+gap)) * 2
params, div_pts = curve.divide_by_count(num_divs, True)

for row in range(num_layers):
    for col, param in enumerate(params,):
        pt = curve.point_at(param)
        pt = pt.translated([0,0,Brick.HEIGHT * row])
        tangent = curve.tangent_at(param)
        normal = cross_vectors(tangent, [0,0,1])
        # only place bricks on alternating divisions depending on the row
        if row % 2 == 0:  
            # even rows 
            if col % 2 == 0:
                b = Brick(frame = Frame(pt, tangent, normal))
                bricks.append(b)
        else:  
            # odd rows 
            if col % 2 == 1:
                b = Brick(frame = Frame(pt, tangent, normal))
                bricks.append(b)

# Visualize and store brick data
geometries = []
way_planes = []

for brick in bricks:
    geometries.append(brick.draw())
    way_planes.append(brick.get_pick_frame())
# ---------- end brick_wall ----------
draw = COMPASDraw(cg=py3.polylines)  # -> rg
#   port cg: The COMPAS geometry or datastructure to be drawn.
#   port rg: The Rhino geometry object.
# ---------- draw: Python ----------
# r: compas>=2.14.1
"""
Draws COMPAS geometry in Grasshopper.
"""

from typing import Any

import Grasshopper

from compas.scene import SceneObject


class CompasToRhinoGeometry(Grasshopper.Kernel.GH_ScriptInstance):
    def RunScript(self, cg):
        if not cg:
            return None

        return SceneObject(item=cg).draw()
# ---------- end draw ----------
draw_2 = COMPASDraw(cg=py3.circle)  # -> rg; same code as draw
draw_3 = COMPASDraw(cg=py3.div_pts)  # -> rg; same code as draw
draw_4 = COMPASDraw(cg=py3.geometry)  # -> rg; same code as draw
python_3_script = Python3Script(x=py3.way_planes)  # -> out, a; inputs x: list
# ---------- python_3_script: Python ----------
from compas_rhino.conversions import frame_to_rhino_plane

a = [frame_to_rhino_plane(f) for f in x]
# ---------- end python_3_script ----------
draw_5 = COMPASDraw(cg=py3.way_planes)  # -> rg; same code as draw
draw_6 = COMPASDraw(cg=py3.geometries)  # -> rg; same code as draw
pl_3 = ConstructPlane(Origin=deplane.Origin, XAxis=deplane.XAxis, YAxis=deplane.YAxis)
item = ListItem(List=draw_5, Index=0, Wrap=True)  # -> Item, Item1, Item2
draw_7 = COMPASDraw(cg=py3_2.way_planes)  # -> flatten(rg); same code as draw
draw_8 = COMPASDraw(cg=py3_2.geometries)  # -> rg; same code as draw
python_3_script_2 = Python3Script(x=py3_2.way_planes)  # -> out, a; inputs x: list; same code as python_3_script
crv_2 = Curve(draw)
compas_draw = COMPASDraw(cg=brick_wall.geometries)  # -> rg; same code as draw
compas_draw_2 = COMPASDraw(cg=brick_wall.way_planes)  # -> rg; same code as draw
pl_4 = ConstructPlane(Origin=item.Item, XAxis=item.Item1, YAxis=item.Item2)
preview = CustomPreview(
    Geometry=draw_6,
    Material={diffuse=RGB(221, 160, 221), emission=RGB(66, 48, 66), shine=0.5, specular=RGB(255, 255, 255), transparency=0})
py3_3 = Python3Script(x=brick_wall.way_planes)  # -> out, a; inputs x: list; same code as python_3_script
preview_2 = CustomPreview(
    Geometry=draw_8,
    Material={diffuse=RGB(221, 160, 221), emission=RGB(66, 48, 66), shine=0.5, specular=RGB(255, 255, 255), transparency=0})
item_2 = ListItem(List=compas_draw_2, Index=0, Wrap=True)  # -> flatten(Item)
pln = Plane(flatten(pl_4))
item_3 = ListItem(List=draw_7, Index=0, Wrap=True)  # -> Item, Item1, Item2
item_4 = ListItem(List=pln, Index=Slider(14, range=0..100), Wrap=True)
points = PointList(Points=item_2, Size=Slider(7, range=0..100))
pl_5 = ConstructPlane(Origin=item_3.Item, XAxis=item_3.Item1, YAxis=item_3.Item2)
panel = Panel("520.86")
pt_5 = ConstructPoint(XCoordinate="526.99", YCoordinate="56.91", ZCoordinate="-23.76")
pt_6 = ConstructPoint(XCoordinate="303.78", YCoordinate="476.27", ZCoordinate="-22.11")
pt_7 = ConstructPoint(XCoordinate="303.78", YCoordinate="56.76", ZCoordinate="-21.99")
srf4pt = _4PointSurface(CornerA=pt_5, CornerB=pt_7, CornerC=pt_6)
# Transform from Rhino to Robot Space
compas = Python3Script(
    way_planes=brick_wall.way_planes,
    wobj_origin=pt_7,
    wobj_xaxis=pt_5,
    wobj_xypoint=pt_6,
    z_safe_margin=Slider(10, range=0..100))  # -> out, transformed_planes; inputs way_planes: list, wobj_origin: Point3d, wobj_xaxis: Point3d, wobj_xypoint: Point3d, z_safe_margin: Double
# ---------- compas: Python ----------
import compas.geometry as cg

#in this step we transform our way planes to robot space
#the rhino co-ordinate system is rather abstract in the physical world
#the robot base plane assumed the base frame of robot is the origin
#but rhino does not know that
#thus we transform things from our design space(Rhino World XY) to Robot Base Plane that we measure

def set_robot_base(origin, xaxis, xypoint):
    """
    set a base plane representing the robot working object plane
    """
    robot_base = cg.Frame(origin, xaxis - origin, xypoint - origin)
    print (robot_base)
    return (robot_base)

def rhino_to_robot_space(rhino_plane,robot_base_plane):
    """
    Transform the objects from Rhino world XY plane to robot work object plane
    """
    T_matrix = cg.Transformation.from_frame_to_frame(cg.Frame.worldXY(), robot_base_plane)
    robot_plane = rhino_plane.transformed(T_matrix)
    return robot_plane

def set_z_safe_margin(planes_to_adjust, safety_margin):
    adjusted = []
    T = cg.Translation.from_vector(cg.Vector(0, 0, safety_margin))
    for f in planes_to_adjust:
        adjusted.append(f.transformed(T))
    return adjusted

# ===== Robot base is set =====
robot_base =  set_robot_base(wobj_origin, wobj_xaxis, wobj_xypoint)
print(robot_base)

# ===== Set safety margin for Z height ======
safe_planes = set_z_safe_margin(way_planes, z_safe_margin)

# ===== Transforming the rhino planes into robot planes =====
transformed_planes = []
for plane in safe_planes: 
    transformed_planes.append(rhino_to_robot_space(plane, robot_base))
# ---------- end compas ----------
compas_draw_3 = COMPASDraw(cg=compas.transformed_planes)  # -> rg; same code as draw
pt_8 = ConstructPoint(XCoordinate="-18.04", YCoordinate="442.29", ZCoordinate="36.95")
pt_9 = ConstructPoint(XCoordinate="10.31", YCoordinate="452.95", ZCoordinate="5.85")
pt_10 = ConstructPoint(XCoordinate="11.40", YCoordinate="444.62", ZCoordinate="3.12")
item_5 = ListItem(List=compas_draw_3, Index=0, Wrap=True)  # -> flatten(Item)
home_position = Panel("pi/2,pi*3/2,pi*3/2,pi*3/2,pi/2,0")

pt_11 = ConstructPoint(XCoordinate="-2.22", YCoordinate="1.36", ZCoordinate="83.85")

py3_4 = Python3Script(origin=pt_10, xaxis_pt=pt_8, xy_pt=pt_9)  # -> out, pick_frame; inputs origin: Point3d, xaxis_pt: Point3d, xy_pt: Point3d
# ---------- py3_4: Python ----------
from compas.geometry import Frame, Point
from compas.geometry import Rotation

from compas_rhino.conversions import point_to_compas
import math

origin = point_to_compas(origin)
xaxis_pt = point_to_compas(xaxis_pt)
xy_pt = point_to_compas(xy_pt)

#define pick frame
angle = math.radians(90)
pick_frame = Frame(origin, xaxis_pt - origin, xy_pt - origin)
pick_frame.rotate(angle, axis=pick_frame.normal, point=pick_frame.point)
# ---------- end py3_4 ----------
points_2 = PointList(Points=item_5, Size=Slider(4, range=0..10))
item_6 = ListItem(List=item_5, Index=Slider(25, range=0..100), Wrap=True)
compas_draw_4 = COMPASDraw(cg=py3_4.pick_frame)  # -> rg; same code as draw
# Convert Planes to URScript
number_slider_3 = Slider(0.1, range=0..0.1)
number_slider_4 = Slider(0.1, range=0..0.1)
compas_2 = Python3Script(
    way_frames=compas.transformed_planes,
    tcp_measured=pt_11,
    acceleration=Slider(1, range=0..3),
    velocity=Slider(2, range=0..3),
    pick_frame=py3_4.pick_frame)  # -> out, vis_frames, vis_planes, script; inputs way_frames: list, tcp_measured: Point3d, acceleration: Double, velocity: Double
# ---------- compas_2: Python ----------
from imp import reload
import sys
import os

#get current file path
path = ghenv.Component.OnPingDocument().FilePath
#get parent directory of the parent directory
parentdir = os.path.dirname(path)
#get src folder which contains classes
dire = os.path.join(parentdir,'src')

sys.path.append(dire)

import simple_ur_script as ur
reload(ur)

import utils 
reload(utils)

import simple_comm as com
reload(com)

import compas.geometry as cg
import math as m

# ===== Set global constants =======

IO = 4 #Global constant
SAFE_DIST = 50

# =================================

script = "" #create empty string

def pickup_brick(script,pick_up_frame):
    frames = []
    
    safe_pick_up_frame = pick_up_frame.translated(-pick_up_frame.normal*SAFE_DIST)
    
    ## add to the path: go to the safe plane
    script += ur.move_l(safe_pick_up_frame, acceleration, velocity)
    frames.append(safe_pick_up_frame)
    
    ## add to the path: go to the pick up plane
    script += ur.move_l(pick_up_frame, acceleration, velocity)
    frames.append(pick_up_frame)
    
    ## add to the path: turn on the vacuum and wait 1 sec.
    script += ur.set_digital_out(IO,True)
    script += ur.sleep(1)

    # add to the path: go back to the safe_plane
    script += ur.move_l(safe_pick_up_frame, acceleration, velocity)
    frames.append(safe_pick_up_frame)
    
    return script, frames


def place_brick(script, place_frame):
    
    frames = []
    
    safe_place_frame = place_frame.translated(cg.Vector(0,0,1)*SAFE_DIST)
    
    # add to the path: go to the safe plane
    script += ur.move_l(safe_place_frame, acceleration, velocity)
    frames.append(safe_place_frame)
    
    # add to the path: go to the place plane
    script += ur.move_l(place_frame, acceleration, velocity)
    frames.append(place_frame)
    
    ## add to the path: turn off the vacuum and wait 1 second (hold the brick)
    script += ur.set_digital_out(IO,False)
    script += ur.sleep(1)
    
    # add to the path: go back to the safe plane
    script += ur.move_l(safe_place_frame, acceleration, velocity)
    frames.append(safe_place_frame)
    
    return script,frames


#if value given for tcp measured, then add line to script, otherwise it will take current tcp from robot
if tcp_measured is not None:
    script += ur.set_tcp_by_angles(tcp_measured.X, tcp_measured.Y, tcp_measured.Z, m.radians(0.0),m.radians(0.0),m.radians(0))


vis_frames = []
#add move_l commands in sequence to script for each way plane
for brick_frame in way_frames:
    script, p = pickup_brick(script,pick_frame)
    vis_frames.extend(p) #only to visualize the planes
    script, p = place_brick(script,brick_frame)
    vis_frames.extend(p)


#format the script to make it sendable
script = com.concatenate_script(script)

from compas_rhino import conversions
import Rhino.Geometry as rg

vis_planes = [conversions.frame_to_rhino(frame) for frame in vis_frames]
# ---------- end compas_2 ----------

# ---- group: create targets
# right click on the create target
# component to add aditional inputs
list_2 = ValueList({"Joint", "Linear"}, selected="Joint")
approximation_zone = Panel("2.0")
cut_speed = Panel("100.0")
target = CreateTarget(
    Plane=flatten(compas_2.vis_planes),
    Motion=list_2,
    Tool=tool.Tool,
    Speed=cut_speed,
    Zone=approximation_zone,
    IsCartesian=True)

# ---- group: turn on and off the tool
# Adds commands to the first and last target that turn on
# and off the first digital output. Zone is set to 0 (stop point)
# to sync the commands with the position of the robot.
do_num = Panel("0")
approach_speed = Panel("500.0")
setdo = SetDO(DO=do_num, Value="0")
setdo_2 = SetDO(DO=do_num, Value="1")
stop_zone = Panel("0")
item_7 = ListItem(List=target, Index=0, Wrap=True)  # -> Item1, Item
speed = SpeedParameter(approach_speed)
zone = ZoneParameter(stop_zone)
target_2 = CreateTarget(Target=item_7.Item, Speed=speed, Zone=zone, Command=setdo_2, IsCartesian=True)
target_3 = CreateTarget(Target=item_7.Item1, Zone=zone, Command=setdo, IsCartesian=True)
merge = Merge(Data1=target_2, Data2=target_3)
panel_2 = Panel("""0
-2""")
replace = ReplaceItems(List=target, Item=merge, Indices=panel_2, Wrap=True)

# ----
# A home position should be set
# using joint rotation values. This is
# the only way to unambiguously
# define a robot pose.
panel_3 = Panel("0")
target_4 = CreateTarget(Joints=home_position, Tool=tool.Tool, Speed=speed, Zone=panel_3, IsCartesian=False)
panel_4 = Panel("""0
-1""")
ins = InsertItems(List=target, Item=target_4, Indices=panel_4, Wrap=True)

# ---- group: create program
program_name = Panel("simpleExtrusion")
program = CreateProgram(Name=program_name, RobotSystem=load_robot, Targets1=ins, StepSize=1)  # -> Program, Code, Duration, Warnings, Errors

# ---- group: preview
# Right click and select 'open controls' to
# preview the tool path, or move the slider.
number_slider_5 = Slider(0, range=0..1)
sim = ProgramSimulation(Program=program.Program, Time=number_slider_5, Normalized=True)  # -> SystemMeshes, JointRotations, Plane, Index, Time, Program, Errors
time = Panel(sim.Time)
trail = SimpleTrail(Program=sim.Program, Length=500, MechanicalGroup=0)

# ---- group: save program to file
panel_5 = Panel("C:\Folder")  # disabled
saveprog = SaveProgram(Program=program.Program, Folder=panel_5)  # disabled

# ----
compas_draw_5 = COMPASDraw(cg=compas_2.vis_frames)  # -> rg; same code as draw
points_3 = PointList(Points=compas_2.vis_planes, Size=Slider(6, range=0..100))
item_8 = ListItem(List=compas_draw_5, Index=0, Wrap=True)  # -> Item, Item1, Item2
pline = PolyLine(Vertices=compas_2.vis_planes, Closed=False)
pl_6 = ConstructPlane(Origin=item_8.Item, XAxis=item_8.Item1, YAxis=item_8.Item2)
robot_program = Panel(program.Code)
panel_6 = Panel(compas_2.script)

# ---- group: Send UR script to Robot!
# Send to Robot!
panel_7 = Panel("192.168.10.10")
py3_5 = Python3Script(script=compas_2.script, ip_address=panel_7, send=Button())  # -> out, a; inputs script: String, ip_address: String, send: Boolean
# ---------- py3_5: Python ----------
import simple_comm as com

if send:
    com.send_script(script,ip_address)
# ---------- end py3_5 ----------
