# Grasshopper definition test_ZX.gh (Grasshopper 1.0.8)
# plug-ins: Robots

# ---- group: This is needed only ONCE in the GH definition
enable_auto_reload = Python3Script()  # -> ok
# ---------- enable_auto_reload: Python ----------
"""
------------------------------
Using VS Code as Python editor
------------------------------

The simplest way to start using VS Code as our editor, is
to place our Python code in files located IN THE SAME FOLDER as our Grasshopper file.

After we have done that, we need 2 steps: 

1. Enable the COMPAS reloader on one component. This tells Grasshopper to watch for changes in the Pythoh files and reload if changed.
2. Every other component that uses Python code from external files needs to start with a method to ensure Grasshopper knows where to load the files from.

"""
# r: compas
# venv: mas-2526

from compas_rhino.devtools import DevTools
DevTools.enable_reloader()
# ---------- end enable_auto_reload ----------

# ---- group: DNA_rotate_column
pt = Point(Point(28.54295149, 6.248147936, 6.91674266))
python_3_script = Python3Script(rows=Slider(50, range=0..100), cols=Slider(5, range=0..100), attractor=pt)  # -> out, way_planes, geometries; inputs rows: Int32, cols: Int32, attractor: Point3d
# ---------- python_3_script: Python ----------
# r: compas
# venv: mas-2526
from compas_rhino.devtools import DevTools
DevTools.ensure_path()

from compas.geometry import Frame, Vector, Point, Rotation
from brick_wall import Brick
import math


angle_step = math.radians(10)
radius = 25


bricks = []

for row in range(rows):
    twist_angle = row * angle_step

    for col in range(cols):
        angle_around = (2.0 * math.pi / cols) * col

        px = radius * math.cos(angle_around)
        py = radius * math.sin(angle_around)
        pz = row * Brick.HEIGHT

        center_pt = Point(px+200, py+100, pz)

        xaxis = Vector(-math.sin(angle_around), math.cos(angle_around), 0.0)
        zaxis = Vector(0.0, 0.0, 1.0)
        yaxis = zaxis.cross(xaxis)

        frame = Frame(center_pt, xaxis, yaxis)

        brick = Brick(frame)

        brick.rotate(math.degrees(twist_angle))

        bricks.append(brick)


# Visualize and store brick data
way_planes = []
geometries = []

for brick in bricks:
    geometries.append(brick.draw())
    way_planes.append(brick.get_pick_frame())
# ---------- end python_3_script ----------
draw = COMPASDraw(cg=python_3_script.way_planes)  # -> rg
#   port cg: The COMPAS geometry or datastructure to be drawn.
#   port rg: The Rhino geometry object.
# ---------- draw: Python ----------
# r: compas>=2.14.1
"""
Draws COMPAS geometry in Grasshopper.
"""

from typing import Any

import Grasshopper

from compas.scene import SceneObject


class CompasToRhinoGeometry(Grasshopper.Kernel.GH_ScriptInstance):
    def RunScript(self, cg):
        if not cg:
            return None

        return SceneObject(item=cg).draw()
# ---------- end draw ----------
draw_2 = COMPASDraw(cg=python_3_script.geometries)  # -> rg; same code as draw

# ----
gap = Slider(2.5, range=0..10)
# Generate Geometry
curve = Curve(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)
brick_wall = Python3Script(crv=curve, num_layers=Slider(9, range=0..30), gap=gap)  # -> bricks, geometries, way_planes; inputs crv: Curve, num_layers: Int32, gap: Double
# ---------- brick_wall: Python ----------
# r: compas
# venv: mas-2526
from compas_rhino.devtools import DevTools
DevTools.ensure_path()

# 0. Import everything we will need
import math
from compas.geometry import Box
from compas.geometry import Point
from compas.geometry import Frame
from compas.geometry import cross_vectors
from compas_rhino.conversions import curve_to_compas

# ..also import our module "brick_wall.py", that needs to be in the same folder as our GH file
from brick_wall import Brick

# 1. Start with an empty list of bricks to be created
#    make sure to match the name of this list to the output of this component!
bricks = []

# 2. Create points on each curve
curve = curve_to_compas(crv)
print(curve.length())

# divide curve twice as fine
num_divs = int(curve.length() / (Brick.LENGTH+gap)) * 2
params, div_pts = curve.divide_by_count(num_divs, True)

for row in range(num_layers):
    for col, param in enumerate(params,):
        pt = curve.point_at(param)
        pt = pt.translated([0,0,Brick.HEIGHT * row])
        tangent = curve.tangent_at(param)
        normal = cross_vectors(tangent, [0,0,1])
        # only place bricks on alternating divisions depending on the row
        if row % 2 == 0:  
            # even rows 
            if col % 2 == 0:
                b = Brick(frame = Frame(pt, tangent, normal))
                bricks.append(b)
        else:  
            # odd rows 
            if col % 2 == 1:
                b = Brick(frame = Frame(pt, tangent, normal))
                bricks.append(b)

# Visualize and store brick data
geometries = []
way_planes = []

for brick in bricks:
    geometries.append(brick.draw())
    way_planes.append(brick.get_pick_frame())
# ---------- end brick_wall ----------
python_3_script_2 = Python3Script(x=brick_wall.way_planes)  # -> out, a; inputs x: list
# ---------- python_3_script_2: Python ----------
from compas_rhino.conversions import frame_to_rhino_plane

a = [frame_to_rhino_plane(f) for f in x]
# ---------- end python_3_script_2 ----------
compas_draw = COMPASDraw(cg=brick_wall.geometries)  # -> rg; same code as draw
compas_draw_2 = COMPASDraw(cg=brick_wall.way_planes)  # -> rg; same code as draw
fine_adjust_z_mm = Slider(5, range=-5..10)
# Transform from Rhino to Robot Space
pt_2 = Point("{462.02, 465.69, 4.06}")
pt_3 = Point("{109.25, 464.14, 5.11}")
pt_4 = Point("{462.19, -132.33, 5.03}")
compas = Python3Script(
    way_planes=python_3_script.way_planes,
    wobj_origin=pt_2,
    wobj_xaxis=pt_3,
    wobj_xypoint=pt_4,
    z_safe_margin=fine_adjust_z_mm)  # -> out, transformed_planes; inputs way_planes: list, wobj_origin: Point3d, wobj_xaxis: Point3d, wobj_xypoint: Point3d, z_safe_margin: Double
# ---------- compas: Python ----------
import compas.geometry as cg

#in this step we transform our way planes to robot space
#the rhino co-ordinate system is rather abstract in the physical world
#the robot base plane assumed the base frame of robot is the origin
#but rhino does not know that
#thus we transform things from our design space(Rhino World XY) to Robot Base Plane that we measure

def set_robot_base(origin, xaxis, xypoint):
    """
    set a base plane representing the robot working object plane
    """
    robot_base = cg.Frame(origin, xaxis - origin, xypoint - origin)
    print (robot_base)
    return (robot_base)

def rhino_to_robot_space(rhino_plane,robot_base_plane):
    """
    Transform the objects from Rhino world XY plane to robot work object plane
    """
    T_matrix = cg.Transformation.from_frame_to_frame(cg.Frame.worldXY(), robot_base_plane)
    robot_plane = rhino_plane.transformed(T_matrix)
    return robot_plane

def set_z_safe_margin(planes_to_adjust, safety_margin):
    adjusted = []
    T = cg.Translation.from_vector(cg.Vector(0, 0, safety_margin))
    for f in planes_to_adjust:
        adjusted.append(f.transformed(T))
    return adjusted

# ===== Robot base is set =====
robot_base =  set_robot_base(wobj_origin, wobj_xaxis, wobj_xypoint)
print(robot_base)

# ===== Set safety margin for Z height ======
safe_planes = set_z_safe_margin(way_planes, z_safe_margin)

# ===== Transforming the rhino planes into robot planes =====
transformed_planes = []
for plane in safe_planes: 
    transformed_planes.append(rhino_to_robot_space(plane, robot_base))
# ---------- end compas ----------
compas_draw_3 = COMPASDraw(cg=compas.transformed_planes)  # -> rg; same code as draw

# ---- group: *Visualize Pln XYZ
cluster = Cluster(pln=compas_draw_3, num=Slider(8.2, range=0..10))

# ----
pt_5 = Point("{-23.736745, 438.885287, 47.558923}")
pt_6 = Point("{-19.501521, 420.444605, 39.878472}")
pt_7 = Point("{-30.431521, 437.504605, 54.198472}")

pt_8 = ConstructPoint(XCoordinate="-2.72", YCoordinate="4.86", ZCoordinate="88.08")

py3 = Python3Script(origin=pt_5, xaxis_pt=pt_6, xy_pt=pt_7)  # -> out, pick_frame; inputs origin: Point3d, xaxis_pt: Point3d, xy_pt: Point3d
# ---------- py3: Python ----------
from compas.geometry import Frame, Point
from compas.geometry import Rotation

from compas_rhino.conversions import point_to_compas

origin = point_to_compas(origin)
xaxis_pt = point_to_compas(xaxis_pt)
xy_pt = point_to_compas(xy_pt)

#define pick frame
pick_frame = Frame(origin, xaxis_pt - origin, xy_pt - origin)
# ---------- end py3 ----------
compas_draw_4 = COMPASDraw(cg=py3.pick_frame)  # -> rg; same code as draw
number_slider = Slider(0.5, range=0..1)
number_slider_2 = Slider(0.1, range=0..0.1)
number_slider_3 = Slider(0.1, range=0..0.1)

create_tool = CreateTool(Name="brick", TCP=pt_8, Weight=Slider(1.5, range=0..10))  # -> Tool, TCP

# ----
# Convert Planes to URScript
compas_2 = Python3Script(
    way_frames=compas.transformed_planes,
    tcp_measured=pt_8,
    acceleration=number_slider,
    velocity=number_slider,
    pick_frame=py3.pick_frame)  # -> out, vis_frames, vis_planes, script; inputs way_frames: list, tcp_measured: Point3d, acceleration: Double, velocity: Double
# ---------- compas_2: Python ----------
from imp import reload
import sys
import os

#get current file path
path = ghenv.Component.OnPingDocument().FilePath
#get parent directory of the parent directory
parentdir = os.path.dirname(path)
#get src folder which contains classes
dire = os.path.join(parentdir,'src')

sys.path.append(dire)

import simple_ur_script as ur
reload(ur)

import utils 
reload(utils)

import simple_comm as com
reload(com)

import compas.geometry as cg
import math as m

# ===== Set global constants =======

IO = 4 #Global constant
SAFE_DIST = 50

# =================================

script = "" #create empty string

def pickup_brick(script,pick_up_frame):
    frames = []
    
    safe_pick_up_frame = pick_up_frame.translated(-pick_up_frame.normal*SAFE_DIST)
    
    ## add to the path: go to the safe plane
    script += ur.move_l(safe_pick_up_frame, acceleration, velocity)
    frames.append(safe_pick_up_frame)
    
    ## add to the path: go to the pick up plane
    script += ur.move_l(pick_up_frame, acceleration, velocity)
    frames.append(pick_up_frame)
    
    ## add to the path: turn on the vacuum and wait 1 sec.
    script += ur.set_digital_out(IO,True)
    script += ur.sleep(1)

    # add to the path: go back to the safe_plane
    script += ur.move_l(safe_pick_up_frame, acceleration, velocity)
    frames.append(safe_pick_up_frame)
    
    return script, frames


def place_brick(script, place_frame):
    
    frames = []
    
    safe_place_frame = place_frame.translated(cg.Vector(0,0,1)*SAFE_DIST)
    
    # add to the path: go to the safe plane
    script += ur.move_l(safe_place_frame, acceleration, velocity)
    frames.append(safe_place_frame)
    
    # add to the path: go to the place plane
    script += ur.move_l(place_frame, acceleration, velocity)
    frames.append(place_frame)
    
    ## add to the path: turn off the vacuum and wait 1 second (hold the brick)
    script += ur.set_digital_out(IO,False)
    script += ur.sleep(1)
    
    # add to the path: go back to the safe plane
    script += ur.move_l(safe_place_frame, acceleration, velocity)
    frames.append(safe_place_frame)
    
    return script,frames


#if value given for tcp measured, then add line to script, otherwise it will take current tcp from robot
if tcp_measured is not None:
    script += ur.set_tcp_by_angles(tcp_measured.X, tcp_measured.Y, tcp_measured.Z, m.radians(0.0),m.radians(0.0),m.radians(0))


vis_frames = []
#add move_l commands in sequence to script for each way plane
for brick_frame in way_frames:
    script, p = pickup_brick(script,pick_frame)
    vis_frames.extend(p) #only to visualize the planes
    script, p = place_brick(script,brick_frame)
    vis_frames.extend(p)


#format the script to make it sendable
script = com.concatenate_script(script)

from compas_rhino import conversions
import Rhino.Geometry as rg

vis_planes = [conversions.frame_to_rhino(frame) for frame in vis_frames]
# ---------- end compas_2 ----------

# ---- group: Tool DO
set_do = SetDO(DO=Slider(1, range=0..1), Value=Toggle(False))

# ----
compas_draw_5 = COMPASDraw(cg=compas_2.vis_frames)  # -> rg; same code as draw
points = PointList(Points=compas_2.vis_planes, Size=Slider(7, range=0..100))

# ---- group: Approach
create_target = CreateTarget(Plane=compas_2.vis_planes, Tool=create_tool.Tool, IsCartesian=True)

# ----
robots_library = RobotsLibrary(
    {"TTDA-KR6", "TTDA-KR60", "TTDA-IIWA14", "Taiwan-IRB1600", "Taiwan-KR6", "Taiwan-KR10", "UR3e", "UR5e", "UR10e", "UR16e", "UR3", "UR5", "UR10", "UR20", "UR30"}, selected="UR5",
    Type=0)
load_robot_system = LoadRobotSystem(Name=robots_library, Base=PlaneXY(0, 0, 0))
create_program = CreateProgram(Name="DefaultProgram", RobotSystem=load_robot_system, Targets=create_target, InitCommands=set_do, StepSize=1)  # -> Program, Code, Duration, Warnings, Errors
program_simulation = ProgramSimulation(Program=create_program.Program, Time=Slider(0, range=0..1), Normalized=True)  # -> SystemMeshes, JointRotations, Plane, Index, Time, Program, Errors
panel = Panel(create_program.Warnings)
panel_2 = Panel(program_simulation.Errors)
remote_connection = RemoteConnection(Program=create_program.Program, IP="192.168.2.1", Upload=Toggle(False), Play=Toggle(False), Pause=Toggle(False))

pline = PolyLine(Vertices=compas_2.vis_planes, Closed=False)
panel_3 = Panel(compas_2.script)

# ---- group: Send UR script to Robot!
# Send to Robot!
py3_2 = Python3Script(script=compas_2.script, ip_address="192.168.10.10", send=Button())  # -> out, a; inputs script: String, ip_address: String, send: Boolean
# ---------- py3_2: Python ----------
import simple_comm as com

if send:
    com.send_script(script,ip_address)
# ---------- end py3_2 ----------

# ==== cluster Cluster
pln = ClusterInput()
num = ClusterInput()
pln_2 = Plane(graft(pln))
num_2 = Number(num)
deplane = DeconstructPlane(Plane=pln_2)  # -> flatten(Origin), XAxis, YAxis, ZAxis
entwine = Entwine(Branch00=deplane.XAxis, Branch01=deplane.YAxis, Branch02=deplane.ZAxis, FlattenInputs=True)
merge = Merge(
    Data1=ColourSwatch(SwatchColor=RGB(255, 0, 0)),
    Data2=ColourSwatch(SwatchColor=RGB(0, 255, 0)),
    Data3=ColourSwatch(SwatchColor=RGB(0, 0, 255)))  # -> graft(Result)
multiplication = Multiplication(A=entwine, B=num_2)
vdisex = VectorDisplayEx(Point=deplane.Origin, Vector=multiplication, Colour=merge, Width=2)
