# Grasshopper definition 101_primitives_and_subdivisions_ex.gh (Grasshopper 1.0.8)

# ---- group: EXAMPLES
py3 = Python3Script(radius=Slider(5.751, range=0..10), num_sides=Slider(4, range=0..10))  # -> out, new_mesh_rhino; inputs num_sides: Int32; disabled
# ---------- py3: Python ----------
import math
import Rhino.Geometry as rg
import mola
from mola import module_rhino

points = []

tetha = (2*math.pi)/num_sides

new_mesh = mola.Mesh()

for i in range(num_sides):
    angle = i*tetha
    x = radius*math.cos(angle)
    y = radius*math.sin(angle)
    z = 0
    pt = rg.Point3d(x,y,z)
    points.append(pt)
    new_mesh.add_vertex(x,y,z)

new_mesh.add_face([*new_mesh.vertices])
new_mesh.add_vertex(0,0,20)

for i in range(num_sides):
    v1 = new_mesh.vertices[i]
    v2 = new_mesh.vertices[(i+1)%num_sides]
    print((i+1)%num_sides)
    cen = new_mesh.vertices[-1]
    new_mesh.add_face([v1,v2,cen])


new_mesh_rhino = module_rhino.display_mesh(new_mesh)
# ---------- end py3 ----------
geo = Geometry(py3.new_mesh_rhino)
number_slider = Slider(7, range=0..10)  # disabled
number_slider_2 = Slider(3, range=0..10)  # disabled
py3_2 = Python3Script(x=number_slider, y=number_slider, z=number_slider, x1=number_slider_2, y1=number_slider_2, z1=number_slider_2)  # -> out, my_mesh, my_mesh_rhino; disabled
# ---------- py3_2: Python ----------
import mola
from mola import module_rhino

my_mesh = mola.construct_box(x,y,x,x1,y1,z1)
my_mesh_rhino = module_rhino.display_mesh(my_mesh)
# ---------- end py3_2 ----------
geo_2 = Geometry(py3_2.my_mesh_rhino)  # disabled
number_slider_3 = Slider(2, range=0..10)  # disabled
py3_3 = Python3Script(mesh=py3_2.my_mesh, r=number_slider_3)  # -> out, new_mesh, my_mesh_rhino; inputs r: Int32; disabled
# ---------- py3_3: Python ----------
import mola
from mola import module_rhino

for i in range(r):
    new_mesh = mola.Mesh()
    for face in mesh.faces:
        resulting_face = mola.subdivide_face_extrude_to_point_center(face, -i*2)
        new_mesh.faces.extend(resulting_face)
    mesh =new_mesh

new_mesh.update_topology()
my_mesh_rhino = module_rhino.display_mesh(new_mesh)
# ---------- end py3_3 ----------
number_slider_4 = Slider(2, range=0..10)  # disabled
py3_4 = Python3Script(mesh=py3_3.new_mesh, r=number_slider_4)  # -> out, my_mesh_rhino; inputs r: Int32; disabled
# ---------- py3_4: Python ----------
import mola
from mola import module_rhino

new_mesh = mesh

for i in range(r):
    new_mesh = mola.subdivide_mesh_catmull(new_mesh)

mola.color_faces_by_area(new_mesh.faces)
my_mesh_rhino = module_rhino.display_mesh(new_mesh)
# ---------- end py3_4 ----------
panel = Panel(py3_4.my_mesh_rhino)  # disabled
geo_3 = Geometry(py3_4.my_mesh_rhino)  # disabled
number_slider_5 = Slider(2, range=0..10)  # disabled
py3_5 = Python3Script(r=number_slider_5)  # -> out, new_mesh, my_mesh_rhino; disabled
# ---------- py3_5: Python ----------
import mola
from mola import module_rhino

my_mesh = mola.construct_sphere(r,3,3)

for v in my_mesh.vertices:
    if v.z>0:
        v.z *= 1.5

my_mesh = mola.subdivide_mesh_catmull(my_mesh)

my_properties = my_mesh.face_properties(mola.face_center_z)


mola.color_faces_by_vertical_angle(my_mesh.faces)

heights = mola.math_map_list(my_properties, 0.0, 2.0)

new_mesh = mola.Mesh()
for i, f in enumerate(my_mesh.faces):
    if heights[i] > 0.5:
        doCap = False
    else: 
        doCap = True
    resulting_faces = mola.subdivide_face_extrude_tapered(f, heights[i], 0.6, doCap)
    new_mesh.faces.extend(resulting_faces)

new_mesh.update_topology()
new_mesh = mola.mesh_offset(new_mesh,0.2)

for i in range(1):
    new_mesh = mola.subdivide_mesh_catmull(new_mesh)

props = new_mesh.face_properties(mola.face_center_z)
color_scheme = [(0,0,1),(1,0,1), (0.5,0.5,0.5), (1,1,1)]
colors = mola.color_map(props , color_scheme)
mola.color_faces_by_map(new_mesh.faces,colors)


new_mesh.update_topology()
my_mesh_rhino = module_rhino.display_mesh(new_mesh)
# ---------- end py3_5 ----------

# ----
py3_6 = Python3Script(mola_path="C:\\Users\\Juste\\Documents\\_GitHub")  # -> out, a
# ---------- py3_6: Python ----------
import sys

if mola_path not in sys.path:
    sys.path.append(mola_path)

print (sys.path)

try:
    import mola
    from mola import module_rhino
except ImportError as e:
    print("Error Importing mola: (e)")
# ---------- end py3_6 ----------
number_slider_6 = Slider(2, range=0..10)  # disabled

# ---- group: CHAIR
number_slider_7 = Slider(-20, range=-20..600)  # disabled
number_slider_8 = Slider(10, range=0..10)  # disabled
number_slider_9 = Slider(10, range=0..10)  # disabled
number_slider_10 = Slider(5, range=0..30)  # disabled
crv = Curve(<curve referenced from the Rhino model>)  # disabled
crv_2 = Curve(<curve referenced from the Rhino model>)
py3_7 = Python3Script(
    curve=crv_2,
    num_sides=Slider(10, range=0..10),
    radius=Slider(10, range=0..10),
    total_height=Slider(115, range=0..600),
    h_subdivisions=Slider(5, range=0..30))  # -> out, column_mesh, list_points, new_pts, center_points, column_mesh_rhino; inputs curve: Polyline, num_sides: Int32, radius: Int32, total_height: Int32, h_subdivisions: Int32
# ---------- py3_7: Python ----------
import mola
from mola import module_rhino
import math
import Rhino.Geometry as rg

def points_on_crv(curve):
    list_of_points = []
    for p in curve:
        pt = rg.Point3d(p)
        list_of_points.append(pt)
    return list_of_points

def points_on_polygon(num_sides, radius):  
    list_of_points = []
    theta = (2*math.pi)/num_sides
    for i in range(num_sides):
        angle = i * theta
        x = radius * math.cos(angle)
        y = radius * math.sin(angle)
        z = 0
        pt = rg.Point3d(x,y,z)
        list_of_points.append(pt)
    return list_of_points


if curve is not None:
    list_points = points_on_crv(curve)

else:
    list_points = points_on_polygon(num_sides, radius)



column_mesh = mola.Mesh()

new_pts = []

for layer_no in range (h_subdivisions +1):
    y = total_height/h_subdivisions * layer_no
    for p in list_points:
        pt = rg.Point3d(p)
        pt[1] = y
        new_pts.append (pt)
        column_mesh.add_vertex(pt[0],pt[1], pt[2])

points_per_layer = len(list_points)

for layer_no in range (h_subdivisions):
    current_layer = layer_no * points_per_layer
    next_layer = (layer_no + 1) * points_per_layer
    for i in range (points_per_layer-1):
        next_i = (i+1) % points_per_layer

        v0 = column_mesh.vertices[current_layer + i]
        v1 = column_mesh.vertices[current_layer + next_i]
        v2 = column_mesh.vertices[next_layer + next_i]
        v3 = column_mesh.vertices[next_layer + i]

        column_mesh.add_face([v0,v1,v2,v3])

center_points = []
for f in (column_mesh.faces):
    c = f.center()
    
    pts = rg.Point3d(c.x, c.y, c.z)
    center_points.append(pts)


#column_mesh = mola.mesh_offset(column_mesh,3)
column_mesh.update_topology()
column_mesh_rhino = module_rhino.display_mesh(column_mesh)
# ---------- end py3_7 ----------
py3_8 = Python3Script(
    curve=crv,
    num_sides=number_slider_9,
    radius=number_slider_8,
    total_height=number_slider_7,
    h_subdivisions=number_slider_10)  # -> out, column_mesh, list_points, new_pts, column_mesh_rhino; inputs curve: Polyline, num_sides: Int32, radius: Int32, total_height: Int32, h_subdivisions: Int32; disabled
# ---------- py3_8: Python ----------
import mola
from mola import module_rhino
import math
import Rhino.Geometry as rg

def points_on_crv(curve):
    list_of_points = []
    for p in curve:
        pt = rg.Point3d(p)
        list_of_points.append(pt)
    return list_of_points

def points_on_polygon(num_sides, radius):   # def texture per math function
    list_of_points = []
    theta = (2*math.pi)/num_sides
    for i in range(num_sides):
        angle = i * theta
        x = radius * math.cos(angle)
        y = radius * math.sin(angle)
        z = 0
        pt = rg.Point3d(x,y,z)
        list_of_points.append(pt)
    return list_of_points


if curve is not None:
    list_points = points_on_crv(curve)

else:
    list_points = points_on_polygon(num_sides, radius)



column_mesh = mola.Mesh()

new_pts = []

for layer_no in range (h_subdivisions +1):
    z= total_height/h_subdivisions * layer_no
    for p in list_points:
        pt = rg.Point3d(p)
        pt[2] = z
        new_pts.append (pt)
        column_mesh.add_vertex(pt[0],pt[1], pt[2])

points_per_layer = len(list_points)

for layer_no in range (h_subdivisions):
    current_layer = layer_no * points_per_layer
    next_layer = (layer_no + 1) * points_per_layer
    for i in range (points_per_layer-1):
        next_i = (i+1) % points_per_layer

        v0 = column_mesh.vertices[current_layer + i]
        v1 = column_mesh.vertices[current_layer + next_i]
        v2 = column_mesh.vertices[next_layer + next_i]
        v3 = column_mesh.vertices[next_layer + i]

        column_mesh.add_face([v0,v1,v2,v3])

column_mesh.update_topology()
column_mesh_rhino = module_rhino.display_mesh(column_mesh)
# ---------- end py3_8 ----------
geo_4 = Geometry(py3_7.list_points)
geo_5 = Geometry(py3_8.column_mesh_rhino)  # disabled
geo_6 = Geometry(py3_7.column_mesh_rhino)
geo_7 = Geometry(py3_8.list_points)  # disabled
number_slider_11 = Slider(4.513, range=0..10)  # disabled
py3_9 = Python3Script(mesh=py3_7.column_mesh, extrusion=Slider(4.513, range=0..10))  # -> out, new_mesh, my_rhino_mesh; inputs extrusion: Double; disabled
# ---------- py3_9: Python ----------
import mola
from mola import module_rhino

new_mesh = mola.Mesh()

for i, face in enumerate (mesh.faces):
    if i % 2 ==0:
        
        new_faces = mola.subdivide_face_extrude_tapered(face, extrusion, 0.5, True)
        for f in new_faces:
            f.group = 0

        new_mesh.faces.extend(new_faces)

    else:
        face.group = 2
        new_mesh.faces.append(face)

new_mesh.update_topology()
my_rhino_mesh = module_rhino.display_mesh(new_mesh)
# ---------- end py3_9 ----------
py3_10 = Python3Script(mesh=py3_8.column_mesh, extrusion=number_slider_11)  # -> out, new_mesh, my_rhino_mesh; inputs extrusion: Double; disabled; same code as py3_9
number_slider_12 = Slider(9.583, range=0..10)  # disabled
number_slider_13 = Slider(9.583, range=0..10)  # disabled
py3_11 = Python3Script(mesh=py3_9.new_mesh, extrusion=number_slider_12)  # -> out, new_mesh, my_rhino_mesh; disabled
# ---------- py3_11: Python ----------
import mola

from mola import module_rhino

new_mesh = mola.Mesh()

for face in mesh.faces:
    if face.group == 2:
        new_faces = mola.subdivide_face_extrude_tapered(face, -extrusion, .8, False)
        new_mesh.faces.extend(new_faces)
    else:
        new_mesh.faces.append(face)


new_mesh.update_topology()
my_rhino_mesh = module_rhino.display_mesh(new_mesh)
# ---------- end py3_11 ----------
py3_12 = Python3Script(mesh=py3_10.new_mesh, extrusion=number_slider_13)  # -> out, new_mesh, my_rhino_mesh; disabled; same code as py3_11
number_slider_14 = Slider(2, range=0..10)  # disabled
number_slider_15 = Slider(2, range=0..10)  # disabled
py3_13 = Python3Script(mesh=py3_12.new_mesh, r=number_slider_14)  # -> out, my_mesh_rhino; inputs r: Int32; disabled; same code as py3_4
panel_2 = Panel(py3_13.my_mesh_rhino)  # disabled
geo_8 = Geometry(py3_13.my_mesh_rhino)  # disabled

# ----
list_item = ListItem(List=py3_7.center_points, Index=Slider(0, range=0..10), Wrap=True)
point_list = PointList(Points=list_item, Size=Slider(10, range=0..10))
panel_3 = Panel(list_item)
py3_14 = Python3Script(my_mesh=py3_11.new_mesh, r=number_slider_6)  # -> out, new_mesh, my_mesh_rhino; disabled
# ---------- py3_14: Python ----------
import mola

from mola import module_rhino


for v in my_mesh.vertices:
    if v.x>0:
        v.x *= 1.5

my_mesh = mola.subdivide_mesh_catmull(my_mesh)

my_properties = my_mesh.face_properties(mola.face_center_x)


mola.color_faces_by_vertical_angle(my_mesh.faces)

heights = mola.math_map_list(my_properties, 0.0, 1.2)

new_mesh = mola.Mesh()
for i, f in enumerate(my_mesh.faces):
    if heights[i] > 0.5:
        doCap = False
    else: 
        doCap = True
    resulting_faces = mola.subdivide_face_extrude_tapered(f, heights[i], 0.6, doCap)
    new_mesh.faces.extend(resulting_faces)

new_mesh.update_topology()
new_mesh = mola.mesh_offset(new_mesh,0.2)

for i in range(1):
    new_mesh = mola.subdivide_mesh_catmull(new_mesh)

props = new_mesh.face_properties(mola.face_center_x)
color_scheme = [(0,0,1),(1,0,1), (0.5,0.5,0.5), (1,1,1)]
colors = mola.color_map(props , color_scheme)
mola.color_faces_by_map(new_mesh.faces,colors)


new_mesh.update_topology()
my_mesh_rhino = module_rhino.display_mesh(new_mesh)
# ---------- end py3_14 ----------

# ---- group: CHAIR (continued)
py3_15 = Python3Script(mesh=py3_14.new_mesh, r=number_slider_15)  # -> out, my_mesh_rhino; inputs r: Int32; disabled; same code as py3_4
panel_4 = Panel(py3_15.my_mesh_rhino)  # disabled
geo_9 = Geometry(py3_15.my_mesh_rhino)  # disabled
