# Grasshopper definition 101_primitives_and_subdivisions_ex.ghx (Grasshopper 1.0.8)

number_slider = Slider(5, range=0..100)
number_slider_2 = Slider(46, range=0..100)

number_slider_3 = Slider(10, range=0..10)  # disabled
number_slider_4 = Slider(4, range=0..100)  # disabled
py3 = Python3Script(radius=number_slider_4, num_sides=number_slider_3)  # -> out, new_mesh_rhino, points; inputs radius: Double, num_sides: Int32; disabled
# ---------- py3: Python ----------
import math
import Rhino.Geometry as rg
import mola
from mola import module_rhino

points = []

tetha = (2*math.pi)/num_sides
new_mesh = mola.Mesh()

for i in range(num_sides):
    angle = i * tetha
    x  = radius * math.cos(angle)
    y = radius * math.sin(angle)
    z = 0
    pt = rg.Point3d(x,y,z)
    points.append(pt)
    new_mesh.add_vertex(x,y,z)

new_mesh.add_face(new_mesh.vertices)
new_mesh.add_vertex(0,0,10)

for i in range(num_sides):
    v1 = new_mesh.vertices[i]
    v2 = new_mesh.vertices[(i+1) % num_sides]
    #print ((i+1) % num_sides)
    cen = new_mesh.vertices[-1]
    new_mesh.add_face([v1,v2,cen])

new_mesh_rhino = module_rhino.display_mesh(new_mesh)

num = [1,2,3,4,5]

print(*num)
# ---------- end py3 ----------
geo = Geometry(py3.new_mesh_rhino)  # disabled

# ----
# mesh from scratch
py3_2 = Python3Script(mola_path="C:\\Users\\Juste\\Documents\\_GitHub")  # -> out, a; inputs mola_path: String
# ---------- py3_2: Python ----------
import sys

if mola_path not in sys.path:
    sys.path.append(mola_path)

print(sys.path)

try:
    import mola
    from mola import module_rhino
except ImportError as e:
    print("Error importing mola: {e}")
# ---------- end py3_2 ----------
slab = Python3Script(
    x=number_slider,
    y=number_slider,
    z=Slider(2, range=0..10),
    x1=number_slider_2,
    y1=number_slider_2,
    z1=Slider(4, range=0..10))  # -> out, my_mesh, my_mesh_rhino
# ---------- slab: Python ----------
import mola 
from mola import module_rhino

my_mesh = mola.construct_box(x,y,z, x1,y1,z1)

my_mesh_rhino = module_rhino.display_mesh(my_mesh)
# ---------- end slab ----------
meshing = Python3Script(mesh=slab.my_mesh, r=Slider(7, range=0..10))  # -> out, new_mesh, my_mesh_rhino; inputs r: Int32
# ---------- meshing: Python ----------
import mola
from mola import module_rhino

for i in range (r):
    new_mesh = mola.Mesh()

    for f in mesh.faces:
        resulting_face = mola.subdivide_face_extrude_to_point_center(f, i/16)
        new_mesh.faces.extend(resulting_face) 
    mesh = new_mesh

new_mesh.update_topology()
my_mesh_rhino = module_rhino.display_mesh(new_mesh)
# ---------- end meshing ----------

number_slider_5 = Slider(6, range=0..10)
number_slider_6 = Slider(-3, range=-10..10)
# primitives
py3_3 = Python3Script(x=number_slider_5, y=number_slider_5, z=number_slider_5, x1=number_slider_6, y1=number_slider_6, z1=number_slider_6)  # -> out, my_mesh, my_mesh_rhino
# ---------- py3_3: Python ----------
import mola
from mola import module_rhino

my_mesh =  mola.construct_box(x,y,x, x1, y1, z1)

my_mesh_rhino = module_rhino.display_mesh(my_mesh)
# ---------- end py3_3 ----------
# subdivision
py3_4 = Python3Script(mesh=py3_3.my_mesh, r=Slider(4, range=0..10))  # -> out, new_mesh, my_mesh_rhino; inputs r: Int32
# ---------- py3_4: Python ----------
import mola
from mola import module_rhino

for i in range(r):
    new_mesh = mola.Mesh()
    for f in mesh.faces:
        resulting_face = mola.subdivide_face_extrude_to_point_center(f, i/2)
        new_mesh.faces.extend(resulting_face)
    mesh = new_mesh

new_mesh.update_topology()
my_mesh_rhino = module_rhino.display_mesh(new_mesh)
# ---------- end py3_4 ----------
py3_5 = Python3Script(mesh=py3_4.new_mesh)  # -> out, new_mesh, my_mesh_rhino
# ---------- py3_5: Python ----------
import mola
from mola import module_rhino

new_mesh = mesh

for i in range(1):
    new_mesh = mola.subdivide_mesh_catmull(new_mesh)

mola.color_faces_by_area(new_mesh.faces)

my_mesh_rhino = module_rhino.display_mesh(new_mesh)
# ---------- end py3_5 ----------

color = Python3Script(mesh=meshing.new_mesh)  # -> out, new_mesh, my_mesh_rhino
# ---------- color: Python ----------
import mola
from mola import module_rhino

new_mesh = mesh

for i in range (1):
    new_mesh = mola.subdivide_mesh_catmull(new_mesh)

mola.color_faces_by_area(new_mesh.faces)

my_mesh_rhino = module_rhino.display_mesh(new_mesh)
# ---------- end color ----------
number_slider_7 = Slider(5, range=0..10)  # disabled
py3_6 = Python3Script(r=number_slider_7)  # -> out, new_mesh, my_mesh_rhino; inputs r: Int32; disabled
# ---------- py3_6: Python ----------
import mola
from mola import module_rhino

my_mesh = mola.construct_sphere(r,3,3)

for v in my_mesh.vertices:
    if v.z>0:
        v.z *= 1.5

my_mesh = mola.subdivide_mesh_catmull(my_mesh)

my_properties = my_mesh.face_properties(mola.face_center_z)


mola.color_faces_by_vertical_angle(my_mesh.faces)

heights = mola.math_map_list(my_properties, 0.0, 2.0)

new_mesh = mola.Mesh()
for i, f in enumerate(my_mesh.faces):
    if heights[i] > 0.5:
        doCap = False
    else: 
        doCap = True
    resulting_faces = mola.subdivide_face_extrude_tapered(f, heights[i], 0.6, doCap)
    new_mesh.faces.extend(resulting_faces)

new_mesh.update_topology()
new_mesh = mola.mesh_offset(new_mesh,0.2)

for i in range(1):
    new_mesh = mola.subdivide_mesh_catmull(new_mesh)

props = new_mesh.face_properties(mola.face_center_z)
color_scheme = [(0,0,1),(1,0,1), (0.5,0.5,0.5), (1,1,1)]
colors = mola.color_map(props , color_scheme)
mola.color_faces_by_map(new_mesh.faces,colors)


new_mesh.update_topology()
my_mesh_rhino = module_rhino.display_mesh(new_mesh)
# ---------- end py3_6 ----------
geo_2 = Geometry(py3_6.my_mesh_rhino)  # disabled
