# Grasshopper definition 101_primitives_and_subdivisions_ex_m.ghx.gh (Grasshopper 1.0.8)
# plug-ins: Pufferfish

# ---- group: Mesh from scratch
py3 = Python3Script(radius=Slider(3.7, range=0..100), num_sides=Slider(10, range=0..10))  # -> out, new_mesh_rhino, points; inputs radius: Double, num_sides: Int32
# ---------- py3: Python ----------
import math
import Rhino.Geometry as rg
import mola
from mola import module_rhino

points = []

tetha = (2*math.pi)/num_sides

new_mesh = mola.Mesh()

for i in range(num_sides):
    angle = i * tetha
    x = radius * math.cos(angle)
    y = radius * math.sin(angle)
    z = 0
    pt = rg.Point3d(x,y,z)
    points.append(pt)
    new_mesh.add_vertex(x,y,z)


new_mesh.add_face([*new_mesh.vertices])
new_mesh.add_vertex(0,0,10)

for i in range(num_sides):
    v1 = new_mesh.vertices[i]
    v2 = new_mesh.vertices[(i+1)%num_sides] 

    cen = new_mesh.vertices[-1]
    new_mesh.add_face([v1,v2,cen])

new_mesh_rhino = module_rhino.display_mesh(new_mesh)
# ---------- end py3 ----------
geo = Geometry(py3.new_mesh_rhino)

# ---- group: from primitive polyline
number_slider = Slider(2, range=0..100)
number_slider_2 = Slider(100, range=0..100)
number_slider_3 = Slider(10, range=0..10)
number_slider_4 = Slider(32.7, range=0..100)
curve = Curve(<curve referenced from the Rhino model>)

# ---- group: construct
number_slider_5 = Slider(16, range=0..100)
number_slider_6 = Slider(16, range=0..100)
number_slider_7 = Slider(16, range=0..100)
number_slider_8 = Slider(100, range=0..100)
number_slider_9 = Slider(30, range=0..100)
number_slider_10 = Slider(100, range=0..100)
number_slider_11 = Slider(50, range=0..100)
number_slider_12 = Slider(12.4, range=0..100)
number_slider_13 = Slider(12, range=0..100)
number_slider_14 = Slider(0, range=0..100)
number_slider_15 = Slider(40.1, range=0..100)
number_slider_16 = Slider(30, range=0..100)
boolean_toggle = BooleanToggle(True)
boolean_toggle_2 = BooleanToggle(True)

# ----
mesh = Mesh(<mesh referenced from the Rhino model>)
reduce_mesh = ReduceMesh(
    Mesh=mesh,
    FaceCount=Slider(1000, range=0..10000),
    Accuracy=1,
    FaceType=Slider(1, range=0..10),
    Distort=True,
    Normalize=Toggle(True))  # -> Reduced, CountDifference

mesh_2 = Mesh(<mesh referenced from the Rhino model>)
reduce_mesh_2 = ReduceMesh(
    Mesh=mesh_2,
    FaceCount=Slider(1000, range=0..10000),
    Accuracy=1,
    FaceType=Slider(2, range=0..10),
    Distort=True,
    Normalize=Toggle(True))  # -> Reduced, CountDifference

# ----
# group 0 = top and bottom
# group 1 = mid face
# move vertices along face normal. Morph the geometry of the column before applying subdivision.
boolean_toggle_3 = BooleanToggle(True)

# ---- group: from primitive polyline / Primitive
script = Script(
    polyline_curve=curve,
    num_sides=number_slider_3,
    radius=number_slider_4,
    height=number_slider_2,
    height_division=number_slider)  # -> column_mesh_rhino, column_mesh, list_points; inputs polyline_curve: Polyline, num_sides: Int32, height: Int32, height_division: Int32
# ---------- script: Python ----------
import mola
from mola import module_rhino
import Rhino.Geometry as rg
import math as m

def points_on_curve (curve):
    list_of_points = []
    for p in curve:
        pt = rg.Point3d(p)
        list_of_points.append(pt)

    return list_of_points

def points_on_polygon (num_sides, radius):
    list_of_points = []
    theta = m.pi * 2 / num_sides
    for i in range (num_sides):
        angle = i * theta
        x = radius * m.cos(angle)
        y = radius * m.sin(angle)
        z = 0
        pt = rg.Point3d(x,y,z)
        list_of_points.append(pt)
    return list_of_points

pts_pol = points_on_polygon(num_sides, radius)
print (pts_pol)

pts = points_on_curve(polyline_curve)
print (pts)

if polyline_curve is not None:
    list_points = points_on_curve(polyline_curve)

else:
    list_points = points_on_polygon(num_sides, radius)

column_mesh = mola.Mesh()

mesh_vertices = []

for layer_no in range (height_division + 1):
    z = height / height_division * layer_no
    for pt in list_points:
        point = rg.Point3d(pt)
        point[2] = z
        mesh_vertices.append(point)
        column_mesh.add_vertex(point[0],point[1],point[2])

points_per_layer = len(list_points)

for layer_no in range (height_division):
    current_layer = layer_no * points_per_layer
    next_layer = (layer_no + 1) * points_per_layer
    for i in range (points_per_layer - 1):
        next_i = (i+1) % points_per_layer

        v0 = column_mesh.vertices[current_layer + i]
        v1 = column_mesh.vertices[current_layer + next_i]
        v2 = column_mesh.vertices[next_layer + next_i]
        v3 = column_mesh.vertices[next_layer + i]

        column_mesh.add_face([v0,v1,v2,v3])
        # column_mesh.add_face([v1,v2,v0])

column_mesh.update_topology()
column_mesh_rhino = module_rhino.display_mesh(column_mesh)
# ---------- end script ----------

# ---- group: construct / octahedron
script_2 = Script(edge_length=number_slider_9)  # -> new_mesh, rhino_mesh; inputs edge_length: Double
# ---------- script_2: Python ----------
import mola
from mola import module_rhino

new_mesh = mola.construct_octahedron(edge_length)

rhino_mesh = module_rhino.display_mesh(new_mesh)
# ---------- end script_2 ----------

# ---- group: construct / rhombic_dodecahedron
script_3 = Script(edge_length=number_slider_9)  # -> new_mesh, rhino_mesh; inputs edge_length: Double
# ---------- script_3: Python ----------
import mola
from mola import module_rhino

new_mesh = mola.construct_rhombic_dodecahedron(edge_length)

rhino_mesh = module_rhino.display_mesh(new_mesh)
# ---------- end script_3 ----------

# ---- group: construct / cone
script_4 = Script(
    z1=number_slider_14,
    z2=number_slider_15,
    radius_1=number_slider_12,
    radius_2=number_slider_13,
    n_segments=number_slider_6,
    cap_bottom=boolean_toggle,
    cap_top=boolean_toggle_2)  # -> new_mesh, rhino_mesh; inputs z1: Double, z2: Double, radius_1: Double, radius_2: Double, n_segments: Int32, cap_bottom: Boolean, cap_top: Boolean
# ---------- script_4: Python ----------
import mola
from mola import module_rhino

new_mesh = mola.construct_cone(z1, z2, radius_1, radius_2, n_segments, cap_bottom, cap_top)

rhino_mesh = module_rhino.display_mesh(new_mesh)
# ---------- end script_4 ----------

# ---- group: construct / construct_torus
script_5 = Script(ring_radius=number_slider_10, tube_radius=number_slider_11, ring_n=number_slider_5, tube_n=number_slider_7)  # -> new_mesh, rhino_mesh; inputs ring_radius: Double, ring_n: Int32, tube_n: Int32
# ---------- script_5: Python ----------
import mola
from mola import module_rhino

new_mesh = mola.construct_torus(ring_radius, tube_radius, ring_n, tube_n)

rhino_mesh = module_rhino.display_mesh(new_mesh)
# ---------- end script_5 ----------

# ---- group: construct / dodecahedron
script_6 = Script(radius=number_slider_16)  # -> new_mesh, rhino_mesh; inputs radius: Double
# ---------- script_6: Python ----------
import mola
from mola import module_rhino

new_mesh = mola.construct_dodecahedron(radius)

rhino_mesh = module_rhino.display_mesh(new_mesh)
# ---------- end script_6 ----------

# ---- group: construct / icosahedron
script_7 = Script(radius=number_slider_16)  # -> new_mesh, rhino_mesh; inputs radius: Double
# ---------- script_7: Python ----------
import mola
from mola import module_rhino

new_mesh = mola.construct_icosahedron(radius)

rhino_mesh = module_rhino.display_mesh(new_mesh)
# ---------- end script_7 ----------

# ---- group: construct / tetrahedron
script_8 = Script(size=number_slider_8)  # -> new_mesh, rhino_mesh; inputs size: Double
# ---------- script_8: Python ----------
import mola
from mola import module_rhino

new_mesh = mola.construct_tetrahedron(size)

rhino_mesh = module_rhino.display_mesh(new_mesh)
# ---------- end script_8 ----------

# ---- group: cone
script_9 = Script(
    z1=Slider(-100, range=-100..100),
    z2=Slider(100, range=0..100),
    radius_1=Slider(12.4, range=0..100),
    radius_2=Slider(12, range=0..100),
    n_segments=Slider(24, range=0..100),
    cap_bottom=Toggle(True),
    cap_top=boolean_toggle_3)  # -> new_mesh, rhino_mesh; inputs z1: Double, z2: Double, radius_1: Double, radius_2: Double, n_segments: Int32, cap_bottom: Boolean, cap_top: Boolean
# ---------- script_9: Python ----------
import mola
from mola import module_rhino

mesh = mola.construct_cone(z1, z2, radius_1, radius_2, n_segments, cap_bottom, cap_top)

new_mesh = mola.Mesh()

face_heights = mesh.face_properties(mola.face_center_z)

for i, f in enumerate(mesh.faces):
    if face_heights[i] == 0:
        f.group = 1
        new_mesh.faces.append(f)
    else:
        f.group = 0
        new_mesh.faces.append(f)

new_mesh.update_topology()

height_values = [f.group for f in new_mesh.faces]

colours = [(1,0,0),(0,0,1)]
colour_map = mola.color_map(height_values, colours)
mola.color_faces_by_map(new_mesh.faces, colour_map)
new_mesh.update_topology()

rhino_mesh = module_rhino.display_mesh(new_mesh)
# ---------- end script_9 ----------

# ----
py3_2 = Python3Script(mola_path="/Users/minghip/Documents/Github")  # -> out, a; inputs mola_path: String
# ---------- py3_2: Python ----------
import sys

if mola_path not in sys.path:
    sys.path.append(mola_path)

print(sys.path)

try:
    import mola
    from mola import module_rhino
except ImportError as e:
    print("Error importing mola: {e}")
# ---------- end py3_2 ----------

# ---- group: Convert to Mola.Mesh
python_3_script = Python3Script(mesh=reduce_mesh.Reduced)  # -> new_mesh, rhino_mesh; inputs mesh: Mesh
# ---------- python_3_script: Python ----------
import mola
from mola import module_rhino

new_mesh = mola.Mesh()

mola_mesh = module_rhino.mesh_from_rhino_mesh(mesh)
mola_mesh.update_topology()

for face in mola_mesh.faces:
    face.group = 0
    new_mesh.faces.append(face)

new_mesh.update_topology()

rhino_mesh = module_rhino.display_mesh(new_mesh)
# ---------- end python_3_script ----------

python_3_script_2 = Python3Script(mesh=reduce_mesh_2.Reduced)  # -> new_mesh, rhino_mesh; inputs mesh: Mesh; same code as python_3_script

# ---- group: from primitive polyline / Subdivision\
mesh_3 = Script(mesh=script.column_mesh, extrusion=Slider(6, range=0..100))  # -> new_mesh, my_rhino_mesh; inputs extrusion: Double
# ---------- mesh_3: Python ----------
import mola
from mola import module_rhino

new_mesh = mola.Mesh()

for i, face in enumerate (mesh.faces):
    if i % 2 == 0:
        face.group = 1
        new_face = mola.subdivide_face_extrude_tapered(face, extrusion, 0.5, True)
        for f in new_face:
            f.group = 1
        new_mesh.faces.extend(new_face)
    else:
        face.group = 2
        new_mesh.faces.append(face)

new_mesh.update_topology()
my_rhino_mesh = module_rhino.display_mesh(new_mesh)
# ---------- end mesh_3 ----------
mesh_4 = Script(mesh=mesh_3.new_mesh, extrusion=Slider(2.9, range=0..100))  # -> new_mesh, my_rhino_mesh; inputs extrusion: Double
# ---------- mesh_4: Python ----------
import mola
from mola import module_rhino

new_mesh = mola.Mesh()

for face in mesh.faces:
    if face.group == 2:
        new_faces = mola.subdivide_face_extrude_tapered(face, -extrusion, 0.3, False)
        new_mesh.faces.extend(new_faces)

    else:
        new_mesh.faces.append(face)

new_mesh.update_topology()

new_mesh = mola.subdivide_mesh_catmull(new_mesh)
new_mesh.update_topology()

my_rhino_mesh = module_rhino.display_mesh(new_mesh)
# ---------- end mesh_4 ----------

# ----
construct_point = ConstructPoint(XCoordinate=Slider(0, range=0..100), YCoordinate=Slider(0, range=0..100), ZCoordinate=Slider(0, range=0..100))

# ---- group: subdivide_face_split_grid
# group 0 = top and bottom
# group 1 = every second vertical, less divisions
# group 2 = every second vertical, more divisions
script_10 = Script(mesh=script_9.new_mesh, u=Slider(2, range=0..10), v=Slider(44, range=0..100))  # -> new_mesh, rhino_mesh; inputs u: Int32, v: Int32
# ---------- script_10: Python ----------
import mola
from mola import module_rhino

new_mesh = mola.Mesh()
for i, f in enumerate (mesh.faces):
    if f.group == 1 and i % 2 == 0:
        new_faces = mola.subdivide_face_split_grid(f, u, v)
        for f in new_faces:
            f.group = 3
            new_mesh.faces.append(f)
    elif f.group == 1 and i % 2 != 0:
        f.group = 2
        new_mesh.faces.append(f)
    else:
        f.group = 1
        new_mesh.faces.append(f)

new_mesh.update_topology()

#color faces by group
values = [f.group for f in new_mesh.faces]

colours =[(0.5, 0.5, 1), (0.25, 0.25, 1)]
colour_map = mola.color_map(values, colours)
mola.color_faces_by_map(new_mesh.faces, colour_map)
new_mesh.update_topology()

#display
rhino_mesh = module_rhino.display_mesh(new_mesh)
# ---------- end script_10 ----------

# ---- group: subdivide_face_extrude_to_point_center
python_3_script_3 = Python3Script(mesh=script_6.new_mesh, extrusion_height=Slider(18.8, range=0..100), concave=Toggle(True))  # -> new_mesh, rhino_mesh; inputs extrusion_height: Double, concave: Boolean
# ---------- python_3_script_3: Python ----------
import mola
from mola import module_rhino

new_mesh = mola.Mesh()

if concave == True:
    x = -1
elif concave == False:
    x = 1
for i, face in enumerate (mesh.faces):
    if i >= 0:
        face.group = 1
        new_face = mola.subdivide_face_extrude_to_point_center(face, x * extrusion_height)

        for f in new_face:
            f.group = 1
        new_mesh.faces.extend(new_face)
    else:
        face.group = 2
        new_mesh.faces.append(face)

new_mesh.update_topology()
rhino_mesh = module_rhino.display_mesh(new_mesh)
# ---------- end python_3_script_3 ----------

# ---- group: subdivide_custom_triface_extrude_tapered_nonU
python_3_script_4 = Python3Script(extrusion_height=Slider(30, range=0..100), fraction=Slider(0.8, range=0.1..0.9), do_cap=Toggle(True))  # -> new_mesh, rhino_mesh; inputs extrusion_height: Double, fraction: Double, do_cap: Boolean
# ---------- python_3_script_4: Python ----------
import mola
from mola import module_rhino

new_mesh = mola.Mesh()

for i, face in enumerate (mesh.faces):
    if i >= 0:
        face.group = 1
        new_face = mola.subdivide_custom_triface_extrude_tapered_nonU(face, extrusion_height, fraction, do_cap)
        for f in new_face:
            f.group = 1
        new_mesh.faces.extend(new_face)
    else:
        face.group = 2
        new_mesh.faces.append(face)

new_mesh.update_topology()
rhino_mesh = module_rhino.display_mesh(new_mesh)
# ---------- end python_3_script_4 ----------

# ---- group: subdivide_face_extrude_tapered
mesh_5 = Script(
    mesh=script_3.new_mesh,
    extrusion=Slider(55.5, range=0..100),
    fraction=Slider(0.7, range=0.1..0.9),
    do_cap=Toggle(True),
    concave=Toggle(True))  # -> new_mesh, my_rhino_mesh; inputs extrusion: Double, fraction: Double, concave: Boolean
# ---------- mesh_5: Python ----------
import mola
from mola import module_rhino

new_mesh = mola.Mesh()

if concave == True:
    x = -1
elif concave == False:
    x = 1

for i, face in enumerate (mesh.faces):
    if i >= 0:
        face.group = 1
        new_face = mola.subdivide_face_extrude_tapered(face, x * extrusion, fraction, do_cap)
        for f in new_face:
            f.group = 1
        new_mesh.faces.extend(new_face)
    else:
        face.group = 2
        new_mesh.faces.append(face)

new_mesh.update_topology()
my_rhino_mesh = module_rhino.display_mesh(new_mesh)
# ---------- end mesh_5 ----------

# ---- group: subdivide_face_extrude
python_3_script_5 = Python3Script(mesh=mesh_5.new_mesh, extrusion_height=Slider(14, range=0..100), cap_bottom=Toggle(True), cap_top=Toggle(False))  # -> new_mesh, rhino_mesh; inputs extrusion_height: Double, cap_bottom: Boolean, cap_top: Boolean
# ---------- python_3_script_5: Python ----------
import mola
from mola import module_rhino

new_mesh = mola.Mesh()

for i, face in enumerate (mesh.faces):
    if i >= 0:
        face.group = 1
        new_face = mola.subdivide_face_extrude(face, -extrusion_height,cap_bottom,cap_top)

        for f in new_face:
            f.group = 1
        new_mesh.faces.extend(new_face)
    else:
        face.group = 2
        new_mesh.faces.append(face)

new_mesh.update_topology()
rhino_mesh = module_rhino.display_mesh(new_mesh)
# ---------- end python_3_script_5 ----------

python_3_script_6 = Python3Script(mesh=python_3_script_5.new_mesh, point=construct_point)  # -> new_mesh, rhino_mesh; inputs point: Point3d
# ---------- python_3_script_6: Python ----------
import mola
from mola import module_rhino

new_mesh = mola.Mesh()
vertex = mola.Vertex(point[0], point[1], point[2])

for i, face in enumerate (mesh.faces):
    if i >= 0:
        face.group = 1

        new_face = mola.subdivide_face_extrude_to_point(face, vertex)

        for f in new_face:
            f.group = 1
        new_mesh.faces.extend(new_face)
    else:
        face.group = 2
        new_mesh.faces.append(face)

new_mesh.update_topology()
rhino_mesh = module_rhino.display_mesh(new_mesh)
# ---------- end python_3_script_6 ----------

# ----
script_11 = Script(mesh=python_3_script.new_mesh, iterations=Slider(10, range=0..10), concave=Toggle(False))  # -> temp_mesh, rhino_mesh; inputs iterations: Int32, concave: Boolean
# ---------- script_11: Python ----------
import mola
from mola import module_rhino
import math

new_mesh = mola.Mesh()

for i in range(iterations):
    #temporary mesh to hold subdivided faces
    temp_mesh = mola.Mesh()

    #alternating between positive and negative concavity between iterations
    if i % 2 == 0:
        y = 1
    if i % 2 == 1:
        y = -1

    #initial cancavity
    if concave == True:
        x = -.01 * y
    elif concave == False:
        x = .01 * y

    #recursive subdivision
    for j, f in enumerate (mesh.faces):
        #initially, all faces are subdivided
        #upon iteration, the top faces are subdivided
        if f.group == 0:
            new_faces = mola.subdivide_face_extrude_tapered(f, x * i * math.sin(j), 0.2)
            for o, face in enumerate (new_faces):
                if o < len(new_faces) -1:
                    face.group = 1
                    new_mesh.faces.extend(new_faces)
                else:
                    face.group = 0
                    temp_mesh.faces.extend(new_faces)
            
    mesh = temp_mesh

temp_mesh.update_topology()

for f in new_mesh.faces:
    if f.group == 1:
        temp_mesh.faces.append(f)

new_mesh.update_topology()

#color faces by group
values = [f.group for f in new_mesh.faces]

colours =[(0.5, 0.5, 1), (0.25, 0.25, 1)]
colour_map = mola.color_map(values, colours)
mola.color_faces_by_map(new_mesh.faces, colour_map)
new_mesh.update_topology()

#display
rhino_mesh = module_rhino.display_mesh(temp_mesh)
# ---------- end script_11 ----------
script_12 = Script(mesh=python_3_script_2.new_mesh, iterations=Slider(6, range=0..10), concave=Toggle(False))  # -> new_mesh, rhino_mesh; inputs iterations: Int32, concave: Boolean
# ---------- script_12: Python ----------
import mola
from mola import module_rhino
import math

new_mesh = mola.Mesh()

for i in range(iterations):
    #temporary mesh to hold subdivided faces
    temp_mesh = mola.Mesh()

    #alternating between positive and negative concavity between iterations
    if i % 2 == 0:
        y = 1.5
    if i % 2 == 1:
        y = -1

    #initial cancavity
    if concave == True:
        x = -.7 * y
    elif concave == False:
        x = .7 * y

    #recursive subdivision
    for j, f in enumerate (mesh.faces):
        #initially, all faces are subdivided
        #upon iteration, the top faces are subdivided
        if f.group == 0:
            new_faces = mola.subdivide_face_extrude_tapered(f, x * i * math.sin(j * 2), 0.2)
            for o, face in enumerate (new_faces):
                if o < len(new_faces) -1:
                    face.group = 1
                    new_mesh.faces.extend(new_faces)
                else:
                    face.group = 0
                    temp_mesh.faces.extend(new_faces)
            
    mesh = temp_mesh

temp_mesh.update_topology()

for f in new_mesh.faces:
    if f.group == 1:
        temp_mesh.faces.append(f)

new_mesh.update_topology()

#color faces by group
values = [f.group for f in new_mesh.faces]

colours =[(0.5, 0.5, 1), (0.25, 0.25, 1)]
colour_map = mola.color_map(values, colours)
mola.color_faces_by_map(new_mesh.faces, colour_map)
new_mesh.update_topology()

#display
rhino_mesh = module_rhino.display_mesh(temp_mesh)
# ---------- end script_12 ----------
script_13 = Script()  # -> rhino_mesh
# ---------- script_13: Python ----------
import mola
from mola import module_rhino

new_mesh = mola.Mesh()

for f in mesh.faces:
    new_mesh.faces.append(f)

new_mesh.update_topology()

props = new_mesh.face_properties(mola.face_curvature)
color_scheme = [(0.7,0.1,0),(0.1,0.1,1), (0,0.1,0.5)]
colors = mola.color_map(props , color_scheme)
mola.color_faces_by_map(new_mesh.faces,colors)

new_mesh.update_topology()
rhino_mesh = module_rhino.display_mesh(new_mesh)
# ---------- end script_13 ----------
py3_3 = Python3Script(r=Slider(5, range=0..10))  # -> out, new_mesh, my_mesh_rhino; inputs r: Int32
# ---------- py3_3: Python ----------
import mola
from mola import module_rhino

my_mesh = mola.construct_sphere(r,3,3)

for v in my_mesh.vertices:
    if v.z>0:
        v.z *= 1.5

my_mesh = mola.subdivide_mesh_catmull(my_mesh)

my_properties = my_mesh.face_properties(mola.face_center_z)


mola.color_faces_by_vertical_angle(my_mesh.faces)

heights = mola.math_map_list(my_properties, 0.0, 2.0)

new_mesh = mola.Mesh()
for i, f in enumerate(my_mesh.faces):
    if heights[i] > 0.5:
        doCap = False
    else: 
        doCap = True
    resulting_faces = mola.subdivide_face_extrude_tapered(f, heights[i], 0.6, doCap)
    new_mesh.faces.extend(resulting_faces)

new_mesh.update_topology()
new_mesh = mola.mesh_offset(new_mesh,0.2)

for i in range(2):
    new_mesh = mola.subdivide_mesh_catmull(new_mesh)

props = new_mesh.face_properties(mola.face_center_z)
color_scheme = [(0,0,1),(1,0,1), (0.5,0.5,0.5), (1,1,1)]
colors = mola.color_map(props , color_scheme)
mola.color_faces_by_map(new_mesh.faces,colors)


new_mesh.update_topology()
my_mesh_rhino = module_rhino.display_mesh(new_mesh)
# ---------- end py3_3 ----------

# ---- group: subdivide_face_split_grid
# group 0 = top and bottom
# group 1 = every second vertical, less divisions
# group 2 = every second vertical, more divisions
script_14 = Script(mesh=script_10.new_mesh, u=Slider(2, range=0..10), v=Slider(2, range=0..10))  # -> new_mesh, rhino_mesh; inputs u: Int32, v: Int32
# ---------- script_14: Python ----------
import mola
from mola import module_rhino

new_mesh = mola.Mesh()
for i, f in enumerate (mesh.faces):
    if f.group == 3 and i % 2 != 0 :
        new_faces = mola.subdivide_face_split_grid(f, u, v)
        for f in new_faces:
            f.group = 2
            new_mesh.faces.append(f)
    elif f.group == 3:
        new_faces = mola.subdivide_face_split_grid(f, int(u/2), int(v/2))
        for f in new_faces:
            f.group = 1
            new_mesh.faces.append(f)
    else:
        new_mesh.faces.append(f)

new_mesh.update_topology()

#color faces by group
values = [f.group for f in new_mesh.faces]

colours =[(0.5, 0.5, 1), (0.25, 0.25, 1)]
colour_map = mola.color_map(values, colours)
mola.color_faces_by_map(new_mesh.faces, colour_map)
new_mesh.update_topology()

#display
rhino_mesh = module_rhino.display_mesh(new_mesh)
# ---------- end script_14 ----------

# ----
check_groups = Script(mesh=script_14.new_mesh)  # -> new_mesh, rhino_mesh
# ---------- check_groups: Python ----------
import mola
from mola import module_rhino

new_mesh = mola.Mesh()
for f in (mesh.faces):
    if f.group == 3:
        new_mesh.faces.append(f)

new_mesh.update_topology()

#display
rhino_mesh = module_rhino.display_mesh(new_mesh)
# ---------- end check_groups ----------
geo_2 = Geometry(py3_3.my_mesh_rhino)

number_slider_17 = Slider(6, range=0..10)
number_slider_18 = Slider(-10, range=-10..10)
# primitives
py3_4 = Python3Script(
    x=number_slider_17,
    y=number_slider_17,
    z=number_slider_17,
    x1=number_slider_18,
    y1=number_slider_18,
    z1=number_slider_18)  # -> out, my_mesh, my_mesh_rhino
# ---------- py3_4: Python ----------
import mola
from mola import module_rhino


my_mesh = mola.construct_box(x,y,z,x1,y1,z1)

my_mesh_rhino = module_rhino.display_mesh(my_mesh)
# ---------- end py3_4 ----------
# subdivision
py3_5 = Python3Script(mesh=py3_4.my_mesh, r=Slider(3, range=0..10))  # -> out, new_mesh, my_mesh_rhino; inputs r: Int32
# ---------- py3_5: Python ----------
import mola
from mola import module_rhino



for i in range(r):
    new_mesh = mola.Mesh()
    for f in mesh.faces:
        resulting_face = mola.subdivide_face_extrude_to_point_center(f, -3)
        new_mesh.faces.extend(resulting_face)
    mesh = new_mesh

new_mesh.update_topology()

my_mesh_rhino = module_rhino.display_mesh(new_mesh)
# ---------- end py3_5 ----------
py3_6 = Python3Script(mesh=py3_5.new_mesh)  # -> out, new_mesh, my_mesh_rhino
# ---------- py3_6: Python ----------
import mola
from mola import module_rhino



new_mesh = mesh

for i in range(1):
    new_mesh = mola.subdivide_mesh_catmull(new_mesh)

mola.color_faces_by_area(new_mesh.faces)

my_mesh_rhino = module_rhino.display_mesh(new_mesh)
# ---------- end py3_6 ----------

# ---- group: subdivide_face_split_frame
python_3_script_7 = Python3Script(mesh=python_3_script_5.new_mesh, width=Slider(15, range=0..100))  # -> new_mesh, rhino_mesh; inputs width: Double
# ---------- python_3_script_7: Python ----------
import mola
from mola import module_rhino

new_mesh = mola.Mesh()

for i, face in enumerate (mesh.faces):
    if i >= 0:
        face.group = 1
        new_face = mola.subdivide_face_split_frame(face, width)

        for f in new_face:
            f.group = 1
        new_mesh.faces.extend(new_face)
    else:
        face.group = 2
        new_mesh.faces.append(face)

new_mesh.update_topology()
rhino_mesh = module_rhino.display_mesh(new_mesh)
# ---------- end python_3_script_7 ----------

# ---- group: subdivide_face_split_grid
python_3_script_8 = Python3Script(nU=Slider(11, range=0..100), nV=Slider(11, range=0..100))  # -> new_mesh, rhino_mesh; inputs nU: Int32, nV: Int32
# ---------- python_3_script_8: Python ----------
import mola
from mola import module_rhino

new_mesh = mola.Mesh()

for i, face in enumerate (mesh.faces):
    if i >= 0:
        face.group = 1
        new_face = mola.subdivide_face_split_grid(face, nU, nV)

        for f in new_face:
            f.group = 1
        new_mesh.faces.extend(new_face)
    else:
        face.group = 2
        new_mesh.faces.append(face)

new_mesh.update_topology()
rhino_mesh = module_rhino.display_mesh(new_mesh)
# ---------- end python_3_script_8 ----------

# ----
# new_faces = mola.subdivide_face_extrude_tapered(face, x * extrusion * math.sin(i), fraction, do_cap)
boolean_toggle_4 = BooleanToggle(False)

# ---- group: subdivide_face_extrude_tapered
# Create variation in extrusion distances based on closest point.
mesh_6 = Script(
    mesh=script_14.new_mesh,
    extrusion=Slider(5, range=0..100),
    fraction=Slider(0.5, range=0.1..0.9),
    do_cap=Toggle(False),
    concave=boolean_toggle_4)  # -> new_mesh, my_rhino_mesh; inputs extrusion: Double, fraction: Double, concave: Boolean
# ---------- mesh_6: Python ----------
import mola
from mola import module_rhino

new_mesh = mola.Mesh()

#concave or convex extrusion
if concave == True:
    x = -1
elif concave == False:
    x = 1

#create new mesh with subdivision
for i, face in enumerate (mesh.faces):
    if face.group == 1:
        new_faces = mola.subdivide_face_extrude_tapered(face, x * extrusion, fraction, do_cap)
        for f in new_faces:
            f.group = 4
        new_faces[-1].group = 5
        new_mesh.faces.extend(new_faces)
    else:
        new_mesh.faces.append(face)

new_mesh.update_topology()

#colour faces by group
values = [f.group for f in new_mesh.faces]
colours =[(0.5, 0.5, 1), (0.5, 0, 1)]
colour_map = mola.color_map(values, colours)
mola.color_faces_by_map(new_mesh.faces, colour_map)

new_mesh.update_topology()

#display mesh
my_rhino_mesh = module_rhino.display_mesh(new_mesh)
# ---------- end mesh_6 ----------

# ---- group: subdivide_face_extrude_to_point_center
python_3_script_9 = Python3Script(mesh=mesh_6.new_mesh, extrusion_height=Slider(2, range=0..100), concave=Toggle(True))  # -> new_mesh, rhino_mesh; inputs extrusion_height: Double, concave: Boolean
# ---------- python_3_script_9: Python ----------
import mola
from mola import module_rhino

new_mesh = mola.Mesh()

if concave == True:
    x = -1
elif concave == False:
    x = 1

for f in (mesh.faces):
    if f.group == 3:
        new_face = mola.subdivide_face_extrude_to_point_center(f, x * extrusion_height)
        new_face[-1].group = 3
        new_mesh.faces.extend(new_face)
    else:
        new_mesh.faces.append(f)

new_mesh.update_topology()

#color faces by group
values = [f.group for f in new_mesh.faces]

colours =[(0.5, 0.5, 1), (0.25, 0.25, 1)]
colour_map = mola.color_map(values, colours)
mola.color_faces_by_map(new_mesh.faces, colour_map)
new_mesh.update_topology()

rhino_mesh = module_rhino.display_mesh(new_mesh)
# ---------- end python_3_script_9 ----------

# ----
script_15 = Script(mesh=python_3_script_9.new_mesh, iterations=Slider(2, range=0..10), concave=Toggle(True))  # -> new_mesh, rhino_mesh; inputs iterations: Int32, concave: Boolean
# ---------- script_15: Python ----------
import mola
from mola import module_rhino

new_mesh = mola.Mesh()

for f in mesh.faces:
    if f.group != 2:
        new_mesh.faces.append(f)

for i in range(iterations):
    if i % 2 == 0:
        y = 1
    if i % 2 == 1:
        y = -1

    if concave == True:
        x = -1 * y
    elif concave == False:
        x = 1 * y

    temp_mesh = mola.Mesh()
    for f in mesh.faces:
        if f.group == 2:
            new_faces = mola.subdivide_face_extrude_tapered(f, x * i, 0.5)
            for i, face in enumerate (new_faces):
                if i < len(new_faces) -1:
                    face.group = 5
                    temp_mesh.faces.extend(new_faces)
                else:
                    face.group = 2
                    temp_mesh.faces.extend(new_faces)
            
    mesh = temp_mesh
    for f in temp_mesh.faces:
        new_mesh.faces.append(f)

new_mesh.update_topology()

#color faces by group
values = [f.group for f in new_mesh.faces]

colours =[(0.5, 0.5, 1), (0.25, 0.25, 1)]
colour_map = mola.color_map(values, colours)
mola.color_faces_by_map(new_mesh.faces, colour_map)
new_mesh.update_topology()

#display
rhino_mesh = module_rhino.display_mesh(new_mesh)
# ---------- end script_15 ----------
py3_7 = Python3Script(r=Slider(5, range=0..10))  # -> out, new_mesh, my_mesh_rhino; inputs r: Int32
# ---------- py3_7: Python ----------
import mola
from mola import module_rhino
import rhinoscriptsyntax as rs


guid = rs.GetObject()

new_mesh = module_rhino.mesh_from_rhino_mesh(guid)

print(new_mesh)
# ---------- end py3_7 ----------
py3_8 = Python3Script(r=Slider(5, range=0..10))  # -> out, new_mesh, my_mesh_rhino; inputs r: Int32; same code as py3_3
py3_9 = Python3Script(r=Slider(5, range=0..10))  # -> out, new_mesh, my_mesh_rhino; inputs r: Int32; same code as py3_7
python_3_script_10 = Python3Script(mesh=script_15.new_mesh)  # -> out, my_mesh, my_mesh_rhino; disabled
# ---------- python_3_script_10: Python ----------
import mola
from mola import module_rhino

#sixth step
mesh.update_topology()

my_mesh = mola.subdivide_mesh_catmull(mesh)
properties = my_mesh.face_properties(mola.face_curvature)
cmap = mola.color_map(properties)

#color faces by a color map
mola.color_faces_by_map(my_mesh.faces, cmap)

# seventh step
my_mesh.update_topology()
my_mesh = mola.subdivide_mesh_catmull(my_mesh)

mesh.update_topology()

#display
my_mesh_rhino = module_rhino.display_mesh(my_mesh)
# ---------- end python_3_script_10 ----------
geo_3 = Geometry(py3_8.my_mesh_rhino)
geo_4 = Geometry(py3_7.my_mesh_rhino)
geo_5 = Geometry(py3_9.my_mesh_rhino)
