# Grasshopper definition 101_primitives_and_subdivisions_sharon.gh (Grasshopper 1.0.8)

# ----
# triangle
number_slider = Slider(3, range=0..10)
crv = Curve(<curve referenced from the Rhino model>)
py3 = Python3Script(
    curve=crv,
    num_sides=Slider(5, range=0..10),
    radius=Slider(7, range=0..10),
    total_height=Slider(60, range=0..100),
    h_subdivisions=number_slider)  # -> out, new_pts, column_mesh, list_points, column_mesh_rhino; inputs curve: Polyline, num_sides: Int32, radius: Double, total_height: Double, h_subdivisions: Int32
# ---------- py3: Python ----------
# polygon-based column mesh -> divide multi layers along zaxis -> triangular meshes

import mola
from mola import module_rhino
import Rhino.Geometry as rg
import math

# extract points from polyline
def points_on_curves(curve):
    list_of_points = []
    for p in curve:
        pt = rg.Point3d(p)
        list_of_points.append(pt)
    return list_of_points

# generate points evenly distributed on a circle in XY-plane(z=0)
def points_on_polygon(num_sides, radius):
    list_of_points = []
    theta = (2*math.pi)/num_sides
    for i in range(num_sides):
        angle = i * theta
        x = radius * math.cos(angle)
        y = radius * math.sin(angle)
        z = 0
        pt = rg.Point3d(x,y,z)
        list_of_points.append(pt)
    return list_of_points

if curve is not None:
    list_points = points_on_curves(curve)
else:
    list_points = points_on_polygon(num_sides, radius)

column_mesh = mola.Mesh() # create a new mola mesh container
new_pts = [] # create a new point container for all points

# Duplicate base points and assign a new Z value for each layer.
for layer_no in range(h_subdivisions + 1): # add one more layer
    z = total_height/h_subdivisions * layer_no
    for p in list_points:
        pt = rg.Point3d(p)
        pt.Z = z # (x,y,z) # pt[2] = z
        new_pts.append(pt) # build pts along layer height
        column_mesh.add_vertex(pt[0], pt[1], pt[2]) # * unpack

len_layer_points = len(list_points)
print(len_layer_points)

# for layer_no in range(h_subdivisions): # set a series of point started index
#     current_layer = layer_no * len_layer_points
#     next_layer = (layer_no + 1) * len_layer_points
#     print(current_layer)
#     for i in range(len_layer_points - 1): # find the index of next point # the start and the last point are repetative
#         next_i = (i+1) % (len_layer_points - 1)

#         # Define 4 vertices for a vertical quad face (between current and next layer).
#         v0 = column_mesh.vertices[current_layer + i]
#         v1 = column_mesh.vertices[current_layer + next_i]
#         v2 = column_mesh.vertices[next_layer + next_i]
#         v3 = column_mesh.vertices[next_layer + i]

#         column_mesh.add_face([v0,v1,v2,v3])

for layer_no in range(h_subdivisions):
    current_layer = layer_no * len_layer_points
    next_layer = (layer_no + 1) * len_layer_points
    for i in range(len_layer_points - 1):
        next_i = (i+1) % (len_layer_points - 1)
        # Define 4 vertices for a triangular or quad face
        v0 = column_mesh.vertices[current_layer + i]
        v1 = column_mesh.vertices[current_layer + next_i]
        v2 = column_mesh.vertices[next_layer + i]
        v3 = column_mesh.vertices[next_layer + next_i]
        column_mesh.add_face([v0,v1,v2])
        column_mesh.add_face([v2,v1,v3])


column_mesh.update_topology() # Update mesh connectivity info after adding vertices and faces.

column_mesh_rhino = module_rhino.display_mesh(column_mesh) # Convert and display the Mola mesh as a Rhino mesh in the Rhino viewport.
# ---------- end py3 ----------
geo = Geometry(py3.list_points)
geo_2 = Geometry(py3.new_pts)
geo_3 = Geometry(py3.column_mesh_rhino)

crv_2 = Curve(<curve referenced from the Rhino model>)
py3_2 = Python3Script(
    curve=crv_2,
    num_sides=Slider(5, range=0..10),
    radius=Slider(7, range=0..10),
    total_height=Slider(60, range=0..100),
    h_subdivisions=Slider(5, range=0..10))  # -> out, new_pts, column_mesh, list_points, column_mesh_rhino; inputs curve: Polyline, num_sides: Int32, radius: Double, total_height: Double, h_subdivisions: Int32
# ---------- py3_2: Python ----------
# build column, divided
import mola
from mola import module_rhino
import Rhino.Geometry as rg
import math

# extract points from polyline
def points_on_curves(curve):
    list_of_points = []
    for p in curve:
        pt = rg.Point3d(p)
        list_of_points.append(pt)
    return list_of_points

# generate points evenly distributed on a circle in XY-plane(z=0)
def points_on_polygon(num_sides, radius):
    list_of_points = []
    theta = (2*math.pi)/num_sides
    for i in range(num_sides):
        angle = i * theta
        x = radius * math.cos(angle)
        y = radius * math.sin(angle)
        z = 0
        pt = rg.Point3d(x,y,z)
        list_of_points.append(pt)
    return list_of_points

if curve is not None:
    list_points = points_on_curves(curve)
else:
    list_points = points_on_polygon(num_sides, radius)

column_mesh = mola.Mesh()
new_pts = []

for layer_no in range(h_subdivisions + 1):
    z = total_height/h_subdivisions * layer_no # add one more layer
    for p in list_points:
        pt = rg.Point3d(p)
        pt[2] = z # (x,y,z)
        new_pts.append(pt) # build pts along layer height
        column_mesh.add_vertex(pt[0], pt[1], pt[2]) # * unpack

points_per_layer = len(list_points)
print(len(list_points))

for layer_no in range(h_subdivisions):
    current_layer = layer_no * points_per_layer
    next_layer = (layer_no + 1) * points_per_layer
    for i in range(points_per_layer-1):
        next_i = (i+1) % points_per_layer

        v0 = column_mesh.vertices[current_layer + i]
        v1 = column_mesh.vertices[current_layer + next_i]
        v2 = column_mesh.vertices[next_layer + next_i]
        v3 = column_mesh.vertices[next_layer + i]

        column_mesh.add_face([v0,v1,v2,v3])

column_mesh.update_topology()

column_mesh_rhino = module_rhino.display_mesh(column_mesh)
# ---------- end py3_2 ----------
geo_4 = Geometry(py3_2.list_points)
geo_5 = Geometry(py3_2.new_pts)
geo_6 = Geometry(py3_2.column_mesh_rhino)
number_slider_2 = Slider(5, range=0..10)  # disabled
py3_3 = Python3Script(mesh=py3_2.column_mesh, extrusion=number_slider_2)  # -> my_rhino_mesh, new_mesh; inputs extrusion: Double; disabled
# ---------- py3_3: Python ----------
import mola
from mola import module_rhino

new_mesh = mola.Mesh()
 
for i, face in enumerate(mesh.faces):
    if i <= 15:
        new_faces = mola.subdivide_face_extrude_tapered(face,extrusion, 0.5, True)
        for f in new_faces:
            f.group = 0
        new_mesh.faces.extend(new_faces)
    else:
        face.group = 2
        new_mesh.faces.append(face)

new_mesh.update_topology()
my_rhino_mesh = module_rhino.display_mesh(new_mesh)
# ---------- end py3_3 ----------
number_slider_3 = Slider(2, range=0..10)  # disabled
py3_4 = Python3Script(mesh=py3_3.new_mesh, extrusion=number_slider_3)  # -> my_rhino_mesh; disabled
# ---------- py3_4: Python ----------
import mola
from mola import module_rhino

new_mesh = mola.Mesh()

for face in mesh.faces:
    if face.group == 2:
        new_faces = mola.subdivide_face_extrude_tapered(face, -extrusion, 0.8, False)
        new_mesh.faces.extend(new_faces)
    else:
        new_mesh.faces.append(face)

new_mesh.update_topology()
# new_mesh = mola.mesh_offset(new_mesh,0.2) # thickness

my_rhino_mesh = module_rhino.display_mesh(new_mesh)
# ---------- end py3_4 ----------

# ----
# quad
number_slider_4 = Slider(8, range=0..10)
crv_3 = Curve(<curve referenced from the Rhino model>)
py3_5 = Python3Script(
    curve=crv_3,
    num_sides=Slider(8, range=0..10),
    radius=Slider(7, range=0..10),
    total_height=Slider(60, range=0..100),
    h_subdivisions=number_slider_4)  # -> out, top_pts, base_pts, column_mesh, list_points, column_mesh_rhino; inputs curve: Polyline, num_sides: Int32, radius: Double, total_height: Double, h_subdivisions: Int32
# ---------- py3_5: Python ----------
# polygon-based column mesh -> divide multi layers along zaxis -> quad meshes
"""
This script generates a column mesh structure based on either:
1. A given input curve (polyline), or
2. A generated regular polygon.

The column is subdivided vertically into layers (h_subdivisions),
and mesh faces are created between adjacent layers.
"""
import mola
from mola import module_rhino
import Rhino.Geometry as rg
import math

# extract points from polyline
def points_on_curves(curve):
    list_of_points = []
    for p in curve:
        pt = rg.Point3d(p)
        list_of_points.append(pt)
    return list_of_points

# generate points evenly distributed on a circle in XY-plane(z=0)
def points_on_polygon(num_sides, radius):
    list_of_points = []
    theta = (2*math.pi)/num_sides
    for i in range(num_sides):
        angle = i * theta
        x = radius * math.cos(angle)
        y = radius * math.sin(angle)
        z = 0
        pt = rg.Point3d(x,y,z)
        list_of_points.append(pt)
    return list_of_points

if curve is not None:
    list_points = points_on_curves(curve)
else:
    list_points = points_on_polygon(num_sides, radius)

column_mesh = mola.Mesh() # create a new mola mesh container
new_pts = [] # create a new point container for all points

# Duplicate base points and assign a new Z value for each layer.
for layer_no in range(h_subdivisions + 1): # add one more layer
    z = total_height/h_subdivisions * layer_no
    for p in list_points:
        pt = rg.Point3d(p)
        pt[2] = z # (x,y,z) # pt.Z = z
        new_pts.append(pt) # build pts along layer height
        column_mesh.add_vertex(pt[0], pt[1], pt[2]) # * unpack

len_points_per_layer = len(list_points)
print(len_points_per_layer)

top_pts = new_pts[:-len(list_points):-1]
base_pts = new_pts[:len(list_points):1]

# x = []
# y = []
# z = []
# print(*top_pts[1])
# for i, num in enumerate(*top_pts):
#     if i % 3 == 0:
#         x.append(num)
#     if i % 3 == 0:
#         y.append(num)
#     if i % 3 == 0:
#         z.append(num)

# top_face = []
# # top_face.add_face(*top_points)


for layer_no in range(h_subdivisions): # set a series of point started index
    current_layer = layer_no * len_points_per_layer
    next_layer = (layer_no + 1) * len_points_per_layer
    # print(next_layer)
    for i in range(len_points_per_layer - 1): # find the index of next point # the start and the last point are repetative
        next_i = (i+1) % (len_points_per_layer - 1)

        # Define 4 vertices for a vertical quad face (between current and next layer).
        v0 = column_mesh.vertices[current_layer + i]
        v1 = column_mesh.vertices[current_layer + next_i]
        v2 = column_mesh.vertices[next_layer + next_i]
        v3 = column_mesh.vertices[next_layer + i]
        column_mesh.add_face([v0,v1,v2,v3])

column_mesh.update_topology() # Update mesh connectivity info after adding vertices and faces.

column_mesh_rhino = module_rhino.display_mesh(column_mesh) # Convert and display the Mola mesh as a Rhino mesh in the Rhino viewport.
# ---------- end py3_5 ----------
geo_7 = Geometry(py3_5.top_pts)
geo_8 = Geometry(py3_5.base_pts)
geo_9 = Geometry(py3_5.column_mesh_rhino)
geo_10 = Geometry(py3_5.list_points)

number_slider_5 = Slider(6, range=0..10)  # disabled
number_slider_6 = Slider(7.2, range=0..100)  # disabled
py3_6 = Python3Script(radius=number_slider_6, num_sides=number_slider_5)  # -> out, points, new_mesh_rhino; inputs radius: Double, num_sides: Int32; disabled
# ---------- py3_6: Python ----------
import math
import Rhino.Geometry as rg
import mola
from mola import module_rhino

points = []

theta = (2*math.pi)/num_sides

new_mesh = mola.Mesh()

for i in range(num_sides):
    angle = i * theta
    x = radius*math.cos(angle)
    y = radius*math.sin(angle)
    z = 0
    pt = rg.Point3d(x,y,z)
    points.append(pt)
    new_mesh.add_vertex(x,y,z)

new_mesh.add_face([*new_mesh.vertices]) # botom of structure # * unpack
new_mesh.add_vertex(0,0,10) # center point

for i in range(num_sides):
    v1 = new_mesh.vertices[i]
    v2 = new_mesh.vertices[(i+1)%num_sides]
    print((i+1)%num_sides)
    cen = new_mesh.vertices[-1]
    new_mesh.add_face([v1,v2,cen])

new_mesh_rhino = module_rhino.display_mesh(new_mesh)
# ---------- end py3_6 ----------
geo_11 = Geometry(py3_6.points)  # disabled
geo_12 = Geometry(py3_6.new_mesh_rhino)  # disabled

# ----
# scratch_explanation
number_slider_7 = Slider(6, range=0..10)  # disabled
number_slider_8 = Slider(7.2, range=0..100)  # disabled
py3_7 = Python3Script(radius=number_slider_8, num_sides=number_slider_7)  # -> out, points, new_mesh_rhino; inputs radius: Double, num_sides: Int32; disabled
# ---------- py3_7: Python ----------
# 建立一個「多邊形底座」並往上連到中心頂點，形成一個錐體 (pyramid-like mesh)
import math
import Rhino.Geometry as rg
import mola
from mola import module_rhino

points = []

theta = (2*math.pi)/num_sides # divide full circle (2π radians = 360°) by num_sides to get the central angle between vertices

new_mesh = mola.Mesh() # build a new MOLA mesh container

for i in range(num_sides): # generate points evenly distributed on a circle in XY-plane (z=0)
    angle = i * theta
    """x = radius * cos(angle)、y = radius * sin(angle)
→ 因為在平面上以圓為基礎的極座標轉換中，
x = r cos θ、y = r sin θ
表示從圓心出發，沿半徑方向在角度 θ 上的座標"""
    x = radius*math.cos(angle) # cos controls x-axis position, sin controls y-axis position, following the unit circle definition
    y = radius*math.sin(angle)
    z = 0
    pt = rg.Point3d(x,y,z)
    points.append(pt)
    new_mesh.add_vertex(x,y,z) # add vertex in new_mesh container

new_mesh.add_face([*new_mesh.vertices]) # create bottom face (the base polygon) using all vertices on the circle
new_mesh.add_vertex(0,0,10) # add apex vertex(頂點) above the center of the base at height = 10

for i in range(num_sides): # build mesh faces
    v1 = new_mesh.vertices[i]
    v2 = new_mesh.vertices[(i+1)%num_sides] # extract the vertices beside ith item
    print((i+1)%num_sides) # 1,2,3...,0
    cen = new_mesh.vertices[-1] # center point(the last one)
    new_mesh.add_face([v1,v2,cen]) # build mesh faces
# connect each edge of the base to the apex vertex to form triangular side faces
# v1, v2 are adjacent base vertices; cen is the apex (last vertex in the list)

new_mesh_rhino = module_rhino.display_mesh(new_mesh) # draw mesh in rhino environment
# ---------- end py3_7 ----------
geo_13 = Geometry(py3_7.points)  # disabled
geo_14 = Geometry(py3_7.new_mesh_rhino)  # disabled

# ----
# mesh from scratch
panel = Panel("C:\Users\user\github")
py3_8 = Python3Script(mola_path=panel)  # -> out, a; inputs mola_path: String
# ---------- py3_8: Python ----------
import sys

if mola_path not in sys.path:
    sys.path.append(mola_path)

print(sys.path)

try:
    import mola
    from mola import module_rhino
except ImportError as e:
    print("Error importing mola: {e}")
# ---------- end py3_8 ----------

py3_9 = Python3Script(mesh=py3_5.column_mesh, h_subdivisions=number_slider_4, extrusion=Slider(3.5, range=0..10))  # -> new_mesh, new_mesh_rhino; inputs h_subdivisions: Int32, extrusion: Double
# ---------- py3_9: Python ----------
import mola
from mola import module_rhino

new_mesh = mola.Mesh()

faces_layer = (len(mesh.faces)/h_subdivisions)
print(faces_layer)
for i, face in enumerate(mesh.faces):
    if (faces_layer * 1) - 1 < i < faces_layer * 2:
        new_faces = mola.subdivide_face_extrude_tapered(face, extrusion, 0.75, True)
        for f in new_faces:
            f.group = 0
        new_mesh.faces.extend(new_faces)
    else:
        face.group = 1
        new_faces = mola.subdivide_face_extrude_tapered(face, -extrusion, 0.6, False)
        new_mesh.faces.extend(new_faces)

new_mesh.update_topology()
new_mesh_rhino = module_rhino.display_mesh(new_mesh)
# ---------- end py3_9 ----------

# ----
# subdivision
number_slider_9 = Slider(3, range=0..10)  # disabled
py3_10 = Python3Script(mesh=py3_5.column_mesh, h_subdivisions=number_slider_4, extrusion=number_slider_9)  # -> new_mesh, new_mesh_rhino, center_pt; inputs h_subdivisions: Int32, extrusion: Double; disabled
# ---------- py3_10: Python ----------
# subdivide_custom_triface_extrude_tapered_nonU(face, height=0.0, fraction=0.5, doCap=True)
# subdivide_face_extrude(face, height=0.0, capBottom=False, capTop=True)
# subdivide_face_extrude_tapered(face, height=0.0, fraction=0.5, doCap=True)
# subdivide_face_extrude_to_point(face, point)
# subdivide_face_extrude_to_point_center(face, height=0.0)
# subdivide_face_offset_planar(face, offsets)
# subdivide_face_split_frame(face, w)
# subdivide_face_split_grid(face, nU, nV)
# subdivide_face_split_offset(face, offset)
# subdivide_face_split_offsets(face, offsets)
# subdivide_face_split_grid(face, nU, nV)
# subdivide_face_split_rel(face, direction=(-1 or 0), split=(0 to 1))
# subdivide_face_split_rel_free_quad(face, indexEdge, split1, split2)
# subdivide_face_split_rel_multiple(face, direction, splits)
# subdivide_face_split_roof(face, height)

import mola
from mola import module_rhino
import random

new_mesh = mola.Mesh()

faces_layer = (len(mesh.faces)/h_subdivisions)
print(faces_layer)
face_amount = len(mesh.faces)

for i, face in enumerate(mesh.faces):
    # give faces thickness
    if i % 8 == 0:
        new_faces = mola.subdivide_face_extrude(face, height=1.0, capBottom=True, capTop=False)
        new_mesh.faces.extend(new_faces)

    # divide face into 4 faces to make a taper
    if i % 8 == 1:
        new_faces = mola.subdivide_face_extrude_tapered(face, height=3.5, fraction=0.7, doCap=False)
        new_mesh.faces.extend(new_faces)
    
    # make face extrude toward a certin point
    t = 1.5
    if i % 8 == 2:
        center_pt = face.center()
        # print(center_pt)
        x = center_pt.x - (t*i*0.2)
        y = center_pt.y + (t*i*0.12)
        z = center_pt.z
        vertex = mola.Vertex(x,y,z)
        new_faces = mola.subdivide_face_extrude_to_point(face, point=vertex)
        new_mesh.faces.extend(new_faces)
    
    # extrude face with a distance
    if i % 8 == 3:
        j = face_amount - i
        new_faces = mola.subdivide_face_extrude_to_point_center(face, height=0.6*j)
        new_mesh.faces.extend(new_faces)

    # split into grid
    if i % 8 == 4:
        new_faces = mola.subdivide_face_split_grid(face, nU=3, nV=5)
        new_mesh.faces.extend(new_faces)
    
    # split face in given direction and length
    if i % 8 == 5:
        direction = random.randint(-1,0)
        split = random.uniform(0,1)
        new_faces = mola.subdivide_face_split_rel(face, direction, split)
        new_mesh.faces.extend(new_faces)
    
    # Splits a quad in two new quads through the points specified by relative position along the edge.
    if i % 8 == 6:
        indexEdge = random.randint(0,1)
        split1 = random.uniform(0,1)
        split2 = random.uniform(0,1)
        new_faces = mola.subdivide_face_split_rel_free_quad(face, indexEdge, split1, split2)
        new_mesh.faces.extend(new_faces)
    
    # # split by certain parameterize value from edge
    # if i % 8 == 7:
    #     new_faces = mola.subdivide_face_split_rel_multiple(face, direction=0, splits=[0.1,0.3,0.7])
    #     new_mesh.faces.extend(new_faces)
    
    # Extrudes a pitched roof
    if i % 8 ==7:
        new_faces = mola.subdivide_face_split_roof(face, height=2.4)
        new_mesh.faces.extend(new_faces)

new_mesh.update_topology()
new_mesh_rhino = module_rhino.display_mesh(new_mesh)
# mola.subdivide_face_split_frame(face, w)
# ---------- end py3_10 ----------

number_slider_10 = Slider(5, range=0..10)  # disabled
number_slider_11 = Slider(-7, range=-10..10)  # disabled
# primitives
py3_11 = Python3Script(
    x=number_slider_10,
    y=number_slider_10,
    z=number_slider_10,
    x1=number_slider_11,
    y1=number_slider_11,
    z1=number_slider_11)  # -> out, my_mesh, my_mesh_rhino; disabled
# ---------- py3_11: Python ----------
import mola
from mola import module_rhino

my_mesh = mola.construct_box(x,y,z,x1,y1,z1)
my_mesh_rhino = module_rhino.display_mesh(my_mesh)
# ---------- end py3_11 ----------
number_slider_12 = Slider(3, range=0..10)  # disabled
# subdivision
py3_12 = Python3Script(mesh=py3_11.my_mesh, r=number_slider_12)  # -> out, new_mesh, my_mesh_rhino; inputs r: Int32; disabled
# ---------- py3_12: Python ----------
import mola
from mola import module_rhino

for i in range(r):
    new_mesh = mola.Mesh()
    for f in mesh.faces:
        resulting_face = mola.subdivide_face_extrude_to_point_center(f, -(i/2)) # direction: normal of surface
        new_mesh.faces.extend(resulting_face) # vertices, edges, faces
    mesh = new_mesh

new_mesh.update_topology()

my_mesh_rhino = module_rhino.display_mesh(new_mesh)
# ---------- end py3_12 ----------
py3_13 = Python3Script(mesh=py3_12.new_mesh)  # -> out, new_mesh, my_mesh_rhino; disabled
# ---------- py3_13: Python ----------
import mola
from mola import module_rhino

new_mesh = mesh
for i in range(2):
    new_mesh = mola.subdivide_mesh_catmull(new_mesh)

mola.color_faces_by_area(new_mesh.faces)
my_mesh_rhino = module_rhino.display_mesh(new_mesh)
# ---------- end py3_13 ----------

# ----
# subdivision
# group layer by layer
number_slider_13 = Slider(3, range=0..10)
py3_14 = Python3Script(mesh=py3_5.column_mesh, h_subdivisions=number_slider_4, extrusion=number_slider_13)  # -> new_mesh, new_mesh_rhino, center_pt; inputs h_subdivisions: Int32, extrusion: Double
# ---------- py3_14: Python ----------
# subdivide_custom_triface_extrude_tapered_nonU(face, height=0.0, fraction=0.5, doCap=True)
# subdivide_face_extrude(face, height=0.0, capBottom=False, capTop=True)
# subdivide_face_extrude_tapered(face, height=0.0, fraction=0.5, doCap=True)
# subdivide_face_extrude_to_point(face, point)
# subdivide_face_extrude_to_point_center(face, height=0.0)
# subdivide_face_offset_planar(face, offsets)
# subdivide_face_split_frame(face, w)
# subdivide_face_split_grid(face, nU, nV)
# subdivide_face_split_offset(face, offset)
# subdivide_face_split_offsets(face, offsets)
# subdivide_face_split_grid(face, nU, nV)
# subdivide_face_split_rel(face, direction=(-1 or 0), split=(0 to 1))
# subdivide_face_split_rel_free_quad(face, indexEdge, split1, split2)
# subdivide_face_split_rel_multiple(face, direction, splits)
# subdivide_face_split_roof(face, height)

import mola
from mola import module_rhino
import random

new_mesh = mola.Mesh()

faces_layer = (len(mesh.faces)/h_subdivisions)
print(faces_layer)
face_amount = len(mesh.faces)
print(face_amount)

for h in range(h_subdivisions):
    for i, face in enumerate(mesh.faces):
        if h * faces_layer <= i < (h+1) * faces_layer:
            face.group = h

for i, face in enumerate(mesh.faces):
    # give faces thickness
    # if i % 8 == 0:
    if face.group == 0: 
        new_faces = mola.subdivide_face_extrude(face, height=1.0, capBottom=True, capTop=False)
        new_mesh.faces.extend(new_faces)

    # divide face into 4 faces to make a taper
    # if i % 8 == 1:
    if face.group == 1:
        new_faces = mola.subdivide_face_extrude_tapered(face, height=3.5, fraction=0.7, doCap=False)
        new_mesh.faces.extend(new_faces)
    
    # make face extrude toward a certin point
    t = 1.5
    # if i % 8 == 2:
    if face.group == 2:
        center_pt = face.center()
        # print(center_pt)
        x = center_pt.x - (t*i*0.2)
        y = center_pt.y + (t*i*0.12)
        z = center_pt.z
        vertex = mola.Vertex(x,y,z)
        new_faces = mola.subdivide_face_extrude_to_point(face, point=vertex)
        new_mesh.faces.extend(new_faces)
    
    # extrude face with a distance
    # if i % 8 == 3:
    if face.group == 3:
        j = face_amount - i
        new_faces = mola.subdivide_face_extrude_to_point_center(face, height=0.45*j)
        new_mesh.faces.extend(new_faces)

    # split into grid
    # if i % 8 == 4:
    if face.group == 4:
        new_faces = mola.subdivide_face_split_grid(face, nU=3, nV=5)
        new_mesh.faces.extend(new_faces)
    
    # split face in given direction and length
    # if i % 8 == 5:
    if face.group == 5:
        direction = random.randint(-1,0)
        split = random.uniform(0,1)
        new_faces = mola.subdivide_face_split_rel(face, direction, split)
        new_mesh.faces.extend(new_faces)
    
    # Splits a quad in two new quads through the points specified by relative position along the edge.
    # if i % 8 == 6:
    if face.group == 6:
        indexEdge = random.randint(0,1)
        split1 = random.uniform(0,1)
        split2 = random.uniform(0,1)
        new_faces = mola.subdivide_face_split_rel_free_quad(face, indexEdge, split1, split2)
        new_mesh.faces.extend(new_faces)
    
    # Extrudes a pitched roof
    # if i % 8 ==7:
    if face.group == 7:
        new_faces = mola.subdivide_face_split_roof(face, height=2.4)
        new_mesh.faces.extend(new_faces)

new_mesh.update_topology()
new_mesh_rhino = module_rhino.display_mesh(new_mesh)
# mola.subdivide_face_split_frame(face, w)
# ---------- end py3_14 ----------

number_slider_14 = Slider(5, range=0..10)  # disabled
py3_15 = Python3Script(mesh=py3_5.column_mesh, list_points=geo_10, extrusion=number_slider_14)  # -> my_rhino_mesh, new_mesh; inputs list_points: Point3d, extrusion: Double; disabled
# ---------- py3_15: Python ----------
import mola
from mola import module_rhino

new_mesh = mola.Mesh()

 
for i, face in enumerate(mesh.faces):
    if i <= 7:
        new_faces = mola.subdivide_face_extrude_tapered(face,extrusion, 0.5, True)
        print(new_faces)
        for f in new_faces:
            f.group = 0
        new_mesh.faces.extend(new_faces)
    else:
        face.group = 2
        new_mesh.faces.append(face)

new_mesh.update_topology()
my_rhino_mesh = module_rhino.display_mesh(new_mesh)
# ---------- end py3_15 ----------
number_slider_15 = Slider(2, range=0..10)  # disabled
py3_16 = Python3Script(mesh=py3_15.new_mesh, extrusion=number_slider_15)  # -> my_rhino_mesh; disabled
# ---------- py3_16: Python ----------
import mola
from mola import module_rhino

new_mesh = mola.Mesh()

for face in mesh.faces:
    if face.group == 2:
        new_faces = mola.subdivide_face_extrude_tapered(face, -extrusion, 0.8, False)
        new_mesh.faces.extend(new_faces)
    else:
        new_mesh.faces.append(face)

new_mesh.update_topology()
new_mesh = mola.mesh_offset(new_mesh,0.2) # thickness

my_rhino_mesh = module_rhino.display_mesh(new_mesh)
# ---------- end py3_16 ----------

py3_17 = Python3Script(mesh=py3.column_mesh, h_subdivisions=number_slider, extrusion=Slider(3, range=0..10))  # -> new_mesh, new_mesh_rhino; inputs h_subdivisions: Int32, extrusion: Double
# ---------- py3_17: Python ----------
# subdivide_custom_triface_extrude_tapered_nonU
import mola
from mola import module_rhino

new_mesh = mola.Mesh()

faces_layer = (len(mesh.faces)/h_subdivisions)
print(faces_layer)
for i, face in enumerate(mesh.faces):
    # if (faces_layer * 1) - 1 < i < faces_layer * 2:
    #     new_faces = mola.subdivide_face_extrude_tapered(face, extrusion, 0.75, True)
    #     for f in new_faces:
    #         f.group = 0
    #     new_mesh.faces.extend(new_faces)
    # else:
    #     face.group = 1
    #     new_faces = mola.subdivide_face_extrude_tapered(face, -extrusion, 0.6, False)
    #     new_mesh.faces.extend(new_faces)
    if i % 3 == 0:
        new_faces = mola.subdivide_face_extrude_tapered(face, extrusion, 0.5, False)
        new_mesh.faces.extend(new_faces)
    if i % 3 == 1:
        new_faces = mola.subdivide_face_extrude_tapered(face, -extrusion/2, 0.7, False)
        new_mesh.faces.extend(new_faces)
    else:
        new_faces = mola.subdivide_face_extrude_tapered(face, -extrusion, 0.9, True)
        new_mesh.faces.extend(new_faces)
        print(new_faces)

new_mesh.update_topology()
new_mesh_rhino = module_rhino.display_mesh(new_mesh)
# ---------- end py3_17 ----------

# ----
# Fabergé egg
number_slider_16 = Slider(5, range=0..10)  # disabled
py3_18 = Python3Script(r=number_slider_16)  # -> out, new_mesh, my_mesh_rhino; inputs r: Int32; disabled
# ---------- py3_18: Python ----------
import mola
from mola import module_rhino

my_mesh = mola.construct_sphere(r,3,3)

for v in my_mesh.vertices:
    if v.z>0:
        v.z *= 1.5

my_mesh = mola.subdivide_mesh_catmull(my_mesh)

my_properties = my_mesh.face_properties(mola.face_center_z)


mola.color_faces_by_vertical_angle(my_mesh.faces)

heights = mola.math_map_list(my_properties, 0.0, 2.0) # value, min=0, max=1

new_mesh = mola.Mesh()
for i, f in enumerate(my_mesh.faces):
    if heights[i] > 0.5:
        doCap = False
    else: 
        doCap = True
    resulting_faces = mola.subdivide_face_extrude_tapered(f, heights[i], 0.6, doCap)
    new_mesh.faces.extend(resulting_faces)

new_mesh.update_topology()
new_mesh = mola.mesh_offset(new_mesh,0.2) # thickness

for i in range(1):
    new_mesh = mola.subdivide_mesh_catmull(new_mesh)

props = new_mesh.face_properties(mola.face_center_z)
color_scheme = [(0,0,1),(1,0,1), (0.5,0.5,0.5), (1,1,1)]
colors = mola.color_map(props , color_scheme)
mola.color_faces_by_map(new_mesh.faces,colors)


new_mesh.update_topology()
my_mesh_rhino = module_rhino.display_mesh(new_mesh)
# ---------- end py3_18 ----------
geo_15 = Geometry(py3_18.my_mesh_rhino)  # disabled

# ----
# Fabergé egg_explanation
number_slider_17 = Slider(5, range=0..10)  # disabled
py3_19 = Python3Script(r=number_slider_17)  # -> out, new_mesh, my_mesh_rhino; inputs r: Int32; disabled
# ---------- py3_19: Python ----------
# 建立球體 → 調整高度 → 細分 → 擷取面屬性 → 根據高度擠出錐形面 → 加厚 → 再次細分 → 上色 → 匯出到 Rhino。

import mola
from mola import module_rhino

my_mesh = mola.construct_sphere(r,3,3)
# create a sphere (radius = r, u = 3, v = 3)
# v 是「經緯線的分割數量」，也就是球面細分的密度（非尺寸或網格數量，而是球的分段數）
# u 越大 → 經度方向（橫向）分段越多
# v 越大 → 緯度方向（縱向）分段越多

for v in my_mesh.vertices:
    if v.z>0:
        v.z *= 1.5
# if vertices are higher than the world plane (z>0), raise them to 1.5 times
# 這會讓球上半部被垂直拉長，下半部保持不變，造成“蛋形”效果

my_mesh = mola.subdivide_mesh_catmull(my_mesh)
# use Catmull–Clark subdivision to smooth the mesh
# 這會增加面數並讓幾何更平滑，「光滑化」演算法

my_properties = my_mesh.face_properties(mola.face_center_z)
# extract z-value of each face's center
# 這會回傳一個 list，包含每個面中心的 z 座標

mola.color_faces_by_vertical_angle(my_mesh.faces)
# add color to faces based on their vertical angle
# 根據法向量與垂直方向的角度上色
# 可視化幾何的「傾斜程度」

heights = mola.math_map_list(my_properties, 0.0, 2.0) # value, min=0, max=1
# map face z-values to range 0–2
# 這裡的參數應為「目標範圍」
# 若原始 z 值為 0–1，會映射成 0–2；但若超出範圍，結果可能失真

new_mesh = mola.Mesh()
for i, f in enumerate(my_mesh.faces): # cap
    if heights[i] > 0.5:
        doCap = False
    else: 
        doCap = True
    resulting_faces = mola.subdivide_face_extrude_tapered(f, heights[i], 0.6, doCap)
    new_mesh.faces.extend(resulting_faces)
# extrude faces with taper; faces above certain height are open
# 「Faces whose height > 0.5 are open, others (below 0.5) are capped」
# 開關面比例取決於 height 值的分佈

new_mesh.update_topology()
new_mesh = mola.mesh_offset(new_mesh,0.2) # thickness
# update connectivity and give mesh thickness of 0.2
# 產生內外表面，適合製作可 3D 列印的實體形狀

for i in range(1):
    new_mesh = mola.subdivide_mesh_catmull(new_mesh)
# 雖然只執行一次，但這種寫法方便調整細分次數（例如 range(2), range(3)...）
# 讓模型更平滑，或在需要時重複細分

props = new_mesh.face_properties(mola.face_center_z)
color_scheme = [(0,0,1),(1,0,1), (0.5,0.5,0.5), (1,1,1)]
colors = mola.color_map(props , color_scheme)
mola.color_faces_by_map(new_mesh.faces,colors)
# map color according to face center's z value
# color_map 會根據 props（z 高度）對應到 color_scheme 中的顏色梯度
# 顏色依高度漸變

new_mesh.update_topology()
my_mesh_rhino = module_rhino.display_mesh(new_mesh)
# update again to refresh color data
# display the mesh in Rhino environment
# ---------- end py3_19 ----------
geo_16 = Geometry(py3_19.my_mesh_rhino)  # disabled
