# Grasshopper definition 103_primitives_and_subdivisions_ex.ghx (Grasshopper 1.0.8)

curve = Curve(<curve referenced from the Rhino model>)
py3 = Python3Script(mola_path="C:\\Users\\Juste\\Documents\\_GitHub")  # -> out, a; inputs mola_path: String
# ---------- py3: Python ----------
import sys

if mola_path not in sys.path:
    sys.path.append(mola_path)

print (sys.path)

try:
    import mola
    from mola import module_rhino
except ImportError as e:
    print("Error Importing mola: (e)")
# ---------- end py3 ----------
python_3_script = Python3Script(
    curve=curve,
    num_sides=Slider(10, range=0..10),
    radius=Slider(10, range=0..10),
    total_height=Slider(105, range=0..600),
    h_subdivisions=Slider(1, range=0..30))  # -> out, column_mesh, list_points, new_pts, column_mesh_rhino; inputs curve: Polyline, num_sides: Int32, radius: Int32, total_height: Int32, h_subdivisions: Int32
# ---------- python_3_script: Python ----------
import mola
from mola import module_rhino
import math
import Rhino.Geometry as rg

def points_on_crv(curve):
    list_of_points = []
    for p in curve:
        pt = rg.Point3d(p)
        list_of_points.append(pt)
    return list_of_points

def points_on_polygon(num_sides, radius):   # def texture per math function
    list_of_points = []
    theta = (2*math.pi)/num_sides
    for i in range(num_sides):
        angle = i * theta
        x = radius * math.cos(angle)
        y = radius * math.sin(angle)
        z = 0
        pt = rg.Point3d(x,y,z)
        list_of_points.append(pt)
    return list_of_points


if curve is not None:
    list_points = points_on_crv(curve)

else:
    list_points = points_on_polygon(num_sides, radius)



column_mesh = mola.Mesh()

new_pts = []

for layer_no in range (h_subdivisions +1):
    z= total_height/h_subdivisions * layer_no
    for p in list_points:
        pt = rg.Point3d(p)
        pt[2] = z
        new_pts.append (pt)
        column_mesh.add_vertex(pt[0],pt[1], pt[2])

points_per_layer = len(list_points)

for layer_no in range (h_subdivisions):
    current_layer = layer_no * points_per_layer
    next_layer = (layer_no + 1) * points_per_layer
    for i in range (points_per_layer-1):
        next_i = (i+1) % points_per_layer

        v0 = column_mesh.vertices[current_layer + i]
        v1 = column_mesh.vertices[current_layer + next_i]
        v2 = column_mesh.vertices[next_layer + next_i]
        v3 = column_mesh.vertices[next_layer + i]

        column_mesh.add_face([v0,v1,v2,v3])

column_mesh.update_topology()
column_mesh_rhino = module_rhino.display_mesh(column_mesh)
# ---------- end python_3_script ----------
geometry = Geometry(python_3_script.column_mesh_rhino)
geometry_2 = Geometry(python_3_script.list_points)
python_3_script_2 = Python3Script(mesh=python_3_script.column_mesh, extrusion=Slider(4.513, range=0..10))  # -> out, new_mesh, my_rhino_mesh; inputs extrusion: Double
# ---------- python_3_script_2: Python ----------
import mola
from mola import module_rhino

new_mesh = mola.Mesh()

for i, face in enumerate (mesh.faces):
    if i % 2 ==0:
        
        new_faces = mola.subdivide_face_extrude_tapered(face, extrusion, 0.5, True)
        for f in new_faces:
            f.group = 0

        new_mesh.faces.extend(new_faces)

    else:
        face.group = 2
        new_mesh.faces.append(face)

new_mesh.update_topology()
my_rhino_mesh = module_rhino.display_mesh(new_mesh)
# ---------- end python_3_script_2 ----------
python_3_script_3 = Python3Script(mesh=python_3_script_2.new_mesh, extrusion=Slider(9.583, range=0..10))  # -> out, new_mesh, my_rhino_mesh
# ---------- python_3_script_3: Python ----------
import mola

from mola import module_rhino

new_mesh = mola.Mesh()

for face in mesh.faces:
    if face.group == 0:
        new_faces = mola.subdivide_face_extrude_tapered(face, extrusion, .8, False)
        new_mesh.faces.extend(new_faces)
    else:
        new_mesh.faces.append(face)


new_mesh.update_topology()
my_rhino_mesh = module_rhino.display_mesh(new_mesh)
# ---------- end python_3_script_3 ----------
