# Grasshopper definition 202_grid_sharon.gh (Grasshopper 1.0.8)
# plug-ins: MeshEdit Components, Weaverbird

# ----
# grid
number_slider = Slider(4, range=0..10)
number_slider_2 = Slider(10, range=0..10)
py3 = Python3Script(nU=Slider(5, range=0..10), nV=Slider(4, range=0..10), sizeX=number_slider_2, sizeY=number_slider_2)  # -> out, grid_mesh, grid_mesh_rhino, points, list_pts; inputs nU: Int32, nV: Int32, sizeX: Double, sizeY: Double
# ---------- py3: Python ----------
import mola
from mola import module_rhino
from compas.geometry import Point, Vector

def build_rect_mesh(nU, nV, sizeX, sizeY, z_func=None):
    mesh = mola.Mesh()
    pts = []
    for j in range(nV):
        for i in range(nU):
            x = i * sizeX / (nU - 1)
            y = j * sizeY / (nV - 1)
            z = z_func(i, j) if z_func else 0
            mesh.add_vertex(x, y, z)
    for j in range(nV - 1):
        for i in range(nU - 1):
            v0 = j * nU + i
            v1 = v0 + 1
            v2 = v0 + nU + 1
            v3 = v0 + nU
            mesh.add_face([v0, v1, v2, v3])
    mesh.update_topology()
    mesh_rhino = module_rhino.display_mesh(grid_mesh)
    return mesh, mesh_rhino

grid_mesh = build_rect_mesh(nU, nV, sizeX, sizeY)
# ---------- end py3 ----------
mesh = Mesh(py3.grid_mesh_rhino)
draw = COMPASDraw(cg=py3.points)  # -> rg
#   port cg: The COMPAS geometry or datastructure to be drawn.
#   port rg: The Rhino geometry object.
# ---------- draw: Python ----------
# r: compas>=2.14.1
"""
Draws COMPAS geometry in Grasshopper.
"""

from typing import Any

import Grasshopper

from compas.scene import SceneObject


class CompasToRhinoGeometry(Grasshopper.Kernel.GH_ScriptInstance):
    def RunScript(self, cg):
        if not cg:
            return None

        return SceneObject(item=cg).draw()
# ---------- end draw ----------
draw_2 = COMPASDraw(cg=py3.list_pts)  # -> rg; same code as draw

# ----
# grid
number_slider_3 = Slider(4, range=0..10)
number_slider_4 = Slider(10, range=0..10)
py3_2 = Python3Script(nU=Slider(5, range=0..10), nV=Slider(4, range=0..10), sizeX=number_slider_4, sizeY=number_slider_4)  # -> out, grid_mesh, grid_mesh_rhino, points, list_pts; inputs nU: Int32, nV: Int32, sizeX: Double, sizeY: Double
# ---------- py3_2: Python ----------
import mola
from mola import module_rhino
from compas.geometry import Point, Translation, Vector

grid = mola.Grid(nx=nU, ny=nV)
grid_mesh = mola.Mesh()
points = []

# build point matrix
for j in range(nV):
    for i in range(nU):
        x = i * sizeX / (nU - 1)
        y = j * sizeY / (nV - 1)
        pt = Point(x, y, 0)
        points.append(pt)

# move interior points
list_pts = []
for j in range(nV):
    for i in range(nU):
        idx = j * nU + i
        pt = points[idx]

        # determine interior points（exclude boundary points）
        if 0 < i < nU - 1 and 0 < j < nV - 1:
            moved_pt = pt.translated(Vector(1, 1, 0))
            list_pts.append(moved_pt)
        else:
            list_pts.append(pt)




# # build 4-edged surface
# for y in range(nV - 1):
#     for x in range(nU - 1):
#         i0 = grid.get_index(x, y)
#         i1 = grid.get_index(x + 1, y)
#         i2 = grid.get_index(x + 1, y + 1)
#         i3 = grid.get_index(x, y + 1)
#         grid_mesh.add_face([
#             grid_mesh.vertices[i0],
#             grid_mesh.vertices[i1],
#             grid_mesh.vertices[i2],
#             grid_mesh.vertices[i3]
#         ])

# grid_mesh.update_topology()
# grid_mesh_rhino = module_rhino.display_mesh(grid_mesh)
# ---------- end py3_2 ----------
draw_3 = COMPASDraw(cg=py3_2.points)  # -> rg; same code as draw
draw_4 = COMPASDraw(cg=py3_2.list_pts)  # -> rg; same code as draw
mesh_2 = Mesh(py3_2.grid_mesh_rhino)

# ----
# grid
number_slider_5 = Slider(5, range=0..10)
number_slider_6 = Slider(10, range=0..10)
py3_3 = Python3Script(nU=number_slider_5, nV=Slider(4, range=0..10), sizeX=number_slider_6, sizeY=number_slider_6)  # -> out, grid_mesh, grid_mesh_rhino, points, list_pts; inputs nU: Int32, nV: Int32, sizeX: Double, sizeY: Double
# ---------- py3_3: Python ----------
import mola
from mola import module_rhino
from compas.geometry import Point, Translation, Vector

grid = mola.Grid(nx=nU, ny=nV)
grid_mesh = mola.Mesh()
points = []

# build point matrix
for j in range(nV):
    for i in range(nU):
        x = i * sizeX / (nU - 1)
        y = j * sizeY / (nV - 1)
        pt = Point(x, y, 0)
        points.append(pt)

# move interior points
list_pts = []
for j in range(nV):
    for i in range(nU):
        idx = j * nU + i
        pt = points[idx]

        # determine interior points（exclude boundary points）
        if 0 < i < nU - 1 and 0 < j < nV - 1:
            moved_pt = pt.translated(Vector(0, 0, 0))
            list_pts.append(moved_pt)
        else:
            list_pts.append(pt)
for p in list_pts:

    grid_mesh.add_vertex(*p)

# for i, p in enumerate(list_pts):
#     if i < len(list_pts) - nU:
#         current_layer = i
#         next_layer = i + nU
#         grid_mesh.add_face([
#             grid_mesh.vertices[current_layer],
#             grid_mesh.vertices[current_layer + 1],
#             grid_mesh.vertices[next_layer + 1],
#             grid_mesh.vertices[next_layer]
#         ])

# build 4-edged surface
for y in range(nV - 1):
    for x in range(nU - 1):
        idx = y * nU + x
        v0 = grid_mesh.vertices[idx]
        v1 = grid_mesh.vertices[idx + 1]
        v2 = grid_mesh.vertices[idx + 1 + nU]
        v3 = grid_mesh.vertices[idx + nU]
        grid_mesh.add_face([v0, v1, v2, v3])

grid_mesh.update_topology()
grid_mesh_rhino = module_rhino.display_mesh(grid_mesh)
# ---------- end py3_3 ----------
draw_5 = COMPASDraw(cg=py3_3.points)  # -> rg; same code as draw
draw_6 = COMPASDraw(cg=py3_3.list_pts)  # -> rg; same code as draw
mesh_3 = Mesh(py3_3.grid_mesh_rhino)

# ----
# grid
number_slider_7 = Slider(4, range=0..10)
number_slider_8 = Slider(10, range=0..10)
py3_4 = Python3Script(col=Slider(5, range=0..10), row=Slider(4, range=0..10), sizeX=number_slider_8, sizeY=number_slider_8)  # -> out, grid_mesh, grid_mesh_rhino, points, list_pts; inputs col: Int32, row: Int32, sizeX: Double, sizeY: Double
# ---------- py3_4: Python ----------
import mola
from mola import module_rhino
from compas.geometry import Point, Vector

grid_mesh = mola.Mesh()
points = []

# --- build point matrix ---
for j in range(row):
    for i in range(col):
        x = i * sizeX / (col - 1)
        y = j * sizeY / (row - 1)
        pt = Point(x, y, 0)
        points.append(pt)

# --- move interior points ---
list_pts = []
for j in range(row):
    for i in range(col):
        idx = j * col + i
        pt = points[idx]

        if 0 < i < col - 1 and 0 < j < row - 1:
            moved_pt = pt.translated(Vector(0, 0, 0))
            list_pts.append(moved_pt)
        else:
            list_pts.append(pt)


# --- add vertices to mesh ---
for p in list_pts:
    pt = mola.Vertex(p)
    grid_mesh.add_vertex(pt.x, pt.y, pt.z)

for num_row in range(row - 1):
    current_layer = num_row * col
    next_layer = (num_row + 1) * col
    for i in range(col - 1):
        next_i = (i+1) % (col - 1)

        v0 = grid_mesh.vertices[current_layer + i]
        v1 = grid_mesh.vertices[current_layer + next_i]
        v2 = grid_mesh.vertices[next_layer + next_i]
        v3 = grid_mesh.vertices[next_layer + i]
        grid_mesh.add_face([v0, v1, v2, v3])

# --- renew & display ---
grid_mesh.update_topology()
grid_mesh_rhino = module_rhino.display_mesh(grid_mesh)
# ---------- end py3_4 ----------
draw_7 = COMPASDraw(cg=py3_4.points)  # -> rg; same code as draw
draw_8 = COMPASDraw(cg=py3_4.list_pts)  # -> rg; same code as draw
mesh_4 = Mesh(py3_4.grid_mesh_rhino)

# ----
# grid
number_slider_9 = Slider(4, range=0..10)
number_slider_10 = Slider(10, range=0..10)
py3_5 = Python3Script(nU=Slider(5, range=0..10), nV=Slider(4, range=0..10), sizeX=number_slider_10, sizeY=number_slider_10)  # -> out, grid_mesh, grid_mesh_rhino, points, list_pts; inputs nU: Int32, nV: Int32, sizeX: Double, sizeY: Double
# ---------- py3_5: Python ----------
import mola
from mola import module_rhino
from compas.geometry import Point, Vector

grid_mesh = mola.Mesh()
points = []

# --- build point matrix ---
for j in range(nV):
    for i in range(nU):
        x = i * sizeX / (nU - 1)
        y = j * sizeY / (nV - 1)
        pt = Point(x, y, 0)
        points.append(pt)

# --- move interior points ---
list_pts = []
for j in range(nV):
    for i in range(nU):
        idx = j * nU + i
        pt = points[idx]

        if 0 < i < nU - 1 and 0 < j < nV - 1:
            moved_pt = pt.translated(Vector(0, 0, 0))
            list_pts.append(moved_pt)
        else:
            list_pts.append(pt)

# --- add vertices to mesh ---
for p in list_pts:
    grid_mesh.add_vertex(*p)

# --- generate faces ---
for j in range(nV - 1):        # row
    for i in range(nU - 1):    # column
        v0 = j * nU + i
        v1 = v0 + 1
        v2 = v0 + nU + 1
        v3 = v0 + nU
        grid_mesh.add_face([v0, v1, v2, v3])

# --- renew & display ---
grid_mesh.update_topology()
grid_mesh_rhino = module_rhino.display_mesh(grid_mesh)
# ---------- end py3_5 ----------
draw_9 = COMPASDraw(cg=py3_5.points)  # -> rg; same code as draw
mesh_5 = Mesh(py3_5.grid_mesh_rhino)
draw_10 = COMPASDraw(cg=py3_5.list_pts)  # -> rg; same code as draw

# ----
# grid
number_slider_11 = Slider(10, range=0..10)
number_slider_12 = Slider(4, range=0..10)
py3_6 = Python3Script(nU=number_slider_12, nV=number_slider_12, sizeX=number_slider_11, sizeY=number_slider_11)  # -> out, grid_mesh, grid_mesh_rhino, points; inputs nU: Int32, nV: Int32, sizeX: Double, sizeY: Double
# ---------- py3_6: Python ----------
import mola
from mola import module_rhino
from compas.geometry import Point

grid = mola.Grid(nx=nU, ny=nV)
grid_mesh = mola.Mesh()
points = []

# build vertices
for i in range(nU * nV):
    x = grid.get_x(i) * sizeX / (nU-1) 
    y = grid.get_y(i) * sizeY / (nV-1) 
    # pt = Point(x,y,0)
    # points.append(pt)
    v = grid_mesh.add_vertex(x, y, 0)



# build 4-edged surface
for y in range(nV - 1):
    for x in range(nU - 1):
        i0 = grid.get_index(x, y)
        i1 = grid.get_index(x + 1, y)
        i2 = grid.get_index(x + 1, y + 1)
        i3 = grid.get_index(x, y + 1)
        grid_mesh.add_face([
            grid_mesh.vertices[i0],
            grid_mesh.vertices[i1],
            grid_mesh.vertices[i2],
            grid_mesh.vertices[i3]
        ])

grid_mesh.update_topology()
grid_mesh_rhino = module_rhino.display_mesh(grid_mesh)
# ---------- end py3_6 ----------

# ---- group: primitive grid
py3_7 = Python3Script()  # -> out, a
# ---------- py3_7: Python ----------
import mola
from mola import module_rhino

rows = 6
cols = 4
grid_mesh = mola.Mesh()
for i in range(rows):
    y = i * 5
    for j in range(cols):
        x = j * 5
        grid_mesh.add_vertex(x, y, 0)

for i in range(rows-1):
    for j in range(cols-1):
        idx = i * cols + j
        v0 = grid_mesh.vertices[idx]
        v1 = grid_mesh.vertices[idx + 1]
        v2 = grid_mesh.vertices[idx + 1 + cols]
        v3 = grid_mesh.vertices[idx + cols]
        grid_mesh.add_face([v0,v1,v2,v3])
grid_mesh.update_topology()

a = mola.module_rhino.display_mesh(grid_mesh)
# ---------- end py3_7 ----------

# ----
number_slider_13 = Slider(50, range=0..100)
number_slider_14 = Slider(5, range=0..50)
number_slider_15 = Slider(10, range=0..10)

# ----
# grid
number_slider_16 = Slider(10, range=0..10)
number_slider_17 = Slider(3, range=0..10)
py3_8 = Python3Script(nU=number_slider_17, nV=number_slider_17, sizeX=number_slider_16, sizeY=number_slider_16)  # -> out, grid_mesh, grid_mesh_rhino; inputs nU: Int32, nV: Int32, sizeX: Double, sizeY: Double
# ---------- py3_8: Python ----------
import mola
from mola import module_rhino
import math

grid = mola.Grid(nx=nU, ny=nV)
grid_mesh = mola.Mesh()

# build vertices
for i in range(nU * nV):
    x = grid.get_x(i) / (nU - 1) * sizeX
    y = grid.get_y(i) / (nV - 1) * sizeY
    v = grid_mesh.add_vertex(x, y, 0)

# build 4-edged surface
for y in range(nV - 1):
    for x in range(nU - 1):
        i0 = grid.get_index(x, y)
        i1 = grid.get_index(x + 1, y)
        i2 = grid.get_index(x + 1, y + 1)
        i3 = grid.get_index(x, y + 1)
        grid_mesh.add_face([
            grid_mesh.vertices[i0],
            grid_mesh.vertices[i1],
            grid_mesh.vertices[i2],
            grid_mesh.vertices[i3]
        ])

# === center point + control point to make shape transform ===
cx, cy, cz = sizeX * 0.4, sizeY * 0.6, 0
strength = 0.3

for face in grid_mesh.faces:
    cx_face = sum([v.x for v in face.vertices]) / len(face.vertices)
    cy_face = sum([v.y for v in face.vertices]) / len(face.vertices)
    
    dx = cx_face - cx
    dy = cy_face - cy
    dist = math.sqrt(dx**2 + dy**2)
    influence = math.exp(-dist * 2.0)
    
    for v in face.vertices:
        v.x += dx * strength * influence
        v.y += dy * strength * influence

grid_mesh.update_topology()
grid_mesh_rhino = module_rhino.display_mesh(grid_mesh)
# ---------- end py3_8 ----------

py3_9 = Python3Script()  # -> out, a
# ---------- py3_9: Python ----------
# class Grid(nx, ny, nz=1, values=None, scale_to_canvas=False)

import mola
from mola import module_rhino

primitive_grid = mola.Grid(nx=2, ny=2, nz=1)

my_grid = primitive_grid
# my_grid.update_topology()
# my_grid_rhino = module_rhino.display_grid(my_grid)
# ---------- end py3_9 ----------
xy = XYPlane(Origin=Point(0, 0, 0))
xy_2 = XYPlane(Origin=Point(0, 0, 0))
py3_10 = Python3Script(mola_path="C:\Users\user\github")  # -> out, a; inputs mola_path: String
# ---------- py3_10: Python ----------
import sys

if mola_path not in sys.path:
    sys.path.append(mola_path)

print(sys.path)

try:
    import mola
    from mola import module_rhino
except ImportError as e:
    print("Error importing mola: {e}")
# ---------- end py3_10 ----------

# ---- group: quad transform
py3_11 = Python3Script()  # -> out, a
# ---------- py3_11: Python ----------
import mola
from mola import module_rhino

rows = 4
cols = 4
grid_mesh = mola.Mesh()
for i in range(rows):
    y = i * 5
    for j in range(cols):
        x = j * 5
        grid_mesh.add_vertex(x, y, 0)

# move vertices
new_mesh = mola.Mesh()
for ix in range(cols):
    for iy in range(rows):
        idx = ix * cols + iy
        ver = grid_mesh.vertices[idx]
        # select interior vertices
        if 0 < ix < cols - 1 and 0 < iy < rows - 1:
            # moved_ver = ver.translate(3, 3, 0)
            moved_ver = mola.Vertex(ver.x + 3, ver.y + 3, ver.z)
            new_mesh.add_vertex(moved_ver.x, moved_ver.y, moved_ver.z)
        else:
            new_mesh.add_vertex(ver.x, ver.y, ver.z)

for i in range(rows-1):
    for j in range(cols-1):
        idx = i * cols + j
        v0 = new_mesh.vertices[idx]
        v1 = new_mesh.vertices[idx + 1]
        v2 = new_mesh.vertices[idx + 1 + cols]
        v3 = new_mesh.vertices[idx + cols]
        new_mesh.add_face([v0,v1,v2,v3])
new_mesh.update_topology()

a = mola.module_rhino.display_mesh(new_mesh)
# ---------- end py3_11 ----------

# ----
recgrid = Rectangular(Plane=xy, SizeX=number_slider_15, SizeY=number_slider_15, ExtentX=number_slider_14, ExtentY=number_slider_14)  # -> flatten(Cells), Points
rectangle = Rectangle(Plane=xy_2, XSize=number_slider_13, YSize=number_slider_13, Radius=0)  # -> Rectangle, Length

explode = MeshExplode(Mesh=mesh_3, Interpolate=False)
item = ListItem(List=explode, Index=Slider(7, range=0..100), Wrap=True)

# ----
# thickness?
number_slider_18 = Slider(3, range=0..10)
py3_12 = Python3Script(curve=rectangle.Rectangle, nU=Slider(2, range=0..10), nV=number_slider_18)  # -> out, grid_mesh, grid_mesh_rhino; inputs curve: Polyline, nU: Int32, nV: Int32
# ---------- py3_12: Python ----------
import mola 
from mola import module_rhino
import Rhino.Geometry as rg
import math

# grid resolution
nU = 10
nV = 6
grid = mola.Grid(nx=nU, ny=nV, nz=1)

def functionIn(i):
    x = grid.get_x(i)
    y = grid.get_y(i)
    z = 0
    return [x, y, z]

def functionOut(i):
    return functionIn(i)

# build quad mesh
grid_mesh = grid.quad_mesh(functionIn, functionOut)
grid_mesh.update_topology()
grid_mesh_rhino = module_rhino.display_mesh(grid_mesh)
# ---------- end py3_12 ----------

number_slider_19 = Slider(5, range=0..10)
number_slider_20 = Slider(4, range=0..10)
points = PointList(Points=draw_8, Size=Slider(1.5, range=0..10))

# ---- group: extract parameters
py3_13 = Python3Script(cols=Slider(5, range=0..10), rows=Slider(3, range=0..10))  # -> out, a; inputs cols: Int32, rows: Int32
# ---------- py3_13: Python ----------
import mola
from mola import module_rhino

# rows = 4
# cols = 4
grid_mesh = mola.Mesh()
for i in range(rows):
    x = i * 5
    for j in range(cols):
        y = j * 5
        grid_mesh.add_vertex(y, x, 0)

# move vertices
new_mesh = mola.Mesh()
for ix in range(cols):
    for iy in range(rows):
        idx = ix * cols + iy
        ver = grid_mesh.vertices[idx]
        # select interior vertices
        if 0 < ix < cols - 1 and 0 < iy < rows - 1:
            # moved_ver = ver.translate(3, 3, 0)
            moved_ver = mola.Vertex(ver.x + 3, ver.y + 3, ver.z)
            new_mesh.add_vertex(moved_ver.x, moved_ver.y, moved_ver.z)
        else:
            new_mesh.add_vertex(ver.x, ver.y, ver.z)

for i in range(rows-1):
    for j in range(cols-1):
        idx = i * cols + j
        v0 = new_mesh.vertices[idx]
        v1 = new_mesh.vertices[idx + 1]
        v2 = new_mesh.vertices[idx + 1 + cols]
        v3 = new_mesh.vertices[idx + cols]
        new_mesh.add_face([v0,v1,v2,v3])
new_mesh.update_topology()

a = mola.module_rhino.display_mesh(new_mesh)
# ---------- end py3_13 ----------

# ----
points_2 = PointList(Points=draw_5, Size=Slider(1.5, range=0..10))

# ---- group: extract parameters
py3_14 = Python3Script(cols=Slider(5, range=0..10), rows=Slider(3, range=0..10), scale=Slider(5, range=0..10))  # -> out, a; inputs cols: Int32, rows: Int32, scale: Double
# ---------- py3_14: Python ----------
import mola
from mola import module_rhino

grid_mesh = mola.Mesh()
for i in range(rows):
    for j in range(cols):
        grid_mesh.add_vertex(i*scale, j*scale, 0)

# move vertices
new_mesh = mola.Mesh()
for i in range(rows):
    for j in range(cols):
        idx = i * cols + j
        ver = grid_mesh.vertices[idx]
        # select interior vertices
        if 0 < j < cols - 1 and 0 < i < rows - 1:
            # moved_ver = ver.translate(3, 3, 0)
            moved_ver = mola.Vertex(ver.x + 3, ver.y + 3, ver.z)
            new_mesh.add_vertex(moved_ver.x, moved_ver.y, moved_ver.z)
        else:
            new_mesh.add_vertex(ver.x, ver.y, ver.z)

for i in range(rows-1):
    for j in range(cols-1):
        idx = i * cols + j
        v0 = new_mesh.vertices[idx]
        v1 = new_mesh.vertices[idx + 1]
        v2 = new_mesh.vertices[idx + 1 + cols]
        v3 = new_mesh.vertices[idx + cols]
        new_mesh.add_face([v0,v1,v2,v3])
new_mesh.update_topology()

a = mola.module_rhino.display_mesh(new_mesh)
# ---------- end py3_14 ----------

# ----
explode_2 = MeshExplode(Mesh=py3_6.grid_mesh_rhino, Interpolate=False)
item_2 = ListItem(List=explode_2, Index=Slider(8, range=0..100), Wrap=True)

py3_15 = Python3Script(curve=rectangle.Rectangle, nU=number_slider_20, nV=number_slider_20)  # -> out, grid_mesh, grid_mesh_rhino; inputs curve: Polyline, nU: Int32, nV: Int32
# ---------- py3_15: Python ----------
import mola
from mola import module_rhino

grid = mola.Grid(nx=nU, ny=nV)
grid_mesh = mola.Mesh()


# build vertices
u = 5
for i in range(nU * nV):
    x = grid.get_x(i) * u
    y = grid.get_y(i) * u
    z = grid.get_z(i) * u
    v = grid_mesh.add_vertex(x, y, z)

# build 4-edged surface
for y in range(nV - 1):
    for x in range(nU - 1):
        i0 = grid.get_index(x, y)
        i1 = grid.get_index(x + 1, y)
        i2 = grid.get_index(x + 1, y + 1)
        i3 = grid.get_index(x, y + 1)
        grid_mesh.add_face([
            grid_mesh.vertices[i0],
            grid_mesh.vertices[i1],
            grid_mesh.vertices[i2],
            grid_mesh.vertices[i3]
        ])

grid_mesh.update_topology()
grid_mesh_rhino = module_rhino.display_mesh(grid_mesh)
# ---------- end py3_15 ----------
py3_16 = Python3Script(curve=rectangle.Rectangle, nU=Slider(2, range=0..10), nV=Slider(3, range=0..10))  # -> out, grid_mesh, grid_mesh_rhino; inputs curve: Polyline, nU: Int32, nV: Int32
# ---------- py3_16: Python ----------
import mola
from mola import module_rhino
import Rhino.Geometry as rg
import math

def points_on_curve(curve):
    list_of_points = []
    for p in curve:
        pt = rg.Point3d(p)
        list_of_points.append(pt)
    return list_of_points

grid_mesh = mola.Mesh()
new_pts = []
list_pts = points_on_curve(curve)
for p in list_pts:
    pt = rg.Point3d(p)
    grid_mesh.add_vertex(pt.X, pt.Y, pt.Z)
    new_pts.append(pt)
print(grid_mesh.vertices)

# build 1 face
v0 = grid_mesh.vertices[0]
v1 = grid_mesh.vertices[1]
v2 = grid_mesh.vertices[2]
v3 = grid_mesh.vertices[3]
grid_mesh.add_face([v0, v1, v2, v3])

#build grid by nU, nV
nU = 2
nV = 3
grid_matrix = mola.Grid(nx=nU, ny=nV, nz=1)


grid_mesh.update_topology()
grid_mesh_rhino = module_rhino.display_mesh(grid_mesh)
# ---------- end py3_16 ----------
draw_11 = COMPASDraw(cg=py3_6.points)  # -> rg; same code as draw

py3_17 = Python3Script(grid_mesh=py3_6.grid_mesh, t_x=Slider(-1.01, range=-2..2.01), t_y=Slider(0.13, range=-2..2.01))  # -> out, my_mesh, my_mesh_rhino, pts; inputs t_x: Double, t_y: Double
# ---------- py3_17: Python ----------
import mola
from mola import module_rhino
import random

new_mesh = mola.Mesh()
pts = []

for i, f in enumerate(grid_mesh.faces):
    # draw center point
    pt = f.center()
    pts.append(pt)
    
    # movement distance
    t_x = -1.25
    t_y = 0.25
    dx = pt.x + t_x
    dy = pt.y - t_y
    dz = 0
    move_v = mola.Vertex(dx, dy, dz)
    new_faces = mola.subdivide_face_extrude_to_point(f, move_v)

    # put result in container
    new_mesh.faces.extend(new_faces)

# display
my_mesh = new_mesh
my_mesh.update_topology()
my_mesh_rhino = module_rhino.display_mesh(my_mesh)
# ---------- end py3_17 ----------

py3_18 = Python3Script(grid_mesh=py3_6.grid_mesh)  # -> out, my_mesh, my_mesh_rhino, pts
# ---------- py3_18: Python ----------
import mola
from mola import module_rhino
import random

new_mesh = mola.Mesh()
pts = []

for f in grid_mesh.faces:
    # draw center point
    pt = f.center()
    pts.append(pt)

    # movement distance
    dx = pt.x + 0.5
    dy = pt.y - 1.0
    dz = 0
    move_v = mola.Vertex(dx, dy, dz)
    new_faces = mola.subdivide_face_extrude_to_point(f, move_v)

    # put result in container
    new_mesh.faces.extend(new_faces)

# display
my_mesh = new_mesh
my_mesh.update_topology()
my_mesh_rhino = module_rhino.display_mesh(my_mesh)
# ---------- end py3_18 ----------

py3_19 = Python3Script(grid_mesh=py3_6.grid_mesh)  # -> out, my_mesh, my_mesh_rhino
# ---------- py3_19: Python ----------
import mola
from mola import module_rhino

new_mesh = mola.Mesh()
for f in grid_mesh.faces:
    new_faces = mola.subdivide_face_split_grid(f, nU=2, nV=2)

    pt = f.center()
    m_x = pt.x - 0.5
    m_y = pt.y + 1.0
    m_z = 0
    m_pt = (m_x, m_y, m_z)

    trans_faces = []
    for m_f in new_faces:
        

    new_mesh.faces.extend(new_faces)

my_mesh = new_mesh
my_mesh.update_topology()
my_mesh_rhino = module_rhino.display_mesh(my_mesh)
# ---------- end py3_19 ----------
py3_20 = Python3Script(grid_mesh=py3_6.grid_mesh)  # -> out, my_mesh, my_mesh_rhino, pts
# ---------- py3_20: Python ----------
import mola
from mola import module_rhino
import random

new_mesh = mola.Mesh()
pts = []

for f in grid_mesh.faces:
    # step 1: subdivide the face
    new_faces = mola.subdivide_face_split_grid(f, nU=2, nV=2)

    # step 2: draw center point
    pt = f.center()
    pts.append(pt)

    # movement distance
    dx = pt.x + 5
    dy = pt.y - 5
    dz = 0
    move_v = mola.Vertex(dx, dy, dz)

    # step 3: reshape for subdivided faces
    for sf in new_faces:
        # target_v = sf.vertices[0]
        target_v = move_v
        target_v.x += move_v.x
        target_v.y += move_v.y
        target_v.z += move_v.z

    # step 4: put result in container
    new_mesh.faces.extend(new_faces)

# step 5: display
my_mesh = new_mesh
my_mesh.update_topology()
my_mesh_rhino = module_rhino.display_mesh(my_mesh)
# ---------- end py3_20 ----------
py3_21 = Python3Script(grid_mesh=py3_6.grid_mesh)  # -> out, my_mesh, my_mesh_rhino, pts; same code as py3_20
points_3 = PointList(Points=draw_11, Size=Slider(2, range=0..10))

# ---- group: extract parameters
py3_22 = Python3Script(cols=Slider(10, range=0..10), rows=Slider(6, range=0..10), scale=Slider(5, range=0..10))  # -> out, new_mesh, new_mesh_rhino; inputs cols: Int32, rows: Int32, scale: Double
# ---------- py3_22: Python ----------
import mola
from mola import module_rhino

# cols = 5
# rows = 3
# scale = 5

grid_mesh = mola.Mesh()
for r in range(rows):
    for c in range(cols):
        grid_mesh.add_vertex(c*scale, r*scale, 0)

# move vertices
new_mesh = mola.Mesh()
for r in range(rows):
    for c in range(cols):
        idx = r * cols + c
        ver = grid_mesh.vertices[idx]
        # select interior vertices
        if 0 < c < cols - 1 and 0 < r < rows - 1:
            # moved_ver = ver.translate(3, 3, 0)
            moved_ver = mola.Vertex(ver.x + 3, ver.y + 3, ver.z)
            new_mesh.add_vertex(moved_ver.x, moved_ver.y, moved_ver.z)
        else:
            new_mesh.add_vertex(ver.x, ver.y, ver.z)

for i in range(rows-1):
    for j in range(cols-1):
        idx = i * cols + j
        v0 = new_mesh.vertices[idx]
        v1 = new_mesh.vertices[idx + 1]
        v2 = new_mesh.vertices[idx + 1 + cols]
        v3 = new_mesh.vertices[idx + cols]
        new_mesh.add_face([v0,v1,v2,v3])
new_mesh.update_topology()

new_mesh_rhino = mola.module_rhino.display_mesh(new_mesh)
# ---------- end py3_22 ----------

# ----
mesh_6 = Mesh(py3_6.grid_mesh_rhino)

explode_3 = MeshExplode(Mesh=py3_17.my_mesh_rhino, Interpolate=False)
item_3 = ListItem(List=explode_3, Index=Slider(0, range=0..100), Wrap=True)

panel = Panel()
split = TextSplit(Text=py3_17.pts, Separators=panel)
item_4 = ListItem(List=split, Index=0, Wrap=True)  # -> Item, Item1, Item2
pt = ConstructPoint(XCoordinate=item_4.Item, YCoordinate=item_4.Item1, ZCoordinate=item_4.Item2)

explode_4 = MeshExplode(Mesh=py3_18.my_mesh_rhino, Interpolate=False)
item_5 = ListItem(List=explode_4, Index=Slider(0, range=0..100), Wrap=True)

panel_2 = Panel()
split_2 = TextSplit(Text=py3_18.pts, Separators=panel_2)
item_6 = ListItem(List=split_2, Index=0, Wrap=True)  # -> Item, Item1, Item2
pt_2 = ConstructPoint(XCoordinate=item_6.Item, YCoordinate=item_6.Item1, ZCoordinate=item_6.Item2)

panel_3 = Panel()
split_3 = TextSplit(Text=py3_20.pts, Separators=panel_3)
item_7 = ListItem(List=split_3, Index=0, Wrap=True)  # -> Item, Item1, Item2
pt_3 = ConstructPoint(XCoordinate=item_7.Item, YCoordinate=item_7.Item1, ZCoordinate=item_7.Item2)

pline = PolyLine(Closed=False)

# ---- group: move randomly
py3_23 = Python3Script(cols=Slider(30, range=0..100), rows=Slider(10, range=0..100), scale=Slider(5, range=0..10))  # -> out, new_mesh, new_mesh_rhino; inputs cols: Int32, rows: Int32, scale: Double
# ---------- py3_23: Python ----------
import mola
from mola import module_rhino
import random

grid_mesh = mola.Mesh()
for r in range(rows):
    for c in range(cols):
        grid_mesh.add_vertex(c*scale, r*scale, 0)

# move vertices
new_mesh = mola.Mesh()
for r in range(rows):
    for c in range(cols):
        idx = r * cols + c
        ver = grid_mesh.vertices[idx]
        # select interior vertices
        if 0 < c < cols - 1 and 0 < r < rows - 1:
            m = random.uniform(0, 0.8 * scale)
            moved_ver = mola.Vertex(ver.x + m, ver.y + m, ver.z)
            new_mesh.add_vertex(moved_ver.x, moved_ver.y, moved_ver.z)
        else:
            new_mesh.add_vertex(ver.x, ver.y, ver.z)

for i in range(rows-1):
    for j in range(cols-1):
        idx = i * cols + j
        v0 = new_mesh.vertices[idx]
        v1 = new_mesh.vertices[idx + 1]
        v2 = new_mesh.vertices[idx + 1 + cols]
        v3 = new_mesh.vertices[idx + cols]
        new_mesh.add_face([v0,v1,v2,v3])
new_mesh.update_topology()

new_mesh_rhino = mola.module_rhino.display_mesh(new_mesh)
# ---------- end py3_23 ----------

py3_24 = Python3Script(cols=Slider(30, range=0..100), rows=Slider(10, range=0..100), scale=Slider(5, range=0..10))  # -> out, new_mesh, new_mesh_rhino; inputs cols: Int32, rows: Int32, scale: Double
# ---------- py3_24: Python ----------
import mola
from mola import module_rhino
import random
import math

grid_mesh = mola.Mesh()
for r in range(rows):
    for c in range(cols):
        grid_mesh.add_vertex(c*scale, r*scale, 0)

# move vertices
new_mesh = mola.Mesh()
for r in range(rows):
    for c in range(cols):
        idx = r * cols + c
        ver = grid_mesh.vertices[idx]
        # select interior vertices
        if 0 < c < cols - 1 and 0 < r < rows - 1:
            a = random.uniform(0, 0.5 * scale)
            m= (math.cos(idx) + math.sin(idx)) * a
            moved_ver = mola.Vertex(ver.x + m, ver.y + m, ver.z)
            new_mesh.add_vertex(moved_ver.x, moved_ver.y, moved_ver.z)
        else:
            new_mesh.add_vertex(ver.x, ver.y, ver.z)

for i in range(rows-1):
    for j in range(cols-1):
        idx = i * cols + j
        v0 = new_mesh.vertices[idx]
        v1 = new_mesh.vertices[idx + 1]
        v2 = new_mesh.vertices[idx + 1 + cols]
        v3 = new_mesh.vertices[idx + cols]
        new_mesh.add_face([v0,v1,v2,v3])
new_mesh.update_topology()

new_mesh_rhino = mola.module_rhino.display_mesh(new_mesh)
# ---------- end py3_24 ----------

# ---- group: move by order
py3_25 = Python3Script(cols=Slider(10, range=0..100), rows=Slider(10, range=0..100), scale=Slider(5, range=0..10))  # -> out, new_mesh, new_mesh_rhino; inputs cols: Int32, rows: Int32, scale: Double
# ---------- py3_25: Python ----------
import mola
from mola import module_rhino
import random
import math

grid_mesh = mola.Mesh()
for r in range(rows):
    for c in range(cols):
        grid_mesh.add_vertex(c*scale, r*scale, 0)

# move vertices
new_mesh = mola.Mesh()
for r in range(rows):
    for c in range(cols):
        idx = r * cols + c
        ver = grid_mesh.vertices[idx]
        # select interior vertices
        if 0 < c < cols - 1 and 0 < r < rows - 1:
            m= (math.cos(idx) + math.sin(idx))
            moved_ver = mola.Vertex(ver.x + m, ver.y + m, ver.z)
            new_mesh.add_vertex(moved_ver.x, moved_ver.y, moved_ver.z)
        else:
            new_mesh.add_vertex(ver.x, ver.y, ver.z)

for i in range(rows-1):
    for j in range(cols-1):
        idx = i * cols + j
        v0 = new_mesh.vertices[idx]
        v1 = new_mesh.vertices[idx + 1]
        v2 = new_mesh.vertices[idx + 1 + cols]
        v3 = new_mesh.vertices[idx + cols]
        new_mesh.add_face([v0,v1,v2,v3])
new_mesh.update_topology()

new_mesh_rhino = mola.module_rhino.display_mesh(new_mesh)
# ---------- end py3_25 ----------

# ----
number_slider_21 = Slider(50, range=0..100)
number_slider_22 = Slider(10, range=0..100)

# ---- group: same boundary size
py3_26 = Python3Script(cols=number_slider_22, rows=number_slider_22, size_x=number_slider_21, size_y=number_slider_21)  # -> out, new_mesh, new_mesh_rhino; inputs cols: Int32, rows: Int32, size_x: Double, size_y: Double
# ---------- py3_26: Python ----------
import mola
from mola import module_rhino
import random
import math

grid_mesh = mola.Mesh()
for r in range(rows):
    for c in range(cols):
        x = c * size_x / (cols - 1)
        y = r * size_y / (rows - 1)
        grid_mesh.add_vertex(x, y, 0)
        # grid_mesh.add_vertex(c*scale, r*scale, 0)


# move vertices
new_mesh = mola.Mesh()
for r in range(rows):
    for c in range(cols):
        idx = r * cols + c
        ver = grid_mesh.vertices[idx]
        # select interior vertices
        if 0 < c < cols - 1 and 0 < r < rows - 1:
            m= (math.cos(idx) + math.sin(idx))
            moved_ver = mola.Vertex(ver.x + m, ver.y + m, ver.z)
            new_mesh.add_vertex(moved_ver.x, moved_ver.y, moved_ver.z)
        else:
            new_mesh.add_vertex(ver.x, ver.y, ver.z)

for i in range(rows-1):
    for j in range(cols-1):
        idx = i * cols + j
        v0 = new_mesh.vertices[idx]
        v1 = new_mesh.vertices[idx + 1]
        v2 = new_mesh.vertices[idx + 1 + cols]
        v3 = new_mesh.vertices[idx + cols]
        new_mesh.add_face([v0,v1,v2,v3])
new_mesh.update_topology()

new_mesh_rhino = mola.module_rhino.display_mesh(new_mesh)
# ---------- end py3_26 ----------

# ----
number_slider_23 = Slider(50, range=0..100)
number_slider_24 = Slider(23, range=0..100)
movement_factor = Python3Script(
    cols=number_slider_24,
    rows=number_slider_24,
    size_x=number_slider_23,
    size_y=number_slider_23,
    m_factor=Slider(0.56, range=0..1))  # -> out, new_mesh, new_mesh_rhino; inputs cols: Int32, rows: Int32, size_x: Double, size_y: Double, m_factor: Double
# ---------- movement_factor: Python ----------
import mola
from mola import module_rhino
import random
import math

grid_mesh = mola.Mesh()
for r in range(rows):
    for c in range(cols):
        x = c * size_x / (cols - 1)
        y = r * size_y / (rows - 1)
        grid_mesh.add_vertex(x, y, 0)

# move vertices
new_mesh = mola.Mesh()
for r in range(rows):
    for c in range(cols):
        idx = r * cols + c
        ver = grid_mesh.vertices[idx]
        # select interior vertices
        if 0 < c < cols - 1 and 0 < r < rows - 1:
            m= (math.cos(idx) + math.sin(idx)) * m_factor
            moved_ver = mola.Vertex(ver.x + m, ver.y + m, ver.z)
            new_mesh.add_vertex(moved_ver.x, moved_ver.y, moved_ver.z)
        else:
            new_mesh.add_vertex(ver.x, ver.y, ver.z)

for i in range(rows-1):
    for j in range(cols-1):
        idx = i * cols + j
        v0 = new_mesh.vertices[idx]
        v1 = new_mesh.vertices[idx + 1]
        v2 = new_mesh.vertices[idx + 1 + cols]
        v3 = new_mesh.vertices[idx + cols]
        new_mesh.add_face([v0,v1,v2,v3])
new_mesh.update_topology()

new_mesh_rhino = mola.module_rhino.display_mesh(new_mesh)
# ---------- end movement_factor ----------
number_slider_25 = Slider(300, range=0..500)
number_slider_26 = Slider(23, range=0..100)
number_slider_27 = Slider(81, range=0..100)
number_slider_28 = Slider(1000, range=0..1000)
number_slider_29 = Slider(300, range=0..500)
number_slider_30 = Slider(300, range=0..500)
number_slider_31 = Slider(50, range=0..100)
number_slider_32 = Slider(23, range=0..100)
number_slider_33 = Slider(23, range=0..100)
number_slider_34 = Slider(23, range=0..100)
panel_4 = Panel("""37
42
43
62
81
87""")

# ---- group: pt.Z up and down
py3_27 = Python3Script(
    cols=number_slider_26,
    rows=number_slider_26,
    size_x=number_slider_25,
    size_y=number_slider_25,
    m_factor=Slider(1, range=0..5))  # -> out, new_mesh, new_mesh_rhino; inputs cols: Int32, rows: Int32, size_x: Double, size_y: Double, m_factor: Double
# ---------- py3_27: Python ----------
import mola
from mola import module_rhino
import random
import math

grid_mesh = mola.Mesh()
for r in range(rows):
    for c in range(cols):
        x = c * size_x / (cols - 1)
        y = r * size_y / (rows - 1)
        # z = math.sin(x) * math.cos(y) * 5
        # z = (math.sin(x * 0.5) + math.cos(y * 0.5)) * 5 # soft wavy
        z = (math.sin(x * 0.4) + math.cos(y * 0.4)) * 5 + random.uniform(-1, 1) # wavy
        # z = math.sin(math.sqrt(x**2 + y**2)) * 6 # continuous mountains
        # z = math.sin(x * 0.3 + random.random()) * math.cos(y * 0.3 + random.random()) * 5 # random flat
        # z = (math.sin(x * 0.3) * math.cos(y * 0.3) +0.5 * math.sin(x * 0.7) * math.cos(y * 0.9)) * 6 # flat-like
        # z = math.sin((x**2 + y**2) * 0.1) * 5 # round wave
        # z = math.sin(x) * math.cos(y) * 6 + math.sin(x * 6) * math.cos(y * 6) # bumpy
        # z = abs(math.sin(x) * math.cos(y)) * 12 # hills
        grid_mesh.add_vertex(x, y, z)

# move vertices
new_mesh = mola.Mesh()
for r in range(rows):
    for c in range(cols):
        idx = r * cols + c
        ver = grid_mesh.vertices[idx]
        # select interior vertices
        if 0 < c < cols - 1 and 0 < r < rows - 1:
            m= (math.cos(idx) + math.sin(idx)) * m_factor
            moved_ver = mola.Vertex(ver.x + m, ver.y + m, ver.z)
            new_mesh.add_vertex(moved_ver.x, moved_ver.y, moved_ver.z)
        else:
            new_mesh.add_vertex(ver.x, ver.y, ver.z)

for i in range(rows-1):
    for j in range(cols-1):
        idx = i * cols + j
        v0 = new_mesh.vertices[idx]
        v1 = new_mesh.vertices[idx + 1]
        v2 = new_mesh.vertices[idx + 1 + cols]
        v3 = new_mesh.vertices[idx + cols]
        new_mesh.add_face([v0,v1,v2,v3])
new_mesh.update_topology()

new_mesh_rhino = mola.module_rhino.display_mesh(new_mesh)
# ---------- end py3_27 ----------

py3_28 = Python3Script(
    cols=number_slider_32,
    rows=number_slider_32,
    size_x=number_slider_30,
    size_y=number_slider_30,
    m_factor=Slider(1, range=0..5))  # -> out, new_mesh, new_mesh_rhino; inputs cols: Int32, rows: Int32, size_x: Double, size_y: Double, m_factor: Double
# ---------- py3_28: Python ----------
import mola
from mola import module_rhino
import random
import math

grid_mesh = mola.Mesh()
for r in range(rows):
    for c in range(cols):
        x = c * size_x / (cols - 1)
        y = r * size_y / (rows - 1)
        z = math.sin(x) * math.cos(y) * 5
        # z = math.cos(x) * math.cos(y) * 5
        grid_mesh.add_vertex(x, y, z)

# move vertices
new_mesh = mola.Mesh()
for r in range(rows):
    for c in range(cols):
        idx = r * cols + c
        ver = grid_mesh.vertices[idx]
        # select interior vertices
        if 0 < c < cols - 1 and 0 < r < rows - 1:
            m= (math.cos(idx) + math.sin(idx)) * m_factor
            moved_ver = mola.Vertex(ver.x + m, ver.y + m, ver.z)
            new_mesh.add_vertex(moved_ver.x, moved_ver.y, moved_ver.z)
        else:
            new_mesh.add_vertex(ver.x, ver.y, ver.z)

for i in range(rows-1):
    for j in range(cols-1):
        idx = i * cols + j
        v0 = new_mesh.vertices[idx]
        v1 = new_mesh.vertices[idx + 1]
        v2 = new_mesh.vertices[idx + 1 + cols]
        v3 = new_mesh.vertices[idx + cols]
        new_mesh.add_face([v0,v1,v2,v3])
new_mesh.update_topology()

new_mesh_rhino = mola.module_rhino.display_mesh(new_mesh)
# ---------- end py3_28 ----------

# ---- group: movement factor
py3_29 = Python3Script(
    cols=number_slider_34,
    rows=number_slider_34,
    size_x=number_slider_31,
    size_y=number_slider_31,
    m_factor=Slider(0.56, range=0..1))  # -> out, new_mesh, new_mesh_rhino; inputs cols: Int32, rows: Int32, size_x: Double, size_y: Double, m_factor: Double; same code as movement_factor

# ---- group: pt.Z up and down
py3_30 = Python3Script(
    cols=number_slider_33,
    rows=number_slider_33,
    size_x=number_slider_29,
    size_y=number_slider_29,
    m_factor=Slider(1, range=0..5),
    trans_type=Slider(2, range=0..8))  # -> out, new_mesh, new_mesh_rhino; inputs cols: Int32, rows: Int32, size_x: Double, size_y: Double, m_factor: Double, trans_type: Int32
# ---------- py3_30: Python ----------
import mola
from mola import module_rhino
import random
import math

grid_mesh = mola.Mesh()
for r in range(rows):
    for c in range(cols):
        x = c * size_x / (cols - 1)
        y = r * size_y / (rows - 1)
        if trans_type == 0:
            z = math.sin(x) * math.cos(y) * 8
        if trans_type == 1:
            z = (math.sin(x * 0.5) + math.cos(y * 0.5)) * 5 # soft wavy
        if trans_type == 2:
            z = (math.sin(x * 0.4) + math.cos(y * 0.4)) * 5 + random.uniform(-1, 1) # wavy
        if trans_type == 3:
            z = math.sin(math.sqrt(x**2 + y**2)) * 6 # continuous mountains
        if trans_type == 4:
            z = math.sin(x * 0.3 + random.random()) * math.cos(y * 0.3 + random.random()) * 5 # random flat
        if trans_type == 5:
            z = (math.sin(x * 0.3) * math.cos(y * 0.3) +0.5 * math.sin(x * 0.7) * math.cos(y * 0.9)) * 6 # flat-like
        if trans_type == 6:
            z = math.sin((x**2 + y**2) * 0.1) * 5 # round wave
        if trans_type == 7:
            z = math.sin(x) * math.cos(y) * 9 + math.sin(x * 9) * math.cos(y * 9) # bumpy
        if trans_type == 8:
            z = abs(math.sin(x) * math.cos(y)) * 12 # hills
        grid_mesh.add_vertex(x, y, z)

# move vertices
new_mesh = mola.Mesh()
for r in range(rows):
    for c in range(cols):
        idx = r * cols + c
        ver = grid_mesh.vertices[idx]
        # select interior vertices
        if 0 < c < cols - 1 and 0 < r < rows - 1:
            m= (math.cos(idx) + math.sin(idx)) * m_factor
            moved_ver = mola.Vertex(ver.x + m, ver.y + m, ver.z)
            new_mesh.add_vertex(moved_ver.x, moved_ver.y, moved_ver.z)
        else:
            new_mesh.add_vertex(ver.x, ver.y, ver.z)

for i in range(rows-1):
    for j in range(cols-1):
        idx = i * cols + j
        v0 = new_mesh.vertices[idx]
        v1 = new_mesh.vertices[idx + 1]
        v2 = new_mesh.vertices[idx + 1 + cols]
        v3 = new_mesh.vertices[idx + cols]
        new_mesh.add_face([v0,v1,v2,v3])
new_mesh.update_topology()

new_mesh_rhino = mola.module_rhino.display_mesh(new_mesh)
# ---------- end py3_30 ----------

py3_31 = Python3Script(
    cols=number_slider_27,
    rows=number_slider_27,
    size_x=number_slider_28,
    size_y=number_slider_28,
    m_factor=Slider(10, range=0..10),
    trans_type=Slider(2, range=0..8),
    height=Slider(2.4, range=0..10))  # -> out, new_mesh, new_mesh_rhino; inputs cols: Int32, rows: Int32, size_x: Double, size_y: Double, m_factor: Double, trans_type: Int32, height: Double
# ---------- py3_31: Python ----------
import mola
from mola import module_rhino
import random
import math

grid_mesh = mola.Mesh()
for r in range(rows):
    for c in range(cols):
        x = c * size_x / (cols - 1)
        y = r * size_y / (rows - 1)
        if trans_type == 0:
            z = math.sin(x) * math.cos(y) * 8
        if trans_type == 1:
            z = (math.sin(x * 0.5) + math.cos(y * 0.5)) * 5 # soft wavy
        if trans_type == 2:
            z = (math.sin(x * 0.4) + math.cos(y * 0.4)) * 5 + random.uniform(-1, 1) # wavy
        if trans_type == 3:
            z = math.sin(math.sqrt(x**2 + y**2)) * 6 # continuous mountains
        if trans_type == 4:
            z = math.sin(x * 0.3 + random.random()) * math.cos(y * 0.3 + random.random()) * 5 # random flat
        if trans_type == 5:
            z = (math.sin(x * 0.3) * math.cos(y * 0.3) +0.5 * math.sin(x * 0.7) * math.cos(y * 0.9)) * 6 # flat-like
        if trans_type == 6:
            z = math.sin((x**2 + y**2) * 0.1) * 5 # round wave
        if trans_type == 7:
            z = math.sin(x) * math.cos(y) * 9 + math.sin(x * 9) * math.cos(y * 9) # bumpy
        if trans_type == 8:
            z = abs(math.sin(x) * math.cos(y)) * 12 # hills
        grid_mesh.add_vertex(x, y, z * height)

# move vertices
new_mesh = mola.Mesh()
for r in range(rows):
    for c in range(cols):
        idx = r * cols + c
        ver = grid_mesh.vertices[idx]
        # select interior vertices
        if 0 < c < cols - 1 and 0 < r < rows - 1:
            m= (math.cos(idx) + math.sin(idx)) * m_factor
            moved_ver = mola.Vertex(ver.x + m, ver.y + m, ver.z)
            new_mesh.add_vertex(moved_ver.x, moved_ver.y, moved_ver.z)
        else:
            new_mesh.add_vertex(ver.x, ver.y, ver.z)

for i in range(rows-1):
    for j in range(cols-1):
        idx = i * cols + j
        v0 = new_mesh.vertices[idx]
        v1 = new_mesh.vertices[idx + 1]
        v2 = new_mesh.vertices[idx + 1 + cols]
        v3 = new_mesh.vertices[idx + cols]
        new_mesh.add_face([v0,v1,v2,v3])
new_mesh.update_topology()

new_mesh_rhino = mola.module_rhino.display_mesh(new_mesh)
# ---------- end py3_31 ----------

# ----
subdivide_tapered = Python3Script(mesh=py3_29.new_mesh)  # -> out, my_mesh, my_mesh_rhino
# ---------- subdivide_tapered: Python ----------
import mola
from mola import module_rhino

new_mesh = mola.Mesh()
for f in mesh.faces:
    new_faces = mola.subdivide_face_extrude_tapered(f, height=1.5, fraction=0.75)
    new_faces[-1].group = 1
    new_mesh.faces.extend(new_faces)

for f in new_mesh.faces:
    print(f.group)

my_mesh = new_mesh
my_mesh.update_topology()
my_mesh_rhino = module_rhino.display_mesh(my_mesh)
# ---------- end subdivide_tapered ----------
subdivide_tapered_2 = Python3Script(mesh=py3_30.new_mesh, h_factor=Slider(3.6, range=0..10))  # -> out, my_mesh, my_mesh_rhino; inputs h_factor: Double
# ---------- subdivide_tapered_2: Python ----------
import mola
from mola import module_rhino
import math

new_mesh = mola.Mesh()
for i, f in enumerate(mesh.faces):
    h_para = abs(math.sin(i) * math.cos(i)) * h_factor
    new_faces = mola.subdivide_face_extrude_tapered(f, height=h_para, fraction=0.3)
    new_faces[-1].group = 1
    new_mesh.faces.extend(new_faces)

my_mesh = new_mesh
my_mesh.update_topology()

#color faces by group
values = [f.group for f in my_mesh.faces]
cmap = mola.color_map(values, [(0.176, 0.329, 0.165), (0.114, 0.129, 0.114)])
mola.color_faces_by_map(my_mesh.faces, cmap)
my_mesh.update_topology()

#display
my_mesh_rhino = module_rhino.display_mesh(my_mesh)
# ---------- end subdivide_tapered_2 ----------
subdivide_tapered_3 = Python3Script(mesh=subdivide_tapered_2.my_mesh, h_factor=Slider(3, range=0..10))  # -> out, my_mesh, my_mesh_rhino; inputs h_factor: Double
# ---------- subdivide_tapered_3: Python ----------
import mola
from mola import module_rhino
import math

new_mesh = mola.Mesh()
for i, f in enumerate(mesh.faces):
    a = len(mesh.faces)
    h_para = abs(math.sin(a - i) * math.cos(a - i)) * h_factor
    if f.group == 1:
        new_faces = mola.subdivide_face_extrude_tapered(f, height=h_para, fraction=0.4)
        new_faces[-1].group = 2
        new_mesh.faces.extend(new_faces)
    else:
        new_mesh.faces.append(f)

# for f in new_mesh.faces:
#     print(f.group)

my_mesh = new_mesh
my_mesh.update_topology()

# color faces by group
values = [f.group for f in my_mesh.faces]
cmap = mola.color_map(values, [(0, 0.286, 0.459), (0.612, 0.816, 0.941)])
mola.color_faces_by_map(my_mesh.faces, cmap)
my_mesh.update_topology()

my_mesh_rhino = module_rhino.display_mesh(my_mesh)
# ---------- end subdivide_tapered_3 ----------
subdivide_tapered_4 = Python3Script(mesh=subdivide_tapered_3.my_mesh, h_factor=Slider(2.4, range=0..10))  # -> out, my_mesh, my_mesh_rhino; inputs h_factor: Double
# ---------- subdivide_tapered_4: Python ----------
import mola
from mola import module_rhino
import math

new_mesh = mola.Mesh()
for i, f in enumerate(mesh.faces):
    a = len(mesh.faces)
    h_para = abs(math.sin(a - i) * math.cos(a - i)) * h_factor
    if f.group == 2:
        new_faces = mola.subdivide_face_extrude_tapered(f, height=h_para, fraction=0.4)
        new_faces[-1].group = 3
        new_mesh.faces.extend(new_faces)
    else:
        new_mesh.faces.append(f)

my_mesh = new_mesh
my_mesh.update_topology()

# color faces by groups
values = [f.group for f in my_mesh.faces]
cmap = mola.color_map(values, [(0.682, 0.776, 0.902), (0.875, 0.902, 0.682)])
mola.color_faces_by_map(my_mesh.faces, cmap)
my_mesh.update_topology()

my_mesh_rhino = module_rhino.display_mesh(my_mesh)
# ---------- end subdivide_tapered_4 ----------
split_grid = Python3Script(mesh=subdivide_tapered_4.my_mesh)  # -> out, my_mesh, my_mesh_rhino
# ---------- split_grid: Python ----------
import mola
from mola import module_rhino

for f in mesh.faces:
    print(f.group)

new_mesh = mola.Mesh()
for f in mesh.faces:
    if f.group == 0:
        new_faces = mola.subdivide_face_split_grid(f, nU=4, nV=1)
        new_faces[-1].group = 4
        new_faces[0].group = 4
        new_mesh.faces.append(new_faces[-1])
        new_mesh.faces.append(new_faces[0])
    elif f.group == 1:
        new_faces = mola.subdivide_face_split_grid(f, nU=4, nV=1)
        new_faces[-1].group = 5
        new_faces[0].group = 5
        new_mesh.faces.append(new_faces[-1])
        new_mesh.faces.append(new_faces[0])
    elif f.group == 2:
        new_faces = mola.subdivide_face_split_grid(f, nU=4, nV=1)
        new_faces[-1].group = 6
        new_faces[0].group = 6
        new_mesh.faces.append(new_faces[-1])
        new_mesh.faces.append(new_faces[0])
    elif f.group == 3:
        new_faces = mola.subdivide_face_split_grid(f, nU=2, nV=2)
        new_mesh.faces.extend(new_faces)

    else:
        new_mesh.faces.append(f)
    
my_mesh = new_mesh
my_mesh.update_topology()
my_mesh_rhino = module_rhino.display_mesh(my_mesh)
# ---------- end split_grid ----------
py3_32 = Python3Script(mesh=split_grid.my_mesh, iterations=Slider(1, range=0..1))  # -> out, my_mesh, my_mesh_rhino; inputs iterations: Int32
# ---------- py3_32: Python ----------
import mola
from mola import module_rhino

for i in range(iterations):
    new_mesh = mola.Mesh()
    for j, f in enumerate(mesh.faces):
        print(f.group)
        if f.group == 4:
            new_faces = mola.subdivide_face_extrude_tapered(f, 1/(i+1.5), 0.4)
            new_mesh.faces.extend(new_faces)
        # elif f.group == 3:
        #     new_faces = mola.subdivide_face_extrude_tapered(f, 1/(j), 0.4)
        #     new_mesh.faces.extend(new_faces)
        else:
            new_mesh.faces.append(f)
my_mesh = new_mesh

# color faces by group
values = [f.group for f in my_mesh.faces]
cmap = mola.color_map(values, [(0.973, 1, 0.812),(0.725, 0.729, 0.961)])
mola.color_faces_by_map(my_mesh.faces, cmap)
my_mesh.update_topology()

my_mesh_rhino = module_rhino.display_mesh(my_mesh)
# ---------- end py3_32 ----------

bbox = BoundingBox(Content=py3_32.my_mesh_rhino, Plane=PlaneXY(0, 0, 0), UnionBox=True)  # -> Box, Box_2
debrep = DeconstructBrep(Brep=bbox.Box)  # -> Faces, Edges, Vertices
number_slider_35 = Slider(3.33, range=0..10)
item_8 = ListItem(List=debrep.Faces, Index="4", Wrap=True)
area = Area(Geometry=item_8)  # -> Area, Centroid
scale_nu = ScaleNU(
    Geometry=py3_32.my_mesh_rhino,
    Plane=area.Centroid,
    ScaleX=number_slider_35,
    ScaleY=number_slider_35,
    ScaleZ=number_slider_35)  # -> Geometry, Transform

wbcatmullclark = WeaverbirdsCatmullClarkSubdivision(MeshCurves=py3_32.my_mesh_rhino, Level=Slider(0, range=0..2), SmoothNakedEdges=1)
