# Grasshopper definition 202_grid_sharon_clean.gh (Grasshopper 1.0.8)
# plug-ins: RADii, Weaverbird

# ---- group: primitive grid
py3 = Python3Script(rows=Slider(4, range=0..10), cols=Slider(6, range=0..10))  # -> out, a; inputs rows: Int32, cols: Int32
# ---------- py3: Python ----------
import mola
from mola import module_rhino

grid_mesh = mola.Mesh()
for i in range(rows):
    y = i * 5
    for j in range(cols):
        x = j * 5
        grid_mesh.add_vertex(x, y, 0)

for i in range(rows-1):
    for j in range(cols-1):
        idx = i * cols + j
        v0 = grid_mesh.vertices[idx]
        v1 = grid_mesh.vertices[idx + 1]
        v2 = grid_mesh.vertices[idx + 1 + cols]
        v3 = grid_mesh.vertices[idx + cols]
        grid_mesh.add_face([v0,v1,v2,v3])
grid_mesh.update_topology()

a = mola.module_rhino.display_mesh(grid_mesh)
# ---------- end py3 ----------

# ---- group: quad transform
py3_2 = Python3Script()  # -> out, a
# ---------- py3_2: Python ----------
import mola
from mola import module_rhino

rows = 4
cols = 4
grid_mesh = mola.Mesh()
for i in range(rows):
    y = i * 5
    for j in range(cols):
        x = j * 5
        grid_mesh.add_vertex(x, y, 0)

# move vertices
new_mesh = mola.Mesh()
for ix in range(cols):
    for iy in range(rows):
        idx = ix * cols + iy
        ver = grid_mesh.vertices[idx]
        # select interior vertices
        if 0 < ix < cols - 1 and 0 < iy < rows - 1:
            # moved_ver = ver.translate(3, 3, 0)
            moved_ver = mola.Vertex(ver.x + 3, ver.y + 3, ver.z)
            new_mesh.add_vertex(moved_ver.x, moved_ver.y, moved_ver.z)
        else:
            new_mesh.add_vertex(ver.x, ver.y, ver.z)

for i in range(rows-1):
    for j in range(cols-1):
        idx = i * cols + j
        v0 = new_mesh.vertices[idx]
        v1 = new_mesh.vertices[idx + 1]
        v2 = new_mesh.vertices[idx + 1 + cols]
        v3 = new_mesh.vertices[idx + cols]
        new_mesh.add_face([v0,v1,v2,v3])
new_mesh.update_topology()

a = mola.module_rhino.display_mesh(new_mesh)
# ---------- end py3_2 ----------

# ---- group: extract parameters
py3_3 = Python3Script(cols=Slider(5, range=0..10), rows=Slider(3, range=0..10), scale=Slider(5, range=0..10))  # -> out, a; inputs cols: Int32, rows: Int32, scale: Double
# ---------- py3_3: Python ----------
import mola
from mola import module_rhino

grid_mesh = mola.Mesh()
for i in range(rows):
    for j in range(cols):
        grid_mesh.add_vertex(i*scale, j*scale, 0)

# move vertices
new_mesh = mola.Mesh()
for i in range(rows):
    for j in range(cols):
        idx = i * cols + j
        ver = grid_mesh.vertices[idx]
        # select interior vertices
        if 0 < j < cols - 1 and 0 < i < rows - 1:
            # moved_ver = ver.translate(3, 3, 0)
            moved_ver = mola.Vertex(ver.x + 3, ver.y + 3, ver.z)
            new_mesh.add_vertex(moved_ver.x, moved_ver.y, moved_ver.z)
        else:
            new_mesh.add_vertex(ver.x, ver.y, ver.z)

for i in range(rows-1):
    for j in range(cols-1):
        idx = i * cols + j
        v0 = new_mesh.vertices[idx]
        v1 = new_mesh.vertices[idx + 1]
        v2 = new_mesh.vertices[idx + 1 + cols]
        v3 = new_mesh.vertices[idx + cols]
        new_mesh.add_face([v0,v1,v2,v3])
new_mesh.update_topology()

a = mola.module_rhino.display_mesh(new_mesh)
# ---------- end py3_3 ----------

py3_4 = Python3Script(cols=Slider(10, range=0..10), rows=Slider(6, range=0..10), scale=Slider(5, range=0..10))  # -> out, new_mesh, new_mesh_rhino; inputs cols: Int32, rows: Int32, scale: Double
# ---------- py3_4: Python ----------
import mola
from mola import module_rhino

# cols = 5
# rows = 3
# scale = 5

grid_mesh = mola.Mesh()
for r in range(rows):
    for c in range(cols):
        grid_mesh.add_vertex(c*scale, r*scale, 0)

# move vertices
new_mesh = mola.Mesh()
for r in range(rows):
    for c in range(cols):
        idx = r * cols + c
        ver = grid_mesh.vertices[idx]
        # select interior vertices
        if 0 < c < cols - 1 and 0 < r < rows - 1:
            # moved_ver = ver.translate(3, 3, 0)
            moved_ver = mola.Vertex(ver.x + 3, ver.y + 3, ver.z)
            new_mesh.add_vertex(moved_ver.x, moved_ver.y, moved_ver.z)
        else:
            new_mesh.add_vertex(ver.x, ver.y, ver.z)

for i in range(rows-1):
    for j in range(cols-1):
        idx = i * cols + j
        v0 = new_mesh.vertices[idx]
        v1 = new_mesh.vertices[idx + 1]
        v2 = new_mesh.vertices[idx + 1 + cols]
        v3 = new_mesh.vertices[idx + cols]
        new_mesh.add_face([v0,v1,v2,v3])
new_mesh.update_topology()

new_mesh_rhino = mola.module_rhino.display_mesh(new_mesh)
# ---------- end py3_4 ----------

# ---- group: move randomly
py3_5 = Python3Script(cols=Slider(30, range=0..100), rows=Slider(10, range=0..100), scale=Slider(5, range=0..10))  # -> out, new_mesh, new_mesh_rhino; inputs cols: Int32, rows: Int32, scale: Double
# ---------- py3_5: Python ----------
import mola
from mola import module_rhino
import random

grid_mesh = mola.Mesh()
for r in range(rows):
    for c in range(cols):
        grid_mesh.add_vertex(c*scale, r*scale, 0)

# move vertices
new_mesh = mola.Mesh()
for r in range(rows):
    for c in range(cols):
        idx = r * cols + c
        ver = grid_mesh.vertices[idx]
        # select interior vertices
        if 0 < c < cols - 1 and 0 < r < rows - 1:
            m = random.uniform(0, 0.8 * scale)
            moved_ver = mola.Vertex(ver.x + m, ver.y + m, ver.z)
            new_mesh.add_vertex(moved_ver.x, moved_ver.y, moved_ver.z)
        else:
            new_mesh.add_vertex(ver.x, ver.y, ver.z)

for i in range(rows-1):
    for j in range(cols-1):
        idx = i * cols + j
        v0 = new_mesh.vertices[idx]
        v1 = new_mesh.vertices[idx + 1]
        v2 = new_mesh.vertices[idx + 1 + cols]
        v3 = new_mesh.vertices[idx + cols]
        new_mesh.add_face([v0,v1,v2,v3])
new_mesh.update_topology()

new_mesh_rhino = mola.module_rhino.display_mesh(new_mesh)
# ---------- end py3_5 ----------

py3_6 = Python3Script(cols=Slider(30, range=0..100), rows=Slider(10, range=0..100), scale=Slider(5, range=0..10))  # -> out, new_mesh, new_mesh_rhino; inputs cols: Int32, rows: Int32, scale: Double
# ---------- py3_6: Python ----------
import mola
from mola import module_rhino
import random
import math

grid_mesh = mola.Mesh()
for r in range(rows):
    for c in range(cols):
        grid_mesh.add_vertex(c*scale, r*scale, 0)

# move vertices
new_mesh = mola.Mesh()
for r in range(rows):
    for c in range(cols):
        idx = r * cols + c
        ver = grid_mesh.vertices[idx]
        # select interior vertices
        if 0 < c < cols - 1 and 0 < r < rows - 1:
            a = random.uniform(0, 0.5 * scale)
            m= (math.cos(idx) + math.sin(idx)) * a
            moved_ver = mola.Vertex(ver.x + m, ver.y + m, ver.z)
            new_mesh.add_vertex(moved_ver.x, moved_ver.y, moved_ver.z)
        else:
            new_mesh.add_vertex(ver.x, ver.y, ver.z)

for i in range(rows-1):
    for j in range(cols-1):
        idx = i * cols + j
        v0 = new_mesh.vertices[idx]
        v1 = new_mesh.vertices[idx + 1]
        v2 = new_mesh.vertices[idx + 1 + cols]
        v3 = new_mesh.vertices[idx + cols]
        new_mesh.add_face([v0,v1,v2,v3])
new_mesh.update_topology()

new_mesh_rhino = mola.module_rhino.display_mesh(new_mesh)
# ---------- end py3_6 ----------

# ---- group: move by order
py3_7 = Python3Script(cols=Slider(10, range=0..100), rows=Slider(10, range=0..100), scale=Slider(5, range=0..10))  # -> out, new_mesh, new_mesh_rhino; inputs cols: Int32, rows: Int32, scale: Double
# ---------- py3_7: Python ----------
import mola
from mola import module_rhino
import random
import math

grid_mesh = mola.Mesh()
for r in range(rows):
    for c in range(cols):
        grid_mesh.add_vertex(c*scale, r*scale, 0)

# move vertices
new_mesh = mola.Mesh()
for r in range(rows):
    for c in range(cols):
        idx = r * cols + c
        ver = grid_mesh.vertices[idx]
        # select interior vertices
        if 0 < c < cols - 1 and 0 < r < rows - 1:
            m= (math.cos(idx) + math.sin(idx))
            moved_ver = mola.Vertex(ver.x + m, ver.y + m, ver.z)
            new_mesh.add_vertex(moved_ver.x, moved_ver.y, moved_ver.z)
        else:
            new_mesh.add_vertex(ver.x, ver.y, ver.z)

for i in range(rows-1):
    for j in range(cols-1):
        idx = i * cols + j
        v0 = new_mesh.vertices[idx]
        v1 = new_mesh.vertices[idx + 1]
        v2 = new_mesh.vertices[idx + 1 + cols]
        v3 = new_mesh.vertices[idx + cols]
        new_mesh.add_face([v0,v1,v2,v3])
new_mesh.update_topology()

new_mesh_rhino = mola.module_rhino.display_mesh(new_mesh)
# ---------- end py3_7 ----------

# ----
number_slider = Slider(50, range=0..100)
number_slider_2 = Slider(10, range=0..100)

# ---- group: same boundary size
py3_8 = Python3Script(cols=number_slider_2, rows=number_slider_2, size_x=number_slider, size_y=number_slider)  # -> out, new_mesh, new_mesh_rhino; inputs cols: Int32, rows: Int32, size_x: Double, size_y: Double
# ---------- py3_8: Python ----------
import mola
from mola import module_rhino
import random
import math

grid_mesh = mola.Mesh()
for r in range(rows):
    for c in range(cols):
        x = c * size_x / (cols - 1)
        y = r * size_y / (rows - 1)
        grid_mesh.add_vertex(x, y, 0)
        # grid_mesh.add_vertex(c*scale, r*scale, 0)


# move vertices
new_mesh = mola.Mesh()
for r in range(rows):
    for c in range(cols):
        idx = r * cols + c
        ver = grid_mesh.vertices[idx]
        # select interior vertices
        if 0 < c < cols - 1 and 0 < r < rows - 1:
            m= (math.cos(idx) + math.sin(idx))
            moved_ver = mola.Vertex(ver.x + m, ver.y + m, ver.z)
            new_mesh.add_vertex(moved_ver.x, moved_ver.y, moved_ver.z)
        else:
            new_mesh.add_vertex(ver.x, ver.y, ver.z)

for i in range(rows-1):
    for j in range(cols-1):
        idx = i * cols + j
        v0 = new_mesh.vertices[idx]
        v1 = new_mesh.vertices[idx + 1]
        v2 = new_mesh.vertices[idx + 1 + cols]
        v3 = new_mesh.vertices[idx + cols]
        new_mesh.add_face([v0,v1,v2,v3])
new_mesh.update_topology()

new_mesh_rhino = mola.module_rhino.display_mesh(new_mesh)
# ---------- end py3_8 ----------

# ----
number_slider_3 = Slider(50, range=0..100)
number_slider_4 = Slider(23, range=0..100)
movement_factor = Python3Script(
    cols=number_slider_4,
    rows=number_slider_4,
    size_x=number_slider_3,
    size_y=number_slider_3,
    m_factor=Slider(0.56, range=0..1))  # -> out, new_mesh, new_mesh_rhino; inputs cols: Int32, rows: Int32, size_x: Double, size_y: Double, m_factor: Double
# ---------- movement_factor: Python ----------
import mola
from mola import module_rhino
import random
import math

grid_mesh = mola.Mesh()
for r in range(rows):
    for c in range(cols):
        x = c * size_x / (cols - 1)
        y = r * size_y / (rows - 1)
        grid_mesh.add_vertex(x, y, 0)

# move vertices
new_mesh = mola.Mesh()
for r in range(rows):
    for c in range(cols):
        idx = r * cols + c
        ver = grid_mesh.vertices[idx]
        # select interior vertices
        if 0 < c < cols - 1 and 0 < r < rows - 1:
            m= (math.cos(idx) + math.sin(idx)) * m_factor
            moved_ver = mola.Vertex(ver.x + m, ver.y + m, ver.z)
            new_mesh.add_vertex(moved_ver.x, moved_ver.y, moved_ver.z)
        else:
            new_mesh.add_vertex(ver.x, ver.y, ver.z)

for i in range(rows-1):
    for j in range(cols-1):
        idx = i * cols + j
        v0 = new_mesh.vertices[idx]
        v1 = new_mesh.vertices[idx + 1]
        v2 = new_mesh.vertices[idx + 1 + cols]
        v3 = new_mesh.vertices[idx + cols]
        new_mesh.add_face([v0,v1,v2,v3])
new_mesh.update_topology()

new_mesh_rhino = mola.module_rhino.display_mesh(new_mesh)
# ---------- end movement_factor ----------
number_slider_5 = Slider(1.2, range=0..10)
number_slider_6 = Slider(300, range=0..500)
number_slider_7 = Slider(23, range=0..100)
number_slider_8 = Slider(300, range=0..500)
number_slider_9 = Slider(23, range=0..100)
number_slider_10 = Slider(81, range=0..100)
number_slider_11 = Slider(1000, range=0..1000)
number_slider_12 = Slider(300, range=0..500)
number_slider_13 = Slider(50, range=0..100)
number_slider_14 = Slider(23, range=0..100)
number_slider_15 = Slider(23, range=0..100)
panel = Panel("""37
42
43
62
81
87""")

# ---- group: pt.Z up and down
py3_9 = Python3Script(
    cols=number_slider_9,
    rows=number_slider_9,
    size_x=number_slider_8,
    size_y=number_slider_8,
    m_factor=Slider(1, range=0..5))  # -> out, new_mesh, new_mesh_rhino; inputs cols: Int32, rows: Int32, size_x: Double, size_y: Double, m_factor: Double
# ---------- py3_9: Python ----------
import mola
from mola import module_rhino
import random
import math

grid_mesh = mola.Mesh()
for r in range(rows):
    for c in range(cols):
        x = c * size_x / (cols - 1)
        y = r * size_y / (rows - 1)
        # z = math.sin(x) * math.cos(y) * 5
        # z = (math.sin(x * 0.5) + math.cos(y * 0.5)) * 5 # soft wavy
        z = (math.sin(x * 0.4) + math.cos(y * 0.4)) * 5 + random.uniform(-1, 1) # wavy
        # z = math.sin(math.sqrt(x**2 + y**2)) * 6 # continuous mountains
        # z = math.sin(x * 0.3 + random.random()) * math.cos(y * 0.3 + random.random()) * 5 # random flat
        # z = (math.sin(x * 0.3) * math.cos(y * 0.3) +0.5 * math.sin(x * 0.7) * math.cos(y * 0.9)) * 6 # flat-like
        # z = math.sin((x**2 + y**2) * 0.1) * 5 # round wave
        # z = math.sin(x) * math.cos(y) * 6 + math.sin(x * 6) * math.cos(y * 6) # bumpy
        # z = abs(math.sin(x) * math.cos(y)) * 12 # hills
        grid_mesh.add_vertex(x, y, z)

# move vertices
new_mesh = mola.Mesh()
for r in range(rows):
    for c in range(cols):
        idx = r * cols + c
        ver = grid_mesh.vertices[idx]
        # select interior vertices
        if 0 < c < cols - 1 and 0 < r < rows - 1:
            m= (math.cos(idx) + math.sin(idx)) * m_factor
            moved_ver = mola.Vertex(ver.x + m, ver.y + m, ver.z)
            new_mesh.add_vertex(moved_ver.x, moved_ver.y, moved_ver.z)
        else:
            new_mesh.add_vertex(ver.x, ver.y, ver.z)

for i in range(rows-1):
    for j in range(cols-1):
        idx = i * cols + j
        v0 = new_mesh.vertices[idx]
        v1 = new_mesh.vertices[idx + 1]
        v2 = new_mesh.vertices[idx + 1 + cols]
        v3 = new_mesh.vertices[idx + cols]
        new_mesh.add_face([v0,v1,v2,v3])
new_mesh.update_topology()

new_mesh_rhino = mola.module_rhino.display_mesh(new_mesh)
# ---------- end py3_9 ----------

py3_10 = Python3Script(
    cols=number_slider_14,
    rows=number_slider_14,
    size_x=number_slider_12,
    size_y=number_slider_12,
    m_factor=Slider(1, range=0..5))  # -> out, new_mesh, new_mesh_rhino; inputs cols: Int32, rows: Int32, size_x: Double, size_y: Double, m_factor: Double
# ---------- py3_10: Python ----------
import mola
from mola import module_rhino
import random
import math

grid_mesh = mola.Mesh()
for r in range(rows):
    for c in range(cols):
        x = c * size_x / (cols - 1)
        y = r * size_y / (rows - 1)
        z = math.sin(x) * math.cos(y) * 5
        # z = math.cos(x) * math.cos(y) * 5
        grid_mesh.add_vertex(x, y, z)

# move vertices
new_mesh = mola.Mesh()
for r in range(rows):
    for c in range(cols):
        idx = r * cols + c
        ver = grid_mesh.vertices[idx]
        # select interior vertices
        if 0 < c < cols - 1 and 0 < r < rows - 1:
            m= (math.cos(idx) + math.sin(idx)) * m_factor
            moved_ver = mola.Vertex(ver.x + m, ver.y + m, ver.z)
            new_mesh.add_vertex(moved_ver.x, moved_ver.y, moved_ver.z)
        else:
            new_mesh.add_vertex(ver.x, ver.y, ver.z)

for i in range(rows-1):
    for j in range(cols-1):
        idx = i * cols + j
        v0 = new_mesh.vertices[idx]
        v1 = new_mesh.vertices[idx + 1]
        v2 = new_mesh.vertices[idx + 1 + cols]
        v3 = new_mesh.vertices[idx + cols]
        new_mesh.add_face([v0,v1,v2,v3])
new_mesh.update_topology()

new_mesh_rhino = mola.module_rhino.display_mesh(new_mesh)
# ---------- end py3_10 ----------

# ---- group: movement factor
py3_11 = Python3Script(
    cols=number_slider_15,
    rows=number_slider_15,
    size_x=number_slider_13,
    size_y=number_slider_13,
    m_factor=Slider(0.56, range=0..1))  # -> out, new_mesh, new_mesh_rhino; inputs cols: Int32, rows: Int32, size_x: Double, size_y: Double, m_factor: Double; same code as movement_factor

# ---- group: pt.Z up and down
py3_12 = Python3Script(
    cols=number_slider_7,
    rows=number_slider_7,
    size_x=number_slider_6,
    size_y=number_slider_6,
    m_factor=Slider(1, range=0..10),
    trans_type=Slider(2, range=0..8),
    height=Slider(0.7, range=0..10))  # -> out, new_mesh, new_mesh_rhino; inputs cols: Int32, rows: Int32, size_x: Double, size_y: Double, m_factor: Double, trans_type: Int32
# ---------- py3_12: Python ----------
import mola
from mola import module_rhino
import random
import math

grid_mesh = mola.Mesh()
for r in range(rows):
    for c in range(cols):
        x = c * size_x / (cols - 1)
        y = r * size_y / (rows - 1)
        if trans_type == 0:
            z = math.sin(x) * math.cos(y) * 8
        if trans_type == 1:
            z = (math.sin(x * 0.5) + math.cos(y * 0.5)) * 5 # soft wavy
        if trans_type == 2:
            z = (math.sin(x * 0.4) + math.cos(y * 0.4)) * 5 + random.uniform(-1, 1) # wavy
        if trans_type == 3:
            z = math.sin(math.sqrt(x**2 + y**2)) * 6 # continuous mountains
        if trans_type == 4:
            z = math.sin(x * 0.3 + random.random()) * math.cos(y * 0.3 + random.random()) * 5 # random flat
        if trans_type == 5:
            z = (math.sin(x * 0.3) * math.cos(y * 0.3) +0.5 * math.sin(x * 0.7) * math.cos(y * 0.9)) * 6 # flat-like
        if trans_type == 6:
            z = math.sin((x**2 + y**2) * 0.1) * 5 # round wave
        if trans_type == 7:
            z = math.sin(x) * math.cos(y) * 9 + math.sin(x * 9) * math.cos(y * 9) # bumpy
        if trans_type == 8:
            z = abs(math.sin(x) * math.cos(y)) * 12 # hills
        grid_mesh.add_vertex(x, y, z * height)

# move vertices
new_mesh = mola.Mesh()
for r in range(rows):
    for c in range(cols):
        idx = r * cols + c
        ver = grid_mesh.vertices[idx]
        # select interior vertices
        if 0 < c < cols - 1 and 0 < r < rows - 1:
            m= (math.cos(idx) + math.sin(idx)) * m_factor
            moved_ver = mola.Vertex(ver.x + m, ver.y + m, ver.z)
            new_mesh.add_vertex(moved_ver.x, moved_ver.y, moved_ver.z)
        else:
            new_mesh.add_vertex(ver.x, ver.y, ver.z)

for i in range(rows-1):
    for j in range(cols-1):
        idx = i * cols + j
        v0 = new_mesh.vertices[idx]
        v1 = new_mesh.vertices[idx + 1]
        v2 = new_mesh.vertices[idx + 1 + cols]
        v3 = new_mesh.vertices[idx + cols]
        new_mesh.add_face([v0,v1,v2,v3])
new_mesh.update_topology()

new_mesh_rhino = mola.module_rhino.display_mesh(new_mesh)
# ---------- end py3_12 ----------

# ----
color_display = Python3Script()  # -> out, a
# ---------- color_display: Python ----------
import mola
from mola import module_rhino
import random

# apply colours
vals1 = [f.center().z for f in mesh.faces]
vals2 = [f.area() for f in mesh.faces]
vals3 = [random.random() for _ in range(len(mesh.faces))]
vals = [v1 * v2 for v1, v2 in zip(vals1, vals2)]
vals = vals1

cmap = mola.color_map(vals, [(.74, .32, .53), (.43, .9, .84)])
mola.color_faces_by_map(mesh.faces, cmap)
mesh.update_topology()
mesh_rhino = module_rhino.display_mesh(mesh)
# ---------- end color_display ----------

# ---- group: pt.Z up and down
py3_13 = Python3Script(
    cols=number_slider_10,
    rows=number_slider_10,
    size_x=number_slider_11,
    size_y=number_slider_11,
    m_factor=Slider(10, range=0..10),
    trans_type=Slider(2, range=0..8),
    height=Slider(1.2, range=0..10))  # -> out, new_mesh, new_mesh_rhino; inputs cols: Int32, rows: Int32, size_x: Double, size_y: Double, m_factor: Double, trans_type: Int32, height: Double; same code as py3_12

# ----
subdivide_tapered = Python3Script(mesh=py3_11.new_mesh)  # -> out, my_mesh, my_mesh_rhino
# ---------- subdivide_tapered: Python ----------
import mola
from mola import module_rhino

new_mesh = mola.Mesh()
for f in mesh.faces:
    new_faces = mola.subdivide_face_extrude_tapered(f, height=1.5, fraction=0.75)
    new_faces[-1].group = 1
    new_mesh.faces.extend(new_faces)

for f in new_mesh.faces:
    print(f.group)

my_mesh = new_mesh
my_mesh.update_topology()
my_mesh_rhino = module_rhino.display_mesh(my_mesh)
# ---------- end subdivide_tapered ----------
subdivide_tapered_2 = Python3Script(h_factor=Slider(3.6, range=0..10))  # -> out, my_mesh, my_mesh_rhino; inputs h_factor: Double
# ---------- subdivide_tapered_2: Python ----------
import mola
from mola import module_rhino
import math

new_mesh = mola.Mesh()
for i, f in enumerate(mesh.faces):
    h_para = abs(math.sin(i) * math.cos(i)) * h_factor
    new_faces = mola.subdivide_face_extrude_tapered(f, height=h_para, fraction=0.3)
    new_faces[-1].group = 1
    new_mesh.faces.extend(new_faces)

my_mesh = new_mesh
my_mesh.update_topology()

#color faces by group
values = [f.group for f in my_mesh.faces]
cmap = mola.color_map(values, [(0.176, 0.329, 0.165), (0.114, 0.129, 0.114)])
mola.color_faces_by_map(my_mesh.faces, cmap)
my_mesh.update_topology()

#display
my_mesh_rhino = module_rhino.display_mesh(my_mesh)
# ---------- end subdivide_tapered_2 ----------
subdivide_tapered_3 = Python3Script(mesh=subdivide_tapered_2.my_mesh, h_factor=Slider(3, range=0..10))  # -> out, my_mesh, my_mesh_rhino; inputs h_factor: Double
# ---------- subdivide_tapered_3: Python ----------
import mola
from mola import module_rhino
import math

new_mesh = mola.Mesh()
for i, f in enumerate(mesh.faces):
    a = len(mesh.faces)
    h_para = abs(math.sin(a - i) * math.cos(a - i)) * h_factor
    if f.group == 1:
        new_faces = mola.subdivide_face_extrude_tapered(f, height=h_para, fraction=0.4)
        new_faces[-1].group = 2
        new_mesh.faces.extend(new_faces)
    else:
        new_mesh.faces.append(f)

# for f in new_mesh.faces:
#     print(f.group)

my_mesh = new_mesh
my_mesh.update_topology()

# color faces by group
values = [f.group for f in my_mesh.faces]
cmap = mola.color_map(values, [(0, 0.286, 0.459), (0.612, 0.816, 0.941)])
mola.color_faces_by_map(my_mesh.faces, cmap)
my_mesh.update_topology()

my_mesh_rhino = module_rhino.display_mesh(my_mesh)
# ---------- end subdivide_tapered_3 ----------
subdivide_tapered_4 = Python3Script(mesh=subdivide_tapered_3.my_mesh, h_factor=Slider(2.4, range=0..10))  # -> out, my_mesh, my_mesh_rhino; inputs h_factor: Double
# ---------- subdivide_tapered_4: Python ----------
import mola
from mola import module_rhino
import math

new_mesh = mola.Mesh()
for i, f in enumerate(mesh.faces):
    a = len(mesh.faces)
    h_para = abs(math.sin(a - i) * math.cos(a - i)) * h_factor
    if f.group == 2:
        new_faces = mola.subdivide_face_extrude_tapered(f, height=h_para, fraction=0.4)
        new_faces[-1].group = 3
        new_mesh.faces.extend(new_faces)
    else:
        new_mesh.faces.append(f)

my_mesh = new_mesh
my_mesh.update_topology()

# color faces by groups
values = [f.group for f in my_mesh.faces]
cmap = mola.color_map(values, [(0.682, 0.776, 0.902), (0.875, 0.902, 0.682)])
mola.color_faces_by_map(my_mesh.faces, cmap)
my_mesh.update_topology()

my_mesh_rhino = module_rhino.display_mesh(my_mesh)
# ---------- end subdivide_tapered_4 ----------
split_grid = Python3Script(mesh=subdivide_tapered_4.my_mesh)  # -> out, my_mesh, my_mesh_rhino
# ---------- split_grid: Python ----------
import mola
from mola import module_rhino

for f in mesh.faces:
    print(f.group)

new_mesh = mola.Mesh()
for f in mesh.faces:
    if f.group == 0:
        new_faces = mola.subdivide_face_split_grid(f, nU=4, nV=1)
        new_faces[-1].group = 4
        new_faces[0].group = 4
        new_mesh.faces.append(new_faces[-1])
        new_mesh.faces.append(new_faces[0])
    elif f.group == 1:
        new_faces = mola.subdivide_face_split_grid(f, nU=4, nV=1)
        new_faces[-1].group = 5
        new_faces[0].group = 5
        new_mesh.faces.append(new_faces[-1])
        new_mesh.faces.append(new_faces[0])
    elif f.group == 2:
        new_faces = mola.subdivide_face_split_grid(f, nU=4, nV=1)
        new_faces[-1].group = 6
        new_faces[0].group = 6
        new_mesh.faces.append(new_faces[-1])
        new_mesh.faces.append(new_faces[0])
    elif f.group == 3:
        new_faces = mola.subdivide_face_split_grid(f, nU=2, nV=2)
        new_mesh.faces.extend(new_faces)

    else:
        new_mesh.faces.append(f)
    
my_mesh = new_mesh
my_mesh.update_topology()
my_mesh_rhino = module_rhino.display_mesh(my_mesh)
# ---------- end split_grid ----------
py3_14 = Python3Script(mesh=split_grid.my_mesh, iterations=Slider(1, range=0..1))  # -> out, my_mesh, my_mesh_rhino; inputs iterations: Int32
# ---------- py3_14: Python ----------
import mola
from mola import module_rhino

for i in range(iterations):
    new_mesh = mola.Mesh()
    for j, f in enumerate(mesh.faces):
        print(f.group)
        if f.group == 4:
            new_faces = mola.subdivide_face_extrude_tapered(f, 1/(i+1.5), 0.4)
            new_mesh.faces.extend(new_faces)
        # elif f.group == 3:
        #     new_faces = mola.subdivide_face_extrude_tapered(f, 1/(j), 0.4)
        #     new_mesh.faces.extend(new_faces)
        else:
            new_mesh.faces.append(f)
my_mesh = new_mesh

# color faces by group
values = [f.group for f in my_mesh.faces]
# cmap = mola.color_map(values, [(0.973, 1, 0.812),(0, 0.024, 1)])
cmap = mola.color_map(values, [(0.682, 0.776, 0.902), (0.875, 0.902, 0.682)])
mola.color_faces_by_map(my_mesh.faces, cmap)
my_mesh.update_topology()

my_mesh_rhino = module_rhino.display_mesh(my_mesh)
# ---------- end py3_14 ----------
trigger = Trigger(Interval=50, TimerInterval=50, Target=py3_15)  # disabled
wbcatmullclark = WeaverbirdsCatmullClarkSubdivision(MeshCurves=py3_14.my_mesh_rhino, Level=Slider(1, range=0..2), SmoothNakedEdges=1)
# time changing
py3_15 = Python3Script()  # -> out, my_mesh_rhino; disabled
# ---------- py3_15: Python ----------
import mola
from mola import module_rhino
import random
import math

new_mesh = mola.Mesh()

# draw vertices.z values
list_vz = [v.z for v in mesh.vertices]
min_z = min(*list_vz)
print(min_z)

s = 1
for v in mesh.vertices:
    v.x += random.uniform(-s * 0.5, s* 0.5)
    v.y += random.uniform(-s * 0.5, s * 0.5)
    if v.z > (min_z + 10):
        v.z += random.uniform(-s, s)
my_mesh = mesh
my_mesh.update_topology()
my_mesh_rhino = module_rhino.display_mesh(my_mesh)
# ---------- end py3_15 ----------

bbox = BoundingBox(Content=wbcatmullclark, Plane=PlaneXY(0, 0, 0), UnionBox=True)  # -> Box, Box_2
debrep = DeconstructBrep(Brep=bbox.Box)  # -> Faces, Edges, Vertices
number_slider_16 = Slider(350, range=0..1000)
item = ListItem(List=debrep.Faces, Index="4", Wrap=True)
area = Area(Geometry=item)  # -> Area, Centroid
scale_nu = ScaleNU(Geometry=wbcatmullclark, Plane=area.Centroid, ScaleX=number_slider_16, ScaleY=number_slider_16, ScaleZ=number_slider_16)  # -> Geometry, Transform
mesh = Mesh(scale_nu.Geometry)

mesh_2 = Mesh(wbcatmullclark)
rec = DataRecorder(py3_15.my_mesh_rhino, DataLimit=90, RecordData=True)
dam = DataDam(DataA=rec, BufferDelay=10000000, BufferMode=0)
panel_2 = Panel(rec)
item_2 = ListItem(List=dam, Index=Slider(89, range=0..89), Wrap=True)
connect_global = ConnectGlobal(
    Connect=Toggle(False),
    PointTo=False,
    Follow=Toggle(False),
    DomainId=2,
    Password="sH!611360040",
    SubChannel="test",
    UserName="sharonli")
mesh_3 = Mesh(mesh)
mesh_4 = Mesh(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)
mesh_grid = Mesh(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)
publishgeometry = PublishGeometry(Connection=connect_global, Geometry=mesh_3)  # -> Log, Content, Sequence
publishmaterial = PublishMaterial(Connection=connect_global)  # -> Log, Content, Sequence
savecontent = SaveContent(Connection=connect_global, Content=[publishmaterial.Content, publishgeometry.Content])
publishview = PublishView(LensLength=25)  # -> Log, Content, Sequence
