# Grasshopper definition 202_parametric_subdivision.ghx (Grasshopper 1.0.8)

# Step 1:
# 
# 1. Create a primitive shape
octahedron = Python3Script(ringRadius=Slider(72.9, range=0..100), tubeRadius=Slider(23.5, range=0..100))  # -> out, my_mesh, my_mesh_rhino; inputs ringRadius: Double, tubeRadius: Double
# ---------- octahedron: Python ----------
import mola
from mola import module_rhino
import math

# # construct a octahedron
# my_mesh = mola.construct_octahedron(radius)
# my_mesh.update_topology()

# my_mesh_rhino = module_rhino.display_mesh(my_mesh)


# construct a torus
my_mesh = mola.construct_torus(ringRadius, tubeRadius, ringN=16, tubeN=16)

my_mesh.update_topology()
my_mesh_rhino = module_rhino.display_mesh(my_mesh)


# my_mesh = mola.Mesh()
# theta = 2 * math.pi / ringN
# phi = 2 * math.pi / tubeN

# for i in range (ringN):
#     for j in range (tubeN):
#         my_mesh.vertices.append(_torus_vertex(ringRadius, tubeRadius, phi * j, theta * i))

# for i in range(ringN):
#     ii = (i + 1) % ringN
#     for j in range(tubeN):
#         jj = (j + 1) % tubeN
#         a = i  * tubeN + j
#         b = ii * tubeN + j
#         c = ii * tubeN + jj
#         d = i  * tubeN + jj
       
#         f = mola.Face([my_mesh.vertices[k] for k in [a, b, c, d]])
#         my_mesh.faces.append(f)

# my_mesh.update_topology()
# my_mesh_rhino = module_rhino.display_mesh(my_mesh)
# ---------- end octahedron ----------
icosahedron = Python3Script(radius=Slider(15, range=0..100))  # -> out, my_mesh, my_mesh_rhino; inputs radius: Double
# ---------- icosahedron: Python ----------
import mola
from mola import module_rhino

# construct a octahedron
my_mesh = mola.construct_icosahedron(radius)
my_mesh.update_topology()

my_mesh_rhino = module_rhino.display_mesh(my_mesh)
# ---------- end icosahedron ----------
octahedron_2 = Python3Script(radius=Slider(15, range=0..100))  # -> out, my_mesh, my_mesh_rhino; inputs radius: Double
# ---------- octahedron_2: Python ----------
import mola
from mola import module_rhino

# construct a octahedron
my_mesh = mola.construct_octahedron(radius)
my_mesh.update_topology()

my_mesh_rhino = module_rhino.display_mesh(my_mesh)
# ---------- end octahedron_2 ----------
geometry = Geometry(octahedron.my_mesh_rhino)
geometry_2 = Geometry(octahedron_2.my_mesh_rhino)
py3 = Python3Script(mola_path="C:\\Users\\Juste\\Documents\\_GitHub")  # -> out, a; inputs mola_path: String
# ---------- py3: Python ----------
import sys

if mola_path not in sys.path:
    sys.path.append(mola_path)

print(sys.path)

try:
    import mola
    from mola import module_rhino
except ImportError as e:
    print("Error importing mola: {e}")
# ---------- end py3 ----------
# Step 2:
# 
# 1. Subdivide all of the faces with
# subdivide_extrude_tapered
# 2. Assign groups so that the top of the
# extruded face is group 1
subdivide_taper = Python3Script(mesh=octahedron_2.my_mesh)  # -> out, my_mesh, my_mesh_rhino
# ---------- subdivide_taper: Python ----------
import mola
from mola import module_rhino

#first step
new_mesh = mola.Mesh()
for f in mesh.faces:
  new_faces = mola.subdivide_face_extrude_tapered(f, 8, 0.4)
  new_faces[-1].group = 1
  new_mesh.faces.extend(new_faces)

my_mesh = new_mesh
my_mesh.update_topology()

#color faces by group
values = [f.group for f in my_mesh.faces]
cmap = mola.color_map(values)
mola.color_faces_by_map(my_mesh.faces, cmap)
my_mesh.update_topology()

#display
my_mesh_rhino = module_rhino.display_mesh(my_mesh)
# ---------- end subdivide_taper ----------
# Step 3:
# 
# 1. Subdivide further so that only
# the top face (group 1) is subdivided
# again using subdivide_extrude_tapered
# 2. Assign Groups
subdivide_taper_2 = Python3Script(mesh=subdivide_taper.my_mesh)  # -> out, my_mesh, my_mesh_rhino
# ---------- subdivide_taper_2: Python ----------
import mola
from mola import module_rhino

#second step
new_mesh = mola.Mesh()
for f in mesh.faces:
  if f.group == 0:
    new_mesh.faces.append(f)
  elif f.group == 1:
    new_faces = mola.subdivide_face_extrude_tapered(f, 5, 0.4)
    new_faces[-1].group = 2
    new_mesh.faces.extend(new_faces)

my_mesh = new_mesh
my_mesh.update_topology()

#color faces by group
values = [f.group for f in my_mesh.faces]
cmap = mola.color_map(values)
mola.color_faces_by_map(my_mesh.faces, cmap)
my_mesh.update_topology()

#display
my_mesh_rhino = module_rhino.display_mesh(my_mesh)
# ---------- end subdivide_taper_2 ----------
# Step 4:
# 
# 1. Subdivide faces using subdivide_face_split_grid
# 2. Only append specific faces
# 3. Assign new groups based on old ones
subdivide_split_grid = Python3Script(mesh=subdivide_taper_2.my_mesh)  # -> out, my_mesh, my_mesh_rhino
# ---------- subdivide_split_grid: Python ----------
import mola
from mola import module_rhino

#third step
new_mesh = mola.Mesh()
for f in mesh.faces:
  if f.group == 1:
    new_faces = mola.subdivide_face_split_grid(f, 4, 1)
    new_faces[-1].group = 3
    new_faces[0].group = 3
    new_mesh.faces.append(new_faces[-1])
    new_mesh.faces.append(new_faces[0])
  elif f.group == 0:
    new_faces = mola.subdivide_face_split_grid(f, 4, 1)
    new_faces[-1].group = 4
    new_faces[0].group = 4
    new_mesh.faces.append(new_faces[-1])
    new_mesh.faces.append(new_faces[0])
  else:
    new_mesh.faces.append(f)
my_mesh = new_mesh
my_mesh.update_topology()

#display
my_mesh_rhino = module_rhino.display_mesh(my_mesh)
# ---------- end subdivide_split_grid ----------
# Step 5:
# 
# 1. Do a secondary subdivision layer on
# specific faces to create variation
number_slider = Slider(1, range=0..10)
python_3_script = Python3Script(mesh=subdivide_split_grid.my_mesh, iterations=number_slider)  # -> out, my_mesh, my_mesh_rhino; inputs iterations: Int32
# ---------- python_3_script: Python ----------
import mola
from mola import module_rhino

#fifth step
for i in range(iterations):
    new_mesh = mola.Mesh()
    for f in mesh.faces:
        if f.group == 4:
          new_faces = mola.subdivide_face_extrude_tapered(f, 1/(i+1.5), 0.4)
          new_mesh.faces.extend(new_faces)
        else:
          new_mesh.faces.append(f)
    mesh = new_mesh

my_mesh = mesh


#color faces by group
values = [f.group for f in my_mesh.faces]
cmap = mola.color_map(values)
mola.color_faces_by_map(my_mesh.faces, cmap)
my_mesh.update_topology()

#display
my_mesh_rhino = module_rhino.display_mesh(my_mesh)
# ---------- end python_3_script ----------
# Step 6:
# 
# 1. Smoothen with catmull for smooth aesthetic!
python_3_script_2 = Python3Script(mesh=python_3_script.my_mesh)  # -> out, my_mesh, my_mesh_rhino
# ---------- python_3_script_2: Python ----------
import mola
from mola import module_rhino

#sixth step
mesh.update_topology()
my_mesh = mola.subdivide_mesh_catmull(mesh)
properties = my_mesh.face_properties(mola.face_curvature)
cmap = mola.color_map(properties)

#color faces by a color map
mola.color_faces_by_map(my_mesh.faces, cmap)


# seventh step
my_mesh.update_topology()
my_mesh = mola.subdivide_mesh_catmull(my_mesh, properties)

#display
my_mesh_rhino = module_rhino.display_mesh(my_mesh)
# ---------- end python_3_script_2 ----------
