# Grasshopper definition 202_parametric_subdivision_sharon.gh (Grasshopper 1.0.8)
# plug-ins: MeshEdit Components

number_slider = Slider(15, range=0..100)
dom = ConstructDomain(DomainStart=expr("-x", number_slider), DomainEnd=number_slider)
xy = XYPlane(Origin=Point(0, 0, 0))
rectangle = Rectangle(Plane=xy, XSize=dom, YSize=dom, Radius=0)  # -> Rectangle, Length

# ----
# construct_box(x1, y1, z1, x2, y2, z2)
# construct_cone(z1, z2, radius1, radius2, nSegments, capBottom=True, capTop=True)
# construct_dodecahedron(radius=1, cx=0, cy=0, cz=0)
# construct_icosahedron(radius=1, cx=0, cy=0, cz=0)
# construct_octahedron(edgeLen=1, cx=0, cy=0, cz=0)
# construct_rhombic_dodecahedro(edge_length=1, cx=0, cy=0, cz=0)
# construct_single_face(vertices)
# construct_tetrahedron(size=1, cx=0, cy=0, cz=0)
# construct_torus(ringRadius, tubeRadius, ringN=16, tubeN=16)
number_slider_2 = Slider(15, range=0..100)

number_slider_3 = Slider(5, range=0..10)
xy_2 = XYPlane(Origin=Point(0, 0, 0))
recgrid = Rectangular(
    Plane=xy_2,
    SizeX=number_slider_3,
    SizeY=number_slider_3,
    ExtentX=Slider(10, range=0..30),
    ExtentY=Slider(10, range=0..30))  # -> Cells, Points

# ----
# curve -> quaded column
number_slider_4 = Slider(8, range=0..10)  # disabled
number_slider_5 = Slider(90, range=0..200)  # disabled
number_slider_6 = Slider(8, range=0..10)  # disabled
number_slider_7 = Slider(7, range=0..10)  # disabled
crv = Curve(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)  # disabled
py3 = Python3Script(
    curve=crv,
    num_sides=number_slider_6,
    radius=number_slider_7,
    total_height=number_slider_5,
    h_subdivisions=number_slider_4)  # -> out, top_pts, base_pts, column_mesh, list_points, column_mesh_rhino; inputs curve: Polyline, num_sides: Int32, radius: Double, total_height: Double, h_subdivisions: Int32; disabled
# ---------- py3: Python ----------
# polygon-based column mesh -> divide multi layers along zaxis -> quad meshes
"""
This script generates a column mesh structure based on either:
1. A given input curve (polyline), or
2. A generated regular polygon.

The column is subdivided vertically into layers (h_subdivisions),
and mesh faces are created between adjacent layers.
"""
import mola
from mola import module_rhino
import Rhino.Geometry as rg
import math

# extract points from polyline
def points_on_curves(curve):
    list_of_points = []
    for p in curve:
        pt = rg.Point3d(p)
        list_of_points.append(pt)
    return list_of_points

# generate points evenly distributed on a circle in XY-plane(z=0)
def points_on_polygon(num_sides, radius):
    list_of_points = []
    theta = (2*math.pi)/num_sides
    for i in range(num_sides):
        angle = i * theta
        x = radius * math.cos(angle)
        y = radius * math.sin(angle)
        z = 0
        pt = rg.Point3d(x,y,z)
        list_of_points.append(pt)
    return list_of_points

if curve is not None:
    list_points = points_on_curves(curve)
else:
    list_points = points_on_polygon(num_sides, radius)

column_mesh = mola.Mesh() # create a new mola mesh container
new_pts = [] # create a new point container for all points

# Duplicate base points and assign a new Z value for each layer.
for layer_no in range(h_subdivisions + 1): # add one more layer
    z = total_height/h_subdivisions * layer_no
    for p in list_points:
        pt = rg.Point3d(p)
        pt[2] = z # (x,y,z) # pt.Z = z
        new_pts.append(pt) # build pts along layer height
        column_mesh.add_vertex(pt[0], pt[1], pt[2]) # * unpack

len_points_per_layer = len(list_points)
print(len_points_per_layer)

top_pts = new_pts[:-len(list_points):-1]
base_pts = new_pts[:len(list_points):1]

# x = []
# y = []
# z = []
# print(*top_pts[1])
# for i, num in enumerate(*top_pts):
#     if i % 3 == 0:
#         x.append(num)
#     if i % 3 == 0:
#         y.append(num)
#     if i % 3 == 0:
#         z.append(num)

# top_face = []
# # top_face.add_face(*top_points)


for layer_no in range(h_subdivisions): # set a series of point started index
    current_layer = layer_no * len_points_per_layer
    next_layer = (layer_no + 1) * len_points_per_layer
    # print(next_layer)
    for i in range(len_points_per_layer - 1): # find the index of next point # the start and the last point are repetative
        next_i = (i+1) % (len_points_per_layer - 1)

        # Define 4 vertices for a vertical quad face (between current and next layer).
        v0 = column_mesh.vertices[current_layer + i]
        v1 = column_mesh.vertices[current_layer + next_i]
        v2 = column_mesh.vertices[next_layer + next_i]
        v3 = column_mesh.vertices[next_layer + i]
        column_mesh.add_face([v0,v1,v2,v3])

column_mesh.update_topology() # Update mesh connectivity info after adding vertices and faces.

column_mesh_rhino = module_rhino.display_mesh(column_mesh) # Convert and display the Mola mesh as a Rhino mesh in the Rhino viewport.
# ---------- end py3 ----------
geo = Geometry(py3.top_pts)  # disabled
geo_2 = Geometry(py3.base_pts)  # disabled
geo_3 = Geometry(py3.column_mesh_rhino)  # disabled
geo_4 = Geometry(py3.list_points)  # disabled

icosahedron_20 = Python3Script(radius=Slider(15, range=0..100))  # -> out, my_mesh, my_mesh_rhino; inputs radius: Double
# ---------- icosahedron_20: Python ----------
import mola
from mola import module_rhino

# construct a icosahedron 二十面體 [aɪˌkɒsəˈhiːdrən]
my_mesh = mola.construct_icosahedron(radius)
my_mesh.update_topology()

my_mesh_rhino = module_rhino.display_mesh(my_mesh)
# ---------- end icosahedron_20 ----------
dodecahedron_12 = Python3Script(radius=Slider(15, range=0..100))  # -> out, my_mesh, my_mesh_rhino; inputs radius: Double
# ---------- dodecahedron_12: Python ----------
import mola
from mola import module_rhino

# construct a dodecahedron 十二面體 /dodecahedron/
my_mesh = mola.construct_rhombic_dodecahedron(radius)
my_mesh = mola.construct_icosahedron(radius)
my_mesh.update_topology()

my_mesh_rhino = module_rhino.display_mesh(my_mesh)
# ---------- end dodecahedron_12 ----------
octahedron_8 = Python3Script(radius=number_slider_2)  # -> out, my_mesh, my_mesh_rhino; inputs radius: Double
# ---------- octahedron_8: Python ----------
import mola
from mola import module_rhino

# construct a octahedron 八面體 /ˌɒk.təˈhiː.drən/
my_mesh = mola.construct_octahedron(radius)
my_mesh.update_topology()

my_mesh_rhino = module_rhino.display_mesh(my_mesh)
# ---------- end octahedron_8 ----------
# Step 1:
# 
# 1. Create a primitive shape
box_6 = Python3Script(radius=Slider(15, range=0..100))  # -> out, my_mesh, my_mesh_rhino; inputs radius: Double
# ---------- box_6: Python ----------
import mola
from mola import module_rhino

# construct a box
my_mesh = mola.construct_box(x1=-5, y1=-5, z1=-10, x2=5, y2=5, z2=10)
my_mesh.update_topology()

my_mesh_rhino = module_rhino.display_mesh(my_mesh)
# ---------- end box_6 ----------
py3_2 = Python3Script(mola_path="C:\Users\user\github")  # -> out, a; inputs mola_path: String
# ---------- py3_2: Python ----------
import sys

if mola_path not in sys.path:
    sys.path.append(mola_path)

print(sys.path)

try:
    import mola
    from mola import module_rhino
except ImportError as e:
    print("Error importing mola: {e}")
# ---------- end py3_2 ----------
subdivide_taper = Python3Script(mesh=octahedron_8.my_mesh)  # -> out, my_mesh, my_mesh_rhino
# ---------- subdivide_taper: Python ----------
# color_map(values=[], colors=[(1, 0, 0.5), (0, 0.5, 1)])
# Maps a value to a color on a custom spectrum, list of (r,g,b))

# color_faces_by_map(faces, colors)
# assign a colour to a face

import mola
from mola import module_rhino

#first step
new_mesh = mola.Mesh()
for f in mesh.faces:
  new_faces = mola.subdivide_face_extrude_tapered(f, 8, 0.4)
  new_faces[-1].group = 1 # last face is group1, side faces are group0
  new_mesh.faces.extend(new_faces)

my_mesh = new_mesh # renew the layer, so that i can use the same logic, name again
my_mesh.update_topology()

#color faces by group
values = [f.group for f in my_mesh.faces]
print(values)
cmap = mola.color_map(values)
mola.color_faces_by_map(my_mesh.faces, cmap)
my_mesh.update_topology()

#display
my_mesh_rhino = module_rhino.display_mesh(my_mesh)
# ---------- end subdivide_taper ----------
# Step 2:
# 
# 1. Subdivide all of the faces with
# subdivide_face_extrude_tapered
# 2. Assign groups so that the top of the
# extruded face is group 1
number_slider_8 = Slider(4, range=0..10)

# ----
# subdivision
# group layer by layer
number_slider_9 = Slider(3, range=0..10)  # disabled
py3_3 = Python3Script(mesh=py3.column_mesh, h_subdivisions=number_slider_4, extrusion=number_slider_9)  # -> new_mesh, new_mesh_rhino, center_pt; inputs h_subdivisions: Int32, extrusion: Double; disabled
# ---------- py3_3: Python ----------
# subdivide_custom_triface_extrude_tapered_nonU(face, height=0.0, fraction=0.5, doCap=True)
# subdivide_face_extrude(face, height=0.0, capBottom=False, capTop=True)
# subdivide_face_extrude_tapered(face, height=0.0, fraction=0.5, doCap=True)
# subdivide_face_extrude_to_point(face, point)
# subdivide_face_extrude_to_point_center(face, height=0.0)
# subdivide_face_offset_planar(face, offsets)
# subdivide_face_split_frame(face, w)
# subdivide_face_split_grid(face, nU, nV)
# subdivide_face_split_offset(face, offset)
# subdivide_face_split_offsets(face, offsets)
# subdivide_face_split_grid(face, nU, nV)
# subdivide_face_split_rel(face, direction=(-1 or 0), split=(0 to 1))
# subdivide_face_split_rel_free_quad(face, indexEdge, split1, split2)
# subdivide_face_split_rel_multiple(face, direction, splits)
# subdivide_face_split_roof(face, height)

import mola
from mola import module_rhino
import random

new_mesh = mola.Mesh()

faces_layer = (len(mesh.faces)/h_subdivisions)
print(faces_layer)
face_amount = len(mesh.faces)
print(face_amount)

for h in range(h_subdivisions):
    for i, face in enumerate(mesh.faces):
        if h * faces_layer <= i < (h+1) * faces_layer:
            face.group = h

for i, face in enumerate(mesh.faces):
    # give faces thickness
    if face.group == 0: 
        new_faces = mola.subdivide_face_extrude(face, height=24, capBottom=True, capTop=True)
        new_mesh.faces.extend(new_faces)

    # divide face into 4 faces to make a taper
    if face.group == 1:
        new_faces = mola.subdivide_face_extrude_tapered(face, height=18, fraction=0.9, doCap=True)
        new_mesh.faces.extend(new_faces)
    
    # make face extrude toward a certin point
    t = 0.5
    if face.group == 2:
        center_pt = face.center()
        # print(center_pt)
        x = center_pt.x - (t*i*0.2)
        y = center_pt.y + (t*i*0.12)
        z = center_pt.z
        vertex = mola.Vertex(x,y,z)
        new_faces = mola.subdivide_face_extrude_to_point(face, point=vertex)
        new_mesh.faces.extend(new_faces)
    
    # extrude face with a distance
    if face.group == 3:
        j = face_amount - i
        new_faces = mola.subdivide_face_extrude_to_point_center(face, height=0.2*j)
        new_mesh.faces.extend(new_faces)

    # split into grid
    if face.group == 4:
        new_faces = mola.subdivide_face_split_grid(face, nU=3, nV=2)
        new_mesh.faces.extend(new_faces)
    
    # split face in given direction and length
    if face.group == 5:
        direction = random.randint(-1,0)
        split = random.uniform(0,1)
        new_faces = mola.subdivide_face_split_rel(face, direction, split)
        new_mesh.faces.extend(new_faces)
    
    # Splits a quad in two new quads through the points specified by relative position along the edge.
    if face.group == 6:
        indexEdge = random.randint(0,1)
        split1 = random.uniform(0,1)
        split2 = random.uniform(0,1)
        new_faces = mola.subdivide_face_split_rel_free_quad(face, indexEdge, split1, split2)
        new_mesh.faces.extend(new_faces)
    
    # Extrudes a pitched roof
    if face.group == 7:
        new_faces = mola.subdivide_face_split_roof(face, height=2.4)
        new_mesh.faces.extend(new_faces)

new_mesh.update_topology()
new_mesh_rhino = module_rhino.display_mesh(new_mesh)
# mola.subdivide_face_split_frame(face, w)
# ---------- end py3_3 ----------

subdivide_taper_2 = Python3Script(mesh=subdivide_taper.my_mesh)  # -> out, my_mesh, my_mesh_rhino; disabled
# ---------- subdivide_taper_2: Python ----------
import mola
from mola import module_rhino

#first step
new_mesh = mola.Mesh()
for f in mesh.faces:
  new_faces = mola.subdivide_face_extrude_tapered(f, 8, 0.4)
  new_faces[-1].group = 1 # last face is group 1
  new_mesh.faces.extend(new_faces)

my_mesh = new_mesh
my_mesh.update_topology()

#color faces by group
values = [f.group for f in my_mesh.faces]
cmap = mola.color_map(values)
mola.color_faces_by_map(my_mesh.faces, cmap)
my_mesh.update_topology()

#display
my_mesh_rhino = module_rhino.display_mesh(my_mesh)
# ---------- end subdivide_taper_2 ----------
explode = MeshExplode(Mesh=subdivide_taper.my_mesh_rhino, Interpolate=False)
item = ListItem(List=explode, Index=number_slider_8, Wrap=True)
subdivide_taper_3 = Python3Script(mesh=subdivide_taper_2.my_mesh)  # -> out, my_mesh, my_mesh_rhino; disabled; same code as subdivide_taper_2
# Step 3:
# 
# 1. Subdivide further so that only
# the top face (group 1) is subdivided
# again using subdivide_face_extrude_tapered
# 2. Assign Groups
subdivide_taper_4 = Python3Script(mesh=subdivide_taper.my_mesh)  # -> out, my_mesh, my_mesh_rhino
# ---------- subdivide_taper_4: Python ----------
import mola
from mola import module_rhino

#second step
new_mesh = mola.Mesh()
for f in mesh.faces:
  if f.group == 0: # if:「獨立條件」，每個都會檢查一次
    new_mesh.faces.append(f)
  elif f.group == 1: # elif:「互斥條件」，只會執行其中一個分支
    new_faces = mola.subdivide_face_extrude_tapered(f, 5, 0.4)
    new_faces[-1].group = 2
    new_mesh.faces.extend(new_faces)

my_mesh = new_mesh # renew the current mesh layer
my_mesh.update_topology()

#color faces by group
values = [f.group for f in my_mesh.faces]
cmap = mola.color_map(values)
mola.color_faces_by_map(my_mesh.faces, cmap)
my_mesh.update_topology()

#display
my_mesh_rhino = module_rhino.display_mesh(my_mesh)
# ---------- end subdivide_taper_4 ----------
# Step 2:
# 
# 1. Subdivide all of the faces with
# subdivide_face_extrude_tapered
# 2. Assign groups so that the top of the
# extruded face is group 1
subdivide_taper_5 = Python3Script()  # -> out, my_mesh, my_mesh_rhino
# ---------- subdivide_taper_5: Python ----------
# color_map(values=[], colors=[(1, 0, 0.5), (0, 0.5, 1)])
# Maps a value to a color on a custom spectrum, list of (r,g,b))

# color_faces_by_map(faces, colors)
# assign a colour to a face

import mola
from mola import module_rhino

#first step
new_mesh = mola.Mesh()
for f in mesh.faces:
  new_faces = mola.subdivide_face_extrude_tapered(f, 3, 0.7)
  new_faces[-1].group = 1 # last face is group1, side faces are group0
  new_mesh.faces.extend(new_faces)

my_mesh = new_mesh # renew the layer, allowing to use the same logic, name again
my_mesh.update_topology()

#color faces by group
values = [f.group for f in my_mesh.faces]
print(values)
cmap = mola.color_map(values)
mola.color_faces_by_map(my_mesh.faces, cmap)
my_mesh.update_topology()

#display
my_mesh_rhino = module_rhino.display_mesh(my_mesh)
# ---------- end subdivide_taper_5 ----------
# Step 3:
# 
# 1. Subdivide further so that only
# the top face (group 1) is subdivided
# again using subdivide_face_extrude_tapered
# 2. Assign Groups
subdivide_taper_6 = Python3Script(mesh=subdivide_taper_5.my_mesh)  # -> out, my_mesh, my_mesh_rhino; same code as subdivide_taper_4
# Step 4:
# 
# 1. Subdivide faces using subdivide_face_split_grid
# 2. Only append specific faces
# 3. Assign new groups based on old ones
subdivide_split_grid = Python3Script(mesh=subdivide_taper_4.my_mesh)  # -> out, my_mesh, my_mesh_rhino
# ---------- subdivide_split_grid: Python ----------
# subdivide_face_split_grid(face, nU, nV)
# splits a triangle, quad or a rectangle into a regular grid

import mola
from mola import module_rhino

#third step
new_mesh = mola.Mesh()
for f in mesh.faces:
  if f.group == 1: # the purple one
    new_faces = mola.subdivide_face_split_grid(f, nU=4, nV=1) # divided into 4 grids
    new_faces[-1].group = 3 # the last face is group3
    new_faces[0].group = 3 # the first face is group3
    new_mesh.faces.append(new_faces[-1]) # append the last face in new_mesh container
    new_mesh.faces.append(new_faces[0]) ## append the first face in new_mesh container
  elif f.group == 0: # the pink one
    new_faces = mola.subdivide_face_split_grid(f, nU=4, nV=1)
    new_faces[-1].group = 4 #  the last face is group4
    new_faces[0].group = 4
    new_mesh.faces.append(new_faces[-1])
    new_mesh.faces.append(new_faces[0])
  else: # group2 = prink
    new_mesh.faces.append(f)
my_mesh = new_mesh
my_mesh.update_topology()

#color faces by group
values = [f.group for f in my_mesh.faces]
cmap = mola.color_map(values)
mola.color_faces_by_map(my_mesh.faces, cmap)
my_mesh.update_topology()

#display
my_mesh_rhino = module_rhino.display_mesh(my_mesh)
# ---------- end subdivide_split_grid ----------
subdivide_split_grid_2 = Python3Script(mesh=subdivide_taper_4.my_mesh)  # -> out, my_mesh, my_mesh_rhino
# ---------- subdivide_split_grid_2: Python ----------
# subdivide_face_split_grid(face, nU, nV)
# splits a triangle, quad or a rectangle into a regular grid

import mola
from mola import module_rhino

#third step
new_mesh = mola.Mesh()
for f in mesh.faces:
  if f.group == 1:
    new_faces = mola.subdivide_face_split_grid(f, 4, 1)
    # new_faces[-1].group = 3
    # new_faces[0].group = 3
    # new_mesh.faces.append(new_faces[-1])
    # new_mesh.faces.append(new_faces[0])
    new_mesh.faces.extend(new_faces)
#   elif f.group == 0:
#     new_faces = mola.subdivide_face_split_grid(f, 4, 1)
#     new_faces[-1].group = 4
#     new_faces[0].group = 4
#     new_mesh.faces.append(new_faces[-1])
#     new_mesh.faces.append(new_faces[0])
  else:
    new_mesh.faces.append(f)
my_mesh = new_mesh
my_mesh.update_topology()

#color faces by group
values = [f.group for f in my_mesh.faces]
cmap = mola.color_map(values)
mola.color_faces_by_map(my_mesh.faces, cmap)
my_mesh.update_topology()

#display
my_mesh_rhino = module_rhino.display_mesh(my_mesh)
# ---------- end subdivide_split_grid_2 ----------
# Step 5:
# 
# 1. Do a secondary subdivision layer on
# specific faces to create variation
number_slider_10 = Slider(1, range=0..10)
_3_subdivide_taper = Python3Script(extrusion=Slider(2.4, range=0..10), fraction=Slider(0.75, range=0..1))  # -> out, my_mesh, my_mesh_rhino; inputs extrusion: Double, fraction: Double
# ---------- _3_subdivide_taper: Python ----------
import mola
from mola import module_rhino

new_mesh = mola.Mesh()

for face in mesh.faces:
    if face.group == 0:
        new_mesh.faces.append(face)
    elif face.group == 1:
        new_faces = mola.subdivide_face_extrude_tapered(face, height= extrusion, fraction=fraction, doCap=True)
        new_faces[-1].group = 2
        new_mesh.faces.extend(new_faces)


my_mesh = new_mesh
my_mesh.update_topology()

values = [f.group for f in my_mesh.faces]
cmap = mola.color_map(values)
mola.color_faces_by_map(my_mesh.faces, cmap)

my_mesh.update_topology()
my_mesh_rhino = module_rhino.display_mesh(my_mesh)
# ---------- end _3_subdivide_taper ----------
# Step 4:
# 
# 1. Subdivide faces using subdivide_face_split_grid
# 2. Only append specific faces
# 3. Assign new groups based on old ones
subdivide_split_grid_3 = Python3Script(mesh=subdivide_taper_5.my_mesh)  # -> out, my_mesh, my_mesh_rhino; same code as subdivide_split_grid
python_3_script = Python3Script(iterations=number_slider_10)  # -> out, my_mesh, my_mesh_rhino; inputs iterations: Int32
# ---------- python_3_script: Python ----------
import mola
from mola import module_rhino

#fifth step
for i in range(iterations):
    new_mesh = mola.Mesh()
    for f in mesh.faces:
        if f.group == 4: # blue part
          new_faces = mola.subdivide_face_extrude_tapered(f, 1/(i+1.5), 0.4)
          new_mesh.faces.extend(new_faces)
        else:
          new_mesh.faces.append(f)
    mesh = new_mesh

my_mesh = mesh


#color faces by group
values = [f.group for f in my_mesh.faces]
cmap = mola.color_map(values)
mola.color_faces_by_map(my_mesh.faces, cmap)
my_mesh.update_topology()

#display
my_mesh_rhino = module_rhino.display_mesh(my_mesh)
# ---------- end python_3_script ----------
_4_subdivide_face_split_grid = Python3Script()  # -> out, my_mesh, my_mesh_rhino
# ---------- _4_subdivide_face_split_grid: Python ----------
import mola
from mola import module_rhino

new_mesh = mola.Mesh()
for f in mesh.faces:
    if f.group == 0:
        new_faces = mola.subdivide_face_split_grid(f, nU=4, nV=1)
        new_faces[0].group = 3
        new_faces[-1].group = 3
        new_mesh.faces.append(new_faces[0])
        new_mesh.faces.append(new_faces[-1])
    elif f.group == 1:
        new_faces = mola.subdivide_face_split_grid(f, nU=4, nV=1)
        new_faces[0].group = 4
        new_faces[-1].group = 4
        new_mesh.faces.append(new_faces[0])
        new_mesh.faces.append(new_faces[-1])
    else:
        new_mesh.faces.append(f)
my_mesh = new_mesh
my_mesh.update_topology()

values = [f.group for f in my_mesh.faces]
cmap = mola.color_map(values)
mola.color_faces_by_map(my_mesh.faces, cmap)

my_mesh.update_topology()
my_mesh_rhino = module_rhino.display_mesh(my_mesh)
# ---------- end _4_subdivide_face_split_grid ----------
# Step 5:
# 
# 1. Do a secondary subdivision layer on
# specific faces to create variation
number_slider_11 = Slider(1, range=0..10)
_5_subdivide_taper = Python3Script(iterations=Slider(1, range=0..5))  # -> out, my_mesh, my_mesh_rhino; inputs iterations: Int32
# ---------- _5_subdivide_taper: Python ----------
import mola
from mola import module_rhino

new_mesh = mola.Mesh()
for i in range(iterations):
    for f in mesh.faces:
        if f.group == 4:
            new_faces = mola.subdivide_face_extrude_tapered(f, height=1/(i+1.5), fraction=0.4, doCap=True)
            new_mesh.faces.extend(new_faces)
        else:
            new_mesh.faces.append(f)
my_mesh = new_mesh

values = [f.group for f in my_mesh.faces]
cmap = mola.color_map(values)
mola.color_faces_by_map(my_mesh.faces, cmap)

my_mesh.update_topology()
my_mesh_rhino = module_rhino.display_mesh(my_mesh)
# ---------- end _5_subdivide_taper ----------
# Step 6:
# 
# 1. Smoothen with catmull for smooth aesthetic!
python_3_script_2 = Python3Script()  # -> out, my_mesh, my_mesh_rhino
# ---------- python_3_script_2: Python ----------
# subdivide_mesh_catmull(mesh, values=[])

import mola
from mola import module_rhino

#sixth step
mesh.update_topology()
my_mesh = mola.subdivide_mesh_catmull(mesh)
properties = my_mesh.face_properties(mola.face_curvature)
# properties = my_mesh.face_properties(mola.face_angle_horizontal)
# properties = my_mesh.face_properties(mola.face_center_z)
# properties = my_mesh.face_properties(mola.face_area)
cmap = mola.color_map(properties)

#color faces by a color map
mola.color_faces_by_map(my_mesh.faces, cmap)


# seventh step
# my_mesh.update_topology()
# my_mesh = mola.subdivide_mesh_catmull(my_mesh, properties)

#display
my_mesh_rhino = module_rhino.display_mesh(my_mesh)
# ---------- end python_3_script_2 ----------
python_3_script_3 = Python3Script(mesh=subdivide_split_grid_3.my_mesh, iterations=number_slider_11)  # -> out, my_mesh, my_mesh_rhino; inputs iterations: Int32; same code as python_3_script
_6_mesh_catmull = Python3Script()  # -> out, my_mesh, my_mesh_rhino
# ---------- _6_mesh_catmull: Python ----------
#subdivide_mesh_catmull(mesh, values=[])

import mola
from mola import module_rhino

mesh.update_topology()
my_mesh = mola.subdivide_mesh_catmull(mesh)
properties = my_mesh.face_properties(mola.face_area)
# properties = my_mesh.face_properties(mola.face_angle_horizontal)
# properties = my_mesh.face_properties(mola.face_center_z)
# properties = my_mesh.face_properties(mola.face_curvature)

cmap = mola.color_map(properties)
mola.color_faces_by_map(my_mesh.faces, cmap)

my_mesh.update_topology()
my_mesh = mola.subdivide_mesh_catmull(my_mesh, properties)

my_mesh_rhino = module_rhino.display_mesh(my_mesh)
# ---------- end _6_mesh_catmull ----------
# Step 6:
# 
# 1. Smoothen with catmull for smooth aesthetic!
python_3_script_4 = Python3Script()  # -> out, my_mesh, my_mesh_rhino; same code as python_3_script_2

explode_2 = Explode(Curve=rectangle.Rectangle, Recursive=True)  # -> Segments, Vertices

number_slider_12 = Slider(3, range=0..100)
midpt = CurveMiddle(Curve=explode_2.Segments)
dom_2 = ConstructDomain(DomainStart=expr("-x", number_slider_12), DomainEnd=number_slider_12)
xy_3 = XYPlane(Origin=midpt)
rectangle_2 = Rectangle(Plane=xy_3, XSize=dom_2, YSize=dom_2, Radius=0)  # -> Rectangle, Length

end = EndPoints(Curve=explode_2.Segments)  # -> Start, End
number_slider_13 = Slider(5, range=0..100)
dom_3 = ConstructDomain(DomainStart=expr("-x", number_slider_13), DomainEnd=number_slider_13)
xy_4 = XYPlane(Origin=end.Start)
rectangle_3 = Rectangle(Plane=xy_4, XSize=dom_3, YSize=dom_3, Radius=0)  # -> Rectangle, Length
rotate = Rotate(Geometry=rectangle_3.Rectangle, Angle=degrees(Slider(45, range=0..180)), Plane=end.Start)  # -> Geometry, Transform

merge = Merge(Data1=rectangle_2.Rectangle, Data2=rotate.Geometry)
rdiff = RegionDifference(CurvesA=rectangle.Rectangle, CurvesB=merge)

number_slider_14 = Slider(8, range=0..10)
crv_2 = Curve(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)
py3_4 = Python3Script(
    curve=rdiff,
    num_sides=Slider(12, range=0..20),
    radius=Slider(30, range=0..100),
    total_height=Slider(150, range=0..200),
    h_subd=number_slider_14)  # -> out, new_pts, column_mesh, column_mesh_rhino; inputs curve: Polyline, num_sides: Int32, radius: Double, total_height: Double, h_subd: Int32
# ---------- py3_4: Python ----------
import mola
from mola import module_rhino
import Rhino.Geometry as rg
import math

# extract points from polyline
def points_on_curve(curve):
    list_of_points = []
    for p in curve:
        pt = rg.Point3d(p)
        list_of_points.append(pt)
    return list_of_points

def points_on_polygon(num_sides, radius):
    list_of_points =[]
    theta = (2*math.pi) / num_sides
    for i in range(num_sides):
        angle = theta * i
        x = radius * math.cos(angle)
        y = radius * math.sin(angle)
        z = 0
        pt = rg.Point3d(x,y,z)
    return list_of_points.append(pt)

if curve is not None:
    list_points = points_on_curve(curve)
else:
    list_points = points_on_polygon(num_sides, radius)

column_mesh = mola.Mesh()
new_pts =[]

for layer_no in range(h_subd + 1):
    z = total_height / h_subd * layer_no
    for p in list_points:
        pt = rg.Point3d(p)
        pt.Z = z
        new_pts.append(pt)
        # print(new_pts)
        column_mesh.add_vertex(*pt)

num_pts_each_layer = len(list_points)
print(num_pts_each_layer)

for layer_no in range(h_subd):
    current_layer = num_pts_each_layer * layer_no
    next_layer = num_pts_each_layer * (layer_no + 1)
    for i in range(num_pts_each_layer - 1): # start and end points are the same
        next_i = (i + 1) % (num_pts_each_layer - 1)
        v0 = column_mesh.vertices[current_layer + i]
        v1 = column_mesh.vertices[current_layer + next_i]
        v2 = column_mesh.vertices[next_layer + next_i]
        v3 = column_mesh.vertices[next_layer + i]
        column_mesh.add_face([v0, v1, v2, v3])

column_mesh.update_topology()
column_mesh_rhino = module_rhino.display_mesh(column_mesh)
# ---------- end py3_4 ----------
geo_5 = Geometry(py3_4.column_mesh_rhino)

py3_5 = Python3Script(mesh=py3_4.column_mesh, h_subd=number_slider_14, extrusion=Slider(9, range=0..10))  # -> out, new_mesh, new_mesh_rhino; inputs h_subd: Int32, extrusion: Double
# ---------- py3_5: Python ----------
# subdivide_face_extrude(face, height=0.0, capBottom=False, capTop=True)
# subdivide_face_split_grid(face, nU, nV)

import mola
from mola import module_rhino
import Rhino.Geometry as rg

new_mesh = mola.Mesh()

num_faces_each_layer = (len(mesh.faces) / h_subd)
print(num_faces_each_layer)

for h in range(h_subd):
    for i, face in enumerate(mesh.faces):
        if h * num_faces_each_layer<= i < (h+1) * num_faces_each_layer:
            face.group = h

for i, face in enumerate(mesh.faces):
    if face.group == 0  or face.group == 7:
        new_faces = mola.subdivide_face_extrude(face, height=extrusion * 1.25, capBottom=True, capTop=True)
        new_mesh.faces.extend(new_faces)

    if face.group == 1 or face.group == 6:
        new_faces = mola.subdivide_face_extrude(face, height=extrusion, capBottom=True, capTop=True)
        new_mesh.faces.extend(new_faces)

    if face.group == 2 or face.group == 5:
        new_faces = mola.subdivide_face_split_grid(face, nU=3, nV=4)
        new_mesh.faces.extend(new_faces)

    if face.group == 3 or face.group == 4:
        new_faces = mola.subdivide_face_split_grid(face, nU=3, nV=6)
        new_mesh.faces.extend(new_faces)

new_mesh.update_topology()
new_mesh_rhino = module_rhino.display_mesh(new_mesh)
# ---------- end py3_5 ----------

py3_6 = Python3Script(mesh=py3_4.column_mesh, h_subd=number_slider_14, extrusion=Slider(9, range=0..10))  # -> out, new_mesh, new_mesh_rhino; inputs h_subd: Int32, extrusion: Double
# ---------- py3_6: Python ----------
# subdivide_face_extrude_to_point(face, point)
# subdivide_face_extrude_to_point_center(face, height=0.0)
# subdivide_face_split_grid(face, nU, nV)
# subdivide_face_split_roof(face, height)

import mola
from mola import module_rhino
import Rhino.Geometry as rg

new_mesh = mola.Mesh()

num_faces_each_layer = (len(mesh.faces) / h_subd)
print(num_faces_each_layer)

for h in range(h_subd):
    for i, face in enumerate(mesh.faces):
        if h * num_faces_each_layer<= i < (h+1) * num_faces_each_layer:
            face.group = h

for i, face in enumerate(mesh.faces):
    if face.group == 0:
        new_faces = mola.subdivide_face_extrude(face, height=extrusion * 1.25, capBottom=False, capTop=True)
        new_mesh.faces.extend(new_faces)

    if face.group == 1:
        new_faces = mola.subdivide_face_split_grid(face, nU=3, nV=6)
        new_mesh.faces.extend(new_faces)

    if face.group == 2:
        new_faces = mola.subdivide_face_split_grid(face, nU=2, nV=5)
        new_mesh.faces.extend(new_faces)

    if face.group == 3:
        if i % 2 == 0:
            fac = 0.5
        if i % 2 != 0:
            fac = -0.5
        cenPt = face.center()
        nor = face.normal()
        nor.unitize()
        # use normal to create new points
        dist = extrusion
        x = cenPt.x + nor.x * dist
        y = cenPt.y + nor.y * dist
        z = cenPt.z + nor.y * dist * fac
        pt = mola.Vertex(x,y,z)
        new_faces = mola.subdivide_face_extrude_to_point(face, point=pt)
        new_mesh.faces.extend(new_faces)
    
    if face.group == 4:
        new_faces = mola.subdivide_face_split_grid(face, nU=2, nV=5)
        new_mesh.faces.extend(new_faces)
    
    if face.group == 5:
        new_faces = mola.subdivide_face_split_roof(face, height=extrusion * 0.65)
        new_mesh.faces.extend(new_faces)
    
    if face.group == 6:
        new_faces = mola.subdivide_face_extrude_to_point_center(face, height=extrusion * 1.25)
        new_mesh.faces.extend(new_faces)

new_mesh.update_topology()
new_mesh_rhino = module_rhino.display_mesh(new_mesh)
# ---------- end py3_6 ----------

# ----
# grid_tapered
number_slider_15 = Slider(4.5, range=0..10)
py3_7 = Python3Script(mesh=py3_5.new_mesh, extrusion=number_slider_15)  # -> out, new_mesh, new_mesh_rhino; inputs extrusion: Double
# ---------- py3_7: Python ----------
# subdivide_face_extrude_tapered(face, height=0.0, fraction=0.5, doCap=True)
import mola
from mola import module_rhino

new_mesh = mola.Mesh()

for i, face in enumerate(mesh.faces):
    n = len(mesh.faces)
    pos_ex_fac = extrusion * (i/n)
    neg_ex_fac = extrusion * (1 - i/n)
    if face.group == 2 or face.group == 3:
        new_face = mola.subdivide_face_extrude_tapered(face, height=pos_ex_fac , fraction=0.85, doCap=True)
        new_mesh.faces.extend(new_face)

    if face.group == 4 or face.group == 5:
        new_face = mola.subdivide_face_extrude_tapered(face, height=neg_ex_fac, fraction=0.5, doCap=True)
        new_mesh.faces.extend(new_face)
    else:
        new_mesh.faces.append(face)

for f in new_mesh.faces:
    f.group = 0

new_mesh.update_topology()
new_mesh_rhino = module_rhino.display_mesh(new_mesh)
# ---------- end py3_7 ----------

py3_8 = Python3Script(mesh=py3_6.new_mesh)  # -> out, a
# ---------- py3_8: Python ----------
import mola
from mola import module_rhino

new_mesh = mola.Mesh()
# ---------- end py3_8 ----------
_2_subdivide_taper = Python3Script(mesh=py3_7.new_mesh, extrusion=Slider(3, range=0..10), fraction=Slider(0.65, range=0..1))  # -> out, my_mesh, my_mesh_rhino; inputs extrusion: Double, fraction: Double
# ---------- _2_subdivide_taper: Python ----------
import mola
from mola import module_rhino

new_mesh = mola.Mesh()
for f in mesh.faces:
    new_faces = mola.subdivide_face_extrude_tapered(f, height=3.0, fraction=0.75, doCap=True)
    new_faces[-1].group = 1
    new_mesh.faces.extend(new_faces)

my_mesh = new_mesh
my_mesh.update_topology()

values = [f.group for f in my_mesh.faces]
# cmap = mola.color_map(values, colors=[(1, 0, 0.5), (0, 0.5, 1)])
cmap = mola.color_map(values)
mola.color_faces_by_map(my_mesh.faces, cmap)

my_mesh.update_topology()
my_mesh_rhino = module_rhino.display_mesh(my_mesh)
# ---------- end _2_subdivide_taper ----------
subdivide_taper_7 = Python3Script(mesh=py3_7.new_mesh)  # -> out, my_mesh, my_mesh_rhino
# ---------- subdivide_taper_7: Python ----------
# color_map(values=[], colors=[(1, 0, 0.5), (0, 0.5, 1)])
# Maps a value to a color on a custom spectrum, list of (r,g,b))

# color_faces_by_map(faces, colors)
# assign a colour to a face

import mola
from mola import module_rhino

#first step
new_mesh = mola.Mesh()
for f in mesh.faces:
  new_faces = mola.subdivide_face_extrude_tapered(f, 3, 0.7)
  new_faces[-1].group = 1 # last face is group1, side faces are group0
  new_mesh.faces.extend(new_faces)

my_mesh = new_mesh # renew the layer, allowing use the same logic, name again
my_mesh.update_topology()

#color faces by group
values = [f.group for f in my_mesh.faces]
print(values)
cmap = mola.color_map(values)
mola.color_faces_by_map(my_mesh.faces, cmap)
my_mesh.update_topology()

#display
my_mesh_rhino = module_rhino.display_mesh(my_mesh)
# ---------- end subdivide_taper_7 ----------
