# Grasshopper definition 101_primitives_and_subdivisions_ex.gh (Grasshopper 1.0.8)

# ---- group: EXAMPLES
py3 = Python3Script(radius=Slider(5.751, range=0..10), num_sides=Slider(5, range=0..10))  # -> out, new_mesh_rhino; inputs num_sides: Int32
# ---------- py3: Python ----------
import math
import Rhino.Geometry as rg
import mola
from mola import module_rhino

points = []

tetha = (2*math.pi)/num_sides

new_mesh = mola.Mesh()

for i in range(num_sides):
    angle = i*tetha
    x = radius*math.cos(angle)
    y = radius*math.sin(angle)
    z = 0
    pt = rg.Point3d(x,y,z)
    points.append(pt)
    new_mesh.add_vertex(x,y,z)

new_mesh.add_face([*new_mesh.vertices])
new_mesh.add_vertex(0,0,20)

for i in range(num_sides):
    v1 = new_mesh.vertices[i]
    v2 = new_mesh.vertices[(i+1)%num_sides]
    print((i+1)%num_sides)
    cen = new_mesh.vertices[-1]
    new_mesh.add_face([v1,v2,cen])


new_mesh_rhino = module_rhino.display_mesh(new_mesh)
# ---------- end py3 ----------
torus = Python3Script(ringRadius=Slider(72.9, range=0..100), tubeRadius=Slider(23.5, range=0..100))  # -> out, my_mesh, my_mesh_rhino; inputs ringRadius: Double, tubeRadius: Double
# ---------- torus: Python ----------
import mola
from mola import module_rhino
import math

# # construct a octahedron
# my_mesh = mola.construct_octahedron(radius)
# my_mesh.update_topology()

# my_mesh_rhino = module_rhino.display_mesh(my_mesh)


# construct a torus
my_mesh = mola.construct_torus(ringRadius, tubeRadius, ringN=16, tubeN=16)

my_mesh.update_topology()
my_mesh_rhino = module_rhino.display_mesh(my_mesh)


# my_mesh = mola.Mesh()
# theta = 2 * math.pi / ringN
# phi = 2 * math.pi / tubeN

# for i in range (ringN):
#     for j in range (tubeN):
#         my_mesh.vertices.append(_torus_vertex(ringRadius, tubeRadius, phi * j, theta * i))

# for i in range(ringN):
#     ii = (i + 1) % ringN
#     for j in range(tubeN):
#         jj = (j + 1) % tubeN
#         a = i  * tubeN + j
#         b = ii * tubeN + j
#         c = ii * tubeN + jj
#         d = i  * tubeN + jj
       
#         f = mola.Face([my_mesh.vertices[k] for k in [a, b, c, d]])
#         my_mesh.faces.append(f)

# my_mesh.update_topology()
# my_mesh_rhino = module_rhino.display_mesh(my_mesh)
# ---------- end torus ----------
polygon_cyldr = Python3Script(
    radius1=Slider(49.1, range=0..100),
    radius2=Slider(34.4, range=0..100),
    nSegments=Slider(6, range=0..100),
    z1=Slider(0, range=0..100),
    z2=Slider(27, range=0..100),
    capBottom=Toggle(True),
    capTop=Toggle(True))  # -> out, my_mesh, my_mesh_rhino; inputs radius1: Double, radius2: Double, nSegments: Int32, z1: Int32, z2: Int32, capTop: Double
# ---------- polygon_cyldr: Python ----------
import mola
from mola import module_rhino
import math



# construct a polygon_cylinder
my_mesh = mola.construct_cone (z1, z2, radius1, radius2, nSegments, capBottom, capTop)

my_mesh.update_topology()
my_mesh_rhino = module_rhino.display_mesh(my_mesh)
# ---------- end polygon_cyldr ----------
geo = Geometry(py3.new_mesh_rhino)
geometry = Geometry(polygon_cyldr.my_mesh_rhino)
geometry_2 = Geometry(torus.my_mesh_rhino)
number_slider = Slider(7, range=0..10)  # disabled
number_slider_2 = Slider(3, range=0..10)  # disabled
py3_2 = Python3Script(x=number_slider, y=number_slider, z=number_slider, x1=number_slider_2, y1=number_slider_2, z1=number_slider_2)  # -> out, my_mesh, my_mesh_rhino; disabled
# ---------- py3_2: Python ----------
import mola
from mola import module_rhino

my_mesh = mola.construct_box(x,y,x,x1,y1,z1)
my_mesh_rhino = module_rhino.display_mesh(my_mesh)
# ---------- end py3_2 ----------
geo_2 = Geometry(py3_2.my_mesh_rhino)  # disabled
number_slider_3 = Slider(2, range=0..10)  # disabled
py3_3 = Python3Script(mesh=py3_2.my_mesh, r=number_slider_3)  # -> out, new_mesh, my_mesh_rhino; inputs r: Int32; disabled
# ---------- py3_3: Python ----------
import mola
from mola import module_rhino

for i in range(r):
    new_mesh = mola.Mesh()
    for face in mesh.faces:
        resulting_face = mola.subdivide_face_extrude_to_point_center(face, -i*2)
        new_mesh.faces.extend(resulting_face)
    mesh =new_mesh

new_mesh.update_topology()
my_mesh_rhino = module_rhino.display_mesh(new_mesh)
# ---------- end py3_3 ----------
number_slider_4 = Slider(2, range=0..10)  # disabled
py3_4 = Python3Script(mesh=py3_3.new_mesh, r=number_slider_4)  # -> out, my_mesh_rhino; inputs r: Int32; disabled
# ---------- py3_4: Python ----------
import mola
from mola import module_rhino

new_mesh = mesh

for i in range(r):
    new_mesh = mola.subdivide_mesh_catmull(new_mesh)

mola.color_faces_by_area(new_mesh.faces)
my_mesh_rhino = module_rhino.display_mesh(new_mesh)
# ---------- end py3_4 ----------
panel = Panel(py3_4.my_mesh_rhino)  # disabled
geo_3 = Geometry(py3_4.my_mesh_rhino)  # disabled
number_slider_5 = Slider(2, range=0..10)  # disabled
py3_5 = Python3Script(r=number_slider_5)  # -> out, new_mesh, my_mesh_rhino; disabled
# ---------- py3_5: Python ----------
import mola
from mola import module_rhino

my_mesh = mola.construct_sphere(r,3,3)

for v in my_mesh.vertices:  # create egg shape (oval)
    if v.z>0:
        v.z *= 1.5

my_mesh = mola.subdivide_mesh_catmull(my_mesh)

my_properties = my_mesh.face_properties(mola.face_center_z)


mola.color_faces_by_vertical_angle(my_mesh.faces)

heights = mola.math_map_list(my_properties, 0.0, 2.0)

new_mesh = mola.Mesh()
for i, f in enumerate(my_mesh.faces):
    if heights[i] > 0.5:
        doCap = False
    else: 
        doCap = True
    resulting_faces = mola.subdivide_face_extrude_tapered(f, heights[i], 0.6, doCap)
    new_mesh.faces.extend(resulting_faces)

new_mesh.update_topology()
new_mesh = mola.mesh_offset(new_mesh,0.2)

for i in range(1):
    new_mesh = mola.subdivide_mesh_catmull(new_mesh)

props = new_mesh.face_properties(mola.face_center_z)
color_scheme = [(0,0,1),(1,0,1), (0.5,0.5,0.5), (1,1,1)]
colors = mola.color_map(props , color_scheme)
mola.color_faces_by_map(new_mesh.faces,colors)


new_mesh.update_topology()
my_mesh_rhino = module_rhino.display_mesh(new_mesh)
# ---------- end py3_5 ----------

# ----
number_slider_6 = Slider(10, range=0..10)  # disabled
number_slider_7 = Slider(115, range=0..600)  # disabled
number_slider_8 = Slider(10, range=0..10)  # disabled
number_slider_9 = Slider(4, range=0..30)  # disabled

# ---- group: CHAIR
number_slider_10 = Slider(12, range=-20..600)  # disabled
number_slider_11 = Slider(12, range=-20..600)  # disabled
number_slider_12 = Slider(10, range=0..10)  # disabled
number_slider_13 = Slider(3, range=0..10)  # disabled
number_slider_14 = Slider(1, range=0..30)  # disabled
number_slider_15 = Slider(10, range=0..10)  # disabled
number_slider_16 = Slider(10, range=0..10)  # disabled
number_slider_17 = Slider(115, range=0..600)  # disabled
number_slider_18 = Slider(3, range=0..10)  # disabled
number_slider_19 = Slider(1, range=0..30)  # disabled
number_slider_20 = Slider(10, range=0..10)  # disabled
number_slider_21 = Slider(4, range=0..30)  # disabled
crv = Curve(<curve referenced from the Rhino model>)  # disabled
crv_2 = Curve(<curve referenced from the Rhino model>)  # disabled
crv_3 = Curve(<curve referenced from the Rhino model>)  # disabled
py3_6 = Python3Script(
    curve=crv,
    num_sides=number_slider_13,
    radius=number_slider_12,
    total_height=number_slider_10,
    h_subdivisions=number_slider_14)  # -> out, column_mesh, list_points, center_points, column_mesh_rhino; inputs curve: Polyline, num_sides: Int32, radius: Int32, total_height: Int32, h_subdivisions: Int32; disabled
# ---------- py3_6: Python ----------
import mola
from mola import module_rhino
import math
import Rhino.Geometry as rg

def points_on_crv(curve):
    list_of_points = []
    for p in curve:
        pt = rg.Point3d(p)
        list_of_points.append(pt)
    return list_of_points

def points_on_polygon(num_sides, radius):   
    list_of_points = []
    theta = (2*math.pi)/num_sides
    for i in range(num_sides):
        angle = i * theta
        x = radius * math.cos(angle)
        y = radius * math.sin(angle)
        z = 0
        pt = rg.Point3d(x,y,z)
        list_of_points.append(pt)
    return list_of_points


if curve is not None:
    list_points = points_on_crv(curve)

else:
    list_points = points_on_polygon(num_sides, radius)



column_mesh = mola.Mesh()

new_pts = []

for layer_no in range (h_subdivisions +1):
    y = total_height/h_subdivisions * layer_no 
    for p in list_points:
        pt = rg.Point3d(p)
        pt[1] = y
        new_pts.append (pt)
        column_mesh.add_vertex(pt[0],pt[1], pt[2])

points_per_layer = len(list_points)

for layer_no in range (h_subdivisions):
    current_layer = layer_no * points_per_layer
    next_layer = (layer_no + 1) * points_per_layer
    for i in range (points_per_layer-1):
        next_i = (i+1) % points_per_layer

        v0 = column_mesh.vertices[current_layer + i]
        v1 = column_mesh.vertices[current_layer + next_i]
        v2 = column_mesh.vertices[next_layer + next_i]
        v3 = column_mesh.vertices[next_layer + i]

        column_mesh.add_face([v0,v1,v2,v3])


center_points = []
for f in (column_mesh.faces):
    c = f.center()
    
    pts = rg.Point3d(c.x, c.y, c.z)
    center_points.append(pts)

column_mesh.update_topology()
column_mesh_rhino = module_rhino.display_mesh(column_mesh)
# ---------- end py3_6 ----------
py3_7 = Python3Script(
    curve=crv_3,
    num_sides=number_slider_20,
    radius=number_slider_15,
    total_height=number_slider_17,
    h_subdivisions=number_slider_21)  # -> out, column_mesh, list_points, new_pts, center_points, column_mesh_rhino; inputs curve: Polyline, num_sides: Int32, radius: Int32, total_height: Int32, h_subdivisions: Int32; disabled
# ---------- py3_7: Python ----------
import mola
from mola import module_rhino
import math
import Rhino.Geometry as rg

def points_on_crv(curve):
    list_of_points = []
    for p in curve:
        pt = rg.Point3d(p)
        list_of_points.append(pt)
    return list_of_points

def points_on_polygon(num_sides, radius):  
    list_of_points = []
    theta = (2*math.pi)/num_sides
    for i in range(num_sides):
        angle = i * theta
        x = radius * math.cos(angle)
        y = radius * math.sin(angle)
        z = 0
        pt = rg.Point3d(x,y,z)
        list_of_points.append(pt)
    return list_of_points


if curve is not None:
    list_points = points_on_crv(curve)

else:
    list_points = points_on_polygon(num_sides, radius)



column_mesh = mola.Mesh()

new_pts = []

for layer_no in range (h_subdivisions +1):
    y = total_height/h_subdivisions * layer_no
    for p in list_points:
        pt = rg.Point3d(p)
        pt[1] = y
        new_pts.append (pt)
        column_mesh.add_vertex(pt[0],pt[1], pt[2])

points_per_layer = len(list_points)

for layer_no in range (h_subdivisions):
    current_layer = layer_no * points_per_layer
    next_layer = (layer_no + 1) * points_per_layer
    for i in range (points_per_layer-1):
        next_i = (i+1) % points_per_layer

        v0 = column_mesh.vertices[current_layer + i]
        v1 = column_mesh.vertices[current_layer + next_i]
        v2 = column_mesh.vertices[next_layer + next_i]
        v3 = column_mesh.vertices[next_layer + i]

        column_mesh.add_face([v0,v1,v2,v3])

center_points = []
for f in (column_mesh.faces):
    c = f.center()
    
    pts = rg.Point3d(c.x, c.y, c.z)
    center_points.append(pts)

print(column_mesh)
#column_mesh = mola.mesh_offset(column_mesh,5)
column_mesh.update_topology()
column_mesh_rhino = module_rhino.display_mesh(column_mesh)
# ---------- end py3_7 ----------
py3_8 = Python3Script(
    curve=crv_2,
    num_sides=number_slider_18,
    radius=number_slider_16,
    total_height=number_slider_11,
    h_subdivisions=number_slider_19)  # -> out, column_mesh, list_points, center_points, column_mesh_rhino; inputs curve: Polyline, num_sides: Int32, radius: Int32, total_height: Int32, h_subdivisions: Int32; disabled
# ---------- py3_8: Python ----------
import mola
from mola import module_rhino
import math
import Rhino.Geometry as rg

def points_on_crv(curve):
    list_of_points = []
    for p in curve:
        pt = rg.Point3d(p)
        list_of_points.append(pt)
    return list_of_points

def points_on_polygon(num_sides, radius):   
    list_of_points = []
    theta = (2*math.pi)/num_sides
    for i in range(num_sides):
        angle = i * theta
        x = radius * math.cos(angle)
        y = radius * math.sin(angle)
        z = 0
        pt = rg.Point3d(x,y,z)
        list_of_points.append(pt)
    return list_of_points


if curve is not None:
    list_points = points_on_crv(curve)

else:
    list_points = points_on_polygon(num_sides, radius)



column_mesh = mola.Mesh()

new_pts = []

for layer_no in range (h_subdivisions +1):
    y = total_height/h_subdivisions * layer_no + float(114.5)
    for p in list_points:
        pt = rg.Point3d(p)
        pt[1] = y
        new_pts.append (pt)
        column_mesh.add_vertex(pt[0],pt[1], pt[2])

points_per_layer = len(list_points)

for layer_no in range (h_subdivisions):
    current_layer = layer_no * points_per_layer
    next_layer = (layer_no + 1) * points_per_layer
    for i in range (points_per_layer-1):
        next_i = (i+1) % points_per_layer

        v0 = column_mesh.vertices[current_layer + i]
        v1 = column_mesh.vertices[current_layer + next_i]
        v2 = column_mesh.vertices[next_layer + next_i]
        v3 = column_mesh.vertices[next_layer + i]

        column_mesh.add_face([v0,v1,v2,v3])

center_points = []
for f in (column_mesh.faces):
    c = f.center()
    
    pts = rg.Point3d(c.x, c.y, c.z)
    center_points.append(pts)

column_mesh.update_topology()
column_mesh_rhino = module_rhino.display_mesh(column_mesh)
# ---------- end py3_8 ----------
number_slider_22 = Slider(19, range=0..20)  # disabled
geo_4 = Geometry(py3_6.column_mesh_rhino)  # disabled
geo_5 = Geometry(py3_7.list_points)  # disabled
geo_6 = Geometry(py3_8.column_mesh_rhino)  # disabled
geo_7 = Geometry(py3_6.list_points)  # disabled
geo_8 = Geometry(py3_7.column_mesh_rhino)  # disabled
geo_9 = Geometry(py3_8.list_points)  # disabled
number_slider_23 = Slider(4.513, range=0..10)  # disabled
number_slider_24 = Slider(4.513, range=0..10)  # disabled
number_slider_25 = Slider(4.513, range=0..10)  # disabled
py3_9 = Python3Script(mesh=py3_6.column_mesh, extrusion=number_slider_23)  # -> out, new_mesh, my_rhino_mesh; inputs extrusion: Double; disabled
# ---------- py3_9: Python ----------
import mola
from mola import module_rhino

new_mesh = mola.Mesh()

for i, face in enumerate (mesh.faces):
    if i % 2 ==0:
        
        new_faces = mola.subdivide_face_extrude_tapered(face, extrusion, 0.5, True)
        for f in new_faces:
            f.group = 0

        new_mesh.faces.extend(new_faces)

    else:
        face.group = 2
        new_mesh.faces.append(face)

new_mesh.update_topology()
my_rhino_mesh = module_rhino.display_mesh(new_mesh)
# ---------- end py3_9 ----------
py3_10 = Python3Script(mesh=py3_7.column_mesh, extrusion=number_slider_24)  # -> out, new_mesh, my_rhino_mesh; inputs extrusion: Double; disabled
# ---------- py3_10: Python ----------
import mola
from mola import module_rhino

new_mesh = mola.Mesh()

for i, face in enumerate (mesh.faces):
    if i % 5 == 0 :
        
        new_faces = mola.subdivide_face_extrude_tapered(face, extrusion, 0.8, True)
        for f in new_faces:
            f.group = 0

        new_mesh.faces.extend(new_faces)
        

    elif i % 5 == 1:

        new_faces1 = mola.subdivide_face_extrude_tapered(face, extrusion, 0.8, True)
        for f in new_faces1:
            f.group = 1

        new_mesh.faces.extend(new_faces1)

    elif i % 5 == 2:
            face.group = 2
            new_mesh.faces.append(face)

    elif i % 5 == 3:

        new_faces3 = mola.subdivide_face_extrude_tapered(face, extrusion, 0.8, True)
        for f in new_faces3:
            f.group = 3

        new_mesh.faces.extend(new_faces3)

            # face.group = 3
            # new_mesh.faces.append(face)

    elif i % 5 == 4:

        new_faces4 = mola.subdivide_face_extrude_tapered(face, extrusion, 0.8, True)
        for f in new_faces4:
            f.group = 4

        new_mesh.faces.extend(new_faces4)



new_mesh.update_topology()
my_rhino_mesh = module_rhino.display_mesh(new_mesh)



# new_mesh = mola.Mesh()
# for i, f in enumerate(my_mesh.faces):
#     if heights[i] > 0.5:
#         doCap = False
#     else: 
#         doCap = True
#     resulting_faces = mola.subdivide_face_extrude_tapered(f, heights[i], 0.6, doCap)
#     new_mesh.faces.extend(resulting_faces)

# new_mesh.update_topology()
# new_mesh = mola.mesh_offset(new_mesh,0.2)
# ---------- end py3_10 ----------
py3_11 = Python3Script(mesh=py3_8.column_mesh, extrusion=number_slider_25)  # -> out, new_mesh, my_rhino_mesh; inputs extrusion: Double; disabled; same code as py3_9
panel_2 = Panel(py3_7.center_points)  # disabled
number_slider_26 = Slider(9.583, range=0..10)  # disabled
number_slider_27 = Slider(4.022, range=0..30)  # disabled
number_slider_28 = Slider(9.583, range=0..10)  # disabled
py3_12 = Python3Script(mesh=py3_9.new_mesh, extrusion=number_slider_26)  # -> out, new_mesh, my_rhino_mesh; disabled
# ---------- py3_12: Python ----------
import mola

from mola import module_rhino

new_mesh = mola.Mesh()

for face in mesh.faces:
    if face.group == 2:
        new_faces = mola.subdivide_face_extrude_tapered(face, -extrusion, .8, False)
        new_mesh.faces.extend(new_faces)
    else:
        new_mesh.faces.append(face)


new_mesh.update_topology()
my_rhino_mesh = module_rhino.display_mesh(new_mesh)
# ---------- end py3_12 ----------
py3_13 = Python3Script(mesh=py3_10.new_mesh, extrusion=number_slider_27)  # -> out, new_mesh, my_rhino_mesh; disabled
# ---------- py3_13: Python ----------
import mola

from mola import module_rhino

new_mesh = mola.Mesh()

for face in mesh.faces:
    if face.group == 4:
        new_faces = mola.subdivide_face_extrude_tapered(face, -extrusion, .5, False)
        new_mesh.faces.extend(new_faces)
    else:
        new_mesh.faces.append(face)


new_mesh.update_topology()
my_rhino_mesh = module_rhino.display_mesh(new_mesh)
# ---------- end py3_13 ----------
py3_14 = Python3Script(mesh=py3_11.new_mesh, extrusion=number_slider_28)  # -> out, new_mesh, my_rhino_mesh; disabled; same code as py3_12
number_slider_29 = Slider(2, range=0..10)  # disabled
number_slider_30 = Slider(1, range=0..10)  # disabled
number_slider_31 = Slider(2, range=0..10)  # disabled
py3_15 = Python3Script(mesh=py3_12.new_mesh, r=number_slider_29)  # -> out, my_mesh_rhino; inputs r: Int32; disabled; same code as py3_4
py3_16 = Python3Script(mesh=py3_13.new_mesh, r=number_slider_30)  # -> out, my_mesh_rhino; inputs r: Int32; disabled; same code as py3_4
py3_17 = Python3Script(mesh=py3_14.new_mesh, r=number_slider_31)  # -> out, my_mesh_rhino; inputs r: Int32; disabled; same code as py3_4
panel_3 = Panel(py3_15.my_mesh_rhino)  # disabled
panel_4 = Panel(py3_16.my_mesh_rhino)  # disabled
panel_5 = Panel(py3_17.my_mesh_rhino)  # disabled
geo_10 = Geometry(py3_15.my_mesh_rhino)  # disabled
geo_11 = Geometry(py3_16.my_mesh_rhino)  # disabled
geo_12 = Geometry(py3_17.my_mesh_rhino)  # disabled

# ----
crv_4 = Curve(<curve referenced from the Rhino model>)
crv_5 = Curve(<curve referenced from the Rhino model>)  # disabled
crv_6 = Curve(<curve referenced from the Rhino model>)
py3_18 = Python3Script(mola_path="C:\\Users\\Juste\\Documents\\_GitHub")  # -> out, a
# ---------- py3_18: Python ----------
import sys

if mola_path not in sys.path:
    sys.path.append(mola_path)

print (sys.path)

try:
    import mola
    from mola import module_rhino
except ImportError as e:
    print("Error Importing mola: (e)")
# ---------- end py3_18 ----------
py3_19 = Python3Script(
    curve=crv_4,
    num_sides=Slider(3, range=0..10),
    radius=Slider(10, range=0..10),
    total_height=Slider(12, range=-20..600),
    h_subdivisions=Slider(1, range=0..30))  # -> out, column_mesh, list_points, center_points, column_mesh_rhino; inputs curve: Polyline, num_sides: Int32, radius: Int32, total_height: Int32, h_subdivisions: Int32; same code as py3_6
py3_20 = Python3Script(
    curve=crv_5,
    num_sides=number_slider_8,
    radius=number_slider_6,
    total_height=number_slider_7,
    h_subdivisions=number_slider_9)  # -> out, column_mesh, list_points, new_pts, center_points, column_mesh_rhino; inputs curve: Polyline, num_sides: Int32, radius: Int32, total_height: Int32, h_subdivisions: Int32; disabled; same code as py3_7
py3_21 = Python3Script(
    curve=crv_6,
    num_sides=Slider(3, range=0..10),
    radius=Slider(10, range=0..10),
    total_height=Slider(12, range=-20..600),
    h_subdivisions=Slider(1, range=0..30))  # -> out, column_mesh, list_points, center_points, column_mesh_rhino; inputs curve: Polyline, num_sides: Int32, radius: Int32, total_height: Int32, h_subdivisions: Int32; same code as py3_8
number_slider_32 = Slider(19, range=0..20)  # disabled
number_slider_33 = Slider(19, range=0..20)  # disabled
geo_13 = Geometry(py3_19.column_mesh_rhino)
geo_14 = Geometry(py3_20.list_points)  # disabled
geo_15 = Geometry(py3_21.column_mesh_rhino)
geo_16 = Geometry(py3_19.list_points)
geo_17 = Geometry(py3_20.column_mesh_rhino)  # disabled
geo_18 = Geometry(py3_21.list_points)
number_slider_34 = Slider(4.513, range=0..10)  # disabled
point_list = PointList(Points=py3_21.center_points, Size=Slider(19, range=0..20))
point_list_2 = PointList(Points=py3_19.center_points, Size=Slider(19, range=0..20))
point_list_3 = PointList(Points=py3_8.center_points, Size=number_slider_33)  # disabled
point_list_4 = PointList(Points=py3_6.center_points, Size=number_slider_32)  # disabled
point_list_5 = PointList(Points=py3_20.center_points, Size=Slider(19, range=0..20))  # disabled
point_list_6 = PointList(Points=py3_7.center_points, Size=number_slider_22)  # disabled
py3_22 = Python3Script(mesh=py3_19.column_mesh, extrusion=Slider(4.513, range=0..10))  # -> out, new_mesh, my_rhino_mesh; inputs extrusion: Double; disabled; same code as py3_9
py3_23 = Python3Script(mesh=py3_20.column_mesh, extrusion=number_slider_34)  # -> out, new_mesh, my_rhino_mesh; inputs extrusion: Double; disabled; same code as py3_10
py3_24 = Python3Script(mesh=py3_21.column_mesh, extrusion=Slider(4.513, range=0..10))  # -> out, new_mesh, my_rhino_mesh; inputs extrusion: Double; disabled; same code as py3_9
panel_6 = Panel(py3_20.center_points)
number_slider_35 = Slider(9.583, range=0..10)  # disabled
number_slider_36 = Slider(4.022, range=0..30)  # disabled
number_slider_37 = Slider(9.583, range=0..10)  # disabled
subdivide_taper = Python3Script()  # -> out, my_mesh, my_mesh_rhino
# ---------- subdivide_taper: Python ----------
import mola
from mola import module_rhino

#first step
new_mesh = mola.Mesh()
for f in mesh.faces:
  new_faces = mola.subdivide_face_extrude_tapered(f, 8, 0.4)
  new_faces[-1].group = 1
  new_mesh.faces.extend(new_faces)

my_mesh = new_mesh
my_mesh.update_topology()

#color faces by group
values = [f.group for f in my_mesh.faces]
cmap = mola.color_map(values)
mola.color_faces_by_map(my_mesh.faces, cmap)
my_mesh.update_topology()

#display
my_mesh_rhino = module_rhino.display_mesh(my_mesh)
# ---------- end subdivide_taper ----------
subdivide_taper_2 = Python3Script(mesh=subdivide_taper.my_mesh)  # -> out, my_mesh, my_mesh_rhino
# ---------- subdivide_taper_2: Python ----------
import mola
from mola import module_rhino

#second step
new_mesh = mola.Mesh()
for f in mesh.faces:
  if f.group == 0:
    new_mesh.faces.append(f)
  elif f.group == 1:
    new_faces = mola.subdivide_face_extrude_tapered(f, 5, 0.4)
    new_faces[-1].group = 2
    new_mesh.faces.extend(new_faces)

my_mesh = new_mesh
my_mesh.update_topology()

#color faces by group
values = [f.group for f in my_mesh.faces]
cmap = mola.color_map(values)
mola.color_faces_by_map(my_mesh.faces, cmap)
my_mesh.update_topology()

#display
my_mesh_rhino = module_rhino.display_mesh(my_mesh)
# ---------- end subdivide_taper_2 ----------
# Step 2:
# 
# 1. Subdivide all of the faces with
# subdivide_extrude_tapered
# 2. Assign groups so that the top of the
# extruded face is group 1
subdivide_taper_3 = Python3Script()  # -> out, my_mesh, my_mesh_rhino; disabled; same code as subdivide_taper
subdivide_split_grid = Python3Script(mesh=subdivide_taper_2.my_mesh)  # -> out, my_mesh, my_mesh_rhino
# ---------- subdivide_split_grid: Python ----------
import mola
from mola import module_rhino

#third step
new_mesh = mola.Mesh()
for f in mesh.faces:
  if f.group == 1:
    new_faces = mola.subdivide_face_split_grid(f, 4, 1)
    new_faces[-1].group = 3
    new_faces[0].group = 3
    new_mesh.faces.append(new_faces[-1])
    new_mesh.faces.append(new_faces[0])
  elif f.group == 0:
    new_faces = mola.subdivide_face_split_grid(f, 4, 1)
    new_faces[-1].group = 4
    new_faces[0].group = 4
    new_mesh.faces.append(new_faces[-1])
    new_mesh.faces.append(new_faces[0])
  else:
    new_mesh.faces.append(f)
my_mesh = new_mesh
my_mesh.update_topology()

#display
my_mesh_rhino = module_rhino.display_mesh(my_mesh)
# ---------- end subdivide_split_grid ----------
# Step 3:
# 
# 1. Subdivide further so that only
# the top face (group 1) is subdivided
# again using subdivide_extrude_tapered
# 2. Assign Groups
subdivide_taper_4 = Python3Script(mesh=subdivide_taper_3.my_mesh)  # -> out, my_mesh, my_mesh_rhino; disabled; same code as subdivide_taper_2
# Step 4:
# 
# 1. Subdivide faces using subdivide_face_split_grid
# 2. Only append specific faces
# 3. Assign new groups based on old ones
subdivide_split_grid_2 = Python3Script(mesh=subdivide_taper_4.my_mesh)  # -> out, my_mesh, my_mesh_rhino; disabled; same code as subdivide_split_grid
python_3_script = Python3Script(mesh=subdivide_split_grid.my_mesh, iterations=Slider(1, range=0..10))  # -> out, my_mesh, my_mesh_rhino; inputs iterations: Int32
# ---------- python_3_script: Python ----------
import mola
from mola import module_rhino

#fifth step
for i in range(iterations):
    new_mesh = mola.Mesh()
    for f in mesh.faces:
        if f.group == 4:
          new_faces = mola.subdivide_face_extrude_tapered(f, 1/(i+1.5), 0.4)
          new_mesh.faces.extend(new_faces)
        else:
          new_mesh.faces.append(f)
    mesh = new_mesh

my_mesh = mesh


#color faces by group
values = [f.group for f in my_mesh.faces]
cmap = mola.color_map(values)
mola.color_faces_by_map(my_mesh.faces, cmap)
my_mesh.update_topology()

#display
my_mesh_rhino = module_rhino.display_mesh(my_mesh)
# ---------- end python_3_script ----------
# Step 5:
# 
# 1. Do a secondary subdivision layer on
# specific faces to create variation
number_slider_38 = Slider(1, range=0..10)  # disabled
python_3_script_2 = Python3Script(mesh=python_3_script.my_mesh)  # -> out, my_mesh, my_mesh_rhino
# ---------- python_3_script_2: Python ----------
import mola
from mola import module_rhino

#sixth step
mesh.update_topology()
my_mesh = mola.subdivide_mesh_catmull(mesh)
properties = my_mesh.face_properties(mola.face_curvature)
cmap = mola.color_map(properties)

#color faces by a color map
mola.color_faces_by_map(my_mesh.faces, cmap)


# seventh step
my_mesh.update_topology()
my_mesh = mola.subdivide_mesh_catmull(my_mesh, properties)

#display
my_mesh_rhino = module_rhino.display_mesh(my_mesh)
# ---------- end python_3_script_2 ----------
python_3_script_3 = Python3Script(mesh=subdivide_split_grid_2.my_mesh, iterations=number_slider_38)  # -> out, my_mesh, my_mesh_rhino; inputs iterations: Int32; disabled; same code as python_3_script
# Step 6:
# 
# 1. Smoothen with catmull for smooth aesthetic!
python_3_script_4 = Python3Script(mesh=python_3_script_3.my_mesh)  # -> out, my_mesh, my_mesh_rhino; disabled; same code as python_3_script_2
