# Grasshopper definition 101_stick_to_it.ghx (Grasshopper 1.0.8)

# ---- group: grid_parameters
number_slider = Slider(4, range=0..10)
number_slider_2 = Slider(4, range=0..10)
number_slider_3 = Slider(4, range=0..10)

number_slider_4 = Slider(4, range=0..10)
number_slider_5 = Slider(4, range=0..10)
number_slider_6 = Slider(4, range=0..10)

# ----
py3 = Python3Script(x_range=number_slider, y_range=number_slider_2, z_range=number_slider_3, offset=Slider(0, range=0..100))  # -> out, points, sticks; inputs x_range: Int32, y_range: Int32, z_range: Int32, offset: Double
# ---------- py3: Python ----------
#locate stick class file in the same folder
from compas_rhino import unload_modules
import sys
import os

#get current file path
path = ghenv.Component.OnPingDocument().FilePath
print (path)
#get parent directory of the parent directory
parentdir = os.path.dirname(path)
print (parentdir)
#get src folder which contains classes
dire = os.path.join(parentdir,'scripts')
print (dire)

sys.path.append(dire)

unload_modules('stick')
unload_modules('stickmodules')

import stick
from stick import Stick 
from stickmodules import OStickModule
from compas.geometry import Line, Point, Vector

stick_width = 18.0
stick_depth = 18.0
stick_length = 200

stick_assembly = []
points = []

for x in range(x_range):
    for y in range(y_range):
        for z in range(z_range):
            grid_size = stick_length - stick_depth - offset
            pt = Point(x*grid_size, y*grid_size, z*grid_size)
            points.append(pt)
            #type = 0 or 1 depending on odd or even
            #additionally type can be 2 for last item
            type_x = x%2 if x<x_range-1 else 2
            type_y = y%2 if y<y_range-1 else 2
            type_z = z%2 if z<z_range-1 else 2
            type = {"x":type_x, "y":type_y, "z":type_z}
            stick_module = OStickModule(pt, stick_length, stick_width, stick_depth, offset, type)
            stick_assembly.extend(stick_module.stick_module)

sticks = [s.geometry for s in stick_assembly]
# ---------- end py3 ----------
py3_2 = Python3Script(x_range=number_slider_4, y_range=number_slider_5, z_range=number_slider_6, offset=Slider(34, range=0..100))  # -> out, points, sticks; inputs x_range: Int32, y_range: Int32, z_range: Int32, offset: Double; same code as py3
draw = COMPASDraw(cg=py3.points)  # -> rg
#   port cg: The COMPAS geometry or datastructure to be drawn.
#   port rg: The Rhino geometry object.
# ---------- draw: Python ----------
# r: compas>=2.14.1
"""
Draws COMPAS geometry in Grasshopper.
"""

from typing import Any

import Grasshopper

from compas.scene import SceneObject


class CompasToRhinoGeometry(Grasshopper.Kernel.GH_ScriptInstance):
    def RunScript(self, cg):
        if not cg:
            return None

        return SceneObject(item=cg).draw()
# ---------- end draw ----------
draw_2 = COMPASDraw(cg=py3.sticks)  # -> rg; same code as draw
draw_3 = COMPASDraw(cg=py3_2.sticks)  # -> rg; same code as draw
draw_4 = COMPASDraw(cg=py3_2.points)  # -> rg; same code as draw
