# Grasshopper definition 102_two_sticks_brokengh.gh (Grasshopper 1.0.8)
# plug-ins: Bifocals

line_0 = Curve(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)
line_1 = Curve(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)
py3 = Python3Script(x_range=Slider(10, range=0..10), y_range=Slider(10, range=0..10), z_range=Slider(10, range=0..10))  # -> out, sticks; inputs x_range: Int32, y_range: Int32, z_range: Int32
# ---------- py3: Python ----------
#locate stick class file in the same folder
from compas_rhino import unload_modules
import sys
import os

#get current file path
path = ghenv.Component.OnPingDocument().FilePath
#get parent directory of the parent directory
parentdir = os.path.dirname(path)
#get src folder which contains classes
dire = os.path.join(parentdir,'Scripts')

sys.path.append(dire)

 
unload_modules('Sticks')
unload_modules('Stick_module')


import Sticks 
from Sticks import Stick, stick_bridge
from Stick_module import OStickMoudle
from compas.geometry import Line, Point, Vector
from compas_rhino.conversions import line_to_compas

stick_length = 200
stick_width = 13
stick_depth = 13


point = []
assembly = []

for x in range(x_range):
    for y in range(y_range):
        for z in range(z_range):
            grid_size = stick_length - 2 * stick_depth
            pt = Point(x * grid_size, y * grid_size, z * grid_size)
            point.append(pt)

            # type = 0 or 1 depending on odd or even
            # additionally type can be 2 for last item
            type_x = x % 2 if x < x_range -1 else 2
            type_y = y % 2 if y < y_range -1 else 2
            type_z = z % 2 if z < z_range -1 else 2
            type = { 'x':type_x, 'y':type_y, 'z':type_z }

            stick_module = OStickMoudle(pt, stick_length, stick_width, stick_depth)
            stick_module.create_orthogonal_module(type)

            assembly.extend(stick_module.sticks)

sticks = [s.geometry for s in assembly]
# ---------- end py3 ----------
py3_2 = Python3Script(line_0=line_0, line_1=line_1)  # -> out, sticks; inputs line_0: Line, line_1: Line
# ---------- py3_2: Python ----------
#locate stick class file in the same folder
from compas_rhino import unload_modules
import sys
import os

#get current file path
path = ghenv.Component.OnPingDocument().FilePath
#get parent directory of the parent directory
parentdir = os.path.dirname(path)
#get src folder which contains classes
dire = os.path.join(parentdir,'Scripts')

sys.path.append(dire)

 
unload_modules('Sticks')

import Sticks 
from Sticks import Stick, stick_bridge, stick_bridge_test
from compas.geometry import Line, Point, Vector
from compas_rhino.conversions import line_to_compas

assembly = []
line0 = line_to_compas(line_0)

# initiates a class Stick name stick0
stick0 = Stick(line0)
stick0.rotate_stick(20)
assembly.append(stick0)

line1 = line_to_compas(line_1)
stick1 = Stick(line1)
stick1.rotate_stick(40, Vector(0,1,0), stick1.axis.start)
assembly.append(stick1)

stick2 = stick_bridge_test(stick0, stick1)
assembly.append(stick2)


# generates the geometry of the stick0 class : Box
sticks = [s.geometry for s in assembly]
# ---------- end py3_2 ----------
draw = COMPASDraw(cg=py3.sticks)  # -> rg
#   port cg: The COMPAS geometry or datastructure to be drawn.
#   port rg: The Rhino geometry object.
# ---------- draw: Python ----------
# r: compas>=2.14.1
"""
Draws COMPAS geometry in Grasshopper.
"""

from typing import Any

import Grasshopper

from compas.scene import SceneObject


class CompasToRhinoGeometry(Grasshopper.Kernel.GH_ScriptInstance):
    def RunScript(self, cg):
        if not cg:
            return None

        return SceneObject(item=cg).draw()
# ---------- end draw ----------
draw_2 = COMPASDraw(cg=py3_2.sticks)  # -> rg; same code as draw
