# Grasshopper definition 103_branching_out_sticks.ghx (Grasshopper 1.0.8)

point = Point(Point(490.7442219, 392.3572409, 608.9921482))
xy_plane = XYPlane(Origin=point)
xy_plane_2 = XYPlane(Origin=Point(0, 0, 0))
xy_plane_3 = XYPlane(Origin=Point(0, 0, 0))
point_2 = Point(<point referenced from the Rhino model>)
xy_plane_4 = XYPlane(Origin=Point(0, 0, 0))
grow_towards_target = Python3Script(root=xy_plane_3, frame=xy_plane)  # -> out, geometries, a; inputs frame: Plane
# ---------- grow_towards_target: Python ----------
# r: compas>=2.14.1
# venv: sticks

import sys
import os
import math

#get current file path
path = ghenv.Component.OnPingDocument().FilePath
print (path)
#get parent directory of the parent directory
parentdir = os.path.dirname(path)
print (parentdir)
#get src folder which contains classes
dire = os.path.join(parentdir,'scripts')
print (dire)

sys.path.append(dire)

from compas_rhino import unload_modules

unload_modules("stick")
unload_modules("stickmodules")

import stick
from stick import Stick 
from stickmodules import BranchingModule
from compas.geometry import Line, Point, Vector, Frame

from compas_rhino.conversions import point_to_compas, plane_to_compas_frame, frame_to_rhino_plane

# Create a branching module starting from a frame

root_frame = plane_to_compas_frame(root)

module = BranchingModule(root_frame, 
                        stick_length=200, 
                        width = 13,
                        depth = 13,
                        )


# Define a target point to grow towards
target = plane_to_compas_frame(frame)

# Grow sticks towards the target until reached
max_iterations = 3
# Automatically selects the best face pointing towards target
for i in range(max_iterations):
    reached = module.grow_stick_towards_auto(
        target_point=target.point,
        offset=20,
    )
    
    if reached:
        break

print(len(module.sticks))


# Visualize all sticks
geometries = module.visualize() #+ [con.geometry for con in cons]

a = frame_to_rhino_plane(module.sticks[-1].frame)
# ---------- end grow_towards_target ----------
grow_towards_target_2 = Python3Script(root=xy_plane_2, pt=point_2)  # -> out, geometries; inputs pt: Point3d
# ---------- grow_towards_target_2: Python ----------
# r: compas>=2.14.1
# venv: sticks

import sys
import os
import math

#get current file path
path = ghenv.Component.OnPingDocument().FilePath
print (path)
#get parent directory of the parent directory
parentdir = os.path.dirname(path)
print (parentdir)
#get src folder which contains classes
dire = os.path.join(parentdir,'scripts')
print (dire)

sys.path.append(dire)

from compas_rhino import unload_modules

unload_modules("stick")
unload_modules("stickmodules")

import stick
from stick import Stick 
from stickmodules import BranchingModule
from compas.geometry import Line, Point, Vector, Frame

from compas_rhino.conversions import point_to_compas, plane_to_compas_frame

# Create a branching module starting from a frame

root_frame = plane_to_compas_frame(root)

module = BranchingModule(root_frame, 
                        stick_length=200, 
                        width = 13,
                        depth = 13,
                        )


# Define a target point to grow towards
target = point_to_compas(pt)

# Grow sticks towards the target until reached
max_iterations = 10
# Automatically selects the best face pointing towards target
for i in range(max_iterations):
    reached = module.grow_stick_towards_auto(
        target_point=target,
        offset=20
    )
    
    if reached:
        break

# Visualize all sticks
geometries = module.visualize()
# ---------- end grow_towards_target_2 ----------
python_3_script = Python3Script(root=xy_plane_4)  # -> out, geometries, a
# ---------- python_3_script: Python ----------
# r: compas>=2.14.1
# venv: sticks

import sys
import os
import math

#get current file path
path = ghenv.Component.OnPingDocument().FilePath
print (path)
#get parent directory of the parent directory
parentdir = os.path.dirname(path)
print (parentdir)
#get src folder which contains classes
dire = os.path.join(parentdir,'scripts')
print (dire)

sys.path.append(dire)

from compas_rhino import unload_modules

unload_modules("stick")
unload_modules("stickmodules")

import stick
from stick import Stick 
from stickmodules import BranchingModule
from compas.geometry import Line, Point, Vector, Frame

stick_width = 13.0
stick_depth = 13.0
stick_length = 200

# Create tree
from compas_rhino.conversions import plane_to_compas_frame, frame_to_rhino_plane

root = plane_to_compas_frame(root)
tree = BranchingModule(root, stick_length=200, width = stick_width, depth = stick_depth)

# Grow main trunk
tree.grow_stick(face_index=2, offset=50, angle=math.pi/12)
tree.grow_stick(face_index=1, offset=20, angle=math.pi/8)
tree.grow_stick(face_index=2, offset=30, angle=math.pi/2)

# Visualize
geometries = tree.visualize()
a = frame_to_rhino_plane(tree.sticks[-1].frame)
# ---------- end python_3_script ----------
draw = COMPASDraw(cg=grow_towards_target.geometries)  # -> rg
#   port cg: The COMPAS geometry or datastructure to be drawn.
#   port rg: The Rhino geometry object.
# ---------- draw: Python ----------
# r: compas>=2.14.1
"""
Draws COMPAS geometry in Grasshopper.
"""

from typing import Any

import Grasshopper

from compas.scene import SceneObject


class CompasToRhinoGeometry(Grasshopper.Kernel.GH_ScriptInstance):
    def RunScript(self, cg):
        if not cg:
            return None

        return SceneObject(item=cg).draw()
# ---------- end draw ----------
draw_2 = COMPASDraw(cg=grow_towards_target_2.geometries)  # -> rg; same code as draw
draw_3 = COMPASDraw(cg=python_3_script.geometries)  # -> rg; same code as draw
plane = Plane(python_3_script.a)
plane_2 = Plane(grow_towards_target.a)
deconstruct_plane = DeconstructPlane(Plane=grow_towards_target.a)  # -> Origin, XAxis, YAxis, ZAxis
xy_plane_5 = XYPlane(Origin=Point(0, 0, 0))
python_3_script_2 = Python3Script(root=xy_plane_5, x=grow_towards_target.a)  # -> out, geometries, a; inputs x: Plane
# ---------- python_3_script_2: Python ----------
# r: compas>=2.14.1
# venv: sticks

import sys
import os
import math

#get current file path
path = ghenv.Component.OnPingDocument().FilePath
print (path)
#get parent directory of the parent directory
parentdir = os.path.dirname(path)
print (parentdir)
#get src folder which contains classes
dire = os.path.join(parentdir,'scripts')
print (dire)

sys.path.append(dire)

from compas_rhino import unload_modules

unload_modules("stick")
unload_modules("stickmodules")

import stick
from stick import Stick 
from stickmodules import BranchingModule
from compas.geometry import Line, Point, Vector, Frame

stick_width = 13.0
stick_depth = 13.0
stick_length = 200

# Create tree
from compas_rhino.conversions import plane_to_compas_frame, frame_to_rhino_plane

root = plane_to_compas_frame(root)
tree = BranchingModule(root, stick_length=200, width = stick_width, depth = stick_depth)

# Grow main trunk
tree.grow_stick(face_index=2, offset=50, angle=math.pi/12)
tree.grow_stick(face_index=1, offset=20, angle=math.pi/8)
tree.grow_stick(face_index=2, offset=30, angle=math.pi/2)

# Visualize



x = plane_to_compas_frame(x)

tree.grow_towards_frame(target_frame = x)

geometries = tree.visualize()
a = frame_to_rhino_plane(tree.sticks[-1].frame)
# ---------- end python_3_script_2 ----------
deconstruct_plane_2 = DeconstructPlane(Plane=python_3_script_2.a)  # -> Origin, XAxis, YAxis, ZAxis
rotate_3d = Rotate3D(Geometry=python_3_script_2.a, Angle=1.570796327, Center=deconstruct_plane_2.Origin, Axis=deconstruct_plane_2.XAxis)  # -> Geometry, Transform
number_slider = Slider(100, range=0..100)
plane_plane = PlanePlane(PlaneA=python_3_script_2.a, PlaneB=grow_towards_target.a)
draw_4 = COMPASDraw(cg=python_3_script_2.geometries)  # -> rg; same code as draw
extend_curve = ExtendCurve(Curve=plane_plane, Type=0, Start=number_slider, End=number_slider)
grow_towards_target_3 = Python3Script(root=extend_curve, pt=deconstruct_plane_2.YAxis)  # -> out, geometries, a; inputs root: Line, pt: Point3d
# ---------- grow_towards_target_3: Python ----------
# r: compas>=2.14.1
# venv: sticks

import sys
import os
import math

#get current file path
path = ghenv.Component.OnPingDocument().FilePath
print (path)
#get parent directory of the parent directory
parentdir = os.path.dirname(path)
print (parentdir)
#get src folder which contains classes
dire = os.path.join(parentdir,'scripts')
print (dire)

sys.path.append(dire)

from compas_rhino import unload_modules

unload_modules("stick")
unload_modules("stickmodules")

import stick
from stick import Stick 
from stickmodules import BranchingModule
from compas.geometry import Line, Point, Vector, Frame

from compas_rhino.conversions import line_to_compas


a = Stick(line_to_compas(root), 13,13, zvector = pt).geometry
# ---------- end grow_towards_target_3 ----------
compas_draw = COMPASDraw(cg=grow_towards_target_3.a)  # -> rg; same code as draw
