# Grasshopper definition 103_sticks_structure.gh (Grasshopper 1.0.8)

py3 = Python3Script(
    x_range=Slider(5, range=0..10),
    y_range=Slider(5, range=0..10),
    z_range=Slider(5, range=0..10),
    offset=Slider(17, range=0..100))  # -> out, sticks, points; inputs x_range: Int32, y_range: Int32, z_range: Int32, offset: Double
# ---------- py3: Python ----------
#locate stick class file in the same folder
from compas_rhino import unload_modules
import sys
import os
import math

#get current file path
path = ghenv.Component.OnPingDocument().FilePath
#get parent directory of the parent directory
parentdir = os.path.dirname(path)
#get src folder which contains classes
dire = os.path.join(parentdir,'sticks')

sys.path.append(dire)


unload_modules('Sticks')
unload_modules('OrtogonalModule')

import Sticks
from Sticks import Stick, stick_bridge
from OrtogonalModule import OStickModule
from compas.geometry import Line, Point, Vector
from compas_rhino.conversions import line_to_compas

stick_length = 200
stick_width = 13.0
stick_depth = 13.0

points = []
assembly = []

for x in range(x_range):
    for y in range(y_range):
        for z in range(z_range):
            grid_size = stick_length - 2*stick_depth + offset
            pt = Point(x * grid_size, y * grid_size, z * grid_size)
            points.append(pt)
            # type = if even return 0, if add return 1, if its the last stick
            type_x = x%2 if x<(x_range-1) else 2
            type_y = y%2 if y<(y_range-1) else 2
            type_z = z%2 if z<(z_range-1) else 2
            print(type_y)

            type = {"x": type_x, "y": type_y, "z": type_z}

            stick_module = OStickModule(pt, stick_length+offset, stick_width, stick_depth)
            stick_module.create_ortogonal_module(offset, type = type)

            assembly.extend(stick_module.sticks)

sticks = [s.geometry for s in assembly]
# ---------- end py3 ----------
draw = COMPASDraw(cg=py3.points)  # -> rg
#   port cg: The COMPAS geometry or datastructure to be drawn.
#   port rg: The Rhino geometry object.
# ---------- draw: Python ----------
# r: compas>=2.14.1
"""
Draws COMPAS geometry in Grasshopper.
"""

from typing import Any

import Grasshopper

from compas.scene import SceneObject


class CompasToRhinoGeometry(Grasshopper.Kernel.GH_ScriptInstance):
    def RunScript(self, cg):
        if not cg:
            return None

        return SceneObject(item=cg).draw()
# ---------- end draw ----------
draw_2 = COMPASDraw(cg=py3.sticks)  # -> rg; same code as draw
points = PointList(Points=draw, Size="50")
swatch = ColourSwatch(SwatchColor=RGB(255, 255, 255))
material = CreateMaterial(Diffuse=ColourSwatch(SwatchColor=RGB(0, 0, 0)), Specular=swatch, Emission=swatch, Transparency=0, Shine=0)
preview = CustomPreview(Geometry=draw_2, Material=material)
