# Grasshopper definition 251205_module_C_connecting_FJ_Ruth_edit.gh (Grasshopper 1.0.8)

x_distance = Slider(264, range=0..500)
y_distance = Slider(80, range=0..500)
sin_curve_length = Slider(12, range=0..100)
rotation = Slider(0, range=0..2000)  # disabled
module_count = Slider(3, range=0..100)  # disabled
face_index = Slider(3, range=0..30)  # disabled
offset_axis = Slider(-74, range=-100..100)  # disabled
offset_axis_b = Slider(-6, range=-100..100)  # disabled
stick_index = Slider(4, range=0..30)  # disabled
python_3_script = Python3Script(x_dist=x_distance, y_dist=y_distance, loop_length=sin_curve_length, x=Slider(10, range=0..10), y=Slider(10, range=0..10))  # -> out, points; inputs x_dist: Int32, y_dist: Int32, loop_length: Int32, x: Int32, y: Int32
# ---------- python_3_script: Python ----------
import Rhino.Geometry as rg
from math import sin, cos, tan

points = []

# for i in range (loop_length):
#     pt = rg.Point3d(sin(i)*x_dist, i*y_dist, 0)
#     points.append(pt)


for i in range (x):
    for i in range (y):
        pt = rg.Point3d(sin(i)*x_dist, i*y_dist, 0)
        points.append(pt)
# ---------- end python_3_script ----------
xy_plane = XYPlane(Origin=Point(0, 0, 0))  # disabled
panel = Panel("200")  # disabled
offset_axis_x_z = Slider(0, range=-100..100)
offset_axis_b_y = Slider(0, range=-100..100)
module_count_2 = Slider(3, range=0..100)
stick_index_2 = Slider(4, range=0..4)
face_index_2 = Slider(1, range=0..3)
rotation_2 = Slider(30, range=0..360)
xy_plane_2 = XYPlane(Origin=Point(0, 0, 0))
xy_plane_3 = XYPlane(Origin=python_3_script.points)

# ----
# base code:
# stick_module_modified_frame
python_3_script_2 = Python3Script(
    root=xy_plane,
    stick_length=panel,
    rot_angle=rotation,
    module_count=module_count,
    s_index=stick_index,
    f_index=face_index,
    offset_axis=offset_axis,
    offset_axis_b=offset_axis_b)  # -> out, geometries, frames; inputs root: Plane, stick_length: Double, rot_angle: Int32, module_count: Int32, s_index: Int32, f_index: Int32, offset_axis: Int32, offset_axis_b: Double; disabled
# ---------- python_3_script_2: Python ----------
# r: compas>=2.14.1
# venv: sticks

import sys
import os
import math

#get current file path
path = ghenv.Component.OnPingDocument().FilePath
print (path)
#get parent directory of the parent directory
parentdir = os.path.dirname(path)
print (parentdir)
#get src folder which contains classes
dire = os.path.join(parentdir,'group_one_scripts')
print (dire)

sys.path.append(dire)

from compas_rhino import unload_modules

unload_modules("group_one_sticks")
unload_modules("group_one_stick_module")
unload_modules("stick_module_modified_frame") 

import group_one_sticks
from group_one_sticks import Stick 
from stick_module_modified_frame import BranchingModule, BranchStickModules
from compas.geometry import Line, Point, Vector, Frame

stick_width = 10
stick_depth = 10    

from compas_rhino.conversions import plane_to_compas_frame, frame_to_rhino_plane

# Convert input to compas
root = plane_to_compas_frame(root)

# Initialize tree
tree = BranchStickModules(root, stick_length, width=stick_width, depth=stick_depth)
# Grow tree "def grow_stick(self, from_stick_index = -1, face_index = 0, angle = 0.0)""
# for i in range(x_count):
#     if i %2:
#         tree.grow_stick(from_stick_index = i, face_index = 2, angle = rot_angle)
#     else:
#         tree.grow_stick(from_stick_index = i, face_index = 2, angle = -rot_angle*i*factor)

for i in range(module_count):
    tree.grow_module( offset_axis, offset_axis_b, from_module_index=i, from_stick_index=s_index, face_index=f_index, angle = rot_angle)
print(tree)
# Visualize
geometries = tree.visualize()

 
#frame = tree.sticks[0].frame
frame = tree.modules[0].sticks[0].frame

frames = [stick.frame for module in tree.modules for stick in module.sticks]
# ---------- end python_3_script_2 ----------

# ----
# base code:
# stick_module_modified_frame
python_3_script_3 = Python3Script(
    root=xy_plane_2,
    stick_length="200",
    rot_angle=rotation_2,
    module_count=module_count_2,
    s_index=stick_index_2,
    f_index=face_index_2,
    offset_axis=offset_axis_x_z,
    offset_axis_b=offset_axis_b_y)  # -> out, colors, geometries, frames; inputs root: Plane, stick_length: Double, rot_angle: Int32, module_count: Int32, s_index: Int32, f_index: Int32, offset_axis: Int32, offset_axis_b: Double
# ---------- python_3_script_3: Python ----------
# r: compas>=2.14.1
# venv: sticks

import sys
import os
import math

#get current file path
path = ghenv.Component.OnPingDocument().FilePath
#get parent directory of the parent directory
parentdir = os.path.dirname(path)
#get src folder which contains classes
dire = os.path.join(parentdir,'group_one_scripts')

sys.path.append(dire)

from compas_rhino import unload_modules

unload_modules("group_one_sticks")
unload_modules("group_one_stick_module")
unload_modules("stick_module_modified_frame_Ruth_edit") 

import group_one_sticks
from group_one_sticks import Stick 
from stick_module_modified_frame_Ruth_edit import BranchStickModules, BranchStickModulesUpdates
from compas.geometry import Line, Point, Vector, Frame

stick_width = 10
stick_depth = 10    

from compas_rhino.conversions import plane_to_compas_frame, frame_to_rhino_plane

# Convert input to compas
root = plane_to_compas_frame(root)

# Initialize tree
tree = BranchStickModulesUpdates(root, stick_length, stick_width, stick_depth)


stick_pattern = [1,1,2,3,4]
face_pattern  = [2,2,1,1,1]

for i in range(module_count):
    from_module_index = i         
    from_stick_index  = stick_pattern[i % len(stick_pattern)]
    face_index        = face_pattern[i % len(face_pattern)]
    
    # angle_for_this_module = i * rot_angle  # 0, 10, 20, 30,... if rot_angle=10

    tree.grow_module(
        offset_axis,
        offset_axis_b,
        from_module_index=from_module_index, # just i
        from_stick_index=from_stick_index,
        face_index=face_index,
        angle=5
    )

# for i in range(module_count):
#     tree.grow_module(offset_axis, offset_axis_b, from_module_index=i, from_stick_index=s_index, face_index=f_index, angle = rot_angle)
# # print(tree)

# Visualize
geometries = tree.visualize()




####   Color with 4 different color to understand the branching method   ####
from System.Drawing import Color

color_1 = Color.FromArgb(255, 100, 0)     # orange
color_2 = Color.FromArgb(0, 150, 255)     # blue
color_3 = Color.FromArgb(0, 200, 80)      # green
color_4 = Color.FromArgb(200, 0, 200)     # magenta

color_list = [color_1, color_2, color_3, color_4]

colors = []

for module_index, module in enumerate(tree.modules):
    col = color_list[module_index % 4]

    for stick in module.sticks:
        colors.append(col)



 
#frame = tree.sticks[0].frame
frame = tree.modules[0].sticks[0].frame

frames = [stick.frame for module in tree.modules for stick in module.sticks]
# ---------- end python_3_script_3 ----------

draw = COMPASDraw(cg=python_3_script_3.geometries)  # -> rg
#   port cg: The COMPAS geometry or datastructure to be drawn.
#   port rg: The Rhino geometry object.
# ---------- draw: Python ----------
# r: compas>=2.14.1
"""
Draws COMPAS geometry in Grasshopper.
"""

from typing import Any

import Grasshopper

from compas.scene import SceneObject


class CompasToRhinoGeometry(Grasshopper.Kernel.GH_ScriptInstance):
    def RunScript(self, cg):
        if not cg:
            return None

        return SceneObject(item=cg).draw()
# ---------- end draw ----------
draw_2 = COMPASDraw(cg=python_3_script_3.frames)  # -> rg; same code as draw
draw_3 = COMPASDraw(cg=python_3_script_2.geometries)  # -> rg; disabled; same code as draw
colour_swatch = ColourSwatch(SwatchColor=RGB(201, 154, 83))  # disabled
colour_swatch_2 = ColourSwatch(SwatchColor=RGB(201, 154, 83))
cluster = Cluster(L=draw_2)
custom_preview = CustomPreview(Geometry=draw, Material=python_3_script_3.colors)
custom_preview_2 = CustomPreview(Geometry=draw_3, Material=colour_swatch)  # disabled

# ==== cluster Cluster
L = ClusterInput()
item = ListItem(List=L, Index=0, Wrap=True)  # -> Item1, Item, Item1_2, Item2
vdisex = VectorDisplayEx(Point=item.Item, Vector=item.Item1_2, Colour=ColourSwatch(SwatchColor=RGB(255, 0, 0)), Width="3")
vdisex_2 = VectorDisplayEx(Point=item.Item, Vector=item.Item2, Colour=ColourSwatch(SwatchColor=RGB(0, 255, 60)), Width="3")
vdisex_3 = VectorDisplayEx(Point=item.Item, Vector=item.Item1, Colour=ColourSwatch(SwatchColor=RGB(0, 85, 255)), Width="3")
