# Grasshopper definition 251209_5_modules_robotest.ghx (Grasshopper 1.0.8)

offset_y_axis = Slider(0, range=-100..100)
offset_z_axis = Slider(3, range=-100..100)
offset_x_axis = Slider(-40, range=-100..100)
pt = Point(Point(-1979.881391, -725.7757754, 47.81409805))
stick_index = Slider(2, range=0..4)
face_index = Slider(3, range=0..3)
rotation = Slider(0, range=0..2000)
module_count = Slider(4, range=0..100)
module_index = Slider(0, range=0..30)
xy_plane = XYPlane(Origin=pt)
# base code:
# stick_module_modified_frame
python_3_script = Python3Script(
    root=xy_plane,
    stick_length="200",
    rot_angle=rotation,
    module_count=module_count,
    m_index=module_index,
    s_index=stick_index,
    f_index=face_index,
    offset_xxis=offset_x_axis,
    offset_yxis=offset_y_axis,
    offset_zxis=offset_z_axis,
    output_frame=Slider(0, range=-2..4),
    stick_indx=Slider(4, range=0..4),
    face_idx=Slider(3, range=0..3))  # -> out, geometries, frames, faces, axis, modules_C; inputs root: Plane, stick_length: Double, rot_angle: Int32, module_count: Int32, m_index: Int32, s_index: Int32, f_index: Int32, offset_xxis: Int32, offset_yxis: Double, offset_zxis: Double, stick_indx: Int32, face_idx: Double
# ---------- python_3_script: Python ----------
# r: compas>=2.14.1
# venv: sticks

import sys
import os
import math

#get current file path
path = ghenv.Component.OnPingDocument().FilePath
print (path)
#get parent directory of the parent directory
parentdir = os.path.dirname(path)
print (parentdir)
#get src folder which contains classes
dire = os.path.join(parentdir,'scripts')
print (dire)

sys.path.append(dire)

from compas_rhino import unload_modules
frames 
# unload_modules("group_one_sticks")
unload_modules("scripts")
unload_modules("stick_module_modified")
unload_modules("251203_module_C_connecting_FJ_safecopy") 

import Sticks
from Sticks import Stick 
from stick_module_modified_frame_safecopy import BranchingModule, BranchStickModules
from compas.geometry import Line, Point, Vector, Frame, Rotation

stick_width = 13
stick_depth = 13    

from compas_rhino.conversions import plane_to_compas_frame, frame_to_rhino_plane

# Convert input to compas
root = plane_to_compas_frame(root)

# Initialize tree
tree = BranchStickModules(root, stick_length, width=stick_width, depth=stick_depth)
# Grow tree "def grow_stick(self, from_stick_index = -1, face_index = 0, angle = 0.0)""
# for i in range(x_count):
#     if i %2:
#         tree.grow_stick(from_stick_index = i, face_index = 2, angle = rot_angle)
#     else:
#         tree.grow_stick(from_stick_index = i, face_index = 2, angle = -rot_angle*i*factor)
modules_C = []
for i in range(module_count):
    stick_idx = i%5
    mod = tree.grow_module( offset_xxis, offset_yxis, offset_zxis, from_module_index=i, from_stick_index=s_index, face_index=f_index, angle = rot_angle, move=output_frame)
    modules_C.append(mod)

print(tree)
# # Visualize
geometries = tree.visualize()
modules_C = tree.visualize()

# get specific faces
faces = []
for i, module in enumerate (tree.modules):
    if stick_indx < len(module.sticks):
        stick = module.sticks[stick_indx]
        angle = face_idx * math.pi / 2
        R = Rotation.from_axis_and_angle(stick.frame.xaxis, angle=angle, point=stick.frame.point)
        face_frame = stick.frame.transformed(R)
        face_frame.point = stick.axis.midpoint
        face_frame.point += face_frame.yaxis * stick.depth / 2
        if i %2 == 0:
            faces.append(face_frame)

####   Color with 4 different color to understand the branching method   ####
from System.Drawing import Color

color_1 = Color.FromArgb(255, 100, 0)     # orange
color_2 = Color.FromArgb(0, 150, 255)     # blue
color_3 = Color.FromArgb(0, 200, 80)      # green
color_4 = Color.FromArgb(200, 0, 200)     # magenta

color_list = [color_1, color_2, color_3, color_4]

colors = []

for module_index, module in enumerate(tree.modules):
    col = color_list[module_index % 4]

    for stick in module.sticks:
        colors.append(col)


#frame = tree.sticks[0].frame
frame = tree.modules[0].sticks[0].frame

frames = [stick.frame for module in tree.modules for stick in module.sticks]
axis = [stick.axis for module in tree.modules for stick in module.sticks]
# ---------- end python_3_script ----------
draw = COMPASDraw(cg=python_3_script.faces)  # -> rg
#   port cg: The COMPAS geometry or datastructure to be drawn.
#   port rg: The Rhino geometry object.
# ---------- draw: Python ----------
# r: compas>=2.14.1
"""
Draws COMPAS geometry in Grasshopper.
"""

from typing import Any

import Grasshopper

from compas.scene import SceneObject


class CompasToRhinoGeometry(Grasshopper.Kernel.GH_ScriptInstance):
    def RunScript(self, cg):
        if not cg:
            return None

        return SceneObject(item=cg).draw()
# ---------- end draw ----------
draw_2 = COMPASDraw(cg=python_3_script.axis)  # -> rg; same code as draw
draw_3 = COMPASDraw(cg=python_3_script.geometries)  # -> rg; same code as draw
midpt = CurveMiddle(Curve=draw_2)
custom_preview = CustomPreview(Geometry=draw, Material=ColourSwatch(SwatchColor=RGB(148, 16, 204)))
custom_preview_2 = CustomPreview(Geometry=draw_3, Material=ColourSwatch(SwatchColor=RGBA(201, 154, 83, 170)))
points = PointList(Points=midpt, Size=Slider(10, range=0..10))
