# Grasshopper definition Random Bridging.gh (Grasshopper 1.0.8)

number_slider = Slider(1, range=0..10)
number_slider_2 = Slider(4, range=0..10)
number_slider_3 = Slider(2, range=0..10)
number_slider_4 = Slider(73, range=0..360)  # disabled
number_slider_5 = Slider(100, range=0..1000)  # disabled
number_slider_6 = Slider(1, range=1..64)  # disabled
xy_plane = XYPlane(Origin=Point(0, 0, 0))  # disabled
toggle = BooleanToggle(False)  # disabled
number_slider_7 = Slider(100, range=0..1000)
pln = Plane(Plane(origin=(28.7698268, -48.98926279, 52.73799589), x=(-0.9998260986, 0.01527260657, -0.01070140646), y=(-0.01510434035, -0.9997637219, -0.01563199227)))  # disabled
pln_2 = Plane(Plane(origin=(48.40986817, -108.2796457, 42.82576786), x=(0.9999493947, 0.006016490278, -0.008062873196), y=(-0.009185141757, 0.2190637946, -0.9756673035)))  # disabled
number_slider_8 = Slider(80, range=0..1000)
rec = Rectangle({Plane=PlaneXY(120.9155109, 116.9844568, 0), Size=Domain2(u=-75..75, v=-75..75)})
rec_2 = Rectangle({Plane=PlaneXY(120.9155109, 116.9844568, 0), Size=Domain2(u=-75..75, v=-75..75)})
py3 = Python3Script(center_frame_0=xy_plane, center_frame_1=pln, bridge_length=number_slider_5, config_id=number_slider_6, auto_best=toggle)  # -> all_frames, geometries, bridge_geoms, info_text, roll_plane, original_frame_0, original_frame_1, rotated_frame_0, rotated_frame_1; disabled
# ---------- py3: Python ----------
# GH_Bridge_Config.py - Grasshopper 64-config bridge component
# r: compas>=2.14.1
# venv: sticks

import sys
import math

# Add your scripts folder
scripts_path = r'D:\Github\MAS-2526\08_SpatialAssemblies\StudentProjects\group_one\Scrypts_Shrey'
if scripts_path not in sys.path:
    sys.path.append(scripts_path)

from compas_rhino import unload_modules
unload_modules("Sticks_s")

from Sticks_s import stick_from_frame, bridge_sticks_euler_config, find_best_configuration, generate_all_frame_configurations
from compas_rhino.conversions import plane_to_compas_frame, frame_to_rhino_plane
import Rhino.Geometry as rg

# ============================================================================
# INPUTS (Grasshopper provides these)
# ============================================================================
#   center_frame_0  - Plane (reference stick)
#   center_frame_1  - Plane (target stick)
#   length_0        - Float (stick 0 length)
#   length_1        - Float (stick 1 length)
#   bridge_length   - Float (bridge length)
#   config_id       - Integer (1-64, which configuration to use)
#   width           - Float (optional, default 13)
#   depth           - Float (optional, default 13)
#   bridge_A_start  - Float (optional, default 0.5)
#   auto_best       - Boolean (optional, if True finds best config automatically)
#
# OUTPUTS
# ============================================================================
#   geometries      - All stick geometries (original + bridges)
#   bridge_geoms    - Just bridge geometries
#   face_planes     - Face planes being used (for visualization)
#   info_text       - Information about the bridges
#   roll_plane      - Visualization of roll plane
#   pitch_plane     - Visualization of pitch plane
#   intersection_sphere - Sphere at intersection point
#   original_frame_0 - Original frame of stick 0 (for debugging)
#   original_frame_1 - Original frame of stick 1 (for debugging)
#   rotated_frame_0  - Rotated frame of stick 0 (for debugging)
#   rotated_frame_1  - Rotated frame of stick 1 (for debugging)

# Defaults
if length_0 is None:
    length_0 = 100.0
if length_1 is None:
    length_1 = 100.0
if bridge_length is None:
    bridge_length = 80.0
if width is None:
    width = 13.0
if depth is None:
    depth = 13.0
if bridge_A_start is None:
    bridge_A_start = 0.5
if config_id is None:
    config_id = 1
if auto_best is None:
    auto_best = False

# Convert config_id to integer (Grasshopper sliders give floats)
config_id = int(config_id)

# Convert frames
frame_0 = plane_to_compas_frame(center_frame_0)
frame_1 = plane_to_compas_frame(center_frame_1)

# Create sticks
stick_0 = stick_from_frame(frame_0, length_0, width, depth)
stick_1 = stick_from_frame(frame_1, length_1, width, depth)

# Get all configurations to extract the frames
all_configs = generate_all_frame_configurations(stick_0, stick_1)
selected_config = all_configs[config_id - 1]

# Output original and rotated frames for debugging
original_frame_0 = frame_to_rhino_plane(frame_0)
original_frame_1 = frame_to_rhino_plane(frame_1)
rotated_frame_0 = frame_to_rhino_plane(selected_config['frame_0'])
rotated_frame_1 = frame_to_rhino_plane(selected_config['frame_1'])

# Auto-find best configuration if requested
if auto_best:
    config_id = find_best_configuration(stick_0, stick_1, criterion='min_angles')
    print(f"Auto-selected best config: {config_id}")

# Create bridges using specific configuration
bridges, info = bridge_sticks_euler_config(
    stick_0, stick_1, bridge_length, config_id, 
    width=width, depth=depth, 
    bridge_A_start=bridge_A_start,
    print_info=True
)

# Outputs
geometries = [stick_0.geometry, stick_1.geometry] + [b.geometry for b in bridges]
bridge_geoms = [b.geometry for b in bridges]

# Get face planes used for connections
face_planes = []

# Face plane for Bridge A attachment on stick_0
if info.get('best_face') is not None:
    face_A = stick_0.get_face_frame(info['best_face'])
    face_planes.append(frame_to_rhino_plane(face_A))

# Face plane for Bridge B attachment on Bridge A (if it exists)
if len(bridges) >= 2:
    # Get the face index from bridge_sequence
    for item in info['bridge_sequence']:
        if item[0] == 'B':
            attachment_pos = item[1]
            next_face_idx = item[2]
            face_B = bridges[0].get_face_frame_at(next_face_idx, attachment_pos)
            face_planes.append(frame_to_rhino_plane(face_B))
            break

# Face plane for Bridge C attachment (if it exists)
if len(bridges) >= 3:
    for item in info['bridge_sequence']:
        if item[0] == 'C':
            attachment_pos = item[1]
            next_face_idx = item[2]
            face_C = bridges[1].get_face_frame_at(next_face_idx, attachment_pos)
            face_planes.append(frame_to_rhino_plane(face_C))
            break

# Visualize roll plane if it exists
roll_plane = None
if 'roll_plane' in info:
    from compas_rhino.conversions import plane_to_rhino
    compas_plane = info['roll_plane']
    
    # Convert to Rhino plane
    plane_rhino = plane_to_rhino(compas_plane)
    
    # Create a rectangle 200x200mm centered on the plane
    size = 200.0
    rect = rg.Rectangle3d(plane_rhino, size, size)
    
    # Convert to surface for better visibility
    roll_plane = rg.Brep.CreateFromCornerPoints(
        rect.Corner(0),
        rect.Corner(1),
        rect.Corner(2),
        rect.Corner(3),
        0.001
    )

# Visualize pitch plane if it exists
pitch_plane = None
if 'pitch_plane' in info:
    from compas_rhino.conversions import plane_to_rhino
    compas_plane = info['pitch_plane']
    
    # Convert to Rhino plane
    plane_rhino = plane_to_rhino(compas_plane)
    
    # Create a rectangle 200x200mm centered on the plane
    size = 200.0
    rect = rg.Rectangle3d(plane_rhino, size, size)
    
    # Convert to surface for better visibility
    pitch_plane = rg.Brep.CreateFromCornerPoints(
        rect.Corner(0),
        rect.Corner(1),
        rect.Corner(2),
        rect.Corner(3),
        0.001
    )

# Visualize intersection point if it exists
intersection_sphere = None
if 'intersection_point' in info:
    pt = info['intersection_point']
    center = rg.Point3d(pt.x, pt.y, pt.z)
    intersection_sphere = rg.Sphere(center, 10.0).ToBrep()

# Info text
info_text = f"""64-CONFIG BRIDGE SOLVER (ZYX EULER ONLY)
{'='*60}
CONFIGURATION: {info['config_id']}/64
{'='*60}
Stick 0: X-flip={info['stick_0_x_flip']}, Z-rot={info['stick_0_z_rot']}°
Stick 1: X-flip={info['stick_1_x_flip']}, Z-rot={info['stick_1_z_rot']}°
Description: {info['description']}

FRAME TRANSFORMATION DEBUG:
  Original Frame 0 Origin: ({frame_0.point.x:.1f}, {frame_0.point.y:.1f}, {frame_0.point.z:.1f})
  Rotated Frame 0 Origin:  ({selected_config['frame_0'].point.x:.1f}, {selected_config['frame_0'].point.y:.1f}, {selected_config['frame_0'].point.z:.1f})
  Original Frame 1 Origin: ({frame_1.point.x:.1f}, {frame_1.point.y:.1f}, {frame_1.point.z:.1f})
  Rotated Frame 1 Origin:  ({selected_config['frame_1'].point.x:.1f}, {selected_config['frame_1'].point.y:.1f}, {selected_config['frame_1'].point.z:.1f})

ORIGINAL STICKS:
  Stick 0 length: {length_0:.1f}mm
  Stick 1 length: {length_1:.1f}mm
  Bridge length:  {bridge_length:.1f}mm

EULER ANGLES (ZYX):
  Z-rotation (Yaw):   {info['z_angle_deg']:>7.1f}°
  Y-rotation (Pitch): {info['y_angle_deg']:>7.1f}°
  X-rotation (Roll):  {info['x_angle_deg']:>7.1f}°
  Z-height diff:      {info.get('z_height_diff', 0):.1f}mm
  XY distance:        {info.get('xy_distance', 0):.1f}mm

BRIDGES CREATED:
  Number of bridges: {info['num_bridges']}
  Starting face:     {info.get('best_face', 'N/A')}
"""

# Add bridge sequence info
if info['bridge_sequence']:
    info_text += "\nBRIDGE SEQUENCE:\n"
    for item in info['bridge_sequence']:
        if item[0] == 'A':
            axis, angle, anchor = item
            info_text += f"  Bridge A: Z-rot {math.degrees(angle):.1f}°, anchor {anchor:.3f}\n"
        elif item[0] == 'B':
            if len(item) == 4:
                axis, pos, face_idx, anchor = item
                info_text += f"  Bridge B: attach@{pos:.3f}, face#{face_idx}, anchor {anchor:.3f}\n"
        elif item[0] == 'C':
            if len(item) == 4:
                axis, pos, face_idx, anchor = item
                info_text += f"  Bridge C: attach@{pos:.3f}, face#{face_idx}, anchor {anchor:.3f}\n"

if info['num_bridges'] == 0:
    info_text += "\n⚠ No bridges needed - sticks are aligned!"
elif info['num_bridges'] == 1:
    info_text += f"\n✓ Only Bridge A (horizontal) needed"
elif info['num_bridges'] == 2:
    info_text += f"\n✓ Bridges A + B created"
else:
    info_text += f"\n✓ All 3 bridges (A+B+C) created"

info_text += f"\n\nTIP: Try different config_id (1-64) or enable auto_best"
info_text += f"\n\nDEBUG: Check original_frame_0/1 vs rotated_frame_0/1 outputs"
# ---------- end py3 ----------
boxrec = BoxRectangle(Rectangle=rec, Height=number_slider_7)
number_slider_9 = Slider(2, range=0..10)  # disabled
boxrec_2 = BoxRectangle(Rectangle=rec_2, Height=number_slider_8)
pln_3 = Plane(Plane(origin=(28.7698268, -48.98926279, 52.73799589), x=(-0.9998260986, 0.01527260657, -0.01070140646), y=(-0.01510434035, -0.9997637219, -0.01563199227)))
pln_4 = Plane(py3.original_frame_1)  # disabled
pln_5 = Plane(py3.rotated_frame_0)  # disabled
pln_6 = Plane(py3.rotated_frame_1)  # disabled
pln_7 = Plane(py3.original_frame_0)  # disabled
pln_8 = Plane(Plane(origin=(28.7698268, -48.98926279, 52.73799589), x=(-0.9998260986, 0.01527260657, -0.01070140646), y=(-0.01510434035, -0.9997637219, -0.01563199227)))
domain_values = Slider(15, range=0..100)
draw = COMPASDraw(cg=py3.geometries)  # -> rg; disabled
#   port cg: The COMPAS geometry or datastructure to be drawn.
#   port rg: The Rhino geometry object.
# ---------- draw: Python ----------
# r: compas>=2.14.1
"""
Draws COMPAS geometry in Grasshopper.
"""

from typing import Any

import Grasshopper

from compas.scene import SceneObject


class CompasToRhinoGeometry(Grasshopper.Kernel.GH_ScriptInstance):
    def RunScript(self, cg):
        if not cg:
            return None

        return SceneObject(item=cg).draw()
# ---------- end draw ----------
draw_2 = COMPASDraw(cg=py3.bridge_geoms)  # -> rg; disabled; same code as draw
multiplication = Multiplication(A=number_slider_2, B=number_slider, C=number_slider_3)
arrbox = BoxArray(Geometry=pln_3, Cell=boxrec, XCount=number_slider_2, YCount=number_slider, ZCount=number_slider_3)  # -> Geometry, Transform
domain_values_2 = Slider(43, range=0..100)
# EULER BRIDGING
multiplication_2 = Multiplication(A=number_slider_2, B=number_slider, C=number_slider_3)
arrbox_2 = BoxArray(Geometry=pln_8, Cell=boxrec_2, XCount=number_slider_2, YCount=number_slider, ZCount=number_slider_3)  # -> Geometry, Transform
vec = VectorXYZ(XComponent=0, YComponent=number_slider_7, ZComponent=Slider(20, range=0..100))  # -> Vector, Length
vec_2 = VectorXYZ(XComponent=0, YComponent=number_slider_8, ZComponent=Slider(20, range=0..100))  # -> Vector, Length
panel = Panel(py3.info_text)  # disabled
move = Move(Geometry=arrbox.Geometry, Motion=vec.Vector)  # -> Geometry, Transform
neg = Negative(Value=vec_2.Vector)
neg_2 = Negative(Value=domain_values)
neg_3 = Negative(Value=domain_values_2)
move_2 = Move(Geometry=arrbox_2.Geometry, Motion=neg)  # -> Geometry, Transform
dom = ConstructDomain(DomainStart=domain_values, DomainEnd=neg_2)
dom_2 = ConstructDomain(DomainStart=domain_values_2, DomainEnd=neg_3)
random = Random(Range=dom, Number=multiplication, Seed=Slider(100, range=0..100))
random_2 = Random(Range=dom_2, Number=multiplication_2, Seed=Slider(90, range=0..100))
domain_values_3 = Slider(30, range=0..100)
domain_values_4 = Slider(30, range=0..100)
prot = RotatePlane(Plane=move.Geometry, Angle=degrees(random))
prot_2 = RotatePlane(Plane=move_2.Geometry, Angle=degrees(random_2))
lng = ListLength(List=prot_2)
lng_2 = ListLength(List=arrbox_2.Geometry)
deplane = DeconstructPlane(Plane=simplify(prot_2))  # -> Origin, XAxis, YAxis, ZAxis
neg_4 = Negative(Value=domain_values_3)
neg_5 = Negative(Value=domain_values_4)
dom_3 = ConstructDomain(DomainStart=domain_values_3, DomainEnd=neg_4)
neg_6 = Negative(Value=deplane.XAxis)
dom_4 = ConstructDomain(DomainStart=domain_values_4, DomainEnd=neg_5)
random_3 = Random(Range=dom_3, Number=lng, Seed=Slider(90, range=0..100))
rot3d = Rotate3D(Geometry=prot_2, Angle=degrees(random_3), Center=deplane.Origin, Axis=neg_6)  # -> Geometry, Transform
random_4 = Random(Range=dom_4, Number=lng_2, Seed=Slider(61, range=0..100))
prot_3 = RotatePlane(Plane=arrbox_2.Geometry, Angle=degrees(random_4))
lng_3 = ListLength(List=prot_3)
multiplication_3 = Multiplication(A=lng_3, B=Slider(0.5, range=0..1))
split = SplitList(List=prot_3, Index=multiplication_3)  # -> ListA, ListB
list = ValueList({"start": 0.1, "middle": 0.5, "end": 0.9}, selected="middle")
list_2 = ValueList({"start": 0.1, "middle": 0.5, "end": 0.9}, selected="start")
item = ListItem(List=split.ListB, Index=Slider(0, range=0..7), Wrap=True)
item_2 = ListItem(List=split.ListA, Index=Slider(3, range=0..7), Wrap=True)
rev = ReverseList(List=split.ListB)
py3_2 = Python3Script(frames_0=prot_3, frames_1=prot, bridge_A_start=list_2)  # -> all_frames, geometries, bridge_geoms, info_text, roll_plane, original_frame_0, original_frame_1, rotated_frame_0, rotated_frame_1; inputs frames_0: list, frames_1: list
# ---------- py3_2: Python ----------
# GH_Bridge_List.py - Grasshopper 64-config bridge component (List Input)
# r: compas>=2.14.1
# venv: sticks

import sys
import math
import Rhino.Geometry as rg

# Add your scripts folder (MUST BE THE SAME PATH AS YOUR OTHER SCRIPT)
scripts_path = r'D:\Github\MAS-2526\08_SpatialAssemblies\StudentProjects\group_one\Scrypts_Shrey'
if scripts_path not in sys.path:
    sys.path.append(scripts_path)

from compas_rhino import unload_modules
unload_modules("Sticks_s")

# Import the necessary functions
from Sticks_s import stick_from_frame, bridge_sticks_euler_config, find_best_configuration
from compas_rhino.conversions import plane_to_compas_frame

# ============================================================================
# INPUTS (Grasshopper provides these)
# frames_0 - List of Planes (reference sticks)
# frames_1 - List of Planes (target sticks)
# length_0, length_1, bridge_length, config_id, auto_best (standard inputs)
# ============================================================================

# --- Initialize Output Lists ---
geometries = []
bridge_geoms = []
info_text = []

# --- Defaults and Type Conversions ---
if frames_0 is None or frames_1 is None:
    # Exit if lists are not provided
    print("Error: Two lists of frames are required.")
    geometries = []
    bridge_geoms = []
    info_text = ["Error: Missing input frames."]
    
# Defaults
if length_0 is None:
    length_0 = 100.0
if length_1 is None:
    length_1 = 100.0
if bridge_length is None:
    bridge_length = 100.0
if config_id is None:
    config_id = 1
if auto_best is None:
    auto_best = False
if width is None:
    width = 13.0
if depth is None:
    depth = 13.0
if bridge_A_start is None:
    bridge_A_start = 0.5
    
# Convert config_id to integer (Grasshopper sliders give floats)
config_id = int(config_id)

# --- Check list lengths ---
num_frames_0 = len(frames_0) if frames_0 else 0
num_frames_1 = len(frames_1) if frames_1 else 0

if num_frames_0 != num_frames_1:
    print(f"Warning: Frame lists have different lengths ({num_frames_0} vs {num_frames_1}). Bridging only up to the shortest list length.")

# Determine the number of pairs to process
num_pairs = min(num_frames_0, num_frames_1)

# --- Loop Through Frame Pairs ---
for i in range(num_pairs):
    center_frame_0 = frames_0[i]
    center_frame_1 = frames_1[i]
    
    # Convert Rhino Planes to Compas Frames
    frame_0 = plane_to_compas_frame(center_frame_0)
    frame_1 = plane_to_compas_frame(center_frame_1)
    
    # Create sticks
    stick_0 = stick_from_frame(frame_0, length_0, width, depth)
    stick_1 = stick_from_frame(frame_1, length_1, width, depth)
    
    # Select or auto-find configuration ID for this pair
    current_config_id = config_id
    if auto_best:
        current_config_id = find_best_configuration(stick_0, stick_1, criterion='min_angles')

    # Create bridges using the configuration
    bridges, info = bridge_sticks_euler_config(
        stick_0, stick_1, bridge_length, current_config_id, 
        width=width, depth=depth, 
        bridge_A_start=bridge_A_start,
        print_info=False # Set to False inside loop for clean output
    )

    # --- Append results for the current pair ---
    
    # Geometries (Original sticks + Bridges)
    geometries.append(stick_0.geometry)
    geometries.append(stick_1.geometry)
    current_bridge_geoms = [b.geometry for b in bridges]
    geometries.extend(current_bridge_geoms)
    bridge_geoms.extend(current_bridge_geoms)

    # Info Text
    info_line = f"""PAIR {i+1}: CONFIG {current_config_id}/{info.get('total_configs', 64)}
    Stick 0 Origin: ({frame_0.point.x:.1f}, {frame_0.point.y:.1f}, {frame_0.point.z:.1f})
    Stick 1 Origin: ({frame_1.point.x:.1f}, {frame_1.point.y:.1f}, {frame_1.point.z:.1f})
    Num Bridges: {info['num_bridges']} | ZYX Angles: Z={info['z_angle_deg']:.1f}°, Y={info['y_angle_deg']:.1f}°, X={info['x_angle_deg']:.1f}°
    """
    info_text.append(info_line)

# Clean up output lists if needed (for GH tree structure)
if num_pairs == 0:
    geometries = []
    bridge_geoms = []
    info_text = ["No bridge connections created (empty input list)."]
# ---------- end py3_2 ----------
py3_3 = Python3Script(frames_0=prot_3, frames_1=rot3d.Geometry, config_id=Slider(33, range=1..64), bridge_A_start=list)  # -> all_frames, geometries, bridge_geoms, info_text, roll_plane, original_frame_0, original_frame_1, rotated_frame_0, rotated_frame_1; inputs frames_0: list, frames_1: list
# ---------- py3_3: Python ----------
# GH_Bridge_List.py - Grasshopper 64-config bridge component (List Input)
# r: compas>=2.14.1
# venv: sticks

import sys
import math
import Rhino.Geometry as rg

# Add your scripts folder (MUST BE THE SAME PATH AS YOUR OTHER SCRIPT)
scripts_path = r'D:\Github\MAS-2526\08_SpatialAssemblies\StudentProjects\group_one\Scrypts_Shrey'
if scripts_path not in sys.path:
    sys.path.append(scripts_path)

from compas_rhino import unload_modules
unload_modules("Sticks_s")

# Import the necessary functions
from Sticks_s import stick_from_frame, bridge_sticks_euler_config, find_best_configuration
from compas_rhino.conversions import plane_to_compas_frame

# ============================================================================
# INPUTS (Grasshopper provides these)
# frames_0 - List of Planes (reference sticks)
# frames_1 - List of Planes (target sticks)
# length_0, length_1, bridge_length, config_id, auto_best (standard inputs)
# ============================================================================

# --- Initialize Output Lists ---
geometries = []
bridge_geoms = []
info_text = []

# --- Defaults and Type Conversions ---
if frames_0 is None or frames_1 is None:
    # Exit if lists are not provided
    print("Error: Two lists of frames are required.")
    geometries = []
    bridge_geoms = []
    info_text = ["Error: Missing input frames."]
    
# Defaults
if length_0 is None:
    length_0 = 100.0
if length_1 is None:
    length_1 = 100.0
if bridge_length is None:
    bridge_length = 80.0
if config_id is None:
    config_id = 1
if auto_best is None:
    auto_best = False
if width is None:
    width = 13.0
if depth is None:
    depth = 13.0
if bridge_A_start is None:
    bridge_A_start = 0.5
    
# Convert config_id to integer (Grasshopper sliders give floats)
config_id = int(config_id)

# --- Check list lengths ---
num_frames_0 = len(frames_0) if frames_0 else 0
num_frames_1 = len(frames_1) if frames_1 else 0

if num_frames_0 != num_frames_1:
    print(f"Warning: Frame lists have different lengths ({num_frames_0} vs {num_frames_1}). Bridging only up to the shortest list length.")

# Determine the number of pairs to process
num_pairs = min(num_frames_0, num_frames_1)

# --- Loop Through Frame Pairs ---
for i in range(num_pairs):
    center_frame_0 = frames_0[i]
    center_frame_1 = frames_1[i]
    
    # Convert Rhino Planes to Compas Frames
    frame_0 = plane_to_compas_frame(center_frame_0)
    frame_1 = plane_to_compas_frame(center_frame_1)
    
    # Create sticks
    stick_0 = stick_from_frame(frame_0, length_0, width, depth)
    stick_1 = stick_from_frame(frame_1, length_1, width, depth)
    
    # Select or auto-find configuration ID for this pair
    current_config_id = config_id
    if auto_best:
        current_config_id = find_best_configuration(stick_0, stick_1, criterion='min_angles')

    # Create bridges using the configuration
    bridges, info = bridge_sticks_euler_config(
        stick_0, stick_1, bridge_length, current_config_id, 
        width=width, depth=depth, 
        bridge_A_start=bridge_A_start,
        print_info=False # Set to False inside loop for clean output
    )

    # --- Append results for the current pair ---
    
    # Geometries (Original sticks + Bridges)
    geometries.append(stick_0.geometry)
    geometries.append(stick_1.geometry)
    current_bridge_geoms = [b.geometry for b in bridges]
    geometries.extend(current_bridge_geoms)
    bridge_geoms.extend(current_bridge_geoms)

    # Info Text
    info_line = f"""PAIR {i+1}: CONFIG {current_config_id}/{info.get('total_configs', 64)}
    Stick 0 Origin: ({frame_0.point.x:.1f}, {frame_0.point.y:.1f}, {frame_0.point.z:.1f})
    Stick 1 Origin: ({frame_1.point.x:.1f}, {frame_1.point.y:.1f}, {frame_1.point.z:.1f})
    Num Bridges: {info['num_bridges']} | ZYX Angles: Z={info['z_angle_deg']:.1f}°, Y={info['y_angle_deg']:.1f}°, X={info['x_angle_deg']:.1f}°
    """
    info_text.append(info_line)

# Clean up output lists if needed (for GH tree structure)
if num_pairs == 0:
    geometries = []
    bridge_geoms = []
    info_text = ["No bridge connections created (empty input list)."]
# ---------- end py3_3 ----------
draw_3 = COMPASDraw(cg=py3_3.bridge_geoms)  # -> rg; same code as draw
draw_4 = COMPASDraw(cg=py3_3.geometries)  # -> rg; same code as draw
draw_5 = COMPASDraw(cg=py3_2.bridge_geoms)  # -> rg; same code as draw
draw_6 = COMPASDraw(cg=py3_2.geometries)  # -> rg; same code as draw
panel_2 = Panel(py3_3.info_text)
list_3 = ValueList({"start": 0.1, "middle": 0.5, "end": 0.9}, selected="end")
py3_4 = Python3Script(frames_0=split.ListA, frames_1=split.ListB, config_id=Slider(17, range=1..64), bridge_A_start=list_3)  # -> all_frames, geometries, bridge_geoms, info_text, roll_plane, original_frame_0, original_frame_1, rotated_frame_0, rotated_frame_1; inputs frames_0: list, frames_1: list; same code as py3_2
draw_7 = COMPASDraw(cg=py3_4.bridge_geoms)  # -> rg; same code as draw
draw_8 = COMPASDraw(cg=py3_4.geometries)  # -> rg; same code as draw
