# Grasshopper definition 102_grid_module_offset.gh (Grasshopper 1.0.8)

x_range = Slider(4, range=0..10)
y_range = Slider(3, range=0..10)
z_range = Slider(4, range=0..10)
x_range_2 = Slider(3, range=0..10)
z_range_2 = Slider(5, range=0..10)
y_range_2 = Slider(5, range=0..10)
py3 = Python3Script(x_range=x_range, y_range=y_range, z_range=z_range)  # -> out, points, assembly, sticks, stick_box; inputs x_range: Int32, y_range: Int32, z_range: Int32, offset: Double, line_0: Line, line_1: Line; disabled
# ---------- py3: Python ----------
#locate stick class file in the same folder
from compas_rhino import unload_modules
import sys
import os

#get current file path
path = ghenv.Component.OnPingDocument().FilePath
#get parent directory of the parent directory
parentdir = os.path.dirname(path)
#get src folder which contains classes
dire = os.path.join(parentdir,'scripts')

sys.path.append(dire)

unload_modules('Sticks')
unload_modules('stick_module')

import Sticks
from Sticks import Stick, stick_bridge
from compas.geometry import Line, Point, Vector
from compas_rhino.conversions import line_to_compas
from stick_module import OStickModule

stick_width = 13.0
stick_depth = 13.0
stick_length = 300

points = []
assembly = []

offset = stick_length
for x in range (x_range):
    for y in range(y_range):
        for z in range(z_range):
            grid_size = stick_length - 2*stick_depth
            pt = Point(x*grid_size, y*grid_size, z*grid_size)
            points.append(pt)
            # type = if even return 0, if odd return 1 if it's the last stick
            type_x = x%2 if x < x_range-1 else 2
            print("x", type_x)
            type_y = y%2 if y < y_range-1 else 2
            print("y", type_y)
            type_z = z%2 if z < z_range-1 else 2
            print("z", type_z)

            type = {"x": type_x, "y": type_y, "z": type_z}

            stick_module = OStickModule(pt, stick_length, stick_width, stick_depth)
            stick_module.create_orthogonal_module(type)

            assembly.extend(stick_module.sticks)

sticks = [s.geometry for s in assembly]
# ---------- end py3 ----------
py3_2 = Python3Script(x_range=x_range_2, y_range=x_range_2, z_range=x_range_2, offset=Slider(120, range=0..120))  # -> out, points, assembly, sticks, stick_box; inputs x_range: Int32, y_range: Int32, z_range: Int32, offset: Double, line_0: Line, line_1: Line
# ---------- py3_2: Python ----------
#locate stick class file in the same folder
from compas_rhino import unload_modules
import sys
import os

#get current file path
path = ghenv.Component.OnPingDocument().FilePath
#get parent directory of the parent directory
parentdir = os.path.dirname(path)
#get src folder which contains classes
dire = os.path.join(parentdir,'scripts')

sys.path.append(dire)

unload_modules('Sticks')
unload_modules('stick_module')

import Sticks
from Sticks import Stick, stick_bridge
from compas.geometry import Line, Point, Vector
from compas_rhino.conversions import line_to_compas
from stick_module_offset import OStickModule

stick_width = 13.0
stick_depth = 13.0
stick_length = 300


points = []
assembly = []

offset
for x in range (x_range):
    for y in range(y_range):
        for z in range(z_range):
            grid_size = stick_length - 2*stick_depth - offset
            pt = Point(x*grid_size, y*grid_size, z*grid_size)
            points.append(pt)
            # type = if even return 0, if odd return 1 if it's the last stick
            type_x = x%2 if x < x_range-1 else 2
            print("x", type_x)
            type_y = y%2 if y < y_range-1 else 2
            print("y", type_y)
            type_z = z%2 if z < z_range-1 else 2
            print("z", type_z)

            type = {"x": type_x, "y": type_y, "z": type_z}

            stick_module = OStickModule(pt, stick_length, stick_width, stick_depth)
            stick_module.create_orthogonal_module(offset, type)

            assembly.extend(stick_module.sticks)

sticks = [s.geometry for s in assembly]
# ---------- end py3_2 ----------
compas_draw = COMPASDraw(cg=py3_2.points)  # -> rg
#   port cg: The COMPAS geometry or datastructure to be drawn.
#   port rg: The Rhino geometry object.
# ---------- compas_draw: Python ----------
# r: compas>=2.14.1
"""
Draws COMPAS geometry in Grasshopper.
"""

from typing import Any

import Grasshopper

from compas.scene import SceneObject


class CompasToRhinoGeometry(Grasshopper.Kernel.GH_ScriptInstance):
    def RunScript(self, cg):
        if not cg:
            return None

        return SceneObject(item=cg).draw()
# ---------- end compas_draw ----------
compas_draw_2 = COMPASDraw(cg=py3.sticks)  # -> rg; same code as compas_draw
compas_draw_3 = COMPASDraw(cg=py3.points)  # -> rg; same code as compas_draw
panel = Panel(py3.sticks)
compas_draw_4 = COMPASDraw(cg=py3_2.sticks)  # -> a; same code as compas_draw
panel_2 = Panel(py3_2.sticks)
panel_3 = Panel(py3.assembly)
panel_4 = Panel(py3_2.assembly)
