# Grasshopper definition 103_branching_out_sticks_FJ.ghx (Grasshopper 1.0.8)

stick_count = Slider(12, range=0..100)
rotation = Slider(3, range=0..100)
face_index = Slider(1, range=0..30)
xy_plane = XYPlane(Origin=Point(0, 0, 0))
factor = Slider(0.71, range=0..1)
stick_index = Slider(2, range=0..30)
offset_axis = Slider(24, range=-100..100)
xy_plane_2 = XYPlane(Origin=Point(0, 0, 0))
stick_length = Slider(360, range=0..1000)
rotation_2 = Slider(459, range=0..2000)
module_count = Slider(5, range=0..100)
face_index_2 = Slider(2, range=0..30)
face_index_3 = Slider(3, range=0..30)
factor_2 = Slider(0.62, range=0..1)
stick_index_2 = Slider(0, range=0..30)
offset_axis_2 = Slider(0, range=-100..100)
xy_plane_3 = XYPlane(Origin=Point(0, 0, 0))
xy_plane_4 = XYPlane(Origin=Point(0, 0, 0))
offset_axis_3 = Slider(-10, range=-100..100)
stick_length_2 = Slider(360, range=0..1000)
rotation_3 = Slider(115, range=0..2000)
module_count_2 = Slider(100, range=0..100)
offset_axis_4 = Slider(-65, range=-100..100)
factor_3 = Slider(0.62, range=0..1)
stick_index_3 = Slider(4, range=0..30)
xy_plane_5 = XYPlane(Origin=Point(0, 0, 0))
xy_plane_6 = XYPlane(Origin=Point(0, 0, 0))
rotation_4 = Slider(0, range=0..2000)
module_count_3 = Slider(3, range=0..100)
x_range = Slider(8, range=0..10)
y_range = Slider(5, range=0..10)
z_range = Slider(4, range=0..10)

# ----
# 4 long branches test
python_3_script = Python3Script(root=xy_plane, stick_length=Slider(155.1, range=0..1000), angle=Slider(90, range=0..100))  # -> out, geometries, frame; inputs stick_length: Double, angle: Int32; disabled
# ---------- python_3_script: Python ----------
# r: compas>=2.14.1
# venv: sticks

import sys
import os
import math

#get current file path
path = ghenv.Component.OnPingDocument().FilePath
print (path)
#get parent directory of the parent directory
parentdir = os.path.dirname(path)
print (parentdir)
#get src folder which contains classes
dire = os.path.join(parentdir,'scripts')
print (dire)

sys.path.append(dire)

from compas_rhino import unload_modules

unload_modules("Sticks")
unload_modules("stick_module")

import Sticks
from Sticks import Stick 
from stick_module import BranchingModule
from compas.geometry import Line, Point, Vector, Frame

stick_width = 13.0
stick_depth = 13.0

from compas_rhino.conversions import plane_to_compas_frame, frame_to_rhino_plane

# Convert input to compas
root = plane_to_compas_frame(root)

# Initialize tree
tree = BranchingModule(root, stick_length, width = stick_width, depth = stick_depth)

# Grow tree "def grow_stick(self, from_stick_index = -1, face_index = 0, angle = 0.0)""
tree.grow_stick(face_index = 0, angle = angle)
tree.grow_stick(face_index = 1, angle = angle)
tree.grow_stick(face_index = 1, angle = angle)
tree.grow_stick(face_index = 1, angle = angle)
tree.grow_stick(face_index = 1, angle = angle)
tree.grow_stick(face_index = 1, angle = angle)
tree.grow_stick(face_index = 1, angle = angle)
tree.grow_stick(face_index = 1, angle = angle)
tree.grow_stick(face_index = 1, angle = angle)
tree.grow_stick(face_index = 1, angle = angle)
tree.grow_stick(face_index = 1, angle = angle)
tree.grow_stick(face_index = 1, angle = angle)
tree.grow_stick(face_index = 1, angle = angle)
tree.grow_stick(face_index = 1, angle = angle)
tree.grow_stick(face_index = 1, angle = angle)
tree.grow_stick(face_index = 1, angle = angle)

tree.grow_stick(from_stick_index = 0, face_index = 1, angle = 45)
tree.grow_stick(face_index = 2, angle = angle)
tree.grow_stick(face_index = 2, angle = angle)
tree.grow_stick(face_index = 2, angle = angle)
tree.grow_stick(face_index = 2, angle = angle)
tree.grow_stick(face_index = 2, angle = angle)
tree.grow_stick(face_index = 2, angle = angle)
tree.grow_stick(face_index = 2, angle = angle)
tree.grow_stick(face_index = 2, angle = angle)


tree.grow_stick(from_stick_index = 0, face_index = 2, angle = 45)
tree.grow_stick(face_index = 3, angle = angle)
tree.grow_stick(face_index = 3, angle = angle)
tree.grow_stick(face_index = 3, angle = angle)
tree.grow_stick(face_index = 3, angle = angle)
tree.grow_stick(face_index = 3, angle = angle)
tree.grow_stick(face_index = 3, angle = angle)
tree.grow_stick(face_index = 3, angle = angle)
tree.grow_stick(face_index = 3, angle = angle)
tree.grow_stick(face_index = 3, angle = angle)
tree.grow_stick(face_index = 3, angle = angle)
tree.grow_stick(face_index = 3, angle = angle)
tree.grow_stick(face_index = 3, angle = angle)
tree.grow_stick(face_index = 3, angle = angle)
tree.grow_stick(face_index = 3, angle = angle)
tree.grow_stick(face_index = 3, angle = angle)
tree.grow_stick(face_index = 3, angle = angle)

tree.grow_stick(from_stick_index = 0, face_index = 3, angle = 45)
tree.grow_stick(face_index = 4, angle = angle)
tree.grow_stick(face_index = 4, angle = angle)
tree.grow_stick(face_index = 4, angle = angle)
tree.grow_stick(face_index = 4, angle = angle)
tree.grow_stick(face_index = 4, angle = angle)
tree.grow_stick(face_index = 4, angle = angle)
tree.grow_stick(face_index = 4, angle = angle)
tree.grow_stick(face_index = 4, angle = angle)
tree.grow_stick(face_index = 4, angle = angle)
tree.grow_stick(face_index = 4, angle = angle)
tree.grow_stick(face_index = 4, angle = angle)
tree.grow_stick(face_index = 4, angle = angle)
tree.grow_stick(face_index = 4, angle = angle)
tree.grow_stick(face_index = 4, angle = angle)
tree.grow_stick(face_index = 4, angle = angle)
tree.grow_stick(face_index = 4, angle = angle)
tree.grow_stick(face_index = 4, angle = angle)
tree.grow_stick(face_index = 4, angle = angle)
tree.grow_stick(face_index = 4, angle = angle)
tree.grow_stick(face_index = 4, angle = angle)
tree.grow_stick(face_index = 4, angle = angle)
tree.grow_stick(face_index = 4, angle = angle)
tree.grow_stick(face_index = 4, angle = angle)
tree.grow_stick(face_index = 4, angle = angle)
tree.grow_stick(face_index = 4, angle = angle)
tree.grow_stick(face_index = 4, angle = angle)
tree.grow_stick(face_index = 4, angle = angle)
tree.grow_stick(face_index = 4, angle = angle)
tree.grow_stick(face_index = 4, angle = angle)
tree.grow_stick(face_index = 4, angle = angle)
tree.grow_stick(face_index = 4, angle = angle)
tree.grow_stick(face_index = 4, angle = angle)
tree.grow_stick(face_index = 4, angle = angle)
tree.grow_stick(face_index = 4, angle = angle)
tree.grow_stick(face_index = 4, angle = angle)
tree.grow_stick(face_index = 4, angle = angle)
tree.grow_stick(face_index = 4, angle = angle)
tree.grow_stick(face_index = 4, angle = angle)
tree.grow_stick(face_index = 4, angle = angle)
tree.grow_stick(face_index = 4, angle = angle)
tree.grow_stick(face_index = 4, angle = angle)
tree.grow_stick(face_index = 4, angle = angle)
tree.grow_stick(face_index = 4, angle = angle)
tree.grow_stick(face_index = 4, angle = angle)
tree.grow_stick(face_index = 4, angle = angle)
tree.grow_stick(face_index = 4, angle = angle)
tree.grow_stick(face_index = 4, angle = angle)


# Visualize
geometries = tree.visualize()


frame = tree.sticks[0].frame
# ---------- end python_3_script ----------

# ----
# Tree
python_3_script_2 = Python3Script(
    root=xy_plane_3,
    stick_length=Slider(155.1, range=0..1000),
    angle=Slider(90, range=0..100),
    x_count=Slider(10, range=0..100),
    y_count=Slider(10, range=0..100))  # -> out, geometries, frames; inputs stick_length: Double, angle: Int32, x_count: Int32, y_count: Int32; disabled
# ---------- python_3_script_2: Python ----------
# r: compas>=2.14.1
# venv: sticks

import sys
import os
import math

#get current file path
path = ghenv.Component.OnPingDocument().FilePath
print (path)
#get parent directory of the parent directory
parentdir = os.path.dirname(path)
print (parentdir)
#get src folder which contains classes
dire = os.path.join(parentdir,'scripts')
print (dire)

sys.path.append(dire)

from compas_rhino import unload_modules

unload_modules("Sticks")
unload_modules("stick_module")

import Sticks
from Sticks import Stick 
from stick_module import BranchingModule
from compas.geometry import Line, Point, Vector, Frame

stick_width = 13.0
stick_depth = 13.0

from compas_rhino.conversions import plane_to_compas_frame, frame_to_rhino_plane

# Convert input to compas
root = plane_to_compas_frame(root)

# Initialize tree
tree = BranchingModule(root, stick_length, width = stick_width, depth = stick_depth)

# Grow tree "def grow_stick(self, from_stick_index = -1, face_index = 0, angle = 0.0)""
for i in range(x_count):
    for j in range(y_count):
        tree.grow_stick(from_stick_index = i, face_index = 0, angle = 10)
        tree.grow_stick(from_stick_index = i, face_index = j%3, angle = 40)

# Visualize
geometries = tree.visualize()

 
#frames = tree.sticks[0].frame

frames = [stick.frame for stick in tree.sticks]
# ---------- end python_3_script_2 ----------

python_3_script_3 = Python3Script(
    root=xy_plane_6,
    stick_length=Slider(155.1, range=0..1000),
    rot_angle=rotation,
    x_count=stick_count,
    y_count=Slider(0, range=0..100),
    factor=Slider(0.2, range=0..1))  # -> out, geometries, frame; inputs stick_length: Double, rot_angle: Int32, x_count: Int32, y_count: Int32, factor: Double; disabled
# ---------- python_3_script_3: Python ----------
# r: compas>=2.14.1
# venv: sticks

import sys
import os
import math

#get current file path
path = ghenv.Component.OnPingDocument().FilePath
print (path)
#get parent directory of the parent directory
parentdir = os.path.dirname(path)
print (parentdir)
#get src folder which contains classes
dire = os.path.join(parentdir,'scripts')
print (dire)

sys.path.append(dire)

from compas_rhino import unload_modules

unload_modules("Sticks")
unload_modules("stick_module")

import Sticks
from Sticks import Stick 
from stick_module import BranchingModule
from compas.geometry import Line, Point, Vector, Frame

stick_width = 13.0 
stick_depth = 13.0

from compas_rhino.conversions import plane_to_compas_frame, frame_to_rhino_plane

# Convert input to compas
root = plane_to_compas_frame(root)

# Initialize tree
tree = BranchingModule(root, stick_length, width = stick_width, depth = stick_depth)

# Grow tree "def grow_stick(self, from_stick_index = -1, face_index = 0, angle = 0.0)""
for i in range(x_count):
    # tree.grow_stick(from_stick_index = i, face_index = 2, angle = rot_angle)
    if i %2:
        tree.grow_stick(from_stick_index = i, face_index = 2, angle = rot_angle)
    else:
        tree.grow_stick(from_stick_index = i, face_index = 2, angle = -rot_angle*i*factor)

# Visualize
geometries = tree.visualize()

 
frame = tree.sticks[0].frame

frames = [stick.frame for stick in tree.sticks]
# ---------- end python_3_script_3 ----------

# ----
# moduleC in Grid
py3 = Python3Script(x_range=x_range, y_range=y_range, z_range=z_range)  # -> out, points, assembly, sticks, stick_box, frames; inputs x_range: Int32, y_range: Int32, z_range: Int32, line_0: Line, line_1: Line; disabled
# ---------- py3: Python ----------
#locate stick class file in the same folder
from compas_rhino import unload_modules
import sys
import os

#get current file path
path = ghenv.Component.OnPingDocument().FilePath
#get parent directory of the parent directory
parentdir = os.path.dirname(path)
#get src folder which contains classes
dire = os.path.join(parentdir,'scripts')

sys.path.append(dire)

unload_modules('Sticks')
unload_modules('stick_module')

import Sticks
from Sticks import Stick, stick_bridge
from compas.geometry import Line, Point, Vector
from compas_rhino.conversions import line_to_compas
from stick_module import OStickModule
from stick_module import StickModuleB
from stick_module import StickModuleC

stick_width = 13.0
stick_depth = 13.0
stick_length = 200

points = []
assembly = []
for x in range (x_range):
    for y in range(y_range):
        for z in range(z_range):
            grid_size = stick_length - 2*stick_depth
            pt = Point(x*grid_size, y*grid_size, z*grid_size)
            points.append(pt)
            # type = if even return 0, if odd return 1 if it's the last stick
            type_x = x%2 if x < x_range-1 else 2
            print("x", type_x)
            type_y = y%2 if y < y_range-1 else 2
            print("y", type_y)
            type_z = z%2 if z < z_range-1 else 2
            print("z", type_z)

            type = {"x": type_x, "y": type_y, "z": type_z}

            stick_module = StickModuleC(pt, stick_width, stick_depth, stick_length)
            stick_module.create_module_b()

            assembly.extend(stick_module.sticks)

sticks = [s.geometry for s in assembly]

frames = [stick.frame for stick in stick_module.sticks]
# ---------- end py3 ----------

draw = COMPASDraw(cg=python_3_script.frame)  # -> rg
#   port cg: The COMPAS geometry or datastructure to be drawn.
#   port rg: The Rhino geometry object.
# ---------- draw: Python ----------
# r: compas>=2.14.1
"""
Draws COMPAS geometry in Grasshopper.
"""

from typing import Any

import Grasshopper

from compas.scene import SceneObject


class CompasToRhinoGeometry(Grasshopper.Kernel.GH_ScriptInstance):
    def RunScript(self, cg):
        if not cg:
            return None

        return SceneObject(item=cg).draw()
# ---------- end draw ----------

# ----
# 1. module trial
# if offset_axis has value, Rotation executes weird
# if no offset, no rotation --> check code
python_3_script_4 = Python3Script(
    root=xy_plane_2,
    stick_length=stick_length,
    rot_angle=rotation_2,
    module_count=module_count,
    y_count=Slider(7, range=0..100),
    factor=factor,
    s_index=stick_index,
    f_index=face_index,
    offset_axis=offset_axis)  # -> out, geometries, frames; inputs root: Plane, stick_length: Double, rot_angle: Int32, module_count: Int32, y_count: Int32, factor: Double, s_index: Int32, f_index: Int32, offset_axis: Int32; disabled
# ---------- python_3_script_4: Python ----------
# r: compas>=2.14.1
# venv: sticks

import sys
import os
import math

#get current file path
path = ghenv.Component.OnPingDocument().FilePath
print (path)
#get parent directory of the parent directory
parentdir = os.path.dirname(path)
print (parentdir)
#get src folder which contains classes
dire = os.path.join(parentdir,'group_one_scripts')
print (dire)

sys.path.append(dire)

from compas_rhino import unload_modules

unload_modules("group_one_sticks")
unload_modules("group_one_stick_module")
unload_modules("stick_module_modified") 

import group_one_sticks
from group_one_sticks import Stick 
from stick_module_modified import BranchingModule, BranchStickModules
from compas.geometry import Line, Point, Vector, Frame

stick_width = 13.0 
stick_depth = 13.0

from compas_rhino.conversions import plane_to_compas_frame, frame_to_rhino_plane

# Convert input to compas
root = plane_to_compas_frame(root)

# Initialize tree
tree = BranchStickModules(root, stick_length, width=stick_width, depth=stick_depth)
# Grow tree "def grow_stick(self, from_stick_index = -1, face_index = 0, angle = 0.0)""
# for i in range(x_count):
#     if i %2:
#         tree.grow_stick(from_stick_index = i, face_index = 2, angle = rot_angle)
#     else:
#         tree.grow_stick(from_stick_index = i, face_index = 2, angle = -rot_angle*i*factor)

for i in range(module_count):
    tree.grow_module( offset_axis, from_module_index=i, from_stick_index=s_index, face_index=f_index, angle = rot_angle)
print(tree)
# Visualize
geometries = tree.visualize()

 
#frame = tree.sticks[0].frame
frame = tree.modules[0].sticks[0].frame

frames = [stick.frame for module in tree.modules for stick in module.sticks]
# ---------- end python_3_script_4 ----------

draw_2 = COMPASDraw(cg=python_3_script.geometries)  # -> a; same code as draw

# ----
# interesting tower modul_
# keep for further exploration/explanation
python_3_script_5 = Python3Script(
    root=xy_plane_4,
    stick_length=stick_length_2,
    rot_angle=rotation_3,
    module_count=module_count_2,
    y_count=Slider(7, range=0..100),
    factor=factor_2,
    s_index=stick_index_2,
    f_index=face_index_2,
    offset_axis=offset_axis_2)  # -> out, geometries, frames; inputs root: Plane, stick_length: Double, rot_angle: Int32, module_count: Int32, y_count: Int32, factor: Double, s_index: Int32, f_index: Int32, offset_axis: Int32; disabled
# ---------- python_3_script_5: Python ----------
# r: compas>=2.14.1
# venv: sticks

import sys
import os
import math

#get current file path
path = ghenv.Component.OnPingDocument().FilePath
print (path)
#get parent directory of the parent directory
parentdir = os.path.dirname(path)
print (parentdir)
#get src folder which contains classes
dire = os.path.join(parentdir,'group_one_scripts')
print (dire)

sys.path.append(dire)

from compas_rhino import unload_modules

unload_modules("group_one_sticks")
unload_modules("group_one_stick_module")
unload_modules("stick_module_modified_towermodul") 

import group_one_sticks
from group_one_sticks import Stick 
from stick_module_modified_towermodul import BranchingModule, BranchStickModules
from compas.geometry import Line, Point, Vector, Frame

stick_width = 13.0 
stick_depth = 13.0

from compas_rhino.conversions import plane_to_compas_frame, frame_to_rhino_plane

# Convert input to compas
root = plane_to_compas_frame(root)

# Initialize tree
tree = BranchStickModules(root, stick_length, width=stick_width, depth=stick_depth)
# Grow tree "def grow_stick(self, from_stick_index = -1, face_index = 0, angle = 0.0)""
# for i in range(x_count):
#     if i %2:
#         tree.grow_stick(from_stick_index = i, face_index = 2, angle = rot_angle)
#     else:
#         tree.grow_stick(from_stick_index = i, face_index = 2, angle = -rot_angle*i*factor)

for i in range(module_count):
    tree.grow_module( offset_axis, from_module_index=i, from_stick_index=s_index, face_index=f_index, angle = rot_angle)
print(tree)
# Visualize
geometries = tree.visualize()

 
#frame = tree.sticks[0].frame
frame = tree.modules[0].sticks[0].frame

frames = [stick.frame for module in tree.modules for stick in module.sticks]
# ---------- end python_3_script_5 ----------

# ----
# interesting tower modul_
# keep for further exploration/explanation
python_3_script_6 = Python3Script(
    root=xy_plane_5,
    stick_length="200",
    rot_angle=rotation_4,
    module_count=module_count_3,
    y_count=Slider(0, range=0..100),
    factor=factor_3,
    s_index=stick_index_3,
    f_index=face_index_3,
    offset_axis=offset_axis_4,
    offset_axis_b=offset_axis_3)  # -> out, geometries, frames; inputs root: Plane, stick_length: Double, rot_angle: Int32, module_count: Int32, y_count: Int32, factor: Double, s_index: Int32, f_index: Int32, offset_axis: Int32, offset_axis_b: Double
# ---------- python_3_script_6: Python ----------
# r: compas>=2.14.1
# venv: sticks

import sys
import os
import math

#get current file path
path = ghenv.Component.OnPingDocument().FilePath
print (path)
#get parent directory of the parent directory
parentdir = os.path.dirname(path)
print (parentdir)
#get src folder which contains classes
dire = os.path.join(parentdir,'group_one_scripts')
print (dire)

sys.path.append(dire)

from compas_rhino import unload_modules

unload_modules("group_one_sticks")
unload_modules("group_one_stick_module")
unload_modules("stick_module_modified_frame") 

import group_one_sticks
from group_one_sticks import Stick 
from stick_module_modified_frame import BranchingModule, BranchStickModules
from compas.geometry import Line, Point, Vector, Frame

stick_width = 10
stick_depth = 10    

from compas_rhino.conversions import plane_to_compas_frame, frame_to_rhino_plane

# Convert input to compas
root = plane_to_compas_frame(root)

# Initialize tree
tree = BranchStickModules(root, stick_length, width=stick_width, depth=stick_depth)
# Grow tree "def grow_stick(self, from_stick_index = -1, face_index = 0, angle = 0.0)""
# for i in range(x_count):
#     if i %2:
#         tree.grow_stick(from_stick_index = i, face_index = 2, angle = rot_angle)
#     else:
#         tree.grow_stick(from_stick_index = i, face_index = 2, angle = -rot_angle*i*factor)

for i in range(module_count):
    tree.grow_module( offset_axis, offset_axis_b, from_module_index=i, from_stick_index=s_index, face_index=f_index, angle = rot_angle)
print(tree)
# Visualize
geometries = tree.visualize()

 
#frame = tree.sticks[0].frame
frame = tree.modules[0].sticks[0].frame

frames = [stick.frame for module in tree.modules for stick in module.sticks]
# ---------- end python_3_script_6 ----------
draw_3 = COMPASDraw(cg=python_3_script_2.geometries)  # -> a; same code as draw
draw_4 = COMPASDraw(cg=python_3_script_2.frames)  # -> rg; same code as draw
draw_5 = COMPASDraw(cg=python_3_script_3.geometries)  # -> rg; same code as draw
draw_6 = COMPASDraw(cg=python_3_script_4.geometries)  # -> rg; same code as draw
draw_7 = COMPASDraw(cg=python_3_script_5.geometries)  # -> rg; same code as draw
compas_draw = COMPASDraw(cg=py3.sticks)  # -> rg; same code as draw
compas_draw_2 = COMPASDraw(cg=py3.points)  # -> rg; same code as draw
draw_8 = COMPASDraw(cg=python_3_script_6.geometries)  # -> rg; same code as draw
custom_preview = CustomPreview(Geometry=[draw_2, draw_3], Material=ColourSwatch(SwatchColor=RGB(184, 139, 103)))
panel = Panel(python_3_script_4.frames)
python_3_script_7 = Python3Script(
    frames=[py3.frames, python_3_script_3.frame, python_3_script_4.frames, python_3_script_5.frames],
    factor=Slider(34, range=10..100))  # -> out, points, x_vectors, y_vectors, normal; inputs frames: list
# ---------- python_3_script_7: Python ----------
from compas.geometry import Vector
from compas.geometry import cross_vectors
from compas_rhino.conversions import vector_to_rhino
from compas_rhino.conversions import point_to_rhino

points = []
x_vectors = []
y_vectors = []
normal = []



for frame in frames:
    points.append(point_to_rhino(frame.point))
    x_vectors.append(vector_to_rhino(frame.xaxis * factor))
    y_vectors.append(vector_to_rhino(frame.yaxis * factor))
    normal.append(vector_to_rhino(frame.normal * factor))

#frames = [stick.frame for stick in tree.sticks]
# ---------- end python_3_script_7 ----------
vector_display_ex = VectorDisplayEx(
    Point=python_3_script_7.points,
    Vector=python_3_script_7.x_vectors,
    Colour=ColourSwatch(SwatchColor=RGB(191, 82, 82)),
    Width=2)
vector_display_ex_2 = VectorDisplayEx(
    Point=python_3_script_7.points,
    Vector=python_3_script_7.y_vectors,
    Colour=ColourSwatch(SwatchColor=RGB(62, 80, 138)),
    Width=2)
vector_display_ex_3 = VectorDisplayEx(Vector=python_3_script_7.normal, Colour=ColourSwatch(SwatchColor=RGB(110, 145, 70)), Width=2)
