# Grasshopper definition 204_send_to_robot_group_one.gh (Grasshopper 1.0.8)

# 1. Save your stick assembly in data folder in the parent directory (Example: 201_stick_assembly.ghx)
# 
# 2. Run Docker and connect with the ROS connect component
# 
# 3. Plan for any index and send to robot using the send components.
button = Button()
compas_fab_ros_connect = COMPASFABROSConnect(connect=button)  # -> ros_client, is_connected; inputs ip: String, port: Int32, connect: Boolean
#   port ip: The ip address ROS. Defaults to 127.0.0.1.
#   port port: The port of ROS. Defaults to 9090.
#   port connect: If True, connects to ROS. If False, disconnects from ROS. Defaults to False.
#   port ros_client: The ROS client.
#   port is_connected: True if connection established.
# ---------- compas_fab_ros_connect: Python ----------
# r: compas_fab>=1.0.2
"""
Connect or disconnect to ROS.

COMPAS FAB v1.0.2
"""

import Grasshopper
from compas_ghpython import create_id
from scriptcontext import sticky as st

from compas_fab.backends import RosClient


class ROSConnect(Grasshopper.Kernel.GH_ScriptInstance):
    def RunScript(self, ip: str, port: int, connect: bool):
        ros_client = None

        ip = ip or "127.0.0.1"
        port = port or 9090

        key = create_id(ghenv.Component, "ros_client")  # noqa: F821

        if ros_client:
            st[key].close()
        if connect:
            st[key] = RosClient(ip, port)
            st[key].run(5)

        ros_client = st.get(key, None)
        is_connected = ros_client.is_connected if ros_client else False
        return (ros_client, is_connected)
# ---------- end compas_fab_ros_connect ----------

# ----
# TCP plane!
number_slider = Slider(0, range=-1000..1000)
# Change TCP place as per measurement on the Robot!
number_slider_2 = Slider(0.14, range=-1000..1000)
pt = ConstructPoint(XCoordinate=number_slider, YCoordinate=Slider(0, range=-1000..1000), ZCoordinate=number_slider_2)

compas_fab_ros_robot = COMPASFABROSRobot(ros_client=compas_fab_ros_connect.ros_client, load=Button())  # -> robot; inputs load: Boolean
#   port ros_client: The ROS client.
#   port load: If True, loads the robot from ROS. Defaults to False.
# ---------- compas_fab_ros_robot: Python ----------
# r: compas_fab>=1.0.2
"""
Load robot directly from ROS.

COMPAS FAB v1.0.2
"""

import Grasshopper
from compas_ghpython import create_id
from scriptcontext import sticky as st
from compas.geometry import Frame, Transformation

from compas.scene import SceneObject


class ROSRobot(Grasshopper.Kernel.GH_ScriptInstance):
    def RunScript(self, ros_client, load: bool):
        key = create_id(ghenv.Component, "robot")  # noqa: F821

        if ros_client and ros_client.is_connected and load:
            # Load URDF from ROS
            st[key] = ros_client.load_robot(load_geometry=True, precision=12)
            st[key].scene_object = SceneObject(item=st[key].model)

        robot = st.get(key, None)

        if robot:  # client sometimes need to be restarted, without needing to reload geometry
            robot.client = ros_client
        # robot.to_world_coordinates(Frame([0,0,0], [1,0,0], [0,1,0]))
        robot.transformation_RCF_WCF()
        return robot
# ---------- end compas_fab_ros_robot ----------
panel = Panel(compas_fab_ros_connect.is_connected)

# ----
# Robot Base
number_slider_3 = Slider(0.561, range=-1000..1000)
pt_2 = ConstructPoint(
    XCoordinate=Slider(0.56, range=-1000..1000),
    YCoordinate=Slider(0.334, range=-1000..1000),
    ZCoordinate=Slider(-0.01, range=-1000..1000))
pt_3 = ConstructPoint(
    XCoordinate=number_slider_3,
    YCoordinate=Slider(-0.336, range=-1000..1000),
    ZCoordinate=Slider(-0.012, range=-1000..1000))
pt_4 = ConstructPoint(
    XCoordinate=Slider(-0.11, range=-1000..1000),
    YCoordinate=Slider(0.336, range=-1000..1000),
    ZCoordinate=Slider(-0.011, range=-1000..1000))
rectangle_3pt = Rectangle3Pt(PointA=pt_2, PointB=pt_3, PointC=pt_4)  # -> Rectangle, Length
box_rectangle = BoxRectangle(Rectangle=rectangle_3pt.Rectangle, Height=Slider(1, range=-100..1))
custom_preview = CustomPreview(Geometry=box_rectangle, Material=ColourSwatch(SwatchColor=RGB(201, 95, 95)))

panel_2 = Panel(compas_fab_ros_robot)
mesh = Mesh(<mesh referenced from the Rhino model>)
plane = Plane(pt)

# ---- group: TCP
mesh_2 = Mesh(mesh)

# ----
mesh_3 = Mesh(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)
rotate = Rotate(Geometry=plane, Angle=degrees("90"), Plane=PlaneXY(0, 0, 0))  # -> Geometry, Transform
compas_fab_attached_tool = COMPASFABAttachedTool(robot=compas_fab_ros_robot, visual_mesh=mesh_2, collision_mesh=mesh_2, tcf_plane=rotate.Geometry)  # -> robot; inputs visual_mesh: Mesh, collision_mesh: Mesh
#   port visual_mesh: A visual mesh for the tool.
#   port collision_mesh: A collision mesh for the tool.
#   port tcf_plane: The frame of the tool in tool0 frame.
#   port group: The planning group to which the tool should be attached.
#   port connected_to: The link to which the tool should be connected to.
# ---------- compas_fab_attached_tool: Python ----------
# r: compas_fab>=1.0.2
"""
Attach a tool to the robot.

COMPAS FAB v1.0.2
"""

import Grasshopper
import Rhino
from compas.geometry import Frame
from compas_rhino.conversions import mesh_to_compas
from compas_rhino.conversions import plane_to_compas_frame

from compas_fab.robots import Tool



class AttachToolComponent(Grasshopper.Kernel.GH_ScriptInstance):
    def RunScript(self,
            robot,
            visual_mesh: Rhino.Geometry.Mesh,
            collision_mesh: Rhino.Geometry.Mesh,
            tcf_plane,
            group,
            connected_to):
        if robot and robot.client and robot.client.is_connected and visual_mesh:
            if not collision_mesh:
                collision_mesh = visual_mesh

            c_visual_mesh = mesh_to_compas(visual_mesh)
            c_collision_mesh = mesh_to_compas(collision_mesh)

            if not tcf_plane:
                frame = Frame.worldXY()
            else:
                frame = plane_to_compas_frame(tcf_plane)
            tool = Tool(c_visual_mesh, frame, c_collision_mesh, connected_to=connected_to)

            robot.attach_tool(tool, group)

        return robot
# ---------- end compas_fab_attached_tool ----------
previewrhinoplane = PreviewRhinoPlane(B=".5", pln=rotate.Geometry)
pt_5 = Point(<point referenced from the Rhino model>)
pt_6 = Point(<point referenced from the Rhino model>)
pt_7 = Point(<point referenced from the Rhino model>)
pickup_station_mesh = Mesh(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)
pickup_station_mesh_2 = Mesh(<mesh referenced from the Rhino model>)
addition = Addition(A="-90", B="90")
rotate_2 = Rotate(Geometry=plane, Angle=degrees(addition), Plane=PlaneXY(0, 0, 0))  # -> Geometry, Transform
rotate_3 = Rotate(Geometry=pickup_station_mesh, Angle=degrees("-180"), Plane=PlaneXY(0, 0, 0))  # -> Geometry, Transform

# ----
# Initial point!
number_slider_4 = Slider(-0.6, range=-1000..1000)
pt_8 = ConstructPoint(XCoordinate=number_slider_4, YCoordinate=Slider(0.2, range=-1000..1000), ZCoordinate=Slider(-0.0145, range=-1000..1000))
rotate_4 = Rotate(Geometry=pt_8, Angle=degrees("-180"), Plane=PlaneXY(0, 0, 0))  # -> Geometry, Transform
pln = Plane(rotate_4.Geometry)
deplane = DeconstructPlane(Plane=pln)  # -> Origin, XAxis, YAxis, ZAxis
pt_9 = Point(deplane.Origin)

# ----
# Pick up point!
number_slider_5 = Slider(0.522, range=-1000..1000)  # disabled
number_slider_6 = Slider(-0.277, range=-1000..1000)  # disabled
number_slider_7 = Slider(0.048, range=-1000..1000)  # disabled
number_slider_8 = Slider(0.49, range=-1000..1000)  # disabled
number_slider_9 = Slider(-0.257, range=-1000..1000)  # disabled
number_slider_10 = Slider(0.058, range=-1000..1000)  # disabled
number_slider_11 = Slider(0.524, range=-1000..1000)  # disabled
number_slider_12 = Slider(-0.27, range=-1000..1000)  # disabled
number_slider_13 = Slider(0.045, range=-1000..1000)  # disabled
pt_10 = ConstructPoint(XCoordinate=number_slider_11, YCoordinate=number_slider_12, ZCoordinate=number_slider_13)  # disabled
pt_11 = ConstructPoint(XCoordinate=number_slider_5, YCoordinate=number_slider_6, ZCoordinate=number_slider_7)  # disabled
pt_12 = ConstructPoint(XCoordinate=number_slider_8, YCoordinate=number_slider_9, ZCoordinate=number_slider_10)  # disabled
plane_3pt = Plane3Pt(PointA=pt_5, PointB=pt_6, PointC=pt_7)

compas_fab_planning_scene = COMPASFABPlanningScene(robot=compas_fab_ros_robot)  # -> scene
#   port scene: A planning scene.
# ---------- compas_fab_planning_scene: Python ----------
# r: compas_fab>=1.0.2
"""
Create a planning scene.

COMPAS FAB v1.0.2
"""

import Grasshopper
from compas_ghpython import create_id
from scriptcontext import sticky as st

from compas_fab.robots import PlanningScene


class PlanningSceneComponent(Grasshopper.Kernel.GH_ScriptInstance):
    def RunScript(self, robot):
        key = create_id(ghenv.Component, "planning_scene")  # noqa: F821
        if robot:
            st[key] = PlanningScene(robot)
        return st.get(key, None)
# ---------- end compas_fab_planning_scene ----------
index = ControlKnob(Decimals=0, Limit=False, Maximum=10, Minimum=0, Range=100, Value=0)
rotate_5 = Rotate(Geometry=plane_3pt, Angle=degrees("-180"), Plane=PlaneXY(0, 0, 0))  # -> Geometry, Transform
py3 = Python3Script(pickup_plane=rotate_5.Geometry, height=Slider(0, range=-1..1.001))  # -> out, my_plane; inputs pickup_plane: Plane
# ---------- py3: Python ----------
from compas.datastructures import Assembly, Mesh
from compas.geometry import Frame, Point, Translation, Transformation
from compas_fab.backends import RosClient
from compas_fab.robots import Tool, PlanningScene, CollisionMesh
import os, sys
import math

import traceback

import compas
from compas.data import json_load
from compas_robots import Configuration

from compas_rhino.conversions import mesh_to_compas, point_to_compas, plane_to_compas_frame, frame_to_rhino_plane
from helpers import scale_and_move_to_point, generate_default_tolerances, calculate_pick_trajectory, calculate_place_trajectories
from scriptcontext import sticky

pick_up_frame = plane_to_compas_frame(pickup_plane)
pick_up_frame.translate(pick_up_frame.zaxis * height)
my_plane = frame_to_rhino_plane(pick_up_frame)
# ---------- end py3 ----------

# ----
# Pick up point (Visualization)
number_slider_14 = Slider(0.02, range=-100..1)
rectangle_3pt_2 = Rectangle3Pt(PointA=pt_10, PointB=pt_11, PointC=pt_12)  # -> Rectangle, Length
rotate_6 = Rotate(Geometry=rectangle_3pt_2.Rectangle, Angle=degrees("-180"), Plane=PlaneXY(0, 0, 0))  # -> Geometry, Transform
box_rectangle_2 = BoxRectangle(Rectangle=rotate_6.Geometry, Height=number_slider_14)
custom_preview_2 = CustomPreview(Geometry=box_rectangle_2, Material=ColourSwatch(SwatchColor=RGB(196, 201, 48)))

# ----
# Assembly Area
# (Table)
number_slider_15 = Slider(-0.43, range=-1000..1000)
pt_13 = ConstructPoint(
    XCoordinate=Slider(-0.43, range=-1000..1000),
    YCoordinate=Slider(-0.661, range=-1000..1000),
    ZCoordinate=Slider(-0.016, range=-1000..1000))
pt_14 = ConstructPoint(
    XCoordinate=number_slider_15,
    YCoordinate=Slider(0.492, range=-1000..1000),
    ZCoordinate=Slider(-0.014, range=-1000..1000))
pt_15 = ConstructPoint(
    XCoordinate=Slider(-0.893, range=-1000..1000),
    YCoordinate=Slider(0.492, range=-1000..1000),
    ZCoordinate=Slider(-0.014, range=-1000..1000))
rectangle_3pt_3 = Rectangle3Pt(PointA=pt_13, PointB=pt_14, PointC=pt_15)  # -> Rectangle, Length

rotate_7 = Rotate(Geometry=rectangle_3pt_3.Rectangle, Angle=degrees("-180"), Plane=PlaneXY(0, 0, 0))  # -> Geometry, Transform

box_rectangle_3 = BoxRectangle(Rectangle=rotate_7.Geometry, Height=Slider(-0.05, range=-100..1))
custom_preview_3 = CustomPreview(Geometry=box_rectangle_3, Material=ColourSwatch(SwatchColor=RGB(207, 172, 91)))

mesh_4 = MeshBrep(
    Brep=box_rectangle_3,
    Settings={GridMaxCount=0, GridMinCount=16, JaggedSeams=False, MaxEdgeLength=0, MinEdgeLength=0.0001, MinTolerance=0, Refine=True, RefineAngle=0, RelativeTolerance=0.65, SimplePlanes=True, Tolerance=0})

# ----
# ENV!
table_mesh = Mesh(mesh_4)
merge = Merge(Data1=table_mesh)  # -> flatten(Result)
mjoin = MeshJoin(Meshes=merge)

python_3_script = Python3Script(
    scene=compas_fab_planning_scene,
    robot=compas_fab_attached_tool,
    load=Button(),
    compute=Button(),
    index=index,
    env=mjoin,
    reset=Button(),
    initial_point=pt_9,
    pick_up_plane=plane_3pt)  # -> out, all_sticks, sticks, results, results_list, pick_traj, place_traj, exit_traj, joined_trajectory, pick_frame; inputs index: Int32, env: Mesh, initial_point: Point3d, pick_up_plane: Plane
# ---------- python_3_script: Python ----------
from compas.datastructures import Assembly, Mesh
from compas.geometry import Frame, Point, Translation, Transformation
from compas_fab.backends import RosClient
from compas_fab.robots import Tool, PlanningScene, CollisionMesh
import os, sys
import math

import traceback

import compas
from compas.data import json_load
from compas_robots import Configuration

compas.PRECISION = "12f"

# Constants
APPROACH_DISTANCE = 0.015  # Meters
group = None
start_configuration = None

# Specify the path to the assembly file and the path to the output file
path = ghenv.Component.OnPingDocument().FilePath
parentdir = os.path.dirname(path)
dire = os.path.join(parentdir, "group_one_scripts_send_to_robot")
sys.path.append(dire)

json_path = os.path.join(parentdir, "data", "stick_assembly_test1.json")
write_path = os.path.join(parentdir, "data", "stick_assembly_with_trajectories.json")

# Import helpers
from compas_rhino import unload_modules
unload_modules("helpers")


from compas_rhino.conversions import mesh_to_compas, point_to_compas, plane_to_compas_frame
from helpers import scale_and_move_to_point, generate_default_tolerances, calculate_pick_trajectory, calculate_place_trajectories
from scriptcontext import sticky

if "last_status" not in sticky or sticky["last_status"] is None:
    sticky["last_status"] = "Idle"

if "geometry" not in sticky or sticky["geometry"] is None:
    pass


initial_point = point_to_compas(initial_point)
pick_up_frame = plane_to_compas_frame(pick_up_plane)

pich_frame = Frame([0.5,0.5,0.1], [0,1,0], [1,0,0])


# SAFE_CONFIG = Configuration.from_revolute_values([math.radians(68.80), 
#                                         math.radians(-70.55), 
#                                         math.radians(-116.42), 
#                                         math.radians(-83.80), 
#                                         math.radians(98.73), 
#                                         math.radians(56.93)])

SAFE_CONFIG = Configuration.from_revolute_values([math.radians(287.53), 
                                        math.radians(-74.71), 
                                        math.radians(-98.02), 
                                        math.radians(-95.67), 
                                        math.radians(90.00), 
                                        math.radians(63.29)])

# SAFE_CONFIG = Configuration.from_revolute_values([math.radians(0.00), 
#                                         math.radians(-90.00), 
#                                         math.radians(0.00), 
#                                         math.radians(-90.00), 
#                                         math.radians(0.00), 
#                                         math.radians(0.00)])

if 'load' in globals() and load:
    scene.reset()
    tcm = CollisionMesh(mesh_to_compas(env), id = "table and pickup station")
    scene.add_collision_mesh(tcm)
    assembly = json_load(json_path)
    scaled_assembly = scale_and_move_to_point(assembly, initial_point)
    sticky["assembly"] = scaled_assembly
    sticky["last_status"] = "Assembly loaded"
else:
    assembly = sticky.get("assembly", [])
    if assembly:
        part = assembly.find_by_key(index)
        all_sticks = [p.attributes.get("shape", None) for p in assembly.parts()]
        sticky["geometry"] = part.attributes.get("shape", None)



if 'compute' in globals() and compute and 'index' in globals():
    results = sticky.get("results", {})
    try:
        part = assembly.find_by_key(index)
        safe_frame = part.attributes.get("safe_frame", None)
        place_frame = part.frame
        

        tolerances = generate_default_tolerances(robot.get_configurable_joints(robot.main_group_name))

        # Set pick frame
        pick_frame = pick_up_frame

        pick_traj, pick_config, approach_config = calculate_pick_trajectory(pick_frame, robot, start_config = SAFE_CONFIG)

        # Calculate place trajectories (safe, place, return)
        place_results = None

        place_results, exit_trajectory = calculate_place_trajectories(
            robot,
            current_config = SAFE_CONFIG,
            placement_frame = place_frame,
            group=robot.main_group_name
        )

        results[str(index)] = {
            "pick_frame": pick_frame,
            "frame": place_frame,
            "pick_trajectory": pick_traj,
            "approach_config": pick_config,
            "place_trajectory": place_results,
            "exit_trajectory": exit_trajectory
        }
        sticky["results"] = results
        print(f"Computed trajectory for frame {index}")

        cm = CollisionMesh(Mesh.from_shape(part.attributes["shape"]), id = "part%d" % index)
        scene.append_collision_mesh(cm)
        sticky["last_status"] = f"Computed: {index}"

    except Exception as e:
        print("Failed for frame {}: {}".format(index, e))
        print(traceback.format_exc())
        sticky["last_status"] = "Error: {}".format(str(e))

results = sticky.get("results", None)
results_list = [results]
if results is not None and str(index) in results.keys():
    sticky["last_status"] = f"{index:.0f} is computed"
    pick_traj = results[str(index)]["pick_trajectory"]
    place_traj = results[str(index)]["place_trajectory"]
    exit_traj = results[str(index)]["exit_trajectory"]
    joined_trajectory = pick_traj.copy()
    joined_trajectory.points.extend(place_traj.points)
    joined_trajectory.points.extend(exit_traj.points)


assembly = sticky.get("assembly", None)


ghenv.Component.Message = sticky["last_status"][:35]
print(sticky["last_status"])
sticks = sticky.get("geometry", None)

if reset:
    sticky["assembly"] = None
    sticky["geometry"] = None
    sticky["results"] = {}
# ---------- end python_3_script ----------
compas_draw = COMPASDraw(cg=python_3_script.sticks)  # -> rg
#   port cg: The COMPAS geometry or datastructure to be drawn.
#   port rg: The Rhino geometry object.
# ---------- compas_draw: Python ----------
# r: compas>=2.14.1
"""
Draws COMPAS geometry in Grasshopper.
"""

from typing import Any

import Grasshopper

from compas.scene import SceneObject


class CompasToRhinoGeometry(Grasshopper.Kernel.GH_ScriptInstance):
    def RunScript(self, cg):
        if not cg:
            return None

        return SceneObject(item=cg).draw()
# ---------- end compas_draw ----------
compas_draw_2 = COMPASDraw(cg=python_3_script.all_sticks)  # -> rg; same code as compas_draw
panel_3 = Panel(python_3_script.out)
compas_fab_trajectory_visualize = COMPASFABTrajectoryVisualize(robot=compas_fab_attached_tool, trajectory=python_3_script.joined_trajectory)  # -> start_configuration, configurations, fraction, time, planes, P, V, A; inputs group: String
#   port group: The planning group for which this trajectory was planned.
#   port trajectory: The calculated trajectory.
#   port start_configuration: The start configuration of the trajectory.
#   port configurations: The full configurations along the trajectory.
#   port fraction: Indicates the fraction of requested trajectory that was calculated, e.g. 1 means the full trajectory was found.
#   port time: The time which is needed to execute that trajectory at full speed.
#   port planes: The planes of the robot's end-effector.
#   port P: The positions along the trajectory
#   port V: The velocities along the trajectory
#   port A: The accelerations along the trajectory
# ---------- compas_fab_trajectory_visualize: Python ----------
# r: compas_fab>=1.0.2
"""
Visualizes a trajectory.

COMPAS FAB v1.0.2
"""

import Grasshopper
from compas_ghpython.drawing import draw_frame
from compas_ghpython.sets import list_to_ghtree


class TrajectoryVisualize(Grasshopper.Kernel.GH_ScriptInstance):
    def RunScript(self, robot, group: str, trajectory):
        start_configuration = None
        configurations = []
        fraction = 0.0
        time = 0.0

        planes = []
        positions = []
        velocities = []
        accelerations = []

        if robot and trajectory:
            group = group or robot.main_group_name

            for c in trajectory.points:
                configurations.append(
                    robot.merge_group_with_full_configuration(c, trajectory.start_configuration, group)
                )
                frame = robot.forward_kinematics(c, group, options=dict(solver="model"))
                planes.append(draw_frame(frame))
                positions.append(c.positions)
                velocities.append(c.velocities)
                accelerations.append(c.accelerations)

            start_configuration = trajectory.start_configuration
            fraction = trajectory.fraction
            time = trajectory.time_from_start

        P = list_to_ghtree(list(zip(*positions)))
        V = list_to_ghtree(list(zip(*velocities)))
        A = list_to_ghtree(list(zip(*accelerations)))

        # return outputs if you have them; here I try it for you:
        return (start_configuration, configurations, fraction, time, planes, P, V, A)
# ---------- end compas_fab_trajectory_visualize ----------
compas_draw_3 = COMPASDraw(cg=python_3_script.pick_frame)  # -> rg; same code as compas_draw
preview = CustomPreview(
    Geometry=compas_draw,
    Material={diffuse=RGB(221, 160, 221), emission=RGB(66, 48, 66), shine=0.5, specular=RGB(255, 255, 255), transparency=0})
previewcompasframe = PreviewCompasFrame(B=".25", L=compas_draw_3)
list_item = ListItem(List=compas_fab_trajectory_visualize.configurations, Index=Slider(8, range=0..100), Wrap=invert(True))
pln_2 = Plane(compas_fab_trajectory_visualize.planes)
pline = PolyLine(Vertices=pln_2, Closed=False)
points = PointList(Points=pln_2, Size=".02")
compas_fab_robot_visualize = COMPASFABRobotVisualize(
    robot=compas_fab_attached_tool,
    configuration=list_item,
    show_visual=Toggle(True),
    show_collision=Toggle(False),
    show_frames=Toggle(False),
    show_base_frame=Toggle(True),
    show_end_effector_frame=Toggle(True))  # -> visual, collision, collision_meshes, attached_meshes, frames, base_frame, ee_frame; inputs group: String, show_visual: Boolean, show_collision: Boolean, show_frames: Boolean, show_base_frame: Boolean, show_end_effector_frame: Boolean, show_cm: Boolean, show_acm: Boolean
#   port group: The planning group used for end-effector and base visualization.
#   port configuration: The robot's full configuration.
#   port show_visual: Whether or not to show the robot's visual meshes.
#   port show_collision: Whether or not to show the robot's collision meshes.
#   port show_frames: Whether or not to show the robot's joint frames.
#   port show_base_frame: Whether or not to show the robot's base frame.
#   port show_end_effector_frame: Whether or not to show the robot's end-effector frame.
#   port show_cm: Whether or not to show the collision meshes (if any).
#   port show_acm: Whether or not to show the attached collision meshes (if any).
#   port visual: Rhino meshes of the robot's visual geometry (if any).
#   port collision: Rhino meshes of the robot's collision geometry (if any).
#   port collision_meshes: Rhino meshes of the scene's collision meshes (if any).
#   port attached_meshes: Rhino meshes of the scene's attached collision meshes (if any).
#   port frames: The robot's joint frames as Rhino planes (if any).
#   port base_frame: The robot's base frame as a Rhino plane (if any).
#   port ee_frame: The robot's end-effector frame as a Rhino plane (if any).
# ---------- compas_fab_robot_visualize: Python ----------
# r: compas_fab>=1.0.2
"""
Visualizes the robot.

COMPAS FAB v1.0.2
"""

import time

import Grasshopper
from compas_ghpython import create_id
from compas_rhino.conversions import frame_to_rhino_plane
from scriptcontext import sticky as st

from compas.geometry import Frame
from compas.geometry import Transformation
from compas.scene import SceneObject
from compas_fab.backends import BackendFeatureNotSupportedError
from compas_fab.robots import PlanningScene


class RobotVisualize(Grasshopper.Kernel.GH_ScriptInstance):
    def RunScript(self,
            robot,
            group: str,
            configuration,
            show_visual: bool,
            show_collision: bool,
            show_frames: bool,
            show_base_frame: bool,
            show_end_effector_frame: bool,
            show_cm: bool,
            show_acm: bool):
        visual = None
        collision = None
        collision_meshes = None
        attached_meshes = None
        frames = None
        base_frame = None
        ee_frame = None

        if robot:
            show_visual = True if show_visual is None else show_visual
            show_cm = True if show_cm is None else show_cm
            show_acm = True if show_acm is None else show_acm
            configuration = configuration or robot.zero_configuration()

            robot.update(configuration, visual=show_visual, collision=show_collision)
            compas_frames = robot.transformed_frames(configuration, group)

            if show_visual:
                visual = robot.scene_object.draw_visual()

            if show_collision:
                collision = robot.scene_object.draw_collision()

            if show_base_frame:
                base_compas_frame = compas_frames[0]
                base_frame = frame_to_rhino_plane(base_compas_frame)

            if show_end_effector_frame:
                options = dict(solver="model")
                if robot.attached_tool:
                    options["link"] = robot.attached_tool.connected_to

                ee_compas_frame = robot.forward_kinematics(configuration, group, options=options)
                ee_frame = frame_to_rhino_plane(ee_compas_frame)

            if show_frames:
                frames = []
                for compas_frame in compas_frames[1:]:
                    frame = frame_to_rhino_plane(compas_frame)
                    frames.append(frame)

            cached_scene_key = create_id(ghenv.Component, "cached_scene")  # noqa: F821

            if show_cm or show_acm:
                cached_scene = st.get(cached_scene_key)
                if not cached_scene:
                    cached_scene = {"time": 0}

                # expire cache if the component has not been executed in the last 2 seconds
                # this allows to slide through a list of configurations
                # without triggering refreshes of the scene in the middle of it
                if time.time() - cached_scene["time"] > 2:
                    update_scene = True
                else:
                    update_scene = False

                if update_scene:
                    scene = PlanningScene(robot)
                    try:
                        scene = robot.client.get_planning_scene()
                    except BackendFeatureNotSupportedError:
                        print(
                            "The selected backend does not support collision meshes. If you need collision mesh support, use a different backend."
                        )
                        scene = None
                        show_cm = False
                        show_acm = False

                if update_scene and show_cm:
                    collision_meshes = []

                    for co in scene.world.collision_objects:
                        header = co.header
                        frame_id = header.frame_id
                        cms = co.to_collision_meshes()

                        for cm in cms:
                            if cm.frame != Frame.worldXY():
                                t = Transformation.from_frame(cm.frame)
                                mesh = cm.mesh.transformed(t)
                            else:
                                mesh = cm.mesh

                            collision_meshes.extend(SceneObject(item=mesh).draw())

                        cached_scene["cm"] = collision_meshes

                collision_meshes = cached_scene.get("cm", [])

                if update_scene and show_acm:
                    attached_meshes = []

                    for aco in scene.robot_state.attached_collision_objects:
                        for acm in aco.to_attached_collision_meshes():
                            frame_id = aco.object["header"]["frame_id"]
                            frame = robot.forward_kinematics(configuration, options=dict(link=frame_id))
                            t = Transformation.from_frame(frame)

                            # Local CM frame
                            if acm.collision_mesh.frame and acm.collision_mesh.frame != Frame.worldXY():
                                t = t * Transformation.from_frame(acm.collision_mesh.frame)

                            mesh = acm.collision_mesh.mesh.transformed(t)

                            attached_meshes.extend(SceneObject(item=mesh).draw())

                    cached_scene["acm"] = attached_meshes

                attached_meshes = cached_scene.get("acm", [])

                cached_scene["time"] = time.time()
                st[cached_scene_key] = cached_scene

        return (
            visual,
            collision,
            collision_meshes,
            attached_meshes,
            frames,
            base_frame,
            ee_frame,
        )
# ---------- end compas_fab_robot_visualize ----------
pln_3 = Plane(compas_fab_robot_visualize.base_frame)

# ----
# Note 1: fix orientation of the griper
# Note 2: fix place.. add go up and close griper
python_3_script_2 = Python3Script(index=index, tcp=plane, results=python_3_script.results_list)  # -> out, script; inputs index: Int32, tcp: Plane, results: list
# ---------- python_3_script_2: Python ----------
from imp import reload
import sys
import os

# get current file path
path = ghenv.Component.OnPingDocument().FilePath
parentdir = os.path.dirname(path)
dire = os.path.join(parentdir, 'group_one_scripts_send_to_robot')

sys.path.append(dire)

import simple_ur_script as ur
reload(ur)

import utils
reload(utils)

import simple_comm as com
reload(com)

import compas.geometry as cg
import math as m

from compas_rhino.conversions import plane_to_compas_frame

# ---------- GLOBALS ----------
IO_OPEN = 4     # open gripper
IO_CLOSE = 4    # close gripper
PAUSE = 5 # pause of the 
# -----------------------------


# ============================================================
# Trajectory → URScript
# ============================================================

def send_joint_trajectory(script, trajectory):
    """Append URScript moveJ motions for all trajectory points."""
    for point in trajectory.points[:-1]:
        q = point.positions
        script += ur.move_j(list(q), accel=0.25, vel=0.5, radius = 0.05)
    return script


def send_cartesian_frame(script, frame, speed=0.05):
    """Append URScript moveL to a Cartesian Frame."""
    frm = frame.copy()
    script += ur.move_l(frm, accel=0.1, vel=speed)
    return script


# ============================================================
# PICKUP
# ============================================================

def pickup_stick(script, pick_traj, pick_fr):
    """
    1. Follow approach & pick trajectory
    2. Move to pick frame
    3. Close gripper
    """
    script += ur.set_digital_out(IO_CLOSE, True)  # open
    script = send_joint_trajectory(script, pick_traj)
    script = send_cartesian_frame(script, pick_fr, speed=0.05)
    script += ur.sleep(PAUSE)
    script += ur.set_digital_out(IO_CLOSE, False)  # close
    script += ur.textmsg("picked")
    return script


# ============================================================
# PLACE
# ============================================================

def place_stick(script, place_traj, place_fr):
    """
    1. Follow place trajectory
    2. Move to place frame
    3. Open gripper
    """
    place = place_fr.copy()
    place.point.x = -place_fr.point.x
    place.point.y = -place_fr.point.y
    script = send_joint_trajectory(script, place_traj)
    script = send_cartesian_frame(script, place, speed=0.05)
    # Popup to check if glue is set
    script += ur.popup("is it done yet?", "hello")
    script += ur.set_digital_out(IO_CLOSE, True)  # open
    script += ur.sleep(PAUSE)
    script += ur.set_digital_out(IO_CLOSE, False)  # close
    script += ur.textmsg("placed")
    return script


# ============================================================
# MAIN PIPELINE
# ============================================================

results = results[0]

pick_frame = results[str(index)]["pick_frame"]
place_frame = results[str(index)]["frame"]
pick_trajectory = results[str(index)]["pick_trajectory"]
place_trajectory = results[str(index)]["place_trajectory"]
exit_trajectory = results[str(index)]["exit_trajectory"]

script = ""

# Set TCP
script = ur.set_tcp_by_frame(plane_to_compas_frame(tcp))
# Pickup
script = pickup_stick(script, pick_trajectory, pick_frame)
# Place
script = place_stick(script, place_trajectory, place_frame)

# Exit
script = send_joint_trajectory(script, exit_trajectory)


# finalize
script = com.concatenate_script(script)
# ---------- end python_3_script_2 ----------
panel_4 = Panel(python_3_script_2.script)
py3_2 = Python3Script(script=python_3_script_2.script, ip_address="192.168.56.101", send=Button())  # -> out, a; inputs script: String, ip_address: String, send: Boolean
# ---------- py3_2: Python ----------
import simple_comm as com

if send:
    com.send_script(script,ip_address)
# ---------- end py3_2 ----------

previewrhinoplane_2 = PreviewRhinoPlane(B="25", pln=pln_3)

# ==== cluster PreviewCompasFrame
B = ClusterInput()
L = ClusterInput()
item = ListItem(List=L, Index=0, Wrap=True)  # -> Item1, Item, Item1_2, Item2
len = Length(Curve=item.Item1_2)
multiplication = Multiplication(A=len, B=B)
amp = Amplitude(Vector=item.Item1, Amplitude=multiplication)
amp_2 = Amplitude(Vector=item.Item1_2, Amplitude=multiplication)
amp_3 = Amplitude(Vector=item.Item2, Amplitude=multiplication)
vdisex = VectorDisplayEx(Point=item.Item, Vector=amp_2, Colour=ColourSwatch(SwatchColor=RGB(255, 0, 0)), Width="3")
vdisex_2 = VectorDisplayEx(Point=item.Item, Vector=amp_3, Colour=ColourSwatch(SwatchColor=RGB(0, 255, 60)), Width="3")
vdisex_3 = VectorDisplayEx(Point=item.Item, Vector=amp, Colour=ColourSwatch(SwatchColor=RGB(0, 85, 255)), Width="3")

# ==== cluster PreviewRhinoPlane
B = ClusterInput()
pln = ClusterInput()
pln_2 = Plane(pln)
deplane = DeconstructPlane(Plane=pln_2)  # -> Origin, XAxis, YAxis, ZAxis
multiplication = Multiplication(A="1", B=B)
amp = Amplitude(Vector=deplane.ZAxis, Amplitude=multiplication)
amp_2 = Amplitude(Vector=deplane.XAxis, Amplitude=multiplication)
amp_3 = Amplitude(Vector=deplane.YAxis, Amplitude=multiplication)
vdisex = VectorDisplayEx(Point=deplane.Origin, Vector=amp_2, Colour=ColourSwatch(SwatchColor=RGB(255, 0, 0)), Width="3")
vdisex_2 = VectorDisplayEx(Point=deplane.Origin, Vector=amp_3, Colour=ColourSwatch(SwatchColor=RGB(0, 255, 60)), Width="3")
vdisex_3 = VectorDisplayEx(Point=deplane.Origin, Vector=amp, Colour=ColourSwatch(SwatchColor=RGB(0, 85, 255)), Width="3")
