# Grasshopper definition 25 12 01 (ruth).gh (Grasshopper 1.0.8)

# ----
# visualize the triangle grid module
number_slider = Slider(2, range=0..10)  # disabled
number_slider_2 = Slider(2, range=0..10)  # disabled
number_slider_3 = Slider(1, range=0..10)  # disabled
number_slider_4 = Slider(0, range=0..50)  # disabled
py3 = Python3Script(x_range=number_slider_2, y_range=number_slider, z_range=number_slider_3, offset=number_slider_4)  # -> out, points, assembly, sticks; inputs x_range: Int32, y_range: Int32, z_range: Int32, offset: Int32; disabled
# ---------- py3: Python ----------
#locate stick class file in the same folder
from compas_rhino import unload_modules
import sys
import os

#get current file path
path = ghenv.Component.OnPingDocument().FilePath
#get parent directory of the parent directory
parentdir = os.path.dirname(path)
#get src folder which contains classes
dire = os.path.join(parentdir,'scripts')

sys.path.append(dire)


unload_modules('Sticks')
unload_modules('ruth_stickmodule_25_12_01_r1')



#########     TRIANGLE GRID   #########

import Sticks
from Sticks import Stick, stick_bridge
from stick_module_learning import OStickModule
from compas.geometry import Line, Point, Vector
from compas_rhino.conversions import line_to_compas

stick_width = 13.0
stick_depth = 13.0
stick_length = 200

points = []
assembly = []

for x in range(x_range):
    for y in range(y_range):
        for z in range(z_range):
            grid_size = (stick_length - 2*stick_depth) - offset 

            # triangle-grid spacing
            dx = grid_size
            dy = grid_size * 0.866  # ≈ sqrt(3)/2

            # shift every second row (y) by half a cell in x
            x_pos = x * dx + (y % 2) * 0.5 * dx
            y_pos = y * dy
            z_pos = z * (grid_size + 2*stick_depth)

            pt = Point(x_pos, y_pos, z_pos)
            points.append(pt)
            
            ##    PATTERN (0,1,0,1,0,1...)   ##
        
            type_a = x%2 if x < x_range-1 else 2
            type_b = y%2 if y < y_range-1 else 2
            type_c = y%2 if y < y_range-1 else 2 
            type_d = 0 if z < z_range - 1 else 2

            if x == 0 and y % 2 == 0:
                type_c = 2

            if x == x_range - 1 and y % 2 == 1:
                type_b = 2

            type = {"a": type_a, "b": type_b, "c": type_c, "d": type_d}


            stick_module_learning = OStickModule(pt, stick_length, stick_width, stick_depth)
            stick_module_learning.create_triangular_module(type)
            
            assembly.extend(stick_module_learning.sticks)

sticks = [s.geometry for s in assembly]
# ---------- end py3 ----------
draw = COMPASDraw(cg=py3.sticks)  # -> rg; disabled
#   port cg: The COMPAS geometry or datastructure to be drawn.
#   port rg: The Rhino geometry object.
# ---------- draw: Python ----------
# r: compas>=2.14.1
"""
Draws COMPAS geometry in Grasshopper.
"""

from typing import Any

import Grasshopper

from compas.scene import SceneObject


class CompasToRhinoGeometry(Grasshopper.Kernel.GH_ScriptInstance):
    def RunScript(self, cg):
        if not cg:
            return None

        return SceneObject(item=cg).draw()
# ---------- end draw ----------
draw_2 = COMPASDraw(cg=py3.points)  # -> rg; disabled; same code as draw
panel = Panel(py3.sticks)  # disabled
colour_picker = ColourPicker(PickedColour=RGB(209, 175, 132))  # disabled
panel_2 = Panel(py3.assembly)  # disabled
custom_preview = CustomPreview(Geometry=draw, Material=colour_picker)  # disabled

# ----
# how to visualize each module
py3_2 = Python3Script()  # -> out, points, assembly, sticks
# ---------- py3_2: Python ----------
#locate stick class file in the same folder
from compas_rhino import unload_modules
import sys
import os

#get current file path
path = ghenv.Component.OnPingDocument().FilePath
#get parent directory of the parent directory
parentdir = os.path.dirname(path)
#get src folder which contains classes
dire = os.path.join(parentdir,'scripts')

sys.path.append(dire)


unload_modules('Sticks')
unload_modules('ruth_stickmodule_25_12_01_r1')

import Sticks
from Sticks import Stick, stick_bridge
from stick_module_learning import OStickModule
from compas.geometry import Line, Point, Vector
from compas_rhino.conversions import line_to_compas

stick_width = 13.0
stick_depth = 13.0
stick_length = 200

points = []
assembly = []


#########     create_module_1    #########
pt_1 = Point(0,0,200)
points.append(pt_1)

module_1 = OStickModule(pt_1, stick_length, stick_width, stick_depth)
module_1.create_module_1()


#########     create_module_2    #########
pt_2 = Point(0,500,200)
points.append(pt_2)

module_2 = OStickModule(pt_2, stick_length, stick_width, stick_depth)
module_2.create_module_2()

#########     create_module_3    #########
pt_3 = Point(0,1000,200)
points.append(pt_3)

module_3 = OStickModule(pt_3, stick_length, stick_width, stick_depth)
module_3.create_module_3()


assembly.extend(module_1.sticks)
assembly.extend(module_2.sticks)
assembly.extend(module_3.sticks)

sticks = [s.geometry for s in assembly]
# ---------- end py3_2 ----------
draw_3 = COMPASDraw(cg=py3_2.sticks)  # -> rg; same code as draw
draw_4 = COMPASDraw(cg=py3_2.points)  # -> rg; same code as draw
colour_picker_2 = ColourPicker(PickedColour=RGBA(222, 184, 135, 135))
custom_preview_2 = CustomPreview(Geometry=draw_3, Material=colour_picker_2)
