# Grasshopper definition 25 12 03 (ruth).gh (Grasshopper 1.0.8)

number_slider = Slider(4, range=0..10)  # disabled
number_slider_2 = Slider(4, range=0..10)  # disabled
number_slider_3 = Slider(4, range=0..10)  # disabled
line_0 = Curve(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)  # disabled
line_1 = Curve(<curve referenced from the Rhino model>)  # disabled
py3 = Python3Script(line_0=line_0, line_1=line_1)  # -> out, sticks; inputs line_0: Line, line_1: Line; disabled
# ---------- py3: Python ----------
#locate stick class file in the same folder
from compas_rhino import unload_modules
import sys
import os

#get current file path
path = ghenv.Component.OnPingDocument().FilePath
#get parent directory of the parent directory
parentdir = os.path.dirname(path)
#get src folder which contains classes
dire = os.path.join(parentdir,'scripts')

sys.path.append(dire)


unload_modules('Sticks')

import Sticks
from Sticks import Stick, stick_bridge
from compas.geometry import Line, Point, Vector
from compas_rhino.conversions import line_to_compas

assembly = []
line0 = line_to_compas(line_0)

#initiates a class Stick named stick0
stick0 = Stick(line0)
stick0.rotate_stick(45)
assembly.append(stick0)

line1 = line_to_compas(line_1)
stick1 = Stick(line1)
# stick1.rotate_stick(45,Vector(0,1,0), stick1.axis.start)
assembly.append(stick1)

stick2 = stick_bridge(stick0, stick1)
assembly.append(stick2)
#generates the geometry of the stick0 class : Box
sticks = [s.geometry for s in assembly]
# ---------- end py3 ----------
number_slider_4 = Slider(2, range=0..10)  # disabled
number_slider_5 = Slider(2, range=0..10)  # disabled
number_slider_6 = Slider(1, range=0..10)  # disabled
number_slider_7 = Slider(0, range=0..50)  # disabled
py3_2 = Python3Script(x_range=number_slider, y_range=number_slider_2, z_range=number_slider_3)  # -> out, points, assembly, sticks; inputs x_range: Int32, y_range: Int32, z_range: Int32; disabled
# ---------- py3_2: Python ----------
#locate stick class file in the same folder
from compas_rhino import unload_modules
import sys
import os

#get current file path
path = ghenv.Component.OnPingDocument().FilePath
#get parent directory of the parent directory
parentdir = os.path.dirname(path)
#get src folder which contains classes
dire = os.path.join(parentdir,'scripts')

sys.path.append(dire)


unload_modules('Sticks')
unload_modules('stick_module')

import Sticks
from Sticks import Stick, stick_bridge
from stick_module import OStickModule
from compas.geometry import Line, Point, Vector
from compas_rhino.conversions import line_to_compas

stick_width = 13.0
stick_depth = 13.0
stick_length = 200

points = []
assembly = []

for x in range(x_range):
    for y in range(y_range):
        for z in range(z_range):
            grid_size = stick_length - 2*stick_depth
            pt = Point(x*grid_size, y*grid_size, z*grid_size)
            points.append(pt)
            
            type_x = x%2 if x<x_range-1 else 2
            type_y = y%2 if y<y_range-1 else 2
            type_z = z%2 if z<z_range-1 else 2

            type = {"x": type_x, "y": type_y, "z": type_z}

            stick_module = OStickModule(pt, stick_length, stick_width, stick_depth)
            stick_module.create_orthogonal_module(type)
            
            assembly.extend(stick_module.sticks)

sticks = [s.geometry for s in assembly]
# ---------- end py3_2 ----------
draw = COMPASDraw(cg=py3.sticks)  # -> rg; disabled
#   port cg: The COMPAS geometry or datastructure to be drawn.
#   port rg: The Rhino geometry object.
# ---------- draw: Python ----------
# r: compas>=2.14.1
"""
Draws COMPAS geometry in Grasshopper.
"""

from typing import Any

import Grasshopper

from compas.scene import SceneObject


class CompasToRhinoGeometry(Grasshopper.Kernel.GH_ScriptInstance):
    def RunScript(self, cg):
        if not cg:
            return None

        return SceneObject(item=cg).draw()
# ---------- end draw ----------
py3_3 = Python3Script(x_range=number_slider_5, y_range=number_slider_4, z_range=number_slider_6, offset=number_slider_7)  # -> out, points, assembly, sticks; inputs x_range: Int32, y_range: Int32, z_range: Int32, offset: Int32; disabled
# ---------- py3_3: Python ----------
#########     KUBUS    #########

##    IMPORT BUTUH AMBIL PYTHON CODE DARI FOLDER YANG SAMA    ##

# #locate stick class file in the same folder
# from compas_rhino import unload_modules
# import sys
# import os

# #get current file path
# path = ghenv.Component.OnPingDocument().FilePath
# #get parent directory of the parent directory
# parentdir = os.path.dirname(path)
# #get src folder which contains classes
# dire = os.path.join(parentdir,'scripts')

# sys.path.append(dire)


# unload_modules('Sticks')
# unload_modules('stick_module')



# ##   IMPORT BUTUH PAKE LIBRARY APA   ##
# import Sticks
# from Sticks import Stick, stick_bridge
# from stick_module import OStickModule
# from compas.geometry import Line, Point, Vector
# from compas_rhino.conversions import line_to_compas

# ## UKURAN STICK NYA ##
# stick_width = 13.0
# stick_depth = 13.0
# stick_length = 200

# points = []
# assembly = []

# ##   BIKIN 3D GRID PAKAI POINTS   ##
# for x in range(x_range):
#     for y in range(y_range):
#         for z in range(z_range):
#             ##   grid_size = stick_length - 2*stick_depth >>>>>>> JADI STICK NYA NEMPEL, TAPI GAK NUMPUK   ##
#             grid_size = stick_length - 2*stick_depth
#             pt = Point(x*grid_size, y*grid_size, z*grid_size)
#             points.append(pt)
            
#             ##   BUAT PATTERN (0,1,0,1,0,1...)   ##
#             type_x = x%2 if x<x_range-1 else 2
#             type_y = y%2 if y<y_range-1 else 2
#             type_z = z%2 if z<z_range-1 else 2

#             type = {"x": type_x, "y": type_y, "z": type_z}

#             ##   SATU POINT GENERATE BEBERAPA STICKS PAKE CLASS "OSTICKMODULE"   ##
#             stick_module = OStickModule(pt, stick_length, stick_width, stick_depth)
#             stick_module.create_orthogonal_module(type)
            
#             assembly.extend(stick_module.sticks)

# ##   INI FUNCTION/CLASS SUPAYA TER VISUALISASI DI RHINO/GH   ##
# sticks = [s.geometry for s in assembly]




########     MODULE 1    #########

#    IMPORT BUTUH AMBIL PYTHON CODE DARI FOLDER YANG SAMA    ##

#locate stick class file in the same folder
from compas_rhino import unload_modules
import sys
import os

#get current file path
path = ghenv.Component.OnPingDocument().FilePath
#get parent directory of the parent directory
parentdir = os.path.dirname(path)
#get src folder which contains classes
dire = os.path.join(parentdir,'scripts')

sys.path.append(dire)


unload_modules('Sticks')
unload_modules('stick_module_learning')



##    IMPORT BUTUH AMBIL PYTHON CODE DARI FOLDER YANG SAMA    ##

#locate stick class file in the same folder
from compas_rhino import unload_modules
import sys
import os

#get current file path
path = ghenv.Component.OnPingDocument().FilePath
#get parent directory of the parent directory
parentdir = os.path.dirname(path)
#get src folder which contains classes
dire = os.path.join(parentdir,'scripts')

sys.path.append(dire)


unload_modules('Sticks')
unload_modules('stick_module_learning')



#########     SEGITIGA    #########

##   IMPORT BUTUH PAKE LIBRARY APA   ##
import Sticks
from Sticks import Stick, stick_bridge
from stick_module_learning import OStickModule
from compas.geometry import Line, Point, Vector
from compas_rhino.conversions import line_to_compas

## UKURAN STICK NYA ##
stick_width = 13.0
stick_depth = 13.0
stick_length = 200

points = []
assembly = []

##   BIKIN 3D GRID PAKAI POINTS   ##
for x in range(x_range):
    for y in range(y_range):
        for z in range(z_range):
            ##   grid_size = stick_length - 2*stick_depth >>>>>>> JADI STICK NYA NEMPEL, TAPI GAK NUMPUK   ##
            grid_size = stick_depth * 2
            pt = Point(x*grid_size, y*grid_size, z*grid_size)
            points.append(pt)

            
            #   BUAT PATTERN (0,1,0,1,0,1...)   ##
            ##  matikan titik paling pinggir supaya gak bikin segitiga gantung   ##
        
            type_a = x%2 if x < x_range-1 else 2
            type_b = y%2 if y < y_range-1 else 2 
            type_c = z%2 if y < z_range-1 else 2

            type = {"a": type_a, "b": type_b, "c": type_c}

            ##   SATU POINT GENERATE BEBERAPA STICKS PAKE CLASS "OSTICKMODULE"   ##
            stick_module_learning = OStickModule(pt, stick_length, stick_width, stick_depth)
            stick_module_learning.create_module_1(type)
            
            assembly.extend(stick_module_learning.sticks)

##   INI FUNCTION/CLASS SUPAYA TER VISUALISASI DI RHINO/GH   ##
sticks = [s.geometry for s in assembly]
# ---------- end py3_3 ----------
draw_2 = COMPASDraw(cg=py3_2.sticks)  # -> rg; disabled; same code as draw
panel = Panel(py3_2.sticks)  # disabled
draw_3 = COMPASDraw(cg=py3_2.points)  # -> rg; disabled; same code as draw
draw_4 = COMPASDraw(cg=py3_3.sticks)  # -> rg; disabled; same code as draw
draw_5 = COMPASDraw(cg=py3_3.points)  # -> rg; disabled; same code as draw
panel_2 = Panel(py3_2.assembly)  # disabled
number_slider_8 = Slider(0, range=-1000..1000)  # disabled
number_slider_9 = Slider(0, range=-1000..1000)  # disabled
number_slider_10 = Slider(0, range=-1000..1000)  # disabled
number_slider_11 = Slider(500, range=0..1000)  # disabled
number_slider_12 = Slider(12, range=0..100)  # disabled
number_slider_13 = Slider(180, range=0..360)  # disabled
number_slider_14 = Slider(12, range=0..100)  # disabled
number_slider_15 = Slider(200, range=0..1000)  # disabled
number_slider_16 = Slider(19, range=0..100)  # disabled
number_slider_17 = Slider(164, range=0..360)  # disabled
number_slider_18 = Slider(3, range=0..100)  # disabled
number_slider_19 = Slider(200, range=0..1000)  # disabled
number_slider_20 = Slider(137, range=0..360)  # disabled

# ----
# berhasil buat arch zigzag kyk bando
number_slider_21 = Slider(200, range=0..1000)  # disabled
number_slider_22 = Slider(10, range=0..10)  # disabled
number_slider_23 = Slider(12, range=0..100)  # disabled
number_slider_24 = Slider(20, range=0..100)  # disabled
xy_plane = XYPlane(Origin=Point(0, 0, 0))  # disabled
python_3_script = Python3Script(
    root=xy_plane,
    stick_length=number_slider_21,
    rib_length=number_slider_21,
    num_arch_rows=number_slider_22,
    num_segments=number_slider_24,
    rib_segments=number_slider_23)  # -> out, geometries; inputs rib_length: Int32, num_arch_rows: Int32, num_segments: Int32, rib_segments: Int32; disabled
# ---------- python_3_script: Python ----------
# r: compas>=2.14.1
# venv: sticks

import sys
import os
import math

#get current file path
path = ghenv.Component.OnPingDocument().FilePath
print (path)
#get parent directory of the parent directory
parentdir = os.path.dirname(path)
print (parentdir)
#get src folder which contains classes
dire = os.path.join(parentdir,'scripts')
print (dire)

sys.path.append(dire)

from compas_rhino import unload_modules

unload_modules("sticks")
unload_modules("stick_module_edit")





##   IMPORT TOOLS   ##
import Sticks
from Sticks import Stick 
from stick_module_edit import BranchingModule
from compas.geometry import Line, Point, Vector, Frame
import math

stick_width = 13.0
stick_depth = 13.0

from compas_rhino.conversions import plane_to_compas_frame, frame_to_rhino_plane

# Convert input to compas
root = plane_to_compas_frame(root)

##  START THE MAIN ARCH  ##
tree = BranchingModule(root, stick_length=200, width = stick_width, depth = stick_depth)

total_angle = 180
angle = total_angle / (num_segments - 1)
normal_yaxis = tree.sticks[0].frame.yaxis

##  MAKE A PATTERN  ##
angle_multipliers = []
for i in range(num_segments - 1):
    if i % 2 == 0:
        angle_multipliers.append(10.0)
    else:
        angle_multipliers.append(-7.0)

sum_multipliers = sum(angle_multipliers)
angle = total_angle / sum_multipliers

for i in range(num_segments - 1):
    face_index = 0 if (i % 2 == 0) else 2
    multiplier = angle_multipliers[i]
    target_angle = multiplier * angle

    face_frame = tree.get_face_frame(-1, face_index)
    ##   Use .dot() so the frame does not get twisty   ##
    dot = face_frame.yaxis.dot(normal_yaxis)
    if dot < 0:
        grow_angle = -target_angle
    else:
        grow_angle = target_angle
    
    tree.grow_stick(face_index=face_index, angle=grow_angle)
    print("i:", i, "| face:", face_index, "| angle:", grow_angle, " | multiplier:", multiplier)






# # Making rib
# rib_total_angle = 90
# rib_angle = rib_total_angle / (rib_segments/2)


# rib_trees = []
# for i, stick in enumerate(tree.sticks):
#     # 1. get a frame on the side face of this arch stick
#     side_face_index = 1
#     base_frame = tree.get_face_frame(i, side_face_index)

#     # 2. start a new branching module (a rib) from that frame
#     rib = BranchingModule(base_frame, stick_length=rib_length, width=stick_width, depth=stick_depth)

#     # 3. grow that rib with a little bend each time
#     for k in range(rib_segments - 1):
#         direction = 1 if (k % 2 == 0) else -1
#         grow_angle = direction * rib_angle
#         rib.grow_stick(face_index=0, angle=grow_angle)

#     rib_trees.append(rib)



# Visualize
geometries = []

# arch
geometries.extend(tree.visualize())

# # ribs
# for rib in rib_trees:
#     geometries.extend(rib.visualize())
# ---------- end python_3_script ----------
draw_6 = COMPASDraw(cg=python_3_script.geometries)  # -> rg; disabled; same code as draw

number_slider_25 = Slider(3, range=0..100)  # disabled
pt = ConstructPoint(XCoordinate=number_slider_8, YCoordinate=number_slider_10, ZCoordinate=number_slider_9)  # disabled
xy_plane_2 = XYPlane(Origin=Point(0, 0, 0))  # disabled
xy_plane_3 = XYPlane(Origin=Point(0, 0, 0))  # disabled
circle_cnr = CircleCNR(Center=pt, Normal=Vector(0, 0, 1), Radius=number_slider_11)  # disabled
python_3_script_2 = Python3Script(
    root=xy_plane_2,
    stick_length=number_slider_15,
    rib_length=number_slider_15,
    num_segments=number_slider_12,
    total_angle=number_slider_13,
    rib_segments=number_slider_14)  # -> out, geometries; inputs rib_length: Int32, num_segments: Int32, total_angle: Int32, rib_segments: Int32; disabled
# ---------- python_3_script_2: Python ----------
# r: compas>=2.14.1
# venv: sticks

import sys
import os
import math

#get current file path
path = ghenv.Component.OnPingDocument().FilePath
print (path)
#get parent directory of the parent directory
parentdir = os.path.dirname(path)
print (parentdir)
#get src folder which contains classes
dire = os.path.join(parentdir,'scripts')
print (dire)

sys.path.append(dire)

from compas_rhino import unload_modules

unload_modules("sticks")
unload_modules("stick_module_edit")

import Sticks
from Sticks import Stick 
from stick_module_edit import BranchingModule
from compas.geometry import Line, Point, Vector, Frame
import math

stick_width = 13.0
stick_depth = 13.0

from compas_rhino.conversions import plane_to_compas_frame, frame_to_rhino_plane

# Convert input to compas
root = plane_to_compas_frame(root)

# Initialize tree
tree = BranchingModule(root, stick_length=200, width = stick_width, depth = stick_depth)

angle = total_angle / (num_segments - 1)

for i in range(num_segments - 1):
    tree.grow_stick(face_index = 0, angle = angle)

# Making rib
rib_total_angle = 90
rib_angle = rib_total_angle / (rib_segments/2)


rib_trees = []
for i, stick in enumerate(tree.sticks):
    # 1. get a frame on the side face of this arch stick
    side_face_index = 1
    base_frame = tree.get_face_frame(i, side_face_index)

    # 2. start a new branching module (a rib) from that frame
    rib = BranchingModule(base_frame, stick_length=rib_length, width=stick_width, depth=stick_depth)

    # 3. grow that rib with a little bend each time
    for k in range(rib_segments - 1):
        direction = 1 if (k % 2 == 0) else -1
        grow_angle = direction * rib_angle
        rib.grow_stick(face_index=0, angle=grow_angle)

    rib_trees.append(rib)

# Grow tree
# tree.grow_stick(face_index = 0, angle = 20)
# tree.grow_stick(face_index = 1, angle = 10)
# tree.grow_stick(face_index = 2, angle = -20)
# tree.grow_stick(face_index = 3, angle = 30)
# tree.grow_stick(from_stick_index = 0, face_index = 2, angle = 40)

# Visualize
geometries = []

# arch
geometries.extend(tree.visualize())

# ribs
for rib in rib_trees:
    geometries.extend(rib.visualize())


# geometries = tree.visualize()

# frame = tree.sticks[0].frame
# ---------- end python_3_script_2 ----------
python_3_script_3 = Python3Script(
    root=xy_plane_3,
    stick_length=number_slider_19,
    rib_length=number_slider_19,
    num_segments=number_slider_16,
    total_angle=number_slider_17,
    rib_segments=number_slider_18,
    rib_total_angle=number_slider_20,
    num_strips=number_slider_25)  # -> out, geometries; inputs rib_length: Int32, num_segments: Int32, total_angle: Int32, rib_segments: Int32, rib_total_angle: Int32, num_strips: Int32; disabled
# ---------- python_3_script_3: Python ----------
# r: compas>=2.14.1
# venv: sticks

import sys
import os
import math

# --- PATH & IMPORTS ---

path = ghenv.Component.OnPingDocument().FilePath
parentdir = os.path.dirname(path)
dire = os.path.join(parentdir, 'scripts')
sys.path.append(dire)

from compas_rhino import unload_modules
unload_modules("sticks")
unload_modules("stick_module_edit")

import Sticks
from Sticks import Stick
from stick_module_edit import BranchingModule
from compas.geometry import Line, Point, Vector, Frame
from compas_rhino.conversions import plane_to_compas_frame, frame_to_rhino_plane

# --- BASIC PARAMETERS ---

stick_width  = 13.0
stick_depth  = 13.0

# GH inputs (make sliders / params in GH):
#   root_plane   : a Plane
#   num_segments : number of segments along arch
#   total_angle  : total bend of arch (deg)
#   rib_segments : segments per rib
#   rib_total_angle : bend per rib (deg)
#   num_strips   : number of arches across width
#   strip_offset : distance between arches (use slider or 2*stick_depth)
#   rib_length   : length of rib sticks

root_frame = plane_to_compas_frame(root)   # GH Plane -> Frame

angle = total_angle / (num_segments - 1)
rib_angle_base = rib_total_angle / (rib_segments - 1)

arches    = []    # list of BranchingModule
rib_trees = []    # list of BranchingModule

# ------------- BUILD MULTIPLE ARCHES ---------------

for s in range(num_strips):

    # 1. offset root frame sideways for this strip
    #    use frame.xaxis as "across width" direction
    f = root_frame.copy()
    strip_offset = 2
    f.point += f.xaxis * (s * strip_offset)

    # 2. create arch for this strip
    arch = BranchingModule(f,
                           stick_length=200,
                           width=stick_width,
                           depth=stick_depth)

    # 3. grow arch with same angle each step
    for i in range(num_segments - 1):
        arch.grow_stick(face_index=0, angle=angle)

    arches.append(arch)

    # ------------- RIBS FOR THIS ARCH --------------

    # decide which side ribs grow from:
    # even strip -> side 1, odd strip -> side 3 (alternating left/right)
    side_face_index = 1 if (s % 2 == 0) else 3

    for i, stick in enumerate(arch.sticks):
        # OPTIONAL: thin out ribs so not every stick has one
        if i % 2 != 0:
            continue

        base_frame = arch.get_face_frame(i, side_face_index)

        rib = BranchingModule(base_frame,
                              stick_length=rib_length,
                              width=stick_width,
                              depth=stick_depth)

        # wavy rib: alternate sign of angle along rib
        for k in range(rib_segments - 1):
            direction = 1 if (k % 2 == 0) else -1
            grow_angle = direction * rib_angle_base
            rib.grow_stick(face_index=0, angle=grow_angle)

        rib_trees.append(rib)

# ------------- VISUALIZE -----------------

geometries = []

# all arches
for arch in arches:
    geometries.extend(arch.visualize())

# all ribs
for rib in rib_trees:
    geometries.extend(rib.visualize())
# ---------- end python_3_script_3 ----------
python_3_script_4 = Python3Script(circle=circle_cnr)  # -> out, arch_curve; disabled
# ---------- python_3_script_4: Python ----------
#locate stick class file in the same folder
from compas_rhino import unload_modules
import sys
import os

#get current file path
path = ghenv.Component.OnPingDocument().FilePath
#get parent directory of the parent directory
parentdir = os.path.dirname(path)
#get src folder which contains classes
dire = os.path.join(parentdir,'scripts')

sys.path.append(dire)


unload_modules('Sticks')
unload_modules('stick_module_learning')



#########     SEGITIGA    #########

##   IMPORT BUTUH PAKE LIBRARY APA   ##
import Sticks
from Sticks import Stick, stick_bridge
from stick_module_learning import OStickModule
from compas.geometry import Circle
from compas_rhino.conversions import line_to_compas
import math

start_angle = math.radians(-90)
end_angle = math.radians(90)

arch_curve = circle.to_arc_segment(start_angle, end_angle)
# ---------- end python_3_script_4 ----------
draw_7 = COMPASDraw(cg=python_3_script_2.geometries)  # -> rg; disabled; same code as draw
draw_8 = COMPASDraw(cg=python_3_script_3.geometries)  # -> rg; disabled; same code as draw
draw_9 = COMPASDraw(cg=python_3_script_4.arch_curve)  # -> rg; disabled; same code as draw
number_slider_26 = Slider(10, range=0..10)  # disabled

number_slider_27 = Slider(2, range=0..10)  # disabled
number_slider_28 = Slider(2, range=0..10)  # disabled
number_slider_29 = Slider(1, range=0..10)  # disabled
number_slider_30 = Slider(0, range=0..50)  # disabled
py3_4 = Python3Script(
    x_range=number_slider_28,
    y_range=number_slider_27,
    z_range=number_slider_29,
    offset=number_slider_30,
    num_segments=number_slider_26)  # -> out, points, connection_pts, geometry; inputs x_range: Int32, y_range: Int32, z_range: Int32, offset: Int32, num_segments: Int32; disabled
# ---------- py3_4: Python ----------
##    IMPORT BUTUH AMBIL PYTHON CODE DARI FOLDER YANG SAMA    ##

#locate stick class file in the same folder
from compas_rhino import unload_modules
import sys
import os

#get current file path
path = ghenv.Component.OnPingDocument().FilePath
#get parent directory of the parent directory
parentdir = os.path.dirname(path)
#get src folder which contains classes
dire = os.path.join(parentdir,'scripts')

sys.path.append(dire)


unload_modules('Sticks')
unload_modules('stick_module_learning')


##   IMPORT BUTUH PAKE LIBRARY APA   ##
import Sticks
from Sticks import Stick, stick_bridge
from stick_module_learning import OStickModule, Branching_Module_to_Module
from compas.geometry import Line, Point, Vector
from compas_rhino.conversions import line_to_compas

## UKURAN STICK NYA ##
stick_width = 13.0
stick_depth = 13.0
stick_length = 200

connect = Branching_Module_to_Module(stick_length, stick_width, stick_depth)

pt = Point(0,0,0)

root_index = connect.add_root_module(pt, mode="module_1", type_dictionary={"a":0, "b":0, "c":0})

for i in range(num_segments):
    branch1_index = connect.grow_from_connection(
        from_index=root_index,
        mode="module_1",
        type_dictionary={"a":0, "b":0, "c":0},
        parent_port=2,                    
        child_port=1,                    
        angle=-30*(i-1),
        offset=Vector(0, 0, stick_depth*2*i)  
    )

    # branch2_index = connect.grow_from_connection(
    #     from_index=branch1_index,
    #     mode="module_3",
    #     type_dictionary={"a":0, "b":0, "c":0},
    #     parent_port=2,                    
    #     child_port=2,                     
    #     angle=0*(i+1),
    #     offset=Vector(0, 0, -stick_depth/2)  
    # )

# geometry for preview
geometry = connect.visualize()

# origin pt of each module (the module.pt)
points = [m.pt for m in connect.modules]

# connection points (same place for parent+child if offset = 0)
connection_pts = []
for m in connect.modules:
    if getattr(m, "connection_point", None) is not None:
        connection_pts.append(m.connection_point)
    if getattr(m, "connection_point2", None) is not None:
        connection_pts.append(m.connection_point2)
# ---------- end py3_4 ----------
draw_10 = COMPASDraw(cg=py3_4.geometry)  # -> rg; disabled; same code as draw
draw_11 = COMPASDraw(cg=py3_4.points)  # -> rg; disabled; same code as draw
colour_picker = ColourPicker(PickedColour=RGB(209, 175, 132))  # disabled
custom_preview = CustomPreview(Geometry=draw_10, Material=colour_picker)  # disabled

# ----
# how to visualize each module
py3_5 = Python3Script()  # -> out, points, frames, stick_frames, connection_points, assembly, sticks
# ---------- py3_5: Python ----------
##    IMPORT BUTUH AMBIL PYTHON CODE DARI FOLDER YANG SAMA    ##

#locate stick class file in the same folder
from compas_rhino import unload_modules
import sys
import os

#get current file path
path = ghenv.Component.OnPingDocument().FilePath
#get parent directory of the parent directory
parentdir = os.path.dirname(path)
#get src folder which contains classes
dire = os.path.join(parentdir,'group_one_scripts')

sys.path.append(dire)


unload_modules('group_one_sticks')
unload_modules('ruth_stickmodule_25_12_03_r1')



#########     SEGITIGA    #########

##   IMPORT BUTUH PAKE LIBRARY APA   ##
import group_one_sticks
from group_one_sticks import Stick, stick_bridge
from ruth_stickmodule_25_12_03_r1 import OStickModule
from compas.geometry import Line, Point, Vector, Frame
from compas_rhino.conversions import line_to_compas, frame_to_rhino_plane

## UKURAN STICK NYA ##
stick_width = 13.0
stick_depth = 13.0
stick_length = 200

points = []
frames = []
assembly = []
connection_points = []

#########     create_module_1    #########

pt_1 = Point(0, 0, 200)
points.append(pt_1)

frame_1 = Frame(pt_1, Vector(1, 0, 0), Vector(0, 1, 0))
# frames.append(frame_1)

module_1 = OStickModule(frame_1, stick_length, stick_width, stick_depth)
module_1.create_module_1()

conn_pt1 = module_1.connection_point
conn_pt1b = module_1.connection_point2

connection_points.append(conn_pt1)
connection_points.append(conn_pt1b)


# #########     create_module_2    #########
# pt_2 = Point(0,500,200)
# points.append(pt_2)

# module_2 = OStickModule(pt_2, stick_length, stick_width, stick_depth)
# module_2.create_module_2()

# conn_pt2 = module_2.connection_point
# conn_pt2b = module_2.connection_point2

# connection_points.append(conn_pt2)
# connection_points.append(conn_pt2b)


# #########     create_module_3    #########
# pt_3 = Point(0,1000,200)
# points.append(pt_3)

# module_3 = OStickModule(pt_3, stick_length, stick_width, stick_depth)
# module_3.create_module_3()

# conn_pt3 = module_3.connection_point
# conn_pt3b = module_3.connection_point2

# connection_points.append(conn_pt3)
# connection_points.append(conn_pt3b)


assembly.extend(module_1.sticks)
# assembly.extend(module_2.sticks)
# assembly.extend(module_3.sticks)

##   VISUALIZATION   ##

sticks = [s.geometry for s in assembly]

stick_frames = [s.frame for s in assembly]
frames = [frame_to_rhino_plane(f) for f in stick_frames]
# ---------- end py3_5 ----------
draw_12 = COMPASDraw(cg=py3_5.sticks)  # -> rg; same code as draw
draw_13 = COMPASDraw(cg=py3_5.points)  # -> rg; same code as draw
colour_picker_2 = ColourPicker(PickedColour=RGB(209, 175, 132))
custom_preview_2 = CustomPreview(Geometry=draw_12, Material=colour_picker_2)

# ----
# visualize the triangle grid module
number_slider_31 = Slider(2, range=0..10)  # disabled
number_slider_32 = Slider(2, range=0..10)  # disabled
number_slider_33 = Slider(1, range=0..10)  # disabled
number_slider_34 = Slider(0, range=0..50)  # disabled
py3_6 = Python3Script(x_range=number_slider_32, y_range=number_slider_31, z_range=number_slider_33, offset=number_slider_34)  # -> out, points, assembly, sticks; inputs x_range: Int32, y_range: Int32, z_range: Int32, offset: Int32; disabled
# ---------- py3_6: Python ----------
##    IMPORT BUTUH AMBIL PYTHON CODE DARI FOLDER YANG SAMA    ##

#locate stick class file in the same folder
from compas_rhino import unload_modules
import sys
import os

#get current file path
path = ghenv.Component.OnPingDocument().FilePath
#get parent directory of the parent directory
parentdir = os.path.dirname(path)
#get src folder which contains classes
dire = os.path.join(parentdir,'group_one_scripts')

sys.path.append(dire)


unload_modules('group_one_sticks')
unload_modules('ruth_stickmodule_25_12_03_r1')



#########     SEGITIGA    #########

##   IMPORT BUTUH PAKE LIBRARY APA   ##
import group_one_sticks
from group_one_sticks import Stick, stick_bridge
from ruth_stickmodule_25_12_03_r1 import OStickModule
from compas.geometry import Line, Point, Vector
from compas_rhino.conversions import line_to_compas

## UKURAN STICK NYA ##
stick_width = 13.0
stick_depth = 13.0
stick_length = 200

points = []
assembly = []

##   BIKIN 3D GRID PAKAI POINTS   ##
for x in range(x_range):
    for y in range(y_range):
        for z in range(z_range):
            ##   grid_size = stick_length - 2*stick_depth >>>>>>> JADI STICK NYA NEMPEL, TAPI GAK NUMPUK   ##
            ##   ini grid bentuk SEGITIGA   ##
            grid_size = (stick_length - 2*stick_depth) - offset 

            # triangle-grid spacing
            dx = grid_size
            dy = grid_size * 0.866  # ≈ sqrt(3)/2

            # shift every second row (y) by half a cell in x
            x_pos = x * dx + (y % 2) * 0.5 * dx
            y_pos = y * dy
            z_pos = z * (grid_size + 2*stick_depth)

            pt = Point(x_pos, y_pos, z_pos)
            points.append(pt)
            
            #   BUAT PATTERN (0,1,0,1,0,1...)   ##
            ##  matikan titik paling pinggir supaya gak bikin segitiga gantung   ##
        
            type_a = x%2 if x < x_range-1 else 2
            type_b = y%2 if y < y_range-1 else 2
            type_c = y%2 if y < y_range-1 else 2 
            type_d = 0 if z < z_range - 1 else 2

            # # MATIKAN STICK YANG KELUAR GRID
            if x == 0 and y % 2 == 0:
                # di kolom paling kiri, jangan gambar stick C (miring ke kiri)
                type_c = 2

            if x == x_range - 1 and y % 2 == 1:
                type_b = 2

            type = {"a": type_a, "b": type_b, "c": type_c, "d": type_d}


            ##   SATU POINT GENERATE BEBERAPA STICKS PAKE CLASS "OSTICKMODULE"   ##
            stick_module_learning = OStickModule(pt, stick_length, stick_width, stick_depth)
            stick_module_learning.create_triangular_module(type)
            
            assembly.extend(stick_module_learning.sticks)

##   INI FUNCTION/CLASS SUPAYA TER VISUALISASI DI RHINO/GH   ##
sticks = [s.geometry for s in assembly]




        #  type_a = x%2 if x < x_range-1 else 2
        #     # if (y_range % 2 == 1) and (y == y_range - 1) and (x == 0):
        #     #     type_a = 2

        #     type_b = y%2 if y < y_range-1 else 2
        #     # if y < y_range-1 and (y % 2 == 1) and (x == x_range - 1): # MATIKAN stick B di titik paling kanan pada row ganjil (biar nggak gantung)
        #     #     type_b = 2

        #     type_c = (x + y)%2 if y < y_range-1 and x > 0 else 2  # simple way to toggle diagonals
        #     # if y % 2 == 1:                      # row ke-2 (tengah)
        #     #     if x == 0:
        #     #         # hidupkan 1 batang miring yang hilang di sisi kiri
        #     #         # (kalau sebelumnya type_c = 2, kita paksa jadi zigzag lagi)
        #     #         type_c = (x + y) % 2    # atau langsung 0 juga boleh


        #     type = {"a": type_a, "b": type_b, "c": type_c}
# ---------- end py3_6 ----------
panel_3 = Panel(py3_6.sticks)  # disabled
draw_14 = COMPASDraw(cg=py3_6.sticks)  # -> rg; disabled; same code as draw
draw_15 = COMPASDraw(cg=py3_6.points)  # -> rg; disabled; same code as draw
colour_picker_3 = ColourPicker(PickedColour=RGB(209, 175, 132))  # disabled
custom_preview_3 = CustomPreview(Geometry=draw_14, Material=colour_picker_3)  # disabled
panel_4 = Panel(py3_6.assembly)  # disabled

number_slider_35 = Slider(2, range=0..10)  # disabled
number_slider_36 = Slider(2, range=0..10)  # disabled
number_slider_37 = Slider(1, range=0..10)  # disabled
number_slider_38 = Slider(0, range=0..50)  # disabled
py3_7 = Python3Script(x_range=number_slider_36, y_range=number_slider_35, z_range=number_slider_37, offset=number_slider_38)  # -> out, points, connection_pts, geometry; inputs x_range: Int32, y_range: Int32, z_range: Int32, offset: Int32; disabled
# ---------- py3_7: Python ----------
##    IMPORT BUTUH AMBIL PYTHON CODE DARI FOLDER YANG SAMA    ##

#locate stick class file in the same folder
from compas_rhino import unload_modules
import sys
import os

#get current file path
path = ghenv.Component.OnPingDocument().FilePath
#get parent directory of the parent directory
parentdir = os.path.dirname(path)
#get src folder which contains classes
dire = os.path.join(parentdir,'scripts')

sys.path.append(dire)


unload_modules('Sticks')
unload_modules('stick_module_learning')


##   IMPORT BUTUH PAKE LIBRARY APA   ##
import Sticks
from Sticks import Stick, stick_bridge
from stick_module_learning import OStickModule, Branching_Module_to_Module
from compas.geometry import Line, Point, Vector
from compas_rhino.conversions import line_to_compas

## UKURAN STICK NYA ##
stick_width = 13.0
stick_depth = 13.0
stick_length = 200

connect = Branching_Module_to_Module(stick_length, stick_width, stick_depth)

pt = Point(0,0,0)

root_index = connect.add_root_module(pt, mode="module_1", type_dictionary={"a":0, "b":0, "c":0})

branch1_index = connect.grow_from_connection(
    from_index=root_index,
    mode="module_2",
    type_dictionary={"a":0, "b":0, "c":0},
    parent_port=2,                    # root: cp2
    child_port=1,                     # child: cp1
    angle=270,
    offset=Vector(0, 0, stick_depth)  # optional small gap
)

branch2_index = connect.grow_from_connection(
    from_index=branch1_index,
    mode="module_3",
    type_dictionary={"a":0, "b":0, "c":0},
    parent_port=2,                    # root: cp2
    child_port=2,                     # child: cp1
    angle=0,
    offset=Vector(0, 0, -stick_depth/2)  
)

# geometry for preview
geometry = connect.visualize()

# origin pt of each module (the module.pt)
points = [m.pt for m in connect.modules]

# connection points (same place for parent+child if offset = 0)
connection_pts = []
for m in connect.modules:
    if getattr(m, "connection_point", None) is not None:
        connection_pts.append(m.connection_point)
    if getattr(m, "connection_point2", None) is not None:
        connection_pts.append(m.connection_point2)
# ---------- end py3_7 ----------
draw_16 = COMPASDraw(cg=py3_7.geometry)  # -> rg; disabled; same code as draw
draw_17 = COMPASDraw(cg=py3_7.points)  # -> rg; disabled; same code as draw
colour_picker_4 = ColourPicker(PickedColour=RGB(209, 175, 132))  # disabled
custom_preview_4 = CustomPreview(Geometry=draw_16, Material=colour_picker_4)  # disabled

draw_18 = COMPASDraw(cg=py3_5.connection_points)  # -> rg; same code as draw
draw_19 = COMPASDraw(cg=py3_5.stick_frames)  # -> rg; same code as draw
point_list = PointList(Points=py3_5.frames, Size=Slider(20, range=0..100))
draw_20 = COMPASDraw(cg=py3_4.connection_pts)  # -> rg; disabled; same code as draw
draw_21 = COMPASDraw(cg=py3_7.connection_pts)  # -> rg; disabled; same code as draw
panel_5 = Panel(py3_5.assembly)
number_slider_39 = Slider(20, range=0..100)  # disabled
point_list_2 = PointList(Points=py3_6.sticks, Size=number_slider_39)  # disabled
