# Grasshopper definition 25 12 05 (nadja).gh (Grasshopper 1.0.8)

number_slider = Slider(2, range=1..3)  # disabled
xy = XYPlane(Origin=Point(0, 0, 0))
xy_2 = XYPlane(Origin=Point(0, 0, 0))

# ---- group: Tamplate
py3 = Python3Script(plane=xy, stick_angles=Slider(17, range=0..90), sticks_distance=Slider(100, range=0..100), length=number_slider)  # -> out, my_geometry, geometry_2, frames, center_points, flatten(my_tree); inputs plane: Plane, stick_angles: Double, sticks_distance: Double, length: Double
# ---------- py3: Python ----------
# r: compas>=2.14.1
# venv: sticks

import sys
import os
import math

#get current file path
path = ghenv.Component.OnPingDocument().FilePath
print (path)
#get parent directory of the parent directory
parentdir = os.path.dirname(path)
print (parentdir)
#get src folder which contains classes
dire = os.path.join(parentdir,'group_one_scripts')
print (dire)

sys.path.append(dire)

from compas_rhino import unload_modules

unload_modules("group_one_sticks")
unload_modules("group_one_stick_module")
unload_modules("nadja_studies_25_12_01_r1")
unload_modules("nadja_bridgeing_25_12_01_r1")

import group_one_sticks
import nadja_studies_25_12_01_r1
import nadja_bridgeing_25_12_01_r1

from group_one_sticks import Stick 
from group_one_stick_module import BranchingModule
from nadja_studies_25_12_01_r1 import StickModule
from nadja_bridgeing_25_12_01_r1 import Bridge

from compas.geometry import Line, Point, Vector, Frame
from compas_rhino.conversions import line_to_compas, point_to_compas, plane_to_compas_frame
from ghpythonlib.treehelpers import list_to_tree, tree_to_list


# STEP 1: converting geometry from rhino to compass
root = plane_to_compas_frame(plane)

module = StickModule(angle_a=stick_angles, 
                    angle_b=stick_angles, 
                    sticks_distance=sticks_distance)



geometry = module.CreateModule(plane=root)

bridge = Bridge(geometry)

center_points = bridge.face_centroids
frame = bridge.get_face_frame(0, 0)


# tree_module = bridge.grow_module(module, face_index=5,angle=0)

# tree = []
# for n in range(0):
#     tree_module = bridge.grow_module(module, from_stick_index=n,face_index=5,angle=30)
#     tree.append(tree_module)

# tree = bridge.sticks
# geometry = []

# for module in tree:
#     geometry_2 = [s.geometry for s in module]
#     geometry.append(geometry_2)

# frames = [s.frame for s in module]

# my_tree = list_to_tree(tree) 
# my_geometry = list_to_tree(geometry)
# ---------- end py3 ----------

# ---- group: base stick module
py3_2 = Python3Script(plane=xy_2)  # -> out, stick, frame, axis, s; inputs plane: Plane
# ---------- py3_2: Python ----------
# r: compas>=2.14.1
# venv: sticks

import sys
import os
import math

#get current file path
path = ghenv.Component.OnPingDocument().FilePath
print (path)
#get parent directory of the parent directory
parentdir = os.path.dirname(path)
print (parentdir)
#get src folder which contains classes
dire = os.path.join(parentdir,'group_one_scripts')
print (dire)

sys.path.append(dire)

from compas_rhino import unload_modules

unload_modules("group_one_sticks")
unload_modules("group_one_stick_module")
unload_modules("nadja_studies_25_12_01_r1")
unload_modules("nadja_bridgeing_25_12_01_r1")

import group_one_sticks
import nadja_studies_25_12_01_r1
import nadja_bridgeing_25_12_01_r1

from group_one_sticks import Stick 
from group_one_stick_module import BranchingModule
from nadja_studies_25_12_01_r1 import StickModule
from nadja_bridgeing_25_12_01_r1 import Bridge

from compas.geometry import Line, Point, Vector, Frame
from compas_rhino.conversions import line_to_compas, point_to_compas, plane_to_compas_frame
from ghpythonlib.treehelpers import list_to_tree, tree_to_list

# STEP 1: converting geometry from rhino to compass
root = plane_to_compas_frame(plane)

# STEP 2: baseplain of the stick
axis_1 = Line([300,100,0], [300,200,200])
axis_2 = Line([200,200,0], [200,200,200])
s1 = Stick(axis_1)
s2 = Stick(axis_2)
s = [s1, s2]
stick = [stick.geometry for stick in s]
frame = [stick.frame for stick in s]
axis = [stick.frame.xaxis for stick in s]
# ---------- end py3_2 ----------

# ----
draw = COMPASDraw(cg=py3_2.stick)  # -> simplify(rg)
#   port cg: The COMPAS geometry or datastructure to be drawn.
#   port rg: The Rhino geometry object.
# ---------- draw: Python ----------
# r: compas>=2.14.1
"""
Draws COMPAS geometry in Grasshopper.
"""

from typing import Any

import Grasshopper

from compas.scene import SceneObject


class CompasToRhinoGeometry(Grasshopper.Kernel.GH_ScriptInstance):
    def RunScript(self, cg):
        if not cg:
            return None

        return SceneObject(item=cg).draw()
# ---------- end draw ----------
draw_2 = COMPASDraw(cg=py3_2.frame)  # -> simplify(rg); same code as draw
draw_3 = COMPASDraw(cg=py3_2.axis)  # -> simplify(rg); same code as draw
draw_4 = COMPASDraw(cg=py3.my_geometry)  # -> simplify(rg); same code as draw
swatch = ColourSwatch(SwatchColor=RGB(255, 255, 255))
py3_3 = Python3Script(sticks=py3_2.s, save=Button())  # -> out, frames, assembly, center_pt, center_vector; inputs sticks: list, save: Boolean
# ---------- py3_3: Python ----------
from compas import json_dump
import os, sys
from itertools import combinations
from compas_rhino import unload_modules
from compas.geometry import Line, Plane, Vector, Point

#get current file path
path = ghenv.Component.OnPingDocument().FilePath
#get parent directory of the parent directory
parentdir = os.path.dirname(path)
#get src folder which contains classes
dire = os.path.join(parentdir,'group_one_scripts')

sys.path.append(dire)

from group_one_sticks import Stick 

from compas.datastructures import Assembly, Part

json_path = os.path.join(parentdir, 'group_one_data', 'stick_assembly.json')

stick_width = 13.0
stick_depth = 13.0
stick_length = 200

sticks_data = []

###########################################################################
# Make frames point in best direction
###########################################################################
import math
import copy

from compas.geometry import dot_vectors, Rotation
from compas.geometry import centroid_points

def is_parallel(v1, v2):
    if math.isclose(dot_vectors(v1, v2), 1, abs_tol = 0.001) or math.isclose(dot_vectors(v1, v2), -1 ,abs_tol = 0.001):
        # Means it is parallel
        print("parallel")
        return True
    else:
        # Means it is not parallel
        print("not parallel")
        return False

def get_frame_closest_to_target(target_vector, stick): # the main idea is that they point in the same direction
    best_dot = -1000.0
    for i in range(4):
        angle = math.pi/2 * i
        R = Rotation.from_axis_and_angle(stick.frame.xaxis, angle, stick.frame.point)
        frame = stick.frame.transformed(R)
        dot = dot_vectors(frame.zaxis, target_vector.unitized())
        print(dot)
        if dot>best_dot:
            best_dot = dot
            best_frame = frame
            # print(i) # rotation angle
    return best_frame

def get_center(sticks_list):
    all_points = [stick.frame.point for stick in sticks_list]
    center = centroid_points(all_points)
    # print(center)
    return center

# Copy sticks

sticks_copy = copy.deepcopy(sticks)
center_pt = get_center(sticks_copy)


for stick in sticks_copy:
    if is_parallel(stick.axis.direction.unitized(), Vector(0,0,1)):
        # Target frame is frame pointing into center of structure
        center_vector = Vector.from_start_end(stick.frame.point, center_pt)
        best_frame = get_frame_closest_to_target(center_vector, stick=stick)
        stick.frame = best_frame

    else:
        # Make sure z axis is pointing down
        R = Rotation.from_axis_and_angle(stick.frame.xaxis, math.pi/2, stick.frame.point)
        stick.frame.transform(R)

from compas_rhino.conversions import frame_to_rhino_plane

###########################################################################
# Make frames point in best direction
###########################################################################

assembly = Assembly()
for i, s in enumerate(sticks_copy):
    part_name = "stick"+ str(i)
    part = Part(name = part_name, frame = s.frame)
    part.key = i
    part.attributes["shape"] = s.geometry
    assembly.add_part(part)
    

frames = [frame_to_rhino_plane(p.frame) for p in assembly.parts()]

if save:
    json_dump(assembly, fp=json_path, pretty=True)
# ---------- end py3_3 ----------
py3_4 = Python3Script(sticks=py3_2.s, save=Button())  # -> out, frames, assembly; inputs sticks: list, save: Boolean
# ---------- py3_4: Python ----------
from compas import json_dump
import os, sys
from itertools import combinations
from compas_rhino import unload_modules
from compas.geometry import Line, Plane, Vector, Point

#get current file path
path = ghenv.Component.OnPingDocument().FilePath
#get parent directory of the parent directory
parentdir = os.path.dirname(path)
#get src folder which contains classes
dire = os.path.join(parentdir,'group_one_scripts')

sys.path.append(dire)

from group_one_sticks import Stick 

from compas.datastructures import Assembly, Part

json_path = os.path.join(parentdir, 'group_one_data', 'stick_assembly.json')

stick_width = 13.0
stick_depth = 13.0
stick_length = 200

sticks_data = []

###########################################################################
# Make frames point in best direction
###########################################################################
import math
import copy

from compas.geometry import dot_vectors, Rotation
from compas.geometry import centroid_points

def is_parallel(v1, v2):
    if math.isclose(dot_vectors(v1, v2), 1, abs_tol = 0.001) or math.isclose(dot_vectors(v1, v2), -1 ,abs_tol = 0.001):
        # Means it is parallel
        print("parallel")
        return True
    else:
        # Means it is not parallel
        print("not parallel")
        return False

def get_frame_closest_to_target(target_vector, stick):
    best_dot = -1000.0
    for i in range(4):
        angle = math.pi/2 * i
        R = Rotation.from_axis_and_angle(stick.frame.xaxis, angle, stick.frame.point)
        frame = stick.frame.transformed(R)
        dot = dot_vectors(frame.zaxis, target_vector.unitized())
        if dot>best_dot:
            best_dot = dot
            best_frame = frame
            print(i)
    return best_frame

def get_center(sticks_list):
    all_points = [stick.frame.point for stick in sticks_list]
    center = centroid_points(all_points)
    print(center)
    return center

# Copy sticks

sticks_copy = copy.deepcopy(sticks)
center_pt = get_center(sticks_copy)


for stick in sticks_copy:
    if is_parallel(stick.axis.direction.unitized(), Vector(0,0,1)):
        # Target frame is frame pointing into center of structure
        center_vector = Vector.from_start_end(stick.frame.point, center_pt)
        best_frame = get_frame_closest_to_target(center_vector, stick=stick)
        stick.frame = best_frame

    else:
        # Make sure z axis is pointing down
        R = Rotation.from_axis_and_angle(stick.frame.xaxis, math.pi/2, stick.frame.point)
        stick.frame.transform(R)

from compas_rhino.conversions import frame_to_rhino_plane

###########################################################################
# Make frames point in best direction
###########################################################################

assembly = Assembly()
for i, s in enumerate(sticks_copy):
    part_name = "stick"+ str(i)
    part = Part(name = part_name, frame = s.frame)
    part.key = i
    part.attributes["shape"] = s.geometry
    assembly.add_part(part)
    

frames = [frame_to_rhino_plane(p.frame) for p in assembly.parts()]

if save:
    json_dump(assembly, fp=json_path, pretty=True)
# ---------- end py3_4 ----------
previewcompasframe = Cluster(B="100", L=draw_2)
material = CreateMaterial(Diffuse=ColourSwatch(SwatchColor=RGB(0, 0, 0)), Specular=swatch, Emission=swatch, Transparency=0, Shine=0)
pln = Plane(py3_3.frames)
draw_5 = COMPASDraw(cg=py3_3.center_vector)  # -> simplify(rg); same code as draw
preview = CustomPreview(Geometry=draw_4, Material=material)
draw_6 = COMPASDraw(cg=py3.frames)  # -> simplify(rg); same code as draw
draw_7 = COMPASDraw(cg=py3.my_tree)  # -> simplify(rg); same code as draw
previewrhinoplane = PreviewRhinoPlane(B="100", pln=pln)
pt = Point("{250,175,100}")
cluster = Cluster(L=draw_6)
cluster_2 = Cluster(L=draw_7)
deplane = DeconstructPlane(Plane=pln)  # -> Origin, XAxis, YAxis, ZAxis
points = PointList(Points=py3.center_points, Size=".05")
vec2pt = Vector2Pt(PointA=deplane.Origin, PointB=pt, Unitize=False)  # -> Vector, Length
vdisex = VectorDisplayEx(Point=deplane.Origin, Vector=vec2pt.Vector, Colour=RGB(0, 0, 0), Width=2)
py3_5 = Python3Script(sticks=py3.my_tree, save=Button())  # -> out, frames, assembly; inputs sticks: list, save: Boolean; same code as py3_4

# ==== cluster Cluster
B = ClusterInput()
L = ClusterInput()
item = ListItem(List=L, Index=0, Wrap=True)  # -> Item1, Item, Item1_2, Item2
len = Length(Curve=item.Item1_2)
multiplication = Multiplication(A=len, B=B)
amp = Amplitude(Vector=item.Item1, Amplitude=multiplication)
amp_2 = Amplitude(Vector=item.Item1_2, Amplitude=multiplication)
amp_3 = Amplitude(Vector=item.Item2, Amplitude=multiplication)
vdisex = VectorDisplayEx(Point=item.Item, Vector=amp_2, Colour=ColourSwatch(SwatchColor=RGB(255, 0, 0)), Width="3")
vdisex_2 = VectorDisplayEx(Point=item.Item, Vector=amp_3, Colour=ColourSwatch(SwatchColor=RGB(0, 255, 60)), Width="3")
vdisex_3 = VectorDisplayEx(Point=item.Item, Vector=amp, Colour=ColourSwatch(SwatchColor=RGB(0, 85, 255)), Width="3")

# ==== cluster PreviewRhinoPlane
B = ClusterInput()
pln = ClusterInput()
pln_2 = Plane(pln)
deplane = DeconstructPlane(Plane=pln_2)  # -> Origin, XAxis, YAxis, ZAxis
multiplication = Multiplication(A="1", B=B)
amp = Amplitude(Vector=deplane.ZAxis, Amplitude=multiplication)
amp_2 = Amplitude(Vector=deplane.XAxis, Amplitude=multiplication)
amp_3 = Amplitude(Vector=deplane.YAxis, Amplitude=multiplication)
vdisex = VectorDisplayEx(Point=deplane.Origin, Vector=amp_2, Colour=ColourSwatch(SwatchColor=RGB(255, 0, 0)), Width="3")
vdisex_2 = VectorDisplayEx(Point=deplane.Origin, Vector=amp_3, Colour=ColourSwatch(SwatchColor=RGB(0, 255, 60)), Width="3")
vdisex_3 = VectorDisplayEx(Point=deplane.Origin, Vector=amp, Colour=ColourSwatch(SwatchColor=RGB(0, 85, 255)), Width="3")
