# Grasshopper definition 25 12 07 (nadja).gh (Grasshopper 1.0.8)

number_slider = Slider(180, range=-180..180)
number_slider_2 = Slider(16, range=-180..180)
number_slider_3 = Slider(2, range=1..3)  # disabled
pln = Plane(PlaneXY(0, 0, 0))
deplane = DeconstructPlane(Plane=pln)  # -> Origin, XAxis, YAxis, ZAxis
xy = XYPlane(Origin=Point(0, 0, 0))
line = LineSDL(Start=deplane.Origin, Direction=deplane.ZAxis, Length=1)
line_2 = LineSDL(Start=deplane.Origin, Direction=deplane.YAxis, Length=1)
rotax = RotateAxis(Geometry=pln, Angle=degrees(Slider(547, range=0..1000)), Axis=line)  # -> Geometry, Transform

# ---- group: Tamplate
py3 = Python3Script(plane=xy, stick_angles=Slider(17, range=0..90), sticks_distance=Slider(100, range=0..100), length=number_slider_3)  # -> out, my_geometry, geometry_2, frames, center_points, flatten(my_tree); inputs plane: Plane, stick_angles: Double, sticks_distance: Double, length: Double
# ---------- py3: Python ----------
# r: compas>=2.14.1
# venv: sticks

import sys
import os
import math

#get current file path
path = ghenv.Component.OnPingDocument().FilePath
print (path)
#get parent directory of the parent directory
parentdir = os.path.dirname(path)
print (parentdir)
#get src folder which contains classes
dire = os.path.join(parentdir,'group_one_scripts')
print (dire)

sys.path.append(dire)

from compas_rhino import unload_modules

unload_modules("group_one_sticks")
unload_modules("group_one_stick_module")
unload_modules("nadja_studies_25_12_01_r1")
unload_modules("nadja_bridgeing_25_12_01_r1")

import group_one_sticks
import nadja_studies_25_12_01_r1
import nadja_bridgeing_25_12_01_r1

from group_one_sticks import Stick 
from group_one_stick_module import BranchingModule
from nadja_studies_25_12_01_r1 import StickModule
from nadja_bridgeing_25_12_01_r1 import Bridge

from compas.geometry import Line, Point, Vector, Frame
from compas_rhino.conversions import line_to_compas, point_to_compas, plane_to_compas_frame
from ghpythonlib.treehelpers import list_to_tree, tree_to_list


# STEP 1: converting geometry from rhino to compass
root = plane_to_compas_frame(plane)

module = StickModule(angle_a=stick_angles, 
                    angle_b=stick_angles, 
                    sticks_distance=sticks_distance)



geometry = module.CreateModule(plane=root)

bridge = Bridge(geometry)

center_points = bridge.face_centroids
frame = bridge.get_face_frame(0, 0)


# tree_module = bridge.grow_module(module, face_index=5,angle=0)

tree = []
for n in range(0):
    tree_module = bridge.grow_module(module, from_stick_index=n,face_index=5,angle=30)
    tree.append(tree_module)

tree = bridge.sticks
geometry = []

for module in tree:
    geometry_2 = [s.geometry for s in module]
    geometry.append(geometry_2)

frames = [s.frame for s in module]

my_tree = list_to_tree(tree) 
my_geometry = list_to_tree(geometry)
# ---------- end py3 ----------

# ----
rotax_2 = RotateAxis(Geometry=rotax.Geometry, Angle=degrees(Slider(10, range=0..1000)), Axis=line_2)  # -> Geometry, Transform

# ---- group: modules
py3_2 = Python3Script(plane=rotax_2.Geometry, stick_angle=Slider(-5, range=-270..270), module_number=Slider(8, range=0..100))  # -> out, my_geometry, face_frames, face_indexes, my_assembly, assemblys, my_frames, sticks; inputs plane: Plane, stick_angle: Double, module_number: Int32
# ---------- py3_2: Python ----------
# r: compas>=2.14.1
# venv: sticks

import sys
import os
import math
from random import *
import random

#get current file path
path = ghenv.Component.OnPingDocument().FilePath
print (path)
#get parent directory of the parent directory
parentdir = os.path.dirname(path)
print (parentdir)
#get src folder which contains classes
dire = os.path.join(parentdir,'group_one_scripts')
print (dire)

sys.path.append(dire)

from compas_rhino import unload_modules

unload_modules("sticks_251207")
unload_modules("nadja_module_conection")
unload_modules("nadja_stick_module")

import sticks_251207
import nadja_module_conection
import nadja_stick_module

from sticks_251207 import Stick 
from nadja_module_conection import ModuleConnection
from nadja_stick_module import StickModuleA

from compas.geometry import Line, Point, Vector, Frame
from compas_rhino.conversions import line_to_compas, point_to_compas, plane_to_compas_frame
from ghpythonlib.treehelpers import list_to_tree, tree_to_list


### MY CODE BELLOW ###

# STEP 1: converting geometry from rhino to compass
random.seed(11)
root = plane_to_compas_frame(plane)
stick_angles = [randint(0, 35) for i in range(module_number)]
stick_angles_z = [randint(0, 5) for i in range(module_number)]
stick_angles.insert(0, stick_angle)
stick_angles_z.insert(0, 0)


# STEP 2: load stick module 
module = StickModuleA(root, angle=stick_angle)
stick_module = module.create_module()
modules = [module.sticks[stick] for stick in module.sticks]

# STEP 3: connect modules on the face
conecction = ModuleConnection(stick_module, root, stick_angles, stick_angles_z)
face_frames = conecction.get_face_frame(0, 0)

# STEP 4: visualise face_index number
face_indexes = []
for i in range(4):
    face_frame = conecction.get_face_frame(0, i, stick="stick1")
    face_indexes.append((face_frame.point))

# STEP 5: grow module
assembly = []
stick = []
for i in range(module_number):
    new_modules = conecction.grow_module(i)
    gemotries = [stick.geometry for stick in new_modules]
    stick.append(new_modules)
    assembly.append(gemotries)


my_frames = conecction.module_frames


face_indexes = []
for i in range(4):
    face_frame = conecction.get_face_frame(0, i, stick="stick1")
    face_indexes.append((face_frame.point))


# STEP 3: visualise
my_geometry = list_to_tree([stick.geometry for stick in modules]) 
# my_assembly = list_to_tree([stick.geometry for stick in assembly]) 
my_assembly = list_to_tree(assembly) 
assemblys = list_to_tree(assembly) 
sticks = list_to_tree(stick)
# ---------- end py3_2 ----------

# ----
draw = COMPASDraw(cg=py3.frames)  # -> simplify(rg)
#   port cg: The COMPAS geometry or datastructure to be drawn.
#   port rg: The Rhino geometry object.
# ---------- draw: Python ----------
# r: compas>=2.14.1
"""
Draws COMPAS geometry in Grasshopper.
"""

from typing import Any

import Grasshopper

from compas.scene import SceneObject


class CompasToRhinoGeometry(Grasshopper.Kernel.GH_ScriptInstance):
    def RunScript(self, cg):
        if not cg:
            return None

        return SceneObject(item=cg).draw()
# ---------- end draw ----------
draw_2 = COMPASDraw(cg=py3.my_tree)  # -> simplify(rg); same code as draw
draw_3 = COMPASDraw(cg=py3_2.my_geometry)  # -> simplify(rg); same code as draw
draw_4 = COMPASDraw(cg=py3_2.face_frames)  # -> simplify(rg); same code as draw
draw_5 = COMPASDraw(cg=py3_2.my_assembly)  # -> simplify(rg); same code as draw
draw_6 = COMPASDraw(cg=py3_2.assemblys)  # -> simplify(rg); same code as draw
draw_7 = COMPASDraw(cg=py3.my_geometry)  # -> simplify(rg); same code as draw
draw_8 = COMPASDraw(cg=py3.frames)  # -> simplify(rg); same code as draw
draw_9 = COMPASDraw(cg=py3_2.face_indexes)  # -> simplify(rg); same code as draw
draw_10 = COMPASDraw(cg=py3_2.my_frames)  # -> simplify(rg); same code as draw
swatch = ColourSwatch(SwatchColor=RGB(255, 255, 255))

# ---- group: stick test
py3_3 = Python3Script(plane=rotax_2.Geometry, stick_angle=Slider(42, range=0..90))  # -> out, my_geometry; inputs plane: Plane, stick_angle: Double
# ---------- py3_3: Python ----------
# r: compas>=2.14.1
# venv: sticks

import sys
import os
import math

#get current file path
path = ghenv.Component.OnPingDocument().FilePath
print (path)
#get parent directory of the parent directory
parentdir = os.path.dirname(path)
print (parentdir)
#get src folder which contains classes
dire = os.path.join(parentdir,'group_one_scripts')
print (dire)

sys.path.append(dire)

from compas_rhino import unload_modules

unload_modules("sticks_251207")
unload_modules("group_one_stick_module")
unload_modules("nadja_studies_25_12_01_r1")
unload_modules("nadja_bridgeing_25_12_01_r1")
unload_modules("nadja_mainmodule_25_12_04_r1")

import sticks_251207
import nadja_studies_25_12_01_r1
import nadja_bridgeing_25_12_01_r1
import nadja_mainmodule_25_12_04_r1

from sticks_251207 import Stick 
from group_one_stick_module import BranchingModule
from nadja_studies_25_12_01_r1 import StickModule
from nadja_bridgeing_25_12_01_r1 import Bridge
from nadja_mainmodule_25_12_04_r1 import StickModuleA

from compas.geometry import Line, Point, Vector, Frame
from compas_rhino.conversions import line_to_compas, point_to_compas, plane_to_compas_frame
from ghpythonlib.treehelpers import list_to_tree, tree_to_list


### MY CODE BELLOW ###

# STEP 1: converting geometry from rhino to compass
root = plane_to_compas_frame(plane)

# STEP 2: load stick module 
module = StickModuleA()
stick_module = module.create_module(root, stick_angle)
modules = [module.sticks[stick] for stick in module.sticks]

# STEP 3: visualise
my_geometry = list_to_tree([stick.geometry for stick in modules])
# ---------- end py3_3 ----------

# ----
points = PointList(Points=py3.center_points, Size=".05")
cluster = Cluster(L=draw)
cluster_2 = Cluster(L=draw_2)
points_2 = PointList(Points=draw_9, Size=5)
previewcompasframe = PreviewCompasFrame(B="25", L=draw_10)
previewrhinoplane = PreviewRhinoPlane(B="100", pln=rotax_2.Geometry)
material = CreateMaterial(Diffuse=ColourSwatch(SwatchColor=RGB(0, 0, 0)), Specular=swatch, Emission=swatch, Transparency=0, Shine=0)
material_2 = CreateMaterial(Diffuse=RGB(255, 105, 180), Specular=RGB(255, 255, 255), Emission=RGB(0, 0, 0), Transparency=0, Shine=0)
previewcompasframe_2 = PreviewCompasFrame(B="25", L=draw_6)
previewcompasframe_3 = PreviewCompasFrame(B="25", L=draw_4)
previewcompasframe_4 = PreviewCompasFrame(B="25", L=draw_5)
preview = CustomPreview(Geometry=draw_7, Material=material)
preview_2 = CustomPreview(Geometry=draw_7, Material=material_2)
draw_11 = COMPASDraw(cg=py3_3.my_geometry)  # -> simplify(rg); same code as draw
py3_4 = Python3Script(sticks=py3.my_tree, save=Button())  # -> out, frames, assembly; inputs sticks: list, save: Boolean
# ---------- py3_4: Python ----------
from compas import json_dump
import os, sys
from itertools import combinations
from compas_rhino import unload_modules
from compas.geometry import Line, Plane, Vector, Point

#get current file path
path = ghenv.Component.OnPingDocument().FilePath
#get parent directory of the parent directory
parentdir = os.path.dirname(path)
#get src folder which contains classes
dire = os.path.join(parentdir,'group_one_scripts')

sys.path.append(dire)

from group_one_sticks import Stick 

from compas.datastructures import Assembly, Part

json_path = os.path.join(parentdir, 'group_one_data', 'stick_assembly.json')

stick_width = 13.0
stick_depth = 13.0
stick_length = 200

sticks_data = []

###########################################################################
# Make frames point in best direction
###########################################################################
import math
import copy

from compas.geometry import dot_vectors, Rotation
from compas.geometry import centroid_points

def is_parallel(v1, v2):
    if math.isclose(dot_vectors(v1, v2), 1, abs_tol = 0.001) or math.isclose(dot_vectors(v1, v2), -1 ,abs_tol = 0.001):
        # Means it is parallel
        print("parallel")
        return True
    else:
        # Means it is not parallel
        print("not parallel")
        return False

def get_frame_closest_to_target(target_vector, stick):
    best_dot = -1000.0
    for i in range(4):
        angle = math.pi/2 * i
        R = Rotation.from_axis_and_angle(stick.frame.xaxis, angle, stick.frame.point)
        frame = stick.frame.transformed(R)
        dot = dot_vectors(frame.zaxis, target_vector.unitized())
        if dot>best_dot:
            best_dot = dot
            best_frame = frame
            print(i)
    return best_frame

def get_center(sticks_list):
    all_points = [stick.frame.point for stick in sticks_list]
    center = centroid_points(all_points)
    print(center)
    return center

# Copy sticks

sticks_copy = copy.deepcopy(sticks)
center_pt = get_center(sticks_copy)


for stick in sticks_copy:
    if is_parallel(stick.axis.direction.unitized(), Vector(0,0,1)):
        # Target frame is frame pointing into center of structure
        center_vector = Vector.from_start_end(stick.frame.point, center_pt)
        best_frame = get_frame_closest_to_target(center_vector, stick=stick)
        stick.frame = best_frame

    else:
        # Make sure z axis is pointing down
        R = Rotation.from_axis_and_angle(stick.frame.xaxis, math.pi/2, stick.frame.point)
        stick.frame.transform(R)

from compas_rhino.conversions import frame_to_rhino_plane

###########################################################################
# Make frames point in best direction
###########################################################################

assembly = Assembly()
for i, s in enumerate(sticks_copy):
    part_name = "stick"+ str(i)
    part = Part(name = part_name, frame = s.frame)
    part.key = i
    part.attributes["shape"] = s.geometry
    assembly.add_part(part)
    

frames = [frame_to_rhino_plane(p.frame) for p in assembly.parts()]

if save:
    json_dump(assembly, fp=json_path, pretty=True)
# ---------- end py3_4 ----------
py3_5 = Python3Script(sticks=flatten(py3_2.sticks), save=Button())  # -> out, frames, frames_pick_up, assembly; inputs sticks: list, save: Boolean
# ---------- py3_5: Python ----------
from compas import json_dump
import os, sys
from itertools import combinations
from compas_rhino import unload_modules
from compas.geometry import Line, Plane, Vector, Point

#get current file path
path = ghenv.Component.OnPingDocument().FilePath
#get parent directory of the parent directory
parentdir = os.path.dirname(path)
#get src folder which contains classes
dire = os.path.join(parentdir,'group_one_scripts')

sys.path.append(dire)

from group_one_sticks import Stick 

from compas.datastructures import Assembly, Part

json_path = os.path.join(parentdir, 'data', 'stick_assembly_nadja.json')

stick_width = 13.0
stick_depth = 13.0
stick_length = 200

sticks_data = []

###########################################################################
# Make frames point in best direction
###########################################################################
import math
import copy

from compas.geometry import dot_vectors, Rotation
from compas.geometry import centroid_points

def is_parallel(v1, v2):
    if math.isclose(dot_vectors(v1, v2), 1, abs_tol = 0.001) or math.isclose(dot_vectors(v1, v2), -1 ,abs_tol = 0.001):
        # Means it is parallel
        print("parallel")
        return True
    else:
        # Means it is not parallel
        print("not parallel")
        return False

def get_frame_closest_to_target(target_vector, stick):
    best_dot = -1000.0
    for i in range(4):
        angle = math.pi/2 * i
        R = Rotation.from_axis_and_angle(stick.frame.xaxis, angle, stick.frame.point)
        frame = stick.frame.transformed(R)
        dot = dot_vectors(frame.zaxis, target_vector.unitized())
        if dot>best_dot:
            best_dot = dot
            best_frame = frame
            # print(i)
    return best_frame

def get_center(sticks_list):
    all_points = [stick.frame.point for stick in sticks_list]
    center = centroid_points(all_points)
    # print(center)
    return center

# Copy sticks

sticks_copy = copy.deepcopy(sticks)
center_pt = get_center(sticks_copy)


for stick in sticks_copy:
    if is_parallel(stick.axis.direction.unitized(), Vector(0,0,1)):
        # Target frame is frame pointing into center of structure
        center_vector = Vector.from_start_end(stick.frame.point, center_pt)
        best_frame = get_frame_closest_to_target(center_vector, stick=stick)
        # best_frame.point += best_frame.xaxis * stick_length/3
        stick.frame = best_frame

    else:
        # Make sure z axis is pointing down
        R = Rotation.from_axis_and_angle(stick.frame.xaxis, math.pi/2, stick.frame.point)
        stick.frame.transform(R)
        # stick.frame.point += stick.frame.xaxis * stick_length/3

from compas_rhino.conversions import frame_to_rhino_plane

###########################################################################
# Make frames point in best direction
###########################################################################

assembly = Assembly()
pick_up_frames = []
for i, s in enumerate(sticks_copy):
    part_name = "stick"+ str(i)

    ### nadja - add translation of the frame along the stick axis
    pick_up_frame = s.frame.translated(s.frame.xaxis * stick_length/4)
    pick_up_frames.append(pick_up_frame)
    ###

    part = Part(name = part_name, frame = pick_up_frame)
    part.key = i
    part.attributes["shape"] = s.geometry
    assembly.add_part(part)
    

frames = [frame_to_rhino_plane(p.frame) for p in assembly.parts()]
frames_pick_up = [frame_to_rhino_plane(p) for p in pick_up_frames]

if save:
    json_dump(assembly, fp=json_path, pretty=True)
# ---------- end py3_5 ----------
item = ListItem(List=draw_6, Index=0, Wrap=True)
item_2 = ListItem(List=draw_6, Index=0, Wrap=True)  # -> Item, Item1, Item2
py3_6 = Python3Script(sticks=py3.my_tree, save=Button())  # -> out, frames, assembly; inputs sticks: list, save: Boolean; same code as py3_4
swatch_2 = ColourSwatch(SwatchColor=RGB(0, 0, 0))
swatch_3 = ColourSwatch(SwatchColor=RGB(0, 0, 0))
previewrhinoplane_2 = PreviewRhinoPlane(B="25", pln=py3_5.frames)
previewrhinoplane_3 = PreviewRhinoPlane(B="50", pln=py3_5.frames_pick_up)
volume = Volume(Geometry=draw_6)  # -> Volume, flatten(Centroid); disabled
material_3 = CreateMaterial(Diffuse=RGB(255, 105, 180), Specular=RGB(255, 255, 255), Emission=RGB(0, 0, 0), Transparency=0, Shine=0)
material_4 = CreateMaterial(Diffuse=ColourSwatch(SwatchColor=RGB(214, 0, 0)), Specular=swatch_2, Emission=swatch_2, Transparency=0, Shine=0)
material_5 = CreateMaterial(Diffuse=RGB(255, 105, 180), Specular=RGB(255, 255, 255), Emission=RGB(0, 0, 0), Transparency=0, Shine=0)
material_6 = CreateMaterial(Diffuse=ColourSwatch(SwatchColor=RGB(255, 137, 133)), Specular=swatch_3, Emission=swatch_3, Transparency=0, Shine=0)
pdecon = Deconstruct(Point=volume.Centroid)  # -> XComponent, YComponent, ZComponent; disabled
preview_3 = CustomPreview(Geometry=item, Material=material_4)
preview_4 = CustomPreview(Geometry=[item_2.Item1, item_2.Item2], Material=material_6)
sort = SortList(Keys=pdecon.ZComponent, ValuesA=flatten(draw_6))  # -> Keys, ValuesA; disabled
item_3 = ListItem(List=sort.Keys, Index=0, Wrap=True)  # -> Item1, Item; disabled
gradient = Gradient(
    LowerLimit=item_3.Item,
    UpperLimit=item_3.Item1,
    Parameter=sort.Keys,
    stops=[0: RGB(255, 255, 255), 0: RGB(255, 255, 255), 0: RGB(255, 255, 255), 0.189: RGB(255, 130, 160), 0.57: RGB(176, 76, 76), 1: RGB(220, 0, 40)])  # disabled
swatch_4 = ColourSwatch(SwatchColor=RGB(107, 107, 107))  # disabled
material_7 = CreateMaterial(Diffuse=swatch_4, Specular=gradient, Emission=gradient, Transparency=0, Shine=0)  # disabled
preview_5 = CustomPreview(Geometry=sort.ValuesA, Material=material_7)  # disabled

# ==== cluster Cluster
L = ClusterInput()
item = ListItem(List=L, Index=0, Wrap=True)  # -> Item1, Item, Item1_2, Item2
vdisex = VectorDisplayEx(Point=item.Item, Vector=item.Item1_2, Colour=ColourSwatch(SwatchColor=RGB(255, 0, 0)), Width="3")
vdisex_2 = VectorDisplayEx(Point=item.Item, Vector=item.Item2, Colour=ColourSwatch(SwatchColor=RGB(0, 255, 60)), Width="3")
vdisex_3 = VectorDisplayEx(Point=item.Item, Vector=item.Item1, Colour=ColourSwatch(SwatchColor=RGB(0, 85, 255)), Width="3")

# ==== cluster PreviewRhinoPlane
B = ClusterInput()
pln = ClusterInput()
pln_2 = Plane(pln)
deplane = DeconstructPlane(Plane=pln_2)  # -> Origin, XAxis, YAxis, ZAxis
multiplication = Multiplication(A="1", B=B)
amp = Amplitude(Vector=deplane.ZAxis, Amplitude=multiplication)
amp_2 = Amplitude(Vector=deplane.XAxis, Amplitude=multiplication)
amp_3 = Amplitude(Vector=deplane.YAxis, Amplitude=multiplication)
vdisex = VectorDisplayEx(Point=deplane.Origin, Vector=amp_2, Colour=ColourSwatch(SwatchColor=RGB(255, 0, 0)), Width="3")
vdisex_2 = VectorDisplayEx(Point=deplane.Origin, Vector=amp_3, Colour=ColourSwatch(SwatchColor=RGB(0, 255, 60)), Width="3")
vdisex_3 = VectorDisplayEx(Point=deplane.Origin, Vector=amp, Colour=ColourSwatch(SwatchColor=RGB(0, 85, 255)), Width="3")

# ==== cluster PreviewCompasFrame
B = ClusterInput()
L = ClusterInput()
item = ListItem(List=L, Index=0, Wrap=True)  # -> Item1, Item, Item1_2, Item2
len = Length(Curve=item.Item1_2)
multiplication = Multiplication(A=len, B=B)
amp = Amplitude(Vector=item.Item1, Amplitude=multiplication)
amp_2 = Amplitude(Vector=item.Item1_2, Amplitude=multiplication)
amp_3 = Amplitude(Vector=item.Item2, Amplitude=multiplication)
vdisex = VectorDisplayEx(Point=item.Item, Vector=amp_2, Colour=ColourSwatch(SwatchColor=RGB(255, 0, 0)), Width="3")
vdisex_2 = VectorDisplayEx(Point=item.Item, Vector=amp_3, Colour=ColourSwatch(SwatchColor=RGB(0, 255, 60)), Width="3")
vdisex_3 = VectorDisplayEx(Point=item.Item, Vector=amp, Colour=ColourSwatch(SwatchColor=RGB(0, 85, 255)), Width="3")
