# Grasshopper definition 25 27 11 (nadja).gh (Grasshopper 1.0.8)

number_slider = Slider(3, range=-90..90)  # disabled
number_slider_2 = Slider(-68, range=-90..90)  # disabled
number_slider_3 = Slider(-42, range=-90..90)
number_slider_4 = Slider(45, range=-90..90)
panel = Panel("{0,0,0}")  # disabled
panel_2 = Panel("{0,0,0}")  # disabled

# ---- group: Tamplate
py3 = Python3Script()  # -> out, a
# ---------- py3: Python ----------
# r: compas>=2.14.1
# venv: sticks

import sys
import os
import math

#get current file path
path = ghenv.Component.OnPingDocument().FilePath
print (path)
#get parent directory of the parent directory
parentdir = os.path.dirname(path)
print (parentdir)
#get src folder which contains classes
dire = os.path.join(parentdir,'group_one_scripts')
print (dire)

sys.path.append(dire)

from compas_rhino import unload_modules

unload_modules("group_one_sticks")
unload_modules("group_one_stick_module")
unload_modules("nadja_test")

import group_one_sticks
import nadja_test

from group_one_sticks import Stick 
from group_one_stick_module import BranchingModule
from nadja_test import Planarize
from compas.geometry import Line, Point, Vector, Frame
# ---------- end py3 ----------

# ----
number_slider_5 = Slider(10, range=0..100)  # disabled
number_slider_6 = Slider(2, range=1..3)  # disabled
pt = Point(panel)  # disabled
pt_2 = Point(panel_2)  # disabled
# first test one row
panel_3 = Panel("{0,0,0}")  # disabled
xy = XYPlane(Origin=Point(0, 0, 0))
merge = Merge(Data1=number_slider_3, Data2=number_slider_4)
merge_2 = Merge(Data1=number_slider, Data2=number_slider_2)  # disabled
pt_3 = Point(panel_3)  # disabled
pt_4 = Point("{0,0,0}")
line_1 = Curve(<curve referenced from the Rhino model>)  # disabled
button = Button()  # disabled
pl = ConstructPlane(Origin=pt, XAxis=Vector(1, 0, 0), YAxis=Vector(0, 1, 0))  # disabled
panel_4 = Panel(".2")  # disabled
crv = Curve([<curve referenced from the Rhino model> x16])
crv_2 = Curve([<curve referenced from the Rhino model> x16])  # disabled
line_0 = Curve(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)  # disabled
crv_3 = Curve([<curve referenced from the Rhino model> x4])  # disabled

# ---- group: Tamplate
py3_2 = Python3Script(plane=xy, stick_angles=Slider(18, range=0..90), sticks_distance=Slider(100, range=0..100), length=number_slider_6)  # -> out, my_geometry, geometry_2, frame, center_points, flatten(my_tree); inputs plane: Plane, stick_angles: Double, sticks_distance: Double, length: Double
# ---------- py3_2: Python ----------
# r: compas>=2.14.1
# venv: sticks

import sys
import os
import math

#get current file path
path = ghenv.Component.OnPingDocument().FilePath
print (path)
#get parent directory of the parent directory
parentdir = os.path.dirname(path)
print (parentdir)
#get src folder which contains classes
dire = os.path.join(parentdir,'group_one_scripts')
print (dire)

sys.path.append(dire)

from compas_rhino import unload_modules

unload_modules("group_one_sticks")
unload_modules("group_one_stick_module")
unload_modules("nadja_studies_25_12_01_r1")
unload_modules("nadja_bridgeing_25_12_01_r1")

import group_one_sticks
import nadja_studies_25_12_01_r1
import nadja_bridgeing_25_12_01_r1

from group_one_sticks import Stick 
from group_one_stick_module import BranchingModule
from nadja_studies_25_12_01_r1 import StickModule
from nadja_bridgeing_25_12_01_r1 import Bridge

from compas.geometry import Line, Point, Vector, Frame
from compas_rhino.conversions import line_to_compas, point_to_compas, plane_to_compas_frame
from ghpythonlib.treehelpers import list_to_tree, tree_to_list


# STEP 1: converting geometry from rhino to compass
root = plane_to_compas_frame(plane)

module = StickModule(angle_a=stick_angles, 
                    angle_b=stick_angles, 
                    sticks_distance=sticks_distance)



geometry = module.CreateModule(plane=root)

bridge = Bridge(geometry)

center_points = bridge.face_centroids
frame = bridge.get_face_frame(0, 0)


# tree_module = bridge.grow_module(module, face_index=5,angle=0)

tree = []
for n in range(3):
    tree_module = bridge.grow_module(module, from_stick_index=n,face_index=5,angle=10)
    tree.append(tree_module)

tree = bridge.sticks
geometry = []
for module in tree:
    geometry_2 = [s.geometry for s in module]
    geometry.append(geometry_2)
print(tree)

my_tree = list_to_tree(tree) 
my_geometry = list_to_tree(geometry)
# ---------- end py3_2 ----------

# ----
crv_4 = Curve([<curve referenced from the Rhino model> x38])

# ---- group: module
py3_3 = Python3Script(
    root_point=pt_4,
    x_range=Slider(10, range=0..100),
    angles=merge,
    angle_x=number_slider_4,
    angle_z=number_slider_3,
    translation_bottom=Slider(2, range=0..10),
    translation_top=Slider(2, range=0..10),
    heigth=Slider(2, range=0..10))  # -> out, sticks, my_points, v_x, face_plane, all_points; inputs root_point: Point3d, x_range: Int32, angles: list of Double, angle_x: Double, angle_z: Double, translation_bottom: Double, translation_top: Double, heigth: Double
# ---------- py3_3: Python ----------
# r: compas>=2.14.1
# venv: sticks

import sys
import os
import math

#get current file path
path = ghenv.Component.OnPingDocument().FilePath
print (path)
#get parent directory of the parent directory
parentdir = os.path.dirname(path)
print (parentdir)
#get src folder which contains classes
dire = os.path.join(parentdir,'group_one_scripts')
print (dire)

sys.path.append(dire)

from compas_rhino import unload_modules

unload_modules("group_one_sticks")
unload_modules("group_one_stick_module")
unload_modules("nadja_studies")

import group_one_sticks
import nadja_studies

from group_one_sticks import Stick 
from group_one_stick_module import BranchingModule
from nadja_studies import Planarize
from compas.geometry import Line, Point, Vector, Frame
from compas_rhino.conversions import line_to_compas, point_to_compas
from ghpythonlib.treehelpers import list_to_tree, tree_to_list

stick_length = translation_bottom
stick_width = .13
stick_depth = .13

# STEP 1: convert rg.Point3d to compas point
root = point_to_compas(root_point)

# STEP 2: class of the planirire
planar = Planarize(root, translation_bottom, translation_top, heigth, angles)
planar.initial_face(angle_x, angle_z)

# STEP 3: initial face
v_x = planar.initial_face_points
face_plane = planar.initial_face_plane # when it is a property it does not need this = ()

# STEP 4: adding rows 
point_list = planar.row_faces(x_range, angles=angles)
column_points = planar.initial_column_faces(x_range, angles=angles)

all_points = planar.column_faces()
    
# STEP 5: make lines for sticks
stick_lines = planar.module_stick()
  
# STEP 6: list to tree
my_points = list_to_tree(stick_lines) 

# STEP 7: sticks class

sticks = [Stick(s, width = stick_width, depth = stick_depth).geometry for s in stick_lines]


# sticks = [s.geometry for s in stick_lines]
# ---------- end py3_3 ----------

# ----
deplane = DeconstructPlane(Plane=pl)  # -> Origin, XAxis, YAxis, ZAxis; disabled

# ---- group: module
py3_4 = Python3Script(root_point=pt_3, x_range=number_slider_5, angles=merge_2, angle_x=number_slider_2, angle_z=number_slider)  # -> out, sticks, my_points, v_x, face_plane, all_points; inputs root_point: Point3d, x_range: Int32, angles: list of Double, angle_x: Double, angle_z: Double; disabled
# ---------- py3_4: Python ----------
# r: compas>=2.14.1
# venv: sticks

import sys
import os
import math

#get current file path
path = ghenv.Component.OnPingDocument().FilePath
print (path)
#get parent directory of the parent directory
parentdir = os.path.dirname(path)
print (parentdir)
#get src folder which contains classes
dire = os.path.join(parentdir,'group_one_scripts')
print (dire)

sys.path.append(dire)

from compas_rhino import unload_modules

unload_modules("group_one_sticks")
unload_modules("group_one_stick_module")
unload_modules("nadja_test")

import group_one_sticks
import nadja_test

from group_one_sticks import Stick 
from group_one_stick_module import BranchingModule
from nadja_test import Planarize
from compas.geometry import Line, Point, Vector, Frame
from compas_rhino.conversions import line_to_compas, point_to_compas
from ghpythonlib.treehelpers import list_to_tree, tree_to_list

stick_length = 2
stick_width = .13
stick_depth = .13

# convert rg.Point3d to compas point
root = point_to_compas(root_point)

# class of the planirire
planar = Planarize(root)
planar.initial_face(angle_x, angle_z)

# initial face
v_x = planar.initial_face_points
face_plane = planar.initial_face_plane # when it is a property it does not need this = ()

# adding rows 
point_list = planar.row_faces(x_range, angles=angles)
column_points = planar.initial_column_faces(x_range, angles=angles)

all_points = planar.column_faces()
print(all_points)

# adding columns 
# point_list = planar.column_faces(x_range, angles=angles)
# print(point_list)

    
# list to tree
my_points = list_to_tree(all_points) 




# points = []
# assembly = []

# for z in range(z_range):
#     row = []
#     for x in range(x_range):
#         grid_size_x = stick_length - 2*stick_depth + offset_x
#         grid_size = stick_length - 2*stick_depth
#         grid_size_z = stick_length - 2*stick_depth + offset_y
#         pt = Point(x * grid_size_x, grid_size, z * grid_size_z)
#         row.append(pt)
#     points.append(row)




# ### make this like it is a class
# ### function of the class: to planarize all the points 
# pol_pt = []
# polylines = []

# for i in range(z_range-1):
#     i = i % z_range
#     pol_points = []
#     for j in range(x_range-1):
#         j = j % x_range
#         p0 = points[i][j]
#         p1 = points[i][j+1]
#         p3 = points[i+1][j]
#         p2 = points[i+1][j+1]
#         pol_points.append([p0, p1, p2, p3, p0])
    
#     pol_pt.append(pol_points)

# for p_list in pol_pt:
#     for p in p_list:
#         pol = Polyline(p)
#         polylines.append(pol)


# # sticks = [s.geometry for s in assembly]
# ---------- end py3_4 ----------

# ----
cpoly = ControlPolygon(Curve=crv)  # -> Polygon, Points
cpoly_2 = ControlPolygon(Curve=crv_2)  # -> Polygon, Points; disabled
py3_5 = Python3Script(lines=crv)  # -> out, my_points, planes, projected_crvs, centroids, my_vectors; inputs lines: list of Polyline
# ---------- py3_5: Python ----------
#locate stick class file in the same folder
from compas_rhino import unload_modules
import sys
import os
import math

import Rhino.Geometry as rg
from ghpythonlib.treehelpers import list_to_tree, tree_to_list
# ---------- end py3_5 ----------
py3_6 = Python3Script(line_0=line_0, line_1=line_1, lines=crv_3, width=panel_4, depth=panel_4)  # -> out, stick_box, sticks; inputs line_0: Line, line_1: Line, lines: list of Line, width: Double, depth: Double; disabled
# ---------- py3_6: Python ----------
#locate stick class file in the same folder
from compas_rhino import unload_modules
import sys
import os
import math

#get current file path
path = ghenv.Component.OnPingDocument().FilePath
#get parent directory of the parent directory
parentdir = os.path.dirname(path)
#get src folder which contains classes
dire = os.path.join(parentdir,'sticks')

sys.path.append(dire)


unload_modules('Sticks')

import Sticks
from Sticks import Stick, stick_bridge
from compas.geometry import Line, Point, Vector
from compas_rhino.conversions import line_to_compas

assembly = []
line0 = line_to_compas(line_0)

#initiates a class Stick named stick0
stick0 = Stick(line0)
# stick0.rotate_stick(0)
assembly.append(stick0)

line1 = line_to_compas(line_1)
stick1 = Stick(line1)
# stick1.rotate_stick(0, Vector(0,1,0), stick1.axis.start)
assembly.append(stick1)


stick2 = stick_bridge(stick0, stick1)
assembly.append(stick2)


for line in lines:
    compas_line = line_to_compas(line)
    stick = Stick(compas_line, width, depth)
    assembly.append(stick)


# generates geometry of the stick0 class: Box
sticks = [s.geometry for s in assembly]
# ---------- end py3_6 ----------
py3_7 = Python3Script(lines=crv_4, width=".2", depth=".2")  # -> out, stick_box, sticks; inputs lines: list of Line, width: Double, depth: Double
# ---------- py3_7: Python ----------
#locate stick class file in the same folder
from compas_rhino import unload_modules
import sys
import os
import math

#get current file path
path = ghenv.Component.OnPingDocument().FilePath
#get parent directory of the parent directory
parentdir = os.path.dirname(path)
#get src folder which contains classes
dire = os.path.join(parentdir,'sticks')

sys.path.append(dire)


unload_modules('Sticks')

import Sticks
from Sticks import Stick, stick_bridge
from compas.geometry import Line, Point, Vector
from compas_rhino.conversions import line_to_compas

assembly = []

for line in lines:
    compas_line = line_to_compas(line)
    stick = Stick(compas_line, width=width, depth=depth)
    assembly.append(stick)


# generates geometry of the stick0 class: Box
sticks = [s.geometry for s in assembly]
# ---------- end py3_7 ----------
compas_fab_ros_connect = COMPASFABROSConnect(connect=button)  # -> ros_client, is_connected; inputs ip: String, port: Int32, connect: Boolean; disabled
#   port ip: The ip address ROS. Defaults to 127.0.0.1.
#   port port: The port of ROS. Defaults to 9090.
#   port connect: If True, connects to ROS. If False, disconnects from ROS. Defaults to False.
#   port ros_client: The ROS client.
#   port is_connected: True if connection established.
# ---------- compas_fab_ros_connect: Python ----------
# r: compas_fab>=1.0.2
"""
Connect or disconnect to ROS.

COMPAS FAB v1.0.2
"""

import Grasshopper
from compas_ghpython import create_id
from scriptcontext import sticky as st

from compas_fab.backends import RosClient


class ROSConnect(Grasshopper.Kernel.GH_ScriptInstance):
    def RunScript(self, ip: str, port: int, connect: bool):
        ros_client = None

        ip = ip or "127.0.0.1"
        port = port or 9090

        key = create_id(ghenv.Component, "ros_client")  # noqa: F821

        if ros_client:
            st[key].close()
        if connect:
            st[key] = RosClient(ip, port)
            st[key].run(5)

        ros_client = st.get(key, None)
        is_connected = ros_client.is_connected if ros_client else False
        return (ros_client, is_connected)
# ---------- end compas_fab_ros_connect ----------
py3_8 = Python3Script(lines=crv_2)  # -> out, my_points, planes, projected_crvs, centroids, my_vectors; inputs lines: list of Polyline; disabled
# ---------- py3_8: Python ----------
#locate stick class file in the same folder
from compas_rhino import unload_modules
import sys
import os
import math

import Rhino.Geometry as rg
from ghpythonlib.treehelpers import list_to_tree, tree_to_list


constrol_pts = []
for crv in lines:
    points = []
    for i in range(len(crv) - 1):
        points.append(crv[i])
    constrol_pts.append(points)

# rearange the points
planes = []
projected_crvs = []
centroids = []
vectors = []
for pts, pl in zip(constrol_pts, lines):
    if len(pts) > 2:
        vector_list = []
        plane = rg.Plane(pts[0], pts[1], pts[2])
        plane_normal = plane.Normal

        plc = rg.PolylineCurve(pl)
        crv = plc.ToNurbsCurve()
        projected_crv = crv.ProjectToPlane(crv, plane)

        # test: try to project along vector
        # pl = crv.ToPolyline(0.01, 0.01, 0, 0)
        # pl = rg.PolylineCurve(plc)
        # poly = rg.Polyline()
        # polyline = pl.TryGetPolyline()
        # print(polyline)
        # for pt in pl:
        #     print(pt)
        
        # rearenge pts in order
        mp = rg.AreaMassProperties.Compute(projected_crv, 0.1)
        if mp:
            centroid = mp.Centroid
            center_plane = rg.Plane(centroid, plane.XAxis, plane.YAxis)
            # angle between the vector
            for pt in pl:
                A = centroid
                B = pt
                v1 = rg.Vector3d(A)
                v2 = rg.Vector3d(B)
                vector = v1 - v2
                vector_list.append(vector)

        centroids.append(centroid)
        planes.append(center_plane)
        vectors.append(vector_list)
        projected_crvs.append(projected_crv)
    else:
        pass



my_points = list_to_tree(constrol_pts)
my_vectors = list_to_tree(vectors)
# ---------- end py3_8 ----------
number_slider_7 = Slider(2, range=0..100)  # disabled
number_slider_8 = Slider(2, range=0..100)  # disabled
vec = Vector(deplane.YAxis)  # disabled
number_slider_9 = Slider(5, range=0..10)  # disabled
button_2 = Button()  # disabled
number_slider_10 = Slider(5, range=0..10)  # disabled
number_slider_11 = Slider(5, range=0..10)  # disabled
points = PointList(Points=py3_2.center_points, Size=".05")
draw = COMPASDraw(cg=py3_6.sticks)  # -> rg; disabled
#   port cg: The COMPAS geometry or datastructure to be drawn.
#   port rg: The Rhino geometry object.
# ---------- draw: Python ----------
# r: compas>=2.14.1
"""
Draws COMPAS geometry in Grasshopper.
"""

from typing import Any

import Grasshopper

from compas.scene import SceneObject


class CompasToRhinoGeometry(Grasshopper.Kernel.GH_ScriptInstance):
    def RunScript(self, cg):
        if not cg:
            return None

        return SceneObject(item=cg).draw()
# ---------- end draw ----------
draw_2 = COMPASDraw(cg=py3_7.sticks)  # -> rg; same code as draw
draw_3 = COMPASDraw(cg=py3_4.my_points)  # -> rg; disabled; same code as draw
vdis = VectorDisplay(Anchor=pt, Vector=vec)  # disabled
draw_4 = COMPASDraw(cg=py3_2.frame)  # -> simplify(rg); same code as draw
draw_5 = COMPASDraw(cg=py3_2.my_geometry)  # -> simplify(rg); same code as draw
draw_6 = COMPASDraw(cg=py3_2.my_tree)  # -> simplify(rg); same code as draw
draw_7 = COMPASDraw(cg=py3_2.geometry_2)  # -> simplify(rg); same code as draw
crv_5 = Curve(py3_5.projected_crvs)
draw_8 = COMPASDraw(cg=py3_3.my_points)  # -> simplify(rg); same code as draw
crv_6 = Curve(py3_8.projected_crvs)  # disabled
swatch = ColourSwatch(SwatchColor=RGB(255, 255, 255))
compas_fab_ros_robot = COMPASFABROSRobot(ros_client=compas_fab_ros_connect.ros_client, load=button_2)  # -> robot; inputs load: Boolean; disabled
#   port ros_client: The ROS client.
#   port load: If True, loads the robot from ROS. Defaults to False.
# ---------- compas_fab_ros_robot: Python ----------
# r: compas_fab>=1.0.2
"""
Load robot directly from ROS.

COMPAS FAB v1.0.2
"""

import Grasshopper
from compas_ghpython import create_id
from scriptcontext import sticky as st

from compas.scene import SceneObject


class ROSRobot(Grasshopper.Kernel.GH_ScriptInstance):
    def RunScript(self, ros_client, load: bool):
        key = create_id(ghenv.Component, "robot")  # noqa: F821

        if ros_client and ros_client.is_connected and load:
            # Load URDF from ROS
            st[key] = ros_client.load_robot(load_geometry=True, precision=12)
            st[key].scene_object = SceneObject(item=st[key].model)

        robot = st.get(key, None)

        if robot:  # client sometimes need to be restarted, without needing to reload geometry
            robot.client = ros_client
        return robot
# ---------- end compas_fab_ros_robot ----------
panel_5 = Panel(compas_fab_ros_connect.is_connected)  # disabled
pln = Plane(py3_5.planes)
panel_6 = Panel("1")  # disabled
draw_9 = COMPASDraw(cg=py3_3.sticks)  # -> simplify(rg); same code as draw
panel_7 = Panel("1")  # disabled
pln_2 = Plane(py3_8.planes)  # disabled
py3_9 = Python3Script(
    x_range=number_slider_10,
    y_range=number_slider_9,
    z_range=number_slider_11,
    offset_x=number_slider_7,
    offset_y=number_slider_8)  # -> out, sticks, my_points, polylines; inputs x_range: Int32, y_range: Int32, z_range: Int32, offset_x: Double, offset_y: Double; disabled
# ---------- py3_9: Python ----------
#locate stick class file in the same folder
from compas_rhino import unload_modules
import sys
import os
import math

#get current file path
path = ghenv.Component.OnPingDocument().FilePath
#get parent directory of the parent directory
parentdir = os.path.dirname(path)
#get src folder which contains classes
dire = os.path.join(parentdir,'sticks')

sys.path.append(dire)


unload_modules('Sticks')
unload_modules('OrtogonalModule')

import Sticks
from Sticks import Stick, stick_bridge
from OrtogonalModule import OStickModule
from compas.geometry import Line, Point, Vector, Polyline
from compas_rhino.conversions import line_to_compas
from ghpythonlib.treehelpers import list_to_tree, tree_to_list

stick_length = 2
stick_width = .13
stick_depth = .13

points = []
assembly = []

for z in range(z_range):
    row = []
    for x in range(x_range):
        grid_size_x = stick_length - 2*stick_depth + offset_x
        grid_size = stick_length - 2*stick_depth
        grid_size_z = stick_length - 2*stick_depth + offset_y
        pt = Point(x * grid_size_x, grid_size, z * grid_size_z)
        row.append(pt)
    points.append(row)




### make this like it is a class
### function of the class: to planarize all the points 
pol_pt = []
polylines = []

for i in range(z_range-1):
    i = i % z_range
    pol_points = []
    for j in range(x_range-1):
        j = j % x_range
        p0 = points[i][j]
        p1 = points[i][j+1]
        p3 = points[i+1][j]
        p2 = points[i+1][j+1]
        pol_points.append([p0, p1, p2, p3, p0])
    
    pol_pt.append(pol_points)

for p_list in pol_pt:
    for p in p_list:
        pol = Polyline(p)
        polylines.append(pol)


my_points = list_to_tree(points)


# sticks = [s.geometry for s in assembly]
# ---------- end py3_9 ----------
cluster = Cluster(L=draw_4)
cluster_2 = Cluster(L=draw_6)
points_2 = PointList(Points=py3_5.my_points, Size="1")
pt_5 = Point(py3_5.centroids)
points_3 = PointList(Points=py3_8.my_points, Size=panel_6)  # disabled
points_4 = PointList(Points=draw_8, Size="1")
pt_6 = Point(py3_8.centroids)  # disabled
preview = CustomPreview(
    Geometry=draw_2,
    Material={diffuse=RGB(221, 160, 221), emission=RGB(66, 48, 66), shine=0.5, specular=RGB(255, 255, 255), transparency=0})
deplane_2 = DeconstructPlane(Plane=pln)  # -> Origin, XAxis, YAxis, ZAxis
points_5 = PointList(Points=draw_3, Size=panel_7)  # disabled
material = CreateMaterial(Diffuse=ColourSwatch(SwatchColor=RGB(0, 0, 0)), Specular=swatch, Emission=swatch, Transparency=0, Shine=0)
deplane_3 = DeconstructPlane(Plane=pln_2)  # -> Origin, XAxis, YAxis, ZAxis; disabled
vdis_2 = VectorDisplay(Anchor=pt_5, Vector=py3_5.my_vectors)
py3_10 = Python3Script(sticks=py3_2.my_tree, save=Button())  # -> out, frames, assembly; inputs sticks: list, save: Boolean
# ---------- py3_10: Python ----------
from compas import json_dump
import os, sys
from itertools import combinations
from compas_rhino import unload_modules
from compas.geometry import Line, Plane, Vector, Point

#get current file path
path = ghenv.Component.OnPingDocument().FilePath
#get parent directory of the parent directory
parentdir = os.path.dirname(path)
#get src folder which contains classes
dire = os.path.join(parentdir,'group_one_scripts')

sys.path.append(dire)

from group_one_sticks import Stick 

from compas.datastructures import Assembly, Part

json_path = os.path.join(parentdir, 'group_one_data', 'stick_assembly.json')

stick_width = 13.0
stick_depth = 13.0
stick_length = 200

sticks_data = []

###########################################################################
# Make frames point in best direction
###########################################################################
import math
import copy

from compas.geometry import dot_vectors, Rotation
from compas.geometry import centroid_points

def is_parallel(v1, v2):
    if math.isclose(dot_vectors(v1, v2), 1, abs_tol = 0.001) or math.isclose(dot_vectors(v1, v2), -1 ,abs_tol = 0.001):
        # Means it is parallel
        print("parallel")
        return True
    else:
        # Means it is not parallel
        print("not parallel")
        return False

def get_frame_closest_to_target(target_vector, stick):
    best_dot = -1000.0
    for i in range(4):
        angle = math.pi/2 * i
        R = Rotation.from_axis_and_angle(stick.frame.xaxis, angle, stick.frame.point)
        frame = stick.frame.transformed(R)
        dot = dot_vectors(frame.zaxis, target_vector.unitized())
        if dot>best_dot:
            best_dot = dot
            best_frame = frame
            print(i)
    return best_frame

def get_center(sticks_list):
    all_points = [stick.frame.point for stick in sticks_list]
    center = centroid_points(all_points)
    print(center)
    return center

# Copy sticks

sticks_copy = copy.deepcopy(sticks)
center_pt = get_center(sticks_copy)


for stick in sticks_copy:
    if is_parallel(stick.axis.direction.unitized(), Vector(0,0,1)):
        # Target frame is frame pointing into center of structure
        center_vector = Vector.from_start_end(stick.frame.point, center_pt)
        best_frame = get_frame_closest_to_target(center_vector, stick=stick)
        stick.frame = best_frame

    else:
        # Make sure z axis is pointing down
        R = Rotation.from_axis_and_angle(stick.frame.xaxis, math.pi/2, stick.frame.point)
        stick.frame.transform(R)

from compas_rhino.conversions import frame_to_rhino_plane

###########################################################################
# Make frames point in best direction
###########################################################################

assembly = Assembly()
for i, s in enumerate(sticks_copy):
    part_name = "stick"+ str(i)
    part = Part(name = part_name, frame = s.frame)
    part.key = i
    part.attributes["shape"] = s.geometry
    assembly.add_part(part)
    

frames = [frame_to_rhino_plane(p.frame) for p in assembly.parts()]

if save:
    json_dump(assembly, fp=json_path, pretty=True)
# ---------- end py3_10 ----------
panel_8 = Panel(compas_fab_ros_robot)  # disabled
pline = PolyLine(Vertices=simplify(draw_8), Closed=invert(False))
vdis_3 = VectorDisplay(Anchor=pt_6, Vector=py3_8.my_vectors)  # disabled
pline_2 = PolyLine(Vertices=simplify(draw_3), Closed=invert(False))  # disabled
preview_2 = CustomPreview(Geometry=draw_5, Material=material)
vdis_4 = VectorDisplay(Anchor=deplane_2.Origin, Vector=deplane_2.XAxis)
vdis_5 = VectorDisplay(Anchor=deplane_3.Origin, Vector=deplane_3.XAxis)  # disabled
draw_10 = COMPASDraw(cg=py3_9.my_points)  # -> rg; disabled; same code as draw
draw_11 = COMPASDraw(cg=py3_9.polylines)  # -> rg; disabled; same code as draw
material_2 = CreateMaterial(
    Diffuse=ColourSwatch(SwatchColor=RGB(0, 0, 0)),
    Specular=ColourSwatch(SwatchColor=RGB(31, 31, 31)),
    Emission=ColourSwatch(SwatchColor=RGB(181, 167, 129)),
    Transparency=0,
    Shine=0)
panel_9 = Panel("1")  # disabled
plane = Plane(Plane(origin=(0.00175, 0.00129, 0.1532), x=(0.7071067812, 0.7071067812, 0), y=(-0.7071067812, 0.7071067812, 0)))  # disabled
draw_12 = COMPASDraw(cg=py3_9.sticks)  # -> rg; disabled; same code as draw
explode = Explode(Curve=pline, Recursive=True)  # -> Segments, Vertices
py3_11 = Python3Script()  # -> out, a; disabled
# ---------- py3_11: Python ----------
from compas.geometry import Vector, Frame
from compas.geometry import cross_vectors
from compas_rhino.conversions import vector_to_rhino
from compas_rhino.conversions import point_to_rhino

points = []
x_vectors = []
y_vectors = []
normal = []

for frame in frames:
    points.append(point_to_rhino(frame.point))
    x_vectors.append(vector_to_rhino(frame.xaxis * factor))
    y_vectors.append(vector_to_rhino(frame.yaxis * factor))
    normal.append(vector_to_rhino(frame.normal * factor))
# ---------- end py3_11 ----------
boundary = BoundarySurfaces(Edges=pline)
boundary_2 = BoundarySurfaces(Edges=pline_2)  # disabled
mesh = Mesh(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)  # disabled
points_6 = PointList(Points=draw_10, Size=panel_9)  # disabled
preview_3 = CustomPreview(Geometry=draw_9, Material=material_2)
preview_4 = CustomPreview(
    Geometry=boundary,
    Material={diffuse=RGB(221, 160, 221), emission=RGB(66, 48, 66), shine=0.5, specular=RGB(255, 255, 255), transparency=0})
preview_5 = CustomPreview(
    Geometry=boundary_2,
    Material={diffuse=RGB(221, 160, 221), emission=RGB(66, 48, 66), shine=0.5, specular=RGB(255, 255, 255), transparency=0})  # disabled
swatch_2 = ColourSwatch(SwatchColor=RGB(0, 0, 0))  # disabled
swatch_3 = ColourSwatch(SwatchColor=RGB(255, 255, 255))  # disabled
compas_fab_attached_tool = COMPASFABAttachedTool(robot=compas_fab_ros_robot, visual_mesh=mesh, collision_mesh=mesh, tcf_plane=plane)  # -> robot; inputs visual_mesh: Mesh, collision_mesh: Mesh; disabled
#   port visual_mesh: A visual mesh for the tool.
#   port collision_mesh: A collision mesh for the tool.
#   port tcf_plane: The frame of the tool in tool0 frame.
#   port group: The planning group to which the tool should be attached.
#   port connected_to: The link to which the tool should be connected to.
# ---------- compas_fab_attached_tool: Python ----------
# r: compas_fab>=1.0.2
"""
Attach a tool to the robot.

COMPAS FAB v1.0.2
"""

import Grasshopper
import Rhino
from compas.geometry import Frame
from compas_rhino.conversions import mesh_to_compas
from compas_rhino.conversions import plane_to_compas_frame

from compas_fab.robots import Tool


class AttachToolComponent(Grasshopper.Kernel.GH_ScriptInstance):
    def RunScript(self,
            robot,
            visual_mesh: Rhino.Geometry.Mesh,
            collision_mesh: Rhino.Geometry.Mesh,
            tcf_plane,
            group,
            connected_to):
        if robot and robot.client and robot.client.is_connected and visual_mesh:
            if not collision_mesh:
                collision_mesh = visual_mesh

            c_visual_mesh = mesh_to_compas(visual_mesh)
            c_collision_mesh = mesh_to_compas(collision_mesh)

            if not tcf_plane:
                frame = Frame.worldXY()
            else:
                frame = plane_to_compas_frame(tcf_plane)
            tool = Tool(c_visual_mesh, frame, c_collision_mesh, connected_to=connected_to)

            robot.attach_tool(tool, group)

        return robot
# ---------- end compas_fab_attached_tool ----------
len = Length(Curve=draw_8)
material_3 = CreateMaterial(Diffuse=swatch_2, Specular=swatch_3, Emission=swatch_3, Transparency=0, Shine=0)  # disabled
preview_6 = CustomPreview(Geometry=draw_12, Material=material_3)  # disabled
compas_fab_planning_scene = COMPASFABPlanningScene(robot=compas_fab_ros_robot)  # -> scene; disabled
#   port scene: A planning scene.
# ---------- compas_fab_planning_scene: Python ----------
# r: compas_fab>=1.0.2
"""
Create a planning scene.

COMPAS FAB v1.0.2
"""

import Grasshopper
from compas_ghpython import create_id
from scriptcontext import sticky as st

from compas_fab.robots import PlanningScene


class PlanningSceneComponent(Grasshopper.Kernel.GH_ScriptInstance):
    def RunScript(self, robot):
        key = create_id(ghenv.Component, "planning_scene")  # noqa: F821
        if robot:
            st[key] = PlanningScene(robot)
        return st.get(key, None)
# ---------- end compas_fab_planning_scene ----------
mesh_2 = Mesh(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)  # disabled
index = ControlKnob(Decimals=0, Limit=False, Maximum=10, Minimum=0, Range=100, Value=3)  # disabled
button_3 = Button()  # disabled
button_4 = Button()  # disabled
button_5 = Button()  # disabled
button_6 = Button()  # disabled
python_3_script = Python3Script(
    scene=compas_fab_planning_scene,
    robot=compas_fab_attached_tool,
    load=button_5,
    compute=button_6,
    index=index,
    env=mesh_2,
    reset=button_3)  # -> out, all_sticks, sticks, results, joined_trajectory; inputs index: Int32, env: Mesh; disabled
# ---------- python_3_script: Python ----------
from compas.datastructures import Assembly, Mesh
from compas.geometry import Frame, Point, Translation, Transformation
from compas_fab.backends import RosClient
from compas_fab.robots import Tool, PlanningScene, CollisionMesh
import os, sys
import math

import traceback

import compas
from compas.data import json_load
from compas_robots import Configuration

compas.PRECISION = "12f"

# Constants
APPROACH_DISTANCE = 0.015  # Meters
group = None
start_configuration = None

# Specify the path to the assembly file and the path to the output file
path = ghenv.Component.OnPingDocument().FilePath
parentdir = os.path.dirname(path)
dire = os.path.join(parentdir, "group_one_scripts")
sys.path.append(dire)

json_path = os.path.join(parentdir, "group_one_data", "stick_assembly.json")
write_path = os.path.join(parentdir, "group_one_data", "stick_assembly_with_trajectories.json")

# Import helpers
from compas_rhino import unload_modules
unload_modules("group_one_helpers")


from compas_rhino.conversions import mesh_to_compas
from group_one_helpers import scale_and_move_to_point, generate_default_tolerances, calculate_pick_trajectory, calculate_place_trajectories
from scriptcontext import sticky

if "last_status" not in sticky or sticky["last_status"] is None:
    sticky["last_status"] = "Idle"

if "geometry" not in sticky or sticky["geometry"] is None:
    pass

SAFE_CONFIG = Configuration.from_revolute_values([math.radians(68.80), 
                                        math.radians(-70.55), 
                                        math.radians(-116.42), 
                                        math.radians(-83.80), 
                                        math.radians(98.73), 
                                        math.radians(56.93)])

if 'load' in globals() and load:
    scene.reset()
    tcm = CollisionMesh(mesh_to_compas(env), id = "table")
    scene.add_collision_mesh(tcm)
    assembly = json_load(json_path)
    scaled_assembly = scale_and_move_to_point(assembly, Point(-0.500, -0.210, 0.010))
    sticky["assembly"] = scaled_assembly
    sticky["last_status"] = "Assembly loaded"
else:
    assembly = sticky.get("assembly", [])
    if assembly:
        part = assembly.find_by_key(index)
        all_sticks = [p.attributes.get("shape", None) for p in assembly.parts()]
        sticky["geometry"] = part.attributes.get("shape", None)



if 'compute' in globals() and compute and 'index' in globals():
    results = sticky.get("results", {})
    try:
        part = assembly.find_by_key(index)
        safe_frame = part.attributes.get("safe_frame", None)
        place_frame = part.frame
        

        tolerances = generate_default_tolerances(robot.get_configurable_joints(robot.main_group_name))
        pick_frame = Frame([-0.5,-0.5,0.1], [0,1,0], [1,0,0])

        pick_traj, pick_config, approach_config = calculate_pick_trajectory(pick_frame, robot, start_config = SAFE_CONFIG)

        # Calculate place trajectories (safe, place, return)
        place_results = None

        place_results = calculate_place_trajectories(
            robot,
            current_config = SAFE_CONFIG,
            place_frame = place_frame,
            group=robot.main_group_name
        )

        results[str(index)] = {
            "frame": place_frame,
            "pick_trajectory": pick_traj,
            "approach_config": pick_config,
            "place_trajectories": place_results
        }
        sticky["results"] = results
        print(f"Computed trajectory for frame {index}")

        cm = CollisionMesh(Mesh.from_shape(part.attributes["shape"]), id = "part%d" % index)
        scene.append_collision_mesh(cm)
        sticky["last_status"] = f"Computed: {index}"

    except Exception as e:
        print("Failed for frame {}: {}".format(index, e))
        print(traceback.format_exc())
        sticky["last_status"] = "Error: {}".format(str(e))

results = sticky.get("results", None)
if results is not None and str(index) in results.keys():
    sticky["last_status"] = f"{index:.0f} is computed"
    pick_traj = results[str(index)]["pick_trajectory"]
    place_traj = results[str(index)]["place_trajectories"]
    joined_trajectory = pick_traj.copy()
    joined_trajectory.points.extend(place_traj.points)


assembly = sticky.get("assembly", None)


ghenv.Component.Message = sticky["last_status"][:35]
print(sticky["last_status"])
sticks = sticky.get("geometry", None)

if reset:
    sticky["assembly"] = None
    sticky["geometry"] = None
    sticky["results"] = {}
# ---------- end python_3_script ----------
compas_draw = COMPASDraw(cg=python_3_script.all_sticks)  # -> rg; disabled; same code as draw
compas_draw_2 = COMPASDraw(cg=python_3_script.sticks)  # -> rg; disabled; same code as draw
panel_10 = Panel(python_3_script.out)  # disabled
number_slider_12 = Slider(61, range=0..100)  # disabled
compas_fab_trajectory_visualize = COMPASFABTrajectoryVisualize(robot=compas_fab_attached_tool, trajectory=python_3_script.joined_trajectory)  # -> start_configuration, configurations, fraction, time, planes, P, V, A; inputs group: String; disabled
#   port group: The planning group for which this trajectory was planned.
#   port trajectory: The calculated trajectory.
#   port start_configuration: The start configuration of the trajectory.
#   port configurations: The full configurations along the trajectory.
#   port fraction: Indicates the fraction of requested trajectory that was calculated, e.g. 1 means the full trajectory was found.
#   port time: The time which is needed to execute that trajectory at full speed.
#   port planes: The planes of the robot's end-effector.
#   port P: The positions along the trajectory
#   port V: The velocities along the trajectory
#   port A: The accelerations along the trajectory
# ---------- compas_fab_trajectory_visualize: Python ----------
# r: compas_fab>=1.0.2
"""
Visualizes a trajectory.

COMPAS FAB v1.0.2
"""

import Grasshopper
from compas_ghpython.drawing import draw_frame
from compas_ghpython.sets import list_to_ghtree


class TrajectoryVisualize(Grasshopper.Kernel.GH_ScriptInstance):
    def RunScript(self, robot, group: str, trajectory):
        start_configuration = None
        configurations = []
        fraction = 0.0
        time = 0.0

        planes = []
        positions = []
        velocities = []
        accelerations = []

        if robot and trajectory:
            group = group or robot.main_group_name

            for c in trajectory.points:
                configurations.append(
                    robot.merge_group_with_full_configuration(c, trajectory.start_configuration, group)
                )
                frame = robot.forward_kinematics(c, group, options=dict(solver="model"))
                planes.append(draw_frame(frame))
                positions.append(c.positions)
                velocities.append(c.velocities)
                accelerations.append(c.accelerations)

            start_configuration = trajectory.start_configuration
            fraction = trajectory.fraction
            time = trajectory.time_from_start

        P = list_to_ghtree(list(zip(*positions)))
        V = list_to_ghtree(list(zip(*velocities)))
        A = list_to_ghtree(list(zip(*accelerations)))

        # return outputs if you have them; here I try it for you:
        return (start_configuration, configurations, fraction, time, planes, P, V, A)
# ---------- end compas_fab_trajectory_visualize ----------
list_item = ListItem(List=compas_fab_trajectory_visualize.configurations, Index=number_slider_12, Wrap=invert(True))  # disabled
pln_3 = Plane(compas_fab_trajectory_visualize.planes)  # disabled
boolean_toggle = BooleanToggle(True)  # disabled
boolean_toggle_2 = BooleanToggle(True)  # disabled
boolean_toggle_3 = BooleanToggle(True)  # disabled
boolean_toggle_4 = BooleanToggle(False)  # disabled
boolean_toggle_5 = BooleanToggle(True)  # disabled
# 1. Save your stick assembly in data folder in the parent directory (Example: 201_stick_assembly.ghx)
# 
# 2. Run Docker and connect with the ROS connect component
# 
# 3. Plan for any index and send to robot using the send components.
button_7 = Button()
compas_fab_ros_connect_2 = COMPASFABROSConnect(connect=button_7)  # -> ros_client, is_connected; inputs ip: String, port: Int32, connect: Boolean; same code as compas_fab_ros_connect
compas_fab_robot_visualize = COMPASFABRobotVisualize(
    robot=compas_fab_attached_tool,
    configuration=list_item,
    show_visual=boolean_toggle,
    show_collision=boolean_toggle_2,
    show_frames=boolean_toggle_3,
    show_base_frame=boolean_toggle_4,
    show_end_effector_frame=boolean_toggle_5)  # -> visual, collision, collision_meshes, attached_meshes, frames, base_frame, ee_frame; inputs group: String, show_visual: Boolean, show_collision: Boolean, show_frames: Boolean, show_base_frame: Boolean, show_end_effector_frame: Boolean, show_cm: Boolean, show_acm: Boolean; disabled
#   port group: The planning group used for end-effector and base visualization.
#   port configuration: The robot's full configuration.
#   port show_visual: Whether or not to show the robot's visual meshes.
#   port show_collision: Whether or not to show the robot's collision meshes.
#   port show_frames: Whether or not to show the robot's joint frames.
#   port show_base_frame: Whether or not to show the robot's base frame.
#   port show_end_effector_frame: Whether or not to show the robot's end-effector frame.
#   port show_cm: Whether or not to show the collision meshes (if any).
#   port show_acm: Whether or not to show the attached collision meshes (if any).
#   port visual: Rhino meshes of the robot's visual geometry (if any).
#   port collision: Rhino meshes of the robot's collision geometry (if any).
#   port collision_meshes: Rhino meshes of the scene's collision meshes (if any).
#   port attached_meshes: Rhino meshes of the scene's attached collision meshes (if any).
#   port frames: The robot's joint frames as Rhino planes (if any).
#   port base_frame: The robot's base frame as a Rhino plane (if any).
#   port ee_frame: The robot's end-effector frame as a Rhino plane (if any).
# ---------- compas_fab_robot_visualize: Python ----------
# r: compas_fab>=1.0.2
"""
Visualizes the robot.

COMPAS FAB v1.0.2
"""

import time

import Grasshopper
from compas_ghpython import create_id
from compas_rhino.conversions import frame_to_rhino_plane
from scriptcontext import sticky as st

from compas.geometry import Frame
from compas.geometry import Transformation
from compas.scene import SceneObject
from compas_fab.backends import BackendFeatureNotSupportedError
from compas_fab.robots import PlanningScene


class RobotVisualize(Grasshopper.Kernel.GH_ScriptInstance):
    def RunScript(self,
            robot,
            group: str,
            configuration,
            show_visual: bool,
            show_collision: bool,
            show_frames: bool,
            show_base_frame: bool,
            show_end_effector_frame: bool,
            show_cm: bool,
            show_acm: bool):
        visual = None
        collision = None
        collision_meshes = None
        attached_meshes = None
        frames = None
        base_frame = None
        ee_frame = None

        if robot:
            show_visual = True if show_visual is None else show_visual
            show_cm = True if show_cm is None else show_cm
            show_acm = True if show_acm is None else show_acm
            configuration = configuration or robot.zero_configuration()

            robot.update(configuration, visual=show_visual, collision=show_collision)
            compas_frames = robot.transformed_frames(configuration, group)

            if show_visual:
                visual = robot.scene_object.draw_visual()

            if show_collision:
                collision = robot.scene_object.draw_collision()

            if show_base_frame:
                base_compas_frame = compas_frames[0]
                base_frame = frame_to_rhino_plane(base_compas_frame)

            if show_end_effector_frame:
                options = dict(solver="model")
                if robot.attached_tool:
                    options["link"] = robot.attached_tool.connected_to

                ee_compas_frame = robot.forward_kinematics(configuration, group, options=options)
                ee_frame = frame_to_rhino_plane(ee_compas_frame)

            if show_frames:
                frames = []
                for compas_frame in compas_frames[1:]:
                    frame = frame_to_rhino_plane(compas_frame)
                    frames.append(frame)

            cached_scene_key = create_id(ghenv.Component, "cached_scene")  # noqa: F821

            if show_cm or show_acm:
                cached_scene = st.get(cached_scene_key)
                if not cached_scene:
                    cached_scene = {"time": 0}

                # expire cache if the component has not been executed in the last 2 seconds
                # this allows to slide through a list of configurations
                # without triggering refreshes of the scene in the middle of it
                if time.time() - cached_scene["time"] > 2:
                    update_scene = True
                else:
                    update_scene = False

                if update_scene:
                    scene = PlanningScene(robot)
                    try:
                        scene = robot.client.get_planning_scene()
                    except BackendFeatureNotSupportedError:
                        print(
                            "The selected backend does not support collision meshes. If you need collision mesh support, use a different backend."
                        )
                        scene = None
                        show_cm = False
                        show_acm = False

                if update_scene and show_cm:
                    collision_meshes = []

                    for co in scene.world.collision_objects:
                        header = co.header
                        frame_id = header.frame_id
                        cms = co.to_collision_meshes()

                        for cm in cms:
                            if cm.frame != Frame.worldXY():
                                t = Transformation.from_frame(cm.frame)
                                mesh = cm.mesh.transformed(t)
                            else:
                                mesh = cm.mesh

                            collision_meshes.extend(SceneObject(item=mesh).draw())

                        cached_scene["cm"] = collision_meshes

                collision_meshes = cached_scene.get("cm", [])

                if update_scene and show_acm:
                    attached_meshes = []

                    for aco in scene.robot_state.attached_collision_objects:
                        for acm in aco.to_attached_collision_meshes():
                            frame_id = aco.object["header"]["frame_id"]
                            frame = robot.forward_kinematics(configuration, options=dict(link=frame_id))
                            t = Transformation.from_frame(frame)

                            # Local CM frame
                            if acm.collision_mesh.frame and acm.collision_mesh.frame != Frame.worldXY():
                                t = t * Transformation.from_frame(acm.collision_mesh.frame)

                            mesh = acm.collision_mesh.mesh.transformed(t)

                            attached_meshes.extend(SceneObject(item=mesh).draw())

                    cached_scene["acm"] = attached_meshes

                attached_meshes = cached_scene.get("acm", [])

                cached_scene["time"] = time.time()
                st[cached_scene_key] = cached_scene

        return (
            visual,
            collision,
            collision_meshes,
            attached_meshes,
            frames,
            base_frame,
            ee_frame,
        )
# ---------- end compas_fab_robot_visualize ----------
# Change TCP place as per measurement on the Robot!
button_8 = Button()
compas_fab_ros_robot_2 = COMPASFABROSRobot(ros_client=compas_fab_ros_connect_2.ros_client, load=button_8)  # -> robot; inputs load: Boolean; same code as compas_fab_ros_robot
panel_11 = Panel(compas_fab_ros_connect_2.is_connected)
pln_4 = Plane(compas_fab_robot_visualize.frames)  # disabled
# Send to Robot!
mesh_3 = Mesh(compas_fab_robot_visualize.visual)  # disabled
panel_12 = Panel(compas_fab_ros_robot_2)

# ---- group: Send UR script to Robot!
button_9 = Button()  # disabled
panel_13 = Panel("192.168.10.10")  # disabled
py3_12 = Python3Script(ip_address=panel_13, send=button_9)  # -> out, a; inputs script: String, ip_address: String, send: Boolean; disabled
# ---------- py3_12: Python ----------
import simple_comm as com

if send:
    com.send_script(script,ip_address)
# ---------- end py3_12 ----------

# ----
mesh_4 = Mesh(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)
plane_2 = Plane(Plane(origin=(0.00175, 0.00129, 0.1532), x=(0.7071067812, 0.7071067812, 0), y=(-0.7071067812, 0.7071067812, 0)))
compas_fab_attached_tool_2 = COMPASFABAttachedTool(robot=compas_fab_ros_robot_2, visual_mesh=mesh_4, collision_mesh=mesh_4, tcf_plane=plane_2)  # -> robot; inputs visual_mesh: Mesh, collision_mesh: Mesh; same code as compas_fab_attached_tool
compas_fab_planning_scene_2 = COMPASFABPlanningScene(robot=compas_fab_ros_robot_2)  # -> scene; same code as compas_fab_planning_scene
mesh_5 = Mesh(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)
index_2 = ControlKnob(Decimals=0, Limit=False, Maximum=10, Minimum=0, Range=100, Value=0)
python_3_script_2 = Python3Script(
    scene=compas_fab_planning_scene_2,
    robot=compas_fab_attached_tool_2,
    load=Button(),
    compute=Button(),
    index=index_2,
    env=mesh_5,
    reset=Button())  # -> out, all_sticks, sticks, results, results_list, pick_traj, place_traj, exit_traj, joined_trajectory; inputs index: Int32, env: Mesh
# ---------- python_3_script_2: Python ----------
from compas.datastructures import Assembly, Mesh
from compas.geometry import Frame, Point, Translation, Transformation
from compas_fab.backends import RosClient
from compas_fab.robots import Tool, PlanningScene, CollisionMesh
import os, sys
import math

import traceback

import compas
from compas.data import json_load
from compas_robots import Configuration

compas.PRECISION = "12f"

# Constants
APPROACH_DISTANCE = 0.015  # Meters
group = None
start_configuration = None

# Specify the path to the assembly file and the path to the output file
path = ghenv.Component.OnPingDocument().FilePath
parentdir = os.path.dirname(path)
dire = os.path.join(parentdir, "group_one_scripts")
sys.path.append(dire)

json_path = os.path.join(parentdir, "group_one_data", "stick_assembly.json")
write_path = os.path.join(parentdir, "group_one_data", "stick_assembly_with_trajectories.json")

# Import helpers
from compas_rhino import unload_modules
unload_modules("group_one_helpers")


from compas_rhino.conversions import mesh_to_compas
from group_one_helpers import scale_and_move_to_point, generate_default_tolerances, calculate_pick_trajectory, calculate_place_trajectories
from scriptcontext import sticky

if "last_status" not in sticky or sticky["last_status"] is None:
    sticky["last_status"] = "Idle"

if "geometry" not in sticky or sticky["geometry"] is None:
    pass

SAFE_CONFIG = Configuration.from_revolute_values([math.radians(68.80), 
                                        math.radians(-70.55), 
                                        math.radians(-116.42), 
                                        math.radians(-83.80), 
                                        math.radians(98.73), 
                                        math.radians(56.93)])

if 'load' in globals() and load:
    scene.reset()
    tcm = CollisionMesh(mesh_to_compas(env), id = "table")
    scene.add_collision_mesh(tcm)
    assembly = json_load(json_path)
    scaled_assembly = scale_and_move_to_point(assembly, Point(-0.500, -0.210, 0.010))
    sticky["assembly"] = scaled_assembly
    sticky["last_status"] = "Assembly loaded"
else:
    assembly = sticky.get("assembly", [])
    if assembly:
        part = assembly.find_by_key(index)
        all_sticks = [p.attributes.get("shape", None) for p in assembly.parts()]
        sticky["geometry"] = part.attributes.get("shape", None)



if 'compute' in globals() and compute and 'index' in globals():
    results = sticky.get("results", {})
    try:
        part = assembly.find_by_key(index)
        safe_frame = part.attributes.get("safe_frame", None)
        place_frame = part.frame
        

        tolerances = generate_default_tolerances(robot.get_configurable_joints(robot.main_group_name))

        # Set pick frame
        pick_frame = Frame([0.5,0.5,0.1], [0,1,0], [1,0,0])

        pick_traj, pick_config, approach_config = calculate_pick_trajectory(pick_frame, robot, start_config = SAFE_CONFIG)

        # Calculate place trajectories (safe, place, return)
        place_results = None

        place_results, exit_trajectory = calculate_place_trajectories(
            robot,
            current_config = SAFE_CONFIG,
            placement_frame = place_frame,
            group=robot.main_group_name
        )

        results[str(index)] = {
            "pick_frame": pick_frame,
            "frame": place_frame,
            "pick_trajectory": pick_traj,
            "approach_config": pick_config,
            "place_trajectory": place_results,
            "exit_trajectory": exit_trajectory
        }
        sticky["results"] = results
        print(f"Computed trajectory for frame {index}")

        cm = CollisionMesh(Mesh.from_shape(part.attributes["shape"]), id = "part%d" % index)
        scene.append_collision_mesh(cm)
        sticky["last_status"] = f"Computed: {index}"

    except Exception as e:
        print("Failed for frame {}: {}".format(index, e))
        print(traceback.format_exc())
        sticky["last_status"] = "Error: {}".format(str(e))

results = sticky.get("results", None)
results_list = [results]
if results is not None and str(index) in results.keys():
    sticky["last_status"] = f"{index:.0f} is computed"
    pick_traj = results[str(index)]["pick_trajectory"]
    place_traj = results[str(index)]["place_trajectory"]
    exit_traj = results[str(index)]["exit_trajectory"]
    joined_trajectory = pick_traj.copy()
    joined_trajectory.points.extend(place_traj.points)
    joined_trajectory.points.extend(exit_traj.points)


assembly = sticky.get("assembly", None)


ghenv.Component.Message = sticky["last_status"][:35]
print(sticky["last_status"])
sticks = sticky.get("geometry", None)

if reset:
    sticky["assembly"] = None
    sticky["geometry"] = None
    sticky["results"] = {}
# ---------- end python_3_script_2 ----------
compas_draw_3 = COMPASDraw(cg=python_3_script_2.all_sticks)  # -> rg; same code as draw
compas_draw_4 = COMPASDraw(cg=python_3_script_2.sticks)  # -> rg; same code as draw
compas_fab_trajectory_visualize_2 = COMPASFABTrajectoryVisualize(robot=compas_fab_attached_tool_2, trajectory=python_3_script_2.joined_trajectory)  # -> start_configuration, configurations, fraction, time, planes, P, V, A; inputs group: String; same code as compas_fab_trajectory_visualize
panel_14 = Panel(python_3_script_2.out)
list_item_2 = ListItem(List=compas_fab_trajectory_visualize_2.configurations, Index=Slider(37, range=0..100), Wrap=invert(True))
compas_fab_robot_visualize_2 = COMPASFABRobotVisualize(robot=compas_fab_attached_tool_2, configuration=list_item_2, show_visual=Toggle(False), show_collision=Toggle(True))  # -> visual, collision, collision_meshes, attached_meshes, frames, base_frame, ee_frame; inputs group: String, show_visual: Boolean, show_collision: Boolean, show_frames: Boolean, show_base_frame: Boolean, show_end_effector_frame: Boolean, show_cm: Boolean, show_acm: Boolean; same code as compas_fab_robot_visualize

python_3_script_3 = Python3Script(index=index_2, tcp=plane_2, results=python_3_script_2.results_list)  # -> out, script; inputs index: Int32, tcp: Plane, results: list
# ---------- python_3_script_3: Python ----------
from imp import reload
import sys
import os

# get current file path
path = ghenv.Component.OnPingDocument().FilePath
parentdir = os.path.dirname(path)
dire = os.path.join(parentdir, 'scripts')

sys.path.append(dire)

import simple_ur_script as ur
reload(ur)

import utils
reload(utils)

import simple_comm as com
reload(com)

import compas.geometry as cg
import math as m

from compas_rhino.conversions import plane_to_compas_frame

# ---------- GLOBALS ----------
IO_OPEN = 0     # open gripper
IO_CLOSE = 1    # close gripper
# -----------------------------


# ============================================================
# Trajectory → URScript
# ============================================================

def send_joint_trajectory(script, trajectory):
    """Append URScript moveJ motions for all trajectory points."""
    for point in trajectory.points[:-1]:
        q = point.positions
        script += ur.move_j(list(q), accel=0.25, vel=0.5, radius = 0.05)
    return script


def send_cartesian_frame(script, frame, speed=0.05):
    """Append URScript moveL to a Cartesian Frame."""
    frm = frame.copy()
    script += ur.move_l(frm, accel=0.1, vel=speed)
    return script


# ============================================================
# PICKUP
# ============================================================

def pickup_stick(script, pick_traj, pick_fr):
    """
    1. Follow approach & pick trajectory
    2. Move to pick frame
    3. Close gripper
    """
    script = send_joint_trajectory(script, pick_traj)
    script = send_cartesian_frame(script, pick_fr, speed=0.05)
    script += ur.set_digital_out(IO_CLOSE, True)  # close
    script += ur.sleep(0.5)
    script += ur.textmsg("picked")
    return script


# ============================================================
# PLACE
# ============================================================

def place_stick(script, place_traj, place_fr):
    """
    1. Follow place trajectory
    2. Move to place frame
    3. Open gripper
    """
    place = place_fr.copy()
    place.point.x = -place_fr.point.x
    place.point.y = -place_fr.point.y
    script = send_joint_trajectory(script, place_traj)
    script = send_cartesian_frame(script, place, speed=0.05)
    # Popup to check if glue is set
    script += ur.popup("is it done yet?", "hello")
    script += ur.set_digital_out(IO_CLOSE, False)  # open
    script += ur.sleep(0.5)
    script += ur.textmsg("placed")
    return script


# ============================================================
# MAIN PIPELINE
# ============================================================

results = results[0]

pick_frame = results[str(index)]["pick_frame"]
place_frame = results[str(index)]["frame"]
pick_trajectory = results[str(index)]["pick_trajectory"]
place_trajectory = results[str(index)]["place_trajectory"]
exit_trajectory = results[str(index)]["exit_trajectory"]

script = ""

# Set TCP
script = ur.set_tcp_by_frame(plane_to_compas_frame(tcp))
# Pickup
script = pickup_stick(script, pick_trajectory, pick_frame)
# Place
script = place_stick(script, place_trajectory, place_frame)

# Exit
script = send_joint_trajectory(script, exit_trajectory)


# finalize
script = com.concatenate_script(script)
# ---------- end python_3_script_3 ----------
panel_15 = Panel(python_3_script_3.script)
py3_13 = Python3Script(script=python_3_script_3.script, ip_address="192.168.10.10", send=Button())  # -> out, a; inputs script: String, ip_address: String, send: Boolean; same code as py3_12

# ==== cluster Cluster
L = ClusterInput()
item = ListItem(List=L, Index=0, Wrap=True)  # -> Item1, Item, Item1_2, Item2
vdisex = VectorDisplayEx(Point=item.Item, Vector=item.Item1_2, Colour=ColourSwatch(SwatchColor=RGB(255, 0, 0)), Width="3")
vdisex_2 = VectorDisplayEx(Point=item.Item, Vector=item.Item2, Colour=ColourSwatch(SwatchColor=RGB(0, 255, 60)), Width="3")
vdisex_3 = VectorDisplayEx(Point=item.Item, Vector=item.Item1, Colour=ColourSwatch(SwatchColor=RGB(0, 85, 255)), Width="3")
