# Grasshopper definition 251203_module_C_connecting_FJ.ghx (Grasshopper 1.0.8)

x_distance = Slider(194, range=0..500)
sin_curve_length = Slider(22, range=0..100)
x_distance_2 = Slider(200, range=0..500)
offset_axis_b = Slider(-26, range=-100..100)
module_count = Slider(28, range=0..100)
module_index = Slider(0, range=0..30)
rotation = Slider(0, range=0..2000)
stick_index = Slider(3, range=0..30)
face_index = Slider(0, range=0..30)
offset_axis = Slider(-56, range=-100..100)
python_3_script = Python3Script(x_dist=x_distance_2, y_dist=x_distance, loop_length=sin_curve_length)  # -> out, points; inputs x_dist: Int32, y_dist: Int32, loop_length: Int32
# ---------- python_3_script: Python ----------
import Rhino.Geometry as rg
from math import sin

points = []

for i in range (loop_length):
    pt = rg.Point3d(sin(i)*x_dist, i*y_dist, 0)
    points.append(pt)
# ---------- end python_3_script ----------
xy_plane = XYPlane(Origin=python_3_script.points)

# ----
# base code:
# stick_module_modified_frame
python_3_script_2 = Python3Script(
    root=xy_plane,
    stick_length="200",
    rot_angle=rotation,
    module_count=module_count,
    m_index=module_index,
    s_index=stick_index,
    f_index=face_index,
    offset_axis=offset_axis,
    offset_axis_b=offset_axis_b)  # -> out, geometries, frames; inputs root: Plane, stick_length: Double, rot_angle: Int32, module_count: Int32, m_index: Int32, s_index: Int32, f_index: Int32, offset_axis: Int32, offset_axis_b: Double
# ---------- python_3_script_2: Python ----------
# r: compas>=2.14.1
# venv: sticks

import sys
import os
import math

#get current file path
path = ghenv.Component.OnPingDocument().FilePath
print (path)
#get parent directory of the parent directory
parentdir = os.path.dirname(path)
print (parentdir)
#get src folder which contains classes
dire = os.path.join(parentdir,'group_one_scripts')
print (dire)

sys.path.append(dire)

from compas_rhino import unload_modules

unload_modules("group_one_sticks")
unload_modules("group_one_stick_module")
unload_modules("stick_module_modified_frame") 

import group_one_sticks
from group_one_sticks import Stick 
from stick_module_modified_frame import BranchingModule, BranchStickModules
from compas.geometry import Line, Point, Vector, Frame

stick_width = 10
stick_depth = 10    

from compas_rhino.conversions import plane_to_compas_frame, frame_to_rhino_plane

# Convert input to compas
root = plane_to_compas_frame(root)

# Initialize tree
tree = BranchStickModules(root, stick_length, width=stick_width, depth=stick_depth)
# Grow tree "def grow_stick(self, from_stick_index = -1, face_index = 0, angle = 0.0)""
# for i in range(x_count):
#     if i %2:
#         tree.grow_stick(from_stick_index = i, face_index = 2, angle = rot_angle)
#     else:
#         tree.grow_stick(from_stick_index = i, face_index = 2, angle = -rot_angle*i*factor)

for i in range(module_count):
    tree.grow_module( offset_axis, offset_axis_b, from_module_index=i, from_stick_index=s_index, face_index=f_index, angle = rot_angle)
print(tree)
# # Visualize
geometries = tree.visualize()

 
#frame = tree.sticks[0].frame
frame = tree.modules[0].sticks[0].frame

frames = [stick.frame for module in tree.modules for stick in module.sticks]
# ---------- end python_3_script_2 ----------

list_length = ListLength(List=python_3_script_2.frames)
draw = COMPASDraw(cg=python_3_script_2.geometries)  # -> rg
#   port cg: The COMPAS geometry or datastructure to be drawn.
#   port rg: The Rhino geometry object.
# ---------- draw: Python ----------
# r: compas>=2.14.1
"""
Draws COMPAS geometry in Grasshopper.
"""

from typing import Any

import Grasshopper

from compas.scene import SceneObject


class CompasToRhinoGeometry(Grasshopper.Kernel.GH_ScriptInstance):
    def RunScript(self, cg):
        if not cg:
            return None

        return SceneObject(item=cg).draw()
# ---------- end draw ----------
series = Series(Start=0, Step=1, Count=list_length)
custom_preview = CustomPreview(Geometry=draw, Material=ColourSwatch(SwatchColor=RGB(201, 154, 83)))
gradient = Gradient(
    LowerLimit=0,
    UpperLimit=list_length,
    Parameter=series,
    stops=[0: RGB(128, 255, 255), 0: RGB(255, 130, 160), 0: RGB(4, 60, 97), 0.922: RGB(220, 0, 40)])
custom_preview_2 = CustomPreview(Geometry=draw, Material=gradient)
