# Grasshopper definition 251203_pointcloud_attractor.gh (Grasshopper 1.0.8)

# ----
# move here for shapes
number_slider = Slider(463, range=0..1000)  # disabled

# ----
# position of attractor: 2 = center
number_slider_2 = Slider(2, range=0..10)

# ----
# size rectangle
number_slider_3 = Slider(1000, range=0..1000)

# ----
# Circles with Attractor
# funny shapes
# creates surface of circles
# attractor point
number_slider_4 = Slider(17, range=0..100)  # disabled
number_slider_5 = Slider(30, range=0..500)  # disabled
vec = VectorXYZ(XComponent=number_slider, YComponent=number_slider, ZComponent=0)  # -> Vector, Length; disabled
panel = Panel("2")  # disabled
multiplication = Multiplication(A=number_slider_5, B=panel)  # disabled
series = Series(Start=number_slider_5, Step=multiplication, Count=number_slider_4)  # disabled
cir = Circle(Plane=vec.Vector, Radius=number_slider_5)  # disabled
Y = UnitY(Factor=series)  # disabled
X = UnitX(Factor=series)  # disabled
move = Move(Geometry=cir, Motion=X)  # -> Geometry, Transform; disabled
crossref = CrossReference(ListA=move.Geometry, ListB=Y, CrossMode=1)  # -> ListA, ListB; disabled
pt = Point(<point referenced from the Rhino model>)  # disabled
move_2 = Move(Geometry=crossref.ListA, Motion=crossref.ListB)  # -> Geometry, Transform; disabled
number_slider_6 = Slider(0.1, range=0..1)  # disabled
number_slider_7 = Slider(1, range=0..1)  # disabled
area = Area(Geometry=move_2.Geometry)  # -> Area, Centroid; disabled
dist = Distance(PointA=area.Centroid, PointB=pt)  # disabled
dom = ConstructDomain(DomainStart=number_slider_6, DomainEnd=number_slider_7)  # disabled
bnd = Bounds(Numbers=dist)  # disabled
remap = RemapNumbers(Value=dist, Source=bnd, Target=dom)  # -> Mapped, Clipped; disabled
scale = Scale(Geometry=move_2.Geometry, Center=Point(0, 0, 0), Factor=remap.Mapped)  # -> Geometry, Transform; disabled
gradient = Gradient(LowerLimit=0, UpperLimit=1, Parameter=remap.Mapped, stops=[0.149: RGB(0, 128, 0), 1: RGB(70, 130, 180)])  # disabled
boundary = BoundarySurfaces(Edges=scale.Geometry)  # disabled
preview = CustomPreview(Geometry=boundary, Material=gradient)  # disabled

# ----
# point count
number_slider_8 = Slider(79, range=0..500)

# ----
# seed of population
number_slider_9 = Slider(38, range=0..100)

# ----
# attractor value
number_slider_10 = Slider(1, range=-1..1)

division = Division(A=number_slider_3, B=number_slider_2)
# Pointcloud with Attractor
rectangle = Rectangle(Plane=PlaneXY(0, 0, 0), XSize=number_slider_3, YSize=number_slider_3, Radius=0)  # -> Rectangle, Length
pop2d = Populate2D(Region=rectangle.Rectangle, Count=number_slider_8, Seed=number_slider_9)
pt_2 = ConstructPoint(XCoordinate=division, YCoordinate=division, ZCoordinate=0)
dist_2 = Distance(PointA=pop2d, PointB=pt_2)
vec2pt = Vector2Pt(PointA=pt_2, PointB=pop2d, Unitize=False)  # -> Vector, Length
bnd_2 = Bounds(Numbers=dist_2)
remap_2 = RemapNumbers(Value=dist_2, Source=bnd_2, Target=number_slider_10)  # -> Mapped, Clipped
multiplication_2 = Multiplication(A=vec2pt.Vector, B=remap_2.Mapped)
panel_2 = Panel(remap_2.Mapped)
move_3 = Move(Geometry=pop2d, Motion=multiplication_2)  # -> Geometry, Transform

# ----
# attractor point
pt_3 = Point(<point referenced from the Rhino model>)

pt_4 = Point(pop2d)
pt_5 = Point(pt_4)
pt_6 = Point(pt_5)
panel_3 = Panel("90")

# ---- group: Test for Line Lengths Larer than 'R'
ln = Line(StartPoint=graft(pt_6), EndPoint=pt_6)
len = Length(Curve=ln)
panel_4 = Panel(len)
larger = LargerThan(FirstNumber=len, SecondNumber=panel_3)  # -> LargerThan, OrEqualTo
bool = Boolean(invert(larger.OrEqualTo))
cull = CullPattern(List=ln, CullPattern=bool)

# ----
drawn_polylines = Curve(flatten(cull))
bool_2 = Boolean(True)
clean = CleanTree(RemoveNulls=True, RemoveInvalid=bool_2, RemoveEmpty=False, Tree=drawn_polylines)
crv = Curve(clean)
dupln = RemoveDuplicateLines(Lines=crv, Tolerance=0.01)
end = EndPoints(Curve=dupln)  # -> Start, End
pt_7 = Point([end.Start, end.End])

lng = ListLength(List=dupln)
problem_points = Panel(lng)

cullpt = CullDuplicates(Points=pt_7, Tolerance=0.1, CullMode=3)  # -> Points, Indices, Valence
problem_points_2 = Point(cullpt.Points)
cull_2 = CullPattern(List=problem_points_2, CullPattern=[False, True])

circle = CircleCNR(Center=problem_points_2, Normal=Vector(0, 0, 1), Radius="1")
incurves = PointInCurves(Point=pt_5, Curves=circle)  # -> Relationship, Index, Point
cull_3 = CullPattern(List=pt_5, CullPattern=invert(incurves.Relationship))

number_slider_11 = Slider(1000, range=0..1000)
number_slider_12 = Slider(30, range=0..500)
vec_2 = VectorXYZ(XComponent=number_slider_11, YComponent=number_slider_11, ZComponent=0)  # -> Vector, Length
multiplication_3 = Multiplication(A=number_slider_12, B="2")
series_2 = Series(Start=number_slider_12, Step=multiplication_3, Count=Slider(17, range=0..100))
cir_2 = Circle(Plane=vec_2.Vector, Radius=number_slider_12)
Y_2 = UnitY(Factor=series_2)
X_2 = UnitX(Factor=series_2)
# Circles with Attractor
move_4 = Move(Geometry=cir_2, Motion=X_2)  # -> Geometry, Transform
crossref_2 = CrossReference(ListA=move_4.Geometry, ListB=Y_2, CrossMode=1)  # -> ListA, ListB
move_5 = Move(Geometry=crossref_2.ListA, Motion=crossref_2.ListB)  # -> Geometry, Transform
area_2 = Area(Geometry=move_5.Geometry)  # -> Area, Centroid
dist_3 = Distance(PointA=area_2.Centroid, PointB=pt_3)
dom_2 = ConstructDomain(DomainStart=Slider(0.1, range=0..1), DomainEnd=Slider(1, range=0..1))
bnd_3 = Bounds(Numbers=dist_3)
remap_3 = RemapNumbers(Value=dist_3, Source=bnd_3, Target=dom_2)  # -> Mapped, Clipped
scale_2 = Scale(Geometry=move_5.Geometry, Center=area_2.Centroid, Factor=remap_3.Mapped)  # -> Geometry, Transform
gradient_2 = Gradient(LowerLimit=0, UpperLimit=1, Parameter=remap_3.Mapped, stops=[0.379: RGB(0, 128, 0), 1: RGB(70, 130, 180)])

# ----
# creates surface of circles
boundary_2 = BoundarySurfaces(Edges=scale_2.Geometry)

preview_2 = CustomPreview(Geometry=boundary_2, Material=gradient_2)
