# Grasshopper definition 251208_module_C_connecting_FJ_Ruth_edit.ghx (Grasshopper 1.0.8)

x_dist = Slider(100, range=0..500)  # disabled
x = Slider(3, range=0..10)  # disabled
y = Slider(3, range=0..10)  # disabled
y_dist = Slider(100, range=0..500)  # disabled
rotation = Slider(0, range=0..2000)  # disabled
module_count = Slider(3, range=0..100)  # disabled
face_index = Slider(3, range=0..30)  # disabled
offset_axis = Slider(-74, range=-100..100)  # disabled
offset_axis_b = Slider(-6, range=-100..100)  # disabled
stick_index = Slider(4, range=0..30)  # disabled
python_3_script = Python3Script(x=x, y=y, x_dist=x_dist, y_dist=y_dist)  # -> out, points; inputs x: Int32, y: Int32, x_dist: Int32, y_dist: Int32; disabled
# ---------- python_3_script: Python ----------
import Rhino.Geometry as rg

points = []

for ix in range(x):
    for iy in range(y):
        pt = rg.Point3d(ix * x_dist, iy * y_dist, 0)
        points.append(pt)
# ---------- end python_3_script ----------
xy_plane = XYPlane(Origin=Point(0, 0, 0))  # disabled
panel = Panel("200")  # disabled
offset_axis_x_z = Slider(0, range=-100..100)  # disabled
offset_axis_b_y = Slider(0, range=-100..100)  # disabled
module_count_2 = Slider(4, range=0..100)  # disabled
stick_index_2 = Slider(4, range=0..4)  # disabled
face_index_2 = Slider(1, range=0..3)  # disabled
rotation_2 = Slider(0, range=0..360)  # disabled
panel_2 = Panel(python_3_script.points)  # disabled
xy_plane_2 = XYPlane(Origin=python_3_script.points)  # disabled
xy_plane_3 = XYPlane(Origin=Point(0, 0, 0))  # disabled
panel_3 = Panel("200")  # disabled

# ----
# base code:
# stick_module_modified_frame
python_3_script_2 = Python3Script(
    root=xy_plane,
    stick_length=panel,
    rot_angle=rotation,
    module_count=module_count,
    s_index=stick_index,
    f_index=face_index,
    offset_axis=offset_axis,
    offset_axis_b=offset_axis_b)  # -> out, geometries, frames; inputs root: Plane, stick_length: Double, rot_angle: Int32, module_count: Int32, s_index: Int32, f_index: Int32, offset_axis: Int32, offset_axis_b: Double; disabled
# ---------- python_3_script_2: Python ----------
# r: compas>=2.14.1
# venv: sticks

import sys
import os
import math

#get current file path
path = ghenv.Component.OnPingDocument().FilePath
print (path)
#get parent directory of the parent directory
parentdir = os.path.dirname(path)
print (parentdir)
#get src folder which contains classes
dire = os.path.join(parentdir,'group_one_scripts')
print (dire)

sys.path.append(dire)

from compas_rhino import unload_modules

unload_modules("group_one_sticks")
unload_modules("group_one_stick_module")
unload_modules("stick_module_modified_frame") 

import group_one_sticks
from group_one_sticks import Stick 
from stick_module_modified_frame import BranchingModule, BranchStickModules
from compas.geometry import Line, Point, Vector, Frame

stick_width = 10
stick_depth = 10    

from compas_rhino.conversions import plane_to_compas_frame, frame_to_rhino_plane

# Convert input to compas
root = plane_to_compas_frame(root)

# Initialize tree
tree = BranchStickModules(root, stick_length, width=stick_width, depth=stick_depth)
# Grow tree "def grow_stick(self, from_stick_index = -1, face_index = 0, angle = 0.0)""
# for i in range(x_count):
#     if i %2:
#         tree.grow_stick(from_stick_index = i, face_index = 2, angle = rot_angle)
#     else:
#         tree.grow_stick(from_stick_index = i, face_index = 2, angle = -rot_angle*i*factor)

for i in range(module_count):
    tree.grow_module( offset_axis, offset_axis_b, from_module_index=i, from_stick_index=s_index, face_index=f_index, angle = rot_angle)
print(tree)
# Visualize
geometries = tree.visualize()

 
#frame = tree.sticks[0].frame
frame = tree.modules[0].sticks[0].frame

frames = [stick.frame for module in tree.modules for stick in module.sticks]
# ---------- end python_3_script_2 ----------

# ----
# base code:
# stick_module_modified_frame
python_3_script_3 = Python3Script(
    root=xy_plane_2,
    stick_length=panel_3,
    rot_angle=rotation_2,
    module_count=module_count_2,
    s_index=stick_index_2,
    f_index=face_index_2,
    offset_axis=offset_axis_x_z,
    offset_axis_b=offset_axis_b_y)  # -> out, colors, geometries, frames; inputs root: Plane, stick_length: Double, rot_angle: Int32, module_count: Int32, s_index: Int32, f_index: Int32, offset_axis: Int32, offset_axis_b: Double; disabled
# ---------- python_3_script_3: Python ----------
# r: compas>=2.14.1
# venv: sticks

import sys
import os
import math

#get current file path
path = ghenv.Component.OnPingDocument().FilePath
#get parent directory of the parent directory
parentdir = os.path.dirname(path)
#get src folder which contains classes
dire = os.path.join(parentdir,'group_one_scripts')

sys.path.append(dire)

from compas_rhino import unload_modules

unload_modules("group_one_sticks")
unload_modules("group_one_stick_module")
unload_modules("stick_module_modified_frame_Ruth_edit") 

import group_one_sticks
from group_one_sticks import Stick 
from stick_module_modified_frame_Ruth_edit import BranchStickModules, BranchStickModulesUpdates
from compas.geometry import Line, Point, Vector, Frame

stick_width = 10
stick_depth = 10    

from compas_rhino.conversions import plane_to_compas_frame, frame_to_rhino_plane

# Convert input to compas
root = plane_to_compas_frame(root)

# Initialize tree
tree = BranchStickModulesUpdates(root, stick_length, stick_width, stick_depth)


stick_pattern = [4,2,0]
face_pattern  = [2,0,2]

for i in range(module_count):
    from_module_index = i         
    from_stick_index  = stick_pattern[i % len(stick_pattern)]
    face_index        = face_pattern[i % len(face_pattern)]
    
    angle_for_this_module = i * rot_angle  # 0, 10, 20, 30,... if rot_angle=10

    tree.grow_module(
        offset_axis,
        offset_axis_b,
        from_module_index=from_module_index,
        from_stick_index=from_stick_index,
        face_index=face_index,
        angle=angle_for_this_module
    )
    print(i, "stick_index :", from_stick_index, "// face_index :", face_index, "// angle :", angle_for_this_module)

### skipping root sticks ###
frames = [stick.frame
          for module in tree.modules[1:]    # skip root
          for stick in module.sticks]

# Visualize
geometries = [stick.geometry
              for module in tree.modules[1:]    # skip root module
              for stick in module.sticks]





####   Color with 4 different color to understand the branching method   ####
from System.Drawing import Color

color_1 = Color.FromArgb(255, 100, 0)     # orange
color_2 = Color.FromArgb(0, 150, 255)     # blue
color_3 = Color.FromArgb(0, 200, 80)      # green
color_4 = Color.FromArgb(200, 0, 200)     # magenta

color_list = [color_1, color_2, color_3, color_4]

colors = []

# start from module_index = 1 so we skip the root
for module_index, module in enumerate(tree.modules[1:], start=1):
    col = color_list[module_index % 4]
    for stick in module.sticks:
        colors.append(col)
# ---------- end python_3_script_3 ----------

draw = COMPASDraw(cg=python_3_script_3.geometries)  # -> rg; disabled
#   port cg: The COMPAS geometry or datastructure to be drawn.
#   port rg: The Rhino geometry object.
# ---------- draw: Python ----------
# r: compas>=2.14.1
"""
Draws COMPAS geometry in Grasshopper.
"""

from typing import Any

import Grasshopper

from compas.scene import SceneObject


class CompasToRhinoGeometry(Grasshopper.Kernel.GH_ScriptInstance):
    def RunScript(self, cg):
        if not cg:
            return None

        return SceneObject(item=cg).draw()
# ---------- end draw ----------
draw_2 = COMPASDraw(cg=python_3_script_3.frames)  # -> rg; disabled; same code as draw
draw_3 = COMPASDraw(cg=python_3_script_2.geometries)  # -> rg; disabled; same code as draw
panel_4 = Panel(python_3_script_3.frames)  # disabled
colour_swatch = ColourSwatch(SwatchColor=RGB(201, 154, 83))  # disabled
colour_swatch_2 = ColourSwatch(SwatchColor=RGB(201, 154, 83))  # disabled
custom_preview = CustomPreview(Geometry=draw, Material=python_3_script_3.colors)  # disabled
custom_preview_2 = CustomPreview(Geometry=draw_3, Material=colour_swatch)  # disabled
panel_5 = Panel("0")  # disabled
panel_6 = Panel("300")  # disabled
panel_7 = Panel("-730")  # disabled
panel_8 = Panel("0")  # disabled
panel_9 = Panel("300")  # disabled
panel_10 = Panel("-730")  # disabled
number_slider = Slider(600, range=0..600)  # disabled
number_slider_2 = Slider(600, range=0..600)  # disabled
construct_point = ConstructPoint(XCoordinate=panel_5, YCoordinate=panel_6, ZCoordinate=panel_7)  # disabled
construct_point_2 = ConstructPoint(XCoordinate=panel_8, YCoordinate=panel_9, ZCoordinate=panel_10)  # disabled
center_box = CenterBox(Base=construct_point, X=number_slider, Y=number_slider, Z=number_slider)  # disabled
center_box_2 = CenterBox(Base=construct_point_2, X=number_slider_2, Y=number_slider_2, Z=number_slider_2)  # disabled
rotation_degree = Slider(25, range=-360..360)
circle = Circle(Plane=PlaneXY(0, 0, 0), Radius=Slider(92, range=0..1000))
python_3_script_4 = Python3Script(curve=circle, num_points=Slider(4, range=0..10), rot=rotation_degree)  # -> out, points, planes; inputs curve: Curve, num_points: Int32, rot: Int32
# ---------- python_3_script_4: Python ----------
import Rhino.Geometry as rg
from math import radians

points = []
planes = []

length = curve.GetLength()
length_segments = curve.DivideByCount(num_points, True)

for l in length_segments:
    pt = curve.PointAt(l)
    points.append(pt)

    pl = rg.Plane(pt, rg.Vector3d.XAxis, rg.Vector3d.YAxis)

    angle = radians(rot)

    pl.Rotate(angle, pl.ZAxis, pl.Origin)
    planes.append(pl)

    print('point:', pt, '// angle:', l * rot)
# ---------- end python_3_script_4 ----------
offset_axis_x_z_2 = Slider(0, range=-100..100)
offset_axis_b_y_2 = Slider(0, range=-100..100)
module_count_3 = Slider(0, range=0..100)
stick_index_3 = Slider(4, range=0..4)
face_index_3 = Slider(1, range=0..3)
radians = Radians(Degrees=Slider(0, range=0..360))
rotation_3 = Slider(10, range=0..360)
xy_plane_4 = XYPlane(Origin=Point(0, 0, 0))
xy_plane_5 = XYPlane(Origin=Point(0, 0, 0))
point_list = PointList(Points=python_3_script_4.points, Size=Slider(50, range=0..100))
number_slider_3 = Slider(11, range=0..100)
point_list_2 = PointList(Points=python_3_script_4.points, Size=Slider(50, range=0..100))
rotate_plane = RotatePlane(Plane=xy_plane_4, Angle=radians)

# ----
# base code:
# stick_module_modified_frame
python_3_script_5 = Python3Script(
    root=rotate_plane,
    stick_length="200",
    rot_angle=rotation_3,
    module_count=module_count_3,
    s_index=stick_index_3,
    f_index=face_index_3,
    offset_axis=offset_axis_x_z_2,
    offset_axis_b=offset_axis_b_y_2)  # -> out, colors, sticks, geometries, frames; inputs root: Plane, stick_length: Double, rot_angle: Int32, module_count: Int32, s_index: Int32, f_index: Int32, offset_axis: Int32, offset_axis_b: Double
# ---------- python_3_script_5: Python ----------
# r: compas>=2.14.1
# venv: sticks

import sys
import os
import math

#get current file path
path = ghenv.Component.OnPingDocument().FilePath
#get parent directory of the parent directory
parentdir = os.path.dirname(path)
#get src folder which contains classes
dire = os.path.join(parentdir,'group_one_scripts')

sys.path.append(dire)

from compas_rhino import unload_modules

unload_modules("group_one_sticks")
unload_modules("group_one_stick_module")
unload_modules("stick_module_modified_frame_Ruth_edit") 

import group_one_sticks
from group_one_sticks import Stick 
from stick_module_modified_frame_Ruth_edit import BranchStickModules, BranchStickModulesUpdates
from compas.geometry import Line, Point, Vector, Frame

stick_width = 13
stick_depth = 13  

from compas_rhino.conversions import plane_to_compas_frame, frame_to_rhino_plane

# Convert input to compas
root = plane_to_compas_frame(root)

# Initialize tree
tree = BranchStickModulesUpdates(root, stick_length, stick_width, stick_depth)


stick_pattern = [4,0,4]
face_pattern  = [1,0,3]

for i in range(module_count):
    from_module_index = i         
    from_stick_index  = stick_pattern[i % len(stick_pattern)]
    face_index        = face_pattern[i % len(face_pattern)]
    
    angle_for_this_module = (i+1) * rot_angle  # 0, 10, 20, 30,... if rot_angle=10

    tree.grow_module(
        offset_axis,
        offset_axis_b,
        from_module_index=from_module_index,
        from_stick_index=from_stick_index,
        face_index=face_index,
        angle=angle_for_this_module
    )
    print(i, "stick_index :", from_stick_index, "// face_index :", face_index,  "// angle :", angle_for_this_module )






####   Color with 4 different color to understand the branching method   ####
from System.Drawing import Color

color_1 = Color.FromArgb(255, 100, 0)     # orange
color_2 = Color.FromArgb(0, 150, 255)     # blue
color_3 = Color.FromArgb(0, 200, 80)      # green
color_4 = Color.FromArgb(200, 0, 200)     # magenta

color_list = [color_1, color_2, color_3, color_4]

colors = []

for module_index, module in enumerate(tree.modules):
    col = color_list[module_index % 4]

    for stick in module.sticks:
        colors.append(col)



 
sticks = [stick for module in tree.modules for stick in module.sticks]

geometries = [s.geometry for s in sticks]

# Frame list converted to Rhino planes, like before:
frames = [frame_to_rhino_plane(s.frame) for s in sticks]
# ---------- end python_3_script_5 ----------

draw_4 = COMPASDraw(cg=python_3_script_5.geometries)  # -> rg; same code as draw
panel_11 = Panel(python_3_script_5.frames)
colour_swatch_3 = ColourSwatch(SwatchColor=RGB(201, 154, 83))
compas_draw = COMPASDraw()  # -> rg; same code as draw
custom_preview_3 = CustomPreview(Geometry=draw_4, Material=python_3_script_5.colors)
py3 = Python3Script(sticks=python_3_script_5.sticks, save=Button())  # -> out, frames, assembly; inputs sticks: list, save: Boolean
# ---------- py3: Python ----------
from compas import json_dump
import os, sys
from itertools import combinations
from compas_rhino import unload_modules
from compas.geometry import Line, Plane, Vector, Point

#get current file path
path = ghenv.Component.OnPingDocument().FilePath
#get parent directory of the parent directory
parentdir = os.path.dirname(path)
print(parentdir)

#get src folder which contains classes
dire = os.path.join(parentdir,'group_one_scripts')

sys.path.append(dire)
print(dire)

from sticks_251207 import Stick 

from compas.datastructures import Assembly, Part

json_path = os.path.join(parentdir, 'data', 'stick_assembly_module_zaxis.json')

stick_width = 13.0
stick_depth = 13.0
stick_length = 200

sticks_data = []

###########################################################################
# Make frames point in best direction
###########################################################################
import math
import copy

from compas.geometry import dot_vectors, Rotation
from compas.geometry import centroid_points

def is_parallel(v1, v2):
    if math.isclose(dot_vectors(v1, v2), 1, abs_tol = 0.001) or math.isclose(dot_vectors(v1, v2), -1 ,abs_tol = 0.001):
        # Means it is parallel
        print("parallel")
        return True
    else:
        # Means it is not parallel
        print("not parallel")
        return False

def get_frame_closest_to_target(target_vector, stick):
    best_dot = -1000.0
    for i in range(4):
        angle = math.pi/2 * i
        R = Rotation.from_axis_and_angle(stick.frame.xaxis, angle, stick.frame.point)
        frame = stick.frame.transformed(R)
        dot = dot_vectors(frame.zaxis, target_vector.unitized())
        if dot>best_dot:
            best_dot = dot
            best_frame = frame
            print(i)
    return best_frame

def get_center(sticks_list):
    all_points = [stick.frame.point for stick in sticks_list]
    center = centroid_points(all_points)
    print(center)
    return center

# Copy sticks

sticks_copy = copy.deepcopy(sticks)
center_pt = get_center(sticks_copy)


for stick in sticks_copy:
    if is_parallel(stick.axis.direction.unitized(), Vector(0,0,1)):
        # Target frame is frame pointing into center of structure
        center_vector = Vector.from_start_end(stick.frame.point, center_pt)
        best_frame = get_frame_closest_to_target(center_vector, stick=stick)
        R = Rotation.from_axis_and_angle(stick.frame.xaxis, math.pi, stick.frame.point)
        best_frame.transform(R)
        stick.frame = best_frame

    else:
        # Make sure z axis is pointing down
        R = Rotation.from_axis_and_angle(stick.frame.xaxis, math.pi/2, stick.frame.point)
        stick.frame.transform(R)


from compas_rhino.conversions import frame_to_rhino_plane

sticks_data = [] 
from helpers import sort_sticks_by_z 
sticks_copy = sort_sticks_by_z(sticks_copy)

###########################################################################
# Make frames point in best direction
###########################################################################

assembly = Assembly()
for i, s in enumerate(sticks_copy):
    part_name = "stick"+ str(i)
    part = Part(name = part_name, frame = s.frame)
    part.key = i
    part.attributes["shape"] = s.geometry
    assembly.add_part(part)
    

frames = [frame_to_rhino_plane(p.frame) for p in assembly.parts()]

if save:
    json_dump(assembly, fp=json_path, pretty=True)
# ---------- end py3 ----------
point_list_3 = PointList(Points=py3.frames, Size=Slider(27, range=0..100))

x_distance = Slider(155, range=0..500)  # disabled
y_distance = Slider(70, range=0..500)  # disabled
point_index = Slider(8, range=0..100)  # disabled
x_2 = Slider(10, range=0..10)  # disabled
y_2 = Slider(10, range=0..10)  # disabled
rotation_degree_2 = Slider(5, range=0..360)  # disabled
python_3_script_6 = Python3Script(x=point_index)  # -> out, module_counts; inputs x: Int32; disabled
# ---------- python_3_script_6: Python ----------
min_count = 1
max_count = 3

module_counts = []

span = max_count - min_count      # 2
period = 2 * span                 # 4

for i in range(x):
    k = i % period
    if k < span:
        c = min_count + k         # going up
    else:
        c = max_count - (k - span)  # coming down
    module_counts.append(c)
# ---------- end python_3_script_6 ----------
panel_12 = Panel(python_3_script_6.module_counts)  # disabled
python_3_script_7 = Python3Script(x_dist=x_distance, y_dist=y_distance, loop_length=point_index, x=x_2, y=y_2, rot=rotation_degree_2)  # -> out, points, planes; inputs x_dist: Int32, y_dist: Int32, loop_length: Int32, x: Int32, y: Int32, rot: Int32; disabled
# ---------- python_3_script_7: Python ----------
# import Rhino.Geometry as rg
# from math import sin, cos, tan

# points = []

# for i in range (loop_length):
#     pt = rg.Point3d(sin(i)*x_dist, i*y_dist, 0)
#     points.append(pt)


# for i in range (x):
#     for i in range (y):
#         pt = rg.Point3d(sin(i)*x_dist, i*y_dist, 0)
#         points.append(pt)



import Rhino.Geometry as rg
from math import cos, radians

points = []
planes = []   

for i in range (loop_length):
    pt = rg.Point3d(cos(i) * x_dist, i * y_dist, 0)
    points.append(pt)

    pl = rg.Plane(pt, rg.Vector3d.XAxis, rg.Vector3d.YAxis)
    angle = radians(i * rot)
    pl.Rotate(angle, pl.ZAxis, pl.Origin)

    planes.append(pl)
    print(i, '// point:', pt, '// angle:', i * rot)
# ---------- end python_3_script_7 ----------
offset_axis_x_z_3 = Slider(0, range=-100..100)  # disabled
offset_axis_b_y_3 = Slider(0, range=-100..100)  # disabled
module_count_4 = Slider(1, range=0..100)  # disabled
stick_index_4 = Slider(4, range=0..4)  # disabled
face_index_4 = Slider(1, range=0..3)  # disabled
rotation_4 = Slider(0, range=0..360)  # disabled
number_slider_4 = Slider(50, range=0..100)  # disabled
xy_plane_6 = XYPlane(Origin=Point(0, 0, 0))  # disabled
xy_plane_7 = XYPlane(Origin=Point(0, 0, 0))  # disabled
panel_13 = Panel("200")  # disabled
panel_14 = Panel("cos curve")
point_list_4 = PointList(Points=python_3_script_7.points, Size=number_slider_4)  # disabled
colour_swatch_4 = ColourSwatch(SwatchColor=RGB(201, 154, 83))  # disabled

# ----
# base code:
# stick_module_modified_frame
python_3_script_8 = Python3Script(
    root=python_3_script_7.planes,
    stick_length=panel_13,
    rot_angle=rotation_4,
    module_count=python_3_script_6.module_counts,
    s_index=stick_index_4,
    f_index=face_index_4,
    offset_axis=offset_axis_x_z_3,
    offset_axis_b=offset_axis_b_y_3)  # -> out, colors, geometries, frames; inputs root: Plane, stick_length: Double, rot_angle: Int32, module_count: Int32, s_index: Int32, f_index: Int32, offset_axis: Int32, offset_axis_b: Double; disabled
# ---------- python_3_script_8: Python ----------
# r: compas>=2.14.1
# venv: sticks

import sys
import os
import math

#get current file path
path = ghenv.Component.OnPingDocument().FilePath
#get parent directory of the parent directory
parentdir = os.path.dirname(path)
#get src folder which contains classes
dire = os.path.join(parentdir,'group_one_scripts')

sys.path.append(dire)

from compas_rhino import unload_modules

unload_modules("group_one_sticks")
unload_modules("group_one_stick_module")
unload_modules("stick_module_modified_frame_Ruth_edit") 

import group_one_sticks
from group_one_sticks import Stick 
from stick_module_modified_frame_Ruth_edit import BranchStickModules, BranchStickModulesUpdates
from compas.geometry import Line, Point, Vector, Frame

stick_width = 10
stick_depth = 10    

from compas_rhino.conversions import plane_to_compas_frame, frame_to_rhino_plane

# Convert input to compas
root = plane_to_compas_frame(root)

# Initialize tree
tree = BranchStickModulesUpdates(root, stick_length, stick_width, stick_depth)


stick_pattern = [0,2,3]
face_pattern  = [0,2,2]

for i in range(module_count):
    from_module_index = i         
    from_stick_index  = stick_pattern[i % len(stick_pattern)]
    face_index        = face_pattern[i % len(face_pattern)]
    
    angle_for_this_module = i * rot_angle  # 0, 10, 20, 30,... if rot_angle=10

    tree.grow_module(
        offset_axis,
        offset_axis_b,
        from_module_index=from_module_index,
        from_stick_index=from_stick_index,
        face_index=face_index,
        angle=angle_for_this_module
    )
    print(i, "stick_index :", from_stick_index, "// face_index :", face_index, "// angle :", angle_for_this_module)

### skipping root sticks ###
frames = [stick.frame
          for module in tree.modules[1:]    # skip root
          for stick in module.sticks]

# Visualize
geometries = [stick.geometry
              for module in tree.modules[1:]    # skip root module
              for stick in module.sticks]





####   Color with 4 different color to understand the branching method   ####
from System.Drawing import Color

color_1 = Color.FromArgb(255, 100, 0)     # orange
color_2 = Color.FromArgb(0, 150, 255)     # blue
color_3 = Color.FromArgb(0, 200, 80)      # green
color_4 = Color.FromArgb(200, 0, 200)     # magenta

color_list = [color_1, color_2, color_3, color_4]

colors = []

# start from module_index = 1 so we skip the root
for module_index, module in enumerate(tree.modules[1:], start=1):
    col = color_list[module_index % 4]
    for stick in module.sticks:
        colors.append(col)
# ---------- end python_3_script_8 ----------

draw_5 = COMPASDraw(cg=python_3_script_8.geometries)  # -> rg; disabled; same code as draw
draw_6 = COMPASDraw(cg=python_3_script_8.frames)  # -> rg; disabled; same code as draw
panel_15 = Panel(python_3_script_8.frames)  # disabled
custom_preview_4 = CustomPreview(Geometry=draw_5, Material=python_3_script_8.colors)  # disabled

# ----
# 2x2 grid (2 modules connected on 1st iteration, 4 modules connected on 3rd iteration)
y_3 = Slider(2, range=0..10)  # disabled
x_3 = Slider(2, range=0..10)  # disabled
x_dist_2 = Slider(400, range=0..500)  # disabled
y_dist_2 = Slider(150, range=0..500)  # disabled
rotation_degree_3 = Slider(90, range=0..360)  # disabled
multiplication = Multiplication(A=x_3, B=y_3)  # disabled
python_3_script_9 = Python3Script(x=multiplication)  # -> out, module_counts; inputs x: Int32; disabled; same code as python_3_script_6
panel_16 = Panel(python_3_script_9.module_counts)  # disabled
python_3_script_10 = Python3Script(x=x_3, y=y_3, x_dist=x_dist_2, y_dist=y_dist_2, rot=rotation_degree_3)  # -> out, points, planes; inputs x: Int32, y: Int32, x_dist: Int32, y_dist: Int32, rot: Int32; disabled
# ---------- python_3_script_10: Python ----------
#### NORMAL GRID 0-1-3-2 ####
# import Rhino.Geometry as rg
# from math import sin, radians

# points = []
# planes = []

# counter = 0

# for ix in range(x):
#     for iy in range(y):

#         pt = rg.Point3d(ix * x_dist, iy * y_dist, 0)
#         points.append(pt)

#         pl = rg.Plane(pt, rg.Vector3d.XAxis, rg.Vector3d.YAxis)

#         angle = radians(counter * rot)   

#         pl.Rotate(angle, pl.ZAxis, pl.Origin)
#         planes.append(pl)

        
#         print(counter, '// point:', pt, '// angle:', counter * rot)

#         counter += 1  






#### SNAKE STYLE 0-1-2-3 ####
import Rhino.Geometry as rg
from math import radians

points = []
planes = []

counter = 0

for ix in range(x):

    # Compute index range depending on row number
    if ix % 2 == 0:
        iy_range = range(y)          # normal direction
    else:
        iy_range = range(y-1, -1, -1)  # reverse direction

    for iy in iy_range:

        pt = rg.Point3d(ix * x_dist, iy * y_dist, 0)
        points.append(pt)

        pl = rg.Plane(pt, rg.Vector3d.XAxis, rg.Vector3d.YAxis)

        angle = -radians(counter * rot)
        pl.Rotate(angle, pl.ZAxis, pl.Origin)
        planes.append(pl)

        print(counter, '// point:', pt, '// angle:', counter * rot)

        counter += 1
# ---------- end python_3_script_10 ----------
offset_axis_x_z_4 = Slider(0, range=-100..100)  # disabled
offset_axis_b_y_4 = Slider(0, range=-100..100)  # disabled
module_count_5 = Slider(4, range=0..100)  # disabled
stick_index_5 = Slider(0, range=0..4)  # disabled
face_index_5 = Slider(1, range=0..3)  # disabled
rotation_5 = Slider(8, range=0..360)  # disabled
number_slider_5 = Slider(50, range=0..100)  # disabled
xy_plane_8 = XYPlane(Origin=Point(0, 0, 0))  # disabled
xy_plane_9 = XYPlane(Origin=Point(0, 0, 0))  # disabled
panel_17 = Panel("200")  # disabled
point_list_5 = PointList(Points=python_3_script_10.points, Size=number_slider_5)  # disabled
colour_swatch_5 = ColourSwatch(SwatchColor=RGB(201, 154, 83))  # disabled

# ----
# base code:
# stick_module_modified_frame
python_3_script_11 = Python3Script(
    root=python_3_script_10.planes,
    stick_length=panel_17,
    rot_angle=rotation_5,
    module_count=module_count_5,
    s_index=stick_index_5,
    f_index=face_index_5,
    offset_axis=offset_axis_x_z_4,
    offset_axis_b=offset_axis_b_y_4)  # -> out, colors, sticks, geometries, frames; inputs root: Plane, stick_length: Double, rot_angle: Int32, module_count: Int32, s_index: Int32, f_index: Int32, offset_axis: Int32, offset_axis_b: Double; disabled
# ---------- python_3_script_11: Python ----------
# r: compas>=2.14.1
# venv: sticks

import sys
import os
import math

#get current file path
path = ghenv.Component.OnPingDocument().FilePath
#get parent directory of the parent directory
parentdir = os.path.dirname(path)
#get src folder which contains classes
dire = os.path.join(parentdir,'group_one_scripts')

sys.path.append(dire)

from compas_rhino import unload_modules

unload_modules("group_one_sticks")
unload_modules("group_one_stick_module")
unload_modules("stick_module_modified_frame_Ruth_edit") 

import group_one_sticks
from group_one_sticks import Stick 
from stick_module_modified_frame_Ruth_edit import BranchStickModules, BranchStickModulesUpdates
from compas.geometry import Line, Point, Vector, Frame

stick_width = 10
stick_depth = 10    

from compas_rhino.conversions import plane_to_compas_frame, frame_to_rhino_plane

# Convert input to compas
root = plane_to_compas_frame(root)

# Initialize tree
tree = BranchStickModulesUpdates(root, stick_length, stick_width, stick_depth)


stick_pattern = [0,1,3,4]
face_pattern  = [2,0,3,1]

for i in range(module_count):
    from_module_index = i         
    from_stick_index  = stick_pattern[i % len(stick_pattern)]
    face_index        = face_pattern[i % len(face_pattern)]
    
    angle_for_this_module = i * rot_angle  # 0, 10, 20, 30,... if rot_angle=10

    tree.grow_module(
        offset_axis,
        offset_axis_b,
        from_module_index=from_module_index,
        from_stick_index=from_stick_index,
        face_index=face_index,
        angle=angle_for_this_module
    )
    print(i, "stick_index :", from_stick_index, "// face_index :", face_index, "// angle :", angle_for_this_module)

sticks = []
# sticks = [stick for module in tree.modules for stick in module.sticks]
sticks = [stick for module in tree.modules[1:] for stick in module.sticks]


### skipping root sticks ###
frames = [stick.frame
          for module in tree.modules[1:]    # skip root
          for stick in module.sticks]

frames = [frame_to_rhino_plane(s.frame) for s in sticks]

# Visualize
geometries = [stick.geometry
              for module in tree.modules[1:]    # skip root module
              for stick in module.sticks]


# geometries = [s.geometry for s in sticks]

# Frame list converted to Rhino planes, like before:



####   Color with 4 different color to understand the branching method   ####
from System.Drawing import Color

color_1 = Color.FromArgb(255, 100, 0)     # orange
color_2 = Color.FromArgb(0, 150, 255)     # blue
color_3 = Color.FromArgb(0, 200, 80)      # green
color_4 = Color.FromArgb(200, 0, 200)     # magenta

color_list = [color_1, color_2, color_3, color_4]

colors = []

# start from module_index = 1 so we skip the root
for module_index, module in enumerate(tree.modules[1:], start=1):
    col = color_list[module_index % 4]
    for stick in module.sticks:
        colors.append(col)
# ---------- end python_3_script_11 ----------

# ----
# Convert to JSON file!
button = Button()  # disabled
py3_2 = Python3Script(sticks=flatten(python_3_script_11.sticks), save=button)  # -> out, frames, assembly; inputs sticks: list, save: Boolean; disabled
# ---------- py3_2: Python ----------
from compas import json_dump
import os, sys
from itertools import combinations
from compas_rhino import unload_modules
from compas.geometry import Line, Plane, Vector, Point

#get current file path
path = ghenv.Component.OnPingDocument().FilePath
#get parent directory of the parent directory
parentdir = os.path.dirname(path)
print(parentdir)

#get src folder which contains classes
dire = os.path.join(parentdir,'group_one_scripts')

sys.path.append(dire)
print(dire)

from sticks_251207 import Stick 

from compas.datastructures import Assembly, Part

json_path = os.path.join(parentdir, 'data', 'stick_assembly_16module_ruth.json')

stick_width = 13.0
stick_depth = 13.0
stick_length = 200

sticks_data = []

###########################################################################
# Make frames point in best direction
###########################################################################
import math
import copy

from compas.geometry import dot_vectors, Rotation
from compas.geometry import centroid_points

def is_parallel(v1, v2):
    if math.isclose(dot_vectors(v1, v2), 1, abs_tol = 0.001) or math.isclose(dot_vectors(v1, v2), -1 ,abs_tol = 0.001):
        # Means it is parallel
        print("parallel")
        return True
    else:
        # Means it is not parallel
        print("not parallel")
        return False

def get_frame_closest_to_target(target_vector, stick):
    best_dot = -1000.0
    for i in range(4):
        angle = math.pi/2 * i
        R = Rotation.from_axis_and_angle(stick.frame.xaxis, angle, stick.frame.point)
        frame = stick.frame.transformed(R)
        dot = dot_vectors(frame.zaxis, target_vector.unitized())
        if dot>best_dot:
            best_dot = dot
            best_frame = frame
            print(i)
    return best_frame

def get_center(sticks_list):
    all_points = [stick.frame.point for stick in sticks_list]
    center = centroid_points(all_points)
    print(center)
    return center

# Copy sticks

sticks_copy = copy.deepcopy(sticks)
center_pt = get_center(sticks_copy)


for stick in sticks_copy:
    if is_parallel(stick.axis.direction.unitized(), Vector(0,0,1)):
        # Target frame is frame pointing into center of structure
        center_vector = Vector.from_start_end(stick.frame.point, center_pt)
        best_frame = get_frame_closest_to_target(center_vector, stick=stick)
        stick.frame = best_frame

    else:
        # Make sure z axis is pointing down
        R = Rotation.from_axis_and_angle(stick.frame.xaxis, math.pi/2, stick.frame.point)
        stick.frame.transform(R)

from compas_rhino.conversions import frame_to_rhino_plane

###########################################################################
# Make frames point in best direction
###########################################################################

assembly = Assembly()
for i, s in enumerate(sticks_copy):
    part_name = "stick"+ str(i)
    part = Part(name = part_name, frame = s.frame)
    part.key = i
    part.attributes["shape"] = s.geometry
    assembly.add_part(part)
    

frames = [frame_to_rhino_plane(p.frame) for p in assembly.parts()]

if save:
    json_dump(assembly, fp=json_path, pretty=True)
# ---------- end py3_2 ----------
number_slider_6 = Slider(14, range=0..100)  # disabled
point_list_6 = PointList(Points=py3_2.frames, Size=number_slider_6)  # disabled

draw_7 = COMPASDraw(cg=python_3_script_11.geometries)  # -> rg; disabled; same code as draw
panel_18 = Panel(python_3_script_11.sticks)  # disabled
custom_preview_5 = CustomPreview(Geometry=draw_7, Material=python_3_script_11.colors)  # disabled

panel_19 = Panel(py3_2.frames)  # disabled

x_4 = Slider(2, range=0..10)  # disabled
y_4 = Slider(2, range=0..10)  # disabled
x_dist_3 = Slider(50, range=0..500)  # disabled
y_dist_3 = Slider(50, range=0..500)  # disabled
rotation_degree_4 = Slider(90, range=0..360)  # disabled
multiplication_2 = Multiplication(A=x_4, B=y_4)  # disabled
python_3_script_12 = Python3Script(x=multiplication_2)  # -> out, module_counts; inputs x: Int32; disabled; same code as python_3_script_6
panel_20 = Panel(python_3_script_12.module_counts)  # disabled
python_3_script_13 = Python3Script(x=x_4, y=y_4, x_dist=x_dist_3, y_dist=y_dist_3, rot=rotation_degree_4)  # -> out, points, planes; inputs x: Int32, y: Int32, x_dist: Int32, y_dist: Int32, rot: Int32; disabled; same code as python_3_script_10
offset_axis_x_z_5 = Slider(0, range=-100..100)  # disabled
offset_axis_b_y_5 = Slider(0, range=-100..100)  # disabled
module_count_6 = Slider(4, range=0..100)  # disabled
stick_index_6 = Slider(4, range=0..4)  # disabled
face_index_6 = Slider(1, range=0..3)  # disabled
rotation_6 = Slider(10, range=0..360)  # disabled
number_slider_7 = Slider(50, range=0..100)  # disabled
xy_plane_10 = XYPlane(Origin=Point(0, 0, 0))  # disabled
xy_plane_11 = XYPlane(Origin=Point(0, 0, 0))  # disabled
panel_21 = Panel("200")  # disabled
panel_22 = Panel("""2x2 grid
rotated clockwise""")
point_list_7 = PointList(Points=python_3_script_13.points, Size=number_slider_7)  # disabled
colour_swatch_6 = ColourSwatch(SwatchColor=RGB(201, 154, 83))  # disabled

# ----
# base code:
# stick_module_modified_frame
python_3_script_14 = Python3Script(
    root=python_3_script_13.planes,
    stick_length=panel_21,
    rot_angle=rotation_6,
    module_count=module_count_6,
    s_index=stick_index_6,
    f_index=face_index_6,
    offset_axis=offset_axis_x_z_5,
    offset_axis_b=offset_axis_b_y_5)  # -> out, colors, geometries, frames; inputs root: Plane, stick_length: Double, rot_angle: Int32, module_count: Int32, s_index: Int32, f_index: Int32, offset_axis: Int32, offset_axis_b: Double; disabled
# ---------- python_3_script_14: Python ----------
# r: compas>=2.14.1
# venv: sticks

import sys
import os
import math

#get current file path
path = ghenv.Component.OnPingDocument().FilePath
#get parent directory of the parent directory
parentdir = os.path.dirname(path)
#get src folder which contains classes
dire = os.path.join(parentdir,'group_one_scripts')

sys.path.append(dire)

from compas_rhino import unload_modules

unload_modules("group_one_sticks")
unload_modules("group_one_stick_module")
unload_modules("stick_module_modified_frame_Ruth_edit") 

import group_one_sticks
from group_one_sticks import Stick 
from stick_module_modified_frame_Ruth_edit import BranchStickModules, BranchStickModulesUpdates
from compas.geometry import Line, Point, Vector, Frame

stick_width = 10
stick_depth = 10    

from compas_rhino.conversions import plane_to_compas_frame, frame_to_rhino_plane

# Convert input to compas
root = plane_to_compas_frame(root)

# Initialize tree
tree = BranchStickModulesUpdates(root, stick_length, stick_width, stick_depth)


stick_pattern = [0,2,1,4]
face_pattern  = [0,2,0,0]

for i in range(module_count):
    from_module_index = i         
    from_stick_index  = stick_pattern[i % len(stick_pattern)]
    face_index        = face_pattern[i % len(face_pattern)]
    
    angle_for_this_module = i * rot_angle  # 0, 10, 20, 30,... if rot_angle=10

    tree.grow_module(
        offset_axis,
        offset_axis_b,
        from_module_index=from_module_index,
        from_stick_index=from_stick_index,
        face_index=face_index,
        angle=angle_for_this_module
    )
    print(i, "stick_index :", from_stick_index, "// face_index :", face_index, "// angle :", angle_for_this_module)

### skipping root sticks ###
frames = [stick.frame
          for module in tree.modules[1:]    # skip root
          for stick in module.sticks]

# Visualize
geometries = [stick.geometry
              for module in tree.modules[1:]    # skip root module
              for stick in module.sticks]





####   Color with 4 different color to understand the branching method   ####
from System.Drawing import Color

color_1 = Color.FromArgb(255, 100, 0)     # orange
color_2 = Color.FromArgb(0, 150, 255)     # blue
color_3 = Color.FromArgb(0, 200, 80)      # green
color_4 = Color.FromArgb(200, 0, 200)     # magenta

color_list = [color_1, color_2, color_3, color_4]

colors = []

# start from module_index = 1 so we skip the root
for module_index, module in enumerate(tree.modules[1:], start=1):
    col = color_list[module_index % 4]
    for stick in module.sticks:
        colors.append(col)
# ---------- end python_3_script_14 ----------

draw_8 = COMPASDraw(cg=python_3_script_14.geometries)  # -> rg; disabled; same code as draw
draw_9 = COMPASDraw(cg=python_3_script_14.frames)  # -> rg; disabled; same code as draw
panel_23 = Panel(python_3_script_14.frames)
custom_preview_6 = CustomPreview(Geometry=draw_8, Material=python_3_script_14.colors)  # disabled

# ----
# 3 points extracted from a circle
number_slider_8 = Slider(7, range=0..1000)  # disabled
rotation_degree_5 = Slider(9, range=0..360)  # disabled
number_slider_9 = Slider(3, range=0..10)  # disabled
circle_2 = Circle(Plane=PlaneXY(0, 0, 0), Radius=number_slider_8)  # disabled
python_3_script_15 = Python3Script(curve=circle_2, num_points=number_slider_9, rot=rotation_degree_5)  # -> out, points, planes; inputs curve: Curve, num_points: Int32, rot: Int32; disabled
# ---------- python_3_script_15: Python ----------
import Rhino.Geometry as rg
from math import radians

points = []
planes = []

length = curve.GetLength()
length_segments = curve.DivideByCount(num_points, True)

for l in length_segments:
    pt = curve.PointAt(l)
    points.append(pt)

    pl = rg.Plane(pt, rg.Vector3d.XAxis, rg.Vector3d.YAxis)

    angle = radians(l * rot)

    pl.Rotate(angle, pl.ZAxis, pl.Origin)
    planes.append(pl)

    print(pt)
# ---------- end python_3_script_15 ----------
number_slider_10 = Slider(50, range=0..100)  # disabled
offset_axis_x_z_6 = Slider(0, range=-100..100)  # disabled
offset_axis_b_y_6 = Slider(0, range=-100..100)  # disabled
module_count_7 = Slider(3, range=0..100)  # disabled
stick_index_7 = Slider(0, range=0..4)  # disabled
face_index_7 = Slider(1, range=0..3)  # disabled
rotation_7 = Slider(15, range=0..360)  # disabled
point_list_8 = PointList(Points=python_3_script_15.points, Size=number_slider_10)  # disabled
xy_plane_12 = XYPlane(Origin=Point(0, 0, 0))  # disabled
panel_24 = Panel("200")  # disabled
colour_swatch_7 = ColourSwatch(SwatchColor=RGB(201, 154, 83))  # disabled

# ----
# base code:
# stick_module_modified_frame
python_3_script_16 = Python3Script(
    root=python_3_script_15.planes,
    stick_length=panel_24,
    rot_angle=rotation_7,
    module_count=module_count_7,
    s_index=stick_index_7,
    f_index=face_index_7,
    offset_axis=offset_axis_x_z_6,
    offset_axis_b=offset_axis_b_y_6)  # -> out, colors, geometries, frames; inputs root: Plane, stick_length: Double, rot_angle: Int32, module_count: Int32, s_index: Int32, f_index: Int32, offset_axis: Int32, offset_axis_b: Double; disabled
# ---------- python_3_script_16: Python ----------
# r: compas>=2.14.1
# venv: sticks

import sys
import os
import math

#get current file path
path = ghenv.Component.OnPingDocument().FilePath
#get parent directory of the parent directory
parentdir = os.path.dirname(path)
#get src folder which contains classes
dire = os.path.join(parentdir,'group_one_scripts')

sys.path.append(dire)

from compas_rhino import unload_modules

unload_modules("group_one_sticks")
unload_modules("group_one_stick_module")
unload_modules("stick_module_modified_frame_Ruth_edit") 

import group_one_sticks
from group_one_sticks import Stick 
from stick_module_modified_frame_Ruth_edit import BranchStickModules, BranchStickModulesUpdates
from compas.geometry import Line, Point, Vector, Frame

stick_width = 10
stick_depth = 10    

from compas_rhino.conversions import plane_to_compas_frame, frame_to_rhino_plane

# Convert input to compas
root = plane_to_compas_frame(root)

# Initialize tree
tree = BranchStickModulesUpdates(root, stick_length, stick_width, stick_depth)


stick_pattern = [2,2,0,4]
face_pattern  = [0,0,0,3]

for i in range(module_count):
    from_module_index = i         
    from_stick_index  = stick_pattern[i % len(stick_pattern)]
    face_index        = face_pattern[i % len(face_pattern)]
    
    angle_for_this_module = i * rot_angle  # 0, 10, 20, 30,... if rot_angle=10

    tree.grow_module(
        offset_axis,
        offset_axis_b,
        from_module_index=from_module_index,
        from_stick_index=from_stick_index,
        face_index=face_index,
        angle=angle_for_this_module
    )
    print(i, "stick_index :", from_stick_index, "// face_index :", face_index, "// angle :", angle_for_this_module)

### skipping root sticks ###
frames = [stick.frame
          for module in tree.modules[1:]    # skip root
          for stick in module.sticks]

# Visualize
geometries = [stick.geometry
              for module in tree.modules[1:]    # skip root module
              for stick in module.sticks]





####   Color with 4 different color to understand the branching method   ####
from System.Drawing import Color

color_1 = Color.FromArgb(255, 100, 0)     # orange
color_2 = Color.FromArgb(0, 150, 255)     # blue
color_3 = Color.FromArgb(0, 200, 80)      # green
color_4 = Color.FromArgb(200, 0, 200)     # magenta

color_list = [color_1, color_2, color_3, color_4]

colors = []

# start from module_index = 1 so we skip the root
for module_index, module in enumerate(tree.modules[1:], start=1):
    col = color_list[module_index % 4]
    for stick in module.sticks:
        colors.append(col)
# ---------- end python_3_script_16 ----------

draw_10 = COMPASDraw(cg=python_3_script_16.geometries)  # -> rg; disabled; same code as draw
draw_11 = COMPASDraw(cg=python_3_script_16.frames)  # -> rg; disabled; same code as draw
panel_25 = Panel(python_3_script_16.frames)  # disabled
custom_preview_7 = CustomPreview(Geometry=draw_10, Material=python_3_script_16.colors)  # disabled

number_slider_11 = Slider(141, range=0..1000)  # disabled
panel_26 = Panel("DOES NOT WORK")
rotation_degree_6 = Slider(0, range=-360..360)  # disabled
number_slider_12 = Slider(4, range=0..10)  # disabled
circle_3 = Circle(Plane=PlaneXY(0, 0, 0), Radius=number_slider_11)  # disabled
python_3_script_17 = Python3Script(curve=circle_3, num_points=number_slider_12, rot=rotation_degree_6)  # -> out, points, planes; inputs curve: Curve, num_points: Int32, rot: Int32; disabled
# ---------- python_3_script_17: Python ----------
import Rhino.Geometry as rg
from math import radians

points = []
planes = []

length = curve.GetLength()
length_segments = curve.DivideByCount(num_points, True)

for l in length_segments:
    pt = curve.PointAt(l)
    points.append(pt)

    pl = rg.Plane(pt, rg.Vector3d.XAxis, rg.Vector3d.YAxis)

    angle = radians(l * rot)

    pl.Rotate(angle, pl.ZAxis, pl.Origin)
    planes.append(pl)

    print('point:', pt, '// angle:', l * rot)
# ---------- end python_3_script_17 ----------
number_slider_13 = Slider(50, range=0..100)  # disabled
offset_axis_x_z_7 = Slider(0, range=-100..100)  # disabled
offset_axis_b_y_7 = Slider(0, range=-100..100)  # disabled
module_count_8 = Slider(0, range=0..100)  # disabled
stick_index_8 = Slider(0, range=0..4)  # disabled
face_index_8 = Slider(1, range=0..3)  # disabled
rotation_8 = Slider(0, range=0..360)  # disabled
point_list_9 = PointList(Points=python_3_script_17.points, Size=number_slider_13)  # disabled
xy_plane_13 = XYPlane(Origin=Point(0, 0, 0))  # disabled
panel_27 = Panel("200")  # disabled
colour_swatch_8 = ColourSwatch(SwatchColor=RGB(201, 154, 83))  # disabled

# ----
# base code:
# stick_module_modified_frame
python_3_script_18 = Python3Script(
    root=python_3_script_17.planes,
    stick_length=panel_27,
    rot_angle=rotation_8,
    module_count=module_count_8,
    s_index=stick_index_8,
    f_index=face_index_8,
    offset_axis=offset_axis_x_z_7,
    offset_axis_b=offset_axis_b_y_7)  # -> out, colors, geometries, frames; inputs root: Plane, stick_length: Double, rot_angle: Int32, module_count: Int32, s_index: Int32, f_index: Int32, offset_axis: Int32, offset_axis_b: Double; disabled
# ---------- python_3_script_18: Python ----------
# r: compas>=2.14.1
# venv: sticks

import sys
import os
import math

#get current file path
path = ghenv.Component.OnPingDocument().FilePath
#get parent directory of the parent directory
parentdir = os.path.dirname(path)
#get src folder which contains classes
dire = os.path.join(parentdir,'group_one_scripts')

sys.path.append(dire)

from compas_rhino import unload_modules

unload_modules("group_one_sticks")
unload_modules("group_one_stick_module")
unload_modules("stick_module_modified_frame_Ruth_edit") 

import group_one_sticks
from group_one_sticks import Stick 
from stick_module_modified_frame_Ruth_edit import BranchStickModules, BranchStickModulesUpdates
from compas.geometry import Line, Point, Vector, Frame

stick_width = 13
stick_depth = 13  

from compas_rhino.conversions import plane_to_compas_frame, frame_to_rhino_plane

# Convert input to compas
root = plane_to_compas_frame(root)

# Initialize tree
tree = BranchStickModulesUpdates(root, stick_length, stick_width, stick_depth)


stick_pattern = [0,1]
face_pattern  = [0,3]

for i in range(module_count):
    from_module_index = i         
    from_stick_index  = stick_pattern[i % len(stick_pattern)]
    face_index        = face_pattern[i % len(face_pattern)]
    
    angle_for_this_module = (i) * rot_angle  # 0, 10, 20, 30,... if rot_angle=10

    tree.grow_module(
        offset_axis,
        offset_axis_b,
        from_module_index=from_module_index,
        from_stick_index=from_stick_index,
        face_index=face_index,
        angle=angle_for_this_module
    )
    print(i, "stick_index :", from_stick_index, "// face_index :", face_index )

# Visualize
geometries = tree.visualize()




####   Color with 4 different color to understand the branching method   ####
from System.Drawing import Color

color_1 = Color.FromArgb(255, 100, 0)     # orange
color_2 = Color.FromArgb(0, 150, 255)     # blue
color_3 = Color.FromArgb(0, 200, 80)      # green
color_4 = Color.FromArgb(200, 0, 200)     # magenta

color_list = [color_1, color_2, color_3, color_4]

colors = []

for module_index, module in enumerate(tree.modules):
    col = color_list[module_index % 4]

    for stick in module.sticks:
        colors.append(col)



 
#frame = tree.sticks[0].frame
frame = tree.modules[0].sticks[0].frame

frames = [stick.frame for module in tree.modules for stick in module.sticks]
# ---------- end python_3_script_18 ----------

draw_12 = COMPASDraw(cg=python_3_script_18.geometries)  # -> rg; disabled; same code as draw
draw_13 = COMPASDraw(cg=python_3_script_18.frames)  # -> rg; disabled; same code as draw
panel_28 = Panel(python_3_script_18.frames)  # disabled
custom_preview_8 = CustomPreview(Geometry=draw_12, Material=python_3_script_18.colors)  # disabled

# ----
# 4 points extract from a circle, not rotated but connected
number_slider_14 = Slider(115, range=0..1000)  # disabled
rotation_degree_7 = Slider(55, range=-360..360)  # disabled
number_slider_15 = Slider(5, range=0..10)  # disabled
circle_4 = Circle(Plane=PlaneXY(0, 0, 0), Radius=number_slider_14)  # disabled
python_3_script_19 = Python3Script(curve=circle_4, num_points=number_slider_15, rot=rotation_degree_7)  # -> out, points, planes; inputs curve: Curve, num_points: Int32, rot: Int32; disabled
# ---------- python_3_script_19: Python ----------
import Rhino.Geometry as rg
from math import radians

points = []
planes = []

length = curve.GetLength()
length_segments = curve.DivideByCount(num_points, True)

for i, l in enumerate(length_segments):
    pt = curve.PointAt(l)
    points.append(pt)

    pl = rg.Plane(pt, rg.Vector3d.XAxis, rg.Vector3d.YAxis)

    angle = radians(rot*(i+1))

    pl.Rotate(angle, pl.ZAxis, pl.Origin)
    planes.append(pl)

    # print(i, '// length_segments:', l, '// point:', pt, '// angle:', rot*(i+1))
    print(i, '// angle:', rot*(i+1))
# ---------- end python_3_script_19 ----------
number_slider_16 = Slider(50, range=0..100)  # disabled
offset_axis_x_z_8 = Slider(0, range=-100..100)  # disabled
offset_axis_b_y_8 = Slider(0, range=-100..100)  # disabled
module_count_9 = Slider(0, range=0..100)  # disabled
rotation_9 = Slider(7, range=0..360)  # disabled
number_slider_17 = Slider(50, range=0..100)  # disabled
xy_plane_14 = XYPlane(Origin=Point(0, 0, 0))  # disabled
xy_plane_15 = XYPlane(Origin=Point(0, 0, 0))  # disabled
panel_29 = Panel("200")  # disabled
point_list_10 = PointList(Points=python_3_script_19.points, Size=number_slider_16)  # disabled
number_slider_18 = Slider(11, range=0..100)  # disabled
point_list_11 = PointList(Points=python_3_script_19.points, Size=number_slider_17)  # disabled
panel_30 = Panel("0")  # disabled
panel_31 = Panel("300")  # disabled
panel_32 = Panel("-730")  # disabled
colour_swatch_9 = ColourSwatch(SwatchColor=RGB(201, 154, 83))  # disabled
number_slider_19 = Slider(600, range=0..600)  # disabled
construct_point_3 = ConstructPoint(XCoordinate=panel_30, YCoordinate=panel_31, ZCoordinate=panel_32)  # disabled
center_box_3 = CenterBox(Base=construct_point_3, X=number_slider_19, Y=number_slider_19, Z=number_slider_19)  # disabled
colour_swatch_10 = ColourSwatch(SwatchColor=RGB(76, 60, 35))  # disabled
button_2 = Button()  # disabled
custom_preview_9 = CustomPreview(Geometry=center_box_3, Material=colour_swatch_10)  # disabled

# ----
# base code:
# stick_module_modified_frame
python_3_script_20 = Python3Script(
    root=python_3_script_19.planes,
    stick_length=panel_29,
    rot_angle=rotation_9,
    module_count=module_count_9,
    offset_axis=offset_axis_x_z_8,
    offset_axis_b=offset_axis_b_y_8)  # -> out, colors, sticks, geometries, frames; inputs root: Plane, stick_length: Double, rot_angle: Int32, module_count: Int32, offset_axis: Int32, offset_axis_b: Double; disabled
# ---------- python_3_script_20: Python ----------
# r: compas>=2.14.1
# venv: sticks

import sys
import os
import math

#get current file path
path = ghenv.Component.OnPingDocument().FilePath
#get parent directory of the parent directory
parentdir = os.path.dirname(path)
#get src folder which contains classes
dire = os.path.join(parentdir,'group_one_scripts')

sys.path.append(dire)

from compas_rhino import unload_modules

unload_modules("group_one_sticks")
unload_modules("group_one_stick_module")
unload_modules("stick_module_modified_frame_Ruth_edit") 

import group_one_sticks
from group_one_sticks import Stick 
from stick_module_modified_frame_Ruth_edit import BranchStickModules, BranchStickModulesUpdates
from compas.geometry import Line, Point, Vector, Frame

stick_width = 13
stick_depth = 13  

from compas_rhino.conversions import plane_to_compas_frame, frame_to_rhino_plane

# Convert input to compas
root = plane_to_compas_frame(root)

# Initialize tree
tree = BranchStickModulesUpdates(root, stick_length, stick_width, stick_depth)


stick_pattern = [4,4]
face_pattern  = [0,3]

for i in range(module_count):
    from_module_index = i         
    from_stick_index  = stick_pattern[i % len(stick_pattern)]
    face_index        = face_pattern[i % len(face_pattern)]
    
    angle_for_this_module = (i+1) * rot_angle  # 0, 10, 20, 30,... if rot_angle=10

    tree.grow_module(
        offset_axis,
        offset_axis_b,
        from_module_index=from_module_index,
        from_stick_index=from_stick_index,
        face_index=face_index,
        angle=angle_for_this_module
    )
    print(i, "stick_index :", from_stick_index, "// face_index :", face_index,  "// angle :", angle_for_this_module )






####   Color with 4 different color to understand the branching method   ####
from System.Drawing import Color

color_1 = Color.FromArgb(255, 100, 0)     # orange
color_2 = Color.FromArgb(0, 150, 255)     # blue
color_3 = Color.FromArgb(0, 200, 80)      # green
color_4 = Color.FromArgb(200, 0, 200)     # magenta

color_list = [color_1, color_2, color_3, color_4]

colors = []

for module_index, module in enumerate(tree.modules):
    col = color_list[module_index % 4]

    for stick in module.sticks:
        colors.append(col)



sticks = [stick for module in tree.modules for stick in module.sticks]

geometries = [s.geometry for s in sticks]

frames = [frame_to_rhino_plane(s.frame) for s in sticks]
# ---------- end python_3_script_20 ----------

draw_14 = COMPASDraw(cg=python_3_script_20.geometries)  # -> rg; disabled; same code as draw
draw_15 = COMPASDraw(cg=python_3_script_20.frames)  # -> rg; disabled; same code as draw
panel_33 = Panel(python_3_script_20.frames)  # disabled
custom_preview_10 = CustomPreview(Geometry=draw_14, Material=python_3_script_20.colors)  # disabled
py3_3 = Python3Script(sticks=python_3_script_20.sticks, save=button_2)  # -> out, frames, assembly; inputs sticks: list, save: Boolean; disabled
# ---------- py3_3: Python ----------
from compas import json_dump
import os, sys
from itertools import combinations
from compas_rhino import unload_modules
from compas.geometry import Line, Plane, Vector, Point

#get current file path
path = ghenv.Component.OnPingDocument().FilePath
#get parent directory of the parent directory
parentdir = os.path.dirname(path)
#get src folder which contains classes
dire = os.path.join(parentdir,'scripts')

sys.path.append(dire)

from stick import Stick 

from compas.datastructures import Assembly, Part

json_path = os.path.join(parentdir, 'data', 'stick_assembly.json')

stick_width = 13.0
stick_depth = 13.0
stick_length = 200

sticks_data = []

###########################################################################
# Make frames point in best direction
###########################################################################
import math
import copy

from compas.geometry import dot_vectors, Rotation
from compas.geometry import centroid_points

def is_parallel(v1, v2):
    if math.isclose(dot_vectors(v1, v2), 1, abs_tol = 0.001) or math.isclose(dot_vectors(v1, v2), -1 ,abs_tol = 0.001):
        # Means it is parallel
        print("parallel")
        return True
    else:
        # Means it is not parallel
        print("not parallel")
        return False

def get_frame_closest_to_target(target_vector, stick):
    best_dot = -1000.0
    for i in range(4):
        angle = math.pi/2 * i
        R = Rotation.from_axis_and_angle(stick.frame.xaxis, angle, stick.frame.point)
        frame = stick.frame.transformed(R)
        dot = dot_vectors(frame.zaxis, target_vector.unitized())
        if dot>best_dot:
            best_dot = dot
            best_frame = frame
            print(i)
    return best_frame

def get_center(sticks_list):
    all_points = [stick.frame.point for stick in sticks_list]
    center = centroid_points(all_points)
    print(center)
    return center

# Copy sticks

sticks_copy = copy.deepcopy(sticks)
center_pt = get_center(sticks_copy)


for stick in sticks_copy:
    if is_parallel(stick.axis.direction.unitized(), Vector(0,0,1)):
        # Target frame is frame pointing into center of structure
        center_vector = Vector.from_start_end(stick.frame.point, center_pt)
        best_frame = get_frame_closest_to_target(center_vector, stick=stick)
        stick.frame = best_frame

    else:
        # Make sure z axis is pointing down
        R = Rotation.from_axis_and_angle(stick.frame.xaxis, math.pi/2, stick.frame.point)
        stick.frame.transform(R)

from compas_rhino.conversions import frame_to_rhino_plane

###########################################################################
# Make frames point in best direction
###########################################################################

assembly = Assembly()
for i, s in enumerate(sticks_copy):
    part_name = "stick"+ str(i)
    part = Part(name = part_name, frame = s.frame)
    part.key = i
    part.attributes["shape"] = s.geometry
    assembly.add_part(part)
    

frames = [frame_to_rhino_plane(p.frame) for p in assembly.parts()]

if save:
    json_dump(assembly, fp=json_path, pretty=True)
# ---------- end py3_3 ----------

# ----
# 4 points extract from a circle, not rotated but connected
number_slider_20 = Slider(92, range=0..1000)  # disabled
rotation_degree_8 = Slider(25, range=-360..360)  # disabled
number_slider_21 = Slider(4, range=0..10)  # disabled
circle_5 = Circle(Plane=PlaneXY(0, 0, 0), Radius=number_slider_20)  # disabled
python_3_script_21 = Python3Script(curve=circle_5, num_points=number_slider_21, rot=rotation_degree_8)  # -> out, points, planes; inputs curve: Curve, num_points: Int32, rot: Int32; disabled; same code as python_3_script_4
number_slider_22 = Slider(50, range=0..100)  # disabled
offset_axis_x_z_9 = Slider(0, range=-100..100)  # disabled
offset_axis_b_y_9 = Slider(0, range=-100..100)  # disabled
module_count_10 = Slider(2, range=0..100)  # disabled
stick_index_9 = Slider(4, range=0..4)  # disabled
face_index_9 = Slider(1, range=0..3)  # disabled
rotation_10 = Slider(10, range=0..360)  # disabled
number_slider_23 = Slider(50, range=0..100)  # disabled
xy_plane_16 = XYPlane(Origin=Point(0, 0, 0))  # disabled
xy_plane_17 = XYPlane(Origin=Point(0, 0, 0))  # disabled
panel_34 = Panel("200")  # disabled
point_list_12 = PointList(Points=python_3_script_21.points, Size=number_slider_22)  # disabled
number_slider_24 = Slider(11, range=0..100)  # disabled
point_list_13 = PointList(Points=python_3_script_21.points, Size=number_slider_23)  # disabled
panel_35 = Panel("0")  # disabled
panel_36 = Panel("300")  # disabled
panel_37 = Panel("-730")  # disabled
colour_swatch_11 = ColourSwatch(SwatchColor=RGB(201, 154, 83))  # disabled
number_slider_25 = Slider(600, range=0..600)  # disabled
construct_point_4 = ConstructPoint(XCoordinate=panel_35, YCoordinate=panel_36, ZCoordinate=panel_37)  # disabled
center_box_4 = CenterBox(Base=construct_point_4, X=number_slider_25, Y=number_slider_25, Z=number_slider_25)  # disabled
colour_swatch_12 = ColourSwatch(SwatchColor=RGB(76, 60, 35))  # disabled
button_3 = Button()  # disabled
custom_preview_11 = CustomPreview(Geometry=center_box_4, Material=colour_swatch_12)  # disabled

# ----
# base code:
# stick_module_modified_frame
python_3_script_22 = Python3Script(
    root=python_3_script_21.planes,
    stick_length=panel_34,
    rot_angle=rotation_10,
    module_count=module_count_10,
    s_index=stick_index_9,
    f_index=face_index_9,
    offset_axis=offset_axis_x_z_9,
    offset_axis_b=offset_axis_b_y_9)  # -> out, colors, sticks, geometries, frames; inputs root: Plane, stick_length: Double, rot_angle: Int32, module_count: Int32, s_index: Int32, f_index: Int32, offset_axis: Int32, offset_axis_b: Double; disabled
# ---------- python_3_script_22: Python ----------
# r: compas>=2.14.1
# venv: sticks

import sys
import os
import math

#get current file path
path = ghenv.Component.OnPingDocument().FilePath
#get parent directory of the parent directory
parentdir = os.path.dirname(path)
#get src folder which contains classes
dire = os.path.join(parentdir,'group_one_scripts')

sys.path.append(dire)

from compas_rhino import unload_modules

unload_modules("group_one_sticks")
unload_modules("group_one_stick_module")
unload_modules("stick_module_modified_frame_Ruth_edit") 

import group_one_sticks
from group_one_sticks import Stick 
from stick_module_modified_frame_Ruth_edit import BranchStickModules, BranchStickModulesUpdates
from compas.geometry import Line, Point, Vector, Frame

stick_width = 13
stick_depth = 13  

from compas_rhino.conversions import plane_to_compas_frame, frame_to_rhino_plane

# Convert input to compas
root = plane_to_compas_frame(root)

# Initialize tree
tree = BranchStickModulesUpdates(root, stick_length, stick_width, stick_depth)


stick_pattern = [4,0,4]
face_pattern  = [1,0,3]

for i in range(module_count):
    from_module_index = i         
    from_stick_index  = stick_pattern[i % len(stick_pattern)]
    face_index        = face_pattern[i % len(face_pattern)]
    
    angle_for_this_module = (i+1) * rot_angle  # 0, 10, 20, 30,... if rot_angle=10

    tree.grow_module(
        offset_axis,
        offset_axis_b,
        from_module_index=from_module_index,
        from_stick_index=from_stick_index,
        face_index=face_index,
        angle=angle_for_this_module
    )
    print(i, "stick_index :", from_stick_index, "// face_index :", face_index,  "// angle :", angle_for_this_module )






####   Color with 4 different color to understand the branching method   ####
from System.Drawing import Color

color_1 = Color.FromArgb(255, 100, 0)     # orange
color_2 = Color.FromArgb(0, 150, 255)     # blue
color_3 = Color.FromArgb(0, 200, 80)      # green
color_4 = Color.FromArgb(200, 0, 200)     # magenta

color_list = [color_1, color_2, color_3, color_4]

colors = []

for module_index, module in enumerate(tree.modules):
    col = color_list[module_index % 4]

    for stick in module.sticks:
        colors.append(col)



sticks = [stick for module in tree.modules for stick in module.sticks]

geometries = [s.geometry for s in sticks]

frames = [frame_to_rhino_plane(s.frame) for s in sticks]
# ---------- end python_3_script_22 ----------

draw_16 = COMPASDraw(cg=python_3_script_22.geometries)  # -> rg; disabled; same code as draw
draw_17 = COMPASDraw(cg=python_3_script_22.frames)  # -> rg; disabled; same code as draw
panel_38 = Panel(python_3_script_22.frames)  # disabled
custom_preview_12 = CustomPreview(Geometry=draw_16, Material=python_3_script_22.colors)  # disabled
py3_4 = Python3Script(sticks=python_3_script_22.sticks, save=button_3)  # -> out, frames, assembly; inputs sticks: list, save: Boolean; disabled; same code as py3_3

x_5 = Slider(3, range=0..10)  # disabled
y_5 = Slider(2, range=0..10)  # disabled
rotation_degree_9 = Slider(5, range=0..360)  # disabled
y_dist_4 = Slider(221, range=0..500)  # disabled
x_dist_4 = Slider(217, range=0..500)  # disabled
multiplication_3 = Multiplication(A=x_5, B=y_5)  # disabled
python_3_script_23 = Python3Script(x=multiplication_3)  # -> out, module_counts; inputs x: Int32; disabled; same code as python_3_script_6
panel_39 = Panel(python_3_script_23.module_counts)  # disabled
python_3_script_24 = Python3Script(x=x_5, y=y_5, x_dist=x_dist_4, y_dist=y_dist_4, rot=rotation_degree_9)  # -> out, points, planes; inputs x: Int32, y: Int32, x_dist: Int32, y_dist: Int32, rot: Int32; disabled
# ---------- python_3_script_24: Python ----------
### NORMAL GRID 0-1-3-2 ####
import Rhino.Geometry as rg
from math import sin, radians

points = []
planes = []

counter = 0

for ix in range(x):
    for iy in range(y):

        pt = rg.Point3d(ix * x_dist, iy * y_dist, 0)
        points.append(pt)

        pl = rg.Plane(pt, rg.Vector3d.XAxis, rg.Vector3d.YAxis)

        angle = radians(counter * rot)   

        pl.Rotate(angle, pl.ZAxis, pl.Origin)
        planes.append(pl)

        
        print(counter, '// point:', pt, '// angle:', counter * rot)

        counter += 1
# ---------- end python_3_script_24 ----------
offset_axis_x_z_10 = Slider(0, range=-100..100)  # disabled
offset_axis_b_y_10 = Slider(0, range=-100..100)  # disabled
module_count_11 = Slider(0, range=0..100)  # disabled
stick_index_10 = Slider(4, range=0..4)  # disabled
face_index_10 = Slider(1, range=0..3)  # disabled
rotation_11 = Slider(33, range=0..360)  # disabled
number_slider_26 = Slider(50, range=0..100)  # disabled
xy_plane_18 = XYPlane(Origin=Point(0, 0, 0))  # disabled
xy_plane_19 = XYPlane(Origin=Point(0, 0, 0))  # disabled
panel_40 = Panel("200")  # disabled
panel_41 = Panel("PERCOBAAN MASIH")
point_list_14 = PointList(Points=python_3_script_24.points, Size=number_slider_26)  # disabled
colour_swatch_13 = ColourSwatch(SwatchColor=RGB(201, 154, 83))  # disabled

# ----
# base code:
# stick_module_modified_frame
python_3_script_25 = Python3Script(
    root=python_3_script_24.planes,
    stick_length=panel_40,
    rot_angle=rotation_11,
    module_count=module_count_11,
    s_index=stick_index_10,
    f_index=face_index_10,
    offset_axis=offset_axis_x_z_10,
    offset_axis_b=offset_axis_b_y_10)  # -> out, colors, geometries, frames; inputs root: Plane, stick_length: Double, rot_angle: Int32, module_count: Int32, s_index: Int32, f_index: Int32, offset_axis: Int32, offset_axis_b: Double; disabled
# ---------- python_3_script_25: Python ----------
# r: compas>=2.14.1
# venv: sticks

import sys
import os
import math

#get current file path
path = ghenv.Component.OnPingDocument().FilePath
#get parent directory of the parent directory
parentdir = os.path.dirname(path)
#get src folder which contains classes
dire = os.path.join(parentdir,'group_one_scripts')

sys.path.append(dire)

from compas_rhino import unload_modules

unload_modules("group_one_sticks")
unload_modules("group_one_stick_module")
unload_modules("stick_module_modified_frame_Ruth_edit") 

import group_one_sticks
from group_one_sticks import Stick 
from stick_module_modified_frame_Ruth_edit import BranchStickModules, BranchStickModulesUpdates
from compas.geometry import Line, Point, Vector, Frame

stick_width = 13
stick_depth = 13  

from compas_rhino.conversions import plane_to_compas_frame, frame_to_rhino_plane

# Convert input to compas
root = plane_to_compas_frame(root)

# Initialize tree
tree = BranchStickModulesUpdates(root, stick_length, stick_width, stick_depth)


stick_pattern = [0,1]
face_pattern  = [0,3]

for i in range(module_count):
    from_module_index = i         
    from_stick_index  = stick_pattern[i % len(stick_pattern)]
    face_index        = face_pattern[i % len(face_pattern)]
    
    angle_for_this_module = (i+1) * rot_angle  # 0, 10, 20, 30,... if rot_angle=10

    tree.grow_module(
        offset_axis,
        offset_axis_b,
        from_module_index=from_module_index,
        from_stick_index=from_stick_index,
        face_index=face_index,
        angle=angle_for_this_module
    )
    print(i, "stick_index :", from_stick_index, "// face_index :", face_index )

# Visualize
geometries = tree.visualize()




####   Color with 4 different color to understand the branching method   ####
from System.Drawing import Color

color_1 = Color.FromArgb(255, 100, 0)     # orange
color_2 = Color.FromArgb(0, 150, 255)     # blue
color_3 = Color.FromArgb(0, 200, 80)      # green
color_4 = Color.FromArgb(200, 0, 200)     # magenta

color_list = [color_1, color_2, color_3, color_4]

colors = []

for module_index, module in enumerate(tree.modules):
    col = color_list[module_index % 4]

    for stick in module.sticks:
        colors.append(col)



 
#frame = tree.sticks[0].frame
frame = tree.modules[0].sticks[0].frame

frames = [stick.frame for module in tree.modules for stick in module.sticks]
# ---------- end python_3_script_25 ----------

draw_18 = COMPASDraw(cg=python_3_script_25.geometries)  # -> rg; disabled; same code as draw
draw_19 = COMPASDraw(cg=python_3_script_25.frames)  # -> rg; disabled; same code as draw
panel_42 = Panel(python_3_script_25.frames)  # disabled
custom_preview_13 = CustomPreview(Geometry=draw_18, Material=python_3_script_25.colors)  # disabled

# ----
# sin curve
# 
# cuman 4 biji ajaaaaaa
# 
# COBA YAK
rotation_degree_10 = Slider(20, range=-360..360)  # disabled
x_distance_2 = Slider(137, range=0..500)  # disabled
point_index_2 = Slider(8, range=0..100)  # disabled
x_6 = Slider(10, range=0..10)  # disabled
y_6 = Slider(10, range=0..10)  # disabled
y_distance_2 = Slider(114, range=0..500)  # disabled
python_3_script_26 = Python3Script(x=point_index_2)  # -> out, module_counts; inputs x: Int32; disabled; same code as python_3_script_6
panel_43 = Panel(python_3_script_26.module_counts)  # disabled
python_3_script_27 = Python3Script(x_dist=x_distance_2, y_dist=y_distance_2, loop_length=point_index_2, x=x_6, y=y_6, rot=rotation_degree_10)  # -> out, points, planes; inputs x_dist: Int32, y_dist: Int32, loop_length: Int32, x: Int32, y: Int32, rot: Int32; disabled
# ---------- python_3_script_27: Python ----------
# import Rhino.Geometry as rg
# from math import sin, cos, tan

# points = []

# for i in range (loop_length):
#     pt = rg.Point3d(sin(i)*x_dist, i*y_dist, 0)
#     points.append(pt)


# for i in range (x):
#     for i in range (y):
#         pt = rg.Point3d(sin(i)*x_dist, i*y_dist, 0)
#         points.append(pt)



import Rhino.Geometry as rg
from math import sin, cos, radians

points = []
planes = []   

for i in range (loop_length):
    pt = rg.Point3d(i* x_dist, sin(i) * y_dist, 0)
    points.append(pt)

    pl = rg.Plane(pt, rg.Vector3d.XAxis, rg.Vector3d.YAxis)
    angle = radians(i * rot)
    pl.Rotate(angle, pl.ZAxis, pl.Origin)

    planes.append(pl)
    print(i, '// point:', pt, '// angle:', i * rot)
# ---------- end python_3_script_27 ----------
offset_axis_x_z_11 = Slider(0, range=-100..100)  # disabled
offset_axis_b_y_11 = Slider(0, range=-100..100)  # disabled
module_count_12 = Slider(1, range=0..100)  # disabled
stick_index_11 = Slider(4, range=0..4)  # disabled
face_index_11 = Slider(1, range=0..3)  # disabled
rotation_12 = Slider(0, range=0..360)  # disabled
number_slider_27 = Slider(50, range=0..100)  # disabled
xy_plane_20 = XYPlane(Origin=Point(0, 0, 0))  # disabled
xy_plane_21 = XYPlane(Origin=Point(0, 0, 0))  # disabled
panel_44 = Panel("200")  # disabled
point_list_15 = PointList(Points=python_3_script_27.points, Size=number_slider_27)  # disabled
colour_swatch_14 = ColourSwatch(SwatchColor=RGB(201, 154, 83))  # disabled

# ----
# base code:
# stick_module_modified_frame
python_3_script_28 = Python3Script(
    root=python_3_script_27.planes,
    stick_length=panel_44,
    rot_angle=rotation_12,
    module_count=module_count_12,
    s_index=stick_index_11,
    f_index=face_index_11,
    offset_axis=offset_axis_x_z_11,
    offset_axis_b=offset_axis_b_y_11)  # -> out, colors, geometries, frames; inputs root: Plane, stick_length: Double, rot_angle: Int32, module_count: Int32, s_index: Int32, f_index: Int32, offset_axis: Int32, offset_axis_b: Double; disabled
# ---------- python_3_script_28: Python ----------
# r: compas>=2.14.1
# venv: sticks

import sys
import os
import math

#get current file path
path = ghenv.Component.OnPingDocument().FilePath
#get parent directory of the parent directory
parentdir = os.path.dirname(path)
#get src folder which contains classes
dire = os.path.join(parentdir,'group_one_scripts')

sys.path.append(dire)

from compas_rhino import unload_modules

unload_modules("group_one_sticks")
unload_modules("group_one_stick_module")
unload_modules("stick_module_modified_frame_Ruth_edit") 

import group_one_sticks
from group_one_sticks import Stick 
from stick_module_modified_frame_Ruth_edit import BranchStickModules, BranchStickModulesUpdates
from compas.geometry import Line, Point, Vector, Frame

stick_width = 13
stick_depth = 13    

from compas_rhino.conversions import plane_to_compas_frame, frame_to_rhino_plane

# Convert input to compas
root = plane_to_compas_frame(root)

# Initialize tree
tree = BranchStickModulesUpdates(root, stick_length, stick_width, stick_depth)


stick_pattern = [2,2,3]
face_pattern  = [0,2,2]

for i in range(module_count):
    from_module_index = i         
    from_stick_index  = stick_pattern[i % len(stick_pattern)]
    face_index        = face_pattern[i % len(face_pattern)]
    
    angle_for_this_module = i * rot_angle  # 0, 10, 20, 30,... if rot_angle=10

    tree.grow_module(
        offset_axis,
        offset_axis_b,
        from_module_index=from_module_index,
        from_stick_index=from_stick_index,
        face_index=face_index,
        angle=angle_for_this_module
    )
    print(i, "stick_index :", from_stick_index, "// face_index :", face_index, "// angle :", angle_for_this_module)

### skipping root sticks ###
frames = [stick.frame
          for module in tree.modules[1:]    # skip root
          for stick in module.sticks]

# Visualize
geometries = [stick.geometry
              for module in tree.modules[1:]    # skip root module
              for stick in module.sticks]





####   Color with 4 different color to understand the branching method   ####
from System.Drawing import Color

color_1 = Color.FromArgb(255, 100, 0)     # orange
color_2 = Color.FromArgb(0, 150, 255)     # blue
color_3 = Color.FromArgb(0, 200, 80)      # green
color_4 = Color.FromArgb(200, 0, 200)     # magenta

color_list = [color_1, color_2, color_3, color_4]

colors = []

# start from module_index = 1 so we skip the root
for module_index, module in enumerate(tree.modules[1:], start=1):
    col = color_list[module_index % 4]
    for stick in module.sticks:
        colors.append(col)
# ---------- end python_3_script_28 ----------

draw_20 = COMPASDraw(cg=python_3_script_28.geometries)  # -> rg; disabled; same code as draw
draw_21 = COMPASDraw(cg=python_3_script_28.frames)  # -> rg; disabled; same code as draw
panel_45 = Panel(python_3_script_28.frames)  # disabled
custom_preview_14 = CustomPreview(Geometry=draw_20, Material=python_3_script_28.colors)  # disabled
