# Grasshopper definition 251210_module_c_uncoordinated_mess.ghx (Grasshopper 1.0.8)

# ----
# position of attractor: 2 = center
number_slider = Slider(2, range=0..10)

# ----
# size rectangle
number_slider_2 = Slider(1000, range=0..1000)

x_distance = Slider(200, range=0..500)  # disabled
x_distance_2 = Slider(194, range=0..500)  # disabled
sin_curve_length = Slider(22, range=0..100)  # disabled
module_count = Slider(15, range=0..100)  # disabled
python_3_script = Python3Script(x_dist=x_distance, y_dist=x_distance_2, loop_length=sin_curve_length)  # -> out, points; inputs x_dist: Int32, y_dist: Int32, loop_length: Int32; disabled
# ---------- python_3_script: Python ----------
import Rhino.Geometry as rg
from math import sin

points = []

for i in range (loop_length):
    pt = rg.Point3d(sin(i)*x_dist, i*y_dist, 0)
    points.append(pt)
# ---------- end python_3_script ----------

# ----
# point count
number_slider_3 = Slider(28, range=0..500)

# ----
# seed of population
number_slider_4 = Slider(21, range=0..100)

# ----
# Point-Grid
# try %2 move Z by self.depth
number_slider_5 = Slider(4, range=0..15)
py3 = Python3Script(
    x_count=number_slider_5,
    y_count=Slider(4, range=0..15),
    x_space=Slider(200, range=0..200),
    y_space=Slider(200, range=0..200))  # -> out, points; inputs x_count: Int32, y_count: Int32, x_space: Double, y_space: Double
# ---------- py3: Python ----------
import Rhino.Geometry as rg

points = []
for i in range (x_count):
    for j in range (y_count):
        pt = rg.Point3d(i*x_space, j*y_space, 0)
        rg.Point3d()
        points.append(pt)
# ---------- end py3 ----------

# ----
# Pointcloud with Attractor
# attractor value
number_slider_6 = Slider(-0.44, range=-1..1)

division = Division(A=number_slider_2, B=number_slider)
rectangle = Rectangle(Plane=PlaneXY(0, 0, 0), XSize=number_slider_2, YSize=number_slider_2, Radius=0)  # -> Rectangle, Length
pt = ConstructPoint(XCoordinate=division, YCoordinate=division, ZCoordinate=0)
pop2d = Populate2D(Region=rectangle.Rectangle, Count=number_slider_3, Seed=number_slider_4)
dist = Distance(PointA=pop2d, PointB=pt)
vec2pt = Vector2Pt(PointA=pt, PointB=pop2d, Unitize=False)  # -> Vector, Length
bnd = Bounds(Numbers=dist)
remap = RemapNumbers(Value=dist, Source=bnd, Target=number_slider_6)  # -> Mapped, Clipped
multiplication = Multiplication(A=vec2pt.Vector, B=remap.Mapped)
panel = Panel(remap.Mapped)
move = Move(Geometry=pop2d, Motion=multiplication)  # -> Geometry, Transform

stick_index = Slider(2, range=0..30)
module_count_2 = Slider(16, range=0..100)
module_index = Slider(0, range=0..30)
face_index = Slider(1, range=0..30)
rotation = Slider(0, range=0..2000)
module_index_2 = Slider(0, range=0..30)
stick_index_2 = Slider(0, range=0..30)
face_index_2 = Slider(1, range=0..30)
offset_axis = Slider(0, range=-100..100)
offset_axis_b = Slider(0, range=-100..100)
offset_axis_b_2 = Slider(0, range=-100..100)
offset_axis_b_3 = Slider(0, range=-100..100)
pt_2 = Point([<point referenced from the Rhino model> x2])  # disabled
module_count_3 = Slider(16, range=0..100)
rotation_2 = Slider(0, range=0..2000)
pt_3 = Point([<point referenced from the Rhino model> x2])  # disabled
offset_z_axis = Slider(3, range=-100..100)  # disabled
offset_x_axis = Slider(-40, range=-100..100)  # disabled
offset_y_axis = Slider(0, range=-100..100)  # disabled
offset_axis_2 = Slider(-5, range=-100..100)
offset_axis_b_4 = Slider(7, range=-100..100)
offset_axis_b_5 = Slider(0, range=-100..100)
offset_z_axis_2 = Slider(3, range=-100..100)  # disabled
offset_x_axis_2 = Slider(-40, range=-100..100)  # disabled
offset_y_axis_2 = Slider(0, range=-100..100)  # disabled
pt_4 = Point(Point(136.8416506, -368.4985018, -136.2966754))
pt_5 = Point(Point(-134.371641, -380.1185434, 0))  # disabled
pt_6 = Point(Point(-256.797109, -924.8519761, 0))  # disabled
yz = YZPlane(Origin=pt_4)
stick_index_3 = Slider(2, range=0..4)  # disabled
face_index_3 = Slider(3, range=0..3)  # disabled
rotation_3 = Slider(0, range=0..2000)  # disabled
module_index_3 = Slider(0, range=0..30)  # disabled
number_slider_7 = Slider(0, range=-2..4)  # disabled
stick_index_4 = Slider(2, range=0..4)  # disabled
face_index_4 = Slider(3, range=0..3)  # disabled
rotation_4 = Slider(0, range=0..2000)  # disabled
module_count_4 = Slider(15, range=0..100)  # disabled
module_index_4 = Slider(0, range=0..30)  # disabled
number_slider_8 = Slider(0, range=-2..4)  # disabled
number_slider_9 = Slider(4, range=0..4)  # disabled
number_slider_10 = Slider(0, range=0..3)  # disabled
number_slider_11 = Slider(4, range=0..4)  # disabled
number_slider_12 = Slider(0, range=0..3)  # disabled
xy_plane = XYPlane(Origin=pt_4)
xy_plane_2 = XYPlane(Origin=pt_3)
xy_plane_3 = XYPlane(Origin=pt_5)  # disabled
rotation_5 = Slider(0, range=0..2000)
module_count_5 = Slider(25, range=0..100)
module_index_5 = Slider(0, range=0..30)
stick_index_5 = Slider(4, range=0..4)
face_index_5 = Slider(1, range=0..3)
offset_x_axis_3 = Slider(0, range=-100..100)
offset_y_axis_3 = Slider(0, range=-100..100)
offset_z_axis_3 = Slider(-1, range=-100..100)
panel_2 = Panel("200")  # disabled
xy_plane_4 = XYPlane(Origin=pt_6)  # disabled
panel_3 = Panel("200")  # disabled
xy_plane_5 = XYPlane(Origin=pt_2)
rotate = Rotate(Geometry=xy_plane, Angle=Slider(0, range=0..3), Plane=xy_plane)  # -> Geometry, Transform
# base code:
# stick_module_modified_frame
python_3_script_2 = Python3Script(
    root=xy_plane_2,
    stick_length="200",
    rot_angle=rotation,
    module_count=module_count_2,
    m_index=module_index,
    s_index=stick_index,
    f_index=face_index,
    offset_xxis=offset_axis,
    offset_yxis=offset_axis_b_3,
    offset_zxis=offset_axis_b,
    output_frame=offset_axis_b_2)  # -> out, geometries, frames, modules_C; inputs root: Plane, stick_length: Double, rot_angle: Int32, module_count: Int32, m_index: Int32, s_index: Int32, f_index: Int32, offset_xxis: Int32, offset_yxis: Double
# ---------- python_3_script_2: Python ----------
# r: compas>=2.14.1
# venv: sticks

import sys
import os
import math

#get current file path
path = ghenv.Component.OnPingDocument().FilePath
print (path)
#get parent directory of the parent directory
parentdir = os.path.dirname(path)
print (parentdir)
#get src folder which contains classes
dire = os.path.join(parentdir,'scripts')
print (dire)

sys.path.append(dire)

from compas_rhino import unload_modules

# unload_modules("group_one_sticks")
unload_modules("scripts")
unload_modules("stick_module_modified")
unload_modules("251203_module_C_connecting_FJ_safecopy") 

import Sticks
from Sticks import Stick 
from stick_module_modified_frame_safecopy import BranchingModule, BranchStickModules
from compas.geometry import Line, Point, Vector, Frame

stick_width = 10
stick_depth = 10    

from compas_rhino.conversions import plane_to_compas_frame, frame_to_rhino_plane

# Convert input to compas
root = plane_to_compas_frame(root)

# Initialize tree
tree = BranchStickModules(root, stick_length, width=stick_width, depth=stick_depth)
# Grow tree "def grow_stick(self, from_stick_index = -1, face_index = 0, angle = 0.0)""
# for i in range(x_count):
#     if i %2:
#         tree.grow_stick(from_stick_index = i, face_index = 2, angle = rot_angle)
#     else:
#         tree.grow_stick(from_stick_index = i, face_index = 2, angle = -rot_angle*i*factor)
modules_C = []
for i in range(module_count):
    mod = tree.grow_module(  offset_xxis, offset_yxis, offset_zxis, from_module_index=i, from_stick_index=s_index, face_index=f_index, angle = rot_angle)
    modules_C.append(mod)

print(tree)
# # Visualize
geometries = tree.visualize()
modules_C = tree.visualize()

 
#frame = tree.sticks[0].frame
frame = tree.modules[0].sticks[0].frame

frames = [stick.frame for module in tree.modules for stick in module.sticks]
# ---------- end python_3_script_2 ----------
pln = Plane(rotate.Geometry)
# base code:
# stick_module_modified_frame
python_3_script_3 = Python3Script(
    root=xy_plane_3,
    stick_length=panel_2,
    rot_angle=rotation_3,
    module_count=module_count,
    m_index=module_index_3,
    s_index=stick_index_3,
    f_index=face_index_3,
    offset_xxis=offset_x_axis,
    offset_yxis=offset_y_axis,
    offset_zxis=offset_z_axis,
    output_frame=number_slider_7,
    stick_indx=number_slider_9,
    face_idx=number_slider_10)  # -> out, geometries, frames, faces, axis, modules_C; inputs root: Plane, stick_length: Double, rot_angle: Int32, module_count: Int32, m_index: Int32, s_index: Int32, f_index: Int32, offset_xxis: Int32, offset_yxis: Double, offset_zxis: Double, stick_indx: Int32, face_idx: Double; disabled
# ---------- python_3_script_3: Python ----------
# r: compas>=2.14.1
# venv: sticks

import sys
import os
import math

#get current file path
path = ghenv.Component.OnPingDocument().FilePath
print (path)
#get parent directory of the parent directory
parentdir = os.path.dirname(path)
print (parentdir)
#get src folder which contains classes
dire = os.path.join(parentdir,'scripts')
print (dire)

sys.path.append(dire)

from compas_rhino import unload_modules
frames 
# unload_modules("group_one_sticks")
unload_modules("scripts")
unload_modules("stick_module_modified")
unload_modules("251203_module_C_connecting_FJ_safecopy") 

import Sticks
from Sticks import Stick 
from stick_module_modified_frame_safecopy import BranchingModule, BranchStickModules
from compas.geometry import Line, Point, Vector, Frame, Rotation

stick_width = 10
stick_depth = 10    

from compas_rhino.conversions import plane_to_compas_frame, frame_to_rhino_plane

# Convert input to compas
root = plane_to_compas_frame(root)

# Initialize tree
tree = BranchStickModules(root, stick_length, width=stick_width, depth=stick_depth)
# Grow tree "def grow_stick(self, from_stick_index = -1, face_index = 0, angle = 0.0)""
# for i in range(x_count):
#     if i %2:
#         tree.grow_stick(from_stick_index = i, face_index = 2, angle = rot_angle)
#     else:
#         tree.grow_stick(from_stick_index = i, face_index = 2, angle = -rot_angle*i*factor)
modules_C = []
for i in range(module_count):
    stick_idx = i%5
    mod = tree.grow_module( offset_xxis, offset_yxis, offset_zxis, from_module_index=i, from_stick_index=s_index, face_index=f_index, angle = rot_angle, move=output_frame)
    modules_C.append(mod)

print(tree)
# # Visualize
geometries = tree.visualize()
modules_C = tree.visualize()

# get specific faces
faces = []
for i, module in enumerate (tree.modules):
    if stick_indx < len(module.sticks):
        stick = module.sticks[stick_indx]
        angle = face_idx * math.pi / 2
        R = Rotation.from_axis_and_angle(stick.frame.xaxis, angle=angle, point=stick.frame.point)
        face_frame = stick.frame.transformed(R)
        face_frame.point = stick.axis.midpoint
        face_frame.point += face_frame.yaxis * stick.depth / 2
        if i % 2:
            faces.append(face_frame)

####   Color with 4 different color to understand the branching method   ####
from System.Drawing import Color

color_1 = Color.FromArgb(255, 100, 0)     # orange
color_2 = Color.FromArgb(0, 150, 255)     # blue
color_3 = Color.FromArgb(0, 200, 80)      # green
color_4 = Color.FromArgb(200, 0, 200)     # magenta

color_list = [color_1, color_2, color_3, color_4]

colors = []

for module_index, module in enumerate(tree.modules):
    col = color_list[module_index % 4]

    for stick in module.sticks:
        colors.append(col)


#frame = tree.sticks[0].frame
frame = tree.modules[0].sticks[0].frame

frames = [stick.frame for module in tree.modules for stick in module.sticks]
axis = [stick.axis for module in tree.modules for stick in module.sticks]
# ---------- end python_3_script_3 ----------
# base code:
# stick_module_modified_frame
python_3_script_4 = Python3Script(
    root=xy_plane_4,
    stick_length=panel_3,
    rot_angle=rotation_4,
    module_count=module_count,
    m_index=module_index_4,
    s_index=stick_index_4,
    f_index=face_index_4,
    offset_xxis=offset_x_axis_2,
    offset_yxis=offset_y_axis_2,
    offset_zxis=offset_z_axis_2,
    output_frame=number_slider_8,
    stick_indx=number_slider_11,
    face_idx=number_slider_12)  # -> out, geometries, frames, faces, axis, modules_C; inputs root: Plane, stick_length: Double, rot_angle: Int32, module_count: Int32, m_index: Int32, s_index: Int32, f_index: Int32, offset_xxis: Int32, offset_yxis: Double, offset_zxis: Double, stick_indx: Int32, face_idx: Double; disabled
# ---------- python_3_script_4: Python ----------
# r: compas>=2.14.1
# venv: sticks

import sys
import os
import math

#get current file path
path = ghenv.Component.OnPingDocument().FilePath
print (path)
#get parent directory of the parent directory
parentdir = os.path.dirname(path)
print (parentdir)
#get src folder which contains classes
dire = os.path.join(parentdir,'scripts')
print (dire)

sys.path.append(dire)

from compas_rhino import unload_modules
frames 
# unload_modules("group_one_sticks")
unload_modules("scripts")
unload_modules("stick_module_modified")
unload_modules("251203_module_C_connecting_FJ_safecopy") 

import Sticks
from Sticks import Stick 
from stick_module_modified_frame_safecopy import BranchingModule, BranchStickModules
from compas.geometry import Line, Point, Vector, Frame, Rotation

stick_width = 10
stick_depth = 10    

from compas_rhino.conversions import plane_to_compas_frame, frame_to_rhino_plane

# Convert input to compas
root = plane_to_compas_frame(root)

# Initialize tree
tree = BranchStickModules(root, stick_length, width=stick_width, depth=stick_depth)
# Grow tree "def grow_stick(self, from_stick_index = -1, face_index = 0, angle = 0.0)""
# for i in range(x_count):
#     if i %2:
#         tree.grow_stick(from_stick_index = i, face_index = 2, angle = rot_angle)
#     else:
#         tree.grow_stick(from_stick_index = i, face_index = 2, angle = -rot_angle*i*factor)
modules_C = []
for i in range(module_count):
    stick_idx = i%5
    mod = tree.grow_module( offset_xxis, offset_yxis, offset_zxis, from_module_index=i, from_stick_index=s_index, face_index=f_index, angle = rot_angle, move=output_frame)
    modules_C.append(mod)

print(tree)
# # Visualize
geometries = tree.visualize()
modules_C = tree.visualize()

# get specific faces
faces = []
for i, module in enumerate (tree.modules):
    if stick_indx < len(module.sticks):
        stick = module.sticks[stick_indx]
        angle = face_idx * math.pi / 2
        R = Rotation.from_axis_and_angle(stick.frame.xaxis, angle=angle, point=stick.frame.point)
        face_frame = stick.frame.transformed(R)
        face_frame.point = stick.axis.midpoint
        face_frame.point += face_frame.yaxis * stick.depth / 2
        if i %2 == 0:
            faces.append(face_frame)

####   Color with 4 different color to understand the branching method   ####
from System.Drawing import Color

color_1 = Color.FromArgb(255, 100, 0)     # orange
color_2 = Color.FromArgb(0, 150, 255)     # blue
color_3 = Color.FromArgb(0, 200, 80)      # green
color_4 = Color.FromArgb(200, 0, 200)     # magenta

color_list = [color_1, color_2, color_3, color_4]

colors = []

for module_index, module in enumerate(tree.modules):
    col = color_list[module_index % 4]

    for stick in module.sticks:
        colors.append(col)


#frame = tree.sticks[0].frame
frame = tree.modules[0].sticks[0].frame

frames = [stick.frame for module in tree.modules for stick in module.sticks]
axis = [stick.axis for module in tree.modules for stick in module.sticks]
# ---------- end python_3_script_4 ----------
# base code:
# stick_module_modified_frame
python_3_script_5 = Python3Script(
    root=rotate.Geometry,
    stick_length="200",
    rot_angle=rotation_5,
    module_count=module_count_5,
    m_index=module_index_5,
    s_index=stick_index_5,
    f_index=face_index_5,
    offset_xxis=offset_x_axis_3,
    offset_yxis=offset_y_axis_3,
    offset_zxis=offset_z_axis_3,
    output_frame=Slider(0, range=-2..4))  # -> out, geometries, frames, kframe, axis, modules_C; inputs root: Plane, stick_length: Double, rot_angle: Int32, module_count: Int32, m_index: Int32, s_index: Int32, f_index: Int32, offset_xxis: Int32, offset_yxis: Double, offset_zxis: Double
# ---------- python_3_script_5: Python ----------
# r: compas>=2.14.1
# venv: sticks

import sys
import os
import math

#get current file path
path = ghenv.Component.OnPingDocument().FilePath
print (path)
#get parent directory of the parent directory
parentdir = os.path.dirname(path)
print (parentdir)
#get src folder which contains classes
dire = os.path.join(parentdir,'group_one_scripts')
print (dire)

sys.path.append(dire)

from compas_rhino import unload_modules
frames 
# unload_modules("group_one_sticks")
unload_modules("scripts")
unload_modules("group_one_scripts")
unload_modules("stick_module_modified_frame")


import Sticks
import stick_module_modified_frame
from Sticks import Stick 
from stick_module_modified_frame import BranchingModule, BranchStickModules
from compas.geometry import Line, Point, Vector, Frame

stick_width = 10
stick_depth = 10    

from compas_rhino.conversions import plane_to_compas_frame, frame_to_rhino_plane

# Convert input to compas
root = plane_to_compas_frame(root)
# print(root)
# Initialize tree
tree = BranchStickModules(root, stick_length, width=stick_width, depth=stick_depth)
# Grow tree "def grow_stick(self, from_stick_index = -1, face_index = 0, angle = 0.0)""
# for i in range(x_count):
#     if i %2:
#         tree.grow_stick(from_stick_index = i, face_index = 2, angle = rot_angle)
#     else:
#         tree.grow_stick(from_stick_index = i, face_index = 2, angle = -rot_angle*i*factor)
modules_C = []
kframe = []
for i in range(module_count):
    mod = tree.grow_module( offset_xxis, offset_yxis, offset_zxis, from_module_index=i, from_stick_index=s_index, face_index=f_index, angle = rot_angle, move=output_frame)
    modules_C.append(mod)
    
    k = tree.modules[i].sticks[s_index].frame
    kframe.append(k)


# # Visualize
geometries = tree.visualize()
modules_C = tree.visualize()

 

####   Color with 4 different color to understand the branching method   ####
from System.Drawing import Color

color_1 = Color.FromArgb(255, 100, 0)     # orange
color_2 = Color.FromArgb(0, 150, 255)     # blue
color_3 = Color.FromArgb(0, 200, 80)      # green
color_4 = Color.FromArgb(200, 0, 200)     # magenta

color_list = [color_1, color_2, color_3, color_4]

colors = []

for module_index, module in enumerate(tree.modules):
    col = color_list[module_index % 4]

    for stick in module.sticks:
        colors.append(col)


#frame = tree.sticks[0].frame
frame = tree.modules[0].sticks[0].frame

frames = [stick.frame for module in tree.modules for stick in module.sticks]
axis = [stick.axis for module in tree.modules for stick in module.sticks]
# ---------- end python_3_script_5 ----------

# ----
# base code:
# stick_module_modified_frame
python_3_script_6 = Python3Script(
    root=xy_plane_5,
    stick_length="200",
    rot_angle=rotation_2,
    module_count=module_count_3,
    m_index=module_index_2,
    s_index=stick_index_2,
    f_index=face_index_2,
    offset_xxis=offset_axis_2,
    offset_yxis=offset_axis_b_4,
    offset_zxis=offset_axis_b_5)  # -> out, geometries, frames, modules_C; inputs root: Plane, stick_length: Double, rot_angle: Int32, module_count: Int32, m_index: Int32, s_index: Int32, f_index: Int32, offset_xxis: Int32, offset_yxis: Double
# ---------- python_3_script_6: Python ----------
# r: compas>=2.14.1
# venv: sticks

import sys
import os
import math

#get current file path
path = ghenv.Component.OnPingDocument().FilePath
print (path)
#get parent directory of the parent directory
parentdir = os.path.dirname(path)
print (parentdir)
#get src folder which contains classes
dire = os.path.join(parentdir,'scripts')
print (dire)

sys.path.append(dire)

from compas_rhino import unload_modules

# unload_modules("group_one_sticks")
unload_modules("scripts")
unload_modules("stick_module_modified")
unload_modules("251203_module_C_connecting_FJ_safecopy") 

import Sticks
from Sticks import Stick 
from stick_module_modified_frame_safecopy import BranchingModule, BranchStickModules
from compas.geometry import Line, Point, Vector, Frame

stick_width = 10
stick_depth = 10    

from compas_rhino.conversions import plane_to_compas_frame, frame_to_rhino_plane

# Convert input to compas
root = plane_to_compas_frame(root)

# Initialize tree
tree = BranchStickModules(root, stick_length, width=stick_width, depth=stick_depth)
# Grow tree "def grow_stick(self, from_stick_index = -1, face_index = 0, angle = 0.0)""
# for i in range(x_count):
#     if i %2:
#         tree.grow_stick(from_stick_index = i, face_index = 2, angle = rot_angle)
#     else:
#         tree.grow_stick(from_stick_index = i, face_index = 2, angle = -rot_angle*i*factor)
modules_C = []
for i in range(module_count):
    mod = tree.grow_module( offset_xxis, offset_yxis, offset_zxis, from_module_index=i, from_stick_index=s_index, face_index=f_index, angle = rot_angle)
    modules_C.append(mod)

print(tree)
# # Visualize
geometries = tree.visualize()
modules_C = tree.visualize()

 
#frame = tree.sticks[0].frame
frame = tree.modules[0].sticks[0].frame

frames = [stick.frame for module in tree.modules for stick in module.sticks]
# ---------- end python_3_script_6 ----------

draw = COMPASDraw(cg=python_3_script_4.faces)  # -> rg; disabled
#   port cg: The COMPAS geometry or datastructure to be drawn.
#   port rg: The Rhino geometry object.
# ---------- draw: Python ----------
# r: compas>=2.14.1
"""
Draws COMPAS geometry in Grasshopper.
"""

from typing import Any

import Grasshopper

from compas.scene import SceneObject


class CompasToRhinoGeometry(Grasshopper.Kernel.GH_ScriptInstance):
    def RunScript(self, cg):
        if not cg:
            return None

        return SceneObject(item=cg).draw()
# ---------- end draw ----------
list_length = ListLength(List=python_3_script_2.frames)
draw_2 = COMPASDraw(cg=python_3_script_5.geometries)  # -> rg; same code as draw
list_length_2 = ListLength(List=python_3_script_6.frames)
draw_3 = COMPASDraw(cg=python_3_script_2.modules_C)  # -> rg; disabled; same code as draw
draw_4 = COMPASDraw(cg=python_3_script_3.axis)  # -> rg; disabled; same code as draw
draw_5 = COMPASDraw(cg=python_3_script_4.axis)  # -> rg; disabled; same code as draw
draw_6 = COMPASDraw(cg=python_3_script_3.geometries)  # -> rg; disabled; same code as draw
colour_swatch = ColourSwatch(SwatchColor=RGBA(201, 154, 83, 170))  # disabled
draw_7 = COMPASDraw(cg=python_3_script_2.geometries)  # -> rg; same code as draw
draw_8 = COMPASDraw(cg=python_3_script_6.modules_C)  # -> rg; disabled; same code as draw
draw_9 = COMPASDraw(cg=python_3_script_4.geometries)  # -> rg; disabled; same code as draw
colour_swatch_2 = ColourSwatch(SwatchColor=RGB(148, 16, 204))  # disabled
number_slider_13 = Slider(10, range=0..10)  # disabled
colour_swatch_3 = ColourSwatch(SwatchColor=RGBA(201, 154, 83, 170))  # disabled
number_slider_14 = Slider(10, range=0..10)  # disabled
# def stick_bridge(stick0, stick1):
#    plane0 = Plane(stick0.axis.midpoint, stick0.frame.xaxis)
# 
# or use: stick_from_fame: "frames of the output sticks"
# 
# call:
# stick0.face_frame
# 
# get_face_frame_at(face_index
draw_10 = COMPASDraw(cg=python_3_script_6.geometries)  # -> rg; same code as draw
colour_swatch_4 = ColourSwatch(SwatchColor=RGB(16, 166, 204))  # disabled
draw_11 = COMPASDraw(cg=python_3_script_5.axis)  # -> rg; same code as draw
draw_12 = COMPASDraw(cg=python_3_script_5.modules_C)  # -> rg; disabled; same code as draw
draw_13 = COMPASDraw(cg=python_3_script_3.faces)  # -> rg; disabled; same code as draw
midpt = CurveMiddle(Curve=draw_4)  # disabled
midpt_2 = CurveMiddle(Curve=draw_5)  # disabled
series = Series(Start=0, Step=1, Count=list_length)
midpt_3 = CurveMiddle(Curve=draw_11)
custom_preview = CustomPreview(Geometry=draw_6, Material=colour_swatch)  # disabled
custom_preview_2 = CustomPreview(Geometry=draw_13, Material=colour_swatch_4)  # disabled
series_2 = Series(Start=0, Step=1, Count=list_length_2)
custom_preview_3 = CustomPreview(Geometry=draw, Material=colour_swatch_2)  # disabled
custom_preview_4 = CustomPreview(Geometry=draw_9, Material=colour_swatch_3)  # disabled
points = PointList(Points=midpt, Size=number_slider_13)  # disabled
custom_preview_5 = CustomPreview(Geometry=draw_2, Material=ColourSwatch(SwatchColor=RGB(227, 173, 93)))
points_2 = PointList(Points=midpt_2, Size=number_slider_14)  # disabled
custom_preview_6 = CustomPreview(Geometry=draw_7, Material=ColourSwatch(SwatchColor=RGB(201, 154, 83)))
custom_preview_7 = CustomPreview(Geometry=draw_10, Material=ColourSwatch(SwatchColor=RGB(201, 154, 83)))
points_3 = PointList(Points=midpt_3, Size=Slider(10, range=0..10))
gradient = Gradient(
    LowerLimit=0,
    UpperLimit=list_length,
    Parameter=series,
    stops=[0: RGB(128, 255, 255), 0: RGB(255, 130, 160), 0: RGB(4, 60, 97), 0.922: RGB(220, 0, 40)])  # disabled
gradient_2 = Gradient(
    LowerLimit=0,
    UpperLimit=list_length_2,
    Parameter=series_2,
    stops=[0: RGB(128, 255, 255), 0: RGB(255, 130, 160), 0: RGB(4, 60, 97), 0.922: RGB(220, 0, 40)])  # disabled
draw_14 = COMPASDraw(cg=python_3_script_5.kframe)  # -> rg; same code as draw
panel_4 = Panel(python_3_script_5.kframe)
custom_preview_8 = CustomPreview(Geometry=draw_7, Material=gradient)  # disabled
custom_preview_9 = CustomPreview(Geometry=draw_10, Material=gradient_2)  # disabled
pln_2 = Plane(Plane(origin=(62.38293416, 123.7313076, 126.9814709), x=(0.9999493947, 0.006016490278, -0.008062873196), y=(-0.007224363873, -0.128315674, -0.9917070618)))  # disabled
number_slider_15 = Slider(157, range=0..1000)  # disabled
number_slider_16 = Slider(88, range=0..1000)  # disabled
list = ValueList({"XYZ", "XZY", "YXZ", "YZX", "ZXY", "ZYX", "XYX", "XZX", "YXY", "YZY", "ZXZ", "ZYZ"}, selected="ZYX")  # disabled
number_slider_17 = Slider(93, range=0..360)  # disabled
number_slider_18 = Slider(132, range=0..360)  # disabled

# ----
# starting_plane
xy_plane_6 = XYPlane(Origin=pln_2)  # disabled

# ----
# end_plane
pln_3 = Plane(Plane(origin=(10.04247611, -119.968413, 71.01204763), x=(0.9741386559, -0.2258766246, -0.005799095829), y=(0.1497074786, 0.6644418912, -0.7321916717)))  # disabled

py3_2 = Python3Script(
    frame_0=python_3_script_3.faces,
    frame_1=python_3_script_4.faces,
    length_0=number_slider_16,
    bridge_length=number_slider_15,
    rotate_0=number_slider_18,
    rotate_1=number_slider_17,
    Type=list)  # -> all_frames, geometries, bridge_geoms, info_text, roll_plane; disabled
# ---------- py3_2: Python ----------
# GH_Bridge_ZYX.py - Grasshopper ZYX decomposed bridge component with face info and plane viz
# r: compas>=2.14.1
# venv: sticks

import sys
import math

# Add your scripts folder
scripts_path = r'C:\Users\frido\OneDrive\Dokumente\ETH_MAS_Architecture_Digital_Fabrication\Visual_Studio_Code\MAS-2526\08_SpatialAssemblies\StudentProjects\group_one\Scrypts_Shrey'
if scripts_path not in sys.path:
    sys.path.append(scripts_path)

from compas_rhino import unload_modules
unload_modules("Sticks_s")

from Sticks_s import stick_from_frame, bridge_sticks_euler_decomposed
from compas_rhino.conversions import plane_to_compas_frame, frame_to_rhino_plane
import Rhino.Geometry as rg

# ============================================================================
# INPUTS (Grasshopper provides these)
# ============================================================================
#   center_frame_0  - Plane (reference stick)
#   center_frame_1  - Plane (target stick)
#   length_0        - Float (stick 0 length)
#   length_1        - Float (stick 1 length)
#   bridge_length   - Float (bridge length)
#   width           - Float (optional, default 13)
#   depth           - Float (optional, default 13)
#
# OUTPUTS
# ============================================================================
#   geometries      - All stick geometries (original + bridges)
#   bridge_geoms    - Just bridge geometries
#   face_planes     - Face planes being used (for visualization)
#   info_text       - Information about the bridges
#   roll_plane      - Visualization of roll plane
#   intersection_sphere - Sphere at intersection point

# Defaults
if length_0 is None:
    length_0 = 100.0
if length_1 is None:
    length_1 = 100.0
if bridge_length is None:
    bridge_length = 80.0
if width is None:
    width = 13.0
if depth is None:
    depth = 13.0

# Convert frames
# frame_0 = plane_to_compas_frame(center_frame_0)
# frame_1 = plane_to_compas_frame(center_frame_1)

# Create sticks
stick_0 = stick_from_frame(frame_0, length_0, width, depth)
stick_1 = stick_from_frame(frame_1, length_1, width, depth)

# Create bridges using ZYX decomposition
bridges, info = bridge_sticks_euler_decomposed(stick_0, stick_1, bridge_length, width, depth, sequence=Type)

# Outputs
geometries = [stick_0.geometry, stick_1.geometry] + [b.geometry for b in bridges]
bridge_geoms = [b.geometry for b in bridges]

# Get face planes used for connections
face_planes = []

# Face plane for Bridge A attachment on stick_0
if info.get('best_face') is not None:
    face_A = stick_0.get_face_frame(info['best_face'])
    face_planes.append(frame_to_rhino_plane(face_A))

# Face plane for Bridge B attachment on Bridge A (if it exists)
if len(bridges) >= 2:
    # Get the face index from sequence
    for item in info['sequence']:
        if len(item) >= 3 and item[0] == 'B':
            attachment_pos = item[1]
            next_face_idx = item[2]
            face_B = bridges[0].get_face_frame_at(next_face_idx, attachment_pos)
            face_planes.append(frame_to_rhino_plane(face_B))

# Visualize roll plane if it exists
roll_plane = None
print(f"DEBUG GH: 'roll_plane' in info? {'roll_plane' in info}")

if 'roll_plane' in info:
    print(f"DEBUG GH: Found roll_plane in info!")
    from compas_rhino.conversions import plane_to_rhino
    compas_plane = info['roll_plane']
    
    print(f"DEBUG GH: COMPAS plane origin: {compas_plane.point}")
    print(f"DEBUG GH: COMPAS plane normal: {compas_plane.normal}")
    
    # Convert to Rhino plane
    plane_rhino = plane_to_rhino(compas_plane)
    
    print(f"DEBUG GH: Converted to Rhino plane")
    
    # Create a rectangle 200x200mm centered on the plane
    size = 200.0
    rect = rg.Rectangle3d(plane_rhino, size, size)
    
    # Convert to surface for better visibility
    roll_plane = rg.Brep.CreateFromCornerPoints(
        rect.Corner(0),
        rect.Corner(1),
        rect.Corner(2),
        rect.Corner(3),
        0.001
    )
    
    print(f"DEBUG GH: Created Brep, valid? {roll_plane is not None}")
else:
    print(f"DEBUG GH: No roll_plane in info")

# Visualize intersection point if it exists
intersection_sphere = None
if 'intersection_point' in info:
    pt = info['intersection_point']
    center = rg.Point3d(pt.x, pt.y, pt.z)
    intersection_sphere = rg.Sphere(center, 10.0).ToBrep()
    print(f"DEBUG GH: Created sphere at intersection point {pt}")

# Info text
info_text = f"""ZYX DECOMPOSED BRIDGE SOLVER
{'='*50}
Method: {info['method']}

ORIGINAL STICKS:
  Stick 0 length: {length_0:.1f}mm
  Stick 1 length: {length_1:.1f}mm

ROTATION DECOMPOSITION (ZYX):
  Z-rotation (Yaw):   {info['z_angle_deg']:>7.1f}°
  Y-rotation (Pitch): {info['y_angle_deg']:>7.1f}°
  X-rotation (Roll):  {info['x_angle_deg']:>7.1f}°
  Z-height diff:      {info.get('z_height_diff', 0):.1f}mm

BRIDGES CREATED:
  Number of bridges: {info['num_bridges']}
  Bridge length: {info['bridge_length']:.1f}mm
  
FACE CONNECTIONS:
  Stick 0 attachment face: {info.get('best_face', 'N/A')}
"""

# Add sequence info
info_text += "\nSEQUENCE:\n"
for item in info['sequence']:
    if len(item) == 2:
        axis, angle = item
        info_text += f"  {axis}-rotation: {math.degrees(angle):.1f}°\n"
    elif len(item) == 3:
        if item[0] == 'A':
            axis, angle, anchor = item
            info_text += f"  Bridge A: Z-rotation {math.degrees(angle):.1f}°, anchor: {anchor:.3f}\n"
        elif item[0] == 'B':
            axis, pos, face_idx = item
            info_text += f"  Bridge B: position {pos:.3f}, from face {face_idx}\n"
    elif len(item) == 4:
        if item[0] == 'B':
            axis, pos, face_idx, anchor = item
            info_text += f"  Bridge B: position {pos:.3f}, from face {face_idx}, anchor {anchor:.3f}\n"

if info['num_bridges'] == 0:
    info_text += "\n⚠ No bridges needed - sticks are aligned!"
elif info['num_bridges'] == 1:
    info_text += f"\n✓ Only horizontal bridge needed"
else:
    info_text += f"\n✓ {info['num_bridges']} bridges created"
# ---------- end py3_2 ----------
draw_15 = COMPASDraw(cg=py3_2.geometries)  # -> rg; disabled; same code as draw
draw_16 = COMPASDraw(cg=py3_2.bridge_geoms)  # -> rg; disabled; same code as draw
panel_5 = Panel(py3_2.info_text)  # disabled

# ----
# end_plane
pln_4 = Plane(Plane(origin=(10.04247611, -119.968413, 71.01204763), x=(0.9741386559, -0.2258766246, -0.005799095829), y=(0.1497074786, 0.6644418912, -0.7321916717)))  # disabled

# ----
# Bridging SHREY
pln_5 = Plane(Plane(origin=(62.38293416, 123.7313076, 126.9814709), x=(0.9999493947, 0.006016490278, -0.008062873196), y=(-0.007224363873, -0.128315674, -0.9917070618)))  # disabled
number_slider_19 = Slider(157, range=0..1000)  # disabled
number_slider_20 = Slider(336, range=0..1000)  # disabled
list_2 = ValueList({"XYZ", "XZY", "YXZ", "YZX", "ZXY", "ZYX", "XYX", "XZX", "YXY", "YZY", "ZXZ", "ZYZ"}, selected="ZYX")  # disabled
number_slider_21 = Slider(125, range=0..360)  # disabled
number_slider_22 = Slider(156, range=0..360)  # disabled

# ----
# starting_plane
xy_plane_7 = XYPlane(Origin=pln_5)  # disabled

py3_3 = Python3Script(
    center_frame_0=xy_plane_7,
    center_frame_1=pln_4,
    bridge_length=number_slider_19,
    rotate_0=number_slider_22,
    rotate_1=number_slider_21,
    Type=list_2)  # -> all_frames, geometries, bridge_geoms, info_text, roll_plane; disabled
# ---------- py3_3: Python ----------
# GH_Bridge_ZYX.py - Grasshopper ZYX decomposed bridge component with face info and plane viz
# r: compas>=2.14.1
# venv: sticks

import sys
import math

# Add your scripts folder
scripts_path = r'C:\Users\frido\OneDrive\Dokumente\ETH_MAS_Architecture_Digital_Fabrication\Visual_Studio_Code\MAS-2526\08_SpatialAssemblies\StudentProjects\group_one\Scrypts_Shrey'
if scripts_path not in sys.path:
    sys.path.append(scripts_path)

from compas_rhino import unload_modules
unload_modules("Sticks_s")

from Sticks_s import stick_from_frame, bridge_sticks_euler_decomposed
from compas_rhino.conversions import plane_to_compas_frame, frame_to_rhino_plane
import Rhino.Geometry as rg

# ============================================================================
# INPUTS (Grasshopper provides these)
# ============================================================================
#   center_frame_0  - Plane (reference stick)
#   center_frame_1  - Plane (target stick)
#   length_0        - Float (stick 0 length)
#   length_1        - Float (stick 1 length)
#   bridge_length   - Float (bridge length)
#   width           - Float (optional, default 13)
#   depth           - Float (optional, default 13)
#
# OUTPUTS
# ============================================================================
#   geometries      - All stick geometries (original + bridges)
#   bridge_geoms    - Just bridge geometries
#   face_planes     - Face planes being used (for visualization)
#   info_text       - Information about the bridges
#   roll_plane      - Visualization of roll plane
#   intersection_sphere - Sphere at intersection point

# Defaults
if length_0 is None:
    length_0 = 100.0
if length_1 is None:
    length_1 = 100.0
if bridge_length is None:
    bridge_length = 80.0
if width is None:
    width = 13.0
if depth is None:
    depth = 13.0

# Convert frames
frame_0 = plane_to_compas_frame(center_frame_0)
frame_1 = plane_to_compas_frame(center_frame_1)

# Create sticks
stick_0 = stick_from_frame(frame_0, length_0, width, depth)
stick_1 = stick_from_frame(frame_1, length_1, width, depth)

# Create bridges using ZYX decomposition
bridges, info = bridge_sticks_euler_decomposed(stick_0, stick_1, bridge_length, width, depth, sequence=Type)

# Outputs
geometries = [stick_0.geometry, stick_1.geometry] + [b.geometry for b in bridges]
bridge_geoms = [b.geometry for b in bridges]

# Get face planes used for connections
face_planes = []

# Face plane for Bridge A attachment on stick_0
if info.get('best_face') is not None:
    face_A = stick_0.get_face_frame(info['best_face'])
    face_planes.append(frame_to_rhino_plane(face_A))

# Face plane for Bridge B attachment on Bridge A (if it exists)
if len(bridges) >= 2:
    # Get the face index from sequence
    for item in info['sequence']:
        if len(item) >= 3 and item[0] == 'B':
            attachment_pos = item[1]
            next_face_idx = item[2]
            face_B = bridges[0].get_face_frame_at(next_face_idx, attachment_pos)
            face_planes.append(frame_to_rhino_plane(face_B))

# Visualize roll plane if it exists
roll_plane = None
print(f"DEBUG GH: 'roll_plane' in info? {'roll_plane' in info}")

if 'roll_plane' in info:
    print(f"DEBUG GH: Found roll_plane in info!")
    from compas_rhino.conversions import plane_to_rhino
    compas_plane = info['roll_plane']
    
    print(f"DEBUG GH: COMPAS plane origin: {compas_plane.point}")
    print(f"DEBUG GH: COMPAS plane normal: {compas_plane.normal}")
    
    # Convert to Rhino plane
    plane_rhino = plane_to_rhino(compas_plane)
    
    print(f"DEBUG GH: Converted to Rhino plane")
    
    # Create a rectangle 200x200mm centered on the plane
    size = 200.0
    rect = rg.Rectangle3d(plane_rhino, size, size)
    
    # Convert to surface for better visibility
    roll_plane = rg.Brep.CreateFromCornerPoints(
        rect.Corner(0),
        rect.Corner(1),
        rect.Corner(2),
        rect.Corner(3),
        0.001
    )
    
    print(f"DEBUG GH: Created Brep, valid? {roll_plane is not None}")
else:
    print(f"DEBUG GH: No roll_plane in info")

# Visualize intersection point if it exists
intersection_sphere = None
if 'intersection_point' in info:
    pt = info['intersection_point']
    center = rg.Point3d(pt.x, pt.y, pt.z)
    intersection_sphere = rg.Sphere(center, 10.0).ToBrep()
    print(f"DEBUG GH: Created sphere at intersection point {pt}")

# Info text
info_text = f"""ZYX DECOMPOSED BRIDGE SOLVER
{'='*50}
Method: {info['method']}

ORIGINAL STICKS:
  Stick 0 length: {length_0:.1f}mm
  Stick 1 length: {length_1:.1f}mm

ROTATION DECOMPOSITION (ZYX):
  Z-rotation (Yaw):   {info['z_angle_deg']:>7.1f}°
  Y-rotation (Pitch): {info['y_angle_deg']:>7.1f}°
  X-rotation (Roll):  {info['x_angle_deg']:>7.1f}°
  Z-height diff:      {info.get('z_height_diff', 0):.1f}mm

BRIDGES CREATED:
  Number of bridges: {info['num_bridges']}
  Bridge length: {info['bridge_length']:.1f}mm
  
FACE CONNECTIONS:
  Stick 0 attachment face: {info.get('best_face', 'N/A')}
"""

# Add sequence info
info_text += "\nSEQUENCE:\n"
for item in info['sequence']:
    if len(item) == 2:
        axis, angle = item
        info_text += f"  {axis}-rotation: {math.degrees(angle):.1f}°\n"
    elif len(item) == 3:
        if item[0] == 'A':
            axis, angle, anchor = item
            info_text += f"  Bridge A: Z-rotation {math.degrees(angle):.1f}°, anchor: {anchor:.3f}\n"
        elif item[0] == 'B':
            axis, pos, face_idx = item
            info_text += f"  Bridge B: position {pos:.3f}, from face {face_idx}\n"
    elif len(item) == 4:
        if item[0] == 'B':
            axis, pos, face_idx, anchor = item
            info_text += f"  Bridge B: position {pos:.3f}, from face {face_idx}, anchor {anchor:.3f}\n"

if info['num_bridges'] == 0:
    info_text += "\n⚠ No bridges needed - sticks are aligned!"
elif info['num_bridges'] == 1:
    info_text += f"\n✓ Only horizontal bridge needed"
else:
    info_text += f"\n✓ {info['num_bridges']} bridges created"
# ---------- end py3_3 ----------
draw_17 = COMPASDraw(cg=py3_3.geometries)  # -> rg; disabled; same code as draw
draw_18 = COMPASDraw(cg=py3_3.bridge_geoms)  # -> rg; disabled; same code as draw
panel_6 = Panel(py3_3.info_text)  # disabled
