# Grasshopper definition 251211_module_c_robot_5modules(1).ghx (Grasshopper 1.0.8)
# plug-ins: Robots

# ----
# SIN curve
x_distance = Slider(200, range=0..500)
x_distance_2 = Slider(200, range=0..500)
sin_curve_length = Slider(12, range=0..100)
python_3_script = Python3Script(x_dist=x_distance_2, y_dist=x_distance, loop_length=sin_curve_length)  # -> out, points; inputs x_dist: Int32, y_dist: Int32, loop_length: Int32
# ---------- python_3_script: Python ----------
import Rhino.Geometry as rg
from math import sin

points = []

for i in range (loop_length):
    pt = rg.Point3d(sin(i)*x_dist, i*y_dist, 0)
    points.append(pt)
# ---------- end python_3_script ----------

# ----
# Point-Grid
# try %2 move Z by self.depth
number_slider = Slider(300, range=0..400)
py3 = Python3Script(x_count=Slider(3, range=0..15), y_count=Slider(4, range=0..15), x_space=number_slider, y_space=Slider(285, range=0..400))  # -> out, points; inputs x_count: Int32, y_count: Int32, x_space: Double, y_space: Double
# ---------- py3: Python ----------
import Rhino.Geometry as rg

points = []
for i in range (x_count):
    for j in range (y_count):
        pt = rg.Point3d(i*x_space, j*y_space, 0)
        rg.Point3d()
        points.append(pt)
# ---------- end py3 ----------

number_slider_2 = Slider(4, range=0..15)  # disabled
number_slider_3 = Slider(300, range=0..400)  # disabled
number_slider_4 = Slider(340, range=0..400)  # disabled
number_slider_5 = Slider(1, range=0..15)  # disabled
# Point-Grid
# try %2 move Z by self.depth
py3_2 = Python3Script(x_count=number_slider_5, y_count=number_slider_2, x_space=number_slider_3, y_space=number_slider_4)  # -> out, points; inputs x_count: Int32, y_count: Int32, x_space: Double, y_space: Double; disabled; same code as py3
pt = Point(Point(-6.057325061e-09, 5.793225901e-07, 19.50000003))  # disabled
pt_2 = Point(Point(-6.057325061e-09, 5.793225901e-07, 19.50000003))  # disabled
offset_x_axis = Slider(-5, range=-100..100)
rotation = Slider(0, range=0..2000)
module_count = Slider(4, range=0..100)
module_index = Slider(0, range=0..30)
face_index = Slider(3, range=0..3)
offset_x_axis_2 = Slider(-6, range=-100..100)
offset_y_axis = Slider(0, range=-100..100)
offset_z_axis = Slider(-1, range=-100..100)
stick_index = Slider(4, range=0..4)
rotation_2 = Slider(36, range=0..2000)
module_count_2 = Slider(24, range=0..100)
face_index_2 = Slider(3, range=0..3)
offset_y_axis_2 = Slider(0, range=-100..100)
offset_z_axis_2 = Slider(-1, range=-100..100)
module_index_2 = Slider(0, range=0..30)
stick_index_2 = Slider(0, range=0..4)
xy_plane = XYPlane(Origin=pt)
xy_plane_2 = XYPlane(Origin=pt_2)

# ----
# move this point
# to move structure
# (x, y, z)
pt_3 = Point(Point(-499.9944744, -499.9915537, 19.50000003))

pt_4 = Point(Point(-21.50322422, 635.9257077, 0))  # disabled
number_slider_6 = Slider(2.2, range=0.1..6.8)  # disabled
offset_x_axis_3 = Slider(-5, range=-100..100)  # disabled
number_slider_7 = Slider(0, range=-2..4)  # disabled
module_count_3 = Slider(14, range=0..100)  # disabled
module_index_3 = Slider(0, range=0..30)  # disabled
face_index_3 = Slider(0, range=0..3)  # disabled
offset_y_axis_3 = Slider(0, range=-100..100)  # disabled
offset_z_axis_3 = Slider(-1, range=-100..100)  # disabled
stick_index_3 = Slider(3, range=0..4)  # disabled
prot = RotatePlane(Plane=xy_plane_2, Angle=Slider(2.6508, range=0..6.2832))
xy_plane_3 = XYPlane(Origin=pt_4)  # disabled
number_slider_8 = Slider(4, range=0..4)  # disabled
number_slider_9 = Slider(0, range=0..3)  # disabled
xz = XZPlane(Origin=pt_3)  # disabled

# ----
# base code:
# stick_module_modified_frame
number_slider_10 = Slider(0, range=-2..4)
module_count_4 = Slider(12, range=0..100)
rotation_3 = Slider(120, range=0..2000)
face_index_4 = Slider(1, range=0..3)
stick_index_4 = Slider(4, range=0..4)
offset_x_axis_4 = Slider(0, range=-13..10)
offset_z_axis_4 = Slider(3, range=-100..100)
module_index_4 = Slider(0, range=0..30)
offset_y_axis_4 = Slider(0, range=-16..16)
xy_plane_4 = XYPlane(Origin=pt_3)  # disabled
python_3_script_2 = Python3Script(
    root=xz,
    stick_length="200",
    rot_angle=rotation_3,
    module_count=module_count_4,
    m_index=module_index_4,
    s_index=stick_index_4,
    f_index=face_index_4,
    offset_xxis=offset_x_axis_4,
    offset_yxis=offset_y_axis_4,
    offset_zxis=offset_z_axis_4,
    output_frame=number_slider_10)  # -> out, geometries, colors, frames, frame, sticks, axis, modules_C; inputs root: Plane, stick_length: Double, rot_angle: Int32, module_count: Int32, m_index: Int32, s_index: Int32, f_index: Int32, offset_xxis: Int32, offset_yxis: Double, offset_zxis: Double
# ---------- python_3_script_2: Python ----------
# r: compas>=2.14.1
# venv: sticks

import sys
import os
import math

#get current file path
path = ghenv.Component.OnPingDocument().FilePath
print (path)
#get parent directory of the parent directory
parentdir = os.path.dirname(path)
print (parentdir)
#get src folder which contains classes
dire = os.path.join(parentdir,'group_one_scripts')
print (dire)

sys.path.append(dire)

from compas_rhino import unload_modules
frames 
# unload_modules("group_one_sticks")
unload_modules("scripts")
unload_modules("group_one_scripts")
unload_modules("stick_module_modified_frame")


import Sticks
import stick_module_modified_frame
from Sticks import Stick 
from stick_module_modified_frame import BranchingModule, BranchStickModules
from compas.geometry import Line, Point, Vector, Frame

stick_width = 13
stick_depth = 13    

from compas_rhino.conversions import plane_to_compas_frame, frame_to_rhino_plane

# Convert input to compas
root = plane_to_compas_frame(root)
# print(root)
# Initialize tree
tree = BranchStickModules(root, stick_length, width=stick_width, depth=stick_depth)
# Grow tree "def grow_stick(self, from_stick_index = -1, face_index = 0, angle = 0.0)""
# for i in range(x_count):
#     if i %2:
#         tree.grow_stick(from_stick_index = i, face_index = 2, angle = rot_angle)
#     else:
#         tree.grow_stick(from_stick_index = i, face_index = 2, angle = -rot_angle*i*factor)
modules_C = []

for i in range(module_count):
    mod = tree.grow_module( offset_xxis, offset_yxis, offset_zxis, from_module_index=i, from_stick_index=s_index, face_index=f_index, angle = rot_angle, move=output_frame)
    modules_C.append(mod)

for i in range(module_count):
    mod = tree.grow_module( 0, -5, 1, from_module_index=i, from_stick_index=3, face_index=1, angle = 0, move=output_frame)
    modules_C.append(mod)

for i in range(module_count):
    mod = tree.grow_module( 0, -9, -1, from_module_index=i+13, from_stick_index=4, face_index=2, angle =0, move=output_frame)
    modules_C.append(mod)

for i in range(module_count):
    mod = tree.grow_module( 0, -9, -1, from_module_index=i+25, from_stick_index=4, face_index=2, angle =0, move=output_frame)
    modules_C.append(mod)

# for i in range(module_count):
#     mod = tree.grow_module( 0, -9, -1, from_module_index=i+37, from_stick_index=1, face_index=2, angle =45, move=output_frame)
#     modules_C.append(mod)


# # Visualize
geometries = tree.visualize()
modules_C = tree.visualize()

 

####   Color with 4 different color to understand the branching method   ####
from System.Drawing import Color

color_1 = Color.FromArgb(255, 100, 0)     # orange
color_2 = Color.FromArgb(0, 150, 255)     # blue
color_3 = Color.FromArgb(0, 200, 80)      # green
color_4 = Color.FromArgb(200, 0, 200)     # magenta

color_list = [color_1, color_2, color_3, color_4]

colors = []

for module_index, module in enumerate(tree.modules):
    col = color_list[module_index % 4]

    for stick in module.sticks:
        colors.append(col)


#frame = tree.sticks[0].frame
frame = tree.modules[0].sticks[0].frame

frames = [stick.frame for module in tree.modules for stick in module.sticks]
axis = [stick.axis for module in tree.modules for stick in module.sticks]
sticks = [stick for module in tree.modules for stick in module.sticks]
# ---------- end python_3_script_2 ----------
draw = COMPASDraw(cg=python_3_script_2.geometries)  # -> rg
#   port cg: The COMPAS geometry or datastructure to be drawn.
#   port rg: The Rhino geometry object.
# ---------- draw: Python ----------
# r: compas>=2.14.1
"""
Draws COMPAS geometry in Grasshopper.
"""

from typing import Any

import Grasshopper

from compas.scene import SceneObject


class CompasToRhinoGeometry(Grasshopper.Kernel.GH_ScriptInstance):
    def RunScript(self, cg):
        if not cg:
            return None

        return SceneObject(item=cg).draw()
# ---------- end draw ----------
draw_2 = COMPASDraw(cg=python_3_script_2.axis)  # -> rg; same code as draw
draw_3 = COMPASDraw(cg=python_3_script_2.modules_C)  # -> rg; disabled; same code as draw
number_slider_11 = Slider(10, range=0..10)
midpt = CurveMiddle(Curve=draw_2)
custom_preview = CustomPreview(Geometry=draw, Material=ColourSwatch(SwatchColor=RGB(227, 173, 93)))
points = PointList(Points=midpt, Size=number_slider_11)

panel = Panel("200")  # disabled
# base code:
# stick_module_modified_frame
python_3_script_3 = Python3Script(
    root=xy_plane,
    stick_length="200",
    rot_angle=rotation,
    module_count=module_count,
    m_index=module_index,
    s_index=stick_index,
    f_index=face_index,
    offset_xxis=offset_x_axis_2,
    offset_yxis=offset_y_axis,
    offset_zxis=offset_z_axis,
    output_frame=Slider(0, range=-2..4))  # -> out, geometries, frames, kframe, axis, modules_C; inputs root: Plane, stick_length: Double, rot_angle: Int32, module_count: Int32, m_index: Int32, s_index: Int32, f_index: Int32, offset_xxis: Int32, offset_yxis: Double, offset_zxis: Double; disabled
# ---------- python_3_script_3: Python ----------
# r: compas>=2.14.1
# venv: sticks

import sys
import os
import math

#get current file path
path = ghenv.Component.OnPingDocument().FilePath
print (path)
#get parent directory of the parent directory
parentdir = os.path.dirname(path)
print (parentdir)
#get src folder which contains classes
dire = os.path.join(parentdir,'group_one_scripts')
print (dire)

sys.path.append(dire)

from compas_rhino import unload_modules
frames 
# unload_modules("group_one_sticks")
unload_modules("scripts")
unload_modules("group_one_scripts")
unload_modules("stick_module_modified_frame")


import Sticks
import stick_module_modified_frame
from Sticks import Stick 
from stick_module_modified_frame import BranchingModule, BranchStickModules
from compas.geometry import Line, Point, Vector, Frame

stick_width = 13
stick_depth = 13    

from compas_rhino.conversions import plane_to_compas_frame, frame_to_rhino_plane

# Convert input to compas
root = plane_to_compas_frame(root)
# print(root)
# Initialize tree
tree = BranchStickModules(root, stick_length, width=stick_width, depth=stick_depth)
# Grow tree "def grow_stick(self, from_stick_index = -1, face_index = 0, angle = 0.0)""
# for i in range(x_count):
#     if i %2:
#         tree.grow_stick(from_stick_index = i, face_index = 2, angle = rot_angle)
#     else:
#         tree.grow_stick(from_stick_index = i, face_index = 2, angle = -rot_angle*i*factor)
modules_C = []
kframe = []
for i in range(module_count):
    if i == 0:
        f_index = 0  # First one is 0
    elif i == 1:
        f_index = 0  # Second one is also 0
    else:
        f_index = 1 #((i - 2) % 4) + 1
    mod = tree.grow_module( offset_xxis, offset_yxis, offset_zxis, from_module_index=i, from_stick_index=s_index, face_index=f_index, angle = rot_angle, move=output_frame)

    modules_C.append(mod)
    
    # k = tree.modules[i].sticks[s_index].frame
    # kframe.append(k)


# # Visualize
geometries = tree.visualize()
modules_C = tree.visualize()

 

####   Color with 4 different color to understand the branching method   ####
from System.Drawing import Color

color_1 = Color.FromArgb(255, 100, 0)     # orange
color_2 = Color.FromArgb(0, 150, 255)     # blue
color_3 = Color.FromArgb(0, 200, 80)      # green
color_4 = Color.FromArgb(200, 0, 200)     # magenta

color_list = [color_1, color_2, color_3, color_4]

colors = []

for module_index, module in enumerate(tree.modules):
    col = color_list[module_index % 4]

    for stick in module.sticks:
        colors.append(col)


#frame = tree.sticks[0].frame
frame = tree.modules[0].sticks[0].frame

frames = [stick.frame for module in tree.modules for stick in module.sticks]
axis = [stick.axis for module in tree.modules for stick in module.sticks]
# ---------- end python_3_script_3 ----------
# base code:
# stick_module_modified_frame
python_3_script_4 = Python3Script(
    root=prot,
    stick_length="200",
    rot_angle=rotation_2,
    module_count=module_count_2,
    m_index=module_index_2,
    s_index=stick_index_2,
    f_index=face_index_2,
    offset_xxis=offset_x_axis,
    offset_yxis=offset_y_axis_2,
    offset_zxis=offset_z_axis_2,
    output_frame=Slider(2, range=-2..4))  # -> out, geometries, colors, frames, frame, sticks, axis, modules_C; inputs root: Plane, stick_length: Double, rot_angle: Int32, module_count: Int32, m_index: Int32, s_index: Int32, f_index: Int32, offset_xxis: Int32, offset_yxis: Double, offset_zxis: Double
# ---------- python_3_script_4: Python ----------
# r: compas>=2.14.1
# venv: sticks

import sys
import os
import math

#get current file path
path = ghenv.Component.OnPingDocument().FilePath
print (path)
#get parent directory of the parent directory
parentdir = os.path.dirname(path)
print (parentdir)
#get src folder which contains classes
dire = os.path.join(parentdir,'group_one_scripts')
print (dire)

sys.path.append(dire)

from compas_rhino import unload_modules
frames 
# unload_modules("group_one_sticks")
unload_modules("scripts")
unload_modules("group_one_scripts")
unload_modules("stick_module_modified_frame")


import Sticks
import stick_module_modified_frame
from Sticks import Stick 
from stick_module_modified_frame import BranchingModule, BranchStickModules
from compas.geometry import Line, Point, Vector, Frame

stick_width = 13
stick_depth = 13    

from compas_rhino.conversions import plane_to_compas_frame, frame_to_rhino_plane

# Convert input to compas
root = plane_to_compas_frame(root)
# print(root)
# Initialize tree
tree = BranchStickModules(root, stick_length, width=stick_width, depth=stick_depth)
# Grow tree "def grow_stick(self, from_stick_index = -1, face_index = 0, angle = 0.0)""
# for i in range(x_count):
#     if i %2:
#         tree.grow_stick(from_stick_index = i, face_index = 2, angle = rot_angle)
#     else:
#         tree.grow_stick(from_stick_index = i, face_index = 2, angle = -rot_angle*i*factor)
modules_C = []
kframe = []
for i in range(module_count):
    mod = tree.grow_module( offset_xxis, offset_yxis, offset_zxis, from_module_index=i, from_stick_index=s_index, face_index=f_index, angle = rot_angle, move=output_frame)
    modules_C.append(mod)
# mod = tree.grow_module( offset_xxis, offset_yxis, offset_zxis, from_module_index=0, from_stick_index=s_index, face_index=f_index, angle = rot_angle, move=output_frame)
# modules_C.append(mod)
# mod = tree.grow_module( -11.3, offset_yxis, offset_zxis, from_module_index=1, from_stick_index=s_index, face_index=f_index, angle = rot_angle, move=output_frame)
# modules_C.append(mod)
# mod = tree.grow_module( offset_xxis, offset_yxis, offset_zxis-1, from_module_index=1, from_stick_index=2, face_index=f_index, angle = 90, move=output_frame)
# modules_C.append(mod)

    # k = tree.modules[i].sticks[s_index].frame
    # kframe.append(k)


# # Visualize
geometries = tree.visualize()
modules_C = tree.visualize()

 

####   Color with 4 different color to understand the branching method   ####
from System.Drawing import Color

color_1 = Color.FromArgb(255, 100, 0)     # orange
color_2 = Color.FromArgb(0, 150, 255)     # blue
color_3 = Color.FromArgb(0, 200, 80)      # green
color_4 = Color.FromArgb(200, 0, 200)     # magenta

color_list = [color_1, color_2, color_3, color_4]

colors = []

for module_index, module in enumerate(tree.modules):
    col = color_list[module_index % 4]

    for stick in module.sticks:
        colors.append(col)


#frame = tree.sticks[0].frame
frame = tree.modules[0].sticks[0].frame

frames = [stick.frame for module in tree.modules for stick in module.sticks]
axis = [stick.axis for module in tree.modules for stick in module.sticks]
sticks = [stick for module in tree.modules for stick in module.sticks]
# ---------- end python_3_script_4 ----------
py3_3 = Python3Script(
    x_count=Slider(3, range=0..15),
    y_count=Slider(5, range=0..15),
    x_space=Slider(302, range=0..400),
    y_space=Slider(232, range=0..400))  # -> out, points; inputs x_count: Int32, y_count: Int32, x_space: Double, y_space: Double; same code as py3
prot_2 = RotatePlane(Plane=xy_plane_3, Angle=number_slider_6)  # disabled
pt_5 = Point(Point(-21.50322422, 635.9257077, 0))

# ----
# json file creator inkl HELPERS
button = Button()
py3_4 = Python3Script(save=button)  # -> out, frames, assembly; inputs sticks: list, save: Boolean
# ---------- py3_4: Python ----------
from compas import json_dump
import os, sys
from itertools import combinations
from compas_rhino import unload_modules
from compas.geometry import Line, Plane, Vector, Point

#get current file path
path = ghenv.Component.OnPingDocument().FilePath
#get parent directory of the parent directory
parentdir = os.path.dirname(path)
#get src folder which contains classes
dire = os.path.join(parentdir,'group_one_scripts_send_to_robot')

sys.path.append(dire)
unload_modules("group_one_scripts_send_to_robot")
unload_modules("helpers")

from group_one_sticks import Stick 

from compas.datastructures import Assembly, Part

json_path = os.path.join(parentdir, 'data', 'stick_tilted_V2_assembly.json') # file is safed where gh file is stored, from there it puts it in data folder

stick_width = 13.0
stick_depth = 13.0
stick_length = 200

sticks_data = []

###########################################################################
# Make frames point in best direction
###########################################################################
import math
import copy

from compas.geometry import dot_vectors, Rotation
from compas.geometry import centroid_points

def is_parallel(v1, v2):
    if math.isclose(dot_vectors(v1, v2), 1, abs_tol = 0.001) or math.isclose(dot_vectors(v1, v2), -1 ,abs_tol = 0.001):
        # Means it is parallel
        #print("parallel")
        return True
    else:
        # Means it is not parallel
        #print("not parallel")
        return False

def get_frame_closest_to_target(target_vector, stick):
    best_dot = -1000.0
    for i in range(4):
        angle = math.pi/2 * i
        R = Rotation.from_axis_and_angle(stick.frame.xaxis, angle, stick.frame.point)
        frame = stick.frame.transformed(R)
        dot = dot_vectors(frame.zaxis, target_vector.unitized())
        if dot>best_dot:
            best_dot = dot
            best_frame = frame
            print(i)
    return best_frame

def get_center(sticks_list):
    all_points = [stick.frame.point for stick in sticks_list]
    center = centroid_points(all_points)
    # center_all = [c.translate(Vector(0,0,1)*-1) for c in center]
    # center.translate(Vector(0,0,1)*-1)
    #print(center)
    return center

# Copy sticks

sticks_copy = copy.deepcopy(sticks)
center_pt = get_center(sticks_copy)
print(center_pt)
center_point = Point[center_pt[0], center_pt[1], center_pt[2]]
center_point.translate(Vector(0,0,1)*-1)


for i,stick in enumerate(sticks_copy):
    if is_parallel(stick.axis.direction.unitized(), Vector(0,0,1)):
        # Target frame is frame pointing into center of structure
        center_vector = Vector.from_start_end(stick.frame.point, center_pt)
        best_frame = get_frame_closest_to_target(center_vector, stick=stick)
        stick.frame = best_frame

    else:
        # Make sure z axis is pointing down
        R = Rotation.from_axis_and_angle(stick.frame.xaxis, math.pi/2, stick.frame.point) #or erase /2
        stick.frame.transform(R)


from helpers import sort_sticks_by_z

sticks_copy = sort_sticks_by_z(sticks_copy)
from compas_rhino.conversions import frame_to_rhino_plane

###########################################################################
# Make frames point in best direction
###########################################################################

assembly = Assembly()
for i, s in enumerate(sticks_copy):
    part_name = "stick"+ str(i)
    part = Part(name = part_name, frame = s.frame)
    part.key = i
    part.attributes["shape"] = s.geometry
    assembly.add_part(part)
    

# frames = [frame_to_rhino_plane(p.frame) for p in assembly.parts()]
frames = [p.frame for p in assembly.parts()]



if save:
    json_dump(assembly, fp=json_path, pretty=True)
# ---------- end py3_4 ----------

# ----
# Point-Grid
# try %2 move Z by self.depth
number_slider_12 = Slider(2.2, range=0.1..6.8)
panel_2 = Panel("0")
panel_3 = Panel("270")  # disabled
offset_x_axis_5 = Slider(-5, range=-100..100)
module_count_5 = Slider(28, range=0..100)
offset_y_axis_5 = Slider(0, range=-100..100)
offset_z_axis_5 = Slider(-3, range=-100..100)
stick_index_5 = Slider(2, range=0..4)
face_index_5 = Slider(0, range=0..3)
draw_4 = COMPASDraw(cg=python_3_script_3.geometries)  # -> rg; same code as draw
rotation_4 = Slider(14, range=0..360)
# base code:
# stick_module_modified_frame
python_3_script_5 = Python3Script(
    root=prot_2,
    stick_length=panel,
    rot_angle=panel_3,
    module_count=module_count_3,
    m_index=module_index_3,
    s_index=stick_index_3,
    f_index=face_index_3,
    offset_xxis=offset_x_axis_3,
    offset_yxis=offset_y_axis_3,
    offset_zxis=offset_z_axis_3,
    output_frame=number_slider_7,
    face_idx=number_slider_9,
    stick_indx=number_slider_8)  # -> out, geometries, frames, colors, frame, faces, sticks, axis, modules_C; inputs root: Plane, stick_length: Double, rot_angle: Int32, module_count: Int32, m_index: Int32, s_index: Int32, f_index: Int32, offset_xxis: Int32, offset_yxis: Double, offset_zxis: Double, face_idx: Int32, stick_indx: Int32; disabled
# ---------- python_3_script_5: Python ----------
# r: compas>=2.14.1
# venv: sticks

import sys
import os
import math

#get current file path
path = ghenv.Component.OnPingDocument().FilePath
print (path)
#get parent directory of the parent directory
parentdir = os.path.dirname(path)
print (parentdir)
#get src folder which contains classes
dire = os.path.join(parentdir,'group_one_scripts')
print (dire)

sys.path.append(dire)

from compas_rhino import unload_modules
frames 
# unload_modules("group_one_sticks")
unload_modules("scripts")
unload_modules("group_one_scripts")
unload_modules("stick_module_modified_frame")


import Sticks
import stick_module_modified_frame
from Sticks import Stick 
from stick_module_modified_frame import BranchingModule, BranchStickModules
from compas.geometry import Line, Point, Vector, Frame, Rotation

stick_width = 13
stick_depth = 13    

from compas_rhino.conversions import plane_to_compas_frame, frame_to_rhino_plane

# Convert input to compas
root = plane_to_compas_frame(root)
# print(root)
# Initialize tree
tree = BranchStickModules(root, stick_length, width=stick_width, depth=stick_depth)
# Grow tree "def grow_stick(self, from_stick_index = -1, face_index = 0, angle = 0.0)""
# for i in range(x_count):
#     if i %2:
#         tree.grow_stick(from_stick_index = i, face_index = 2, angle = rot_angle)
#     else:
#         tree.grow_stick(from_stick_index = i, face_index = 2, angle = -rot_angle*i*factor)
modules_C = []

for i in range(module_count):
    mod = tree.grow_module( offset_xxis, offset_yxis, offset_zxis, from_module_index=i, from_stick_index=s_index, face_index=f_index, angle = rot_angle, move=output_frame)
    modules_C.append(mod)

    # k = tree.modules[i].sticks[s_index].frame
    # kframe.append(k)

faces = []
for i, module in enumerate (tree.modules):
    if stick_indx < len(module.sticks):
        stick = module.sticks[stick_indx]
        angle = face_idx * math.pi / 2
        R = Rotation.from_axis_and_angle(stick.frame.xaxis, angle=angle, point=stick.frame.point)
        face_frame = stick.frame.transformed(R)
        face_frame.point = stick.axis.midpoint
        # face_frame.point += face_frame.yaxis * stick.depth / 2
        if i % 2 == 0:
            faces.append(face_frame)

# # Visualize
geometries = tree.visualize()
modules_C = tree.visualize()

 

####   Color with 4 different color to understand the branching method   ####
from System.Drawing import Color

color_1 = Color.FromArgb(255, 100, 0)     # orange
color_2 = Color.FromArgb(0, 150, 255)     # blue
color_3 = Color.FromArgb(0, 200, 80)      # green
color_4 = Color.FromArgb(200, 0, 200)     # magenta

color_list = [color_1, color_2, color_3, color_4]

colors = []

for module_index, module in enumerate(tree.modules):
    col = color_list[module_index % 4]

    for stick in module.sticks:
        colors.append(col)


#frame = tree.sticks[0].frame
frame = tree.modules[0].sticks[0].frame

frames = [stick.frame for module in tree.modules for stick in module.sticks]
axis = [stick.axis for module in tree.modules for stick in module.sticks]
sticks = [stick for module in tree.modules for stick in module.sticks]
# ---------- end python_3_script_5 ----------
module_index_5 = Slider(0, range=0..30)
xy_plane_5 = XYPlane(Origin=pt_5)
draw_5 = COMPASDraw(cg=python_3_script_4.geometries)  # -> rg; same code as draw
colour_swatch = ColourSwatch(SwatchColor=RGB(227, 173, 93))
getplane = GetPlane(Numbers=python_3_script_4.frames)

# ----
# json file creator
button_2 = Button()  # disabled
py3_5 = Python3Script(sticks=python_3_script_5.sticks, save=button_2)  # -> out, frames, assembly; inputs sticks: list, save: Boolean; disabled
# ---------- py3_5: Python ----------
from compas import json_dump
import os, sys
from itertools import combinations
from compas_rhino import unload_modules
from compas.geometry import Line, Plane, Vector, Point

#get current file path
path = ghenv.Component.OnPingDocument().FilePath
#get parent directory of the parent directory
parentdir = os.path.dirname(path)
#get src folder which contains classes
dire = os.path.join(parentdir,'scripts')

sys.path.append(dire)

from group_one_sticks import Stick 

from compas.datastructures import Assembly, Part

json_path = os.path.join(parentdir, 'data', 'stick_FJmod5_assembly.json') # file is safed where gh file is stored, from there it puts it in data folder

stick_width = 13.0
stick_depth = 13.0
stick_length = 200

sticks_data = []

###########################################################################
# Make frames point in best direction
###########################################################################
import math
import copy

from compas.geometry import dot_vectors, Rotation
from compas.geometry import centroid_points

def is_parallel(v1, v2):
    if math.isclose(dot_vectors(v1, v2), 1, abs_tol = 0.001) or math.isclose(dot_vectors(v1, v2), -1 ,abs_tol = 0.001):
        # Means it is parallel
        print("parallel")
        return True
    else:
        # Means it is not parallel
        print("not parallel")
        return False

def get_frame_closest_to_target(target_vector, stick):
    best_dot = -1000.0
    for i in range(4):
        angle = math.pi/2 * i
        R = Rotation.from_axis_and_angle(stick.frame.xaxis, angle, stick.frame.point)
        frame = stick.frame.transformed(R)
        dot = dot_vectors(frame.zaxis, target_vector.unitized())
        if dot>best_dot:
            best_dot = dot
            best_frame = frame
            print(i)
    return best_frame

def get_center(sticks_list):
    all_points = [stick.frame.point for stick in sticks_list]
    center = centroid_points(all_points)
    print(center)
    return center

# Copy sticks

sticks_copy = copy.deepcopy(sticks)
center_pt = get_center(sticks_copy)


for stick in sticks_copy:
    if is_parallel(stick.axis.direction.unitized(), Vector(0,0,1)):
        # Target frame is frame pointing into center of structure
        center_vector = Vector.from_start_end(stick.frame.point, center_pt)
        best_frame = get_frame_closest_to_target(center_vector, stick=stick)
        stick.frame = best_frame

    else:
        # Make sure z axis is pointing down
        R = Rotation.from_axis_and_angle(stick.frame.xaxis, math.pi/2, stick.frame.point)
        stick.frame.transform(R)

from compas_rhino.conversions import frame_to_rhino_plane

###########################################################################
# Make frames point in best direction
###########################################################################

assembly = Assembly()
for i, s in enumerate(sticks_copy):
    part_name = "stick"+ str(i)
    part = Part(name = part_name, frame = s.frame)
    part.key = i
    part.attributes["shape"] = s.geometry
    assembly.add_part(part)
    

frames = [p.frame for p in assembly.parts()]

if save:
    json_dump(assembly, fp=json_path, pretty=True)
# ---------- end py3_5 ----------

draw_6 = COMPASDraw(cg=python_3_script_3.axis)  # -> rg; same code as draw
draw_7 = COMPASDraw(cg=python_3_script_3.modules_C)  # -> rg; disabled; same code as draw
draw_8 = COMPASDraw(cg=python_3_script_4.axis)  # -> rg; same code as draw
draw_9 = COMPASDraw(cg=python_3_script_4.modules_C)  # -> rg; disabled; same code as draw
prot_3 = RotatePlane(Plane=xy_plane_5, Angle=number_slider_12)
# base code:
# stick_module_modified_frame
python_3_script_6 = Python3Script(
    root=prot_3,
    stick_length="200",
    rot_angle=rotation_4,
    module_count=module_count_5,
    m_index=module_index_5,
    s_index=stick_index_5,
    f_index=face_index_5,
    offset_xxis=offset_x_axis_5,
    offset_yxis=offset_y_axis_5,
    offset_zxis=offset_z_axis_5,
    output_frame=Slider(-2, range=-2..4),
    face_idx=Slider(0, range=0..3),
    stick_indx=Slider(4, range=0..4))  # -> out, geometries, frames, colors, frame, faces, sticks, axis, modules_C; inputs root: Plane, stick_length: Double, rot_angle: Int32, module_count: Int32, m_index: Int32, s_index: Int32, f_index: Int32, offset_xxis: Int32, offset_yxis: Double, offset_zxis: Double, face_idx: Int32, stick_indx: Int32
# ---------- python_3_script_6: Python ----------
# r: compas>=2.14.1
# venv: sticks

import sys
import os
import math

#get current file path
path = ghenv.Component.OnPingDocument().FilePath
print (path)
#get parent directory of the parent directory
parentdir = os.path.dirname(path)
print (parentdir)
#get src folder which contains classes
dire = os.path.join(parentdir,'group_one_scripts')
print (dire)

sys.path.append(dire)

from compas_rhino import unload_modules
frames 
# unload_modules("group_one_sticks")
unload_modules("scripts")
unload_modules("group_one_scripts")
unload_modules("stick_module_modified_frame")


import Sticks
import stick_module_modified_frame
from Sticks import Stick 
from stick_module_modified_frame import BranchingModule, BranchStickModules
from compas.geometry import Line, Point, Vector, Frame, Rotation

stick_width = 13
stick_depth = 13    

from compas_rhino.conversions import plane_to_compas_frame, frame_to_rhino_plane

# Convert input to compas
root = plane_to_compas_frame(root)
# print(root)
# Initialize tree
tree = BranchStickModules(root, stick_length, width=stick_width, depth=stick_depth)
# Grow tree "def grow_stick(self, from_stick_index = -1, face_index = 0, angle = 0.0)""
# for i in range(x_count):
#     if i %2:
#         tree.grow_stick(from_stick_index = i, face_index = 2, angle = rot_angle)
#     else:
#         tree.grow_stick(from_stick_index = i, face_index = 2, angle = -rot_angle*i*factor)
modules_C = []

for i in range(module_count):
    mod = tree.grow_module( offset_xxis, offset_yxis, offset_zxis, from_module_index=i, from_stick_index=s_index, face_index=f_index, angle = rot_angle*i/10, move=output_frame)
    modules_C.append(mod)

    # k = tree.modules[i].sticks[s_index].frame
    # kframe.append(k)

faces = []
for i, module in enumerate (tree.modules):
    if stick_indx < len(module.sticks):
        stick = module.sticks[stick_indx]
        angle = face_idx * math.pi / 2
        R = Rotation.from_axis_and_angle(stick.frame.xaxis, angle=angle, point=stick.frame.point)
        face_frame = stick.frame.transformed(R)
        face_frame.point = stick.axis.midpoint
        # face_frame.point += face_frame.yaxis * stick.depth / 2
        if i % 2 == 0:
            faces.append(face_frame)

# # Visualize
geometries = tree.visualize()
modules_C = tree.visualize()

 

####   Color with 4 different color to understand the branching method   ####
from System.Drawing import Color

color_1 = Color.FromArgb(255, 100, 0)     # orange
color_2 = Color.FromArgb(0, 150, 255)     # blue
color_3 = Color.FromArgb(0, 200, 80)      # green
color_4 = Color.FromArgb(200, 0, 200)     # magenta

color_list = [color_1, color_2, color_3, color_4]

colors = []

for module_index, module in enumerate(tree.modules):
    col = color_list[module_index % 4]

    for stick in module.sticks:
        colors.append(col)


#frame = tree.sticks[0].frame
frame = tree.modules[0].sticks[0].frame

frames = [stick.frame for module in tree.modules for stick in module.sticks]
axis = [stick.axis for module in tree.modules for stick in module.sticks]
sticks = [stick for module in tree.modules for stick in module.sticks]
# ---------- end python_3_script_6 ----------
midpt_2 = CurveMiddle(Curve=draw_6)
midpt_3 = CurveMiddle(Curve=draw_8)
draw_10 = COMPASDraw(cg=python_3_script_5.geometries)  # -> rg; disabled; same code as draw
custom_preview_2 = CustomPreview(Geometry=draw_4, Material=ColourSwatch(SwatchColor=RGB(227, 173, 93)))
custom_preview_3 = CustomPreview(Geometry=draw_5, Material=python_3_script_4.colors)
colour_swatch_2 = ColourSwatch(SwatchColor=RGB(227, 173, 93))  # disabled
draw_11 = COMPASDraw(cg=python_3_script_5.axis)  # -> rg; disabled; same code as draw
draw_12 = COMPASDraw(cg=python_3_script_5.modules_C)  # -> rg; disabled; same code as draw
number_slider_13 = Slider(10, range=0..10)  # disabled
points_2 = PointList(Points=midpt_2, Size=Slider(10, range=0..10))
points_3 = PointList(Points=midpt_3, Size=Slider(10, range=0..10))
midpt_4 = CurveMiddle(Curve=draw_11)  # disabled
custom_preview_4 = CustomPreview(Geometry=draw_10, Material=colour_swatch_2)  # disabled

# ----
# json file
button_3 = Button()
py3_6 = Python3Script(sticks=python_3_script_2.sticks, save=button_3)  # -> out, frames, assembly; inputs sticks: list, save: Boolean
# ---------- py3_6: Python ----------
from compas import json_dump
import os, sys
from itertools import combinations
from compas_rhino import unload_modules
from compas.geometry import Line, Plane, Vector, Point

#get current file path
path = ghenv.Component.OnPingDocument().FilePath
#get parent directory of the parent directory
parentdir = os.path.dirname(path)
#get src folder which contains classes
dire = os.path.join(parentdir,'group_one_scripts_send_to_robot')

sys.path.append(dire)
unload_modules("group_one_scripts_send_to_robot")
unload_modules("helpers")

from group_one_sticks import Stick 

from compas.datastructures import Assembly, Part

json_path = os.path.join(parentdir, 'data', 'stick_FJmod5_assembly.json') # file is safed where gh file is stored, from there it puts it in data folder

stick_width = 13.0
stick_depth = 13.0
stick_length = 200

sticks_data = []

###########################################################################
# Make frames point in best direction
###########################################################################
import math
import copy

from compas.geometry import dot_vectors, Rotation
from compas.geometry import centroid_points

def is_parallel(v1, v2):
    if math.isclose(dot_vectors(v1, v2), 1, abs_tol = 0.001) or math.isclose(dot_vectors(v1, v2), -1 ,abs_tol = 0.001):
        # Means it is parallel
        print("parallel")
        return True
    else:
        # Means it is not parallel
        print("not parallel")
        return False

def get_frame_closest_to_target(target_vector, stick):
    best_dot = -1000.0
    for i in range(4):
        angle = math.pi/2 * i
        R = Rotation.from_axis_and_angle(stick.frame.xaxis, angle, stick.frame.point)
        frame = stick.frame.transformed(R)
        dot = dot_vectors(frame.zaxis, target_vector.unitized())
        if dot>best_dot:
            best_dot = dot
            best_frame = frame
            print(i)
    return best_frame

def get_center(sticks_list):
    all_points = [stick.frame.point for stick in sticks_list]
    center = centroid_points(all_points)
    print(center)
    return center

# Copy sticks

sticks_copy = copy.deepcopy(sticks)
center_pt = get_center(sticks_copy)


for stick in sticks_copy:
    if is_parallel(stick.axis.direction.unitized(), Vector(0,0,1)):
        # Target frame is frame pointing into center of structure
        center_vector = Vector.from_start_end(stick.frame.point, center_pt)
        best_frame = get_frame_closest_to_target(center_vector, stick=stick)
        stick.frame = best_frame

    else:
        # Make sure z axis is pointing down
        R = Rotation.from_axis_and_angle(stick.frame.xaxis, math.pi/2, stick.frame.point)
        stick.frame.transform(R)


from helpers import sort_sticks_by_z

sticks_copy = sort_sticks_by_z(sticks_copy)
from compas_rhino.conversions import frame_to_rhino_plane

###########################################################################
# Make frames point in best direction
###########################################################################

assembly = Assembly()
for i, s in enumerate(sticks_copy):
    part_name = "stick"+ str(i)
    part = Part(name = part_name, frame = s.frame)
    part.key = i
    part.attributes["shape"] = s.geometry
    assembly.add_part(part)
    

frames = [frame_to_rhino_plane(p.frame) for p in assembly.parts()]

if save:
    json_dump(assembly, fp=json_path, pretty=True)
# ---------- end py3_6 ----------

py3_7 = Python3Script(sticks=python_3_script_4.sticks, save=Button())  # -> out, frames, assembly; inputs sticks: list, save: Boolean
# ---------- py3_7: Python ----------
from compas import json_dump
import os, sys
from itertools import combinations
from compas_rhino import unload_modules
from compas.geometry import Line, Plane, Vector, Point

#get current file path
path = ghenv.Component.OnPingDocument().FilePath
#get parent directory of the parent directory
parentdir = os.path.dirname(path)
#get src folder which contains classes
dire = os.path.join(parentdir,'scripts')

sys.path.append(dire)

from group_one_sticks import Stick 

from compas.datastructures import Assembly, Part

json_path = os.path.join(parentdir, 'data', 'stick_assembly.json')

stick_width = 13.0
stick_depth = 13.0
stick_length = 200

sticks_data = []

###########################################################################
# Make frames point in best direction
###########################################################################
import math
import copy

from compas.geometry import dot_vectors, Rotation
from compas.geometry import centroid_points

def is_parallel(v1, v2):
    if math.isclose(dot_vectors(v1, v2), 1, abs_tol = 0.001) or math.isclose(dot_vectors(v1, v2), -1 ,abs_tol = 0.001):
        # Means it is parallel
        print("parallel")
        return True
    else:
        # Means it is not parallel
        print("not parallel")
        return False

def get_frame_closest_to_target(target_vector, stick):
    best_dot = -1000.0
    for i in range(4):
        angle = math.pi/2 * i
        R = Rotation.from_axis_and_angle(stick.frame.xaxis, angle, stick.frame.point)
        frame = stick.frame.transformed(R)
        dot = dot_vectors(frame.zaxis, target_vector.unitized())
        if dot>best_dot:
            best_dot = dot
            best_frame = frame
            print(i)
    return best_frame

def get_center(sticks_list):
    all_points = [stick.frame.point for stick in sticks_list]
    center = centroid_points(all_points)
    print(center)
    return center

# Copy sticks

sticks_copy = copy.deepcopy(sticks)
center_pt = get_center(sticks_copy)


for stick in sticks_copy:
    if is_parallel(stick.axis.direction.unitized(), Vector(0,0,1)):
        # Target frame is frame pointing into center of structure
        center_vector = Vector.from_start_end(stick.frame.point, center_pt)
        best_frame = get_frame_closest_to_target(center_vector, stick=stick)
        stick.frame = best_frame

    else:
        # Make sure z axis is pointing down
        R = Rotation.from_axis_and_angle(stick.frame.xaxis, math.pi/2, stick.frame.point)
        stick.frame.transform(R)

from compas_rhino.conversions import frame_to_rhino_plane

###########################################################################
# Make frames point in best direction
###########################################################################

assembly = Assembly()
for i, s in enumerate(sticks_copy):
    part_name = "stick"+ str(i)
    part = Part(name = part_name, frame = s.frame)
    part.key = i
    part.attributes["shape"] = s.geometry
    assembly.add_part(part)
    

frames = [frame_to_rhino_plane(p.frame) for p in assembly.parts()]

if save:
    json_dump(assembly, fp=json_path, pretty=True)
# ---------- end py3_7 ----------

draw_13 = COMPASDraw(cg=python_3_script_6.geometries)  # -> rg; same code as draw
points_4 = PointList(Points=midpt_4, Size=number_slider_13)  # disabled
# json file creator
py3_8 = Python3Script(sticks=python_3_script_6.sticks, save=Button())  # -> out, frames, assembly; inputs sticks: list, save: Boolean; same code as py3_5
draw_14 = COMPASDraw(cg=python_3_script_6.axis)  # -> rg; same code as draw
colour_swatch_3 = ColourSwatch(SwatchColor=RGB(227, 173, 93))
draw_15 = COMPASDraw(cg=python_3_script_6.modules_C)  # -> rg; same code as draw
midpt_5 = CurveMiddle(Curve=draw_14)
custom_preview_5 = CustomPreview(Geometry=draw_13, Material=python_3_script_6.colors)
points_5 = PointList(Points=midpt_5, Size=Slider(10, range=0..10))
points_6 = PointList(Points=py3_6.frames, Size=number_slider_11)
python_3_script_7 = Python3Script(frames=python_3_script_4.frames, factor=Slider(17, range=5..20))  # -> out, points, x_vectors, y_vectors, normal; inputs frames: list; disabled
# ---------- python_3_script_7: Python ----------
from compas.geometry import Vector
from compas.geometry import cross_vectors
from compas_rhino.conversions import vector_to_rhino
from compas_rhino.conversions import point_to_rhino

points = []
x_vectors = []
y_vectors = []
normal = []



for frame in frames:
    points.append(point_to_rhino(frame.point))
    x_vectors.append(vector_to_rhino(frame.xaxis * factor))
    y_vectors.append(vector_to_rhino(frame.yaxis * factor))
    normal.append(vector_to_rhino(frame.normal * factor))

#frames = [stick.frame for stick in tree.sticks]
# ---------- end python_3_script_7 ----------

# ----
# position of attractor: 2 = center
number_slider_14 = Slider(2, range=0..10)

# ----
# size rectangle
number_slider_15 = Slider(1000, range=0..1000)

vector_display_ex = VectorDisplayEx(
    Point=python_3_script_7.points,
    Vector=python_3_script_7.x_vectors,
    Colour=ColourSwatch(SwatchColor=RGB(191, 82, 82)),
    Width=2)
# check:"towermodule" branching out sticks FJ
vector_display_ex_2 = VectorDisplayEx(
    Point=python_3_script_7.points,
    Vector=python_3_script_7.y_vectors,
    Colour=ColourSwatch(SwatchColor=RGB(62, 80, 138)),
    Width=2)
vector_display_ex_3 = VectorDisplayEx(Vector=python_3_script_7.normal, Colour=ColourSwatch(SwatchColor=RGB(110, 145, 70)), Width=2)

# ----
# point count
number_slider_16 = Slider(28, range=0..500)

# ----
# seed of population
number_slider_17 = Slider(21, range=0..100)

# ----
# Pointcloud with Attractor
# attractor value
number_slider_18 = Slider(-0.44, range=-1..1)

division = Division(A=number_slider_15, B=number_slider_14)
rectangle = Rectangle(Plane=PlaneXY(0, 0, 0), XSize=number_slider_15, YSize=number_slider_15, Radius=0)  # -> Rectangle, Length
pt_6 = ConstructPoint(XCoordinate=division, YCoordinate=division, ZCoordinate=0)
pop2d = Populate2D(Region=rectangle.Rectangle, Count=number_slider_16, Seed=number_slider_17)
dist = Distance(PointA=pop2d, PointB=pt_6)
vec2pt = Vector2Pt(PointA=pt_6, PointB=pop2d, Unitize=False)  # -> Vector, Length
bnd = Bounds(Numbers=dist)
remap = RemapNumbers(Value=dist, Source=bnd, Target=number_slider_18)  # -> Mapped, Clipped
multiplication = Multiplication(A=vec2pt.Vector, B=remap.Mapped)
panel_4 = Panel(remap.Mapped)
move = Move(Geometry=pop2d, Motion=multiplication)  # -> Geometry, Transform
