# Grasshopper definition 251211_module_c_robot_5modules_v2.ghx (Grasshopper 1.0.8)

pt = Point(Point(-6.057325061e-09, 5.793225901e-07, 19.50000003))
pt_2 = Point(Point(-6.057325061e-09, 5.793225901e-07, 19.50000003))
xy_plane = XYPlane(Origin=pt)
xy_plane_2 = XYPlane(Origin=pt_2)
rotation = Slider(0, range=0..2000)
offset_x_axis = Slider(-6, range=-100..100)
offset_z_axis = Slider(-1, range=-100..100)
offset_x_axis_2 = Slider(-6, range=-100..100)
module_count = Slider(4, range=0..100)
module_index = Slider(0, range=0..30)
stick_index = Slider(4, range=0..4)
face_index = Slider(3, range=0..3)
offset_y_axis = Slider(0, range=-100..100)
rotation_2 = Slider(0, range=0..2000)
offset_z_axis_2 = Slider(-1, range=-100..100)
module_count_2 = Slider(0, range=0..100)
module_index_2 = Slider(0, range=0..30)
stick_index_2 = Slider(4, range=0..4)
face_index_2 = Slider(3, range=0..3)
offset_y_axis_2 = Slider(0, range=-100..100)
# base code:
# stick_module_modified_frame
python_3_script = Python3Script(
    root=xy_plane,
    stick_length="200",
    rot_angle=rotation,
    module_count=module_count,
    m_index=module_index,
    s_index=stick_index,
    f_index=face_index,
    offset_xxis=offset_x_axis,
    offset_yxis=offset_y_axis,
    offset_zxis=offset_z_axis,
    output_frame=Slider(0, range=-2..4))  # -> out, geometries, frames, kframe, axis, modules_C; inputs root: Plane, stick_length: Double, rot_angle: Int32, module_count: Int32, m_index: Int32, s_index: Int32, f_index: Int32, offset_xxis: Int32, offset_yxis: Double, offset_zxis: Double; disabled
# ---------- python_3_script: Python ----------
# r: compas>=2.14.1
# venv: sticks

import sys
import os
import math

#get current file path
path = ghenv.Component.OnPingDocument().FilePath
print (path)
#get parent directory of the parent directory
parentdir = os.path.dirname(path)
print (parentdir)
#get src folder which contains classes
dire = os.path.join(parentdir,'group_one_scripts')
print (dire)

sys.path.append(dire)

from compas_rhino import unload_modules
frames 
# unload_modules("group_one_sticks")
unload_modules("scripts")
unload_modules("group_one_scripts")
unload_modules("stick_module_modified_frame")


import Sticks
import stick_module_modified_frame
from Sticks import Stick 
from stick_module_modified_frame import BranchingModule, BranchStickModules
from compas.geometry import Line, Point, Vector, Frame

stick_width = 13
stick_depth = 13    

from compas_rhino.conversions import plane_to_compas_frame, frame_to_rhino_plane

# Convert input to compas
root = plane_to_compas_frame(root)
# print(root)
# Initialize tree
tree = BranchStickModules(root, stick_length, width=stick_width, depth=stick_depth)
# Grow tree "def grow_stick(self, from_stick_index = -1, face_index = 0, angle = 0.0)""
# for i in range(x_count):
#     if i %2:
#         tree.grow_stick(from_stick_index = i, face_index = 2, angle = rot_angle)
#     else:
#         tree.grow_stick(from_stick_index = i, face_index = 2, angle = -rot_angle*i*factor)
modules_C = []
kframe = []
for i in range(module_count):
    if i == 0:
        f_index = 0  # First one is 0
    elif i == 1:
        f_index = 0  # Second one is also 0
    else:
        f_index = 1 #((i - 2) % 4) + 1
    mod = tree.grow_module( offset_xxis, offset_yxis, offset_zxis, from_module_index=i, from_stick_index=s_index, face_index=f_index, angle = rot_angle, move=output_frame)

    modules_C.append(mod)
    
    # k = tree.modules[i].sticks[s_index].frame
    # kframe.append(k)


# # Visualize
geometries = tree.visualize()
modules_C = tree.visualize()

 

####   Color with 4 different color to understand the branching method   ####
from System.Drawing import Color

color_1 = Color.FromArgb(255, 100, 0)     # orange
color_2 = Color.FromArgb(0, 150, 255)     # blue
color_3 = Color.FromArgb(0, 200, 80)      # green
color_4 = Color.FromArgb(200, 0, 200)     # magenta

color_list = [color_1, color_2, color_3, color_4]

colors = []

for module_index, module in enumerate(tree.modules):
    col = color_list[module_index % 4]

    for stick in module.sticks:
        colors.append(col)


#frame = tree.sticks[0].frame
frame = tree.modules[0].sticks[0].frame

frames = [stick.frame for module in tree.modules for stick in module.sticks]
axis = [stick.axis for module in tree.modules for stick in module.sticks]
# ---------- end python_3_script ----------
# base code:
# stick_module_modified_frame
python_3_script_2 = Python3Script(
    root=xy_plane_2,
    stick_length="200",
    rot_angle=rotation_2,
    module_count=module_count_2,
    m_index=module_index_2,
    s_index=stick_index_2,
    f_index=face_index_2,
    offset_xxis=offset_x_axis_2,
    offset_yxis=offset_y_axis_2,
    offset_zxis=offset_z_axis_2,
    output_frame=Slider(0, range=-2..4))  # -> out, geometries, frames, kframe, axis, modules_C, sticks; inputs root: Plane, stick_length: Double, rot_angle: Int32, module_count: Int32, m_index: Int32, s_index: Int32, f_index: Int32, offset_xxis: Int32, offset_yxis: Double, offset_zxis: Double
# ---------- python_3_script_2: Python ----------
# r: compas>=2.14.1
# venv: sticks

import sys
import os
import math

#get current file path
path = ghenv.Component.OnPingDocument().FilePath
print (path)
#get parent directory of the parent directory
parentdir = os.path.dirname(path)
print (parentdir)
#get src folder which contains classes
dire = os.path.join(parentdir,'group_one_scripts')
print (dire)

sys.path.append(dire)

from compas_rhino import unload_modules
frames 
# unload_modules("group_one_sticks")
unload_modules("scripts")
unload_modules("group_one_scripts")
unload_modules("stick_module_modified_frame")


import Sticks
import stick_module_modified_frame
from Sticks import Stick 
from stick_module_modified_frame import BranchingModule, BranchStickModules
from compas.geometry import Line, Point, Vector, Frame

stick_width = 13
stick_depth = 13    

from compas_rhino.conversions import plane_to_compas_frame, frame_to_rhino_plane

# Convert input to compas
root = plane_to_compas_frame(root)
# print(root)
# Initialize tree
tree = BranchStickModules(root, stick_length, width=stick_width, depth=stick_depth)
# Grow tree "def grow_stick(self, from_stick_index = -1, face_index = 0, angle = 0.0)""
# for i in range(x_count):
#     if i %2:
#         tree.grow_stick(from_stick_index = i, face_index = 2, angle = rot_angle)
#     else:
#         tree.grow_stick(from_stick_index = i, face_index = 2, angle = -rot_angle*i*factor)
modules_C = []
kframe = []
for i in range(module_count):
    mod = tree.grow_module( offset_xxis, offset_yxis, offset_zxis, from_module_index=i, from_stick_index=s_index, face_index=f_index, angle = rot_angle, move=output_frame)
    modules_C.append(mod)
mod = tree.grow_module( offset_xxis, offset_yxis, offset_zxis, from_module_index=0, from_stick_index=s_index, face_index=f_index, angle = rot_angle, move=output_frame)
modules_C.append(mod)
mod = tree.grow_module( -11.3, offset_yxis, offset_zxis, from_module_index=1, from_stick_index=s_index, face_index=f_index, angle = rot_angle, move=output_frame)
modules_C.append(mod)
mod = tree.grow_module( offset_xxis, offset_yxis, offset_zxis-1, from_module_index=1, from_stick_index=2, face_index=f_index, angle = 90, move=output_frame)
modules_C.append(mod)

    # k = tree.modules[i].sticks[s_index].frame
    # kframe.append(k)


# # Visualize
geometries = tree.visualize()
modules_C = tree.visualize()

 

####   Color with 4 different color to understand the branching method   ####
from System.Drawing import Color

color_1 = Color.FromArgb(255, 100, 0)     # orange
color_2 = Color.FromArgb(0, 150, 255)     # blue
color_3 = Color.FromArgb(0, 200, 80)      # green
color_4 = Color.FromArgb(200, 0, 200)     # magenta

color_list = [color_1, color_2, color_3, color_4]

colors = []

for module_index, module in enumerate(tree.modules):
    col = color_list[module_index % 4]

    for stick in module.sticks:
        colors.append(col)


frames = []
sticks = []


sticks = [stick for module in tree.modules for stick in module.sticks]

geometries = [s.geometry for s in sticks]

# Frame list converted to Rhino planes, like before:
frames = [stick.frame for module in tree.modules for stick in module.sticks]
# frames = [frame_to_rhino_plane(s.frame) for s in sticks]




#frame = tree.sticks[0].frame
# frame = tree.modules[0].sticks[0].frame

# frames = [stick.frame for module in tree.modules for stick in module.sticks]
# axis = [stick.axis for module in tree.modules for stick in module.sticks]
# ---------- end python_3_script_2 ----------
draw = COMPASDraw(cg=python_3_script.geometries)  # -> rg
#   port cg: The COMPAS geometry or datastructure to be drawn.
#   port rg: The Rhino geometry object.
# ---------- draw: Python ----------
# r: compas>=2.14.1
"""
Draws COMPAS geometry in Grasshopper.
"""

from typing import Any

import Grasshopper

from compas.scene import SceneObject


class CompasToRhinoGeometry(Grasshopper.Kernel.GH_ScriptInstance):
    def RunScript(self, cg):
        if not cg:
            return None

        return SceneObject(item=cg).draw()
# ---------- end draw ----------
draw_2 = COMPASDraw(cg=python_3_script_2.geometries)  # -> rg; same code as draw
panel = Panel(python_3_script_2.sticks)
draw_3 = COMPASDraw(cg=python_3_script_2.frames)  # -> rg; same code as draw
draw_4 = COMPASDraw(cg=python_3_script.axis)  # -> rg; same code as draw
draw_5 = COMPASDraw(cg=python_3_script.modules_C)  # -> rg; disabled; same code as draw
draw_6 = COMPASDraw(cg=python_3_script_2.axis)  # -> rg; same code as draw
draw_7 = COMPASDraw(cg=python_3_script_2.modules_C)  # -> rg; disabled; same code as draw
midpt = CurveMiddle(Curve=draw_4)
midpt_2 = CurveMiddle(Curve=draw_6)
custom_preview = CustomPreview(Geometry=draw, Material=ColourSwatch(SwatchColor=RGB(227, 173, 93)))
custom_preview_2 = CustomPreview(Geometry=draw_2, Material=ColourSwatch(SwatchColor=RGB(227, 173, 93)))
points = PointList(Points=midpt, Size=Slider(10, range=0..10))
points_2 = PointList(Points=midpt_2, Size=Slider(10, range=0..10))
py3 = Python3Script(sticks=python_3_script_2.sticks, save=Button())  # -> out, frames, assembly; inputs sticks: list, save: Boolean
# ---------- py3: Python ----------
from compas import json_dump
import os, sys
from itertools import combinations
from compas_rhino import unload_modules
from compas.geometry import Line, Plane, Vector, Point

#get current file path
path = ghenv.Component.OnPingDocument().FilePath
#get parent directory of the parent directory
parentdir = os.path.dirname(path)
print(parentdir)

#get src folder which contains classes
dire = os.path.join(parentdir,'group_one_scripts')

sys.path.append(dire)

from sticks_251207 import Stick 

from compas.datastructures import Assembly, Part

json_path = os.path.join(parentdir, 'data', 'stick_assembly.json')

stick_width = 13.0
stick_depth = 13.0
stick_length = 200

sticks_data = []

###########################################################################
# Make frames point in best direction
###########################################################################
import math
import copy

from compas.geometry import dot_vectors, Rotation
from compas.geometry import centroid_points

def is_parallel(v1, v2):
    if math.isclose(dot_vectors(v1, v2), 1, abs_tol = 0.001) or math.isclose(dot_vectors(v1, v2), -1 ,abs_tol = 0.001):
        # Means it is parallel
        print("parallel")
        return True
    else:
        # Means it is not parallel
        print("not parallel")
        return False

def get_frame_closest_to_target(target_vector, stick):
    best_dot = -1000.0
    for i in range(4):
        angle = math.pi/2 * i
        R = Rotation.from_axis_and_angle(stick.frame.xaxis, angle, stick.frame.point)
        frame = stick.frame.transformed(R)
        dot = dot_vectors(frame.zaxis, target_vector.unitized())
        if dot>best_dot:
            best_dot = dot
            best_frame = frame
            print(i)
    return best_frame

def get_center(sticks_list):
    all_points = [stick.frame.point for stick in sticks_list]
    center = centroid_points(all_points)
    print(center)
    return center

# Copy sticks

sticks_copy = copy.deepcopy(sticks)
center_pt = get_center(sticks_copy)


for stick in sticks_copy:
    if is_parallel(stick.axis.direction.unitized(), Vector(0,0,1)):
        # Target frame is frame pointing into center of structure
        center_vector = Vector.from_start_end(stick.frame.point, center_pt)
        best_frame = get_frame_closest_to_target(center_vector, stick=stick)
        stick.frame = best_frame

    else:
        # Make sure z axis is pointing down
        R = Rotation.from_axis_and_angle(stick.frame.xaxis, math.pi/2, stick.frame.point)
        stick.frame.transform(R)

from compas_rhino.conversions import frame_to_rhino_plane

###########################################################################
# Make frames point in best direction
###########################################################################

assembly = Assembly()
for i, s in enumerate(sticks_copy):
    part_name = "stick"+ str(i)
    part = Part(name = part_name, frame = s.frame)
    part.key = i
    part.attributes["shape"] = s.geometry
    assembly.add_part(part)
    

frames = [frame_to_rhino_plane(p.frame) for p in assembly.parts()]

if save:
    json_dump(assembly, fp=json_path, pretty=True)
# ---------- end py3 ----------
point_list = PointList(Points=py3.frames, Size=Slider(27, range=0..100))
