# Grasshopper definition 251212_tower_bridge_2(1)_r.ghx (Grasshopper 1.0.8)

pt = Point(Point(0, 0, 0))  # disabled
number_slider = Slider(0.6877, range=0..6.2832)  # disabled
pt_2 = Point([Point(109.1977204, 62.75020872, 0), Point(-123.7172083, -43.85394162, 0), Point(249.9059691, -123.5207064, 0), Point(56.1244786, -247.5881841, 0)])
offset_x_axis = Slider(-5, range=-100..100)  # disabled
rotation = Slider(45, range=0..2000)  # disabled
offset_z_axis = Slider(-2, range=-100..100)  # disabled
number_slider_2 = Slider(0, range=-2..4)  # disabled
module_count = Slider(5, range=0..100)  # disabled
module_index = Slider(0, range=0..30)  # disabled
stick_index = Slider(3, range=0..4)  # disabled
face_index = Slider(0, range=0..3)  # disabled
offset_y_axis = Slider(0, range=-100..100)  # disabled
pt_3 = Point([<point referenced from the Rhino model> x2])
xy_plane = XYPlane(Origin=pt)  # disabled
number_slider_3 = Slider(0, range=0..3)  # disabled
number_slider_4 = Slider(4, range=0..4)  # disabled
panel = Panel("200")  # disabled
rotation_2 = Slider(56, range=0..2000)
offset_z_axis_2 = Slider(0, range=-100..100)
module_count_2 = Slider(2, range=0..100)
module_index_2 = Slider(0, range=0..30)
stick_index_2 = Slider(4, range=0..4)
face_index_2 = Slider(0, range=0..3)
offset_x_axis_2 = Slider(0, range=-100..100)
offset_y_axis_2 = Slider(0, range=-100..100)
xy_plane_2 = XYPlane(Origin=pt_3)
panel_2 = Panel("270")  # disabled
prot = RotatePlane(Plane=xy_plane, Angle=number_slider)  # disabled
knob = ControlKnob(Decimals=0, Limit=False, Maximum=50, Minimum=0, Range=50, Value=27)  # disabled
prot_2 = RotatePlane(Plane=xy_plane_2, Angle=Slider(0, range=0..2))
# base code:
# stick_module_modified_frame
python_3_script = Python3Script(
    root=prot,
    stick_length=panel,
    rot_angle=rotation,
    module_count=module_count,
    m_index=module_index,
    s_index=stick_index,
    f_index=face_index,
    offset_xxis=offset_x_axis,
    offset_yxis=offset_y_axis,
    offset_zxis=offset_z_axis,
    output_frame=number_slider_2,
    face_idx=number_slider_3,
    stick_indx=number_slider_4)  # -> out, geometries, frames, frame, faces, sticks, axis, modules_C; inputs root: Plane, stick_length: Double, rot_angle: Int32, module_count: Int32, m_index: Int32, s_index: Int32, f_index: Int32, offset_xxis: Int32, offset_yxis: Double, offset_zxis: Double, face_idx: Int32, stick_indx: Int32; disabled
# ---------- python_3_script: Python ----------
# r: compas>=2.14.1
# venv: sticks

import sys
import os
import math

#get current file path
path = ghenv.Component.OnPingDocument().FilePath
print (path)
#get parent directory of the parent directory
parentdir = os.path.dirname(path)
print (parentdir)
#get src folder which contains classes
dire = os.path.join(parentdir,'group_one_scripts')
print (dire)

sys.path.append(dire)

from compas_rhino import unload_modules
frames 
# unload_modules("group_one_sticks")
unload_modules("scripts")
unload_modules("group_one_scripts")
unload_modules("stick_module_modified_frame")


import Sticks
import stick_module_modified_frame
from Sticks import Stick 
from stick_module_modified_frame import BranchingModule, BranchStickModules
from compas.geometry import Line, Point, Vector, Frame, Rotation

stick_width = 13
stick_depth = 13    

from compas_rhino.conversions import plane_to_compas_frame, frame_to_rhino_plane

# Convert input to compas
root = plane_to_compas_frame(root)
# print(root)
# Initialize tree
tree = BranchStickModules(root, stick_length, width=stick_width, depth=stick_depth)
# Grow tree "def grow_stick(self, from_stick_index = -1, face_index = 0, angle = 0.0)""
# for i in range(x_count):
#     if i %2:
#         tree.grow_stick(from_stick_index = i, face_index = 2, angle = rot_angle)
#     else:
#         tree.grow_stick(from_stick_index = i, face_index = 2, angle = -rot_angle*i*factor)
modules_C = []

for i in range(module_count):
    mod = tree.grow_module( offset_xxis, offset_yxis, offset_zxis, from_module_index=i, from_stick_index=s_index, face_index=f_index, angle = rot_angle, move=output_frame)
    modules_C.append(mod)

    # k = tree.modules[i].sticks[s_index].frame
    # kframe.append(k)

faces = []
for i, module in enumerate (tree.modules):
    if stick_indx < len(module.sticks):
        stick = module.sticks[stick_indx]
        angle = face_idx * math.pi / 2
        R = Rotation.from_axis_and_angle(stick.frame.xaxis, angle=angle, point=stick.frame.point)
        face_frame = stick.frame.transformed(R)
        face_frame.point = stick.axis.midpoint
        # face_frame.point += face_frame.yaxis * stick.depth / 2
        if i % 2:
            faces.append(face_frame)

# # Visualize
geometries = tree.visualize()
modules_C = tree.visualize()

 

####   Color with 4 different color to understand the branching method   ####
from System.Drawing import Color

color_1 = Color.FromArgb(255, 100, 0)     # orange
color_2 = Color.FromArgb(0, 150, 255)     # blue
color_3 = Color.FromArgb(0, 200, 80)      # green
color_4 = Color.FromArgb(200, 0, 200)     # magenta

color_list = [color_1, color_2, color_3, color_4]

colors = []

for module_index, module in enumerate(tree.modules):
    col = color_list[module_index % 4]

    for stick in module.sticks:
        colors.append(col)


#frame = tree.sticks[0].frame
frame = tree.modules[0].sticks[0].frame

frames = [stick.frame for module in tree.modules for stick in module.sticks]
axis = [stick.axis for module in tree.modules for stick in module.sticks]
sticks = [stick for module in tree.modules for stick in module.sticks]
# ---------- end python_3_script ----------
number_slider_5 = Slider(1, range=0..4)  # disabled

# ----
# json file creator
button = Button()  # disabled
py3 = Python3Script(sticks=python_3_script.sticks, save=button, failed_stick_index=knob, rotation=number_slider_5)  # -> out, frames, assembly; inputs sticks: list, save: Boolean, failed_stick_index: Int32, rotation: Int32; disabled
# ---------- py3: Python ----------
from compas import json_dump
import os, sys
from itertools import combinations
from compas_rhino import unload_modules
from compas.geometry import Line, Plane, Vector, Point

#get current file path
path = ghenv.Component.OnPingDocument().FilePath
#get parent directory of the parent directory
parentdir = os.path.dirname(path)
#get src folder which contains classes
dire = os.path.join(parentdir,'group_one_scripts_send_to_robot')

sys.path.append(dire)
unload_modules("group_one_scripts_send_to_robot")
unload_modules("helpers")

from group_one_sticks import Stick 

from compas.datastructures import Assembly, Part

json_path = os.path.join(parentdir, 'data', 'stick_tilted_V2_assembly_b3.json') # file is safed where gh file is stored, from there it puts it in data folder

stick_width = 13.0
stick_depth = 13.0
stick_length = 200

sticks_data = []
f_index = failed_stick_index
rotation = rotation

###########################################################################
# Make frames point in best direction
###########################################################################
import math
import copy

from compas.geometry import dot_vectors, Rotation
from compas.geometry import centroid_points

def is_parallel(v1, v2):
    if math.isclose(dot_vectors(v1, v2), 1, abs_tol = .01) or math.isclose(dot_vectors(v1, v2), -1 ,abs_tol = .01):
        # Means it is parallel
        # print("parallel")
        return True
    else:
        # Means it is not parallel
        # print("not parallel")
        return False

def is_parallel_same_direction(v1, v2, direction):
    if math.isclose(dot_vectors(v1, v2), direction, abs_tol = 0.001):
        return True
    else:
        return False

def is_parallel_point_down(v1, v2, direction):
    if dot_vectors(v1, v2) > direction:
        # print(dot_vectors(v1, v2))
        return True
    else:
        # print((dot_vectors(v1, v2)), "false")
        return False

def get_frame_closest_to_target(target_vector, stick):
    best_dot = -1000.0
    for i in range(4):
        angle = math.pi/2 * i
        R = Rotation.from_axis_and_angle(stick.frame.xaxis, angle, stick.frame.point)
        frame = stick.frame.transformed(R)
        dot = dot_vectors(frame.zaxis, target_vector.unitized())
        if dot>best_dot:
            best_dot = dot
            best_frame = frame
            # print(i)
    return best_frame

def get_center(sticks_list):
    all_points = [stick.frame.point for stick in sticks_list]
    center = centroid_points(all_points)
    # print(center)
    return center

# Copy sticks

from helpers import sort_sticks_by_z

sticks_copy = copy.deepcopy(sticks)
center_pt = get_center(sticks_copy)
sticks_copy = sort_sticks_by_z(sticks_copy)



for i,stick in enumerate(sticks_copy):
    if is_parallel(stick.axis.direction.unitized(), Vector(0,0,1)):
        # Target frame is frame pointing into center of structure
        center_vector = Vector.from_start_end(stick.frame.point, center_pt)
        best_frame = get_frame_closest_to_target(-center_vector, stick=stick)
        stick.frame = best_frame

    # elif i == f_index:
    #     print("True")
    #     R_stick = Rotation.from_axis_and_angle(stick.frame.xaxis, math.pi*rotation, stick.frame.point)
    #     print(R_stick)
    #     if stick.frame.transform(R_stick):
    #         print("True")

    else:
        # Make sure z axis is pointing down
        R = Rotation.from_axis_and_angle(stick.frame.xaxis, math.pi/2, stick.frame.point)
        stick.frame.transform(R)
        if is_parallel_same_direction(stick.frame.zaxis, Vector(0,0,1), -1):
            continue
        else:
            R_new = Rotation.from_axis_and_angle(stick.frame.xaxis, math.pi/2, stick.frame.point)
            stick.frame.transform(R_new)
        if is_parallel_same_direction(stick.frame.zaxis, Vector(0,0,1), -1):
            continue
        else:
            R_new = Rotation.from_axis_and_angle(stick.frame.xaxis, math.pi, stick.frame.point)
            stick.frame.transform(R_new)
        
        if is_parallel_point_down(stick.frame.zaxis, Vector(0,0,1), 0):
            R_new = Rotation.from_axis_and_angle(stick.frame.xaxis, math.pi, stick.frame.point)
            stick.frame.transform(R_new)
        else:
            R_new = Rotation.from_axis_and_angle(stick.frame.xaxis, 0, stick.frame.point)
            stick.frame.transform(R_new)

for i, s in enumerate(sticks_copy):
    if i == f_index:
        angle = math.pi/2 * rotation
        R_stick = Rotation.from_axis_and_angle(s.frame.xaxis, angle, s.frame.point)
        new_frame = s.frame.transformed(R_stick)
        s.frame = new_frame
        
        




from compas_rhino.conversions import frame_to_rhino_plane

###########################################################################
# Make frames point in best direction
###########################################################################

assembly = Assembly()
for i, s in enumerate(sticks_copy):
    part_name = f"stick{i:04d}"
    # print(part_name)
    part = Part(name = part_name, frame = s.frame)
    part.key = i
    part.attributes["shape"] = s.geometry
    assembly.add_part(part)



frames = [frame_to_rhino_plane(p.frame) for p in assembly.parts()]

if save:
    json_dump(assembly, fp=json_path, pretty=True)
# ---------- end py3 ----------

# ----
# base code:
# stick_module_modified_frame
python_3_script_2 = Python3Script(
    root=prot_2,
    stick_length="200",
    rot_angle=rotation_2,
    module_count=module_count_2,
    m_index=module_index_2,
    s_index=stick_index_2,
    f_index=face_index_2,
    offset_xxis=offset_x_axis_2,
    offset_yxis=offset_y_axis_2,
    offset_zxis=offset_z_axis_2,
    output_frame=Slider(0, range=-2..4),
    face_idx=Slider(0, range=0..3),
    stick_indx=Slider(4, range=0..4))  # -> out, geometries, frames, frame, faces, flatten(sticks), axis, modules_C; inputs root: Plane, stick_length: Double, rot_angle: Int32, module_count: Int32, m_index: Int32, s_index: Int32, f_index: Int32, offset_xxis: Int32, offset_yxis: Double, offset_zxis: Double, face_idx: Int32, stick_indx: Int32
# ---------- python_3_script_2: Python ----------
# r: compas>=2.14.1
# venv: sticks

import sys
import os
import math

#get current file path
path = ghenv.Component.OnPingDocument().FilePath
print (path)
#get parent directory of the parent directory
parentdir = os.path.dirname(path)
print (parentdir)
#get src folder which contains classes
dire = os.path.join(parentdir,'group_one_scripts')
print (dire)

sys.path.append(dire)

from compas_rhino import unload_modules
frames 
# unload_modules("group_one_sticks")
unload_modules("scripts")
unload_modules("group_one_scripts")
unload_modules("stick_module_modified_frame")


import Sticks
import stick_module_modified_frame
from Sticks import Stick 
from stick_module_modified_frame import BranchingModule, BranchStickModules
from compas.geometry import Line, Point, Vector, Frame, Rotation

stick_width = 13
stick_depth = 13    

from compas_rhino.conversions import plane_to_compas_frame, frame_to_rhino_plane

# Convert input to compas
root = plane_to_compas_frame(root)
# print(root)
# Initialize tree
tree = BranchStickModules(root, stick_length, width=stick_width, depth=stick_depth)
# Grow tree "def grow_stick(self, from_stick_index = -1, face_index = 0, angle = 0.0)""
# for i in range(x_count):
#     if i %2:
#         tree.grow_stick(from_stick_index = i, face_index = 2, angle = rot_angle)
#     else:
#         tree.grow_stick(from_stick_index = i, face_index = 2, angle = -rot_angle*i*factor)
modules_C = []

for i in range(module_count):
    mod = tree.grow_module( offset_xxis, offset_yxis, offset_zxis, from_module_index=i, from_stick_index=s_index, face_index=f_index, angle = rot_angle, move=output_frame)
    modules_C.append(mod)

    # k = tree.modules[i].sticks[s_index].frame
    # kframe.append(k)

faces = []
for i, module in enumerate (tree.modules):
    if stick_indx < len(module.sticks):
        stick = module.sticks[stick_indx]
        angle = face_idx * math.pi / 2
        R = Rotation.from_axis_and_angle(stick.frame.xaxis, angle=angle, point=stick.frame.point)
        face_frame = stick.frame.transformed(R)
        face_frame.point = stick.axis.midpoint
        # face_frame.point += face_frame.yaxis * stick.depth / 2
        if i % 2 == 0:
            faces.append(face_frame)

# # Visualize
geometries = tree.visualize()
modules_C = tree.visualize()

 

####   Color with 4 different color to understand the branching method   ####
from System.Drawing import Color

color_1 = Color.FromArgb(255, 100, 0)     # orange
color_2 = Color.FromArgb(0, 150, 255)     # blue
color_3 = Color.FromArgb(0, 200, 80)      # green
color_4 = Color.FromArgb(200, 0, 200)     # magenta

color_list = [color_1, color_2, color_3, color_4]

colors = []

for module_index, module in enumerate(tree.modules):
    col = color_list[module_index % 4]

    for stick in module.sticks:
        colors.append(col)


#frame = tree.sticks[0].frame
frame = tree.modules[0].sticks[0].frame

frames = [stick.frame for module in tree.modules for stick in module.sticks]
axis = [stick.axis for module in tree.modules for stick in module.sticks]
sticks = [stick for module in tree.modules for stick in module.sticks]
# ---------- end python_3_script_2 ----------

# ----
# json file creator
button_2 = Button()
py3_2 = Python3Script(sticks=python_3_script_2.sticks, save=button_2)  # -> out, frames, assembly; inputs sticks: list, save: Boolean
# ---------- py3_2: Python ----------
from compas import json_dump
import os, sys
from itertools import combinations
from compas_rhino import unload_modules
from compas.geometry import Line, Plane, Vector, Point

#get current file path
path = ghenv.Component.OnPingDocument().FilePath
#get parent directory of the parent directory
parentdir = os.path.dirname(path)
#get src folder which contains classes
dire = os.path.join(parentdir,'scripts')

sys.path.append(dire)

from group_one_sticks import Stick 

from compas.datastructures import Assembly, Part

json_path = os.path.join(parentdir, 'data', 'stick_FJmod5_assembly.json') # file is safed where gh file is stored, from there it puts it in data folder

stick_width = 13.0
stick_depth = 13.0
stick_length = 200

sticks_data = []

###########################################################################
# Make frames point in best direction
###########################################################################
import math
import copy

from compas.geometry import dot_vectors, Rotation
from compas.geometry import centroid_points

def is_parallel(v1, v2):
    if math.isclose(dot_vectors(v1, v2), 1, abs_tol = 0.001) or math.isclose(dot_vectors(v1, v2), -1 ,abs_tol = 0.001):
        # Means it is parallel
        print("parallel")
        return True
    else:
        # Means it is not parallel
        print("not parallel")
        return False

def get_frame_closest_to_target(target_vector, stick):
    best_dot = -1000.0
    for i in range(4):
        angle = math.pi/2 * i
        R = Rotation.from_axis_and_angle(stick.frame.xaxis, angle, stick.frame.point)
        frame = stick.frame.transformed(R)
        dot = dot_vectors(frame.zaxis, target_vector.unitized())
        if dot>best_dot:
            best_dot = dot
            best_frame = frame
            print(i)
    return best_frame

def get_center(sticks_list):
    all_points = [stick.frame.point for stick in sticks_list]
    center = centroid_points(all_points)
    print(center)
    return center

# Copy sticks

sticks_copy = copy.deepcopy(sticks)
center_pt = get_center(sticks_copy)


for stick in sticks_copy:
    if is_parallel(stick.axis.direction.unitized(), Vector(0,0,1)):
        # Target frame is frame pointing into center of structure
        center_vector = Vector.from_start_end(stick.frame.point, center_pt)
        best_frame = get_frame_closest_to_target(center_vector, stick=stick)
        stick.frame = best_frame

    else:
        # Make sure z axis is pointing down
        R = Rotation.from_axis_and_angle(stick.frame.xaxis, math.pi/2, stick.frame.point)
        stick.frame.transform(R)

from compas_rhino.conversions import frame_to_rhino_plane

###########################################################################
# Make frames point in best direction
###########################################################################

assembly = Assembly()
for i, s in enumerate(sticks_copy):
    part_name = "stick"+ str(i)
    part = Part(name = part_name, frame = s.frame)
    part.key = i
    part.attributes["shape"] = s.geometry
    assembly.add_part(part)
    

frames = [p.frame for p in assembly.parts()]

if save:
    json_dump(assembly, fp=json_path, pretty=True)
# ---------- end py3_2 ----------

draw = COMPASDraw(cg=python_3_script.frames)  # -> rg; disabled
#   port cg: The COMPAS geometry or datastructure to be drawn.
#   port rg: The Rhino geometry object.
# ---------- draw: Python ----------
# r: compas>=2.14.1
"""
Draws COMPAS geometry in Grasshopper.
"""

from typing import Any

import Grasshopper

from compas.scene import SceneObject


class CompasToRhinoGeometry(Grasshopper.Kernel.GH_ScriptInstance):
    def RunScript(self, cg):
        if not cg:
            return None

        return SceneObject(item=cg).draw()
# ---------- end draw ----------
draw_2 = COMPASDraw(cg=python_3_script.geometries)  # -> rg; disabled; same code as draw
panel_3 = Panel("25")  # disabled
colour_swatch = ColourSwatch(SwatchColor=RGBA(227, 173, 93, 165))  # disabled
draw_3 = COMPASDraw(cg=python_3_script.axis)  # -> rg; disabled; same code as draw
draw_4 = COMPASDraw(cg=python_3_script.modules_C)  # -> rg; disabled; same code as draw
number_slider_6 = Slider(16, range=0..50)  # disabled
previewcompasframe = PreviewCompasFrame(B=panel_3, L=draw)  # disabled
draw_5 = COMPASDraw(cg=python_3_script_2.geometries)  # -> rg; same code as draw
draw_6 = COMPASDraw(cg=python_3_script_2.axis)  # -> rg; same code as draw
draw_7 = COMPASDraw(cg=python_3_script_2.modules_C)  # -> rg; disabled; same code as draw
midpt = CurveMiddle(Curve=draw_3)  # disabled
custom_preview = CustomPreview(Geometry=draw_2, Material=colour_swatch)  # disabled
panel_4 = Panel("50")  # disabled
midpt_2 = CurveMiddle(Curve=draw_6)
points = PointList(Points=midpt, Size=number_slider_6)  # disabled
custom_preview_2 = CustomPreview(Geometry=draw_5, Material=ColourSwatch(SwatchColor=RGBA(227, 173, 93, 204)))
previewrhinoplane = PreviewRhinoPlane(B=panel_4, pln=py3.frames)  # disabled
points_2 = PointList(Points=py3.frames, Size=number_slider_6)  # disabled
points_3 = PointList(Points=midpt_2, Size=Slider(10, range=0..10))

# ----
# connecting Sticks A
draw_8 = COMPASDraw(cg=python_3_script.faces)  # -> rg; disabled; same code as draw
colour_swatch_2 = ColourSwatch(SwatchColor=RGB(204, 16, 16))  # disabled
custom_preview_3 = CustomPreview(Geometry=draw_8, Material=colour_swatch_2)  # disabled

# ----
# connecting Sticks B
draw_9 = COMPASDraw(cg=python_3_script_2.faces)  # -> rg; same code as draw
custom_preview_4 = CustomPreview(Geometry=draw_9, Material=ColourSwatch(SwatchColor=RGB(79, 168, 59)))

knob_2 = ControlKnob(Decimals=0, Limit=False, Maximum=50, Minimum=0, Range=50, Value=0)

# ----
# json file creator
button_3 = Button()
py3_3 = Python3Script(sticks=python_3_script_2.sticks, save=button_3, failed_stick_index=knob_2, rotation=Slider(0, range=0..4))  # -> out, frames, assembly; inputs sticks: list, save: Boolean, failed_stick_index: Int32, rotation: Int32
# ---------- py3_3: Python ----------
from compas import json_dump
import os, sys
from itertools import combinations
from compas_rhino import unload_modules
from compas.geometry import Line, Plane, Vector, Point

#get current file path
path = ghenv.Component.OnPingDocument().FilePath
#get parent directory of the parent directory
parentdir = os.path.dirname(path)
#get src folder which contains classes
dire = os.path.join(parentdir,'group_one_scripts_send_to_robot')

sys.path.append(dire)
unload_modules("group_one_scripts_send_to_robot")
unload_modules("helpers")

from group_one_sticks import Stick 

from compas.datastructures import Assembly, Part

json_path = os.path.join(parentdir, 'data', 'stick_tilted_V3_assembly_fj.json') # file is safed where gh file is stored, from there it puts it in data folder

stick_width = 13.0
stick_depth = 13.0
stick_length = 200

sticks_data = []
f_index = failed_stick_index
rotation = rotation

###########################################################################
# Make frames point in best direction
###########################################################################
import math
import copy

from compas.geometry import dot_vectors, Rotation
from compas.geometry import centroid_points

def is_parallel(v1, v2):
    if math.isclose(dot_vectors(v1, v2), 1, abs_tol = .01) or math.isclose(dot_vectors(v1, v2), -1 ,abs_tol = .01):
        # Means it is parallel
        # print("parallel")
        return True
    else:
        # Means it is not parallel
        # print("not parallel")
        return False

def is_parallel_same_direction(v1, v2, direction):
    if math.isclose(dot_vectors(v1, v2), direction, abs_tol = 0.001):
        return True
    else:
        return False

def is_parallel_point_down(v1, v2, direction):
    if dot_vectors(v1, v2) > direction:
        # print(dot_vectors(v1, v2))
        return True
    else:
        # print((dot_vectors(v1, v2)), "false")
        return False

def get_frame_closest_to_target(target_vector, stick):
    best_dot = -1000.0
    for i in range(4):
        angle = math.pi/2 * i
        R = Rotation.from_axis_and_angle(stick.frame.xaxis, angle, stick.frame.point)
        frame = stick.frame.transformed(R)
        dot = dot_vectors(frame.zaxis, target_vector.unitized())
        if dot>best_dot:
            best_dot = dot
            best_frame = frame
            # print(i)
    return best_frame

def get_center(sticks_list):
    all_points = [stick.frame.point for stick in sticks_list]
    center = centroid_points(all_points)
    # print(center)
    return center

# Copy sticks

from helpers import sort_sticks_by_z

sticks_copy = copy.deepcopy(sticks)
center_pt = get_center(sticks_copy)
sticks_copy = sort_sticks_by_z(sticks_copy)



for i,stick in enumerate(sticks_copy):
    if is_parallel(stick.axis.direction.unitized(), Vector(0,0,1)):
        # Target frame is frame pointing into center of structure
        center_vector = Vector.from_start_end(stick.frame.point, center_pt)
        best_frame = get_frame_closest_to_target(-center_vector, stick=stick)
        stick.frame = best_frame

    # elif i == f_index:
    #     print("True")
    #     R_stick = Rotation.from_axis_and_angle(stick.frame.xaxis, math.pi*rotation, stick.frame.point)
    #     print(R_stick)
    #     if stick.frame.transform(R_stick):
    #         print("True")

    else:
        # Make sure z axis is pointing down
        R = Rotation.from_axis_and_angle(stick.frame.xaxis, math.pi/2, stick.frame.point)
        stick.frame.transform(R)
        if is_parallel_same_direction(stick.frame.zaxis, Vector(0,0,1), -1):
            continue
        else:
            R_new = Rotation.from_axis_and_angle(stick.frame.xaxis, math.pi/2, stick.frame.point)
            stick.frame.transform(R_new)
        if is_parallel_same_direction(stick.frame.zaxis, Vector(0,0,1), -1):
            continue
        else:
            R_new = Rotation.from_axis_and_angle(stick.frame.xaxis, math.pi, stick.frame.point)
            stick.frame.transform(R_new)
        
        if is_parallel_point_down(stick.frame.zaxis, Vector(0,0,1), 0):
            R_new = Rotation.from_axis_and_angle(stick.frame.xaxis, math.pi, stick.frame.point)
            stick.frame.transform(R_new)
        else:
            R_new = Rotation.from_axis_and_angle(stick.frame.xaxis, 0, stick.frame.point)
            stick.frame.transform(R_new)

for i, s in enumerate(sticks_copy):
    if i == f_index:
        angle = math.pi/2 * rotation
        R_stick = Rotation.from_axis_and_angle(s.frame.xaxis, angle, s.frame.point)
        new_frame = s.frame.transformed(R_stick)
        s.frame = new_frame
        
        




from compas_rhino.conversions import frame_to_rhino_plane

###########################################################################
# Make frames point in best direction
###########################################################################

assembly = Assembly()
for i, s in enumerate(sticks_copy):
    part_name = f"stick{i:04d}"
    # print(part_name)
    part = Part(name = part_name, frame = s.frame)
    part.key = i
    part.attributes["shape"] = s.geometry
    assembly.add_part(part)



frames = [frame_to_rhino_plane(p.frame) for p in assembly.parts()]

if save:
    json_dump(assembly, fp=json_path, pretty=True)
# ---------- end py3_3 ----------

previewrhinoplane_2 = PreviewRhinoPlane(B="50", pln=py3_3.frames)
points_4 = PointList(Points=py3_3.frames, Size=Slider(10, range=10..20))

# ==== cluster PreviewRhinoPlane
B = ClusterInput()
pln = ClusterInput()
pln_2 = Plane(pln)
deplane = DeconstructPlane(Plane=pln_2)  # -> Origin, XAxis, YAxis, ZAxis
multiplication = Multiplication(A="1", B=B)
amp = Amplitude(Vector=deplane.ZAxis, Amplitude=multiplication)
amp_2 = Amplitude(Vector=deplane.XAxis, Amplitude=multiplication)
amp_3 = Amplitude(Vector=deplane.YAxis, Amplitude=multiplication)
vdisex = VectorDisplayEx(Point=deplane.Origin, Vector=amp_2, Colour=ColourSwatch(SwatchColor=RGB(255, 0, 0)), Width="3")
vdisex_2 = VectorDisplayEx(Point=deplane.Origin, Vector=amp_3, Colour=ColourSwatch(SwatchColor=RGB(0, 255, 60)), Width="3")
vdisex_3 = VectorDisplayEx(Point=deplane.Origin, Vector=amp, Colour=ColourSwatch(SwatchColor=RGB(0, 85, 255)), Width="3")

# ==== cluster PreviewCompasFrame
B = ClusterInput()
L = ClusterInput()
item = ListItem(List=L, Index=0, Wrap=True)  # -> Item1, Item, Item1_2, Item2
len = Length(Curve=item.Item1_2)
multiplication = Multiplication(A=len, B=B)
amp = Amplitude(Vector=item.Item1, Amplitude=multiplication)
amp_2 = Amplitude(Vector=item.Item1_2, Amplitude=multiplication)
amp_3 = Amplitude(Vector=item.Item2, Amplitude=multiplication)
vdisex = VectorDisplayEx(Point=item.Item, Vector=amp_2, Colour=ColourSwatch(SwatchColor=RGB(255, 0, 0)), Width="3")
vdisex_2 = VectorDisplayEx(Point=item.Item, Vector=amp_3, Colour=ColourSwatch(SwatchColor=RGB(0, 255, 60)), Width="3")
vdisex_3 = VectorDisplayEx(Point=item.Item, Vector=amp, Colour=ColourSwatch(SwatchColor=RGB(105, 155, 255)), Width="3")
