# Grasshopper definition Tower_bridge_2_Shrey.ghx (Grasshopper 1.0.8)
# plug-ins: Bifocals

rotation = Slider(270, range=0..2000)
pt = Point(Point(0, 0, 0))
offset_x_axis = Slider(0, range=-100..100)
module_count = Slider(7, range=0..100)
module_index = Slider(0, range=0..30)
stick_index = Slider(2, range=0..4)
face_index = Slider(0, range=0..3)
offset_y_axis = Slider(0, range=-100..100)
offset_z_axis = Slider(0, range=-100..100)
pt_2 = Point(Point(174.3269661, -418.4727026, 16.2633016))
offset_x_axis_2 = Slider(0, range=-100..100)
module_count_2 = Slider(7, range=0..100)
module_index_2 = Slider(0, range=0..30)
stick_index_2 = Slider(2, range=0..4)
face_index_2 = Slider(0, range=0..3)
offset_y_axis_2 = Slider(0, range=-100..100)
offset_z_axis_2 = Slider(0, range=-100..100)
rotation_2 = Slider(270, range=0..2000)
xy = XYPlane(Origin=pt)
xy_2 = XYPlane(Origin=pt_2)
# base code:
# stick_module_modified_frame
py3 = Python3Script(
    root=xy,
    stick_length="200",
    rot_angle=rotation,
    module_count=module_count,
    m_index=module_index,
    s_index=stick_index,
    f_index=face_index,
    offset_xxis=offset_x_axis,
    offset_yxis=offset_y_axis,
    offset_zxis=offset_z_axis,
    output_frame=Slider(0, range=-2..4),
    face_idx=Slider(0, range=0..3),
    stick_indx=Slider(4, range=0..4))  # -> out, geometries, frames, frame, faces, sticks, axis, modules_C; inputs root: Plane, stick_length: Double, rot_angle: Int32, module_count: Int32, m_index: Int32, s_index: Int32, f_index: Int32, offset_xxis: Int32, offset_yxis: Double, offset_zxis: Double, face_idx: Int32, stick_indx: Int32
# ---------- py3: Python ----------
# r: compas>=2.14.1
# venv: sticks

import sys
import os
import math
from compas_rhino import unload_modules

# --- PATH FIX START ---
# We define the specific path where Sticks.py and other scripts are located
# Using r"..." ensures backslashes are read correctly as a file path
module_path = r"D:\Github\MAS-2526\08_SpatialAssemblies\StudentProjects\group_one\group_one_scripts"

# Add this path to the system path if it isn't there already
if module_path not in sys.path:
    sys.path.append(module_path)
# --- PATH FIX END ---

# Unload modules to ensure updates are reflected when you reset the engine
unload_modules("Sticks")
unload_modules("stick_module_modified_frame")

import Sticks
import stick_module_modified_frame
from Sticks import Stick 
from stick_module_modified_frame import BranchingModule, BranchStickModules
from compas.geometry import Line, Point, Vector, Frame, Rotation
from compas_rhino.conversions import plane_to_compas_frame, frame_to_rhino_plane
from System.Drawing import Color

# Parameters
stick_width = 13
stick_depth = 13    

# Convert input to compas
root = plane_to_compas_frame(root)

# Initialize tree
tree = BranchStickModules(root, stick_length, width=stick_width, depth=stick_depth)

# Grow tree logic
modules_C = []

for i in range(module_count):
    # Ensure all these variables (offset_xxis, etc.) are defined in your GH inputs
    mod = tree.grow_module(
        offset_xxis, 
        offset_yxis, 
        offset_zxis, 
        from_module_index=i, 
        from_stick_index=s_index, 
        face_index=f_index, 
        angle=rot_angle, 
        move=output_frame
    )
    modules_C.append(mod)

faces = []
for i, module in enumerate(tree.modules):
    if stick_indx < len(module.sticks):
        stick = module.sticks[stick_indx]
        angle = face_idx * math.pi / 2
        R = Rotation.from_axis_and_angle(stick.frame.xaxis, angle=angle, point=stick.frame.point)
        face_frame = stick.frame.transformed(R)
        face_frame.point = stick.axis.midpoint
        
        if i % 2:
            faces.append(face_frame)

# Visualize
geometries = tree.visualize()
# Note: You were overwriting modules_C here in your original script, 
# I assume you want the visualization geometry in a different output variable?
vis_modules = tree.visualize() 

####   Color with 4 different colors to understand the branching method   ####
color_1 = Color.FromArgb(255, 100, 0)     # orange
color_2 = Color.FromArgb(0, 150, 255)     # blue
color_3 = Color.FromArgb(0, 200, 80)      # green
color_4 = Color.FromArgb(200, 0, 200)     # magenta

color_list = [color_1, color_2, color_3, color_4]

colors = []

for module_index, module in enumerate(tree.modules):
    col = color_list[module_index % 4]
    for stick in module.sticks:
        colors.append(col)

if len(tree.modules) > 0 and len(tree.modules[0].sticks) > 0:
    # Convert the COMPAS frames to Rhino Planes here:
    frames = [frame_to_rhino_plane(stick.frame) for module in tree.modules for stick in module.sticks]
    
    axis = [stick.axis for module in tree.modules for stick in module.sticks]
    sticks = [stick for module in tree.modules for stick in module.sticks]
else:
    frames = []
    axis = []
    sticks = []
# ---------- end py3 ----------
# base code:
# stick_module_modified_frame
py3_2 = Python3Script(
    root=xy_2,
    stick_length="200",
    rot_angle=rotation_2,
    module_count=module_count_2,
    m_index=module_index_2,
    s_index=stick_index_2,
    f_index=face_index_2,
    offset_xxis=offset_x_axis_2,
    offset_yxis=offset_y_axis_2,
    offset_zxis=offset_z_axis_2,
    output_frame=Slider(0, range=-2..4),
    face_idx=Slider(0, range=0..3),
    stick_indx=Slider(4, range=0..4))  # -> out, geometries, frames, frame, faces, sticks, axis, modules_C; inputs root: Plane, stick_length: Double, rot_angle: Int32, module_count: Int32, m_index: Int32, s_index: Int32, f_index: Int32, offset_xxis: Int32, offset_yxis: Double, offset_zxis: Double, face_idx: Int32, stick_indx: Int32
# ---------- py3_2: Python ----------
# r: compas>=2.14.1
# venv: sticks

import sys
import os
import math
from compas_rhino import unload_modules

# --- PATH FIX START ---
# We point directly to the folder containing Sticks.py and stick_module_modified_frame.py
module_path = r"D:\Github\MAS-2526\08_SpatialAssemblies\StudentProjects\group_one\group_one_scripts"

if module_path not in sys.path:
    sys.path.append(module_path)
# --- PATH FIX END ---

# Unload the specific modules to ensure updates in the code are reflected in GH
unload_modules("Sticks")
unload_modules("stick_module_modified_frame")

import Sticks
import stick_module_modified_frame
from Sticks import Stick 
from stick_module_modified_frame import BranchingModule, BranchStickModules
from compas.geometry import Line, Point, Vector, Frame, Rotation
from compas_rhino.conversions import plane_to_compas_frame, frame_to_rhino_plane

# --- PARAMETERS ---
stick_width = 13
stick_depth = 13    

# Convert input to compas
root = plane_to_compas_frame(root)

# Initialize tree
tree = BranchStickModules(root, stick_length, width=stick_width, depth=stick_depth)

modules_C = []

# Grow tree loop
for i in range(module_count):
    # Note: Ensure variables like s_index, f_index, rot_angle are inputs to the component
    mod = tree.grow_module(
        offset_xxis, 
        offset_yxis, 
        offset_zxis, 
        from_module_index=i, 
        from_stick_index=s_index, 
        face_index=f_index, 
        angle=rot_angle, 
        move=output_frame
    )
    modules_C.append(mod)

faces = []

# Face generation loop
for i, module in enumerate(tree.modules):
    if stick_indx < len(module.sticks):
        stick = module.sticks[stick_indx]
        angle = face_idx * math.pi / 2
        R = Rotation.from_axis_and_angle(stick.frame.xaxis, angle=angle, point=stick.frame.point)
        face_frame = stick.frame.transformed(R)
        face_frame.point = stick.axis.midpoint
        
        # Only append every second one based on your logic
        if i % 2 == 0:
            # Convert COMPAS frame to Rhino plane before appending
            faces.append(frame_to_rhino_plane(face_frame))

# --- VISUALIZATION ---
geometries = tree.visualize()

# NOTE: In your original script, you were overwriting 'modules_C' here. 
# I have renamed this to 'visual_meshes' so you don't lose the module data.
visual_meshes = tree.visualize()


# --- COLORING ---
from System.Drawing import Color

color_1 = Color.FromArgb(255, 100, 0)     # orange
color_2 = Color.FromArgb(0, 150, 255)     # blue
color_3 = Color.FromArgb(0, 200, 80)      # green
color_4 = Color.FromArgb(200, 0, 200)     # magenta

color_list = [color_1, color_2, color_3, color_4]
colors = []

for module_index, module in enumerate(tree.modules):
    col = color_list[module_index % 4]
    for stick in module.sticks:
        colors.append(col)

# --- OUTPUTS ---
# Added a check to prevent index errors if the tree failed to grow
if len(tree.modules) > 0 and len(tree.modules[0].sticks) > 0:
    frame = frame_to_rhino_plane(tree.modules[0].sticks[0].frame)
    frames = [frame_to_rhino_plane(stick.frame) for module in tree.modules for stick in module.sticks]
    axis = [stick.axis for module in tree.modules for stick in module.sticks]
    sticks = [stick for module in tree.modules for stick in module.sticks]
# ---------- end py3_2 ----------

# ----
# json file creator
button = Button()
py3_3 = Python3Script(sticks=py3.sticks, save=button)  # -> out, frames, assembly; inputs sticks: list, save: Boolean
# ---------- py3_3: Python ----------
from compas import json_dump
import os, sys
from itertools import combinations
from compas_rhino import unload_modules
from compas.geometry import Line, Plane, Vector, Point

#get current file path
path = ghenv.Component.OnPingDocument().FilePath
#get parent directory of the parent directory
parentdir = os.path.dirname(path)
#get src folder which contains classes
dire = os.path.join(parentdir,'scripts')

sys.path.append(dire)

from group_one_sticks import Stick 

from compas.datastructures import Assembly, Part

json_path = os.path.join(parentdir, 'data', 'stick_FJmod5_assembly.json') # file is safed where gh file is stored, from there it puts it in data folder

stick_width = 13.0
stick_depth = 13.0
stick_length = 200

sticks_data = []

###########################################################################
# Make frames point in best direction
###########################################################################
import math
import copy

from compas.geometry import dot_vectors, Rotation
from compas.geometry import centroid_points

def is_parallel(v1, v2):
    if math.isclose(dot_vectors(v1, v2), 1, abs_tol = 0.001) or math.isclose(dot_vectors(v1, v2), -1 ,abs_tol = 0.001):
        # Means it is parallel
        print("parallel")
        return True
    else:
        # Means it is not parallel
        print("not parallel")
        return False

def get_frame_closest_to_target(target_vector, stick):
    best_dot = -1000.0
    for i in range(4):
        angle = math.pi/2 * i
        R = Rotation.from_axis_and_angle(stick.frame.xaxis, angle, stick.frame.point)
        frame = stick.frame.transformed(R)
        dot = dot_vectors(frame.zaxis, target_vector.unitized())
        if dot>best_dot:
            best_dot = dot
            best_frame = frame
            print(i)
    return best_frame

def get_center(sticks_list):
    all_points = [stick.frame.point for stick in sticks_list]
    center = centroid_points(all_points)
    print(center)
    return center

# Copy sticks

sticks_copy = copy.deepcopy(sticks)
center_pt = get_center(sticks_copy)


for stick in sticks_copy:
    if is_parallel(stick.axis.direction.unitized(), Vector(0,0,1)):
        # Target frame is frame pointing into center of structure
        center_vector = Vector.from_start_end(stick.frame.point, center_pt)
        best_frame = get_frame_closest_to_target(center_vector, stick=stick)
        stick.frame = best_frame

    else:
        # Make sure z axis is pointing down
        R = Rotation.from_axis_and_angle(stick.frame.xaxis, math.pi/2, stick.frame.point)
        stick.frame.transform(R)

from compas_rhino.conversions import frame_to_rhino_plane

###########################################################################
# Make frames point in best direction
###########################################################################

assembly = Assembly()
for i, s in enumerate(sticks_copy):
    part_name = "stick"+ str(i)
    part = Part(name = part_name, frame = s.frame)
    part.key = i
    part.attributes["shape"] = s.geometry
    assembly.add_part(part)
    

frames = [frame_to_rhino_plane(p.frame) for p in assembly.parts()]

if save:
    json_dump(assembly, fp=json_path, pretty=True)
# ---------- end py3_3 ----------

# ----
# json file creator
button_2 = Button()
py3_4 = Python3Script(sticks=py3_2.sticks, save=button_2)  # -> out, frames, assembly; inputs sticks: list, save: Boolean; same code as py3_3

draw = COMPASDraw(cg=py3.geometries)  # -> rg
#   port cg: The COMPAS geometry or datastructure to be drawn.
#   port rg: The Rhino geometry object.
# ---------- draw: Python ----------
# r: compas>=2.14.1
"""
Draws COMPAS geometry in Grasshopper.
"""

from typing import Any

import Grasshopper

from compas.scene import SceneObject


class CompasToRhinoGeometry(Grasshopper.Kernel.GH_ScriptInstance):
    def RunScript(self, cg):
        if not cg:
            return None

        return SceneObject(item=cg).draw()
# ---------- end draw ----------
draw_2 = COMPASDraw(cg=py3_2.modules_C)  # -> rg; disabled; same code as draw
draw_3 = COMPASDraw(cg=py3_2.geometries)  # -> rg; same code as draw
draw_4 = COMPASDraw(cg=py3.axis)  # -> rg; same code as draw
draw_5 = COMPASDraw(cg=py3.modules_C)  # -> rg; disabled; same code as draw
draw_6 = COMPASDraw(cg=py3_2.axis)  # -> rg; same code as draw
midpt = CurveMiddle(Curve=draw_4)
preview = CustomPreview(Geometry=draw, Material=ColourSwatch(SwatchColor=RGBA(227, 173, 93, 110)))
midpt_2 = CurveMiddle(Curve=draw_6)
pln = Plane(py3_2.faces)
points = PointList(Points=midpt, Size=Slider(10, range=0..10))
points_2 = PointList(Points=midpt_2, Size=Slider(10, range=0..10))
rot3d = Rotate3D(Geometry=draw_3, Angle=degrees(Slider(0, range=0..100)), Center=pt_2, Axis=Vector(0, 0, 1))  # -> Geometry, Transform
py3_5 = Python3Script(frame=py3.faces)  # -> out, planes
# ---------- py3_5: Python ----------
from compas.geometry import Frame
from compas_rhino.conversions import frame_to_rhino_plane
planes = frame_to_rhino_plane(frame)
# ---------- end py3_5 ----------

# ----
# connecting Sticks A
draw_7 = COMPASDraw(cg=py3.faces)  # -> flatten(rg); same code as draw
preview_2 = CustomPreview(Geometry=draw_7, Material=ColourSwatch(SwatchColor=RGB(204, 16, 16)))

# ----
# connecting Sticks B
draw_8 = COMPASDraw(cg=py3_2.faces)  # -> rg; same code as draw
preview_3 = CustomPreview(Geometry=rot3d.Geometry, Material=ColourSwatch(SwatchColor=RGBA(227, 93, 93, 110)))
preview_4 = CustomPreview(Geometry=draw_8, Material=ColourSwatch(SwatchColor=RGB(79, 168, 59)))
list = ValueList({"start": 0.1, "middle": 0.5, "end": 0.9}, selected="end")
py3_6 = Python3Script(
    frames_0=py3_5.planes,
    frames_1=pln,
    bridge_length=Slider(200, range=0..1000),
    auto_best=Slider(1, range=1..64),
    bridge_A_start=list)  # -> all_frames, geometries, bridge_geoms, info_text, roll_plane, original_frame_0, original_frame_1, rotated_frame_0, rotated_frame_1; inputs frames_0: list, frames_1: list
# ---------- py3_6: Python ----------
# GH_Bridge_List.py - Grasshopper 64-config bridge component (List Input)
# r: compas>=2.14.1
# venv: sticks

import sys
import math
import Rhino.Geometry as rg

# Add your scripts folder (MUST BE THE SAME PATH AS YOUR OTHER SCRIPT)
scripts_path = r'D:\Github\MAS-2526\08_SpatialAssemblies\StudentProjects\group_one\Scrypts_Shrey'
if scripts_path not in sys.path:
    sys.path.append(scripts_path)

from compas_rhino import unload_modules
unload_modules("Sticks_s")

# Import the necessary functions
from Sticks_s import stick_from_frame, bridge_sticks_euler_config, find_best_configuration
from compas_rhino.conversions import plane_to_compas_frame

# ============================================================================
# INPUTS (Grasshopper provides these)
# frames_0 - List of Planes (reference sticks)
# frames_1 - List of Planes (target sticks)
# length_0, length_1, bridge_length, config_id, auto_best (standard inputs)
# ============================================================================

# --- Initialize Output Lists ---
geometries = []
bridge_geoms = []
info_text = []

# --- Defaults and Type Conversions ---
if frames_0 is None or frames_1 is None:
    # Exit if lists are not provided
    print("Error: Two lists of frames are required.")
    geometries = []
    bridge_geoms = []
    info_text = ["Error: Missing input frames."]
    
# Defaults
if length_0 is None:
    length_0 = 100.0
if length_1 is None:
    length_1 = 100.0
if bridge_length is None:
    bridge_length = 100.0
if config_id is None:
    config_id = 1
if auto_best is None:
    auto_best = False
if width is None:
    width = 13.0
if depth is None:
    depth = 13.0
if bridge_A_start is None:
    bridge_A_start = 0.5
    
# Convert config_id to integer (Grasshopper sliders give floats)
config_id = int(config_id)

# --- Check list lengths ---
num_frames_0 = len(frames_0) if frames_0 else 0
num_frames_1 = len(frames_1) if frames_1 else 0

if num_frames_0 != num_frames_1:
    print(f"Warning: Frame lists have different lengths ({num_frames_0} vs {num_frames_1}). Bridging only up to the shortest list length.")

# Determine the number of pairs to process
num_pairs = min(num_frames_0, num_frames_1)

# --- Loop Through Frame Pairs ---
for i in range(num_pairs):
    center_frame_0 = frames_0[i]
    center_frame_1 = frames_1[i]
    
    # Convert Rhino Planes to Compas Frames
    frame_0 = plane_to_compas_frame(center_frame_0)
    frame_1 = plane_to_compas_frame(center_frame_1)
    
    # Create sticks
    stick_0 = stick_from_frame(frame_0, length_0, width, depth)
    stick_1 = stick_from_frame(frame_1, length_1, width, depth)
    
    # Select or auto-find configuration ID for this pair
    current_config_id = config_id
    if auto_best:
        current_config_id = find_best_configuration(stick_0, stick_1, criterion='min_angles')

    # Create bridges using the configuration
    bridges, info = bridge_sticks_euler_config(
        stick_0, stick_1, bridge_length, current_config_id, 
        width=width, depth=depth, 
        bridge_A_start=bridge_A_start,
        print_info=False # Set to False inside loop for clean output
    )

    # --- Append results for the current pair ---
    
    # Geometries (Original sticks + Bridges)
    geometries.append(stick_0.geometry)
    geometries.append(stick_1.geometry)
    current_bridge_geoms = [b.geometry for b in bridges]
    geometries.extend(current_bridge_geoms)
    bridge_geoms.extend(current_bridge_geoms)

    # Info Text
    info_line = f"""PAIR {i+1}: CONFIG {current_config_id}/{info.get('total_configs', 64)}
    Stick 0 Origin: ({frame_0.point.x:.1f}, {frame_0.point.y:.1f}, {frame_0.point.z:.1f})
    Stick 1 Origin: ({frame_1.point.x:.1f}, {frame_1.point.y:.1f}, {frame_1.point.z:.1f})
    Num Bridges: {info['num_bridges']} | ZYX Angles: Z={info['z_angle_deg']:.1f}°, Y={info['y_angle_deg']:.1f}°, X={info['x_angle_deg']:.1f}°
    """
    info_text.append(info_line)

# Clean up output lists if needed (for GH tree structure)
if num_pairs == 0:
    geometries = []
    bridge_geoms = []
    info_text = ["No bridge connections created (empty input list)."]
# ---------- end py3_6 ----------
draw_9 = COMPASDraw(cg=py3_6.geometries)  # -> rg; same code as draw
draw_10 = COMPASDraw(cg=py3_6.bridge_geoms)  # -> rg; same code as draw
