# Grasshopper definition 201_stick_assembly.ghx (Grasshopper 1.0.8)

# ---- group: grid_parameters
number_slider = Slider(2, range=0..10)
number_slider_2 = Slider(2, range=0..10)
number_slider_3 = Slider(2, range=0..10)

# ----
pt = Point(Point(0.1313875721, 0.0945869119, 0))
xy_plane = XYPlane(Origin=Point(0, 0, 0))

# ---- group: 3 --- 6 // if (u+1) % 6 == 0 :
python_3_script = Python3Script(
    root=xy_plane,
    stick_length=Slider(230, range=0..1000),
    num=Slider(3, range=0..100),
    angle_middle=Slider(45, range=0..180),
    align_dist=Slider(115, range=0..180),
    angle_deg=Slider(50, range=0..180),
    distance_on_st1=Slider(0, range=0..180),
    offset_along_self=Slider(0, range=0..200))  # -> out, geometries, sticks, frames; inputs num: Int32, angle_middle: Int32, angle_deg: Int32, distance_on_st1: Int32
# ---------- python_3_script: Python ----------
# r: compas>=2.14.1
# venv: sticks

import sys
import os
import math

#get current file path
path = ghenv.Component.OnPingDocument().FilePath
print (path)
#get parent directory of the parent directory
parentdir = os.path.dirname(path)
print (parentdir)
#get src folder which contains classes
dire = os.path.join(parentdir, 'scripts')
print (dire)

sys.path.append(dire)

from compas_rhino import unload_modules

unload_modules("Sticks")
unload_modules("Stick_module_x_type")

import Sticks, random
from Sticks import Stick 
from Stick_module_x_type import BranchingModule_x_type
from compas.geometry import Line, Point, Vector, Frame
from compas_rhino.conversions import plane_to_compas_frame, frame_to_rhino_plane


stick_width = 13.0
stick_depth = 13.0


# Convert input to compas
root = plane_to_compas_frame(root)

# Initialize tree
tree = BranchingModule_x_type(root, stick_length, width = stick_width, depth = stick_depth)

# Grow tree
def grow_unit (tree, base_index, mode = 'stick1'):
    stick1 = tree.grow_stick(from_stick_index = base_index, face_index = 0, angle = angle_deg, distance_from_end=distance_on_st1, offset_along_self = offset_along_self)
    stick2 = tree.grow_stick(from_stick_index = base_index, face_index = 1, angle = -angle_middle, align_center_with = base_index, align_distance = align_dist, offset_normal = stick_depth)
    stick3 = tree.grow_stick(from_stick_index = stick2, face_index = 1, angle = angle_deg, distance_from_end=distance_on_st1,offset_along_self = offset_along_self)

    if mode == "stick1":
        return stick1
    elif mode == "stick2":
        return stick2
    elif mode == "stick3":
        return stick3  # stick1 / stick2 / stick3

base = 0  

for u in range(num):
    if u < 3:
        if (u+1) % 3 == 0:
            base = grow_unit(tree, base, mode = "stick3")
        else:
            base = grow_unit(tree, base, mode = "stick1")
    else:
        idx = u-3
        if(idx + 1) % 6 == 0:
            base = grow_unit(tree, base, mode = "stick3")
        else:
            base = grow_unit(tree, base, mode = "stick1")

# Visualize
geometries = tree.visualize()
sticks = tree.sticks
frames = [stick.frame for stick in tree.sticks]
# ---------- end python_3_script ----------

# ----
py3 = Python3Script(x_range=number_slider_2, y_range=number_slider, z_range=number_slider_3, offset=Slider(0, range=0..100), st_pt=pt)  # -> out, points, sticks, geometry, frames; inputs x_range: Int32, y_range: Int32, z_range: Int32, offset: Double, st_pt: Point3d
# ---------- py3: Python ----------
#locate stick class file in the same folder
from compas_rhino import unload_modules
import sys
import os

#get current file path
path = ghenv.Component.OnPingDocument().FilePath
print (path)
#get parent directory of the parent directory
parentdir = os.path.dirname(path)
print (parentdir)
#get src folder which contains classes
dire = os.path.join(parentdir,'scripts')
print (dire)

sys.path.append(dire)

unload_modules('stick')
unload_modules('stickmodules')

import stick
from stick import Stick 
from stickmodules import OStickModule
from helpers import sort_sticks_by_z

from compas.geometry import Line, Point, Vector, Polyhedron, Rotation
from compas.datastructures import Assembly
from compas.datastructures import Part
from compas.datastructures import Mesh
from compas import json_dump
import math

stick_width = 13.0
stick_depth = 13.0
stick_length = 200


sticks = []
points = []

for x in range(x_range):
    for y in range(y_range):
        for z in range(z_range):
            grid_size = stick_length - 2*stick_depth - offset
            pt = Point(x*grid_size, y*grid_size, z*grid_size)
            points.append(pt)
            #type = 0 or 1 depending on odd or even
            #additionally type can be 2 for last item
            type_x = x%2 if x<x_range-1 else 2
            type_y = y%2 if y<y_range-1 else 2
            type_z = z%2 if z<z_range-1 else 2
            type = {"x":type_x, "y":type_y, "z":type_z}
            stick_module = OStickModule(pt, stick_length, stick_width, stick_depth, offset, type)
            sticks.extend(stick_module.stick_module)

from compas_rhino.conversions import frame_to_rhino_plane

geometry = [s.geometry for s in sticks]
frames = [frame_to_rhino_plane(s.frame) for s in sticks]
# ---------- end py3 ----------
points = PointList(Points=py3.frames, Size=Slider(20, range=0..100))
draw = COMPASDraw(cg=python_3_script.geometries)  # -> rg
#   port cg: The COMPAS geometry or datastructure to be drawn.
#   port rg: The Rhino geometry object.
# ---------- draw: Python ----------
# r: compas>=2.14.1
"""
Draws COMPAS geometry in Grasshopper.
"""

from typing import Any

import Grasshopper

from compas.scene import SceneObject


class CompasToRhinoGeometry(Grasshopper.Kernel.GH_ScriptInstance):
    def RunScript(self, cg):
        if not cg:
            return None

        return SceneObject(item=cg).draw()
# ---------- end draw ----------
draw_2 = COMPASDraw(cg=py3.points)  # -> rg; same code as draw
draw_3 = COMPASDraw(cg=py3.geometry)  # -> rg; same code as draw
py3_2 = Python3Script(sticks=python_3_script.sticks, save=Button())  # -> out, frames, assembly; inputs sticks: list, save: Boolean
# ---------- py3_2: Python ----------
from compas import json_dump
import os, sys
from itertools import combinations
from compas_rhino import unload_modules
from compas.geometry import Line, Plane, Vector, Point

#get current file path
path = ghenv.Component.OnPingDocument().FilePath
#get parent directory of the parent directory
parentdir = os.path.dirname(path)
#get src folder which contains classes
dire = os.path.join(parentdir,'scripts')

sys.path.append(dire)

from stick import Stick 

from compas.datastructures import Assembly, Part

json_path = os.path.join(parentdir, 'data', 'stick_assembly.json')

stick_width = 13.0
stick_depth = 13.0
stick_length = 200

sticks_data = []

###########################################################################
# Make frames point in best direction
###########################################################################
import math
import copy

from compas.geometry import dot_vectors, Rotation
from compas.geometry import centroid_points

def is_parallel(v1, v2):
    if math.isclose(dot_vectors(v1, v2), 1, abs_tol = 0.001) or math.isclose(dot_vectors(v1, v2), -1 ,abs_tol = 0.001):
        # Means it is parallel
        print("parallel")
        return True
    else:
        # Means it is not parallel
        print("not parallel")
        return False

def get_frame_closest_to_target(target_vector, stick):
    best_dot = -1000.0
    for i in range(4):
        angle = math.pi/2 * i  # 0, 90, 180, 270
        R = Rotation.from_axis_and_angle(stick.frame.xaxis, angle, stick.frame.point)
        frame = stick.frame.transformed(R)
        dot = dot_vectors(frame.zaxis, target_vector.unitized())
        if dot>best_dot: 
            best_dot = dot
            best_frame = frame
            print(i)
    return best_frame

def get_center(sticks_list):
    all_points = [stick.frame.point for stick in sticks_list]
    center = centroid_points(all_points)
    print(center)
    return center

# Copy sticks

sticks_copy = copy.deepcopy(sticks)
center_pt = get_center(sticks_copy)


for stick in sticks_copy:
    if is_parallel(stick.axis.direction.unitized(), Vector(0,0,1)):
        # Target frame is frame pointing into center of structure
        center_vector = Vector.from_start_end(stick.frame.point, center_pt)
        best_frame = get_frame_closest_to_target(center_vector, stick=stick)
        stick.frame = best_frame

    else:
        # Make sure z axis is pointing down
        R = Rotation.from_axis_and_angle(stick.frame.xaxis, math.pi/2, stick.frame.point)
        stick.frame.transform(R)

from compas_rhino.conversions import frame_to_rhino_plane

###########################################################################
# Make frames point in best direction
###########################################################################

assembly = Assembly()
for i, s in enumerate(sticks_copy):
    part_name = "stick"+ str(i)
    part = Part(name = part_name, frame = s.frame)
    part.key = i
    part.attributes["shape"] = s.geometry
    part.attributes["whatever"] = "name"
    assembly.add_part(part)
    

frames = [frame_to_rhino_plane(p.frame) for p in assembly.parts()]

if save:
    json_dump(assembly, fp=json_path, pretty=True)
# ---------- end py3_2 ----------
