# Grasshopper definition 021225_sticks_x_type_THL.gh (Grasshopper 1.0.8)

xy_plane = XYPlane(Origin=Point(0, 0, 0))
xy_plane_2 = XYPlane(Origin=Point(0, 0, 0))
xy_plane_3 = XYPlane(Origin=Point(0, 0, 0))
xy_plane_4 = XYPlane(Origin=Point(0, 0, 0))
xy_plane_5 = XYPlane(Origin=Point(0, 0, 0))
xy_plane_6 = XYPlane(Origin=Point(0, 0, 0))
xy_plane_7 = XYPlane(Origin=Point(0, 0, 0))

panel = Panel("60 * 60 * 60 cm workspace")
geo = Geometry(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)

# ---- group: Stick1 / Stick2 / Stick3
python_3_script = Python3Script(
    root=xy_plane,
    stick_length=Slider(230, range=0..1000),
    num=Slider(10, range=0..100),
    angle_middle=Slider(45, range=0..180),
    align_dist=Slider(100, range=0..180),
    angle_deg=Slider(60, range=0..180),
    distance_on_st1=Slider(20, range=0..180),
    offset_along_self=Slider(0, range=0..200))  # -> out, geometries, sticks, frames; inputs num: Int32, angle_middle: Int32, align_dist: Int32, angle_deg: Int32, distance_on_st1: Int32
# ---------- python_3_script: Python ----------
# r: compas>=2.14.1
# venv: sticks

import sys
import os
import math

#get current file path
path = ghenv.Component.OnPingDocument().FilePath
print (path)
#get parent directory of the parent directory
parentdir = os.path.dirname(path)
print (parentdir)
#get src folder which contains classes
dire = os.path.join(parentdir, 'scripts')
print (dire)

sys.path.append(dire)

from compas_rhino import unload_modules

unload_modules("Sticks")
unload_modules("Stick_module_x_type")

import Sticks, random
from Sticks import Stick 
from Stick_module_x_type import BranchingModule_x_type
from compas.geometry import Line, Point, Vector, Frame
from compas_rhino.conversions import plane_to_compas_frame, frame_to_rhino_plane


stick_width = 13.0
stick_depth = 13.0


# Convert input to compas
root = plane_to_compas_frame(root)

# Initialize tree
tree = BranchingModule_x_type(root, stick_length, width = stick_width, depth = stick_depth)

# Grow tree
def grow_unit (tree, base_index):
    stick1 = tree.grow_stick(from_stick_index = base_index, face_index = 0, angle = angle_deg, distance_from_end=distance_on_st1, offset_along_self = offset_along_self)
    stick2 = tree.grow_stick(from_stick_index = base_index, face_index = 1, angle = -angle_middle, align_center_with = base_index, align_distance = align_dist, offset_normal = stick_depth)
    stick3 = tree.grow_stick(from_stick_index = stick2, face_index = 1, angle = angle_deg, distance_from_end=distance_on_st1,offset_along_self = offset_along_self)

    return stick1  # stick1 / stick2 / stick3

base = 0  

for u in range(num):
    base = grow_unit(tree, base)

# Visualize
geometries = tree.visualize()
sticks = [s.geometry for s in tree.sticks]
frames = [stick.frame for stick in tree.sticks]
# ---------- end python_3_script ----------

# ---- group: 3 --- 6 // if (u+1) % 6 == 0 :
python_3_script_2 = Python3Script(
    root=xy_plane_2,
    stick_length=Slider(230, range=0..1000),
    num=Slider(22, range=0..100),
    angle_middle=Slider(45, range=0..180),
    align_dist=Slider(115, range=0..180),
    angle_deg=Slider(50, range=0..180),
    distance_on_st1=Slider(0, range=0..180),
    offset_along_self=Slider(0, range=0..200))  # -> out, geometries, sticks, frames; inputs num: Int32, angle_middle: Int32, angle_deg: Int32, distance_on_st1: Int32
# ---------- python_3_script_2: Python ----------
# r: compas>=2.14.1
# venv: sticks

import sys
import os
import math

#get current file path
path = ghenv.Component.OnPingDocument().FilePath
print (path)
#get parent directory of the parent directory
parentdir = os.path.dirname(path)
print (parentdir)
#get src folder which contains classes
dire = os.path.join(parentdir, 'scripts')
print (dire)

sys.path.append(dire)

from compas_rhino import unload_modules

unload_modules("Sticks")
unload_modules("Stick_module_x_type")

import Sticks, random
from Sticks import Stick 
from Stick_module_x_type import BranchingModule_x_type
from compas.geometry import Line, Point, Vector, Frame
from compas_rhino.conversions import plane_to_compas_frame, frame_to_rhino_plane


stick_width = 13.0
stick_depth = 13.0


# Convert input to compas
root = plane_to_compas_frame(root)

# Initialize tree
tree = BranchingModule_x_type(root, stick_length, width = stick_width, depth = stick_depth)

# Grow tree
def grow_unit (tree, base_index, mode = 'stick1'):
    stick1 = tree.grow_stick(from_stick_index = base_index, face_index = 0, angle = angle_deg, distance_from_end=distance_on_st1, offset_along_self = offset_along_self)
    stick2 = tree.grow_stick(from_stick_index = base_index, face_index = 1, angle = -angle_middle, align_center_with = base_index, align_distance = align_dist, offset_normal = stick_depth)
    stick3 = tree.grow_stick(from_stick_index = stick2, face_index = 1, angle = angle_deg, distance_from_end=distance_on_st1,offset_along_self = offset_along_self)

    if mode == "stick1":
        return stick1
    elif mode == "stick2":
        return stick2
    elif mode == "stick3":
        return stick3  # stick1 / stick2 / stick3

base = 0  

for u in range(num):
    if u < 3:
        if (u+1) % 3 == 0:
            base = grow_unit(tree, base, mode = "stick3")
        else:
            base = grow_unit(tree, base, mode = "stick1")
    else:
        idx = u-3
        if(idx + 1) % 6 == 0:
            base = grow_unit(tree, base, mode = "stick3")
        else:
            base = grow_unit(tree, base, mode = "stick1")

# Visualize
geometries = tree.visualize()
sticks = [s.geometry for s in tree.sticks]
frames = [stick.frame for stick in tree.sticks]
# ---------- end python_3_script_2 ----------

# ---- group: Random (seed)_process
python_3_script_3 = Python3Script(
    root=xy_plane_3,
    stick_length=Slider(230, range=0..1000),
    num=Slider(10, range=0..100),
    angle_middle=Slider(45, range=0..180),
    align_dist=Slider(100, range=0..180),
    angle_deg=Slider(60, range=0..180),
    distance_on_st1=Slider(20, range=0..180),
    offset_along_self=Slider(0, range=0..200))  # -> out, geometries, sticks, frames; inputs num: Int32, angle_middle: Int32, angle_deg: Int32, distance_on_st1: Int32
# ---------- python_3_script_3: Python ----------
# r: compas>=2.14.1
# venv: sticks

import sys
import os
import math

#get current file path
path = ghenv.Component.OnPingDocument().FilePath
print (path)
#get parent directory of the parent directory
parentdir = os.path.dirname(path)
print (parentdir)
#get src folder which contains classes
dire = os.path.join(parentdir, 'scripts')
print (dire)

sys.path.append(dire)

from compas_rhino import unload_modules

unload_modules("Sticks")
unload_modules("Stick_module_x_type")

import Sticks, random
from Sticks import Stick 
from Stick_module_x_type import BranchingModule_x_type
from compas.geometry import Line, Point, Vector, Frame
from compas_rhino.conversions import plane_to_compas_frame, frame_to_rhino_plane


stick_width = 13.0
stick_depth = 13.0


# Convert input to compas
root = plane_to_compas_frame(root)

# Initialize tree
tree = BranchingModule_x_type(root, stick_length, width = stick_width, depth = stick_depth)

# Grow tree
def grow_unit (tree, base_index, mode = 'stick1'):
    stick1 = tree.grow_stick(from_stick_index = base_index, face_index = 0, angle = angle_deg, distance_from_end=distance_on_st1, offset_along_self = offset_along_self)
    stick2 = tree.grow_stick(from_stick_index = base_index, face_index = 1, angle = -angle_middle, align_center_with = base_index, align_distance = align_dist, offset_normal = stick_depth)
    stick3 = tree.grow_stick(from_stick_index = stick2, face_index = 1, angle = angle_deg, distance_from_end=distance_on_st1,offset_along_self = offset_along_self)

    return [base_index,stick1, stick2, stick3]

random.seed(10)
base = 0  
prev_unit =[0]

for u in range(num):
    new_unit = grow_unit(tree, base)         
    base = random.choice(new_unit)
    prev_unit = new_unit
    print(prev_unit)

# Visualize
geometries = tree.visualize()
sticks = [s.geometry for s in tree.sticks]
frames = [stick.frame for stick in tree.sticks]
# ---------- end python_3_script_3 ----------

# ---- group: Random ( Seed ) _ POP
python_3_script_4 = Python3Script(
    root=xy_plane_4,
    stick_length=Slider(230, range=0..1000),
    num=Slider(10, range=0..100),
    angle_middle=Slider(45, range=0..180),
    align_dist=Slider(100, range=0..180),
    angle_deg=Slider(60, range=0..180),
    distance_on_st1=Slider(20, range=0..180),
    offset_along_self=Slider(0, range=0..180))  # -> out, geometries, sticks, frames; inputs num: Int32, angle_deg: Int32, distance_on_st1: Int32
# ---------- python_3_script_4: Python ----------
# r: compas>=2.14.1
# venv: sticks

import sys
import os
import math

#get current file path
path = ghenv.Component.OnPingDocument().FilePath
print (path)
#get parent directory of the parent directory
parentdir = os.path.dirname(path)
print (parentdir)
#get src folder which contains classes
dire = os.path.join(parentdir, 'scripts')
print (dire)

sys.path.append(dire)

from compas_rhino import unload_modules

unload_modules("Sticks")
unload_modules("Stick_module_x_type")

import Sticks, random
from Sticks import Stick 
from Stick_module_x_type import BranchingModule_x_type
from compas.geometry import Line, Point, Vector, Frame
from compas_rhino.conversions import plane_to_compas_frame, frame_to_rhino_plane


stick_width = 13.0
stick_depth = 13.0


# Convert input to compas
root = plane_to_compas_frame(root)

# Initialize tree
tree = BranchingModule_x_type(root, stick_length, width = stick_width, depth = stick_depth)

# Grow tree
def grow_unit (tree, base_index):

    before = len(tree.sticks)

    stick1 = tree.grow_stick(from_stick_index = base_index, face_index = 2, angle = angle_deg, distance_from_end=distance_on_st1, offset_along_self = offset_along_self)
    stick2 = tree.grow_stick(from_stick_index = base_index, face_index = 1, angle = angle_middle, align_center_with = base_index, align_distance = align_dist, offset_normal = stick_depth)
    stick3 = tree.grow_stick(from_stick_index = stick2, face_index = 3, angle = angle_deg, distance_from_end=distance_on_st1, offset_along_self = offset_along_self)

    after = len(tree.sticks)
    new_sticks = list(range(before, after))

    return [base_index,stick1, stick2, stick3], new_sticks

random.seed(10)
base = 0
units = []

count = 0
max_attempts = 100
attempt = 0

while count < num and attempt < max_attempts:
    attempt += 1
    
    new_unit , new_sticks = grow_unit(tree, base)         
    new_base = random.choice(new_unit)

    if new_base == new_unit[0]:

        for idx in reversed(new_sticks):
            tree.sticks.pop(idx)

        continue
    
    units.append(new_unit)
    base = new_base
    count += 1
    print(new_unit)

# Visualize
geometries = tree.visualize()

sticks = [s.geometry for s in tree.sticks]
frames = [stick.frame for stick in tree.sticks]
# ---------- end python_3_script_4 ----------

# ----
python_3_script_5 = Python3Script(
    root=xy_plane_5,
    stick_length=Slider(235, range=0..1000),
    num=Slider(9, range=0..100),
    angle_middle=Slider(45, range=0..180),
    angle_deg=Slider(60, range=0..180),
    distance_on_st1=Slider(25, range=0..180))  # -> out, geometries; inputs num: Int32, angle_deg: Int32, distance_on_st1: Int32
# ---------- python_3_script_5: Python ----------
# r: compas>=2.14.1
# venv: sticks

import sys
import os
import math

#get current file path
path = ghenv.Component.OnPingDocument().FilePath
print (path)
#get parent directory of the parent directory
parentdir = os.path.dirname(path)
print (parentdir)
#get src folder which contains classes
dire = os.path.join(parentdir, 'scripts')
print (dire)

sys.path.append(dire)

from compas_rhino import unload_modules

unload_modules("Sticks")
unload_modules("Stick_module_x_type")

import Sticks, random
from Sticks import Stick 
from Stick_module_x_type import BranchingModule_x_type
from compas.geometry import Line, Point, Vector, Frame
from compas.geometry import closest_point_on_line, distance_point_point, dot_vectors, cross_vectors, normalize_vector, length_vector
from compas_rhino.conversions import plane_to_compas_frame, frame_to_rhino_plane

stick_width = 13.0
stick_depth = 13.0


# Convert input to compas
root = plane_to_compas_frame(root)

# Initialize tree
tree = BranchingModule_x_type(root, stick_length, width = stick_width, depth = stick_depth)

# Grow tree
def grow_unit(tree, base_index):

    before = len(tree.sticks)

    stick1 = tree.grow_stick(
        from_stick_index=base_index,
        face_index=0,
        angle=angle_deg,
        distance_from_end=distance_on_st1
    )

    stick2 = tree.grow_stick(
        from_stick_index=base_index,
        face_index=1,
        angle=-angle_middle,
        align_center_with=base_index,
        offset_normal=stick_depth
    )

    stick3 = tree.grow_stick(
        from_stick_index=stick2,
        face_index=1,
        angle=angle_deg,
        distance_from_end=distance_on_st1
    )

    after = len(tree.sticks)
    new_sticks = list(range(before, after))

    return [base_index, stick1, stick2, stick3], new_sticks


# -----------------------
#  AABB
# -----------------------

def get_aabb(box):
    """Return axis-aligned bounding box for COMPAS Box."""
    pts = box.points
    xs = [p.x for p in pts]
    ys = [p.y for p in pts]
    zs = [p.z for p in pts]
    return (min(xs), min(ys), min(zs)), (max(xs), max(ys), max(zs))


def aabb_overlap(boxA, boxB):
    """Fast AABB overlap."""
    a_min, a_max = get_aabb(boxA)
    b_min, b_max = get_aabb(boxB)

    if a_max[0] < b_min[0] or a_min[0] > b_max[0]: return False
    if a_max[1] < b_min[1] or a_min[1] > b_max[1]: return False
    if a_max[2] < b_min[2] or a_min[2] > b_max[2]: return False

    return True


# -----------------------
#  OBB – SAT collision check
# -----------------------

def project(box, axis):
    pts = box.points
    dots = [dot_vectors(p, axis) for p in pts]
    return min(dots), max(dots)


def interval_disjoint(a_min, a_max, b_min, b_max):
    return a_max < b_min or b_min < a_min


def obb_overlap(boxA, boxB, eps=1e-6):
    A = boxA.frame
    B = boxB.frame

    axes = [
        A.xaxis, A.yaxis, A.zaxis,
        B.xaxis, B.yaxis, B.zaxis
    ]

    for a in [A.xaxis, A.yaxis, A.zaxis]:
        for b in [B.xaxis, B.yaxis, B.zaxis]:
            c = cross_vectors(a, b)
            if length_vector(c) > eps:
                axes.append(normalize_vector(c))

    for axis in axes:
        a_min, a_max = project(boxA, axis)
        b_min, b_max = project(boxB, axis)

        if interval_disjoint(a_min, a_max, b_min, b_max):
            return False

    return True


# -----------------------
#  Combined collision test
# -----------------------

def sticks_overlap(stickA, stickB):
    boxA = stickA.geometry
    boxB = stickB.geometry

    # Step 1 – Fast reject
    if not aabb_overlap(boxA, boxB):
        return False

    # Step 2 – Accurate OBB SAT
    return obb_overlap(boxA, boxB)


# -----------------------
#  Main growth loop
# -----------------------

random.seed(10)
units = []
base = 0
count = 0

max_units = num
max_attempts = 500
attempt = 0

while count < max_units and attempt < max_attempts:
    attempt += 1

    success = False
    retry_attempts = 0
    max_retry = 50

    while not success and retry_attempts < max_retry:
        retry_attempts += 1

        new_unit, new_sticks = grow_unit(tree, base)
        new_base = random.choice(new_unit)

        # Avoid selecting original base stick
        if new_base == new_unit[0]:
            for idx in reversed(new_sticks):
                tree.sticks.pop(idx)
            continue

        # Collision check
        overlapped = False
        for idx in new_sticks:
            A = tree.sticks[idx]
            for j, B in enumerate(tree.sticks):
                if j in new_sticks:
                    continue
                if sticks_overlap(A, B):
                    overlapped = True
                    break
            if overlapped:
                break

        if overlapped:
            for idx in reversed(new_sticks):
                tree.sticks.pop(idx)
            continue

        success = True

    if not success:
        print("Skip unit at base:", base)

        if units:
            last_unit = units[-1]
            base = random.choice(last_unit[1:])
        else:
            base = 0

        continue

    units.append(new_unit)
    base = new_base
    count += 1
    print(new_unit)


# -----------------------
#  Visualize
# -----------------------

geometries = tree.visualize()
frames = [stick.frame for stick in tree.sticks]
# ---------- end python_3_script_5 ----------

# ---- group: without_collision_unit by unit
python_3_script_6 = Python3Script(
    root=xy_plane_6,
    stick_length=Slider(200, range=0..1000),
    num=Slider(30, range=0..100),
    angle_middle=Slider(45, range=0..180),
    angle_deg=Slider(60, range=0..180),
    distance_on_st1=Slider(15, range=0..180))  # -> out, geometries, sticks; inputs num: Int32, angle_deg: Int32, distance_on_st1: Int32
# ---------- python_3_script_6: Python ----------
# r: compas>=2.14.1
# venv: sticks

import sys
import os
import math

#get current file path
path = ghenv.Component.OnPingDocument().FilePath
print (path)
#get parent directory of the parent directory
parentdir = os.path.dirname(path)
print (parentdir)
#get src folder which contains classes
dire = os.path.join(parentdir, 'scripts')
print (dire)

sys.path.append(dire)

from compas_rhino import unload_modules

unload_modules("Sticks")
unload_modules("Stick_module_x_type")

import Sticks, random
from Sticks import Stick 
from Stick_module_x_type import BranchingModule_x_type
from compas.geometry import Line, Point, Vector, Frame
from compas.geometry import closest_point_on_line, distance_point_point
from compas_rhino.conversions import plane_to_compas_frame, frame_to_rhino_plane

stick_width = 13.0
stick_depth = 13.0


# Convert input to compas
root = plane_to_compas_frame(root)

# Initialize tree
tree = BranchingModule_x_type(root, stick_length, width = stick_width, depth = stick_depth)

# Grow tree
def grow_unit (tree, base_index):

    before = len(tree.sticks)

    stick1 = tree.grow_stick(from_stick_index = base_index, face_index = 0, angle = angle_deg, distance_from_end=distance_on_st1)
    stick2 = tree.grow_stick(from_stick_index = base_index, face_index = 1, angle = -angle_middle, align_center_with = base_index, offset_normal = stick_depth)
    stick3 = tree.grow_stick(from_stick_index = stick2, face_index = 1, angle = angle_deg, distance_from_end=distance_on_st1)

    after = len(tree.sticks)
    new_sticks = list(range(before, after))

    return [base_index,stick1, stick2, stick3], new_sticks

def sticks_overlap(stickA, stickB, min_dist = stick_depth):
    axisA = stickA.axis
    axisB = stickB.axis

    ptA = closest_point_on_line(axisA.start, axisB)
    ptB = closest_point_on_line(axisB.start, axisA)
    d = distance_point_point(ptA, ptB)

    return d < min_dist

random.seed(1)
units = []
sticks = []
base = 0
count = 0

max_units = num           
max_attempts = 500         
attempt = 0

while count < max_units and attempt < max_attempts:
    attempt += 1

    success = False
    retry_attempts = 0
    max_retry = 50   

    while not success and retry_attempts < max_retry:
        retry_attempts += 1

        new_unit, new_sticks = grow_unit(tree, base)
        new_base = random.choice(new_unit)

        if new_base == new_unit[0]:
            for idx in reversed(new_sticks):
                tree.sticks.pop(idx)
            continue

        overlapped = False
        for idx in new_sticks:
            stickA = tree.sticks[idx]
            for j, stickB in enumerate(tree.sticks):
                if j in new_sticks:
                    continue
                if sticks_overlap(stickA, stickB, min_dist=stick_depth):
                    overlapped = True
                    break
            if overlapped:
                break

        if overlapped:
            for idx in reversed(new_sticks):
                tree.sticks.pop(idx)
            continue

        success = True

    if not success:
        print("Skip unit at base:", base)

        if units:
            last_unit = units[-1]
            base = random.choice(last_unit[1:])
        else:
            base = 0
        continue

    units.append(new_unit)
    base = new_base
    count += 1
    print(new_unit)


# Visualize
geometries = tree.visualize()

frames = [stick.frame for stick in tree.sticks]
# ---------- end python_3_script_6 ----------

# ---- group: without collision
python_3_script_7 = Python3Script(
    root=xy_plane_7,
    stick_length=Slider(200, range=0..1000),
    num=Slider(30, range=0..100),
    angle_middle=Slider(45, range=0..180),
    angle_deg=Slider(60, range=0..180),
    distance_on_st1=Slider(25, range=0..180))  # -> out, geometries; inputs num: Int32, angle_deg: Int32, distance_on_st1: Int32
# ---------- python_3_script_7: Python ----------
# r: compas>=2.14.1
# venv: sticks

import sys
import os
import math

#get current file path
path = ghenv.Component.OnPingDocument().FilePath
print (path)
#get parent directory of the parent directory
parentdir = os.path.dirname(path)
print (parentdir)
#get src folder which contains classes
dire = os.path.join(parentdir, 'scripts')
print (dire)

sys.path.append(dire)

from compas_rhino import unload_modules

unload_modules("Sticks")
unload_modules("Stick_module_x_type")

import Sticks, random
from Sticks import Stick 
from Stick_module_x_type import BranchingModule_x_type
from compas.geometry import Line, Point, Vector, Frame
from compas.geometry import closest_point_on_line, distance_point_point
from compas_rhino.conversions import plane_to_compas_frame, frame_to_rhino_plane

stick_width = 13.0
stick_depth = 13.0


# Convert input to compas
root = plane_to_compas_frame(root)

# Initialize tree
tree = BranchingModule_x_type(root, stick_length, width = stick_width, depth = stick_depth)

# Grow tree
def grow_unit (tree, base_index):

    before = len(tree.sticks)

    stick1 = tree.grow_stick(from_stick_index = base_index, face_index = 0, angle = angle_deg, distance_from_end=distance_on_st1)
    stick2 = tree.grow_stick(from_stick_index = base_index, face_index = 1, angle = angle_middle, align_center_with = base_index, offset_normal = stick_depth)
    stick3 = tree.grow_stick(from_stick_index = stick2, face_index = 1, angle = angle_deg, distance_from_end=distance_on_st1)

    after = len(tree.sticks)
    new_sticks = list(range(before, after))

    return [base_index,stick1, stick2, stick3], new_sticks

def sticks_overlap(stickA, stickB, min_dist = stick_depth):
    axisA = stickA.axis
    axisB = stickB.axis

    ptA = closest_point_on_line(axisA.start, axisB)
    ptB = closest_point_on_line(axisB.start, axisA)
    d = distance_point_point(ptA, ptB)

    return d < min_dist

random.seed(1)
units = []
base = 0
count = 0

max_units = num           
max_attempts = 500         
attempt = 0

while count < max_units and attempt < max_attempts:
    attempt += 1

    success = False
    retry_attempts = 0
    max_retry = 50   

    while not success and retry_attempts < max_retry:
        retry_attempts += 1

        new_unit, new_sticks = grow_unit(tree, base)
        new_base = random.choice(new_unit)

        if new_base == new_unit[0]:
            for idx in reversed(new_sticks):
                tree.sticks.pop(idx)
            continue

        overlapped = False
        for idx in new_sticks:
            stickA = tree.sticks[idx]
            for j, stickB in enumerate(tree.sticks):
                if j in new_sticks:
                    continue
                if sticks_overlap(stickA, stickB, min_dist=stick_depth):
                    overlapped = True
                    break
            if overlapped:
                break

        if overlapped:
            for idx in reversed(new_sticks):
                tree.sticks.pop(idx)
            continue

        success = True

    if not success:
        print("Skip unit at base:", base)
        base = random.choice(range(len(tree.sticks)))
        continue

    units.append(new_unit)
    base = new_base
    count += 1
    print(new_unit)


# Visualize
geometries = tree.visualize()

frames = [stick.frame for stick in tree.sticks]
# ---------- end python_3_script_7 ----------

# ----
draw = COMPASDraw(cg=python_3_script.sticks)  # -> rg
#   port cg: The COMPAS geometry or datastructure to be drawn.
#   port rg: The Rhino geometry object.
# ---------- draw: Python ----------
# r: compas>=2.14.1
"""
Draws COMPAS geometry in Grasshopper.
"""

from typing import Any

import Grasshopper

from compas.scene import SceneObject


class CompasToRhinoGeometry(Grasshopper.Kernel.GH_ScriptInstance):
    def RunScript(self, cg):
        if not cg:
            return None

        return SceneObject(item=cg).draw()
# ---------- end draw ----------
draw_2 = COMPASDraw(cg=python_3_script_2.sticks)  # -> rg; same code as draw
draw_3 = COMPASDraw(cg=python_3_script_3.sticks)  # -> rg; same code as draw
draw_4 = COMPASDraw(cg=python_3_script_4.sticks)  # -> rg; same code as draw
draw_5 = COMPASDraw(cg=python_3_script_5.geometries)  # -> rg; same code as draw
draw_6 = COMPASDraw(cg=python_3_script_6.geometries)  # -> rg; same code as draw
draw_7 = COMPASDraw(cg=python_3_script_7.geometries)  # -> rg; same code as draw
