# Grasshopper definition 103_aggregation_sharon_2.gh (Grasshopper 1.0.8)

# ---- group: aggregation_4 legs_arc_2
pt = ConstructPoint(XCoordinate=0, YCoordinate=0, ZCoordinate=0)  # disabled
number_slider = Slider(90, range=0..100)  # disabled
xy = XYPlane(Origin=pt)  # disabled
xz = XZPlane(Origin=Point(0, 0, 0))  # disabled
rot3d = Rotate3D(Geometry=xy, Angle=degrees(number_slider), Center=Point(0, 0, 0), Axis=xz)  # -> Geometry, Transform; disabled

number_slider_2 = Slider(1, range=0..3)  # disabled
number_slider_3 = Slider(0, range=0..3)  # disabled
number_slider_4 = Slider(0, range=-180..180)  # disabled
number_slider_5 = Slider(46, range=-180..180)  # disabled
number_slider_6 = Slider(61, range=0..180)  # disabled
number_slider_7 = Slider(0.791, range=0..1)  # disabled
number_slider_8 = Slider(1, range=0..3)  # disabled
number_slider_9 = Slider(3, range=0..3)  # disabled
number_slider_10 = Slider(4, range=0..10)  # disabled
number_slider_11 = Slider(0.262, range=0..1)  # disabled
neg = Negative(Value=number_slider_4)  # disabled
stick_module_aggregation = Python3Script(
    base_plane=rot3d.Geometry,
    agg_times=number_slider_10,
    to_stick_index=number_slider_9,
    to_face_index=number_slider_8,
    to_t=number_slider_11,
    from_stick_index=number_slider_3,
    from_face_index=number_slider_2,
    from_t=number_slider_7,
    angle=number_slider_5)  # -> out, module_out, geo, module_frame_out, to_frame, from_frame; inputs agg_times: Int32, to_stick_index: Int32, to_face_index: Int32, to_t: Double, from_stick_index: Int32, from_face_index: Int32, from_t: Double, angle: Double; disabled
# ---------- stick_module_aggregation: Python ----------
# r: compas>=2.14.1
# venv: sticks

import sys
import os
import math

#get current file path
path = ghenv.Component.OnPingDocument().FilePath
print (path)
#get parent directory of the parent directory
parentdir = os.path.dirname(path)
print (parentdir)
#get src folder which contains classes
dire = os.path.join(parentdir,'scripts')
print (dire)

sys.path.append(dire)

from compas_rhino import unload_modules

unload_modules("Sticks_Single_1")
unload_modules("Sticks_Multiple_1")
unload_modules("Sticks_Aggregation_5")

from Sticks_Single_1 import Stick  
from Sticks_Multiple_1 import TiltedModule_4legs
from Sticks_Aggregation_5 import ModuleAggregation
from compas.geometry import Line, Point, Vector, Frame
from compas_rhino.conversions import plane_to_compas_frame, frame_to_rhino_plane

module_agg = []
stick_width = 13.0
stick_depth = 13.0
stick_d_length = 235
stick_u_length = 263

# Convert input to compas
base_frame = plane_to_compas_frame(base_plane)

# Initialize tree
module_unit = TiltedModule_4legs(base_frame = base_frame, root_angle = 25, stick_d_length = 235, stick_u_length = 263, width = stick_width, depth = stick_depth)

# Grow tree
module_unit.grow_tilted_stick(length = stick_d_length, from_stick_index = -1, face_index = 2, angle = 46)
module_unit.grow_shorter_stick(length = stick_d_length, from_stick_index = 0, face_index = 3, angle = 50)
module_unit.grow_tilted_stick(length = stick_d_length, from_stick_index = 2, face_index = 1, angle = 46)

# Visualize
module_out = module_unit.visualize()
module_frame_out = [frame_to_rhino_plane(stick.frame) for stick in module_unit.sticks]

# Aggregation

module_agg = ModuleAggregation(module_unit.sticks)

for i in range(agg_times):
    module_agg.compute_next_module(
        from_stick_index=from_stick_index,
        from_face_index=from_face_index,
        from_t=from_t,
        to_stick_index=to_stick_index,
        to_face_index=to_face_index,
        to_t=to_t,
        angle=angle)
    
    from_frame = frame_to_rhino_plane(module_agg.from_frame)
    to_frame = frame_to_rhino_plane(module_agg.to_frame)


# output geometry
geo = module_agg.visualize()
# ---------- end stick_module_aggregation ----------
draw = COMPASDraw(cg=stick_module_aggregation.module_out)  # -> rg; disabled
#   port cg: The COMPAS geometry or datastructure to be drawn.
#   port rg: The Rhino geometry object.
# ---------- draw: Python ----------
# r: compas>=2.14.1
"""
Draws COMPAS geometry in Grasshopper.
"""

from typing import Any

import Grasshopper

from compas.scene import SceneObject


class CompasToRhinoGeometry(Grasshopper.Kernel.GH_ScriptInstance):
    def RunScript(self, cg):
        if not cg:
            return None

        return SceneObject(item=cg).draw()
# ---------- end draw ----------
draw_2 = COMPASDraw(cg=stick_module_aggregation.geo)  # -> rg; disabled; same code as draw
pln = Plane(stick_module_aggregation.from_frame)  # disabled
pln_2 = Plane(stick_module_aggregation.to_frame)  # disabled
pln_3 = Plane(stick_module_aggregation.module_frame_out)  # disabled
vec_display = Cluster(num=30)  # disabled
preview = CustomPreview(
    Geometry=draw,
    Material={diffuse=RGB(221, 160, 221), emission=RGB(66, 48, 66), shine=0.5, specular=RGB(255, 255, 255), transparency=0})  # disabled
preview_2 = CustomPreview(
    Geometry=draw_2,
    Material={diffuse=RGB(221, 160, 221), emission=RGB(66, 48, 66), shine=0.5, specular=RGB(255, 255, 255), transparency=0})  # disabled
number_slider_12 = Slider(3, range=0..3)  # disabled
number_slider_13 = Slider(1, range=0..3)  # disabled
tstat = TreeStatistics(Tree=pln)  # -> simplify(Paths), Length, Count; disabled
item = ListItem(List=draw, Index=number_slider_12, Wrap=True)  # disabled
item_2 = ListItem(List=tstat.Paths, Index=number_slider_12, Wrap=True)  # disabled
item_3 = ListItem(List=pln_3, Index=number_slider_13, Wrap=True)  # disabled
branch = TreeBranch(Tree=pln, Path=item_2, MaintainPaths=True)  # disabled
vec_display_2 = Cluster(pln=branch, num=30)  # disabled

# ---- group: aggregation_4 legs_arc_3_move by layer
pt_2 = ConstructPoint(XCoordinate=0, YCoordinate=0, ZCoordinate=0)  # disabled
number_slider_14 = Slider(90, range=0..100)  # disabled
xy_2 = XYPlane(Origin=pt_2)  # disabled
xz_2 = XZPlane(Origin=Point(0, 0, 0))  # disabled
rot3d_2 = Rotate3D(Geometry=xy_2, Angle=degrees(number_slider_14), Center=Point(0, 0, 0), Axis=xz_2)  # -> Geometry, Transform; disabled

number_slider_15 = Slider(1, range=0..3)  # disabled
number_slider_16 = Slider(0, range=0..3)  # disabled
number_slider_17 = Slider(1, range=0..10)  # disabled
number_slider_18 = Slider(46, range=-180..180)  # disabled
number_slider_19 = Slider(0.791, range=0..1)  # disabled
number_slider_20 = Slider(1, range=0..3)  # disabled
number_slider_21 = Slider(3, range=0..3)  # disabled
number_slider_22 = Slider(4, range=0..10)  # disabled
number_slider_23 = Slider(0.262, range=0..1)  # disabled
stick_module_aggregation_2 = Python3Script(
    base_plane=rot3d_2.Geometry,
    agg_times=number_slider_22,
    to_stick_index=number_slider_21,
    to_face_index=number_slider_20,
    to_t=number_slider_23,
    from_stick_index=number_slider_16,
    from_face_index=number_slider_15,
    from_t=number_slider_19,
    angle=number_slider_18,
    layer_iteration=number_slider_17)  # -> out, module_out, geo, module_frame_out, to_frame, from_frame; inputs agg_times: Int32, to_stick_index: Int32, to_face_index: Int32, to_t: Double, from_stick_index: Int32, from_face_index: Int32, from_t: Double, angle: Double, layer_iteration: Int32; disabled
# ---------- stick_module_aggregation_2: Python ----------
# r: compas>=2.14.1
# venv: sticks

import sys
import os
import math

#get current file path
path = ghenv.Component.OnPingDocument().FilePath
print (path)
#get parent directory of the parent directory
parentdir = os.path.dirname(path)
print (parentdir)
#get src folder which contains classes
dire = os.path.join(parentdir,'scripts')
print (dire)

sys.path.append(dire)

from compas_rhino import unload_modules

unload_modules("Sticks_Single_1")
unload_modules("Sticks_Multiple_1")
unload_modules("Sticks_Aggregation_6")

from Sticks_Single_1 import Stick  
from Sticks_Multiple_1 import TiltedModule_4legs
from Sticks_Aggregation_6 import ModuleAggregation
from compas.geometry import Line, Point, Vector, Frame
from compas_rhino.conversions import plane_to_compas_frame, frame_to_rhino_plane

module_agg = []
stick_width = 13.0
stick_depth = 13.0
stick_d_length = 235
stick_u_length = 263

# Convert input to compas
base_frame = plane_to_compas_frame(base_plane)

# Initialize tree
module_unit = TiltedModule_4legs(base_frame = base_frame, root_angle = 25, stick_d_length = 235, stick_u_length = 263, width = stick_width, depth = stick_depth)

# Grow tree
module_unit.grow_tilted_stick(length = stick_d_length, from_stick_index = -1, face_index = 2, angle = 46)
module_unit.grow_shorter_stick(length = stick_d_length, from_stick_index = 0, face_index = 3, angle = 50)
module_unit.grow_tilted_stick(length = stick_d_length, from_stick_index = 2, face_index = 1, angle = 46)

# Visualize
module_out = module_unit.visualize()
module_frame_out = [frame_to_rhino_plane(stick.frame) for stick in module_unit.sticks]

# Aggregation

module_agg = ModuleAggregation(module_unit.sticks)

for i in range(agg_times):
    module_agg.compute_next_module(
        from_stick_index=from_stick_index,
        from_face_index=from_face_index,
        from_t=from_t,
        to_stick_index=to_stick_index,
        to_face_index=to_face_index,
        to_t=to_t,
        angle=angle)
    
    from_frame = frame_to_rhino_plane(module_agg.from_frame)
    to_frame = frame_to_rhino_plane(module_agg.to_frame)

module_agg.move_by_layer(translation_vector = (-124.017431,0,0), layer_iteration = layer_iteration)

# output geometry
geo = module_agg.visualize()
# ---------- end stick_module_aggregation_2 ----------
draw_3 = COMPASDraw(cg=stick_module_aggregation_2.module_out)  # -> rg; disabled; same code as draw
draw_4 = COMPASDraw(cg=stick_module_aggregation_2.geo)  # -> rg; disabled; same code as draw
pln_4 = Plane(stick_module_aggregation_2.from_frame)  # disabled
pln_5 = Plane(stick_module_aggregation_2.to_frame)  # disabled
pln_6 = Plane(stick_module_aggregation_2.module_frame_out)  # disabled
preview_3 = CustomPreview(
    Geometry=draw_3,
    Material={diffuse=RGB(221, 160, 221), emission=RGB(66, 48, 66), shine=0.5, specular=RGB(255, 255, 255), transparency=0})  # disabled
preview_4 = CustomPreview(
    Geometry=draw_4,
    Material={diffuse=RGB(221, 160, 221), emission=RGB(66, 48, 66), shine=0.5, specular=RGB(255, 255, 255), transparency=0})  # disabled
vec_display_3 = Cluster(num=30)  # disabled
number_slider_24 = Slider(3, range=0..3)  # disabled
number_slider_25 = Slider(1, range=0..3)  # disabled
tstat_2 = TreeStatistics(Tree=pln_4)  # -> simplify(Paths), Length, Count; disabled
item_4 = ListItem(List=draw_3, Index=number_slider_24, Wrap=True)  # disabled
item_5 = ListItem(List=tstat_2.Paths, Index=number_slider_24, Wrap=True)  # disabled
item_6 = ListItem(List=pln_6, Index=number_slider_25, Wrap=True)  # disabled
branch_2 = TreeBranch(Tree=pln_4, Path=item_5, MaintainPaths=True)  # disabled
vec_display_4 = Cluster(pln=branch_2, num=30)  # disabled

# ---- group: aggregation_4 legs_arc_2
pt_3 = Point(Point(19.5, -439.0724516, 2.747018701))  # disabled
pt_4 = Point(Point(-104.5174306, -439.0724516, 2.747018701))  # disabled
vec2pt = Vector2Pt(PointA=pt_3, PointB=pt_4, Unitize=False)  # -> Vector, Length; disabled
number_slider_26 = Slider(2, range=0..10)  # disabled
series = Series(Start=0, Step=1, Count=number_slider_26)  # disabled
multiplication = Multiplication(A=vec2pt.Vector, B=series)  # disabled
group = Group(Geometry=draw_2)  # disabled
move = Move(Geometry=group, Motion=multiplication)  # -> Geometry, Transform; disabled
ungroup = Ungroup(Group=move.Geometry)  # disabled

# ---- group: stick_branch_module
xy_plane = XYPlane(Origin=Point(0, 0, 0))
stick_branch_module = Python3Script(base_plane=xy_plane)  # -> out, module_out, module_frame_out
# ---------- stick_branch_module: Python ----------
# r: compas>=2.14.1
# venv: sticks

import sys
import os
import math

#get current file path
path = ghenv.Component.OnPingDocument().FilePath
print (path)
#get parent directory of the parent directory
parentdir = os.path.dirname(path)
print (parentdir)
#get src folder which contains classes
dire = os.path.join(parentdir,'scripts')
print (dire)

sys.path.append(dire)

from compas_rhino import unload_modules

unload_modules("Sticks_Single_1")
unload_modules("Sticks_Multiple_1")

from Sticks_Single_1 import Stick  
from Sticks_Multiple_1 import TiltedModule
from compas.geometry import Line, Point, Vector, Frame
from compas_rhino.conversions import plane_to_compas_frame, frame_to_rhino_plane

stick_width = 13.0
stick_depth = 13.0

# Convert input to compas
base_frame = plane_to_compas_frame(base_plane)

# Initialize tree
module = TiltedModule(base_frame = base_frame, root_angle = -25, stick_d_length = 235, stick_u_length = 263, width = stick_width, depth = stick_depth)

# Grow tree
module.grow_stick(face_index = 2, angle = 27)

# mirror sticks
module.mirror_stick(113)

# Visualize
module_out = module.visualize()
module_frame_out = [stick.frame for stick in module.sticks]
# ---------- end stick_branch_module ----------
draw_5 = COMPASDraw(cg=stick_branch_module.module_frame_out)  # -> rg; same code as draw
draw_6 = COMPASDraw(cg=stick_branch_module.module_out)  # -> rg; same code as draw
vec_display_5 = Cluster(pln=draw_5, num=30)

# ----
# Frame-based Class: Stick
pt_5 = Point(Point(131.4515182, -575.0679293, 0))
xy_3 = XYPlane(Origin=pt_5)
yz = YZPlane(Origin=pt_5)
xz_3 = XZPlane(Origin=pt_5)
rotate = Rotate(Geometry=xy_3, Angle=degrees(Slider(37, range=0..180)), Plane=xz_3)  # -> Geometry, Transform
pln_7 = Plane(rotate.Geometry)
cluster = Cluster(pln=pln_7, num=30)
py3 = Python3Script(first_pln=pln_7, length=Slider(230, range=0..1000), face_index=Slider(0, range=0..10), t=Slider(0.477, range=0..1))  # -> out, axis_out, stick_out, midframe_out, evalframe_out, corner_out; inputs first_pln: Plane, length: Double, face_index: Int32, t: Double
# ---------- py3: Python ----------
#locate stick class file in the same folder
from compas_rhino import unload_modules
import sys
import os

#get current file path
path = ghenv.Component.OnPingDocument().FilePath
#get parent directory of the parent directory
parentdir = os.path.dirname(path)
#get src folder which contains classes
dire = os.path.join(parentdir,'scripts')

sys.path.append(dire)


unload_modules('Sticks_Jerry_v1')
unload_modules('Sticks_Jerry_v2')

from Sticks_Jerry_v1 import Stick
from Sticks_Jerry_v2 import SingleStickAggregation
from compas.geometry import Line, Point, Vector
from compas.geometry import Transformation
from compas_rhino.conversions import plane_to_compas_frame, frame_to_rhino_plane
import random

"""Main Code"""
first_pln = plane_to_compas_frame(first_pln)
stick = Stick(first_pln, length)

axis = stick.axis
geo = stick.geometry
midframe = stick.midframe
evalframe = stick.eval_frame(face_index, t)
# corners = stick.corners
# Output
axis_out = axis
stick_out = geo
midframe_out = frame_to_rhino_plane(midframe)
evalframe_out = frame_to_rhino_plane(evalframe)
# corner_out = corners
# ---------- end py3 ----------
draw_7 = COMPASDraw(cg=py3.axis_out)  # -> rg; same code as draw
draw_8 = COMPASDraw(cg=py3.stick_out)  # -> rg; same code as draw
draw_9 = COMPASDraw(cg=py3.corner_out)  # -> rg; same code as draw
pln_8 = Plane(py3.evalframe_out)
pln_9 = Plane(py3.midframe_out)
cluster_2 = Cluster(pln=pln_9, num=30)
cluster_3 = Cluster(pln=pln_8, num=30)

# ----
# Frame-based Aggregation by Random Value
pt_6 = Point(Point(-186.0594048, -107.2522057, 0))  # disabled
number_slider_27 = Slider(90, range=0..180)  # disabled
xy_4 = XYPlane(Origin=pt_6)  # disabled
yz_2 = YZPlane(Origin=pt_6)  # disabled
xz_4 = XZPlane(Origin=pt_6)  # disabled
rotate_2 = Rotate(Geometry=xy_4, Angle=degrees(number_slider_27), Plane=xz_4)  # -> Geometry, Transform; disabled
number_slider_28 = Slider(23, range=0..100)  # disabled
number_slider_29 = Slider(1, range=0..10)  # disabled
number_slider_30 = Slider(34, range=0..100)  # disabled
number_slider_31 = Slider(216, range=0..1000)  # disabled
number_slider_32 = Slider(0, range=0..180)  # disabled
list = ValueList({"Regular": 0, "Random": 1}, selected="Random")  # disabled
pln_10 = Plane(rotate_2.Geometry)  # disabled
cluster_4 = Cluster(pln=pln_10, num=30)  # disabled
py3_2 = Python3Script(
    first_pln=pln_10,
    length=number_slider_31,
    seed=number_slider_30,
    agg_type=list,
    agg_count=number_slider_28,
    angle=number_slider_32)  # -> out, stick_out, axis_out, plane_out, from_pln_out, to_pln_out; inputs first_pln: Plane, length: Double, seed: Int32, agg_type: Int32, agg_count: Int32, angle: Double; disabled
# ---------- py3_2: Python ----------
#locate stick class file in the same folder
from compas_rhino import unload_modules
import sys
import os

#get current file path
path = ghenv.Component.OnPingDocument().FilePath
#get parent directory of the parent directory
parentdir = os.path.dirname(path)
#get src folder which contains classes
dire = os.path.join(parentdir,'scripts')

sys.path.append(dire)


unload_modules('J3RRY_Stick_v2')
unload_modules('Sticks')

from Sticks import Stick
from J3RRY_Stick_v2 import JStickAggregation
from compas.geometry import Line, Point, Vector
from compas.geometry import Transformation
from compas_rhino.conversions import plane_to_compas_frame, frame_to_rhino_plane

import random


"""Main Code"""
# Convert rhino plane to compas frame
first_pln = plane_to_compas_frame(first_pln)
agg = JStickAggregation(first_pln, length, agg_type, seed)


# Aggregation
for i in range(agg_count):
    # angle = random.uniform(0, 180)
    agg.spawn_next_stick_random(angle, seed)


# Output
stick_out = agg.visualize()
axis_out = agg.axes
plane_out = [frame_to_rhino_plane(f) for f in agg.frames]
from_pln_out = [frame_to_rhino_plane(f) for f in agg.from_frames]
to_pln_out = [frame_to_rhino_plane(f) for f in agg.to_frames]
# ---------- end py3_2 ----------
draw_10 = COMPASDraw(cg=py3_2.stick_out)  # -> rg; disabled; same code as draw
draw_11 = COMPASDraw(cg=py3_2.axis_out)  # -> rg; disabled; same code as draw
pln_11 = Plane(py3_2.plane_out)  # disabled
pln_12 = Plane(py3_2.from_pln_out)  # disabled
pln_13 = Plane(py3_2.to_pln_out)  # disabled
number_slider_33 = Slider(10, range=0..10)  # disabled
lng = ListLength(List=draw_10)  # disabled
cluster_5 = Cluster(pln=pln_11, num=30)  # disabled
cluster_6 = Cluster(pln=pln_12, num=30)  # disabled
cluster_7 = Cluster(pln=pln_13, num=30)  # disabled
midpt = CurveMiddle(Curve=draw_11)  # disabled
series_2 = Series(Start=0, Step=1, Count=lng)  # disabled
points = PointList(Points=midpt, Size=number_slider_33)  # disabled
gradient = Gradient(
    LowerLimit=0,
    UpperLimit=expr("x-1", lng),
    Parameter=series_2,
    stops=[0: RGB(80, 55, 25), 0.5: RGB(159, 65, 29), 1: RGB(174, 166, 129)])  # disabled
preview_5 = CustomPreview(Geometry=draw_10, Material=gradient)  # disabled

# ----
# Frame-based Aggregation by Face Index and T Value
pt_7 = Point(Point(131.4515182, -575.0679293, 0))  # disabled
number_slider_34 = Slider(70, range=0..180)  # disabled
xy_5 = XYPlane(Origin=pt_7)  # disabled
yz_3 = YZPlane(Origin=pt_7)  # disabled
xz_5 = XZPlane(Origin=pt_7)  # disabled
rotate_3 = Rotate(Geometry=xy_5, Angle=degrees(number_slider_34), Plane=xz_5)  # -> Geometry, Transform; disabled
number_slider_35 = Slider(0, range=0..10)  # disabled
number_slider_36 = Slider(3, range=0..10)  # disabled
number_slider_37 = Slider(4, range=0..100)  # disabled
number_slider_38 = Slider(0.142, range=0..1)  # disabled
number_slider_39 = Slider(0.374, range=0..1)  # disabled
number_slider_40 = Slider(230, range=0..1000)  # disabled
number_slider_41 = Slider(120, range=0..180)  # disabled
pln_14 = Plane(rotate_3.Geometry)  # disabled
cluster_8 = Cluster(pln=pln_14, num=30)  # disabled
py3_3 = Python3Script(
    first_pln=pln_14,
    length=number_slider_40,
    agg_count=number_slider_37,
    angle=number_slider_41,
    from_face_index=number_slider_35,
    to_face_index=number_slider_36,
    from_t=number_slider_38,
    to_t=number_slider_39)  # -> out, stick_out, axis_out, plane_out, from_pln_out, to_pln_out; inputs first_pln: Plane, length: Double, agg_count: Int32, angle: Double, from_face_index: Int32, to_face_index: Int32, from_t: Double, to_t: Double; disabled
# ---------- py3_3: Python ----------
#locate stick class file in the same folder
from compas_rhino import unload_modules
import sys
import os

#get current file path
path = ghenv.Component.OnPingDocument().FilePath
#get parent directory of the parent directory
parentdir = os.path.dirname(path)
#get src folder which contains classes
dire = os.path.join(parentdir,'scripts')

sys.path.append(dire)

unload_modules('Sticks_Jerry_v1')
unload_modules('Sticks_Jerry_v2')

from Sticks_Jerry_v1 import Stick
from Sticks_Jerry_v2 import SingleStickAggregation
from compas.geometry import Line, Point, Vector
from compas.geometry import Transformation
from compas_rhino.conversions import plane_to_compas_frame, frame_to_rhino_plane
import random


"""Main Code"""
# Convert rhino plane to compas frame
first_pln = plane_to_compas_frame(first_pln)

# Aggregation
agg = SingleStickAggregation(first_pln, length)
for i in range(agg_count):
    # angle = random.uniform(0, 180)
    agg.spawn_next_stick(angle, from_face_index, from_t, to_face_index, to_t)


# Output
stick_out = agg.visualize()
axis_out = agg.axes
plane_out = [frame_to_rhino_plane(f) for f in agg.new_frames]
from_pln_out = [frame_to_rhino_plane(f) for f in agg.from_frames]
to_pln_out = [frame_to_rhino_plane(f) for f in agg.to_frames]
# ---------- end py3_3 ----------
draw_12 = COMPASDraw(cg=py3_3.stick_out)  # -> rg; disabled; same code as draw
draw_13 = COMPASDraw(cg=py3_3.axis_out)  # -> rg; disabled; same code as draw
pln_15 = Plane(py3_3.plane_out)  # disabled
pln_16 = Plane(py3_3.from_pln_out)  # disabled
pln_17 = Plane(py3_3.to_pln_out)  # disabled
number_slider_42 = Slider(10, range=0..10)  # disabled
midpt_2 = CurveMiddle(Curve=draw_13)  # disabled
cluster_9 = Cluster(pln=pln_15, num=30)  # disabled
cluster_10 = Cluster(pln=pln_16, num=30)  # disabled
cluster_11 = Cluster(pln=pln_17, num=30)  # disabled
preview_6 = CustomPreview(
    Geometry=draw_12,
    Material={diffuse=RGB(221, 160, 221), emission=RGB(66, 48, 66), shine=0.5, specular=RGB(255, 255, 255), transparency=0})  # disabled
points_2 = PointList(Points=midpt_2, Size=number_slider_42)  # disabled

# ---- group: stick_branch_module
xy_plane_2 = XYPlane(Origin=Point(0, 0, 0))  # disabled
stick_branch_module_2 = Python3Script(base_plane=xy_plane_2)  # -> out, module_out, module_frame_out; disabled; same code as stick_branch_module
draw_14 = COMPASDraw(cg=stick_branch_module_2.module_out)  # -> rg; disabled; same code as draw
draw_15 = COMPASDraw(cg=stick_branch_module_2.module_frame_out)  # -> rg; disabled; same code as draw
vec_display_6 = Cluster(pln=draw_15, num=30)  # disabled

# ----
# Frame-based Aggregation by Face Index and T Value
pt_8 = ConstructPoint(XCoordinate=0, YCoordinate=0, ZCoordinate=0)
pt_9 = Point(pt_8)
xy_6 = XYPlane(Origin=pt_9)
xz_6 = XZPlane(Origin=pt_9)
rotate_4 = Rotate(Geometry=xy_6, Angle=degrees(Slider(30, range=0..180)), Plane=xz_6)  # -> Geometry, Transform
pln_18 = Plane(rotate_4.Geometry)
vec_display_7 = Cluster(pln=pln_18, num=30)
py3_4 = Python3Script(
    first_pln=pln_18,
    length=Slider(230, range=0..1000),
    agg_times=Slider(4, range=0..10),
    angle=Slider(120, range=0..180),
    from_face_index=Slider(0, range=0..100),
    to_face_index=Slider(3, range=0..10),
    from_t=Slider(0.125, range=0..1),
    to_t=Slider(0.275, range=0..1))  # -> out, sticks_out, axes_out, new_primitive_plns_out, from_plns_out, to_plns_out; inputs first_pln: Plane, length: Int32, agg_times: Int32, angle: Double, from_face_index: Int32, to_face_index: Int32, from_t: Double, to_t: Double
# ---------- py3_4: Python ----------
#locate stick class file in the same folder
from compas_rhino import unload_modules
import sys
import os

#get current file path
path = ghenv.Component.OnPingDocument().FilePath
#get parent directory of the parent directory
parentdir = os.path.dirname(path)
#get src folder which contains classes
dire = os.path.join(parentdir,'scripts')

sys.path.append(dire)

unload_modules('Sticks_Jerry_v1')
unload_modules('Sticks_Jerry_v2_3')

from Sticks_Jerry_v1 import Stick
from Sticks_Jerry_v2_3 import SingleStickAggregation
from compas_rhino.conversions import plane_to_compas_frame, frame_to_rhino_plane

"""Main Code"""
# Convert rhino frame to compas frame
first_pln = plane_to_compas_frame(first_pln)

# Aggregation
agg_stick = SingleStickAggregation(first_frame=first_pln, length=length, aggregation_type=0)
for i in range(agg_times):
    agg_stick.compute_next_stick_regular(angle=angle, from_index=from_face_index, from_t=from_t, to_index=to_face_index, to_t=to_t)

# Output
sticks_out = agg_stick.visualize()
axes_out = agg_stick.axes
new_primitive_plns_out = [frame_to_rhino_plane(f) for f in agg_stick.new_frames]
from_plns_out = [frame_to_rhino_plane(f) for f in agg_stick.from_frames]
to_plns_out = [frame_to_rhino_plane(f) for f in agg_stick.to_frames]
# ---------- end py3_4 ----------
draw_16 = COMPASDraw(cg=py3_4.sticks_out)  # -> rg; same code as draw
draw_17 = COMPASDraw(cg=py3_4.axes_out)  # -> rg; same code as draw
pln_19 = Plane(py3_4.from_plns_out)
pln_20 = Plane(py3_4.new_primitive_plns_out)
pln_21 = Plane(py3_4.to_plns_out)
vec_display_8 = Cluster(pln=pln_20, num=30)
vec_display_9 = Cluster(pln=pln_19, num=30)
vec_display_10 = Cluster(pln=pln_21, num=30)
preview_7 = CustomPreview(
    Geometry=draw_16,
    Material={diffuse=RGB(221, 160, 221), emission=RGB(66, 48, 66), shine=0.5, specular=RGB(255, 255, 255), transparency=0})
midpt_3 = CurveMiddle(Curve=draw_17)
points_3 = PointList(Points=midpt_3, Size=Slider(10, range=0..10))

# ---- group: stick_module_aggregation
pt_10 = ConstructPoint(XCoordinate=0, YCoordinate=0, ZCoordinate=0)  # disabled
number_slider_43 = Slider(90, range=0..100)  # disabled
xy_7 = XYPlane(Origin=pt_10)  # disabled
xz_7 = XZPlane(Origin=Point(0, 0, 0))  # disabled
rot3d_3 = Rotate3D(Geometry=xy_7, Angle=degrees(number_slider_43), Center=Point(0, 0, 0), Axis=xz_7)  # -> Geometry, Transform; disabled

pt_11 = ConstructPoint(XCoordinate=0, YCoordinate=0, ZCoordinate=0)  # disabled
number_slider_44 = Slider(90, range=0..100)  # disabled
xy_8 = XYPlane(Origin=pt_11)  # disabled
xz_8 = XZPlane(Origin=Point(0, 0, 0))  # disabled
rot3d_4 = Rotate3D(Geometry=xy_8, Angle=degrees(number_slider_44), Center=Point(0, 0, 0), Axis=xz_8)  # -> Geometry, Transform; disabled

number_slider_45 = Slider(2, range=0..10)  # disabled
number_slider_46 = Slider(0, range=0..10)  # disabled
number_slider_47 = Slider(3, range=0..10)  # disabled
number_slider_48 = Slider(1, range=0..10)  # disabled
number_slider_49 = Slider(0.125, range=0..1)  # disabled
number_slider_50 = Slider(27, range=0..180)  # disabled
number_slider_51 = Slider(0.275, range=0..1)  # disabled
stick_module_aggregation_3 = Python3Script(
    base_plane=rot3d_3.Geometry,
    agg_times=number_slider_48,
    angle=number_slider_50,
    ref_stick_index=number_slider_45,
    from_face_index=number_slider_46,
    to_face_index=number_slider_47,
    from_t=number_slider_49,
    to_t=number_slider_51)  # -> out, module_out, geo, module_frame_out; inputs agg_times: Int32, angle: Double, ref_stick_index: Int32, from_face_index: Int32, to_face_index: Int32, from_t: Double, to_t: Double; disabled
# ---------- stick_module_aggregation_3: Python ----------
# r: compas>=2.14.1
# venv: sticks

import sys
import os
import math

#get current file path
path = ghenv.Component.OnPingDocument().FilePath
print (path)
#get parent directory of the parent directory
parentdir = os.path.dirname(path)
print (parentdir)
#get src folder which contains classes
dire = os.path.join(parentdir,'scripts')
print (dire)

sys.path.append(dire)

from compas_rhino import unload_modules

unload_modules("Sticks_Single_1")
unload_modules("Sticks_Multiple_1")
unload_modules("Sticks_Aggregation_1")

from Sticks_Single_1 import Stick  
from Sticks_Multiple_1 import TiltedModule
from Sticks_Aggregation_1 import ModuleAggregation
from compas.geometry import Line, Point, Vector, Frame
from compas_rhino.conversions import plane_to_compas_frame, frame_to_rhino_plane

stick_width = 13.0
stick_depth = 13.0
stick_d_length = 235
stick_u_length = 263

# Convert input to compas
base_frame = plane_to_compas_frame(base_plane)

# Initialize tree
# module_unit = TiltedModule(base_frame = base_frame, root_angle = -25, stick_d_length = 235, stick_u_length = 263, width = stick_width, depth = stick_depth)
module_unit = TiltedModule(base_frame = base_frame, root_angle = 25, stick_d_length = 235, stick_u_length = 263, width = stick_width, depth = stick_depth)

# Grow tree
module_unit.grow_stick(length = stick_u_length, from_stick_index = -1, face_index = 2, angle = 27)
module_unit.grow_shorter_stick(length = stick_d_length, from_stick_index = 0, face_index = 3, angle = 50)
module_unit.grow_longer_stick(length = stick_u_length, from_stick_index = 2, face_index = 1, angle = 27)

# Visualize
module_out = module_unit.visualize()
module_frame_out = [stick.frame for stick in module_unit.sticks]

# Aggregation
# 1. build first module
module_agg = module_unit
# print("first module stick count =", len(module_agg.sticks))

# 2. build ModuleAggregation
agg = ModuleAggregation(first_module=module_agg)
for i in range(agg_times):



# 3. generate the next module（用上一組第2根，取面1的 t=0.5、面2 的 t=0.75）
    # agg.compute_next_module(ref_stick_index=2,
    #                         from_face_index=1, from_t=0.5,
    #                         to_face_index=2,   to_t=0.75,
    #                         angle=35,
    #                         stick_length=235)
    agg.compute_next_module(ref_stick_index=ref_stick_index,
                            from_face_index=from_face_index, from_t=from_t,
                            to_face_index=to_face_index,   to_t=to_t,
                            angle=angle,
                            stick_length=235)

# 4. output geometry
geo = agg.visualize()
# ---------- end stick_module_aggregation_3 ----------
draw_18 = COMPASDraw(cg=stick_module_aggregation_3.module_frame_out)  # -> rg; disabled; same code as draw
draw_19 = COMPASDraw(cg=stick_module_aggregation_3.geo)  # -> rg; disabled; same code as draw
draw_20 = COMPASDraw(cg=stick_module_aggregation_3.module_out)  # -> rg; disabled; same code as draw
preview_8 = CustomPreview(
    Geometry=draw_19,
    Material={diffuse=RGB(221, 160, 221), emission=RGB(66, 48, 66), shine=0.5, specular=RGB(255, 255, 255), transparency=0})  # disabled
vec_display_11 = Cluster(pln=draw_18, num=30)  # disabled

number_slider_52 = Slider(2, range=0..10)  # disabled
number_slider_53 = Slider(1, range=0..10)  # disabled
number_slider_54 = Slider(0, range=0..10)  # disabled
number_slider_55 = Slider(0, range=0..10)  # disabled
number_slider_56 = Slider(0.2, range=0..1)  # disabled
number_slider_57 = Slider(76, range=0..180)  # disabled
number_slider_58 = Slider(0.45, range=0..1)  # disabled
stick_module_aggregation_4 = Python3Script(
    base_plane=rot3d_4.Geometry,
    agg_times=number_slider_55,
    angle=number_slider_57,
    ref_stick_index=number_slider_53,
    from_face_index=number_slider_52,
    to_face_index=number_slider_54,
    from_t=number_slider_56,
    to_t=number_slider_58)  # -> out, module_out, geo, module_frame_out; inputs agg_times: Int32, angle: Double, ref_stick_index: Int32, from_face_index: Int32, to_face_index: Int32, from_t: Double, to_t: Double; disabled
# ---------- stick_module_aggregation_4: Python ----------
# r: compas>=2.14.1
# venv: sticks

import sys
import os
import math

#get current file path
path = ghenv.Component.OnPingDocument().FilePath
print (path)
#get parent directory of the parent directory
parentdir = os.path.dirname(path)
print (parentdir)
#get src folder which contains classes
dire = os.path.join(parentdir,'scripts')
print (dire)

sys.path.append(dire)

from compas_rhino import unload_modules

unload_modules("Sticks_Single_1")
unload_modules("Sticks_Multiple_1")
unload_modules("Sticks_Aggregation_1")

from Sticks_Single_1 import Stick  
from Sticks_Multiple_1 import TiltedModule
from Sticks_Aggregation_1 import ModuleAggregation
from compas.geometry import Line, Point, Vector, Frame
from compas_rhino.conversions import plane_to_compas_frame, frame_to_rhino_plane

stick_width = 13.0
stick_depth = 13.0
stick_d_length = 235
stick_u_length = 263

# Convert input to compas
base_frame = plane_to_compas_frame(base_plane)

# Initialize tree
# module_unit = TiltedModule(base_frame = base_frame, root_angle = -25, stick_d_length = 235, stick_u_length = 263, width = stick_width, depth = stick_depth)
module_unit = TiltedModule(base_frame = base_frame, root_angle = 25, stick_d_length = 235, stick_u_length = 263, width = stick_width, depth = stick_depth)

# Grow tree
module_unit.grow_stick(length = stick_u_length, from_stick_index = -1, face_index = 2, angle = 27)
module_unit.grow_shorter_stick(length = stick_d_length, from_stick_index = 0, face_index = 3, angle = 50)
module_unit.grow_longer_stick(length = stick_u_length, from_stick_index = 2, face_index = 1, angle = 27)

# Visualize
module_out = module_unit.visualize()
module_frame_out = [stick.frame for stick in module_unit.sticks]

# Aggregation
# 1. build first module
module_agg = module_unit
# print("first module stick count =", len(module_agg.sticks))

# 2. build ModuleAggregation
agg = ModuleAggregation(first_module=module_agg)
for i in range(agg_times):



# 3. generate the next module（用上一組第2根，取面1的 t=0.5、面2 的 t=0.75）
    agg.compute_next_module(ref_stick_index=ref_stick_index,
                            from_face_index=from_face_index, from_t=from_t,
                            to_face_index=to_face_index,   to_t=to_t,
                            angle=angle)

# 4. output geometry
geo = agg.visualize()
# ---------- end stick_module_aggregation_4 ----------
draw_21 = COMPASDraw(cg=stick_module_aggregation_4.module_frame_out)  # -> rg; disabled; same code as draw
draw_22 = COMPASDraw(cg=stick_module_aggregation_4.geo)  # -> rg; disabled; same code as draw
draw_23 = COMPASDraw(cg=stick_module_aggregation_4.module_out)  # -> rg; disabled; same code as draw
preview_9 = CustomPreview(
    Geometry=draw_22,
    Material={diffuse=RGB(221, 160, 221), emission=RGB(66, 48, 66), shine=0.5, specular=RGB(255, 255, 255), transparency=0})  # disabled
vec_display_12 = Cluster(pln=draw_21, num=30)  # disabled

# ----
draw_24 = COMPASDraw(cg=stick_module_aggregation_4.module_out)  # -> rg; disabled; same code as draw
number_slider_59 = Slider(3, range=0..3)  # disabled
debrep = DeconstructBrep(Brep=draw_19)  # -> Faces, Edges, Vertices; disabled
debrep_2 = DeconstructBrep(Brep=draw_22)  # -> Faces, Edges, Vertices; disabled
item_7 = ListItem(List=debrep.Edges, Index=0, Wrap=True)  # disabled
item_8 = ListItem(List=debrep_2.Edges, Index=0, Wrap=True)  # disabled
item_9 = ListItem(List=draw_22, Index=number_slider_59, Wrap=True)  # disabled
len = Length(Curve=item_7)  # -> flatten(Length); disabled
len_2 = Length(Curve=item_8)  # -> flatten(Length); disabled
debrep_3 = DeconstructBrep(Brep=item_9)  # -> Faces, Edges, Vertices; disabled
panel = Panel(len)  # disabled
panel_2 = Panel(len_2)  # disabled
number_slider_60 = Slider(10, range=0..10)  # disabled
area = Area(Geometry=debrep_3.Faces)  # -> Area, Centroid; disabled
points_4 = PointList(Points=area.Centroid, Size=number_slider_60)  # disabled

# ---- group: aggregation_4 legs_arc_2
pt_12 = ConstructPoint(XCoordinate=0, YCoordinate=0, ZCoordinate=0)  # disabled
number_slider_61 = Slider(90, range=0..100)  # disabled
xy_9 = XYPlane(Origin=pt_12)  # disabled
xz_9 = XZPlane(Origin=Point(0, 0, 0))  # disabled
rot3d_5 = Rotate3D(Geometry=xy_9, Angle=degrees(number_slider_61), Center=Point(0, 0, 0), Axis=xz_9)  # -> Geometry, Transform; disabled

number_slider_62 = Slider(1, range=0..3)  # disabled
number_slider_63 = Slider(0, range=0..3)  # disabled
number_slider_64 = Slider(2, range=0..10)  # disabled
number_slider_65 = Slider(0, range=-180..180)  # disabled
number_slider_66 = Slider(46, range=-180..180)  # disabled
number_slider_67 = Slider(61, range=0..180)  # disabled
number_slider_68 = Slider(0.791, range=0..1)  # disabled
number_slider_69 = Slider(1, range=0..3)  # disabled
number_slider_70 = Slider(3, range=0..3)  # disabled
number_slider_71 = Slider(4, range=0..10)  # disabled
number_slider_72 = Slider(0.262, range=0..1)  # disabled
neg_2 = Negative(Value=number_slider_65)  # disabled
stick_module_aggregation_5 = Python3Script(
    base_plane=rot3d_5.Geometry,
    agg_times=number_slider_71,
    to_stick_index=number_slider_70,
    to_face_index=number_slider_69,
    to_t=number_slider_72,
    from_stick_index=number_slider_63,
    from_face_index=number_slider_62,
    from_t=number_slider_68,
    angle=number_slider_66,
    layer_iteration=number_slider_64)  # -> out, module_out, geo, module_frame_out, to_frame, from_frame; inputs agg_times: Int32, to_stick_index: Int32, to_face_index: Int32, to_t: Double, from_stick_index: Int32, from_face_index: Int32, from_t: Double, angle: Double, layer_iteration: Int32; disabled; same code as stick_module_aggregation_2
draw_25 = COMPASDraw(cg=stick_module_aggregation_5.module_out)  # -> rg; disabled; same code as draw
pln_22 = Plane(stick_module_aggregation_5.from_frame)  # disabled
draw_26 = COMPASDraw(cg=stick_module_aggregation_5.geo)  # -> rg; disabled; same code as draw
pln_23 = Plane(stick_module_aggregation_5.to_frame)  # disabled
pln_24 = Plane(stick_module_aggregation_5.module_frame_out)  # disabled
vec_display_13 = Cluster(num=30)  # disabled
preview_10 = CustomPreview(
    Geometry=draw_25,
    Material={diffuse=RGB(221, 160, 221), emission=RGB(66, 48, 66), shine=0.5, specular=RGB(255, 255, 255), transparency=0})  # disabled
preview_11 = CustomPreview(
    Geometry=draw_26,
    Material={diffuse=RGB(221, 160, 221), emission=RGB(66, 48, 66), shine=0.5, specular=RGB(255, 255, 255), transparency=0})  # disabled
number_slider_73 = Slider(3, range=0..3)  # disabled
number_slider_74 = Slider(1, range=0..3)  # disabled
tstat_3 = TreeStatistics(Tree=pln_22)  # -> simplify(Paths), Length, Count; disabled
item_10 = ListItem(List=draw_25, Index=number_slider_73, Wrap=True)  # disabled
item_11 = ListItem(List=tstat_3.Paths, Index=number_slider_73, Wrap=True)  # disabled
item_12 = ListItem(List=pln_24, Index=number_slider_74, Wrap=True)  # disabled
branch_3 = TreeBranch(Tree=pln_22, Path=item_11, MaintainPaths=True)  # disabled
vec_display_14 = Cluster(pln=branch_3, num=30)  # disabled

# ---- group: stick_module_aggregation
pt_13 = ConstructPoint(XCoordinate=0, YCoordinate=0, ZCoordinate=0)
xy_10 = XYPlane(Origin=pt_13)
xz_10 = XZPlane(Origin=Point(0, 0, 0))
rot3d_6 = Rotate3D(Geometry=xy_10, Angle=degrees(Slider(90, range=0..100)), Center=Point(0, 0, 0), Axis=xz_10)  # -> Geometry, Transform

stick_module_aggregation_6 = Python3Script(
    base_plane=rot3d_6.Geometry,
    agg_times=Slider(1, range=0..10),
    from_stick_index=Slider(1, range=0..3),
    from_face_index=Slider(1, range=0..3),
    from_t=Slider(0, range=0..1),
    to_stick_index=Slider(1, range=0..3),
    to_face_index=Slider(1, range=0..3),
    to_t=Slider(0, range=0..1),
    angle=Slider(0, range=0..180))  # -> out, module_out, geo, module_frame_out; inputs agg_times: Int32, from_stick_index: Int32, from_face_index: Int32, from_t: Double, to_stick_index: Int32, to_face_index: Int32, to_t: Double, angle: Double
# ---------- stick_module_aggregation_6: Python ----------
# r: compas>=2.14.1
# venv: sticks

import sys
import os
import math

#get current file path
path = ghenv.Component.OnPingDocument().FilePath
print (path)
#get parent directory of the parent directory
parentdir = os.path.dirname(path)
print (parentdir)
#get src folder which contains classes
dire = os.path.join(parentdir,'scripts')
print (dire)

sys.path.append(dire)

from compas_rhino import unload_modules

unload_modules("Sticks_Single_1")
unload_modules("Sticks_Multiple_1")
unload_modules("Sticks_Aggregation_2")

from Sticks_Single_1 import Stick  
from Sticks_Multiple_1 import TiltedModule
from Sticks_Aggregation_2 import ModuleAggregation
from compas.geometry import Line, Point, Vector, Frame
from compas_rhino.conversions import plane_to_compas_frame, frame_to_rhino_plane

module_agg = []
stick_width = 13.0
stick_depth = 13.0
stick_d_length = 235
stick_u_length = 263

# Convert input to compas
base_frame = plane_to_compas_frame(base_plane)

# Initialize tree
module_unit = TiltedModule(base_frame = base_frame, root_angle = 25, stick_d_length = 235, stick_u_length = 263, width = stick_width, depth = stick_depth)

# Grow tree
module_unit.grow_stick(length = stick_u_length, from_stick_index = -1, face_index = 2, angle = 27)
module_unit.grow_shorter_stick(length = stick_d_length, from_stick_index = 0, face_index = 3, angle = 50)
module_unit.grow_longer_stick(length = stick_u_length, from_stick_index = 2, face_index = 1, angle = 27)

# Visualize
module_out = module_unit.visualize()
module_frame_out = [stick.frame for stick in module_unit.sticks]

# Aggregation
# 1. build first module
module_agg = module_unit
# module_agg = [s for s in module_unit.sticks]

# print(module_agg)
# module_agg = []
# for s in module_unit.stick:
#     module_agg.extend(s)

# print("first module stick count =", len(module_agg.sticks))

# 2. build ModuleAggregation
agg = ModuleAggregation(first_module=module_agg)
for i in range(agg_times):

# 3. generate the next module
    agg.compute_next_module(from_stick_index=from_stick_index,
                            from_face_index=from_face_index,
                            from_t=from_t,
                            to_stick_index=to_stick_index,
                            to_face_index=to_face_index,
                            to_t=to_t,
                            angle=angle)

# 4. output geometry
geo = agg.visualize()
# ---------- end stick_module_aggregation_6 ----------
draw_27 = COMPASDraw(cg=stick_module_aggregation_6.module_frame_out)  # -> rg; same code as draw
draw_28 = COMPASDraw(cg=stick_module_aggregation_6.geo)  # -> rg; same code as draw
draw_29 = COMPASDraw(cg=stick_module_aggregation_6.module_out)  # -> rg; same code as draw
preview_12 = CustomPreview(
    Geometry=draw_28,
    Material={diffuse=RGB(221, 160, 221), emission=RGB(66, 48, 66), shine=0.5, specular=RGB(255, 255, 255), transparency=0})
vec_display_15 = Cluster(pln=draw_27, num=30)

pt_14 = ConstructPoint(XCoordinate=0, YCoordinate=0, ZCoordinate=0)  # disabled
number_slider_75 = Slider(90, range=0..100)  # disabled
xy_11 = XYPlane(Origin=pt_14)  # disabled
xz_11 = XZPlane(Origin=Point(0, 0, 0))  # disabled
rot3d_7 = Rotate3D(Geometry=xy_11, Angle=degrees(number_slider_75), Center=Point(0, 0, 0), Axis=xz_11)  # -> Geometry, Transform; disabled

number_slider_76 = Slider(2, range=0..3)  # disabled
number_slider_77 = Slider(1, range=0..3)  # disabled
number_slider_78 = Slider(2, range=0..3)  # disabled
number_slider_79 = Slider(1, range=0..3)  # disabled
number_slider_80 = Slider(0, range=0..180)  # disabled
number_slider_81 = Slider(0.793, range=0..1)  # disabled
number_slider_82 = Slider(1, range=0..10)  # disabled
number_slider_83 = Slider(0, range=0..1)  # disabled
stick_module_aggregation_7 = Python3Script(
    base_plane=rot3d_7.Geometry,
    agg_times=number_slider_82,
    from_stick_index=number_slider_79,
    from_face_index=number_slider_78,
    from_t=number_slider_81,
    to_stick_index=number_slider_77,
    to_face_index=number_slider_76,
    to_t=number_slider_83,
    angle=number_slider_80)  # -> out, module_out, geo, module_frame_out, from_frame, to_frame; inputs agg_times: Int32, from_stick_index: Int32, from_face_index: Int32, from_t: Double, to_stick_index: Int32, to_face_index: Int32, to_t: Double, angle: Double; disabled
# ---------- stick_module_aggregation_7: Python ----------
# r: compas>=2.14.1
# venv: sticks

import sys
import os
import math

#get current file path
path = ghenv.Component.OnPingDocument().FilePath
print (path)
#get parent directory of the parent directory
parentdir = os.path.dirname(path)
print (parentdir)
#get src folder which contains classes
dire = os.path.join(parentdir,'scripts')
print (dire)

sys.path.append(dire)

from compas_rhino import unload_modules

unload_modules("Sticks_Single_1")
unload_modules("Sticks_Multiple_1")
unload_modules("Sticks_Aggregation_3")

from Sticks_Single_1 import Stick  
from Sticks_Multiple_1 import TiltedModule
from Sticks_Aggregation_3 import ModuleAggregation
from compas.geometry import Line, Point, Vector, Frame
from compas_rhino.conversions import plane_to_compas_frame, frame_to_rhino_plane

module_agg = []
stick_width = 13.0
stick_depth = 13.0
stick_d_length = 235
stick_u_length = 263

# Convert input to compas
base_frame = plane_to_compas_frame(base_plane)

# Initialize tree
module_unit = TiltedModule(base_frame = base_frame, root_angle = 25, stick_d_length = 235, stick_u_length = 263, width = stick_width, depth = stick_depth)

# Grow tree
module_unit.grow_stick(length = stick_u_length, from_stick_index = -1, face_index = 2, angle = 27)
module_unit.grow_shorter_stick(length = stick_d_length, from_stick_index = 0, face_index = 3, angle = 50)
module_unit.grow_longer_stick(length = stick_u_length, from_stick_index = 2, face_index = 1, angle = 27)

# Visualize
module_out = module_unit.visualize()
module_frame_out = [frame_to_rhino_plane(stick.frame) for stick in module_unit.sticks]
# print(module_unit.sticks)

# Aggregation
# 1. build first module
module_agg = ModuleAggregation(module_unit.sticks)
# print(module_agg.first_module)

# 2. build ModuleAggregation
module_agg.compute_next_module(from_stick_index=from_stick_index,
                            from_face_index=from_face_index,
                            from_t=from_t,
                            to_stick_index=to_stick_index,
                            to_face_index=to_face_index,
                            to_t=to_t,
                            angle=angle)

from_frame = frame_to_rhino_plane(module_agg.from_frame)
to_frame = frame_to_rhino_plane(module_agg.to_frame)

# 4. output geometry
geo = module_agg.visualize()
# ---------- end stick_module_aggregation_7 ----------
draw_30 = COMPASDraw(cg=stick_module_aggregation_7.geo)  # -> rg; disabled; same code as draw
draw_31 = COMPASDraw(cg=stick_module_aggregation_7.module_out)  # -> rg; disabled; same code as draw
pln_25 = Plane(stick_module_aggregation_7.module_frame_out)  # disabled
preview_13 = CustomPreview(
    Geometry=draw_31,
    Material={diffuse=RGB(221, 160, 221), emission=RGB(66, 48, 66), shine=0.5, specular=RGB(255, 255, 255), transparency=0})  # disabled
vec_display_16 = Cluster(num=30)  # disabled

pt_15 = ConstructPoint(XCoordinate=0, YCoordinate=0, ZCoordinate=0)  # disabled
number_slider_84 = Slider(90, range=0..100)  # disabled
xy_12 = XYPlane(Origin=pt_15)  # disabled
xz_12 = XZPlane(Origin=Point(0, 0, 0))  # disabled
rot3d_8 = Rotate3D(Geometry=xy_12, Angle=degrees(number_slider_84), Center=Point(0, 0, 0), Axis=xz_12)  # -> Geometry, Transform; disabled

number_slider_85 = Slider(3, range=0..3)  # disabled
number_slider_86 = Slider(1, range=0..3)  # disabled
number_slider_87 = Slider(1, range=0..3)  # disabled
number_slider_88 = Slider(0, range=0..3)  # disabled
number_slider_89 = Slider(0, range=0..180)  # disabled
number_slider_90 = Slider(0, range=0..1)  # disabled
number_slider_91 = Slider(1, range=0..10)  # disabled
number_slider_92 = Slider(0.745, range=0..1)  # disabled
stick_module_aggregation_8 = Python3Script(
    base_plane=rot3d_8.Geometry,
    agg_times=number_slider_91,
    to_stick_index=number_slider_88,
    to_face_index=number_slider_87,
    to_t=number_slider_90,
    from_stick_index=number_slider_86,
    from_face_index=number_slider_85,
    from_t=number_slider_92,
    angle=number_slider_89)  # -> out, module_out, geo, module_frame_out, to_frame, from_frame; inputs agg_times: Int32, to_stick_index: Int32, to_face_index: Int32, to_t: Double, from_stick_index: Int32, from_face_index: Int32, from_t: Double, angle: Double; disabled; same code as stick_module_aggregation_7
draw_32 = COMPASDraw(cg=stick_module_aggregation_8.geo)  # -> rg; disabled; same code as draw
draw_33 = COMPASDraw(cg=stick_module_aggregation_8.module_out)  # -> rg; disabled; same code as draw
pln_26 = Plane(stick_module_aggregation_8.module_frame_out)  # disabled
preview_14 = CustomPreview(
    Geometry=draw_33,
    Material={diffuse=RGB(221, 160, 221), emission=RGB(66, 48, 66), shine=0.5, specular=RGB(255, 255, 255), transparency=0})  # disabled
vec_display_17 = Cluster(num=30)  # disabled

pt_16 = ConstructPoint(XCoordinate=0, YCoordinate=0, ZCoordinate=0)  # disabled
number_slider_93 = Slider(90, range=0..100)  # disabled
xy_13 = XYPlane(Origin=pt_16)  # disabled
xz_13 = XZPlane(Origin=Point(0, 0, 0))  # disabled
rot3d_9 = Rotate3D(Geometry=xy_13, Angle=degrees(number_slider_93), Center=Point(0, 0, 0), Axis=xz_13)  # -> Geometry, Transform; disabled

number_slider_94 = Slider(3, range=0..3)  # disabled
number_slider_95 = Slider(1, range=0..3)  # disabled
number_slider_96 = Slider(1, range=0..3)  # disabled
number_slider_97 = Slider(0, range=0..3)  # disabled
number_slider_98 = Slider(0, range=0..180)  # disabled
number_slider_99 = Slider(0, range=0..1)  # disabled
number_slider_100 = Slider(1, range=0..10)  # disabled
number_slider_101 = Slider(0.745, range=0..1)  # disabled
stick_module_aggregation_9 = Python3Script(
    base_plane=rot3d_9.Geometry,
    agg_times=number_slider_100,
    to_stick_index=number_slider_97,
    to_face_index=number_slider_96,
    to_t=number_slider_99,
    from_stick_index=number_slider_95,
    from_face_index=number_slider_94,
    from_t=number_slider_101,
    angle=number_slider_98)  # -> out, module_out, geo, module_frame_out, to_frame, from_frame; inputs agg_times: Int32, to_stick_index: Int32, to_face_index: Int32, to_t: Double, from_stick_index: Int32, from_face_index: Int32, from_t: Double, angle: Double; disabled; same code as stick_module_aggregation_7
draw_34 = COMPASDraw(cg=stick_module_aggregation_9.geo)  # -> rg; disabled; same code as draw
draw_35 = COMPASDraw(cg=stick_module_aggregation_9.module_out)  # -> rg; disabled; same code as draw
pln_27 = Plane(stick_module_aggregation_9.module_frame_out)  # disabled
preview_15 = CustomPreview(
    Geometry=draw_35,
    Material={diffuse=RGB(221, 160, 221), emission=RGB(66, 48, 66), shine=0.5, specular=RGB(255, 255, 255), transparency=0})  # disabled
vec_display_18 = Cluster(num=30)  # disabled

# ---- group: aggregation_arc_1
pt_17 = ConstructPoint(XCoordinate=0, YCoordinate=0, ZCoordinate=0)  # disabled
number_slider_102 = Slider(90, range=0..100)  # disabled
xy_14 = XYPlane(Origin=pt_17)  # disabled
xz_14 = XZPlane(Origin=Point(0, 0, 0))  # disabled
rot3d_10 = Rotate3D(Geometry=xy_14, Angle=degrees(number_slider_102), Center=Point(0, 0, 0), Axis=xz_14)  # -> Geometry, Transform; disabled

number_slider_103 = Slider(3, range=0..3)  # disabled
number_slider_104 = Slider(1, range=0..3)  # disabled
# opposite: from frame to frame
# aggregation order: orient type a, orient type b
# position of layer by layer
number_slider_105 = Slider(2, range=0..180)  # disabled
number_slider_106 = Slider(1, range=0..3)  # disabled
number_slider_107 = Slider(0, range=0..3)  # disabled
number_slider_108 = Slider(0, range=0..1)  # disabled
number_slider_109 = Slider(5, range=0..10)  # disabled
number_slider_110 = Slider(0.745, range=0..1)  # disabled
neg_3 = Negative(Value=number_slider_105)  # disabled
stick_module_aggregation_10 = Python3Script(
    base_plane=rot3d_10.Geometry,
    agg_times=number_slider_109,
    to_stick_index=number_slider_107,
    to_face_index=number_slider_106,
    to_t=number_slider_108,
    from_stick_index=number_slider_104,
    from_face_index=number_slider_103,
    from_t=number_slider_110,
    angle=neg_3)  # -> out, module_out, geo, module_frame_out, to_frame, from_frame; inputs agg_times: Int32, to_stick_index: Int32, to_face_index: Int32, to_t: Double, from_stick_index: Int32, from_face_index: Int32, from_t: Double, angle: Double; disabled
# ---------- stick_module_aggregation_10: Python ----------
# r: compas>=2.14.1
# venv: sticks

import sys
import os
import math

#get current file path
path = ghenv.Component.OnPingDocument().FilePath
print (path)
#get parent directory of the parent directory
parentdir = os.path.dirname(path)
print (parentdir)
#get src folder which contains classes
dire = os.path.join(parentdir,'scripts')
print (dire)

sys.path.append(dire)

from compas_rhino import unload_modules

unload_modules("Sticks_Single_1")
unload_modules("Sticks_Multiple_1")
unload_modules("Sticks_Aggregation_5")

from Sticks_Single_1 import Stick  
from Sticks_Multiple_1 import TiltedModule
from Sticks_Aggregation_5 import ModuleAggregation
from compas.geometry import Line, Point, Vector, Frame
from compas_rhino.conversions import plane_to_compas_frame, frame_to_rhino_plane

module_agg = []
stick_width = 13.0
stick_depth = 13.0
stick_d_length = 235
stick_u_length = 263

# Convert input to compas
base_frame = plane_to_compas_frame(base_plane)

# Initialize tree
module_unit = TiltedModule(base_frame = base_frame, root_angle = 25, stick_d_length = 235, stick_u_length = 263, width = stick_width, depth = stick_depth)

# Grow tree
module_unit.grow_stick(length = stick_u_length, from_stick_index = -1, face_index = 2, angle = 27)
module_unit.grow_shorter_stick(length = stick_d_length, from_stick_index = 0, face_index = 3, angle = 50)
module_unit.grow_longer_stick(length = stick_u_length, from_stick_index = 2, face_index = 1, angle = 27)

# Visualize
module_out = module_unit.visualize()
module_frame_out = [frame_to_rhino_plane(stick.frame) for stick in module_unit.sticks]

# Aggregation

module_agg = ModuleAggregation(module_unit.sticks)

for i in range(agg_times):
    module_agg.compute_next_module(
        from_stick_index=from_stick_index,
        from_face_index=from_face_index,
        from_t=from_t,
        to_stick_index=to_stick_index,
        to_face_index=to_face_index,
        to_t=to_t,
        angle=angle)
    
    from_frame = frame_to_rhino_plane(module_agg.from_frame)
    to_frame = frame_to_rhino_plane(module_agg.to_frame)


# output geometry
geo = module_agg.visualize()
# ---------- end stick_module_aggregation_10 ----------
draw_36 = COMPASDraw(cg=stick_module_aggregation_10.module_out)  # -> rg; disabled; same code as draw
draw_37 = COMPASDraw(cg=stick_module_aggregation_10.geo)  # -> rg; disabled; same code as draw
pln_28 = Plane(stick_module_aggregation_10.from_frame)  # disabled
pln_29 = Plane(stick_module_aggregation_10.to_frame)  # disabled
pln_30 = Plane(stick_module_aggregation_10.module_frame_out)  # disabled
preview_16 = CustomPreview(
    Geometry=draw_36,
    Material={diffuse=RGB(221, 160, 221), emission=RGB(66, 48, 66), shine=0.5, specular=RGB(255, 255, 255), transparency=0})  # disabled
vec_display_19 = Cluster(num=30)  # disabled
number_slider_111 = Slider(0, range=0..3)  # disabled
number_slider_112 = Slider(1, range=0..3)  # disabled
tstat_4 = TreeStatistics(Tree=pln_28)  # -> simplify(Paths), Length, Count; disabled
item_13 = ListItem(List=draw_36, Index=number_slider_111, Wrap=True)  # disabled
item_14 = ListItem(List=tstat_4.Paths, Index=number_slider_111, Wrap=True)  # disabled
item_15 = ListItem(List=pln_30, Index=number_slider_112, Wrap=True)  # disabled
branch_4 = TreeBranch(Tree=pln_28, Path=item_14, MaintainPaths=True)  # disabled
vec_display_20 = Cluster(pln=branch_4, num=30)  # disabled

# ----
pln_31 = Plane(stick_module_aggregation_7.from_frame)  # disabled
pln_32 = Plane(stick_module_aggregation_7.to_frame)  # disabled
pln_33 = Plane(stick_module_aggregation_8.from_frame)  # disabled
pln_34 = Plane(stick_module_aggregation_8.to_frame)  # disabled
pln_35 = Plane(stick_module_aggregation_9.from_frame)  # disabled
pln_36 = Plane(stick_module_aggregation_9.to_frame)  # disabled
number_slider_113 = Slider(1, range=0..3)  # disabled
number_slider_114 = Slider(1, range=0..3)  # disabled
number_slider_115 = Slider(0, range=0..3)  # disabled
number_slider_116 = Slider(1, range=0..3)  # disabled
debrep_4 = DeconstructBrep(Brep=draw_28)  # -> Faces, Edges, Vertices
multiplication_2 = Multiplication(A=Slider(1, range=0..10), B="4")
number_slider_117 = Slider(0, range=0..3)  # disabled
tstat_5 = TreeStatistics(Tree=pln_32)  # -> simplify(Paths), Length, Count; disabled
number_slider_118 = Slider(1, range=0..3)  # disabled
multiplication_3 = Multiplication(A=Slider(0, range=0..10), B="4")
tstat_6 = TreeStatistics(Tree=pln_33)  # -> simplify(Paths), Length, Count; disabled
item_16 = ListItem(List=debrep_4.Edges, Index=0, Wrap=True)
series_3 = Series(Start=multiplication_2, Step=1, Count="4")
item_17 = ListItem(List=draw_31, Index=number_slider_113, Wrap=True)  # disabled
tstat_7 = TreeStatistics(Tree=pln_35)  # -> simplify(Paths), Length, Count; disabled
item_18 = ListItem(List=tstat_5.Paths, Index=number_slider_113, Wrap=True)  # disabled
series_4 = Series(Start=multiplication_3, Step=1, Count="4")
item_19 = ListItem(List=pln_25, Index=number_slider_114, Wrap=True)  # disabled
item_20 = ListItem(List=draw_28, Index=Slider(1, range=0..3), Wrap=True)
item_21 = ListItem(List=draw_33, Index=number_slider_115, Wrap=True)  # disabled
item_22 = ListItem(List=tstat_6.Paths, Index=number_slider_115, Wrap=True)  # disabled
item_23 = ListItem(List=pln_26, Index=number_slider_116, Wrap=True)  # disabled

# ---- group: aggregation_4 legs_arc_2
pt_18 = Point(Point(19.5, -439.0724516, 2.747018701))  # disabled
pt_19 = Point(Point(-104.5174306, -439.0724516, 2.747018701))  # disabled
vec2pt_2 = Vector2Pt(PointA=pt_18, PointB=pt_19, Unitize=False)  # -> Vector, Length; disabled
number_slider_119 = Slider(2, range=0..10)  # disabled
panel_3 = Panel(vec2pt_2.Vector)  # disabled
series_5 = Series(Start=0, Step=1, Count=number_slider_119)  # disabled
multiplication_4 = Multiplication(A=vec2pt_2.Vector, B=series_5)  # disabled
group_2 = Group(Geometry=draw_26)  # disabled
move_2 = Move(Geometry=group_2, Motion=multiplication_4)  # -> Geometry, Transform; disabled
ungroup_2 = Ungroup(Group=move_2.Geometry)  # disabled

# ----
len_3 = Length(Curve=item_16)  # -> flatten(Length)
item_24 = ListItem(List=draw_35, Index=number_slider_117, Wrap=True)  # disabled
item_25 = ListItem(List=draw_28, Index=series_3, Wrap=True)
branch_5 = TreeBranch(Tree=pln_32, Path=item_18, MaintainPaths=True)  # disabled
item_26 = ListItem(List=tstat_7.Paths, Index=number_slider_117, Wrap=True)  # disabled
item_27 = ListItem(List=pln_27, Index=number_slider_118, Wrap=True)  # disabled
debrep_5 = DeconstructBrep(Brep=item_20)  # -> Faces, Edges, Vertices
item_28 = ListItem(List=draw_28, Index=series_4, Wrap=True)
branch_6 = TreeBranch(Tree=pln_33, Path=item_22, MaintainPaths=True)  # disabled
panel_4 = Panel(len_3)
vec_display_21 = Cluster(pln=branch_5, num=30)  # disabled
branch_7 = TreeBranch(Tree=pln_35, Path=item_26, MaintainPaths=True)  # disabled
area_2 = Area(Geometry=debrep_5.Faces)  # -> Area, Centroid
preview_17 = CustomPreview(
    Geometry=item_28,
    Material={diffuse=RGB(221, 160, 221), emission=RGB(66, 48, 66), shine=0.5, specular=RGB(255, 255, 255), transparency=0})
vec_display_22 = Cluster(pln=branch_6, num=30)  # disabled
vec_display_23 = Cluster(pln=branch_7, num=30)  # disabled
item_29 = ListItem(List=item_28, Index=series_3, Wrap=True)
points_5 = PointList(Points=area_2.Centroid, Size=Slider(10, range=0..10))

# ---- group: stick_module_aggregation
pt_20 = ConstructPoint(XCoordinate=0, YCoordinate=0, ZCoordinate=0)  # disabled
number_slider_120 = Slider(90, range=0..100)  # disabled
xy_15 = XYPlane(Origin=pt_20)  # disabled
xz_15 = XZPlane(Origin=Point(0, 0, 0))  # disabled
rot3d_11 = Rotate3D(Geometry=xy_15, Angle=degrees(number_slider_120), Center=Point(0, 0, 0), Axis=xz_15)  # -> Geometry, Transform; disabled
number_slider_121 = Slider(3, range=0..3)  # disabled
number_slider_122 = Slider(1, range=0..3)  # disabled
number_slider_123 = Slider(1, range=0..3)  # disabled
number_slider_124 = Slider(0, range=0..3)  # disabled
number_slider_125 = Slider(20, range=0..180)  # disabled
number_slider_126 = Slider(0, range=0..1)  # disabled
number_slider_127 = Slider(3, range=0..10)  # disabled
number_slider_128 = Slider(0.745, range=0..1)  # disabled
stick_module_aggregation_11 = Python3Script(
    base_plane=rot3d_11.Geometry,
    agg_times=number_slider_127,
    to_stick_index=number_slider_124,
    to_face_index=number_slider_123,
    to_t=number_slider_126,
    from_stick_index=number_slider_122,
    from_face_index=number_slider_121,
    from_t=number_slider_128,
    angle=number_slider_125)  # -> out, module_out, geo, module_frame_out, to_frame, from_frame; inputs agg_times: Int32, to_stick_index: Int32, to_face_index: Int32, to_t: Double, from_stick_index: Int32, from_face_index: Int32, from_t: Double, angle: Double; disabled
# ---------- stick_module_aggregation_11: Python ----------
# r: compas>=2.14.1
# venv: sticks

import sys
import os
import math

# get current file path
path = ghenv.Component.OnPingDocument().FilePath
parentdir = os.path.dirname(path)
dire = os.path.join(parentdir, 'scripts')
sys.path.append(dire)

from compas_rhino import unload_modules
unload_modules("Sticks_Single_1")
unload_modules("Sticks_Multiple_1")
unload_modules("Sticks_Aggregation_4")

from Sticks_Single_1 import Stick
from Sticks_Multiple_1 import TiltedModule
from Sticks_Aggregation_4 import ModuleAggregation # ★ 你新版本的 aggregation
from compas.geometry import Line, Point, Vector, Frame
from compas_rhino.conversions import plane_to_compas_frame, frame_to_rhino_plane


# ---------------------
# 初始化參數與第一個模矩
# ---------------------
stick_width = 13.0
stick_depth = 13.0
stick_d_length = 235
stick_u_length = 263

base_frame = plane_to_compas_frame(base_plane)

# 建立第一個 module
module_unit = TiltedModule(
    base_frame=base_frame,
    root_angle=25,
    stick_d_length=stick_d_length,
    stick_u_length=stick_u_length,
    width=stick_width,
    depth=stick_depth
)

# growth 過程
module_unit.grow_stick(length=stick_u_length, from_stick_index=-1, face_index=2, angle=27)
module_unit.grow_shorter_stick(length=stick_d_length, from_stick_index=0, face_index=3, angle=50)
module_unit.grow_longer_stick(length=stick_u_length, from_stick_index=2, face_index=1, angle=27)

# 建立 aggregation
module_agg = ModuleAggregation(module_unit.sticks)


# ---------------------
# 產生後續模矩
# ---------------------
for i in range(agg_times):

    # 產生下一個模矩（四根 stick）
    next_module = TiltedModule(
        base_frame=base_frame,
        root_angle=25,
        stick_d_length=stick_d_length,
        stick_u_length=stick_u_length,
        width=stick_width,
        depth=stick_depth
    )

    # 讓新模矩有自己的 grow 結構
    next_module.grow_stick(length=stick_u_length, from_stick_index=-1, face_index=2, angle=27)
    next_module.grow_shorter_stick(length=stick_d_length, from_stick_index=0, face_index=3, angle=50)
    next_module.grow_longer_stick(length=stick_u_length, from_stick_index=2, face_index=1, angle=27)

    # ★★ 最重要：對齊到上一層模矩
    module_agg.orient_next_module(next_module.sticks)


# ---------------------
# Output to Grasshopper
# ---------------------
all_sticks = module_agg.get_all_sticks()

# geo = [stick.as_geometry() for stick in all_sticks]
geo = [stick.visualize() for stick in all_sticks]
print(geo)
module_frame_out = [frame_to_rhino_plane(stick.frame) for stick in all_sticks]
# ---------- end stick_module_aggregation_11 ----------
draw_38 = COMPASDraw(cg=stick_module_aggregation_11.module_out)  # -> rg; disabled; same code as draw
draw_39 = COMPASDraw(cg=stick_module_aggregation_11.geo)  # -> rg; disabled; same code as draw
pln_37 = Plane(stick_module_aggregation_11.module_frame_out)  # disabled
preview_18 = CustomPreview(
    Geometry=draw_38,
    Material={diffuse=RGB(221, 160, 221), emission=RGB(66, 48, 66), shine=0.5, specular=RGB(255, 255, 255), transparency=0})  # disabled
vec_display_24 = Cluster(num=30)  # disabled

pt_21 = ConstructPoint(XCoordinate=0, YCoordinate=0, ZCoordinate=0)  # disabled
number_slider_129 = Slider(90, range=0..100)  # disabled
xy_16 = XYPlane(Origin=pt_21)  # disabled
xz_16 = XZPlane(Origin=Point(0, 0, 0))  # disabled
rot3d_12 = Rotate3D(Geometry=xy_16, Angle=degrees(number_slider_129), Center=Point(0, 0, 0), Axis=xz_16)  # -> Geometry, Transform; disabled

number_slider_130 = Slider(3, range=0..3)  # disabled
number_slider_131 = Slider(1, range=0..3)  # disabled
number_slider_132 = Slider(1, range=0..3)  # disabled
number_slider_133 = Slider(0, range=0..3)  # disabled
# set (i-1) times module as base, orient first_module on it
number_slider_134 = Slider(0, range=0..180)  # disabled
number_slider_135 = Slider(0, range=0..1)  # disabled
number_slider_136 = Slider(2, range=0..10)  # disabled
number_slider_137 = Slider(0.745, range=0..1)  # disabled
stick_module_aggregation_12 = Python3Script(
    base_plane=rot3d_12.Geometry,
    agg_times=number_slider_136,
    to_stick_index=number_slider_133,
    to_face_index=number_slider_132,
    to_t=number_slider_135,
    from_stick_index=number_slider_131,
    from_face_index=number_slider_130,
    from_t=number_slider_137,
    angle=number_slider_134)  # -> out, module_out, geo, module_frame_out, to_frame, from_frame; inputs agg_times: Int32, to_stick_index: Int32, to_face_index: Int32, to_t: Double, from_stick_index: Int32, from_face_index: Int32, from_t: Double, angle: Double; disabled
# ---------- stick_module_aggregation_12: Python ----------
# r: compas>=2.14.1
# venv: sticks

import sys
import os
import math

#get current file path
path = ghenv.Component.OnPingDocument().FilePath
print (path)
#get parent directory of the parent directory
parentdir = os.path.dirname(path)
print (parentdir)
#get src folder which contains classes
dire = os.path.join(parentdir,'scripts')
print (dire)

sys.path.append(dire)

from compas_rhino import unload_modules

unload_modules("Sticks_Single_1")
unload_modules("Sticks_Multiple_1")
unload_modules("Sticks_Aggregation_3")

from Sticks_Single_1 import Stick  
from Sticks_Multiple_1 import TiltedModule
from Sticks_Aggregation_3 import ModuleAggregation
from compas.geometry import Line, Point, Vector, Frame
from compas_rhino.conversions import plane_to_compas_frame, frame_to_rhino_plane

module_agg = []
stick_width = 13.0
stick_depth = 13.0
stick_d_length = 235
stick_u_length = 263

# Convert input to compas
base_frame = plane_to_compas_frame(base_plane)

# Initialize tree
module_unit = TiltedModule(base_frame = base_frame, root_angle = 25, stick_d_length = 235, stick_u_length = 263, width = stick_width, depth = stick_depth)

# Grow tree
module_unit.grow_stick(length = stick_u_length, from_stick_index = -1, face_index = 2, angle = 27)
module_unit.grow_shorter_stick(length = stick_d_length, from_stick_index = 0, face_index = 3, angle = 50)
module_unit.grow_longer_stick(length = stick_u_length, from_stick_index = 2, face_index = 1, angle = 27)

# Visualize
module_out = module_unit.visualize()
module_frame_out = [frame_to_rhino_plane(stick.frame) for stick in module_unit.sticks]
# print(module_unit.sticks)

# Aggregation
# 1. build first module
module_agg = ModuleAggregation(module_unit.sticks)
# print(module_agg.first_module)

for i in range(agg_times):

    # 2. build ModuleAggregation
    module_agg.compute_next_module(from_stick_index=from_stick_index,
                                from_face_index=from_face_index,
                                from_t=from_t,
                                to_stick_index=to_stick_index,
                                to_face_index=to_face_index,
                                to_t=to_t,
                                angle=angle)

    from_frame = frame_to_rhino_plane(module_agg.from_frame)
    to_frame = frame_to_rhino_plane(module_agg.to_frame)

# 4. output geometry
geo = module_agg.visualize()
# ---------- end stick_module_aggregation_12 ----------
draw_40 = COMPASDraw(cg=stick_module_aggregation_12.module_out)  # -> rg; disabled; same code as draw
draw_41 = COMPASDraw(cg=stick_module_aggregation_12.geo)  # -> rg; disabled; same code as draw
pln_38 = Plane(stick_module_aggregation_12.module_frame_out)  # disabled
preview_19 = CustomPreview(
    Geometry=draw_40,
    Material={diffuse=RGB(221, 160, 221), emission=RGB(66, 48, 66), shine=0.5, specular=RGB(255, 255, 255), transparency=0})  # disabled
vec_display_25 = Cluster(num=30)  # disabled

# ---- group: aggregation_spiral tower_1
pt_22 = ConstructPoint(XCoordinate=0, YCoordinate=0, ZCoordinate=0)
xy_17 = XYPlane(Origin=pt_22)
xz_17 = XZPlane(Origin=Point(0, 0, 0))
rot3d_13 = Rotate3D(Geometry=xy_17, Angle=degrees(Slider(90, range=0..100)), Center=Point(0, 0, 0), Axis=xz_17)  # -> Geometry, Transform

# spiral tower
number_slider_138 = Slider(3, range=0..3)
number_slider_139 = Slider(24, range=0..180)
# opposite: from frame to frame
# aggregation order: orient type a, orient type b
# position of layer by layer
number_slider_140 = Slider(-24, range=-180..180)
stick_module_aggregation_13 = Python3Script(
    base_plane=rot3d_13.Geometry,
    agg_times=Slider(9, range=0..10),
    to_stick_index=Slider(3, range=0..3),
    to_face_index=Slider(2, range=0..3),
    to_t=Slider(0.025, range=0..1),
    from_stick_index=Slider(1, range=0..3),
    from_face_index=number_slider_138,
    from_t=Slider(0.7, range=0..1),
    angle=number_slider_140)  # -> out, module_out, geo, module_frame_out, to_frame, from_frame; inputs agg_times: Int32, to_stick_index: Int32, to_face_index: Int32, to_t: Double, from_stick_index: Int32, from_face_index: Int32, from_t: Double, angle: Double; same code as stick_module_aggregation_10
draw_42 = COMPASDraw(cg=stick_module_aggregation_13.module_out)  # -> rg; same code as draw
draw_43 = COMPASDraw(cg=stick_module_aggregation_13.geo)  # -> rg; same code as draw
pln_39 = Plane(stick_module_aggregation_13.from_frame)
pln_40 = Plane(stick_module_aggregation_13.to_frame)
pln_41 = Plane(stick_module_aggregation_13.module_frame_out)
vec_display_26 = Cluster(num=30)
preview_20 = CustomPreview(
    Geometry=draw_43,
    Material={diffuse=RGB(221, 160, 221), emission=RGB(66, 48, 66), shine=0.5, specular=RGB(255, 255, 255), transparency=0})
number_slider_141 = Slider(3, range=0..3)
tstat_8 = TreeStatistics(Tree=pln_39)  # -> simplify(Paths), Length, Count
item_30 = ListItem(List=draw_42, Index=number_slider_141, Wrap=True)
item_31 = ListItem(List=tstat_8.Paths, Index=number_slider_141, Wrap=True)
item_32 = ListItem(List=pln_41, Index=Slider(1, range=0..3), Wrap=True)
branch_8 = TreeBranch(Tree=pln_39, Path=item_31, MaintainPaths=True)
vec_display_27 = Cluster(pln=branch_8, num=30)

# ----
panel_5 = Panel(stick_module_aggregation_11.geo)  # disabled
pln_42 = Plane(stick_module_aggregation_11.to_frame)  # disabled
pln_43 = Plane(stick_module_aggregation_11.from_frame)  # disabled
draw_44 = COMPASDraw(cg=stick_module_aggregation_11.geo)  # -> rg; disabled; same code as draw
pln_44 = Plane(stick_module_aggregation_12.from_frame)  # disabled
number_slider_142 = Slider(0, range=0..3)  # disabled
pln_45 = Plane(stick_module_aggregation_12.to_frame)  # disabled
number_slider_143 = Slider(1, range=0..3)  # disabled

# ---- group: aggregation_4 legs_arc_3_move by layer
pt_23 = ConstructPoint(XCoordinate=0, YCoordinate=0, ZCoordinate=0)  # disabled
number_slider_144 = Slider(90, range=0..100)  # disabled
xy_18 = XYPlane(Origin=pt_23)  # disabled
xz_18 = XZPlane(Origin=Point(0, 0, 0))  # disabled
rot3d_14 = Rotate3D(Geometry=xy_18, Angle=degrees(number_slider_144), Center=Point(0, 0, 0), Axis=xz_18)  # -> Geometry, Transform; disabled

number_slider_145 = Slider(1, range=0..3)  # disabled
# opposite: from frame to frame
# aggregation order: orient type a, orient type b
# position of layer by layer
number_slider_146 = Slider(1, range=0..10)  # disabled
number_slider_147 = Slider(0, range=0..3)  # disabled
number_slider_148 = Slider(46, range=-180..180)  # disabled
number_slider_149 = Slider(0.791, range=0..1)  # disabled
number_slider_150 = Slider(1, range=0..3)  # disabled
number_slider_151 = Slider(3, range=0..3)  # disabled
number_slider_152 = Slider(4, range=0..10)  # disabled
number_slider_153 = Slider(0.262, range=0..1)  # disabled
stick_module_aggregation_14 = Python3Script(
    base_plane=rot3d_14.Geometry,
    agg_times=number_slider_152,
    to_stick_index=number_slider_151,
    to_face_index=number_slider_150,
    to_t=number_slider_153,
    from_stick_index=number_slider_147,
    from_face_index=number_slider_145,
    from_t=number_slider_149,
    angle=number_slider_148,
    layer_iteration=number_slider_146)  # -> out, module_out, geo, module_frame_out, to_frame, from_frame; inputs agg_times: Int32, to_stick_index: Int32, to_face_index: Int32, to_t: Double, from_stick_index: Int32, from_face_index: Int32, from_t: Double, angle: Double, layer_iteration: Int32; disabled; same code as stick_module_aggregation_2
draw_45 = COMPASDraw(cg=stick_module_aggregation_14.module_out)  # -> rg; disabled; same code as draw
draw_46 = COMPASDraw(cg=stick_module_aggregation_14.geo)  # -> rg; disabled; same code as draw
pln_46 = Plane(stick_module_aggregation_14.from_frame)  # disabled
pln_47 = Plane(stick_module_aggregation_14.to_frame)  # disabled
pln_48 = Plane(stick_module_aggregation_14.module_frame_out)  # disabled
preview_21 = CustomPreview(
    Geometry=draw_45,
    Material={diffuse=RGB(221, 160, 221), emission=RGB(66, 48, 66), shine=0.5, specular=RGB(255, 255, 255), transparency=0})  # disabled
preview_22 = CustomPreview(
    Geometry=draw_46,
    Material={diffuse=RGB(221, 160, 221), emission=RGB(66, 48, 66), shine=0.5, specular=RGB(255, 255, 255), transparency=0})  # disabled
vec_display_28 = Cluster(num=30)  # disabled
number_slider_154 = Slider(3, range=0..3)  # disabled
number_slider_155 = Slider(1, range=0..3)  # disabled
tstat_9 = TreeStatistics(Tree=pln_46)  # -> simplify(Paths), Length, Count; disabled
item_33 = ListItem(List=draw_45, Index=number_slider_154, Wrap=True)  # disabled
item_34 = ListItem(List=tstat_9.Paths, Index=number_slider_154, Wrap=True)  # disabled
item_35 = ListItem(List=pln_48, Index=number_slider_155, Wrap=True)  # disabled
branch_9 = TreeBranch(Tree=pln_46, Path=item_34, MaintainPaths=True)  # disabled
vec_display_29 = Cluster(pln=branch_9, num=30)  # disabled

# ----
tstat_10 = TreeStatistics(Tree=pln_43)  # -> simplify(Paths), Length, Count; disabled
number_slider_156 = Slider(0, range=0..3)  # disabled
number_slider_157 = Slider(1, range=0..3)  # disabled
item_36 = ListItem(List=draw_38, Index=number_slider_142, Wrap=True)  # disabled
item_37 = ListItem(List=tstat_10.Paths, Index=number_slider_142, Wrap=True)  # disabled
item_38 = ListItem(List=pln_37, Index=number_slider_143, Wrap=True)  # disabled
tstat_11 = TreeStatistics(Tree=pln_44)  # -> simplify(Paths), Length, Count; disabled
branch_10 = TreeBranch(Tree=pln_43, Path=item_37, MaintainPaths=True)  # disabled
item_39 = ListItem(List=draw_40, Index=number_slider_156, Wrap=True)  # disabled
item_40 = ListItem(List=tstat_11.Paths, Index=number_slider_156, Wrap=True)  # disabled
item_41 = ListItem(List=pln_38, Index=number_slider_157, Wrap=True)  # disabled
vec_display_30 = Cluster(pln=branch_10, num=30)  # disabled
branch_11 = TreeBranch(Tree=pln_44, Path=item_40, MaintainPaths=True)  # disabled
vec_display_31 = Cluster(pln=branch_11, num=30)  # disabled

# ---- group: stick_module_aggregation
pt_24 = ConstructPoint(XCoordinate=0, YCoordinate=0, ZCoordinate=0)  # disabled
number_slider_158 = Slider(90, range=0..100)  # disabled
xy_19 = XYPlane(Origin=pt_24)  # disabled
xz_19 = XZPlane(Origin=Point(0, 0, 0))  # disabled
rot3d_15 = Rotate3D(Geometry=xy_19, Angle=degrees(number_slider_158), Center=Point(0, 0, 0), Axis=xz_19)  # -> Geometry, Transform; disabled

number_slider_159 = Slider(3, range=0..3)  # disabled
number_slider_160 = Slider(1, range=0..3)  # disabled
number_slider_161 = Slider(1, range=0..3)  # disabled
number_slider_162 = Slider(0, range=0..3)  # disabled
# set (i-1) times module as base, orient first_module on it
number_slider_163 = Slider(0, range=0..180)  # disabled
number_slider_164 = Slider(0, range=0..1)  # disabled
number_slider_165 = Slider(1, range=0..10)  # disabled
number_slider_166 = Slider(0.745, range=0..1)  # disabled
stick_module_aggregation_15 = Python3Script(
    base_plane=rot3d_15.Geometry,
    agg_times=number_slider_165,
    to_stick_index=number_slider_162,
    to_face_index=number_slider_161,
    to_t=number_slider_164,
    from_stick_index=number_slider_160,
    from_face_index=number_slider_159,
    from_t=number_slider_166,
    angle=number_slider_163)  # -> out, module_out, geo, module_frame_out, to_frame, from_frame; inputs agg_times: Int32, to_stick_index: Int32, to_face_index: Int32, to_t: Double, from_stick_index: Int32, from_face_index: Int32, from_t: Double, angle: Double; disabled
# ---------- stick_module_aggregation_15: Python ----------
# r: compas>=2.14.1
# venv: sticks

import sys
import os
import math

#get current file path
path = ghenv.Component.OnPingDocument().FilePath
print (path)
#get parent directory of the parent directory
parentdir = os.path.dirname(path)
print (parentdir)
#get src folder which contains classes
dire = os.path.join(parentdir,'scripts')
print (dire)

sys.path.append(dire)

from compas_rhino import unload_modules

unload_modules("Sticks_Single_1")
unload_modules("Sticks_Multiple_1")
unload_modules("Sticks_Aggregation_4")

from Sticks_Single_1 import Stick  
from Sticks_Multiple_1 import TiltedModule
from Sticks_Aggregation_4 import ModuleAggregation
from compas.geometry import Line, Point, Vector, Frame
from compas_rhino.conversions import plane_to_compas_frame, frame_to_rhino_plane

module_agg = []
stick_width = 13.0
stick_depth = 13.0
stick_d_length = 235
stick_u_length = 263

# Convert input to compas
base_frame = plane_to_compas_frame(base_plane)

# Initialize tree
module_unit = TiltedModule(base_frame = base_frame, root_angle = 25, stick_d_length = 235, stick_u_length = 263, width = stick_width, depth = stick_depth)

# Grow tree
module_unit.grow_stick(length = stick_u_length, from_stick_index = -1, face_index = 2, angle = 27)
module_unit.grow_shorter_stick(length = stick_d_length, from_stick_index = 0, face_index = 3, angle = 50)
module_unit.grow_longer_stick(length = stick_u_length, from_stick_index = 2, face_index = 1, angle = 27)

# Visualize
module_out = module_unit.visualize()
module_frame_out = [frame_to_rhino_plane(stick.frame) for stick in module_unit.sticks]
# print(module_unit.sticks)

# Aggregation
# 1. build first module
module_agg = ModuleAggregation(module_unit.sticks)
# print(module_agg.first_module)

for i in range(agg_times):

    # 2. build ModuleAggregation
    module_agg.compute_next_module(from_stick_index=from_stick_index,
                                from_face_index=from_face_index,
                                from_t=from_t,
                                to_stick_index=to_stick_index,
                                to_face_index=to_face_index,
                                to_t=to_t,
                                angle=angle)

    from_frame = frame_to_rhino_plane(module_agg.from_frame)
    to_frame = frame_to_rhino_plane(module_agg.to_frame)

# 4. output geometry
geo = module_agg.visualize()
# ---------- end stick_module_aggregation_15 ----------
draw_47 = COMPASDraw(cg=stick_module_aggregation_15.module_out)  # -> rg; disabled; same code as draw
draw_48 = COMPASDraw(cg=stick_module_aggregation_15.geo)  # -> rg; disabled; same code as draw
pln_49 = Plane(stick_module_aggregation_15.module_frame_out)  # disabled
preview_23 = CustomPreview(
    Geometry=draw_47,
    Material={diffuse=RGB(221, 160, 221), emission=RGB(66, 48, 66), shine=0.5, specular=RGB(255, 255, 255), transparency=0})  # disabled
vec_display_32 = Cluster(num=30)  # disabled

pt_25 = ConstructPoint(XCoordinate=0, YCoordinate=0, ZCoordinate=0)  # disabled
number_slider_167 = Slider(90, range=0..100)  # disabled
xy_20 = XYPlane(Origin=pt_25)  # disabled
xz_20 = XZPlane(Origin=Point(0, 0, 0))  # disabled
rot3d_16 = Rotate3D(Geometry=xy_20, Angle=degrees(number_slider_167), Center=Point(0, 0, 0), Axis=xz_20)  # -> Geometry, Transform; disabled

number_slider_168 = Slider(3, range=0..3)  # disabled
number_slider_169 = Slider(1, range=0..3)  # disabled
number_slider_170 = Slider(1, range=0..3)  # disabled
number_slider_171 = Slider(0, range=0..3)  # disabled
number_slider_172 = Slider(20, range=0..180)  # disabled
number_slider_173 = Slider(0, range=0..1)  # disabled
number_slider_174 = Slider(3, range=0..10)  # disabled
number_slider_175 = Slider(0.745, range=0..1)  # disabled
stick_module_aggregation_16 = Python3Script(
    base_plane=rot3d_16.Geometry,
    agg_times=number_slider_174,
    to_stick_index=number_slider_171,
    to_face_index=number_slider_170,
    to_t=number_slider_173,
    from_stick_index=number_slider_169,
    from_face_index=number_slider_168,
    from_t=number_slider_175,
    angle=number_slider_172)  # -> out, module_out, geo, module_frame_out, to_frame, from_frame; inputs agg_times: Int32, to_stick_index: Int32, to_face_index: Int32, to_t: Double, from_stick_index: Int32, from_face_index: Int32, from_t: Double, angle: Double; disabled
# ---------- stick_module_aggregation_16: Python ----------
# r: compas>=2.14.1
# venv: sticks

import sys
import os
import math

# get current file path
path = ghenv.Component.OnPingDocument().FilePath
parentdir = os.path.dirname(path)
dire = os.path.join(parentdir, 'scripts')
sys.path.append(dire)

from compas_rhino import unload_modules
unload_modules("Sticks_Single_1")
unload_modules("Sticks_Multiple_1")
unload_modules("Sticks_Aggregation_4")

from Sticks_Single_1 import Stick
from Sticks_Multiple_1 import TiltedModule
from Sticks_Aggregation_4 import ModuleAggregation # ★ 你新版本的 aggregation
from compas.geometry import Line, Point, Vector, Frame
from compas_rhino.conversions import plane_to_compas_frame, frame_to_rhino_plane


# ---------------------
# 初始化參數與第一個模矩
# ---------------------
stick_width = 13.0
stick_depth = 13.0
stick_d_length = 235
stick_u_length = 263

base_frame = plane_to_compas_frame(base_plane)

# 建立第一個 module
module_unit = TiltedModule(
    base_frame=base_frame,
    root_angle=25,
    stick_d_length=stick_d_length,
    stick_u_length=stick_u_length,
    width=stick_width,
    depth=stick_depth
)

# growth 過程
module_unit.grow_stick(length=stick_u_length, from_stick_index=-1, face_index=2, angle=27)
module_unit.grow_shorter_stick(length=stick_d_length, from_stick_index=0, face_index=3, angle=50)
module_unit.grow_longer_stick(length=stick_u_length, from_stick_index=2, face_index=1, angle=27)

# 建立 aggregation
module_agg = ModuleAggregation(module_unit.sticks)


# ---------------------
# 產生後續模矩
# ---------------------
for i in range(agg_times):

    # # 產生下一個模矩（四根 stick）
    # next_module = TiltedModule(
    #     base_frame=base_frame,
    #     root_angle=25,
    #     stick_d_length=stick_d_length,
    #     stick_u_length=stick_u_length,
    #     width=stick_width,
    #     depth=stick_depth
    # )

    # # 讓新模矩有自己的 grow 結構
    # next_module.grow_stick(length=stick_u_length, from_stick_index=-1, face_index=2, angle=27)
    # next_module.grow_shorter_stick(length=stick_d_length, from_stick_index=0, face_index=3, angle=50)
    # next_module.grow_longer_stick(length=stick_u_length, from_stick_index=2, face_index=1, angle=27)

    # ★★ 最重要：對齊到上一層模矩
    module_agg.orient_next_module(module_agg.sticks)


# ---------------------
# Output to Grasshopper
# ---------------------
all_sticks = module_agg.get_all_sticks()

# geo = [stick.as_geometry() for stick in all_sticks]
geo = [stick.visualize() for stick in all_sticks]
print(geo)
module_frame_out = [frame_to_rhino_plane(stick.frame) for stick in all_sticks]
# ---------- end stick_module_aggregation_16 ----------
draw_49 = COMPASDraw(cg=stick_module_aggregation_16.module_out)  # -> rg; disabled; same code as draw
draw_50 = COMPASDraw(cg=stick_module_aggregation_16.geo)  # -> rg; disabled; same code as draw
pln_50 = Plane(stick_module_aggregation_16.module_frame_out)  # disabled
preview_24 = CustomPreview(
    Geometry=draw_49,
    Material={diffuse=RGB(221, 160, 221), emission=RGB(66, 48, 66), shine=0.5, specular=RGB(255, 255, 255), transparency=0})  # disabled
vec_display_33 = Cluster(num=30)  # disabled

# ----
panel_6 = Panel(stick_module_aggregation_16.geo)  # disabled
pln_51 = Plane(stick_module_aggregation_15.from_frame)  # disabled
pln_52 = Plane(stick_module_aggregation_15.to_frame)  # disabled
pln_53 = Plane(stick_module_aggregation_16.to_frame)  # disabled
pln_54 = Plane(stick_module_aggregation_16.from_frame)  # disabled
number_slider_176 = Slider(0, range=0..3)  # disabled
number_slider_177 = Slider(1, range=0..3)  # disabled
draw_51 = COMPASDraw(cg=stick_module_aggregation_16.geo)  # -> rg; disabled; same code as draw
number_slider_178 = Slider(0, range=0..3)  # disabled
number_slider_179 = Slider(1, range=0..3)  # disabled
tstat_12 = TreeStatistics(Tree=pln_51)  # -> simplify(Paths), Length, Count; disabled
tstat_13 = TreeStatistics(Tree=pln_54)  # -> simplify(Paths), Length, Count; disabled
item_42 = ListItem(List=draw_47, Index=number_slider_176, Wrap=True)  # disabled
item_43 = ListItem(List=tstat_12.Paths, Index=number_slider_176, Wrap=True)  # disabled
item_44 = ListItem(List=pln_49, Index=number_slider_177, Wrap=True)  # disabled

# ---- group: aggregation_spiral tower_1
pt_26 = ConstructPoint(XCoordinate=0, YCoordinate=0, ZCoordinate=0)  # disabled
number_slider_180 = Slider(90, range=0..100)  # disabled
xy_21 = XYPlane(Origin=pt_26)  # disabled
xz_21 = XZPlane(Origin=Point(0, 0, 0))  # disabled
rot3d_17 = Rotate3D(Geometry=xy_21, Angle=degrees(number_slider_180), Center=Point(0, 0, 0), Axis=xz_21)  # -> Geometry, Transform; disabled

# spiral tower
number_slider_181 = Slider(1, range=0..3)  # disabled
number_slider_182 = Slider(1, range=0..3)  # disabled
number_slider_183 = Slider(0, range=-180..180)  # disabled
number_slider_184 = Slider(0.8, range=0..1)  # disabled
number_slider_185 = Slider(2, range=0..3)  # disabled
number_slider_186 = Slider(3, range=0..3)  # disabled
number_slider_187 = Slider(9, range=0..10)  # disabled
number_slider_188 = Slider(0.1, range=0..1)  # disabled
stick_module_aggregation_17 = Python3Script(
    base_plane=rot3d_17.Geometry,
    agg_times=number_slider_187,
    to_stick_index=number_slider_186,
    to_face_index=number_slider_185,
    to_t=number_slider_188,
    from_stick_index=number_slider_182,
    from_face_index=number_slider_181,
    from_t=number_slider_184,
    angle=number_slider_183)  # -> out, module_out, geo, module_frame_out, to_frame, from_frame; inputs agg_times: Int32, to_stick_index: Int32, to_face_index: Int32, to_t: Double, from_stick_index: Int32, from_face_index: Int32, from_t: Double, angle: Double; disabled; same code as stick_module_aggregation_10
draw_52 = COMPASDraw(cg=stick_module_aggregation_17.module_out)  # -> rg; disabled; same code as draw
draw_53 = COMPASDraw(cg=stick_module_aggregation_17.geo)  # -> rg; disabled; same code as draw
pln_55 = Plane(stick_module_aggregation_17.from_frame)  # disabled
pln_56 = Plane(stick_module_aggregation_17.to_frame)  # disabled
pln_57 = Plane(stick_module_aggregation_17.module_frame_out)  # disabled
vec_display_34 = Cluster(num=30)  # disabled
preview_25 = CustomPreview(
    Geometry=draw_53,
    Material={diffuse=RGB(221, 160, 221), emission=RGB(66, 48, 66), shine=0.5, specular=RGB(255, 255, 255), transparency=0})  # disabled
number_slider_189 = Slider(3, range=0..3)  # disabled
number_slider_190 = Slider(1, range=0..3)  # disabled
tstat_14 = TreeStatistics(Tree=pln_55)  # -> simplify(Paths), Length, Count; disabled
item_45 = ListItem(List=draw_52, Index=number_slider_189, Wrap=True)  # disabled
item_46 = ListItem(List=tstat_14.Paths, Index=number_slider_189, Wrap=True)  # disabled
item_47 = ListItem(List=pln_57, Index=number_slider_190, Wrap=True)  # disabled
branch_12 = TreeBranch(Tree=pln_55, Path=item_46, MaintainPaths=True)  # disabled
vec_display_35 = Cluster(pln=branch_12, num=30)  # disabled

# ----
item_48 = ListItem(List=draw_49, Index=number_slider_178, Wrap=True)  # disabled
item_49 = ListItem(List=tstat_13.Paths, Index=number_slider_178, Wrap=True)  # disabled
item_50 = ListItem(List=pln_50, Index=number_slider_179, Wrap=True)  # disabled
branch_13 = TreeBranch(Tree=pln_51, Path=item_43, MaintainPaths=True)  # disabled
vec_display_36 = Cluster(pln=branch_13, num=30)  # disabled
branch_14 = TreeBranch(Tree=pln_54, Path=item_49, MaintainPaths=True)  # disabled
vec_display_37 = Cluster(pln=branch_14, num=30)  # disabled

pt_27 = Point(Point(6.5, -5.891000616, 2.747018701))  # disabled
pt_28 = Point(Point(32.5, 104.5473792, 2.747018701))  # disabled
vec2pt_3 = Vector2Pt(PointA=pt_27, PointB=pt_28, Unitize=False)  # -> Vector, Length; disabled
number_slider_191 = Slider(2, range=0..10)  # disabled
series_6 = Series(Start=0, Step=1, Count=number_slider_191)  # disabled
multiplication_5 = Multiplication(A=vec2pt_3.Vector, B=series_6)  # disabled
group_3 = Group(Geometry=draw_53)  # disabled
move_3 = Move(Geometry=group_3, Motion=multiplication_5)  # -> Geometry, Transform; disabled
ungroup_3 = Ungroup(Group=move_3.Geometry)  # disabled

number_slider_192 = Slider(180, range=-180..180)  # disabled
rotate_5 = Rotate(Geometry=group_3, Angle=degrees(number_slider_192), Plane=PlaneXY(0, 0, 0))  # -> Geometry, Transform; disabled
panel_7 = Panel("13")  # disabled
X = UnitX(Factor=panel_7)  # disabled
move_4 = Move(Geometry=rotate_5.Geometry, Motion=X)  # -> Geometry, Transform; disabled

# ---- group: aggregation_4 legs_arc_2
pt_29 = ConstructPoint(XCoordinate=0, YCoordinate=0, ZCoordinate=0)  # disabled
number_slider_193 = Slider(90, range=0..100)  # disabled
xy_22 = XYPlane(Origin=pt_29)  # disabled
xz_22 = XZPlane(Origin=Point(0, 0, 0))  # disabled
rot3d_18 = Rotate3D(Geometry=xy_22, Angle=degrees(number_slider_193), Center=Point(0, 0, 0), Axis=xz_22)  # -> Geometry, Transform; disabled

# arc_2
number_slider_194 = Slider(2, range=0..3)  # disabled
number_slider_195 = Slider(2, range=0..3)  # disabled
number_slider_196 = Slider(46, range=0..180)  # disabled
number_slider_197 = Slider(0.714, range=0..1)  # disabled
number_slider_198 = Slider(1, range=0..3)  # disabled
number_slider_199 = Slider(0, range=0..3)  # disabled
number_slider_200 = Slider(2, range=0..10)  # disabled
number_slider_201 = Slider(0.095, range=0..1)  # disabled
neg_4 = Negative(Value=number_slider_196)  # disabled
stick_module_aggregation_18 = Python3Script(
    base_plane=rot3d_18.Geometry,
    agg_times=number_slider_200,
    to_stick_index=number_slider_199,
    to_face_index=number_slider_198,
    to_t=number_slider_201,
    from_stick_index=number_slider_195,
    from_face_index=number_slider_194,
    from_t=number_slider_197,
    angle=neg_4)  # -> out, module_out, geo, module_frame_out, to_frame, from_frame; inputs agg_times: Int32, to_stick_index: Int32, to_face_index: Int32, to_t: Double, from_stick_index: Int32, from_face_index: Int32, from_t: Double, angle: Double; disabled
# ---------- stick_module_aggregation_18: Python ----------
# r: compas>=2.14.1
# venv: sticks

import sys
import os
import math

#get current file path
path = ghenv.Component.OnPingDocument().FilePath
print (path)
#get parent directory of the parent directory
parentdir = os.path.dirname(path)
print (parentdir)
#get src folder which contains classes
dire = os.path.join(parentdir,'scripts')
print (dire)

sys.path.append(dire)

from compas_rhino import unload_modules

unload_modules("Sticks_Single_1")
unload_modules("Sticks_Multiple_1")
unload_modules("Sticks_Aggregation_5")

from Sticks_Single_1 import Stick  
from Sticks_Multiple_1 import TiltedModule_4legs
from Sticks_Aggregation_5 import ModuleAggregation
from compas.geometry import Line, Point, Vector, Frame
from compas_rhino.conversions import plane_to_compas_frame, frame_to_rhino_plane

module_agg = []
stick_width = 13.0
stick_depth = 13.0
stick_d_length = 235
stick_u_length = 263

# Convert input to compas
base_frame = plane_to_compas_frame(base_plane)

# Initialize tree
module_unit = TiltedModule_4legs(base_frame = base_frame, root_angle = 25, stick_d_length = 235, stick_u_length = 263, width = stick_width, depth = stick_depth)

# Grow tree
# module_unit.grow_tilted_stick(length = stick_d_length, from_stick_index = -1, face_index = 2, angle = 51)
# module_unit.grow_shorter_stick(length = stick_d_length, from_stick_index = 0, face_index = 3, angle = 50)
# module_unit.grow_tilted_stick(length = stick_d_length, from_stick_index = 2, face_index = 1, angle = 51)

module_unit.grow_tilted_stick(length = stick_d_length, from_stick_index = -1, face_index = 2, angle = 46)
module_unit.grow_shorter_stick(length = stick_d_length, from_stick_index = 0, face_index = 3, angle = 50)
module_unit.grow_tilted_stick(length = stick_d_length, from_stick_index = 2, face_index = 1, angle = 46)

# Visualize
module_out = module_unit.visualize()
module_frame_out = [frame_to_rhino_plane(stick.frame) for stick in module_unit.sticks]

# Aggregation

module_agg = ModuleAggregation(module_unit.sticks)

for i in range(agg_times):
    module_agg.compute_next_module(
        from_stick_index=from_stick_index,
        from_face_index=from_face_index,
        from_t=from_t,
        to_stick_index=to_stick_index,
        to_face_index=to_face_index,
        to_t=to_t,
        angle=angle)
    
    from_frame = frame_to_rhino_plane(module_agg.from_frame)
    to_frame = frame_to_rhino_plane(module_agg.to_frame)


# output geometry
geo = module_agg.visualize()
# ---------- end stick_module_aggregation_18 ----------
draw_54 = COMPASDraw(cg=stick_module_aggregation_18.module_out)  # -> rg; disabled; same code as draw
draw_55 = COMPASDraw(cg=stick_module_aggregation_18.geo)  # -> rg; disabled; same code as draw
pln_58 = Plane(stick_module_aggregation_18.from_frame)  # disabled
pln_59 = Plane(stick_module_aggregation_18.to_frame)  # disabled
pln_60 = Plane(stick_module_aggregation_18.module_frame_out)  # disabled
vec_display_38 = Cluster(num=30)  # disabled
preview_26 = CustomPreview(
    Geometry=draw_55,
    Material={diffuse=RGB(221, 160, 221), emission=RGB(66, 48, 66), shine=0.5, specular=RGB(255, 255, 255), transparency=0})  # disabled
number_slider_202 = Slider(0, range=0..3)  # disabled
number_slider_203 = Slider(1, range=0..3)  # disabled
tstat_15 = TreeStatistics(Tree=pln_58)  # -> simplify(Paths), Length, Count; disabled
item_51 = ListItem(List=draw_54, Index=number_slider_202, Wrap=True)  # disabled
item_52 = ListItem(List=tstat_15.Paths, Index=number_slider_202, Wrap=True)  # disabled
item_53 = ListItem(List=pln_60, Index=number_slider_203, Wrap=True)  # disabled
branch_15 = TreeBranch(Tree=pln_58, Path=item_52, MaintainPaths=True)  # disabled
vec_display_39 = Cluster(pln=branch_15, num=30)  # disabled

pt_30 = ConstructPoint(XCoordinate=0, YCoordinate=0, ZCoordinate=0)  # disabled
number_slider_204 = Slider(90, range=0..100)  # disabled
xy_23 = XYPlane(Origin=pt_30)  # disabled
xz_23 = XZPlane(Origin=Point(0, 0, 0))  # disabled
rot3d_19 = Rotate3D(Geometry=xy_23, Angle=degrees(number_slider_204), Center=Point(0, 0, 0), Axis=xz_23)  # -> Geometry, Transform; disabled

# arc_2
number_slider_205 = Slider(2, range=0..3)  # disabled
number_slider_206 = Slider(2, range=0..3)  # disabled
number_slider_207 = Slider(68, range=0..180)  # disabled
number_slider_208 = Slider(0.814, range=0..1)  # disabled
number_slider_209 = Slider(1, range=0..3)  # disabled
number_slider_210 = Slider(0, range=0..3)  # disabled
number_slider_211 = Slider(2, range=0..10)  # disabled
number_slider_212 = Slider(0.237, range=0..1)  # disabled
neg_5 = Negative(Value=number_slider_207)  # disabled
stick_module_aggregation_19 = Python3Script(
    base_plane=rot3d_19.Geometry,
    agg_times=number_slider_211,
    to_stick_index=number_slider_210,
    to_face_index=number_slider_209,
    to_t=number_slider_212,
    from_stick_index=number_slider_206,
    from_face_index=number_slider_205,
    from_t=number_slider_208,
    angle=neg_5)  # -> out, module_out, geo, module_frame_out, to_frame, from_frame; inputs agg_times: Int32, to_stick_index: Int32, to_face_index: Int32, to_t: Double, from_stick_index: Int32, from_face_index: Int32, from_t: Double, angle: Double; disabled; same code as stick_module_aggregation_18
draw_56 = COMPASDraw(cg=stick_module_aggregation_19.module_out)  # -> rg; disabled; same code as draw
draw_57 = COMPASDraw(cg=stick_module_aggregation_19.geo)  # -> rg; disabled; same code as draw
pln_61 = Plane(stick_module_aggregation_19.from_frame)  # disabled
pln_62 = Plane(stick_module_aggregation_19.to_frame)  # disabled
pln_63 = Plane(stick_module_aggregation_19.module_frame_out)  # disabled
vec_display_40 = Cluster(num=30)  # disabled
preview_27 = CustomPreview(
    Geometry=draw_56,
    Material={diffuse=RGB(221, 160, 221), emission=RGB(66, 48, 66), shine=0.5, specular=RGB(255, 255, 255), transparency=0})  # disabled
number_slider_213 = Slider(0, range=0..3)  # disabled
number_slider_214 = Slider(1, range=0..3)  # disabled
tstat_16 = TreeStatistics(Tree=pln_61)  # -> simplify(Paths), Length, Count; disabled
item_54 = ListItem(List=draw_56, Index=number_slider_213, Wrap=True)  # disabled
item_55 = ListItem(List=tstat_16.Paths, Index=number_slider_213, Wrap=True)  # disabled
item_56 = ListItem(List=pln_63, Index=number_slider_214, Wrap=True)  # disabled
branch_16 = TreeBranch(Tree=pln_61, Path=item_55, MaintainPaths=True)  # disabled
vec_display_41 = Cluster(pln=branch_16, num=30)  # disabled

# ----
number_slider_215 = Slider(0.817, range=0..1)  # disabled
number_slider_216 = Slider(0.226, range=0..1)  # disabled

# ---- group: aggregation_4 legs_arc_2
pt_31 = ConstructPoint(XCoordinate=0, YCoordinate=0, ZCoordinate=0)  # disabled
number_slider_217 = Slider(90, range=0..100)  # disabled
xy_24 = XYPlane(Origin=pt_31)  # disabled
xz_24 = XZPlane(Origin=Point(0, 0, 0))  # disabled
rot3d_20 = Rotate3D(Geometry=xy_24, Angle=degrees(number_slider_217), Center=Point(0, 0, 0), Axis=xz_24)  # -> Geometry, Transform; disabled

# arc_2
number_slider_218 = Slider(0, range=0..3)  # disabled
number_slider_219 = Slider(2, range=0..3)  # disabled
number_slider_220 = Slider(46, range=0..180)  # disabled
number_slider_221 = Slider(0.714, range=0..1)  # disabled
number_slider_222 = Slider(1, range=0..3)  # disabled
number_slider_223 = Slider(0, range=0..3)  # disabled
number_slider_224 = Slider(7, range=0..10)  # disabled
number_slider_225 = Slider(0.095, range=0..1)  # disabled
neg_6 = Negative(Value=number_slider_220)  # disabled
stick_module_aggregation_20 = Python3Script(
    base_plane=rot3d_20.Geometry,
    agg_times=number_slider_224,
    to_stick_index=number_slider_223,
    to_face_index=number_slider_222,
    to_t=number_slider_225,
    from_stick_index=number_slider_219,
    from_face_index=number_slider_218,
    from_t=number_slider_221,
    angle=neg_6)  # -> out, module_out, geo, module_frame_out, to_frame, from_frame; inputs agg_times: Int32, to_stick_index: Int32, to_face_index: Int32, to_t: Double, from_stick_index: Int32, from_face_index: Int32, from_t: Double, angle: Double; disabled; same code as stick_module_aggregation_18
draw_58 = COMPASDraw(cg=stick_module_aggregation_20.module_out)  # -> rg; disabled; same code as draw
draw_59 = COMPASDraw(cg=stick_module_aggregation_20.geo)  # -> rg; disabled; same code as draw
pln_64 = Plane(stick_module_aggregation_20.from_frame)  # disabled
pln_65 = Plane(stick_module_aggregation_20.to_frame)  # disabled
pln_66 = Plane(stick_module_aggregation_20.module_frame_out)  # disabled
vec_display_42 = Cluster(num=30)  # disabled
preview_28 = CustomPreview(
    Geometry=draw_59,
    Material={diffuse=RGB(221, 160, 221), emission=RGB(66, 48, 66), shine=0.5, specular=RGB(255, 255, 255), transparency=0})  # disabled
number_slider_226 = Slider(0, range=0..3)  # disabled
number_slider_227 = Slider(1, range=0..3)  # disabled
tstat_17 = TreeStatistics(Tree=pln_64)  # -> simplify(Paths), Length, Count; disabled
item_57 = ListItem(List=draw_58, Index=number_slider_226, Wrap=True)  # disabled
item_58 = ListItem(List=tstat_17.Paths, Index=number_slider_226, Wrap=True)  # disabled
item_59 = ListItem(List=pln_66, Index=number_slider_227, Wrap=True)  # disabled
branch_17 = TreeBranch(Tree=pln_64, Path=item_58, MaintainPaths=True)  # disabled
vec_display_43 = Cluster(pln=branch_17, num=30)  # disabled

# ----
pt_32 = Point(Point(19.5, -439.0724516, 2.747018701))
pt_33 = Point(Point(-104.5174306, -439.0724516, 2.747018701))
vec2pt_4 = Vector2Pt(PointA=pt_32, PointB=pt_33, Unitize=False)  # -> Vector, Length
series_7 = Series(Start=0, Step=1, Count=Slider(2, range=0..10))
multiplication_6 = Multiplication(A=vec2pt_4.Vector, B=series_7)
group_4 = Group(Geometry=draw_59)
move_5 = Move(Geometry=group_4, Motion=multiplication_6)  # -> Geometry, Transform
ungroup_4 = Ungroup(Group=move_5.Geometry)

# ---- group: aggregation_4 legs_arc_2
pt_34 = ConstructPoint(XCoordinate=0, YCoordinate=0, ZCoordinate=0)  # disabled
number_slider_228 = Slider(90, range=0..100)  # disabled
xy_25 = XYPlane(Origin=pt_34)  # disabled
xz_25 = XZPlane(Origin=Point(0, 0, 0))  # disabled
rot3d_21 = Rotate3D(Geometry=xy_25, Angle=degrees(number_slider_228), Center=Point(0, 0, 0), Axis=xz_25)  # -> Geometry, Transform; disabled

pt_35 = ConstructPoint(XCoordinate=0, YCoordinate=0, ZCoordinate=0)  # disabled
number_slider_229 = Slider(90, range=0..100)  # disabled
xy_26 = XYPlane(Origin=pt_35)  # disabled
xz_26 = XZPlane(Origin=Point(0, 0, 0))  # disabled
rot3d_22 = Rotate3D(Geometry=xy_26, Angle=degrees(number_slider_229), Center=Point(0, 0, 0), Axis=xz_26)  # -> Geometry, Transform; disabled

number_slider_230 = Slider(1, range=0..3)  # disabled
number_slider_231 = Slider(0, range=0..3)  # disabled
number_slider_232 = Slider(0, range=-180..180)  # disabled
number_slider_233 = Slider(46, range=-180..180)  # disabled
number_slider_234 = Slider(61, range=0..180)  # disabled
number_slider_235 = Slider(0.791, range=0..1)  # disabled
number_slider_236 = Slider(1, range=0..3)  # disabled
number_slider_237 = Slider(3, range=0..3)  # disabled
number_slider_238 = Slider(4, range=0..10)  # disabled
number_slider_239 = Slider(0.262, range=0..1)  # disabled
neg_7 = Negative(Value=number_slider_232)  # disabled
stick_module_aggregation_21 = Python3Script(
    base_plane=rot3d_22.Geometry,
    agg_times=number_slider_238,
    to_stick_index=number_slider_237,
    to_face_index=number_slider_236,
    to_t=number_slider_239,
    from_stick_index=number_slider_231,
    from_face_index=number_slider_230,
    from_t=number_slider_235,
    angle=number_slider_233)  # -> out, module_out, geo, module_frame_out, to_frame, from_frame; inputs agg_times: Int32, to_stick_index: Int32, to_face_index: Int32, to_t: Double, from_stick_index: Int32, from_face_index: Int32, from_t: Double, angle: Double; disabled; same code as stick_module_aggregation_18
draw_60 = COMPASDraw(cg=stick_module_aggregation_21.module_out)  # -> rg; disabled; same code as draw
draw_61 = COMPASDraw(cg=stick_module_aggregation_21.geo)  # -> rg; disabled; same code as draw
pln_67 = Plane(stick_module_aggregation_21.from_frame)  # disabled
pln_68 = Plane(stick_module_aggregation_21.to_frame)  # disabled
pln_69 = Plane(stick_module_aggregation_21.module_frame_out)  # disabled
vec_display_44 = Cluster(num=30)  # disabled
preview_29 = CustomPreview(
    Geometry=draw_60,
    Material={diffuse=RGB(221, 160, 221), emission=RGB(66, 48, 66), shine=0.5, specular=RGB(255, 255, 255), transparency=0})  # disabled
preview_30 = CustomPreview(
    Geometry=draw_61,
    Material={diffuse=RGB(221, 160, 221), emission=RGB(66, 48, 66), shine=0.5, specular=RGB(255, 255, 255), transparency=0})  # disabled
number_slider_240 = Slider(3, range=0..3)  # disabled
number_slider_241 = Slider(1, range=0..3)  # disabled
tstat_18 = TreeStatistics(Tree=pln_67)  # -> simplify(Paths), Length, Count; disabled
item_60 = ListItem(List=draw_60, Index=number_slider_240, Wrap=True)  # disabled
item_61 = ListItem(List=tstat_18.Paths, Index=number_slider_240, Wrap=True)  # disabled
item_62 = ListItem(List=pln_69, Index=number_slider_241, Wrap=True)  # disabled
branch_18 = TreeBranch(Tree=pln_67, Path=item_61, MaintainPaths=True)  # disabled
vec_display_45 = Cluster(pln=branch_18, num=30)  # disabled

pt_36 = Point(Point(19.5, -439.0724516, 2.747018701))  # disabled
pt_37 = Point(Point(-104.5174306, -439.0724516, 2.747018701))  # disabled
vec2pt_5 = Vector2Pt(PointA=pt_36, PointB=pt_37, Unitize=False)  # -> Vector, Length; disabled
number_slider_242 = Slider(2, range=0..10)  # disabled
series_8 = Series(Start=0, Step=1, Count=number_slider_242)  # disabled
multiplication_7 = Multiplication(A=vec2pt_5.Vector, B=series_8)  # disabled
group_5 = Group(Geometry=draw_61)  # disabled
move_6 = Move(Geometry=group_5, Motion=multiplication_7)  # -> Geometry, Transform; disabled
ungroup_5 = Ungroup(Group=move_6.Geometry)  # disabled

# ----
X_2 = UnitX(Factor=Slider(1341, range=0..2000))
neg_8 = Negative(Value=X_2)
move_7 = Move(Geometry=draw_43, Motion=neg_8)  # -> Geometry, Transform
preview_31 = CustomPreview(
    Geometry=move_7.Geometry,
    Material={diffuse=RGB(221, 160, 221), emission=RGB(66, 48, 66), shine=0.5, specular=RGB(255, 255, 255), transparency=0})
pt_38 = ConstructPoint(XCoordinate=0, YCoordinate=0, ZCoordinate=0)
move_8 = Move(Geometry=pt_38, Motion=neg_8)  # -> Geometry, Transform
X_3 = UnitX(Factor="13")

pt_39 = Point(Point(6.5, -5.891000616, 2.747018701))
pt_40 = Point(Point(32.5, 104.5473792, 2.747018701))
vec2pt_6 = Vector2Pt(PointA=pt_39, PointB=pt_40, Unitize=False)  # -> Vector, Length
series_9 = Series(Start=0, Step=1, Count=Slider(2, range=0..10))
multiplication_8 = Multiplication(A=vec2pt_6.Vector, B=series_9)
group_6 = Group(Geometry=move_7.Geometry)
move_9 = Move(Geometry=group_6, Motion=multiplication_8)  # -> Geometry, Transform
ungroup_6 = Ungroup(Group=move_9.Geometry)

rotate_6 = Rotate(Geometry=group_6, Angle=degrees(Slider(180, range=-180..180)), Plane=move_8.Geometry)  # -> Geometry, Transform
move_10 = Move(Geometry=rotate_6.Geometry, Motion=X_3)  # -> Geometry, Transform

# ---- group: aggregation_4 legs_arc_2
# arc_2
number_slider_243 = Slider(0, range=0..3)  # disabled
number_slider_244 = Slider(2, range=0..3)  # disabled
number_slider_245 = Slider(-24, range=-180..180)  # disabled
number_slider_246 = Slider(-46, range=-180..180)  # disabled
number_slider_247 = Slider(0, range=0..180)  # disabled
number_slider_248 = Slider(0.744, range=0..1)  # disabled
number_slider_249 = Slider(3, range=0..3)  # disabled
number_slider_250 = Slider(0, range=0..3)  # disabled
number_slider_251 = Slider(3, range=0..10)  # disabled
number_slider_252 = Slider(0.095, range=0..1)  # disabled
neg_9 = Negative(Value=number_slider_245)  # disabled
stick_module_aggregation_22 = Python3Script(
    base_plane=rot3d_21.Geometry,
    agg_times=number_slider_251,
    to_stick_index=number_slider_250,
    to_face_index=number_slider_249,
    to_t=number_slider_252,
    from_stick_index=number_slider_244,
    from_face_index=number_slider_243,
    from_t=number_slider_248,
    angle=neg_9)  # -> out, module_out, geo, module_frame_out, to_frame, from_frame; inputs agg_times: Int32, to_stick_index: Int32, to_face_index: Int32, to_t: Double, from_stick_index: Int32, from_face_index: Int32, from_t: Double, angle: Double; disabled; same code as stick_module_aggregation_18
draw_62 = COMPASDraw(cg=stick_module_aggregation_22.module_out)  # -> rg; disabled; same code as draw
draw_63 = COMPASDraw(cg=stick_module_aggregation_22.geo)  # -> rg; disabled; same code as draw
pln_70 = Plane(stick_module_aggregation_22.from_frame)  # disabled
pln_71 = Plane(stick_module_aggregation_22.to_frame)  # disabled
pln_72 = Plane(stick_module_aggregation_22.module_frame_out)  # disabled
vec_display_46 = Cluster(num=30)  # disabled
preview_32 = CustomPreview(
    Geometry=draw_62,
    Material={diffuse=RGB(221, 160, 221), emission=RGB(66, 48, 66), shine=0.5, specular=RGB(255, 255, 255), transparency=0})  # disabled
number_slider_253 = Slider(0, range=0..3)  # disabled
number_slider_254 = Slider(1, range=0..3)  # disabled
tstat_19 = TreeStatistics(Tree=pln_70)  # -> simplify(Paths), Length, Count; disabled
item_63 = ListItem(List=draw_62, Index=number_slider_253, Wrap=True)  # disabled
item_64 = ListItem(List=tstat_19.Paths, Index=number_slider_253, Wrap=True)  # disabled
item_65 = ListItem(List=pln_72, Index=number_slider_254, Wrap=True)  # disabled
branch_19 = TreeBranch(Tree=pln_70, Path=item_64, MaintainPaths=True)  # disabled
vec_display_47 = Cluster(pln=branch_19, num=30)  # disabled

pt_41 = Point(Point(19.5, -439.0724516, 2.747018701))  # disabled
pt_42 = Point(Point(-104.5174306, -439.0724516, 2.747018701))  # disabled
vec2pt_7 = Vector2Pt(PointA=pt_41, PointB=pt_42, Unitize=False)  # -> Vector, Length; disabled
move_11 = Move(Geometry=draw_63, Motion=vec2pt_7.Vector)  # -> Geometry, Transform; disabled

merge = Merge(Data1=draw_63, Data2=move_11.Geometry)  # disabled

# ==== cluster Cluster
pln = ClusterInput()
num = ClusterInput()
pln_2 = Plane(graft(pln))
num_2 = Number(num)
deplane = DeconstructPlane(Plane=pln_2)  # -> flatten(Origin), XAxis, YAxis, ZAxis
entwine = Entwine(Branch00=deplane.XAxis, Branch01=deplane.YAxis, Branch02=deplane.ZAxis, FlattenInputs=True)
merge = Merge(
    Data1=ColourSwatch(SwatchColor=RGB(255, 0, 0)),
    Data2=ColourSwatch(SwatchColor=RGB(0, 255, 0)),
    Data3=ColourSwatch(SwatchColor=RGB(0, 0, 255)))  # -> graft(Result)
multiplication = Multiplication(A=entwine, B=num_2)
vdisex = VectorDisplayEx(Point=deplane.Origin, Vector=multiplication, Colour=merge, Width=2)
