# Grasshopper definition 103_branching_out_sticks_sharon_SquareModule.gh (Grasshopper 1.0.8)

# ---- group: vector_display
py3 = Python3Script(factor=Slider(30, range=0..100))  # -> out, points, x_vectors, y_vectors, normal; inputs frames: list, factor: Double
# ---------- py3: Python ----------
from compas.geometry import Vector
from compas.geometry import cross_vectors
from compas_rhino.conversions import vector_to_rhino
from compas_rhino.conversions import point_to_rhino

points = []
x_vectors = []
y_vectors = []
normal = []

for frame in frames:
    points.append(point_to_rhino(frame.point))
    x_vectors.append(vector_to_rhino(frame.xaxis * factor))
    y_vectors.append(vector_to_rhino(frame.yaxis * factor))
    normal.append(vector_to_rhino(frame.normal * factor))
# ---------- end py3 ----------
xaxis = VectorDisplayEx(Point=py3.points, Vector=py3.x_vectors, Colour=ColourSwatch(SwatchColor=RGB(255, 0, 0)), Width=2)
yaxis = VectorDisplayEx(Point=py3.points, Vector=py3.y_vectors, Colour=ColourSwatch(SwatchColor=RGB(0, 255, 21)), Width=2)
zaxis = VectorDisplayEx(Point=py3.points, Vector=py3.normal, Colour=ColourSwatch(SwatchColor=RGB(0, 30, 255)), Width=2)
vector_display = VectorDisplay(num=30)
vector_display_py = VectorDisplay_py(num=30)

# ---- group: return_to_origin
geo = Geometry([<brep referenced from the Rhino model>, <point referenced from the Rhino model> x2, <curve referenced from the Rhino model> x4, <point referenced from the Rhino model> x2, <brep referenced from the Rhino model>, <curve referenced from the Rhino model> x2, <point referenced from the Rhino model> x2, <brep referenced from the Rhino model>])
bbox = BoundingBox(Content=geo, Plane=PlaneXY(0, 0, 0), UnionBox=True)  # -> Box, Box_2
debrep = DeconstructBrep(Brep=bbox.Box)  # -> Faces, Edges, Vertices
item = ListItem(List=debrep.Faces, Index="4", Wrap=True)
pt = ConstructPoint(XCoordinate=0, YCoordinate=0, ZCoordinate=0)
area = Area(Geometry=item)  # -> Area, Centroid
vec2pt = Vector2Pt(PointA=area.Centroid, PointB=pt, Unitize=False)  # -> Vector, Length
move = Move(Geometry=geo, Motion=vec2pt.Vector)  # -> Geometry, Transform

# ---- group: stick_branch_module
xy_plane = XYPlane(Origin=Point(0, 0, 0))
stick_branch_module = Python3Script(root=xy_plane)  # -> out, geometries, frames
# ---------- stick_branch_module: Python ----------
# r: compas>=2.14.1
# venv: sticks

import sys
import os
import math

#get current file path
path = ghenv.Component.OnPingDocument().FilePath
print (path)
#get parent directory of the parent directory
parentdir = os.path.dirname(path)
print (parentdir)
#get src folder which contains classes
dire = os.path.join(parentdir,'scripts')
print (dire)

sys.path.append(dire)

from compas_rhino import unload_modules

unload_modules("Sticks")
unload_modules("stick_module")

# import Sticks
# from Sticks import Stick
import Sticks_Jerry_v1
from Sticks_Jerry_v1 import Stick  
from stick_module_3 import TiltedModule
from compas.geometry import Line, Point, Vector, Frame
from compas_rhino.conversions import plane_to_compas_frame, frame_to_rhino_plane

stick_width = 13.0
stick_depth = 13.0

# Convert input to compas
root = plane_to_compas_frame(root)

# Initialize tree
tree = TiltedModule(root_frame = root, root_angle = -25, stick_d_length = 235, stick_u_length = 263, width = stick_width, depth = stick_depth)

# Grow tree
tree.grow_stick(face_index = 2, angle = 27)

# mirror sticks
tree.mirror_stick(113)

# Visualize
geometries = tree.visualize()
frames = [stick.frame for stick in tree.sticks]
# ---------- end stick_branch_module ----------
draw = COMPASDraw(cg=stick_branch_module.frames)  # -> rg
#   port cg: The COMPAS geometry or datastructure to be drawn.
#   port rg: The Rhino geometry object.
# ---------- draw: Python ----------
# r: compas>=2.14.1
"""
Draws COMPAS geometry in Grasshopper.
"""

from typing import Any

import Grasshopper

from compas.scene import SceneObject


class CompasToRhinoGeometry(Grasshopper.Kernel.GH_ScriptInstance):
    def RunScript(self, cg):
        if not cg:
            return None

        return SceneObject(item=cg).draw()
# ---------- end draw ----------
draw_2 = COMPASDraw(cg=stick_branch_module.geometries)  # -> rg; same code as draw

# ----
geo_2 = Geometry()
geo_3 = Geometry()
group = Group(Geometry=geo_3)
group_2 = Group(Geometry=geo_2)
py3_2 = Python3Script(shape=group, lines=group_2, counter=Slider(5, range=0..10), grid_size=Slider(50, range=0..100))  # -> out, placed_spaces, output; inputs counter: Int32, grid_size: Int32; unedited script template
group_3 = Group(Geometry=py3_2.placed_spaces)
geo_4 = Geometry(group_3)

tri_module = Geometry([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, Point(6.5, 85, 6.5), Point(-6.5, -85, 6.5), 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, Point(147.2243186, -11.25833025, 19.5), Point(-6.5, -85, 19.5), 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, Point(6.5, 85, 32.5), Point(147.2243186, -11.25833025, 32.5), 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])
pt_2 = Point(Point(-6.5, -100, -6.5))
pt_3 = Point(Point(-160.2243186, -173.7416698, -6.5))
vec2pt_2 = Vector2Pt(PointA=pt_2, PointB=pt_3, Unitize=False)  # -> Vector, Length
arrlinear = LinearArray(Geometry=tri_module, Direction=vec2pt_2.Vector, Count=Slider(6, range=0..10))  # -> Geometry, Transform

B = Base(PlaneXY(0, 0, 0))
box = CenterBox(
    Base=B,
    X=expr("x/2", Slider(13, range=0..100)),
    Y=expr("x/2", Slider(200, range=0..1000)),
    Z=expr("x/2", Slider(13, range=0..100)))

pt_4 = Point(Point(160.2146997, -3.758330249, 6.5))
pt_5 = Point(Point(19.49038106, 92.5, 6.5))
vec2pt_3 = Vector2Pt(PointA=pt_4, PointB=pt_5, Unitize=False)  # -> Vector, Length
arrlinear_2 = LinearArray(Geometry=arrlinear.Geometry, Direction=vec2pt_3.Vector, Count=Slider(6, range=0..10))  # -> Geometry, Transform

toggle = BooleanToggle(False)
xy_plane_2 = XYPlane(Origin=Point(0, 0, 0))
stick_branch_jerry_v2 = Python3Script(
    root=xy_plane_2,
    stick_length=Slider(200, range=0..1000),
    aggregation_type=Slider(0, range=0..1),
    global_seed=Slider(33, range=0..100),
    iteration=Slider(1, range=0..10),
    angle=Slider(3, range=0..10),
    from_index=Slider(4, range=0..4),
    to_index=Slider(2, range=0..4),
    from_t=Slider(0.5, range=0..1),
    to_t=Slider(0.75, range=0..1))  # -> out, geometries, frames; inputs aggregation_type: Int32, global_seed: Int32, iteration: Int32, angle: Double, from_index: Int32, to_index: Int32, from_t: Double, to_t: Double
# ---------- stick_branch_jerry_v2: Python ----------
# r: compas>=2.14.1
# venv: sticks

import sys
import os
import math

path = ghenv.Component.OnPingDocument().FilePath
parentdir = os.path.dirname(path)
dire = os.path.join(parentdir,'scripts')

sys.path.append(dire)

from compas_rhino import unload_modules
unload_modules("Sticks")
unload_modules("stick_module")

import Sticks_Jerry_v1
from Sticks_Jerry_v1 import Stick

import Sticks_Jerry_v2_3
from Sticks_Jerry_v2_3 import JStickAggregation

from compas.geometry import Frame
from compas_rhino.conversions import plane_to_compas_frame

stick_width = 13.0
stick_depth = 13.0

# Convert GH input plane → COMPAS frame
root_frame = plane_to_compas_frame(root)

# Create stick
my_stick = Stick(frame=root_frame, length=200, width=stick_width, depth=stick_depth)

# Make geometry
geometries = my_stick.geometry      # COMPAS Box
frames = my_stick.frame       # COMPAS Frame
# ---------- end stick_branch_jerry_v2 ----------
draw_3 = COMPASDraw(cg=stick_branch_jerry_v2.geometries)  # -> rg; same code as draw
draw_4 = COMPASDraw(cg=stick_branch_jerry_v2.frames)  # -> rg; same code as draw
vector_display_2 = VectorDisplay(pln=draw_4, num=30)

# ---- group: stick_branch_Jerry_v1
xy_plane_3 = XYPlane(Origin=Point(0, 0, 0))
stick_branch_jerry_v1 = Python3Script(root=xy_plane_3, stick_length=Slider(200, range=0..1000))  # -> out, geometries, frames
# ---------- stick_branch_jerry_v1: Python ----------
# r: compas>=2.14.1
# venv: sticks

import sys
import os
import math

path = ghenv.Component.OnPingDocument().FilePath
parentdir = os.path.dirname(path)
dire = os.path.join(parentdir,'scripts')

sys.path.append(dire)

from compas_rhino import unload_modules
unload_modules("Sticks")
unload_modules("stick_module")

import Sticks_Jerry_v1
from Sticks_Jerry_v1 import Stick 

from compas.geometry import Frame
from compas_rhino.conversions import plane_to_compas_frame

stick_width = 13.0
stick_depth = 13.0

# Convert GH input plane → COMPAS frame
root_frame = plane_to_compas_frame(root)

# Create stick
my_stick = Stick(frame=root_frame, length=200, width=stick_width, depth=stick_depth)

# Make geometry
geometries = my_stick.geometry      # COMPAS Box
frames = my_stick.frame       # COMPAS Frame
# ---------- end stick_branch_jerry_v1 ----------
draw_5 = COMPASDraw(cg=stick_branch_jerry_v1.frames)  # -> rg; same code as draw
draw_6 = COMPASDraw(cg=stick_branch_jerry_v1.geometries)  # -> rg; same code as draw

# ---- group: stick_branch_tutorial
xy_plane_4 = XYPlane(Origin=Point(0, 0, 0))
stick_branch_tutorial = Python3Script(root=xy_plane_4, stick_length=Slider(200, range=0..1000))  # -> out, geometries, frames
# ---------- stick_branch_tutorial: Python ----------
# r: compas>=2.14.1
# venv: sticks

import sys
import os
import math

#get current file path
path = ghenv.Component.OnPingDocument().FilePath
print (path)
#get parent directory of the parent directory
parentdir = os.path.dirname(path)
print (parentdir)
#get src folder which contains classes
dire = os.path.join(parentdir,'scripts')
print (dire)

sys.path.append(dire)

from compas_rhino import unload_modules

unload_modules("Sticks")
unload_modules("stick_module")

import Sticks
from Sticks import Stick 
from stick_module import BranchingModule
from compas.geometry import Line, Point, Vector, Frame

stick_width = 13.0
stick_depth = 13.0

from compas_rhino.conversions import plane_to_compas_frame, frame_to_rhino_plane

# Convert input to compas
root = plane_to_compas_frame(root)

# Initialize tree
tree = BranchingModule(root, stick_length=200, width = stick_width, depth = stick_depth)

# Grow tree
tree.grow_stick(face_index = 0, angle = 15)
tree.grow_stick(face_index = 1, angle = 30)
tree.grow_stick(face_index = 2, angle = 15)
tree.grow_stick(from_stick_index = 0, face_index = 2, angle = 45)

# Visualize
geometries = tree.visualize()
# frames = tree.sticks[0].frame
frames = [stick.frame for stick in tree.sticks]
# ---------- end stick_branch_tutorial ----------
draw_7 = COMPASDraw(cg=stick_branch_tutorial.frames)  # -> rg; same code as draw
draw_8 = COMPASDraw(cg=stick_branch_tutorial.geometries)  # -> rg; same code as draw
vector_display_3 = VectorDisplay(pln=draw_7, num=30)

# ---- group: stick_branch_practice
xy_plane_5 = XYPlane(Origin=Point(0, 0, 0))
stick_branch_practice = Python3Script(root=xy_plane_5, stick_length=Slider(200, range=0..1000))  # -> out, geometries, frames
# ---------- stick_branch_practice: Python ----------
# r: compas>=2.14.1
# venv: sticks

import sys
import os
import math

#get current file path
path = ghenv.Component.OnPingDocument().FilePath
print (path)
#get parent directory of the parent directory
parentdir = os.path.dirname(path)
print (parentdir)
#get src folder which contains classes
dire = os.path.join(parentdir,'scripts')
print (dire)

sys.path.append(dire)

from compas_rhino import unload_modules

unload_modules("Sticks")
unload_modules("stick_module")

import Sticks
from Sticks import Stick 
from stick_module_2 import BranchingModule
from compas.geometry import Line, Point, Vector, Frame

stick_width = 13.0
stick_depth = 13.0

from compas_rhino.conversions import plane_to_compas_frame, frame_to_rhino_plane

# Convert input to compas
root = plane_to_compas_frame(root)

# Initialize tree
tree = BranchingModule(root, stick_length=200, width = stick_width, depth = stick_depth)

# Grow tree
tree.grow_stick(face_index = 0, angle = 0)
# tree.grow_stick(face_index = 1, angle = 30)
# tree.grow_stick(face_index = 2, angle = 15)
# tree.grow_stick(from_stick_index = 0, face_index = 2, angle = 45)

# Visualize
geometries = tree.visualize()
frames = tree.sticks[0].frame
# frames = [stick.frame for stick in tree.sticks]
# ---------- end stick_branch_practice ----------
draw_9 = COMPASDraw(cg=stick_branch_practice.frames)  # -> rg; same code as draw
draw_10 = COMPASDraw(cg=stick_branch_practice.geometries)  # -> rg; same code as draw

# ---- group: stick_branch_module
xy_plane_6 = XYPlane(Origin=Point(0, 0, 0))
stick_branch_module_2 = Python3Script(root=xy_plane_6, stick_length=Slider(200, range=0..1000))  # -> out, geometries, frames
# ---------- stick_branch_module_2: Python ----------
# r: compas>=2.14.1
# venv: sticks

import sys
import os
import math

#get current file path
path = ghenv.Component.OnPingDocument().FilePath
print (path)
#get parent directory of the parent directory
parentdir = os.path.dirname(path)
print (parentdir)
#get src folder which contains classes
dire = os.path.join(parentdir,'scripts')
print (dire)

sys.path.append(dire)

from compas_rhino import unload_modules

unload_modules("Sticks")
unload_modules("stick_module")

import Sticks
from Sticks import Stick 
from stick_module_3 import TiltedModule
from compas.geometry import Line, Point, Vector, Frame

stick_width = 13.0
stick_depth = 13.0

from compas_rhino.conversions import plane_to_compas_frame, frame_to_rhino_plane

# Convert input to compas
root = plane_to_compas_frame(root)

# Initialize tree
tree = TiltedModule(root_frame = root, root_angle = -25, stick_d_length = 235, stick_u_length = 263, width = stick_width, depth = stick_depth)

# Grow tree
tree.grow_stick(face_index = 2, angle = 27)
# tree.grow_stick(face_index = 1, angle = 30)
# tree.grow_stick(face_index = 2, angle = 15)
# tree.grow_stick(from_stick_index = 0, face_index = 2, angle = 45)

# mirror sticks
tree.mirror_stick(113)

# Visualize
geometries = tree.visualize()
# frames = tree.sticks[0].frame
frames = [stick.frame for stick in tree.sticks]
# ---------- end stick_branch_module_2 ----------
draw_11 = COMPASDraw(cg=stick_branch_module_2.frames)  # -> rg; same code as draw
draw_12 = COMPASDraw(cg=stick_branch_module_2.geometries)  # -> rg; same code as draw

xy_plane_7 = XYPlane(Origin=Point(0, 0, 0))
stick_branch_module_3 = Python3Script(root=xy_plane_7)  # -> out, geometries, frames; same code as stick_branch_module
draw_13 = COMPASDraw(cg=stick_branch_module_3.frames)  # -> rg; same code as draw
draw_14 = COMPASDraw(cg=stick_branch_module_3.geometries)  # -> rg; same code as draw

# ----
item_2 = ListItem(List=draw_12, Index=0, Wrap=True)  # -> Item, Item1, Item2
bbox_2 = BoundingBox(Content=[item_2.Item, item_2.Item2], Plane=PlaneXY(0, 0, 0), UnionBox=True)  # -> Box, Box_2
debrep_2 = DeconstructBrep(Brep=bbox_2.Box)  # -> Faces, Edges, Vertices
item_3 = ListItem(List=debrep_2.Edges, Index=0, Wrap=True)
midpt = CurveMiddle(Curve=item_3)
dom = ConstructDomain(DomainStart=0, DomainEnd=Slider(108, range=0..200))
dom_2 = ConstructDomain(DomainStart=0, DomainEnd=Slider(108, range=0..1000))
dom_3 = ConstructDomain(DomainStart=0, DomainEnd=Slider(165, range=0..1000))
box_2 = DomainBox(Base=midpt, X=dom, Y=dom_2, Z=dom_3)

item_4 = ListItem(List=draw_12, Index=0, Wrap=True)  # -> Item, Item1, Item2
bbox_3 = BoundingBox(Content=[item_4.Item, item_4.Item2], Plane=PlaneXY(0, 0, 0), UnionBox=True)  # -> Box, Box_2
debrep_3 = DeconstructBrep(Brep=bbox_3.Box)  # -> Faces, Edges, Vertices
item_5 = ListItem(List=debrep_3.Edges, Index=0, Wrap=True)
midpt_2 = CurveMiddle(Curve=item_5)
box_3 = DomainBox(Base=midpt_2, X=Domain(0, 108), Y=Domain(0, 108), Z=Domain(0, 165))

# ---- group: stick_branch_module
xy_plane_8 = XYPlane(Origin=Point(0, 0, 0))
stick_branch_module_4 = Python3Script(root=xy_plane_8)  # -> out, geometries, frames; same code as stick_branch_module
draw_15 = COMPASDraw(cg=stick_branch_module_4.frames)  # -> rg; same code as draw
draw_16 = COMPASDraw(cg=stick_branch_module_4.geometries)  # -> rg; same code as draw

# ----
py3_3 = Python3Script(geometries=draw_12, x_range=Slider(3, range=0..10), y_range=Slider(4, range=0..10), z_range=Slider(5, range=0..10))  # -> out, a; inputs geometries: Box, x_range: Int32, y_range: Int32, z_range: Int32
# ---------- py3_3: Python ----------
# r: compas>=2.14.1
# venv: sticks

import sys
import os
import math

#get current file path
path = ghenv.Component.OnPingDocument().FilePath
print (path)
#get parent directory of the parent directory
parentdir = os.path.dirname(path)
print (parentdir)
#get src folder which contains classes
dire = os.path.join(parentdir,'scripts')
print (dire)

sys.path.append(dire)

from compas_rhino import unload_modules

unload_modules("Sticks")
unload_modules("stick_module")

import Sticks
from Sticks import Stick 
from stick_module_3 import TiltedModule
from compas.geometry import Line, Point, Vector, Frame

from compas_rhino.conversions import brep_to_compas

# Convert input to compas
module = brep_to_compas(geometries)

# Move amount
# ---------- end py3_3 ----------

vector_display_4 = VectorDisplay(pln=draw_11, num=30)
vector_display_py_2 = VectorDisplay_py(L=draw_11, num=30)
preview = CustomPreview(
    Geometry=draw_12,
    Material={diffuse=RGB(221, 160, 221), emission=RGB(66, 48, 66), shine=0.5, specular=RGB(255, 255, 255), transparency=0})

xy_plane_9 = XYPlane(Origin=Point(0, 0, 0))
stick_branch_jerry_v2_2 = Python3Script(
    root=xy_plane_9,
    stick_length=Slider(200, range=0..1000),
    aggregation_type=Slider(0, range=0..1),
    global_seed=Slider(33, range=0..100),
    iteration=Slider(1, range=0..10),
    angle=Slider(3, range=0..10),
    from_index=Slider(4, range=0..4),
    to_index=Slider(2, range=0..4),
    from_t=Slider(0.5, range=0..1),
    to_t=Slider(0.75, range=0..1))  # -> out, module_geo, agg_geo, module_frames, agg_frames; inputs aggregation_type: Int32, global_seed: Int32, iteration: Int32, angle: Double, from_index: Int32, to_index: Int32, from_t: Double, to_t: Double
# ---------- stick_branch_jerry_v2_2: Python ----------
# r: compas>=2.14.1
# venv: sticks

import sys
import os
import math

#get current file path
path = ghenv.Component.OnPingDocument().FilePath
print (path)
#get parent directory of the parent directory
parentdir = os.path.dirname(path)
print (parentdir)
#get src folder which contains classes
dire = os.path.join(parentdir,'scripts')
print (dire)

sys.path.append(dire)

from compas_rhino import unload_modules

unload_modules("Sticks")
unload_modules("stick_module")

# from Sticks import Stick
from Sticks_Jerry_v1 import Stick  
from stick_module_3 import TiltedModule
from Sticks_Jerry_v2_3 import JStickAggregation

from compas.geometry import Line, Point, Vector, Frame
from compas_rhino.conversions import plane_to_compas_frame

stick_width = 13.0
stick_depth = 13.0
stick_d_length = 235
stick_u_length = 263

# Convert input to compas
root = plane_to_compas_frame(root)

# Initialize tree
module = TiltedModule(root_frame=root, root_angle=-25, stick_d_length=stick_d_length, stick_u_length=stick_u_length, width=stick_width, depth=stick_depth)

# Grow tree
module.grow_stick(face_index = 2, angle = 27)

# mirror sticks
module.mirror_stick(113)

# Visualize
module_geo = module.visualize()
module_frames = [stick.frame for stick in module.sticks]

# Aggregation
agg_module = JStickAggregation(first_frame=root, length=stick_u_length, aggregation_type=aggregation_type, global_seed=global_seed)

# Visualize
agg_geo = agg_module.visualize()
agg_frames = [stick.frame for stick in agg_module.sticks]
# ---------- end stick_branch_jerry_v2_2 ----------
draw_17 = COMPASDraw(cg=stick_branch_jerry_v2_2.module_geo)  # -> rg; same code as draw
draw_18 = COMPASDraw(cg=stick_branch_jerry_v2_2.agg_geo)  # -> rg; same code as draw
draw_19 = COMPASDraw(cg=stick_branch_jerry_v2_2.module_frames)  # -> rg; same code as draw
draw_20 = COMPASDraw(cg=stick_branch_jerry_v2_2.agg_frames)  # -> rg; same code as draw
vector_display_5 = VectorDisplay(pln=draw_19, num=30)
vector_display_6 = VectorDisplay(pln=draw_20, num=30)

vector_display_7 = VectorDisplay(pln=draw_15, num=30)

group_4 = Group(Geometry=draw_12)
arrbox = BoxArray(
    Geometry=group_4,
    Cell=box_2,
    XCount=Slider(5, range=0..10),
    YCount=Slider(5, range=0..10),
    ZCount=Slider(3, range=0..10))  # -> Geometry, Transform

group_5 = Group(Geometry=draw_12)
arrbox_2 = BoxArray(
    Geometry=group_5,
    Cell=box_3,
    XCount=Slider(5, range=0..10),
    YCount=Slider(5, range=0..10),
    ZCount=Slider(3, range=0..10))  # -> Geometry, Transform

ungroup = Ungroup(Group=arrbox.Geometry)  # -> simplify(Geometry)
preview_2 = CustomPreview(
    Geometry=ungroup,
    Material={diffuse=RGB(221, 160, 221), emission=RGB(66, 48, 66), shine=0.5, specular=RGB(255, 255, 255), transparency=0})

bbox_4 = BoundingBox(Content=flatten(arrbox.Geometry), Plane=PlaneXY(0, 0, 0), UnionBox=True)  # -> Box, Box_2
debrep_4 = DeconstructBrep(Brep=bbox_4.Box)  # -> Faces, Edges, Vertices
panel = Panel("""0
1
8""")
item_6 = ListItem(List=debrep_4.Edges, Index=panel, Wrap=True)
len = Length(Curve=item_6)
panel_2 = Panel(len)

ungroup_2 = Ungroup(Group=arrbox_2.Geometry)  # -> simplify(Geometry)
preview_3 = CustomPreview(
    Geometry=ungroup_2,
    Material={diffuse=RGB(221, 160, 221), emission=RGB(66, 48, 66), shine=0.5, specular=RGB(255, 255, 255), transparency=0})

bbox_5 = BoundingBox(Content=flatten(arrbox_2.Geometry), Plane=PlaneXY(0, 0, 0), UnionBox=True)  # -> Box, Box_2
debrep_5 = DeconstructBrep(Brep=bbox_5.Box)  # -> Faces, Edges, Vertices
panel_3 = Panel("""0
1
8""")
item_7 = ListItem(List=debrep_5.Edges, Index=panel_3, Wrap=True)
len_2 = Length(Curve=item_7)
panel_4 = Panel(len_2)

xy_plane_10 = XYPlane(Origin=Point(0, 0, 0))
stick_branch_jerry_v2_3 = Python3Script(
    root=xy_plane_10,
    stick_length=Slider(200, range=0..1000),
    aggregation_type=Slider(0, range=0..1),
    global_seed=Slider(33, range=0..100),
    iteration=Slider(2, range=0..10),
    angle=Slider(30, range=0..180),
    from_index=Slider(4, range=0..4),
    to_index=Slider(2, range=0..4),
    from_t=Slider(0.2, range=0..1),
    to_t=Slider(0.43, range=0..1))  # -> out, module_geo, agg_geo, module_frames, agg_frames; inputs aggregation_type: Int32, global_seed: Int32, iteration: Int32, angle: Double, from_index: Int32, to_index: Int32, from_t: Double, to_t: Double
# ---------- stick_branch_jerry_v2_3: Python ----------
# r: compas>=2.14.1
# venv: sticks

import sys
import os
import math

# get current file path
path = ghenv.Component.OnPingDocument().FilePath
parentdir = os.path.dirname(path)
dire = os.path.join(parentdir, 'scripts')
sys.path.append(dire)

from compas_rhino import unload_modules

unload_modules("Sticks")
unload_modules("stick_module")
unload_modules("Sticks_Jerry_v1")
unload_modules("Sticks_Jerry_v2_3")

from compas.geometry import Line, Point, Vector, Frame
from compas_rhino.conversions import plane_to_compas_frame

from Sticks_Jerry_v1 import Stick
from stick_module_3 import TiltedModule
from Sticks_Jerry_v2_3 import JStickAggregation

# -------------------------------
# Convert GH input to compas frame
# -------------------------------

root = plane_to_compas_frame(root)

stick_width = 13.0
stick_depth = 13.0
stick_d_length = 235
stick_u_length = 263

# -------------------------------
# TiltedModule (原本的樹)
# -------------------------------
module = TiltedModule(root_frame=root,
                      root_angle=-25,
                      stick_d_length=stick_d_length,
                      stick_u_length=stick_u_length,
                      width=stick_width,
                      depth=stick_depth)

module.grow_stick(face_index=2, angle=27)
module.mirror_stick(113)

module_geo = module.visualize()
module_frames = [stick.frame for stick in module.sticks]

# -------------------------------
# Aggregation Module（新版）
# -------------------------------
agg_module = JStickAggregation(
    first_frame=root,
    length=stick_u_length,
    aggregation_type=aggregation_type,
    global_seed=global_seed
)

# -------------------------------
# !!! 多次 Aggregation !!!
# -------------------------------
if aggregation_type == 0:
    # regular mode
    for i in range(iteration):
        agg_module.compute_next_stick_regular(angle=angle)
else:
    # random mode
    for i in range(iteration):
        agg_module.compute_next_stick_random(angle=angle)

# -------------------------------
# Output 結果給 GH
# -------------------------------
agg_geo = agg_module.visualize()
agg_frames = [stick.frame for stick in agg_module.sticks]
# ---------- end stick_branch_jerry_v2_3 ----------
draw_21 = COMPASDraw(cg=stick_branch_jerry_v2_3.module_geo)  # -> rg; same code as draw
draw_22 = COMPASDraw(cg=stick_branch_jerry_v2_3.agg_geo)  # -> rg; same code as draw
draw_23 = COMPASDraw(cg=stick_branch_jerry_v2_3.module_frames)  # -> rg; same code as draw
draw_24 = COMPASDraw(cg=stick_branch_jerry_v2_3.agg_frames)  # -> rg; same code as draw
vector_display_8 = VectorDisplay(pln=draw_23, num=30)
vector_display_9 = VectorDisplay(pln=draw_24, num=30)

xy_plane_11 = XYPlane(Origin=Point(0, 0, 0))
stick_branch_jerry_v2_4 = Python3Script(
    root=xy_plane_11,
    stick_length=Slider(200, range=0..1000),
    aggregation_type=Slider(0, range=0..1),
    global_seed=Slider(33, range=0..100),
    iteration=Slider(2, range=0..10),
    angle=Slider(30, range=0..180),
    from_index=Slider(4, range=0..4),
    to_index=Slider(2, range=0..4),
    from_t=Slider(0.2, range=0..1),
    to_t=Slider(0.43, range=0..1))  # -> out, module_geo, agg_geo, module_frames, agg_frames; inputs aggregation_type: Int32, global_seed: Int32, iteration: Int32, angle: Double, from_index: Int32, to_index: Int32, from_t: Double, to_t: Double
# ---------- stick_branch_jerry_v2_4: Python ----------
# r: compas>=2.14.1
# venv: sticks

import sys
import os
import math

# get current file path
path = ghenv.Component.OnPingDocument().FilePath
parentdir = os.path.dirname(path)
dire = os.path.join(parentdir, 'scripts')
sys.path.append(dire)

from compas_rhino import unload_modules

unload_modules("Sticks")
unload_modules("stick_module")
unload_modules("Sticks_Jerry_v1")
unload_modules("Sticks_Jerry_v2_3")

from compas.geometry import Line, Point, Vector, Frame
from compas_rhino.conversions import plane_to_compas_frame

from Sticks_Jerry_v1 import Stick
from stick_module_3 import TiltedModule
from Sticks_Jerry_v2_3 import JStickAggregation

# -------------------------------
# Convert GH input to compas frame
# -------------------------------

root = plane_to_compas_frame(root)

stick_width = 13.0
stick_depth = 13.0
stick_d_length = 235
stick_u_length = 263

# -------------------------------
# TiltedModule (原本的樹)
# -------------------------------
module = TiltedModule(root_frame=root,
                      root_angle=-25,
                      stick_d_length=stick_d_length,
                      stick_u_length=stick_u_length,
                      width=stick_width,
                      depth=stick_depth)

module.grow_stick(face_index=2, angle=27)
module.mirror_stick(113)

module_geo = module.visualize()
module_frames = [stick.frame for stick in module.sticks]

# -------------------------------
# Aggregation Module（新版）
# -------------------------------

agg_module = JStickAggregation(
    first_frame=root,
    length=stick_u_length,
    aggregation_type=aggregation_type,
    global_seed=global_seed
)

# 第一個 module：直接從 root 建立
# 後續 iterations：每次生長新 module
for i in range(iteration):
    agg_module.compute_next_module(
        from_index=from_index,
        to_index=to_index,
        from_t=from_t,
        to_t=to_t,
        angle=angle
    )

agg_geo = agg_module.visualize()
agg_frames = [stick.frame for stick in agg_module.sticks]
# ---------- end stick_branch_jerry_v2_4 ----------
draw_25 = COMPASDraw(cg=stick_branch_jerry_v2_4.module_geo)  # -> rg; same code as draw
draw_26 = COMPASDraw(cg=stick_branch_jerry_v2_4.agg_geo)  # -> rg; same code as draw
draw_27 = COMPASDraw(cg=stick_branch_jerry_v2_4.module_frames)  # -> rg; same code as draw
draw_28 = COMPASDraw(cg=stick_branch_jerry_v2_4.agg_frames)  # -> rg; same code as draw
vector_display_10 = VectorDisplay(pln=draw_27, num=30)
vector_display_11 = VectorDisplay(pln=draw_28, num=30)

# ==== cluster VectorDisplay
pln = ClusterInput()
num = ClusterInput()
pln_2 = Plane(pln)
num_2 = Number(num)
item = ListItem(List=pln_2, Index=0, Wrap=True)  # -> Item, Item1, Item2
pl = ConstructPlane(Origin=item.Item, XAxis=item.Item1, YAxis=item.Item2)
deplane = DeconstructPlane(Plane=pl)  # -> flatten(Origin), XAxis, YAxis, ZAxis
entwine = Entwine(Branch00=deplane.XAxis, Branch01=deplane.YAxis, Branch02=deplane.ZAxis, FlattenInputs=True)
merge = Merge(
    Data1=ColourSwatch(SwatchColor=RGB(255, 0, 0)),
    Data2=ColourSwatch(SwatchColor=RGB(0, 255, 21)),
    Data3=ColourSwatch(SwatchColor=RGB(0, 30, 255)))  # -> graft(Result)
multiplication = Multiplication(A=entwine, B=num_2)
xaxis = VectorDisplayEx(Point=deplane.Origin, Vector=multiplication, Colour=merge, Width=2)

# ==== cluster VectorDisplay_py
num = ClusterInput()
L = ClusterInput()
num_2 = Number(num)
item = ListItem(List=L, Index=0, Wrap=True)  # -> Item, Item1, Item2, Item3
pl = ConstructPlane(Origin=item.Item, XAxis=item.Item1, YAxis=item.Item2)
py3 = Python3Script(planes=pl, factor=num_2)  # -> out, points, x_vectors, y_vectors, normal; inputs planes: list, factor: Double
# ---------- py3: Python ----------
from compas.geometry import Vector, Plane
from compas.geometry import cross_vectors
from compas_rhino.conversions import plane_to_compas_frame, point_to_rhino, vector_to_rhino

points = []
x_vectors = []
y_vectors = []
normal = []

for plane in planes:
    frame = plane_to_compas_frame(plane)
    points.append(point_to_rhino(frame.point))
    x_vectors.append(vector_to_rhino(frame.xaxis * factor))
    y_vectors.append(vector_to_rhino(frame.yaxis * factor))
    normal.append(vector_to_rhino(frame.normal * factor))
# ---------- end py3 ----------
merge = Merge(Data1=py3.x_vectors, Data2=py3.y_vectors, Data3=py3.normal)
merge_2 = Merge(
    Data1=ColourSwatch(SwatchColor=RGB(255, 0, 0)),
    Data2=ColourSwatch(SwatchColor=RGB(0, 255, 21)),
    Data3=ColourSwatch(SwatchColor=RGB(0, 30, 255)))
vdisex = VectorDisplayEx(Point=py3.points, Vector=merge, Colour=merge_2, Width=2)
