# Grasshopper definition 201_stick_assembly_sharon.gh (Grasshopper 1.0.8)

# ---- group: aggregation 7_4 legs_arc_3_move by layer
pt = ConstructPoint(XCoordinate=0, YCoordinate=0, ZCoordinate=0)  # disabled
number_slider = Slider(90, range=0..100)  # disabled
xy = XYPlane(Origin=pt)  # disabled
xz = XZPlane(Origin=Point(0, 0, 0))  # disabled
rot3d = Rotate3D(Geometry=xy, Angle=degrees(number_slider), Center=Point(0, 0, 0), Axis=xz)  # -> Geometry, Transform; disabled

number_slider_2 = Slider(1, range=0..3)  # disabled
number_slider_3 = Slider(0, range=0..10)  # disabled
number_slider_4 = Slider(0, range=0..3)  # disabled
number_slider_5 = Slider(46, range=-180..180)  # disabled
number_slider_6 = Slider(0.791, range=0..1)  # disabled
number_slider_7 = Slider(1, range=0..3)  # disabled
number_slider_8 = Slider(3, range=0..3)  # disabled
number_slider_9 = Slider(4, range=0..10)  # disabled
number_slider_10 = Slider(0.262, range=0..1)  # disabled
stick_module_aggregation = Python3Script(
    base_plane=rot3d.Geometry,
    agg_times=number_slider_9,
    to_stick_index=number_slider_8,
    to_face_index=number_slider_7,
    to_t=number_slider_10,
    from_stick_index=number_slider_4,
    from_face_index=number_slider_2,
    from_t=number_slider_6,
    angle=number_slider_5,
    layer_iteration=number_slider_3)  # -> out, module_out, geo, sticks, module_frame_out, to_frame, from_frame; inputs agg_times: Int32, to_stick_index: Int32, to_face_index: Int32, to_t: Double, from_stick_index: Int32, from_face_index: Int32, from_t: Double, angle: Double, layer_iteration: Int32; disabled
# ---------- stick_module_aggregation: Python ----------
# r: compas>=2.14.1
# venv: sticks

import sys
import os
import math

#get current file path
path = ghenv.Component.OnPingDocument().FilePath
print (path)
#get parent directory of the parent directory
parentdir = os.path.dirname(path)
print (parentdir)
#get src folder which contains classes
dire = os.path.join(parentdir,'scripts')
print (dire)

sys.path.append(dire)

from compas_rhino import unload_modules

unload_modules("Sticks_Single_1")
unload_modules("Sticks_Multiple_1")
unload_modules("Sticks_Aggregation_7")

from Sticks_Single_1 import Stick  
from Sticks_Multiple_1 import TiltedModule_4legs
from Sticks_Aggregation_7 import ModuleAggregation
from compas.geometry import Line, Point, Vector, Frame
from compas_rhino.conversions import plane_to_compas_frame, frame_to_rhino_plane

module_agg = []
sticks = []
stick_width = 13.0
stick_depth = 13.0
stick_d_length = 235
stick_u_length = 263

# Convert input to compas
base_frame = plane_to_compas_frame(base_plane)

# Initialize tree
module_unit = TiltedModule_4legs(base_frame = base_frame, root_angle = 25, stick_d_length = 235, stick_u_length = 263, width = stick_width, depth = stick_depth)

# Grow tree
module_unit.grow_tilted_stick(length = stick_d_length, from_stick_index = -1, face_index = 2, angle = 46)
module_unit.grow_shorter_stick(length = stick_d_length, from_stick_index = 0, face_index = 3, angle = 50)
module_unit.grow_tilted_stick(length = stick_d_length, from_stick_index = 2, face_index = 1, angle = 46)

# Visualize
module_out = module_unit.visualize()
module_frame_out = [frame_to_rhino_plane(stick.frame) for stick in module_unit.sticks]

# Aggregation

module_agg = ModuleAggregation(module_unit.sticks)

for i in range(agg_times):
    module_agg.compute_next_module(
        from_stick_index=from_stick_index,
        from_face_index=from_face_index,
        from_t=from_t,
        to_stick_index=to_stick_index,
        to_face_index=to_face_index,
        to_t=to_t,
        angle=angle)
    
    from_frame = frame_to_rhino_plane(module_agg.from_frame)
    to_frame = frame_to_rhino_plane(module_agg.to_frame)

module_agg.move_by_layer(translation_vector = (124.017431,0,0), layer_iteration = layer_iteration)

# output geometry
sticks = module_agg.sticks_object()
geo = module_agg.visualize()
# ---------- end stick_module_aggregation ----------
draw = COMPASDraw(cg=stick_module_aggregation.module_out)  # -> rg; disabled
#   port cg: The COMPAS geometry or datastructure to be drawn.
#   port rg: The Rhino geometry object.
# ---------- draw: Python ----------
# r: compas>=2.14.1
"""
Draws COMPAS geometry in Grasshopper.
"""

from typing import Any

import Grasshopper

from compas.scene import SceneObject


class CompasToRhinoGeometry(Grasshopper.Kernel.GH_ScriptInstance):
    def RunScript(self, cg):
        if not cg:
            return None

        return SceneObject(item=cg).draw()
# ---------- end draw ----------
draw_2 = COMPASDraw(cg=stick_module_aggregation.geo)  # -> rg; disabled; same code as draw
pln = Plane(stick_module_aggregation.from_frame)  # disabled
pln_2 = Plane(stick_module_aggregation.to_frame)  # disabled
pln_3 = Plane(stick_module_aggregation.module_frame_out)  # disabled
preview = CustomPreview(
    Geometry=draw,
    Material={diffuse=RGB(221, 160, 221), emission=RGB(66, 48, 66), shine=0.5, specular=RGB(255, 255, 255), transparency=0})  # disabled
preview_2 = CustomPreview(
    Geometry=draw_2,
    Material={diffuse=RGB(221, 160, 221), emission=RGB(66, 48, 66), shine=0.5, specular=RGB(255, 255, 255), transparency=0})  # disabled
vec_display = VecDisplay(num=30)  # disabled
number_slider_11 = Slider(3, range=0..3)  # disabled
panel = Panel(stick_module_aggregation.sticks)  # disabled
number_slider_12 = Slider(1, range=0..3)  # disabled
tstat = TreeStatistics(Tree=pln)  # -> simplify(Paths), Length, Count; disabled
item = ListItem(List=draw, Index=number_slider_11, Wrap=True)  # disabled
item_2 = ListItem(List=tstat.Paths, Index=number_slider_11, Wrap=True)  # disabled
item_3 = ListItem(List=pln_3, Index=number_slider_12, Wrap=True)  # disabled
branch = TreeBranch(Tree=pln, Path=item_2, MaintainPaths=True)  # disabled
vec_display_2 = VecDisplay(pln=branch, num=30)  # disabled

# ----
pt_2 = ConstructPoint(XCoordinate=0, YCoordinate=0, ZCoordinate=0)  # disabled
number_slider_13 = Slider(90, range=0..100)  # disabled
xy_2 = XYPlane(Origin=pt_2)  # disabled
xz_2 = XZPlane(Origin=Point(0, 0, 0))  # disabled
rot3d_2 = Rotate3D(Geometry=xy_2, Angle=degrees(number_slider_13), Center=Point(0, 0, 0), Axis=xz_2)  # -> Geometry, Transform; disabled

number_slider_14 = Slider(1, range=0..3)  # disabled
number_slider_15 = Slider(0, range=0..3)  # disabled
number_slider_16 = Slider(0, range=0..10)  # disabled
number_slider_17 = Slider(46, range=-180..180)  # disabled
number_slider_18 = Slider(0.791, range=0..1)  # disabled
number_slider_19 = Slider(1, range=0..3)  # disabled
number_slider_20 = Slider(3, range=0..3)  # disabled
number_slider_21 = Slider(4, range=0..10)  # disabled
number_slider_22 = Slider(0.262, range=0..1)  # disabled
stick_module_aggregation_2 = Python3Script(
    base_plane=rot3d_2.Geometry,
    agg_times=number_slider_21,
    to_stick_index=number_slider_20,
    to_face_index=number_slider_19,
    to_t=number_slider_22,
    from_stick_index=number_slider_15,
    from_face_index=number_slider_14,
    from_t=number_slider_18,
    angle=number_slider_17,
    layer_iteration=number_slider_16)  # -> out, module_out, geo, sticks, module_frame_out, to_frame, from_frame; inputs agg_times: Int32, to_stick_index: Int32, to_face_index: Int32, to_t: Double, from_stick_index: Int32, from_face_index: Int32, from_t: Double, angle: Double, layer_iteration: Int32; disabled; same code as stick_module_aggregation
draw_3 = COMPASDraw(cg=stick_module_aggregation_2.module_out)  # -> rg; disabled; same code as draw
draw_4 = COMPASDraw(cg=stick_module_aggregation_2.geo)  # -> rg; disabled; same code as draw
pln_4 = Plane(stick_module_aggregation_2.from_frame)  # disabled
pln_5 = Plane(stick_module_aggregation_2.to_frame)  # disabled
pln_6 = Plane(stick_module_aggregation_2.module_frame_out)  # disabled
preview_3 = CustomPreview(
    Geometry=draw_3,
    Material={diffuse=RGB(221, 160, 221), emission=RGB(66, 48, 66), shine=0.5, specular=RGB(255, 255, 255), transparency=0})  # disabled
preview_4 = CustomPreview(
    Geometry=draw_4,
    Material={diffuse=RGB(221, 160, 221), emission=RGB(66, 48, 66), shine=0.5, specular=RGB(255, 255, 255), transparency=0})  # disabled
vec_display_3 = VecDisplay(num=30)  # disabled
number_slider_23 = Slider(3, range=0..3)  # disabled
panel_2 = Panel(stick_module_aggregation_2.sticks)  # disabled
number_slider_24 = Slider(1, range=0..3)  # disabled
tstat_2 = TreeStatistics(Tree=pln_4)  # -> simplify(Paths), Length, Count; disabled
item_4 = ListItem(List=draw_3, Index=number_slider_23, Wrap=True)  # disabled
item_5 = ListItem(List=tstat_2.Paths, Index=number_slider_23, Wrap=True)  # disabled
item_6 = ListItem(List=pln_6, Index=number_slider_24, Wrap=True)  # disabled
branch_2 = TreeBranch(Tree=pln_4, Path=item_5, MaintainPaths=True)  # disabled
vec_display_4 = VecDisplay(pln=branch_2, num=30)  # disabled

# ---- group: aggregation 7_4 legs_arc_3_move by layer
pt_3 = ConstructPoint(XCoordinate=0, YCoordinate=0, ZCoordinate=0)  # disabled
number_slider_25 = Slider(90, range=0..100)  # disabled
xy_3 = XYPlane(Origin=pt_3)  # disabled
xz_3 = XZPlane(Origin=Point(0, 0, 0))  # disabled
rot3d_3 = Rotate3D(Geometry=xy_3, Angle=degrees(number_slider_25), Center=Point(0, 0, 0), Axis=xz_3)  # -> Geometry, Transform; disabled

number_slider_26 = Slider(1, range=0..3)  # disabled
number_slider_27 = Slider(0, range=0..3)  # disabled
number_slider_28 = Slider(0, range=0..10)  # disabled
number_slider_29 = Slider(46, range=-180..180)  # disabled
number_slider_30 = Slider(0.791, range=0..1)  # disabled
number_slider_31 = Slider(1, range=0..3)  # disabled
number_slider_32 = Slider(3, range=0..3)  # disabled
number_slider_33 = Slider(4, range=0..10)  # disabled
number_slider_34 = Slider(0.262, range=0..1)  # disabled
stick_module_aggregation_3 = Python3Script(
    base_plane=rot3d_3.Geometry,
    agg_times=number_slider_33,
    to_stick_index=number_slider_32,
    to_face_index=number_slider_31,
    to_t=number_slider_34,
    from_stick_index=number_slider_27,
    from_face_index=number_slider_26,
    from_t=number_slider_30,
    angle=number_slider_29,
    layer_iteration=number_slider_28)  # -> out, module_out, geo, sticks, module_frame_out, to_frame, from_frame; inputs agg_times: Int32, to_stick_index: Int32, to_face_index: Int32, to_t: Double, from_stick_index: Int32, from_face_index: Int32, from_t: Double, angle: Double, layer_iteration: Int32; disabled; same code as stick_module_aggregation
draw_5 = COMPASDraw(cg=stick_module_aggregation_3.module_out)  # -> rg; disabled; same code as draw
draw_6 = COMPASDraw(cg=stick_module_aggregation_3.geo)  # -> rg; disabled; same code as draw
pln_7 = Plane(stick_module_aggregation_3.from_frame)  # disabled
pln_8 = Plane(stick_module_aggregation_3.to_frame)  # disabled
pln_9 = Plane(stick_module_aggregation_3.module_frame_out)  # disabled
preview_5 = CustomPreview(
    Geometry=draw_5,
    Material={diffuse=RGB(221, 160, 221), emission=RGB(66, 48, 66), shine=0.5, specular=RGB(255, 255, 255), transparency=0})  # disabled
preview_6 = CustomPreview(
    Geometry=draw_6,
    Material={diffuse=RGB(221, 160, 221), emission=RGB(66, 48, 66), shine=0.5, specular=RGB(255, 255, 255), transparency=0})  # disabled
vec_display_5 = VecDisplay(num=30)  # disabled
number_slider_35 = Slider(3, range=0..3)  # disabled
panel_3 = Panel(stick_module_aggregation_3.sticks)  # disabled
number_slider_36 = Slider(1, range=0..3)  # disabled
tstat_3 = TreeStatistics(Tree=pln_7)  # -> simplify(Paths), Length, Count; disabled
item_7 = ListItem(List=draw_5, Index=number_slider_35, Wrap=True)  # disabled
item_8 = ListItem(List=tstat_3.Paths, Index=number_slider_35, Wrap=True)  # disabled
item_9 = ListItem(List=pln_9, Index=number_slider_36, Wrap=True)  # disabled
branch_3 = TreeBranch(Tree=pln_7, Path=item_8, MaintainPaths=True)  # disabled
vec_display_6 = VecDisplay(pln=branch_3, num=30)  # disabled

number_slider_37 = Slider(18, range=0..19)  # disabled
panel_4 = Panel("""18
16
17
19
12
13
14
15
8
11
10
9
4
6
7
5
0
2
3
1""")  # disabled
number_slider_38 = Slider(0, range=0..19)  # disabled
item_10 = ListItem(List=draw_2, Index=panel_4, Wrap=True)  # disabled
item_11 = ListItem(List=draw_2, Index=number_slider_37, Wrap=True)  # disabled
geo = Geometry(item_10)  # disabled
item_12 = ListItem(List=geo, Index=number_slider_38, Wrap=True)  # disabled
geo_2 = Geometry(item_12)  # disabled

number_slider_39 = Slider(18, range=0..19)  # disabled
number_slider_40 = Slider(0, range=0..19)  # disabled
item_13 = ListItem(List=stick_module_aggregation.sticks, Index=panel_4, Wrap=True)  # disabled
item_14 = ListItem(List=stick_module_aggregation.sticks, Index=number_slider_39, Wrap=True)  # disabled
item_15 = ListItem(List=item_13, Index=number_slider_40, Wrap=True)  # disabled

# ---- group: aggregation 7_4 legs_arc_3_move by layer / working basement
bbox = BoundingBox(Content=geo, Plane=PlaneXY(0, 0, 0), UnionBox=True)  # -> Box, Box_2; disabled
number_slider_41 = Slider(400, range=0..1000)  # disabled
number_slider_42 = Slider(450, range=0..1000)  # disabled
debrep = DeconstructBrep(Brep=bbox.Box)  # -> Faces, Edges, Vertices; disabled
number_slider_43 = Slider(0, range=0..100)  # disabled
panel_5 = Panel("4")  # disabled
item_16 = ListItem(List=debrep.Faces, Index=panel_5, Wrap=True)  # disabled
neg = Negative(Value=number_slider_42)  # disabled
neg_2 = Negative(Value=number_slider_41)  # disabled
area = Area(Geometry=item_16)  # -> Area, Centroid; disabled
dom = ConstructDomain(DomainStart=neg_2, DomainEnd=number_slider_41)  # disabled
dom_2 = ConstructDomain(DomainStart=neg, DomainEnd=number_slider_43)  # disabled
box = DomainBox(Base=area.Centroid, X=dom, Y=dom, Z=dom_2)  # disabled
geo_working_basement = Geometry(box)  # disabled

# ----
# geo
number_slider_44 = Slider(18, range=0..19)  # disabled
panel_6 = Panel("""18
16
17
19
12
13
14
15
8
11
10
9
4
6
7
5
0
2
3
1""")  # disabled
number_slider_45 = Slider(17, range=0..19)  # disabled
item_17 = ListItem(List=draw_4, Index=panel_6, Wrap=True)  # disabled
item_18 = ListItem(List=draw_4, Index=number_slider_44, Wrap=True)  # disabled
geo_3 = Geometry(item_17)  # disabled
item_19 = ListItem(List=geo_3, Index=number_slider_45, Wrap=True)  # disabled
geo_4 = Geometry(item_19)  # disabled

# ---- group: aggregation 7_4 legs_arc_3_move by layer
# geo
number_slider_46 = Slider(18, range=0..19)  # disabled
panel_7 = Panel("""18
16
17
19
12
13
14
15
8
11
10
9
4
6
7
5
0
2
3
1""")  # disabled
number_slider_47 = Slider(0, range=0..19)  # disabled
item_20 = ListItem(List=draw_6, Index=panel_7, Wrap=True)  # disabled
item_21 = ListItem(List=draw_6, Index=number_slider_46, Wrap=True)  # disabled
geo_5 = Geometry(item_20)  # disabled
item_22 = ListItem(List=geo_5, Index=number_slider_47, Wrap=True)  # disabled
geo_6 = Geometry(item_22)  # disabled

# ----
# sticks
number_slider_48 = Slider(18, range=0..19)  # disabled
number_slider_49 = Slider(0, range=0..19)  # disabled
item_23 = ListItem(List=stick_module_aggregation_2.sticks, Index=panel_6, Wrap=True)  # disabled
item_24 = ListItem(List=stick_module_aggregation_2.sticks, Index=number_slider_48, Wrap=True)  # disabled
item_25 = ListItem(List=item_23, Index=number_slider_49, Wrap=True)  # disabled

# ---- group: aggregation 7_4 legs_arc_3_move by layer
# sticks
number_slider_50 = Slider(18, range=0..19)  # disabled
number_slider_51 = Slider(0, range=0..19)  # disabled
item_26 = ListItem(List=stick_module_aggregation_3.sticks, Index=panel_7, Wrap=True)  # disabled
item_27 = ListItem(List=stick_module_aggregation_3.sticks, Index=number_slider_50, Wrap=True)  # disabled
item_28 = ListItem(List=item_26, Index=number_slider_51, Wrap=True)  # disabled

# ---- group: aggregation 7_4 legs_arc_3_move by layer / working basement
bbox_2 = BoundingBox(Content=geo_3, Plane=PlaneXY(0, 0, 0), UnionBox=True)  # -> Box, Box_2
number_slider_52 = Slider(300, range=0..1000)
debrep_2 = DeconstructBrep(Brep=bbox_2.Box)  # -> Faces, Edges, Vertices
item_29 = ListItem(List=debrep_2.Faces, Index="4", Wrap=True)
neg_3 = Negative(Value=Slider(450, range=0..1000))
neg_4 = Negative(Value=number_slider_52)
area_2 = Area(Geometry=item_29)  # -> Area, Centroid
dom_3 = ConstructDomain(DomainStart=neg_4, DomainEnd=number_slider_52)
dom_4 = ConstructDomain(DomainStart=neg_3, DomainEnd=Slider(0, range=0..100))
box_2 = DomainBox(Base=area_2.Centroid, X=dom_3, Y=dom_3, Z=dom_4)
geo_working_basement_2 = Geometry(box_2)

# ---- group: frame determination_3_specific rotation
button = Button()  # disabled
py3 = Python3Script(sticks=item_13, save=button)  # -> out, frames, assembly; inputs sticks: list, save: Boolean; disabled
# ---------- py3: Python ----------
from compas import json_dump
import os, sys
import math
import copy

from compas_rhino import unload_modules
from compas.geometry import (
    Line, Plane, Vector, Point, Frame, Box,
    Rotation, Translation,
    dot_vectors, centroid_points
)
from compas.datastructures import Assembly, Part
from compas_rhino.conversions import frame_to_rhino_plane


# -------------------------------------------------------------
# Setup Path and Import Stick Class
# -------------------------------------------------------------
path = ghenv.Component.OnPingDocument().FilePath
parentdir = os.path.dirname(path)
dire = os.path.join(parentdir, 'scripts')

sys.path.append(dire)
unload_modules("Sticks_Single_1")
from Sticks_Single_1 import Stick

json_path = os.path.join(parentdir, 'data', 'stick_assembly.json')


# -------------------------------------------------------------
# Helpers
# -------------------------------------------------------------
def is_parallel(v1, v2, tol=0.001):
    """Check if two vectors are parallel by dot product."""
    dot = dot_vectors(v1, v2)
    if math.isclose(dot, 1.0, abs_tol=tol) or math.isclose(dot, -1.0, abs_tol=tol):
        print("parallel")
        return True
    print("not parallel")
    return False


def get_frame_closest_to_target(target_vector, stick):
    """
    Rotate around stick.xaxis in 90° increments and find the frame
    whose Z axis most closely matches target_vector.
    """
    best_dot = -1000.0
    best_frame = stick.frame

    target = target_vector.unitized()

    for i in range(4):
        angle = (math.pi / 2) * i
        R = Rotation.from_axis_and_angle(stick.frame.xaxis, angle, stick.frame.point)
        candidate_frame = stick.frame.transformed(R)

        alignment = dot_vectors(candidate_frame.zaxis, target)
        if alignment > best_dot:
            best_dot = alignment
            best_frame = candidate_frame

    return best_frame


def get_center(sticks_list):
    """Compute geometric centroid from stick frame points."""
    return centroid_points([s.frame.point for s in sticks_list])


def get_lowest_point(sticks_list):
    """
    Compute the center point of the lowest face of the bounding box
    that encloses all stick frame points.

    Returns
    -------
    Point : center of the bottom face of the bounding box
    """
    # 1. 收集所有 frame 的點
    # pts = [s.frame.point for s in sticks_list]
    pts = []
    for s in sticks_list:
        pts.append(s.axis.start)
        pts.append(s.axis.end)


    if not pts:
        return None

    # 2. 建立整組 sticks 的 bounding box
    bbox = Box.from_points(pts)

    # 3. Box 的 faces 順序固定：0~5
    #    0 = bottom, 1 = top, 2/3/4/5 = side faces
    bottom_face = bbox.faces[0]

    # 4. 取得底面四個角點
    bottom_vertices = [bbox.vertices[i] for i in bottom_face]

    # 5. 算底面的中心（四角點幾何中心）
    bottom_center = centroid_points(bottom_vertices)

    return bottom_center



def move_to_gripper_position(stick, direction_vector=None, distance=30.0):
    """
    Move a stick along any direction vector by given distance.
    
    Parameters
    ----------
    stick : object with a .frame attribute
    direction_vector : Vector or list/tuple, optional
        Direction to move. If None, use local x-axis.
    distance : float
        Translation distance in mm.
    """
    # 如果沒有指定方向，就用 stick 的局部 x-axis
    if direction_vector is None:
        direction = stick.frame.xaxis.unitized()
    else:
        # 轉成 Vector 並 unitize
        direction = Vector(*direction_vector).unitized()

    # 計算位移向量
    move_vec = direction * distance

    # 產生平移變換
    T = Translation.from_vector(move_vec)

    # 套用到 frame
    stick.frame.transform(T)

    return stick.frame

def rotate_frame_direction(stick, angle):
    """
    Rotate the stick's frame around its local X-axis by angle degrees.
    """
    R = Rotation.from_axis_and_angle(stick.frame.xaxis, math.radians(angle), stick.frame.point)
    stick.frame.transform(R)
    return stick.frame


# -------------------------------------------------------------
# Apply frame adjustments to sticks
# -------------------------------------------------------------
sticks_copy = copy.deepcopy(sticks)
center_pt = get_center(sticks_copy)
print("Center:", center_pt)
lowest_pt = get_lowest_point(sticks_copy)
print("Lowest center:", lowest_pt)

up_vector = Vector(0, 0, 1)

for stick in sticks_copy:
    stick_dir = stick.axis.direction.unitized()

    # Case 1: Stick is vertical (parallel to Z)
    if is_parallel(stick_dir, up_vector):
        center_vector = Vector.from_start_end(stick.frame.point, center_pt)
        lowest_vector = Vector.from_start_end(stick.frame.point, lowest_pt)
        # stick.frame = get_frame_closest_to_target(center_vector, stick)
        stick.frame = get_frame_closest_to_target(lowest_vector, stick)

    # Case 2: Stick is non-vertical
    else:
        # Rotate so its Z axis becomes downward
        R = Rotation.from_axis_and_angle(stick.frame.xaxis, math.pi / 2, stick.frame.point)
        stick.frame.transform(R)

    # Move frame for robotic gripping
    move_to_gripper_position(stick, distance=30.0)


# Manual rotation based on index
rotate_90 = [1, 2]                   # certain index: [1] = index 1
rotate_180 = [7, 8, 9, 12, 16]    # certain index

for i, rotated_stick in enumerate(sticks_copy):
    if i in rotate_90:
        rotate_frame_direction(rotated_stick, 90)

    elif i in rotate_180:
        rotate_frame_direction(rotated_stick, 180)

    else:
        # no rotation
        pass


# -------------------------------------------------------------
# Build Assembly
# -------------------------------------------------------------
assembly = Assembly()

for i, s in enumerate(sticks_copy):
    part = Part(name=f"stick{i}", frame=s.frame)
    part.key = i
    part.attributes["shape"] = s.geometry
    assembly.add_part(part)

frames = [frame_to_rhino_plane(p.frame) for p in assembly.parts()]


# -------------------------------------------------------------
# Save JSON
# -------------------------------------------------------------
if save:
    json_dump(assembly, fp=json_path, pretty=True)
# ---------- end py3 ----------
panel_8 = Panel(py3.frames)  # disabled
panel_9 = Panel(py3.assembly)  # disabled

# let the frame of vertical stick facing the centroid of structure
# let the z axis of frame of horizontal stick facing down
# frame position: away 3 cm from strat point
# reference point: lowest_pt
# frame direction: select specific plane to rotate
button_2 = Button()  # disabled
py3_2 = Python3Script(sticks=item_23, save=button_2)  # -> out, frames, assembly; inputs sticks: list, save: Boolean; disabled
# ---------- py3_2: Python ----------
from compas import json_dump
import os, sys
import math
import copy

from compas_rhino import unload_modules
from compas.geometry import (
    Line, Plane, Vector, Point, Frame, Box,
    Rotation, Translation,
    dot_vectors, centroid_points
)
from compas.datastructures import Assembly, Part
from compas_rhino.conversions import frame_to_rhino_plane


# -------------------------------------------------------------
# Setup Path and Import Stick Class
# -------------------------------------------------------------
path = ghenv.Component.OnPingDocument().FilePath
parentdir = os.path.dirname(path)
dire = os.path.join(parentdir, 'scripts')

sys.path.append(dire)
unload_modules("Sticks_Single_1")
from Sticks_Single_1 import Stick

json_path = os.path.join(parentdir, 'data', 'stick_assembly.json')


# -------------------------------------------------------------
# Helpers
# -------------------------------------------------------------
def is_parallel(v1, v2, tol=0.001):
    """Check if two vectors are parallel by dot product."""
    dot = dot_vectors(v1, v2)
    if math.isclose(dot, 1.0, abs_tol=tol) or math.isclose(dot, -1.0, abs_tol=tol):
        print("parallel")
        return True
    print("not parallel")
    return False


def get_frame_closest_to_target(target_vector, stick):
    """
    Rotate around stick.xaxis in 90° increments and find the frame
    whose Z axis most closely matches target_vector.
    """
    best_dot = -1000.0
    best_frame = stick.frame

    target = target_vector.unitized()

    for i in range(4):
        angle = (math.pi / 2) * i
        R = Rotation.from_axis_and_angle(stick.frame.xaxis, angle, stick.frame.point)
        candidate_frame = stick.frame.transformed(R)

        alignment = dot_vectors(candidate_frame.zaxis, target)
        if alignment > best_dot:
            best_dot = alignment
            best_frame = candidate_frame

    return best_frame


def get_center(sticks_list):
    """Compute geometric centroid from stick frame points."""
    return centroid_points([s.frame.point for s in sticks_list])


def get_lowest_point(sticks_list):
    """
    Compute the center point of the lowest face of the bounding box
    that encloses all stick frame points.

    Returns
    -------
    Point : center of the bottom face of the bounding box
    """
    # 1. 收集所有 frame 的點
    # pts = [s.frame.point for s in sticks_list]
    pts = []
    for s in sticks_list:
        pts.append(s.axis.start)
        pts.append(s.axis.end)


    if not pts:
        return None

    # 2. 建立整組 sticks 的 bounding box
    bbox = Box.from_points(pts)

    # 3. Box 的 faces 順序固定：0~5
    #    0 = bottom, 1 = top, 2/3/4/5 = side faces
    bottom_face = bbox.faces[0]

    # 4. 取得底面四個角點
    bottom_vertices = [bbox.vertices[i] for i in bottom_face]

    # 5. 算底面的中心（四角點幾何中心）
    bottom_center = centroid_points(bottom_vertices)

    return bottom_center



def move_to_gripper_position(stick, direction_vector=None, distance=30.0):
    """
    Move a stick along any direction vector by given distance.
    
    Parameters
    ----------
    stick : object with a .frame attribute
    direction_vector : Vector or list/tuple, optional
        Direction to move. If None, use local x-axis.
    distance : float
        Translation distance in mm.
    """
    # 如果沒有指定方向，就用 stick 的局部 x-axis
    if direction_vector is None:
        direction = stick.frame.xaxis.unitized()
    else:
        # 轉成 Vector 並 unitize
        direction = Vector(*direction_vector).unitized()

    # 計算位移向量
    move_vec = direction * distance

    # 產生平移變換
    T = Translation.from_vector(move_vec)

    # 套用到 frame
    stick.frame.transform(T)

    return stick.frame

def rotate_frame_direction(stick, angle):
    """
    Rotate the stick's frame around its local X-axis by angle degrees.
    """
    R = Rotation.from_axis_and_angle(stick.frame.xaxis, math.radians(angle), stick.frame.point)
    stick.frame.transform(R)
    return stick.frame


# -------------------------------------------------------------
# Apply frame adjustments to sticks
# -------------------------------------------------------------
sticks_copy = copy.deepcopy(sticks)
center_pt = get_center(sticks_copy)
print("Center:", center_pt)
lowest_pt = get_lowest_point(sticks_copy)
print("Lowest center:", lowest_pt)

up_vector = Vector(0, 0, 1)

for stick in sticks_copy:
    stick_dir = stick.axis.direction.unitized()

    # Case 1: Stick is vertical (parallel to Z)
    if is_parallel(stick_dir, up_vector):
        center_vector = Vector.from_start_end(stick.frame.point, center_pt)
        lowest_vector = Vector.from_start_end(stick.frame.point, lowest_pt)
        # stick.frame = get_frame_closest_to_target(center_vector, stick)
        stick.frame = get_frame_closest_to_target(lowest_vector, stick)

    # Case 2: Stick is non-vertical
    else:
        # Rotate so its Z axis becomes downward
        R = Rotation.from_axis_and_angle(stick.frame.xaxis, math.pi / 2, stick.frame.point)
        stick.frame.transform(R)

    # Move frame for robotic gripping
    move_to_gripper_position(stick, distance=30.0)


# Manual rotation based on index
rotate_90 = [1]                   # certain index: [1] = index 1
rotate_180 = [7, 8, 9, 12, 16]    # certain index

for i, rotated_stick in enumerate(sticks_copy):
    if i in rotate_90:
        rotate_frame_direction(rotated_stick, 90)

    elif i in rotate_180:
        rotate_frame_direction(rotated_stick, 180)

    else:
        # no rotation
        pass


# -------------------------------------------------------------
# Build Assembly
# -------------------------------------------------------------
assembly = Assembly()

for i, s in enumerate(sticks_copy):
    part = Part(name=f"stick{i}", frame=s.frame)
    part.key = i
    part.attributes["shape"] = s.geometry
    assembly.add_part(part)

frames = [frame_to_rhino_plane(p.frame) for p in assembly.parts()]


# -------------------------------------------------------------
# Save JSON
# -------------------------------------------------------------
if save:
    json_dump(assembly, fp=json_path, pretty=True)
# ---------- end py3_2 ----------
panel_10 = Panel(py3_2.frames)  # disabled
panel_11 = Panel(py3_2.assembly)  # disabled

# ---- group: frame determination_2
# let the frame of vertical stick facing the centroid of structure
# let the z axis of frame of horizontal stick facing down
# frame position: away 3 cm from strat point
# frame direction
button_3 = Button()  # disabled
py3_3 = Python3Script(sticks=item_26, save=button_3)  # -> out, frames, assembly; inputs sticks: list, save: Boolean; disabled
# ---------- py3_3: Python ----------
from compas import json_dump
import os, sys
import math
import copy

from compas_rhino import unload_modules
from compas.geometry import (
    Line, Plane, Vector, Point, Frame,
    Rotation, Translation,
    dot_vectors, centroid_points
)
from compas.datastructures import Assembly, Part
from compas_rhino.conversions import frame_to_rhino_plane


# -------------------------------------------------------------
# Setup Path and Import Stick Class
# -------------------------------------------------------------
path = ghenv.Component.OnPingDocument().FilePath
parentdir = os.path.dirname(path)
dire = os.path.join(parentdir, 'scripts')

sys.path.append(dire)
unload_modules("Sticks_Single_1")
from Sticks_Single_1 import Stick

json_path = os.path.join(parentdir, 'data', 'stick_assembly.json')


# -------------------------------------------------------------
# Helpers
# -------------------------------------------------------------
def is_parallel(v1, v2, tol=0.001):
    """Check if two vectors are parallel by dot product."""
    dot = dot_vectors(v1, v2)
    if math.isclose(dot, 1.0, abs_tol=tol) or math.isclose(dot, -1.0, abs_tol=tol):
        print("parallel")
        return True
    print("not parallel")
    return False


def get_frame_closest_to_target(target_vector, stick):
    """
    Rotate around stick.xaxis in 90° increments and find the frame
    whose Z axis most closely matches target_vector.
    """
    best_dot = -1000.0
    best_frame = stick.frame

    target = target_vector.unitized()

    for i in range(4):
        angle = (math.pi / 2) * i
        R = Rotation.from_axis_and_angle(stick.frame.xaxis, angle, stick.frame.point)
        candidate_frame = stick.frame.transformed(R)

        alignment = dot_vectors(candidate_frame.zaxis, target)
        if alignment > best_dot:
            best_dot = alignment
            best_frame = candidate_frame

    return best_frame


def get_center(sticks_list):
    """Compute geometric centroid from stick frame points."""
    return centroid_points([s.frame.point for s in sticks_list])


# def move_to_gripper_position(stick, distance=30.0):
#     """
#     Move stick 30mm along its local x-axis.
#     """
#     xdir = stick.frame.xaxis.unitized()
#     T = Translation.from_vector(xdir * distance)
#     stick.frame.transform(T)
#     return stick.frame


def move_to_gripper_position(stick, direction_vector=None, distance=30.0):
    """
    Move a stick along any direction vector by given distance.
    
    Parameters
    ----------
    stick : object with a .frame attribute
    direction_vector : Vector or list/tuple, optional
        Direction to move. If None, use local x-axis.
    distance : float
        Translation distance in mm.
    """
    # 如果沒有指定方向，就用 stick 的局部 x-axis
    if direction_vector is None:
        direction = stick.frame.xaxis.unitized()
    else:
        # 轉成 Vector 並 unitize
        direction = Vector(*direction_vector).unitized()

    # 計算位移向量
    move_vec = direction * distance

    # 產生平移變換
    T = Translation.from_vector(move_vec)

    # 套用到 frame
    stick.frame.transform(T)

    return stick.frame


# -------------------------------------------------------------
# Apply frame adjustments to sticks
# -------------------------------------------------------------
sticks_copy = copy.deepcopy(sticks)
center_pt = get_center(sticks_copy)
print("Center:", center_pt)

up_vector = Vector(0, 0, 1)

for stick in sticks_copy:
    stick_dir = stick.axis.direction.unitized()

    # Case 1: Stick is vertical (parallel to Z)
    if is_parallel(stick_dir, up_vector):
        center_vector = Vector.from_start_end(stick.frame.point, center_pt)
        stick.frame = get_frame_closest_to_target(center_vector, stick)

    # Case 2: Stick is non-vertical
    else:
        # Rotate so its Z axis becomes downward
        R = Rotation.from_axis_and_angle(stick.frame.xaxis, math.pi / 2, stick.frame.point)
        stick.frame.transform(R)

    # Move frame for robotic gripping
    move_to_gripper_position(stick, distance=30.0)


# -------------------------------------------------------------
# Build Assembly
# -------------------------------------------------------------
assembly = Assembly()

for i, s in enumerate(sticks_copy):
    part = Part(name=f"stick{i}", frame=s.frame)
    part.key = i
    part.attributes["shape"] = s.geometry
    assembly.add_part(part)

frames = [frame_to_rhino_plane(p.frame) for p in assembly.parts()]


# -------------------------------------------------------------
# Save JSON
# -------------------------------------------------------------
if save:
    json_dump(assembly, fp=json_path, pretty=True)
# ---------- end py3_3 ----------
panel_12 = Panel(py3_3.frames)  # disabled
panel_13 = Panel(py3_3.assembly)  # disabled

# ---- group: aggregation_4 legs_arc_3_move by layer
pt_4 = ConstructPoint(XCoordinate=0, YCoordinate=0, ZCoordinate=0)  # disabled
number_slider_53 = Slider(90, range=0..100)  # disabled
xy_4 = XYPlane(Origin=pt_4)  # disabled
xz_4 = XZPlane(Origin=Point(0, 0, 0))  # disabled
rot3d_4 = Rotate3D(Geometry=xy_4, Angle=degrees(number_slider_53), Center=Point(0, 0, 0), Axis=xz_4)  # -> Geometry, Transform; disabled

number_slider_54 = Slider(1, range=0..3)  # disabled
number_slider_55 = Slider(0, range=0..3)  # disabled
number_slider_56 = Slider(2, range=0..10)  # disabled
number_slider_57 = Slider(46, range=-180..180)  # disabled
number_slider_58 = Slider(0.791, range=0..1)  # disabled
number_slider_59 = Slider(1, range=0..3)  # disabled
number_slider_60 = Slider(3, range=0..3)  # disabled
number_slider_61 = Slider(4, range=0..10)  # disabled
number_slider_62 = Slider(0.262, range=0..1)  # disabled
stick_module_aggregation_4 = Python3Script(
    base_plane=rot3d_4.Geometry,
    agg_times=number_slider_61,
    to_stick_index=number_slider_60,
    to_face_index=number_slider_59,
    to_t=number_slider_62,
    from_stick_index=number_slider_55,
    from_face_index=number_slider_54,
    from_t=number_slider_58,
    angle=number_slider_57,
    layer_iteration=number_slider_56)  # -> out, module_out, geo, module_frame_out, to_frame, from_frame; inputs agg_times: Int32, to_stick_index: Int32, to_face_index: Int32, to_t: Double, from_stick_index: Int32, from_face_index: Int32, from_t: Double, angle: Double, layer_iteration: Int32; disabled
# ---------- stick_module_aggregation_4: Python ----------
# r: compas>=2.14.1
# venv: sticks

import sys
import os
import math

#get current file path
path = ghenv.Component.OnPingDocument().FilePath
print (path)
#get parent directory of the parent directory
parentdir = os.path.dirname(path)
print (parentdir)
#get src folder which contains classes
dire = os.path.join(parentdir,'scripts')
print (dire)

sys.path.append(dire)

from compas_rhino import unload_modules

unload_modules("Sticks_Single_1")
unload_modules("Sticks_Multiple_1")
unload_modules("Sticks_Aggregation_6")

from Sticks_Single_1 import Stick  
from Sticks_Multiple_1 import TiltedModule_4legs
from Sticks_Aggregation_6 import ModuleAggregation
from compas.geometry import Line, Point, Vector, Frame
from compas_rhino.conversions import plane_to_compas_frame, frame_to_rhino_plane

module_agg = []
stick_width = 13.0
stick_depth = 13.0
stick_d_length = 235
stick_u_length = 263

# Convert input to compas
base_frame = plane_to_compas_frame(base_plane)

# Initialize tree
module_unit = TiltedModule_4legs(base_frame = base_frame, root_angle = 25, stick_d_length = 235, stick_u_length = 263, width = stick_width, depth = stick_depth)

# Grow tree
module_unit.grow_tilted_stick(length = stick_d_length, from_stick_index = -1, face_index = 2, angle = 46)
module_unit.grow_shorter_stick(length = stick_d_length, from_stick_index = 0, face_index = 3, angle = 50)
module_unit.grow_tilted_stick(length = stick_d_length, from_stick_index = 2, face_index = 1, angle = 46)

# Visualize
module_out = module_unit.visualize()
module_frame_out = [frame_to_rhino_plane(stick.frame) for stick in module_unit.sticks]

# Aggregation

module_agg = ModuleAggregation(module_unit.sticks)

for i in range(agg_times):
    module_agg.compute_next_module(
        from_stick_index=from_stick_index,
        from_face_index=from_face_index,
        from_t=from_t,
        to_stick_index=to_stick_index,
        to_face_index=to_face_index,
        to_t=to_t,
        angle=angle)
    
    from_frame = frame_to_rhino_plane(module_agg.from_frame)
    to_frame = frame_to_rhino_plane(module_agg.to_frame)

module_agg.move_by_layer(translation_vector = (-124.017431,0,0), layer_iteration = layer_iteration)

# output geometry
geo = module_agg.visualize()
# ---------- end stick_module_aggregation_4 ----------
draw_7 = COMPASDraw(cg=stick_module_aggregation_4.module_out)  # -> rg; disabled; same code as draw
draw_8 = COMPASDraw(cg=stick_module_aggregation_4.geo)  # -> rg; disabled; same code as draw
pln_10 = Plane(stick_module_aggregation_4.from_frame)  # disabled
pln_11 = Plane(stick_module_aggregation_4.to_frame)  # disabled
pln_12 = Plane(stick_module_aggregation_4.module_frame_out)  # disabled
vec_display_7 = VecDisplay(num=30)  # disabled
preview_7 = CustomPreview(
    Geometry=draw_7,
    Material={diffuse=RGB(221, 160, 221), emission=RGB(66, 48, 66), shine=0.5, specular=RGB(255, 255, 255), transparency=0})  # disabled
preview_8 = CustomPreview(
    Geometry=draw_8,
    Material={diffuse=RGB(221, 160, 221), emission=RGB(66, 48, 66), shine=0.5, specular=RGB(255, 255, 255), transparency=0})  # disabled
number_slider_63 = Slider(3, range=0..3)  # disabled
number_slider_64 = Slider(1, range=0..3)  # disabled
tstat_4 = TreeStatistics(Tree=pln_10)  # -> simplify(Paths), Length, Count; disabled
item_30 = ListItem(List=draw_7, Index=number_slider_63, Wrap=True)  # disabled
item_31 = ListItem(List=tstat_4.Paths, Index=number_slider_63, Wrap=True)  # disabled
item_32 = ListItem(List=pln_12, Index=number_slider_64, Wrap=True)  # disabled
branch_4 = TreeBranch(Tree=pln_10, Path=item_31, MaintainPaths=True)  # disabled
vec_display_8 = VecDisplay(pln=branch_4, num=30)  # disabled

pt_5 = ConstructPoint(XCoordinate=0, YCoordinate=0, ZCoordinate=0)  # disabled
number_slider_65 = Slider(90, range=0..100)  # disabled
xy_5 = XYPlane(Origin=pt_5)  # disabled
xz_5 = XZPlane(Origin=Point(0, 0, 0))  # disabled
rot3d_5 = Rotate3D(Geometry=xy_5, Angle=degrees(number_slider_65), Center=Point(0, 0, 0), Axis=xz_5)  # -> Geometry, Transform; disabled

number_slider_66 = Slider(1, range=0..3)  # disabled
number_slider_67 = Slider(1, range=0..10)  # disabled
number_slider_68 = Slider(0, range=0..3)  # disabled
number_slider_69 = Slider(46, range=-180..180)  # disabled
number_slider_70 = Slider(0.791, range=0..1)  # disabled
number_slider_71 = Slider(1, range=0..3)  # disabled
number_slider_72 = Slider(3, range=0..3)  # disabled
number_slider_73 = Slider(4, range=0..10)  # disabled
number_slider_74 = Slider(0.262, range=0..1)  # disabled
stick_module_aggregation_5 = Python3Script(
    base_plane=rot3d_5.Geometry,
    agg_times=number_slider_73,
    to_stick_index=number_slider_72,
    to_face_index=number_slider_71,
    to_t=number_slider_74,
    from_stick_index=number_slider_68,
    from_face_index=number_slider_66,
    from_t=number_slider_70,
    angle=number_slider_69,
    layer_iteration=number_slider_67)  # -> out, module_out, geo, sticks, module_frame_out, to_frame, from_frame; inputs agg_times: Int32, to_stick_index: Int32, to_face_index: Int32, to_t: Double, from_stick_index: Int32, from_face_index: Int32, from_t: Double, angle: Double, layer_iteration: Int32; disabled
# ---------- stick_module_aggregation_5: Python ----------
# r: compas>=2.14.1
# venv: sticks

import sys
import os
import math

#get current file path
path = ghenv.Component.OnPingDocument().FilePath
print (path)
#get parent directory of the parent directory
parentdir = os.path.dirname(path)
print (parentdir)
#get src folder which contains classes
dire = os.path.join(parentdir,'scripts')
print (dire)

sys.path.append(dire)

from compas_rhino import unload_modules

unload_modules("Sticks_Single_1")
unload_modules("Sticks_Multiple_1")
unload_modules("Sticks_Aggregation_6")

from Sticks_Single_1 import Stick  
from Sticks_Multiple_1 import TiltedModule_4legs
from Sticks_Aggregation_6 import ModuleAggregation
from compas.geometry import Line, Point, Vector, Frame
from compas_rhino.conversions import plane_to_compas_frame, frame_to_rhino_plane

module_agg = []
sticks = []
stick_width = 13.0
stick_depth = 13.0
stick_d_length = 235
stick_u_length = 263

# Convert input to compas
base_frame = plane_to_compas_frame(base_plane)

# Initialize tree
module_unit = TiltedModule_4legs(base_frame = base_frame, root_angle = 25, stick_d_length = 235, stick_u_length = 263, width = stick_width, depth = stick_depth)

# Grow tree
module_unit.grow_tilted_stick(length = stick_d_length, from_stick_index = -1, face_index = 2, angle = 46)
module_unit.grow_shorter_stick(length = stick_d_length, from_stick_index = 0, face_index = 3, angle = 50)
module_unit.grow_tilted_stick(length = stick_d_length, from_stick_index = 2, face_index = 1, angle = 46)

# Visualize
module_out = module_unit.visualize()
module_frame_out = [frame_to_rhino_plane(stick.frame) for stick in module_unit.sticks]

# Aggregation

module_agg = ModuleAggregation(module_unit.sticks)

for i in range(agg_times):
    module_agg.compute_next_module(
        from_stick_index=from_stick_index,
        from_face_index=from_face_index,
        from_t=from_t,
        to_stick_index=to_stick_index,
        to_face_index=to_face_index,
        to_t=to_t,
        angle=angle)
    
    from_frame = frame_to_rhino_plane(module_agg.from_frame)
    to_frame = frame_to_rhino_plane(module_agg.to_frame)

module_agg.move_by_layer(translation_vector = (-124.017431,0,0), layer_iteration = layer_iteration)

# output geometry
geo = module_agg.visualize()
sticks = module_agg.sticks_object()
# ---------- end stick_module_aggregation_5 ----------
draw_9 = COMPASDraw(cg=stick_module_aggregation_5.module_out)  # -> rg; disabled; same code as draw
draw_10 = COMPASDraw(cg=stick_module_aggregation_5.geo)  # -> rg; disabled; same code as draw
pln_13 = Plane(stick_module_aggregation_5.from_frame)  # disabled
pln_14 = Plane(stick_module_aggregation_5.to_frame)  # disabled
pln_15 = Plane(stick_module_aggregation_5.module_frame_out)  # disabled
preview_9 = CustomPreview(
    Geometry=draw_9,
    Material={diffuse=RGB(221, 160, 221), emission=RGB(66, 48, 66), shine=0.5, specular=RGB(255, 255, 255), transparency=0})  # disabled
preview_10 = CustomPreview(
    Geometry=draw_10,
    Material={diffuse=RGB(221, 160, 221), emission=RGB(66, 48, 66), shine=0.5, specular=RGB(255, 255, 255), transparency=0})  # disabled
vec_display_9 = VecDisplay(num=30)  # disabled
number_slider_75 = Slider(3, range=0..3)  # disabled
panel_14 = Panel(stick_module_aggregation_5.sticks)  # disabled
number_slider_76 = Slider(1, range=0..3)  # disabled
tstat_5 = TreeStatistics(Tree=pln_13)  # -> simplify(Paths), Length, Count; disabled
item_33 = ListItem(List=draw_9, Index=number_slider_75, Wrap=True)  # disabled
item_34 = ListItem(List=tstat_5.Paths, Index=number_slider_75, Wrap=True)  # disabled
item_35 = ListItem(List=pln_15, Index=number_slider_76, Wrap=True)  # disabled
branch_5 = TreeBranch(Tree=pln_13, Path=item_34, MaintainPaths=True)  # disabled
vec_display_10 = VecDisplay(pln=branch_5, num=30)  # disabled

# ---- group: aggregation 6_4 legs_arc_3_move by layer
pt_6 = ConstructPoint(XCoordinate=0, YCoordinate=0, ZCoordinate=0)  # disabled
number_slider_77 = Slider(90, range=0..100)  # disabled
xy_6 = XYPlane(Origin=pt_6)  # disabled
xz_6 = XZPlane(Origin=Point(0, 0, 0))  # disabled
rot3d_6 = Rotate3D(Geometry=xy_6, Angle=degrees(number_slider_77), Center=Point(0, 0, 0), Axis=xz_6)  # -> Geometry, Transform; disabled

number_slider_78 = Slider(1, range=0..3)  # disabled
number_slider_79 = Slider(3, range=0..10)  # disabled
number_slider_80 = Slider(0, range=0..3)  # disabled
number_slider_81 = Slider(46, range=-180..180)  # disabled
number_slider_82 = Slider(0.791, range=0..1)  # disabled
number_slider_83 = Slider(1, range=0..3)  # disabled
number_slider_84 = Slider(3, range=0..3)  # disabled
number_slider_85 = Slider(4, range=0..10)  # disabled
number_slider_86 = Slider(0.262, range=0..1)  # disabled
stick_module_aggregation_6 = Python3Script(
    base_plane=rot3d_6.Geometry,
    agg_times=number_slider_85,
    to_stick_index=number_slider_84,
    to_face_index=number_slider_83,
    to_t=number_slider_86,
    from_stick_index=number_slider_80,
    from_face_index=number_slider_78,
    from_t=number_slider_82,
    angle=number_slider_81,
    layer_iteration=number_slider_79)  # -> out, module_out, geo, sticks, module_frame_out, to_frame, from_frame; inputs agg_times: Int32, to_stick_index: Int32, to_face_index: Int32, to_t: Double, from_stick_index: Int32, from_face_index: Int32, from_t: Double, angle: Double, layer_iteration: Int32; disabled
# ---------- stick_module_aggregation_6: Python ----------
# r: compas>=2.14.1
# venv: sticks

import sys
import os
import math

#get current file path
path = ghenv.Component.OnPingDocument().FilePath
print (path)
#get parent directory of the parent directory
parentdir = os.path.dirname(path)
print (parentdir)
#get src folder which contains classes
dire = os.path.join(parentdir,'scripts')
print (dire)

sys.path.append(dire)

from compas_rhino import unload_modules

unload_modules("Sticks_Single_1")
unload_modules("Sticks_Multiple_1")
unload_modules("Sticks_Aggregation_6")

from Sticks_Single_1 import Stick  
from Sticks_Multiple_1 import TiltedModule_4legs
from Sticks_Aggregation_6 import ModuleAggregation
from compas.geometry import Line, Point, Vector, Frame
from compas_rhino.conversions import plane_to_compas_frame, frame_to_rhino_plane

module_agg = []
sticks = []
stick_width = 13.0
stick_depth = 13.0
stick_d_length = 235
stick_u_length = 263

# Convert input to compas
base_frame = plane_to_compas_frame(base_plane)

# Initialize tree
module_unit = TiltedModule_4legs(base_frame = base_frame, root_angle = 25, stick_d_length = 235, stick_u_length = 263, width = stick_width, depth = stick_depth)

# Grow tree
module_unit.grow_tilted_stick(length = stick_d_length, from_stick_index = -1, face_index = 2, angle = 46)
module_unit.grow_shorter_stick(length = stick_d_length, from_stick_index = 0, face_index = 3, angle = 50)
module_unit.grow_tilted_stick(length = stick_d_length, from_stick_index = 2, face_index = 1, angle = 46)

# Visualize
module_out = module_unit.visualize()
module_frame_out = [frame_to_rhino_plane(stick.frame) for stick in module_unit.sticks]

# Aggregation

module_agg = ModuleAggregation(module_unit.sticks)

for i in range(agg_times):
    module_agg.compute_next_module(
        from_stick_index=from_stick_index,
        from_face_index=from_face_index,
        from_t=from_t,
        to_stick_index=to_stick_index,
        to_face_index=to_face_index,
        to_t=to_t,
        angle=angle)
    
    from_frame = frame_to_rhino_plane(module_agg.from_frame)
    to_frame = frame_to_rhino_plane(module_agg.to_frame)

module_agg.move_by_layer(translation_vector = (124.017431,0,0), layer_iteration = layer_iteration)

# output geometry
sticks = module_agg.sticks_object()
geo = module_agg.visualize()
# ---------- end stick_module_aggregation_6 ----------
draw_11 = COMPASDraw(cg=stick_module_aggregation_6.module_out)  # -> rg; disabled; same code as draw
draw_12 = COMPASDraw(cg=stick_module_aggregation_6.geo)  # -> rg; disabled; same code as draw
pln_16 = Plane(stick_module_aggregation_6.from_frame)  # disabled
pln_17 = Plane(stick_module_aggregation_6.to_frame)  # disabled
pln_18 = Plane(stick_module_aggregation_6.module_frame_out)  # disabled
preview_11 = CustomPreview(
    Geometry=draw_11,
    Material={diffuse=RGB(221, 160, 221), emission=RGB(66, 48, 66), shine=0.5, specular=RGB(255, 255, 255), transparency=0})  # disabled
preview_12 = CustomPreview(
    Geometry=draw_12,
    Material={diffuse=RGB(221, 160, 221), emission=RGB(66, 48, 66), shine=0.5, specular=RGB(255, 255, 255), transparency=0})  # disabled
vec_display_11 = VecDisplay(num=30)  # disabled
number_slider_87 = Slider(3, range=0..3)  # disabled
panel_15 = Panel(stick_module_aggregation_6.sticks)  # disabled
number_slider_88 = Slider(1, range=0..3)  # disabled
tstat_6 = TreeStatistics(Tree=pln_16)  # -> simplify(Paths), Length, Count; disabled
item_36 = ListItem(List=draw_11, Index=number_slider_87, Wrap=True)  # disabled
item_37 = ListItem(List=tstat_6.Paths, Index=number_slider_87, Wrap=True)  # disabled
item_38 = ListItem(List=pln_18, Index=number_slider_88, Wrap=True)  # disabled
branch_6 = TreeBranch(Tree=pln_16, Path=item_37, MaintainPaths=True)  # disabled
vec_display_12 = VecDisplay(pln=branch_6, num=30)  # disabled

# ---- group: aggregation 7_4 legs_arc_3_move by layer
pt_7 = ConstructPoint(XCoordinate=0, YCoordinate=0, ZCoordinate=0)  # disabled
number_slider_89 = Slider(90, range=0..100)  # disabled
xy_7 = XYPlane(Origin=pt_7)  # disabled
xz_7 = XZPlane(Origin=Point(0, 0, 0))  # disabled
rot3d_7 = Rotate3D(Geometry=xy_7, Angle=degrees(number_slider_89), Center=Point(0, 0, 0), Axis=xz_7)  # -> Geometry, Transform; disabled

number_slider_90 = Slider(1, range=0..3)  # disabled
number_slider_91 = Slider(0, range=0..10)  # disabled
number_slider_92 = Slider(0, range=0..3)  # disabled
number_slider_93 = Slider(46, range=-180..180)  # disabled
number_slider_94 = Slider(0.791, range=0..1)  # disabled
number_slider_95 = Slider(1, range=0..3)  # disabled
number_slider_96 = Slider(3, range=0..3)  # disabled
number_slider_97 = Slider(4, range=0..10)  # disabled
number_slider_98 = Slider(0.262, range=0..1)  # disabled
stick_module_aggregation_7 = Python3Script(
    base_plane=rot3d_7.Geometry,
    agg_times=number_slider_97,
    to_stick_index=number_slider_96,
    to_face_index=number_slider_95,
    to_t=number_slider_98,
    from_stick_index=number_slider_92,
    from_face_index=number_slider_90,
    from_t=number_slider_94,
    angle=number_slider_93,
    layer_iteration=number_slider_91)  # -> out, module_out, geo, sticks, module_frame_out, to_frame, from_frame; inputs agg_times: Int32, to_stick_index: Int32, to_face_index: Int32, to_t: Double, from_stick_index: Int32, from_face_index: Int32, from_t: Double, angle: Double, layer_iteration: Int32; disabled; same code as stick_module_aggregation
draw_13 = COMPASDraw(cg=stick_module_aggregation_7.module_out)  # -> rg; disabled; same code as draw
draw_14 = COMPASDraw(cg=stick_module_aggregation_7.geo)  # -> rg; disabled; same code as draw
pln_19 = Plane(stick_module_aggregation_7.from_frame)  # disabled
pln_20 = Plane(stick_module_aggregation_7.to_frame)  # disabled
pln_21 = Plane(stick_module_aggregation_7.module_frame_out)  # disabled
preview_13 = CustomPreview(
    Geometry=draw_13,
    Material={diffuse=RGB(221, 160, 221), emission=RGB(66, 48, 66), shine=0.5, specular=RGB(255, 255, 255), transparency=0})  # disabled
preview_14 = CustomPreview(
    Geometry=draw_14,
    Material={diffuse=RGB(221, 160, 221), emission=RGB(66, 48, 66), shine=0.5, specular=RGB(255, 255, 255), transparency=0})  # disabled
vec_display_13 = VecDisplay(num=30)  # disabled
number_slider_99 = Slider(3, range=0..3)  # disabled
panel_16 = Panel(stick_module_aggregation_7.sticks)  # disabled
number_slider_100 = Slider(1, range=0..3)  # disabled
tstat_7 = TreeStatistics(Tree=pln_19)  # -> simplify(Paths), Length, Count; disabled
item_39 = ListItem(List=draw_13, Index=number_slider_99, Wrap=True)  # disabled
item_40 = ListItem(List=tstat_7.Paths, Index=number_slider_99, Wrap=True)  # disabled
item_41 = ListItem(List=pln_21, Index=number_slider_100, Wrap=True)  # disabled
branch_7 = TreeBranch(Tree=pln_19, Path=item_40, MaintainPaths=True)  # disabled
vec_display_14 = VecDisplay(pln=branch_7, num=30)  # disabled

# ----
# stick and frame
number_slider_101 = Slider(0, range=0..19)  # disabled
item_42 = ListItem(List=py3_3.frames, Index=number_slider_101, Wrap=True)  # disabled

number_slider_102 = Slider(0, range=0..19)  # disabled
item_43 = ListItem(List=py3.frames, Index=number_slider_102, Wrap=True)  # disabled

# ----
# stick and frame
number_slider_103 = Slider(0, range=0..19)  # disabled
item_44 = ListItem(List=py3_2.frames, Index=number_slider_103, Wrap=True)  # disabled

merge = Merge(Data1=simplify(graft(geo_5)), Data2=simplify(graft(py3_3.frames)))  # disabled
number_slider_104 = Slider(2, range=0..19)  # disabled
tstat_8 = TreeStatistics(Tree=merge)  # -> Paths, Length, Count; disabled
item_45 = ListItem(List=tstat_8.Paths, Index=number_slider_104, Wrap=True)  # disabled
branch_8 = TreeBranch(Tree=merge, Path=item_45, MaintainPaths=True)  # disabled

merge_2 = Merge(Data1=simplify(graft(geo)), Data2=simplify(graft(py3.frames)))  # disabled
number_slider_105 = Slider(2, range=0..19)  # disabled
tstat_9 = TreeStatistics(Tree=merge_2)  # -> Paths, Length, Count; disabled
item_46 = ListItem(List=tstat_9.Paths, Index=number_slider_105, Wrap=True)  # disabled
branch_9 = TreeBranch(Tree=merge_2, Path=item_46, MaintainPaths=True)  # disabled

merge_3 = Merge(Data1=simplify(graft(geo_3)), Data2=simplify(graft(py3_2.frames)))  # disabled
number_slider_106 = Slider(0, range=0..19)  # disabled
tstat_10 = TreeStatistics(Tree=merge_3)  # -> Paths, Length, Count; disabled
item_47 = ListItem(List=tstat_10.Paths, Index=number_slider_106, Wrap=True)  # disabled
branch_10 = TreeBranch(Tree=merge_3, Path=item_47, MaintainPaths=True)  # disabled

button_4 = Button()  # disabled
py3_4 = Python3Script(sticks=item_23, save=button_4)  # -> out, frames, assembly; inputs sticks: list, save: Boolean; disabled
# ---------- py3_4: Python ----------
from compas import json_dump
import os, sys
import math
import copy

from compas_rhino import unload_modules
from compas.geometry import (
    Line, Plane, Vector, Point, Frame, Box,
    Rotation, Translation,
    dot_vectors, centroid_points
)
from compas.datastructures import Assembly, Part
from compas_rhino.conversions import frame_to_rhino_plane


# -------------------------------------------------------------
# Setup Path and Import Stick Class
# -------------------------------------------------------------
path = ghenv.Component.OnPingDocument().FilePath
parentdir = os.path.dirname(path)
dire = os.path.join(parentdir, 'scripts')

sys.path.append(dire)
unload_modules("Sticks_Single_1")
from Sticks_Single_1 import Stick

json_path = os.path.join(parentdir, 'data', 'stick_assembly.json')


# -------------------------------------------------------------
# Helpers
# -------------------------------------------------------------
def is_parallel(v1, v2, tol=0.001):
    dot = dot_vectors(v1, v2)
    if math.isclose(dot, 1.0, abs_tol=tol) or math.isclose(dot, -1.0, abs_tol=tol):
        print("parallel")
        return True
    print("not parallel")
    return False

def get_frame_closest_to_target(target_vector, stick):
    best_dot = -1000
    best_frame = stick.frame
    target = target_vector.unitized()

    for i in range(4):
        angle = (math.pi/2) * i
        R =Rotation.from_axis_and_angle(stick.frame.xaxis, angle, stick.frame.point)
        candidate_frame = stick.frame.transformed(R)

        alignment = dot_vectors(candidate_frame.zaxis, target)
        if alignment > best_dot:
            best_dot = alignment
            best_frame = candidate_frame
        
        return best_frame
    
def get_center(sticks_list):
    return centroid_points([s.frame.point for s in sticks_list])

def get_lowest_point(sticks_list):
    pts = [s.axis.start and s.axis.end for s in sticks_list]

    if not pts:
        return None
    
    bbox = Box.from_points(pts)
    bottom_face = bbox.faces[0]
    bottom_vertices = [bbox.vertices[i] for i in bottom_face]
    bottom_center = centroid_points(bottom_vertices)
    return bottom_center

def move_to_gripper_position(stick, direction_vector=None, distance=30.0):
    if direction_vector is None:
        direction = stick.frame.xaxis.unitized()
    else:
        direction = direction_vector.unitized()
    
    mov_vec = direction * distance
    T = Translation.from_vector(mov_vec)
    stick.frame.transform(T)

    return stick.frame

def rotate_frame_direction(stick, angle):
    R = Rotation.from_axis_and_angle(stick.frame.xaxis, math.radians(angle), stick.frame.point)
    stick.frame.transform(R)
    return stick.frame


sticks_copy = copy.deepcopy(sticks)
center_pt = get_center(sticks_copy)
print("Center:", center_pt)
lowest_pt = get_lowest_point(sticks_copy)
print("Lowest point:", lowest_pt)

up_vector = Vector(0,0,1)

for stick in sticks_copy:
    stick_dir = stick.axis.direction.unitized()

    if is_parallel(stick_dir, up_vector):
        center_vector = Vector.from_start_end(stick.frame.point, center_pt)
        lowest_vector = Vector.from_start_end(stick.frame.point, lowest_pt)
        stick.frame = get_frame_closest_to_target(center_vector, stick)
        # stick.frame = get_frame_closest_to_target(lowest_vector, stick)
    
    else:
        R = Rotation.from_axis_and_angle(stick.frame.xaxis, math.pi/2, stick.frame.point)
        stick.frame.transform(R)
    
    move_to_gripper_position(stick, distance=30.0)

rotate_90 = [1]
rotate_180 = [7,8,9,12,16]

for i, rotated_stick in enumerate(sticks_copy):
    if i in rotate_90:
        rotate_frame_direction(rotated_stick, 90)
    elif i in rotate_180:
        rotate_frame_direction(rotated_stick, 180)
    else:
        pass

assembly = Assembly()

for i, s in enumerate(sticks_copy):
    part = Part(name=f"stick{i}", frame=s.frame)
    part.key = i
    part.attributes["shape"] = s.geometry
    assembly.add_part(part)

if save:
    json_dump(assembly, fp=json_path, pretty=True)
# ---------- end py3_4 ----------

# ---- group: gripper visualize
pt_8 = Point(Point(-0.4729400358, 0, 140))  # disabled
panel_17 = Panel("1")  # disabled
xy_8 = XYPlane(Origin=pt_8)  # disabled
item_48 = ListItem(List=branch_8, Index=panel_17, Wrap=True)  # disabled
geo_gripper = Geometry([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])  # disabled
orient = Orient(Geometry=geo_gripper, Source=xy_8, Target=item_48)  # -> Geometry, Transform; disabled
preview_15 = CustomPreview(
    Geometry=[orient.Geometry, branch_8],
    Material={diffuse=RGB(221, 160, 221), emission=RGB(66, 48, 66), shine=0.5, specular=RGB(255, 255, 255), transparency=0})  # disabled

pt_9 = Point(Point(-0.4729400358, 0, 140))  # disabled
panel_18 = Panel("1")  # disabled
xy_9 = XYPlane(Origin=pt_9)  # disabled
item_49 = ListItem(List=branch_9, Index=panel_18, Wrap=True)  # disabled
geo_gripper_2 = Geometry([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])  # disabled
orient_2 = Orient(Geometry=geo_gripper_2, Source=xy_9, Target=item_49)  # -> Geometry, Transform; disabled
preview_16 = CustomPreview(
    Geometry=[orient_2.Geometry, branch_9],
    Material={diffuse=RGB(221, 160, 221), emission=RGB(66, 48, 66), shine=0.5, specular=RGB(255, 255, 255), transparency=0})  # disabled

pt_10 = Point(Point(-0.4729400358, 0, 140))  # disabled
panel_19 = Panel("1")  # disabled
xy_10 = XYPlane(Origin=pt_10)  # disabled
item_50 = ListItem(List=branch_10, Index=panel_19, Wrap=True)  # disabled
geo_gripper_3 = Geometry([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])  # disabled
orient_3 = Orient(Geometry=geo_gripper_3, Source=xy_10, Target=item_50)  # -> Geometry, Transform; disabled
preview_17 = CustomPreview(
    Geometry=[orient_3.Geometry, branch_10],
    Material={diffuse=RGB(221, 160, 221), emission=RGB(66, 48, 66), shine=0.5, specular=RGB(255, 255, 255), transparency=0})  # disabled

# ---- group: grid_parameters
number_slider_107 = Slider(2, range=0..10)  # disabled
number_slider_108 = Slider(2, range=0..10)  # disabled
number_slider_109 = Slider(2, range=0..10)  # disabled

# ----
# find out the original frame of each stick
number_slider_110 = Slider(25, range=0..100)  # disabled
pt_11 = Point(Point(0.1313875721, 0.0945869119, 0))  # disabled
py3_5 = Python3Script(x_range=number_slider_108, y_range=number_slider_109, z_range=number_slider_107, offset=number_slider_110, st_pt=pt_11)  # -> out, points, sticks, geometry, frames; inputs x_range: Int32, y_range: Int32, z_range: Int32, offset: Double, st_pt: Point3d; disabled
# ---------- py3_5: Python ----------
#locate stick class file in the same folder
from compas_rhino import unload_modules
import sys
import os

#get current file path
path = ghenv.Component.OnPingDocument().FilePath
print (path)
#get parent directory of the parent directory
parentdir = os.path.dirname(path)
print (parentdir)
#get src folder which contains classes
dire = os.path.join(parentdir,'scripts')
print (dire)

sys.path.append(dire)

unload_modules('stick')
unload_modules('stickmodules')

import stick
from stick import Stick 
from stickmodules import OStickModule
from helpers import sort_sticks_by_z

from compas.geometry import Line, Point, Vector, Polyhedron, Rotation
from compas.datastructures import Assembly
from compas.datastructures import Part
from compas.datastructures import Mesh
from compas import json_dump
import math

stick_width = 13.0
stick_depth = 13.0
stick_length = 200


sticks = []
points = []

for x in range(x_range):
    for y in range(y_range):
        for z in range(z_range):
            grid_size = stick_length - 2*stick_depth - offset
            pt = Point(x*grid_size, y*grid_size, z*grid_size)
            points.append(pt)
            #type = 0 or 1 depending on odd or even
            #additionally type can be 2 for last item
            type_x = x%2 if x<x_range-1 else 2
            type_y = y%2 if y<y_range-1 else 2
            type_z = z%2 if z<z_range-1 else 2
            type = {"x":type_x, "y":type_y, "z":type_z}
            s_module = OStickModule(pt, stick_length, stick_width, stick_depth, offset, type)
            sticks.extend(s_module.stick_module)

from compas_rhino.conversions import frame_to_rhino_plane

geometry = [s.geometry for s in sticks]
frames = [frame_to_rhino_plane(s.frame) for s in sticks]
# ---------- end py3_5 ----------
number_slider_111 = Slider(10, range=0..10)  # disabled
panel_20 = Panel(py3_5.sticks)  # disabled
draw_15 = COMPASDraw(cg=py3_5.points)  # -> rg; disabled; same code as draw
draw_16 = COMPASDraw(cg=py3_5.geometry)  # -> rg; disabled; same code as draw
points = PointList(Points=py3_5.frames, Size=number_slider_111)  # disabled

# ---- group: aggregation 6_4 legs_arc_3_move by layer
pt_12 = ConstructPoint(XCoordinate=0, YCoordinate=0, ZCoordinate=0)  # disabled
number_slider_112 = Slider(90, range=0..100)  # disabled
xy_11 = XYPlane(Origin=pt_12)  # disabled
xz_8 = XZPlane(Origin=Point(0, 0, 0))  # disabled
rot3d_8 = Rotate3D(Geometry=xy_11, Angle=degrees(number_slider_112), Center=Point(0, 0, 0), Axis=xz_8)  # -> Geometry, Transform; disabled

number_slider_113 = Slider(0, range=0..3)  # disabled
number_slider_114 = Slider(1, range=0..3)  # disabled
number_slider_115 = Slider(3, range=0..10)  # disabled
number_slider_116 = Slider(46, range=-180..180)  # disabled
number_slider_117 = Slider(0.791, range=0..1)  # disabled
number_slider_118 = Slider(1, range=0..3)  # disabled
number_slider_119 = Slider(3, range=0..3)  # disabled
number_slider_120 = Slider(4, range=0..10)  # disabled
number_slider_121 = Slider(0.262, range=0..1)  # disabled
stick_module_aggregation_8 = Python3Script(
    base_plane=rot3d_8.Geometry,
    agg_times=number_slider_120,
    to_stick_index=number_slider_119,
    to_face_index=number_slider_118,
    to_t=number_slider_121,
    from_stick_index=number_slider_113,
    from_face_index=number_slider_114,
    from_t=number_slider_117,
    angle=number_slider_116,
    layer_iteration=number_slider_115)  # -> out, module_out, geo, sticks, module_frame_out, to_frame, from_frame; inputs agg_times: Int32, to_stick_index: Int32, to_face_index: Int32, to_t: Double, from_stick_index: Int32, from_face_index: Int32, from_t: Double, angle: Double, layer_iteration: Int32; disabled; same code as stick_module_aggregation_6
draw_17 = COMPASDraw(cg=stick_module_aggregation_8.module_out)  # -> rg; disabled; same code as draw
draw_18 = COMPASDraw(cg=stick_module_aggregation_8.geo)  # -> rg; disabled; same code as draw
pln_22 = Plane(stick_module_aggregation_8.from_frame)  # disabled
pln_23 = Plane(stick_module_aggregation_8.to_frame)  # disabled
pln_24 = Plane(stick_module_aggregation_8.module_frame_out)  # disabled
preview_18 = CustomPreview(
    Geometry=draw_17,
    Material={diffuse=RGB(221, 160, 221), emission=RGB(66, 48, 66), shine=0.5, specular=RGB(255, 255, 255), transparency=0})  # disabled
preview_19 = CustomPreview(
    Geometry=draw_18,
    Material={diffuse=RGB(221, 160, 221), emission=RGB(66, 48, 66), shine=0.5, specular=RGB(255, 255, 255), transparency=0})  # disabled
vec_display_15 = VecDisplay(num=30)  # disabled
number_slider_122 = Slider(3, range=0..3)  # disabled
panel_21 = Panel(stick_module_aggregation_8.sticks)  # disabled
number_slider_123 = Slider(1, range=0..3)  # disabled
tstat_11 = TreeStatistics(Tree=pln_22)  # -> simplify(Paths), Length, Count; disabled
item_51 = ListItem(List=draw_17, Index=number_slider_122, Wrap=True)  # disabled
item_52 = ListItem(List=tstat_11.Paths, Index=number_slider_122, Wrap=True)  # disabled
item_53 = ListItem(List=pln_24, Index=number_slider_123, Wrap=True)  # disabled
branch_11 = TreeBranch(Tree=pln_22, Path=item_52, MaintainPaths=True)  # disabled
vec_display_16 = VecDisplay(pln=branch_11, num=30)  # disabled

# ----
# let the frame of vertical stick facing the centroid of structure
# let the z axis of frame of horizontal stick facing down
button_5 = Button()  # disabled
py3_6 = Python3Script(sticks=py3_5.sticks, save=button_5)  # -> out, frames, assembly; inputs sticks: list, save: Boolean; disabled
# ---------- py3_6: Python ----------
from compas import json_dump
import os, sys
from itertools import combinations
from compas_rhino import unload_modules
from compas.geometry import Line, Plane, Vector, Point

#get current file path
path = ghenv.Component.OnPingDocument().FilePath
#get parent directory of the parent directory
parentdir = os.path.dirname(path)
#get src folder which contains classes
dire = os.path.join(parentdir,'scripts')

sys.path.append(dire)

from stick import Stick 

from compas.datastructures import Assembly, Part

json_path = os.path.join(parentdir, 'data', 'stick_assembly.json')

stick_width = 13.0
stick_depth = 13.0
stick_length = 200

sticks_data = []

###########################################################################
# Make frames point in best direction
###########################################################################
import math
import copy

from compas.geometry import dot_vectors, Rotation
from compas.geometry import centroid_points

def is_parallel(v1, v2):
    if math.isclose(dot_vectors(v1, v2), 1, abs_tol = 0.001) or math.isclose(dot_vectors(v1, v2), -1 ,abs_tol = 0.001):
        # Means it is parallel
        print("parallel")
        return True
    else:
        # Means it is not parallel
        print("not parallel")
        return False

# 在 stick 的四面以 x 軸為基準的 90° 旋轉中，選出其 z 軸最接近 target_vector 的那個 frame
def get_frame_closest_to_target(target_vector, stick):
    best_dot = -1000.0
    for i in range(4):
        angle = math.pi/2 * i # 0, 90, 180, 270
        R = Rotation.from_axis_and_angle(stick.frame.xaxis, angle, stick.frame.point)
        frame = stick.frame.transformed(R)
        dot = dot_vectors(frame.zaxis, target_vector.unitized()) #貼近 1 表示極度平行
        if dot>best_dot:
            best_dot = dot
            best_frame = frame
            print(i)
    return best_frame

def get_center(sticks_list):
    all_points = [stick.frame.point for stick in sticks_list]
    center = centroid_points(all_points)
    print(center)
    return center

# Copy sticks

sticks_copy = copy.deepcopy(sticks)
center_pt = get_center(sticks_copy)


for stick in sticks_copy:
    if is_parallel(stick.axis.direction.unitized(), Vector(0,0,1)):
        # Target frame is frame pointing into center of structure
        center_vector = Vector.from_start_end(stick.frame.point, center_pt)
        best_frame = get_frame_closest_to_target(center_vector, stick=stick)
        stick.frame = best_frame

    else:
        # Make sure z axis is pointing down
        R = Rotation.from_axis_and_angle(stick.frame.xaxis, math.pi/2, stick.frame.point)
        stick.frame.transform(R)
        # zaxis = Vector(0, 0, -1)
        # xaxis = stick.frame.xaxis.unitized()
        # yaxis = zaxis.cross(xaxis).unitized()

        # stick.frame = Frame(stick.frame.point, xaxis, yaxis)


from compas_rhino.conversions import frame_to_rhino_plane

###########################################################################
# Make frames point in best direction
###########################################################################
# 建立 Assembly 並把每根 stick 轉成 Part
assembly = Assembly()
for i, s in enumerate(sticks_copy):
    part_name = "stick"+ str(i)
    part = Part(name = part_name, frame = s.frame)
    part.key = i
    part.attributes["shape"] = s.geometry
    part.attributes["whatever"] = "name"
    assembly.add_part(part)
    

frames = [frame_to_rhino_plane(p.frame) for p in assembly.parts()]

if save:
    json_dump(assembly, fp=json_path, pretty=True)
# ---------- end py3_6 ----------
panel_22 = Panel(py3_6.frames)  # disabled
panel_23 = Panel(py3_6.assembly)  # disabled

# ---- group: aggregation 7_4 legs_arc_3_move by layer
pt_13 = ConstructPoint(XCoordinate=0, YCoordinate=0, ZCoordinate=0)
xy_12 = XYPlane(Origin=pt_13)
xz_9 = XZPlane(Origin=Point(0, 0, 0))
rot3d_9 = Rotate3D(Geometry=xy_12, Angle=degrees(Slider(90, range=0..100)), Center=Point(0, 0, 0), Axis=xz_9)  # -> Geometry, Transform

stick_module_aggregation_9 = Python3Script(
    base_plane=rot3d_9.Geometry,
    agg_times=Slider(4, range=0..10),
    to_stick_index=Slider(3, range=0..3),
    to_face_index=Slider(1, range=0..3),
    to_t=Slider(0.262, range=0..1),
    from_stick_index=Slider(0, range=0..3),
    from_face_index=Slider(1, range=0..3),
    from_t=Slider(0.791, range=0..1),
    angle=Slider(46, range=-180..180),
    layer_iteration=Slider(0, range=0..10))  # -> out, module_out, geo, sticks, module_frame_out, to_frame, from_frame; inputs agg_times: Int32, to_stick_index: Int32, to_face_index: Int32, to_t: Double, from_stick_index: Int32, from_face_index: Int32, from_t: Double, angle: Double, layer_iteration: Int32; same code as stick_module_aggregation
draw_19 = COMPASDraw(cg=stick_module_aggregation_9.module_out)  # -> rg; same code as draw
draw_20 = COMPASDraw(cg=stick_module_aggregation_9.geo)  # -> rg; same code as draw
pln_25 = Plane(stick_module_aggregation_9.from_frame)
pln_26 = Plane(stick_module_aggregation_9.to_frame)
pln_27 = Plane(stick_module_aggregation_9.module_frame_out)
preview_20 = CustomPreview(
    Geometry=draw_19,
    Material={diffuse=RGB(221, 160, 221), emission=RGB(66, 48, 66), shine=0.5, specular=RGB(255, 255, 255), transparency=0})
preview_21 = CustomPreview(
    Geometry=draw_20,
    Material={diffuse=RGB(221, 160, 221), emission=RGB(66, 48, 66), shine=0.5, specular=RGB(255, 255, 255), transparency=0})
vec_display_17 = VecDisplay(num=30)
number_slider_124 = Slider(3, range=0..3)
panel_24 = Panel(stick_module_aggregation_9.sticks)
tstat_12 = TreeStatistics(Tree=pln_25)  # -> simplify(Paths), Length, Count
item_54 = ListItem(List=draw_19, Index=number_slider_124, Wrap=True)
item_55 = ListItem(List=tstat_12.Paths, Index=number_slider_124, Wrap=True)
item_56 = ListItem(List=pln_27, Index=Slider(1, range=0..3), Wrap=True)
branch_12 = TreeBranch(Tree=pln_25, Path=item_55, MaintainPaths=True)
vec_display_18 = VecDisplay(pln=branch_12, num=30)

# geo
number_slider_125 = Slider(18, range=0..19)
panel_25 = Panel("""18
16
17
19
12
13
14
15
8
11
10
9
4
6
7
5
0
2
3
1""")
item_57 = ListItem(List=draw_20, Index=panel_25, Wrap=True)
item_58 = ListItem(List=draw_20, Index=number_slider_125, Wrap=True)
geo_7 = Geometry(item_57)
item_59 = ListItem(List=geo_7, Index=Slider(0, range=0..19), Wrap=True)
geo_8 = Geometry(item_59)

# sticks
number_slider_126 = Slider(18, range=0..19)
item_60 = ListItem(List=stick_module_aggregation_9.sticks, Index=panel_25, Wrap=True)
item_61 = ListItem(List=stick_module_aggregation_9.sticks, Index=number_slider_126, Wrap=True)
item_62 = ListItem(List=item_60, Index=Slider(0, range=0..19), Wrap=True)

# ---- group: aggregation 7_4 legs_arc_3_move by layer / working basement
bbox_3 = BoundingBox(Content=geo_7, Plane=PlaneXY(0, 0, 0), UnionBox=True)  # -> Box, Box_2
number_slider_127 = Slider(300, range=0..1000)
debrep_3 = DeconstructBrep(Brep=bbox_3.Box)  # -> Faces, Edges, Vertices
item_63 = ListItem(List=debrep_3.Faces, Index="4", Wrap=True)
neg_5 = Negative(Value=Slider(450, range=0..1000))
neg_6 = Negative(Value=number_slider_127)
area_3 = Area(Geometry=item_63)  # -> Area, Centroid
dom_5 = ConstructDomain(DomainStart=neg_6, DomainEnd=number_slider_127)
dom_6 = ConstructDomain(DomainStart=neg_5, DomainEnd=Slider(0, range=0..100))
box_3 = DomainBox(Base=area_3.Centroid, X=dom_5, Y=dom_5, Z=dom_6)
geo_working_basement_3 = Geometry(box_3)

# ---- group: frame determination_2
# let the frame of vertical stick facing the centroid of structure
# let the z axis of frame of horizontal stick facing down
# frame position: away 3 cm from strat point
# frame direction
button_6 = Button()
py3_7 = Python3Script(sticks=item_60, save=button_6)  # -> out, frames, assembly; inputs sticks: list, save: Boolean
# ---------- py3_7: Python ----------
from compas import json_dump
import os, sys
from itertools import combinations
from compas_rhino import unload_modules
from compas.geometry import Line, Plane, Vector, Point, Frame
from compas.geometry import Transformation, Translation

#get current file path
path = ghenv.Component.OnPingDocument().FilePath
#get parent directory of the parent directory
parentdir = os.path.dirname(path)
#get src folder which contains classes
dire = os.path.join(parentdir,'scripts')

sys.path.append(dire)

from compas_rhino import unload_modules
unload_modules("Sticks_Single_1")

from Sticks_Single_1 import Stick 

from compas.datastructures import Assembly, Part

json_path = os.path.join(parentdir, 'data', 'stick_assembly.json')

stick_width = 13.0
stick_depth = 13.0
stick_length = 200
stick_d_length = 235

sticks_data = []

###########################################################################
# Make frames point in best direction
###########################################################################
import math
import copy

from compas.geometry import dot_vectors, Rotation
from compas.geometry import centroid_points

def is_parallel(v1, v2):
    if math.isclose(dot_vectors(v1, v2), 1, abs_tol = 0.001) or math.isclose(dot_vectors(v1, v2), -1 ,abs_tol = 0.001):
        # Means it is parallel
        print("parallel")
        return True
    else:
        # Means it is not parallel
        print("not parallel")
        return False

# 在 stick 的四面以 x 軸為基準的 90° 旋轉中，選出其 z 軸最接近 target_vector 的那個 frame
def get_frame_closest_to_target(target_vector, stick):
    best_dot = -1000.0
    for i in range(4):
        angle = math.pi/2 * i # 0, 90, 180, 270
        R = Rotation.from_axis_and_angle(stick.frame.xaxis, angle, stick.frame.point)
        frame = stick.frame.transformed(R)
        dot = dot_vectors(frame.zaxis, target_vector.unitized()) #貼近 1 表示極度平行
        if dot>best_dot:
            best_dot = dot
            best_frame = frame
            print(i)
    return best_frame

def get_center(sticks_list):
    all_points = [stick.frame.point for stick in sticks_list]
    center = centroid_points(all_points)
    print(center)
    return center

def move_to_gripper_position(stick, distance=30.0):
    # 取得 stick 的 x 軸方向（Vector）
    xdir = stick.frame.xaxis.unitized()

    # 要平移的向量
    translation_vector = xdir * distance

    # T = Translation.from_vector([1, 2, 3])
    # T = Translation.from_vector(Vector(1, 2, 3))
    T = Translation.from_vector(translation_vector)

    # 對 Frame 做 transform（正確用法）
    stick.frame.transform(T)

    return stick.frame

# Copy sticks

sticks_copy = copy.deepcopy(sticks)
center_pt = get_center(sticks_copy)


for stick in sticks_copy:
    if is_parallel(stick.axis.direction.unitized(), Vector(0,0,1)):
        # Target frame is frame pointing into center of structure
        center_vector = Vector.from_start_end(stick.frame.point, center_pt)
        best_frame = get_frame_closest_to_target(center_vector, stick=stick)
        stick.frame = best_frame
        move_to_gripper_position(stick=stick, distance=30.0)

    else:
        # Make sure z axis is pointing down
        R = Rotation.from_axis_and_angle(stick.frame.xaxis, math.pi/2, stick.frame.point)
        stick.frame.transform(R)
        move_to_gripper_position(stick=stick, distance=30.0)

from compas_rhino.conversions import frame_to_rhino_plane

###########################################################################
# Make frames point in best direction
###########################################################################
# 建立 Assembly 並把每根 stick 轉成 Part
assembly = Assembly()
for i, s in enumerate(sticks_copy):
    part_name = "stick"+ str(i)
    part = Part(name = part_name, frame = s.frame)
    part.key = i
    part.attributes["shape"] = s.geometry
    part.attributes["whatever"] = "name"
    assembly.add_part(part)
    

frames = [frame_to_rhino_plane(p.frame) for p in assembly.parts()]

if save:
    json_dump(assembly, fp=json_path, pretty=True)
# ---------- end py3_7 ----------
panel_26 = Panel(py3_7.frames)
panel_27 = Panel(py3_7.assembly)

# ---- group: frame determination_1
# let the frame of vertical stick facing the centroid of structure
# let the z axis of frame of horizontal stick facing down
button_7 = Button()  # disabled
py3_8 = Python3Script(sticks=item_60, save=button_7)  # -> out, frames, assembly; inputs sticks: list, save: Boolean; disabled
# ---------- py3_8: Python ----------
from compas import json_dump
import os, sys
from itertools import combinations
from compas_rhino import unload_modules
from compas.geometry import Line, Plane, Vector, Point

#get current file path
path = ghenv.Component.OnPingDocument().FilePath
#get parent directory of the parent directory
parentdir = os.path.dirname(path)
#get src folder which contains classes
dire = os.path.join(parentdir,'scripts')

sys.path.append(dire)

from compas_rhino import unload_modules
unload_modules("Sticks_Single_1")

from Sticks_Single_1 import Stick 

from compas.datastructures import Assembly, Part

json_path = os.path.join(parentdir, 'data', 'stick_assembly.json')

stick_width = 13.0
stick_depth = 13.0
stick_length = 200
stick_d_length = 235

sticks_data = []

###########################################################################
# Make frames point in best direction
###########################################################################
import math
import copy

from compas.geometry import dot_vectors, Rotation
from compas.geometry import centroid_points

def is_parallel(v1, v2):
    if math.isclose(dot_vectors(v1, v2), 1, abs_tol = 0.001) or math.isclose(dot_vectors(v1, v2), -1 ,abs_tol = 0.001):
        # Means it is parallel
        print("parallel")
        return True
    else:
        # Means it is not parallel
        print("not parallel")
        return False

# 在 stick 的四面以 x 軸為基準的 90° 旋轉中，選出其 z 軸最接近 target_vector 的那個 frame
def get_frame_closest_to_target(target_vector, stick):
    best_dot = -1000.0
    for i in range(4):
        angle = math.pi/2 * i # 0, 90, 180, 270
        R = Rotation.from_axis_and_angle(stick.frame.xaxis, angle, stick.frame.point)
        frame = stick.frame.transformed(R)
        dot = dot_vectors(frame.zaxis, target_vector.unitized()) #貼近 1 表示極度平行
        if dot>best_dot:
            best_dot = dot
            best_frame = frame
            print(i)
    return best_frame

def get_center(sticks_list):
    all_points = [stick.frame.point for stick in sticks_list]
    center = centroid_points(all_points)
    print(center)
    return center

# Copy sticks

sticks_copy = copy.deepcopy(sticks)
center_pt = get_center(sticks_copy)


for stick in sticks_copy:
    if is_parallel(stick.axis.direction.unitized(), Vector(0,0,1)):
        # Target frame is frame pointing into center of structure
        center_vector = Vector.from_start_end(stick.frame.point, center_pt)
        best_frame = get_frame_closest_to_target(center_vector, stick=stick)
        stick.frame = best_frame

    else:
        # Make sure z axis is pointing down
        R = Rotation.from_axis_and_angle(stick.frame.xaxis, math.pi/2, stick.frame.point)
        stick.frame.transform(R)
        # zaxis = Vector(0, 0, -1)
        # xaxis = stick.frame.xaxis.unitized()
        # yaxis = zaxis.cross(xaxis).unitized()

        # stick.frame = Frame(stick.frame.point, xaxis, yaxis)


from compas_rhino.conversions import frame_to_rhino_plane

###########################################################################
# Make frames point in best direction
###########################################################################
# 建立 Assembly 並把每根 stick 轉成 Part
assembly = Assembly()
for i, s in enumerate(sticks_copy):
    part_name = "stick"+ str(i)
    part = Part(name = part_name, frame = s.frame)
    part.key = i
    part.attributes["shape"] = s.geometry
    part.attributes["whatever"] = "name"
    assembly.add_part(part)
    

frames = [frame_to_rhino_plane(p.frame) for p in assembly.parts()]

if save:
    json_dump(assembly, fp=json_path, pretty=True)
# ---------- end py3_8 ----------
panel_28 = Panel(py3_8.frames)  # disabled
panel_29 = Panel(py3_8.assembly)  # disabled

# ----
# stick and frame
number_slider_128 = Slider(0, range=0..19)  # disabled
item_64 = ListItem(List=py3_8.frames, Index=number_slider_128, Wrap=True)  # disabled

merge_4 = Merge(Data1=simplify(graft(geo_7)), Data2=simplify(graft(py3_8.frames)))  # disabled
number_slider_129 = Slider(1, range=0..19)  # disabled
tstat_13 = TreeStatistics(Tree=merge_4)  # -> Paths, Length, Count; disabled
item_65 = ListItem(List=tstat_13.Paths, Index=number_slider_129, Wrap=True)  # disabled
branch_13 = TreeBranch(Tree=merge_4, Path=item_65, MaintainPaths=True)  # disabled

# ---- group: frame determination_2
# let the frame of vertical stick facing the centroid of structure
# let the z axis of frame of horizontal stick facing down
# frame position: away 3 cm from strat point
# frame direction
button_8 = Button()  # disabled
py3_9 = Python3Script(sticks=item_60, save=button_8)  # -> out, frames, assembly; inputs sticks: list, save: Boolean; disabled; same code as py3_3
panel_30 = Panel(py3_9.frames)  # disabled
panel_31 = Panel(py3_9.assembly)  # disabled

# ---- group: gripper visualize
pt_14 = Point(Point(-0.4729400358, 0, 140))  # disabled
panel_32 = Panel("1")  # disabled
xy_13 = XYPlane(Origin=pt_14)  # disabled
item_66 = ListItem(List=branch_13, Index=panel_32, Wrap=True)  # disabled
geo_gripper_4 = Geometry([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])  # disabled
orient_4 = Orient(Geometry=geo_gripper_4, Source=xy_13, Target=item_66)  # -> Geometry, Transform; disabled
preview_22 = CustomPreview(
    Geometry=[orient_4.Geometry, branch_13],
    Material={diffuse=RGB(221, 160, 221), emission=RGB(66, 48, 66), shine=0.5, specular=RGB(255, 255, 255), transparency=0})  # disabled

# ---- group: frame determination_2
# let the frame of vertical stick facing the centroid of structure
# let the z axis of frame of horizontal stick facing down
# frame position: away 3 cm from strat point
# reference point: center_pt
# frame direction: compute automatically
button_9 = Button()  # disabled
py3_10 = Python3Script(sticks=item_60, save=button_9)  # -> out, frames, assembly; inputs sticks: list, save: Boolean; disabled
# ---------- py3_10: Python ----------
from compas import json_dump
import os, sys
import math
import copy

from compas_rhino import unload_modules
from compas.geometry import (
    Line, Plane, Vector, Point, Frame, Box,
    Rotation, Translation,
    dot_vectors, centroid_points
)
from compas.datastructures import Assembly, Part
from compas_rhino.conversions import frame_to_rhino_plane


# -------------------------------------------------------------
# Setup Path and Import Stick Class
# -------------------------------------------------------------
path = ghenv.Component.OnPingDocument().FilePath
parentdir = os.path.dirname(path)
dire = os.path.join(parentdir, 'scripts')

sys.path.append(dire)
unload_modules("Sticks_Single_1")
from Sticks_Single_1 import Stick

json_path = os.path.join(parentdir, 'data', 'stick_assembly.json')


# -------------------------------------------------------------
# Helpers
# -------------------------------------------------------------
def is_parallel(v1, v2, tol=0.001):
    """Check if two vectors are parallel by dot product."""
    dot = dot_vectors(v1, v2)
    if math.isclose(dot, 1.0, abs_tol=tol) or math.isclose(dot, -1.0, abs_tol=tol):
        print("parallel")
        return True
    print("not parallel")
    return False


def get_frame_closest_to_target(target_vector, stick):
    """
    Rotate around stick.xaxis in 90° increments and find the frame
    whose Z axis most closely matches target_vector.
    """
    best_dot = -1000.0
    best_frame = stick.frame

    target = target_vector.unitized()

    for i in range(4):
        angle = (math.pi / 2) * i
        R = Rotation.from_axis_and_angle(stick.frame.xaxis, angle, stick.frame.point)
        candidate_frame = stick.frame.transformed(R)

        alignment = dot_vectors(candidate_frame.zaxis, target)
        if alignment > best_dot:
            best_dot = alignment
            best_frame = candidate_frame

    return best_frame


def get_center(sticks_list):
    """Compute geometric centroid from stick frame points."""
    return centroid_points([s.frame.point for s in sticks_list])


def get_lowest_points(sticks_list):
    """
    Compute the center point of the lowest face of the bounding box
    that encloses all stick frame points.

    Returns
    -------
    Point : center of the bottom face of the bounding box
    """
    # 1. 收集所有 frame 的點
    pts = [s.frame.point for s in sticks_list]

    if not pts:
        return None

    # 2. 建立整組 sticks 的 bounding box
    bbox = Box.from_points(pts)

    # 3. Box 的 faces 順序固定：0~5
    #    0 = bottom, 1 = top, 2/3/4/5 = side faces
    bottom_face = bbox.faces[0]

    # 4. 取得底面四個角點
    bottom_vertices = [bbox.vertices[i] for i in bottom_face]

    # 5. 算底面的中心（四角點幾何中心）
    bottom_center = centroid_points(bottom_vertices)

    return bottom_center



def move_to_gripper_position(stick, direction_vector=None, distance=30.0):
    """
    Move a stick along any direction vector by given distance.
    
    Parameters
    ----------
    stick : object with a .frame attribute
    direction_vector : Vector or list/tuple, optional
        Direction to move. If None, use local x-axis.
    distance : float
        Translation distance in mm.
    """
    # 如果沒有指定方向，就用 stick 的局部 x-axis
    if direction_vector is None:
        direction = stick.frame.xaxis.unitized()
    else:
        # 轉成 Vector 並 unitize
        direction = Vector(*direction_vector).unitized()

    # 計算位移向量
    move_vec = direction * distance

    # 產生平移變換
    T = Translation.from_vector(move_vec)

    # 套用到 frame
    stick.frame.transform(T)

    return stick.frame


# -------------------------------------------------------------
# Apply frame adjustments to sticks
# -------------------------------------------------------------
sticks_copy = copy.deepcopy(sticks)
center_pt = get_center(sticks_copy)
print("Center:", center_pt)
lowest_pt = get_lowest_points(sticks_copy)
print("Lowest center:", lowest_pt)

up_vector = Vector(0, 0, 1)

for stick in sticks_copy:
    stick_dir = stick.axis.direction.unitized()

    # Case 1: Stick is vertical (parallel to Z)
    if is_parallel(stick_dir, up_vector):
        center_vector = Vector.from_start_end(stick.frame.point, center_pt)
        stick.frame = get_frame_closest_to_target(center_vector, stick)

    # Case 2: Stick is non-vertical
    else:
        # Rotate so its Z axis becomes downward
        R = Rotation.from_axis_and_angle(stick.frame.xaxis, math.pi / 2, stick.frame.point)
        stick.frame.transform(R)

    # Move frame for robotic gripping
    move_to_gripper_position(stick, distance=30.0)

# # arrange frame direction
# for i, stick in enumerate(sticks_copy):
#     stick.frame.direction


# -------------------------------------------------------------
# Build Assembly
# -------------------------------------------------------------
assembly = Assembly()

for i, s in enumerate(sticks_copy):
    part = Part(name=f"stick{i}", frame=s.frame)
    part.key = i
    part.attributes["shape"] = s.geometry
    assembly.add_part(part)

frames = [frame_to_rhino_plane(p.frame) for p in assembly.parts()]


# -------------------------------------------------------------
# Save JSON
# -------------------------------------------------------------
if save:
    json_dump(assembly, fp=json_path, pretty=True)
# ---------- end py3_10 ----------
panel_33 = Panel(py3_10.frames)  # disabled
panel_34 = Panel(py3_10.assembly)  # disabled

# ---- group: frame determination_3_specific rotation
# let the frame of vertical stick facing the centroid of structure
# let the z axis of frame of horizontal stick facing down
# frame position: away 3 cm from strat point
# reference point: lowest_pt
# frame direction: select specific plane to rotate
button_10 = Button()
py3_11 = Python3Script(sticks=item_60, save=button_10)  # -> out, frames, assembly; inputs sticks: list, save: Boolean; same code as py3
panel_35 = Panel(py3_11.frames)
panel_36 = Panel(py3_11.assembly)

# ----
panel_37 = Panel("[150.88282510821278, 232.39831639692613, -36.87571508842052]")
panel_38 = Panel("[150.88282510821284, 234.15705997556273, 0.0]")
vec = VectorXYZ(XComponent="1", YComponent=0, ZComponent=0)  # -> Vector, Length
rotate = Rotate(Geometry=vec.Vector, Angle=degrees(Slider(45, range=0..360)), Plane=PlaneXY(0, 0, 0))  # -> Geometry, Transform
rotate_2 = Rotate(Geometry=vec.Vector, Angle=degrees(Slider(90, range=0..360)), Plane=PlaneXY(0, 0, 0))  # -> Geometry, Transform
rotate_3 = Rotate(Geometry=vec.Vector, Angle=degrees(Slider(180, range=0..360)), Plane=PlaneXY(0, 0, 0))  # -> Geometry, Transform
rotate_4 = Rotate(Geometry=vec.Vector, Angle=degrees(Slider(270, range=0..360)), Plane=PlaneXY(0, 0, 0))  # -> Geometry, Transform
dprod = DotProduct(VectorA=vec.Vector, VectorB=vec.Vector, Unitize=False)
dprod_2 = DotProduct(VectorA=vec.Vector, VectorB=rotate.Geometry, Unitize=False)
dprod_3 = DotProduct(VectorA=vec.Vector, VectorB=rotate_2.Geometry, Unitize=False)
dprod_4 = DotProduct(VectorA=vec.Vector, VectorB=rotate_3.Geometry, Unitize=False)
dprod_5 = DotProduct(VectorA=vec.Vector, VectorB=rotate_4.Geometry, Unitize=False)
panel_39 = Panel(dprod)
panel_40 = Panel(dprod_2)
panel_41 = Panel(dprod_3)
panel_42 = Panel(dprod_4)
panel_43 = Panel(dprod_5)

# ----
# stick and frame
number_slider_130 = Slider(0, range=0..19)  # disabled
item_67 = ListItem(List=py3_10.frames, Index=number_slider_130, Wrap=True)  # disabled

# ----
# stick and frame
number_slider_131 = Slider(0, range=0..19)
item_68 = ListItem(List=py3_11.frames, Index=number_slider_131, Wrap=True)

merge_5 = Merge(Data1=simplify(graft(geo_7)), Data2=simplify(graft(py3_10.frames)))  # disabled
number_slider_132 = Slider(19, range=0..19)  # disabled
tstat_14 = TreeStatistics(Tree=merge_5)  # -> Paths, Length, Count; disabled
item_69 = ListItem(List=tstat_14.Paths, Index=number_slider_132, Wrap=True)  # disabled
branch_14 = TreeBranch(Tree=merge_5, Path=item_69, MaintainPaths=True)  # disabled

merge_6 = Merge(Data1=simplify(graft(geo_7)), Data2=simplify(graft(py3_11.frames)))
tstat_15 = TreeStatistics(Tree=merge_6)  # -> Paths, Length, Count
item_70 = ListItem(List=tstat_15.Paths, Index=Slider(2, range=0..19), Wrap=True)
branch_15 = TreeBranch(Tree=merge_6, Path=item_70, MaintainPaths=True)

# ---- group: gripper visualize
pt_15 = Point(Point(-0.4729400358, 0, 140))  # disabled
panel_44 = Panel("1")  # disabled
xy_14 = XYPlane(Origin=pt_15)  # disabled
item_71 = ListItem(List=branch_14, Index=panel_44, Wrap=True)  # disabled
geo_gripper_5 = Geometry([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])  # disabled
orient_5 = Orient(Geometry=geo_gripper_5, Source=xy_14, Target=item_71)  # -> Geometry, Transform; disabled
preview_23 = CustomPreview(
    Geometry=[orient_5.Geometry, branch_14],
    Material={diffuse=RGB(221, 160, 221), emission=RGB(66, 48, 66), shine=0.5, specular=RGB(255, 255, 255), transparency=0})  # disabled

pt_16 = Point(Point(-0.4729400358, 0, 140))
xy_15 = XYPlane(Origin=pt_16)
item_72 = ListItem(List=branch_15, Index="1", Wrap=True)
geo_gripper_6 = Geometry([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])
orient_6 = Orient(Geometry=geo_gripper_6, Source=xy_15, Target=item_72)  # -> Geometry, Transform
preview_24 = CustomPreview(
    Geometry=[orient_6.Geometry, branch_15],
    Material={diffuse=RGB(221, 160, 221), emission=RGB(66, 48, 66), shine=0.5, specular=RGB(255, 255, 255), transparency=0})

# ==== cluster VecDisplay
pln = ClusterInput()
num = ClusterInput()
pln_2 = Plane(graft(pln))
num_2 = Number(num)
deplane = DeconstructPlane(Plane=pln_2)  # -> flatten(Origin), XAxis, YAxis, ZAxis
entwine = Entwine(Branch00=deplane.XAxis, Branch01=deplane.YAxis, Branch02=deplane.ZAxis, FlattenInputs=True)
merge = Merge(
    Data1=ColourSwatch(SwatchColor=RGB(255, 0, 0)),
    Data2=ColourSwatch(SwatchColor=RGB(0, 255, 0)),
    Data3=ColourSwatch(SwatchColor=RGB(0, 0, 255)))  # -> graft(Result)
multiplication = Multiplication(A=entwine, B=num_2)
vdisex = VectorDisplayEx(Point=deplane.Origin, Vector=multiplication, Colour=merge, Width=2)
