# Grasshopper definition 204_send_to_robot_THL_2.gh (Grasshopper 1.0.8)

# ---- group: aggregation 7_4 legs_arc_3_move by layer
pt = ConstructPoint(XCoordinate=0, YCoordinate=0, ZCoordinate=0)
xy = XYPlane(Origin=pt)
xz = XZPlane(Origin=Point(0, 0, 0))
rot3d = Rotate3D(Geometry=xy, Angle=degrees(Slider(90, range=0..100)), Center=Point(0, 0, 0), Axis=xz)  # -> Geometry, Transform

stick_module_aggregation = Python3Script(
    base_plane=rot3d.Geometry,
    agg_times=Slider(4, range=0..10),
    to_stick_index=Slider(3, range=0..3),
    to_face_index=Slider(1, range=0..3),
    to_t=Slider(0.262, range=0..1),
    from_stick_index=Slider(0, range=0..3),
    from_face_index=Slider(1, range=0..3),
    from_t=Slider(0.791, range=0..1),
    angle=Slider(46, range=-180..180),
    layer_iteration=Slider(0, range=0..10))  # -> out, module_out, geo, sticks, module_frame_out, to_frame, from_frame; inputs agg_times: Int32, to_stick_index: Int32, to_face_index: Int32, to_t: Double, from_stick_index: Int32, from_face_index: Int32, from_t: Double, angle: Double, layer_iteration: Int32
# ---------- stick_module_aggregation: Python ----------
# r: compas>=2.14.1
# venv: sticks

import sys
import os
import math

#get current file path
path = ghenv.Component.OnPingDocument().FilePath
print (path)
#get parent directory of the parent directory
parentdir = os.path.dirname(path)
print (parentdir)
#get src folder which contains classes
dire = os.path.join(parentdir,'scripts')
print (dire)

sys.path.append(dire)

from compas_rhino import unload_modules

unload_modules("Sticks_Single_1")
unload_modules("Sticks_Multiple_1")
unload_modules("Sticks_Aggregation_7")

from Sticks_Single_1 import Stick  
from Sticks_Multiple_1 import TiltedModule_4legs
from Sticks_Aggregation_7 import ModuleAggregation
from compas.geometry import Line, Point, Vector, Frame
from compas_rhino.conversions import plane_to_compas_frame, frame_to_rhino_plane

module_agg = []
sticks = []
stick_width = 13.0
stick_depth = 13.0
stick_d_length = 235
stick_u_length = 263

# Convert input to compas
base_frame = plane_to_compas_frame(base_plane)

# Initialize tree
module_unit = TiltedModule_4legs(base_frame = base_frame, root_angle = 25, stick_d_length = 235, stick_u_length = 263, width = stick_width, depth = stick_depth)

# Grow tree
module_unit.grow_tilted_stick(length = stick_d_length, from_stick_index = -1, face_index = 2, angle = 46)
module_unit.grow_shorter_stick(length = stick_d_length, from_stick_index = 0, face_index = 3, angle = 50)
module_unit.grow_tilted_stick(length = stick_d_length, from_stick_index = 2, face_index = 1, angle = 46)

# Visualize
module_out = module_unit.visualize()
module_frame_out = [frame_to_rhino_plane(stick.frame) for stick in module_unit.sticks]

# Aggregation

module_agg = ModuleAggregation(module_unit.sticks)

for i in range(agg_times):
    module_agg.compute_next_module(
        from_stick_index=from_stick_index,
        from_face_index=from_face_index,
        from_t=from_t,
        to_stick_index=to_stick_index,
        to_face_index=to_face_index,
        to_t=to_t,
        angle=angle)
    
    from_frame = frame_to_rhino_plane(module_agg.from_frame)
    to_frame = frame_to_rhino_plane(module_agg.to_frame)

module_agg.move_by_layer(translation_vector = (124.017431,0,0), layer_iteration = layer_iteration)

# output geometry
sticks = module_agg.sticks_object()
geo = module_agg.visualize()
# ---------- end stick_module_aggregation ----------
draw = COMPASDraw(cg=stick_module_aggregation.module_out)  # -> rg
#   port cg: The COMPAS geometry or datastructure to be drawn.
#   port rg: The Rhino geometry object.
# ---------- draw: Python ----------
# r: compas>=2.14.1
"""
Draws COMPAS geometry in Grasshopper.
"""

from typing import Any

import Grasshopper

from compas.scene import SceneObject


class CompasToRhinoGeometry(Grasshopper.Kernel.GH_ScriptInstance):
    def RunScript(self, cg):
        if not cg:
            return None

        return SceneObject(item=cg).draw()
# ---------- end draw ----------
draw_2 = COMPASDraw(cg=stick_module_aggregation.geo)  # -> rg; same code as draw
pln = Plane(stick_module_aggregation.from_frame)
pln_2 = Plane(stick_module_aggregation.to_frame)
pln_3 = Plane(stick_module_aggregation.module_frame_out)
preview = CustomPreview(
    Geometry=draw,
    Material={diffuse=RGB(221, 160, 221), emission=RGB(66, 48, 66), shine=0.5, specular=RGB(255, 255, 255), transparency=0})
preview_2 = CustomPreview(
    Geometry=draw_2,
    Material={diffuse=RGB(221, 160, 221), emission=RGB(66, 48, 66), shine=0.5, specular=RGB(255, 255, 255), transparency=0})
vec_display = VecDisplay(num=30)
number_slider = Slider(3, range=0..3)
panel = Panel(stick_module_aggregation.sticks)
tstat = TreeStatistics(Tree=pln)  # -> simplify(Paths), Length, Count
item = ListItem(List=draw, Index=number_slider, Wrap=True)
item_2 = ListItem(List=tstat.Paths, Index=number_slider, Wrap=True)
item_3 = ListItem(List=pln_3, Index=Slider(1, range=0..3), Wrap=True)
branch = TreeBranch(Tree=pln, Path=item_2, MaintainPaths=True)
vec_display_2 = VecDisplay(pln=branch, num=30)

panel_2 = Panel("""18
16
17
19
12
13
14
15
8
11
10
9
4
6
7
5
0
2
3
1""")
item_4 = ListItem(List=draw_2, Index=panel_2, Wrap=True)
item_5 = ListItem(List=draw_2, Index=Slider(18, range=0..19), Wrap=True)
geo = Geometry(item_4)
item_6 = ListItem(List=geo, Index=Slider(17, range=0..19), Wrap=True)
geo_2 = Geometry(item_6)

item_7 = ListItem(List=stick_module_aggregation.sticks, Index=panel_2, Wrap=True)
item_8 = ListItem(List=stick_module_aggregation.sticks, Index=Slider(18, range=0..19), Wrap=True)
item_9 = ListItem(List=item_7, Index=Slider(0, range=0..19), Wrap=True)

# ---- group: working basement
bbox = BoundingBox(Content=geo, Plane=PlaneXY(0, 0, 0), UnionBox=True)  # -> Box, Box_2
number_slider_2 = Slider(400, range=0..1000)
debrep = DeconstructBrep(Brep=bbox.Box)  # -> Faces, Edges, Vertices
item_10 = ListItem(List=debrep.Faces, Index="4", Wrap=True)
neg = Negative(Value=Slider(450, range=0..1000))
neg_2 = Negative(Value=number_slider_2)
area = Area(Geometry=item_10)  # -> Area, Centroid
dom = ConstructDomain(DomainStart=neg_2, DomainEnd=number_slider_2)
dom_2 = ConstructDomain(DomainStart=neg, DomainEnd=Slider(0, range=0..100))
box = DomainBox(Base=area.Centroid, X=dom, Y=dom, Z=dom_2)
geo_working_basement = Geometry(box)
mesh = MeshBrep(
    Brep=geo_working_basement,
    Settings={GridMaxCount=0, GridMinCount=16, JaggedSeams=False, MaxEdgeLength=0, MinEdgeLength=0.0001, MinTolerance=0, Refine=True, RefineAngle=0, RelativeTolerance=0.65, SimplePlanes=True, Tolerance=0})

# ---- group: frame determination_3_specific rotation
py3 = Python3Script(sticks=item_7, save=Button())  # -> out, frames, assembly; inputs sticks: list, save: Boolean
# ---------- py3: Python ----------
from compas import json_dump
import os, sys
import math
import copy

from compas_rhino import unload_modules
from compas.geometry import (
    Line, Plane, Vector, Point, Frame, Box,
    Rotation, Translation,
    dot_vectors, centroid_points
)
from compas.datastructures import Assembly, Part
from compas_rhino.conversions import frame_to_rhino_plane


# -------------------------------------------------------------
# Setup Path and Import Stick Class
# -------------------------------------------------------------
path = ghenv.Component.OnPingDocument().FilePath
parentdir = os.path.dirname(path)
dire = os.path.join(parentdir, 'scripts')

sys.path.append(dire)
unload_modules("Sticks_Single_1")
from Sticks_Single_1 import Stick

json_path = os.path.join(parentdir, 'data', 'stick_assembly.json')


# -------------------------------------------------------------
# Helpers
# -------------------------------------------------------------
def is_parallel(v1, v2, tol=0.001):
    """Check if two vectors are parallel by dot product."""
    dot = dot_vectors(v1, v2)
    if math.isclose(dot, 1.0, abs_tol=tol) or math.isclose(dot, -1.0, abs_tol=tol):
        print("parallel")
        return True
    print("not parallel")
    return False


def get_frame_closest_to_target(target_vector, stick):
    """
    Rotate around stick.xaxis in 90° increments and find the frame
    whose Z axis most closely matches target_vector.
    """
    best_dot = -1000.0
    best_frame = stick.frame

    target = target_vector.unitized()

    for i in range(4):
        angle = (math.pi / 2) * i
        R = Rotation.from_axis_and_angle(stick.frame.xaxis, angle, stick.frame.point)
        candidate_frame = stick.frame.transformed(R)

        alignment = dot_vectors(candidate_frame.zaxis, target)
        if alignment > best_dot:
            best_dot = alignment
            best_frame = candidate_frame

    return best_frame


def get_center(sticks_list):
    """Compute geometric centroid from stick frame points."""
    return centroid_points([s.frame.point for s in sticks_list])


def get_lowest_point(sticks_list):
    """
    Compute the center point of the lowest face of the bounding box
    that encloses all stick frame points.

    Returns
    -------
    Point : center of the bottom face of the bounding box
    """
    # 1. 收集所有 frame 的點
    # pts = [s.frame.point for s in sticks_list]
    pts = []
    for s in sticks_list:
        pts.append(s.axis.start)
        pts.append(s.axis.end)


    if not pts:
        return None

    # 2. 建立整組 sticks 的 bounding box
    bbox = Box.from_points(pts)

    # 3. Box 的 faces 順序固定：0~5
    #    0 = bottom, 1 = top, 2/3/4/5 = side faces
    bottom_face = bbox.faces[0]

    # 4. 取得底面四個角點
    bottom_vertices = [bbox.vertices[i] for i in bottom_face]

    # 5. 算底面的中心（四角點幾何中心）
    bottom_center = centroid_points(bottom_vertices)

    return bottom_center



def move_to_gripper_position(stick, direction_vector=None, distance=30.0):
    """
    Move a stick along any direction vector by given distance.
    
    Parameters
    ----------
    stick : object with a .frame attribute
    direction_vector : Vector or list/tuple, optional
        Direction to move. If None, use local x-axis.
    distance : float
        Translation distance in mm.
    """
    # 如果沒有指定方向，就用 stick 的局部 x-axis
    if direction_vector is None:
        direction = stick.frame.xaxis.unitized()
    else:
        # 轉成 Vector 並 unitize
        direction = Vector(*direction_vector).unitized()

    # 計算位移向量
    move_vec = direction * distance

    # 產生平移變換
    T = Translation.from_vector(move_vec)

    # 套用到 frame
    stick.frame.transform(T)

    return stick.frame

def rotate_frame_direction(stick, angle):
    """
    Rotate the stick's frame around its local X-axis by angle degrees.
    """
    R = Rotation.from_axis_and_angle(stick.frame.xaxis, math.radians(angle), stick.frame.point)
    stick.frame.transform(R)
    return stick.frame


# -------------------------------------------------------------
# Apply frame adjustments to sticks
# -------------------------------------------------------------
sticks_copy = copy.deepcopy(sticks)
center_pt = get_center(sticks_copy)
print("Center:", center_pt)
lowest_pt = get_lowest_point(sticks_copy)
print("Lowest center:", lowest_pt)

up_vector = Vector(0, 0, 1)

for stick in sticks_copy:
    stick_dir = stick.axis.direction.unitized()

    # Case 1: Stick is vertical (parallel to Z)
    if is_parallel(stick_dir, up_vector):
        center_vector = Vector.from_start_end(stick.frame.point, center_pt)
        lowest_vector = Vector.from_start_end(stick.frame.point, lowest_pt)
        # stick.frame = get_frame_closest_to_target(center_vector, stick)
        stick.frame = get_frame_closest_to_target(lowest_vector, stick)

    # Case 2: Stick is non-vertical
    else:
        # Rotate so its Z axis becomes downward
        R = Rotation.from_axis_and_angle(stick.frame.xaxis, math.pi / 2, stick.frame.point)
        stick.frame.transform(R)

    # Move frame for robotic gripping
    move_to_gripper_position(stick, distance=30.0)


# Manual rotation based on index
rotate_90 = [1]                   # certain index: [1] = index 1
rotate_180 = [7, 8, 9, 12, 16]    # certain index

for i, rotated_stick in enumerate(sticks_copy):
    if i in rotate_90:
        rotate_frame_direction(rotated_stick, 90)

    elif i in rotate_180:
        rotate_frame_direction(rotated_stick, 180)

    else:
        # no rotation
        pass


# -------------------------------------------------------------
# Build Assembly
# -------------------------------------------------------------
assembly = Assembly()

for i, s in enumerate(sticks_copy):
    part = Part(name=f"stick{i}", frame=s.frame)
    part.key = i
    part.attributes["shape"] = s.geometry
    assembly.add_part(part)

frames = [frame_to_rhino_plane(p.frame) for p in assembly.parts()]


# -------------------------------------------------------------
# Save JSON
# -------------------------------------------------------------
if save:
    json_dump(assembly, fp=json_path, pretty=True)
# ---------- end py3 ----------
panel_3 = Panel(py3.frames)
panel_4 = Panel(py3.assembly)

# ----
item_11 = ListItem(List=py3.frames, Index=Slider(0, range=0..19), Wrap=True)

merge = Merge(Data1=simplify(graft(geo)), Data2=simplify(graft(py3.frames)))
tstat_2 = TreeStatistics(Tree=merge)  # -> Paths, Length, Count
item_12 = ListItem(List=tstat_2.Paths, Index=Slider(0, range=0..19), Wrap=True)
branch_2 = TreeBranch(Tree=merge, Path=item_12, MaintainPaths=True)

py3_2 = Python3Script(sticks=item_7, save=Button())  # -> out, frames, assembly; inputs sticks: list, save: Boolean
# ---------- py3_2: Python ----------
from compas import json_dump
import os, sys
import math
import copy

from compas_rhino import unload_modules
from compas.geometry import (
    Line, Plane, Vector, Point, Frame, Box,
    Rotation, Translation,
    dot_vectors, centroid_points
)
from compas.datastructures import Assembly, Part
from compas_rhino.conversions import frame_to_rhino_plane


# -------------------------------------------------------------
# Setup Path and Import Stick Class
# -------------------------------------------------------------
path = ghenv.Component.OnPingDocument().FilePath
parentdir = os.path.dirname(path)
dire = os.path.join(parentdir, 'scripts')

sys.path.append(dire)
unload_modules("Sticks_Single_1")
from Sticks_Single_1 import Stick

json_path = os.path.join(parentdir, 'data', 'stick_assembly.json')


# -------------------------------------------------------------
# Helpers
# -------------------------------------------------------------
def is_parallel(v1, v2, tol=0.001):
    dot = dot_vectors(v1, v2)
    if math.isclose(dot, 1.0, abs_tol=tol) or math.isclose(dot, -1.0, abs_tol=tol):
        print("parallel")
        return True
    print("not parallel")
    return False

def get_frame_closest_to_target(target_vector, stick):
    best_dot = -1000
    best_frame = stick.frame
    target = target_vector.unitized()

    for i in range(4):
        angle = (math.pi/2) * i
        R =Rotation.from_axis_and_angle(stick.frame.xaxis, angle, stick.frame.point)
        candidate_frame = stick.frame.transformed(R)

        alignment = dot_vectors(candidate_frame.zaxis, target)
        if alignment > best_dot:
            best_dot = alignment
            best_frame = candidate_frame
        
        return best_frame
    
def get_center(sticks_list):
    return centroid_points([s.frame.point for s in sticks_list])

def get_lowest_point(sticks_list):
    pts = [s.axis.start and s.axis.end for s in sticks_list]

    if not pts:
        return None
    
    bbox = Box.from_points(pts)
    bottom_face = bbox.faces[0]
    bottom_vertices = [bbox.vertices[i] for i in bottom_face]
    bottom_center = centroid_points(bottom_vertices)
    return bottom_center

def move_to_gripper_position(stick, direction_vector=None, distance=30.0):
    if direction_vector is None:
        direction = stick.frame.xaxis.unitized()
    else:
        direction = direction_vector.unitized()
    
    mov_vec = direction * distance
    T = Translation.from_vector(mov_vec)
    stick.frame.transform(T)

    return stick.frame

def rotate_frame_direction(stick, angle):
    R = Rotation.from_axis_and_angle(stick.frame.xaxis, math.radians(angle), stick.frame.point)
    stick.frame.transform(R)
    return stick.frame


sticks_copy = copy.deepcopy(sticks)
center_pt = get_center(sticks_copy)
print("Center:", center_pt)
lowest_pt = get_lowest_point(sticks_copy)
print("Lowest point:", lowest_pt)

up_vector = Vector(0,0,1)

for stick in sticks_copy:
    stick_dir = stick.axis.direction.unitized()

    if is_parallel(stick_dir, up_vector):
        center_vector = Vector.from_start_end(stick.frame.point, center_pt)
        lowest_vector = Vector.from_start_end(stick.frame.point, lowest_pt)
        stick.frame = get_frame_closest_to_target(center_vector, stick)
        # stick.frame = get_frame_closest_to_target(lowest_vector, stick)
    
    else:
        R = Rotation.from_axis_and_angle(stick.frame.xaxis, math.pi/2, stick.frame.point)
        stick.frame.transform(R)
    
    move_to_gripper_position(stick, distance=30.0)

rotate_90 = [1]
rotate_180 = [7,8,9,12,16]

for i, rotated_stick in enumerate(sticks_copy):
    if i in rotate_90:
        rotate_frame_direction(rotated_stick, 90)
    elif i in rotate_180:
        rotate_frame_direction(rotated_stick, 180)
    else:
        pass

assembly = Assembly()

for i, s in enumerate(sticks_copy):
    part = Part(name=f"stick{i}", frame=s.frame)
    part.key = i
    part.attributes["shape"] = s.geometry
    assembly.add_part(part)

if save:
    json_dump(assembly, fp=json_path, pretty=True)
# ---------- end py3_2 ----------

# ---- group: gripper visualize
pt_2 = Point(Point(-0.4729400358, 0, 140))
xy_2 = XYPlane(Origin=pt_2)
item_13 = ListItem(List=branch_2, Index="1", Wrap=True)
geo_gripper = Geometry([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])
orient = Orient(Geometry=geo_gripper, Source=xy_2, Target=item_13)  # -> Geometry, Transform
# Change TCP place as per measurement on the Robot!
preview_3 = CustomPreview(
    Geometry=[orient.Geometry, branch_2],
    Material={diffuse=RGB(221, 160, 221), emission=RGB(66, 48, 66), shine=0.5, specular=RGB(255, 255, 255), transparency=0})

# ----
# 1. Save your stick assembly in data folder in the parent directory (Example: 201_stick_assembly.ghx)
# 
# 2. Run Docker and connect with the ROS connect component
# 
# 3. Plan for any index and send to robot using the send components.
button = Button()  # disabled
compas_fab_ros_connect = COMPASFABROSConnect(connect=button)  # -> ros_client, is_connected; inputs ip: String, port: Int32, connect: Boolean; disabled
#   port ip: The ip address ROS. Defaults to 127.0.0.1.
#   port port: The port of ROS. Defaults to 9090.
#   port connect: If True, connects to ROS. If False, disconnects from ROS. Defaults to False.
#   port ros_client: The ROS client.
#   port is_connected: True if connection established.
# ---------- compas_fab_ros_connect: Python ----------
# r: compas_fab>=1.0.2
"""
Connect or disconnect to ROS.

COMPAS FAB v1.0.2
"""

import Grasshopper
from compas_ghpython import create_id
from scriptcontext import sticky as st

from compas_fab.backends import RosClient


class ROSConnect(Grasshopper.Kernel.GH_ScriptInstance):
    def RunScript(self, ip: str, port: int, connect: bool):
        ros_client = None

        ip = ip or "127.0.0.1"
        port = port or 9090

        key = create_id(ghenv.Component, "ros_client")  # noqa: F821

        if ros_client:
            st[key].close()
        if connect:
            st[key] = RosClient(ip, port)
            st[key].run(5)

        ros_client = st.get(key, None)
        is_connected = ros_client.is_connected if ros_client else False
        return (ros_client, is_connected)
# ---------- end compas_fab_ros_connect ----------
button_2 = Button()  # disabled
compas_fab_ros_robot = COMPASFABROSRobot(ros_client=compas_fab_ros_connect.ros_client, load=button_2)  # -> robot; inputs load: Boolean; disabled
#   port ros_client: The ROS client.
#   port load: If True, loads the robot from ROS. Defaults to False.
# ---------- compas_fab_ros_robot: Python ----------
# r: compas_fab>=1.0.2
"""
Load robot directly from ROS.

COMPAS FAB v1.0.2
"""

import Grasshopper
from compas_ghpython import create_id
from scriptcontext import sticky as st

from compas.scene import SceneObject


class ROSRobot(Grasshopper.Kernel.GH_ScriptInstance):
    def RunScript(self, ros_client, load: bool):
        key = create_id(ghenv.Component, "robot")  # noqa: F821

        if ros_client and ros_client.is_connected and load:
            # Load URDF from ROS
            st[key] = ros_client.load_robot(load_geometry=True, precision=12)
            st[key].scene_object = SceneObject(item=st[key].model)

        robot = st.get(key, None)

        if robot:  # client sometimes need to be restarted, without needing to reload geometry
            robot.client = ros_client
        return robot
# ---------- end compas_fab_ros_robot ----------
panel_5 = Panel(compas_fab_ros_connect.is_connected)  # disabled
panel_6 = Panel(compas_fab_ros_robot)  # disabled

pln_4 = Plane(Plane(origin=(0.0002624128792, -0.0005468049385, 0.1434769231), x=(0.7071067812, 0.7071067812, 0), y=(-0.7071067812, 0.7071067812, 0)))  # disabled
mesh_2 = Mesh(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)  # disabled

plane = Plane(Plane(origin=(0.00175, 0.00129, 0.1532), x=(0.7071067812, 0.7071067812, 0), y=(-0.7071067812, 0.7071067812, 0)))  # disabled
mesh_3 = Mesh(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)  # disabled
compas_fab_attached_tool = COMPASFABAttachedTool(robot=compas_fab_ros_robot, visual_mesh=mesh_2, collision_mesh=mesh_2, tcf_plane=pln_4)  # -> robot; inputs visual_mesh: Mesh, collision_mesh: Mesh; disabled
#   port visual_mesh: A visual mesh for the tool.
#   port collision_mesh: A collision mesh for the tool.
#   port tcf_plane: The frame of the tool in tool0 frame.
#   port group: The planning group to which the tool should be attached.
#   port connected_to: The link to which the tool should be connected to.
# ---------- compas_fab_attached_tool: Python ----------
# r: compas_fab>=1.0.2
"""
Attach a tool to the robot.

COMPAS FAB v1.0.2
"""

import Grasshopper
import Rhino
from compas.geometry import Frame
from compas_rhino.conversions import mesh_to_compas
from compas_rhino.conversions import plane_to_compas_frame

from compas_fab.robots import Tool


class AttachToolComponent(Grasshopper.Kernel.GH_ScriptInstance):
    def RunScript(self,
            robot,
            visual_mesh: Rhino.Geometry.Mesh,
            collision_mesh: Rhino.Geometry.Mesh,
            tcf_plane,
            group,
            connected_to):
        if robot and robot.client and robot.client.is_connected and visual_mesh:
            if not collision_mesh:
                collision_mesh = visual_mesh

            c_visual_mesh = mesh_to_compas(visual_mesh)
            c_collision_mesh = mesh_to_compas(collision_mesh)

            if not tcf_plane:
                frame = Frame.worldXY()
            else:
                frame = plane_to_compas_frame(tcf_plane)
            tool = Tool(c_visual_mesh, frame, c_collision_mesh, connected_to=connected_to)

            robot.attach_tool(tool, group)

        return robot
# ---------- end compas_fab_attached_tool ----------
compas_fab_planning_scene = COMPASFABPlanningScene(robot=compas_fab_ros_robot)  # -> scene; disabled
#   port scene: A planning scene.
# ---------- compas_fab_planning_scene: Python ----------
# r: compas_fab>=1.0.2
"""
Create a planning scene.

COMPAS FAB v1.0.2
"""

import Grasshopper
from compas_ghpython import create_id
from scriptcontext import sticky as st

from compas_fab.robots import PlanningScene


class PlanningSceneComponent(Grasshopper.Kernel.GH_ScriptInstance):
    def RunScript(self, robot):
        key = create_id(ghenv.Component, "planning_scene")  # noqa: F821
        if robot:
            st[key] = PlanningScene(robot)
        return st.get(key, None)
# ---------- end compas_fab_planning_scene ----------
mesh_4 = Mesh(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)  # disabled
index = ControlKnob(Decimals=0, Limit=False, Maximum=10, Minimum=0, Range=100, Value=15)  # disabled
button_3 = Button()  # disabled
button_4 = Button()  # disabled
button_5 = Button()  # disabled
python_3_script = Python3Script(
    scene=compas_fab_planning_scene,
    robot=compas_fab_attached_tool,
    load=button_3,
    compute=button_4,
    index=index,
    env=mesh_4,
    reset=button_5)  # -> out, all_sticks, sticks, results, results_list, pick_traj, place_traj, exit_traj, joined_trajectory; inputs index: Int32, env: Mesh; disabled
# ---------- python_3_script: Python ----------
from compas.datastructures import Assembly, Mesh
from compas.geometry import Frame, Point, Translation, Transformation
from compas_fab.backends import RosClient
from compas_fab.robots import Tool, PlanningScene, CollisionMesh
import os, sys
import math

import traceback

import compas
from compas.data import json_load
from compas_robots import Configuration

compas.PRECISION = "12f"

# Constants
APPROACH_DISTANCE = 0.015  # Meters
group = None
start_configuration = None

# Specify the path to the assembly file and the path to the output file
path = ghenv.Component.OnPingDocument().FilePath
parentdir = os.path.dirname(path)
dire = os.path.join(parentdir, "scripts")
sys.path.append(dire)

json_path = os.path.join(parentdir, "data", "stick_assembly.json")
write_path = os.path.join(parentdir, "data", "stick_assembly_with_trajectories.json")

# Import helpers
from compas_rhino import unload_modules
unload_modules("helpers")


from compas_rhino.conversions import mesh_to_compas
from helpers import scale_and_move_to_point, generate_default_tolerances, calculate_pick_trajectory, calculate_place_trajectories
from scriptcontext import sticky

if "last_status" not in sticky or sticky["last_status"] is None:
    sticky["last_status"] = "Idle"

if "geometry" not in sticky or sticky["geometry"] is None:
    pass

SAFE_CONFIG = Configuration.from_revolute_values([math.radians(68.80), 
                                        math.radians(-70.55), 
                                        math.radians(-116.42), 
                                        math.radians(-83.80), 
                                        math.radians(98.73), 
                                        math.radians(56.93)])

if 'load' in globals() and load:
    scene.reset()
    tcm = CollisionMesh(mesh_to_compas(env), id = "table")
    scene.add_collision_mesh(tcm)
    assembly = json_load(json_path)
    scaled_assembly = scale_and_move_to_point(assembly, Point(-0.500, -0.210, 0.010))
    sticky["assembly"] = scaled_assembly
    sticky["last_status"] = "Assembly loaded"
else:
    assembly = sticky.get("assembly", [])
    if assembly:
        part = assembly.find_by_key(index)
        all_sticks = [p.attributes.get("shape", None) for p in assembly.parts()]
        sticky["geometry"] = part.attributes.get("shape", None)



if 'compute' in globals() and compute and 'index' in globals():
    results = sticky.get("results", {})
    try:
        part = assembly.find_by_key(index)
        safe_frame = part.attributes.get("safe_frame", None)
        place_frame = part.frame
        

        tolerances = generate_default_tolerances(robot.get_configurable_joints(robot.main_group_name))

        # Set pick frame
        pick_frame = Frame([0.5,0.5,0.1], [0,1,0], [1,0,0])

        pick_traj, pick_config, approach_config = calculate_pick_trajectory(pick_frame, robot, start_config = SAFE_CONFIG)

        # Calculate place trajectories (safe, place, return)
        place_results = None

        place_results, exit_trajectory = calculate_place_trajectories(
            robot,
            current_config = SAFE_CONFIG,
            placement_frame = place_frame,
            group=robot.main_group_name
        )

        results[str(index)] = {
            "pick_frame": pick_frame,
            "frame": place_frame,
            "pick_trajectory": pick_traj,
            "approach_config": pick_config,
            "place_trajectory": place_results,
            "exit_trajectory": exit_trajectory
        }
        sticky["results"] = results
        print(f"Computed trajectory for frame {index}")

        cm = CollisionMesh(Mesh.from_shape(part.attributes["shape"]), id = "part%d" % index)
        scene.append_collision_mesh(cm)
        sticky["last_status"] = f"Computed: {index}"

    except Exception as e:
        print("Failed for frame {}: {}".format(index, e))
        print(traceback.format_exc())
        sticky["last_status"] = "Error: {}".format(str(e))

results = sticky.get("results", None)
results_list = [results]
if results is not None and str(index) in results.keys():
    sticky["last_status"] = f"{index:.0f} is computed"
    pick_traj = results[str(index)]["pick_trajectory"]
    place_traj = results[str(index)]["place_trajectory"]
    exit_traj = results[str(index)]["exit_trajectory"]
    joined_trajectory = pick_traj.copy()
    joined_trajectory.points.extend(place_traj.points)
    joined_trajectory.points.extend(exit_traj.points)


assembly = sticky.get("assembly", None)


ghenv.Component.Message = sticky["last_status"][:35]
print(sticky["last_status"])
sticks = sticky.get("geometry", None)

if reset:
    sticky["assembly"] = None
    sticky["geometry"] = None
    sticky["results"] = {}
# ---------- end python_3_script ----------
compas_draw = COMPASDraw(cg=python_3_script.all_sticks)  # -> rg; disabled; same code as draw
compas_draw_2 = COMPASDraw(cg=python_3_script.sticks)  # -> rg; disabled; same code as draw
number_slider_3 = Slider(9, range=0..100)  # disabled
compas_fab_trajectory_visualize = COMPASFABTrajectoryVisualize(robot=compas_fab_attached_tool, trajectory=python_3_script.joined_trajectory)  # -> start_configuration, configurations, fraction, time, planes, P, V, A; inputs group: String; disabled
#   port group: The planning group for which this trajectory was planned.
#   port trajectory: The calculated trajectory.
#   port start_configuration: The start configuration of the trajectory.
#   port configurations: The full configurations along the trajectory.
#   port fraction: Indicates the fraction of requested trajectory that was calculated, e.g. 1 means the full trajectory was found.
#   port time: The time which is needed to execute that trajectory at full speed.
#   port planes: The planes of the robot's end-effector.
#   port P: The positions along the trajectory
#   port V: The velocities along the trajectory
#   port A: The accelerations along the trajectory
# ---------- compas_fab_trajectory_visualize: Python ----------
# r: compas_fab>=1.0.2
"""
Visualizes a trajectory.

COMPAS FAB v1.0.2
"""

import Grasshopper
from compas_ghpython.drawing import draw_frame
from compas_ghpython.sets import list_to_ghtree


class TrajectoryVisualize(Grasshopper.Kernel.GH_ScriptInstance):
    def RunScript(self, robot, group: str, trajectory):
        start_configuration = None
        configurations = []
        fraction = 0.0
        time = 0.0

        planes = []
        positions = []
        velocities = []
        accelerations = []

        if robot and trajectory:
            group = group or robot.main_group_name

            for c in trajectory.points:
                configurations.append(
                    robot.merge_group_with_full_configuration(c, trajectory.start_configuration, group)
                )
                frame = robot.forward_kinematics(c, group, options=dict(solver="model"))
                planes.append(draw_frame(frame))
                positions.append(c.positions)
                velocities.append(c.velocities)
                accelerations.append(c.accelerations)

            start_configuration = trajectory.start_configuration
            fraction = trajectory.fraction
            time = trajectory.time_from_start

        P = list_to_ghtree(list(zip(*positions)))
        V = list_to_ghtree(list(zip(*velocities)))
        A = list_to_ghtree(list(zip(*accelerations)))

        # return outputs if you have them; here I try it for you:
        return (start_configuration, configurations, fraction, time, planes, P, V, A)
# ---------- end compas_fab_trajectory_visualize ----------
panel_7 = Panel(python_3_script.out)  # disabled
list_item = ListItem(List=compas_fab_trajectory_visualize.configurations, Index=number_slider_3, Wrap=invert(True))  # disabled
boolean_toggle = BooleanToggle(False)  # disabled
boolean_toggle_2 = BooleanToggle(True)  # disabled
compas_fab_robot_visualize = COMPASFABRobotVisualize(robot=compas_fab_attached_tool, configuration=list_item, show_visual=boolean_toggle, show_collision=boolean_toggle_2)  # -> visual, collision, collision_meshes, attached_meshes, frames, base_frame, ee_frame; inputs group: String, show_visual: Boolean, show_collision: Boolean, show_frames: Boolean, show_base_frame: Boolean, show_end_effector_frame: Boolean, show_cm: Boolean, show_acm: Boolean; disabled
#   port group: The planning group used for end-effector and base visualization.
#   port configuration: The robot's full configuration.
#   port show_visual: Whether or not to show the robot's visual meshes.
#   port show_collision: Whether or not to show the robot's collision meshes.
#   port show_frames: Whether or not to show the robot's joint frames.
#   port show_base_frame: Whether or not to show the robot's base frame.
#   port show_end_effector_frame: Whether or not to show the robot's end-effector frame.
#   port show_cm: Whether or not to show the collision meshes (if any).
#   port show_acm: Whether or not to show the attached collision meshes (if any).
#   port visual: Rhino meshes of the robot's visual geometry (if any).
#   port collision: Rhino meshes of the robot's collision geometry (if any).
#   port collision_meshes: Rhino meshes of the scene's collision meshes (if any).
#   port attached_meshes: Rhino meshes of the scene's attached collision meshes (if any).
#   port frames: The robot's joint frames as Rhino planes (if any).
#   port base_frame: The robot's base frame as a Rhino plane (if any).
#   port ee_frame: The robot's end-effector frame as a Rhino plane (if any).
# ---------- compas_fab_robot_visualize: Python ----------
# r: compas_fab>=1.0.2
"""
Visualizes the robot.

COMPAS FAB v1.0.2
"""

import time

import Grasshopper
from compas_ghpython import create_id
from compas_rhino.conversions import frame_to_rhino_plane
from scriptcontext import sticky as st

from compas.geometry import Frame
from compas.geometry import Transformation
from compas.scene import SceneObject
from compas_fab.backends import BackendFeatureNotSupportedError
from compas_fab.robots import PlanningScene


class RobotVisualize(Grasshopper.Kernel.GH_ScriptInstance):
    def RunScript(self,
            robot,
            group: str,
            configuration,
            show_visual: bool,
            show_collision: bool,
            show_frames: bool,
            show_base_frame: bool,
            show_end_effector_frame: bool,
            show_cm: bool,
            show_acm: bool):
        visual = None
        collision = None
        collision_meshes = None
        attached_meshes = None
        frames = None
        base_frame = None
        ee_frame = None

        if robot:
            show_visual = True if show_visual is None else show_visual
            show_cm = True if show_cm is None else show_cm
            show_acm = True if show_acm is None else show_acm
            configuration = configuration or robot.zero_configuration()

            robot.update(configuration, visual=show_visual, collision=show_collision)
            compas_frames = robot.transformed_frames(configuration, group)

            if show_visual:
                visual = robot.scene_object.draw_visual()

            if show_collision:
                collision = robot.scene_object.draw_collision()

            if show_base_frame:
                base_compas_frame = compas_frames[0]
                base_frame = frame_to_rhino_plane(base_compas_frame)

            if show_end_effector_frame:
                options = dict(solver="model")
                if robot.attached_tool:
                    options["link"] = robot.attached_tool.connected_to

                ee_compas_frame = robot.forward_kinematics(configuration, group, options=options)
                ee_frame = frame_to_rhino_plane(ee_compas_frame)

            if show_frames:
                frames = []
                for compas_frame in compas_frames[1:]:
                    frame = frame_to_rhino_plane(compas_frame)
                    frames.append(frame)

            cached_scene_key = create_id(ghenv.Component, "cached_scene")  # noqa: F821

            if show_cm or show_acm:
                cached_scene = st.get(cached_scene_key)
                if not cached_scene:
                    cached_scene = {"time": 0}

                # expire cache if the component has not been executed in the last 2 seconds
                # this allows to slide through a list of configurations
                # without triggering refreshes of the scene in the middle of it
                if time.time() - cached_scene["time"] > 2:
                    update_scene = True
                else:
                    update_scene = False

                if update_scene:
                    scene = PlanningScene(robot)
                    try:
                        scene = robot.client.get_planning_scene()
                    except BackendFeatureNotSupportedError:
                        print(
                            "The selected backend does not support collision meshes. If you need collision mesh support, use a different backend."
                        )
                        scene = None
                        show_cm = False
                        show_acm = False

                if update_scene and show_cm:
                    collision_meshes = []

                    for co in scene.world.collision_objects:
                        header = co.header
                        frame_id = header.frame_id
                        cms = co.to_collision_meshes()

                        for cm in cms:
                            if cm.frame != Frame.worldXY():
                                t = Transformation.from_frame(cm.frame)
                                mesh = cm.mesh.transformed(t)
                            else:
                                mesh = cm.mesh

                            collision_meshes.extend(SceneObject(item=mesh).draw())

                        cached_scene["cm"] = collision_meshes

                collision_meshes = cached_scene.get("cm", [])

                if update_scene and show_acm:
                    attached_meshes = []

                    for aco in scene.robot_state.attached_collision_objects:
                        for acm in aco.to_attached_collision_meshes():
                            frame_id = aco.object["header"]["frame_id"]
                            frame = robot.forward_kinematics(configuration, options=dict(link=frame_id))
                            t = Transformation.from_frame(frame)

                            # Local CM frame
                            if acm.collision_mesh.frame and acm.collision_mesh.frame != Frame.worldXY():
                                t = t * Transformation.from_frame(acm.collision_mesh.frame)

                            mesh = acm.collision_mesh.mesh.transformed(t)

                            attached_meshes.extend(SceneObject(item=mesh).draw())

                    cached_scene["acm"] = attached_meshes

                attached_meshes = cached_scene.get("acm", [])

                cached_scene["time"] = time.time()
                st[cached_scene_key] = cached_scene

        return (
            visual,
            collision,
            collision_meshes,
            attached_meshes,
            frames,
            base_frame,
            ee_frame,
        )
# ---------- end compas_fab_robot_visualize ----------

python_3_script_2 = Python3Script(index=index, tcp=pln_4, results=python_3_script.results_list)  # -> out, script; inputs index: Int32, tcp: Plane, results: list; disabled
# ---------- python_3_script_2: Python ----------
from imp import reload
import sys
import os

# get current file path
path = ghenv.Component.OnPingDocument().FilePath
parentdir = os.path.dirname(path)
dire = os.path.join(parentdir, 'scripts')

sys.path.append(dire)

import simple_ur_script as ur
reload(ur)

import utils
reload(utils)

import simple_comm as com
reload(com)

import compas.geometry as cg
import math as m

from compas_rhino.conversions import plane_to_compas_frame

# ---------- GLOBALS ----------
IO_OPEN = 0     # open gripper
IO_CLOSE = 1    # close gripper
# -----------------------------


# ============================================================
# Trajectory → URScript
# ============================================================

def send_joint_trajectory(script, trajectory):
    """Append URScript moveJ motions for all trajectory points."""
    for point in trajectory.points[:-1]:
        q = point.positions
        script += ur.move_j(list(q), accel=0.25, vel=0.5, radius = 0.05)
    return script


def send_cartesian_frame(script, frame, speed=0.05):
    """Append URScript moveL to a Cartesian Frame."""
    frm = frame.copy()
    script += ur.move_l(frm, accel=0.1, vel=speed)
    return script


# ============================================================
# PICKUP
# ============================================================

def pickup_stick(script, pick_traj, pick_fr):
    """
    1. Follow approach & pick trajectory
    2. Move to pick frame
    3. Close gripper
    """
    script = send_joint_trajectory(script, pick_traj)
    script = send_cartesian_frame(script, pick_fr, speed=0.05)
    script += ur.set_digital_out(IO_CLOSE, True)  # close
    script += ur.sleep(0.5)
    script += ur.textmsg("picked")
    return script


# ============================================================
# PLACE
# ============================================================

def place_stick(script, place_traj, place_fr):
    """
    1. Follow place trajectory
    2. Move to place frame
    3. Open gripper
    """
    place = place_fr.copy()
    place.point.x = -place_fr.point.x
    place.point.y = -place_fr.point.y
    script = send_joint_trajectory(script, place_traj)
    script = send_cartesian_frame(script, place, speed=0.05)
    # Popup to check if glue is set
    script += ur.popup("is it done yet?", "hello")
    script += ur.set_digital_out(IO_CLOSE, False)  # open
    script += ur.sleep(0.5)
    script += ur.textmsg("placed")
    return script


# ============================================================
# MAIN PIPELINE
# ============================================================

results = results[0]
print(results)

pick_frame = results[str(index)]["pick_frame"]
place_frame = results[str(index)]["frame"]
pick_trajectory = results[str(index)]["pick_trajectory"]
place_trajectory = results[str(index)]["place_trajectory"]
exit_trajectory = results[str(index)]["exit_trajectory"]

script = ""

# Set TCP
script = ur.set_tcp_by_frame(plane_to_compas_frame(tcp))
# Pickup
script = pickup_stick(script, pick_trajectory, pick_frame)
# Place
script = place_stick(script, place_trajectory, place_frame)

# Exit
script = send_joint_trajectory(script, exit_trajectory)


# finalize
script = com.concatenate_script(script)
# ---------- end python_3_script_2 ----------
panel_8 = Panel(python_3_script_2.script)  # disabled
panel_9 = Panel("192.168.10.10")  # disabled
button_6 = Button()  # disabled
py3_3 = Python3Script(script=python_3_script_2.script, ip_address=panel_9, send=button_6)  # -> out, a; inputs script: String, ip_address: String, send: Boolean; disabled
# ---------- py3_3: Python ----------
import simple_comm as com

if send:
    com.send_script(script,ip_address)
# ---------- end py3_3 ----------

# ==== cluster VecDisplay
pln = ClusterInput()
num = ClusterInput()
pln_2 = Plane(graft(pln))
num_2 = Number(num)
deplane = DeconstructPlane(Plane=pln_2)  # -> flatten(Origin), XAxis, YAxis, ZAxis
entwine = Entwine(Branch00=deplane.XAxis, Branch01=deplane.YAxis, Branch02=deplane.ZAxis, FlattenInputs=True)
merge = Merge(
    Data1=ColourSwatch(SwatchColor=RGB(255, 0, 0)),
    Data2=ColourSwatch(SwatchColor=RGB(0, 255, 0)),
    Data3=ColourSwatch(SwatchColor=RGB(0, 0, 255)))  # -> graft(Result)
multiplication = Multiplication(A=entwine, B=num_2)
vdisex = VectorDisplayEx(Point=deplane.Origin, Vector=multiplication, Colour=merge, Width=2)
