# Grasshopper definition agg.gh (Grasshopper 1.0.8)

# ---- group: stick_branch_module
pt = ConstructPoint(XCoordinate=0, YCoordinate=0, ZCoordinate=0)
xy = XYPlane(Origin=pt)
xz = XZPlane(Origin=Point(0, 0, 0))
rotate = Rotate(Geometry=xy, Angle=degrees(Slider(90, range=0..180)), Plane=xz)  # -> Geometry, Transform
number_slider = Slider(25, range=0..100)
yz = YZPlane(Origin=Point(0, 0, 0))
neg = Negative(Value=Slider(0, range=0..100))
rotate_2 = Rotate(Geometry=rotate.Geometry, Angle=degrees(neg), Plane=yz)  # -> Geometry, Transform
pln = Plane(rotate_2.Geometry)

xy_plane = XYPlane(Origin=Point(0, 0, 0))
stick_branch_module = Python3Script(root=xy_plane)  # -> out, geometries, frames
# ---------- stick_branch_module: Python ----------
# r: compas>=2.14.1
# venv: sticks

import sys
import os
import math

#get current file path
path = ghenv.Component.OnPingDocument().FilePath
print (path)
#get parent directory of the parent directory
parentdir = os.path.dirname(path)
print (parentdir)
#get src folder which contains classes
dire = os.path.join(parentdir,'scripts')
print (dire)

sys.path.append(dire)

from compas_rhino import unload_modules

unload_modules("Sticks")
unload_modules("stick_module")

# import Sticks
# from Sticks import Stick
import Sticks_Jerry_v1
from Sticks_Jerry_v1 import Stick  
from stick_module_3 import TiltedModule
from compas.geometry import Line, Point, Vector, Frame
from compas_rhino.conversions import plane_to_compas_frame, frame_to_rhino_plane

stick_width = 13.0
stick_depth = 13.0

# Convert input to compas
root = plane_to_compas_frame(root)

# Initialize tree
tree = TiltedModule(root_frame = root, root_angle = -25, stick_d_length = 235, stick_u_length = 263, width = stick_width, depth = stick_depth)

# Grow tree
tree.grow_stick(face_index = 2, angle = 27)

# mirror sticks
tree.mirror_stick(113)

# Visualize
geometries = tree.visualize()
frames = [stick.frame for stick in tree.sticks]
# ---------- end stick_branch_module ----------
draw = COMPASDraw(cg=stick_branch_module.frames)  # -> rg
#   port cg: The COMPAS geometry or datastructure to be drawn.
#   port rg: The Rhino geometry object.
# ---------- draw: Python ----------
# r: compas>=2.14.1
"""
Draws COMPAS geometry in Grasshopper.
"""

from typing import Any

import Grasshopper

from compas.scene import SceneObject


class CompasToRhinoGeometry(Grasshopper.Kernel.GH_ScriptInstance):
    def RunScript(self, cg):
        if not cg:
            return None

        return SceneObject(item=cg).draw()
# ---------- end draw ----------
draw_2 = COMPASDraw(cg=stick_branch_module.geometries)  # -> rg; same code as draw

xy_plane_2 = XYPlane(Origin=Point(0, 0, 0))
stick_branch_module_2 = Python3Script(root=xy_plane_2)  # -> out, geometries, frames; same code as stick_branch_module
draw_3 = COMPASDraw(cg=stick_branch_module_2.frames)  # -> rg; same code as draw
draw_4 = COMPASDraw(cg=stick_branch_module_2.geometries)  # -> rg; same code as draw

# ---- group: stick_module_aggregation
number_slider_2 = Slider(2, range=0..10)  # disabled
number_slider_3 = Slider(0, range=0..10)  # disabled
number_slider_4 = Slider(3, range=0..10)  # disabled
number_slider_5 = Slider(3, range=0..10)  # disabled
number_slider_6 = Slider(0.125, range=0..1)  # disabled
number_slider_7 = Slider(30, range=0..180)  # disabled
number_slider_8 = Slider(0.275, range=0..1)  # disabled
xy_plane_3 = XYPlane(Origin=Point(0, 0, 0))  # disabled
stick_module_aggregation = Python3Script(
    base_plane=pln,
    agg_times=number_slider_5,
    angle=number_slider_7,
    ref_stick_index=number_slider_2,
    from_face_index=number_slider_3,
    to_face_index=number_slider_4,
    from_t=number_slider_6,
    to_t=number_slider_8)  # -> out, module_out, geo, module_frame_out; inputs agg_times: Int32, angle: Double, ref_stick_index: Int32, from_face_index: Int32, to_face_index: Int32, from_t: Double, to_t: Double; disabled
# ---------- stick_module_aggregation: Python ----------
# r: compas>=2.14.1
# venv: sticks

import sys
import os
import math

#get current file path
path = ghenv.Component.OnPingDocument().FilePath
print (path)
#get parent directory of the parent directory
parentdir = os.path.dirname(path)
print (parentdir)
#get src folder which contains classes
dire = os.path.join(parentdir,'scripts')
print (dire)

sys.path.append(dire)

from compas_rhino import unload_modules

unload_modules("Sticks_Single_1")
unload_modules("Sticks_Multiple_1")
unload_modules("Sticks_Aggregation_1")

from Sticks_Single_1 import Stick  
from Sticks_Multiple_1 import TiltedModule
from Sticks_Aggregation_1 import ModuleAggregation
from compas.geometry import Line, Point, Vector, Frame
from compas_rhino.conversions import plane_to_compas_frame, frame_to_rhino_plane

stick_width = 13.0
stick_depth = 13.0

# Convert input to compas
base_frame = plane_to_compas_frame(base_plane)

# Initialize tree
module_unit = TiltedModule(base_frame = base_frame, root_angle = -25, stick_d_length = 235, stick_u_length = 263, width = stick_width, depth = stick_depth)

# Grow tree
module_unit.grow_stick(face_index = 2, angle = 27)

# symmetrica sticks
module_unit.symmetrical_stick(m_distanece = 56.5)

# Visualize
module_out = module_unit.visualize()
module_frame_out = [stick.frame for stick in module_unit.sticks]

# Aggregation
# 1. build first module
module_agg = module_unit
# print("first module stick count =", len(module_agg.sticks))

# 2. build ModuleAggregation
agg = ModuleAggregation(first_module=module_agg)

# 3. generate the next module（用上一組第2根，取面1的 t=0.5、面2 的 t=0.75）
agg.compute_next_module(ref_stick_index=2,
                        from_face_index=1, from_t=0.5,
                        to_face_index=2,   to_t=0.75,
                        angle=35,
                        stick_length=235)

# 4. output geometry
geo = agg.visualize()
# ---------- end stick_module_aggregation ----------
draw_5 = COMPASDraw(cg=stick_module_aggregation.module_frame_out)  # -> rg; disabled; same code as draw
draw_6 = COMPASDraw(cg=stick_module_aggregation.module_out)  # -> rg; disabled; same code as draw
draw_7 = COMPASDraw(cg=stick_module_aggregation.geo)  # -> rg; disabled; same code as draw
vec_display = VecDisplay(pln=draw_5, num=30)  # disabled

# ---- group: stick_branch_module
stick_branch_module_3 = Python3Script(base_plane=pln)  # -> out, module_out, module_frame_out
# ---------- stick_branch_module_3: Python ----------
# r: compas>=2.14.1
# venv: sticks

import sys
import os
import math

#get current file path
path = ghenv.Component.OnPingDocument().FilePath
print (path)
#get parent directory of the parent directory
parentdir = os.path.dirname(path)
print (parentdir)
#get src folder which contains classes
dire = os.path.join(parentdir,'scripts')
print (dire)

sys.path.append(dire)

from compas_rhino import unload_modules

unload_modules("Sticks_Single_1")
unload_modules("Sticks_Multiple_1")

from Sticks_Single_1 import Stick  
from Sticks_Multiple_1 import TiltedModule
from compas.geometry import Line, Point, Vector, Frame
from compas_rhino.conversions import plane_to_compas_frame, frame_to_rhino_plane

stick_width = 13.0
stick_depth = 13.0

# Convert input to compas
base_frame = plane_to_compas_frame(base_plane)

# Initialize tree
# module = TiltedModule(base_frame = base_frame, root_angle = -25, stick_d_length = 235, stick_u_length = 263, width = stick_width, depth = stick_depth)
module = TiltedModule(base_frame = base_frame, root_angle = 0, stick_d_length = 235, stick_u_length = 263, width = stick_width, depth = stick_depth)

# Grow tree
module.grow_stick(face_index = 2, angle = 27)

# symmetrical sticks
module.symmetrical_stick(m_distanece = 56.5)

# Visualize
module_out = module.visualize()
module_frame_out = [stick.frame for stick in module.sticks]
# ---------- end stick_branch_module_3 ----------
draw_8 = COMPASDraw(cg=stick_branch_module_3.module_frame_out)  # -> rg; same code as draw
draw_9 = COMPASDraw(cg=stick_branch_module_3.module_out)  # -> rg; same code as draw
vec_display_2 = VecDisplay(pln=draw_8, num=30)

# ----
item = ListItem(List=stick_branch_module_3.module_frame_out, Index=Slider(2, range=0..10), Wrap=True)
py3 = Python3Script(frames=item, factor=Slider(30, range=0..100))  # -> out, points, x_vectors, y_vectors, normal; inputs frames: list, factor: Double
# ---------- py3: Python ----------
from compas.geometry import Vector
from compas.geometry import cross_vectors
from compas_rhino.conversions import vector_to_rhino
from compas_rhino.conversions import point_to_rhino

points = []
x_vectors = []
y_vectors = []
normal = []

for frame in frames:
    points.append(point_to_rhino(frame.point))
    x_vectors.append(vector_to_rhino(frame.xaxis * factor))
    y_vectors.append(vector_to_rhino(frame.yaxis * factor))
    normal.append(vector_to_rhino(frame.normal * factor))
# ---------- end py3 ----------
xaxis = VectorDisplayEx(Point=py3.points, Vector=py3.x_vectors, Colour=ColourSwatch(SwatchColor=RGB(255, 0, 0)), Width=2)
yaxis = VectorDisplayEx(Point=py3.points, Vector=py3.y_vectors, Colour=ColourSwatch(SwatchColor=RGB(0, 255, 21)), Width=2)
zaxis = VectorDisplayEx(Point=py3.points, Vector=py3.normal, Colour=ColourSwatch(SwatchColor=RGB(0, 30, 255)), Width=2)

preview = CustomPreview(
    Geometry=draw_9,
    Material={diffuse=RGB(221, 160, 221), emission=RGB(66, 48, 66), shine=0.5, specular=RGB(255, 255, 255), transparency=0})
series = Series(Start=0, Step=1, Count=Slider(2, range=0..10))

# ---- group: stick_module_aggregation
pt_2 = ConstructPoint(XCoordinate=0, YCoordinate=0, ZCoordinate=0)
xy_2 = XYPlane(Origin=pt_2)
xz_2 = XZPlane(Origin=Point(0, 0, 0))
rot3d = Rotate3D(Geometry=xy_2, Angle=degrees(Slider(90, range=0..100)), Center=Point(0, 0, 0), Axis=xz_2)  # -> Geometry, Transform

stick_module_aggregation_2 = Python3Script(
    base_plane=rot3d.Geometry,
    agg_times=Slider(3, range=0..10),
    angle=Slider(30, range=0..180),
    ref_stick_index=Slider(2, range=0..10),
    from_face_index=Slider(0, range=0..10),
    to_face_index=Slider(3, range=0..10),
    from_t=Slider(0.125, range=0..1),
    to_t=Slider(0.275, range=0..1))  # -> out, module_out, geo, module_frame_out; inputs agg_times: Int32, angle: Double, ref_stick_index: Int32, from_face_index: Int32, to_face_index: Int32, from_t: Double, to_t: Double
# ---------- stick_module_aggregation_2: Python ----------
# r: compas>=2.14.1
# venv: sticks

import sys
import os
import math

#get current file path
path = ghenv.Component.OnPingDocument().FilePath
print (path)
#get parent directory of the parent directory
parentdir = os.path.dirname(path)
print (parentdir)
#get src folder which contains classes
dire = os.path.join(parentdir,'scripts')
print (dire)

sys.path.append(dire)

from compas_rhino import unload_modules

unload_modules("Sticks_Single_1")
unload_modules("Sticks_Multiple_1")
unload_modules("Sticks_Aggregation_1")

from Sticks_Single_1 import Stick  
from Sticks_Multiple_1 import TiltedModule
from Sticks_Aggregation_1 import ModuleAggregation
from compas.geometry import Line, Point, Vector, Frame
from compas_rhino.conversions import plane_to_compas_frame, frame_to_rhino_plane

stick_width = 13.0
stick_depth = 13.0
stick_d_length = 235
stick_u_length = 263

# Convert input to compas
base_frame = plane_to_compas_frame(base_plane)

# Initialize tree
# module_unit = TiltedModule(base_frame = base_frame, root_angle = -25, stick_d_length = 235, stick_u_length = 263, width = stick_width, depth = stick_depth)
module_unit = TiltedModule(base_frame = base_frame, root_angle = 25, stick_d_length = 235, stick_u_length = 263, width = stick_width, depth = stick_depth)

# Grow tree
module_unit.grow_stick(length = stick_u_length, from_stick_index = -1, face_index = 2, angle = 27)
module_unit.grow_shorter_stick(length = stick_d_length, from_stick_index = 0, face_index = 3, angle = 50)
module_unit.grow_longer_stick(length = stick_u_length, from_stick_index = 2, face_index = 1, angle = 27)

# Visualize
module_out = module_unit.visualize()
module_frame_out = [stick.frame for stick in module_unit.sticks]

# Aggregation
# 1. build first module
module_agg = module_unit
# print("first module stick count =", len(module_agg.sticks))

# 2. build ModuleAggregation
agg = ModuleAggregation(first_module=module_agg)

# 3. generate the next module（用上一組第2根，取面1的 t=0.5、面2 的 t=0.75）
agg.compute_next_module(ref_stick_index=2,
                        from_face_index=1, from_t=0.5,
                        to_face_index=2,   to_t=0.75,
                        angle=35,
                        stick_length=235)

# 4. output geometry
geo = agg.visualize()
# ---------- end stick_module_aggregation_2 ----------
draw_10 = COMPASDraw(cg=stick_module_aggregation_2.module_frame_out)  # -> rg; same code as draw
draw_11 = COMPASDraw(cg=stick_module_aggregation_2.module_out)  # -> rg; same code as draw
draw_12 = COMPASDraw(cg=stick_module_aggregation_2.geo)  # -> rg; same code as draw
vec_display_3 = VecDisplay(pln=draw_10, num=30)

# ----
item_2 = ListItem(List=draw_9, Index=series, Wrap=True)
preview_2 = CustomPreview(
    Geometry=draw_12,
    Material={diffuse=RGB(221, 160, 221), emission=RGB(66, 48, 66), shine=0.5, specular=RGB(255, 255, 255), transparency=0})

# ---- group: stick_module_aggregation
pt_3 = ConstructPoint(XCoordinate=0, YCoordinate=0, ZCoordinate=0)  # disabled
number_slider_9 = Slider(90, range=0..100)  # disabled
xy_3 = XYPlane(Origin=pt_3)  # disabled
xz_3 = XZPlane(Origin=Point(0, 0, 0))  # disabled
rot3d_2 = Rotate3D(Geometry=xy_3, Angle=degrees(number_slider_9), Center=Point(0, 0, 0), Axis=xz_3)  # -> Geometry, Transform; disabled

pt_4 = ConstructPoint(XCoordinate=0, YCoordinate=0, ZCoordinate=0)
xy_4 = XYPlane(Origin=pt_4)
xz_4 = XZPlane(Origin=Point(0, 0, 0))
rot3d_3 = Rotate3D(Geometry=xy_4, Angle=degrees(Slider(90, range=0..100)), Center=Point(0, 0, 0), Axis=xz_4)  # -> Geometry, Transform

number_slider_10 = Slider(0, range=0..10)  # disabled
number_slider_11 = Slider(2, range=0..10)  # disabled
number_slider_12 = Slider(3, range=0..10)  # disabled
number_slider_13 = Slider(3, range=0..10)  # disabled
number_slider_14 = Slider(0.125, range=0..1)  # disabled
number_slider_15 = Slider(30, range=0..180)  # disabled
number_slider_16 = Slider(0.275, range=0..1)  # disabled
stick_module_aggregation_3 = Python3Script(
    base_plane=rot3d_2.Geometry,
    agg_times=number_slider_13,
    angle=number_slider_15,
    ref_stick_index=number_slider_11,
    from_face_index=number_slider_10,
    to_face_index=number_slider_12,
    from_t=number_slider_14,
    to_t=number_slider_16)  # -> out, module_out, geo, module_frame_out; inputs agg_times: Int32, angle: Double, ref_stick_index: Int32, from_face_index: Int32, to_face_index: Int32, from_t: Double, to_t: Double; disabled
# ---------- stick_module_aggregation_3: Python ----------
# r: compas>=2.14.1
# venv: sticks

import sys
import os
import math

#get current file path
path = ghenv.Component.OnPingDocument().FilePath
print (path)
#get parent directory of the parent directory
parentdir = os.path.dirname(path)
print (parentdir)
#get src folder which contains classes
dire = os.path.join(parentdir,'scripts')
print (dire)

sys.path.append(dire)

from compas_rhino import unload_modules

unload_modules("Sticks_Single_1")
unload_modules("Sticks_Multiple_1")
unload_modules("Sticks_Aggregation_1")

from Sticks_Single_1 import Stick  
from Sticks_Multiple_1 import TiltedModule
from Sticks_Aggregation_1 import ModuleAggregation
from compas.geometry import Line, Point, Vector, Frame
from compas_rhino.conversions import plane_to_compas_frame, frame_to_rhino_plane

stick_width = 13.0
stick_depth = 13.0
stick_d_length = 235
stick_u_length = 263

# Convert input to compas
base_frame = plane_to_compas_frame(base_plane)

# Initialize tree
# module_unit = TiltedModule(base_frame = base_frame, root_angle = -25, stick_d_length = 235, stick_u_length = 263, width = stick_width, depth = stick_depth)
module_unit = TiltedModule(base_frame = base_frame, root_angle = 25, stick_d_length = 235, stick_u_length = 263, width = stick_width, depth = stick_depth)

# Grow tree
module_unit.grow_stick(length = stick_u_length, from_stick_index = -1, face_index = 2, angle = 27)
module_unit.grow_shorter_stick(length = stick_d_length, from_stick_index = 0, face_index = 3, angle = 50)
module_unit.grow_longer_stick(length = stick_u_length, from_stick_index = 2, face_index = 1, angle = 27)

# Visualize
module_out = module_unit.visualize()
module_frame_out = [stick.frame for stick in module_unit.sticks]

# Aggregation
# 1. build first module
module_agg = module_unit
# print("first module stick count =", len(module_agg.sticks))

# 2. build ModuleAggregation

for i in range(agg_times):

    agg = ModuleAggregation(first_module=module_agg)

    # 3. generate the next module（用上一組第2根，取面1的 t=0.5、面2 的 t=0.75）
    agg.compute_next_module(ref_stick_index=2,
                            from_face_index=1, from_t=0.5,
                            to_face_index=2,   to_t=0.75,
                            angle=35,
                            stick_length=235)

# 4. output geometry
geo = agg.visualize()
# ---------- end stick_module_aggregation_3 ----------
draw_13 = COMPASDraw(cg=stick_module_aggregation_3.module_frame_out)  # -> rg; disabled; same code as draw
draw_14 = COMPASDraw(cg=stick_module_aggregation_3.module_out)  # -> rg; disabled; same code as draw
draw_15 = COMPASDraw(cg=stick_module_aggregation_3.geo)  # -> rg; disabled; same code as draw
vec_display_4 = VecDisplay(pln=draw_13, num=30)  # disabled

stick_module_aggregation_4 = Python3Script(
    base_plane=rot3d_3.Geometry,
    agg_times=Slider(1, range=0..10),
    angle=Slider(27, range=0..180),
    ref_stick_index=Slider(2, range=0..10),
    from_face_index=Slider(0, range=0..10),
    to_face_index=Slider(3, range=0..10),
    from_t=Slider(0.125, range=0..1),
    to_t=Slider(0.275, range=0..1))  # -> out, module_out, geo, module_frame_out; inputs agg_times: Int32, angle: Double, ref_stick_index: Int32, from_face_index: Int32, to_face_index: Int32, from_t: Double, to_t: Double
# ---------- stick_module_aggregation_4: Python ----------
# r: compas>=2.14.1
# venv: sticks

import sys
import os
import math

#get current file path
path = ghenv.Component.OnPingDocument().FilePath
print (path)
#get parent directory of the parent directory
parentdir = os.path.dirname(path)
print (parentdir)
#get src folder which contains classes
dire = os.path.join(parentdir,'scripts')
print (dire)

sys.path.append(dire)

from compas_rhino import unload_modules

unload_modules("Sticks_Single_1")
unload_modules("Sticks_Multiple_1")
unload_modules("Sticks_Aggregation_1")

from Sticks_Single_1 import Stick  
from Sticks_Multiple_1 import TiltedModule
from Sticks_Aggregation_1 import ModuleAggregation
from compas.geometry import Line, Point, Vector, Frame
from compas_rhino.conversions import plane_to_compas_frame, frame_to_rhino_plane

stick_width = 13.0
stick_depth = 13.0
stick_d_length = 235
stick_u_length = 263

# Convert input to compas
base_frame = plane_to_compas_frame(base_plane)

# Initialize tree
# module_unit = TiltedModule(base_frame = base_frame, root_angle = -25, stick_d_length = 235, stick_u_length = 263, width = stick_width, depth = stick_depth)
module_unit = TiltedModule(base_frame = base_frame, root_angle = 25, stick_d_length = 235, stick_u_length = 263, width = stick_width, depth = stick_depth)

# Grow tree
module_unit.grow_stick(length = stick_u_length, from_stick_index = -1, face_index = 2, angle = 27)
module_unit.grow_shorter_stick(length = stick_d_length, from_stick_index = 0, face_index = 3, angle = 50)
module_unit.grow_longer_stick(length = stick_u_length, from_stick_index = 2, face_index = 1, angle = 27)

# Visualize
module_out = module_unit.visualize()
module_frame_out = [stick.frame for stick in module_unit.sticks]

# Aggregation
# 1. build first module
module_agg = module_unit
# print("first module stick count =", len(module_agg.sticks))

# 2. build ModuleAggregation
agg = ModuleAggregation(first_module=module_agg)
for i in range(agg_times):



# 3. generate the next module（用上一組第2根，取面1的 t=0.5、面2 的 t=0.75）
    # agg.compute_next_module(ref_stick_index=2,
    #                         from_face_index=1, from_t=0.5,
    #                         to_face_index=2,   to_t=0.75,
    #                         angle=35,
    #                         stick_length=235)
    agg.compute_next_module(ref_stick_index=ref_stick_index,
                            from_face_index=from_face_index, from_t=from_t,
                            to_face_index=to_face_index,   to_t=to_t,
                            angle=angle,
                            stick_length=235)

# 4. output geometry
geo = agg.visualize()
# ---------- end stick_module_aggregation_4 ----------
draw_16 = COMPASDraw(cg=stick_module_aggregation_4.module_frame_out)  # -> rg; same code as draw
draw_17 = COMPASDraw(cg=stick_module_aggregation_4.geo)  # -> rg; same code as draw
draw_18 = COMPASDraw(cg=stick_module_aggregation_4.module_out)  # -> rg; same code as draw
preview_3 = CustomPreview(
    Geometry=draw_17,
    Material={diffuse=RGB(221, 160, 221), emission=RGB(66, 48, 66), shine=0.5, specular=RGB(255, 255, 255), transparency=0})
vec_display_5 = VecDisplay(pln=draw_16, num=30)

# ----
preview_4 = CustomPreview(
    Geometry=draw_15,
    Material={diffuse=RGB(221, 160, 221), emission=RGB(66, 48, 66), shine=0.5, specular=RGB(255, 255, 255), transparency=0})  # disabled
debrep = DeconstructBrep(Brep=draw_17)  # -> Faces, Edges, Vertices
item_3 = ListItem(List=debrep.Edges, Index=0, Wrap=True)
len = Length(Curve=item_3)  # -> flatten(Length)
panel = Panel(len)

# ==== cluster VecDisplay
pln = ClusterInput()
num = ClusterInput()
pln_2 = Plane(graft(pln))
num_2 = Number(num)
deplane = DeconstructPlane(Plane=pln_2)  # -> flatten(Origin), XAxis, YAxis, ZAxis
entwine = Entwine(Branch00=deplane.XAxis, Branch01=deplane.YAxis, Branch02=deplane.ZAxis, FlattenInputs=True)
merge = Merge(
    Data1=ColourSwatch(SwatchColor=RGB(255, 0, 0)),
    Data2=ColourSwatch(SwatchColor=RGB(0, 255, 0)),
    Data3=ColourSwatch(SwatchColor=RGB(0, 0, 255)))  # -> graft(Result)
multiplication = Multiplication(A=entwine, B=num_2)
vdisex = VectorDisplayEx(Point=deplane.Origin, Vector=multiplication, Colour=merge, Width=2)
