# Grasshopper definition 081225_Stick_Insect.ghx (Grasshopper 1.0.8)
# plug-ins: Human, Weaverbird

pt = ConstructPoint(XCoordinate=0, YCoordinate=0, ZCoordinate=0)
number_slider = Slider(150, range=0..1000)

# ---- group: Generate Base Frames
# Global Constraints
py3 = Python3Script(origin=pt, legs=Slider(3, range=0..10), r=number_slider, incline=Slider(-8, range=-90..90))  # -> out, plns_out; inputs origin: Point3d, legs: Int32, r: Double, incline: Double
# ---------- py3: Python ----------
import Rhino.Geometry as rg
import math


plns = []
for i in range(legs):
    theta = 2 * math.pi * (i / legs)
    x = origin.X + r * math.cos(theta)
    y = origin.Y + r * math.sin(theta)
    pt = rg.Point3d(x, y, 0)

    pln = rg.Plane(pt, rg.Vector3d.ZAxis)
    pln.Rotate(theta, rg.Vector3d.ZAxis)
    pln.Rotate(-math.pi / 2, pln.YAxis)
    pln.Rotate(math.radians(incline), pln.YAxis)
    plns.append(pln)

plns_out = plns
# ---------- end py3 ----------

# ---- group: Generate Boundary Polygon
cluster = Cluster_2(
    G=pt,
    F_2="-10",
    A=number_slider,
    B=Slider(28, range=0..100),
    S=Slider(12, range=0..20),
    D=Slider(262, range=0..1000),
    F=Slider(1200, range=0..10000))  # -> G_2, P, G_3, X

# ---- group: Convert to Mesh
cluster_2 = Cluster_3(C_2=cluster.P, C=cluster.G_2, C_3=cluster.G_3, G=cluster.G_2, T=cluster.X)

# ----
cluster_3 = Cluster(pln=py3.plns_out, num=30)
wbedges = WeaverbirdsMeshEdges(MeshOrPolylines=cluster_2)

# ---- group: Visualise Boundary Mesh
custom_preview_lineweights = CustomPreviewLineweights(
    Geometry=wbedges,
    Shader=ColourSwatch(SwatchColor=RGB(150, 150, 150)),
    Thickness=Slider(1, range=0..10),
    Absolute=Toggle(False))

# ---- group: Angles
merge = Merge(Data1=Slider(20, range=0..100), Data2=Slider(160, range=0..1000))

# ---- group: Lengths
merge_2 = Merge(Data1=Slider(200, range=0..1000), Data2=Slider(400, range=0..1000))

# ----
list = ValueList({"Regular": 0, "Random": 1}, selected="Random")

# ---- group: Py_aggregation_logic
# Aggregation
py3_2 = Python3Script(
    first_plns=py3.plns_out,
    length_pattern=merge_2,
    angle_pattern=merge,
    agg_type=list,
    seed="53",
    agg_count=Slider(3, range=0..20),
    agg_round=Slider(2, range=0..20),
    branch_count=Slider(3, range=0..20),
    max_attempts=Slider(10, range=0..20),
    boundary_mesh=cluster_2)  # -> out, stick_out, frame_out, axis_out, failed_sticks, valid_sticks, collision_log; inputs first_plns: list of Plane, length_pattern: list of Double, angle_pattern: list of Double, agg_type: Int32, seed: Int32, agg_count: Int32, agg_round: Int32, branch_count: Int32, max_attempts: Int32, boundary_mesh: Mesh
# ---------- py3_2: Python ----------
# r: compas>=2.14.1
# venv: sticks

import sys
import os

#get current file path
path = ghenv.Component.OnPingDocument().FilePath
#get parent directory of the parent directory
parentdir = os.path.dirname(path)
#get src folder which contains classes
dire = os.path.join(parentdir,'scripts')

print (f'src folder is', dire)
sys.path.append(dire)

#update modules
from compas_rhino import unload_modules
unload_modules('single_stick')
unload_modules('aggregation_logic')
unload_modules('collision_detection')

"""
import file specific classes
"""

from single_stick import Stick
from aggregation_logic import Aggregation, run_multiround_aggregation
from collision_detection import Collision

from compas.geometry import Line, Point, Vector
from compas.geometry import Transformation
from compas_rhino.conversions import plane_to_compas_frame, frame_to_rhino_plane

import scriptcontext as sc
import random

from Grasshopper import DataTree
from Grasshopper.Kernel.Data import GH_Path

"""Main Code"""
# Convert rhino plane to compas frame
first_frames = [plane_to_compas_frame(p) for p in first_plns]

all_rounds = run_multiround_aggregation(
    first_frames,
    length_pattern,
    angle_pattern,
    agg_type,
    seed,
    agg_count,
    agg_round,
    branch_count,
    boundary_mesh,
    max_attempts)

# Visualization
stick_tree = DataTree[object]()
axis_tree = DataTree[object]()
frame_tree = DataTree[object]()
pln_tree = DataTree[object]()

for r, round_aggs in enumerate(all_rounds):
    for i, agg in enumerate(round_aggs):
        path = GH_Path(r, i)
        for s in agg.sticks:
            stick_tree.Add(s.geometry, path)
            axis_tree.Add(s.axis, path)
            frame_tree.Add(s.frame, path)
            pln_tree.Add(frame_to_rhino_plane(s.frame))

stick_out = stick_tree
axis_out = axis_tree
frame_out = frame_tree
pln_out = pln_tree

# Log
failed_sticks = DataTree[object]()
valid_sticks = DataTree[object]()
for i, round_aggs in enumerate(all_rounds):
    for agg in round_aggs:
        for j, branch in enumerate(agg.failed_sticks):
            path = GH_Path(i, j + 1)
            for s in branch:
                failed_sticks.Add(s.geometry, path)

        for j, branch in enumerate(agg.valid_sticks):
            path = GH_Path(i, j + 1)
            for s in branch:
                valid_sticks.Add(s.geometry, path)

# collision_log = DataTree[object]()
# for i, log in enumerate(agg.collision_log):
#     path = GH_Path(i + 1)

#     # 1. primitive values first
#     collision_log.Add(f"attempts = {log['attempts']}", path)
#     collision_log.Add(f"fail_count = {log['fail_count']}", path)
#     collision_log.Add(f"success = {log['success']}", path)
#     collision_log.Add(f"reason = {log['reason']}", path)
#     collision_log.Add(f"length = {log['params']['length']}", path)    
#     collision_log.Add(f"angle = {log['params']['angle']}", path)
#     collision_log.Add(f"from_index = {log['params']['from_index']}", path)
#     collision_log.Add(f"to_index = {log['params']['to_index']}", path)
#     collision_log.Add(f"from_t = {log['params']['from_t']}", path)
#     collision_log.Add(f"to_t = {log['params']['to_t']}", path)
# ---------- end py3_2 ----------

# ----
panel = Panel(py3_2.collision_log)
draw = COMPASDraw(cg=py3_2.stick_out)  # -> rg
#   port cg: The COMPAS geometry or datastructure to be drawn.
#   port rg: The Rhino geometry object.
# ---------- draw: Python ----------
# r: compas>=2.14.1
"""
Draws COMPAS geometry in Grasshopper.
"""

from typing import Any

import Grasshopper

from compas.scene import SceneObject


class CompasToRhinoGeometry(Grasshopper.Kernel.GH_ScriptInstance):
    def RunScript(self, cg):
        if not cg:
            return None

        return SceneObject(item=cg).draw()
# ---------- end draw ----------
draw_2 = COMPASDraw(cg=py3_2.axis_out)  # -> rg; same code as draw
draw_3 = COMPASDraw(cg=py3_2.failed_sticks)  # -> rg; same code as draw
draw_4 = COMPASDraw(cg=py3_2.valid_sticks)  # -> rg; same code as draw

midpt = CurveMiddle(Curve=draw_2)
number_slider_2 = Slider(30, range=0..30)
points = PointList(Points=midpt, Size=Slider(10, range=0..10))
lng = ListLength(List=draw)

# ---- group: Sticks Visualisation from Generation
trim = TrimTree(Tree=draw, Depth=1)
entwine = Entwine(
    Branch00=ColourSwatch(SwatchColor=RGBA(255, 255, 255, 150)),
    Branch01=ColourSwatch(SwatchColor=RGBA(255, 247, 0, 150)),
    Branch02=ColourSwatch(SwatchColor=RGBA(0, 255, 153, 150)),
    FlattenInputs=True)
preview = CustomPreview(Geometry=trim, Material=entwine)

# ---- group: Collision Visualisation
min = Minimum(A=number_slider_2, B=lng)
concat = Concatenate(FragmentA="{?;", FragmentB=min, FragmentC="}")
split = SplitTree(Data=draw_3, Masks=flatten(concat))  # -> Positive, Negative
split_2 = SplitTree(Data=draw_4, Masks=flatten(concat))  # -> Positive, Negative

# ---- group: Sticks Visualisation from Count
cluster_4 = Cluster_4(L=draw, A=number_slider_2, B=lng)  # -> i, M
preview_2 = CustomPreview(Geometry=cluster_4.i, Material=cluster_4.M)

# ---- group: Find Index
volume = Volume(Geometry=flatten(draw))  # -> Volume, Centroid
point_list = PointList(Points=volume.Centroid, Size=Slider(10, range=0..100))

# ----
option = BooleanToggle(False)
option_2 = BooleanToggle(True)
option_3 = BooleanToggle(False)

option_4 = BooleanToggle(False)
option_5 = BooleanToggle(True)
option_6 = BooleanToggle(False)

option_7 = BooleanToggle(False)
option_8 = BooleanToggle(True)
option_9 = BooleanToggle(True)

option_10 = BooleanToggle(True)
option_11 = BooleanToggle(True)
option_12 = BooleanToggle(False)

# ---- group: Py_Bridge
py_grow = Python3Script(
    branches=flatten(py3_2.frame_out),
    xaxis_list=flatten(py3_2.axis_out),
    root_index=Slider(1, range=0..50),
    target_index=Slider(27, range=0..50),
    root_dummy_face_index=Slider(0, range=0..3),
    target_dummy_face_index=Slider(1, range=0..3),
    root_dummy_length=Slider(200, range=-500..500),
    root_dummy_offset=Slider(0, range=-300..300),
    target_dummy_length=Slider(200, range=-500..500),
    target_dummy_offset=Slider(0, range=-300..300),
    root_offset=Slider(-25, range=-300..300),
    root_child_offset=Slider(-25, range=-300..300),
    target_child_offset=Slider(-67, range=-300..300),
    stick_length=Slider(300, range=0..400),
    solution=option,
    mirror_root=option_2,
    mirror_target=option_3)  # -> out, geometries, frames, root_dummy_frame, root_child_frame, target_dummy_frame, target_child_frame, root_dummy_stick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; inputs branches: list, xaxis_list: list, root_index: Int32, target_index: Int32, root_dummy_face_index: Int32, target_dummy_face_index: Int32, root_dummy_length: Double, root_dummy_offset: Double, root_offset: Double, root_child_offset: Double, target_child_offset: Double, stick_length: Double
# ---------- py_grow: Python ----------
# r: compas>=2.14.1
# venv: sticks

import sys
import os
import math

#get current file path
path = ghenv.Component.OnPingDocument().FilePath
#get parent directory of the parent directory
parentdir = os.path.dirname(path)
#get src folder which contains classes
dire = os.path.join(parentdir,'scripts')
print (f'src folder is', dire)

sys.path.append(dire)

from compas_rhino import unload_modules

unload_modules("stick_axis")
unload_modules("stick_bridge_axis")

"""
import file specific classes
"""
from stick_axis import Stick 
from stick_bridge_axis import BridgeIndex, compare_angles, get_plane_from_frame
"""
Default variables
"""
stick_width = 13.0
stick_depth = 13.0

from compas_rhino.conversions import plane_to_compas_frame, frame_to_rhino_plane
from compas.geometry import Line, Point, Vector, Frame
from compas_rhino.conversions import line_to_rhino

"""
Bridge Logic
"""

"""convert Lines to Vector (specific to jerry's aggregation logic)"""
xaxis_v_list = []
for line in xaxis_list:
    v = Vector.from_start_end(line.start, line.end)
    xaxis_v_list.append(v)

# Initialize tree
tree = BridgeIndex(branches, xaxis_v_list, 
root_index, target_index, 
root_dummy_face_index, target_dummy_face_index,
root_dummy_length, root_dummy_offset,
target_dummy_length, target_dummy_offset,
root_offset, root_child_offset, target_child_offset, 
stick_length=stick_length, 
solution = solution, mirror_root = mirror_root, mirror_target = mirror_target)

#Compare two frames
print (f"normal deviation is {tree.normal_deviation} degrees")
#rotated (aligned target frame)
r_target_frame = tree.rotated_target_frame

#frames
root_child_frame = tree.root_child_stick.frame
root_dummy_frame = tree.root_dummy_stick.frame
target_child_frame = tree.target_child_stick.frame
target_dummy_frame = tree.target_dummy_stick.frame

#visualise intersection line
line = tree.frame_intersection
intersection = line_to_rhino(line)

#visualise bridge sticks
root_child_stick = tree.root_child_stick.geometry
root_dummy_stick = tree.root_dummy_stick.geometry
target_child_stick = tree.target_child_stick.geometry
target_dummy_stick = tree.target_dummy_stick.geometry

# Visualize
geometries = tree.visualize()
frames = [stick.frame for stick in tree.sticks]
# ---------- end py_grow ----------

# ----
panel_2 = Panel(py_grow.out)

# ---- group: Py_Bridge
py_grow_2 = Python3Script(
    branches=flatten(py3_2.frame_out),
    xaxis_list=flatten(py3_2.axis_out),
    root_index=Slider(9, range=0..50),
    target_index=Slider(10, range=0..50),
    root_dummy_face_index=Slider(2, range=0..3),
    target_dummy_face_index=Slider(2, range=0..3),
    root_dummy_length=Slider(200, range=-500..500),
    root_dummy_offset=Slider(200, range=-300..300),
    target_dummy_length=Slider(200, range=-500..500),
    target_dummy_offset=Slider(0, range=-300..300),
    root_offset=Slider(75, range=-300..300),
    root_child_offset=Slider(-10, range=-300..300),
    target_child_offset=Slider(-25, range=-300..300),
    stick_length=Slider(300, range=0..400),
    solution=option_4,
    mirror_root=option_5,
    mirror_target=option_6)  # -> out, geometries, frames, root_dummy_frame, root_child_frame, target_dummy_frame, target_child_frame, root_dummy_stick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; inputs branches: list, xaxis_list: list, root_index: Int32, target_index: Int32, root_dummy_face_index: Int32, target_dummy_face_index: Int32, root_dummy_length: Double, root_dummy_offset: Double, root_offset: Double, root_child_offset: Double, target_child_offset: Double, stick_length: Double; same code as py_grow

# ----
panel_3 = Panel(py_grow_2.out)

# ---- group: Py_Bridge
py_grow_3 = Python3Script(
    branches=flatten(py3_2.frame_out),
    xaxis_list=flatten(py3_2.axis_out),
    root_index=Slider(14, range=0..50),
    target_index=Slider(26, range=0..50),
    root_dummy_face_index=Slider(2, range=0..3),
    target_dummy_face_index=Slider(2, range=0..3),
    root_dummy_length=Slider(200, range=-500..500),
    root_dummy_offset=Slider(0, range=-300..300),
    target_dummy_length=Slider(200, range=-500..500),
    target_dummy_offset=Slider(0, range=-300..300),
    root_offset=Slider(-25, range=-300..300),
    root_child_offset=Slider(0, range=-300..300),
    target_child_offset=Slider(-100, range=-300..300),
    stick_length=Slider(300, range=0..400),
    solution=option_7,
    mirror_root=option_8,
    mirror_target=option_9)  # -> out, geometries, frames, root_dummy_frame, root_child_frame, target_dummy_frame, target_child_frame, root_dummy_stick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; inputs branches: list, xaxis_list: list, root_index: Int32, target_index: Int32, root_dummy_face_index: Int32, target_dummy_face_index: Int32, root_dummy_length: Double, root_dummy_offset: Double, root_offset: Double, root_child_offset: Double, target_child_offset: Double, stick_length: Double; same code as py_grow

# ----
panel_4 = Panel(py_grow_3.out)

# ---- group: Py_Bridge
py_grow_4 = Python3Script(
    branches=flatten(py3_2.frame_out),
    xaxis_list=flatten(py3_2.axis_out),
    root_index=Slider(23, range=0..50),
    target_index=Slider(29, range=0..50),
    root_dummy_face_index=Slider(3, range=0..3),
    target_dummy_face_index=Slider(0, range=0..3),
    root_dummy_length=Slider(200, range=-500..500),
    root_dummy_offset=Slider(0, range=-300..300),
    target_dummy_length=Slider(200, range=-500..500),
    target_dummy_offset=Slider(200, range=-300..300),
    root_offset=Slider(0, range=-300..300),
    root_child_offset=Slider(0, range=-300..300),
    target_child_offset=Slider(0, range=-300..300),
    stick_length=Slider(300, range=0..400),
    solution=option_10,
    mirror_root=option_11,
    mirror_target=option_12)  # -> out, geometries, frames, root_dummy_frame, root_child_frame, target_dummy_frame, target_child_frame, root_dummy_stick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; inputs branches: list, xaxis_list: list, root_index: Int32, target_index: Int32, root_dummy_face_index: Int32, target_dummy_face_index: Int32, root_dummy_length: Double, root_dummy_offset: Double, root_offset: Double, root_child_offset: Double, target_child_offset: Double, stick_length: Double; same code as py_grow

# ---- group: Frame visualisation
python_3_script = Python3Script(frames=py_grow_4.root_dummy_frame, factor=Slider(20, range=0..25))  # -> points, x_axis, y_axis, normal; inputs frames: list
# ---------- python_3_script: Python ----------
from compas.geometry import Vector
from compas.geometry import cross_vectors
from compas_rhino.conversions import vector_to_rhino
from compas_rhino.conversions import point_to_rhino

points = []
x_axis = []
y_axis = []
normal = []

for frame in frames:
    points.append(point_to_rhino(frame.point))
    x_axis.append(vector_to_rhino(frame.xaxis * 2 * factor))
    y_axis.append(vector_to_rhino(frame.normal * factor))
    normal.append(vector_to_rhino(frame.yaxis * factor))
# ---------- end python_3_script ----------
vector_display_ex = VectorDisplayEx(Point=python_3_script.points, Vector=python_3_script.x_axis, Colour=ColourSwatch(SwatchColor=RGB(255, 0, 0)), Width=2)
vector_display_ex_2 = VectorDisplayEx(Point=python_3_script.points, Vector=python_3_script.y_axis, Colour=ColourSwatch(SwatchColor=RGB(0, 0, 255)), Width=2)
vector_display_ex_3 = VectorDisplayEx(Point=python_3_script.points, Vector=python_3_script.normal, Colour=ColourSwatch(SwatchColor=RGB(0, 255, 0)), Width=2)

# ----
panel_5 = Panel(py_grow_4.out)
draw_5 = COMPASDraw(cg=py_grow.geometries)  # -> rg; same code as draw
draw_6 = COMPASDraw(cg=py_grow.root_dummy_frame)  # -> rg; same code as draw
draw_7 = COMPASDraw(cg=py_grow.root_child_frame)  # -> rg; same code as draw
draw_8 = COMPASDraw(cg=py_grow.target_dummy_frame)  # -> rg; same code as draw
draw_9 = COMPASDraw(cg=py_grow.target_child_frame)  # -> rg; same code as draw
draw_10 = COMPASDraw(cg=py_grow.root_dummy_stick)  # -> rg; same code as draw
draw_11 = COMPASDraw(cg=py_grow.root_child_stick)  # -> rg; same code as draw
draw_12 = COMPASDraw(cg=py_grow.target_dummy_stick)  # -> rg; same code as draw
draw_13 = COMPASDraw(cg=py_grow.target_child_stick)  # -> rg; same code as draw
draw_14 = COMPASDraw(cg=py_grow_2.geometries)  # -> rg; same code as draw
draw_15 = COMPASDraw(cg=py_grow_2.root_dummy_frame)  # -> rg; same code as draw
draw_16 = COMPASDraw(cg=py_grow_2.root_child_frame)  # -> rg; same code as draw
draw_17 = COMPASDraw(cg=py_grow_2.target_dummy_frame)  # -> rg; same code as draw
draw_18 = COMPASDraw(cg=py_grow_2.target_child_frame)  # -> rg; same code as draw
draw_19 = COMPASDraw(cg=py_grow_2.root_dummy_stick)  # -> rg; same code as draw
draw_20 = COMPASDraw(cg=py_grow_2.root_child_stick)  # -> rg; same code as draw
draw_21 = COMPASDraw(cg=py_grow_2.target_dummy_stick)  # -> rg; same code as draw
draw_22 = COMPASDraw(cg=py_grow_2.target_child_stick)  # -> rg; same code as draw

# ---- group: Frame visualisation
python_3_script_2 = Python3Script(frames=[py_grow_4.target_dummy_frame, py_grow_4.target_child_frame], factor=Slider(20, range=0..25))  # -> points, x_axis, y_axis, normal; inputs frames: list; same code as python_3_script
vector_display_ex_4 = VectorDisplayEx(
    Point=python_3_script_2.points,
    Vector=python_3_script_2.x_axis,
    Colour=ColourSwatch(SwatchColor=RGB(255, 0, 0)),
    Width=2)
vector_display_ex_5 = VectorDisplayEx(
    Point=python_3_script_2.points,
    Vector=python_3_script_2.y_axis,
    Colour=ColourSwatch(SwatchColor=RGB(0, 0, 255)),
    Width=2)
vector_display_ex_6 = VectorDisplayEx(
    Point=python_3_script_2.points,
    Vector=python_3_script_2.normal,
    Colour=ColourSwatch(SwatchColor=RGB(0, 255, 0)),
    Width=2)

# ----
draw_23 = COMPASDraw(cg=py_grow_3.geometries)  # -> rg; same code as draw
draw_24 = COMPASDraw(cg=py_grow_3.root_dummy_frame)  # -> rg; same code as draw
draw_25 = COMPASDraw(cg=py_grow_3.root_child_frame)  # -> rg; same code as draw
draw_26 = COMPASDraw(cg=py_grow_3.target_dummy_frame)  # -> rg; same code as draw
draw_27 = COMPASDraw(cg=py_grow_3.target_child_frame)  # -> rg; same code as draw
draw_28 = COMPASDraw(cg=py_grow_3.root_dummy_stick)  # -> rg; same code as draw
draw_29 = COMPASDraw(cg=py_grow_3.root_child_stick)  # -> rg; same code as draw
draw_30 = COMPASDraw(cg=py_grow_3.target_dummy_stick)  # -> rg; same code as draw
draw_31 = COMPASDraw(cg=py_grow_3.target_child_stick)  # -> rg; same code as draw
draw_32 = COMPASDraw(cg=py_grow_4.geometries)  # -> rg; same code as draw
draw_33 = COMPASDraw(cg=py_grow_4.root_dummy_frame)  # -> rg; same code as draw
draw_34 = COMPASDraw(cg=py_grow_4.root_child_frame)  # -> rg; same code as draw
draw_35 = COMPASDraw(cg=py_grow_4.target_dummy_frame)  # -> rg; same code as draw
draw_36 = COMPASDraw(cg=py_grow_4.target_child_frame)  # -> rg; same code as draw
draw_37 = COMPASDraw(cg=py_grow_4.root_dummy_stick)  # -> rg; same code as draw
draw_38 = COMPASDraw(cg=py_grow_4.root_child_stick)  # -> rg; same code as draw
draw_39 = COMPASDraw(cg=py_grow_4.target_dummy_stick)  # -> rg; same code as draw
draw_40 = COMPASDraw(cg=py_grow_4.target_child_stick)  # -> rg; same code as draw
volume_2 = Volume(Geometry=draw_5)  # -> Volume, Centroid
volume_3 = Volume(Geometry=draw_14)  # -> Volume, Centroid
volume_4 = Volume(Geometry=draw_23)  # -> Volume, Centroid
volume_5 = Volume(Geometry=draw_32)  # -> Volume, Centroid
preview_3 = CustomPreview(Geometry=draw_5, Material=ColourSwatch(SwatchColor=RGBA(0, 255, 0, 150)))
preview_4 = CustomPreview(Geometry=draw_14, Material=ColourSwatch(SwatchColor=RGBA(0, 255, 0, 150)))
preview_5 = CustomPreview(Geometry=draw_23, Material=ColourSwatch(SwatchColor=RGBA(0, 255, 0, 150)))
preview_6 = CustomPreview(Geometry=draw_32, Material=ColourSwatch(SwatchColor=RGBA(0, 255, 0, 150)))
point_list_2 = PointList(Points=volume_2.Centroid, Size=Slider(10, range=0..10))
point_list_3 = PointList(Points=volume_3.Centroid, Size=Slider(10, range=0..10))
point_list_4 = PointList(Points=volume_4.Centroid, Size=Slider(10, range=0..10))
point_list_5 = PointList(Points=volume_5.Centroid, Size=Slider(10, range=0..10))

# ==== cluster Cluster
pln = ClusterInput()
num = ClusterInput()
pln_2 = Plane(graft(pln))
num_2 = Number(num)
deplane = DeconstructPlane(Plane=pln_2)  # -> flatten(Origin), XAxis, YAxis, ZAxis
entwine = Entwine(Branch00=deplane.XAxis, Branch01=deplane.YAxis, Branch02=deplane.ZAxis, FlattenInputs=True)
merge = Merge(
    Data1=ColourSwatch(SwatchColor=RGB(255, 0, 0)),
    Data2=ColourSwatch(SwatchColor=RGB(0, 255, 0)),
    Data3=ColourSwatch(SwatchColor=RGB(0, 0, 255)))  # -> graft(Result)
multiplication = Multiplication(A=entwine, B=num_2)
vdisex = VectorDisplayEx(Point=deplane.Origin, Vector=multiplication, Colour=merge, Width=2)

# ==== cluster Cluster_2
A = ClusterInput()
B = ClusterInput()
D = ClusterInput()
F = ClusterInput()
G = ClusterInput()
F_2 = ClusterInput()
S = ClusterInput()
Z = UnitZ(Factor=F_2)
move = Move(Geometry=G, Motion=Z)  # -> Geometry, Transform
G_2 = ClusterOutput(move.Geometry)
addition = Addition(A=A, B=B)
polygon = Polygon(Plane=move.Geometry, Radius=addition, Segments=S, FilletRadius=0)  # -> Polygon, Length
P = ClusterOutput(polygon.Polygon)
offset = OffsetCurve(Curve=polygon.Polygon, Distance=D, Corners=1)
Z_2 = UnitZ(Factor=F)
move_2 = Move(Geometry=offset, Motion=Z_2)  # -> Geometry, Transform
G_3 = ClusterOutput(move_2.Geometry)
X = ClusterOutput(move_2.Transform)

# ==== cluster Cluster_3
C = ClusterInput()
C_2 = ClusterInput()
C_3 = ClusterInput()
G = ClusterInput()
T = ClusterInput()
disc = Discontinuity(Curve=C_2, Level=1)  # -> Points, Parameters
shift = ShiftList(List=disc.Points, Shift="-1", Wrap=True)
disc_2 = Discontinuity(Curve=C_3, Level=1)  # -> Points, Parameters
long = LongestList(ListA=shift, ListB=disc.Points, ListC=C, PaddingMode=2)  # -> ListA, ListB, ListC
shift_2 = ShiftList(List=disc_2.Points, Shift="-1", Wrap=True)
long_2 = LongestList(ListA=shift, ListB=disc.Points, ListC=disc_2.Points, ListD=shift_2, PaddingMode=2)  # -> ListA, ListB, ListC, ListD
transform = Transform(Geometry=G, Transform=T)
merge = Merge(Data1=graft(long.ListA), Data2=graft(long.ListB), Data3=graft(long.ListC))  # -> reverse(Result)
merge_2 = Merge(Data1=graft(long_2.ListA), Data2=graft(long_2.ListB), Data3=graft(long_2.ListC), Data4=graft(long_2.ListD))
long_3 = LongestList(ListA=shift_2, ListB=disc_2.Points, ListC=transform, PaddingMode=2)  # -> ListA, ListB, ListC
conmesh = ConstructMesh(Vertices=merge, Faces={A=0, B=1, C=2, D=2})
merge_3 = Merge(Data1=graft(long_3.ListA), Data2=graft(long_3.ListB), Data3=graft(long_3.ListC))
conmesh_2 = ConstructMesh(Vertices=merge_2, Faces={A=0, B=1, C=2, D=3})
conmesh_3 = ConstructMesh(Vertices=merge_3, Faces={A=0, B=1, C=2, D=2})
merge_4 = Merge(Data1=simplify(conmesh), Data2=simplify(conmesh_2), Data3=simplify(conmesh_3))  # -> flatten(Result)
mjoin = MeshJoin(Meshes=merge_4)
M = ClusterOutput(mjoin)

# ==== cluster Cluster_4
A = ClusterInput()
B = ClusterInput()
addition = Addition(A=A, B=1)
min = Minimum(A=addition, B=B)
L = ClusterInput()
series = Series(Start=0, Step=1, Count=min)
item = ListItem(List=L, Index=series, Wrap=True)
i = ClusterOutput(item)
lng = ListLength(List=item)
series_2 = Series(Start=0, Step=1, Count=lng)
gradient = Gradient(
    LowerLimit=0,
    UpperLimit=expr("x-1", lng),
    Parameter=series_2,
    stops=[0: RGB(80, 55, 25), 0.5: RGB(159, 65, 29), 1: RGB(174, 166, 129)])
dmaterial = DeconstructMaterial(Material=gradient)  # -> Diffuse, Specular, Emission, Transparency, Shine
material = CreateMaterial(
    Diffuse=dmaterial.Diffuse,
    Specular=dmaterial.Specular,
    Emission=dmaterial.Emission,
    Transparency=Slider(0.75, range=0..1),
    Shine=dmaterial.Shine)
M = ClusterOutput(material)
