# Grasshopper definition 102_two_sticks_copy.gh (Grasshopper 1.0.8)

number_slider = Slider(5, range=0..10)  # disabled
number_slider_2 = Slider(5, range=0..10)  # disabled
number_slider_3 = Slider(5, range=0..10)  # disabled
number_slider_4 = Slider(0, range=0..90)  # disabled
line_0 = Curve(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)  # disabled
line_1 = Curve(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)  # disabled
py3 = Python3Script(line_0=line_0, line_1=line_1, angle=number_slider_4)  # -> out, stick_out, sticks; inputs line_0: Line, line_1: Line, angle: Double; disabled
# ---------- py3: Python ----------
#locate stick class file in the same folder
from compas_rhino import unload_modules
import sys
import os

#get current file path
path = ghenv.Component.OnPingDocument().FilePath
#get parent directory of the parent directory
parentdir = os.path.dirname(path)
#get src folder which contains classes
dire = os.path.join(parentdir,'scripts')

sys.path.append(dire)


unload_modules('Sticks')

# import Sticks
from Sticks import Stick, stick_bridge
from compas.geometry import Line, Point, Vector
from compas_rhino.conversions import line_to_compas


assembly = []
line_0 = line_to_compas(line_0)
stick_0 = Stick(line_0)
stick_0.rotate_stick(angle)
assembly.append(stick_0)

line_1 = line_to_compas(line_1)
stick_1 = Stick(line_1)
stick_1.rotate_stick(angle, Vector(0,1,0), stick_1.axis.start)
assembly.append(stick_1)


stick_2 = stick_bridge(stick_0, stick_1)
assembly.append(stick_2)
# Output
stick_out = [s.geometry for s in assembly]
# ---------- end py3 ----------
py3_2 = Python3Script(x=number_slider, y=number_slider_2, z=number_slider_3)  # -> out, stick_out, pts; inputs x: Int32, y: Int32, z: Int32; disabled
# ---------- py3_2: Python ----------
#locate stick class file in the same folder
from compas_rhino import unload_modules
import sys
import os

#get current file path
path = ghenv.Component.OnPingDocument().FilePath
#get parent directory of the parent directory
parentdir = os.path.dirname(path)
#get src folder which contains classes
dire = os.path.join(parentdir,'scripts')

sys.path.append(dire)


unload_modules('Sticks')
unload_modules('StickModule')

# import Sticks
from Sticks import Stick, stick_bridge
from StickModule import Stickmodule
from compas.geometry import Line, Point, Vector
from compas_rhino.conversions import line_to_compas

stick_width = 13.0
stick_depth = 13.0
stick_length = 200

grid_size = stick_length - 2*stick_depth
pts = []
assembly = []
for i in range(x):
    for j in range(y):
        for k in range(z):
            pt = Point(i*grid_size, j*grid_size, k*grid_size)
            pts.append(pt)
            type_x = i % 2 if i < x-1 else 2
            type_y = j % 2 if j < y-1 else 2
            type_z = k % 2 if k < z-1 else 2
            type = {"x" : type_x, "y" : type_y, "z" : type_z}

            stick_module = Stickmodule(pt, stick_length, stick_width, stick_depth)
            stick_module.create_module(type)

            assembly.extend(stick_module.sticks)



# Visualization
stick_out = [a.geometry for a in assembly]
# ---------- end py3_2 ----------
draw = COMPASDraw(cg=py3.stick_out)  # -> rg; disabled
#   port cg: The COMPAS geometry or datastructure to be drawn.
#   port rg: The Rhino geometry object.
# ---------- draw: Python ----------
# r: compas>=2.14.1
"""
Draws COMPAS geometry in Grasshopper.
"""

from typing import Any

import Grasshopper

from compas.scene import SceneObject


class CompasToRhinoGeometry(Grasshopper.Kernel.GH_ScriptInstance):
    def RunScript(self, cg):
        if not cg:
            return None

        return SceneObject(item=cg).draw()
# ---------- end draw ----------
draw_2 = COMPASDraw(cg=py3.sticks)  # -> rg; disabled; same code as draw
draw_3 = COMPASDraw(cg=py3_2.stick_out)  # -> rg; disabled; same code as draw
draw_4 = COMPASDraw(cg=py3_2.pts)  # -> rg; disabled; same code as draw
preview = CustomPreview(
    Geometry=draw_3,
    Material={diffuse=RGB(221, 160, 221), emission=RGB(66, 48, 66), shine=0.5, specular=RGB(255, 255, 255), transparency=0})  # disabled

number_slider_5 = Slider(1, range=0..10)  # disabled
number_slider_6 = Slider(0.689, range=0..1)  # disabled
number_slider_7 = Slider(52, range=0..100)  # disabled
line = Line(Line((-137.5745333, -194.4849321, 0), (121.8637187, -194.4849321, 0)))  # disabled
py3_3 = Python3Script(first_ln=line, face_index=number_slider_5, t=number_slider_6, seed=number_slider_7)  # -> out, stick_out, a, b, c, d, e; inputs first_ln: Line, face_index: Int32, seed: Int32; disabled
# ---------- py3_3: Python ----------
#locate stick class file in the same folder
from compas_rhino import unload_modules
import sys
import os

#get current file path
path = ghenv.Component.OnPingDocument().FilePath
#get parent directory of the parent directory
parentdir = os.path.dirname(path)
#get src folder which contains classes
dire = os.path.join(parentdir,'scripts')

sys.path.append(dire)


unload_modules('J3RRY_Stick_v1')

# import Sticks
from J3RRY_Stick_v1 import JStick
from compas.geometry import Line, Point, Vector
from compas.geometry import Transformation
from compas_rhino.conversions import line_to_compas, frame_to_rhino


assembly = []
first_ln = line_to_compas(first_ln)
first_stick = JStick(first_ln)
print (first_stick)
first_frame = first_stick.eval_frame(face_index, t)
print (first_frame)
assembly.append(first_stick)

for i in range(2):
    new_axis, new_frame = first_stick.spawn_next_stick(first_ln, first_frame)
    
    next_stick = JStick(new_axis)

    assembly.append(next_stick)
    """Update line and frame"""
    first_ln = new_axis
    # first_frame = new_frame

# Visualization
stick_out = [s.geometry for s in assembly]
a = frame_to_rhino(first_frame)
b = frame_to_rhino(new_frame)
# ---------- end py3_3 ----------
draw_5 = COMPASDraw(cg=py3_3.stick_out)  # -> rg; disabled; same code as draw
draw_6 = COMPASDraw(cg=py3_3.c)  # -> rg; disabled; same code as draw
item = ListItem(List=draw_5, Index=0, Wrap=True)  # disabled
pln = Plane(py3_3.a)  # disabled
pln_2 = Plane(py3_3.b)  # disabled
cluster = Cluster(pln=pln_2, num=30)  # disabled
py3_4 = Python3Script(first_ln=line, a=py3_3.a, b=py3_3.b)  # -> out, stick_out, a, b, c; inputs first_ln: Line, a: Plane, b: Plane; disabled
# ---------- py3_4: Python ----------
import compas.geometry as cg
import compas_rhino.conversions as crc

ln = crc.line_to_compas(first_ln)

a = crc.plane_to_compas_frame(a)
b = crc.plane_to_compas_frame(b)
T = cg.Transformation.from_frame_to_frame(b, a)

stick_out = ln.transformed(T)
# ---------- end py3_4 ----------
orient = Orient(Geometry=item, Source=pln_2, Target=pln)  # -> Geometry, Transform; disabled
draw_7 = COMPASDraw(cg=py3_4.stick_out)  # -> rg; disabled; same code as draw

# ---- group: *Visualize Pln XYZ
cluster_2 = Cluster(pln=pln, num=30)  # disabled

# ----
# v2(OLD)
number_slider_8 = Slider(57, range=0..180)  # disabled
number_slider_9 = Slider(48, range=0..100)  # disabled
number_slider_10 = Slider(2, range=0..10)  # disabled
number_slider_11 = Slider(36, range=0..100)  # disabled
line_2 = Line(Line((74.3477668, -87.01365111, 0), (284.437173, -87.01365111, 0)))  # disabled
py3_5 = Python3Script(first_ln=line_2, seed=number_slider_11, agg_count=number_slider_10, angle=number_slider_8)  # -> out, stick_out, a, b, c, d, e; inputs first_ln: Line, seed: Int32, agg_count: Int32, angle: Double; disabled
# ---------- py3_5: Python ----------
#locate stick class file in the same folder
from compas_rhino import unload_modules
import sys
import os

#get current file path
path = ghenv.Component.OnPingDocument().FilePath
#get parent directory of the parent directory
parentdir = os.path.dirname(path)
#get src folder which contains classes
dire = os.path.join(parentdir,'scripts')

sys.path.append(dire)


unload_modules('J3RRY_Stick_v2')
unload_modules('Sticks')

from Sticks import Stick
from J3RRY_Stick_v2 import JStickAggregation
from compas.geometry import Line, Point, Vector
from compas.geometry import Transformation
from compas_rhino.conversions import line_to_compas, frame_to_rhino
import random


"""Main Code"""
# Convert rhino line to compas line
first_ln = line_to_compas(first_ln)
# Create first stick
agg = JStickAggregation(first_ln)

# Aggregation
for i in range(agg_count):
    # angle = random.uniform(0, 180)
    from_pln, to_pln = agg.spawn_next_stick(angle, seed)



# Output
stick_out = agg.visualize()
a = frame_to_rhino(from_pln)
b = frame_to_rhino(to_pln)
# ---------- end py3_5 ----------
draw_8 = COMPASDraw(cg=py3_5.stick_out)  # -> rg; disabled; same code as draw
number_slider_12 = Slider(10, range=0..10)  # disabled
pln_3 = Plane(py3_5.a)  # disabled
volume = Volume(Geometry=draw_8)  # disabled
pln_4 = Plane(py3_5.b)  # disabled
item_2 = ListItem(List=draw_8, Index=0, Wrap=True)  # -> Item2, Item1, Item; disabled
cluster_3 = Cluster(pln=pln_4, num=30)  # disabled
points = PointList(Points=volume, Size=number_slider_12)  # disabled
orient_2 = Orient(Geometry=item_2.Item2, Source=pln_3, Target=pln_4)  # -> Geometry, Transform; disabled
py3_6 = Python3Script(x=line_2, to_pln=pln_4, from_pln=pln_3)  # -> out, a; inputs x: Line, to_pln: Plane, from_pln: Plane; disabled
# ---------- py3_6: Python ----------
#locate stick class file in the same folder
from compas_rhino import unload_modules
import sys
import os

#get current file path
path = ghenv.Component.OnPingDocument().FilePath
#get parent directory of the parent directory
parentdir = os.path.dirname(path)
#get src folder which contains classes
dire = os.path.join(parentdir,'scripts')

sys.path.append(dire)


unload_modules('J3RRY_Stick_v2')
unload_modules('Sticks')

from Sticks import Stick

import compas.geometry as cg
import compas_rhino.conversions as crc

ln = crc.line_to_compas(x)

to_pln = crc.plane_to_compas_frame(to_pln)
from_pln = crc.plane_to_compas_frame(from_pln)

T = cg.Transformation.from_frame_to_frame(from_pln, to_pln)

ln.transform(T)


a = Stick(ln).geometry
# ---------- end py3_6 ----------
draw_9 = COMPASDraw(cg=py3_6.a)  # -> rg; disabled; same code as draw

# ---- group: *Visualize Pln XYZ
cluster_4 = Cluster(pln=pln_3, num=30)  # disabled

# ----
# Frame-based Class: Stick
pt = Point(Point(131.4515182, -575.0679293, 0))  # disabled
number_slider_13 = Slider(47, range=0..180)  # disabled
xy = XYPlane(Origin=pt)  # disabled
yz = YZPlane(Origin=pt)  # disabled
xz = XZPlane(Origin=pt)  # disabled
rotate = Rotate(Geometry=xy, Angle=degrees(number_slider_13), Plane=xz)  # -> Geometry, Transform; disabled
number_slider_14 = Slider(1, range=0..10)  # disabled
number_slider_15 = Slider(230, range=0..1000)  # disabled
number_slider_16 = Slider(0.822, range=0..1)  # disabled
pln_5 = Plane(rotate.Geometry)  # disabled
cluster_5 = Cluster(pln=pln_5, num=30)  # disabled
py3_7 = Python3Script(first_pln=pln_5, length=number_slider_15, face_index=number_slider_14, t=number_slider_16)  # -> out, axis_out, stick_out, midframe_out, evalframe_out; inputs first_pln: Plane, length: Double, face_index: Int32, t: Double; disabled
# ---------- py3_7: Python ----------
#locate stick class file in the same folder
from compas_rhino import unload_modules
import sys
import os

#get current file path
path = ghenv.Component.OnPingDocument().FilePath
#get parent directory of the parent directory
parentdir = os.path.dirname(path)
#get src folder which contains classes
dire = os.path.join(parentdir,'scripts')

sys.path.append(dire)


unload_modules('J3RRY_Stick_v2')
unload_modules('Sticks')

from Sticks import Stick
from J3RRY_Stick_v2 import JStickAggregation
from compas.geometry import Line, Point, Vector
from compas.geometry import Transformation
from compas_rhino.conversions import plane_to_compas_frame, frame_to_rhino_plane
import random

"""Main Code"""
first_pln = plane_to_compas_frame(first_pln)
stick = Stick(first_pln, length)

axis = stick.axis
geo = stick.geometry
midframe = stick.midframe
evalframe = stick.eval_frame(face_index, t)
# Output
axis_out = axis
stick_out = geo
midframe_out = frame_to_rhino_plane(midframe)
evalframe_out = frame_to_rhino_plane(evalframe)
# ---------- end py3_7 ----------
draw_10 = COMPASDraw(cg=py3_7.axis_out)  # -> rg; disabled; same code as draw
draw_11 = COMPASDraw(cg=py3_7.stick_out)  # -> rg; disabled; same code as draw
pln_6 = Plane(py3_7.midframe_out)  # disabled
pln_7 = Plane(py3_7.evalframe_out)  # disabled
cluster_6 = Cluster(pln=pln_6, num=30)  # disabled
cluster_7 = Cluster(pln=pln_7, num=30)  # disabled

# ----
# Frame-based Aggregation  by Random Value
pt_2 = Point(Point(131.4515182, -575.0679293, 0))  # disabled
number_slider_17 = Slider(90, range=0..180)  # disabled
xy_2 = XYPlane(Origin=pt_2)  # disabled
yz_2 = YZPlane(Origin=pt_2)  # disabled
xz_2 = XZPlane(Origin=pt_2)  # disabled
rotate_2 = Rotate(Geometry=xy_2, Angle=degrees(number_slider_17), Plane=xz_2)  # -> Geometry, Transform; disabled
number_slider_18 = Slider(47, range=0..100)  # disabled
number_slider_19 = Slider(1, range=0..10)  # disabled
number_slider_20 = Slider(230, range=0..1000)  # disabled
number_slider_21 = Slider(39, range=0..100)  # disabled
number_slider_22 = Slider(96, range=0..180)  # disabled
list = ValueList({"Regular": 0, "Random": 1}, selected="Regular")  # disabled
pln_8 = Plane(rotate_2.Geometry)  # disabled
cluster_8 = Cluster(pln=pln_8, num=30)  # disabled
py3_8 = Python3Script(
    first_pln=pln_8,
    length=number_slider_20,
    seed=number_slider_21,
    agg_type=list,
    agg_count=number_slider_18,
    angle=number_slider_22)  # -> out, stick_out, axis_out, from_pln_out, to_pln_out, new_pln_out; inputs first_pln: Plane, length: Double, seed: Int32, agg_type: Int32, agg_count: Int32, angle: Double; disabled
# ---------- py3_8: Python ----------
#locate stick class file in the same folder
from compas_rhino import unload_modules
import sys
import os

#get current file path
path = ghenv.Component.OnPingDocument().FilePath
#get parent directory of the parent directory
parentdir = os.path.dirname(path)
#get src folder which contains classes
dire = os.path.join(parentdir,'scripts')

sys.path.append(dire)


unload_modules('J3RRY_Stick_v2')
unload_modules('Sticks')

from Sticks import Stick
from J3RRY_Stick_v2 import JStickAggregation
from compas.geometry import Line, Point, Vector
from compas.geometry import Transformation
from compas_rhino.conversions import plane_to_compas_frame, frame_to_rhino_plane

import random


"""Main Code"""
# Convert rhino plane to compas frame
first_pln = plane_to_compas_frame(first_pln)
agg = JStickAggregation(first_pln, length, agg_type, seed)


# Aggregation
for i in range(agg_count):
    # angle = random.uniform(0, 180)
    agg.spawn_next_stick_random(angle, seed)

# Collect Data


# Output
stick_out = agg.visualize()
axis_out = agg.axes
from_pln_out = [frame_to_rhino_plane(f) for f in agg.from_frames]
to_pln_out = [frame_to_rhino_plane(f) for f in agg.to_frames]
new_pln_out = [frame_to_rhino_plane(f) for f in agg.new_frames]
# ---------- end py3_8 ----------
draw_12 = COMPASDraw(cg=py3_8.stick_out)  # -> rg; disabled; same code as draw
draw_13 = COMPASDraw(cg=py3_8.axis_out)  # -> rg; disabled; same code as draw
pln_9 = Plane(py3_8.from_pln_out)  # disabled
pln_10 = Plane(py3_8.to_pln_out)  # disabled
pln_11 = Plane(py3_8.new_pln_out)  # disabled
number_slider_23 = Slider(10, range=0..10)  # disabled
cluster_9 = Cluster(pln=pln_9, num=30)  # disabled
cluster_10 = Cluster(pln=pln_10, num=30)  # disabled
cluster_11 = Cluster(pln=pln_11, num=30)  # disabled
midpt = CurveMiddle(Curve=draw_13)  # disabled
preview_2 = CustomPreview(
    Geometry=draw_12,
    Material={diffuse=RGB(221, 160, 221), emission=RGB(66, 48, 66), shine=0.5, specular=RGB(255, 255, 255), transparency=0})  # disabled
points_2 = PointList(Points=midpt, Size=number_slider_23)  # disabled

# ----
# Frame-based Aggregation by Face Index and T Value
pt_3 = Point(Point(131.4515182, -575.0679293, 0))  # disabled
number_slider_24 = Slider(90, range=0..180)  # disabled
xy_3 = XYPlane(Origin=pt_3)  # disabled
yz_3 = YZPlane(Origin=pt_3)  # disabled
xz_3 = XZPlane(Origin=pt_3)  # disabled
rotate_3 = Rotate(Geometry=xy_3, Angle=degrees(number_slider_24), Plane=xz_3)  # -> Geometry, Transform; disabled
number_slider_25 = Slider(0, range=0..10)  # disabled
number_slider_26 = Slider(2, range=0..10)  # disabled
number_slider_27 = Slider(30, range=0..100)  # disabled
number_slider_28 = Slider(0.212, range=0..1)  # disabled
number_slider_29 = Slider(0.712, range=0..1)  # disabled
number_slider_30 = Slider(230, range=0..1000)  # disabled
number_slider_31 = Slider(90, range=0..180)  # disabled
pln_12 = Plane(rotate_3.Geometry)  # disabled
cluster_12 = Cluster(pln=pln_12, num=30)  # disabled
py3_9 = Python3Script(
    first_pln=pln_12,
    length=number_slider_30,
    agg_count=number_slider_27,
    angle=number_slider_31,
    from_face_index=number_slider_25,
    to_face_index=number_slider_26,
    from_t=number_slider_28,
    to_t=number_slider_29)  # -> out, stick_out, axis_out, from_pln_out, to_pln_out, new_pln_out; inputs first_pln: Plane, length: Double, agg_count: Int32, angle: Double, from_face_index: Int32, to_face_index: Int32, from_t: Double, to_t: Double; disabled
# ---------- py3_9: Python ----------
#locate stick class file in the same folder
from compas_rhino import unload_modules
import sys
import os

#get current file path
path = ghenv.Component.OnPingDocument().FilePath
#get parent directory of the parent directory
parentdir = os.path.dirname(path)
#get src folder which contains classes
dire = os.path.join(parentdir,'scripts')

sys.path.append(dire)


unload_modules('J3RRY_Stick_v2')
unload_modules('Sticks')

from Sticks import Stick
from J3RRY_Stick_v2 import JStickAggregation
from compas.geometry import Line, Point, Vector
from compas.geometry import Transformation
from compas_rhino.conversions import plane_to_compas_frame, frame_to_rhino_plane

import random


"""Main Code"""
# Convert rhino plane to compas frame
first_pln = plane_to_compas_frame(first_pln)
agg = JStickAggregation(first_pln, length)


# Aggregation
for i in range(agg_count):
    # angle = random.uniform(0, 180)
    agg.spawn_next_stick(angle, from_face_index, from_t, to_face_index, to_t)


# Output
stick_out = agg.visualize()
axis_out = agg.axes
from_pln_out = [frame_to_rhino_plane(f) for f in agg.from_frames]
to_pln_out = [frame_to_rhino_plane(f) for f in agg.to_frames]
new_pln_out = [frame_to_rhino_plane(f) for f in agg.new_frames]
# ---------- end py3_9 ----------
draw_14 = COMPASDraw(cg=py3_9.stick_out)  # -> rg; disabled; same code as draw
draw_15 = COMPASDraw(cg=py3_9.axis_out)  # -> rg; disabled; same code as draw
pln_13 = Plane(py3_9.from_pln_out)  # disabled
pln_14 = Plane(py3_9.to_pln_out)  # disabled
pln_15 = Plane(py3_9.new_pln_out)  # disabled
number_slider_32 = Slider(10, range=0..10)  # disabled
midpt_2 = CurveMiddle(Curve=draw_15)  # disabled
cluster_13 = Cluster(pln=pln_13, num=30)  # disabled
cluster_14 = Cluster(pln=pln_14, num=30)  # disabled
cluster_15 = Cluster(pln=pln_15, num=30)  # disabled
preview_3 = CustomPreview(
    Geometry=draw_14,
    Material={diffuse=RGB(221, 160, 221), emission=RGB(66, 48, 66), shine=0.5, specular=RGB(255, 255, 255), transparency=0})  # disabled
points_3 = PointList(Points=midpt_2, Size=number_slider_32)  # disabled

# ==== cluster Cluster
pln = ClusterInput()
num = ClusterInput()
pln_2 = Plane(graft(pln))
num_2 = Number(num)
deplane = DeconstructPlane(Plane=pln_2)  # -> flatten(Origin), XAxis, YAxis, ZAxis
entwine = Entwine(Branch00=deplane.XAxis, Branch01=deplane.YAxis, Branch02=deplane.ZAxis, FlattenInputs=True)
merge = Merge(
    Data1=ColourSwatch(SwatchColor=RGB(255, 0, 0)),
    Data2=ColourSwatch(SwatchColor=RGB(0, 255, 0)),
    Data3=ColourSwatch(SwatchColor=RGB(0, 0, 255)))  # -> graft(Result)
multiplication = Multiplication(A=entwine, B=num_2)
vdisex = VectorDisplayEx(Point=deplane.Origin, Vector=multiplication, Colour=merge, Width=2)
