# Grasshopper definition Dec_02_Jerry_Sticks.gh (Grasshopper 1.0.8)
# plug-ins: Human

# ----
# Mid-phase AABB Collision + Infinate-axis Distance Check
pt = Point(Point(-186.0594048, -107.2522057, 0))  # disabled
number_slider = Slider(114, range=0..180)  # disabled
xy = XYPlane(Origin=pt)  # disabled
yz = YZPlane(Origin=pt)  # disabled
xz = XZPlane(Origin=pt)  # disabled
rotate = Rotate(Geometry=xy, Angle=degrees(number_slider), Plane=xz)  # -> Geometry, Transform; disabled
number_slider_2 = Slider(23, range=0..100)  # disabled
number_slider_3 = Slider(1, range=0..10)  # disabled
number_slider_4 = Slider(216, range=0..1000)  # disabled
number_slider_5 = Slider(34, range=0..100)  # disabled
number_slider_6 = Slider(133, range=0..180)  # disabled
list = ValueList({"Regular": 0, "Random": 1}, selected="Random")  # disabled
pln = Plane(rotate.Geometry)  # disabled
cluster = Cluster(pln=pln, num=30)  # disabled
py3 = Python3Script(
    first_pln=pln,
    length=number_slider_4,
    seed=number_slider_5,
    agg_type=list,
    agg_count=number_slider_2,
    angle=number_slider_6)  # -> out, stick_out, axis_out, aabb, index_overlap; inputs first_pln: Plane, length: Double, seed: Int32, agg_type: Int32, agg_count: Int32, angle: Double; disabled
# ---------- py3: Python ----------
#locate stick class file in the same folder
from compas_rhino import unload_modules
import sys
import os
"""
#get current file path
path = ghenv.Component.OnPingDocument().FilePath
#get parent directory of the parent directory
parentdir = os.path.dirname(path)
#get src folder which contains classes
dire = os.path.join(parentdir,'scripts')

sys.path.append(dire)"""

path = 'D:\\ETH\\Github\\MAS-2526\\08_SpatialAssemblies\\StudentProjects\\group_two\\J3RRY_Sticks_^o^\\scripts\\Package_v2'
sys.path.append(path)

unload_modules('J3RRY_SingleStick_v1')
unload_modules('J3RRY_Aggregation_v1')
unload_modules('J3RRY_Collision_v1')

from J3RRY_SingleStick_v1 import Stick
from J3RRY_Aggregation_v1 import Aggregation
from J3RRY_Collision_v1 import Collision

from compas.geometry import Line, Point, Vector
from compas.geometry import Transformation
from compas_rhino.conversions import plane_to_compas_frame, frame_to_rhino_plane

import random


"""Main Code"""
# Convert rhino plane to compas frame
first_pln = plane_to_compas_frame(first_pln)
agg = Aggregation(first_pln, length, agg_type, seed)


# Aggregation
for i in range(agg_count):
    # angle = random.uniform(0, 180)
    # angle = 45*i
    agg.spawn_next_stick_random(angle, seed)


# Output
stick_out = agg.visualize()
axis_out = agg.axes
plane_out = [frame_to_rhino_plane(f) for f in agg.frames]
from_pln_out = [frame_to_rhino_plane(f) for f in agg.from_frames]
to_pln_out = [frame_to_rhino_plane(f) for f in agg.to_frames]


# Collision Check
aabb = [Point(*pt) for pt in agg.sticks[-1].aabb]

index_overlap = []
for i, s in enumerate(agg.sticks[:-2]):
    col = Collision(agg.sticks[-1], s)
    is_overlap = col.check_collision()

    if is_overlap:
        index_overlap.append(i)
        dist = col.axis_distance
        print ('index:', i, ', dist:', dist)
# ---------- end py3 ----------
draw = COMPASDraw(cg=py3.stick_out)  # -> rg; disabled
#   port cg: The COMPAS geometry or datastructure to be drawn.
#   port rg: The Rhino geometry object.
# ---------- draw: Python ----------
# r: compas>=2.14.1
"""
Draws COMPAS geometry in Grasshopper.
"""

from typing import Any

import Grasshopper

from compas.scene import SceneObject


class CompasToRhinoGeometry(Grasshopper.Kernel.GH_ScriptInstance):
    def RunScript(self, cg):
        if not cg:
            return None

        return SceneObject(item=cg).draw()
# ---------- end draw ----------
draw_2 = COMPASDraw(cg=py3.axis_out)  # -> rg; disabled; same code as draw
number_slider_7 = Slider(0, range=0..10)  # disabled
lng = ListLength(List=draw)  # disabled
draw_3 = COMPASDraw(cg=py3.aabb)  # -> rg; disabled; same code as draw
midpt = CurveMiddle(Curve=draw_2)  # disabled
item = ListItem(List=draw_3, Index=0, Wrap=True)  # -> Item, Item1; disabled
series = Series(Start=0, Step=1, Count=lng)  # disabled
points = PointList(Points=midpt, Size=number_slider_7)  # disabled
box = Box2Pt(PointA=item.Item, PointB=item.Item1, Plane=PlaneXY(0, 0, 0))  # disabled
gradient = Gradient(
    LowerLimit=0,
    UpperLimit=expr("x-1", lng),
    Parameter=series,
    stops=[0: RGB(80, 55, 25), 0.5: RGB(159, 65, 29), 1: RGB(174, 166, 129)])  # disabled
swatch = ColourSwatch(SwatchColor=RGBA(255, 255, 255, 119))  # disabled
preview = CustomPreview(Geometry=box, Material=swatch)  # disabled
preview_2 = CustomPreview(Geometry=draw, Material=gradient)  # disabled

# ----
# Mid-phase AABB Collision + Segment Distance Check
pt_2 = Point(Point(-186.0594048, -107.2522057, 0))  # disabled
number_slider_8 = Slider(90, range=0..180)  # disabled
xy_2 = XYPlane(Origin=pt_2)  # disabled
yz_2 = YZPlane(Origin=pt_2)  # disabled
xz_2 = XZPlane(Origin=pt_2)  # disabled
rotate_2 = Rotate(Geometry=xy_2, Angle=degrees(number_slider_8), Plane=xz_2)  # -> Geometry, Transform; disabled
number_slider_9 = Slider(4, range=0..100)  # disabled
number_slider_10 = Slider(2, range=0..10)  # disabled
number_slider_11 = Slider(216, range=0..1000)  # disabled
number_slider_12 = Slider(37, range=0..100)  # disabled
number_slider_13 = Slider(0, range=0..180)  # disabled
list_2 = ValueList({"Regular": 0, "Random": 1}, selected="Random")  # disabled
pln_2 = Plane(rotate_2.Geometry)  # disabled
cluster_2 = Cluster(pln=pln_2, num=30)  # disabled
py3_2 = Python3Script(
    first_pln=pln_2,
    length=number_slider_11,
    seed=number_slider_12,
    agg_type=list_2,
    agg_count=number_slider_10,
    angle=number_slider_13)  # -> out, stick_out, axis_out, aabb, index_overlap; inputs first_pln: Plane, length: Double, seed: Int32, agg_type: Int32, agg_count: Int32, angle: Double; disabled
# ---------- py3_2: Python ----------
#locate stick class file in the same folder
from compas_rhino import unload_modules
import sys
import os
"""
#get current file path
path = ghenv.Component.OnPingDocument().FilePath
#get parent directory of the parent directory
parentdir = os.path.dirname(path)
#get src folder which contains classes
dire = os.path.join(parentdir,'scripts')

sys.path.append(dire)"""

path = 'D:\\ETH\\Github\\MAS-2526\\08_SpatialAssemblies\\StudentProjects\\group_two\\J3RRY_Sticks_^o^\\scripts\\Package_v2'
sys.path.append(path)

unload_modules('J3RRY_SingleStick_v1')
unload_modules('J3RRY_Aggregation_v1')
unload_modules('J3RRY_Collision_v1')

from J3RRY_SingleStick_v1 import Stick
from J3RRY_Aggregation_v1 import Aggregation
from J3RRY_Collision_v1 import Collision

from compas.geometry import Line, Point, Vector
from compas.geometry import Transformation
from compas_rhino.conversions import plane_to_compas_frame, frame_to_rhino_plane

import random


"""Main Code"""
# Convert rhino plane to compas frame
first_pln = plane_to_compas_frame(first_pln)
agg = Aggregation(first_pln, length, agg_type, seed)


# Aggregation
for i in range(agg_count):
    # angle = random.uniform(0, 180)
    # angle = 45*i
    agg.spawn_next_stick_random(angle, seed)


# Output
stick_out = agg.visualize()
axis_out = agg.axes
plane_out = [frame_to_rhino_plane(f) for f in agg.frames]
from_pln_out = [frame_to_rhino_plane(f) for f in agg.from_frames]
to_pln_out = [frame_to_rhino_plane(f) for f in agg.to_frames]


# Collision Check
aabb = [Point(*pt) for pt in agg.sticks[-1].aabb]

index_overlap = []
for i, s in enumerate(agg.sticks[:-2]):
    col = Collision(agg.sticks[-1], s)
    is_overlap = col.check_collision()

    if is_overlap:
        index_overlap.append(i)
        dist = col.segment_distance
        print ('index:', i, ', dist:', dist)
# ---------- end py3_2 ----------
draw_4 = COMPASDraw(cg=py3_2.stick_out)  # -> rg; disabled; same code as draw
draw_5 = COMPASDraw(cg=py3_2.axis_out)  # -> rg; disabled; same code as draw
number_slider_14 = Slider(0, range=0..10)  # disabled
lng_2 = ListLength(List=draw_4)  # disabled
draw_6 = COMPASDraw(cg=py3_2.aabb)  # -> rg; disabled; same code as draw
midpt_2 = CurveMiddle(Curve=draw_5)  # disabled
item_2 = ListItem(List=draw_6, Index=0, Wrap=True)  # -> Item, Item1; disabled
series_2 = Series(Start=0, Step=1, Count=lng_2)  # disabled
points_2 = PointList(Points=midpt_2, Size=number_slider_14)  # disabled
box_2 = Box2Pt(PointA=item_2.Item, PointB=item_2.Item1, Plane=PlaneXY(0, 0, 0))  # disabled
gradient_2 = Gradient(
    LowerLimit=0,
    UpperLimit=expr("x-1", lng_2),
    Parameter=series_2,
    stops=[0: RGB(80, 55, 25), 0.5: RGB(159, 65, 29), 1: RGB(174, 166, 129)])  # disabled
swatch_2 = ColourSwatch(SwatchColor=RGBA(255, 255, 255, 119))  # disabled
preview_3 = CustomPreview(Geometry=box_2, Material=swatch_2)  # disabled
preview_4 = CustomPreview(Geometry=draw_4, Material=gradient_2)  # disabled

pt_3 = Point(Point(-186.0594048, -107.2522057, 0))

# ----
# Demo of 6 axes SAT Check
number_slider_15 = Slider(13, range=0..100)  # disabled
crv = Curve(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)  # disabled
crv_2 = Curve(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)  # disabled
end = EndPoints(Curve=crv)  # -> Start, End; disabled
pt_4 = Point(Point(-144.4582918, 266.0791842, 0))  # disabled
pl = ConstructPlane(Origin=end.Start, XAxis=crv, YAxis=crv_2)  # disabled
deplane = DeconstructPlane(Plane=pl)  # -> Origin, XAxis, YAxis, ZAxis; disabled
amp = Amplitude(Vector=deplane.ZAxis, Amplitude=number_slider_15)  # disabled
move = Move(Geometry=pl, Motion=amp)  # -> Geometry, Transform; disabled
number_slider_16 = Slider(0, range=0..90)  # disabled
number_slider_17 = Slider(1, range=0..10)  # disabled
number_slider_18 = Slider(230, range=0..1000)  # disabled
number_slider_19 = Slider(0.477, range=0..1)  # disabled
rotate_3 = Rotate(Geometry=move.Geometry, Angle=degrees(number_slider_16), Plane=move.Geometry)  # -> Geometry, Transform; disabled
cluster_3 = Cluster(pln=pl, num=30)  # disabled
py3_3 = Python3Script(first_pln=pl, length=number_slider_18, face_index=number_slider_17, t=number_slider_19)  # -> out, axis_out, stick_out, midframe_out, evalframe_out, corner_out, stick_class; inputs first_pln: Plane, length: Double, face_index: Int32, t: Double; disabled
# ---------- py3_3: Python ----------
#locate stick class file in the same folder
from compas_rhino import unload_modules
import sys
import os
"""
#get current file path
path = ghenv.Component.OnPingDocument().FilePath
#get parent directory of the parent directory
parentdir = os.path.dirname(path)
#get src folder which contains classes
dire = os.path.join(parentdir,'scripts')

sys.path.append(dire)
"""

path = 'D:\\ETH\\Github\\MAS-2526\\08_SpatialAssemblies\\StudentProjects\\group_two\\J3RRY_Sticks_^o^\\scripts\\Package_v2'
sys.path.append(path)

unload_modules('J3RRY_SingleStick_v1')
unload_modules('J3RRY_Aggregation_v1')
unload_modules('J3RRY_Collision_v1')

from J3RRY_SingleStick_v1 import Stick
from J3RRY_Aggregation_v1 import Aggregation
from J3RRY_Collision_v1 import Collision

from compas.geometry import Line, Point, Vector
from compas.geometry import Transformation
from compas_rhino.conversions import plane_to_compas_frame, frame_to_rhino_plane
import random

"""Main Code"""
first_pln = plane_to_compas_frame(first_pln)
stick = Stick(first_pln, length)

axis = stick.axis
geo = stick.geometry
midframe = stick.midframe
evalframe = stick.eval_frame(face_index, t)
corners = stick.corners
# Output
axis_out = axis
stick_out = geo
midframe_out = frame_to_rhino_plane(midframe)
evalframe_out = frame_to_rhino_plane(evalframe)
corner_out = corners

stick_class = stick
# ---------- end py3_3 ----------
py3_4 = Python3Script(first_pln=rotate_3.Geometry, length=number_slider_18, face_index=number_slider_17, t=number_slider_19)  # -> out, axis_out, stick_out, midframe_out, evalframe_out, corner_out, stick_class; inputs first_pln: Plane, length: Double, face_index: Int32, t: Double; disabled; same code as py3_3
number_slider_20 = Slider(10, range=0..10)  # disabled
draw_7 = COMPASDraw(cg=py3_4.stick_out)  # -> rg; disabled; same code as draw
draw_8 = COMPASDraw(cg=py3_3.axis_out)  # -> rg; disabled; same code as draw
draw_9 = COMPASDraw(cg=py3_3.stick_out)  # -> rg; disabled; same code as draw
draw_10 = COMPASDraw(cg=py3_3.corner_out)  # -> rg; disabled; same code as draw
pln_3 = Plane(py3_3.midframe_out)  # disabled
pln_4 = Plane(py3_3.evalframe_out)  # disabled
cluster_4 = Cluster(pln=pln_3, num=30)  # disabled
cluster_5 = Cluster(pln=pln_4, num=30)  # disabled
py3_5 = Python3Script(stick1=py3_3.stick_class, stick2=py3_4.stick_class)  # -> out; disabled
# ---------- py3_5: Python ----------
#locate stick class file in the same folder
from compas_rhino import unload_modules
import sys
import os
"""
#get current file path
path = ghenv.Component.OnPingDocument().FilePath
#get parent directory of the parent directory
parentdir = os.path.dirname(path)
#get src folder which contains classes
dire = os.path.join(parentdir,'scripts')

sys.path.append(dire)
"""

path = 'D:\\ETH\\Github\\MAS-2526\\08_SpatialAssemblies\\StudentProjects\\group_two\\J3RRY_Sticks_^o^\\scripts\\Package_v2'
sys.path.append(path)

unload_modules('J3RRY_SingleStick_v1')
unload_modules('J3RRY_Aggregation_v1')
unload_modules('J3RRY_Collision_v1')

from J3RRY_SingleStick_v1 import Stick
from J3RRY_Aggregation_v1 import Aggregation
from J3RRY_Collision_v1 import Collision

from compas.geometry import Line, Point, Vector
from compas.geometry import Transformation
from compas_rhino.conversions import plane_to_compas_frame, frame_to_rhino_plane
import random

"""Main Code"""
col = Collision(stick1, stick2)
is_collided = col.sat_6_axis()
is_collided_2 = col.check_collision()


print (is_collided)
print (is_collided_2)
# ---------- end py3_5 ----------
panel = Panel(py3_5)  # disabled
points_3 = PointList(Points=draw_10, Size=number_slider_20)  # disabled

# ----
# Mid-phase AABB Collision + Infinate-axis Distance Check
# Diagram
xy_3 = XYPlane(Origin=pt_3)
yz_3 = YZPlane(Origin=pt_3)
xz_3 = XZPlane(Origin=pt_3)
rotate_4 = Rotate(Geometry=xy_3, Angle=degrees(Slider(90, range=0..180)), Plane=xz_3)  # -> Geometry, Transform
number_slider_21 = Slider(1, range=0..10)
pln_5 = Plane(Plane(origin=(13.5631619, -178.9141947, 129.6364106), x=(0.8385868466, 0.0141294915, 0.5445846657), y=(-0.445854499, -0.5566117195, 0.7009972607)))  # disabled

# ----
# Narrow-phase AABB Collision + Reduced SAT Check
number_slider_22 = Slider(4, range=0..100)  # disabled
number_slider_23 = Slider(2, range=0..10)  # disabled
number_slider_24 = Slider(35, range=0..100)  # disabled
number_slider_25 = Slider(216, range=0..1000)  # disabled
number_slider_26 = Slider(7, range=0..180)  # disabled
list_3 = ValueList({"Regular": 0, "Random": 1}, selected="Random")  # disabled
cluster_6 = Cluster(pln=pln_5, num=30)  # disabled
py3_6 = Python3Script(
    first_pln=pln_5,
    length=number_slider_25,
    seed=number_slider_24,
    agg_type=list_3,
    agg_count=number_slider_23,
    angle=number_slider_26)  # -> out, stick_out, axis_out, aabb, index_overlap; inputs first_pln: Plane, length: Double, seed: Int32, agg_type: Int32, agg_count: Int32, angle: Double; disabled
# ---------- py3_6: Python ----------
#locate stick class file in the same folder
from compas_rhino import unload_modules
import sys
import os
"""
#get current file path
path = ghenv.Component.OnPingDocument().FilePath
#get parent directory of the parent directory
parentdir = os.path.dirname(path)
#get src folder which contains classes
dire = os.path.join(parentdir,'scripts')

sys.path.append(dire)"""

path = 'D:\\ETH\\Github\\MAS-2526\\08_SpatialAssemblies\\StudentProjects\\group_two\\J3RRY_Sticks_^o^\\scripts\\Package_v2'
sys.path.append(path)

unload_modules('J3RRY_SingleStick_v1')
unload_modules('J3RRY_Aggregation_v1')
unload_modules('J3RRY_Collision_v1')

from J3RRY_SingleStick_v1 import Stick
from J3RRY_Aggregation_v1 import Aggregation
from J3RRY_Collision_v1 import Collision

from compas.geometry import Line, Point, Vector
from compas.geometry import Transformation
from compas_rhino.conversions import plane_to_compas_frame, frame_to_rhino_plane

import random


"""Main Code"""
# Convert rhino plane to compas frame
first_pln = plane_to_compas_frame(first_pln)
agg = Aggregation(first_pln, length, agg_type, seed)


# Aggregation
for i in range(agg_count):
    # angle = random.uniform(0, 180)
    # angle = 45*i
    agg.spawn_next_stick_random(angle, seed)


# Output
stick_out = agg.visualize()
axis_out = agg.axes
plane_out = [frame_to_rhino_plane(f) for f in agg.frames]
from_pln_out = [frame_to_rhino_plane(f) for f in agg.from_frames]
to_pln_out = [frame_to_rhino_plane(f) for f in agg.to_frames]


# Collision Check
aabb = [Point(*pt) for pt in agg.sticks[-1].aabb]

# index_overlap = []
# for i, s in enumerate(agg.sticks[:-2]):
#     col = Collision(agg.sticks[-1], s)
#     is_overlap = col.check_collision()

#     if is_overlap:
#         index_overlap.append(i)
#         dist = col.segment_distance
#         # print ('index:', i, ', dist:', dist)


for i, s in enumerate(agg.sticks[:-1]):
    col = Collision(agg.sticks[-1], s)
    is_overlap = col.sat_6_axis()
    print ('index', i, is_overlap)
# ---------- end py3_6 ----------
draw_11 = COMPASDraw(cg=py3_6.stick_out)  # -> rg; disabled; same code as draw
draw_12 = COMPASDraw(cg=py3_6.axis_out)  # -> rg; disabled; same code as draw
number_slider_27 = Slider(0, range=0..10)  # disabled
lng_3 = ListLength(List=draw_11)  # disabled
draw_13 = COMPASDraw(cg=py3_6.aabb)  # -> rg; disabled; same code as draw
midpt_3 = CurveMiddle(Curve=draw_12)  # disabled
item_3 = ListItem(List=draw_13, Index=0, Wrap=True)  # -> Item, Item1; disabled
series_3 = Series(Start=0, Step=1, Count=lng_3)  # disabled
points_4 = PointList(Points=midpt_3, Size=number_slider_27)  # disabled
box_3 = Box2Pt(PointA=item_3.Item, PointB=item_3.Item1, Plane=PlaneXY(0, 0, 0))  # disabled
gradient_3 = Gradient(
    LowerLimit=0,
    UpperLimit=expr("x-1", lng_3),
    Parameter=series_3,
    stops=[0: RGB(80, 55, 25), 0.5: RGB(159, 65, 29), 1: RGB(174, 166, 129)])  # disabled
swatch_3 = ColourSwatch(SwatchColor=RGBA(255, 255, 255, 119))  # disabled
preview_5 = CustomPreview(Geometry=box_3, Material=swatch_3)  # disabled
preview_6 = CustomPreview(Geometry=draw_11, Material=gradient_3)  # disabled

list_4 = ValueList({"Regular": 0, "Random": 1}, selected="Random")
pln_6 = Plane(rotate_4.Geometry)
panel_2 = Panel(py3_6.out)  # disabled
cluster_7 = Cluster(pln=pln_6, num=30)
panel_3 = Panel(py3.index_overlap)  # disabled

panel_4 = Panel("-1")  # disabled
line = Line(draw_2)  # disabled
number_slider_28 = Slider(1000, range=0..1000)  # disabled
item_4 = ListItem(List=line, Index=panel_4, Wrap=True)  # disabled
item_5 = ListItem(List=line, Index=panel_3, Wrap=True)  # disabled
ext = ExtendCurve(Curve=item_4, Type=0, Start=number_slider_28, End=number_slider_28)  # disabled
ext_2 = ExtendCurve(Curve=item_5, Type=0, Start=number_slider_28, End=number_slider_28)  # disabled
crvprox = CurveProximity(CurveA=ext, CurveB=ext_2)  # -> PointA, PointB, Distance; disabled
panel_5 = Panel(crvprox.Distance)  # disabled

panel_6 = Panel(py3_2.index_overlap)  # disabled

panel_7 = Panel("-1")  # disabled
line_2 = Line(draw_5)  # disabled
item_6 = ListItem(List=line_2, Index=panel_7, Wrap=True)  # disabled
item_7 = ListItem(List=line_2, Index=panel_6, Wrap=True)  # disabled
crvprox_2 = CurveProximity(CurveA=item_6, CurveB=item_7)  # -> PointA, PointB, Distance; disabled
panel_8 = Panel(crvprox_2.Distance)  # disabled

panel_9 = Panel(py3_6.index_overlap)  # disabled
brep = Brep(draw)  # disabled
panel_10 = Panel("-1")  # disabled
brep_2 = Brep(draw_4)  # disabled
panel_11 = Panel("-1")  # disabled
brep_3 = Brep(draw_11)  # disabled
panel_12 = Panel("-1")  # disabled
item_8 = ListItem(List=brep, Index=panel_3, Wrap=True)  # disabled
item_9 = ListItem(List=brep, Index=panel_10, Wrap=True)  # disabled
item_10 = ListItem(List=brep_2, Index=panel_6, Wrap=True)  # disabled
item_11 = ListItem(List=brep_2, Index=panel_11, Wrap=True)  # disabled
item_12 = ListItem(List=brep_3, Index=panel_9, Wrap=True)  # disabled
item_13 = ListItem(List=brep_3, Index=panel_12, Wrap=True)  # disabled
py3_7 = Python3Script(
    first_pln=pln_6,
    length=Slider(200, range=0..1000),
    seed=Slider(48, range=0..100),
    agg_type=list_4,
    agg_count=Slider(23, range=0..100),
    angle=Slider(12, range=0..180))  # -> out, stick_out, axis_out, aabb, index_overlap; inputs first_pln: Plane, length: Double, seed: Int32, agg_type: Int32, agg_count: Int32, angle: Double; same code as py3
draw_14 = COMPASDraw(cg=py3_7.stick_out)  # -> rg; same code as draw
draw_15 = COMPASDraw(cg=py3_7.axis_out)  # -> rg; same code as draw
panel_13 = Panel(py3_7.index_overlap)

line_3 = Line(draw_15)
number_slider_29 = Slider(1000, range=0..1000)
item_14 = ListItem(List=line_3, Index="-1", Wrap=True)
item_15 = ListItem(List=line_3, Index=panel_13, Wrap=True)
ext_3 = ExtendCurve(Curve=item_14, Type=0, Start=number_slider_29, End=number_slider_29)
ext_4 = ExtendCurve(Curve=item_15, Type=0, Start=number_slider_29, End=number_slider_29)
crvprox_3 = CurveProximity(CurveA=ext_3, CurveB=ext_4)  # -> PointA, PointB, Distance
panel_14 = Panel(crvprox_3.Distance)

brep_4 = Brep(draw_14)
draw_16 = COMPASDraw(cg=py3_7.aabb)  # -> rg; same code as draw
item_16 = ListItem(List=brep_4, Index=panel_13, Wrap=True)
item_17 = ListItem(List=brep_4, Index="-1", Wrap=True)
bbox = BoundingBox(Content=item_8, Plane=PlaneXY(0, 0, 0))  # -> Box, Box_2; disabled
panel_15 = Panel(py3.out)  # disabled
cull_i = CullIndex(List=draw_14, Indices="-1", Wrap=True)
item_18 = ListItem(List=draw_16, Index=0, Wrap=True)  # -> Item, Item1
bbox_2 = BoundingBox(Content=item_10, Plane=PlaneXY(0, 0, 0))  # -> Box, Box_2; disabled
bbox_3 = BoundingBox(Content=item_12, Plane=PlaneXY(0, 0, 0))  # -> Box, Box_2; disabled
swatch_4 = ColourSwatch(SwatchColor=RGBA(255, 255, 255, 119))  # disabled
swatch_5 = ColourSwatch(SwatchColor=RGBA(255, 255, 255, 119))  # disabled
bbox_4 = BoundingBox(Content=item_16, Plane=PlaneXY(0, 0, 0))  # -> Box, Box_2
panel_16 = Panel(py3_2.out)  # disabled
swatch_6 = ColourSwatch(SwatchColor=RGB(250, 195, 30))
box_4 = Box2Pt(PointA=item_18.Item, PointB=item_18.Item1, Plane=PlaneXY(0, 0, 0))
preview_7 = CustomPreview(Geometry=cull_i, Material=ColourSwatch(SwatchColor=RGB(0, 0, 0)))
preview_8 = CustomPreview(Geometry=item_17, Material=swatch_6)
preview_9 = CustomPreview(Geometry=item_11, Material=swatch_4)  # disabled
preview_10 = CustomPreview(Geometry=item_13, Material=swatch_5)  # disabled
wires = BrepWireframe(Brep=box_4, Density=-1)
wires_2 = BrepWireframe(Brep=item_17, Density=-1)
preview_11 = CustomPreview(Geometry=box_4, Material=ColourSwatch(SwatchColor=RGBA(255, 255, 255, 0)))
previewlw = CustomPreviewLineweights(Geometry=wires, Shader=swatch_6, Absolute=False)
previewlw_2 = CustomPreviewLineweights(Geometry=wires_2, Shader=swatch_6, Absolute=False)

# ----
# Aggregation with Rejection Sampling: AABB + 6-Axis SAT
pt_5 = Point(Point(-186.0594048, -107.2522057, 0))  # disabled
number_slider_30 = Slider(80, range=0..180)  # disabled
xy_4 = XYPlane(Origin=pt_5)  # disabled
yz_4 = YZPlane(Origin=pt_5)  # disabled
xz_4 = XZPlane(Origin=pt_5)  # disabled
rotate_5 = Rotate(Geometry=xy_4, Angle=degrees(number_slider_30), Plane=xz_4)  # -> Geometry, Transform; disabled
number_slider_31 = Slider(20, range=0..20)  # disabled
number_slider_32 = Slider(83, range=0..100)  # disabled
number_slider_33 = Slider(216, range=0..1000)  # disabled
number_slider_34 = Slider(7, range=0..180)  # disabled
number_slider_35 = Slider(26, range=0..100)  # disabled
number_slider_36 = Slider(20, range=0..20)  # disabled
pln_7 = Plane(rotate_5.Geometry)  # disabled
list_5 = ValueList({"Regular": 0, "Random": 1}, selected="Random")  # disabled
cluster_8 = Cluster(pln=pln_7, num=30)  # disabled
py3_8 = Python3Script(
    first_pln=pln_7,
    length=number_slider_33,
    seed=number_slider_35,
    agg_type=list_5,
    agg_count=number_slider_32,
    max_attempts=number_slider_31,
    angle=number_slider_34)  # -> out, stick_out, axis_out, failed_sticks, failed_axes, collision_log; inputs first_pln: Plane, length: list of Double, seed: Int32, agg_type: Int32, agg_count: Int32, max_attempts: Int32, angle: Double; disabled
# ---------- py3_8: Python ----------
#locate stick class file in the same folder
from compas_rhino import unload_modules
import sys
import os
"""
#get current file path
path = ghenv.Component.OnPingDocument().FilePath
#get parent directory of the parent directory
parentdir = os.path.dirname(path)
#get src folder which contains classes
dire = os.path.join(parentdir,'scripts')

sys.path.append(dire)"""

path = 'D:\\ETH\\Github\\MAS-2526\\08_SpatialAssemblies\\StudentProjects\\group_two\\J3RRY_Sticks_^o^\\scripts\\Package_v2'
sys.path.append(path)

unload_modules('J3RRY_SingleStick_v1')
unload_modules('J3RRY_Aggregation_v1')
unload_modules('J3RRY_Collision_v1')

from J3RRY_SingleStick_v1 import Stick
from J3RRY_Aggregation_v1 import Aggregation
from J3RRY_Collision_v1 import Collision

from compas.geometry import Line, Point, Vector
from compas.geometry import Transformation
from compas_rhino.conversions import plane_to_compas_frame, frame_to_rhino_plane

import random


"""Main Code"""
# Convert rhino plane to compas frame
first_pln = plane_to_compas_frame(first_pln)
agg = Aggregation(first_pln, length, agg_type, seed)


# Aggregation with Collision Check
index_overlap = []
for i in range(agg_count):
    new_stick = agg.spawn_next_stick_random_with_rejection(angle, max_attempts, seed)

    if new_stick is None:
        # print (f"Spawn failed at iteration {i}.")
        break
    else:
        # print ("Success. No Collision.")
        pass


# Output
stick_out = agg.visualize()
axis_out = agg.axes

from Grasshopper import DataTree
from Grasshopper.Kernel.Data import GH_Path

failed_sticks = DataTree[object]()
failed_axes = DataTree[object]()
# print (agg.failed_sticks)
# print (len(agg.failed_sticks))

for i, branch in enumerate(agg.failed_sticks):
    sub_path = GH_Path(i + 1)
    for s in branch:
        failed_sticks.Add(s.geometry, sub_path)
        failed_axes.Add(s.axis, sub_path)


collision_log = DataTree[object]()
for i, log in enumerate(agg.collision_log):
    path = GH_Path(i + 1)

    # 1. primitive values first
    collision_log.Add(f"attempts = {log['attempts']}", path)
    collision_log.Add(f"fail_count = {log['fail_count']}", path)
    collision_log.Add(f"success = {log['success']}", path)
    collision_log.Add(f"reason = {log['reason']}", path)
    collision_log.Add(f"angle = {log['params']['angle']}", path)

    # 2. list values (expand as multiple items)
    for fi in log["params"]["from_index"]:
        collision_log.Add(f"from_index = {fi}", path)

    for ft in log["params"]["from_t"]:
        collision_log.Add(f"from_t = {ft}", path)

    for ti in log["params"]["to_index"]:
        collision_log.Add(f"to_index = {ti}", path)

    for tt in log["params"]["to_t"]:
        collision_log.Add(f"to_t = {tt}", path)
# ---------- end py3_8 ----------
draw_17 = COMPASDraw(cg=py3_8.failed_sticks)  # -> rg; disabled; same code as draw
draw_18 = COMPASDraw(cg=py3_8.failed_axes)  # -> rg; disabled; same code as draw
draw_19 = COMPASDraw(cg=py3_8.stick_out)  # -> rg; disabled; same code as draw
draw_20 = COMPASDraw(cg=py3_8.axis_out)  # -> rg; disabled; same code as draw
number_slider_37 = Slider(9, range=0..10)  # disabled
lng_4 = ListLength(List=draw_19)  # disabled
midpt_4 = CurveMiddle(Curve=draw_20)  # disabled
series_4 = Series(Start=0, Step=1, Count=lng_4)  # disabled
points_5 = PointList(Points=midpt_4, Size=number_slider_37)  # disabled
gradient_4 = Gradient(
    LowerLimit=0,
    UpperLimit=expr("x-1", lng_4),
    Parameter=series_4,
    stops=[0: RGB(80, 55, 25), 0.5: RGB(159, 65, 29), 1: RGB(174, 166, 129)])  # disabled
number_slider_38 = Slider(0.515, range=0..1)  # disabled
dmaterial = DeconstructMaterial(Material=gradient_4)  # -> Diffuse, Specular, Emission, Transparency, Shine; disabled
material = CreateMaterial(
    Diffuse=dmaterial.Diffuse,
    Specular=dmaterial.Specular,
    Emission=dmaterial.Emission,
    Transparency=number_slider_38,
    Shine=dmaterial.Shine)  # disabled
preview_12 = CustomPreview(Geometry=draw_19, Material=material)  # disabled

panel_17 = Panel(py3_8.collision_log)  # disabled
panel_18 = Panel(draw_17)  # disabled

geo = Geometry()  # disabled
lng_5 = ListLength(List=geo)  # disabled
series_5 = Series(Start=0, Step=1, Count=lng_5)  # -> graft(Series); disabled
item_19 = ListItem(List=geo, Index=series_5, Wrap=True)  # disabled
cull_i_2 = CullIndex(List=geo, Indices=series_5, Wrap=True)  # disabled
clash = Clash(FirstSet=item_19, SecondSet=cull_i_2, Distance=0, L=100)  # -> ClashCount, ClashPoints, flatten(ClashRadii), FirstIndex, SecondIndex; disabled
cset = CreateSet(List=clash.ClashRadii)  # -> Set, Map; disabled
panel_19 = Panel(cset.Set)  # disabled

panel_20 = Panel(py3_8.out)  # disabled

# ----
# Aggregation with Rejection Sampling: AABB + 6-Axis SAT
pt_6 = Point(Point(-186.0594048, -107.2522057, 0))  # disabled
number_slider_39 = Slider(0, range=0..180)  # disabled
xy_5 = XYPlane(Origin=pt_6)  # disabled
yz_5 = YZPlane(Origin=pt_6)  # disabled
xz_5 = XZPlane(Origin=pt_6)  # disabled
rotate_6 = Rotate(Geometry=xy_5, Angle=degrees(number_slider_39), Plane=xz_5)  # -> Geometry, Transform; disabled
number_slider_40 = Slider(200, range=0..1000)  # disabled
number_slider_41 = Slider(20, range=0..20)  # disabled
pln_8 = Plane(rotate_6.Geometry)  # disabled
number_slider_42 = Slider(100, range=0..100)  # disabled
number_slider_43 = Slider(20, range=0..20)  # disabled
cluster_9 = Cluster(pln=pln_8, num=30)  # disabled
number_slider_44 = Slider(18, range=0..100)  # disabled
list_6 = ValueList({"Regular": 0, "Random": 1}, selected="Random")  # disabled
panel_21 = Panel("""0
30""")  # disabled
py3_9 = Python3Script(
    first_pln=pln_8,
    length_pattern=number_slider_40,
    seed=number_slider_44,
    agg_type=list_6,
    agg_count=number_slider_42,
    max_attempts=number_slider_41,
    angle_pattern=panel_21)  # -> out, stick_out, axis_out, failed_sticks, failed_axes, collision_log; inputs first_pln: Plane, length_pattern: Double, seed: Int32, agg_type: Int32, agg_count: Int32, max_attempts: Int32, angle_pattern: list of Double; disabled
# ---------- py3_9: Python ----------
#locate stick class file in the same folder
from compas_rhino import unload_modules
import sys
import os
"""
#get current file path
path = ghenv.Component.OnPingDocument().FilePath
#get parent directory of the parent directory
parentdir = os.path.dirname(path)
#get src folder which contains classes
dire = os.path.join(parentdir,'scripts')

sys.path.append(dire)"""

path = 'D:\\ETH\\Github\\MAS-2526\\08_SpatialAssemblies\\StudentProjects\\group_two\\J3RRY_Sticks_^o^\\scripts\\Package_v2'
sys.path.append(path)

unload_modules('J3RRY_SingleStick_v1')
unload_modules('J3RRY_Aggregation_v1')
unload_modules('J3RRY_Collision_v1')

from J3RRY_SingleStick_v1 import Stick
from J3RRY_Aggregation_v1 import Aggregation
from J3RRY_Collision_v1 import Collision

from compas.geometry import Line, Point, Vector
from compas.geometry import Transformation
from compas_rhino.conversions import plane_to_compas_frame, frame_to_rhino_plane

import random


"""Main Code"""
# Convert rhino plane to compas frame
first_pln = plane_to_compas_frame(first_pln)
# random pick length
agg = Aggregation(first_pln, length_pattern, agg_type, seed)


# Aggregation with Collision Check
index_overlap = []
for i in range(agg_count):
    angle = random.choice(angle_pattern)
    new_stick = agg.spawn_next_stick_random_with_rejection(angle, max_attempts, seed)

    if new_stick is None:
        # print (f"Spawn failed at iteration {i}.")
        break
    else:
        # print ("Success. No Collision.")
        pass


# Output
stick_out = agg.visualize()
axis_out = agg.axes

from Grasshopper import DataTree
from Grasshopper.Kernel.Data import GH_Path

failed_sticks = DataTree[object]()
failed_axes = DataTree[object]()
# print (agg.failed_sticks)
# print (len(agg.failed_sticks))

for i, branch in enumerate(agg.failed_sticks):
    sub_path = GH_Path(i + 1)
    for s in branch:
        failed_sticks.Add(s.geometry, sub_path)
        failed_axes.Add(s.axis, sub_path)


collision_log = DataTree[object]()
for i, log in enumerate(agg.collision_log):
    path = GH_Path(i + 1)

    # 1. primitive values first
    collision_log.Add(f"attempts = {log['attempts']}", path)
    collision_log.Add(f"fail_count = {log['fail_count']}", path)
    collision_log.Add(f"success = {log['success']}", path)
    collision_log.Add(f"reason = {log['reason']}", path)
    collision_log.Add(f"angle = {log['params']['angle']}", path)

    # 2. list values (expand as multiple items)
    for fi in log["params"]["from_index"]:
        collision_log.Add(f"from_index = {fi}", path)

    for ft in log["params"]["from_t"]:
        collision_log.Add(f"from_t = {ft}", path)

    for ti in log["params"]["to_index"]:
        collision_log.Add(f"to_index = {ti}", path)

    for tt in log["params"]["to_t"]:
        collision_log.Add(f"to_t = {tt}", path)
# ---------- end py3_9 ----------
draw_21 = COMPASDraw(cg=py3_9.failed_sticks)  # -> rg; disabled; same code as draw
draw_22 = COMPASDraw(cg=py3_9.failed_axes)  # -> rg; disabled; same code as draw
draw_23 = COMPASDraw(cg=py3_9.stick_out)  # -> rg; disabled; same code as draw
draw_24 = COMPASDraw(cg=py3_9.axis_out)  # -> rg; disabled; same code as draw
number_slider_45 = Slider(9, range=0..10)  # disabled
lng_6 = ListLength(List=draw_23)  # disabled
midpt_5 = CurveMiddle(Curve=draw_24)  # disabled
series_6 = Series(Start=0, Step=1, Count=lng_6)  # disabled
points_6 = PointList(Points=midpt_5, Size=number_slider_45)  # disabled
gradient_5 = Gradient(
    LowerLimit=0,
    UpperLimit=expr("x-1", lng_6),
    Parameter=series_6,
    stops=[0: RGB(80, 55, 25), 0.5: RGB(159, 65, 29), 1: RGB(174, 166, 129)])  # disabled
number_slider_46 = Slider(0.515, range=0..1)  # disabled
dmaterial_2 = DeconstructMaterial(Material=gradient_5)  # -> Diffuse, Specular, Emission, Transparency, Shine; disabled
material_2 = CreateMaterial(
    Diffuse=dmaterial_2.Diffuse,
    Specular=dmaterial_2.Specular,
    Emission=dmaterial_2.Emission,
    Transparency=number_slider_46,
    Shine=dmaterial_2.Shine)  # disabled
preview_13 = CustomPreview(Geometry=draw_23, Material=material_2)  # disabled

panel_22 = Panel(py3_9.collision_log)  # disabled
panel_23 = Panel(draw_21)  # disabled
panel_24 = Panel(py3_9.out)  # disabled

# ==== cluster Cluster
pln = ClusterInput()
num = ClusterInput()
pln_2 = Plane(graft(pln))
num_2 = Number(num)
deplane = DeconstructPlane(Plane=pln_2)  # -> flatten(Origin), XAxis, YAxis, ZAxis
entwine = Entwine(Branch00=deplane.XAxis, Branch01=deplane.YAxis, Branch02=deplane.ZAxis, FlattenInputs=True)
merge = Merge(
    Data1=ColourSwatch(SwatchColor=RGB(255, 0, 0)),
    Data2=ColourSwatch(SwatchColor=RGB(0, 255, 0)),
    Data3=ColourSwatch(SwatchColor=RGB(0, 0, 255)))  # -> graft(Result)
multiplication = Multiplication(A=entwine, B=num_2)
vdisex = VectorDisplayEx(Point=deplane.Origin, Vector=multiplication, Colour=merge, Width=2)
