# Grasshopper definition Dec_05_Jerry_Sticks.gh (Grasshopper 1.0.8)
# plug-ins: Weaverbird

# ----
# Aggregation with Multiple Lengths and Angles
pt = Point(Point(-186.0594048, -107.2522057, 0))  # disabled
number_slider = Slider(29, range=0..180)  # disabled
xy = XYPlane(Origin=pt)  # disabled
yz = YZPlane(Origin=pt)  # disabled
xz = XZPlane(Origin=pt)  # disabled
rotate = Rotate(Geometry=xy, Angle=degrees(number_slider), Plane=xz)  # -> Geometry, Transform; disabled
number_slider_2 = Slider(108, range=0..180)  # disabled
pln = Plane(rotate.Geometry)  # disabled
number_slider_3 = Slider(0, range=0..10)  # disabled
number_slider_4 = Slider(0, range=0..10)  # disabled
number_slider_5 = Slider(0, range=0..1)  # disabled
cluster = Cluster(pln=pln, num=30)  # disabled
number_slider_6 = Slider(0, range=0..1)  # disabled
number_slider_7 = Slider(39, range=0..100)  # disabled
list = ValueList({"Regular": 0, "Random": 1}, selected="Random")  # disabled
panel = Panel("""200
500""")  # disabled
py3 = Python3Script(
    first_pln=pln,
    length_pattern=panel,
    seed=number_slider_7,
    agg_type=list,
    from_index=number_slider_3,
    from_t=number_slider_5,
    to_index=number_slider_4,
    to_t=number_slider_6,
    angle_pattern=number_slider_2)  # -> out, stick_out, axis_out, frame_out; inputs first_pln: Plane, length_pattern: list of Double, seed: Int32, agg_type: Int32, from_index: Int32, from_t: Double, to_index: Int32, to_t: Double, angle_pattern: list of Double; disabled
# ---------- py3: Python ----------
#locate stick class file in the same folder
from compas_rhino import unload_modules
import sys
import os
"""
#get current file path
path = ghenv.Component.OnPingDocument().FilePath
#get parent directory of the parent directory
parentdir = os.path.dirname(path)
#get src folder which contains classes
dire = os.path.join(parentdir,'scripts')

sys.path.append(dire)
"""

path = 'D:\\ETH\\Github\\MAS-2526\\08_SpatialAssemblies\\StudentProjects\\group_two\\J3RRY_Sticks_^o^\\scripts\\Package_v2'
sys.path.append(path)

unload_modules('J3RRY_SingleStick_v1')
unload_modules('J3RRY_Aggregation_v2')
unload_modules('J3RRY_Collision_v1')

from J3RRY_SingleStick_v1 import Stick
from J3RRY_Aggregation_v2 import Aggregation
from J3RRY_Collision_v1 import Collision

from compas.geometry import Line, Point, Vector
from compas.geometry import Transformation
from compas_rhino.conversions import plane_to_compas_frame, frame_to_rhino_plane

import random


"""Main Code"""
# Convert rhino plane to compas frame
first_pln = plane_to_compas_frame(first_pln)
# random pick length
agg = Aggregation(first_pln, length_pattern, angle_pattern, agg_type, seed)

agg.spawn_next_stick(from_index, from_t, to_index, to_t)
# Output
stick_out = agg.visualize()
axis_out = agg.axes

frame_out = [frame_to_rhino_plane(f) for f in agg.frames]
print (agg.sticks[0].corners)
# ---------- end py3 ----------
draw = COMPASDraw(cg=py3.stick_out)  # -> rg; disabled
#   port cg: The COMPAS geometry or datastructure to be drawn.
#   port rg: The Rhino geometry object.
# ---------- draw: Python ----------
# r: compas>=2.14.1
"""
Draws COMPAS geometry in Grasshopper.
"""

from typing import Any

import Grasshopper

from compas.scene import SceneObject


class CompasToRhinoGeometry(Grasshopper.Kernel.GH_ScriptInstance):
    def RunScript(self, cg):
        if not cg:
            return None

        return SceneObject(item=cg).draw()
# ---------- end draw ----------
pln_2 = Plane(py3.frame_out)  # disabled
draw_2 = COMPASDraw(cg=py3.axis_out)  # -> rg; disabled; same code as draw
number_slider_8 = Slider(9, range=0..10)  # disabled
cluster_2 = Cluster(pln=pln_2, num=30)  # disabled
lng = ListLength(List=draw)  # disabled
midpt = CurveMiddle(Curve=draw_2)  # disabled
series = Series(Start=0, Step=1, Count=lng)  # disabled
points = PointList(Points=midpt, Size=number_slider_8)  # disabled
gradient = Gradient(
    LowerLimit=0,
    UpperLimit=expr("x-1", lng),
    Parameter=series,
    stops=[0: RGB(80, 55, 25), 0.5: RGB(159, 65, 29), 1: RGB(174, 166, 129)])  # disabled
number_slider_9 = Slider(0.515, range=0..1)  # disabled
dmaterial = DeconstructMaterial(Material=gradient)  # -> Diffuse, Specular, Emission, Transparency, Shine; disabled
material = CreateMaterial(
    Diffuse=dmaterial.Diffuse,
    Specular=dmaterial.Specular,
    Emission=dmaterial.Emission,
    Transparency=number_slider_9,
    Shine=dmaterial.Shine)  # disabled
preview = CustomPreview(Geometry=draw, Material=material)  # disabled

# ----
# Aggregation with Multiple Lengths and Angles
pt_2 = Point(Point(-186.0594048, -107.2522057, 0))  # disabled
number_slider_10 = Slider(33, range=0..180)  # disabled
xy_2 = XYPlane(Origin=pt_2)  # disabled
yz_2 = YZPlane(Origin=pt_2)  # disabled
xz_2 = XZPlane(Origin=pt_2)  # disabled
rotate_2 = Rotate(Geometry=xy_2, Angle=degrees(number_slider_10), Plane=xz_2)  # -> Geometry, Transform; disabled
pln_3 = Plane(rotate_2.Geometry)  # disabled
number_slider_11 = Slider(1, range=0..100)  # disabled
cluster_3 = Cluster(pln=pln_3, num=30)  # disabled
number_slider_12 = Slider(30, range=0..100)  # disabled
list_2 = ValueList({"Regular": 0, "Random": 1}, selected="Regular")  # disabled
panel_2 = Panel("""0
30""")  # disabled
panel_3 = Panel("""200
500""")  # disabled
py3_2 = Python3Script(
    first_pln=pln_3,
    length_pattern=panel_3,
    seed=number_slider_12,
    agg_type=list_2,
    agg_count=number_slider_11,
    angle_pattern=panel_2)  # -> out, stick_out, axis_out, frame_out; inputs first_pln: Plane, length_pattern: list of Double, seed: Int32, agg_type: Int32, agg_count: Int32, angle_pattern: list of Double; disabled
# ---------- py3_2: Python ----------
#locate stick class file in the same folder
from compas_rhino import unload_modules
import sys
import os
"""
#get current file path
path = ghenv.Component.OnPingDocument().FilePath
#get parent directory of the parent directory
parentdir = os.path.dirname(path)
#get src folder which contains classes
dire = os.path.join(parentdir,'scripts')

sys.path.append(dire)
"""

path = 'D:\\ETH\\Github\\MAS-2526\\08_SpatialAssemblies\\StudentProjects\\group_two\\J3RRY_Sticks_^o^\\scripts\\Package_v2'
sys.path.append(path)

unload_modules('J3RRY_SingleStick_v1')
unload_modules('J3RRY_Aggregation_v2')
unload_modules('J3RRY_Collision_v1')

from J3RRY_SingleStick_v1 import Stick
from J3RRY_Aggregation_v2 import Aggregation
from J3RRY_Collision_v1 import Collision

from compas.geometry import Line, Point, Vector
from compas.geometry import Transformation
from compas_rhino.conversions import plane_to_compas_frame, frame_to_rhino_plane

import random


"""Main Code"""
# Convert rhino plane to compas frame
first_pln = plane_to_compas_frame(first_pln)
# random pick length
agg = Aggregation(first_pln, length_pattern, angle_pattern, agg_type, seed)

for i in range(agg_count):
    agg.spawn_next_stick_random(seed)
# Output
stick_out = agg.visualize()
axis_out = agg.axes

frame_out = [frame_to_rhino_plane(f) for f in agg.frames]
# ---------- end py3_2 ----------
draw_3 = COMPASDraw(cg=py3_2.stick_out)  # -> rg; disabled; same code as draw
pln_4 = Plane(py3_2.frame_out)  # disabled
draw_4 = COMPASDraw(cg=py3_2.axis_out)  # -> rg; disabled; same code as draw
number_slider_13 = Slider(9, range=0..10)  # disabled
cluster_4 = Cluster(pln=pln_4, num=30)  # disabled
lng_2 = ListLength(List=draw_3)  # disabled
midpt_2 = CurveMiddle(Curve=draw_4)  # disabled
series_2 = Series(Start=0, Step=1, Count=lng_2)  # disabled
points_2 = PointList(Points=midpt_2, Size=number_slider_13)  # disabled
gradient_2 = Gradient(
    LowerLimit=0,
    UpperLimit=expr("x-1", lng_2),
    Parameter=series_2,
    stops=[0: RGB(80, 55, 25), 0.5: RGB(159, 65, 29), 1: RGB(174, 166, 129)])  # disabled
number_slider_14 = Slider(0.515, range=0..1)  # disabled
dmaterial_2 = DeconstructMaterial(Material=gradient_2)  # -> Diffuse, Specular, Emission, Transparency, Shine; disabled
material_2 = CreateMaterial(
    Diffuse=dmaterial_2.Diffuse,
    Specular=dmaterial_2.Specular,
    Emission=dmaterial_2.Emission,
    Transparency=number_slider_14,
    Shine=dmaterial_2.Shine)  # disabled
preview_2 = CustomPreview(Geometry=draw_3, Material=material_2)  # disabled

# ----
# Aggregation with Multiple Lengths and Angles
pt_3 = Point(Point(-186.0594048, -107.2522057, 0))  # disabled
number_slider_15 = Slider(0, range=0..180)  # disabled
xy_3 = XYPlane(Origin=pt_3)  # disabled
yz_3 = YZPlane(Origin=pt_3)  # disabled
xz_3 = XZPlane(Origin=pt_3)  # disabled
rotate_3 = Rotate(Geometry=xy_3, Angle=degrees(number_slider_15), Plane=xz_3)  # -> Geometry, Transform; disabled
number_slider_16 = Slider(20, range=0..20)  # disabled
pln_5 = Plane(rotate_3.Geometry)  # disabled
number_slider_17 = Slider(100, range=0..100)  # disabled
number_slider_18 = Slider(20, range=0..20)  # disabled
cluster_5 = Cluster(pln=pln_5, num=30)  # disabled
number_slider_19 = Slider(47, range=0..100)  # disabled
list_3 = ValueList({"Regular": 0, "Random": 1}, selected="Random")  # disabled
panel_4 = Panel("""100
300
600""")  # disabled
panel_5 = Panel("""0
30
120""")  # disabled
py3_3 = Python3Script(
    first_pln=pln_5,
    length_pattern=panel_4,
    seed=number_slider_19,
    agg_type=list_3,
    agg_count=number_slider_17,
    max_attempts=number_slider_16,
    angle_pattern=panel_5)  # -> out, stick_out, axis_out, failed_sticks, failed_axes, collision_log; inputs first_pln: Plane, length_pattern: list of Double, seed: Int32, agg_type: Int32, agg_count: Int32, max_attempts: Int32, angle_pattern: list of Double; disabled
# ---------- py3_3: Python ----------
#locate stick class file in the same folder
from compas_rhino import unload_modules
import sys
import os
"""
#get current file path
path = ghenv.Component.OnPingDocument().FilePath
#get parent directory of the parent directory
parentdir = os.path.dirname(path)
#get src folder which contains classes
dire = os.path.join(parentdir,'scripts')

sys.path.append(dire)"""

path = 'D:\\ETH\\Github\\MAS-2526\\08_SpatialAssemblies\\StudentProjects\\group_two\\J3RRY_Sticks_^o^\\scripts\\Package_v2'
sys.path.append(path)

unload_modules('J3RRY_SingleStick_v1')
unload_modules('J3RRY_Aggregation_v2')
unload_modules('J3RRY_Collision_v1')

from J3RRY_SingleStick_v1 import Stick
from J3RRY_Aggregation_v2 import Aggregation
from J3RRY_Collision_v1 import Collision

from compas.geometry import Line, Point, Vector
from compas.geometry import Transformation
from compas_rhino.conversions import plane_to_compas_frame, frame_to_rhino_plane

import random


"""Main Code"""
# Convert rhino plane to compas frame
first_pln = plane_to_compas_frame(first_pln)
# random pick length
agg = Aggregation(first_pln, length_pattern, angle_pattern, agg_type, seed)


# Aggregation with Collision Check
index_overlap = []
for i in range(agg_count):
    new_stick = agg.spawn_next_stick_random_with_rejection(max_attempts, seed)

    if new_stick is None:
        # print (f"Spawn failed at iteration {i}.")
        break
    else:
        # print ("Success. No Collision.")
        pass


# Output
stick_out = agg.visualize()
axis_out = agg.axes

from Grasshopper import DataTree
from Grasshopper.Kernel.Data import GH_Path

failed_sticks = DataTree[object]()
failed_axes = DataTree[object]()
# print (agg.failed_sticks)
# print (len(agg.failed_sticks))

for i, branch in enumerate(agg.failed_sticks):
    sub_path = GH_Path(i + 1)
    for s in branch:
        failed_sticks.Add(s.geometry, sub_path)
        failed_axes.Add(s.axis, sub_path)


collision_log = DataTree[object]()
for i, log in enumerate(agg.collision_log):
    path = GH_Path(i + 1)

    # 1. primitive values first
    collision_log.Add(f"attempts = {log['attempts']}", path)
    collision_log.Add(f"fail_count = {log['fail_count']}", path)
    collision_log.Add(f"success = {log['success']}", path)
    collision_log.Add(f"reason = {log['reason']}", path)
    collision_log.Add(f"length = {log['params']['length']}", path)    
    collision_log.Add(f"angle = {log['params']['angle']}", path)
    collision_log.Add(f"from_index = {log['params']['from_index']}", path)
    collision_log.Add(f"to_index = {log['params']['to_index']}", path)
    collision_log.Add(f"from_t = {log['params']['from_t']}", path)
    collision_log.Add(f"to_t = {log['params']['to_t']}", path)
# ---------- end py3_3 ----------
draw_5 = COMPASDraw(cg=py3_3.failed_sticks)  # -> rg; disabled; same code as draw
draw_6 = COMPASDraw(cg=py3_3.failed_axes)  # -> rg; disabled; same code as draw
draw_7 = COMPASDraw(cg=py3_3.stick_out)  # -> rg; disabled; same code as draw
draw_8 = COMPASDraw(cg=py3_3.axis_out)  # -> rg; disabled; same code as draw
number_slider_20 = Slider(9, range=0..10)  # disabled
lng_3 = ListLength(List=draw_7)  # disabled
midpt_3 = CurveMiddle(Curve=draw_8)  # disabled
series_3 = Series(Start=0, Step=1, Count=lng_3)  # disabled
points_3 = PointList(Points=midpt_3, Size=number_slider_20)  # disabled
gradient_3 = Gradient(
    LowerLimit=0,
    UpperLimit=expr("x-1", lng_3),
    Parameter=series_3,
    stops=[0: RGB(80, 55, 25), 0.5: RGB(159, 65, 29), 1: RGB(174, 166, 129)])  # disabled
number_slider_21 = Slider(0.515, range=0..1)  # disabled
dmaterial_3 = DeconstructMaterial(Material=gradient_3)  # -> Diffuse, Specular, Emission, Transparency, Shine; disabled
material_3 = CreateMaterial(
    Diffuse=dmaterial_3.Diffuse,
    Specular=dmaterial_3.Specular,
    Emission=dmaterial_3.Emission,
    Transparency=number_slider_21,
    Shine=dmaterial_3.Shine)  # disabled
preview_3 = CustomPreview(Geometry=draw_7, Material=material_3)  # disabled

panel_6 = Panel(py3_3.collision_log)  # disabled
panel_7 = Panel(draw_5)  # disabled
panel_8 = Panel(py3_3.out)  # disabled

# ----
# Demo of Compas Point in Polyhedron
P = Plane(PlaneXY(0, 0, 0))  # disabled
wbicosahedron = WeaverbirdsMeshMeshIcosahedron(Plane=P, Radius=5)  # disabled
pop3d = Populate3D(Region={Plane=PlaneXY(0, 0, 0), X=Domain(0, 10), Y=Domain(0, 10), Z=Domain(0, 2)}, Count=100, Seed=1)  # disabled
pt_4 = Point(Point(4.472136021, 0, 2.23606801))  # disabled
py3_4 = Python3Script(x=wbicosahedron, y=pop3d, z=pt_4)  # -> out, a, b; inputs x: Mesh, y: list of Point3d, z: Point3d; disabled
# ---------- py3_4: Python ----------
import compas.geometry as cg
import compas_rhino.conversions as crc

mesh = crc.mesh_to_compas(x)
pts = [crc.point_to_compas(pt) for pt in y]

vertices, faces = mesh.to_vertices_and_faces()

print (mesh)
# print (vertices)
# print (faces)
poly = cg.Polyhedron(vertices, faces)
print (poly)

inside = []
for pt in pts:
    is_inside = cg.is_point_in_polyhedron(pt, poly)
    inside.append(is_inside)
a = inside

p = crc.point_to_compas(z)
is_inside = cg.is_point_in_polyhedron(p, poly)
b = is_inside
# ---------- end py3_4 ----------
panel_9 = Panel(py3_4.b)  # disabled
cull = CullPattern(List=pop3d, CullPattern=py3_4.a)  # disabled
panel_10 = Panel(py3_4.a)  # disabled

# ----
# Aggregation within boundary
pt_5 = Point(Point(-186.0594048, -107.2522057, 0))  # disabled
number_slider_22 = Slider(90, range=0..180)  # disabled
xy_4 = XYPlane(Origin=pt_5)  # disabled
yz_4 = YZPlane(Origin=pt_5)  # disabled
xz_4 = XZPlane(Origin=pt_5)  # disabled
number_slider_23 = Slider(295, range=0..1000)  # disabled
rotate_4 = Rotate(Geometry=xy_4, Angle=degrees(number_slider_22), Plane=xz_4)  # -> Geometry, Transform; disabled
number_slider_24 = Slider(20, range=0..20)  # disabled
wbicosahedron_2 = WeaverbirdsMeshMeshIcosahedron(Plane=PlaneXY(0, 0, 0), Radius=number_slider_23)  # disabled
pln_6 = Plane(rotate_4.Geometry)  # disabled
number_slider_25 = Slider(93, range=0..100)  # disabled
number_slider_26 = Slider(10, range=0..20)  # disabled
cluster_6 = Cluster(pln=pln_6, num=30)  # disabled
number_slider_27 = Slider(39, range=0..100)  # disabled
list_4 = ValueList({"Regular": 0, "Random": 1}, selected="Regular")  # disabled
mesh = Mesh(wbicosahedron_2)  # disabled
wbedges = WeaverbirdsMeshEdges(MeshOrPolylines=mesh)  # disabled
panel_11 = Panel("""100
300""")  # disabled
panel_12 = Panel("""20
160""")  # disabled
py3_5 = Python3Script(
    first_pln=pln_6,
    length_pattern=panel_11,
    seed=number_slider_27,
    agg_type=list_4,
    agg_count=number_slider_25,
    max_attempts=number_slider_24,
    angle_pattern=panel_12,
    boundary_mesh=mesh)  # -> out, stick_out, axis_out, failed_sticks, failed_axes, collision_log, valid_sticks; inputs first_pln: Plane, length_pattern: list of Double, seed: Int32, agg_type: Int32, agg_count: Int32, max_attempts: Int32, angle_pattern: list of Double, boundary_mesh: Mesh; disabled
# ---------- py3_5: Python ----------
#locate stick class file in the same folder
from compas_rhino import unload_modules
import sys
import os
"""
#get current file path
path = ghenv.Component.OnPingDocument().FilePath
#get parent directory of the parent directory
parentdir = os.path.dirname(path)
#get src folder which contains classes
dire = os.path.join(parentdir,'scripts')

sys.path.append(dire)"""

path = 'D:\\ETH\\Github\\MAS-2526\\08_SpatialAssemblies\\StudentProjects\\group_two\\J3RRY_Sticks_^o^\\scripts\\Package_v2'
sys.path.append(path)

unload_modules('J3RRY_SingleStick_v1')
unload_modules('J3RRY_Aggregation_v2')
unload_modules('J3RRY_Collision_v1')

from J3RRY_SingleStick_v1 import Stick
from J3RRY_Aggregation_v2 import Aggregation
from J3RRY_Collision_v1 import Collision

from compas.geometry import Line, Point, Vector
from compas.geometry import Transformation
from compas_rhino.conversions import plane_to_compas_frame, frame_to_rhino_plane
import scriptcontext as sc
import random


"""Main Code"""

# Convert rhino plane to compas frame
first_pln = plane_to_compas_frame(first_pln)
# random pick length
agg = Aggregation(first_pln, length_pattern, angle_pattern, agg_type, seed)

# Aggregation with Collision Check
index_overlap = []
for i in range(agg_count):
    new_stick = agg.spawn_next_stick_random_in_boundary(
        boundary_mesh, max_attempts, seed)

    if new_stick is None:
        # print (f"Spawn failed at iteration {i}.")
        break
    else:
        # print ("Success. No Collision.")
        pass


# Output
stick_out = agg.visualize()
axis_out = agg.axes

from Grasshopper import DataTree
from Grasshopper.Kernel.Data import GH_Path

failed_sticks = DataTree[object]()
failed_axes = DataTree[object]()
valid_sticks = DataTree[object]()
valid_axes = DataTree[object]()

for i, branch in enumerate(agg.failed_sticks):
    sub_path = GH_Path(i + 1)
    for s in branch:
        failed_sticks.Add(s.geometry, sub_path)
        failed_axes.Add(s.axis, sub_path)

for i, branch in enumerate(agg.valid_sticks):
    sub_path = GH_Path(i + 1)
    for s in branch:
        valid_sticks.Add(s.geometry, sub_path)
        valid_axes.Add(s.axis, sub_path)



# collision_log = DataTree[object]()
# for i, log in enumerate(agg.collision_log):
#     path = GH_Path(i + 1)

#     # 1. primitive values first
#     collision_log.Add(f"attempts = {log['attempts']}", path)
#     collision_log.Add(f"fail_count = {log['fail_count']}", path)
#     collision_log.Add(f"success = {log['success']}", path)
#     collision_log.Add(f"reason = {log['reason']}", path)
#     collision_log.Add(f"length = {log['params']['length']}", path)    
#     collision_log.Add(f"angle = {log['params']['angle']}", path)
#     collision_log.Add(f"from_index = {log['params']['from_index']}", path)
#     collision_log.Add(f"to_index = {log['params']['to_index']}", path)
#     collision_log.Add(f"from_t = {log['params']['from_t']}", path)
#     collision_log.Add(f"to_t = {log['params']['to_t']}", path)
# ---------- end py3_5 ----------
panel_13 = Panel(py3_5.out)  # disabled
draw_9 = COMPASDraw(cg=py3_5.stick_out)  # -> rg; disabled; same code as draw
draw_10 = COMPASDraw(cg=py3_5.failed_axes)  # -> rg; disabled; same code as draw
draw_11 = COMPASDraw(cg=py3_5.axis_out)  # -> rg; disabled; same code as draw
number_slider_28 = Slider(9, range=0..100)  # disabled
draw_12 = COMPASDraw(cg=py3_5.failed_sticks)  # -> rg; disabled; same code as draw
draw_13 = COMPASDraw(cg=py3_5.valid_sticks)  # -> rg; disabled; same code as draw
geo = Geometry(draw_9)  # disabled
number_slider_29 = Slider(9, range=0..10)  # disabled
lng_4 = ListLength(List=geo)  # disabled
midpt_4 = CurveMiddle(Curve=draw_11)  # disabled
min = Minimum(A=number_slider_28, B=lng_4)  # disabled
points_4 = PointList(Points=midpt_4, Size=number_slider_29)  # disabled
series_4 = Series(Start=0, Step=1, Count=min)  # disabled
item = ListItem(List=geo, Index=series_4, Wrap=True)  # disabled
lng_5 = ListLength(List=item)  # disabled
series_5 = Series(Start=0, Step=1, Count=lng_5)  # disabled
gradient_4 = Gradient(
    LowerLimit=0,
    UpperLimit=expr("x-1", lng_5),
    Parameter=series_5,
    stops=[0: RGB(80, 55, 25), 0.5: RGB(159, 65, 29), 1: RGB(174, 166, 129)])  # disabled
number_slider_30 = Slider(0.515, range=0..1)  # disabled
dmaterial_4 = DeconstructMaterial(Material=gradient_4)  # -> Diffuse, Specular, Emission, Transparency, Shine; disabled
path = ConstructPath(Indices=min)  # disabled
geo_2 = Geometry(draw_13)  # disabled
material_4 = CreateMaterial(
    Diffuse=dmaterial_4.Diffuse,
    Specular=dmaterial_4.Specular,
    Emission=dmaterial_4.Emission,
    Transparency=number_slider_30,
    Shine=dmaterial_4.Shine)  # disabled
geo_3 = Geometry(draw_12)  # disabled
branch = TreeBranch(Tree=geo_3, Path=path, MaintainPaths=True)  # disabled
branch_2 = TreeBranch(Tree=geo_2, Path=path, MaintainPaths=True)  # disabled
preview_4 = CustomPreview(Geometry=item, Material=material_4)  # disabled

# ----
# Multiple Aggregations
number_slider_31 = Slider(0, range=0..100)  # disabled
pt_6 = ConstructPoint(XCoordinate=number_slider_31, YCoordinate=number_slider_31, ZCoordinate=0)  # disabled
panel_15 = Panel("-10")  # disabled
number_slider_32 = Slider(-8, range=-90..90)  # disabled
pt_7 = Point(pt_6)  # disabled
number_slider_33 = Slider(12, range=0..20)  # disabled
number_slider_34 = Slider(28, range=0..100)  # disabled
Z = UnitZ(Factor=panel_15)  # disabled
number_slider_35 = Slider(5, range=0..10)  # disabled
number_slider_36 = Slider(200, range=0..1000)  # disabled
move = Move(Geometry=pt_7, Motion=Z)  # -> Geometry, Transform; disabled
addition = Addition(A=number_slider_36, B=number_slider_34)  # disabled
number_slider_37 = Slider(262, range=0..1000)  # disabled
number_slider_38 = Slider(1200, range=0..10000)  # disabled
py3_6 = Python3Script(origin=pt_7, legs=number_slider_35, r=number_slider_36, incline=number_slider_32)  # -> out, plns_out; inputs origin: Point3d, legs: Int32, r: Double, incline: Double; disabled
# ---------- py3_6: Python ----------
import Rhino.Geometry as rg
import math


plns = []
for i in range(legs):
    theta = 2 * math.pi * (i / legs)
    x = origin.X + r * math.cos(theta)
    y = origin.Y + r * math.sin(theta)
    pt = rg.Point3d(x, y, 0)

    pln = rg.Plane(pt, rg.Vector3d.ZAxis)
    pln.Rotate(theta, rg.Vector3d.ZAxis)
    pln.Rotate(-math.pi / 2, pln.YAxis)
    pln.Rotate(math.radians(incline), pln.YAxis)
    plns.append(pln)

plns_out = plns
# ---------- end py3_6 ----------
polygon = Polygon(Plane=move.Geometry, Radius=addition, Segments=number_slider_33, FilletRadius=0)  # -> Polygon, Length; disabled
offset = OffsetCurve(Curve=polygon.Polygon, Distance=number_slider_37, Corners=1)  # disabled
Z_2 = UnitZ(Factor=number_slider_38)  # disabled
cluster_7 = Cluster(pln=py3_6.plns_out, num=30)  # disabled
disc = Discontinuity(Curve=polygon.Polygon, Level=1)  # -> Points, Parameters; disabled
panel_16 = Panel("-1")  # disabled
move_2 = Move(Geometry=offset, Motion=Z_2)  # -> Geometry, Transform; disabled
shift = ShiftList(List=disc.Points, Shift=panel_16, Wrap=True)  # disabled
disc_2 = Discontinuity(Curve=move_2.Geometry, Level=1)  # -> Points, Parameters; disabled
panel_17 = Panel("-1")  # disabled
long = LongestList(ListA=shift, ListB=disc.Points, ListC=move.Geometry, PaddingMode=2)  # -> ListA, ListB, ListC; disabled
shift_2 = ShiftList(List=disc_2.Points, Shift=panel_17, Wrap=True)  # disabled
long_2 = LongestList(ListA=shift, ListB=disc.Points, ListC=disc_2.Points, ListD=shift_2, PaddingMode=2)  # -> ListA, ListB, ListC, ListD; disabled
transform = Transform(Geometry=move.Geometry, Transform=move_2.Transform)  # disabled
merge = Merge(Data1=graft(long.ListA), Data2=graft(long.ListB), Data3=graft(long.ListC))  # -> reverse(Result); disabled
merge_2 = Merge(Data1=graft(long_2.ListA), Data2=graft(long_2.ListB), Data3=graft(long_2.ListC), Data4=graft(long_2.ListD))  # disabled
long_3 = LongestList(ListA=shift_2, ListB=disc_2.Points, ListC=transform, PaddingMode=2)  # -> ListA, ListB, ListC; disabled
conmesh = ConstructMesh(Vertices=merge, Faces={A=0, B=1, C=2, D=2})  # disabled
merge_3 = Merge(Data1=graft(long_3.ListA), Data2=graft(long_3.ListB), Data3=graft(long_3.ListC))  # disabled
conmesh_2 = ConstructMesh(Vertices=merge_2, Faces={A=0, B=1, C=2, D=3})  # disabled
conmesh_3 = ConstructMesh(Vertices=merge_3, Faces={A=0, B=1, C=2, D=2})  # disabled
merge_4 = Merge(Data1=simplify(conmesh), Data2=simplify(conmesh_2), Data3=simplify(conmesh_3))  # -> flatten(Result); disabled
mjoin = MeshJoin(Meshes=merge_4)  # disabled
number_slider_39 = Slider(10, range=0..20)  # disabled
number_slider_40 = Slider(10, range=0..20)  # disabled
number_slider_41 = Slider(3, range=0..20)  # disabled
number_slider_42 = Slider(29, range=0..100)  # disabled
mesh_2 = Mesh(mjoin)  # disabled
panel_18 = Panel("""200
400""")  # disabled
list_5 = ValueList({"Regular": 0, "Random": 1}, selected="Random")  # disabled
pln_7 = Plane(py3_6.plns_out)  # disabled
wbedges_2 = WeaverbirdsMeshEdges(MeshOrPolylines=mesh_2)  # disabled
panel_19 = Panel("""20
160""")  # disabled
py3_7 = Python3Script(
    first_plns=pln_7,
    length_pattern=panel_18,
    angle_pattern=panel_19,
    agg_type=list_5,
    seed=number_slider_42,
    agg_count=number_slider_41,
    agg_round=number_slider_40,
    max_attempts=number_slider_39,
    boundary_mesh=mesh_2)  # -> out, stick_out, axis_out, failed_sticks, valid_sticks, collision_log; inputs first_plns: list of Plane, length_pattern: list of Double, angle_pattern: list of Double, agg_type: Int32, seed: Int32, agg_count: Int32, agg_round: Int32, max_attempts: Int32, boundary_mesh: Mesh; disabled
# ---------- py3_7: Python ----------
#locate stick class file in the same folder
from compas_rhino import unload_modules
import sys
import os
"""
#get current file path
path = ghenv.Component.OnPingDocument().FilePath
#get parent directory of the parent directory
parentdir = os.path.dirname(path)
#get src folder which contains classes
dire = os.path.join(parentdir,'scripts')

sys.path.append(dire)"""

path = 'D:\\ETH\\Github\\MAS-2526\\08_SpatialAssemblies\\StudentProjects\\group_two\\J3RRY_Sticks_^o^\\scripts\\Package_v2'
sys.path.append(path)

unload_modules('J3RRY_SingleStick_v1')
unload_modules('J3RRY_Aggregation_v3')
unload_modules('J3RRY_Collision_v1')

from J3RRY_SingleStick_v1 import Stick
from J3RRY_Aggregation_v3 import Aggregation
from J3RRY_Collision_v1 import Collision

from compas.geometry import Line, Point, Vector
from compas.geometry import Transformation
from compas_rhino.conversions import plane_to_compas_frame, frame_to_rhino_plane
import scriptcontext as sc
import random

from Grasshopper import DataTree
from Grasshopper.Kernel.Data import GH_Path

"""Main Code"""
# Convert rhino plane to compas frame
first_frames = [plane_to_compas_frame(p) for p in first_plns]

aggs = []
global_sticks = []
for i, frame in enumerate(first_frames):
    agg = Aggregation(frame, length_pattern, angle_pattern, agg_type, seed+i)
    aggs.append(agg)
    global_sticks.extend(agg.sticks)

for _ in range(agg_round):
    for i, agg in enumerate(aggs):
        for _ in range(agg_count):
            new_stick = agg.spawn_next_stick_random_in_boundary(
                boundary_mesh, max_attempts, seed, global_sticks)
            if new_stick is not None:
                global_sticks.append(new_stick)

# Visualization
stick_tree = DataTree[object]()
axis_tree = DataTree[object]()
for i, agg in enumerate(aggs):
    path = GH_Path(i)
    sticks = agg.sticks
    axes = agg.axes
    for s, axis in zip(sticks, axes):
        stick_tree.Add(s.geometry, path)
        axis_tree.Add(axis, path)
# Output
stick_out = stick_tree
axis_out = axis_tree

# Log
failed_sticks = DataTree[object]()
valid_sticks = DataTree[object]()
for i, agg in enumerate(aggs):
    for j, branch in enumerate(agg.failed_sticks):
        path = GH_Path(i, j + 1)
        for s in branch:
            failed_sticks.Add(s.geometry, path)

    for j, branch in enumerate(agg.valid_sticks):
        path = GH_Path(i, j + 1)
        for s in branch:
            valid_sticks.Add(s.geometry, path)



# collision_log = DataTree[object]()
# for i, log in enumerate(agg.collision_log):
#     path = GH_Path(i + 1)

#     # 1. primitive values first
#     collision_log.Add(f"attempts = {log['attempts']}", path)
#     collision_log.Add(f"fail_count = {log['fail_count']}", path)
#     collision_log.Add(f"success = {log['success']}", path)
#     collision_log.Add(f"reason = {log['reason']}", path)
#     collision_log.Add(f"length = {log['params']['length']}", path)    
#     collision_log.Add(f"angle = {log['params']['angle']}", path)
#     collision_log.Add(f"from_index = {log['params']['from_index']}", path)
#     collision_log.Add(f"to_index = {log['params']['to_index']}", path)
#     collision_log.Add(f"from_t = {log['params']['from_t']}", path)
#     collision_log.Add(f"to_t = {log['params']['to_t']}", path)
# ---------- end py3_7 ----------
panel_20 = Panel(py3_7.collision_log)  # disabled
number_slider_43 = Slider(30, range=0..30)  # disabled
draw_14 = COMPASDraw(cg=py3_7.stick_out)  # -> rg; disabled; same code as draw
draw_15 = COMPASDraw(cg=py3_7.axis_out)  # -> rg; disabled; same code as draw
number_slider_44 = Slider(10, range=0..10)  # disabled
draw_16 = COMPASDraw(cg=py3_7.failed_sticks)  # -> rg; disabled; same code as draw
draw_17 = COMPASDraw(cg=py3_7.valid_sticks)  # -> rg; disabled; same code as draw
geo_4 = Geometry(draw_14)  # disabled
midpt_5 = CurveMiddle(Curve=draw_15)  # disabled
addition_2 = Addition(A=number_slider_43, B=1)  # disabled
lng_6 = ListLength(List=geo_4)  # disabled
points_5 = PointList(Points=midpt_5, Size=number_slider_44)  # disabled
min_2 = Minimum(A=addition_2, B=lng_6)  # disabled
series_6 = Series(Start=0, Step=1, Count=min_2)  # disabled
panel_21 = Panel(min_2)  # disabled
item_2 = ListItem(List=geo_4, Index=series_6, Wrap=True)  # disabled
lng_7 = ListLength(List=item_2)  # disabled
series_7 = Series(Start=0, Step=1, Count=lng_7)  # disabled
gradient_5 = Gradient(
    LowerLimit=0,
    UpperLimit=expr("x-1", lng_7),
    Parameter=series_7,
    stops=[0: RGB(80, 55, 25), 0.5: RGB(159, 65, 29), 1: RGB(174, 166, 129)])  # disabled
number_slider_45 = Slider(0.515, range=0..1)  # disabled
min_3 = Minimum(A=number_slider_43, B=lng_6)  # disabled
panel_22 = Panel("{?;")  # disabled
panel_23 = Panel("}")  # disabled
dmaterial_5 = DeconstructMaterial(Material=gradient_5)  # -> Diffuse, Specular, Emission, Transparency, Shine; disabled
concat = Concatenate(FragmentA=panel_22, FragmentB=min_3, FragmentC=panel_23)  # disabled
material_5 = CreateMaterial(
    Diffuse=dmaterial_5.Diffuse,
    Specular=dmaterial_5.Specular,
    Emission=dmaterial_5.Emission,
    Transparency=number_slider_45,
    Shine=dmaterial_5.Shine)  # disabled
split = SplitTree(Data=draw_16, Masks=flatten(concat))  # -> Positive, Negative; disabled
split_2 = SplitTree(Data=draw_17, Masks=flatten(concat))  # -> Positive, Negative; disabled
preview_5 = CustomPreview(Geometry=item_2, Material=material_5)  # disabled

# ----
# Multiple Aggregations and Branches
# for Week 3 Prototype (Fixed Params)
number_slider_46 = Slider(0, range=0..100)  # disabled
pt_8 = ConstructPoint(XCoordinate=number_slider_46, YCoordinate=number_slider_46, ZCoordinate=0)  # disabled
panel_24 = Panel("-10")  # disabled
number_slider_47 = Slider(-8, range=-90..90)  # disabled
pt_9 = Point(pt_8)  # disabled
number_slider_48 = Slider(12, range=0..20)  # disabled
number_slider_49 = Slider(28, range=0..100)  # disabled
Z_3 = UnitZ(Factor=panel_24)  # disabled
number_slider_50 = Slider(3, range=0..10)  # disabled
number_slider_51 = Slider(150, range=0..1000)  # disabled
move_3 = Move(Geometry=pt_9, Motion=Z_3)  # -> Geometry, Transform; disabled
addition_3 = Addition(A=number_slider_51, B=number_slider_49)  # disabled
number_slider_52 = Slider(262, range=0..1000)  # disabled
number_slider_53 = Slider(1200, range=0..10000)  # disabled
py3_8 = Python3Script(origin=pt_9, legs=number_slider_50, r=number_slider_51, incline=number_slider_47)  # -> out, plns_out; inputs origin: Point3d, legs: Int32, r: Double, incline: Double; disabled; same code as py3_6
polygon_2 = Polygon(Plane=move_3.Geometry, Radius=addition_3, Segments=number_slider_48, FilletRadius=0)  # -> Polygon, Length; disabled
offset_2 = OffsetCurve(Curve=polygon_2.Polygon, Distance=number_slider_52, Corners=1)  # disabled
Z_4 = UnitZ(Factor=number_slider_53)  # disabled
cluster_8 = Cluster(pln=py3_8.plns_out, num=30)  # disabled
disc_3 = Discontinuity(Curve=polygon_2.Polygon, Level=1)  # -> Points, Parameters; disabled
panel_25 = Panel("-1")  # disabled
move_4 = Move(Geometry=offset_2, Motion=Z_4)  # -> Geometry, Transform; disabled
shift_3 = ShiftList(List=disc_3.Points, Shift=panel_25, Wrap=True)  # disabled
disc_4 = Discontinuity(Curve=move_4.Geometry, Level=1)  # -> Points, Parameters; disabled
panel_26 = Panel("-1")  # disabled
long_4 = LongestList(ListA=shift_3, ListB=disc_3.Points, ListC=move_3.Geometry, PaddingMode=2)  # -> ListA, ListB, ListC; disabled
shift_4 = ShiftList(List=disc_4.Points, Shift=panel_26, Wrap=True)  # disabled
long_5 = LongestList(ListA=shift_3, ListB=disc_3.Points, ListC=disc_4.Points, ListD=shift_4, PaddingMode=2)  # -> ListA, ListB, ListC, ListD; disabled
transform_2 = Transform(Geometry=move_3.Geometry, Transform=move_4.Transform)  # disabled
merge_5 = Merge(Data1=graft(long_4.ListA), Data2=graft(long_4.ListB), Data3=graft(long_4.ListC))  # -> reverse(Result); disabled
merge_6 = Merge(Data1=graft(long_5.ListA), Data2=graft(long_5.ListB), Data3=graft(long_5.ListC), Data4=graft(long_5.ListD))  # disabled
long_6 = LongestList(ListA=shift_4, ListB=disc_4.Points, ListC=transform_2, PaddingMode=2)  # -> ListA, ListB, ListC; disabled
conmesh_4 = ConstructMesh(Vertices=merge_5, Faces={A=0, B=1, C=2, D=2})  # disabled
merge_7 = Merge(Data1=graft(long_6.ListA), Data2=graft(long_6.ListB), Data3=graft(long_6.ListC))  # disabled
conmesh_5 = ConstructMesh(Vertices=merge_6, Faces={A=0, B=1, C=2, D=3})  # disabled
conmesh_6 = ConstructMesh(Vertices=merge_7, Faces={A=0, B=1, C=2, D=2})  # disabled
merge_8 = Merge(Data1=simplify(conmesh_4), Data2=simplify(conmesh_5), Data3=simplify(conmesh_6))  # -> flatten(Result); disabled
mjoin_2 = MeshJoin(Meshes=merge_8)  # disabled
panel_27 = Panel("53")  # disabled
mesh_3 = Mesh(mjoin_2)  # disabled
panel_28 = Panel("3")  # disabled
panel_29 = Panel("3")  # disabled
panel_30 = Panel("""200
400""")  # disabled
list_6 = ValueList({"Regular": 0, "Random": 1}, selected="Random")  # disabled
panel_31 = Panel("10")  # disabled
pln_8 = Plane(py3_8.plns_out)  # disabled
panel_32 = Panel("2")  # disabled
wbedges_3 = WeaverbirdsMeshEdges(MeshOrPolylines=mesh_3)  # disabled
panel_33 = Panel("""20
160""")  # disabled
py3_9 = Python3Script(
    first_plns=pln_8,
    length_pattern=panel_30,
    angle_pattern=panel_33,
    agg_type=list_6,
    seed=panel_27,
    agg_count=panel_28,
    agg_round=panel_32,
    branch_count=panel_29,
    max_attempts=panel_31,
    boundary_mesh=mesh_3)  # -> out, stick_out, frame_out, pln_out, axis_out, failed_sticks, valid_sticks, collision_log; inputs first_plns: list of Plane, length_pattern: list of Double, angle_pattern: list of Double, agg_type: Int32, seed: Int32, agg_count: Int32, agg_round: Int32, branch_count: Int32, max_attempts: Int32, boundary_mesh: Mesh; disabled
# ---------- py3_9: Python ----------
#locate stick class file in the same folder
from compas_rhino import unload_modules
import sys
import os
"""
#get current file path
path = ghenv.Component.OnPingDocument().FilePath
#get parent directory of the parent directory
parentdir = os.path.dirname(path)
#get src folder which contains classes
dire = os.path.join(parentdir,'scripts')

sys.path.append(dire)"""

path = 'D:\\ETH\\Github\\MAS-2526\\08_SpatialAssemblies\\StudentProjects\\group_two\\J3RRY_Sticks_^o^\\scripts\\Package_v2'
sys.path.append(path)

unload_modules('J3RRY_SingleStick_v1')
unload_modules('J3RRY_Aggregation_v3')
unload_modules('J3RRY_Collision_v1')

from J3RRY_SingleStick_v1 import Stick
from J3RRY_Aggregation_v3 import Aggregation, run_multiround_aggregation
from J3RRY_Collision_v1 import Collision

from compas.geometry import Line, Point, Vector
from compas.geometry import Transformation
from compas_rhino.conversions import plane_to_compas_frame, frame_to_rhino_plane
import scriptcontext as sc
import random


from Grasshopper import DataTree
from Grasshopper.Kernel.Data import GH_Path

"""Main Code"""
# Convert rhino plane to compas frame
first_frames = [plane_to_compas_frame(p) for p in first_plns]

all_rounds = run_multiround_aggregation(
    first_frames,
    length_pattern,
    angle_pattern,
    agg_type,
    seed,
    agg_count,
    agg_round,
    branch_count,
    boundary_mesh,
    max_attempts)

# Visualization
stick_tree = DataTree[object]()
axis_tree = DataTree[object]()
frame_tree = DataTree[object]()
pln_tree = DataTree[object]()

for r, round_aggs in enumerate(all_rounds):
    for i, agg in enumerate(round_aggs):
        path = GH_Path(r, i)
        for s in agg.sticks:
            stick_tree.Add(s.geometry, path)
            axis_tree.Add(s.axis, path)
            frame_tree.Add(s.frame, path)
            pln_tree.Add(frame_to_rhino_plane(s.frame))


stick_out = stick_tree
axis_out = axis_tree
frame_out = frame_tree
pln_out = pln_tree




# Log
failed_sticks = DataTree[object]()
valid_sticks = DataTree[object]()
for i, round_aggs in enumerate(all_rounds):
    for agg in round_aggs:
        for j, branch in enumerate(agg.failed_sticks):
            path = GH_Path(i, j + 1)
            for s in branch:
                failed_sticks.Add(s.geometry, path)

        for j, branch in enumerate(agg.valid_sticks):
            path = GH_Path(i, j + 1)
            for s in branch:
                valid_sticks.Add(s.geometry, path)



# collision_log = DataTree[object]()
# for i, log in enumerate(agg.collision_log):
#     path = GH_Path(i + 1)

#     # 1. primitive values first
#     collision_log.Add(f"attempts = {log['attempts']}", path)
#     collision_log.Add(f"fail_count = {log['fail_count']}", path)
#     collision_log.Add(f"success = {log['success']}", path)
#     collision_log.Add(f"reason = {log['reason']}", path)
#     collision_log.Add(f"length = {log['params']['length']}", path)    
#     collision_log.Add(f"angle = {log['params']['angle']}", path)
#     collision_log.Add(f"from_index = {log['params']['from_index']}", path)
#     collision_log.Add(f"to_index = {log['params']['to_index']}", path)
#     collision_log.Add(f"from_t = {log['params']['from_t']}", path)
#     collision_log.Add(f"to_t = {log['params']['to_t']}", path)
# ---------- end py3_9 ----------
panel_34 = Panel(py3_9.collision_log)  # disabled
number_slider_54 = Slider(30, range=0..30)  # disabled
draw_18 = COMPASDraw(cg=py3_9.stick_out)  # -> rg; disabled; same code as draw
draw_19 = COMPASDraw(cg=py3_9.axis_out)  # -> rg; disabled; same code as draw
pln_9 = Plane(py3_9.pln_out)  # disabled
trim = TrimTree(Tree=draw_18, Depth=1)  # disabled
swatch = ColourSwatch(SwatchColor=RGBA(255, 255, 255, 150))  # disabled
swatch_2 = ColourSwatch(SwatchColor=RGBA(255, 247, 0, 150))  # disabled
number_slider_55 = Slider(10, range=0..10)  # disabled
swatch_3 = ColourSwatch(SwatchColor=RGBA(0, 255, 153, 150))  # disabled
cluster_9 = Cluster(pln=pln_9, num=30)  # disabled
draw_20 = COMPASDraw(cg=py3_9.failed_sticks)  # -> rg; disabled; same code as draw
draw_21 = COMPASDraw(cg=py3_9.valid_sticks)  # -> rg; disabled; same code as draw
geo_5 = Geometry(draw_18)  # disabled
midpt_6 = CurveMiddle(Curve=draw_19)  # disabled
addition_4 = Addition(A=number_slider_54, B=1)  # disabled
lng_8 = ListLength(List=geo_5)  # disabled
entwine = Entwine(Branch00=swatch, Branch01=swatch_2, Branch02=swatch_3, FlattenInputs=True)  # disabled
min_4 = Minimum(A=addition_4, B=lng_8)  # disabled
points_6 = PointList(Points=midpt_6, Size=number_slider_55)  # disabled
preview_6 = CustomPreview(Geometry=trim, Material=entwine)  # disabled
series_8 = Series(Start=0, Step=1, Count=min_4)  # disabled
panel_35 = Panel(min_4)  # disabled
item_3 = ListItem(List=geo_5, Index=series_8, Wrap=True)  # disabled
lng_9 = ListLength(List=item_3)  # disabled
series_9 = Series(Start=0, Step=1, Count=lng_9)  # disabled
gradient_6 = Gradient(
    LowerLimit=0,
    UpperLimit=expr("x-1", lng_9),
    Parameter=series_9,
    stops=[0: RGB(80, 55, 25), 0.5: RGB(159, 65, 29), 1: RGB(174, 166, 129)])  # disabled
number_slider_56 = Slider(0.515, range=0..1)  # disabled
min_5 = Minimum(A=number_slider_54, B=lng_8)  # disabled
panel_36 = Panel("{?;")  # disabled
panel_37 = Panel("}")  # disabled
dmaterial_6 = DeconstructMaterial(Material=gradient_6)  # -> Diffuse, Specular, Emission, Transparency, Shine; disabled
concat_2 = Concatenate(FragmentA=panel_36, FragmentB=min_5, FragmentC=panel_37)  # disabled
material_6 = CreateMaterial(
    Diffuse=dmaterial_6.Diffuse,
    Specular=dmaterial_6.Specular,
    Emission=dmaterial_6.Emission,
    Transparency=number_slider_56,
    Shine=dmaterial_6.Shine)  # disabled
split_3 = SplitTree(Data=draw_20, Masks=flatten(concat_2))  # -> Positive, Negative; disabled
split_4 = SplitTree(Data=draw_21, Masks=flatten(concat_2))  # -> Positive, Negative; disabled
preview_7 = CustomPreview(Geometry=item_3, Material=material_6)  # disabled

# ----
# Multiple Aggregations and Branches
number_slider_57 = Slider(0, range=0..100)
pt_10 = ConstructPoint(XCoordinate=number_slider_57, YCoordinate=number_slider_57, ZCoordinate=0)
pt_11 = Point(pt_10)
Z_5 = UnitZ(Factor="-10")
number_slider_58 = Slider(150, range=0..1000)
move_5 = Move(Geometry=pt_11, Motion=Z_5)  # -> Geometry, Transform
addition_5 = Addition(A=number_slider_58, B=Slider(28, range=0..100))
py3_10 = Python3Script(origin=pt_11, legs=Slider(3, range=0..10), r=number_slider_58, incline=Slider(-8, range=-90..90))  # -> out, plns_out; inputs origin: Point3d, legs: Int32, r: Double, incline: Double; same code as py3_6
polygon_3 = Polygon(Plane=move_5.Geometry, Radius=addition_5, Segments=Slider(12, range=0..20), FilletRadius=0)  # -> Polygon, Length
offset_3 = OffsetCurve(Curve=polygon_3.Polygon, Distance=Slider(262, range=0..1000), Corners=1)
Z_6 = UnitZ(Factor=Slider(1200, range=0..10000))
cluster_10 = Cluster(pln=py3_10.plns_out, num=30)
disc_5 = Discontinuity(Curve=polygon_3.Polygon, Level=1)  # -> Points, Parameters
move_6 = Move(Geometry=offset_3, Motion=Z_6)  # -> Geometry, Transform
shift_5 = ShiftList(List=disc_5.Points, Shift="-1", Wrap=True)
disc_6 = Discontinuity(Curve=move_6.Geometry, Level=1)  # -> Points, Parameters
long_7 = LongestList(ListA=shift_5, ListB=disc_5.Points, ListC=move_5.Geometry, PaddingMode=2)  # -> ListA, ListB, ListC
shift_6 = ShiftList(List=disc_6.Points, Shift="-1", Wrap=True)
long_8 = LongestList(ListA=shift_5, ListB=disc_5.Points, ListC=disc_6.Points, ListD=shift_6, PaddingMode=2)  # -> ListA, ListB, ListC, ListD
transform_3 = Transform(Geometry=move_5.Geometry, Transform=move_6.Transform)
merge_9 = Merge(Data1=graft(long_7.ListA), Data2=graft(long_7.ListB), Data3=graft(long_7.ListC))  # -> reverse(Result)
merge_10 = Merge(Data1=graft(long_8.ListA), Data2=graft(long_8.ListB), Data3=graft(long_8.ListC), Data4=graft(long_8.ListD))
long_9 = LongestList(ListA=shift_6, ListB=disc_6.Points, ListC=transform_3, PaddingMode=2)  # -> ListA, ListB, ListC
conmesh_7 = ConstructMesh(Vertices=merge_9, Faces={A=0, B=1, C=2, D=2})
merge_11 = Merge(Data1=graft(long_9.ListA), Data2=graft(long_9.ListB), Data3=graft(long_9.ListC))
conmesh_8 = ConstructMesh(Vertices=merge_10, Faces={A=0, B=1, C=2, D=3})
conmesh_9 = ConstructMesh(Vertices=merge_11, Faces={A=0, B=1, C=2, D=2})
merge_12 = Merge(Data1=simplify(conmesh_7), Data2=simplify(conmesh_8), Data3=simplify(conmesh_9))  # -> flatten(Result)
mjoin_3 = MeshJoin(Meshes=merge_12)
mesh_4 = Mesh(mjoin_3)
panel_38 = Panel("""200
400""")
list_7 = ValueList({"Regular": 0, "Random": 1}, selected="Random")
pln_10 = Plane(py3_10.plns_out)
wbedges_4 = WeaverbirdsMeshEdges(MeshOrPolylines=mesh_4)
panel_39 = Panel("""20
160""")
py3_11 = Python3Script(
    first_plns=pln_10,
    length_pattern=panel_38,
    angle_pattern=panel_39,
    agg_type=list_7,
    seed=Slider(63, range=0..100),
    agg_count=Slider(3, range=0..20),
    agg_round=Slider(5, range=0..20),
    branch_count=Slider(3, range=0..20),
    max_attempts=Slider(10, range=0..20),
    boundary_mesh=mesh_4)  # -> out, stick_out, frame_out, pln_out, axis_out, failed_sticks, valid_sticks, collision_log; inputs first_plns: list of Plane, length_pattern: list of Double, angle_pattern: list of Double, agg_type: Int32, seed: Int32, agg_count: Int32, agg_round: Int32, branch_count: Int32, max_attempts: Int32, boundary_mesh: Mesh; same code as py3_9
panel_40 = Panel(py3_11.collision_log)
number_slider_59 = Slider(30, range=0..30)
draw_22 = COMPASDraw(cg=py3_11.stick_out)  # -> rg; same code as draw
viewer = ParamViewer(draw_22)
group = Group(Geometry=draw_22)
pln_11 = Plane(py3_11.pln_out)
draw_23 = COMPASDraw(cg=py3_11.axis_out)  # -> rg; same code as draw
trim_2 = TrimTree(Tree=draw_22, Depth=1)
cluster_11 = Cluster(pln=pln_11, num=30)
draw_24 = COMPASDraw(cg=py3_11.failed_sticks)  # -> rg; same code as draw
draw_25 = COMPASDraw(cg=py3_11.valid_sticks)  # -> rg; same code as draw
geo_6 = Geometry(draw_22)
midpt_7 = CurveMiddle(Curve=draw_23)
addition_6 = Addition(A=number_slider_59, B=1)
lng_10 = ListLength(List=geo_6)
tstat = TreeStatistics(Tree=trim_2)  # -> Paths, Length, Count
entwine_2 = Entwine(
    Branch00=ColourSwatch(SwatchColor=RGBA(247, 255, 0, 150)),
    Branch01=ColourSwatch(SwatchColor=RGBA(0, 255, 123, 150)),
    Branch02=ColourSwatch(SwatchColor=RGBA(0, 8, 255, 150)),
    Branch03=ColourSwatch(SwatchColor=RGBA(144, 0, 255, 150)),
    Branch04=ColourSwatch(SwatchColor=RGBA(255, 0, 21, 150)),
    FlattenInputs=True)  # -> simplify(Result)
min_6 = Minimum(A=addition_6, B=lng_10)
points_7 = PointList(Points=midpt_7, Size=Slider(10, range=0..10))
series_10 = Series(Start=0, Step=1, Count=tstat.Count)
group_2 = Group(Geometry=trim_2)
series_11 = Series(Start=0, Step=1, Count=min_6)
branch_3 = TreeBranch(Tree=entwine_2, Path=series_10, MaintainPaths=True)
preview_8 = CustomPreview(Geometry=group_2, Material=branch_3)
item_4 = ListItem(List=geo_6, Index=series_11, Wrap=True)
lng_11 = ListLength(List=item_4)
series_12 = Series(Start=0, Step=1, Count=lng_11)
gradient_7 = Gradient(
    LowerLimit=0,
    UpperLimit=expr("x-1", lng_11),
    Parameter=series_12,
    stops=[0: RGB(80, 55, 25), 0.5: RGB(159, 65, 29), 1: RGB(174, 166, 129)])
min_7 = Minimum(A=number_slider_59, B=lng_10)
dmaterial_7 = DeconstructMaterial(Material=gradient_7)  # -> Diffuse, Specular, Emission, Transparency, Shine
concat_3 = Concatenate(FragmentA="{?;", FragmentB=min_7, FragmentC="}")
material_7 = CreateMaterial(
    Diffuse=dmaterial_7.Diffuse,
    Specular=dmaterial_7.Specular,
    Emission=dmaterial_7.Emission,
    Transparency=Slider(0.515, range=0..1),
    Shine=dmaterial_7.Shine)
split_5 = SplitTree(Data=draw_24, Masks=flatten(concat_3))  # -> Positive, Negative
split_6 = SplitTree(Data=draw_25, Masks=flatten(concat_3))  # -> Positive, Negative
preview_9 = CustomPreview(Geometry=item_4, Material=material_7)

flatten = FlattenTree(Tree=trim_2, Path="{0}")
smesh = SimpleMesh(Brep=flatten)  # -> flatten(Mesh)
lng_12 = ListLength(List=smesh)
series_13 = Series(Start=0, Step=1, Count=lng_12)  # -> graft(Series)
cull_i = CullIndex(List=smesh, Indices=series_13, Wrap=True)
item_5 = ListItem(List=smesh, Index=series_13, Wrap=True)
clash = Clash(FirstSet=item_5, SecondSet=cull_i, Distance=0, L=100)  # -> ClashCount, ClashPoints, ClashRadii, FirstIndex, SecondIndex
number_slider_60 = Slider(3, range=0..10)
data = Data(clash.ClashPoints)
data_2 = Data(cull_i)
data_3 = Data(clash.SecondIndex)
data_4 = Data(item_5)
data_5 = Data(clash.FirstIndex)
tstat_2 = TreeStatistics(Tree=data)  # -> Paths, Length, Count
tstat_3 = TreeStatistics(Tree=data_2)  # -> Paths, Length, Count
tstat_4 = TreeStatistics(Tree=data_3)  # -> Paths, Length, Count
tstat_5 = TreeStatistics(Tree=data_4)  # -> Paths, Length, Count
tstat_6 = TreeStatistics(Tree=data_5)  # -> Paths, Length, Count
item_6 = ListItem(List=tstat_2.Paths, Index=number_slider_60, Wrap=True)
item_7 = ListItem(List=tstat_3.Paths, Index=number_slider_60, Wrap=True)
item_8 = ListItem(List=tstat_4.Paths, Index=number_slider_60, Wrap=True)
item_9 = ListItem(List=tstat_5.Paths, Index=number_slider_60, Wrap=True)
item_10 = ListItem(List=tstat_6.Paths, Index=number_slider_60, Wrap=True)
panel_41 = Panel(clash.SecondIndex)
branch_4 = TreeBranch(Tree=data, Path=item_6, MaintainPaths=True)
branch_5 = TreeBranch(Tree=data_2, Path=item_7, MaintainPaths=True)
branch_6 = TreeBranch(Tree=data_3, Path=item_8, MaintainPaths=True)
branch_7 = TreeBranch(Tree=data_4, Path=item_9, MaintainPaths=True)
branch_8 = TreeBranch(Tree=data_5, Path=item_10, MaintainPaths=True)
item_11 = ListItem(List=branch_5, Index=branch_6, Wrap=True)
item_12 = ListItem(List=branch_7, Index=branch_8, Wrap=True)

# ==== cluster Cluster
pln = ClusterInput()
num = ClusterInput()
pln_2 = Plane(graft(pln))
num_2 = Number(num)
deplane = DeconstructPlane(Plane=pln_2)  # -> flatten(Origin), XAxis, YAxis, ZAxis
entwine = Entwine(Branch00=deplane.XAxis, Branch01=deplane.YAxis, Branch02=deplane.ZAxis, FlattenInputs=True)
merge = Merge(
    Data1=ColourSwatch(SwatchColor=RGB(255, 0, 0)),
    Data2=ColourSwatch(SwatchColor=RGB(0, 255, 0)),
    Data3=ColourSwatch(SwatchColor=RGB(0, 0, 255)))  # -> graft(Result)
multiplication = Multiplication(A=entwine, B=num_2)
vdisex = VectorDisplayEx(Point=deplane.Origin, Vector=multiplication, Colour=merge, Width=2)
