# Grasshopper definition 171225_Fabrication.ghx (Grasshopper 1.0.8)
# plug-ins: Human, Weaverbird

multiplication = Multiplication(A=Slider(0.5, range=0..1), B=Slider(0, range=0..3))
pi = Pi(Factor=multiplication)
xy_plane = XYPlane(Origin=Point(0, 0, 0))

# ---- group: Orientation
pt = Point(<point referenced from the Rhino model>)
dots = DotDisplay(Point=pt, Colour=ColourSwatch(SwatchColor=RGB(255, 255, 255)), Size="10")

# ----
rotate = Rotate(Geometry=pt, Angle=pi, Plane=xy_plane)  # -> Geometry, Transform

# ---- group: Actions
number_slider = Slider(9, range=0..20)
number_slider_2 = Slider(0, range=0..3)
button = Button()

# ----
# Bridge 3
number_slider_3 = Slider(25, range=0..50)

# ----
# Bridge 2
number_slider_4 = Slider(14, range=0..50)

# ----
# Bridge 1
number_slider_5 = Slider(11, range=0..50)
number_slider_6 = Slider(21, range=0..50)

option = BooleanToggle(True)
option_2 = BooleanToggle(True)
option_3 = BooleanToggle(False)

option_4 = BooleanToggle(False)
option_5 = BooleanToggle(False)
option_6 = BooleanToggle(False)

option_7 = BooleanToggle(False)
option_8 = BooleanToggle(True)
option_9 = BooleanToggle(False)

option_10 = BooleanToggle(True)
option_11 = BooleanToggle(True)
option_12 = BooleanToggle(False)

# ----
# TCP
panel = Panel("{0.83, 0.47, 109.91}")
multiplication_2 = Multiplication(A=panel, _0001=0.001)
pt_2 = Point(multiplication_2)
pl = ConstructPlane(Origin=pt_2, XAxis=Vector(1, 0, 0), YAxis=Vector(0, 1, 0))
prot = RotatePlane(Plane=pl, Angle=degrees("135"))
pln = Plane(prot)

# ----
# Virtual Robot
button_2 = Button()
compas_fab_ros_connect = COMPASFABROSConnect(connect=button_2)  # -> ros_client, is_connected; inputs ip: String, port: Int32, connect: Boolean
#   port ip: The ip address ROS. Defaults to 127.0.0.1.
#   port port: The port of ROS. Defaults to 9090.
#   port connect: If True, connects to ROS. If False, disconnects from ROS. Defaults to False.
#   port ros_client: The ROS client.
#   port is_connected: True if connection established.
# ---------- compas_fab_ros_connect: Python ----------
# r: compas_fab>=1.0.2
"""
Connect or disconnect to ROS.

COMPAS FAB v1.0.2
"""

import Grasshopper
from compas_ghpython import create_id
from scriptcontext import sticky as st

from compas_fab.backends import RosClient


class ROSConnect(Grasshopper.Kernel.GH_ScriptInstance):
    def RunScript(self, ip: str, port: int, connect: bool):
        ros_client = None

        ip = ip or "127.0.0.1"
        port = port or 9090

        key = create_id(ghenv.Component, "ros_client")  # noqa: F821

        if ros_client:
            st[key].close()
        if connect:
            st[key] = RosClient(ip, port)
            st[key].run(5)

        ros_client = st.get(key, None)
        is_connected = ros_client.is_connected if ros_client else False
        return (ros_client, is_connected)
# ---------- end compas_fab_ros_connect ----------
compas_fab_ros_robot = COMPASFABROSRobot(ros_client=compas_fab_ros_connect.ros_client, load=Button())  # -> robot; inputs load: Boolean
#   port ros_client: The ROS client.
#   port load: If True, loads the robot from ROS. Defaults to False.
# ---------- compas_fab_ros_robot: Python ----------
# r: compas_fab>=1.0.2
"""
Load robot directly from ROS.

COMPAS FAB v1.0.2
"""

import Grasshopper
from compas_ghpython import create_id
from scriptcontext import sticky as st

from compas.scene import SceneObject


class ROSRobot(Grasshopper.Kernel.GH_ScriptInstance):
    def RunScript(self, ros_client, load: bool):
        key = create_id(ghenv.Component, "robot")  # noqa: F821

        if ros_client and ros_client.is_connected and load:
            # Load URDF from ROS
            st[key] = ros_client.load_robot(load_geometry=True, precision=12)
            st[key].scene_object = SceneObject(item=st[key].model)

        robot = st.get(key, None)

        if robot:  # client sometimes need to be restarted, without needing to reload geometry
            robot.client = ros_client
        return robot
# ---------- end compas_fab_ros_robot ----------
panel_2 = Panel(compas_fab_ros_connect.is_connected)
panel_3 = Panel(compas_fab_ros_robot)
compas_fab_planning_scene = COMPASFABPlanningScene(robot=compas_fab_ros_robot)  # -> scene
#   port scene: A planning scene.
# ---------- compas_fab_planning_scene: Python ----------
# r: compas_fab>=1.0.2
"""
Create a planning scene.

COMPAS FAB v1.0.2
"""

import Grasshopper
from compas_ghpython import create_id
from scriptcontext import sticky as st

from compas_fab.robots import PlanningScene


class PlanningSceneComponent(Grasshopper.Kernel.GH_ScriptInstance):
    def RunScript(self, robot):
        key = create_id(ghenv.Component, "planning_scene")  # noqa: F821
        if robot:
            st[key] = PlanningScene(robot)
        return st.get(key, None)
# ---------- end compas_fab_planning_scene ----------

# ----
# Environment
brep = Brep([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])
smesh = SimpleMesh(Brep=brep)
mjoin = MeshJoin(Meshes=smesh)
mesh = Mesh(mjoin)

unit_z = UnitZ(Factor=Slider(-0.005, range=-0.01..0.01))
move = Move(Geometry=mesh, Motion=unit_z)  # -> Geometry, Transform

# ---- group: Job
number_slider_7 = Slider(0, range=0..100)

# ----
# 1. Save your stick assembly in data folder in the parent directory (Example: 201_stick_assembly.ghx)
# 
# 2. Run Docker and connect with the ROS connect component
# 
# 3. Plan for any index and send to robot using the send components.
# 3. Inverse Kinematics
index_always_skip_the_first_stick = Slider(3, range=1..10)

# ---- group: Fabrication_Env
bounding_box = BoundingBox(Content=move.Geometry, Plane=PlaneXY(0, 0, 0), UnionBox=True)  # -> Box, Box_2

# ---- group: Load_sequence
compute = Button()
reset = Button()
load = Button()

# ----
# 1. Aggregation Solver
number_slider_8 = Slider(0, range=0..10000)
neg = Negative(Value=Slider(0, range=0..1000))
neg_2 = Negative(Value=Slider(0, range=0..1000))
number_slider_9 = Slider(150, range=0..1000)
pt_3 = ConstructPoint(XCoordinate=number_slider_8, YCoordinate=neg_2, ZCoordinate=neg)
pt_4 = Point(pt_3)
py3 = Python3Script(origin=pt_4, legs=Slider(3, range=0..10), r=number_slider_9, incline=Slider(-8, range=-90..90))  # -> out, plns_out; inputs origin: Point3d, legs: Int32, r: Double, incline: Double
# ---------- py3: Python ----------
import Rhino.Geometry as rg
import math


plns = []
for i in range(legs):
    theta = 2 * math.pi * (i / legs)
    x = origin.X + r * math.cos(theta)
    y = origin.Y + r * math.sin(theta)
    pt = rg.Point3d(x, y, origin.Z)

    pln = rg.Plane(pt, rg.Vector3d.ZAxis)
    pln.Rotate(theta, rg.Vector3d.ZAxis)
    pln.Rotate(-math.pi / 2, pln.YAxis)
    pln.Rotate(math.radians(incline), pln.YAxis)
    plns.append(pln)

plns_out = plns
# ---------- end py3 ----------
Z = UnitZ(Factor="-10")
cluster = Cluster(pln=py3.plns_out, num=30)
merge = Merge(Data1=Slider(20, range=0..500), Data2=Slider(160, range=0..500))
merge_2 = Merge(Data1=Slider(200, range=0..500), Data2=Slider(400, range=0..500))
list = ValueList({"Regular": 0, "Random": 1}, selected="Random")

# ---- group: Generate_Boundary_Mesh
cluster_2 = Cluster_3(
    A=number_slider_9,
    B=Slider(28, range=0..100),
    G=pt_4,
    T=Z,
    S=Slider(12, range=0..20),
    D=Slider(262, range=0..1000),
    F=Slider(1200, range=0..10000))

# ---- group: aggregation_solver
py3_2 = Python3Script(
    first_plns=py3.plns_out,
    length_pattern=merge_2,
    angle_pattern=merge,
    agg_type=list,
    seed="91",
    agg_count="3",
    agg_round="2",
    branch_count="3",
    max_attempts="10",
    boundary_mesh=cluster_2)  # -> out, geo_out, frame_out, pln_out, axis_out, failed_sticks, valid_sticks, collision_log, Sticks_out, agg_manager; inputs first_plns: list of Plane, length_pattern: list of Double, angle_pattern: list of Double, agg_type: Int32, seed: Int32, agg_count: Int32, agg_round: Int32, branch_count: Int32, max_attempts: Int32, boundary_mesh: Mesh
# ---------- py3_2: Python ----------
#locate stick class file in the same folder
from compas_rhino import unload_modules
import sys
import os

#get current file path
path = ghenv.Component.OnPingDocument().FilePath
#get parent directory of the parent directory
parentdir = os.path.dirname(path)
par_par_dir = os.path.dirname(parentdir)
#get src folder which contains classes
dire = os.path.join(par_par_dir,'scripts','package_v2')

sys.path.append(dire)

# path = 'D:\\ETH\\Github\\MAS-2526\\08_SpatialAssemblies\\StudentProjects\\group_two\\J3RRY_Sticks_^o^\\scripts\\Package_v2'
sys.path.append(path)

unload_modules('J3RRY_SingleStick_v1')
unload_modules('J3RRY_Aggregation_v3')
unload_modules('J3RRY_Collision_v1')

from J3RRY_SingleStick_v1 import Stick
from J3RRY_Aggregation_v3 import Aggregation, AggregationManager
from J3RRY_Collision_v1 import Collision

from compas.geometry import Line, Point, Vector
from compas.geometry import Transformation
from compas_rhino.conversions import plane_to_compas_frame, frame_to_rhino_plane
import scriptcontext as sc
import random


from Grasshopper import DataTree
from Grasshopper.Kernel.Data import GH_Path

"""Main Code"""
# Convert rhino plane to compas frame
first_frames = [plane_to_compas_frame(p) for p in first_plns]
# Create aggregation manager
agg_manager = AggregationManager()
# Run aggregations
all_rounds = agg_manager.run_multiround_aggregation(
    first_frames,
    length_pattern,
    angle_pattern,
    agg_type,
    seed,
    agg_count,
    agg_round,
    branch_count,
    boundary_mesh,
    max_attempts)
# Get graph
graph = agg_manager.graph
print (graph)


# Visualization
geo_tree = DataTree[object]()
axis_tree = DataTree[object]()
frame_tree = DataTree[object]()
pln_tree = DataTree[object]()
Sticks_tree = DataTree[object]()

for i, agg in enumerate(agg_manager.aggs):
    path = GH_Path(graph[i])
    print (path)
    for s in agg.sticks:
        geo_tree.Add(s.geometry, path)
        axis_tree.Add(s.axis, path)
        frame_tree.Add(s.frame, path)
        pln_tree.Add(frame_to_rhino_plane(s.frame), path)
        Sticks_tree.Add(s, path)

geo_out = geo_tree
axis_out = axis_tree
frame_out = frame_tree
pln_out = pln_tree
Sticks_out = Sticks_tree



# Log
failed_sticks = DataTree[object]()
valid_sticks = DataTree[object]()
for i, agg in enumerate(agg_manager.aggs):
    for j, branch in enumerate(agg.failed_sticks):
        path = GH_Path(*graph[i] + [j + 1])
        for s in branch:
            failed_sticks.Add(s.geometry, path)

    for j, branch in enumerate(agg.valid_sticks):
        path = GH_Path(*graph[i] + [j + 1])
        for s in branch:
            valid_sticks.Add(s.geometry, path)



collision_log = DataTree[object]()
for i, agg in enumerate(agg_manager.aggs):
    for j, log in enumerate(agg.collision_log):
        path = GH_Path(graph[i] + [j + 1])
        collision_log.Add(f"attempts = {log['attempts']}", path)
        collision_log.Add(f"fail_count = {log['fail_count']}", path)
        collision_log.Add(f"success = {log['success']}", path)
        collision_log.Add(f"reason = {log['reason']}", path)
        collision_log.Add(f"length = {log['params']['length']}", path)    
        collision_log.Add(f"angle = {log['params']['angle']}", path)
        collision_log.Add(f"from_index = {log['params']['from_index']}", path)
        collision_log.Add(f"to_index = {log['params']['to_index']}", path)
        collision_log.Add(f"from_t = {log['params']['from_t']}", path)
        collision_log.Add(f"to_t = {log['params']['to_t']}", path)
# ---------- end py3_2 ----------

# ----
# Labelling
draw = COMPASDraw(cg=py3_2.axis_out)  # -> rg; same code as draw
cluster_3 = Cluster_4(C=draw)  # -> M, R
tag = TextTag(Location=cluster_3.M, Text=cluster_3.R)

wbedges = WeaverbirdsMeshEdges(MeshOrPolylines=cluster_2)
panel_4 = Panel(py3_2.collision_log)

tag_2 = TextTag3D(Location=cluster_3.M, Text=cluster_3.R, Size=Slider(14, range=0..100), Justification=7)

draw_2 = COMPASDraw(cg=py3_2.geo_out)  # -> rg; same code as draw
cluster_4 = Cluster_5(
    geo=draw_2,
    d1=ColourSwatch(SwatchColor=RGB(255, 255, 255)),
    d2=ColourSwatch(SwatchColor=RGB(255, 247, 0)),
    d3=ColourSwatch(SwatchColor=RGBA(0, 255, 153, 150)))  # -> groups, i
preview = CustomPreview(Geometry=cluster_4.groups, Material=cluster_4.i)

draw_3 = COMPASDraw(cg=py3_2.failed_sticks)  # -> rg; same code as draw
draw_4 = COMPASDraw(cg=py3_2.valid_sticks)  # -> rg; same code as draw
geo = Geometry(draw_3)
tstat = TreeStatistics(Tree=geo)  # -> Paths, Length, Count
geo_2 = Geometry(draw_4)
item = ListItem(List=tstat.Paths, Index=Slider(1, range=0..29), Wrap=True)
branch = TreeBranch(Tree=geo, Path=item, MaintainPaths=True)
branch_2 = TreeBranch(Tree=geo_2, Path=item, MaintainPaths=True)

# ----
# Visualization
pln_2 = Plane(py3_2.pln_out)
cluster_5 = Cluster(pln=pln_2, num=30)

draw_5 = COMPASDraw(cg=py3_2.axis_out)  # -> rg; same code as draw
draw_6 = COMPASDraw(cg=py3_2.failed_sticks)  # -> rg; same code as draw
draw_7 = COMPASDraw(cg=py3_2.valid_sticks)  # -> rg; same code as draw
draw_8 = COMPASDraw(cg=py3_2.geo_out)  # -> rg; same code as draw

# ---- group: Find Index
volume = Volume(Geometry=flatten(draw_8))  # -> Volume, Centroid
point_list = PointList(Points=volume.Centroid, Size=Slider(30, range=0..100))

# ----
midpt = CurveMiddle(Curve=draw_5)
points = PointList(Points=midpt, Size=Slider(10, range=0..10))
number_slider_10 = Slider(30, range=0..30)
lng = ListLength(List=draw_8)

# ---- group: Sticks Visualisation from Generation
trim = TrimTree(Tree=draw_8, Depth=1)
entwine = Entwine(
    Branch00=ColourSwatch(SwatchColor=RGBA(255, 255, 255, 150)),
    Branch01=ColourSwatch(SwatchColor=RGBA(255, 247, 0, 150)),
    Branch02=ColourSwatch(SwatchColor=RGBA(0, 255, 153, 150)),
    FlattenInputs=True)
preview_2 = CustomPreview(Geometry=trim, Material=entwine)

# ---- group: Collision Visualisation
min = Minimum(A=number_slider_10, B=lng)
concat = Concatenate(FragmentA="{?;", FragmentB=min, FragmentC="}")
split = SplitTree(Data=draw_6, Masks=flatten(concat))  # -> Positive, Negative
split_2 = SplitTree(Data=draw_7, Masks=flatten(concat))  # -> Positive, Negative

# ----
# 2a. Fabrication
data = Data(py3_2.agg_manager)

# ---- group: Py_Bridge
py_grow = Python3Script(
    branches=flatten(py3_2.frame_out),
    xaxis_list=flatten(py3_2.axis_out),
    root_index=number_slider_3,
    target_index=Slider(15, range=0..50),
    root_dummy_face_index=Slider(3, range=0..3),
    target_dummy_face_index=Slider(1, range=0..3),
    root_dummy_length=Slider(200, range=-500..500),
    root_dummy_offset=Slider(0, range=-300..300),
    target_dummy_length=Slider(200, range=-500..500),
    target_dummy_offset=Slider(0, range=-300..300),
    root_offset=Slider(-175, range=-300..300),
    root_child_offset=Slider(-65, range=-300..300),
    target_child_offset=Slider(-125, range=-300..300),
    stick_length=Slider(300, range=0..400),
    solution=option,
    mirror_root=option_2,
    mirror_target=option_3)  # -> out, geometries, frames, root_dummy_frame, root_child_frame, target_dummy_frame, target_child_frame, root_dummy_stick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; inputs branches: list, xaxis_list: list, root_index: Int32, target_index: Int32, root_dummy_face_index: Int32, target_dummy_face_index: Int32, root_dummy_length: Double, root_dummy_offset: Double, root_offset: Double, root_child_offset: Double, target_child_offset: Double, stick_length: Double
# ---------- py_grow: Python ----------
# r: compas>=2.14.1
# venv: sticks

import sys
import os
import math

#get current file path
path = ghenv.Component.OnPingDocument().FilePath
#get parent directory of the parent directory
parentdir = os.path.dirname(os.path.dirname(os.path.dirname(path)))
#get src folder which contains classes
dire = os.path.join(parentdir,'Final_Prototype','Design','scripts')
print (f'src folder is', dire)

sys.path.append(dire)

from compas_rhino import unload_modules

unload_modules("stick_axis")
unload_modules("stick_bridge_axis")

"""
import file specific classes
"""
from stick_axis import Stick
from stick_bridge_axis import BridgeIndex, compare_angles, get_plane_from_frame
"""
Default variables
"""
stick_width = 13.0
stick_depth = 13.0

from compas_rhino.conversions import plane_to_compas_frame, frame_to_rhino_plane
from compas.geometry import Line, Point, Vector, Frame
from compas_rhino.conversions import line_to_rhino

"""
Bridge Logic
"""

"""convert Lines to Vector (specific to jerry's aggregation logic)"""
xaxis_v_list = []
for line in xaxis_list:
    v = Vector.from_start_end(line.start, line.end)
    xaxis_v_list.append(v)

# Initialize tree
tree = BridgeIndex(branches, xaxis_v_list, 
root_index, target_index, 
root_dummy_face_index, target_dummy_face_index,
root_dummy_length, root_dummy_offset,
target_dummy_length, target_dummy_offset,
root_offset, root_child_offset, target_child_offset, 
stick_length=stick_length, 
solution = solution, mirror_root = mirror_root, mirror_target = mirror_target)

#Compare two frames
print (f"normal deviation is {tree.normal_deviation} degrees")
#rotated (aligned target frame)
r_target_frame = tree.rotated_target_frame

#frames
root_child_frame = tree.root_child_stick.frame
root_dummy_frame = tree.root_dummy_stick.frame
target_child_frame = tree.target_child_stick.frame
target_dummy_frame = tree.target_dummy_stick.frame

#visualise intersection line
line = tree.frame_intersection
intersection = line_to_rhino(line)

#visualise bridge sticks
root_child_stick = tree.root_child_stick.geometry
root_dummy_stick = tree.root_dummy_stick.geometry
target_child_stick = tree.target_child_stick.geometry
target_dummy_stick = tree.target_dummy_stick.geometry

# Visualize
geometries = tree.visualize()
frames = [stick.frame for stick in tree.sticks]
sticks = tree.sticks
# ---------- end py_grow ----------

# ----
panel_5 = Panel(py_grow.out)
draw_9 = COMPASDraw(cg=py_grow.root_dummy_frame)  # -> rg; same code as draw
draw_10 = COMPASDraw(cg=py_grow.root_child_frame)  # -> rg; same code as draw
draw_11 = COMPASDraw(cg=py_grow.target_dummy_frame)  # -> rg; same code as draw
draw_12 = COMPASDraw(cg=py_grow.target_child_frame)  # -> rg; same code as draw
draw_13 = COMPASDraw(cg=py_grow.root_dummy_stick)  # -> rg; same code as draw
draw_14 = COMPASDraw(cg=py_grow.root_child_stick)  # -> rg; same code as draw
draw_15 = COMPASDraw(cg=py_grow.target_dummy_stick)  # -> rg; same code as draw
draw_16 = COMPASDraw(cg=py_grow.target_child_stick)  # -> rg; same code as draw
draw_17 = COMPASDraw(cg=py_grow.geometries)  # -> rg; same code as draw
volume_2 = Volume(Geometry=draw_17)  # -> Volume, Centroid
preview_3 = CustomPreview(Geometry=draw_17, Material=ColourSwatch(SwatchColor=RGB(255, 0, 0)))
point_list_2 = PointList(Points=volume_2.Centroid, Size=Slider(10, range=0..10))

# ---- group: Py_Bridge
py_grow_2 = Python3Script(
    branches=flatten(py3_2.frame_out),
    xaxis_list=flatten(py3_2.axis_out),
    root_index=number_slider_4,
    target_index=Slider(20, range=0..50),
    root_dummy_face_index=Slider(0, range=0..3),
    target_dummy_face_index=Slider(3, range=0..3),
    root_dummy_length=Slider(200, range=-500..500),
    root_dummy_offset=Slider(200, range=-300..300),
    target_dummy_length=Slider(200, range=-500..500),
    target_dummy_offset=Slider(0, range=-300..300),
    root_offset=Slider(125, range=-300..300),
    root_child_offset=Slider(0, range=-300..300),
    target_child_offset=Slider(-220, range=-300..300),
    stick_length=Slider(300, range=0..400),
    solution=option_4,
    mirror_root=option_5,
    mirror_target=option_6)  # -> out, geometries, frames, root_dummy_frame, root_child_frame, target_dummy_frame, target_child_frame, root_dummy_stick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; inputs branches: list, xaxis_list: list, root_index: Int32, target_index: Int32, root_dummy_face_index: Int32, target_dummy_face_index: Int32, root_dummy_length: Double, root_dummy_offset: Double, root_offset: Double, root_child_offset: Double, target_child_offset: Double, stick_length: Double; same code as py_grow

# ----
panel_6 = Panel(py_grow_2.out)
draw_18 = COMPASDraw(cg=py_grow_2.root_dummy_frame)  # -> rg; same code as draw
draw_19 = COMPASDraw(cg=py_grow_2.root_child_frame)  # -> rg; same code as draw
draw_20 = COMPASDraw(cg=py_grow_2.target_dummy_frame)  # -> rg; same code as draw
draw_21 = COMPASDraw(cg=py_grow_2.target_child_frame)  # -> rg; same code as draw
draw_22 = COMPASDraw(cg=py_grow_2.root_dummy_stick)  # -> rg; same code as draw
draw_23 = COMPASDraw(cg=py_grow_2.root_child_stick)  # -> rg; same code as draw
draw_24 = COMPASDraw(cg=py_grow_2.target_dummy_stick)  # -> rg; same code as draw
draw_25 = COMPASDraw(cg=py_grow_2.target_child_stick)  # -> rg; same code as draw
draw_26 = COMPASDraw(cg=py_grow_2.geometries)  # -> rg; same code as draw
volume_3 = Volume(Geometry=draw_26)  # -> Volume, Centroid
preview_4 = CustomPreview(Geometry=draw_26, Material=ColourSwatch(SwatchColor=RGB(0, 0, 255)))
point_list_3 = PointList(Points=volume_3.Centroid, Size=Slider(10, range=0..10))

# ---- group: Py_Bridge
py_grow_3 = Python3Script(
    branches=flatten(py3_2.frame_out),
    xaxis_list=flatten(py3_2.axis_out),
    root_index=number_slider_5,
    target_index=number_slider_6,
    root_dummy_face_index=Slider(0, range=0..3),
    target_dummy_face_index=Slider(2, range=0..3),
    root_dummy_length=Slider(200, range=-500..500),
    root_dummy_offset=Slider(0, range=-300..300),
    target_dummy_length=Slider(200, range=-500..500),
    target_dummy_offset=Slider(0, range=-300..300),
    root_offset=Slider(-20, range=-300..300),
    root_child_offset=Slider(0, range=-300..300),
    target_child_offset=Slider(0, range=-300..300),
    stick_length=Slider(300, range=0..400),
    solution=option_7,
    mirror_root=option_8,
    mirror_target=option_9)  # -> out, geometries, frames, root_dummy_frame, root_child_frame, target_dummy_frame, target_child_frame, root_dummy_stick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; inputs branches: list, xaxis_list: list, root_index: Int32, target_index: Int32, root_dummy_face_index: Int32, target_dummy_face_index: Int32, root_dummy_length: Double, root_dummy_offset: Double, root_offset: Double, root_child_offset: Double, target_child_offset: Double, stick_length: Double; same code as py_grow

# ----
panel_7 = Panel(py_grow_3.out)
draw_27 = COMPASDraw(cg=py_grow_3.geometries)  # -> rg; same code as draw
draw_28 = COMPASDraw(cg=py_grow_3.root_dummy_frame)  # -> rg; same code as draw
draw_29 = COMPASDraw(cg=py_grow_3.root_child_frame)  # -> rg; same code as draw
draw_30 = COMPASDraw(cg=py_grow_3.target_dummy_frame)  # -> rg; same code as draw
draw_31 = COMPASDraw(cg=py_grow_3.target_child_frame)  # -> rg; same code as draw
draw_32 = COMPASDraw(cg=py_grow_3.root_dummy_stick)  # -> rg; same code as draw
draw_33 = COMPASDraw(cg=py_grow_3.root_child_stick)  # -> rg; same code as draw
draw_34 = COMPASDraw(cg=py_grow_3.target_dummy_stick)  # -> rg; same code as draw
draw_35 = COMPASDraw(cg=py_grow_3.target_child_stick)  # -> rg; same code as draw
volume_4 = Volume(Geometry=draw_27)  # -> Volume, Centroid
preview_5 = CustomPreview(Geometry=draw_27, Material=ColourSwatch(SwatchColor=RGB(0, 255, 0)))
point_list_4 = PointList(Points=volume_4.Centroid, Size=Slider(10, range=0..10))

# ---- group: Sticks Visualisation from Count
cluster_6 = Cluster_2(L=draw_8, A=number_slider_10, B=lng)  # -> i, M
preview_6 = CustomPreview(Geometry=cluster_6.i, Material=cluster_6.M)

# ----
list_item = ListItem(List=flatten(cluster_6.i), Index=number_slider_5, Wrap=True)
list_item_2 = ListItem(List=flatten(cluster_6.i), Index=number_slider_6, Wrap=True)
custom_preview_lineweights = CustomPreviewLineweights(Geometry=cluster_6.i, Shader=ColourSwatch(SwatchColor=RGBA(200, 200, 200, 50)), Absolute=False)
custom_preview_lineweights_2 = CustomPreviewLineweights(Geometry=[list_item, list_item_2], Shader=ColourSwatch(SwatchColor=RGB(50, 50, 50)), Absolute=False)

# ---- group: Py_Bridge
# Bridge 4
py_grow_4 = Python3Script(
    branches=flatten(py3_2.frame_out),
    xaxis_list=flatten(py3_2.axis_out),
    root_index=Slider(29, range=0..50),
    target_index=Slider(25, range=0..50),
    root_dummy_face_index=Slider(1, range=0..3),
    target_dummy_face_index=Slider(2, range=0..3),
    root_dummy_length=Slider(200, range=-500..500),
    root_dummy_offset=Slider(0, range=-300..300),
    target_dummy_length=Slider(200, range=-500..500),
    target_dummy_offset=Slider(0, range=-300..300),
    root_offset=Slider(-50, range=-300..300),
    root_child_offset=Slider(0, range=-300..300),
    target_child_offset=Slider(-250, range=-300..300),
    stick_length=Slider(300, range=0..400),
    solution=option_10,
    mirror_root=option_11,
    mirror_target=option_12)  # -> out, geometries, frames, root_dummy_frame, root_child_frame, target_dummy_frame, target_child_frame, root_dummy_stick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; inputs branches: list, xaxis_list: list, root_index: Int32, target_index: Int32, root_dummy_face_index: Int32, target_dummy_face_index: Int32, root_dummy_length: Double, root_dummy_offset: Double, root_offset: Double, root_child_offset: Double, target_child_offset: Double, stick_length: Double; same code as py_grow

# ----
panel_8 = Panel(py_grow_4.out)
draw_36 = COMPASDraw(cg=py_grow_4.root_dummy_frame)  # -> rg; same code as draw
draw_37 = COMPASDraw(cg=py_grow_4.root_child_frame)  # -> rg; same code as draw
draw_38 = COMPASDraw(cg=py_grow_4.target_dummy_frame)  # -> rg; same code as draw
draw_39 = COMPASDraw(cg=py_grow_4.target_child_frame)  # -> rg; same code as draw
draw_40 = COMPASDraw(cg=py_grow_4.root_dummy_stick)  # -> rg; same code as draw
draw_41 = COMPASDraw(cg=py_grow_4.root_child_stick)  # -> rg; same code as draw
draw_42 = COMPASDraw(cg=py_grow_4.target_dummy_stick)  # -> rg; same code as draw
draw_43 = COMPASDraw(cg=py_grow_4.target_child_stick)  # -> rg; same code as draw
draw_44 = COMPASDraw(cg=py_grow_4.geometries)  # -> rg; same code as draw
volume_5 = Volume(Geometry=draw_44)  # -> Volume, Centroid
preview_7 = CustomPreview(Geometry=draw_44, Material=ColourSwatch(SwatchColor=RGB(255, 0, 255)))
point_list_5 = PointList(Points=volume_5.Centroid, Size=Slider(10, range=0..10))

# ----
# * Pick Up Station Coordinates
panel_9 = Panel("""{527.26, -296.47, 11.71}
{527.26, 111.91, 12.98}
{467.80, -296.11, 12.62}""")
z_tolorence = Slider(1.7, range=0..10)
Z_2 = UnitZ(Factor=z_tolorence)
pt_5 = Point(panel_9)
move_2 = Move(Geometry=pt_5, Motion=Z_2)  # -> Geometry, Transform
item_2 = ListItem(List=move_2.Geometry, Index=0, Wrap=True)  # -> Item, Item1, Item2
pt_6 = Point(item_2.Item)
pt_7 = Point(item_2.Item1)
pt_8 = Point(item_2.Item2)

# ---- group: Pick_up_station
py3_3 = Python3Script(origin=pt_6, x=pt_7, y=pt_8)  # -> out, jig_frame_list, pln_200, pln_400, pick_frame_200, pick_frame_400; inputs origin: Point3d, x: Point3d, y: Point3d
# ---------- py3_3: Python ----------
from compas.geometry import Vector
from compas.geometry import Frame
from compas.geometry import Translation
from compas.geometry import Rotation
from compas_rhino.conversions import point_to_compas
from compas_rhino.conversions import frame_to_rhino_plane

import math

jig_frame_list = []

o_pt = point_to_compas(origin)
x_pt = point_to_compas(x)
y_pt = point_to_compas(y)

x_v = Vector.from_start_end(o_pt, x_pt)
y_v = Vector.from_start_end(o_pt, y_pt)

jig_frame = Frame(o_pt, x_v, y_v)

angle = 0

R = Rotation.from_axis_and_angle(jig_frame.yaxis, math.radians(angle), jig_frame.point)
rotated_jig_frame = jig_frame.transformed(R)

v_jig_to_stick_frame_200 = jig_frame.xaxis * 54.0 + jig_frame.yaxis * 12.59 + jig_frame.zaxis * -3.5
T_200 = Translation.from_vector(v_jig_to_stick_frame_200)

v_jig_to_stick_frame_400 = jig_frame.xaxis * 3.9 + jig_frame.yaxis * 49.5 + jig_frame.zaxis * -3.5
T_400 = Translation.from_vector(v_jig_to_stick_frame_400)

pick_frame_200 = rotated_jig_frame.transformed(T_200)
jig_frame_list.append(pick_frame_200)
pick_frame_400 = rotated_jig_frame.transformed(T_400)
jig_frame_list.append(pick_frame_400)
pick_frame_300 = pick_frame_400.copy()
jig_frame_list.append(pick_frame_300)

# jig_Frame_list = [j.rotate(math.pi, (0,0,1), (0,0,0)) for j in jig_frame_list]
# jig_Frame_list = [j.rotate(math.pi, (0,0,1), j.point) for j in jig_frame_list]
pln_200 = frame_to_rhino_plane(pick_frame_200)
pln_400 = frame_to_rhino_plane(pick_frame_400)
# ---------- end py3_3 ----------

# ----
compas_draw = COMPASDraw(cg=py3_3.jig_frame_list)  # -> rg; same code as draw
cluster_7 = Cluster(pln=py3_3.pln_200, num=30)
cluster_8 = Cluster(pln=py3_3.pln_400, num=30)

# ----
# * Holding Jig Coordinates
panel_10 = Panel("""{843.9, -128.0, 19.0}
{841.4, -78.9, 15.8}
{793.7, -132.5, 19.3}""")
item_3 = ListItem(List=panel_10, Index=0, Wrap=True)  # -> Item, Item1, Item2
pt_9 = Point(item_3.Item)
pt_10 = Point(item_3.Item1)
pt_11 = Point(item_3.Item2)

# ---- group: Place_station
py3_4 = Python3Script(origin=pt_9, x=pt_10, y=pt_11)  # -> out, pln_out, holding_frame; inputs origin: Point3d, x: Point3d, y: Point3d
# ---------- py3_4: Python ----------
from compas.geometry import Vector
from compas.geometry import Frame
from compas.geometry import Translation
from compas.geometry import Rotation
from compas_rhino.conversions import point_to_compas, frame_to_rhino_plane

import math

o_pt = point_to_compas(origin)
x_pt = point_to_compas(x)
y_pt = point_to_compas(y)

x_v = Vector.from_start_end(o_pt, x_pt)
y_v = Vector.from_start_end(o_pt, y_pt)

jig_frame = Frame(o_pt, x_v, y_v)

angle = -90

R = Rotation.from_axis_and_angle(jig_frame.yaxis, math.radians(angle), jig_frame.point)
rotated_jig_frame = jig_frame.transformed(R)

v_jig_to_stick_frame = jig_frame.xaxis * 24.5 + jig_frame.yaxis * 24.5 + jig_frame.zaxis * 15.0
T = Translation.from_vector(v_jig_to_stick_frame)

holding_frame = rotated_jig_frame.transformed(T)

# holding_frame.rotate(math.pi, (0,0,1), (0,0,0))
# holding_frame.rotate(math.pi, (0,0,1), holding_frame.point)
pln_out = frame_to_rhino_plane(holding_frame)
# ---------- end py3_4 ----------

# ----
cluster_9 = Cluster(pln=py3_4.pln_out, num=30)

# ---- group: Aggregation_to_fabrication_pipeline
py3_5 = Python3Script(
    agg_manager=data,
    robot_position=pt,
    pick_up_stations=py3_3.jig_frame_list,
    holding_jig=py3_4.pln_out,
    which_module=number_slider,
    rot=number_slider_2,
    save=button)  # -> out, curr_module_lng, joint_plns, fab_stick_geos, target_plns, fab, port, t_vals_out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; inputs robot_position: Point3d, pick_up_stations: list, holding_jig: Plane, which_module: Int32, rot: Int32, save: Boolean
# ---------- py3_5: Python ----------
#locate stick class file in the same folder
from compas_rhino import unload_modules
import sys
import os

#get current file path
path = ghenv.Component.OnPingDocument().FilePath
#get parent directory of the parent directory
parentdir = os.path.dirname(path)
par_par_dir = os.path.dirname(parentdir)
#get src folder which contains classes
dire = os.path.join(par_par_dir,'scripts','package_v2')

sys.path.append(dire)

# path = 'D:\\ETH\\Github\\MAS-2526\\08_SpatialAssemblies\\StudentProjects\\group_two\\J3RRY_Sticks_^o^\\scripts\\Package_v2'
sys.path.append(path)

unload_modules('J3RRY_SingleStick_v1')
unload_modules('J3RRY_Aggregation_v3')
unload_modules('J3RRY_Collision_v1')
unload_modules('J3R RY_Fabrication_v1')

from J3RRY_SingleStick_v1 import Stick
from J3RRY_Aggregation_v3 import Aggregation, AggregationManager
from J3RRY_Collision_v1 import Collision
from J3RRY_Fabrication_v1 import Fabrication

from compas.geometry import Line, Point, Vector, Frame
from compas.geometry import Transformation, Rotation
from compas_rhino.conversions import plane_to_compas_frame, frame_to_rhino_plane
from compas_rhino.conversions import point_to_compas
import scriptcontext as sc
import random, math


from Grasshopper import DataTree
from Grasshopper.Kernel.Data import GH_Path

"""Main Code"""
graph = agg_manager.graph
print (graph)
# Construct Fab
fab = Fabrication(agg_manager)

# Add adjacent sticks FIRST
sticks_with_adjacent, agg_indices, stick_indices = fab.add_adjacent_sticks(False)
print (agg_indices)
print (stick_indices)


# Erect modules with adjacent sticks
erected_modules = fab.erect_modules(sticks_with_adjacent)

# Check and flip modules if sticks are below the ground
fab.check_and_flip_modules(erected_modules)

# Evaluate target frames
if robot_position:
    robot_position = point_to_compas(robot_position)
else:
    robot_position = Point(0,0,0)
target_frames, face_indices, t_values = fab.eval_target_frames(
    fab.erected_modules, robot_position
    )
print (face_indices)
# print (t_values)

# Sent sticks to pick up station
# Get pick up frame
pick_up_sticks, pick_up_frames = fab.send_to_pick_up_station(
    fab.erected_modules, pick_up_stations)

# Sent sticks to holding jig
holding_jig_frame = plane_to_compas_frame(holding_jig)
place_sticks, place_frames = fab.send_to_holding_jig(
    fab.erected_modules, holding_jig_frame, rot)

# Get joint plns from erected modules
joint_frames = fab.get_joint_frames(place_sticks)


#Output
fab_stick_geos = DataTree[object]()
for i, branch in enumerate(erected_modules):
    path = GH_Path(*graph[i])
    for stick in branch:
        fab_stick_geos.Add(stick.geometry, path)

joint_plns = DataTree[object]()
for i, branch in enumerate(joint_frames):
    path = GH_Path(*graph[i])
    for frame in branch:
        pln = frame_to_rhino_plane(frame)
        joint_plns.Add(pln, path)

target_plns = DataTree[object]()
for i, branch in enumerate(target_frames):
    path = GH_Path(*graph[i])
    for frame in branch:
        pln = frame_to_rhino_plane(frame)
        target_plns.Add(pln, path)



#get current file path
path = ghenv.Component.OnPingDocument().FilePath
#get parent directory of the parent directory
parentdir = os.path.dirname(path)
#get src folder which contains classes
dire = os.path.join(parentdir,'scripts')
sys.path.append(dire)
json_path = os.path.join(parentdir, 'data', 'stick_assembly.json')

print(json_path)
from compas import json_dump
from compas.datastructures import Assembly, Part

# Select which module to produce
idx = min(which_module, len(graph)-1)
current_place_sticks = list(place_sticks[idx])
current_place_frames = list(place_frames[idx])
current_face_indices = list(face_indices[idx])
current_t_values = list(t_values[idx])
current_joint_frames = list(joint_frames[idx])
current_pick_up_sticks = list(pick_up_sticks[idx])
current_pick_up_frames = list(pick_up_frames[idx])

curr_module_lng = len(fab.original_modules[idx])



# Create Compas Assembly object
assembly = Assembly()
for i, s in enumerate(current_place_sticks):
    part_name = "stick" + str(i)
    part = Part(part_name, current_place_frames[i])
    part.key = i
    # part.attributes["stick"] = s  # didn't work
    part.attributes["start_frame"] = s.frame
    part.attributes["shape"] = s.geometry
    part.attributes["length"] = s.length
    part.attributes["face_idx"] = current_face_indices[i]
    part.attributes["t_val"] = current_t_values[i]

    part.attributes["pick_up_geo"] = current_pick_up_sticks[i].geometry
    part.attributes["pick_up_frame"] = current_pick_up_frames[i]
    part.attributes["lean_in_normal"] = current_joint_frames[i].zaxis

    assembly.add_part(part)

name = [p.attributes["name"] for p in assembly.parts()]
print (name)

t_vals_out = [p.attributes["t_val"] for p in assembly.parts()]
lengths_out = [p.attributes["length"] for p in assembly.parts()]

pick_up_plns_out = [
    frame_to_rhino_plane(p.attributes["pick_up_frame"]) for p in assembly.parts()
    ]
pick_up_geos_out = [p.attributes["pick_up_geo"] for p in assembly.parts()]

place_plns_out = [
    frame_to_rhino_plane(p.frame) for p in assembly.parts()
    ]
place_geos_out = [p.attributes["shape"] for p in assembly.parts()]

if save:
    json_dump(assembly, fp=json_path, pretty=True)
# ---------- end py3_5 ----------

# ----
# Plotting
number_slider_11 = Slider(400, range=0..1000)
pt_12 = Point(Point(1176.794478, -1741.692546, 0))
py3_6 = Python3Script(fab=py3_5.fab, origin=pt_12, x_size=number_slider_11, y_size=Slider(240, range=0..1000))  # -> out, borders, plotted_sticks, start_plns; inputs origin: Point3d, x_size: Double, y_size: Double
# ---------- py3_6: Python ----------
#locate stick class file in the same folder
from compas_rhino import unload_modules
import sys
import os

#get current file path
path = ghenv.Component.OnPingDocument().FilePath
#get parent directory of the parent directory
parentdir = os.path.dirname(path)
par_par_dir = os.path.dirname(parentdir)
#get src folder which contains classes
dire = os.path.join(par_par_dir,'scripts','package_v2')

sys.path.append(dire)

# path = 'D:\\ETH\\Github\\MAS-2526\\08_SpatialAssemblies\\StudentProjects\\group_two\\J3RRY_Sticks_^o^\\scripts\\Package_v2'
sys.path.append(path)

unload_modules('J3RRY_SingleStick_v1')
unload_modules('J3RRY_Aggregation_v3')
unload_modules('J3RRY_Collision_v1')
unload_modules('J3RRY_Fabrication_v1')

from J3RRY_SingleStick_v1 import Stick
from J3RRY_Aggregation_v3 import Aggregation, AggregationManager
from J3RRY_Collision_v1 import Collision
from J3RRY_Fabrication_v1 import Fabrication

from compas.geometry import Line, Point, Vector, Frame
from compas.geometry import Transformation
from compas_rhino.conversions import plane_to_compas_frame, frame_to_rhino_plane
from compas_rhino.conversions import point_to_compas
import scriptcontext as sc
import random


from Grasshopper import DataTree
from Grasshopper.Kernel.Data import GH_Path

"""Main Code"""

# Plotting
origin = point_to_compas(origin)
plotted_modules, recs = fab.plot_modules(
    fab.erected_modules, origin, x_size, y_size
    )

plotted_sticks = DataTree[object]()
borders = DataTree[object]()
start_plns = DataTree[object]()
for i, branch in enumerate(plotted_modules):
    path = GH_Path(*fab.graph[i])
    borders.Add(recs[i], path)
    for stick in branch:
        plotted_sticks.Add(stick.geometry, path)
        pln = frame_to_rhino_plane(stick.frame)
        start_plns.Add(pln, path)
# ---------- end py3_6 ----------
item_4 = ListItem(List=py3_6.start_plns, Index=0, Wrap=True)
draw_45 = COMPASDraw(cg=py3_6.borders)  # -> rg; same code as draw
md_slider = MDSlider(
    SliderMode=0,
    slider_value=Point(0.3009484454, 0.8959676696, 0.5),
    x_domain=Domain(0, 1),
    y_domain=Domain(0, 1),
    z_domain=Domain(0, 1))
evalsrf = EvaluateSurface(Surface=reparameterize(draw_45), Point=md_slider)  # -> Point, Normal, UDirection, VDirection, Frame
tstat_2 = TreeStatistics(Tree=draw_45)  # -> graft(Paths), Length, Count
draw_46 = COMPASDraw(cg=py3_6.plotted_sticks)  # -> rg; same code as draw
tag_3 = TextTag3D(Location=evalsrf.Point, Text=tstat_2.Paths, Size=Slider(20, range=0..20), Justification=7)
cluster_10 = Cluster(pln=item_4, num=30)

# ----
# Plotting
number_slider_12 = Slider(467, range=0..1000)
pt_13 = Point(Point(1176.794478, -1741.692546, 0))
py3_7 = Python3Script(fab=py3_5.fab, origin=pt_13, x_size=number_slider_12, y_size=Slider(240, range=0..1000))  # -> out, texts, borders, plotted_sticks, original_sticks, original_names, marked_sticks, marked_names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; inputs origin: Point3d, x_size: Double, y_size: Double
# ---------- py3_7: Python ----------
#locate stick class file in the same folder
from compas_rhino import unload_modules
import sys
import os

#get current file path
path = ghenv.Component.OnPingDocument().FilePath
#get parent directory of the parent directory
parentdir = os.path.dirname(path)
par_par_dir = os.path.dirname(parentdir)
#get src folder which contains classes
dire = os.path.join(par_par_dir,'scripts','package_v2')

sys.path.append(dire)

# path = 'D:\\ETH\\Github\\MAS-2526\\08_SpatialAssemblies\\StudentProjects\\group_two\\J3RRY_Sticks_^o^\\scripts\\Package_v2'
sys.path.append(path)

unload_modules('J3RRY_SingleStick_v1')
unload_modules('J3RRY_Aggregation_v3')
unload_modules('J3RRY_Collision_v1')
unload_modules('J3RRY_Fabrication_v1')

from J3RRY_SingleStick_v1 import Stick
from J3RRY_Aggregation_v3 import Aggregation, AggregationManager
from J3RRY_Collision_v1 import Collision
from J3RRY_Fabrication_v1 import Fabrication

from compas.geometry import Line, Point, Vector, Frame
from compas.geometry import Transformation
from compas_rhino.conversions import plane_to_compas_frame, frame_to_rhino_plane
from compas_rhino.conversions import point_to_compas
import scriptcontext as sc
import random


from Grasshopper import DataTree
from Grasshopper.Kernel.Data import GH_Path

"""Main Code"""

# Plotting
origin = point_to_compas(origin)
plotted_modules, recs = fab.plot_modules(
    fab.erected_modules, origin, x_size, y_size
    )

plotted_sticks = DataTree[object]()
borders = DataTree[object]()
start_plns = DataTree[object]()
for i, branch in enumerate(plotted_modules):
    path = GH_Path(*fab.graph[i])
    borders.Add(recs[i], path)
    for stick in branch:
        plotted_sticks.Add(stick.geometry, path)
        pln = frame_to_rhino_plane(stick.frame)
        start_plns.Add(pln, path)

# Get length of original module
ori_lngs = [len(om) for om in fab.original_modules]
print (ori_lngs)

# Seperate original sticks and marked sticks
original_sticks = DataTree[object]()
marked_sticks = DataTree[object]()
original_names = DataTree[object]()
marked_names = DataTree[object]()

child_marked_sticks = DataTree[object]()
# child_marked_names = DataTree[object]()

graph = fab.graph
agg_indices = fab.agg_indices
curr_graphs = []
for branch in agg_indices:
    branch_graphs = []
    for i in branch:
        branch_graphs.append(graph[i])
    curr_graphs.append(branch_graphs)


for i, (branch, curr_g_branch, curr_agg_i_branch) in \
    enumerate(zip(plotted_modules, curr_graphs, agg_indices)):
    path = GH_Path(*graph[i])
    lng = ori_lngs[i]

    curr_marked_i = []
    for j, (stick, curr_g, curr_agg_i) in \
        enumerate(zip(branch, curr_g_branch, curr_agg_i_branch)):
        if j < lng:
            original_sticks.Add(stick.geometry, path)
            original_names.Add(f"m{curr_agg_i}; g{curr_g}", path)
        else:
            marked_sticks.Add(stick.geometry, path)
            marked_names.Add(f"m{curr_agg_i}; g{curr_g}", path)
            curr_marked_i.append(curr_agg_i)
    for k in curr_marked_i:
        child_marked_sticks.Add(plotted_modules[k][0].geometry, path)
        



print (fab.agg_indices)
print (curr_graphs)

# Concatenate texts
texts = DataTree[object]()
for i, (g, lng) in enumerate(zip(fab.graph, ori_lngs)):
    text = "module {}; graph {}; count {}".format(i, g, lng)
    texts.Add(text, GH_Path(i))
# ---------- end py3_7 ----------
draw_47 = COMPASDraw(cg=py3_7.plotted_sticks)  # -> rg; same code as draw
md_slider_2 = MDSlider(
    SliderMode=0,
    slider_value=Point(0.9795182391, 0.9227535201, 0.5),
    x_domain=Domain(0, 1),
    y_domain=Domain(0, 1),
    z_domain=Domain(0, 1))
draw_48 = COMPASDraw(cg=py3_7.borders)  # -> rg; same code as draw
cluster_11 = Cluster_8(cg_2=py3_7.original_sticks, cg=py3_7.marked_sticks, cg_3=py3_7.child_marked_sticks, L=py3_7.start_plns)  # -> rg_2, C, rg, C_2, T, rg_3, i
evalsrf_2 = EvaluateSurface(Surface=reparameterize(draw_48), Point=md_slider_2)  # -> Point, Normal, UDirection, VDirection, Frame
cluster_12 = Cluster(pln=cluster_11.i, num=30)
data_2 = Data(cluster_11.rg_2)
tag_4 = TextTag(Location=cluster_11.C, Text=py3_7.original_names, Colour=RGB(255, 255, 255))
preview_8 = CustomPreview(Geometry=cluster_11.rg, Material=cluster_11.T)
preview_9 = CustomPreview(Geometry=cluster_11.rg_3, Material=cluster_11.T)
tag_5 = TextTag3D(Location=evalsrf_2.Point, Text=py3_7.texts, Size=20, Justification=7)

# ---- group: Visualisation
cluster_13 = Cluster(pln=py3_5.pick_up_plns_out, num=30)
cluster_14 = Cluster(pln=py3_5.place_plns_out, num=30)
draw_49 = COMPASDraw(cg=py3_5.pick_up_geos_out)  # -> rg; same code as draw
draw_50 = COMPASDraw(cg=py3_5.place_geos_out)  # -> rg; same code as draw

# ---- group: st
num = Number(py3_5.lengths_out)

# ---- group: t_value
num_2 = Number(py3_5.t_vals_out)

# ----
tag_6 = TextTag3D(Location=cluster_11.C_2, Text=py3_7.marked_names, Size=Slider(30, range=0..100), Justification=7)

# ---- group: Generate .JSON
py3_8 = Python3Script(
    sticks=py_grow.sticks,
    robot_position=pt,
    pick_up_stations=py3_3.jig_frame_list,
    holding_jig=py3_4.pln_out,
    rotation=Slider(0, range=0..3),
    save=Button())  # -> out, aligned_sticks, frames, assembly, port, pick_up_planes, pick_up_geometries, port_2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; inputs sticks: list, robot_position: Point3d, pick_up_stations: list, save: Boolean
# ---------- py3_8: Python ----------
""" .JSON export file directory"""

from compas import json_dump
import os, sys
from itertools import combinations

#get current file path
path = ghenv.Component.OnPingDocument().FilePath
#get parent directory of the parent directory
parentdir = os.path.dirname(path)
#get src folder which contains classes
dire = os.path.join(parentdir,'scripts')

sys.path.append(dire)
print (f'directory is {dire}')

###########################################################################
# Orientate root_stick to World Z-axis
###########################################################################
import math
import copy

from compas.geometry import Line, Plane, Vector, Point, Frame, Transformation, Rotation
from compas.geometry import dot_vectors, Rotation
from compas.geometry import centroid_points
from compas.datastructures import Assembly, Part
from compas_rhino import unload_modules

from compas_rhino.conversions import plane_to_compas_frame, frame_to_rhino_plane
from compas_rhino.conversions import point_to_compas

unload_modules('stick_axis')
unload_modules('stick_bridge_axis')

"""custom class import"""
from stick_axis import Stick
from stick_bridge_axis import evaluate_target_frames_bridge, send_to_pick_up_station, send_to_holding_jig, get_joint_frames

#align root stick axis with world z-axis
aligned_sticks = []

#transformation about root stick
root_frame = sticks[0].frame.copy()
target_frame = Frame(root_frame.point, [0,0,1], [0,1,0])
O = Transformation.from_frame_to_frame(root_frame, target_frame)

for s in sticks:
    original_frame = s.frame.copy()
    orientated_frame = original_frame.transformed(O)
    orientated_frame.point += orientated_frame.xaxis * -s.axis.length/2

    stick_axis = Line.from_point_and_vector(orientated_frame.point, orientated_frame.xaxis * s.axis.length)
    orientated_sticks = Stick(stick_axis, orientated_frame.yaxis)
    aligned_sticks.append(orientated_sticks)

#evaluate target frames
if robot_position:
    robot_position = point_to_compas(robot_position)
else:
    robot_position = Point(0,0,0)

#orientate and rotate target frames based on robot location
target_frames = evaluate_target_frames_bridge(aligned_sticks, robot_position = robot_position)

###########################################################################
#Translate frames for fabrication env
###########################################################################

#Find pick up frame
pick_up_sticks, pick_up_frames = send_to_pick_up_station(aligned_sticks, pick_up_stations[:2])

#Send sticks to holding jig
holding_jig_frame = plane_to_compas_frame(holding_jig)
place_sticks, place_frames = send_to_holding_jig(aligned_sticks, target_frames, holding_jig_frame, rotation)

# Joint frames from aligned sticks
joint_frames = get_joint_frames(place_sticks)

assembly = Assembly()
for i, s in enumerate(place_sticks):
    part_name = "stick"+ str(i)
    part = Part(name = part_name, frame = place_frames[i])
    part.key = i
    #part attributes
    part.attributes["start_frame"] = s.frame
    part.attributes["shape"] = s.geometry
    part.attributes["length"] = s.length

    part.attributes["pick_up_geo"] = pick_up_sticks[i].geometry
    part.attributes["pick_up_frame"] = pick_up_frames[i]
    part.attributes["lean_in_normal"] = joint_frames[i].zaxis

    assembly.add_part(part)

name = [p.attributes["name"] for p in assembly.parts()]
print (name)

frames = [p.frame for p in assembly.parts()]
planes = [frame_to_rhino_plane(p.frame) for p in assembly.parts()]

#create .JSON file path - "bridge_assembly.json"
json_path = os.path.join(parentdir, 'data', 'bridge_assembly.json')
print (f'json_path is {json_path}')

if save:
    json_dump(assembly, fp=json_path, pretty=True)
# ---------- end py3_8 ----------

# ----
list_item_3 = ListItem(List=py3_8.place_frames, Index=Slider(3, range=0..3), Wrap=True)

# ---- group: Frame visualisation
python_3_script = Python3Script(frames=list_item_3, factor=Slider(20, range=0..25))  # -> points, x_axis, y_axis, normal; inputs frames: list
# ---------- python_3_script: Python ----------
from compas.geometry import Vector
from compas.geometry import cross_vectors
from compas_rhino.conversions import vector_to_rhino
from compas_rhino.conversions import point_to_rhino

points = []
x_axis = []
y_axis = []
normal = []

for frame in frames:
    points.append(point_to_rhino(frame.point))
    x_axis.append(vector_to_rhino(frame.xaxis * 2 * factor))
    y_axis.append(vector_to_rhino(frame.normal * factor))
    normal.append(vector_to_rhino(frame.yaxis * factor))
# ---------- end python_3_script ----------
vector_display_ex = VectorDisplayEx(Point=python_3_script.points, Vector=python_3_script.x_axis, Colour=ColourSwatch(SwatchColor=RGB(255, 0, 0)), Width=2)
vector_display_ex_2 = VectorDisplayEx(Point=python_3_script.points, Vector=python_3_script.y_axis, Colour=ColourSwatch(SwatchColor=RGB(0, 0, 255)), Width=2)
vector_display_ex_3 = VectorDisplayEx(Point=python_3_script.points, Vector=python_3_script.normal, Colour=ColourSwatch(SwatchColor=RGB(0, 255, 0)), Width=2)

# ----
current_module_length = Panel(py3_5.curr_module_lng)
compas_draw_2 = COMPASDraw(cg=py3_8.root_frame)  # -> rg; same code as draw
python_3_script_2 = Python3Script(x=py3_8.aligned_sticks)  # -> out, a; inputs x: list
# ---------- python_3_script_2: Python ----------
import os, sys

#get current file path
path = ghenv.Component.OnPingDocument().FilePath
#get parent directory of the parent directory
parentdir = os.path.dirname(path)
#get src folder which contains classes
dire = os.path.join(parentdir,'scripts')

sys.path.append(dire)

from compas_rhino import unload_modules
unload_modules('stick_axis')
from stick_axis import Stick
from compas.geometry import Line

a = [s.geometry for s in x]
# ---------- end python_3_script_2 ----------
python_3_script_3 = Python3Script(x=py3_8.place_sticks)  # -> out, a; inputs x: list; same code as python_3_script_2
compas_draw_3 = COMPASDraw(cg=python_3_script_2.a)  # -> rg; same code as draw
compas_draw_4 = COMPASDraw(cg=python_3_script_3.a)  # -> rg; same code as draw

# ---- group: Frame visualisation
python_3_script_4 = Python3Script(frames=py3_8.target_frames, factor=Slider(20, range=0..25))  # -> points, x_axis, y_axis, normal; inputs frames: list; same code as python_3_script
vector_display_ex_4 = VectorDisplayEx(
    Point=python_3_script_4.points,
    Vector=python_3_script_4.x_axis,
    Colour=ColourSwatch(SwatchColor=RGB(255, 0, 0)),
    Width=2)
vector_display_ex_5 = VectorDisplayEx(
    Point=python_3_script_4.points,
    Vector=python_3_script_4.y_axis,
    Colour=ColourSwatch(SwatchColor=RGB(0, 0, 255)),
    Width=2)
vector_display_ex_6 = VectorDisplayEx(
    Point=python_3_script_4.points,
    Vector=python_3_script_4.normal,
    Colour=ColourSwatch(SwatchColor=RGB(0, 255, 0)),
    Width=2)

# ---- group: Design_Env
bounding_box_2 = BoundingBox(Content=draw_46, Plane=PlaneXY(0, 0, 0), UnionBox=True)  # -> Box, Box_2

# ----
list_item_4 = ListItem(List=py3_8.joint_frames, Index=Slider(3, range=0..3), Wrap=True)

# ---- group: Frame visualisation
python_3_script_5 = Python3Script(frames=list_item_4, factor=Slider(20, range=0..25))  # -> points, x_axis, y_axis, normal; inputs frames: list; same code as python_3_script
vector_display_ex_7 = VectorDisplayEx(
    Point=python_3_script_5.points,
    Vector=python_3_script_5.x_axis,
    Colour=ColourSwatch(SwatchColor=RGB(255, 0, 0)),
    Width=2)
vector_display_ex_8 = VectorDisplayEx(
    Point=python_3_script_5.points,
    Vector=python_3_script_5.y_axis,
    Colour=ColourSwatch(SwatchColor=RGB(0, 0, 255)),
    Width=2)
vector_display_ex_9 = VectorDisplayEx(
    Point=python_3_script_5.points,
    Vector=python_3_script_5.normal,
    Colour=ColourSwatch(SwatchColor=RGB(0, 255, 0)),
    Width=2)

# ---- group: Visualise_current_module
draw_51 = COMPASDraw(cg=py3_5.fab_stick_geos)  # -> rg; same code as draw
data_3 = Data(draw_51)
data_4 = Data(py3_5.joint_plns)
data_5 = Data(py3_5.target_plns)

# ----
cluster_15 = Cluster_6(int=number_slider, T_4=data_4, T=data_4, T_6=data_3, T_3=data_3, T_5=data_5, T_2=data_5)  # -> i, B, S, i_2
item_5 = ListItem(List=cluster_15.B, Index=cluster_15.S, Wrap=True)

# ---- group: Visualise_current_module (continued)
cluster_16 = Cluster(pln=cluster_15.i, num=30)
cluster_17 = Cluster(pln=cluster_15.i_2, num=30)
volume_6 = Volume(Geometry=item_5)
points_2 = PointList(Points=volume_6, Size=Slider(20, range=0..20))

# ----
# Variable End Effector
panel_11 = Panel("""0.2
0.3
0.4""")
panel_12 = Panel(num_2)
panel_13 = Panel(num)

# ---- group: stock_length
num_3 = Number(panel_11)

# ----
cluster_18 = Cluster_7(A=num_3, X=num_3, S=num_3, V=panel_12, A_2=panel_13, A_3=index_always_skip_the_first_stick)  # -> M, current_index_2
preview_10 = CustomPreview(
    Geometry=cluster_18.M,
    Material={diffuse=RGB(221, 160, 221), emission=RGB(66, 48, 66), shine=0.5, specular=RGB(255, 255, 255), transparency=0})
rotate_2 = Rotate(Geometry=cluster_18.M, Angle=degrees("135"), Plane=PlaneXY(0, 0, 0))  # -> Geometry, Transform
mesh_2 = Mesh(rotate_2.Geometry)
compas_fab_attached_tool = COMPASFABAttachedTool(robot=compas_fab_ros_robot, visual_mesh=mesh_2, collision_mesh=mesh_2, tcf_plane=pln)  # -> robot; inputs visual_mesh: Mesh, collision_mesh: Mesh
#   port visual_mesh: A visual mesh for the tool.
#   port collision_mesh: A collision mesh for the tool.
#   port tcf_plane: The frame of the tool in tool0 frame.
#   port group: The planning group to which the tool should be attached.
#   port connected_to: The link to which the tool should be connected to.
# ---------- compas_fab_attached_tool: Python ----------
# r: compas_fab>=1.0.2
"""
Attach a tool to the robot.

COMPAS FAB v1.0.2
"""

import Grasshopper
import Rhino
from compas.geometry import Frame
from compas_rhino.conversions import mesh_to_compas
from compas_rhino.conversions import plane_to_compas_frame

from compas_fab.robots import Tool


class AttachToolComponent(Grasshopper.Kernel.GH_ScriptInstance):
    def RunScript(self,
            robot,
            visual_mesh: Rhino.Geometry.Mesh,
            collision_mesh: Rhino.Geometry.Mesh,
            tcf_plane,
            group,
            connected_to):
        if robot and robot.client and robot.client.is_connected and visual_mesh:
            if not collision_mesh:
                collision_mesh = visual_mesh

            c_visual_mesh = mesh_to_compas(visual_mesh)
            c_collision_mesh = mesh_to_compas(collision_mesh)

            if not tcf_plane:
                frame = Frame.worldXY()
            else:
                frame = plane_to_compas_frame(tcf_plane)
            tool = Tool(c_visual_mesh, frame, c_collision_mesh, connected_to=connected_to)

            robot.attach_tool(tool, group)

        return robot
# ---------- end compas_fab_attached_tool ----------

# ---- group: Compas_Fab
py3_9 = Python3Script(
    scene=compas_fab_planning_scene,
    robot=compas_fab_attached_tool,
    load=load,
    compute=compute,
    index=index_always_skip_the_first_stick,
    env=move.Geometry,
    reset=reset)  # -> out, plns_out, pick_plns_out, pick_up_geos, all_sticks, current_stick, current_pick_up_stick, results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; inputs index: Int32, env: Mesh
# ---------- py3_9: Python ----------
from compas.datastructures import Assembly, Mesh
from compas.geometry import Frame, Point, Translation, Transformation
from compas_fab.backends import RosClient
from compas_fab.robots import Tool, PlanningScene, CollisionMesh
import os, sys
import math

import traceback

import compas
from compas.data import json_load
from compas_robots import Configuration

compas.PRECISION = "12f"

# Constants
APPROACH_DISTANCE = 0.015  # Meters
group = None
start_configuration = None

# Specify the path to the assembly file and the path to the output file
path = ghenv.Component.OnPingDocument().FilePath
parentdir = os.path.dirname(path)
dire = os.path.join(parentdir, "scripts")
sys.path.append(dire)

# json_path = os.path.join(parentdir, "data", "stick_assembly.json")
# write_path = os.path.join(parentdir, "data", "stick_assembly_with_trajectories.json")

json_path = os.path.join(parentdir, "data", "bridge_assembly.json")
write_path = os.path.join(parentdir, "data", "bridge_assembly_with_trajectories.json")

# Import helpers
from compas_rhino import unload_modules
unload_modules("helpers")
unload_modules("J3RRY_helpers_v1")

from compas_rhino.conversions import mesh_to_compas, point_to_compas, frame_to_rhino_plane, mesh_to_rhino
from helpers import scale_and_move_to_point, generate_default_tolerances, calculate_pick_trajectory, calculate_place_trajectories
from scriptcontext import sticky
from J3RRY_helpers_v1 import move_and_scale

if "last_status" not in sticky or sticky["last_status"] is None:
    sticky["last_status"] = "Idle"

if "geometry" not in sticky or sticky["geometry"] is None:
    pass

SAFE_CONFIG = Configuration.from_revolute_values([math.radians(68.80), 
                                        math.radians(-70.55), 
                                        math.radians(-116.42), 
                                        math.radians(-83.80), 
                                        math.radians(98.73), 
                                        math.radians(56.93)])

if 'load' in globals() and load:
    scene.reset()

    assembly = json_load(json_path)
    scaled_assembly = scale_and_move_to_point(assembly, Point(0,0,0))
    # Get first stick and put into environment
    first_part = scaled_assembly.find_by_key(0)
    first_stick = first_part.attributes.get("shape", None)
    first_mesh = first_stick.to_mesh()
    env = mesh_to_compas(env)
    # env.join(first_mesh)
    
    tcm = CollisionMesh(env, id = "table")
    scene.add_collision_mesh(tcm)

    sticky["assembly"] = scaled_assembly
    sticky["last_status"] = "Assembly loaded"
else:
    assembly = sticky.get("assembly", [])
    if assembly:
        part = assembly.find_by_key(index)
        all_sticks = [p.attributes.get("shape", None) for p in assembly.parts()]
        plns_out = [frame_to_rhino_plane(p.frame) for p in assembly.parts()]
        pick_plns_out = [frame_to_rhino_plane(p.attributes.get("pick_up_frame")) for p in assembly.parts()]
        pick_up_geos = [p.attributes.get("pick_up_geo", None) for p in assembly.parts()]
        current_pick_up_stick = part.attributes.get("pick_up_geo", None)
        sticky["geometry"] = part.attributes.get("shape", None)


if 'compute' in globals() and compute and 'index' in globals():
    results = sticky.get("results", {})
    try:
        part = scaled_assembly.find_by_key(index)
        # safe_frame = part.attributes.get("safe_frame", None)
        place_frame = part.frame

        # Get lean in normal from zaxis of the taget frame
        lean_in_normal = part.attributes.get("lean_in_normal")

        #
        tolerances = generate_default_tolerances(robot.get_configurable_joints(robot.main_group_name))

        # Set pick frame
        pick_frame = part.attributes.get("pick_up_frame")

        pick_traj, pick_config, approach_config = calculate_pick_trajectory(
            pick_frame, robot, start_config = SAFE_CONFIG)

        # Calculate place trajectories (safe, place, return)
        place_results = None

        place_results, exit_trajectory = calculate_place_trajectories(
            robot,
            current_config = SAFE_CONFIG,
            placement_frame = place_frame,
            lean_in_normal = lean_in_normal,
            group=robot.main_group_name
        )

        results[str(index)] = {
            "pick_frame": pick_frame,
            "frame": place_frame,
            "pick_trajectory": pick_traj,
            "approach_config": pick_config,
            "place_trajectory": place_results,
            "exit_trajectory": exit_trajectory
        }
        sticky["results"] = results
        print(f"Computed trajectory for frame {index}")

        cm = CollisionMesh(Mesh.from_shape(part.attributes["shape"]), id = "part%d" % index)
        scene.append_collision_mesh(cm)
        sticky["last_status"] = f"Computed: {index}"

    except Exception as e:
        print("Failed for frame {}: {}".format(index, e))
        print(traceback.format_exc())
        sticky["last_status"] = "Error: {}".format(str(e))

results = sticky.get("results", None)
results_list = [results]
if results is not None and str(index) in results.keys():
    sticky["last_status"] = f"{index:.0f} is computed"
    pick_traj = results[str(index)]["pick_trajectory"]
    place_traj = results[str(index)]["place_trajectory"]
    exit_traj = results[str(index)]["exit_trajectory"]
    joined_trajectory = pick_traj.copy()
    joined_trajectory.points.extend(place_traj.points)
    joined_trajectory.points.extend(exit_traj.points)


assembly = sticky.get("assembly", None)


ghenv.Component.Message = sticky["last_status"][:35]
print(sticky["last_status"])
current_stick = sticky.get("geometry", None)

if reset:
    sticky["assembly"] = None
    sticky["geometry"] = None
    sticky["results"] = {}
# ---------- end py3_9 ----------
panel_14 = Panel(py3_9.out)

# ----
py3_10 = Python3Script(index=index_always_skip_the_first_stick, tcp=pln, results=py3_9.results_list, part=py3_9.part)  # -> out, place_pln, script; inputs index: Int32, tcp: Plane, results: list
# ---------- py3_10: Python ----------
from imp import reload
import sys
import os

# get current file path
path = ghenv.Component.OnPingDocument().FilePath
parentdir = os.path.dirname(path)
dire = os.path.join(parentdir, 'scripts')

sys.path.append(dire)

import simple_ur_script as ur
reload(ur)

import utils
reload(utils)

import simple_comm as com
reload(com)

import compas.geometry as cg
import math as m

from compas_rhino.conversions import plane_to_compas_frame, frame_to_rhino_plane
from compas.geometry import Frame, Vector, Rotation
import math

# ---------- GLOBALS ----------
IO_port = 4    # close gripper
# -----------------------------

# ============================================================
# Trajectory → URScript
# ============================================================

def send_joint_trajectory(script, trajectory):
    """Append URScript moveJ motions for all trajectory points."""
    for point in trajectory.points[:-1]:
        q = point.positions
        script += ur.move_j(list(q), accel=0.25, vel=0.5, radius = 0.05)
    return script

def send_cartesian_frame(script, frame, speed=0.05):
    """Append URScript moveL to a Cartesian Frame."""
    frm = frame.copy()
    script += ur.move_l(frm, accel=0.1, vel=speed)
    return script

# ============================================================
# PICKUP
# ============================================================

def pickup_stick(script, pick_traj, pick_fr):
    """
    1. Follow approach & pick trajectory
    2. Move to pick frame
    3. Close gripper
    """
    # pick = pick_fr.copy()
    pick = part.attributes.get("pick_up_frame").copy()
    normal = pick.zaxis
    enter_pick = pick.translated(-0.1 * normal)
    # R = Rotation.from_axis_and_angle(Frame.worldXY().zaxis, math.radians(180), (0,0,0))
    # pick.transform(R)
    pick.point.x = -pick.point.x
    pick.point.y = -pick.point.y
    
    enter_pick.point.x = -enter_pick.point.x
    enter_pick.point.y = -enter_pick.point.y

    # pick.rotate(math.pi, Vector(0,0,1), (0,0,0))

    # pick.rotate(-math.pi*0.5, pick.zaxis, pick.point)
    # Set
    script += ur.set_digital_out(IO_port, False)  # open
    
    script = send_joint_trajectory(script, pick_traj)
    script = send_cartesian_frame(script, enter_pick, speed=0.05)
    script = send_cartesian_frame(script, pick, speed=0.05)
    script += ur.set_digital_out(IO_port, True)  # close
    script += ur.sleep(0.5)
    script += ur.textmsg("picked")
    script = send_cartesian_frame(script, enter_pick, speed=0.05)

    return script

# ============================================================
# PLACE
# ============================================================

def place_stick(script, place_traj, place_fr):
    """
    1. Follow place trajectory
    2. Move to place frame
    3. Open gripper
    """
    # place = place_fr.copy()

    """SOMETHING WRONG"""
    # place = place_fr.copy()
    place = part.frame.copy()
    place.rotate(math.pi, place.zaxis, place.point)

    #adding rotation to lead_in and lead_out. NEEDS TO MATCH CHANGES TO helpers.py 
    enter_frame = place_fr.copy()
    normal = part.attributes.get("lean_in_normal")
    # normal.rotate(math.pi/2, enter_frame.xaxis, enter_frame.point)

    enter_place = place.translated(0.2 * -normal)
    glue_place = place.translated(0.2 * -normal)
    
    # R = Rotation.from_axis_and_angle(Frame.worldXY().zaxis, math.radians(180), (0,0,0))
    # place.transform(R)

    # place.point.x = -place.point.x
    # place.point.y = -place.point.y
    # enter_place.point.x = -enter_place.point.x
    # enter_place.point.y = -enter_place.point.y

    place.rotate(math.pi, Vector(0,0,1), (0,0,0))
    enter_place.rotate(math.pi, Vector(0,0,1), (0,0,0))
    glue_place.rotate(math.pi, Vector(0,0,1), (0,0,0))

    script = send_joint_trajectory(script, place_traj)

    script = send_cartesian_frame(script, enter_place, speed=0.05)
    script = send_cartesian_frame(script, place, speed=0.05)
    # Popup to mark the intersection
    script += ur.popup("mark the intersection", "hello")
    script = send_cartesian_frame(script, glue_place, speed=0.05)
    # Popup to apply glue
    script += ur.popup("apply glue", "hello")
    script = send_cartesian_frame(script, place, speed=0.05)
    # Wait for glue
    script += ur.popup("wait for glue", "hello")
    # Remove gripper
    script += ur.set_digital_out(IO_port, False)  # open
    # go the safety frame
    # script = send_cartesian_frame(script, enter_place, speed=0.05)

    script += ur.sleep(0.5)
    script += ur.textmsg("placed")
    return script

# ============================================================
# MAIN PIPELINE
# ============================================================

results = results[0]

pick_frame = results[str(index)]["pick_frame"]
place_frame = results[str(index)]["frame"]
pick_trajectory = results[str(index)]["pick_trajectory"]
place_trajectory = results[str(index)]["place_trajectory"]
exit_trajectory = results[str(index)]["exit_trajectory"]
print (len(pick_trajectory.points))
place_pln = frame_to_rhino_plane(place_frame)
script = ""

# Set TCP
script = ur.set_tcp_by_frame(plane_to_compas_frame(tcp))
# Pickup
script = pickup_stick(script, pick_trajectory, pick_frame)
# Place
script = place_stick(script, place_trajectory, place_frame)
# Exit
script = send_joint_trajectory(script, exit_trajectory)
# finalize
script = com.concatenate_script(script)
# ---------- end py3_10 ----------
# Post Processor
cluster_19 = Cluster(pln=py3_10.place_pln, num=Slider(0.03, range=0..0.1))

panel_15 = Panel(py3_10.script)

compas_draw_5 = COMPASDraw(cg=py3_9.current_stick)  # -> rg; same code as draw
compas_draw_6 = COMPASDraw(cg=py3_9.current_pick_up_stick)  # -> rg; same code as draw
number_slider_13 = Slider(0.03, range=0..0.1)
preview_11 = CustomPreview(
    Geometry=compas_draw_6,
    Material={diffuse=RGB(221, 160, 221), emission=RGB(66, 48, 66), shine=0.5, specular=RGB(255, 255, 255), transparency=0})
compas_draw_7 = COMPASDraw(cg=py3_9.pick_up_geos)  # -> rg; same code as draw
compas_draw_8 = COMPASDraw(cg=py3_9.all_sticks)  # -> rg; same code as draw
preview_12 = CustomPreview(
    Geometry=compas_draw_5,
    Material={diffuse=RGB(221, 160, 221), emission=RGB(66, 48, 66), shine=0.5, specular=RGB(255, 255, 255), transparency=0})
cluster_20 = Cluster(pln=py3_9.plns_out, num=number_slider_13)
cluster_21 = Cluster(pln=py3_9.pick_plns_out, num=number_slider_13)

send_to_robot = Button()
py3_11 = Python3Script(script=py3_10.script, ip_address="192.168.10.10", send=send_to_robot)  # -> out, a; inputs script: String, ip_address: String, send: Boolean
# ---------- py3_11: Python ----------
import simple_comm as com

if send:
    com.send_script(script,ip_address)
# ---------- end py3_11 ----------

# ----
# Robot Visualisation
compas_fab_trajectory_visualize = COMPASFABTrajectoryVisualize(robot=compas_fab_attached_tool, trajectory=py3_9.joined_trajectory)  # -> start_configuration, configurations, fraction, time, planes, P, V, A; inputs group: String
#   port group: The planning group for which this trajectory was planned.
#   port trajectory: The calculated trajectory.
#   port start_configuration: The start configuration of the trajectory.
#   port configurations: The full configurations along the trajectory.
#   port fraction: Indicates the fraction of requested trajectory that was calculated, e.g. 1 means the full trajectory was found.
#   port time: The time which is needed to execute that trajectory at full speed.
#   port planes: The planes of the robot's end-effector.
#   port P: The positions along the trajectory
#   port V: The velocities along the trajectory
#   port A: The accelerations along the trajectory
# ---------- compas_fab_trajectory_visualize: Python ----------
# r: compas_fab>=1.0.2
"""
Visualizes a trajectory.

COMPAS FAB v1.0.2
"""

import Grasshopper
from compas_ghpython.drawing import draw_frame
from compas_ghpython.sets import list_to_ghtree


class TrajectoryVisualize(Grasshopper.Kernel.GH_ScriptInstance):
    def RunScript(self, robot, group: str, trajectory):
        start_configuration = None
        configurations = []
        fraction = 0.0
        time = 0.0

        planes = []
        positions = []
        velocities = []
        accelerations = []

        if robot and trajectory:
            group = group or robot.main_group_name

            for c in trajectory.points:
                configurations.append(
                    robot.merge_group_with_full_configuration(c, trajectory.start_configuration, group)
                )
                frame = robot.forward_kinematics(c, group, options=dict(solver="model"))
                planes.append(draw_frame(frame))
                positions.append(c.positions)
                velocities.append(c.velocities)
                accelerations.append(c.accelerations)

            start_configuration = trajectory.start_configuration
            fraction = trajectory.fraction
            time = trajectory.time_from_start

        P = list_to_ghtree(list(zip(*positions)))
        V = list_to_ghtree(list(zip(*velocities)))
        A = list_to_ghtree(list(zip(*accelerations)))

        # return outputs if you have them; here I try it for you:
        return (start_configuration, configurations, fraction, time, planes, P, V, A)
# ---------- end compas_fab_trajectory_visualize ----------
number_slider_14 = Slider(0.03, range=0..0.1)
lng_2 = ListLength(List=compas_fab_trajectory_visualize.configurations)  # -> expr("x-1", Length)
cull_i = CullIndex(List=compas_fab_trajectory_visualize.planes, Indices=-1, Wrap=True)
panel_16 = Panel(lng_2)
min_2 = Minimum(A=lng_2, B=number_slider_7)
item_6 = ListItem(List=compas_fab_trajectory_visualize.configurations, Index=min_2, Wrap=True)
pline = PolyLine(Vertices=cull_i, Closed=False)
compas_fab_robot_visualize = COMPASFABRobotVisualize(
    robot=compas_fab_attached_tool,
    configuration=item_6,
    show_visual=Toggle(True),
    show_collision=Toggle(True),
    show_frames=Toggle(False))  # -> visual, collision, collision_meshes, attached_meshes, frames, base_frame, ee_frame; inputs group: String, show_visual: Boolean, show_collision: Boolean, show_frames: Boolean, show_base_frame: Boolean, show_end_effector_frame: Boolean, show_cm: Boolean, show_acm: Boolean
#   port group: The planning group used for end-effector and base visualization.
#   port configuration: The robot's full configuration.
#   port show_visual: Whether or not to show the robot's visual meshes.
#   port show_collision: Whether or not to show the robot's collision meshes.
#   port show_frames: Whether or not to show the robot's joint frames.
#   port show_base_frame: Whether or not to show the robot's base frame.
#   port show_end_effector_frame: Whether or not to show the robot's end-effector frame.
#   port show_cm: Whether or not to show the collision meshes (if any).
#   port show_acm: Whether or not to show the attached collision meshes (if any).
#   port visual: Rhino meshes of the robot's visual geometry (if any).
#   port collision: Rhino meshes of the robot's collision geometry (if any).
#   port collision_meshes: Rhino meshes of the scene's collision meshes (if any).
#   port attached_meshes: Rhino meshes of the scene's attached collision meshes (if any).
#   port frames: The robot's joint frames as Rhino planes (if any).
#   port base_frame: The robot's base frame as a Rhino plane (if any).
#   port ee_frame: The robot's end-effector frame as a Rhino plane (if any).
# ---------- compas_fab_robot_visualize: Python ----------
# r: compas_fab>=1.0.2
"""
Visualizes the robot.

COMPAS FAB v1.0.2
"""

import time

import Grasshopper
from compas_ghpython import create_id
from compas_rhino.conversions import frame_to_rhino_plane
from scriptcontext import sticky as st

from compas.geometry import Frame
from compas.geometry import Transformation
from compas.scene import SceneObject
from compas_fab.backends import BackendFeatureNotSupportedError
from compas_fab.robots import PlanningScene


class RobotVisualize(Grasshopper.Kernel.GH_ScriptInstance):
    def RunScript(self,
            robot,
            group: str,
            configuration,
            show_visual: bool,
            show_collision: bool,
            show_frames: bool,
            show_base_frame: bool,
            show_end_effector_frame: bool,
            show_cm: bool,
            show_acm: bool):
        visual = None
        collision = None
        collision_meshes = None
        attached_meshes = None
        frames = None
        base_frame = None
        ee_frame = None

        if robot:
            show_visual = True if show_visual is None else show_visual
            show_cm = True if show_cm is None else show_cm
            show_acm = True if show_acm is None else show_acm
            configuration = configuration or robot.zero_configuration()

            robot.update(configuration, visual=show_visual, collision=show_collision)
            compas_frames = robot.transformed_frames(configuration, group)

            if show_visual:
                visual = robot.scene_object.draw_visual()

            if show_collision:
                collision = robot.scene_object.draw_collision()

            if show_base_frame:
                base_compas_frame = compas_frames[0]
                base_frame = frame_to_rhino_plane(base_compas_frame)

            if show_end_effector_frame:
                options = dict(solver="model")
                if robot.attached_tool:
                    options["link"] = robot.attached_tool.connected_to

                ee_compas_frame = robot.forward_kinematics(configuration, group, options=options)
                ee_frame = frame_to_rhino_plane(ee_compas_frame)

            if show_frames:
                frames = []
                for compas_frame in compas_frames[1:]:
                    frame = frame_to_rhino_plane(compas_frame)
                    frames.append(frame)

            cached_scene_key = create_id(ghenv.Component, "cached_scene")  # noqa: F821

            if show_cm or show_acm:
                cached_scene = st.get(cached_scene_key)
                if not cached_scene:
                    cached_scene = {"time": 0}

                # expire cache if the component has not been executed in the last 2 seconds
                # this allows to slide through a list of configurations
                # without triggering refreshes of the scene in the middle of it
                if time.time() - cached_scene["time"] > 2:
                    update_scene = True
                else:
                    update_scene = False

                if update_scene:
                    scene = PlanningScene(robot)
                    try:
                        scene = robot.client.get_planning_scene()
                    except BackendFeatureNotSupportedError:
                        print(
                            "The selected backend does not support collision meshes. If you need collision mesh support, use a different backend."
                        )
                        scene = None
                        show_cm = False
                        show_acm = False

                if update_scene and show_cm:
                    collision_meshes = []

                    for co in scene.world.collision_objects:
                        header = co.header
                        frame_id = header.frame_id
                        cms = co.to_collision_meshes()

                        for cm in cms:
                            if cm.frame != Frame.worldXY():
                                t = Transformation.from_frame(cm.frame)
                                mesh = cm.mesh.transformed(t)
                            else:
                                mesh = cm.mesh

                            collision_meshes.extend(SceneObject(item=mesh).draw())

                        cached_scene["cm"] = collision_meshes

                collision_meshes = cached_scene.get("cm", [])

                if update_scene and show_acm:
                    attached_meshes = []

                    for aco in scene.robot_state.attached_collision_objects:
                        for acm in aco.to_attached_collision_meshes():
                            frame_id = aco.object["header"]["frame_id"]
                            frame = robot.forward_kinematics(configuration, options=dict(link=frame_id))
                            t = Transformation.from_frame(frame)

                            # Local CM frame
                            if acm.collision_mesh.frame and acm.collision_mesh.frame != Frame.worldXY():
                                t = t * Transformation.from_frame(acm.collision_mesh.frame)

                            mesh = acm.collision_mesh.mesh.transformed(t)

                            attached_meshes.extend(SceneObject(item=mesh).draw())

                    cached_scene["acm"] = attached_meshes

                attached_meshes = cached_scene.get("acm", [])

                cached_scene["time"] = time.time()
                st[cached_scene_key] = cached_scene

        return (
            visual,
            collision,
            collision_meshes,
            attached_meshes,
            frames,
            base_frame,
            ee_frame,
        )
# ---------- end compas_fab_robot_visualize ----------
series = Series(Start=0, Step=1, Count=expr("x-1", cluster_18.current_index_2))
mesh_3 = Mesh(compas_fab_robot_visualize.collision_meshes)
mesh_4 = Mesh(compas_fab_robot_visualize.collision)
cluster_22 = Cluster(pln=compas_fab_robot_visualize.frames, num=number_slider_14)

# ---- group: Current_stick
item_7 = ListItem(List=mesh_3, Index=series, Wrap=True)

# ---- group: Waypoints
cluster_23 = Cluster(pln=compas_fab_trajectory_visualize.planes, num=number_slider_14)

# ---- group: Toolpath
crv = Curve(pline)

# ==== cluster Cluster
pln = ClusterInput()
num = ClusterInput()
pln_2 = Plane(graft(pln))
num_2 = Number(num)
deplane = DeconstructPlane(Plane=pln_2)  # -> flatten(Origin), XAxis, YAxis, ZAxis
entwine = Entwine(Branch00=deplane.XAxis, Branch01=deplane.YAxis, Branch02=deplane.ZAxis, FlattenInputs=True)
merge = Merge(
    Data1=ColourSwatch(SwatchColor=RGB(255, 0, 0)),
    Data2=ColourSwatch(SwatchColor=RGB(0, 255, 0)),
    Data3=ColourSwatch(SwatchColor=RGB(0, 0, 255)))  # -> graft(Result)
multiplication = Multiplication(A=entwine, B=num_2)
vdisex = VectorDisplayEx(Point=deplane.Origin, Vector=multiplication, Colour=merge, Width=2)

# ==== cluster Cluster_2
A = ClusterInput()
B = ClusterInput()
addition = Addition(A=A, B=1)
min = Minimum(A=addition, B=B)
L = ClusterInput()
series = Series(Start=0, Step=1, Count=min)
item = ListItem(List=L, Index=series, Wrap=True)
i = ClusterOutput(item)
lng = ListLength(List=item)
series_2 = Series(Start=0, Step=1, Count=lng)
gradient = Gradient(
    LowerLimit=0,
    UpperLimit=expr("x-1", lng),
    Parameter=series_2,
    stops=[0: RGB(80, 55, 25), 0.5: RGB(159, 65, 29), 1: RGB(174, 166, 129)])
dmaterial = DeconstructMaterial(Material=gradient)  # -> Diffuse, Specular, Emission, Transparency, Shine
material = CreateMaterial(
    Diffuse=dmaterial.Diffuse,
    Specular=dmaterial.Specular,
    Emission=dmaterial.Emission,
    Transparency=Slider(0.75, range=0..1),
    Shine=dmaterial.Shine)
M = ClusterOutput(material)

# ==== cluster Cluster_3
G = ClusterInput()
T = ClusterInput()
A = ClusterInput()
B = ClusterInput()
move = Move(Geometry=G, Motion=T)  # -> Geometry, Transform
addition = Addition(A=A, B=B)
S = ClusterInput()
polygon = Polygon(Plane=move.Geometry, Radius=addition, Segments=S, FilletRadius=0)  # -> Polygon, Length
D = ClusterInput()
F = ClusterInput()
offset = OffsetCurve(Curve=polygon.Polygon, Distance=D, Corners=1)
Z = UnitZ(Factor=F)
disc = Discontinuity(Curve=polygon.Polygon, Level=1)  # -> Points, Parameters
move_2 = Move(Geometry=offset, Motion=Z)  # -> Geometry, Transform
shift = ShiftList(List=disc.Points, Shift="-1", Wrap=True)
disc_2 = Discontinuity(Curve=move_2.Geometry, Level=1)  # -> Points, Parameters
long = LongestList(ListA=shift, ListB=disc.Points, ListC=move.Geometry, PaddingMode=2)  # -> ListA, ListB, ListC
shift_2 = ShiftList(List=disc_2.Points, Shift="-1", Wrap=True)
long_2 = LongestList(ListA=shift, ListB=disc.Points, ListC=disc_2.Points, ListD=shift_2, PaddingMode=2)  # -> ListA, ListB, ListC, ListD
transform = Transform(Geometry=move.Geometry, Transform=move_2.Transform)
merge = Merge(Data1=graft(long.ListA), Data2=graft(long.ListB), Data3=graft(long.ListC))  # -> reverse(Result)
merge_2 = Merge(Data1=graft(long_2.ListA), Data2=graft(long_2.ListB), Data3=graft(long_2.ListC), Data4=graft(long_2.ListD))
long_3 = LongestList(ListA=shift_2, ListB=disc_2.Points, ListC=transform, PaddingMode=2)  # -> ListA, ListB, ListC
conmesh = ConstructMesh(Vertices=merge, Faces={A=0, B=1, C=2, D=2})
merge_3 = Merge(Data1=graft(long_3.ListA), Data2=graft(long_3.ListB), Data3=graft(long_3.ListC))
conmesh_2 = ConstructMesh(Vertices=merge_2, Faces={A=0, B=1, C=2, D=3})
conmesh_3 = ConstructMesh(Vertices=merge_3, Faces={A=0, B=1, C=2, D=2})
merge_4 = Merge(Data1=simplify(conmesh), Data2=simplify(conmesh_2), Data3=simplify(conmesh_3))  # -> flatten(Result)
mjoin = MeshJoin(Meshes=merge_4)
M = ClusterOutput(mjoin)

# ==== cluster Cluster_4
C = ClusterInput()
midpt = CurveMiddle(Curve=C)
M = ClusterOutput(midpt)
tstat = TreeStatistics(Tree=midpt)  # -> graft(Paths), Length, Count
chars = Characters(Text=tstat.Paths)  # -> Result, Unicode
cull_i = CullIndex(List=chars.Result, Indices="-1", Wrap=True)
series = Series(Start=0, Step=1, Count=tstat.Length)
join = TextJoin(Text=cull_i)
concat = Concatenate(FragmentA=join, FragmentC="_", FragmentB=series, FragmentD="}")
R = ClusterOutput(concat)

# ==== cluster Cluster_5
geo = ClusterInput()
geo_2 = Geometry(geo)
py3 = Python3Script(geos=geo_2)  # -> out, groups; inputs geos: tree of GeometryBase
# ---------- py3: Python ----------
from Grasshopper import DataTree
from Grasshopper.Kernel.Data import GH_Path

path_length = [path.Length for path in geos.Paths]
print (path_length)
cset = sorted(set(path_length))
print (cset)

geo_tree = DataTree[object]()

for i, L in enumerate(cset):
    path = GH_Path(i)
    for p in geos.Paths:
        if p.Length == L:
            for item in geos.Branch(p):
                geo_tree.Add(item, path)

groups = geo_tree
# ---------- end py3 ----------
d1 = ClusterInput()
d2 = ClusterInput()
d3 = ClusterInput()
groups = ClusterOutput(py3.groups)
merge = Merge(Data1=d1, Data2=d2, Data3=d3)
tstat = TreeStatistics(Tree=py3.groups)  # -> Paths, Length, Count
series = Series(Start=0, Step=1, Count=tstat.Count)
item = ListItem(List=merge, Index=series, Wrap=True)  # -> graft(Item)
i = ClusterOutput(item)

# ==== cluster Cluster_6
int = ClusterInput()
T = ClusterInput()
int_2 = Integer(int)
tstat = TreeStatistics(Tree=T)  # -> Paths, Length, Count
subtraction = Subtraction(A=tstat.Count, B=1)
min = Minimum(A=subtraction, B=int_2)
T_2 = ClusterInput()
T_3 = ClusterInput()
T_4 = ClusterInput()
item = ListItem(List=tstat.Paths, Index=min, Wrap=True)
tstat_2 = TreeStatistics(Tree=T_2)  # -> Paths, Length, Count
tstat_3 = TreeStatistics(Tree=T_3)  # -> Paths, Length, Count
branch = TreeBranch(Tree=T_4, Path=item, MaintainPaths=True)
T_5 = ClusterInput()
item_2 = ListItem(List=tstat_2.Paths, Index=min, Wrap=True)
T_6 = ClusterInput()
item_3 = ListItem(List=tstat_3.Paths, Index=min, Wrap=True)
panel = Panel(branch)
branch_2 = TreeBranch(Tree=T_5, Path=item_2, MaintainPaths=True)
branch_3 = TreeBranch(Tree=T_6, Path=item_3, MaintainPaths=True)
B = ClusterOutput(branch_3)
lng = ListLength(List=branch_3)
min_2 = Minimum(A=lng, B=Slider(10, range=0..10))
series = Series(Start=0, Step=1, Count=min_2)
S = ClusterOutput(series)
item_4 = ListItem(List=branch, Index=series, Wrap=True)
item_5 = ListItem(List=branch_2, Index=series, Wrap=True)
i = ClusterOutput(item_4)
i_2 = ClusterOutput(item_5)

# ==== cluster Cluster_7
A = ClusterInput()
A_2 = ClusterInput()
division = Division(A=A, B=2)
brep = Brep(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)
X = ClusterInput()
S = ClusterInput()
volume = Volume(Geometry=brep)
X_2 = UnitX(Factor=division)
multiplication = Multiplication(A=A_2, B="0.001")
box = CenterBox(Base=volume, X=expr("x/2", X), Y=expr("x/2", "0.013"), Z=expr("x/2", "0.013"))
mindex = MemberIndex(Set=S, Member=multiplication)  # -> flatten(Index), Count
V = ClusterInput()
move = Move(Geometry=box, Motion=X_2)  # -> Geometry, Transform
panel = Panel(mindex.Index)
remap = RemapNumbers(Value=V, Source=Domain(0, 1), Target=multiplication)  # -> Mapped, Clipped
lng = ListLength(List=panel)  # -> expr("x-1", Length)
item = ListItem(List=move.Geometry, Index=mindex.Index, Wrap=True)
A_3 = ClusterInput()
X_3 = UnitX(Factor=remap.Mapped)
min = Minimum(A=A_3, B=lng)
rev = Reverse(Vector=X_3)
current_index = Panel(min)
move_2 = Move(Geometry=item, Motion=rev)  # -> Geometry, Transform
current_index_2 = ClusterOutput(current_index)
brep_2 = Brep(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)
item_2 = ListItem(List=move_2.Geometry, Index=current_index, Wrap=True)
mesh = Mesh(brep_2)
smesh = SimpleMesh(Brep=item_2)
merge = Merge(Data1=mesh, Data2=smesh)  # -> flatten(Result)
mjoin = MeshJoin(Meshes=merge)
M = ClusterOutput(mjoin)

# ==== cluster Cluster_8
cg = ClusterInput()
draw = COMPASDraw(cg=cg)  # -> rg
#   port cg: The COMPAS geometry or datastructure to be drawn.
#   port rg: The Rhino geometry object.
# ---------- draw: Python ----------
# r: compas>=2.14.1
"""
Draws COMPAS geometry in Grasshopper.
"""

from typing import Any

import Grasshopper

from compas.scene import SceneObject


class CompasToRhinoGeometry(Grasshopper.Kernel.GH_ScriptInstance):
    def RunScript(self, cg):
        if not cg:
            return None

        return SceneObject(item=cg).draw()
# ---------- end draw ----------
lng = ListLength(List=flatten(draw))
rg = ClusterOutput(draw)
series = Series(Start=0, Step=1, Count=lng)
bnd = Bounds(Numbers=series)
cg_2 = ClusterInput()
cg_3 = ClusterInput()
remap = RemapNumbers(Value=series, Source=bnd, Target="255")  # -> Mapped, Clipped
draw_2 = COMPASDraw(cg=cg_2)  # -> rg; same code as draw
rgb = ColourRGB(Alpha=255, Red=remap.Mapped, Green=remap.Mapped, Blue=remap.Mapped)
draw_3 = COMPASDraw(cg=cg_3)  # -> rg; same code as draw
unflatten = UnflattenTree(Tree=rgb, Guide=draw)
rg_2 = ClusterOutput(draw_2)
rg_3 = ClusterOutput(draw_3)
L = ClusterInput()
volume = Volume(Geometry=draw_2)
volume_2 = Volume(Geometry=draw)
T = ClusterOutput(unflatten)
item = ListItem(List=L, Index=0, Wrap=True)
C = ClusterOutput(volume)
C_2 = ClusterOutput(volume_2)
i = ClusterOutput(item)
