# Grasshopper definition Dec_08_Jerry_Fabrication.gh (Grasshopper 1.0.8)
# plug-ins: Weaverbird

neg = Negative(Value=Slider(600, range=0..1000))
neg_2 = Negative(Value=Slider(600, range=0..1000))
pt = ConstructPoint(XCoordinate=Slider(1300, range=0..10000), YCoordinate=neg, ZCoordinate=neg_2)
pt_2 = Point(pt)
Z = UnitZ(Factor="-10")
number_slider = Slider(150, range=0..1000)
move = Move(Geometry=pt_2, Motion=Z)  # -> Geometry, Transform
addition = Addition(A=number_slider, B=Slider(28, range=0..100))

# ---- group: grid_parameters
number_slider_2 = Slider(2, range=0..10)  # disabled
number_slider_3 = Slider(2, range=0..10)  # disabled
number_slider_4 = Slider(2, range=0..10)  # disabled

# ----
# from 201_stick_assembly
number_slider_5 = Slider(25, range=0..100)  # disabled
pt_3 = Point(Point(0.1313875721, 0.0945869119, 0))  # disabled
number_slider_6 = Slider(2, range=0..10)  # disabled
py3 = Python3Script(x_range=number_slider_2, y_range=number_slider_3, z_range=number_slider_4, offset=number_slider_5, st_pt=pt_3)  # -> out, points, sticks, geometry, frames; inputs x_range: Int32, y_range: Int32, z_range: Int32, offset: Double, st_pt: Point3d; disabled
# ---------- py3: Python ----------
#locate stick class file in the same folder
from compas_rhino import unload_modules
import sys
import os

#get current file path
path = ghenv.Component.OnPingDocument().FilePath
print (path)
#get parent directory of the parent directory
parentdir = os.path.dirname(path)
print (parentdir)
#get src folder which contains classes
dire = os.path.join(parentdir,'scripts')
print (dire)

sys.path.append(dire)

unload_modules('stick')
unload_modules('stickmodules')

import stick
from stick import Stick 
from stickmodules import OStickModule
from helpers import sort_sticks_by_z

from compas.geometry import Line, Point, Vector, Polyhedron, Rotation
from compas.datastructures import Assembly
from compas.datastructures import Part
from compas.datastructures import Mesh
from compas import json_dump
import math

stick_width = 13.0
stick_depth = 13.0
stick_length = 200


sticks = []
points = []

for x in range(x_range):
    for y in range(y_range):
        for z in range(z_range):
            grid_size = stick_length - 2*stick_depth - offset
            pt = Point(x*grid_size, y*grid_size, z*grid_size)
            points.append(pt)
            #type = 0 or 1 depending on odd or even
            #additionally type can be 2 for last item
            type_x = x%2 if x<x_range-1 else 2
            type_y = y%2 if y<y_range-1 else 2
            type_z = z%2 if z<z_range-1 else 2
            type = {"x":type_x, "y":type_y, "z":type_z}
            stick_module = OStickModule(pt, stick_length, stick_width, stick_depth, offset, type)
            sticks.extend(stick_module.stick_module)

from compas_rhino.conversions import frame_to_rhino_plane

geometry = [s.geometry for s in sticks]
frames = [frame_to_rhino_plane(s.frame) for s in sticks]
# ---------- end py3 ----------
point_list = PointList(Points=py3.frames, Size=number_slider_6)  # disabled
draw = COMPASDraw(cg=py3.points)  # -> rg; disabled
#   port cg: The COMPAS geometry or datastructure to be drawn.
#   port rg: The Rhino geometry object.
# ---------- draw: Python ----------
# r: compas>=2.14.1
"""
Draws COMPAS geometry in Grasshopper.
"""

from typing import Any

import Grasshopper

from compas.scene import SceneObject


class CompasToRhinoGeometry(Grasshopper.Kernel.GH_ScriptInstance):
    def RunScript(self, cg):
        if not cg:
            return None

        return SceneObject(item=cg).draw()
# ---------- end draw ----------
draw_2 = COMPASDraw(cg=py3.geometry)  # -> rg; disabled; same code as draw
button = Button()  # disabled
cluster = Cluster(pln=py3.frames, num=30)  # disabled
py3_2 = Python3Script(sticks=py3.sticks, save=button)  # -> out, frames, assembly; inputs sticks: list, save: Boolean; disabled
# ---------- py3_2: Python ----------
from compas import json_dump
import os, sys
from itertools import combinations
from compas_rhino import unload_modules
from compas.geometry import Line, Plane, Vector, Point

#get current file path
path = ghenv.Component.OnPingDocument().FilePath
#get parent directory of the parent directory
parentdir = os.path.dirname(path)
#get src folder which contains classes
dire = os.path.join(parentdir,'scripts')

sys.path.append(dire)

from stick import Stick 

from compas.datastructures import Assembly, Part

json_path = os.path.join(parentdir, 'data', 'stick_assembly.json')

stick_width = 13.0
stick_depth = 13.0
stick_length = 200

sticks_data = []

###########################################################################
# Make frames point in best direction
###########################################################################
import math
import copy

from compas.geometry import dot_vectors, Rotation
from compas.geometry import centroid_points

def is_parallel(v1, v2):
    if math.isclose(dot_vectors(v1, v2), 1, abs_tol = 0.001) or math.isclose(dot_vectors(v1, v2), -1 ,abs_tol = 0.001):
        # Means it is parallel
        print("parallel")
        return True
    else:
        # Means it is not parallel
        print("not parallel")
        return False

def get_frame_closest_to_target(target_vector, stick):
    best_dot = -1000.0
    for i in range(4):
        angle = math.pi/2 * i
        R = Rotation.from_axis_and_angle(stick.frame.xaxis, angle, stick.frame.point)
        frame = stick.frame.transformed(R)
        dot = dot_vectors(frame.zaxis, target_vector.unitized())
        if dot>best_dot:
            best_dot = dot
            best_frame = frame
            print(i)
    return best_frame

def get_center(sticks_list):
    all_points = [stick.frame.point for stick in sticks_list]
    center = centroid_points(all_points)
    print(center)
    return center

# Copy sticks

sticks_copy = copy.deepcopy(sticks)
center_pt = get_center(sticks_copy)


for stick in sticks_copy:
    if is_parallel(stick.axis.direction.unitized(), Vector(0,0,1)):
        # Target frame is frame pointing into center of structure
        center_vector = Vector.from_start_end(stick.frame.point, center_pt)
        best_frame = get_frame_closest_to_target(center_vector, stick=stick)
        stick.frame = best_frame

    else:
        # Make sure z axis is pointing down
        R = Rotation.from_axis_and_angle(stick.frame.xaxis, math.pi/2, stick.frame.point)
        stick.frame.transform(R)

from compas_rhino.conversions import frame_to_rhino_plane

###########################################################################
# Make frames point in best direction
###########################################################################

assembly = Assembly()
for i, s in enumerate(sticks_copy):
    part_name = "stick"+ str(i)
    part = Part(name = part_name, frame = s.frame)
    part.key = i
    part.attributes["shape"] = s.geometry
    assembly.add_part(part)
    

frames = [frame_to_rhino_plane(p.frame) for p in assembly.parts()]

if save:
    json_dump(assembly, fp=json_path, pretty=True)
# ---------- end py3_2 ----------

# ----
# Multiple Aggregations and Branches:
# Week 3 Prototype (Fixed Params)
py3_3 = Python3Script(origin=pt_2, legs=Slider(3, range=0..10), r=number_slider, incline=Slider(-8, range=-90..90))  # -> out, plns_out; inputs origin: Point3d, legs: Int32, r: Double, incline: Double
# ---------- py3_3: Python ----------
import Rhino.Geometry as rg
import math


plns = []
for i in range(legs):
    theta = 2 * math.pi * (i / legs)
    x = origin.X + r * math.cos(theta)
    y = origin.Y + r * math.sin(theta)
    pt = rg.Point3d(x, y, origin.Z)

    pln = rg.Plane(pt, rg.Vector3d.ZAxis)
    pln.Rotate(theta, rg.Vector3d.ZAxis)
    pln.Rotate(-math.pi / 2, pln.YAxis)
    pln.Rotate(math.radians(incline), pln.YAxis)
    plns.append(pln)

plns_out = plns
# ---------- end py3_3 ----------
polygon = Polygon(Plane=move.Geometry, Radius=addition, Segments=Slider(12, range=0..20), FilletRadius=0)  # -> Polygon, Length
offset = OffsetCurve(Curve=polygon.Polygon, Distance=Slider(262, range=0..1000), Corners=1)
Z_2 = UnitZ(Factor=Slider(1200, range=0..10000))
cluster_2 = Cluster(pln=py3_3.plns_out, num=30)
disc = Discontinuity(Curve=polygon.Polygon, Level=1)  # -> Points, Parameters
move_2 = Move(Geometry=offset, Motion=Z_2)  # -> Geometry, Transform
shift = ShiftList(List=disc.Points, Shift="-1", Wrap=True)
disc_2 = Discontinuity(Curve=move_2.Geometry, Level=1)  # -> Points, Parameters
long = LongestList(ListA=shift, ListB=disc.Points, ListC=move.Geometry, PaddingMode=2)  # -> ListA, ListB, ListC
shift_2 = ShiftList(List=disc_2.Points, Shift="-1", Wrap=True)
long_2 = LongestList(ListA=shift, ListB=disc.Points, ListC=disc_2.Points, ListD=shift_2, PaddingMode=2)  # -> ListA, ListB, ListC, ListD
transform = Transform(Geometry=move.Geometry, Transform=move_2.Transform)
merge = Merge(Data1=graft(long.ListA), Data2=graft(long.ListB), Data3=graft(long.ListC))  # -> reverse(Result)
merge_2 = Merge(Data1=graft(long_2.ListA), Data2=graft(long_2.ListB), Data3=graft(long_2.ListC), Data4=graft(long_2.ListD))
long_3 = LongestList(ListA=shift_2, ListB=disc_2.Points, ListC=transform, PaddingMode=2)  # -> ListA, ListB, ListC
conmesh = ConstructMesh(Vertices=merge, Faces={A=0, B=1, C=2, D=2})
merge_3 = Merge(Data1=graft(long_3.ListA), Data2=graft(long_3.ListB), Data3=graft(long_3.ListC))
conmesh_2 = ConstructMesh(Vertices=merge_2, Faces={A=0, B=1, C=2, D=3})
conmesh_3 = ConstructMesh(Vertices=merge_3, Faces={A=0, B=1, C=2, D=2})
merge_4 = Merge(Data1=simplify(conmesh), Data2=simplify(conmesh_2), Data3=simplify(conmesh_3))  # -> flatten(Result)
mjoin = MeshJoin(Meshes=merge_4)
mesh = Mesh(mjoin)
panel = Panel("""200
400""")
list = ValueList({"Regular": 0, "Random": 1}, selected="Random")
pln = Plane(py3_3.plns_out)
wbedges = WeaverbirdsMeshEdges(MeshOrPolylines=mesh)
panel_2 = Panel("""20
160""")
py3_4 = Python3Script(
    first_plns=pln,
    length_pattern=panel,
    angle_pattern=panel_2,
    agg_type=list,
    seed="53",
    agg_count="3",
    agg_round="2",
    branch_count="3",
    max_attempts="10",
    boundary_mesh=mesh)  # -> out, geo_out, frame_out, pln_out, axis_out, failed_sticks, valid_sticks, collision_log, Sticks_out, agg_manager; inputs first_plns: list of Plane, length_pattern: list of Double, angle_pattern: list of Double, agg_type: Int32, seed: Int32, agg_count: Int32, agg_round: Int32, branch_count: Int32, max_attempts: Int32, boundary_mesh: Mesh
# ---------- py3_4: Python ----------
#locate stick class file in the same folder
from compas_rhino import unload_modules
import sys
import os
"""
#get current file path
path = ghenv.Component.OnPingDocument().FilePath
#get parent directory of the parent directory
parentdir = os.path.dirname(path)
#get src folder which contains classes
dire = os.path.join(parentdir,'scripts')

sys.path.append(dire)"""

path = 'D:\\ETH\\Github\\MAS-2526\\08_SpatialAssemblies\\StudentProjects\\group_two\\J3RRY_Sticks_^o^\\scripts\\Package_v2'
sys.path.append(path)

unload_modules('J3RRY_SingleStick_v1')
unload_modules('J3RRY_Aggregation_v3')
unload_modules('J3RRY_Collision_v1')

from J3RRY_SingleStick_v1 import Stick
from J3RRY_Aggregation_v3 import Aggregation, AggregationManager
from J3RRY_Collision_v1 import Collision

from compas.geometry import Line, Point, Vector
from compas.geometry import Transformation
from compas_rhino.conversions import plane_to_compas_frame, frame_to_rhino_plane
import scriptcontext as sc
import random


from Grasshopper import DataTree
from Grasshopper.Kernel.Data import GH_Path

"""Main Code"""
# Convert rhino plane to compas frame
first_frames = [plane_to_compas_frame(p) for p in first_plns]
# Create aggregation manager
agg_manager = AggregationManager()
# Run aggregations
all_rounds = agg_manager.run_multiround_aggregation(
    first_frames,
    length_pattern,
    angle_pattern,
    agg_type,
    seed,
    agg_count,
    agg_round,
    branch_count,
    boundary_mesh,
    max_attempts)
# Get graph
graph = agg_manager.graph
print (graph)


# Visualization
geo_tree = DataTree[object]()
axis_tree = DataTree[object]()
frame_tree = DataTree[object]()
pln_tree = DataTree[object]()
Sticks_tree = DataTree[object]()

for i, agg in enumerate(agg_manager.aggs):
    path = GH_Path(graph[i])
    print (path)
    for s in agg.sticks:
        geo_tree.Add(s.geometry, path)
        axis_tree.Add(s.axis, path)
        frame_tree.Add(s.frame, path)
        pln_tree.Add(frame_to_rhino_plane(s.frame), path)
        Sticks_tree.Add(s, path)

geo_out = geo_tree
axis_out = axis_tree
frame_out = frame_tree
pln_out = pln_tree
Sticks_out = Sticks_tree



# Log
failed_sticks = DataTree[object]()
valid_sticks = DataTree[object]()
for i, agg in enumerate(agg_manager.aggs):
    for j, branch in enumerate(agg.failed_sticks):
        path = GH_Path(*graph[i] + [j + 1])
        for s in branch:
            failed_sticks.Add(s.geometry, path)

    for j, branch in enumerate(agg.valid_sticks):
        path = GH_Path(*graph[i] + [j + 1])
        for s in branch:
            valid_sticks.Add(s.geometry, path)



collision_log = DataTree[object]()
for i, agg in enumerate(agg_manager.aggs):
    for j, log in enumerate(agg.collision_log):
        path = GH_Path(graph[i] + [j + 1])
        collision_log.Add(f"attempts = {log['attempts']}", path)
        collision_log.Add(f"fail_count = {log['fail_count']}", path)
        collision_log.Add(f"success = {log['success']}", path)
        collision_log.Add(f"reason = {log['reason']}", path)
        collision_log.Add(f"length = {log['params']['length']}", path)    
        collision_log.Add(f"angle = {log['params']['angle']}", path)
        collision_log.Add(f"from_index = {log['params']['from_index']}", path)
        collision_log.Add(f"to_index = {log['params']['to_index']}", path)
        collision_log.Add(f"from_t = {log['params']['from_t']}", path)
        collision_log.Add(f"to_t = {log['params']['to_t']}", path)
# ---------- end py3_4 ----------
panel_3 = Panel(py3_4.collision_log)
draw_3 = COMPASDraw()  # -> rg; same code as draw
data = Data(py3_4.agg_manager)
pt_4 = Point(Point(340.5922383, -1741.692546, 0))
pt_5 = Point(Point(1691.100249, -919.8009515, 0))  # disabled
draw_4 = COMPASDraw(cg=py3_4.geo_out)  # -> rg; same code as draw
pln_2 = Plane(py3_4.pln_out)
draw_5 = COMPASDraw(cg=py3_4.axis_out)  # -> rg; same code as draw
md_slider = MDSlider(
    SliderMode=0,
    slider_value=Point(0.1644700213, 0.8996145202, 0.5),
    x_domain=Domain(0, 1),
    y_domain=Domain(0, 1),
    z_domain=Domain(0, 1))
draw_6 = COMPASDraw(cg=py3_4.failed_sticks)  # -> rg; same code as draw
draw_7 = COMPASDraw(cg=py3_4.valid_sticks)  # -> rg; same code as draw
# * Fabrication
py3_5 = Python3Script(agg_manager=data, origin=pt_4, x_size=Slider(400, range=0..1000), y_size=Slider(240, range=0..1000), robot_position=pt_5)  # -> out, joint_plns, fab_sticks, borders, plotted_sticks, pick_plns, pick_frames_out; inputs origin: Point3d, x_size: Double, y_size: Double, robot_position: Point3d
# ---------- py3_5: Python ----------
#locate stick class file in the same folder
from compas_rhino import unload_modules
import sys
import os
"""
#get current file path
path = ghenv.Component.OnPingDocument().FilePath
#get parent directory of the parent directory
parentdir = os.path.dirname(path)
#get src folder which contains classes
dire = os.path.join(parentdir,'scripts')

sys.path.append(dire)"""

path = 'D:\\ETH\\Github\\MAS-2526\\08_SpatialAssemblies\\StudentProjects\\group_two\\J3RRY_Sticks_^o^\\scripts\\Package_v2'
sys.path.append(path)

unload_modules('J3RRY_SingleStick_v1')
unload_modules('J3RRY_Aggregation_v3')
unload_modules('J3RRY_Collision_v1')
unload_modules('J3RRY_Fabrication_v1')

from J3RRY_SingleStick_v1 import Stick
from J3RRY_Aggregation_v3 import Aggregation, AggregationManager
from J3RRY_Collision_v1 import Collision
from J3RRY_Fabrication_v1 import Fabrication

from compas.geometry import Line, Point, Vector, Frame
from compas.geometry import Transformation
from compas_rhino.conversions import plane_to_compas_frame, frame_to_rhino_plane
from compas_rhino.conversions import point_to_compas
import scriptcontext as sc
import random


from Grasshopper import DataTree
from Grasshopper.Kernel.Data import GH_Path

"""Main Code"""
graph = agg_manager.graph
print (graph)
# Construct Fab
fab = Fabrication(agg_manager)


# Add adjacent sticks FIRST
sticks_with_adjacent, agg_indices, stick_indices = fab.add_adjacent_sticks(False)

# Erect modules with adjacent sticks
erected_modules = fab.erect_modules(sticks_with_adjacent)

# Get joint plns
joint_frames = fab.get_joint_frames(erected_modules)
# Erect joint_frames

# Evaluate pick up frames
if robot_position:
    robot_position = point_to_compas(robot_position)
else:
    robot_position = Point(0,0,0)
pick_frames = fab.eval_pick_frames(erected_modules, robot_position)

#Output
fab_sticks = DataTree[object]()
for i, branch in enumerate(erected_modules):
    path = GH_Path(*graph[i])
    for stick in branch:
        fab_sticks.Add(stick.geometry, path)

print (agg_indices)
print (stick_indices)

joint_plns = DataTree[object]()
for i, branch in enumerate(joint_frames):
    path = GH_Path(*graph[i])
    for frame in branch:
        pln = frame_to_rhino_plane(frame)
        joint_plns.Add(pln, path)

pick_plns = DataTree[object]()
pick_frames_out = DataTree[object]()

for i, branch in enumerate(pick_frames):
    path = GH_Path(*graph[i])
    for frame in branch:
        pln = frame_to_rhino_plane(frame)
        pick_plns.Add(pln, path)
        pick_frames_out.Add(frame, path)

# Plotting
origin = point_to_compas(origin)
plotted_modules, borders = fab.plot_modules(erected_modules, origin, x_size, y_size)

plotted_sticks = DataTree[object]()
for i, branch in enumerate(plotted_modules):
    path = GH_Path(*graph[i])
    for stick in branch:
        plotted_sticks.Add(stick.geometry, path)
# ---------- end py3_5 ----------
cluster_3 = Cluster(pln=pln_2, num=30)

data_2 = Data(py3_4.agg_manager)  # disabled
py3_6 = Python3Script(agg_manager=data_2)  # -> out, joint_plns; disabled
# ---------- py3_6: Python ----------
#locate stick class file in the same folder
from compas_rhino import unload_modules
import sys
import os
"""
#get current file path
path = ghenv.Component.OnPingDocument().FilePath
#get parent directory of the parent directory
parentdir = os.path.dirname(path)
#get src folder which contains classes
dire = os.path.join(parentdir,'scripts')

sys.path.append(dire)"""

path = 'D:\\ETH\\Github\\MAS-2526\\08_SpatialAssemblies\\StudentProjects\\group_two\\J3RRY_Sticks_^o^\\scripts\\Package_v2'
sys.path.append(path)

unload_modules('J3RRY_SingleStick_v1')
unload_modules('J3RRY_Aggregation_v3')
unload_modules('J3RRY_Collision_v1')
unload_modules('J3RRY_Fabrication_v1')

from J3RRY_SingleStick_v1 import Stick
from J3RRY_Aggregation_v3 import Aggregation, AggregationManager
from J3RRY_Collision_v1 import Collision
from J3RRY_Fabrication_v1 import Fabrication

from compas.geometry import Line, Point, Vector, Frame
from compas.geometry import Transformation
from compas_rhino.conversions import plane_to_compas_frame, frame_to_rhino_plane
import scriptcontext as sc
import random


from Grasshopper import DataTree
from Grasshopper.Kernel.Data import GH_Path

"""Main Code"""
graph = agg_manager.graph
print (graph)
# Construct Fab
fab = Fabrication(agg_manager)

joint_frames = fab.get_joint_frames()


#Output
joint_plns = DataTree[object]()
for i, branch in enumerate(joint_frames):
    path = GH_Path(*graph[i])
    for frame in branch:
        pln = frame_to_rhino_plane(frame)
        joint_plns.Add(pln, path)
# ---------- end py3_6 ----------
number_slider_7 = Slider(0, range=0..10)  # disabled
data_3 = Data(py3_6.joint_plns)  # disabled
tstat = TreeStatistics(Tree=data_3)  # -> Paths, Length, Count; disabled
item = ListItem(List=tstat.Paths, Index=number_slider_7, Wrap=True)  # disabled
cluster_4 = Cluster(pln=py3_6.joint_plns, num=30)  # disabled
branch = TreeBranch(Tree=data_3, Path=item, MaintainPaths=True)  # disabled

evalsrf = EvaluateSurface(Surface=reparameterize(draw_3), Point=md_slider)  # -> Point, Normal, UDirection, VDirection, Frame

# ----
# * Get joint planes
# * Erect Stick Modules
data_4 = Data(py3_4.agg_manager)
py3_7 = Python3Script(agg_manager=data_4)  # -> out, joint_plns, erected_sticks, fab_sticks
# ---------- py3_7: Python ----------
#locate stick class file in the same folder
from compas_rhino import unload_modules
import sys
import os
"""
#get current file path
path = ghenv.Component.OnPingDocument().FilePath
#get parent directory of the parent directory
parentdir = os.path.dirname(path)
#get src folder which contains classes
dire = os.path.join(parentdir,'scripts')

sys.path.append(dire)"""

path = 'D:\\ETH\\Github\\MAS-2526\\08_SpatialAssemblies\\StudentProjects\\group_two\\J3RRY_Sticks_^o^\\scripts\\Package_v2'
sys.path.append(path)

unload_modules('J3RRY_SingleStick_v1')
unload_modules('J3RRY_Aggregation_v3')
unload_modules('J3RRY_Collision_v1')
unload_modules('J3RRY_Fabrication_v1')

from J3RRY_SingleStick_v1 import Stick
from J3RRY_Aggregation_v3 import Aggregation, AggregationManager
from J3RRY_Collision_v1 import Collision
from J3RRY_Fabrication_v1 import Fabrication

from compas.geometry import Line, Point, Vector, Frame
from compas.geometry import Transformation
from compas_rhino.conversions import plane_to_compas_frame, frame_to_rhino_plane
import scriptcontext as sc
import random


from Grasshopper import DataTree
from Grasshopper.Kernel.Data import GH_Path

"""Main Code"""
graph = agg_manager.graph
print (graph)
# Construct Fab
fab = Fabrication(agg_manager)
# Get joint frames
joint_frames = fab.get_joint_frames()

# Erect modules
erected_modules = fab.erect_modules()

# Convert frame to plane
joint_plns = DataTree[object]()
for i, branch in enumerate(joint_frames):
    path = GH_Path(*graph[i])
    for frame in branch:
        pln = frame_to_rhino_plane(frame)
        joint_plns.Add(pln, path)

# Convert frame to plane
erected_sticks = DataTree[object]()
for i, branch in enumerate(erected_modules):
    path = GH_Path(*graph[i])
    for stick in branch:
        erected_sticks.Add(stick.geometry, path)

# adj
# fab.add_adjacent_sticks()

# fab_sticks = DataTree[object]()
# for i, branch in enumerate(fab.sticks):
#     path = GH_Path(*graph[i])
#     for stick in branch:
#         fab_sticks.Add(stick.geometry, path)
# ---------- end py3_7 ----------
data_5 = Data(py3_7.joint_plns)
draw_8 = COMPASDraw(cg=py3_7.erected_sticks)  # -> rg; disabled; same code as draw
tstat_2 = TreeStatistics(Tree=data_5)  # -> Paths, Length, Count
item_2 = ListItem(List=tstat_2.Paths, Index=Slider(0, range=0..10), Wrap=True)
branch_2 = TreeBranch(Tree=data_5, Path=item_2, MaintainPaths=True)
cluster_5 = Cluster(pln=branch_2, num=30)

tstat_3 = TreeStatistics(Tree=draw_3)  # -> graft(Paths), Length, Count
draw_9 = COMPASDraw(cg=py3_5.borders)  # -> rg; same code as draw
draw_10 = COMPASDraw(cg=py3_5.plotted_sticks)  # -> rg; same code as draw
tag = TextTag3D(Location=evalsrf.Point, Text=tstat_3.Paths, Size=Slider(20, range=0..20), Justification=7)

# ----
# * Label
midpt = CurveMiddle(Curve=draw_5)
tstat_4 = TreeStatistics(Tree=midpt)  # -> graft(Paths), Length, Count
chars = Characters(Text=tstat_4.Paths)  # -> Result, Unicode
cull_i = CullIndex(List=chars.Result, Indices="-1", Wrap=True)
series = Series(Start=0, Step=1, Count=tstat_4.Length)
join = TextJoin(Text=cull_i)
concat = Concatenate(FragmentA=join, FragmentC="_", FragmentB=series, FragmentD="}")
tag_2 = TextTag(Location=midpt, Text=concat)

geo = Geometry(draw_4)
geo_2 = Geometry(draw_6)
geo_3 = Geometry(draw_7)
py3_8 = Python3Script(geos=geo)  # -> out, groups; inputs geos: tree of GeometryBase
# ---------- py3_8: Python ----------
from Grasshopper import DataTree
from Grasshopper.Kernel.Data import GH_Path

path_length = [path.Length for path in geos.Paths]
print (path_length)
cset = sorted(set(path_length))
print (cset)

geo_tree = DataTree[object]()

for i, L in enumerate(cset):
    path = GH_Path(i)
    for p in geos.Paths:
        if p.Length == L:
            for item in geos.Branch(p):
                geo_tree.Add(item, path)

groups = geo_tree
# ---------- end py3_8 ----------
tstat_5 = TreeStatistics(Tree=geo_2)  # -> Paths, Length, Count
merge_5 = Merge(
    Data1=ColourSwatch(SwatchColor=RGBA(255, 255, 255, 150)),
    Data2=ColourSwatch(SwatchColor=RGBA(255, 247, 0, 150)),
    Data3=ColourSwatch(SwatchColor=RGBA(0, 255, 153, 150)))
item_3 = ListItem(List=tstat_5.Paths, Index=Slider(1, range=0..29), Wrap=True)
tstat_6 = TreeStatistics(Tree=py3_8.groups)  # -> Paths, Length, Count
series_2 = Series(Start=0, Step=1, Count=tstat_6.Count)
item_4 = ListItem(List=merge_5, Index=series_2, Wrap=True)  # -> graft(Item)
branch_3 = TreeBranch(Tree=geo_2, Path=item_3, MaintainPaths=True)
branch_4 = TreeBranch(Tree=geo_3, Path=item_3, MaintainPaths=True)
preview = CustomPreview(Geometry=py3_8.groups, Material=item_4)

draw_11 = COMPASDraw(cg=py3_5.fab_sticks)  # -> rg; same code as draw
number_slider_8 = Slider(1, range=0..10)  # disabled
draw_12 = COMPASDraw(cg=py3_7.fab_sticks)  # -> rg; disabled; same code as draw
data_6 = Data(py3_5.joint_plns)
number_slider_9 = Slider(0, range=0..10)
data_7 = Data(py3_5.pick_plns)
data_8 = Data(py3_5.pick_frames_out)
tstat_7 = TreeStatistics(Tree=data_6)  # -> Paths, Length, Count
tstat_8 = TreeStatistics(Tree=data_7)  # -> Paths, Length, Count
tstat_9 = TreeStatistics(Tree=data_8)  # -> Paths, Length, Count
data_9 = Data(draw_12)  # disabled
data_10 = Data(draw_4)  # disabled
data_11 = Data(draw_11)
tstat_10 = TreeStatistics(Tree=data_9)  # -> Paths, Length, Count; disabled
tstat_11 = TreeStatistics(Tree=data_10)  # -> Paths, Length, Count; disabled
item_5 = ListItem(List=tstat_7.Paths, Index=number_slider_9, Wrap=True)
item_6 = ListItem(List=tstat_8.Paths, Index=number_slider_9, Wrap=True)
tstat_12 = TreeStatistics(Tree=data_11)  # -> Paths, Length, Count
item_7 = ListItem(List=tstat_9.Paths, Index=number_slider_9, Wrap=True)
item_8 = ListItem(List=tstat_10.Paths, Index=number_slider_8, Wrap=True)  # disabled
item_9 = ListItem(List=tstat_11.Paths, Index=number_slider_8, Wrap=True)  # disabled
branch_5 = TreeBranch(Tree=data_6, Path=item_5, MaintainPaths=True)
item_10 = ListItem(List=tstat_12.Paths, Index=number_slider_9, Wrap=True)
branch_6 = TreeBranch(Tree=data_7, Path=item_6, MaintainPaths=True)
branch_7 = TreeBranch(Tree=data_8, Path=item_7, MaintainPaths=True)
branch_8 = TreeBranch(Tree=data_9, Path=item_8, MaintainPaths=True)  # disabled
branch_9 = TreeBranch(Tree=data_10, Path=item_9, MaintainPaths=True)  # disabled
cluster_6 = Cluster(pln=branch_5, num=30)
cluster_7 = Cluster(pln=branch_6, num=30)
branch_10 = TreeBranch(Tree=data_11, Path=item_10, MaintainPaths=True)
ins = InsertItems(List=branch_6, Indices="0", Wrap=invert(True))
series_3 = Series(Start=0, Step=1, Count=Slider(7, range=0..10))
viewer = ParamViewer(data_9)  # disabled
viewer_2 = ParamViewer(data_10)  # disabled
item_11 = ListItem(List=ins, Index=series_3, Wrap=True)
item_12 = ListItem(List=branch_10, Index=series_3, Wrap=True)
cluster_8 = Cluster(pln=item_11, num=30)
py3_9 = Python3Script(pick_frames=branch_7, save=Button())  # -> out, plns, assembly; inputs pick_frames: list, sticks: list, save: Boolean
# ---------- py3_9: Python ----------
from compas import json_dump
import os, sys
from itertools import combinations
from compas_rhino import unload_modules
from compas.geometry import Line, Plane, Vector, Point

#get current file path
path = ghenv.Component.OnPingDocument().FilePath
#get parent directory of the parent directory
parentdir = os.path.dirname(path)
#get src folder which contains classes
dire = os.path.join(parentdir,'scripts')

sys.path.append(dire)

from stick import Stick 

from compas.datastructures import Assembly, Part

json_path = os.path.join(parentdir, 'data', 'stick_assembly.json')


sticks_data = []

###########################################################################
# Make frames point in best direction
###########################################################################
import math
import copy

from compas.geometry import dot_vectors, Rotation
from compas.geometry import centroid_points

def is_parallel(v1, v2):
    if math.isclose(dot_vectors(v1, v2), 1, abs_tol = 0.001) or math.isclose(dot_vectors(v1, v2), -1 ,abs_tol = 0.001):
        # Means it is parallel
        print("parallel")
        return True
    else:
        # Means it is not parallel
        print("not parallel")
        return False

def get_frame_closest_to_target(target_vector, stick):
    best_dot = float(-'inf')
    for i in range(4):
        angle = math.pi/2 * i
        R = Rotation.from_axis_and_angle(stick.midframe.xaxis, angle, stick.midframe.point)
        frame = stick.midframe.transformed(R)
        dot = dot_vectors(frame.zaxis, target_vector.unitized())
        if dot>best_dot:
            best_dot = dot
            best_frame = frame
            print(i)
    return best_frame

def get_center(sticks_list):
    all_points = [stick.midframe.point for stick in sticks_list]
    center = centroid_points(all_points)
    print(center)
    return center

# Copy sticks

sticks_copy = copy.deepcopy(sticks)
center_pt = get_center(sticks_copy)


for stick in sticks_copy:
    if is_parallel(stick.axis.direction.unitized(), Vector(0,0,1)):
        # Target frame is frame pointing into center of structure
        center_vector = Vector.from_start_end(stick.midframe.point, center_pt)
        best_frame = get_frame_closest_to_target(center_vector, stick=stick)
        stick.midframe = best_frame

    else:
        # Make sure z axis is pointing down
        R = Rotation.from_axis_and_angle(stick.midframe.xaxis, math.pi/2, stick.midframe.point)
        stick.midframe.transform(R)

from compas_rhino.conversions import frame_to_rhino_plane

###########################################################################
# Make frames point in best direction
###########################################################################

assembly = Assembly()
for i, s in enumerate(sticks_copy):
    part_name = "stick"+ str(i)
    part = Part(name = part_name, frame = s.midframe)
    part.key = i
    part.attributes["shape"] = s.geometry
    assembly.add_part(part)
    
name = [p.attributes["name"] for p in assembly.parts()]
print (name)
plns = [frame_to_rhino_plane(p.frame) for p in assembly.parts()]

if save:
    json_dump(assembly, fp=json_path, pretty=True)
# ---------- end py3_9 ----------
# * Hypothetical Robot's Location: (0, 0, 0)
# * Modules' Location:
pt_6 = Point(move.Geometry)
py3_10 = Python3Script(origin=pt_6)  # -> out, oriented_sticks, geos, joint_plns; inputs sticks: tree, origin: Point3d
# ---------- py3_10: Python ----------
#locate stick class file in the same folder
from compas_rhino import unload_modules
import sys
import os
"""
#get current file path
path = ghenv.Component.OnPingDocument().FilePath
#get parent directory of the parent directory
parentdir = os.path.dirname(path)
#get src folder which contains classes
dire = os.path.join(parentdir,'scripts')

sys.path.append(dire)"""

path = 'D:\\ETH\\Github\\MAS-2526\\08_SpatialAssemblies\\StudentProjects\\group_two\\J3RRY_Sticks_^o^\\scripts\\Package_v2'
sys.path.append(path)

unload_modules('J3RRY_SingleStick_v1')
unload_modules('J3RRY_Aggregation_v3')
unload_modules('J3RRY_Collision_v1')

from J3RRY_SingleStick_v1 import Stick
from J3RRY_Aggregation_v3 import Aggregation
from J3RRY_Collision_v1 import Collision

from compas.geometry import Line, Point, Vector, Frame
from compas.geometry import Transformation
from compas_rhino.conversions import plane_to_compas_frame, frame_to_rhino_plane
import scriptcontext as sc
import random


from Grasshopper import DataTree
from Grasshopper.Kernel.Data import GH_Path

"""Main Code"""
# Erect modules to be vertical
# by orienting the first stick(index 0) of each module for robotic fabrication
oriented_sticks = DataTree[object]()
geos = DataTree[object]()
plns = DataTree[object]()

# frame to orient to
to_frame = Frame(origin, [0,0,1], [0,1,0])

for path in sticks.Paths:
    module = sticks.Branch(path)
    # frame to orient from
    from_frame = module[0].frame.copy()
    # Create Orientation
    O = Transformation.from_frame_to_frame(from_frame, to_frame)
    for stick in module:
        new_frame = stick.frame.copy()
        new_frame.transform(O)
        ori_stick = Stick(new_frame, stick.length)
        oriented_sticks.Add(ori_stick, path)
        geos.Add(ori_stick.geometry, path)

# Evaluate Pick Up Frames
joint_plns = DataTree[object]()
for path in oriented_sticks.Paths:
    module = oriented_sticks.Branch(path)
    face_branch = face_indices.Branch(path)
    t_branch = t_values.Branch(path)
    for stick, face_idx, t in zip(module, face_branch, t_branch):
        if face_idx is not None and t is not None:
            pick_frame = stick.eval_frame(face_idx, t)
            pick_pln = frame_to_rhino_plane(pick_frame)
            joint_plns.Add(pick_pln, path)
# ---------- end py3_10 ----------
cluster_9 = Cluster(pln=py3_9.plns, num=30)
number_slider_10 = Slider(3, range=0..10)
draw_13 = COMPASDraw(cg=py3_10.geos)  # -> rg; same code as draw
data_12 = Data(py3_10.oriented_sticks)
data_13 = Data(draw_13)
data_14 = Data(py3_10.joint_plns)
tstat_13 = TreeStatistics(Tree=data_12)  # -> Paths, Length, Count
tstat_14 = TreeStatistics(Tree=data_13)  # -> Paths, Length, Count
tstat_15 = TreeStatistics(Tree=data_14)  # -> Paths, Length, Count
item_13 = ListItem(List=tstat_13.Paths, Index=number_slider_10, Wrap=True)
item_14 = ListItem(List=tstat_14.Paths, Index=number_slider_10, Wrap=True)
item_15 = ListItem(List=tstat_15.Paths, Index=number_slider_10, Wrap=True)
data_15 = Data()
branch_11 = TreeBranch(Tree=data_12, Path=item_13, MaintainPaths=True)
branch_12 = TreeBranch(Tree=data_13, Path=item_14, MaintainPaths=True)
branch_13 = TreeBranch(Tree=data_14, Path=item_15, MaintainPaths=True)
tstat_16 = TreeStatistics(Tree=data_15)  # -> Paths, Length, Count
cluster_10 = Cluster(pln=branch_13, num=30)
item_16 = ListItem(List=tstat_16.Paths, Index=Slider(0, range=0..10), Wrap=True)
branch_14 = TreeBranch(Tree=data_15, Path=item_16, MaintainPaths=True)
# * Evaluate Pick Frames Based on which
# Face Index & T Value
# * Define a frame first to start searching the path
button_2 = Button()
py3_11 = Python3Script(sticks=branch_14, save=button_2)  # -> out, frames, assembly; inputs sticks: list, save: Boolean
# ---------- py3_11: Python ----------
from compas import json_dump
import os, sys
from itertools import combinations
from compas_rhino import unload_modules
from compas.geometry import Line, Plane, Vector, Point

#get current file path
path = ghenv.Component.OnPingDocument().FilePath
#get parent directory of the parent directory
parentdir = os.path.dirname(path)
#get src folder which contains classes
dire = os.path.join(parentdir,'scripts')

sys.path.append(dire)

from stick import Stick 

from compas.datastructures import Assembly, Part

json_path = os.path.join(parentdir, 'data', 'stick_assembly.json')


sticks_data = []

###########################################################################
# Make frames point in best direction
###########################################################################
import math
import copy

from compas.geometry import dot_vectors, Rotation
from compas.geometry import centroid_points

def is_parallel(v1, v2):
    if math.isclose(dot_vectors(v1, v2), 1, abs_tol = 0.001) or math.isclose(dot_vectors(v1, v2), -1 ,abs_tol = 0.001):
        # Means it is parallel
        print("parallel")
        return True
    else:
        # Means it is not parallel
        print("not parallel")
        return False

def get_frame_closest_to_target(target_vector, stick):
    best_dot = float(-'inf')
    for i in range(4):
        angle = math.pi/2 * i
        R = Rotation.from_axis_and_angle(stick.midframe.xaxis, angle, stick.midframe.point)
        frame = stick.midframe.transformed(R)
        dot = dot_vectors(frame.zaxis, target_vector.unitized())
        if dot>best_dot:
            best_dot = dot
            best_frame = frame
            print(i)
    return best_frame

def get_center(sticks_list):
    all_points = [stick.midframe.point for stick in sticks_list]
    center = centroid_points(all_points)
    print(center)
    return center

# Copy sticks

sticks_copy = copy.deepcopy(sticks)
center_pt = get_center(sticks_copy)


for stick in sticks_copy:
    if is_parallel(stick.axis.direction.unitized(), Vector(0,0,1)):
        # Target frame is frame pointing into center of structure
        center_vector = Vector.from_start_end(stick.midframe.point, center_pt)
        best_frame = get_frame_closest_to_target(center_vector, stick=stick)
        stick.midframe = best_frame

    else:
        # Make sure z axis is pointing down
        R = Rotation.from_axis_and_angle(stick.midframe.xaxis, math.pi/2, stick.midframe.point)
        stick.midframe.transform(R)

from compas_rhino.conversions import frame_to_rhino_plane

###########################################################################
# Make frames point in best direction
###########################################################################

assembly = Assembly()
for i, s in enumerate(sticks_copy):
    part_name = "stick"+ str(i)
    part = Part(name = part_name, frame = s.midframe)
    part.key = i
    part.attributes["shape"] = s.geometry
    assembly.add_part(part)
    
name = [p.attributes["name"] for p in assembly.parts()]
print (name)
frames = [frame_to_rhino_plane(p.frame) for p in assembly.parts()]

if save:
    json_dump(assembly, fp=json_path, pretty=True)
# ---------- end py3_11 ----------
py3_12 = Python3Script(sticks=branch_14, save=Button())  # -> out, frames, assembly; inputs sticks: list, save: Boolean; same code as py3_11

# ----
# 1. Save your stick assembly in data folder in the parent directory (Example: 201_stick_assembly.ghx)
# 
# 2. Run Docker and connect with the ROS connect component
# 
# 3. Plan for any index and send to robot using the send components.
button_3 = Button()
compas_fab_ros_connect = COMPASFABROSConnect(connect=button_3)  # -> ros_client, is_connected; inputs ip: String, port: Int32, connect: Boolean
#   port ip: The ip address ROS. Defaults to 127.0.0.1.
#   port port: The port of ROS. Defaults to 9090.
#   port connect: If True, connects to ROS. If False, disconnects from ROS. Defaults to False.
#   port ros_client: The ROS client.
#   port is_connected: True if connection established.
# ---------- compas_fab_ros_connect: Python ----------
# r: compas_fab>=1.0.2
"""
Connect or disconnect to ROS.

COMPAS FAB v1.0.2
"""

import Grasshopper
from compas_ghpython import create_id
from scriptcontext import sticky as st

from compas_fab.backends import RosClient


class ROSConnect(Grasshopper.Kernel.GH_ScriptInstance):
    def RunScript(self, ip: str, port: int, connect: bool):
        ros_client = None

        ip = ip or "127.0.0.1"
        port = port or 9090

        key = create_id(ghenv.Component, "ros_client")  # noqa: F821

        if ros_client:
            st[key].close()
        if connect:
            st[key] = RosClient(ip, port)
            st[key].run(5)

        ros_client = st.get(key, None)
        is_connected = ros_client.is_connected if ros_client else False
        return (ros_client, is_connected)
# ---------- end compas_fab_ros_connect ----------
compas_fab_ros_robot = COMPASFABROSRobot(ros_client=compas_fab_ros_connect.ros_client, load=Button())  # -> robot; inputs load: Boolean
#   port ros_client: The ROS client.
#   port load: If True, loads the robot from ROS. Defaults to False.
# ---------- compas_fab_ros_robot: Python ----------
# r: compas_fab>=1.0.2
"""
Load robot directly from ROS.

COMPAS FAB v1.0.2
"""

import Grasshopper
from compas_ghpython import create_id
from scriptcontext import sticky as st

from compas.scene import SceneObject


class ROSRobot(Grasshopper.Kernel.GH_ScriptInstance):
    def RunScript(self, ros_client, load: bool):
        key = create_id(ghenv.Component, "robot")  # noqa: F821

        if ros_client and ros_client.is_connected and load:
            # Load URDF from ROS
            st[key] = ros_client.load_robot(load_geometry=True, precision=12)
            st[key].scene_object = SceneObject(item=st[key].model)

        robot = st.get(key, None)

        if robot:  # client sometimes need to be restarted, without needing to reload geometry
            robot.client = ros_client
        return robot
# ---------- end compas_fab_ros_robot ----------
panel_4 = Panel(compas_fab_ros_connect.is_connected)
panel_5 = Panel(compas_fab_ros_robot)

# ----
# Change TCP place as per measurement on the Robot!
cluster_11 = Cluster(pln=py3_11.frames, num=30)
# * If Fail to Generate Robot Path, Evaluate again
cluster_12 = Cluster(pln=py3_12.frames, num=30)
# *Change End Effector & Different Length of stick
# type Mesh
mesh_2 = Mesh(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)
plane = Plane(Plane(origin=(0.00175, 0.00129, 0.1532), x=(0.7071067812, 0.7071067812, 0), y=(-0.7071067812, 0.7071067812, 0)))
compas_fab_attached_tool = COMPASFABAttachedTool(robot=compas_fab_ros_robot, visual_mesh=mesh_2, collision_mesh=mesh_2, tcf_plane=plane)  # -> robot; inputs visual_mesh: Mesh, collision_mesh: Mesh
#   port visual_mesh: A visual mesh for the tool.
#   port collision_mesh: A collision mesh for the tool.
#   port tcf_plane: The frame of the tool in tool0 frame.
#   port group: The planning group to which the tool should be attached.
#   port connected_to: The link to which the tool should be connected to.
# ---------- compas_fab_attached_tool: Python ----------
# r: compas_fab>=1.0.2
"""
Attach a tool to the robot.

COMPAS FAB v1.0.2
"""

import Grasshopper
import Rhino
from compas.geometry import Frame
from compas_rhino.conversions import mesh_to_compas
from compas_rhino.conversions import plane_to_compas_frame

from compas_fab.robots import Tool


class AttachToolComponent(Grasshopper.Kernel.GH_ScriptInstance):
    def RunScript(self,
            robot,
            visual_mesh: Rhino.Geometry.Mesh,
            collision_mesh: Rhino.Geometry.Mesh,
            tcf_plane,
            group,
            connected_to):
        if robot and robot.client and robot.client.is_connected and visual_mesh:
            if not collision_mesh:
                collision_mesh = visual_mesh

            c_visual_mesh = mesh_to_compas(visual_mesh)
            c_collision_mesh = mesh_to_compas(collision_mesh)

            if not tcf_plane:
                frame = Frame.worldXY()
            else:
                frame = plane_to_compas_frame(tcf_plane)
            tool = Tool(c_visual_mesh, frame, c_collision_mesh, connected_to=connected_to)

            robot.attach_tool(tool, group)

        return robot
# ---------- end compas_fab_attached_tool ----------
compas_fab_planning_scene = COMPASFABPlanningScene(robot=compas_fab_ros_robot)  # -> scene
#   port scene: A planning scene.
# ---------- compas_fab_planning_scene: Python ----------
# r: compas_fab>=1.0.2
"""
Create a planning scene.

COMPAS FAB v1.0.2
"""

import Grasshopper
from compas_ghpython import create_id
from scriptcontext import sticky as st

from compas_fab.robots import PlanningScene


class PlanningSceneComponent(Grasshopper.Kernel.GH_ScriptInstance):
    def RunScript(self, robot):
        key = create_id(ghenv.Component, "planning_scene")  # noqa: F821
        if robot:
            st[key] = PlanningScene(robot)
        return st.get(key, None)
# ---------- end compas_fab_planning_scene ----------
# *Existing sticks, which have been placed in space
# type mesh
button_4 = Button()
mesh_3 = Mesh(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)
index = ControlKnob(Decimals=0, Limit=False, Maximum=10, Minimum=0, Range=100, Value=0)
python_3_script = Python3Script(
    scene=compas_fab_planning_scene,
    robot=compas_fab_attached_tool,
    load=Button(),
    compute=Button(),
    index=index,
    env=mesh_3,
    reset=button_4)  # -> out, all_sticks, sticks, results, results_list, pick_traj, place_traj, exit_traj, joined_trajectory; inputs index: Int32, env: Mesh
# ---------- python_3_script: Python ----------
from compas.datastructures import Assembly, Mesh
from compas.geometry import Frame, Point, Translation, Transformation
from compas_fab.backends import RosClient
from compas_fab.robots import Tool, PlanningScene, CollisionMesh
import os, sys
import math

import traceback

import compas
from compas.data import json_load
from compas_robots import Configuration

compas.PRECISION = "12f"

# Constants
APPROACH_DISTANCE = 0.015  # Meters
group = None
start_configuration = None

# Specify the path to the assembly file and the path to the output file
path = ghenv.Component.OnPingDocument().FilePath
parentdir = os.path.dirname(path)
dire = os.path.join(parentdir, "scripts")
sys.path.append(dire)

json_path = os.path.join(parentdir, "data", "stick_assembly.json")
write_path = os.path.join(parentdir, "data", "stick_assembly_with_trajectories.json")

# Import helpers
from compas_rhino import unload_modules
unload_modules("helpers")


from compas_rhino.conversions import mesh_to_compas
from helpers import scale_and_move_to_point, generate_default_tolerances, calculate_pick_trajectory, calculate_place_trajectories
from scriptcontext import sticky

if "last_status" not in sticky or sticky["last_status"] is None:
    sticky["last_status"] = "Idle"

if "geometry" not in sticky or sticky["geometry"] is None:
    pass

SAFE_CONFIG = Configuration.from_revolute_values([math.radians(68.80), 
                                        math.radians(-70.55), 
                                        math.radians(-116.42), 
                                        math.radians(-83.80), 
                                        math.radians(98.73), 
                                        math.radians(56.93)])

if 'load' in globals() and load:
    scene.reset()
    tcm = CollisionMesh(mesh_to_compas(env), id = "table")
    scene.add_collision_mesh(tcm)
    assembly = json_load(json_path)
    scaled_assembly = scale_and_move_to_point(assembly, Point(-0.500, -0.210, 0.010))
    sticky["assembly"] = scaled_assembly
    sticky["last_status"] = "Assembly loaded"
else:
    assembly = sticky.get("assembly", [])
    if assembly:
        part = assembly.find_by_key(index)
        all_sticks = [p.attributes.get("shape", None) for p in assembly.parts()]
        sticky["geometry"] = part.attributes.get("shape", None)



if 'compute' in globals() and compute and 'index' in globals():
    results = sticky.get("results", {})
    try:
        part = assembly.find_by_key(index)
        safe_frame = part.attributes.get("safe_frame", None)
        place_frame = part.frame
        

        tolerances = generate_default_tolerances(robot.get_configurable_joints(robot.main_group_name))

        # Set pick frame
        pick_frame = Frame([0.5,0.5,0.1], [0,1,0], [1,0,0])

        pick_traj, pick_config, approach_config = calculate_pick_trajectory(pick_frame, robot, start_config = SAFE_CONFIG)

        # Calculate place trajectories (safe, place, return)
        place_results = None

        place_results, exit_trajectory = calculate_place_trajectories(
            robot,
            current_config = SAFE_CONFIG,
            placement_frame = place_frame,
            group=robot.main_group_name
        )

        results[str(index)] = {
            "pick_frame": pick_frame,
            "frame": place_frame,
            "pick_trajectory": pick_traj,
            "approach_config": pick_config,
            "place_trajectory": place_results,
            "exit_trajectory": exit_trajectory
        }
        sticky["results"] = results
        print(f"Computed trajectory for frame {index}")

        cm = CollisionMesh(Mesh.from_shape(part.attributes["shape"]), id = "part%d" % index)
        scene.append_collision_mesh(cm)
        sticky["last_status"] = f"Computed: {index}"

    except Exception as e:
        print("Failed for frame {}: {}".format(index, e))
        print(traceback.format_exc())
        sticky["last_status"] = "Error: {}".format(str(e))

results = sticky.get("results", None)
results_list = [results]
if results is not None and str(index) in results.keys():
    sticky["last_status"] = f"{index:.0f} is computed"
    pick_traj = results[str(index)]["pick_trajectory"]
    place_traj = results[str(index)]["place_trajectory"]
    exit_traj = results[str(index)]["exit_trajectory"]
    joined_trajectory = pick_traj.copy()
    joined_trajectory.points.extend(place_traj.points)
    joined_trajectory.points.extend(exit_traj.points)


assembly = sticky.get("assembly", None)


ghenv.Component.Message = sticky["last_status"][:35]
print(sticky["last_status"])
sticks = sticky.get("geometry", None)

if reset:
    sticky["assembly"] = None
    sticky["geometry"] = None
    sticky["results"] = {}
# ---------- end python_3_script ----------
compas_draw = COMPASDraw(cg=python_3_script.all_sticks)  # -> rg; same code as draw
compas_draw_2 = COMPASDraw(cg=python_3_script.sticks)  # -> rg; same code as draw
panel_6 = Panel(python_3_script.out)
compas_fab_trajectory_visualize = COMPASFABTrajectoryVisualize(robot=compas_fab_attached_tool, trajectory=python_3_script.joined_trajectory)  # -> start_configuration, configurations, fraction, time, planes, P, V, A; inputs group: String
#   port group: The planning group for which this trajectory was planned.
#   port trajectory: The calculated trajectory.
#   port start_configuration: The start configuration of the trajectory.
#   port configurations: The full configurations along the trajectory.
#   port fraction: Indicates the fraction of requested trajectory that was calculated, e.g. 1 means the full trajectory was found.
#   port time: The time which is needed to execute that trajectory at full speed.
#   port planes: The planes of the robot's end-effector.
#   port P: The positions along the trajectory
#   port V: The velocities along the trajectory
#   port A: The accelerations along the trajectory
# ---------- compas_fab_trajectory_visualize: Python ----------
# r: compas_fab>=1.0.2
"""
Visualizes a trajectory.

COMPAS FAB v1.0.2
"""

import Grasshopper
from compas_ghpython.drawing import draw_frame
from compas_ghpython.sets import list_to_ghtree


class TrajectoryVisualize(Grasshopper.Kernel.GH_ScriptInstance):
    def RunScript(self, robot, group: str, trajectory):
        start_configuration = None
        configurations = []
        fraction = 0.0
        time = 0.0

        planes = []
        positions = []
        velocities = []
        accelerations = []

        if robot and trajectory:
            group = group or robot.main_group_name

            for c in trajectory.points:
                configurations.append(
                    robot.merge_group_with_full_configuration(c, trajectory.start_configuration, group)
                )
                frame = robot.forward_kinematics(c, group, options=dict(solver="model"))
                planes.append(draw_frame(frame))
                positions.append(c.positions)
                velocities.append(c.velocities)
                accelerations.append(c.accelerations)

            start_configuration = trajectory.start_configuration
            fraction = trajectory.fraction
            time = trajectory.time_from_start

        P = list_to_ghtree(list(zip(*positions)))
        V = list_to_ghtree(list(zip(*velocities)))
        A = list_to_ghtree(list(zip(*accelerations)))

        # return outputs if you have them; here I try it for you:
        return (start_configuration, configurations, fraction, time, planes, P, V, A)
# ---------- end compas_fab_trajectory_visualize ----------
panel_7 = Panel(compas_fab_trajectory_visualize.V)
cull_i_2 = CullIndex(List=compas_fab_trajectory_visualize.planes, Indices=-1, Wrap=True)
pline = PolyLine(Vertices=cull_i_2, Closed=False)
lng = ListLength(List=compas_fab_trajectory_visualize.configurations)  # -> expr("x-1", Length)
cluster_13 = Cluster(pln=compas_fab_trajectory_visualize.planes, num=Slider(0.03, range=0..0.1))
panel_8 = Panel(lng)
min = Minimum(A=lng, B=Slider(0, range=0..100))
list_item = ListItem(List=compas_fab_trajectory_visualize.configurations, Index=min, Wrap=True)
compas_fab_robot_visualize = COMPASFABRobotVisualize(robot=compas_fab_attached_tool, configuration=list_item, show_visual=Toggle(False), show_collision=Toggle(True))  # -> visual, collision, collision_meshes, attached_meshes, frames, base_frame, ee_frame; inputs group: String, show_visual: Boolean, show_collision: Boolean, show_frames: Boolean, show_base_frame: Boolean, show_end_effector_frame: Boolean, show_cm: Boolean, show_acm: Boolean
#   port group: The planning group used for end-effector and base visualization.
#   port configuration: The robot's full configuration.
#   port show_visual: Whether or not to show the robot's visual meshes.
#   port show_collision: Whether or not to show the robot's collision meshes.
#   port show_frames: Whether or not to show the robot's joint frames.
#   port show_base_frame: Whether or not to show the robot's base frame.
#   port show_end_effector_frame: Whether or not to show the robot's end-effector frame.
#   port show_cm: Whether or not to show the collision meshes (if any).
#   port show_acm: Whether or not to show the attached collision meshes (if any).
#   port visual: Rhino meshes of the robot's visual geometry (if any).
#   port collision: Rhino meshes of the robot's collision geometry (if any).
#   port collision_meshes: Rhino meshes of the scene's collision meshes (if any).
#   port attached_meshes: Rhino meshes of the scene's attached collision meshes (if any).
#   port frames: The robot's joint frames as Rhino planes (if any).
#   port base_frame: The robot's base frame as a Rhino plane (if any).
#   port ee_frame: The robot's end-effector frame as a Rhino plane (if any).
# ---------- compas_fab_robot_visualize: Python ----------
# r: compas_fab>=1.0.2
"""
Visualizes the robot.

COMPAS FAB v1.0.2
"""

import time

import Grasshopper
from compas_ghpython import create_id
from compas_rhino.conversions import frame_to_rhino_plane
from scriptcontext import sticky as st

from compas.geometry import Frame
from compas.geometry import Transformation
from compas.scene import SceneObject
from compas_fab.backends import BackendFeatureNotSupportedError
from compas_fab.robots import PlanningScene


class RobotVisualize(Grasshopper.Kernel.GH_ScriptInstance):
    def RunScript(self,
            robot,
            group: str,
            configuration,
            show_visual: bool,
            show_collision: bool,
            show_frames: bool,
            show_base_frame: bool,
            show_end_effector_frame: bool,
            show_cm: bool,
            show_acm: bool):
        visual = None
        collision = None
        collision_meshes = None
        attached_meshes = None
        frames = None
        base_frame = None
        ee_frame = None

        if robot:
            show_visual = True if show_visual is None else show_visual
            show_cm = True if show_cm is None else show_cm
            show_acm = True if show_acm is None else show_acm
            configuration = configuration or robot.zero_configuration()

            robot.update(configuration, visual=show_visual, collision=show_collision)
            compas_frames = robot.transformed_frames(configuration, group)

            if show_visual:
                visual = robot.scene_object.draw_visual()

            if show_collision:
                collision = robot.scene_object.draw_collision()

            if show_base_frame:
                base_compas_frame = compas_frames[0]
                base_frame = frame_to_rhino_plane(base_compas_frame)

            if show_end_effector_frame:
                options = dict(solver="model")
                if robot.attached_tool:
                    options["link"] = robot.attached_tool.connected_to

                ee_compas_frame = robot.forward_kinematics(configuration, group, options=options)
                ee_frame = frame_to_rhino_plane(ee_compas_frame)

            if show_frames:
                frames = []
                for compas_frame in compas_frames[1:]:
                    frame = frame_to_rhino_plane(compas_frame)
                    frames.append(frame)

            cached_scene_key = create_id(ghenv.Component, "cached_scene")  # noqa: F821

            if show_cm or show_acm:
                cached_scene = st.get(cached_scene_key)
                if not cached_scene:
                    cached_scene = {"time": 0}

                # expire cache if the component has not been executed in the last 2 seconds
                # this allows to slide through a list of configurations
                # without triggering refreshes of the scene in the middle of it
                if time.time() - cached_scene["time"] > 2:
                    update_scene = True
                else:
                    update_scene = False

                if update_scene:
                    scene = PlanningScene(robot)
                    try:
                        scene = robot.client.get_planning_scene()
                    except BackendFeatureNotSupportedError:
                        print(
                            "The selected backend does not support collision meshes. If you need collision mesh support, use a different backend."
                        )
                        scene = None
                        show_cm = False
                        show_acm = False

                if update_scene and show_cm:
                    collision_meshes = []

                    for co in scene.world.collision_objects:
                        header = co.header
                        frame_id = header.frame_id
                        cms = co.to_collision_meshes()

                        for cm in cms:
                            if cm.frame != Frame.worldXY():
                                t = Transformation.from_frame(cm.frame)
                                mesh = cm.mesh.transformed(t)
                            else:
                                mesh = cm.mesh

                            collision_meshes.extend(SceneObject(item=mesh).draw())

                        cached_scene["cm"] = collision_meshes

                collision_meshes = cached_scene.get("cm", [])

                if update_scene and show_acm:
                    attached_meshes = []

                    for aco in scene.robot_state.attached_collision_objects:
                        for acm in aco.to_attached_collision_meshes():
                            frame_id = aco.object["header"]["frame_id"]
                            frame = robot.forward_kinematics(configuration, options=dict(link=frame_id))
                            t = Transformation.from_frame(frame)

                            # Local CM frame
                            if acm.collision_mesh.frame and acm.collision_mesh.frame != Frame.worldXY():
                                t = t * Transformation.from_frame(acm.collision_mesh.frame)

                            mesh = acm.collision_mesh.mesh.transformed(t)

                            attached_meshes.extend(SceneObject(item=mesh).draw())

                    cached_scene["acm"] = attached_meshes

                attached_meshes = cached_scene.get("acm", [])

                cached_scene["time"] = time.time()
                st[cached_scene_key] = cached_scene

        return (
            visual,
            collision,
            collision_meshes,
            attached_meshes,
            frames,
            base_frame,
            ee_frame,
        )
# ---------- end compas_fab_robot_visualize ----------
python_3_script_2 = Python3Script(index=index, tcp=plane, results=python_3_script.results_list)  # -> out, script; inputs index: Int32, tcp: Plane, results: list
# ---------- python_3_script_2: Python ----------
from imp import reload
import sys
import os

# get current file path
path = ghenv.Component.OnPingDocument().FilePath
parentdir = os.path.dirname(path)
dire = os.path.join(parentdir, 'scripts')

sys.path.append(dire)

import simple_ur_script as ur
reload(ur)

import utils
reload(utils)

import simple_comm as com
reload(com)

import compas.geometry as cg
import math as m

from compas_rhino.conversions import plane_to_compas_frame

# ---------- GLOBALS ----------
IO_OPEN = 0     # open gripper
IO_CLOSE = 4    # close gripper
# -----------------------------


# ============================================================
# Trajectory → URScript
# ============================================================

def send_joint_trajectory(script, trajectory):
    """Append URScript moveJ motions for all trajectory points."""
    for point in trajectory.points[:-1]:
        q = point.positions
        script += ur.move_j(list(q), accel=0.25, vel=0.5, radius = 0.05)
    return script


def send_cartesian_frame(script, frame, speed=0.05):
    """Append URScript moveL to a Cartesian Frame."""
    frm = frame.copy()
    script += ur.move_l(frm, accel=0.1, vel=speed)
    return script


# ============================================================
# PICKUP
# ============================================================

def pickup_stick(script, pick_traj, pick_fr):
    """
    1. Follow approach & pick trajectory
    2. Move to pick frame
    3. Close gripper
    """
    script = send_joint_trajectory(script, pick_traj)
    script = send_cartesian_frame(script, pick_fr, speed=0.05)
    script += ur.set_digital_out(IO_CLOSE, True)  # close
    script += ur.sleep(0.5)
    script += ur.textmsg("picked")
    return script


# ============================================================
# PLACE
# ============================================================

def place_stick(script, place_traj, place_fr):
    """
    1. Follow place trajectory
    2. Move to place frame
    3. Open gripper
    """
    place = place_fr.copy()
    place.point.x = -place_fr.point.x
    place.point.y = -place_fr.point.y
    script = send_joint_trajectory(script, place_traj)
    script = send_cartesian_frame(script, place, speed=0.05)
    # Popup to check if glue is set
    script += ur.popup("is it done yet?", "hello")
    script += ur.set_digital_out(IO_CLOSE, False)  # open
    script += ur.sleep(0.5)
    script += ur.textmsg("placed")
    return script


# ============================================================
# MAIN PIPELINE
# ============================================================

results = results[0]

pick_frame = results[str(index)]["pick_frame"]
place_frame = results[str(index)]["frame"]
pick_trajectory = results[str(index)]["pick_trajectory"]
place_trajectory = results[str(index)]["place_trajectory"]
exit_trajectory = results[str(index)]["exit_trajectory"]

script = ""

# Set TCP
script = ur.set_tcp_by_frame(plane_to_compas_frame(tcp))
# Pickup
script = pickup_stick(script, pick_trajectory, pick_frame)
# Place
script = place_stick(script, place_trajectory, place_frame)

# Exit
script = send_joint_trajectory(script, exit_trajectory)


# finalize
script = com.concatenate_script(script)
# ---------- end python_3_script_2 ----------

python_3_script_3 = Python3Script(index=index, tcp=plane, results=python_3_script.results_list)  # -> out, script; inputs index: Int32, tcp: Plane, results: list; same code as python_3_script_2
panel_9 = Panel(python_3_script_3.script)
py3_13 = Python3Script(script=python_3_script_3.script, ip_address="192.168.10.10", send=Button())  # -> out, a; inputs script: String, ip_address: String, send: Boolean
# ---------- py3_13: Python ----------
import simple_comm as com

if send:
    com.send_script(script,ip_address)
# ---------- end py3_13 ----------

panel_10 = Panel(python_3_script_3.out)

# ==== cluster Cluster
pln = ClusterInput()
num = ClusterInput()
pln_2 = Plane(graft(pln))
num_2 = Number(num)
deplane = DeconstructPlane(Plane=pln_2)  # -> flatten(Origin), XAxis, YAxis, ZAxis
entwine = Entwine(Branch00=deplane.XAxis, Branch01=deplane.YAxis, Branch02=deplane.ZAxis, FlattenInputs=True)
merge = Merge(
    Data1=ColourSwatch(SwatchColor=RGB(255, 0, 0)),
    Data2=ColourSwatch(SwatchColor=RGB(0, 255, 0)),
    Data3=ColourSwatch(SwatchColor=RGB(0, 0, 255)))  # -> graft(Result)
multiplication = Multiplication(A=entwine, B=num_2)
vdisex = VectorDisplayEx(Point=deplane.Origin, Vector=multiplication, Colour=merge, Width=2)
