# Grasshopper definition Dec_11_Jerry_Fabrication.gh (Grasshopper 1.0.8)
# plug-ins: Weaverbird

# ----
# Multiple Aggregations and Branches:
# Week 3 Prototype (Fixed Params)
number_slider = Slider(1300, range=0..10000)
neg = Negative(Value=Slider(600, range=0..1000))
neg_2 = Negative(Value=Slider(600, range=0..1000))
pt = ConstructPoint(XCoordinate=number_slider, YCoordinate=neg, ZCoordinate=neg_2)
pt_2 = Point(pt)
Z = UnitZ(Factor="-10")
number_slider_2 = Slider(150, range=0..1000)
move = Move(Geometry=pt_2, Motion=Z)  # -> Geometry, Transform
addition = Addition(A=number_slider_2, B=Slider(28, range=0..100))
py3 = Python3Script(origin=pt_2, legs=Slider(3, range=0..10), r=number_slider_2, incline=Slider(-8, range=-90..90))  # -> out, plns_out; inputs origin: Point3d, legs: Int32, r: Double, incline: Double
# ---------- py3: Python ----------
import Rhino.Geometry as rg
import math


plns = []
for i in range(legs):
    theta = 2 * math.pi * (i / legs)
    x = origin.X + r * math.cos(theta)
    y = origin.Y + r * math.sin(theta)
    pt = rg.Point3d(x, y, origin.Z)

    pln = rg.Plane(pt, rg.Vector3d.ZAxis)
    pln.Rotate(theta, rg.Vector3d.ZAxis)
    pln.Rotate(-math.pi / 2, pln.YAxis)
    pln.Rotate(math.radians(incline), pln.YAxis)
    plns.append(pln)

plns_out = plns
# ---------- end py3 ----------
polygon = Polygon(Plane=move.Geometry, Radius=addition, Segments=Slider(12, range=0..20), FilletRadius=0)  # -> Polygon, Length
offset = OffsetCurve(Curve=polygon.Polygon, Distance=Slider(262, range=0..1000), Corners=1)
Z_2 = UnitZ(Factor=Slider(1200, range=0..10000))
cluster = Cluster(pln=py3.plns_out, num=30)
disc = Discontinuity(Curve=polygon.Polygon, Level=1)  # -> Points, Parameters
move_2 = Move(Geometry=offset, Motion=Z_2)  # -> Geometry, Transform
shift = ShiftList(List=disc.Points, Shift="-1", Wrap=True)
disc_2 = Discontinuity(Curve=move_2.Geometry, Level=1)  # -> Points, Parameters
long = LongestList(ListA=shift, ListB=disc.Points, ListC=move.Geometry, PaddingMode=2)  # -> ListA, ListB, ListC
shift_2 = ShiftList(List=disc_2.Points, Shift="-1", Wrap=True)
long_2 = LongestList(ListA=shift, ListB=disc.Points, ListC=disc_2.Points, ListD=shift_2, PaddingMode=2)  # -> ListA, ListB, ListC, ListD
transform = Transform(Geometry=move.Geometry, Transform=move_2.Transform)
merge = Merge(Data1=graft(long.ListA), Data2=graft(long.ListB), Data3=graft(long.ListC))  # -> reverse(Result)
merge_2 = Merge(Data1=graft(long_2.ListA), Data2=graft(long_2.ListB), Data3=graft(long_2.ListC), Data4=graft(long_2.ListD))
long_3 = LongestList(ListA=shift_2, ListB=disc_2.Points, ListC=transform, PaddingMode=2)  # -> ListA, ListB, ListC
conmesh = ConstructMesh(Vertices=merge, Faces={A=0, B=1, C=2, D=2})
merge_3 = Merge(Data1=graft(long_3.ListA), Data2=graft(long_3.ListB), Data3=graft(long_3.ListC))
conmesh_2 = ConstructMesh(Vertices=merge_2, Faces={A=0, B=1, C=2, D=3})
conmesh_3 = ConstructMesh(Vertices=merge_3, Faces={A=0, B=1, C=2, D=2})
merge_4 = Merge(Data1=simplify(conmesh), Data2=simplify(conmesh_2), Data3=simplify(conmesh_3))  # -> flatten(Result)
mjoin = MeshJoin(Meshes=merge_4)
mesh = Mesh(mjoin)
panel = Panel("""200
400""")
list = ValueList({"Regular": 0, "Random": 1}, selected="Random")
wbedges = WeaverbirdsMeshEdges(MeshOrPolylines=mesh)
pln = Plane(py3.plns_out)
panel_2 = Panel("""20
160""")
py3_2 = Python3Script(
    first_plns=pln,
    length_pattern=panel,
    angle_pattern=panel_2,
    agg_type=list,
    seed="53",
    agg_count="3",
    agg_round="2",
    branch_count="3",
    max_attempts="10",
    boundary_mesh=mesh)  # -> out, geo_out, frame_out, pln_out, axis_out, failed_sticks, valid_sticks, collision_log, Sticks_out, agg_manager; inputs first_plns: list of Plane, length_pattern: list of Double, angle_pattern: list of Double, agg_type: Int32, seed: Int32, agg_count: Int32, agg_round: Int32, branch_count: Int32, max_attempts: Int32, boundary_mesh: Mesh
# ---------- py3_2: Python ----------
#locate stick class file in the same folder
from compas_rhino import unload_modules
import sys
import os
"""
#get current file path
path = ghenv.Component.OnPingDocument().FilePath
#get parent directory of the parent directory
parentdir = os.path.dirname(path)
#get src folder which contains classes
dire = os.path.join(parentdir,'scripts')

sys.path.append(dire)"""

path = 'D:\\ETH\\Github\\MAS-2526\\08_SpatialAssemblies\\StudentProjects\\group_two\\J3RRY_Sticks_^o^\\scripts\\Package_v2'
sys.path.append(path)

unload_modules('J3RRY_SingleStick_v1')
unload_modules('J3RRY_Aggregation_v3')
unload_modules('J3RRY_Collision_v1')

from J3RRY_SingleStick_v1 import Stick
from J3RRY_Aggregation_v3 import Aggregation, AggregationManager
from J3RRY_Collision_v1 import Collision

from compas.geometry import Line, Point, Vector
from compas.geometry import Transformation
from compas_rhino.conversions import plane_to_compas_frame, frame_to_rhino_plane
import scriptcontext as sc
import random


from Grasshopper import DataTree
from Grasshopper.Kernel.Data import GH_Path

"""Main Code"""
# Convert rhino plane to compas frame
first_frames = [plane_to_compas_frame(p) for p in first_plns]
# Create aggregation manager
agg_manager = AggregationManager()
# Run aggregations
all_rounds = agg_manager.run_multiround_aggregation(
    first_frames,
    length_pattern,
    angle_pattern,
    agg_type,
    seed,
    agg_count,
    agg_round,
    branch_count,
    boundary_mesh,
    max_attempts)
# Get graph
graph = agg_manager.graph
print (graph)


# Visualization
geo_tree = DataTree[object]()
axis_tree = DataTree[object]()
frame_tree = DataTree[object]()
pln_tree = DataTree[object]()
Sticks_tree = DataTree[object]()

for i, agg in enumerate(agg_manager.aggs):
    path = GH_Path(graph[i])
    print (path)
    for s in agg.sticks:
        geo_tree.Add(s.geometry, path)
        axis_tree.Add(s.axis, path)
        frame_tree.Add(s.frame, path)
        pln_tree.Add(frame_to_rhino_plane(s.frame), path)
        Sticks_tree.Add(s, path)

geo_out = geo_tree
axis_out = axis_tree
frame_out = frame_tree
pln_out = pln_tree
Sticks_out = Sticks_tree



# Log
failed_sticks = DataTree[object]()
valid_sticks = DataTree[object]()
for i, agg in enumerate(agg_manager.aggs):
    for j, branch in enumerate(agg.failed_sticks):
        path = GH_Path(*graph[i] + [j + 1])
        for s in branch:
            failed_sticks.Add(s.geometry, path)

    for j, branch in enumerate(agg.valid_sticks):
        path = GH_Path(*graph[i] + [j + 1])
        for s in branch:
            valid_sticks.Add(s.geometry, path)



collision_log = DataTree[object]()
for i, agg in enumerate(agg_manager.aggs):
    for j, log in enumerate(agg.collision_log):
        path = GH_Path(graph[i] + [j + 1])
        collision_log.Add(f"attempts = {log['attempts']}", path)
        collision_log.Add(f"fail_count = {log['fail_count']}", path)
        collision_log.Add(f"success = {log['success']}", path)
        collision_log.Add(f"reason = {log['reason']}", path)
        collision_log.Add(f"length = {log['params']['length']}", path)    
        collision_log.Add(f"angle = {log['params']['angle']}", path)
        collision_log.Add(f"from_index = {log['params']['from_index']}", path)
        collision_log.Add(f"to_index = {log['params']['to_index']}", path)
        collision_log.Add(f"from_t = {log['params']['from_t']}", path)
        collision_log.Add(f"to_t = {log['params']['to_t']}", path)
# ---------- end py3_2 ----------
panel_3 = Panel(py3_2.collision_log)

# ----
# Fabrication
data = Data(py3_2.agg_manager)
pt_3 = Point(Point(1691.100249, -919.8009515, 0))  # disabled
py3_3 = Python3Script(agg_manager=data, robot_position=pt_3)  # -> out, joint_plns, fab_sticks, pick_plns, pick_frames_out, fab; inputs robot_position: Point3d
# ---------- py3_3: Python ----------
#locate stick class file in the same folder
from compas_rhino import unload_modules
import sys
import os
"""
#get current file path
path = ghenv.Component.OnPingDocument().FilePath
#get parent directory of the parent directory
parentdir = os.path.dirname(path)
#get src folder which contains classes
dire = os.path.join(parentdir,'scripts')

sys.path.append(dire)"""

path = 'D:\\ETH\\Github\\MAS-2526\\08_SpatialAssemblies\\StudentProjects\\group_two\\J3RRY_Sticks_^o^\\scripts\\Package_v2'
sys.path.append(path)

unload_modules('J3RRY_SingleStick_v1')
unload_modules('J3RRY_Aggregation_v3')
unload_modules('J3RRY_Collision_v1')
unload_modules('J3RRY_Fabrication_v1')

from J3RRY_SingleStick_v1 import Stick
from J3RRY_Aggregation_v3 import Aggregation, AggregationManager
from J3RRY_Collision_v1 import Collision
from J3RRY_Fabrication_v1 import Fabrication

from compas.geometry import Line, Point, Vector, Frame
from compas.geometry import Transformation
from compas_rhino.conversions import plane_to_compas_frame, frame_to_rhino_plane
from compas_rhino.conversions import point_to_compas
import scriptcontext as sc
import random


from Grasshopper import DataTree
from Grasshopper.Kernel.Data import GH_Path

"""Main Code"""
graph = agg_manager.graph
print (graph)
# Construct Fab
fab = Fabrication(agg_manager)


# Add adjacent sticks FIRST
sticks_with_adjacent, agg_indices, stick_indices = fab.add_adjacent_sticks(False)

# Erect modules with adjacent sticks
erected_modules = fab.erect_modules(sticks_with_adjacent)

# Get joint plns
joint_frames = fab.get_joint_frames(erected_modules)
# Erect joint_frames

# Evaluate pick up frames
if robot_position:
    robot_position = point_to_compas(robot_position)
else:
    robot_position = Point(0,0,0)
pick_frames = fab.eval_pick_frames(erected_modules, robot_position)

#Output
fab_sticks = DataTree[object]()
for i, branch in enumerate(erected_modules):
    path = GH_Path(*graph[i])
    for stick in branch:
        fab_sticks.Add(stick.geometry, path)

print (agg_indices)
print (stick_indices)

joint_plns = DataTree[object]()
for i, branch in enumerate(joint_frames):
    path = GH_Path(*graph[i])
    for frame in branch:
        pln = frame_to_rhino_plane(frame)
        joint_plns.Add(pln, path)

pick_plns = DataTree[object]()
pick_frames_out = DataTree[object]()

for i, branch in enumerate(pick_frames):
    path = GH_Path(*graph[i])
    for frame in branch:
        pln = frame_to_rhino_plane(frame)
        pick_plns.Add(pln, path)
        pick_frames_out.Add(frame, path)
# ---------- end py3_3 ----------
draw = COMPASDraw(cg=py3_3.fab_sticks)  # -> rg
#   port cg: The COMPAS geometry or datastructure to be drawn.
#   port rg: The Rhino geometry object.
# ---------- draw: Python ----------
# r: compas>=2.14.1
"""
Draws COMPAS geometry in Grasshopper.
"""

from typing import Any

import Grasshopper

from compas.scene import SceneObject


class CompasToRhinoGeometry(Grasshopper.Kernel.GH_ScriptInstance):
    def RunScript(self, cg):
        if not cg:
            return None

        return SceneObject(item=cg).draw()
# ---------- end draw ----------
data_2 = Data(py3_3.joint_plns)
number_slider_3 = Slider(0, range=0..10)
data_3 = Data(py3_3.pick_plns)
data_4 = Data(py3_3.pick_frames_out)
tstat = TreeStatistics(Tree=data_2)  # -> Paths, Length, Count
tstat_2 = TreeStatistics(Tree=data_3)  # -> Paths, Length, Count
tstat_3 = TreeStatistics(Tree=data_4)  # -> Paths, Length, Count
data_5 = Data(draw)
item = ListItem(List=tstat.Paths, Index=number_slider_3, Wrap=True)
item_2 = ListItem(List=tstat_2.Paths, Index=number_slider_3, Wrap=True)
tstat_4 = TreeStatistics(Tree=data_5)  # -> Paths, Length, Count
item_3 = ListItem(List=tstat_3.Paths, Index=number_slider_3, Wrap=True)
branch = TreeBranch(Tree=data_2, Path=item, MaintainPaths=True)
item_4 = ListItem(List=tstat_4.Paths, Index=number_slider_3, Wrap=True)
branch_2 = TreeBranch(Tree=data_3, Path=item_2, MaintainPaths=True)
branch_3 = TreeBranch(Tree=data_4, Path=item_3, MaintainPaths=True)
cluster_2 = Cluster(pln=branch_2, num=30)
branch_4 = TreeBranch(Tree=data_5, Path=item_4, MaintainPaths=True)
lng = ListLength(List=branch_4)
min = Minimum(A=lng, B=Slider(4, range=0..10))
ins = InsertItems(List=branch, Indices="0", Wrap=invert(True))
ins_2 = InsertItems(List=branch_2, Indices="0", Wrap=invert(True))
series = Series(Start=0, Step=1, Count=min)
item_5 = ListItem(List=ins, Index=series, Wrap=True)
item_6 = ListItem(List=ins_2, Index=series, Wrap=True)
item_7 = ListItem(List=branch_4, Index=series, Wrap=True)
cluster_3 = Cluster(pln=item_5, num=30)
cluster_4 = Cluster(pln=item_6, num=30)

# ----
# Labelling
draw_2 = COMPASDraw(cg=py3_2.axis_out)  # -> rg; same code as draw
midpt = CurveMiddle(Curve=draw_2)
tstat_5 = TreeStatistics(Tree=midpt)  # -> graft(Paths), Length, Count
chars = Characters(Text=tstat_5.Paths)  # -> Result, Unicode
cull_i = CullIndex(List=chars.Result, Indices="-1", Wrap=True)
series_2 = Series(Start=0, Step=1, Count=tstat_5.Length)
join = TextJoin(Text=cull_i)
concat = Concatenate(FragmentA=join, FragmentC="_", FragmentB=series_2, FragmentD="}")
tag = TextTag(Location=midpt, Text=concat)

# ----
# Visualization
draw_3 = COMPASDraw(cg=py3_2.geo_out)  # -> rg; same code as draw
draw_4 = COMPASDraw(cg=py3_2.failed_sticks)  # -> rg; same code as draw
draw_5 = COMPASDraw(cg=py3_2.valid_sticks)  # -> rg; same code as draw
pln_2 = Plane(py3_2.pln_out)
geo = Geometry(draw_3)
geo_2 = Geometry(draw_4)
geo_3 = Geometry(draw_5)
py3_4 = Python3Script(geos=geo)  # -> out, groups; inputs geos: tree of GeometryBase
# ---------- py3_4: Python ----------
from Grasshopper import DataTree
from Grasshopper.Kernel.Data import GH_Path

path_length = [path.Length for path in geos.Paths]
print (path_length)
cset = sorted(set(path_length))
print (cset)

geo_tree = DataTree[object]()

for i, L in enumerate(cset):
    path = GH_Path(i)
    for p in geos.Paths:
        if p.Length == L:
            for item in geos.Branch(p):
                geo_tree.Add(item, path)

groups = geo_tree
# ---------- end py3_4 ----------
tstat_6 = TreeStatistics(Tree=geo_2)  # -> Paths, Length, Count
merge_5 = Merge(
    Data1=ColourSwatch(SwatchColor=RGBA(255, 255, 255, 150)),
    Data2=ColourSwatch(SwatchColor=RGBA(255, 247, 0, 150)),
    Data3=ColourSwatch(SwatchColor=RGBA(0, 255, 153, 150)))
item_8 = ListItem(List=tstat_6.Paths, Index=Slider(1, range=0..29), Wrap=True)
tstat_7 = TreeStatistics(Tree=py3_4.groups)  # -> Paths, Length, Count
series_3 = Series(Start=0, Step=1, Count=tstat_7.Count)
item_9 = ListItem(List=merge_5, Index=series_3, Wrap=True)  # -> graft(Item)
branch_5 = TreeBranch(Tree=geo_2, Path=item_8, MaintainPaths=True)
branch_6 = TreeBranch(Tree=geo_3, Path=item_8, MaintainPaths=True)
cluster_5 = Cluster(pln=pln_2, num=30)
preview = CustomPreview(Geometry=py3_4.groups, Material=item_9)

# ----
# Plotting
number_slider_4 = Slider(400, range=0..1000)
pt_4 = Point(Point(229.1741497, -1741.692546, 0))
py3_5 = Python3Script(fab=py3_3.fab, origin=pt_4, x_size=number_slider_4, y_size=Slider(240, range=0..1000))  # -> out, borders, plotted_sticks; inputs origin: Point3d, x_size: Double, y_size: Double
# ---------- py3_5: Python ----------
#locate stick class file in the same folder
from compas_rhino import unload_modules
import sys
import os
"""
#get current file path
path = ghenv.Component.OnPingDocument().FilePath
#get parent directory of the parent directory
parentdir = os.path.dirname(path)
#get src folder which contains classes
dire = os.path.join(parentdir,'scripts')

sys.path.append(dire)"""

path = 'D:\\ETH\\Github\\MAS-2526\\08_SpatialAssemblies\\StudentProjects\\group_two\\J3RRY_Sticks_^o^\\scripts\\Package_v2'
sys.path.append(path)

unload_modules('J3RRY_SingleStick_v1')
unload_modules('J3RRY_Aggregation_v3')
unload_modules('J3RRY_Collision_v1')
unload_modules('J3RRY_Fabrication_v1')

from J3RRY_SingleStick_v1 import Stick
from J3RRY_Aggregation_v3 import Aggregation, AggregationManager
from J3RRY_Collision_v1 import Collision
from J3RRY_Fabrication_v1 import Fabrication

from compas.geometry import Line, Point, Vector, Frame
from compas.geometry import Transformation
from compas_rhino.conversions import plane_to_compas_frame, frame_to_rhino_plane
from compas_rhino.conversions import point_to_compas
import scriptcontext as sc
import random


from Grasshopper import DataTree
from Grasshopper.Kernel.Data import GH_Path

"""Main Code"""

# Plotting
origin = point_to_compas(origin)
plotted_modules, recs = fab.plot_modules(
    fab.erected_modules, origin, x_size, y_size
    )

plotted_sticks = DataTree[object]()
borders = DataTree[object]()
for i, branch in enumerate(plotted_modules):
    path = GH_Path(*fab.graph[i])
    borders.Add(recs[i], path)
    for stick in branch:
        plotted_sticks.Add(stick.geometry, path)
# ---------- end py3_5 ----------
draw_6 = COMPASDraw(cg=py3_5.borders)  # -> rg; same code as draw
draw_7 = COMPASDraw(cg=py3_5.plotted_sticks)  # -> rg; same code as draw
md_slider = MDSlider(
    SliderMode=0,
    slider_value=Point(0.2851021929, 0.8721982909, 0.5),
    x_domain=Domain(0, 1),
    y_domain=Domain(0, 1),
    z_domain=Domain(0, 1))
evalsrf = EvaluateSurface(Surface=reparameterize(draw_6), Point=md_slider)  # -> Point, Normal, UDirection, VDirection, Frame
tstat_8 = TreeStatistics(Tree=draw_6)  # -> graft(Paths), Length, Count
tag_2 = TextTag3D(Location=evalsrf.Point, Text=tstat_8.Paths, Size=Slider(20, range=0..20), Justification=7)

py3_6 = Python3Script(pick_frames=branch_3, save=Button())  # -> out, plns, assembly; inputs pick_frames: list, sticks: list, save: Boolean
# ---------- py3_6: Python ----------
from compas import json_dump
import os, sys
from itertools import combinations
from compas_rhino import unload_modules
from compas.geometry import Line, Plane, Vector, Point

#get current file path
path = ghenv.Component.OnPingDocument().FilePath
#get parent directory of the parent directory
parentdir = os.path.dirname(path)
#get src folder which contains classes
dire = os.path.join(parentdir,'scripts')

sys.path.append(dire)

from stick import Stick 

from compas.datastructures import Assembly, Part

json_path = os.path.join(parentdir, 'data', 'stick_assembly.json')


sticks_data = []

###########################################################################
# Make frames point in best direction
###########################################################################
import math
import copy

from compas.geometry import dot_vectors, Rotation
from compas.geometry import centroid_points

def is_parallel(v1, v2):
    if math.isclose(dot_vectors(v1, v2), 1, abs_tol = 0.001) or math.isclose(dot_vectors(v1, v2), -1 ,abs_tol = 0.001):
        # Means it is parallel
        print("parallel")
        return True
    else:
        # Means it is not parallel
        print("not parallel")
        return False

def get_frame_closest_to_target(target_vector, stick):
    best_dot = float(-'inf')
    for i in range(4):
        angle = math.pi/2 * i
        R = Rotation.from_axis_and_angle(stick.midframe.xaxis, angle, stick.midframe.point)
        frame = stick.midframe.transformed(R)
        dot = dot_vectors(frame.zaxis, target_vector.unitized())
        if dot>best_dot:
            best_dot = dot
            best_frame = frame
            print(i)
    return best_frame

def get_center(sticks_list):
    all_points = [stick.midframe.point for stick in sticks_list]
    center = centroid_points(all_points)
    print(center)
    return center

# Copy sticks

sticks_copy = copy.deepcopy(sticks)
center_pt = get_center(sticks_copy)


for stick in sticks_copy:
    if is_parallel(stick.axis.direction.unitized(), Vector(0,0,1)):
        # Target frame is frame pointing into center of structure
        center_vector = Vector.from_start_end(stick.midframe.point, center_pt)
        best_frame = get_frame_closest_to_target(center_vector, stick=stick)
        stick.midframe = best_frame

    else:
        # Make sure z axis is pointing down
        R = Rotation.from_axis_and_angle(stick.midframe.xaxis, math.pi/2, stick.midframe.point)
        stick.midframe.transform(R)

from compas_rhino.conversions import frame_to_rhino_plane

###########################################################################
# Make frames point in best direction
###########################################################################

assembly = Assembly()
for i, s in enumerate(sticks_copy):
    part_name = "stick"+ str(i)
    part = Part(name = part_name, frame = s.midframe)
    part.key = i
    part.attributes["shape"] = s.geometry
    assembly.add_part(part)
    
name = [p.attributes["name"] for p in assembly.parts()]
print (name)
plns = [frame_to_rhino_plane(p.frame) for p in assembly.parts()]

if save:
    json_dump(assembly, fp=json_path, pretty=True)
# ---------- end py3_6 ----------
cluster_6 = Cluster(pln=py3_6.plns, num=30)

# ==== cluster Cluster
pln = ClusterInput()
num = ClusterInput()
pln_2 = Plane(graft(pln))
num_2 = Number(num)
deplane = DeconstructPlane(Plane=pln_2)  # -> flatten(Origin), XAxis, YAxis, ZAxis
entwine = Entwine(Branch00=deplane.XAxis, Branch01=deplane.YAxis, Branch02=deplane.ZAxis, FlattenInputs=True)
merge = Merge(
    Data1=ColourSwatch(SwatchColor=RGB(255, 0, 0)),
    Data2=ColourSwatch(SwatchColor=RGB(0, 255, 0)),
    Data3=ColourSwatch(SwatchColor=RGB(0, 0, 255)))  # -> graft(Result)
multiplication = Multiplication(A=entwine, B=num_2)
vdisex = VectorDisplayEx(Point=deplane.Origin, Vector=multiplication, Colour=merge, Width=2)
