# Grasshopper definition A_Root_Frames_&_Bridges.gh (Grasshopper 1.0.8)
# plug-ins: Telepathy

number_slider = Slider(200, range=0..1000)  # disabled
number_slider_2 = Slider(0, range=0..3)  # disabled
number_slider_3 = Slider(25, range=0..50)  # disabled
number_slider_4 = Slider(52, range=0..180)  # disabled

# ---- group: create_plane
number_slider_5 = Slider(0, range=0..1000)  # disabled
number_slider_6 = Slider(0, range=0..1000)  # disabled
number_slider_7 = Slider(0, range=0..1000)  # disabled
number_slider_8 = Slider(35, range=0..360)  # disabled
pt = ConstructPoint(XCoordinate=number_slider_5, YCoordinate=number_slider_7, ZCoordinate=number_slider_6)  # disabled
xy = XYPlane(Origin=pt)  # disabled
rot3d = Rotate3D(Geometry=xy, Angle=degrees(number_slider_8), Center=pt, Axis=Vector(0, 0, 1))  # -> Geometry, Transform; disabled

# ----
number_slider_9 = Slider(50, range=0..1000)  # disabled
number_slider_10 = Slider(50, range=0..1000)  # disabled
number_slider_11 = Slider(200, range=0..1000)  # disabled
py_grow = Python3Script(
    root_plane=rot3d.Geometry,
    stick_length=number_slider,
    face_index=number_slider_2,
    offset=number_slider_3,
    angle=number_slider_4)  # -> out, geometries, frames; inputs face_index: Int32, offset: Double, angle: Double; disabled
# ---------- py_grow: Python ----------
# r: compas>=2.14.1
# venv: sticks

import sys
import os
import math

#get current file path
path = ghenv.Component.OnPingDocument().FilePath
# print (path)
#get parent directory of the parent directory
parentdir = os.path.dirname(path)
# print (parentdir)
#get src folder which contains classes
dire = os.path.join(parentdir,'scripts')
print (dire)

sys.path.append(dire)

from compas_rhino import unload_modules

unload_modules("Sticks")
unload_modules("stick_module")

import Sticks
from Sticks import Stick 
from stick_module import BranchingModule
from compas.geometry import Line, Point, Vector, Frame

stick_width = 13.0
stick_depth = 13.0

from compas_rhino.conversions import plane_to_compas_frame, frame_to_rhino_plane

# Convert input to compas
root = plane_to_compas_frame(root_plane)

# Initialize tree
tree = BranchingModule(root, stick_length=stick_length, width = stick_width, depth = stick_depth)

# Grow tree
tree.grow_stick(face_index = face_index, angle = angle, offset = offset)

# Visualize
geometries = tree.visualize()
frames = [stick.frame for stick in tree.sticks]
# ---------- end py_grow ----------

# ---- group: _REF_LIBRARY
number_slider_12 = Slider(9, range=0..90)  # disabled
choose_axis = Panel("X")  # disabled
number_slider_13 = Slider(12, range=-20..600)  # disabled
number_slider_14 = Slider(10, range=0..10)  # disabled
number_slider_15 = Slider(3, range=0..10)  # disabled
number_slider_16 = Slider(1, range=0..30)  # disabled
xy_2 = XYPlane(Origin=Point(0, 0, 0))  # disabled
crv = Curve(<curve referenced from the Rhino model>)  # disabled
py3 = Python3Script(
    curve=crv,
    num_sides=number_slider_15,
    radius=number_slider_14,
    total_height=number_slider_13,
    h_subdivisions=number_slider_16)  # -> out, column_mesh, list_points, center_points, column_mesh_rhino; inputs curve: Polyline, num_sides: Int32, radius: Int32, total_height: Int32, h_subdivisions: Int32; disabled
# ---------- py3: Python ----------
import mola
from mola import module_rhino
import math
import Rhino.Geometry as rg

def points_on_crv(curve):
    list_of_points = []
    for p in curve:
        pt = rg.Point3d(p)
        list_of_points.append(pt)
    return list_of_points

def points_on_polygon(num_sides, radius):   
    list_of_points = []
    theta = (2*math.pi)/num_sides
    for i in range(num_sides):
        angle = i * theta
        x = radius * math.cos(angle)
        y = radius * math.sin(angle)
        z = 0
        pt = rg.Point3d(x,y,z)
        list_of_points.append(pt)
    return list_of_points


if curve is not None:
    list_points = points_on_crv(curve)

else:
    list_points = points_on_polygon(num_sides, radius)



column_mesh = mola.Mesh()

new_pts = []

for layer_no in range (h_subdivisions +1):
    y = total_height/h_subdivisions * layer_no + float(114.5)
    for p in list_points:
        pt = rg.Point3d(p)
        pt[1] = y
        new_pts.append (pt)
        column_mesh.add_vertex(pt[0],pt[1], pt[2])

points_per_layer = len(list_points)

for layer_no in range (h_subdivisions):
    current_layer = layer_no * points_per_layer
    next_layer = (layer_no + 1) * points_per_layer
    for i in range (points_per_layer-1):
        next_i = (i+1) % points_per_layer

        v0 = column_mesh.vertices[current_layer + i]
        v1 = column_mesh.vertices[current_layer + next_i]
        v2 = column_mesh.vertices[next_layer + next_i]
        v3 = column_mesh.vertices[next_layer + i]

        column_mesh.add_face([v0,v1,v2,v3])

center_points = []
for f in (column_mesh.faces):
    c = f.center()
    
    pts = rg.Point3d(c.x, c.y, c.z)
    center_points.append(pts)

column_mesh.update_topology()
column_mesh_rhino = module_rhino.display_mesh(column_mesh)
# ---------- end py3 ----------
geo = Geometry(py3.column_mesh_rhino)  # disabled
geo_2 = Geometry(py3.list_points)  # disabled

# ----
number_slider_17 = Slider(100, range=0..1000)  # disabled
rh_geometry = Geometry([<surface referenced from the Rhino model> x8])  # disabled

number_slider_18 = Slider(30, range=0..135)  # disabled
number_slider_19 = Slider(1, range=0..20)  # disabled
number_slider_20 = Slider(0.8, range=0..1)  # disabled

detect_collisions = BooleanToggle(True)  # disabled
debug_mode = BooleanToggle(False)  # disabled
do_bridging = BooleanToggle(True)  # disabled
lite_mode = BooleanToggle(False)  # disabled

angle_rule = ValueList({"-30", "0", "30", "60"}, selected="-30")  # disabled
face_rule = ValueList({"0", "1", "2", "3"}, selected="1")  # disabled

number_slider_21 = Slider(48, range=0..360)  # disabled

# ---- group: MAIN PROJECT
number_slider_22 = Slider(100, range=0..100)  # disabled
number_slider_23 = Slider(1, range=0..1)  # disabled
number_slider_24 = Slider(100, range=0..250)  # disabled
number_slider_25 = Slider(200, range=0..500)  # disabled
geo_3 = Geometry([<surface referenced from the Rhino model> x9])  # disabled
gen_rhplanes = Python3Script(surface=geo_3, point_density=number_slider_25, point_randomness=number_slider_23, min_stick_length=number_slider_24)  # -> out, list_pts, rootplanes; inputs surface: Surface, point_density: Int32, point_randomness: Double, min_stick_length: Int32; disabled
# ---------- gen_rhplanes: Python ----------
import Rhino.Geometry as rg
import random

# INPUTS: surface, point_density, point_randomness, min_stick_length

def get_domain_offset_surface(srf, offset_dist):
    u_domain = srf.Domain(0)
    v_domain = srf.Domain(1)

    u_len = u_domain.Length
    v_len = v_domain.Length
    max_len = max(u_len, v_len)
    buffer = offset_dist / max_len

    sample_count = 20
    trim_pts = []

    for i in range(sample_count + 1):
        for j in range(sample_count + 1):
            u = u_domain.T0 + (u_len * i / sample_count)
            v = v_domain.T0 + (v_len * j / sample_count)
            u_norm = (u - u_domain.T0) / u_len
            v_norm = (v - v_domain.T0) / v_len

            if buffer < u_norm < 1 - buffer and buffer < v_norm < 1 - buffer:
                trim_pts.append((u, v))
    return trim_pts


def generate_points(srf, uv_pts, density, randomness, min_spacing, max_spacing):
    list_pts = []
    rootplanes = []
    
    # Sort by increasing V to create a vertical gradient
    uv_pts.sort(key=lambda x: x[1])

    for uv in uv_pts:
        u, v = uv

        # Probability gradient based on V
        v_ratio = (v - srf.Domain(1).T0) / srf.Domain(1).Length
        prob = v_ratio ** 2  # Exponential increase in probability
        if random.random() > prob:
            continue
        
        pt = srf.PointAt(u, v)
        
        # Check distances to existing points
        if all(pt.DistanceTo(p) > random.uniform(min_spacing, max_spacing) for p in list_pts):
            list_pts.append(pt)
            normal = srf.NormalAt(u, v)
            plane = rg.Plane(pt, normal)
            rootplanes.append(plane)

        if len(list_pts) >= density:
            break
    return list_pts, rootplanes

# === Parameters ===
edge_offset = 0.8 * min_stick_length
min_spacing = 0.6 * min_stick_length
max_spacing = 1.2 * min_stick_length

# Step 1: Get UV coordinates in trimmed zone
uv_coords = get_domain_offset_surface(surface, edge_offset)

# Step 2: Generate spaced points with gradient
points, planes = generate_points(surface, uv_coords, point_density, point_randomness, min_spacing, max_spacing)

#geometry

list_pts= points
rootplanes = planes
# ---------- end gen_rhplanes ----------
rhplanes_to_frames = Python3Script(
    rootplanes=flatten(gen_rhplanes.rootplanes),
    stick_length=number_slider_24,
    desired_number_of_base_roots=number_slider_22)  # -> out, points_list, paired_root_frames, growth_directions, direction_lines, layered_frames; inputs rootplanes: list of Plane, stick_length: Int32, desired_number_of_base_roots: Int32; disabled
# ---------- rhplanes_to_frames: Python ----------
# --------------------------
# ✅ 1. PAIRING SCRIPT
# --------------------------

from compas.geometry import Frame, Point, Vector, Line, distance_point_point

# Parameters
stick_length = 200
layer_fraction = 0.25
max_distance = 4 * stick_length
total_height = 500
layer_height = total_height * layer_fraction

# Step 1: Convert GH planes to COMPAS Frames
root_frames = []
for i, pl in enumerate(rootplanes):
    try:
        origin = pl.Origin
        xaxis = pl.XAxis
        yaxis = pl.YAxis
        frame = Frame(
            Point(origin.X, origin.Y, origin.Z),
            Vector(xaxis.X, xaxis.Y, xaxis.Z),
            Vector(yaxis.X, yaxis.Y, yaxis.Z)
        )
        root_frames.append(frame)
    except Exception as e:
        print(f"Failed to convert plane {i}: {e}")

# Step 2: Extract points
points_list = [f.point for f in root_frames]

# Step 3: Sort and group by layers
points_sorted = sorted(points_list, key=lambda pt: pt.z)
layers = []
current_layer = []
z_min = points_sorted[0].z if points_sorted else 0

for pt in points_sorted:
    if pt.z - z_min < layer_height:
        current_layer.append(pt)
    else:
        layers.append(current_layer)
        current_layer = [pt]
        z_min = pt.z
if current_layer:
    layers.append(current_layer)

# Step 4: Pairing logic
paired = []
direction_lines = []

for layer_index, layer_points in enumerate(layers):
    if len(layer_points) < 2:
        continue

    if layer_index % 2 == 0:
        Group_Y = [pt for i, pt in enumerate(layer_points) if i % 2 == 0]
        Group_Z = [pt for i, pt in enumerate(layer_points) if i % 2 == 1]
    else:
        Group_Y = [pt for i, pt in enumerate(layer_points) if i % 2 == 1]
        Group_Z = [pt for i, pt in enumerate(layer_points) if i % 2 == 0]

    for a in Group_Y:
        closest_b = None
        min_dist = float('inf')
        for b in Group_Z:
            dist = distance_point_point(a, b)
            if dist < min_dist and dist <= max_distance:
                closest_b = b
                min_dist = dist

        if closest_b:
            direction = (closest_b - a)
            if direction.length > 0:
                direction = direction.unitized()
                xaxis = Vector(1, 0, 0)
                if abs(direction.dot(xaxis)) > 0.99:
                    xaxis = Vector(0, 1, 0)
                yaxis = direction.cross(xaxis).unitized()
                xaxis = yaxis.cross(direction).unitized()
                frame = Frame(a, xaxis, yaxis)

                paired.append((frame, direction))
                direction_lines.append(Line(a, a + direction * stick_length))
                Group_Z.remove(closest_b)

# Output
paired_root_frames = [p[0] for p in paired]
growth_directions = [p[1] for p in paired]
# ---------- end rhplanes_to_frames ----------
py3_2 = Python3Script()  # -> out, a; inputs gh_planes: Plane; disabled; unedited script template
panel = Panel(rhplanes_to_frames.layered_frames)  # disabled
draw = COMPASDraw(cg=rhplanes_to_frames.growth_directions)  # -> rg; disabled
#   port cg: The COMPAS geometry or datastructure to be drawn.
#   port rg: The Rhino geometry object.
# ---------- draw: Python ----------
# r: compas>=2.14.1
"""
Draws COMPAS geometry in Grasshopper.
"""

from typing import Any

import Grasshopper

from compas.scene import SceneObject


class CompasToRhinoGeometry(Grasshopper.Kernel.GH_ScriptInstance):
    def RunScript(self, cg):
        if not cg:
            return None

        return SceneObject(item=cg).draw()
# ---------- end draw ----------
panel_2 = Panel(gen_rhplanes.rootplanes)  # disabled
number_slider_26 = Slider(1, range=0..5)  # disabled
number_slider_27 = Slider(70, range=0..90)  # disabled
number_slider_28 = Slider(33, range=0..90)  # disabled
number_slider_29 = Slider(0, range=0..5)  # disabled
toggle = BooleanToggle(True)  # disabled
number_slider_30 = Slider(1500, range=0..1500)  # disabled
number_slider_31 = Slider(500, range=0..500)  # disabled
number_slider_32 = Slider(0, range=0..100)  # disabled
branching = Python3Script(
    paired_root_frames=rhplanes_to_frames.paired_root_frames,
    direction_lines=rhplanes_to_frames.direction_lines,
    growth_directions=rhplanes_to_frames.growth_directions,
    face_index=number_slider_26,
    stick_angle=number_slider_27,
    offset=number_slider_28,
    root_index=number_slider_29,
    use_root_index=toggle)  # -> out, parent_frames, geometries, layered_sticks; inputs paired_root_frames: list, direction_lines: list, growth_directions: list, face_index: Int32, stick_angle: Int32, offset: Int32, root_index: Int32, use_root_index: Boolean; disabled
# ---------- branching: Python ----------
# Updated Branching Script: Stores Group A and B separately in each layer

import sys
import os

# Setup script path
path = ghenv.Component.OnPingDocument().FilePath
parentdir = os.path.dirname(path)
scripts_dir = os.path.join(parentdir, "scripts")
if scripts_dir not in sys.path:
    sys.path.append(scripts_dir)

from compas.geometry import Vector, Frame
from compas_rhino import unload_modules
from Sticks import Stick
from branch import BranchingModule

unload_modules("Sticks")
unload_modules("branch")

# Constants
stick_length = 200
stick_width = 13.0
stick_depth = 13.0

# Outputs
all_geometries = []
layered_output = []

# Group (frame, vector) by Z-height
paired_frames = list(zip(paired_root_frames, growth_directions))
paired_frames = sorted(paired_frames, key=lambda p: p[0].point.z)

def group_by_z_height(pairs, height=125.0):
    layers = []
    current = []
    z_min = pairs[0][0].point.z if pairs else 0
    for frame, vec in pairs:
        if frame.point.z - z_min < height:
            current.append((frame, vec))
        else:
            layers.append(current)
            current = [(frame, vec)]
            z_min = frame.point.z
    if current:
        layers.append(current)
    return layers

raw_layers = group_by_z_height(paired_frames)

# Process each layer, splitting into Group A and B based on direction
for layer in raw_layers:
    group_A = [pair for pair in layer if pair[1].z > 0]
    group_B = [pair for pair in layer if pair[1].z <= 0]

    def build_branch_group(group):
        geometries, sticks, roots, childs = [], [], [], []
        for root_frame, growth_vector in group:
            zaxis = growth_vector.unitized()
            temp_x = Vector(1, 0, 0)
            if abs(zaxis.dot(temp_x)) > 0.99:
                temp_x = Vector(0, 1, 0)
            yaxis = zaxis.cross(temp_x).unitized()
            xaxis = yaxis.cross(zaxis).unitized()

            aligned_root = Frame(root_frame.point - zaxis * (stick_depth / 2), xaxis, yaxis)

            tree = BranchingModule(aligned_root, stick_length=stick_length, width=stick_width, depth=stick_depth)
            tree.grow_stick(face_index=1, angle=stick_angle, offset=offset)

            for stick in tree.sticks:
                geometries.append(stick.geometry)
                sticks.append(stick.axis)
                roots.append(stick.frame)
                if hasattr(stick, "child_frame"):
                    childs.append(stick.child_frame)
        return {"sticks": sticks, "geometries": geometries, "root_frames": roots, "child_frames": childs}

    layer_data = {
        "group_A": build_branch_group(group_A),
        "group_B": build_branch_group(group_B)
    }
    layered_output.append(layer_data)

# Final outputs
geometries = [g for layer in layered_output for g in layer["group_A"]["geometries"] + layer["group_B"]["geometries"]]
layered_sticks = layered_output
# ---------- end branching ----------
list = ValueList({"edge", "center"}, selected="center")  # disabled
bridging = Python3Script(
    layered_frames=rhplanes_to_frames.layered_frames,
    layered_sticks=branching.layered_sticks,
    mode=list,
    max_distance=number_slider_30,
    density_variation=number_slider_31,
    angle=number_slider_32)  # -> out, geometries, bridge_frames; inputs layered_frames: list of Plane, layered_sticks: list, mode: String, angle: String; disabled
# ---------- bridging: Python ----------
# Bridging Script: Inter-layer and Intra-layer Connections

import sys
import os

# Setup script path early to avoid import issues
path = ghenv.Component.OnPingDocument().FilePath
parentdir = os.path.dirname(path)
scripts_dir = os.path.join(parentdir, "scripts")
if scripts_dir not in sys.path:
    sys.path.append(scripts_dir)

from compas.geometry import Point, Frame, distance_point_point
from compas_rhino import unload_modules
from bridge import GrowTowards
from Sticks import Stick

# Reload modules
unload_modules("bridge")
unload_modules("Sticks")

# Parameters
stick_length = 200.0
stick_width = 13.0
stick_depth = 13.0
max_bridge_distance = 300.0
min_bridge_len = 50.0

# Input: layered_groups from branching script
layered_groups = layered_sticks  # Structure: list of layers, each with dict: {"GroupA": {}, "GroupB": {}}

bridging_sticks = []

def midpoint(line):
    return Point(
        (line.start.x + line.end.x) / 2,
        (line.start.y + line.end.y) / 2,
        (line.start.z + line.end.z) / 2,
    )

for i, layer in enumerate(layered_groups):
    group_a = layer.get("GroupA", {})
    group_b = layer.get("GroupB", {})

    # Intra-layer bridging: Group A → Group B
    for source, target in [(group_a, group_b), (group_b, group_a)]:
        source_cfs = source.get("child_frames", [])
        target_sticks = target.get("sticks", [])

        targets = [(axis, midpoint(axis)) for axis in target_sticks]

        for cf in source_cfs:
            closest = None
            min_dist = float("inf")

            for axis, mid in targets:
                d = distance_point_point(cf.point, mid)
                if d < max_bridge_distance and d < min_dist:
                    closest = (axis, mid)
                    min_dist = d

            if closest:
                axis, mid = closest
                try:
                    bridge = GrowTowards(
                        cf,
                        Frame(mid, cf.xaxis, cf.yaxis),
                        offset_root_child=0.0,
                        offset_target_child=0.0,
                        stick_length=stick_length,
                        width=stick_width,
                        depth=stick_depth
                    )
                    for s in bridge.sticks:
                        if s.axis.length >= min_bridge_len:
                            bridging_sticks.append(s)
                except Exception as e:
                    print("❌ Intra-layer bridge error:", e)

    # Inter-layer bridging to next layer
    if i + 1 < len(layered_groups):
        current = layer.get("GroupA", {})
        next_layer = layered_groups[i + 1].get("GroupB", {})

        current_cfs = current.get("child_frames", [])
        next_sticks = next_layer.get("sticks", [])
        targets = [(axis, midpoint(axis)) for axis in next_sticks]

        for cf in current_cfs:
            closest = None
            min_dist = float("inf")

            for axis, mid in targets:
                d = distance_point_point(cf.point, mid)
                if d < max_bridge_distance and d < min_dist:
                    closest = (axis, mid)
                    min_dist = d

            if closest:
                axis, mid = closest
                try:
                    bridge = GrowTowards(
                        cf,
                        Frame(mid, cf.xaxis, cf.yaxis),
                        offset_root_child=0.0,
                        offset_target_child=0.0,
                        stick_length=stick_length,
                        width=stick_width,
                        depth=stick_depth
                    )
                    for s in bridge.sticks:
                        if s.axis.length >= min_bridge_len:
                            bridging_sticks.append(s)
                except Exception as e:
                    print("❌ Inter-layer bridge error:", e)

# Output
bridge_geometries = [s.geometry for s in bridging_sticks]
bridge_frames = [s.frame for s in bridging_sticks if hasattr(s, "frame")]
# ---------- end bridging ----------
draw_2 = COMPASDraw(cg=branching.geometries)  # -> rg; disabled; same code as draw
draw_3 = COMPASDraw(cg=bridging.geometries)  # -> rg; disabled; same code as draw
panel_3 = Panel(bridging.geometries)  # disabled

# ----
pt_2 = ConstructPoint(XCoordinate=number_slider_10, YCoordinate=number_slider_9, ZCoordinate=number_slider_11)  # disabled
xy_3 = XYPlane(Origin=pt_2)  # disabled
bridged_branched_sticks_lite = Python3Script(
    surface_or_curve=rh_geometry,
    point_density=number_slider_17,
    angle_rule=angle_rule,
    face_rule=face_rule,
    stick_angle=number_slider_18,
    offset01=number_slider_20,
    steps=number_slider_19,
    do_bridging=do_bridging,
    detect_collisions=detect_collisions,
    debug_mode=debug_mode,
    lite_mode=lite_mode)  # -> out, geometries, colors, frames, sticks, dbg_root_frames, dbg_root_axes, dbg_branch_geos, dbg_bridge_geos; inputs surface_or_curve: Surface, point_density: Int32, angle_rule: String, face_rule: String, steps: Int32, do_bridging: Int32, detect_collisions: Double; disabled
# ---------- bridged_branched_sticks_lite: Python ----------
"""
Bridged_Branched_Sticks_LITE

Inputs:
    surface_or_curve : Brep / Surface / Curve
    point_density    : int
    angle_rule       : string (e.g. "15, -10, 5")
    face_rule        : string (e.g. "2,3,4,5")
    stick_angle      : float (deg)
    offset01         : float (0–1 blend)
    steps            : int
    do_bridging      : bool
    detect_collisions: bool
    debug_mode       : bool (extra logging only)
    lite_mode        : bool (unused hook)

Outputs:
    out              : log string
    geometries       : Breps of all sticks
    colors           : System.Drawing.Color list for each Brep
    frames           : list of COMPAS Frames (one per stick)
    sticks           : Stick objects (for advanced use)
    dbg_root_frames  : root edge frames
    dbg_root_axes    : root axes as lines
    dbg_branch_geos  : branch axes as lines
    dbg_bridge_geos  : bridge axes as lines
"""

import os
import sys
import importlib
import traceback
import Rhino.Geometry as rg
import System.Drawing as SD

# ----------------------------------------------------------------------
# Helper: COMPAS Stick → Rhino Brep box
# ----------------------------------------------------------------------

def stick_to_rhino_box(stick):
    f = stick.frame
    origin = rg.Point3d(f.point.x, f.point.y, f.point.z)
    x = rg.Vector3d(f.xaxis.x, f.xaxis.y, f.xaxis.z)
    y = rg.Vector3d(f.yaxis.x, f.yaxis.y, f.yaxis.z)
    plane = rg.Plane(origin, x, y)

    L = stick.length
    W = stick.width
    D = stick.depth

    ix = rg.Interval(-0.5 * L, 0.5 * L)
    iy = rg.Interval(-0.5 * W, 0.5 * W)
    iz = rg.Interval(-0.5 * D, 0.5 * D)

    box = rg.Box(plane, ix, iy, iz)
    return box.ToBrep()

def compas_line_to_rhino(line):
    p0 = rg.Point3d(line.start.x, line.start.y, line.start.z)
    p1 = rg.Point3d(line.end.x, line.end.y, line.end.z)
    return rg.LineCurve(p0, p1)

def color_for_stick(s):
    # collision overrides everything
    if getattr(s, "collided", False):
        return SD.Color.FromArgb(255, 255, 0, 0)          # Red

    if getattr(s, "is_root", False):
        return SD.Color.FromArgb(255, 255, 255, 0)        # Yellow

    fam = getattr(s, "family", None)
    if fam == "Y":
        return SD.Color.FromArgb(255, 255, 182, 193)      # Light pink
    if fam == "Z":
        return SD.Color.FromArgb(255, 144, 238, 144)      # Light green
    if fam == "BRIDGE":
        return SD.Color.FromArgb(255, 245, 245, 220)      # Beige

    return SD.Color.FromArgb(255, 255, 255, 0)            # default: yellow


# ----------------------------------------------------------------------
# 0. Resolve /scripts folder & import modules
# ----------------------------------------------------------------------

log_lines = []
def log(msg):
    log_lines.append(str(msg))
    print(msg)

# ensure GH file is saved
gh_path = ghenv.Component.OnPingDocument().FilePath
if not gh_path:
    raise RuntimeError("Save the GH file before running this component.")

root_dir = os.path.dirname(gh_path)
script_dir = os.path.join(root_dir, "scripts")

log("========================================")
log("USING SCRIPT DIR: {}".format(script_dir))
if script_dir not in sys.path:
    sys.path.insert(0, script_dir)
log("sys.path[0]: {}".format(sys.path[0]))

if not os.path.exists(script_dir):
    raise RuntimeError("Missing /scripts folder next to GH file.")

log("Directory Listing: {}".format(os.listdir(script_dir)))
log("========================================")

MODULES = ["stick_fixed", "branch", "bridge", "rf_core"]

# unload previous versions (hot-reload in GH)
for m in MODULES:
    if m in sys.modules:
        log("Removing previously loaded module: {}".format(m))
        del sys.modules[m]

try:
    import stick_fixed
    import branch
    import bridge
    import rf_core
    importlib.reload(stick_fixed)
    importlib.reload(branch)
    importlib.reload(bridge)
    importlib.reload(rf_core)
    from rf_core import RootFrames
    log("SUCCESS — Imported all modules.")
except Exception:
    log("\n==== IMPORT ERROR ====")
    traceback.print_exc()
    raise

# ----------------------------------------------------------------------
# 1. Prepare input geometry (Surface / Brep / Curve)
# ----------------------------------------------------------------------

# unwrap lists if needed
geom_in = surface_or_curve
if isinstance(geom_in, (list, tuple)):
    geom_in = geom_in[0] if geom_in else None

surf_input = None
curve_input = None

if isinstance(geom_in, rg.Brep):
    if geom_in.Faces.Count > 0:
        surf_input = geom_in.Faces[0]
elif isinstance(geom_in, rg.BrepFace):
    surf_input = geom_in
elif isinstance(geom_in, rg.Surface):
    surf_input = geom_in
elif isinstance(geom_in, rg.Curve):
    curve_input = geom_in
else:
    if geom_in is not None:
        log("WARNING: Unsupported geometry type: {}".format(type(geom_in)))

# ----------------------------------------------------------------------
# 2. Run RootFrames pipeline
# ----------------------------------------------------------------------

from rf_core import RootFrames

sticks_out = []
frames_out = []
dbg_root_frames = []
dbg_root_axes = []
dbg_branch_geos = []
dbg_bridge_geos = []
geometries = []
colors = []
out = ""

try:
    RF = RootFrames(
        surface=surf_input,
        curve=curve_input,
        point_density=point_density,
        stick_length=None,
        stick_width=None,
        stick_depth=None
    )

    all_sticks = RF.run(
        steps=int(steps),
        stick_angle=float(stick_angle),
        offset01=float(offset01),
        detect_collisions=bool(detect_collisions),
        do_bridging=bool(do_bridging),
        face_rule=str(face_rule) if face_rule else None,
        angle_rule=str(angle_rule) if angle_rule else None,
        debug=bool(debug_mode),
        collision_clearance=0.0,
    )

    sticks_out = all_sticks
    frames_out = [s.frame for s in all_sticks]

    dbg_root_frames = RF.root_frames_debug
    dbg_root_axes = [compas_line_to_rhino(a) for a in RF.root_axes_debug]
    dbg_branch_geos = [compas_line_to_rhino(a) for a in RF.branch_axes_debug]
    dbg_bridge_geos = [compas_line_to_rhino(a) for a in RF.bridge_axes_debug]

    # build Breps + colors
    for s in sticks_out:
        try:
            brep = stick_to_rhino_box(s)
            geometries.append(brep)
            colors.append(color_for_stick(s))
        except Exception:
            geometries.append(None)
            colors.append(SD.Color.FromArgb(255, 0, 0, 0))

except Exception:
    log("\n==== PIPELINE ERROR ====")
    traceback.print_exc()
    raise RuntimeError("RootFrames execution failed. See traceback above.")

out = "\n".join(log_lines)
# ---------- end bridged_branched_sticks_lite ----------
rot3d_2 = Rotate3D(Geometry=xy_3, Angle=degrees(number_slider_21), Center=pt_2, Axis=Vector(0, 0, 1))  # -> Geometry, Transform; disabled
number_slider_33 = Slider(7, range=0..10)  # disabled
number_slider_34 = Slider(0, range=0..50)  # disabled
number_slider_35 = Slider(100, range=0..100)  # disabled
info = COMPASInfo()  # -> info
#   port info: Environment info.
# ---------- info: Python ----------
# r: compas>=2.14.1
"""
Displays information about the active COMPAS environment.
"""

import os

import Grasshopper

import compas


class CompasInfo(Grasshopper.Kernel.GH_ScriptInstance):
    def RunScript(self):
        try:
            import compas_bootstrapper

            environment_name = compas_bootstrapper.ENVIRONMENT_NAME
        except ImportError:
            environment_name = os.path.dirname(compas.__file__)
            environment_name = os.path.abspath(os.path.join(environment_name, ".."))

        ghenv.Component.Message = "COMPAS v{}".format(compas.__version__)  # noqa: F821
        info = "COMPAS Version: {}\nEnvironment: {}"
        return info.format(compas.__version__, environment_name)
# ---------- end info ----------

py3_3 = Python3Script(scale=Slider(7, range=0..10))  # -> out, x_lines, y_lines, z_lines; inputs frames: list, scale: Double
# ---------- py3_3: Python ----------
import Rhino.Geometry as rg
from compas.geometry import Point, Vector

# Inputs: frames (list[Frame]), scale (float)

x_lines = []
y_lines = []
z_lines = []

for f in frames:
    origin = f.point
    x_end = origin + f.xaxis.scaled(scale)
    y_end = origin + f.yaxis.scaled(scale)
    z_end = origin + f.zaxis.scaled(scale)

    x_lines.append(rg.Line(rg.Point3d(*origin), rg.Point3d(*x_end)))
    y_lines.append(rg.Line(rg.Point3d(*origin), rg.Point3d(*y_end)))
    z_lines.append(rg.Line(rg.Point3d(*origin), rg.Point3d(*z_end)))
# ---------- end py3_3 ----------
preview = CustomPreview(Geometry=py3_3.x_lines, Material=ColourSwatch(SwatchColor=RGB(255, 0, 0)))
preview_2 = CustomPreview(Geometry=py3_3.y_lines, Material=ColourSwatch(SwatchColor=RGB(0, 255, 0)))
preview_3 = CustomPreview(Geometry=py3_3.z_lines, Material=ColourSwatch(SwatchColor=RGB(6, 0, 255)))

geo_4 = Geometry(bridged_branched_sticks_lite.geometries)  # disabled
panel_4 = Panel(info)

panel_5 = Panel(bridged_branched_sticks_lite.dbg_bridge_geos)  # disabled
panel_6 = Panel(bridged_branched_sticks_lite.dbg_branch_geos)  # disabled

panel_7 = Panel(bridged_branched_sticks_lite.out)  # disabled
compas_draw = COMPASDraw(cg=bridged_branched_sticks_lite.frames)  # -> rg; disabled; same code as draw
py3_4 = Python3Script(
    root_frame=py_grow.frames,
    target_plane=rot3d_2.Geometry,
    offset_root_child=number_slider_33,
    offset_target_child=number_slider_34,
    stick_length=number_slider_35)  # -> out, geometries, frames; inputs target_plane: Plane, offset_root_child: Double, offset_target_child: Double, stick_length: Double; disabled
# ---------- py3_4: Python ----------
# r: compas>=2.14.1
# venv: sticks

import sys, os, math

path = ghenv.Component.OnPingDocument().FilePath
parentdir = os.path.dirname(path)
scripts = os.path.join(parentdir, 'scripts')
sys.path.append(scripts)

from compas_rhino import unload_modules
unload_modules("Sticks")
unload_modules("stick_bridge_v2")

from stick_bridge_v2 import GrowTowards
from RootFrames import Stick


from compas_rhino.conversions import plane_to_compas_frame
from compas.geometry import Frame

stick_width = 13.0
stick_depth = 13.0

# GH inputs:
#   root_frame  : COMPAS Frame (from previous module)
#   target_plane: Rhino Plane  (your target)
#   offset_root_child, offset_target_child : floats
#   stick_length: float



target_frame = plane_to_compas_frame(target_plane)

bridge = GrowTowards(
    root_frame=root_frame,
    target_frame=target_frame,
    offset_root_child=offset_root_child,
    offset_target_child=offset_target_child,
    stick_length=stick_length,
    width=stick_width,
    depth=stick_depth
)

geometries = bridge.visualize()
frames = [stick.frame for stick in bridge.sticks]

print("root_frame:", type(root_frame), root_frame)
print("target_frame:", type(target_frame), target_frame)
# ---------- end py3_4 ----------
swatch = ColourSwatch(SwatchColor=RGB(0, 0, 250))
compas_draw_2 = COMPASDraw(cg=py3_4.geometries)  # -> rg; disabled; same code as draw
py3_5 = Python3Script()  # -> out, a
# ---------- py3_5: Python ----------
from compas.geometry import distance_line_line, dot_vectors
import math


class Collision:
    def __init__(self, stick1, stick2):
        """
        Constructor for Collision between two sticks.
        
        Args:
            stick1: type Stick, first stick.
            stick2: type Stick, second stick.
        """
        self.stick1 = stick1
        self.stick2 = stick2


    def aabb_overlap(self):
        """
        Check if AABBs of two sticks overlap.
        
        Returns:
            bool: True if AABBs overlap.
        """
        a_min, a_max = self.stick1.aabb
        b_min, b_max = self.stick2.aabb
        
        return not (
            a_max[0] < b_min[0] or a_min[0] > b_max[0] or
            a_max[1] < b_min[1] or a_min[1] > b_max[1] or
            a_max[2] < b_min[2] or a_min[2] > b_max[2]
        )
    

    @property
    def axis_distance(self):
        """
        Private method to compute the shortest distance between the infinite axes of two sticks.
        Using for rounded pipe-like sticks.

        Returns:
            float: shortest distance between two infinite axes.
        """
        return distance_line_line(self.stick1.axis, self.stick2.axis, tol=None)
    

    @property
    def segment_distance(self):
        """
        Private method to compute the shortest distance between the line segments of two sticks.
        Using for rounded pipe-like sticks.

        Returns:
            float: the shortest distance between two line SEGMENTS.
        """
        p1 = self.stick1.axis.start
        q1 = self.stick1.axis.end
        p2 = self.stick2.axis.start
        q2 = self.stick2.axis.end

        def dot(a, b):
            return a.x*b.x + a.y*b.y + a.z*b.z

        def sub(a, b):
            return type(a)(a.x - b.x, a.y - b.y, a.z - b.z)

        def add(a, b):
            return type(a)(a.x + b.x, a.y + b.y, a.z + b.z)

        def mul(a, s):
            return type(a)(a.x * s, a.y * s, a.z * s)

        u = sub(q1, p1)   # segment1 direction
        v = sub(q2, p2)   # segment2 direction
        w = sub(p1, p2)

        a = dot(u, u)     # length^2 of segment1
        b = dot(u, v)
        c = dot(v, v)     # length^2 of segment2
        d = dot(u, w)
        e = dot(v, w)

        D = a * c - b * b
        EPS = 1e-9

        sc, sN, sD = 0.0, 0.0, D
        tc, tN, tD = 0.0, 0.0, D

        # segments almost parallel
        if D < EPS:
            sN = 0.0
            sD = 1.0
            tN = e
            tD = c
        else:
            sN = (b * e - c * d)
            tN = (a * e - b * d)

            if sN < 0.0:
                sN = 0.0
                tN = e
                tD = c
            elif sN > sD:
                sN = sD
                tN = e + b
                tD = c

        if tN < 0.0:
            tN = 0.0
            if -d < 0.0:
                sN = 0.0
            elif -d > a:
                sN = sD
            else:
                sN = -d
                sD = a
        elif tN > tD:
            tN = tD
            if (-d + b) < 0.0:
                sN = 0.0
            elif (-d + b) > a:
                sN = sD
            else:
                sN = (-d + b)
                sD = a

        sc = 0.0 if abs(sN) < EPS else sN / sD
        tc = 0.0 if abs(tN) < EPS else tN / tD

        dP = sub(add(w, mul(u, sc)), mul(v, tc))  # = closest point difference vector
        return math.sqrt(dot(dP, dP))


    def _project_corners_onto_axis(self, stick, axis):
        """
        Helper for sat_6_axis (1/2):
            Private method to calculate dot products between stick corners and the other stick axis.

        Args:
            stick: type Stick, the stick whose corners to project.
            axis: type Vector, the axis to project onto.
        
        Returns:
            tuple : (min dot product, max dot product)
        """
        unit_axis = axis.unitized()
        dots = [dot_vectors(c, unit_axis) for c in stick.corners]
        return min(dots), max(dots)
    

    def _interval_overlap(self, minA, maxA, minB, maxB):
        """
        Helper for sat_6_axis (2/2):
            Private method to check if two 1D intervals overlap.
        
        Args:
            minA: Minimum of interval A.
            maxA: Maximum of interval A.
            minB: Minimum of interval B.
            maxB: Maximum of interval B.
            
        Returns:
            bool: True if intervals overlap.
        """
        EPS = 1e-6  # tolerance for floating point comparison
        return not (maxA <= minB + EPS or maxB <= minA + EPS)


    def sat_6_axis(self):
        """
        Compute collision using the Separating Axis Theorem (SAT) on six axes:
        the local x, y, z axes of both sticks.
        
        Returns:
            bool: True if sticks collide.
        """
        A = self.stick1
        B = self.stick2
        axes = [
                A.frame.xaxis,
                A.frame.yaxis,
                A.frame.zaxis,
                B.frame.xaxis,
                B.frame.yaxis,
                B.frame.zaxis
        ]

        for axis in axes:
            minA, maxA = self._project_corners_onto_axis(A, axis)
            minB, maxB = self._project_corners_onto_axis(B, axis)
            if not self._interval_overlap(minA, maxA, minB, maxB):
                return False
        return True
    

    def check_collision(self):
        """
        Check collision between two sticks using:
        1. Broad-phase: AABB
        2. Mid-phase: Segment-segment distance (Using for rounded pipe-like sticks, not for rectangular sticks)
        3. Narrow-phase: Six-axis SAT (Separating Axis Theorem)

        Args:
            radius: collision thickness, default = stick width

        Returns:
            bool: True if collision dectected.
        """
        EPS = 1e-6  # tolerance for floating point comparison

        # 1. AABB
        if not self.aabb_overlap():
            return False

        """
        # 2. Segment distance
        dist = self.segment_distance
        threshold = radius or max(self.stick1.width, self.stick2.width)
        if dist >= threshold - EPS:
            return False
        """

        # 3. Six-axis SAT
        if not self.sat_6_axis():
            return False
        return True
# ---------- end py3_5 ----------
py3_6 = Python3Script()  # -> out, a
# ---------- py3_6: Python ----------
from compas.geometry import Box, Line, Rotation
import math


class Stick:
    size = 13.0
    width = size
    depth = size
    def __init__(self, frame, length=None, width=None, depth=None):
        """
        Constructor for single Stick.
        Args:
            frame: Frame representing the start of the stick.
            length: Length of the stick (defaults to 100.0)
            width: Width of the stick (defaults to Stick.width)
            depth: Depth of the stick (defaults to Stick.depth)
        """
        self.frame = frame
        self.length = length or 100.0
        self.width = width or Stick.width
        self.depth = depth or Stick.depth

        self.axis = self._axis_from_frame()
        self.midframe = self._get_axis_mid_frame()
        self.corners = self._get_corners()
        self.aabb = self._get_aabb()

    def _axis_from_frame(self):
        """
        Private method to compute the stick's axis as a Line.

        Returns:
            Line representing the stick's axis.
        """
        start_pt = self.frame.point
        direction = self.frame.xaxis
        axis = Line.from_point_direction_length(start_pt, direction, self.length)
        return axis
    

    def _get_axis_mid_frame(self):
        """
        Private method to compute the mid frame of the stick's axis.

        Returns:
            Frame at the middle point of the stick's axis, aligned with the stick's frame but at different origin.
        """
        vector = self.frame.xaxis.unitized()
        vector *= (self.length / 2)
        frame = self.frame.translated(vector)
        return frame


    def eval_frame(self, face_index=0, t_value=.5):
        """
        Gets a frame on one of the four faces of a stick.

        Args:
            face_index: Face index (0-3) around the stick
            t_value: The relative position along the line as a fraction of the length of the line. 0.0 corresponds to the start point and 1.0 corresponds to the end point. Numbers outside of this range are also valid and correspond to points beyond the start and end point.
            
        Returns:
            Frame on the specified face index and t value.
        """
        # Rotate stick frame based on index
        base = self.midframe
        angle = (face_index % 4) * (math.pi / 2)
        R = Rotation.from_axis_and_angle(base.xaxis, angle, base.point)
        new_stick_frame = base.transformed(R)

        # Set frame point along stick axis
        new_stick_frame.point = self.axis.point_at(t_value)
        # Offset frame to be on surface of stick
        new_stick_frame.point += new_stick_frame.zaxis * (self.depth / 2)
        return new_stick_frame
    

    def _get_corners(self):
        """
        Private method to compute 8 corners of the stick.
        
        Returns:
            List of 8 corner points of the stick.
        """
        l, w, d = self.length / 2, self.width / 2, self.depth / 2
        vecx, vecy, vecz = self.frame.xaxis, self.frame.yaxis, self.frame.zaxis
        sign = [-1, 1]
        corners = []
        for i in sign:
            for j in sign:
                for k in sign:
                    corner = self.midframe.point + vecx * (i*l) + vecy * (j*w) + vecz * (k*d)
                    corners.append(corner)
        return corners
    

    def _get_aabb(self):
        """
        Private method to compute the axis-aligned bounding box of the stick.

        Returns:
            (min_point, max_point): tuple of two points defining the AABB.
        """
        corners = self.corners
        xs = [p[0] for p in corners]
        ys = [p[1] for p in corners]
        zs = [p[2] for p in corners]
        return [(min(xs), min(ys), min(zs)), (max(xs), max(ys), max(zs))]
    

    @property
    def geometry(self):
        return Box(self.length, self.width, self.depth, self.midframe)
# ---------- end py3_6 ----------

# ---- group: Surface_to_Brep_for_Random_Points
height_subdiv = Slider(14, range=0..30)  # disabled
layer_height = Slider(0, range=0..30)  # disabled
randomness = Slider(1, range=0..1)  # disabled
twist_angle = Slider(0, range=0..90)  # disabled
point_density = Slider(100, range=0..100)  # disabled
max_height = Slider(1000, range=0..1000)  # disabled
srf = Surface(<surface referenced from the Rhino model>)  # disabled
crv_2 = Curve(<curve referenced from the Rhino model>)  # disabled
brep_for_random_points = Python3Script(
    srf_input=srf,
    curve_input=crv_2,
    height_subdiv=height_subdiv,
    point_density=point_density,
    max_height=max_height,
    layer_height=layer_height,
    randomness=randomness,
    twist_angle=twist_angle)  # -> out, list_pts, srf_out; inputs srf_input: Surface, curve_input: Curve, height_subdiv: Int32, point_density: Int32, max_height: Int32, layer_height: Int32, randomness: Double; disabled
# ---------- brep_for_random_points: Python ----------
import Rhino.Geometry as rg
import random, math


# - If a curve is provided -> extrusion + layer logic
# - If a surface/Brep is provided -> UV sampling (Z-height ignored)

#rotate a point around centroid by ang_rad

def rotate_point_z(pt, cx, cy, ang_rad):
    dx = pt.X - cx
    dy = pt.Y - cy
    ca = math.cos(ang_rad)
    sa = math.sin(ang_rad)
    x = cx + dx * ca - dy * sa
    y = cy + dx * sa + dy * ca
    return rg.Point3d(x, y, pt.Z)

# CURVE INPUT

if curve_input is not None and srf_input is None:
    
    # 1. Create vertical extrusion surface
    z_dir = rg.Vector3d(0,0,1)
    surface = rg.Surface.CreateExtrusion(curve_input, z_dir * max_height)
    
    if not surface:
        raise Exception("Failed to extrude curve_input.")

    brep = surface.ToBrep()
    face = brep.Faces[0]

    # Output surface
    srf_out = brep

    # UV sampling domain
    u_domain = face.Domain(0)
    v_domain = face.Domain(1)

    # Generate points layer-by-layer
    pts_all = []

    for layer in range(height_subdiv + 1):

        z = (max_height / float(height_subdiv)) * layer
        ang_rad = math.radians(twist_angle * layer)
        n = max(1, int(point_density))

        # Random UV sampling
        pts_layer = []
        for i in range(n):
            u = random.uniform(u_domain.T0, u_domain.T1)
            v = random.uniform(v_domain.T0, v_domain.T1)
            p = face.PointAt(u, v)

            pz = rg.Point3d(p.X, p.Y, z)
            pts_layer.append(pz)

        # Twist around centroid
        cx = sum(p.X for p in pts_layer) / len(pts_layer)
        cy = sum(p.Y for p in pts_layer) / len(pts_layer)
        pts_rot = [rotate_point_z(p, cx, cy, ang_rad) for p in pts_layer]

        # Sort angularly
        pts_sorted = sorted(
            pts_rot,
            key=lambda pt: math.atan2(pt.Y - cy, pt.X - cx)
        )

        pts_all.extend(pts_sorted)

    pts_out = pts_all



# IF SURFACE INPUT, UV-BASED LOGIC, HEIGHT IGNORED

elif srf_input is not None:

    # 1. Normalize input to a Brep and its first face
    if isinstance(srf_input, rg.Brep):
        brep = srf_input
    elif isinstance(srf_input, rg.Surface):
        brep = srf_input.ToBrep()
    elif isinstance(srf_input, rg.Extrusion):
        brep = srf_input.ToBrep()
    else:
        raise Exception("Unsupported srf_input type.")

    face = brep.Faces[0]
    srf_out = brep

    # 2. UV Sampling (Option 3 logic)
    u_dom = face.Domain(0)
    v_dom = face.Domain(1)

    num_points = int(point_density) * max(1, int(height_subdiv))

    pts = []
    for i in range(num_points):
        u = random.uniform(u_dom.T0, u_dom.T1)
        v = random.uniform(v_dom.T0, v_dom.T1)
        pts.append(face.PointAt(u, v))

    # 3. Sort bottom → top (Z-axis)
    pts_sorted = sorted(pts, key=lambda p: p.Z)

    # 4. Optional sequence inside each Z band: cluster points into height_subdiv groups

    clustered = []
    if height_subdiv > 0:
        zmin = min(p.Z for p in pts_sorted)
        zmax = max(p.Z for p in pts_sorted)
        zspan = zmax - zmin

        for k in range(height_subdiv + 1):
            z_lo = zmin + (zspan / height_subdiv) *  k
            z_hi = zmin + (zspan / height_subdiv) * (k+1)

            layer_pts = [p for p in pts_sorted if z_lo <= p.Z < z_hi]

            if len(layer_pts) > 2:
                cx = sum(p.X for p in layer_pts)/len(layer_pts)
                cy = sum(p.Y for p in layer_pts)/len(layer_pts)
                layer_pts = sorted(
                    layer_pts,
                    key=lambda p: math.atan2(p.Y - cy, p.X - cx)
                )

            clustered.extend(layer_pts)

        list_pts = clustered

    else:
        list_pts = pts_sorted
# ---------- end brep_for_random_points ----------
geo_5 = Geometry(brep_for_random_points.list_pts)  # disabled
geo_6 = Geometry(brep_for_random_points.srf_out)  # disabled

# ----
height_subdiv_2 = Slider(2, range=0..30)  # disabled
twist_angle_2 = Slider(11, range=0..30)  # disabled
number_slider_36 = Slider(40, range=0..100)  # disabled
angle = Slider(90, range=0..90)  # disabled
offset = Slider(37.8, range=0..100)  # disabled
max_height_2 = Slider(126, range=0..200)  # disabled
face_index = Slider(2, range=0..4)  # disabled
root_index = Slider(5, range=0..5)  # disabled
number_slider_37 = Slider(45, range=0..135)  # disabled
number_slider_38 = Slider(1, range=0..20)  # disabled
number_slider_39 = Slider(0.2, range=0..1)  # disabled
layers = Slider(80, range=0..100)  # disabled
show_branch_bridge = BooleanToggle(False)  # disabled
show_frames_axes = BooleanToggle(True)  # disabled
detect_collisions_2 = BooleanToggle(True)  # disabled
angle_rule_2 = ValueList({"-30", "0", "30", "60"}, selected="-30")  # disabled
debug_mode_2 = BooleanToggle(True)  # disabled
do_bridging_2 = BooleanToggle(True)  # disabled
face_rule_2 = ValueList({"0", "1", "2", "3"}, selected="1")  # disabled
way_planes = RemoteReceiver()  # disabled
rh_geometry_2 = Geometry(<surface referenced from the Rhino model>)  # disabled
crv_3 = Curve(<curve referenced from the Rhino model>)  # disabled
py3_7 = Python3Script(way_planes=way_planes, root_index=root_index, face_index=face_index, angle=angle, offset=offset)  # -> out, geometries; inputs way_planes: list, face_index: Int32, angle: Double, offset: Double; disabled
# ---------- py3_7: Python ----------
# r: compas>=2.14.1
# venv: sticks

import sys
import os
import math

#get current file path
path = ghenv.Component.OnPingDocument().FilePath
print (path)
#get parent directory of the parent directory
parentdir = os.path.dirname(path)
print (parentdir)
#get src folder which contains classes
dire = os.path.join(parentdir,'scripts')
print (dire)

sys.path.append(dire)

from compas_rhino import unload_modules

unload_modules("Sticks")
unload_modules("stick_module")

import Sticks
from Sticks import Stick 
from stick_module import BranchingModule
from compas.geometry import Point, Line, Point, Vector, Frame, Rotation

stick_width = 1.0
stick_depth = 1.0

from compas_rhino.conversions import plane_to_compas_frame, frame_to_rhino_plane

# Convert way_planes input to compas
root_frames = []
for pl in way_planes:
    root_frames.append(plane_to_compas_frame(pl))


root_frames_out = []
preview_planes = []                                         # Rhino planes to preview

# Apply root_index orientation per frame 
for f in root_frames:
    f_oriented = reorient_frame_for_root(f, root_index)
    root_frames_out.append(f_oriented)
    preview_planes.append(frame_to_rhino_plane(f_oriented))  # Rhino planes to preview

# Initialize tree
trees = []
for f in root_frames:
    trees.append(BranchingModule(f, stick_length=200, width=stick_width, depth=stick_depth))

# Grow tree
for t in trees:
    t.grow_stick(face_index = face_index, angle = angle, offset = offset)
    t.grow_stick(face_index = face_index, angle = angle, offset = offset)
    t.grow_stick(face_index = face_index, angle = angle, offset = offset) 

# Visualize
geometries = []
for t in trees:
    geomet = t.visualize()          
    geometries.extend(t.visualize())
# ---------- end py3_7 ----------
bridged_branched_sticks_full = Python3Script(
    surface_or_curve=rh_geometry_2,
    point_density=number_slider_36,
    angle_rule=angle_rule_2,
    face_rule=face_rule_2,
    stick_angle=number_slider_37,
    offset01=number_slider_39,
    steps=number_slider_38,
    do_bridging=do_bridging_2,
    detect_collisions=detect_collisions_2,
    debug_mode=debug_mode_2,
    show_frames=show_frames_axes,
    show_axes=show_frames_axes,
    show_branch=show_branch_bridge,
    show_bridge=show_branch_bridge)  # -> out, geometries, colors, frames, sticks, dbg_root_frames, dbg_root_axes, dbg_branch_geos, dbg_bridge_geos; inputs surface_or_curve: Surface, point_density: Int32, angle_rule: String, face_rule: String, steps: Int32, do_bridging: Int32, detect_collisions: Double; disabled
# ---------- bridged_branched_sticks_full: Python ----------
"""
GH Python – RootFrames Lite Integrator
FAST + SAFE version that guarantees:
- Modules load from your real /scripts folder
- RhinoCode sandbox modules are deleted
- Preview uses axes (very lightweight)

Inputs:
    surface_or_curve : Brep/Surface or Curve
    point_density    : int
    steps            : int
    stick_angle      : float
    offset01         : float in [0,1]
    detect_collisions: bool
    do_bridging      : bool

    face_rule        : str, e.g. "0,1,2,3"
    angle_rule       : str, e.g. "0,30,-30"
    debug_mode       : bool
    lite_mode        : bool
"""

# =============================================================================
# 0. CLEAR RHINOCODE SANDBOX MODULES FIRST
# =============================================================================

import sys

mods_to_remove = [
    m for m in sys.modules
    if m.startswith("RootFrames")
    or m.startswith("branch")
    or m.startswith("stick")
    or m.startswith("bridge")
]

for m in mods_to_remove:
    print("REMOVING MODULE:", m)
    del sys.modules[m]


# =============================================================================
# 1. SETUP SCRIPT FOLDER IN sys.path BEFORE IMPORTS
# =============================================================================

import os
doc_path = ghenv.Component.OnPingDocument().FilePath
root_dir = os.path.dirname(doc_path)
scripts_dir = os.path.join(root_dir, "scripts")

if scripts_dir not in sys.path:
    sys.path.insert(0, scripts_dir)  # IMPORTANT: search disk BEFORE RhinoCode sandbox

print("sys.path[0]:", sys.path[0])


# =============================================================================
# 2. IMPORT & FORCE RELOAD FROM DISK
# =============================================================================

import importlib

import stick
import branch
import bridge
import RootFrames

importlib.reload(stick)
importlib.reload(branch)
importlib.reload(bridge)
importlib.reload(RootFrames)

from RootFrames import RootFrames

print(">>> RootFrames NOW loaded from:", RootFrames.__file__)


# =============================================================================
# 3. CLASSIFY INPUT (curve or surface)
# =============================================================================

import Rhino.Geometry as rg
from System.Drawing import Color

def classify_surface_or_curve(obj):
    if obj is None:
        raise ValueError("Nothing connected to `surface_or_curve` input.")

    if isinstance(obj, (rg.Brep, rg.Surface, rg.Extrusion, rg.RevSurface)):
        return obj, None

    if isinstance(obj, rg.Curve):
        return None, obj

    raise ValueError("Expected Brep/Surface/Curve. Got: {}".format(type(obj)))


surface, curve = classify_surface_or_curve(surface_or_curve)


# =============================================================================
# 4. CONSTRUCT ROOTFRAMES ENGINE
# =============================================================================

RF = RootFrames(
    surface=surface,
    curve=curve,
    point_density=point_density,
    stick_length=None,
    stick_width=None,
    stick_depth=None,
)


# =============================================================================
# 5. RUN PIPELINE
# =============================================================================

try:
    sticks_all = RF.run(
        steps=steps,
        stick_angle=stick_angle,
        offset01=offset01,
        detect_collisions=detect_collisions,
        do_bridging=do_bridging,
        clearance=0.0,
        face_rule=face_rule,
        angle_rule=angle_rule,
        verbose=debug_mode,   # newer version
    )
except TypeError:
    # fallback for older signature
    sticks_all = RF.run(
        steps=steps,
        stick_angle=stick_angle,
        offset01=offset01,
        detect_collisions=detect_collisions,
        do_bridging=do_bridging,
        clearance=0.0,
        face_rule=face_rule,
        angle_rule=angle_rule,
    )
except Exception as e:
    raise RuntimeError("RootFrames execution failed: {}".format(e))


# =============================================================================
# 6. LITE PREVIEW — AXES ONLY (SUPER FAST)
# =============================================================================

from compas_rhino.conversions import line_to_rhino, box_to_rhino

geometries = []

if lite_mode:
    # preview axes only
    for s in sticks_all:
        try:
            geometries.append(line_to_rhino(s.axis))
        except Exception:
            geometries.append(None)
else:
    # heavier preview (Breps)
    for s in sticks_all:
        try:
            geometries.append(box_to_rhino(s.geometry))
        except Exception:
            geometries.append(None)


# =============================================================================
# 7. COLORS (simple uniform scheme)
# =============================================================================

colors = [Color.ForestGreen] * len(geometries)


# =============================================================================
# 8. PRIMARY OUTPUTS
# =============================================================================

frames = RF.frames
sticks = sticks_all


# =============================================================================
# 9. DEBUG OUTPUTS (optional, lightweight)
# =============================================================================

dbg_root_frames = RF.frames if debug_mode else []
dbg_root_axes   = []
dbg_branch_geos = []
dbg_bridge_geos = []

if debug_mode:

    # ROOT AXES
    if getattr(RF, "root_sticks", None):
        for s in RF.root_sticks:
            try:
                dbg_root_axes.append(line_to_rhino(s.axis))
            except:
                pass

    # BRANCH GEOMETRIES
    if getattr(RF, "branch_sticks", None):
        for s in RF.branch_sticks:
            try:
                dbg_branch_geos.append(
                    line_to_rhino(s.axis) if lite_mode else box_to_rhino(s.geometry)
                )
            except:
                dbg_branch_geos.append(None)

    # BRIDGE GEOMETRIES
    if getattr(RF, "bridge_sticks", None):
        for s in RF.bridge_sticks:
            try:
                dbg_bridge_geos.append(
                    line_to_rhino(s.axis) if lite_mode else box_to_rhino(s.geometry)
                )
            except:
                dbg_bridge_geos.append(None)
# ---------- end bridged_branched_sticks_full ----------
list_pts = RemoteSender()  # disabled

# ---- group: Curve_to_Brep_for_Random_Points
twist_angle_3 = Slider(0, range=0..90)  # disabled
layer_height_2 = Slider(7, range=0..30)  # disabled
randomness_2 = Slider(0.6, range=0..1)  # disabled
height_subdiv_3 = Slider(6, range=0..30)  # disabled
point_density_2 = Slider(11, range=0..30)  # disabled
max_height_3 = Slider(78, range=0..1000)  # disabled
crv_4 = Curve(<curve referenced from the Rhino model>)  # disabled
brep_for_random_points_2 = Python3Script(
    curve_input=crv_4,
    height_subdiv=height_subdiv_3,
    point_density=point_density_2,
    max_height=max_height_3,
    layer_height=layer_height_2,
    randomness=randomness_2,
    twist_angle=twist_angle_3)  # -> out, list_pts, srf_out; inputs curve_input: Curve, height_subdiv: Int32, point_density: Int32, max_height: Int32, layer_height: Int32, randomness: Double; disabled
# ---------- brep_for_random_points_2: Python ----------
import Rhino.Geometry as rg
import random, math


z_dir = rg.Vector3d(0,0,1)
surface = rg.Surface.CreateExtrusion(curve_input, z_dir * max_height)
brep = surface.ToBrep()
face = brep.Faces[0]

# UV domains for random sampling
u_domain = face.Domain(0)
v_domain = face.Domain(1)


# Output surface for GH preview
srf_out = brep



# Rotate pts around centroid by ang_rad

def rotate_point_z(pt, cx, cy, ang_rad):
    dx = pt.X - cx
    dy = pt.Y - cy
    ca = math.cos(ang_rad)
    sa = math.sin(ang_rad)
    x = cx + dx * ca - dy * sa
    y = cy + dx * sa + dy * ca
    return rg.Point3d(x, y, pt.Z)


# Generate list points by layer

list_pts = []

for layer in range(height_subdiv + 1):

    # Height of this layer
    z = (max_height / float(height_subdiv)) * layer

    # Twist angle for this layer
    ang_rad = math.radians(twist_angle * layer)

    # Number of points in this layer
    n = max(1, int(point_density))

    # Random sample points on the surface
    
    pts_layer = []
    for i in range(n):
        u = random.uniform(u_domain.T0, u_domain.T1)
        v = random.uniform(v_domain.T0, v_domain.T1)

        # define points on surface
        p = face.PointAt(u, v)

        # orient pt per Z-dir 
        p_layer = rg.Point3d(p.X, p.Y, z)
        pts_layer.append(p_layer)

    #Twist points around layer centroid
    
    cx = sum(p.X for p in pts_layer) / len(pts_layer)
    cy = sum(p.Y for p in pts_layer) / len(pts_layer)

    pts_rotated = [rotate_point_z(p, cx, cy, ang_rad) for p in pts_layer]

    # Sort points radially within the layer to sequence correctly

    pts_sorted = sorted(
        pts_rotated,
        key=lambda p: math.atan2(p.Y - cy, p.X - cx)
    )

    # Append them to the list of points
    list_pts.extend(pts_sorted)
# ---------- end brep_for_random_points_2 ----------
list_pts_2 = RemoteReceiver([brep_for_random_points_2.list_pts, list_pts])  # disabled
geo_7 = Geometry(brep_for_random_points_2.srf_out)  # disabled
geo_8 = Geometry(list_pts_2)  # disabled

# ----
draw_4 = COMPASDraw(cg=py3_7.geometries)  # -> rg; disabled; same code as draw
geo_9 = Geometry(list_pts)  # disabled
geo_10 = Geometry(bridged_branched_sticks_full.geometries)  # disabled
rot_at_tan = Slider(0, range=-90..0)  # disabled

# ---- group: Create Planes_and_their_Rotations
rot_at_tan_2 = Slider(-90, range=-90..0)  # disabled
planes_that_rotate = Python3Script(list_pts=brep_for_random_points.list_pts, rot_at_tan=rot_at_tan_2, rot_at_norm=rot_at_tan)  # -> out, way_planes; inputs list_pts: list of Point3d, rot_at_tan: Double; disabled
# ---------- planes_that_rotate: Python ----------
import Rhino.Geometry as rg
import math

#define a vector by the rel. coordinates of two consecutive points
def vec(a, b):
    return rg.Vector3d(b.X - a.X, b.Y - a.Y, b.Z - a.Z)

# set up
Z = rg.Vector3d(0, 0, 1)
way_planes = []
n = len(list_pts)

for i, pt in enumerate(list_pts):
    # estimate tangent
    if  i == 0:
        tan = vec(list_pts[0], list_pts[1])
    elif i == n - 1:
        tan = vec(list_pts[n - 2], list_pts[n - 1])
    else:
        tan = vec(list_pts[i - 1], list_pts[i + 1])

    # keep planes horizontal (about global Z)
    tan.Z = 0.0
    if not tan.Unitize():                     # guard zero-length & keeps tan to local pt coordinates
        tan = rg.Vector3d(1, 0, 0)

    norm = rg.Vector3d.CrossProduct(Z, tan)   
    if not norm.Unitize():                   # guard parallel cases
        norm = rg.Vector3d(0, 1, 0)

    # base plane
    pl = rg.Plane(pt, tan, norm)

    # rotation around tangent 
    ang_tan = math.radians(rot_at_tan)
    R_tan = rg.Transform.Rotation(ang_tan, tan, pt)
    pl.Transform(R_tan)

    # rotate the 'norm' as well, and use the updated plane
    norm_rot = rg.Vector3d(norm)
    norm_rot.Transform(R_tan)

    # then rotation around normal
    ang_norm = math.radians(rot_at_norm)
    R_norm = rg.Transform.Rotation(ang_norm, norm_rot, pt)
    pl.Transform(R_norm)

    way_planes.append(pl)
# ---------- end planes_that_rotate ----------
geo_11 = Geometry(planes_that_rotate.way_planes)  # disabled

# ----
panel_8 = Panel(bridged_branched_sticks_full.out)  # disabled
panel_9 = Panel(bridged_branched_sticks_full.dbg_root_frames)  # disabled
panel_10 = Panel(bridged_branched_sticks_full.dbg_root_axes)  # disabled
panel_11 = Panel(bridged_branched_sticks_full.dbg_bridge_geos)  # disabled
panel_12 = Panel(bridged_branched_sticks_full.dbg_branch_geos)  # disabled

number_slider_40 = Slider(2, range=0..10)  # disabled
list_pts_3 = RemoteReceiver(list_pts)  # disabled
points = PointList(Points=list_pts_3, Size=number_slider_40)  # disabled

preview_4 = CustomPreview(Geometry=geo_10, Material=bridged_branched_sticks_full.colors)  # disabled

remote_receiver = RemoteReceiver()  # disabled
panel_13 = Panel(remote_receiver)  # disabled

root_offset_normal = Slider(0, range=0..20)  # disabled
root_offset_planar = Slider(0, range=0..20)  # disabled

# ---- group: ConvertPlanes_to_EdgeFrames&Vectors
root_offset_normal_2 = Slider(0, range=0..1000)  # disabled
root_offset_planar_2 = Slider(0, range=0..1000)  # disabled
root_index_2 = Slider(0, range=0..5)  # disabled
convert_to_compasframes = Python3Script(
    way_planes=planes_that_rotate.way_planes,
    root_index=root_index_2,
    root_offset_planar=root_offset_planar_2,
    root_offset_normal=root_offset_normal_2)  # -> out, edge_lines, edge_frames, edge_vectors; inputs way_planes: list, root_offset_planar: Double; disabled
# ---------- convert_to_compasframes: Python ----------
# r: compas>=2.14.1

import sys, os, math
import Rhino.Geometry as rg

# ------------------------------------------------------------
# Load COMPAS + conversions
# ------------------------------------------------------------
path = ghenv.Component.OnPingDocument().FilePath
parentdir = os.path.dirname(path)
scripts_dir = os.path.join(parentdir, 'scripts')
sys.path.append(scripts_dir)

from compas.geometry import (
    Frame,
    Point,
    Vector,
    Line,
    Rotation,
    Translation,
)
from compas_rhino.conversions import plane_to_compas_frame


# ------------------------------------------------------------
# Helper: rotate a base frame (same as earlier)
# ------------------------------------------------------------
def reorient_frame_for_root(f, index):
    index = int(index)
    if index == 0:
        return f

    if index == 1:
        R = Rotation.from_axis_and_angle(f.xaxis, math.radians(180), point=f.point)
    elif index == 2:
        R = Rotation.from_axis_and_angle(f.xaxis, math.radians(90), point=f.point)
    elif index == 3:
        R = Rotation.from_axis_and_angle(f.xaxis, math.radians(-90), point=f.point)
    elif index == 4:
        R = Rotation.from_axis_and_angle(f.yaxis, math.radians(90), point=f.point)
    elif index == 5:
        R = Rotation.from_axis_and_angle(f.yaxis, math.radians(-90), point=f.point)
    else:
        return f

    f2 = Frame(f.point, f.xaxis, f.yaxis)
    f2.transform(R)
    return f2


# ------------------------------------------------------------
# Helper: planar + normal offsets
# ------------------------------------------------------------
def apply_offsets(f, planar, normal):
    if planar:
        move = f.xaxis.scaled(planar) + f.yaxis.scaled(planar)
        f.transform(Translation.from_vector(move))

    if normal:
        f.transform(Translation.from_vector(f.zaxis.scaled(normal)))

    return f


# ------------------------------------------------------------
# Helper: produce a stable orthonormal frame
#   with:
#       origin = p0
#       xaxis  = direction vector (unit)
# ------------------------------------------------------------
def orthonormal_frame_from_direction(origin, xaxis):
    """Return a stable Frame(origin, x, y) with guaranteed orthonormality."""

    x = xaxis.copy()
    x.unitize()

    # Choose any non-parallel "up" vector
    worldZ = Vector(0, 0, 1)
    worldY = Vector(0, 1, 0)
    up = worldZ if abs(x.dot(worldZ)) < 0.95 else worldY

    # Construct a stable z-axis
    z = x.cross(up)
    if z.length < 1e-6:      # rare fallback
        up = Vector(1, 0, 0)
        z = x.cross(up)
    z.unitize()

    # Construct y-axis
    y = z.cross(x)
    y.unitize()

    return Frame(origin, x, y)


# ------------------------------------------------------------
# 1) Convert GH planes to frames
# ------------------------------------------------------------
frame_list = []
for pl in way_planes:
    f = plane_to_compas_frame(pl)
    f = reorient_frame_for_root(f, root_index)
    f = apply_offsets(f, root_offset_planar, root_offset_normal)
    frame_list.append(f)

# Extract points
points = [f.point for f in frame_list]
N = len(points)


# ------------------------------------------------------------
# 2) Compute nearest-neighbor connections
# ------------------------------------------------------------
edges = set()

for i in range(N):
    p_i = points[i]
    best_j = None
    best_d = 1e9

    for j in range(N):
        if i == j:
            continue
        d = p_i.distance_to_point(points[j])
        if d < best_d:
            best_d = d
            best_j = j

    if best_j is not None:
        edges.add(tuple(sorted((i, best_j))))


# ------------------------------------------------------------
# 3) Build projected vectors + orthonormal frames
# ------------------------------------------------------------
edge_vectors = []
edge_frames  = []
edge_lines   = []

for i, j in edges:
    f0 = frame_list[i]
    p0 = points[i]
    p1 = points[j]

    # step 1 — compute raw direction
    v = Vector.from_start_end(p0, p1)

    # step 2 — project onto local tangent plane (remove normal component)
    v_proj = v - f0.zaxis.scaled(v.dot(f0.zaxis))
    if v_proj.length < 1e-6:
        v_proj = f0.xaxis.copy()
    v_proj.unitize()

    # Build stable orthonormal frame
    new_f = orthonormal_frame_from_direction(p0, v_proj)

    # Save outputs
    edge_vectors.append(v_proj)
    edge_frames.append(new_f)

    # preview line for GH
    A = rg.Point3d(p0.x, p0.y, p0.z)
    B = rg.Point3d(
        p0.x + v_proj.x * 50,
        p0.y + v_proj.y * 50,
        p0.z + v_proj.z * 50
    )
    edge_lines.append(rg.Line(A, B))


# ------------------------------------------------------------
# OUTPUTS
# ------------------------------------------------------------
# Provide these to downstream code
# ---------- end convert_to_compasframes ----------
geo_12 = Geometry(convert_to_compasframes.edge_lines)  # disabled

# ----
root_index_3 = Slider(0, range=0..5)  # disabled
panel_14 = Panel(convert_to_compasframes.edge_frames)  # disabled

# ---- group: Branching Sticks
growth_steps = Slider(1, range=0..4)  # disabled
offset_2 = Slider(0.8, range=0..1)  # disabled
face_index_2 = Slider(0, range=0..4)  # disabled
angle_2 = Slider(79.4, range=0..90)  # disabled
sticks_that_grow = Python3Script(
    edge_frames=convert_to_compasframes.edge_frames,
    edge_vectors=convert_to_compasframes.edge_vectors,
    NUM_GROWTH_STEPS=growth_steps,
    face_index=face_index_2,
    angle=angle_2,
    offset=offset_2)  # -> out, geometries; inputs edge_frames: list, edge_vectors: list, NUM_GROWTH_STEPS: Int32, face_index: Int32, angle: Double, offset: Double; disabled
# ---------- sticks_that_grow: Python ----------
# r: compas>=2.14.1
# venv: sticks

import sys, os
import Rhino.Geometry as rg

from compas_rhino import unload_modules
from compas_rhino.conversions import box_to_rhino
from compas.geometry import Line


# ------------------------------------------------------------
# Load your custom scripts
# ------------------------------------------------------------
path = ghenv.Component.OnPingDocument().FilePath
parentdir = os.path.dirname(path)
scripts_dir = os.path.join(parentdir, 'scripts')
sys.path.append(scripts_dir)

unload_modules("Sticks2")
unload_modules("stick_module")

from Sticks2 import Stick
from stick_module import BranchingModule


# ------------------------------------------------------------
# GH Inputs:
#
# edge_frames      : list of COMPAS Frames
# edge_vectors     : list of COMPAS Vectors (parallel)
# NUM_GROWTH_STEPS : int
# face_index       : int 0–3
# angle            : float (deg)
# ------------------------------------------------------------


# ------------------------------------------------------------
# Validate inputs
# ------------------------------------------------------------
if not edge_frames:
    raise Exception("edge_frames input is empty.")

if not edge_vectors:
    raise Exception("edge_vectors input is empty.")

if len(edge_frames) != len(edge_vectors):
    raise Exception("edge_frames and edge_vectors must have same length.")


# ------------------------------------------------------------
# Use Stick CLASS CONSTANTS
# ------------------------------------------------------------
STICK_LEN   = Stick.LENGTH
STICK_WIDTH = Stick.WIDTH
STICK_DEPTH = Stick.DEPTH


# ------------------------------------------------------------
# MAIN LOOP
# ------------------------------------------------------------
geometries = []
trees = []

for f, v in zip(edge_frames, edge_vectors):

    # ------------------------------------------------------------------
    # 1. Construct axis aligned with GH vector
    # ------------------------------------------------------------------
    origin = f.point
    endpt = origin + v.scaled(STICK_LEN)

    axis = Line(origin, endpt)

    # ------------------------------------------------------------------
    # 2. Create the root stick (main stick)
    # ------------------------------------------------------------------
    root_stick = Stick(
        axis=axis,
        length=STICK_LEN,
        width=STICK_WIDTH,
        depth=STICK_DEPTH
    )

    # Output main stick geometry
    geometries.append(box_to_rhino(root_stick.geometry))


    # ------------------------------------------------------------------
    # 3. Build branching tree starting from THIS root stick
    # ------------------------------------------------------------------
    tree = BranchingModule(
        root_stick=root_stick,
        stick_length=STICK_LEN,
        width=STICK_WIDTH,
        depth=STICK_DEPTH
    )

    # Grow branch
    for _ in range(NUM_GROWTH_STEPS):
        tree.grow_stick(
            from_stick_index=-1,
            face_index=face_index,
            angle=angle,
            offset=offset
        )


    # Output branch geometry
    for s in tree.sticks:
        geometries.append(box_to_rhino(s.geometry))

    trees.append(tree)


# Visualize
geometries = []
for t in trees:
    geomet = t.visualize()          
    geometries.extend(t.visualize())
# ---------- end sticks_that_grow ----------
compas_draw_3 = COMPASDraw(cg=sticks_that_grow.geometries)  # -> rg; disabled; same code as draw

# ---- group: DEBUG MODE
number_slider_41 = Slider(200, range=0..250)
geo_13 = Geometry([<surface referenced from the Rhino model> x8])
gen_rhplanes_2 = Python3Script(
    surface=geo_13,
    point_density=Slider(326, range=0..500),
    point_randomness=Slider(1, range=0..1),
    min_stick_length=number_slider_41)  # -> out, list_pts, rootplanes, plane_geos; inputs surface: Surface, point_density: Int32, point_randomness: Double, min_stick_length: Int32
# ---------- gen_rhplanes_2: Python ----------
import Rhino.Geometry as rg
import random

# -------------------------------------------------
# INPUT VALIDATION
# -------------------------------------------------

if surface is None or not isinstance(surface, rg.Surface):
    raise ValueError("Input 'surface' must be a Rhino.Geometry.Surface")

if point_density is None or point_density < 2:
    raise ValueError("sample_density must be >= 2")

if point_density is None or point_density < 1:
    point_density = 10

if point_randomness is None:
    point_randomness = 1.0

# -------------------------------------------------
# PARAMETERS
# -------------------------------------------------

min_spacing = 1.5 * min_stick_length
edge_offset = 0.4 * min_stick_length

# -------------------------------------------------
# UV GRID (CONTROLLED BY sample_density)
# -------------------------------------------------

u_dom = surface.Domain(0)
v_dom = surface.Domain(1)

u_len = u_dom.Length
v_len = v_dom.Length

# normalized buffer (edge inset)
u_buf = edge_offset / u_len if u_len > 0 else 0.0
v_buf = edge_offset / v_len if v_len > 0 else 0.0

u_count = int(point_density)
v_count = int(point_density)

uv_candidates = []

for i in range(u_count + 1):
    for j in range(v_count + 1):

        u = u_dom.T0 + u_len * (i / float(u_count))
        v = v_dom.T0 + v_len * (j / float(v_count))

        u_n = (u - u_dom.T0) / u_len
        v_n = (v - v_dom.T0) / v_len

        # trim away edges
        if u_n <= u_buf or u_n >= 1.0 - u_buf:
            continue
        if v_n <= v_buf or v_n >= 1.0 - v_buf:
            continue

        uv_candidates.append((u, v))

# -------------------------------------------------
# RANDOMIZED SAMPLING (SOFT FILTERS)
# -------------------------------------------------

random.shuffle(uv_candidates)

accepted_pts = []
accepted_planes = []
rejected_pts = []

for (u, v) in uv_candidates:

    if len(accepted_pts) >= point_density:
        break

    # randomness gate (does NOT kill determinism entirely)
    if random.random() > point_randomness:
        rejected_pts.append(surface.PointAt(u, v))
        continue

    pt = surface.PointAt(u, v)
    normal = surface.NormalAt(u, v)

    if not normal.IsValid or normal.Length < 1e-6:
        rejected_pts.append(pt)
        continue

    # soft spacing penalty
    too_close = False
    for p in accepted_pts:
        if pt.DistanceTo(p) < min_spacing * random.uniform(0.6, 1.2):
            too_close = True
            break

    if too_close:
        rejected_pts.append(pt)
        continue

    plane = rg.Plane(pt, normal)

    accepted_pts.append(pt)
    accepted_planes.append(plane)

# -------------------------------------------------
# PLANE AXIS PREVIEW
# -------------------------------------------------

plane_geos = []
axis_len = 0.25 * min_stick_length

for pl in accepted_planes:
    o = pl.Origin
    plane_geos.append(rg.Line(o, o + pl.XAxis * axis_len))
    plane_geos.append(rg.Line(o, o + pl.YAxis * axis_len))
    plane_geos.append(rg.Line(o, o + pl.ZAxis * axis_len))

# -------------------------------------------------
# OUTPUTS
# -------------------------------------------------

list_pts = accepted_pts
rootplanes = accepted_planes
plane_geos = plane_geos
rejected_pts = rejected_pts
# ---------- end gen_rhplanes_2 ----------
rhplanes_to_frames_2 = Python3Script(rootplanes=flatten(gen_rhplanes_2.rootplanes), source_surfaces=geo_13, stick_length=number_slider_41)  # -> out, paired_root_frames, paired_origins, family_labels_output, growth_directions_rg, direction_lines, qa_visual_tags, qa_visual_roots; inputs rootplanes: list of Plane, source_surfaces: list of Surface, stick_length: Int32
# ---------- rhplanes_to_frames_2: Python ----------
import Rhino.Geometry as rg
from compas.geometry import Frame, Point, Vector, distance_point_point
from collections import defaultdict


# Validate Inputs

if not source_surfaces or not rootplanes:
    raise ValueError("Missing input surfaces or planes.")


# Assign each plane to its closest surface (perpendicular distance)

plane_surface_ids = []
for i, pl in enumerate(rootplanes):
    pt = pl.Origin
    closest_sid = None
    closest_dist = float("inf")

    for sid, surf in enumerate(source_surfaces):
        result, surf_plane = surf.TryGetPlane()
        if not result:
            continue
        d = abs(surf_plane.DistanceTo(pt))
        if d < closest_dist:
            closest_dist = d
            closest_sid = sid

    plane_surface_ids.append(closest_sid)


# Assign families alternating *within* each surface group

surface_plane_indices = defaultdict(list)
for idx, sid in enumerate(plane_surface_ids):
    surface_plane_indices[sid].append(idx)

family_labels = [None] * len(rootplanes)
for sid, indices in surface_plane_indices.items():
    for j, i in enumerate(indices):
        family_labels[i] = "Y" if j % 2 == 0 else "Z"


# Surface type definitions

surface_types = {
    0: "outer",
    1: "outer",
    2: "inner",
    3: "inner"
}


# Organize frames into structured dictionary

structured = {}
for i, pl in enumerate(rootplanes):
    if not isinstance(pl, rg.Plane):
        continue

    origin = pl.Origin
    xaxis = pl.XAxis
    yaxis = pl.YAxis

    frame = Frame(
        Point(origin.X, origin.Y, origin.Z),
        Vector(xaxis.X, xaxis.Y, xaxis.Z),
        Vector(yaxis.X, yaxis.Y, yaxis.Z)
    )

    sid = plane_surface_ids[i]
    fam = family_labels[i]
    surface_type = surface_types.get(sid, "outer")

    key = (sid, fam)
    if key not in structured:
        structured[key] = {
            "surface_id": sid,
            "family": fam,
            "type": surface_type,
            "frames": []
        }
    structured[key]["frames"].append(frame)


# Pairing: root → closest frame in same group and correct direction

paired = []
direction_lines = []
qa_dots = []
qa_tags = []

for key, group in structured.items():
    frames = group["frames"]
    surface_type = group["type"]
    sid = group["surface_id"]
    fam = group["family"]

    if len(frames) < 2:
        continue

    sorted_frames = sorted(frames, key=lambda f: f.point.z)

    for i, root in enumerate(sorted_frames):
        root_pt = root.point
        closest = None
        min_dist = float("inf")

        for f in frames:
            if f is root:
                continue

            dz = f.point.z - root_pt.z
            if surface_type == "outer" and dz <= 0:
                continue
            if surface_type == "inner" and dz >= 0:
                continue

            dist = distance_point_point(root_pt, f.point)
            if dist < min_dist:
                closest = f
                min_dist = dist

        if closest:
            direction = closest.point - root_pt
            normal = root.normal
            direction_proj = (direction - direction.dot(normal) * normal).unitized()

            xaxis = direction_proj
            yaxis = normal.cross(xaxis).unitized()
            new_frame = Frame(root_pt, xaxis, yaxis)

            paired.append((new_frame, direction_proj))

            # QA tag for root
            dot_text = f"ROOT | SID {sid} | L{i+1}"
            qa_dots.append(rg.Point3d(root_pt.x, root_pt.y, root_pt.z))
            qa_tags.append(rg.TextDot(dot_text, rg.Point3d(root_pt.x, root_pt.y, root_pt.z)))


# Output for Grasshopper

paired_root_frames = [p[0] for p in paired]
growth_directions = [p[1] for p in paired]
growth_directions_rg = [rg.Vector3d(v.x, v.y, v.z) for v in growth_directions]
paired_origins = [rg.Point3d(f.point.x, f.point.y, f.point.z) for f in paired_root_frames]

# Outputs
qa_visual_dots = qa_dots
qa_visual_tags = qa_tags
family_labels_output = family_labels
# ---------- end rhplanes_to_frames_2 ----------
panel_15 = Panel(gen_rhplanes_2.list_pts)
panel_16 = Panel(rhplanes_to_frames_2.family_labels_output)
draw_5 = COMPASDraw(cg=rhplanes_to_frames_2.paired_root_frames)  # -> rg; same code as draw
number_slider_42 = Slider(100, range=0..500)
number_slider_43 = Slider(1500, range=0..1500)
number_slider_44 = Slider(0, range=0..100)
list_2 = ValueList({"A", "B", "C"}, selected="A")
branching_2 = Python3Script(
    surface=geo_13,
    paired_root_frames=rhplanes_to_frames_2.paired_root_frames,
    family_labels_output=rhplanes_to_frames_2.family_labels_output,
    direction_lines=rhplanes_to_frames_2.direction_lines,
    growth_directions_rg=rhplanes_to_frames_2.growth_directions_rg,
    stick_angle=Slider(60, range=0..90),
    offset=Slider(15, range=0..200))  # -> out, parent_frames, geometries, layered_sticks, qa_collision_report; inputs surface: Surface, paired_root_frames: list, family_labels_output: String, direction_lines: list, growth_directions_rg: list, stick_angle: Int32, offset: Int32
# ---------- branching_2: Python ----------
import sys
import os
import math
import Rhino.Geometry as rg

# -------------------------------------------------
# SETUP
# -------------------------------------------------

path = ghenv.Component.OnPingDocument().FilePath
parentdir = os.path.dirname(path)
scripts_dir = os.path.join(parentdir, "scripts")
if scripts_dir not in sys.path:
    sys.path.append(scripts_dir)

from compas.geometry import Frame, Vector
from compas_rhino import unload_modules
from branch import BranchingModule

unload_modules("branch")

# -------------------------------------------------
# INPUT VALIDATION
# -------------------------------------------------

if not paired_root_frames or not growth_directions_rg:
    raise ValueError("Missing inputs: paired_root_frames or growth_directions_rg")

if not family_labels_output:
    family_labels_output = ["Y"]

if len(family_labels_output) == 1:
    family_labels_output = [family_labels_output[0]] * len(paired_root_frames)

# Preserve Y / Z families
family_labels_output = ["Y" if i % 2 == 0 else "Z"
                        for i in range(len(paired_root_frames))]

# -------------------------------------------------
# CONSTANTS
# -------------------------------------------------

stick_length = 150.0
stick_width  = 13.0
stick_depth  = 13.0
stick_angle  = stick_angle if "stick_angle" in globals() else 35.0
offset       = offset if "offset" in globals() else 20.0

ANGLE_STEPS = [0, -15, -30, -45, -60, -75, -90]

# -------------------------------------------------
# GROUP BY HEIGHT
# -------------------------------------------------

def group_by_height(data, h=125.0):
    layers, current = [], []
    z0 = data[0][0].point.z
    for item in data:
        if item[0].point.z - z0 < h:
            current.append(item)
        else:
            layers.append(current)
            current = [item]
            z0 = item[0].point.z
    if current:
        layers.append(current)
    return layers

# -------------------------------------------------
# PURE GROWTH LOOP (FACE-SAFE)
# -------------------------------------------------

def build_branch_group(group, face_index, collision_pool):
    sticks, geoms, reports = [], [], []

    for i, (root_frame, vec_rg, label) in enumerate(group):

        # Growth direction (COMPAS)
        xaxis = Vector(vec_rg.X, vec_rg.Y, vec_rg.Z).unitized()

        # -------------------------------------------------
        # 🔧 CRITICAL FIX — RESTORE FACE SEPARATION
        # -------------------------------------------------
        # Rebuild frame so:
        #   x = growth direction
        #   y = face separation axis
        # This guarantees face_index maps to a real face
        # -------------------------------------------------

        ref = root_frame.zaxis if abs(xaxis.dot(root_frame.zaxis)) < 0.95 else root_frame.yaxis
        yaxis = ref.cross(xaxis).unitized()
        zaxis = xaxis.cross(yaxis).unitized()

        base_point = root_frame.point - xaxis * (0.1 * stick_length)
        base_frame = Frame(base_point, xaxis, yaxis)

        best_tree = None
        best_energy = float("inf")

        for a in ANGLE_STEPS:
            f = base_frame.copy()
            f.rotate(math.radians(a), zaxis)

            tree = BranchingModule(
                f,
                stick_length=stick_length,
                width=stick_width,
                depth=stick_depth
            )

            tree.grow_stick(
                from_stick_index=0,
                face_index=face_index,
                angle=stick_angle,
                offset=offset
            )

            if len(tree.sticks) < 2:
                continue

            # No collision changes here (intentionally untouched)
            best_tree = tree
            break

        if best_tree:
            for s in best_tree.sticks:
                sticks.append(s)
                geoms.append(s.geometry)
                collision_pool.append(s)

            reports.append({
                "index": i,
                "face_index": face_index,
                "placed": True
            })

    return {
        "sticks": sticks,
        "geometries": geoms,
        "report": reports
    }

# -------------------------------------------------
# MAIN
# -------------------------------------------------

paired = list(zip(paired_root_frames, growth_directions_rg, family_labels_output))
paired.sort(key=lambda p: p[0].point.z)
layers = group_by_height(paired)

all_geom = []
layered = []
collision_pool = []

for layer in layers:
    group_Y = [i for i in layer if i[2] == "Y"]
    group_Z = [i for i in layer if i[2] == "Z"]

    data_Y = build_branch_group(group_Y, face_index=3, collision_pool=collision_pool)
    data_Z = build_branch_group(group_Z, face_index=2, collision_pool=collision_pool)

    layered.append({"Y": data_Y, "Z": data_Z})
    all_geom.extend(data_Y["geometries"])
    all_geom.extend(data_Z["geometries"])

# -------------------------------------------------
# OUTPUTS
# -------------------------------------------------

geometries = all_geom
layered_sticks = layered
qa_collision_report = layered
# ---------- end branching_2 ----------
bridging_2 = Python3Script(
    layered_sticks=branching_2.layered_sticks,
    mode=list_2,
    max_distance=number_slider_43,
    density_variation=number_slider_42,
    angle=number_slider_44)  # -> out, bridge_mode_A, bridge_mode_B, bridge_mode_C, gh_ghost_A, gh_ghost_B, gh_ghost_C, bridge_frames; inputs layered_sticks: list, mode: String, angle: String; disabled
# ---------- bridging_2: Python ----------
import Rhino.Geometry as rg
import math

# ======================================================
# PARAMETERS (LOCKED / SAFE DEFAULTS)
# ======================================================
BOX_W = 13.0
BOX_D = 13.0
OVERLAP = 0.05

MAX_BEND_DEG = angle if angle is not None else 150.0
max_distance = max_distance if max_distance is not None else 275.0
mode = mode if mode is not None else "ALL"

layered_sticks = layered_sticks if layered_sticks is not None else []

# ======================================================
# OUTPUT BUFFERS
# ======================================================
bridge_mode_A = []
bridge_mode_B = []
bridge_mode_C = []

gh_ghost_A = []
gh_ghost_B = []
gh_ghost_C = []

bridge_frames = []

# ======================================================
# BASIC HELPERS
# ======================================================
def unit(v):
    if v is None or v.Length < 1e-6:
        return None
    v.Unitize()
    return v

def angle_deg(v1, v2):
    return math.degrees(rg.Vector3d.VectorAngle(v1, v2))

def make_box(Fa, Fb):
    v = Fb.Origin - Fa.Origin
    L = v.Length
    if L < 1e-6:
        return None

    x = unit(rg.Vector3d(v))
    if x is None:
        return None

    y = rg.Vector3d(Fa.YAxis)
    y = y - x * (x * y)
    if y.Length < 1e-6:
        y = rg.Vector3d(Fa.ZAxis)   # ← fallback ONLY
        y = y - x * (x * y)
    y = unit(y)
    if y is None:
        return None


    pl = rg.Plane(Fa.Origin, x, y)
    box = rg.Box(
        pl,
        rg.Interval(0, L),
        rg.Interval(-BOX_W/2, BOX_W/2),
        rg.Interval(-BOX_D/2, BOX_D/2)
    )
    return box.ToBrep()

# ======================================================
# BEND POINT (POINT ONLY)
# ======================================================
def compute_bend(S, T, surf_plane):
    chord = T - S
    d = chord.Length
    if d < 1e-6:
        return None

    u = unit(rg.Vector3d(chord))
    n = unit(rg.Vector3d(surf_plane.ZAxis))
    v = unit(rg.Vector3d.CrossProduct(n, u))

    if u is None or n is None or v is None:
        return None

    M = rg.Point3d(
        0.5*(S.X+T.X),
        0.5*(S.Y+T.Y),
        0.5*(S.Z+T.Z)
    )

    h = (d*0.5) / math.tan(math.radians(MAX_BEND_DEG/2))

    for sign in (1.0, -1.0):
        B = M + v * (sign * h)
        a = angle_deg(S-B, T-B)
        if a <= MAX_BEND_DEG:
            return B

    return None

# ======================================================
# DIAGNOSTIC HEADER
# ======================================================
print("BRIDGE DEBUG")
print("Layers:", len(layered_sticks))
print("Mode:", mode)
print("MaxDist:", max_distance)
print("MaxBend:", MAX_BEND_DEG)

# ======================================================
# MODE A — FIXED FRAME SELECTION
# ======================================================
for layer in layered_sticks:

    group_Y = layer.get("Y", {})
    group_Z = layer.get("Z", {})

    sticks_Y = group_Y.get("sticks", [])
    sticks_Z = group_Z.get("sticks", [])

    if not sticks_Y or not sticks_Z:
        continue

    # ---- LAST CHILD MID FRAMES ----
    sy = sticks_Y[-1]
    sz = sticks_Z[-1]

    if not isinstance(sy.geometry, rg.Box):
        continue
    if not isinstance(sz.geometry, rg.Box):
        continue

    plY = sy.geometry.Plane
    plZ = sz.geometry.Plane

    # SAME SURFACE ONLY
    if abs(plY.DistanceTo(plZ.Origin)) > 1.0:
        continue

    def mid_frame(stick):
        g = stick.geometry
        pl = g.Plane
        xmid = 0.5 * (g.X.T0 + g.X.T1)
        origin = pl.Origin + pl.XAxis * xmid
        return rg.Plane(origin, pl.XAxis, pl.YAxis)

    Fs = mid_frame(sy)
    Ft = mid_frame(sz)

    gh_ghost_A.append(rg.Line(Fs.Origin, Ft.Origin))

    d = Fs.Origin.DistanceTo(Ft.Origin)

    if d <= max_distance:
        brep = make_box(Fs, Ft)
        if brep:
            bridge_mode_A.append(brep)
            bridge_frames.extend([Fs, Ft])
    else:
        Bp = compute_bend(Fs.Origin, Ft.Origin, plY)
        if not Bp:
            continue

        Fb = rg.Plane(Bp, Fs.XAxis, Fs.YAxis)

        for F0, F1 in ((Fs, Fb), (Fb, Ft)):
            brep = make_box(F0, F1)
            if brep:
                bridge_mode_A.append(brep)
                bridge_frames.extend([F0, F1])

print("A:", len(bridge_mode_A), "B:", len(bridge_mode_B), "C:", len(bridge_mode_C))
# ---------- end bridging_2 ----------
draw_6 = COMPASDraw(cg=branching_2.geometries)  # -> rg; disabled; same code as draw

# ----
geo_14 = Geometry(gen_rhplanes_2.list_pts)
geo_15 = Geometry(rhplanes_to_frames_2.qa_visual_roots)
preview_5 = CustomPreview(Geometry=gen_rhplanes_2.plane_geos, Material=ColourSwatch(SwatchColor=RGB(232, 241, 30)))
preview_6 = CustomPreview(Geometry=rhplanes_to_frames_2.direction_lines, Material=swatch)
tag = TextTag(Text=rhplanes_to_frames_2.family_labels_output, Colour=swatch)
bridging_3 = Python3Script(
    layered_sticks=branching_2.layered_sticks,
    mode=list_2,
    max_distance=number_slider_43,
    density_variation=number_slider_42,
    angle=number_slider_44)  # -> out, bridge_mode_A, bridge_mode_B, bridge_mode_C, gh_ghost_A, gh_ghost_B, gh_ghost_C, bridge_frames; inputs layered_sticks: list, mode: String, angle: String
# ---------- bridging_3: Python ----------
import traceback
import sys
import os
import math
import Rhino.Geometry as rg
from compas_rhino import unload_modules

# --------------------------------------------
# SETUP PATHS
# --------------------------------------------
path = ghenv.Component.OnPingDocument().FilePath
parentdir = os.path.dirname(path) if path else ""
scripts_dir = os.path.join(parentdir, "scripts") if parentdir else ""
if scripts_dir and scripts_dir not in sys.path:
    sys.path.append(scripts_dir)

unload_modules("Sticks")

try:
    from Sticks import Stick
except Exception:
    Stick = None

print("\n=== BRIDGE PAIRWISE DEBUG START ===")

try:
    # --------------------------------------------
    # PARAMETERS (UNCHANGED)
    # --------------------------------------------
    BOX_WIDTH = 13.0
    BOX_DEPTH = 13.0

    BRIDGE_STICK_LENGTH = 275.0
    TWO_SEG_THRESHOLD = 0.8 * BRIDGE_STICK_LENGTH
    MAX_BEND_ANGLE_DEG = 150.0

    OVERLAP_RATIO = 0.05

    # --------------------------------------------
    # DATA TREE NORMALIZATION
    # --------------------------------------------
    layered_groups = layered_sticks if layered_sticks is not None else []

    try:
        from ghpythonlib import treehelpers
        if hasattr(layered_groups, "BranchCount"):
            layered_groups = treehelpers.tree_to_list(layered_groups)
    except Exception:
        pass

    if isinstance(layered_groups, list) and layered_groups:
        if isinstance(layered_groups[0], list):
            if len(layered_groups[0]) == 1 and isinstance(layered_groups[0][0], dict):
                layered_groups = [b[0] for b in layered_groups]

    # --------------------------------------------
    # FRAME CONSTRUCTION
    # --------------------------------------------
    def stick_mid_face_frame(stick, sign):
        g = stick.geometry
        pl = g.Plane
        xmid = 0.5 * (g.X.T0 + g.X.T1)
        y = g.Y.T1 if sign > 0 else g.Y.T0
        origin = pl.Origin + pl.XAxis * xmid + pl.YAxis * y
        return rg.Plane(origin, pl.XAxis, pl.YAxis)

    def stick_end_face_frame(stick, sign):
        g = stick.geometry
        pl = g.Plane
        x = g.X.T1 if sign > 0 else g.X.T0
        ymid = 0.5 * (g.Y.T0 + g.Y.T1)
        origin = pl.Origin + pl.XAxis * x + pl.YAxis * ymid
        return rg.Plane(origin, pl.XAxis, pl.YAxis)

    # --------------------------------------------
    # FACE & OFFSET HELPERS
    # --------------------------------------------
    def apply_face_choice(frame, use_Z, face_sign):
        X = rg.Vector3d(frame.XAxis); X.Unitize()
        Y = rg.Vector3d(frame.ZAxis if use_Z else frame.YAxis) * face_sign
        Y.Unitize()
        Z = rg.Vector3d.CrossProduct(X, Y); Z.Unitize()
        Y = rg.Vector3d.CrossProduct(Z, X); Y.Unitize()
        return rg.Plane(frame.Origin, X, Y)

    def apply_x_overlap(frame, sign):
        o = rg.Point3d(frame.Origin)
        x = rg.Vector3d(frame.XAxis); x.Unitize()
        o += x * sign * (OVERLAP_RATIO * BRIDGE_STICK_LENGTH)
        return rg.Plane(o, frame.XAxis, frame.YAxis)

    # --------------------------------------------
    # BEND GEOMETRY (UNCHANGED)
    # --------------------------------------------
    def bend_angle_at(B, S, T):
        v1 = rg.Vector3d(S - B)
        v2 = rg.Vector3d(T - B)
        v1.Unitize(); v2.Unitize()
        return math.degrees(rg.Vector3d.VectorAngle(v1, v2))

    def compute_bend_point(S, T, surface_plane):
        chord = rg.Vector3d(T - S)
        d = chord.Length
        if d <= 1e-9:
            return None
        u = rg.Vector3d(chord); u.Unitize()
        n = rg.Vector3d(surface_plane.ZAxis); n.Unitize()
        v = rg.Vector3d.CrossProduct(n, u); v.Unitize()
        M = rg.Point3d(
            0.5 * (S.X + T.X),
            0.5 * (S.Y + T.Y),
            0.5 * (S.Z + T.Z)
        )
        h = (d * 0.5) / math.tan(math.radians(MAX_BEND_ANGLE_DEG * 0.5))
        for s in (+1, -1):
            B = M + v * h * s
            if bend_angle_at(B, S, T) <= MAX_BEND_ANGLE_DEG:
                return B
        return None

    # --------------------------------------------
    # BRIDGE BOX
    # --------------------------------------------
    def make_bridge_box_from_frames(Fa, Fb):
        v = Fb.Origin - Fa.Origin
        if v.Length <= 1e-6:
            return None
        x = rg.Vector3d(v); x.Unitize()
        z = rg.Vector3d(Fb.ZAxis)
        y = rg.Vector3d.CrossProduct(z, x); y.Unitize()
        pl = rg.Plane(Fa.Origin, x, y)
        box = rg.Box(
            pl,
            rg.Interval(0, v.Length),
            rg.Interval(-BOX_WIDTH * 0.5, BOX_WIDTH * 0.5),
            rg.Interval(-BOX_DEPTH * 0.5, BOX_DEPTH * 0.5)
        )
        return box.ToBrep()

    # =================================================
    # MODE A — MID (LAST) → MID (LAST CHILD)
    # =================================================
    bridges_A = []

    for layer in layered_groups:
        Y = layer.get("Y", {}).get("sticks", [])
        Z = layer.get("Z", {}).get("sticks", [])
        if not Y or not Z:
            continue

        F_S = stick_mid_face_frame(Y[-1], +1)
        F_T = stick_mid_face_frame(Z[-1], -1)

        F_S = apply_face_choice(F_S, False, +1)
        F_T = apply_face_choice(F_T, True, -1)

        F_S = apply_x_overlap(F_S, +1)
        F_T = apply_x_overlap(F_T, -1)

        d = F_S.Origin.DistanceTo(F_T.Origin)
        if d <= TWO_SEG_THRESHOLD:
            b = make_bridge_box_from_frames(F_S, F_T)
            if b: bridges_A.append(b)
        else:
            B = compute_bend_point(F_S.Origin, F_T.Origin, Y[-1].geometry.Plane)
            if not B: continue
            F_B = rg.Plane(B, Y[-1].geometry.Plane.XAxis, Y[-1].geometry.Plane.YAxis)
            bridges_A += filter(None, [
                make_bridge_box_from_frames(F_S, F_B),
                make_bridge_box_from_frames(F_B, F_T)
            ])

    bridge_mode_A = bridges_A

    # =================================================
    # MODE B — END (LAST CHILD) → MID (INITIAL, REVERSED)
    # =================================================
    bridges_B = []

    for layer in layered_groups:
        Y = layer.get("Y", {}).get("sticks", [])
        Z = layer.get("Z", {}).get("sticks", [])
        if not Y or not Z:
            continue

        F_S = stick_end_face_frame(Z[-1], +1)
        F_T = stick_mid_face_frame(Y[0], -1)

        F_S = apply_face_choice(F_S, True, +1)
        F_T = apply_face_choice(F_T, False, -1)

        F_S = apply_x_overlap(F_S, +1)
        F_T = apply_x_overlap(F_T, -1)

        d = F_S.Origin.DistanceTo(F_T.Origin)
        if d <= TWO_SEG_THRESHOLD:
            b = make_bridge_box_from_frames(F_S, F_T)
            if b: bridges_B.append(b)
        else:
            B = compute_bend_point(F_S.Origin, F_T.Origin, Z[-1].geometry.Plane)
            if not B: continue
            F_B = rg.Plane(B, Z[-1].geometry.Plane.XAxis, Z[-1].geometry.Plane.YAxis)
            bridges_B += filter(None, [
                make_bridge_box_from_frames(F_S, F_B),
                make_bridge_box_from_frames(F_B, F_T)
            ])

    bridge_mode_B = bridges_B

    # =================================================
    # MODE C — MID (2ND LAST) → MID (2ND LAST, ADJACENT)
    # =================================================
    bridges_C = []

    for layer in layered_groups:
        Y = layer.get("Y", {}).get("sticks", [])
        Z = layer.get("Z", {}).get("sticks", [])
        if len(Y) < 2 or len(Z) < 2:
            continue

        F_S = stick_mid_face_frame(Y[-2], +1)
        F_T = stick_mid_face_frame(Z[-2], +1)

        n1 = rg.Vector3d(F_S.YAxis); n1.Unitize()
        n2 = rg.Vector3d(F_T.YAxis); n2.Unitize()
        if abs(rg.Vector3d.Multiply(n1, n2)) > 0.2:
            continue

        F_S = apply_face_choice(F_S, False, +1)
        F_T = apply_face_choice(F_T, True, -1)

        F_S = apply_x_overlap(F_S, +1)
        F_T = apply_x_overlap(F_T, -1)

        d = F_S.Origin.DistanceTo(F_T.Origin)
        if d <= TWO_SEG_THRESHOLD:
            b = make_bridge_box_from_frames(F_S, F_T)
            if b: bridges_C.append(b)
        else:
            B = compute_bend_point(F_S.Origin, F_T.Origin, Y[-2].geometry.Plane)
            if not B: continue
            F_B = rg.Plane(B, Y[-2].geometry.Plane.XAxis, Y[-2].geometry.Plane.YAxis)
            bridges_C += filter(None, [
                make_bridge_box_from_frames(F_S, F_B),
                make_bridge_box_from_frames(F_B, F_T)
            ])

    bridge_mode_C = bridges_C

except Exception:
    print(traceback.format_exc())
    bridge_mode_A = bridge_mode_B = bridge_mode_C = []
# ---------- end bridging_3 ----------
preview_7 = CustomPreview(Geometry=branching_2.geometries, Material=ColourSwatch(SwatchColor=RGB(232, 140, 25)))
preview_8 = CustomPreview(Geometry=bridging_3.bridge_mode_A, Material=ColourSwatch(SwatchColor=RGB(217, 62, 189)))
preview_9 = CustomPreview(Geometry=bridging_3.bridge_mode_B, Material=ColourSwatch(SwatchColor=RGB(115, 133, 187)))

# ---- group: DEBUG MODE (continued)
panel_17 = Panel(bridging_3.bridge_mode_A)

# ----
preview_10 = CustomPreview(Geometry=branching_2.qa_collision_report, Material=ColourSwatch(SwatchColor=RGB(244, 0, 25)))
preview_11 = CustomPreview(Geometry=bridging_3.bridge_mode_C, Material=ColourSwatch(SwatchColor=RGB(42, 205, 189)))
