# Grasshopper definition ae396e75-a5b8-0ef3-d407-1103749dbaf8.gh (Grasshopper 1.0.8)
# plug-ins: Human, Weaverbird

pt = ConstructPoint(XCoordinate=0, YCoordinate=0, ZCoordinate=0)
number_slider = Slider(150, range=0..1000)

# ---- group: Generate Base Frames
# Global Constraints
py3 = Python3Script(origin=pt, legs=Slider(3, range=0..10), r=number_slider, incline=Slider(-8, range=-90..90))  # -> out, plns_out; inputs origin: Point3d, legs: Int32, r: Double, incline: Double
# ---------- py3: Python ----------
import Rhino.Geometry as rg
import math


plns = []
for i in range(legs):
    theta = 2 * math.pi * (i / legs)
    x = origin.X + r * math.cos(theta)
    y = origin.Y + r * math.sin(theta)
    pt = rg.Point3d(x, y, 0)

    pln = rg.Plane(pt, rg.Vector3d.ZAxis)
    pln.Rotate(theta, rg.Vector3d.ZAxis)
    pln.Rotate(-math.pi / 2, pln.YAxis)
    pln.Rotate(math.radians(incline), pln.YAxis)
    plns.append(pln)

plns_out = plns
# ---------- end py3 ----------

# ---- group: Generate Boundary Polygon
cluster = Cluster_2(
    G=pt,
    F="-10",
    A=number_slider,
    B=Slider(28, range=0..100),
    S=Slider(12, range=0..20),
    D=Slider(262, range=0..1000),
    F_2=Slider(1200, range=0..10000))  # -> G_2, P, G_3, X

# ---- group: BASEPLATES_APPEND_SCRIPT
pln = Plane(PlaneXY(857, -453, 8.5))
pt_2 = Point(<point referenced from the Rhino model>)
geo = Geometry(<brep referenced from the Rhino model>)
geo_2 = Geometry(<curve referenced from the Rhino model>)
geo_3 = Geometry(<brep referenced from the Rhino model>)
geo_4 = Geometry(<brep referenced from the Rhino model>)
py3_2 = Python3Script(planes=py3.plns_out, axis="Y", angle_deg=Slider(90, range=0..90))  # -> out, rotated_planes; inputs planes: list of Plane, axis: String
# ---------- py3_2: Python ----------
"""Rotate planes around their local X or Y axis
Inputs:
    planes: List of Planes
    axis: 'X' or 'Y' - axis of rotation (local to the plane)
    angle_deg: Rotation angle in degrees
Output:
    rotated_planes: List of rotated planes
"""

import Rhino.Geometry as rg
import math

rotated_planes = []

angle_rad = math.radians(angle_deg)

for plane in planes:
    origin = plane.Origin

    if axis.upper() == "X":
        rot_axis = plane.XAxis
    elif axis.upper() == "Y":
        rot_axis = plane.YAxis
    else:
        raise ValueError("Axis must be 'X' or 'Y'")

    rot_transform = rg.Transform.Rotation(angle_rad, rot_axis, origin)

    new_plane = rg.Plane(plane)
    new_plane.Transform(rot_transform)
    rotated_planes.append(new_plane)
# ---------- end py3_2 ----------
py3_3 = Python3Script(
    pickup_point=pt_2,
    world_plane=pln,
    target_plane=py3_2.rotated_planes,
    top_unit=geo,
    hinge_axis_line=geo_2,
    hinge_body=geo_3,
    baseplate=geo_4,
    face_index="5",
    show_frames=Toggle(True))  # -> out, output_top, output_hinge, output_base, previews; inputs pickup_point: Point3d, world_plane: Plane, target_plane: list of Plane, top_unit: Brep, hinge_axis_line: Line, hinge_body: Brep, baseplate: Brep, face_index: Int32, show_frames: Boolean
# ---------- py3_3: Python ----------
import Rhino.Geometry as rg
import math

# ------------------ INPUTS ------------------
# pickup_point: Point3d 
# world_plane: Plane 
# target_plane: list of Planes
# top_unit, hinge_body, baseplate: Breps
# hinge_axis_line: Line 
# show_frames: bool

# ------------------ OUTPUTS ------------------
output_top = []
output_hinge = []
output_base = []
previews = []

# ------------------ SOURCE PLANE ------------------
guide_z = rg.Vector3d(0, 0, 1)
guide_x = rg.Vector3d(1, 0, 0)
guide_y = rg.Vector3d.CrossProduct(guide_z, guide_x)
source_plane = rg.Plane(pickup_point, guide_x, guide_y)

if show_frames:
    previews.append(rg.PlaneSurface(source_plane, rg.Interval(-25, 25), rg.Interval(-25, 25)))

# ------------------ TARGET TRANSFORMATIONS ------------------
for tp in target_plane:
    
    # 1. Transform from source → target plane
    xform = rg.Transform.PlaneToPlane(source_plane, tp)

    # 2. Duplicate and transform breps
    top_copy = top_unit.Duplicate()
    hinge_copy = hinge_body.Duplicate()
    base_copy = baseplate.Duplicate()

    top_copy.Transform(xform)
    hinge_copy.Transform(xform)
    base_copy.Transform(xform)

    # 3. Transform hinge axis line
    local_hinge = rg.Line(hinge_axis_line.From, hinge_axis_line.To)
    local_hinge.Transform(xform)

    # 4. Define local baseplane (centered at hinge axis midpoint)
    hinge_center = local_hinge.PointAt(0.5)
    axis_dir = local_hinge.Direction
    axis_dir.Unitize()

    local_y = rg.Vector3d.CrossProduct(tp.ZAxis, axis_dir)
    local_y.Unitize()
    local_base_plane = rg.Plane(hinge_center, axis_dir, local_y)

    # 5. Calculate angle from local Z to world Z
    local_z = local_base_plane.ZAxis
    world_z = rg.Vector3d(0, 0, 1)

    angle = rg.Vector3d.VectorAngle(local_z, world_z)
    
    # Determine rotation sign using cross + dot product
    cross = rg.Vector3d.CrossProduct(local_z, world_z)
    sign = rg.Vector3d.Multiply(cross, local_base_plane.XAxis)
    if sign < 0:
        angle *= -1

    # 6. Rotate baseplate about local hinge axis
    rot = rg.Transform.Rotation(angle, axis_dir, hinge_center)
    base_copy.Transform(rot)

    # 7. Store outputs
    output_top.append(top_copy)
    output_hinge.append(hinge_copy)
    output_base.append(base_copy)

    # ------------------ DEBUG VISUALS ------------------
    if show_frames:
        previews.append(rg.PlaneSurface(tp, rg.Interval(-25, 25), rg.Interval(-25, 25)))                   # Target plane
        previews.append(local_hinge)                                                                       # Axis line
        world_x = rg.Vector3d(1, 0, 0)
        world_y = rg.Vector3d(0, 1, 0)
        fixed_world_plane = rg.Plane(hinge_center, world_x, world_y)
        previews.append(rg.PlaneSurface(fixed_world_plane, rg.Interval(-25, 25), rg.Interval(-25, 25)))

        # Local Z axis (green)
        previews.append(rg.Line(hinge_center, hinge_center + local_base_plane.ZAxis * 30))

        # World Z axis from hinge center (cyan)
        true_world_z = rg.Vector3d(0, 0, 1)
        previews.append(rg.Line(hinge_center, hinge_center + true_world_z * 50))
# ---------- end py3_3 ----------
preview = CustomPreview(Geometry=py3_2.rotated_planes, Material=ColourSwatch(SwatchColor=RGB(237, 160, 255)))
preview_2 = CustomPreview(Geometry=py3_3.previews, Material=ColourSwatch(SwatchColor=RGB(47, 231, 255)))
geo_5 = Geometry([py3_3.output_top, py3_3.output_hinge, py3_3.output_base])

# ---- group: Convert to Mesh
cluster_2 = Cluster_3(C=cluster.P, C_3=cluster.G_2, C_2=cluster.G_3, G=cluster.G_2, T=cluster.X)

# ----
cluster_3 = Cluster(pln=py3.plns_out, num=30)
wbedges = WeaverbirdsMeshEdges(MeshOrPolylines=cluster_2)

# ---- group: Visualise Boundary Mesh
custom_preview_lineweights = CustomPreviewLineweights(
    Geometry=wbedges,
    Shader=ColourSwatch(SwatchColor=RGB(150, 150, 150)),
    Thickness=Slider(1, range=0..10),
    Absolute=Toggle(False))

# ---- group: Angles
merge = Merge(Data1=Slider(20, range=0..100), Data2=Slider(160, range=0..1000))

# ---- group: Lengths
merge_2 = Merge(Data1=Slider(200, range=0..1000), Data2=Slider(400, range=0..1000))

# ----
list = ValueList({"Regular": 0, "Random": 1}, selected="Random")

# ---- group: Py_aggregation_logic
# Aggregation
py3_4 = Python3Script(
    first_plns=py3.plns_out,
    length_pattern=merge_2,
    angle_pattern=merge,
    agg_type=list,
    seed="53",
    agg_count=Slider(3, range=0..20),
    agg_round=Slider(2, range=0..20),
    branch_count=Slider(3, range=0..20),
    max_attempts=Slider(10, range=0..20),
    boundary_mesh=cluster_2)  # -> out, stick_out, frame_out, axis_out, failed_sticks, valid_sticks, collision_log; inputs first_plns: list of Plane, length_pattern: list of Double, angle_pattern: list of Double, agg_type: Int32, seed: Int32, agg_count: Int32, agg_round: Int32, branch_count: Int32, max_attempts: Int32, boundary_mesh: Mesh
# ---------- py3_4: Python ----------
# r: compas>=2.14.1
# venv: sticks

import sys
import os

#get current file path
path = ghenv.Component.OnPingDocument().FilePath
#get parent directory of the parent directory
parentdir = os.path.dirname(path)
#get src folder which contains classes
dire = os.path.join(parentdir,'scripts')

print (f'src folder is', dire)
sys.path.append(dire)

#update modules
from compas_rhino import unload_modules
unload_modules('single_stick')
unload_modules('aggregation_logic')
unload_modules('collision_detection')

"""
import file specific classes
"""

from single_stick import Stick
from aggregation_logic import Aggregation, run_multiround_aggregation
from collision_detection import Collision

from compas.geometry import Line, Point, Vector
from compas.geometry import Transformation
from compas_rhino.conversions import plane_to_compas_frame, frame_to_rhino_plane

import scriptcontext as sc
import random

from Grasshopper import DataTree
from Grasshopper.Kernel.Data import GH_Path

"""Main Code"""
# Convert rhino plane to compas frame
first_frames = [plane_to_compas_frame(p) for p in first_plns]

all_rounds = run_multiround_aggregation(
    first_frames,
    length_pattern,
    angle_pattern,
    agg_type,
    seed,
    agg_count,
    agg_round,
    branch_count,
    boundary_mesh,
    max_attempts)

# Visualization
stick_tree = DataTree[object]()
axis_tree = DataTree[object]()
frame_tree = DataTree[object]()
pln_tree = DataTree[object]()

for r, round_aggs in enumerate(all_rounds):
    for i, agg in enumerate(round_aggs):
        path = GH_Path(r, i)
        for s in agg.sticks:
            stick_tree.Add(s.geometry, path)
            axis_tree.Add(s.axis, path)
            frame_tree.Add(s.frame, path)
            pln_tree.Add(frame_to_rhino_plane(s.frame))

stick_out = stick_tree
axis_out = axis_tree
frame_out = frame_tree
pln_out = pln_tree

# Log
failed_sticks = DataTree[object]()
valid_sticks = DataTree[object]()
for i, round_aggs in enumerate(all_rounds):
    for agg in round_aggs:
        for j, branch in enumerate(agg.failed_sticks):
            path = GH_Path(i, j + 1)
            for s in branch:
                failed_sticks.Add(s.geometry, path)

        for j, branch in enumerate(agg.valid_sticks):
            path = GH_Path(i, j + 1)
            for s in branch:
                valid_sticks.Add(s.geometry, path)

# collision_log = DataTree[object]()
# for i, log in enumerate(agg.collision_log):
#     path = GH_Path(i + 1)

#     # 1. primitive values first
#     collision_log.Add(f"attempts = {log['attempts']}", path)
#     collision_log.Add(f"fail_count = {log['fail_count']}", path)
#     collision_log.Add(f"success = {log['success']}", path)
#     collision_log.Add(f"reason = {log['reason']}", path)
#     collision_log.Add(f"length = {log['params']['length']}", path)    
#     collision_log.Add(f"angle = {log['params']['angle']}", path)
#     collision_log.Add(f"from_index = {log['params']['from_index']}", path)
#     collision_log.Add(f"to_index = {log['params']['to_index']}", path)
#     collision_log.Add(f"from_t = {log['params']['from_t']}", path)
#     collision_log.Add(f"to_t = {log['params']['to_t']}", path)
# ---------- end py3_4 ----------

# ----
panel = Panel(py3_4.collision_log)
draw = COMPASDraw(cg=py3_4.axis_out)  # -> rg
#   port cg: The COMPAS geometry or datastructure to be drawn.
#   port rg: The Rhino geometry object.
# ---------- draw: Python ----------
# r: compas>=2.14.1
"""
Draws COMPAS geometry in Grasshopper.
"""

from typing import Any

import Grasshopper

from compas.scene import SceneObject


class CompasToRhinoGeometry(Grasshopper.Kernel.GH_ScriptInstance):
    def RunScript(self, cg):
        if not cg:
            return None

        return SceneObject(item=cg).draw()
# ---------- end draw ----------
draw_2 = COMPASDraw(cg=py3_4.failed_sticks)  # -> rg; same code as draw
draw_3 = COMPASDraw(cg=py3_4.valid_sticks)  # -> rg; same code as draw
draw_4 = COMPASDraw(cg=py3_4.stick_out)  # -> rg; same code as draw

midpt = CurveMiddle(Curve=draw)
number_slider_2 = Slider(30, range=0..30)
points = PointList(Points=midpt, Size=Slider(10, range=0..10))
lng = ListLength(List=draw_4)

# ---- group: Sticks Visualisation from Generation
trim = TrimTree(Tree=draw_4, Depth=1)
entwine = Entwine(
    Branch00=ColourSwatch(SwatchColor=RGBA(255, 255, 255, 150)),
    Branch01=ColourSwatch(SwatchColor=RGBA(255, 247, 0, 150)),
    Branch02=ColourSwatch(SwatchColor=RGBA(0, 255, 153, 150)),
    FlattenInputs=True)
preview_3 = CustomPreview(Geometry=trim, Material=entwine)

# ---- group: Collision Visualisation
min = Minimum(A=number_slider_2, B=lng)
concat = Concatenate(FragmentA="{?;", FragmentB=min, FragmentC="}")
split = SplitTree(Data=draw_2, Masks=flatten(concat))  # -> Positive, Negative
split_2 = SplitTree(Data=draw_3, Masks=flatten(concat))  # -> Positive, Negative

# ---- group: Sticks Visualisation from Count
cluster_4 = Cluster_4(L=draw_4, A=number_slider_2, B=lng)  # -> i, M
preview_4 = CustomPreview(Geometry=cluster_4.i, Material=cluster_4.M)

# ----
list_item = ListItem(List=flatten(py3_4.frame_out), Index=Slider(23, range=0..50), Wrap=True)
list_item_2 = ListItem(List=flatten(py3_4.frame_out), Index=Slider(29, range=0..100), Wrap=True)

# ---- group: Py_FrameStick
py_planestick = Python3Script(root_frame=list_item_2, stick_length=Slider(400, range=0..1000))  # -> out, geometries, frames
# ---------- py_planestick: Python ----------
# r: compas>=2.14.1
# venv: sticks

import sys
import os
import math

#get current file path
path = ghenv.Component.OnPingDocument().FilePath
#get parent directory of the parent directory
parentdir = os.path.dirname(path)
#get src folder which contains classes
dire = os.path.join(parentdir,'scripts')
print (dire)

sys.path.append(dire)

from compas_rhino import unload_modules

unload_modules("Sticks")
unload_modules("single_stick")

from single_stick import Stick 
from compas.geometry import Line, Point, Vector, Frame

stick_width = 13.0
stick_depth = 13.0

from compas_rhino.conversions import frame_to_rhino_plane

# #create Stick from frame
# my_axis = Line.from_point_and_vector(root_frame.point, root_frame.xaxis * stick_length)
my_stick = Stick(root_frame, length = stick_length)
print (my_stick)

# Visualize
geometries = my_stick.geometry
# ---------- end py_planestick ----------
draw_5 = COMPASDraw(cg=py_planestick.geometries)  # -> rg; same code as draw

py_planestick_2 = Python3Script(root_frame=list_item, stick_length=Slider(200, range=0..1000))  # -> out, geometries, frames
# ---------- py_planestick_2: Python ----------
# r: compas>=2.14.1
# venv: sticks

import sys
import os
import math

#get current file path
path = ghenv.Component.OnPingDocument().FilePath
#get parent directory of the parent directory
parentdir = os.path.dirname(path)
#get src folder which contains classes
dire = os.path.join(parentdir,'scripts')
print (dire)

sys.path.append(dire)

from compas_rhino import unload_modules

unload_modules("Sticks")
unload_modules("single_stick")

from single_stick import Stick 
from compas.geometry import Line, Point, Vector, Frame

stick_width = 13.0
stick_depth = 13.0

from compas_rhino.conversions import frame_to_rhino_plane

# #create Stick from frame 
# my_axis = Line.from_point_and_vector(root_frame.point, root_frame.xaxis * stick_length)
my_stick = Stick(root_frame, length = stick_length)
print (my_stick)

# Visualize
geometries = my_stick.geometry
# ---------- end py_planestick_2 ----------
draw_6 = COMPASDraw(cg=py_planestick_2.geometries)  # -> rg; same code as draw

# ----
python_3_script = Python3Script(x=py3_4.axis_out)  # -> out, a
# ---------- python_3_script: Python ----------
print(x)
# ---------- end python_3_script ----------
option = BooleanToggle(True)
option_2 = BooleanToggle(True)
option_3 = BooleanToggle(True)

# ---- group: Py_Growth
py_grow_towards = Python3Script(
    root_frame=list_item,
    face_index=Slider(3, range=0..3),
    offset_root_child=Slider(0, range=0..100),
    offset_target_child=Slider(175, range=-300..300),
    target_frame=list_item_2)  # -> out, geometries, frames, root_child_frame, target_child_frame, r_target_frame, root_child_stick, target_child_stick; inputs face_index: Int32, offset_root_child: Double
# ---------- py_grow_towards: Python ----------
# r: compas>=2.14.1
# venv: sticks

import sys
import os
import math

#get current file path
path = ghenv.Component.OnPingDocument().FilePath
#get parent directory of the parent directory
parentdir = os.path.dirname(path)
#get src folder which contains classes
dire = os.path.join(parentdir,'scripts')
print (f'src folder is', dire)

sys.path.append(dire)

from compas_rhino import unload_modules

unload_modules("stick_axis")
unload_modules("stick_growth_axis")

"""
import file specific classes
"""

from stick_axis import Stick 
from stick_growth_axis import GrowTowards, compare_angles, get_plane_from_frame
"""
Default variables
"""

stick_width = 13.0
stick_depth = 13.0

from compas_rhino.conversions import plane_to_compas_frame, frame_to_rhino_plane
from compas.geometry import Line, Point, Vector, Frame
from compas_rhino.conversions import line_to_rhino

"""
Growth Logic
"""

#Initialize tree
tree = GrowTowards(root_frame, target_frame, offset_root_child, offset_target_child, stick_length=200, width = stick_width, depth = stick_depth)

#Compare two frames
print (tree.normal_deviation)

#rotated (aligned target frame)ang
r_target_frame = tree.rotated_target_frame

#child_frames
root_child_frame = tree.root_child_frame
target_child_frame = tree.target_child_frame

#visualise child_frame
plane = get_plane_from_frame(target_child_frame)

#visualise intersection line
line = tree.frame_intersection
intersection = line_to_rhino(line)

#visualise bridge sticks
root_child_stick = tree.root_child_stick.geometry
target_child_stick = tree.target_child_stick.geometry

# Visualize
geometries = tree.visualize()
frames = [stick.frame for stick in tree.sticks]
# ---------- end py_grow_towards ----------

# ---- group: Frame visualisation
python_3_script_2 = Python3Script(frames=py_grow_towards.r_target_frame, factor=Slider(20, range=0..25))  # -> points, x_axis, y_axis, normal; inputs frames: list
# ---------- python_3_script_2: Python ----------
from compas.geometry import Vector
from compas.geometry import cross_vectors
from compas_rhino.conversions import vector_to_rhino
from compas_rhino.conversions import point_to_rhino

points = []
x_axis = []
y_axis = []
normal = []

for frame in frames:
    points.append(point_to_rhino(frame.point))
    x_axis.append(vector_to_rhino(frame.xaxis * 2 * factor))
    y_axis.append(vector_to_rhino(frame.normal * factor))
    normal.append(vector_to_rhino(frame.yaxis * factor))
# ---------- end python_3_script_2 ----------
vector_display_ex = VectorDisplayEx(
    Point=python_3_script_2.points,
    Vector=python_3_script_2.x_axis,
    Colour=ColourSwatch(SwatchColor=RGB(255, 0, 0)),
    Width=2)
vector_display_ex_2 = VectorDisplayEx(
    Point=python_3_script_2.points,
    Vector=python_3_script_2.y_axis,
    Colour=ColourSwatch(SwatchColor=RGB(0, 0, 255)),
    Width=2)
vector_display_ex_3 = VectorDisplayEx(
    Point=python_3_script_2.points,
    Vector=python_3_script_2.normal,
    Colour=ColourSwatch(SwatchColor=RGB(0, 255, 0)),
    Width=2)

# ---- group: Py_Bridge
py_grow = Python3Script(
    branches=flatten(py3_4.frame_out),
    xaxis_list=flatten(py3_4.axis_out),
    root_index=Slider(23, range=0..50),
    target_index=Slider(29, range=0..50),
    root_offset=Slider(0, range=-300..300),
    target_offset=Slider(0, range=-300..300),
    root_child_offset=Slider(0, range=-300..300),
    target_child_offset=Slider(0, range=-300..300),
    stick_length=Slider(300, range=0..400),
    solution=option,
    mirror_root=option_2,
    mirror_target=option_3)  # -> out, geometries, frames, frame; inputs branches: list, xaxis_list: list, root_index: Int32, target_index: Int32, root_offset: Double, target_offset: Double, root_child_offset: Double, target_child_offset: Double, stick_length: Double
# ---------- py_grow: Python ----------
# r: compas>=2.14.1
# venv: sticks

import sys
import os
import math

#get current file path
path = ghenv.Component.OnPingDocument().FilePath
#get parent directory of the parent directory
parentdir = os.path.dirname(path)
#get src folder which contains classes
dire = os.path.join(parentdir,'scripts')
print (f'src folder is', dire)

sys.path.append(dire)

from compas_rhino import unload_modules

unload_modules("stick_axis")
unload_modules("stick_bridge_axis")

"""
import file specific classes
"""

from stick_axis import Stick 
from stick_bridge_axis import BridgeIndex, compare_angles, get_plane_from_frame
"""
Default variables
"""

stick_width = 13.0
stick_depth = 13.0

from compas_rhino.conversions import plane_to_compas_frame, frame_to_rhino_plane
from compas.geometry import Line, Point, Vector, Frame
from compas_rhino.conversions import line_to_rhino

"""
Bridge Logic
"""

xaxis_v_list = []
for line in xaxis_list:
    v = Vector.from_start_end(line.start, line.end)
    xaxis_v_list.append(v)

# Initialize tree
tree = BridgeIndex(branches, xaxis_v_list, root_index, target_index, root_offset, target_offset, root_child_offset, target_child_offset, stick_length=300, solution = solution, mirror_root = mirror_root, mirror_target = mirror_target)
#Compare two frames
print (tree.normal_deviation)

#rotated (aligned target frame)ang
r_target_frame = tree.rotated_target_frame

#child_frames
root_child_frame = tree.root_child_frame
target_child_frame = tree.target_child_frame

#visualise child_frame
plane = get_plane_from_frame(target_child_frame)

#visualise intersection line
line = tree.frame_intersection
intersection = line_to_rhino(line)

#visualise bridge sticks
root_child_stick = tree.root_child_stick.geometry
target_child_stick = tree.target_child_stick.geometry

# Visualize
geometries = tree.visualize()
frames = [stick.frame for stick in tree.sticks]
# ---------- end py_grow ----------

# ----
draw_7 = COMPASDraw(cg=py_grow.geometries)  # -> rg; same code as draw
draw_8 = COMPASDraw(cg=py_grow_towards.geometries)  # -> rg; same code as draw
draw_9 = COMPASDraw(cg=py_grow_towards.root_child_stick)  # -> rg; same code as draw
draw_10 = COMPASDraw(cg=py_grow_towards.target_child_stick)  # -> rg; same code as draw

# ---- group: Frame visualisation
python_3_script_3 = Python3Script(frames=[py_grow_towards.root_child_frame, py_grow_towards.target_child_frame], factor=Slider(20, range=0..25))  # -> points, x_axis, y_axis, normal; inputs frames: list; same code as python_3_script_2
vector_display_ex_4 = VectorDisplayEx(
    Point=python_3_script_3.points,
    Vector=python_3_script_3.x_axis,
    Colour=ColourSwatch(SwatchColor=RGB(255, 0, 0)),
    Width=2)
vector_display_ex_5 = VectorDisplayEx(
    Point=python_3_script_3.points,
    Vector=python_3_script_3.y_axis,
    Colour=ColourSwatch(SwatchColor=RGB(0, 0, 255)),
    Width=2)
vector_display_ex_6 = VectorDisplayEx(
    Point=python_3_script_3.points,
    Vector=python_3_script_3.normal,
    Colour=ColourSwatch(SwatchColor=RGB(0, 255, 0)),
    Width=2)

# ==== cluster Cluster
pln = ClusterInput()
num = ClusterInput()
pln_2 = Plane(graft(pln))
num_2 = Number(num)
deplane = DeconstructPlane(Plane=pln_2)  # -> flatten(Origin), XAxis, YAxis, ZAxis
entwine = Entwine(Branch00=deplane.XAxis, Branch01=deplane.YAxis, Branch02=deplane.ZAxis, FlattenInputs=True)
merge = Merge(
    Data1=ColourSwatch(SwatchColor=RGB(255, 0, 0)),
    Data2=ColourSwatch(SwatchColor=RGB(0, 255, 0)),
    Data3=ColourSwatch(SwatchColor=RGB(0, 0, 255)))  # -> graft(Result)
multiplication = Multiplication(A=entwine, B=num_2)
vdisex = VectorDisplayEx(Point=deplane.Origin, Vector=multiplication, Colour=merge, Width=2)

# ==== cluster Cluster_2
F = ClusterInput()
G = ClusterInput()
Z = UnitZ(Factor=F)
move = Move(Geometry=G, Motion=Z)  # -> Geometry, Transform
A = ClusterInput()
B = ClusterInput()
S = ClusterInput()
D = ClusterInput()
F_2 = ClusterInput()
addition = Addition(A=A, B=B)
G_2 = ClusterOutput(move.Geometry)
polygon = Polygon(Plane=move.Geometry, Radius=addition, Segments=S, FilletRadius=0)  # -> Polygon, Length
offset = OffsetCurve(Curve=polygon.Polygon, Distance=D, Corners=1)
Z_2 = UnitZ(Factor=F_2)
move_2 = Move(Geometry=offset, Motion=Z_2)  # -> Geometry, Transform
P = ClusterOutput(polygon.Polygon)
G_3 = ClusterOutput(move_2.Geometry)
X = ClusterOutput(move_2.Transform)

# ==== cluster Cluster_3
C = ClusterInput()
disc = Discontinuity(Curve=C, Level=1)  # -> Points, Parameters
C_2 = ClusterInput()
shift = ShiftList(List=disc.Points, Shift="-1", Wrap=True)
C_3 = ClusterInput()
disc_2 = Discontinuity(Curve=C_2, Level=1)  # -> Points, Parameters
G = ClusterInput()
T = ClusterInput()
long = LongestList(ListA=shift, ListB=disc.Points, ListC=C_3, PaddingMode=2)  # -> ListA, ListB, ListC
shift_2 = ShiftList(List=disc_2.Points, Shift="-1", Wrap=True)
long_2 = LongestList(ListA=shift, ListB=disc.Points, ListC=disc_2.Points, ListD=shift_2, PaddingMode=2)  # -> ListA, ListB, ListC, ListD
transform = Transform(Geometry=G, Transform=T)
merge = Merge(Data1=graft(long.ListA), Data2=graft(long.ListB), Data3=graft(long.ListC))  # -> reverse(Result)
merge_2 = Merge(Data1=graft(long_2.ListA), Data2=graft(long_2.ListB), Data3=graft(long_2.ListC), Data4=graft(long_2.ListD))
long_3 = LongestList(ListA=shift_2, ListB=disc_2.Points, ListC=transform, PaddingMode=2)  # -> ListA, ListB, ListC
conmesh = ConstructMesh(Vertices=merge, Faces={A=0, B=1, C=2, D=2})
merge_3 = Merge(Data1=graft(long_3.ListA), Data2=graft(long_3.ListB), Data3=graft(long_3.ListC))
conmesh_2 = ConstructMesh(Vertices=merge_2, Faces={A=0, B=1, C=2, D=3})
conmesh_3 = ConstructMesh(Vertices=merge_3, Faces={A=0, B=1, C=2, D=2})
merge_4 = Merge(Data1=simplify(conmesh), Data2=simplify(conmesh_2), Data3=simplify(conmesh_3))  # -> flatten(Result)
mjoin = MeshJoin(Meshes=merge_4)
M = ClusterOutput(mjoin)

# ==== cluster Cluster_4
A = ClusterInput()
B = ClusterInput()
addition = Addition(A=A, B=1)
min = Minimum(A=addition, B=B)
L = ClusterInput()
series = Series(Start=0, Step=1, Count=min)
item = ListItem(List=L, Index=series, Wrap=True)
i = ClusterOutput(item)
lng = ListLength(List=item)
series_2 = Series(Start=0, Step=1, Count=lng)
gradient = Gradient(
    LowerLimit=0,
    UpperLimit=expr("x-1", lng),
    Parameter=series_2,
    stops=[0: RGB(80, 55, 25), 0.5: RGB(159, 65, 29), 1: RGB(174, 166, 129)])
dmaterial = DeconstructMaterial(Material=gradient)  # -> Diffuse, Specular, Emission, Transparency, Shine
material = CreateMaterial(
    Diffuse=dmaterial.Diffuse,
    Specular=dmaterial.Specular,
    Emission=dmaterial.Emission,
    Transparency=Slider(0.25, range=0..1),
    Shine=dmaterial.Shine)
M = ClusterOutput(material)
