# Grasshopper definition 102_grid_frame.gh (Grasshopper 1.0.8)
# plug-ins: Moonlight

line_0 = Curve(<curve referenced from the Rhino model>)
line_1 = Curve(<curve referenced from the Rhino model>)

# ---- group: Two Sticks
py3 = Python3Script(line_0=line_0, line_1=line_1)  # -> out, sticks_geo, stick_frames; inputs line_0: Line, line_1: Line
# ---------- py3: Python ----------
#locate stick class file in the same folder
from compas_rhino import unload_modules
import sys
import os

#get current file path
path = ghenv.Component.OnPingDocument().FilePath
#get parent directory of the parent directory
parentdir = os.path.dirname(path)
#get src folder which contains classes
dire = os.path.join(parentdir,'scripts')

sys.path.append(dire)

unload_modules('Sticks')

import Sticks
from Sticks import Stick, stick_bridge
from compas.geometry import Line, Point, Vector
from compas_rhino.conversions import line_to_compas
import math

assembly = []
stick_frames = []
 
c_line_0 = line_to_compas(line_0)
stick_0 = Stick(c_line_0, width = 5, depth = 5)

stick_0.rotate_stick(30)
assembly.append(stick_0)

c_line_1 = line_to_compas(line_1)
stick_1 = Stick(c_line_1, width = 5, depth = 5)
stick_1.rotate_stick(50, Vector(0,1,0), stick_1.axis.start)
assembly.append(stick_1)

bridge_sticks = stick_bridge(stick_0, stick_1)
bridge_sticks = [Stick(l, width = 5, depth =5) for l in bridge_sticks]
assembly.extend(bridge_sticks)

sticks_geo = [s.geometry for s in assembly]
stick_frames = [s.frame for s in assembly]
# ---------- end py3 ----------

# ----
moonlight = Moonlight(Mode=Toggle(False))
draw = COMPASDraw(cg=py3.sticks_geo)  # -> rg
#   port cg: The COMPAS geometry or datastructure to be drawn.
#   port rg: The Rhino geometry object.
# ---------- draw: Python ----------
# r: compas>=2.14.1
"""
Draws COMPAS geometry in Grasshopper.
"""

from typing import Any

import Grasshopper

from compas.scene import SceneObject


class CompasToRhinoGeometry(Grasshopper.Kernel.GH_ScriptInstance):
    def RunScript(self, cg):
        if not cg:
            return None

        return SceneObject(item=cg).draw()
# ---------- end draw ----------

# ---- group: Frame visualisation
python_3_script = Python3Script(frames=py3.stick_frames, factor=Slider(25, range=0..25))  # -> points, x_axis, y_axis, normal; inputs frames: list
# ---------- python_3_script: Python ----------
from compas.geometry import Vector
from compas.geometry import cross_vectors
from compas_rhino.conversions import vector_to_rhino
from compas_rhino.conversions import point_to_rhino

points = []
x_axis = []
y_axis = []
normal = []

for frame in frames:
    points.append(point_to_rhino(frame.point))
    x_axis.append(vector_to_rhino(frame.xaxis * factor))
    y_axis.append(vector_to_rhino(frame.normal * factor))
    normal.append(vector_to_rhino(frame.yaxis * factor))
# ---------- end python_3_script ----------
vector_display_ex = VectorDisplayEx(Point=python_3_script.points, Vector=python_3_script.x_axis, Colour=ColourSwatch(SwatchColor=RGB(255, 0, 0)), Width=2)
vector_display_ex_2 = VectorDisplayEx(Point=python_3_script.points, Vector=python_3_script.y_axis, Colour=ColourSwatch(SwatchColor=RGB(0, 0, 255)), Width=2)
vector_display_ex_3 = VectorDisplayEx(Point=python_3_script.points, Vector=python_3_script.normal, Colour=ColourSwatch(SwatchColor=RGB(0, 255, 0)), Width=2)

# ---- group: Frame
python_3_script_2 = Python3Script(
    x_range=Slider(4, range=0..25),
    y_range=Slider(4, range=0..25),
    z_range=Slider(4, range=0..25),
    offset=Slider(50, range=0..100))  # -> grid_points, sticks_geo, stick_frames; inputs x_range: Int32, y_range: Int32, z_range: Int32, offset: Double
# ---------- python_3_script_2: Python ----------
from compas_rhino import unload_modules
import sys
import os

path = ghenv.Component.OnPingDocument().FilePath
parentdir = os.path.dirname(path)
dire = os.path.join(parentdir,'scripts')

sys.path.append(dire)

unload_modules('Sticks')
unload_modules('stick_orthogonal')

import Sticks
import stick_orthogonal

from Sticks import Stick, stick_bridge
from stick_orthogonal import O_Stick_Module
from compas.geometry import Line, Point, Vector
from compas_rhino.conversions import line_to_compas
import math

stick_width = 13.0
stick_depth = 13.0

stick_length = 250

#create grid
grid_points = []
assembly = []
stick_frames = []

for x in range (x_range): 
    for y in range (y_range):
        for z in range (z_range):
            grid_size = stick_length - 2 * stick_depth - offset
            point = Point(x * grid_size, y * grid_size, z * grid_size)
            grid_points.append(point)
            type_x = x % 2 if x < x_range -1 else 2
            type_y = y % 2 if y < y_range -1 else 2
            type_z = z % 2 if z < z_range -1 else 2

            type = { "x": type_x, "y" : type_y, "z" : type_z }

            stick_module = O_Stick_Module(point, stick_length, stick_width, stick_length)
            stick_module.create_orthogonal_module(offset, type)

            assembly.extend(stick_module.sticks)

sticks_geo = [s.geometry for s in assembly]
stick_frames = [s.frame for s in assembly]
# ---------- end python_3_script_2 ----------

# ----
draw_2 = COMPASDraw(cg=python_3_script_2.sticks_geo)  # -> rg; same code as draw
draw_3 = COMPASDraw(cg=python_3_script_2.grid_points)  # -> rg; same code as draw
point_list = PointList(Points=draw_3, Size=Slider(50, range=0..100))
