# Grasshopper definition 103_branching_out_sticks.ghx (Grasshopper 1.0.8)

# ---- group: create_plane
construct_point = ConstructPoint(XCoordinate=Slider(0, range=0..1000), YCoordinate=Slider(0, range=0..1000), ZCoordinate=Slider(0, range=0..1000))
xy_plane = XYPlane(Origin=construct_point)
rotate_3d = Rotate3D(Geometry=xy_plane, Angle=degrees(Slider(0, range=0..360)), Center=construct_point, Axis=Vector(0, 0, 1))  # -> Geometry, Transform

# ----
py_grow = Python3Script(
    root_plane=rotate_3d.Geometry,
    stick_length=Slider(200, range=0..1000),
    face_index=Slider(0, range=0..3),
    offset=Slider(25, range=0..50),
    angle=Slider(53, range=0..180))  # -> out, geometries, frames; inputs face_index: Int32, offset: Double, angle: Double
# ---------- py_grow: Python ----------
# r: compas>=2.14.1
# venv: sticks

import sys
import os
import math

#get current file path
path = ghenv.Component.OnPingDocument().FilePath
# print (path)
#get parent directory of the parent directory
parentdir = os.path.dirname(path)
# print (parentdir)
#get src folder which contains classes
dire = os.path.join(parentdir,'scripts')
print (dire)

sys.path.append(dire)

from compas_rhino import unload_modules

unload_modules("Sticks")
unload_modules("stick_module")

import Sticks
from Sticks import Stick 
from stick_module import BranchingModule
from compas.geometry import Line, Point, Vector, Frame

stick_width = 13.0
stick_depth = 13.0

from compas_rhino.conversions import plane_to_compas_frame, frame_to_rhino_plane

# Convert input to compas
root = plane_to_compas_frame(root_plane)

# Initialize tree
tree = BranchingModule(root, stick_length=stick_length, width = stick_width, depth = stick_depth)

# Grow tree
tree.grow_stick(face_index = face_index, angle = angle, offset = offset)
tree.grow_stick(face_index = 1, angle = -angle, offset = offset)

# Visualize
geometries = tree.visualize()
frames = [stick.frame for stick in tree.sticks]
# ---------- end py_grow ----------
draw = COMPASDraw(cg=py_grow.geometries)  # -> rg
#   port cg: The COMPAS geometry or datastructure to be drawn.
#   port rg: The Rhino geometry object.
# ---------- draw: Python ----------
# r: compas>=2.14.1
"""
Draws COMPAS geometry in Grasshopper.
"""

from typing import Any

import Grasshopper

from compas.scene import SceneObject


class CompasToRhinoGeometry(Grasshopper.Kernel.GH_ScriptInstance):
    def RunScript(self, cg):
        if not cg:
            return None

        return SceneObject(item=cg).draw()
# ---------- end draw ----------

# ---- group: Py_Create_New_Root
py_grow_2 = Python3Script(
    branches=py_grow.geometries,
    segment_index=Slider(2, range=0..100),
    stick_length=Slider(200, range=0..1000),
    face_index=Slider(3, range=0..3),
    segment_offset=Slider(100, range=0..100),
    root_offset=Slider(65, range=0..100),
    angle=Slider(132, range=0..360))  # -> out, geometries, frames, new_root_frame; inputs branches: list, segment_index: Int32, face_index: Int32, segment_offset: Double, root_offset: Double, angle: Double, target: Point3d
# ---------- py_grow_2: Python ----------
# r: compas>=2.14.1
# venv: sticks

import sys
import os
import math

#get current file path
path = ghenv.Component.OnPingDocument().FilePath
print (path)
#get parent directory of the parent directory
parentdir = os.path.dirname(path)
print (parentdir)
#get src folder which contains classes
dire = os.path.join(parentdir,'scripts')
print (dire)

sys.path.append(dire)

from compas_rhino import unload_modules

unload_modules("Sticks")
unload_modules("stick_module")

import Sticks
from Sticks import Stick 
from stick_module import RootModule
from compas.geometry import Line, Point, Vector, Frame

stick_width = 13.0
stick_depth = 13.0

from compas_rhino.conversions import plane_to_compas_frame, frame_to_rhino_plane

# Initialize tree
tree = RootModule(branches, segment_index, stick_length=200, width = stick_width, depth = stick_depth)
 
# Create root frame
new_root_frame = tree.get_root_frame(face_index = face_index, rotation_angle = angle, segment_offset = segment_offset)

# Grow root stick
tree.get_root_stick(new_root_frame, root_offset = root_offset)

# Visualize
geometries = tree.visualize()
frames = [stick.frame for stick in tree.sticks]
# ---------- end py_grow_2 ----------

# ---- group: Frame visualisation
python_3_script = Python3Script(frames=py_grow_2.new_root_frame, factor=Slider(20, range=0..25))  # -> points, x_axis, y_axis, normal; inputs frames: list
# ---------- python_3_script: Python ----------
from compas.geometry import Vector
from compas.geometry import cross_vectors
from compas_rhino.conversions import vector_to_rhino
from compas_rhino.conversions import point_to_rhino

points = []
x_axis = []
y_axis = []
normal = []

for frame in frames:
    points.append(point_to_rhino(frame.point))
    x_axis.append(vector_to_rhino(frame.xaxis * 2 * factor))
    y_axis.append(vector_to_rhino(frame.normal * factor))
    normal.append(vector_to_rhino(frame.yaxis * factor))
# ---------- end python_3_script ----------
vector_display_ex = VectorDisplayEx(Point=python_3_script.points, Vector=python_3_script.x_axis, Colour=ColourSwatch(SwatchColor=RGB(255, 0, 0)), Width=2)
vector_display_ex_2 = VectorDisplayEx(Point=python_3_script.points, Vector=python_3_script.y_axis, Colour=ColourSwatch(SwatchColor=RGB(0, 0, 255)), Width=2)
vector_display_ex_3 = VectorDisplayEx(Point=python_3_script.points, Vector=python_3_script.normal, Colour=ColourSwatch(SwatchColor=RGB(0, 255, 0)), Width=2)

# ---- group: Py_Create_New_Root
py_grow_3 = Python3Script(
    branches=py_grow.geometries,
    segment_index_a=Slider(0, range=0..50),
    face_index_a=Slider(0, range=0..3),
    segment_index_b=Slider(2, range=0..50),
    face_index_b=Slider(0, range=0..3),
    Bridge_a_offset=Slider(0, range=0..100),
    bridge_b_offset=Slider(0, range=0..100))  # -> out, geometries, frames, frame; inputs branches: list, segment_index_a: Int32, face_index_a: Int32, segment_index_b: Int32, face_index_b: Int32, Bridge_a_offset: Double, bridge_b_offset: Double
# ---------- py_grow_3: Python ----------
# r: compas>=2.14.1
# venv: sticks

import sys
import os
import math

#get current file path
path = ghenv.Component.OnPingDocument().FilePath
print (f'path is', path)
#get parent directory of the parent directory
parentdir = os.path.dirname(path)
print (f'parant directory is', parentdir)
#get src folder which contains classes
dire = os.path.join(parentdir,'scripts')
print (f'src folder is', dire)

sys.path.append(dire)

from compas_rhino import unload_modules

unload_modules("Sticks")
unload_modules("stick_module")
unload_modules("stick_bridge")

"""
import file specific classes

"""

import Sticks
from Sticks import Stick 
from stick_bridge import BridgeIndex, compare_angles, get_plane_from_frame
"""
Default variables
"""

stick_width = 13.0
stick_depth = 13.0

from compas_rhino.conversions import plane_to_compas_frame, frame_to_rhino_plane
from compas.geometry import Line, Point, Vector, Frame
from compas_rhino.conversions import line_to_rhino

"""
Growth Logic
"""

#Convert rhino (target plane) into compas frame
target_frame = plane_to_compas_frame(target_plane)

# Initialize tree
tree = GrowTowards(root_frame, target_frame, offset_root_child, offset_target_child, stick_length=200, width = stick_width, depth = stick_depth)

#Compare two frames
print (tree.normal_deviation)

#rotated (aligned target frame)ang
r_target_frame = tree.rotated_target_frame

#child_frames
root_child_frame = tree.root_child_frame
target_child_frame = tree.target_child_frame

#visualise child_frame
plane = get_plane_from_frame(target_child_frame)

#visualise intersection line
line = tree.frame_intersection
intersection = line_to_rhino(line)

#visualise bridge sticks
root_child_stick = tree.root_child_stick.geometry
target_child_stick = tree.target_child_stick.geometry

# Visualize
geometries = tree.visualize()
frames = [stick.frame for stick in tree.sticks]
# ---------- end py_grow_3 ----------

# ---- group: Frame visualisation
python_3_script_2 = Python3Script(factor=Slider(20, range=0..25))  # -> points, x_axis, y_axis, normal; inputs frames: list; same code as python_3_script
vector_display_ex_4 = VectorDisplayEx(
    Point=python_3_script_2.points,
    Vector=python_3_script_2.x_axis,
    Colour=ColourSwatch(SwatchColor=RGB(255, 0, 0)),
    Width=2)
vector_display_ex_5 = VectorDisplayEx(
    Point=python_3_script_2.points,
    Vector=python_3_script_2.y_axis,
    Colour=ColourSwatch(SwatchColor=RGB(0, 0, 255)),
    Width=2)
vector_display_ex_6 = VectorDisplayEx(
    Point=python_3_script_2.points,
    Vector=python_3_script_2.normal,
    Colour=ColourSwatch(SwatchColor=RGB(0, 255, 0)),
    Width=2)

# ----
unit_x = UnitX(Factor=1)

# ---- group: create_plane
construct_point_2 = ConstructPoint(
    XCoordinate=Slider(52.7, range=-1000..1000),
    YCoordinate=Slider(-92.3, range=-1000..1000),
    ZCoordinate=Slider(202.1, range=-1000..1000))
xy_plane_2 = XYPlane(Origin=construct_point_2)
rotate_3d_2 = Rotate3D(Geometry=xy_plane_2, Angle=degrees(Slider(150, range=0..360)), Center=construct_point_2, Axis=unit_x)  # -> Geometry, Transform

# ----
draw_2 = COMPASDraw(cg=py_grow_3.geometries)  # -> rg; same code as draw
draw_3 = COMPASDraw()  # -> rg; same code as draw
draw_4 = COMPASDraw(cg=py_grow_2.geometries)  # -> rg; same code as draw

# ---- group: Py_PlaneStick
py_planestick = Python3Script(root=rotate_3d_2.Geometry, stick_length=Slider(200, range=0..1000))  # -> out, geometries, frames
# ---------- py_planestick: Python ----------
# r: compas>=2.14.1
# venv: sticks

import sys
import os
import math

#get current file path
path = ghenv.Component.OnPingDocument().FilePath
print (path)
#get parent directory of the parent directory
parentdir = os.path.dirname(path)
print (parentdir)
#get src folder which contains classes
dire = os.path.join(parentdir,'scripts')
print (dire)

sys.path.append(dire)

from compas_rhino import unload_modules

unload_modules("Sticks")
unload_modules("stick_module")

import Sticks
from Sticks import Stick 
from stick_module import BranchingModule
from compas.geometry import Line, Point, Vector, Frame

stick_width = 13.0
stick_depth = 13.0

from compas_rhino.conversions import plane_to_compas_frame, frame_to_rhino_plane

# Convert input to compas
root = plane_to_compas_frame(root)

#create Stick from frame
my_axis = Line.from_point_and_vector(root.point, root.xaxis * stick_length)
my_stick = Stick(my_axis, z_vector = root.yaxis)
print (my_stick)

# Visualize
geometries = my_stick.geometry
# ---------- end py_planestick ----------
draw_5 = COMPASDraw(cg=py_planestick.geometries)  # -> rg; same code as draw

# ---- group: Py_GrowTowards
py_grow_towards = Python3Script(
    root_frame=py_grow_2.new_root_frame,
    face_index=Slider(3, range=0..3),
    offset_root_child=Slider(47, range=0..100),
    offset_target_child=Slider(31, range=0..100),
    target_plane=rotate_3d_2.Geometry)  # -> out, geometries, frames, root_child_frame, target_child_frame, r_target_frame, root_child_stick, target_child_stick; inputs face_index: Int32, offset_root_child: Double, target_plane: Plane
# ---------- py_grow_towards: Python ----------
# r: compas>=2.14.1
# venv: sticks

import sys
import os
import math

#get current file path
path = ghenv.Component.OnPingDocument().FilePath
print (f'path is', path)
#get parent directory of the parent directory
parentdir = os.path.dirname(path)
print (f'parant directory is', parentdir)
#get src folder which contains classes
dire = os.path.join(parentdir,'scripts')
print (f'src folder is', dire)

sys.path.append(dire)

from compas_rhino import unload_modules

unload_modules("Sticks")
unload_modules("stick_module")
unload_modules("stick_growth")

"""
import file specific classes

"""

import Sticks
from Sticks import Stick 
from stick_growth import GrowTowards, compare_angles, get_plane_from_frame
"""
Default variables
"""

stick_width = 13.0
stick_depth = 13.0

from compas_rhino.conversions import plane_to_compas_frame, frame_to_rhino_plane
from compas.geometry import Line, Point, Vector, Frame
from compas_rhino.conversions import line_to_rhino

"""
Growth Logic
"""

#Convert rhino (target plane) into compas frame
target_frame = plane_to_compas_frame(target_plane)

# Initialize tree
tree = GrowTowards(root_frame, target_frame, offset_root_child, offset_target_child, stick_length=200, width = stick_width, depth = stick_depth)

#Compare two frames
print (tree.normal_deviation)

#rotated (aligned target frame)ang
r_target_frame = tree.rotated_target_frame

#child_frames
root_child_frame = tree.root_child_frame
target_child_frame = tree.target_child_frame

#visualise child_frame
plane = get_plane_from_frame(target_child_frame)

#visualise intersection line
line = tree.frame_intersection
intersection = line_to_rhino(line)

#visualise bridge sticks
root_child_stick = tree.root_child_stick.geometry
target_child_stick = tree.target_child_stick.geometry

# Visualize
geometries = tree.visualize()
frames = [stick.frame for stick in tree.sticks]
# ---------- end py_grow_towards ----------

# ---- group: Frame visualisation
python_3_script_3 = Python3Script(frames=py_grow_towards.r_target_frame, factor=Slider(20, range=0..25))  # -> points, x_axis, y_axis, normal; inputs frames: list; same code as python_3_script
vector_display_ex_7 = VectorDisplayEx(
    Point=python_3_script_3.points,
    Vector=python_3_script_3.x_axis,
    Colour=ColourSwatch(SwatchColor=RGB(255, 0, 0)),
    Width=2)
vector_display_ex_8 = VectorDisplayEx(
    Point=python_3_script_3.points,
    Vector=python_3_script_3.y_axis,
    Colour=ColourSwatch(SwatchColor=RGB(0, 0, 255)),
    Width=2)
vector_display_ex_9 = VectorDisplayEx(
    Point=python_3_script_3.points,
    Vector=python_3_script_3.normal,
    Colour=ColourSwatch(SwatchColor=RGB(0, 255, 0)),
    Width=2)

# ----
draw_6 = COMPASDraw(cg=py_grow_towards.geometries)  # -> rg; same code as draw
draw_7 = COMPASDraw(cg=py_grow_towards.root_child_stick)  # -> rg; same code as draw
draw_8 = COMPASDraw(cg=py_grow_towards.target_child_stick)  # -> rg; same code as draw

# ---- group: Frame visualisation
python_3_script_4 = Python3Script(frames=[py_grow_towards.root_child_frame, py_grow_towards.target_child_frame], factor=Slider(20, range=0..25))  # -> points, x_axis, y_axis, normal; inputs frames: list; same code as python_3_script
vector_display_ex_10 = VectorDisplayEx(
    Point=python_3_script_4.points,
    Vector=python_3_script_4.x_axis,
    Colour=ColourSwatch(SwatchColor=RGB(255, 0, 0)),
    Width=2)
vector_display_ex_11 = VectorDisplayEx(
    Point=python_3_script_4.points,
    Vector=python_3_script_4.y_axis,
    Colour=ColourSwatch(SwatchColor=RGB(0, 0, 255)),
    Width=2)
vector_display_ex_12 = VectorDisplayEx(
    Point=python_3_script_4.points,
    Vector=python_3_script_4.normal,
    Colour=ColourSwatch(SwatchColor=RGB(0, 255, 0)),
    Width=2)
