# Grasshopper definition Root_Frames.gh (Grasshopper 1.0.8)
# plug-ins: Telepathy

# ---- group: _REF_LIBRARY
number_slider = Slider(9, range=0..90)  # disabled
choose_axis = Panel("X")  # disabled
number_slider_2 = Slider(12, range=-20..600)  # disabled
number_slider_3 = Slider(10, range=0..10)  # disabled
number_slider_4 = Slider(3, range=0..10)  # disabled
number_slider_5 = Slider(1, range=0..30)  # disabled
xy_plane = XYPlane(Origin=Point(0, 0, 0))  # disabled
crv = Curve(<curve referenced from the Rhino model>)  # disabled
rotate_root_planes = Python3Script(root_plane=xy_plane, rot_angle=number_slider, axis_choice=choose_axis)  # -> out, rot_rootplane; inputs root_plane: Plane, rot_angle: Double, axis_choice: String; disabled
# ---------- rotate_root_planes: Python ----------
import math
import Rhino.Geometry as rg

def rotate_plane(root_plane, rot_angle, axis= axis_choice):
    """Return a copy of root_plane `pl` rotated by `ang_deg` about its local axis."""
    p = rg.Plane(root_plane)  # copy
    ax = {'X': p.XAxis, 'Y': p.YAxis, 'Z': p.ZAxis}[axis.upper()]
    p.Rotate(math.radians(rot_angle), ax, p.Origin)
    return p


# from a single plane input
rot_rootplane = rotate_plane(root_plane, rot_angle, axis_choice)


# # from a list of planes: planes (list[rg.Plane]), angle_degrees (float), axis_choice ('X'/'Y'/'Z')
# rotated = [rotate_plane(pl, rot_angle, axis_choice) for pl in root_planes]

# # from a data tree
# from ghpythonlib.treehelpers import tree_to_list, list_to_tree

# planes_list = tree_to_list(input_planes)          # DataTree -> nested lists
# rot_list = [[rotate_plane(pl, angle_degrees, axis_choice) for pl in branch]
#             for branch in planes_list]
# output_planes = list_to_tree(rot_list)            # back to DataTree
# ---------- end rotate_root_planes ----------
py3 = Python3Script(
    curve=crv,
    num_sides=number_slider_4,
    radius=number_slider_3,
    total_height=number_slider_2,
    h_subdivisions=number_slider_5)  # -> out, column_mesh, list_points, center_points, column_mesh_rhino; inputs curve: Polyline, num_sides: Int32, radius: Int32, total_height: Int32, h_subdivisions: Int32; disabled
# ---------- py3: Python ----------
import mola
from mola import module_rhino
import math
import Rhino.Geometry as rg

def points_on_crv(curve):
    list_of_points = []
    for p in curve:
        pt = rg.Point3d(p)
        list_of_points.append(pt)
    return list_of_points

def points_on_polygon(num_sides, radius):   
    list_of_points = []
    theta = (2*math.pi)/num_sides
    for i in range(num_sides):
        angle = i * theta
        x = radius * math.cos(angle)
        y = radius * math.sin(angle)
        z = 0
        pt = rg.Point3d(x,y,z)
        list_of_points.append(pt)
    return list_of_points


if curve is not None:
    list_points = points_on_crv(curve)

else:
    list_points = points_on_polygon(num_sides, radius)



column_mesh = mola.Mesh()

new_pts = []

for layer_no in range (h_subdivisions +1):
    y = total_height/h_subdivisions * layer_no + float(114.5)
    for p in list_points:
        pt = rg.Point3d(p)
        pt[1] = y
        new_pts.append (pt)
        column_mesh.add_vertex(pt[0],pt[1], pt[2])

points_per_layer = len(list_points)

for layer_no in range (h_subdivisions):
    current_layer = layer_no * points_per_layer
    next_layer = (layer_no + 1) * points_per_layer
    for i in range (points_per_layer-1):
        next_i = (i+1) % points_per_layer

        v0 = column_mesh.vertices[current_layer + i]
        v1 = column_mesh.vertices[current_layer + next_i]
        v2 = column_mesh.vertices[next_layer + next_i]
        v3 = column_mesh.vertices[next_layer + i]

        column_mesh.add_face([v0,v1,v2,v3])

center_points = []
for f in (column_mesh.faces):
    c = f.center()
    
    pts = rg.Point3d(c.x, c.y, c.z)
    center_points.append(pts)

column_mesh.update_topology()
column_mesh_rhino = module_rhino.display_mesh(column_mesh)
# ---------- end py3 ----------
panel = Panel(rotate_root_planes.out)  # disabled
geo = Geometry(py3.column_mesh_rhino)  # disabled
geo_2 = Geometry(py3.list_points)  # disabled

# ----
height_subdiv = Slider(3, range=0..30)
twist_angle = Slider(11, range=0..30)
max_height = Slider(17, range=0..30)
height_subdiv_2 = Slider(3, range=0..30)
twist_angle_2 = Slider(11, range=0..30)
max_height_2 = Slider(17, range=0..30)
layers = Slider(14, range=0..30)
layers_2 = Slider(14, range=0..30)
curve = Curve(<curve referenced from the Rhino model>)
curve_2 = Curve(<curve referenced from the Rhino model>)
brep_any_shape = Python3Script(curve_input=curve, pt_spacing=layers, max_height=max_height, height_subdiv=height_subdiv, twist_angle=twist_angle)  # -> out, list_pts; inputs curve_input: Curve, pt_spacing: Int32, max_height: Int32, height_subdiv: Int32, twist_angle: Double
# ---------- brep_any_shape: Python ----------
import Rhino.Geometry as rg
import math



list_pts = []

# define points on curve
L = curve_input.GetLength()
t_params = curve_input.DivideByLength(float(pt_spacing), True)
div_pts  = [curve_input.PointAt(t) for t in t_params] 

# curve centroid
cx = sum(p.X for p in div_pts) / len(div_pts)
cy = sum(p.Y for p in div_pts) / len(div_pts)
center = rg.Point3d(cx, cy, 0.0)

# rotation by curve centroid
def rot_at_Z (pt, ang_rad, c):
    ca = math.cos(ang_rad)
    sa = math.sin(ang_rad)
    dx = pt.X - c.X
    dy = pt.Y - c.Y
    x = c.X + (dx*ca - dy*sa)
    y = c.Y + (dx*sa + dy*ca)
    return x, y

# extrude layers in the z-direction
for each_layer in range (height_subdiv +1):
    z = max_height/height_subdiv * each_layer 
    ang_rad = math.radians(twist_angle * each_layer)

    if each_layer % 2 == 0:
        for p in div_pts:
            x, y = rot_at_Z(p, ang_rad, center)
            list_pts.append (rg.Point3d(x, y, z))
    
    else:
        
        for j in range(len(div_pts)):

            mid_pt_x = (div_pts[j]+ div_pts[(j + 1) % len(div_pts)]).X * 0.5
            mid_pt_y = (div_pts[j]+ div_pts[(j + 1) % len(div_pts)]).Y * 0.5

            x, y = rot_at_Z(rg.Point3d(mid_pt_x,mid_pt_y, 0.0), ang_rad, center)
            list_pts.append(rg.Point3d(x, y, z))
    

        

# points_per_layer = len(div_pts)
# print(points_per_layer)
# # 2. Create points on each curve


# # divide curve twice as fine


# for row in range(num_layers):
#     for col, param in enumerate(params,):
#         pt = curve.point_at(param)
#         pt = pt.translated([0,0,Brick.HEIGHT * row])
#         tangent = curve.tangent_at(param)
#         normal = cross_vectors(tangent, [0,0,1])
#         # only place bricks on alternating divisions depending on the row
#         if row % 2 == 0:  
#             # even rows 
#             if col % 2 == 0:
#                 b = Brick(frame = Frame(pt, tangent, normal))
#                 bricks.append(b)
#         else:  
#             # odd rows 
#             if col % 2 == 1:
#                 b = Brick(frame = Frame(pt, tangent, normal))
#                 bricks.append(b)

# # Visualize and store brick data
# geometries = []
# way_planes = []

# for brick in bricks:
#     geometries.append(brick.draw())
#     way_planes.append(brick.get_pick_frame())
# ---------- end brep_any_shape ----------
brep_any_shape_2 = Python3Script(
    curve_input=curve_2,
    pt_spacing=layers_2,
    max_height=max_height_2,
    height_subdiv=height_subdiv_2,
    twist_angle=twist_angle_2)  # -> out, list_pts; inputs curve_input: Curve, pt_spacing: Int32, max_height: Int32, height_subdiv: Int32, twist_angle: Double
# ---------- brep_any_shape_2: Python ----------
import Rhino.Geometry as rg
import math



list_pts = []

# define points on curve
L = curve_input.GetLength()
t_params = curve_input.DivideByLength(float(pt_spacing), True)
div_pts  = [curve_input.PointAt(t) for t in t_params] 

# curve centroid
cx = sum(p.X for p in div_pts) / len(div_pts)
cy = sum(p.Y for p in div_pts) / len(div_pts)
center = rg.Point3d(cx, cy, 0.0)

# rotation by curve centroid
def rot_at_Z (pt, ang_rad, c):
    ca = math.cos(ang_rad)
    sa = math.sin(ang_rad)
    dx = pt.X - c.X
    dy = pt.Y - c.Y
    x = c.X + (dx*ca - dy*sa)
    y = c.Y + (dx*sa + dy*ca)
    return x, y

# extrude layers in the z-direction
for each_layer in range (height_subdiv +1):
    z = max_height/height_subdiv * each_layer 
    ang_rad = math.radians(twist_angle * each_layer)

    if each_layer % 2 == 0:
        for p in div_pts:
            x, y = rot_at_Z(p, ang_rad, center)
            list_pts.append (rg.Point3d(x, y, z))
    
    else:
        
        for j in range(len(div_pts)):

            mid_pt_x = (div_pts[j]+ div_pts[(j + 1) % len(div_pts)]).X * 0.5
            mid_pt_y = (div_pts[j]+ div_pts[(j + 1) % len(div_pts)]).Y * 0.5

            x, y = rot_at_Z(rg.Point3d(mid_pt_x,mid_pt_y, 0.0), ang_rad, center)
            list_pts.append(rg.Point3d(x, y, z))
# ---------- end brep_any_shape_2 ----------
list_pts = RemoteSender(brep_any_shape.list_pts)
list_pts_2 = RemoteSender(brep_any_shape_2.list_pts)
geometry = Geometry(list_pts)
geometry_2 = Geometry(list_pts_2)
rot_at_tan = Slider(0, range=-90..0)

rot_at_tan_2 = Slider(-90, range=-90..0)
list_pts_3 = RemoteReceiver([list_pts_2, list_pts])
planes_that_rotate = Python3Script(list_pts=list_pts_3, rot_at_tan=rot_at_tan_2, rot_at_norm=rot_at_tan)  # -> out, way_planes; inputs list_pts: list of Point3d, rot_at_tan: Double
# ---------- planes_that_rotate: Python ----------
import Rhino.Geometry as rg
import math

#define a vector by the rel. coordinates of two consecutive points
def vec(a, b):
    return rg.Vector3d(b.X - a.X, b.Y - a.Y, b.Z - a.Z)

# set up
Z = rg.Vector3d(0, 0, 1)
way_planes = []
n = len(list_pts)

for i, pt in enumerate(list_pts):
    # estimate tangent
    if  i == 0:
        tan = vec(list_pts[0], list_pts[1])
    elif i == n - 1:
        tan = vec(list_pts[n - 2], list_pts[n - 1])
    else:
        tan = vec(list_pts[i - 1], list_pts[i + 1])

    # keep planes horizontal (about global Z)
    tan.Z = 0.0
    if not tan.Unitize():                     # guard zero-length & keeps tan to local pt coordinates
        tan = rg.Vector3d(1, 0, 0)

    norm = rg.Vector3d.CrossProduct(Z, tan)   
    if not norm.Unitize():                   # guard parallel cases
        norm = rg.Vector3d(0, 1, 0)

    # base plane
    pl = rg.Plane(pt, tan, norm)

    # rotation around tangent 
    ang_tan = math.radians(rot_at_tan)
    R_tan = rg.Transform.Rotation(ang_tan, tan, pt)
    pl.Transform(R_tan)

    # rotate the 'norm' as well, and use the updated plane
    norm_rot = rg.Vector3d(norm)
    norm_rot.Transform(R_tan)

    # then rotation around normal
    ang_norm = math.radians(rot_at_norm)
    R_norm = rg.Transform.Rotation(ang_norm, norm_rot, pt)
    pl.Transform(R_norm)

    way_planes.append(pl)
# ---------- end planes_that_rotate ----------

remote_receiver = RemoteReceiver()
panel_2 = Panel(remote_receiver)

list_pts_4 = RemoteReceiver([list_pts_2, list_pts])
point_list = PointList(Points=list_pts_4, Size=Slider(2, range=0..10))

way_planes = RemoteSender(planes_that_rotate.way_planes)
geometry_3 = Geometry(planes_that_rotate.way_planes)
root_planes = Python3Script()  # -> out, root_planes; unedited script template
face_index = Slider(3.6, range=0..4)
angle = Slider(3.6, range=0..90)
offset = Slider(3.6, range=0..10)
way_planes_2 = RemoteReceiver(way_planes)
python_3_script = Python3Script(way_planes=way_planes_2, face_index=face_index, angle=angle, offset=offset)  # -> out, geometries; inputs face_index: Int32, angle: Double, offset: Double
# ---------- python_3_script: Python ----------
# r: compas>=2.14.1
# venv: sticks

import sys
import os
import math

#get current file path
path = ghenv.Component.OnPingDocument().FilePath
print (path)
#get parent directory of the parent directory
parentdir = os.path.dirname(path)
print (parentdir)
#get src folder which contains classes
dire = os.path.join(parentdir,'scripts')
print (dire)

sys.path.append(dire)

from compas_rhino import unload_modules

unload_modules("Sticks")
unload_modules("stick_module")

import Sticks
from Sticks import Stick 
from stick_module import BranchingModule
from compas.geometry import Line, Point, Vector, Frame

stick_width = 13.0
stick_depth = 13.0

from compas_rhino.conversions import plane_to_compas_frame, frame_to_rhino_plane

# Convert way_planes input to compas
root_frames = []
for pl in way_planes:
    root_frames.append(plane_to_compas_frame(pl))

# Initialize tree
for f in root_frames:
    tree = BranchingModule(f, stick_length=200, width = stick_width, depth = stick_depth)

# Grow tree
tree.grow_stick(face_index = face_index, angle = angle, offset = offset)
tree.grow_stick(face_index = face_index, angle = angle, offset = offset)
tree.grow_stick(face_index = face_index, angle = angle, offset = offset)

# Visualize
geometries = tree.visualize()
# ---------- end python_3_script ----------
draw = COMPASDraw(cg=python_3_script.geometries)  # -> rg
#   port cg: The COMPAS geometry or datastructure to be drawn.
#   port rg: The Rhino geometry object.
# ---------- draw: Python ----------
# r: compas>=2.14.1
"""
Draws COMPAS geometry in Grasshopper.
"""

from typing import Any

import Grasshopper

from compas.scene import SceneObject


class CompasToRhinoGeometry(Grasshopper.Kernel.GH_ScriptInstance):
    def RunScript(self, cg):
        if not cg:
            return None

        return SceneObject(item=cg).draw()
# ---------- end draw ----------
