# Grasshopper definition 103_loop_sticks_WN.gh (Grasshopper 1.0.8)

# ----
# LoopBranchStable
number_slider = Slider(0, range=0..100)
construct_point = ConstructPoint(XCoordinate=Slider(5000, range=0..10000), YCoordinate=Slider(0, range=0..100), ZCoordinate=number_slider)
xy_plane = XYPlane(Origin=construct_point)
python_3_script = Python3Script(root=xy_plane, stick_length=Slider(200, range=0..1000), offset=Slider(34, range=0..100))  # -> out, geometries
# ---------- python_3_script: Python ----------
# r: compas>=2.14.1
# venv: sticks

import sys
import os
import math


# get current file path
path = ghenv.Component.OnPingDocument().FilePath
print(path)
# get parent directory of the parent directory
parentdir = os.path.dirname(path)
print(parentdir)
# get src folder which contains classes
dire = os.path.join(parentdir, "scripts")
print(dire)

sys.path.append(dire)


from compas_rhino import unload_modules

unload_modules("Sticks")
unload_modules("stick_module")

import Sticks
from Sticks import Stick 
from stick_module_WN import LoopBranchModuleStable
from compas.geometry import Line, Point, Vector, Frame

stick_width = 13.0
stick_depth = 13.0

from compas_rhino.conversions import plane_to_compas_frame, frame_to_rhino_plane

# Convert input to compas
root = plane_to_compas_frame(root)
loop = LoopBranchModuleStable(
    root_frame = root,
    stick_length = 200,
    num_segments = 10,
    min_turn = math.radians(15),
    max_turn = math.radians(120),
    overlap_distance = 30,
    last_length_limit = 50,
    offset = offset,
    depth = 13,
    width = 13,
    min_distance = 30,
    closure_tol = 1.0,
    max_attempts = 200
)
geometries = loop.visualize()
# ---------- end python_3_script ----------
draw = COMPASDraw(cg=python_3_script.geometries)  # -> rg
#   port cg: The COMPAS geometry or datastructure to be drawn.
#   port rg: The Rhino geometry object.
# ---------- draw: Python ----------
# r: compas>=2.14.1
"""
Draws COMPAS geometry in Grasshopper.
"""

from typing import Any

import Grasshopper

from compas.scene import SceneObject


class CompasToRhinoGeometry(Grasshopper.Kernel.GH_ScriptInstance):
    def RunScript(self, cg):
        if not cg:
            return None

        return SceneObject(item=cg).draw()
# ---------- end draw ----------

# ----
# CurveLoop
number_slider_2 = Slider(8000, range=0..10000)
construct_point_2 = ConstructPoint(XCoordinate=number_slider_2, YCoordinate=Slider(0, range=0..100), ZCoordinate=Slider(0, range=0..100))
xy_plane_2 = XYPlane(Origin=construct_point_2)
curve = Curve(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)
python_3_script_2 = Python3Script(root=xy_plane_2, curve=curve, stick_length=Slider(200, range=0..1000), offset=Slider(58, range=0..100))  # -> out, geometries; inputs curve: Curve, offset: Int32
# ---------- python_3_script_2: Python ----------
# r: compas>=2.14.1
# venv: sticks

import sys
import os
import math

# get current file path
path = ghenv.Component.OnPingDocument().FilePath
print(path)
# get parent directory of the parent directory
parentdir = os.path.dirname(path)
print(parentdir)
# get src folder which contains classes
dire = os.path.join(parentdir, "scripts")
print(dire)

sys.path.append(dire)

from compas_rhino import unload_modules

unload_modules("Sticks")
unload_modules("stick_module")

import Sticks
from Sticks import Stick
from stick_module_WN import CurveLoopModule
from compas.geometry import Line, Point, Vector, Frame
from compas_rhino.conversions import curve_to_compas

stick_width = 13.0
stick_depth = 13.0

from compas_rhino.conversions import plane_to_compas_frame, frame_to_rhino_plane

# Convert input to compas
root = plane_to_compas_frame(root)
my_curve = curve_to_compas(curve)
loop = CurveLoopModule(my_curve, stick_length, offset, stick_width, stick_depth)
geometries = loop.visualize()
# ---------- end python_3_script_2 ----------
# TowerLoop
draw_2 = COMPASDraw(cg=python_3_script_2.geometries)  # -> rg; same code as draw

# ----
# LoopBranch3D
number_slider_3 = Slider(0, range=0..100)
construct_point_3 = ConstructPoint(XCoordinate=Slider(3000, range=0..10000), YCoordinate=Slider(0, range=0..100), ZCoordinate=number_slider_3)
xy_plane_3 = XYPlane(Origin=construct_point_3)
python_3_script_3 = Python3Script(root=xy_plane_3, stick_length=Slider(200, range=0..1000), offset=Slider(34, range=0..100))  # -> out, geometries
# ---------- python_3_script_3: Python ----------
# r: compas>=2.14.1
# venv: sticks

import sys
import os
import math


# get current file path
path = ghenv.Component.OnPingDocument().FilePath
print(path)
# get parent directory of the parent directory
parentdir = os.path.dirname(path)
print(parentdir)
# get src folder which contains classes
dire = os.path.join(parentdir, "scripts")
print(dire)

sys.path.append(dire)


from compas_rhino import unload_modules

unload_modules("Sticks")
unload_modules("stick_module")

import Sticks
from Sticks import Stick 
from stick_module_WN import LoopBranchModule3D, LoopBranchModule3DWithFaces, FaceConnectedLoop3D
from compas.geometry import Line, Point, Vector, Frame

stick_width = 13.0
stick_depth = 13.0

from compas_rhino.conversions import plane_to_compas_frame, frame_to_rhino_plane

# Convert input to compas
root = plane_to_compas_frame(root)
loop = LoopBranchModule3DWithFaces(
    root_frame=root,
    stick_length=600,
    num_segments=8,
    face_sequence=[0, 1, 2, 3, 0, 1, 2],  # 指定每个连接用哪个face
    rotation_mode='constrained'
)
geometries = loop.visualize()
# ---------- end python_3_script_3 ----------
draw_3 = COMPASDraw(cg=python_3_script_3.geometries)  # -> rg; same code as draw

construct_point_4 = ConstructPoint(XCoordinate=Slider(1000, range=0..10000), YCoordinate=Slider(0, range=0..100), ZCoordinate=Slider(0, range=0..100))
python_3_script_4 = Python3Script()  # -> out, a
# ---------- python_3_script_4: Python ----------
# r: compas>=2.14.1
# venv: sticks

import sys
import os
import math

# get current file path
path = ghenv.Component.OnPingDocument().FilePath
print(path)
# get parent directory of the parent directory
parentdir = os.path.dirname(path)
print(parentdir)
# get src folder which contains classes
dire = os.path.join(parentdir, "scripts")
print(dire)

sys.path.append(dire)

from compas_rhino import unload_modules

unload_modules("Sticks")
unload_modules("stick_module")

import Sticks
from Sticks import Stick
from stick_module_WN import CurveLoopModule
from compas.geometry import Line, Point, Vector, Frame
from compas_rhino.conversions import curve_to_compas

from compas.geometry import Transformation
from compas_rhino.conversions import plane_to_compas_frame, frame_to_rhino_plane
import scriptcontext as sc
import random

from Grasshopper import DataTree
from Grasshopper.Kernel.Data import GH_Path

path = 'D:\\0000_ETH_DFAB\\Github\\MAS-2526\\08_SpatialAssemblies\\StudentProjects\\group_two\\J3RRY_Sticks_^o^\\scripts\\Package_v2'
sys.path.append(path)

unload_modules('J3RRY_SingleStick_v1')
unload_modules('J3RRY_Aggregation_v3')
unload_modules('J3RRY_Collision_v1')

from J3RRY_SingleStick_v1 import Stick
from J3RRY_Aggregation_v3 import Aggregation
from J3RRY_Collision_v1 import Collision


stick_width = 13.0
stick_depth = 13.0

from compas_rhino.conversions import plane_to_compas_frame, frame_to_rhino_plane

# Convert input to compas
root = plane_to_compas_frame(root)


import traceback

# -----------------------------------------------------------
# 工具函数：DFS 搜索树状结构，收集 root→leaf 路径
# -----------------------------------------------------------
def collect_branch_paths(root_sticks):
    paths = []

    def dfs(stick, current_path):
        new_path = current_path + [stick]

        # 叶节点：无 children
        if not hasattr(stick, "children") or not stick.children:
            paths.append(new_path)
            return
        
        # 递归每个 child
        for c in stick.children:
            dfs(c, new_path)

    for r in root_sticks:
        dfs(r, [])

    return paths


# -----------------------------------------------------------
# 工具函数：path → polyline curve
# stick.axis.midpoint → 曲线点
# -----------------------------------------------------------
from compas.geometry import Polyline

def path_to_curve(path):
    pts = [s.axis.midpoint for s in path]
    return Polyline(pts)


# -----------------------------------------------------------
# 构建模块
# -----------------------------------------------------------
def build_modules_from_paths(paths, segment_length):
    modules = []
    for p in paths:
        try:
            curve = path_to_curve(p)
            module = CurveLoopModule(curve, segment_length)
            modules.append(module)
        except Exception:
            print("Error building module from path:", traceback.format_exc())
    return modules


# -----------------------------------------------------------
# 构建 branch bridges（父子 stick 之间）
# 这里简单连接 module 内部相邻两段
# -----------------------------------------------------------
def build_branch_bridges(paths, modules):
    bridges = []
    for path, module in zip(paths, modules):
        sticks = module.get_sticks()
        for i in range(len(sticks) - 1):
            s0 = sticks[i]
            s1 = sticks[i + 1]
            try:
                b = stick_bridge(s0, s1)
                bridges.append(b)
            except Exception:
                print("Error building bridge:", traceback.format_exc())
    return bridges


# -----------------------------------------------------------
# MAIN EXECUTION
# -----------------------------------------------------------

if A is None:
    Modules = []
    Bridges = []
else:
    # 1. 找所有 root→leaf 路径
    paths = collect_branch_paths(A)

    # 2. 转成 CurveLoopModule
    Modules = build_modules_from_paths(paths, seglen)

    # 3. 可选构建 bridges
    if make_bridges:
        Bridges = build_branch_bridges(paths, Modules)
    else:
        Bridges = []
# ---------- end python_3_script_4 ----------
xy_plane_4 = XYPlane(Origin=construct_point_4)
python_3_script_5 = Python3Script(
    root=xy_plane_4,
    num_levels=Slider(2, range=0..10),
    level_height=Slider(366, range=0..1000),
    stick_length=Slider(200, range=0..1000),
    num_segments=Slider(8, range=0..10),
    min_turn=Slider(20, range=0..180),
    max_turn=Slider(79, range=0..360),
    offset=Slider(34, range=0..100),
    seed=Slider(42, range=0..100))  # -> out, geometries; inputs num_levels: Int32, level_height: Int32, num_segments: Int32, min_turn: Int32, max_turn: Int32, seed: Int32
# ---------- python_3_script_5: Python ----------
# r: compas>=2.14.1
# venv: sticks

import sys
import os
import math


# get current file path
path = ghenv.Component.OnPingDocument().FilePath
print(path)
# get parent directory of the parent directory
parentdir = os.path.dirname(path)
print(parentdir)
# get src folder which contains classes
dire = os.path.join(parentdir, "scripts")
print(dire)

sys.path.append(dire)


from compas_rhino import unload_modules

unload_modules("Sticks")
unload_modules("stick_module")

import Sticks
from Sticks import Stick 
from stick_module_WN import LoopBranchModuleStable, TowerGenerator
from compas.geometry import Line, Point, Vector, Frame

stick_width = 13.0
stick_depth = 13.0

from compas_rhino.conversions import plane_to_compas_frame, frame_to_rhino_plane

# Convert input to compas
root = plane_to_compas_frame(root)
tower = TowerGenerator(
        root_frame=root,
        num_levels=num_levels,
        level_height=level_height,
        stick_length=stick_length,
        num_segments=num_segments,
        min_turn=min_turn,
        max_turn=max_turn,
        offset=offset,
        connector_stick_width=13
)
geometries = tower.visualize()
# ---------- end python_3_script_5 ----------
draw_4 = COMPASDraw(cg=python_3_script_5.geometries)  # -> rg; same code as draw
