# Grasshopper definition Dec_11_Wanchen_Fabrication_V9.ghx (Grasshopper 1.0.8)
# plug-ins: Weaverbird

# ----
# Multiple Aggregations and Branches:
# Week 3 Prototype (Fixed Params)
number_slider = Slider(700, range=0..10000)
neg = Negative(Value=number_slider)
neg_2 = Negative(Value=Slider(150, range=0..1000))
neg_3 = Negative(Value=Slider(0, range=0..1000))
pt = ConstructPoint(XCoordinate=number_slider, YCoordinate=neg_2, ZCoordinate=neg_3)
pt_2 = Point(pt)
Z = UnitZ(Factor="-10")
number_slider_2 = Slider(150, range=0..1000)
move = Move(Geometry=pt_2, Motion=Z)  # -> Geometry, Transform
addition = Addition(A=number_slider_2, B=Slider(28, range=0..100))
py3 = Python3Script(origin=pt_2, legs=Slider(3, range=0..10), r=number_slider_2, incline=Slider(-8, range=-90..90))  # -> out, plns_out; inputs origin: Point3d, legs: Int32, r: Double, incline: Double
# ---------- py3: Python ----------
import Rhino.Geometry as rg
import math


plns = []
for i in range(legs):
    theta = 2 * math.pi * (i / legs)
    x = origin.X + r * math.cos(theta)
    y = origin.Y + r * math.sin(theta)
    pt = rg.Point3d(x, y, origin.Z)

    pln = rg.Plane(pt, rg.Vector3d.ZAxis)
    pln.Rotate(theta, rg.Vector3d.ZAxis)
    pln.Rotate(-math.pi / 2, pln.YAxis)
    pln.Rotate(math.radians(incline), pln.YAxis)
    plns.append(pln)

plns_out = plns
# ---------- end py3 ----------
polygon = Polygon(Plane=move.Geometry, Radius=addition, Segments=Slider(12, range=0..20), FilletRadius=0)  # -> Polygon, Length
offset = OffsetCurve(Curve=polygon.Polygon, Distance=Slider(262, range=0..1000), Corners=1)
Z_2 = UnitZ(Factor=Slider(1200, range=0..10000))
cluster = Cluster(pln=py3.plns_out, num=30)
disc = Discontinuity(Curve=polygon.Polygon, Level=1)  # -> Points, Parameters
move_2 = Move(Geometry=offset, Motion=Z_2)  # -> Geometry, Transform
shift = ShiftList(List=disc.Points, Shift="-1", Wrap=True)
disc_2 = Discontinuity(Curve=move_2.Geometry, Level=1)  # -> Points, Parameters
long = LongestList(ListA=shift, ListB=disc.Points, ListC=move.Geometry, PaddingMode=2)  # -> ListA, ListB, ListC
shift_2 = ShiftList(List=disc_2.Points, Shift="-1", Wrap=True)
long_2 = LongestList(ListA=shift, ListB=disc.Points, ListC=disc_2.Points, ListD=shift_2, PaddingMode=2)  # -> ListA, ListB, ListC, ListD
transform = Transform(Geometry=move.Geometry, Transform=move_2.Transform)
merge = Merge(Data1=graft(long.ListA), Data2=graft(long.ListB), Data3=graft(long.ListC))  # -> reverse(Result)
merge_2 = Merge(Data1=graft(long_2.ListA), Data2=graft(long_2.ListB), Data3=graft(long_2.ListC), Data4=graft(long_2.ListD))
long_3 = LongestList(ListA=shift_2, ListB=disc_2.Points, ListC=transform, PaddingMode=2)  # -> ListA, ListB, ListC
conmesh = ConstructMesh(Vertices=merge, Faces={A=0, B=1, C=2, D=2})
merge_3 = Merge(Data1=graft(long_3.ListA), Data2=graft(long_3.ListB), Data3=graft(long_3.ListC))
conmesh_2 = ConstructMesh(Vertices=merge_2, Faces={A=0, B=1, C=2, D=3})
conmesh_3 = ConstructMesh(Vertices=merge_3, Faces={A=0, B=1, C=2, D=2})
merge_4 = Merge(Data1=simplify(conmesh), Data2=simplify(conmesh_2), Data3=simplify(conmesh_3))  # -> flatten(Result)
mjoin = MeshJoin(Meshes=merge_4)
mesh = Mesh(mjoin)
panel = Panel("""200
400""")
list = ValueList({"Regular": 0, "Random": 1}, selected="Random")
wbedges = WeaverbirdsMeshEdges(MeshOrPolylines=mesh)
pln = Plane(py3.plns_out)
panel_2 = Panel("""20
160""")
py3_2 = Python3Script(
    first_plns=pln,
    length_pattern=panel,
    angle_pattern=panel_2,
    agg_type=list,
    seed="91",
    agg_count="3",
    agg_round="2",
    branch_count="3",
    max_attempts="10",
    boundary_mesh=mesh)  # -> out, geo_out, frame_out, pln_out, axis_out, failed_sticks, valid_sticks, collision_log, Sticks_out, agg_manager; inputs first_plns: list of Plane, length_pattern: list of Double, angle_pattern: list of Double, agg_type: Int32, seed: Int32, agg_count: Int32, agg_round: Int32, branch_count: Int32, max_attempts: Int32, boundary_mesh: Mesh
# ---------- py3_2: Python ----------
#locate stick class file in the same folder
from compas_rhino import unload_modules
import sys
import os
"""
#get current file path
path = ghenv.Component.OnPingDocument().FilePath
#get parent directory of the parent directory
parentdir = os.path.dirname(path)
#get src folder which contains classes
dire = os.path.join(parentdir,'scripts')

sys.path.append(dire)"""

path = 'D:\\0000_ETH_DFAB\\Github\\MAS-2526\\08_SpatialAssemblies\\StudentProjects\\group_two\\J3RRY_Sticks_^o^\\scripts\\Package_v2'
sys.path.append(path)

unload_modules('J3RRY_SingleStick_v1')
unload_modules('J3RRY_Aggregation_v3')
unload_modules('J3RRY_Collision_v1')

from J3RRY_SingleStick_v1 import Stick
from J3RRY_Aggregation_v3 import Aggregation, AggregationManager
from J3RRY_Collision_v1 import Collision

from compas.geometry import Line, Point, Vector
from compas.geometry import Transformation
from compas_rhino.conversions import plane_to_compas_frame, frame_to_rhino_plane
import scriptcontext as sc
import random


from Grasshopper import DataTree
from Grasshopper.Kernel.Data import GH_Path

"""Main Code"""
# Convert rhino plane to compas frame
first_frames = [plane_to_compas_frame(p) for p in first_plns]
# Create aggregation manager
agg_manager = AggregationManager()
# Run aggregations
all_rounds = agg_manager.run_multiround_aggregation(
    first_frames,
    length_pattern,
    angle_pattern,
    agg_type,
    seed,
    agg_count,
    agg_round,
    branch_count,
    boundary_mesh,
    max_attempts)
# Get graph
graph = agg_manager.graph
print (graph)


# Visualization
geo_tree = DataTree[object]()
axis_tree = DataTree[object]()
frame_tree = DataTree[object]()
pln_tree = DataTree[object]()
Sticks_tree = DataTree[object]()

for i, agg in enumerate(agg_manager.aggs):
    path = GH_Path(graph[i])
    print (path)
    for s in agg.sticks:
        geo_tree.Add(s.geometry, path)
        axis_tree.Add(s.axis, path)
        frame_tree.Add(s.frame, path)
        pln_tree.Add(frame_to_rhino_plane(s.frame), path)
        Sticks_tree.Add(s, path)

geo_out = geo_tree
axis_out = axis_tree
frame_out = frame_tree
pln_out = pln_tree
Sticks_out = Sticks_tree



# Log
failed_sticks = DataTree[object]()
valid_sticks = DataTree[object]()
for i, agg in enumerate(agg_manager.aggs):
    for j, branch in enumerate(agg.failed_sticks):
        path = GH_Path(*graph[i] + [j + 1])
        for s in branch:
            failed_sticks.Add(s.geometry, path)

    for j, branch in enumerate(agg.valid_sticks):
        path = GH_Path(*graph[i] + [j + 1])
        for s in branch:
            valid_sticks.Add(s.geometry, path)



collision_log = DataTree[object]()
for i, agg in enumerate(agg_manager.aggs):
    for j, log in enumerate(agg.collision_log):
        path = GH_Path(graph[i] + [j + 1])
        collision_log.Add(f"attempts = {log['attempts']}", path)
        collision_log.Add(f"fail_count = {log['fail_count']}", path)
        collision_log.Add(f"success = {log['success']}", path)
        collision_log.Add(f"reason = {log['reason']}", path)
        collision_log.Add(f"length = {log['params']['length']}", path)    
        collision_log.Add(f"angle = {log['params']['angle']}", path)
        collision_log.Add(f"from_index = {log['params']['from_index']}", path)
        collision_log.Add(f"to_index = {log['params']['to_index']}", path)
        collision_log.Add(f"from_t = {log['params']['from_t']}", path)
        collision_log.Add(f"to_t = {log['params']['to_t']}", path)
# ---------- end py3_2 ----------
panel_3 = Panel(py3_2.collision_log)

# ----
# * Pick Up Station Coordinates
# * Holding Jig Coordinates
panel_4 = Panel("""{527.26, -296.47, 11.71}
{527.26, 111.91, 12.98}
{467.80, -296.11, 12.62}""")
panel_5 = Panel("""{843.9, -128.0, 19.0}
{841.4, -78.9, 15.8}
{793.7, -132.5, 19.3}""")
item = ListItem(List=panel_4, Index=0, Wrap=True)  # -> Item, Item1, Item2
item_2 = ListItem(List=panel_5, Index=0, Wrap=True)  # -> Item, Item1, Item2
pt_3 = Point(item.Item2)
pt_4 = Point(item.Item)
pt_5 = Point(item.Item1)
pt_6 = Point(item_2.Item2)
pt_7 = Point(item_2.Item)
pt_8 = Point(item_2.Item1)
py3_3 = Python3Script(origin=pt_4, x=pt_5, y=pt_3)  # -> out, jig_frame_list, pln_200, pln_400, pick_frame_200, pick_frame_400; inputs origin: Point3d, x: Point3d, y: Point3d
# ---------- py3_3: Python ----------
from compas.geometry import Vector
from compas.geometry import Frame
from compas.geometry import Translation
from compas.geometry import Rotation
from compas_rhino.conversions import point_to_compas
from compas_rhino.conversions import frame_to_rhino_plane

import math

jig_frame_list = []

o_pt = point_to_compas(origin)
x_pt = point_to_compas(x)
y_pt = point_to_compas(y)

x_v = Vector.from_start_end(o_pt, x_pt)
y_v = Vector.from_start_end(o_pt, y_pt)

jig_frame = Frame(o_pt, x_v, y_v)

angle = 0

R = Rotation.from_axis_and_angle(jig_frame.yaxis, math.radians(angle), jig_frame.point)
rotated_jig_frame = jig_frame.transformed(R)

v_jig_to_stick_frame_200 = jig_frame.xaxis * 54.0 + jig_frame.yaxis * 12.59 + jig_frame.zaxis * -3.5
T_200 = Translation.from_vector(v_jig_to_stick_frame_200)

v_jig_to_stick_frame_400 = jig_frame.xaxis * 3.9 + jig_frame.yaxis * 49.5 + jig_frame.zaxis * -3.5
T_400 = Translation.from_vector(v_jig_to_stick_frame_400)

pick_frame_200 = rotated_jig_frame.transformed(T_200)
jig_frame_list.append(pick_frame_200)
pick_frame_400 = rotated_jig_frame.transformed(T_400)
jig_frame_list.append(pick_frame_400)
pick_frame_300 = pick_frame_400.copy()
jig_frame_list.append(pick_frame_300)

pln_200 = frame_to_rhino_plane(pick_frame_200)
pln_400 = frame_to_rhino_plane(pick_frame_400)
# ---------- end py3_3 ----------
py3_4 = Python3Script(origin=pt_7, x=pt_8, y=pt_6)  # -> out, pln_out, holding_frame; inputs origin: Point3d, x: Point3d, y: Point3d
# ---------- py3_4: Python ----------
from compas.geometry import Vector
from compas.geometry import Frame
from compas.geometry import Translation
from compas.geometry import Rotation
from compas_rhino.conversions import point_to_compas, frame_to_rhino_plane

import math

o_pt = point_to_compas(origin)
x_pt = point_to_compas(x)
y_pt = point_to_compas(y)

x_v = Vector.from_start_end(o_pt, x_pt)
y_v = Vector.from_start_end(o_pt, y_pt)

jig_frame = Frame(o_pt, x_v, y_v)

angle = -90

R = Rotation.from_axis_and_angle(jig_frame.yaxis, math.radians(angle), jig_frame.point)
rotated_jig_frame = jig_frame.transformed(R)

v_jig_to_stick_frame = jig_frame.xaxis * 24.5 + jig_frame.yaxis * 24.5 + jig_frame.zaxis * 15.0
T = Translation.from_vector(v_jig_to_stick_frame)

holding_frame = rotated_jig_frame.transformed(T)
pln_out = frame_to_rhino_plane(holding_frame)
# ---------- end py3_4 ----------
compas_draw = COMPASDraw(cg=py3_3.jig_frame_list)  # -> rg
#   port cg: The COMPAS geometry or datastructure to be drawn.
#   port rg: The Rhino geometry object.
# ---------- compas_draw: Python ----------
# r: compas>=2.14.1
"""
Draws COMPAS geometry in Grasshopper.
"""

from typing import Any

import Grasshopper

from compas.scene import SceneObject


class CompasToRhinoGeometry(Grasshopper.Kernel.GH_ScriptInstance):
    def RunScript(self, cg):
        if not cg:
            return None

        return SceneObject(item=cg).draw()
# ---------- end compas_draw ----------
cluster_2 = Cluster(pln=py3_3.pln_200, num=30)
cluster_3 = Cluster(pln=py3_3.pln_400, num=30)
cluster_4 = Cluster(pln=py3_4.pln_out, num=30)

# ----
# Fabrication
# type list
pln_2 = Plane(Plane(origin=(1125.379177, -423.464351, 72.59458203), x=(0, 1, 0), y=(-1, 0, 0)))
number_slider_3 = Slider(0, range=0..20)
data = Data(py3_2.agg_manager)
pt_9 = Point(Point(1189.669348, -217.5168097, 0))
py3_5 = Python3Script(
    agg_manager=data,
    robot_position=pt_9,
    pick_up_station=py3_3.pln_200,
    holding_jig=py3_4.pln_out,
    which_module=number_slider_3,
    save=Button())  # -> out, joint_plns, fab_stick_geos, target_plns, fab, port, t_vals_out, lengths_out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; inputs robot_position: Point3d, pick_up_station: Plane, holding_jig: Plane, which_module: Int32, save: Boolean
# ---------- py3_5: Python ----------
#locate stick class file in the same folder
from compas_rhino import unload_modules
import sys
import os
"""
#get current file path
path = ghenv.Component.OnPingDocument().FilePath
#get parent directory of the parent directory
parentdir = os.path.dirname(path)
#get src folder which contains classes
dire = os.path.join(parentdir,'scripts')

sys.path.append(dire)"""

path = 'D:\\0000_ETH_DFAB\\Github\\MAS-2526\\08_SpatialAssemblies\\StudentProjects\\group_two\\J3RRY_Sticks_^o^\\scripts\\Package_v2'
sys.path.append(path)

unload_modules('J3RRY_SingleStick_v1')
unload_modules('J3RRY_Aggregation_v3')
unload_modules('J3RRY_Collision_v1')
unload_modules('J3RRY_Fabrication_v1')

from J3RRY_SingleStick_v1 import Stick
from J3RRY_Aggregation_v3 import Aggregation, AggregationManager
from J3RRY_Collision_v1 import Collision
from J3RRY_Fabrication_v1 import Fabrication

from compas.geometry import Line, Point, Vector, Frame
from compas.geometry import Transformation
from compas_rhino.conversions import plane_to_compas_frame, frame_to_rhino_plane
from compas_rhino.conversions import point_to_compas
import scriptcontext as sc
import random, math


from Grasshopper import DataTree
from Grasshopper.Kernel.Data import GH_Path

"""Main Code"""
graph = agg_manager.graph
print (graph)
# Construct Fab
fab = Fabrication(agg_manager)

# Add adjacent sticks FIRST
sticks_with_adjacent, agg_indices, stick_indices = fab.add_adjacent_sticks(False)
print (agg_indices)
print (stick_indices)


# Erect modules with adjacent sticks
erected_modules = fab.erect_modules(sticks_with_adjacent)

# Get joint plns from erected modules
joint_frames = fab.get_joint_frames(erected_modules)

# Evaluate target frames
if robot_position:
    robot_position = point_to_compas(robot_position)
else:
    robot_position = Point(0,0,0)
target_frames, face_indices, t_values = fab.eval_target_frames(
    fab.erected_modules, robot_position
    )
print (face_indices)
print (t_values)


#try rotate target frame
# for branch in target_frames:
#     for f in branch:
#         f.rotate(math.pi, f.zaxis, f.point)

# Sent sticks to pick up station
# Get pick up frame
pick_up_station_frame = plane_to_compas_frame(pick_up_station)
pick_up_sticks, pick_up_frames = fab.send_to_pick_up_station(
    fab.erected_modules, pick_up_station_frame)

# Sent sticks to holding jig
holding_jig_frame = plane_to_compas_frame(holding_jig)
place_sticks, place_frames = fab.send_to_holding_jig(
    fab.erected_modules, holding_jig_frame)


#Output
fab_stick_geos = DataTree[object]()
for i, branch in enumerate(erected_modules):
    path = GH_Path(*graph[i])
    for stick in branch:
        fab_stick_geos.Add(stick.geometry, path)

joint_plns = DataTree[object]()
for i, branch in enumerate(joint_frames):
    path = GH_Path(*graph[i])
    for frame in branch:
        pln = frame_to_rhino_plane(frame)
        joint_plns.Add(pln, path)

target_plns = DataTree[object]()
for i, branch in enumerate(target_frames):
    path = GH_Path(*graph[i])
    for frame in branch:
        pln = frame_to_rhino_plane(frame)
        target_plns.Add(pln, path)



#get current file path
path = ghenv.Component.OnPingDocument().FilePath
#get parent directory of the parent directory
parentdir = os.path.dirname(path)
#get src folder which contains classes
dire = os.path.join(parentdir,'scripts')
sys.path.append(dire)
json_path = os.path.join(parentdir, 'data', 'stick_assembly.json')

from compas import json_dump
from compas.datastructures import Assembly, Part

# Select which module to produce
idx = min(which_module, len(graph)-1)
current_place_sticks = list(place_sticks[idx])
current_place_frames = list(place_frames[idx])
current_face_indices = list(face_indices[idx])
current_t_values = list(t_values[idx])
current_joint_frames = list(joint_frames[idx])
current_pick_up_sticks = list(pick_up_sticks[idx])
current_pick_up_frames = list(pick_up_frames[idx])

# Create Compas Assembly object
assembly = Assembly()
for i, s in enumerate(current_place_sticks):
    part_name = "stick" + str(i)
    part = Part(part_name, current_place_frames[i])
    part.key = i
    # part.attributes["stick"] = s  # didn't work
    part.attributes["start_frame"] = s.frame
    part.attributes["shape"] = s.geometry
    part.attributes["length"] = s.length
    part.attributes["face_idx"] = current_face_indices[i]
    part.attributes["t_val"] = current_t_values[i]

    part.attributes["pick_up_geo"] = current_pick_up_sticks[i].geometry
    part.attributes["pick_up_frame"] = current_pick_up_frames[i]
    part.attributes["lean_in_normal"] = current_joint_frames[i].zaxis

    assembly.add_part(part)

name = [p.attributes["name"] for p in assembly.parts()]
print (name)

t_vals_out = [p.attributes["t_val"] for p in assembly.parts()]
lengths_out = [p.attributes["length"] for p in assembly.parts()]

pick_up_plns_out = [
    frame_to_rhino_plane(p.attributes["pick_up_frame"]) for p in assembly.parts()
    ]
pick_up_geos_out = [p.attributes["pick_up_geo"] for p in assembly.parts()]

place_plns_out = [
    frame_to_rhino_plane(part.frame) for p in assembly.parts()
    ]
place_geos_out = [p.attributes["shape"] for p in assembly.parts()]

if save:
    json_dump(assembly, fp=json_path, pretty=True)
# ---------- end py3_5 ----------
draw = COMPASDraw(cg=py3_5.pick_up_geos_out)  # -> rg; same code as compas_draw
cluster_5 = Cluster(pln=py3_5.pick_up_plns_out, num=30)
int = Integer(number_slider_3)
draw_2 = COMPASDraw(cg=py3_5.fab_stick_geos)  # -> rg; same code as compas_draw
data_2 = Data(py3_5.joint_plns)
data_3 = Data(py3_5.target_plns)
tstat = TreeStatistics(Tree=data_2)  # -> Paths, Length, Count
subtraction = Subtraction(A=tstat.Count, B=1)
min = Minimum(A=subtraction, B=int)
tstat_2 = TreeStatistics(Tree=data_3)  # -> Paths, Length, Count
data_4 = Data(draw_2)
item_3 = ListItem(List=tstat.Paths, Index=min, Wrap=True)
item_4 = ListItem(List=tstat_2.Paths, Index=min, Wrap=True)
tstat_3 = TreeStatistics(Tree=data_4)  # -> Paths, Length, Count
branch = TreeBranch(Tree=data_2, Path=item_3, MaintainPaths=True)
item_5 = ListItem(List=tstat_3.Paths, Index=min, Wrap=True)
branch_2 = TreeBranch(Tree=data_3, Path=item_4, MaintainPaths=True)
panel_6 = Panel(branch)
branch_3 = TreeBranch(Tree=data_4, Path=item_5, MaintainPaths=True)
lng = ListLength(List=branch_3)
panel_7 = Panel(branch_3)
min_2 = Minimum(A=lng, B=Slider(10, range=0..10))
series = Series(Start=0, Step=1, Count=min_2)
item_6 = ListItem(List=branch, Index=series, Wrap=True)
item_7 = ListItem(List=branch_3, Index=series, Wrap=True)
item_8 = ListItem(List=branch_2, Index=series, Wrap=True)
cluster_6 = Cluster(pln=item_6, num=30)
cluster_7 = Cluster(pln=item_8, num=30)
volume = Volume(Geometry=item_7)
points = PointList(Points=volume, Size=Slider(20, range=0..20))

# ----
# Plotting
number_slider_4 = Slider(400, range=0..1000)
pt_10 = Point(Point(1176.794478, -1741.692546, 0))
py3_6 = Python3Script(fab=py3_5.fab, origin=pt_10, x_size=number_slider_4, y_size=Slider(240, range=0..1000))  # -> out, borders, plotted_sticks, start_plns; inputs origin: Point3d, x_size: Double, y_size: Double
# ---------- py3_6: Python ----------
#locate stick class file in the same folder
from compas_rhino import unload_modules
import sys
import os
"""
#get current file path
path = ghenv.Component.OnPingDocument().FilePath
#get parent directory of the parent directory
parentdir = os.path.dirname(path)
#get src folder which contains classes
dire = os.path.join(parentdir,'scripts')

sys.path.append(dire)"""

path = 'D:\\0000_ETH_DFAB\\Github\\MAS-2526\\08_SpatialAssemblies\\StudentProjects\\group_two\\J3RRY_Sticks_^o^\\scripts\\Package_v2'
sys.path.append(path)

unload_modules('J3RRY_SingleStick_v1')
unload_modules('J3RRY_Aggregation_v3')
unload_modules('J3RRY_Collision_v1')
unload_modules('J3RRY_Fabrication_v1')

from J3RRY_SingleStick_v1 import Stick
from J3RRY_Aggregation_v3 import Aggregation, AggregationManager
from J3RRY_Collision_v1 import Collision
from J3RRY_Fabrication_v1 import Fabrication

from compas.geometry import Line, Point, Vector, Frame
from compas.geometry import Transformation
from compas_rhino.conversions import plane_to_compas_frame, frame_to_rhino_plane
from compas_rhino.conversions import point_to_compas
import scriptcontext as sc
import random


from Grasshopper import DataTree
from Grasshopper.Kernel.Data import GH_Path

"""Main Code"""

# Plotting
origin = point_to_compas(origin)
plotted_modules, recs = fab.plot_modules(
    fab.erected_modules, origin, x_size, y_size
    )

plotted_sticks = DataTree[object]()
borders = DataTree[object]()
start_plns = DataTree[object]()
for i, branch in enumerate(plotted_modules):
    path = GH_Path(*fab.graph[i])
    borders.Add(recs[i], path)
    for stick in branch:
        plotted_sticks.Add(stick.geometry, path)
        pln = frame_to_rhino_plane(stick.frame)
        start_plns.Add(pln, path)
# ---------- end py3_6 ----------
item_9 = ListItem(List=py3_6.start_plns, Index=0, Wrap=True)
cluster_8 = Cluster(pln=item_9, num=30)
draw_3 = COMPASDraw(cg=py3_6.borders)  # -> rg; same code as compas_draw
draw_4 = COMPASDraw(cg=py3_6.plotted_sticks)  # -> rg; same code as compas_draw
md_slider = MDSlider(
    SliderMode=0,
    slider_value=Point(0.3009484454, 0.8959676696, 0.5),
    x_domain=Domain(0, 1),
    y_domain=Domain(0, 1),
    z_domain=Domain(0, 1))
evalsrf = EvaluateSurface(Surface=reparameterize(draw_3), Point=md_slider)  # -> Point, Normal, UDirection, VDirection, Frame
tstat_4 = TreeStatistics(Tree=draw_3)  # -> graft(Paths), Length, Count
tag = TextTag3D(Location=evalsrf.Point, Text=tstat_4.Paths, Size=Slider(20, range=0..20), Justification=7)

# ----
# Labelling
draw_5 = COMPASDraw(cg=py3_2.axis_out)  # -> rg; same code as compas_draw
midpt = CurveMiddle(Curve=draw_5)
tstat_5 = TreeStatistics(Tree=midpt)  # -> graft(Paths), Length, Count
chars = Characters(Text=tstat_5.Paths)  # -> Result, Unicode
cull_i = CullIndex(List=chars.Result, Indices="-1", Wrap=True)
series_2 = Series(Start=0, Step=1, Count=tstat_5.Length)
join = TextJoin(Text=cull_i)
concat = Concatenate(FragmentA=join, FragmentC="_", FragmentB=series_2, FragmentD="}")
tag_2 = TextTag(Location=midpt, Text=concat)

# ----
# Visualization
draw_6 = COMPASDraw(cg=py3_2.geo_out)  # -> rg; same code as compas_draw
draw_7 = COMPASDraw(cg=py3_2.failed_sticks)  # -> rg; same code as compas_draw
draw_8 = COMPASDraw(cg=py3_2.valid_sticks)  # -> rg; same code as compas_draw
pln_3 = Plane(py3_2.pln_out)
geo = Geometry(draw_6)
geo_2 = Geometry(draw_7)
geo_3 = Geometry(draw_8)
py3_7 = Python3Script(geos=geo)  # -> out, groups; inputs geos: tree of GeometryBase
# ---------- py3_7: Python ----------
from Grasshopper import DataTree
from Grasshopper.Kernel.Data import GH_Path

path_length = [path.Length for path in geos.Paths]
print (path_length)
cset = sorted(set(path_length))
print (cset)

geo_tree = DataTree[object]()

for i, L in enumerate(cset):
    path = GH_Path(i)
    for p in geos.Paths:
        if p.Length == L:
            for item in geos.Branch(p):
                geo_tree.Add(item, path)

groups = geo_tree
# ---------- end py3_7 ----------
tstat_6 = TreeStatistics(Tree=geo_2)  # -> Paths, Length, Count
merge_5 = Merge(
    Data1=ColourSwatch(SwatchColor=RGBA(255, 255, 255, 150)),
    Data2=ColourSwatch(SwatchColor=RGBA(255, 247, 0, 150)),
    Data3=ColourSwatch(SwatchColor=RGBA(0, 255, 153, 150)))
item_10 = ListItem(List=tstat_6.Paths, Index=Slider(1, range=0..29), Wrap=True)
tstat_7 = TreeStatistics(Tree=py3_7.groups)  # -> Paths, Length, Count
series_3 = Series(Start=0, Step=1, Count=tstat_7.Count)
item_11 = ListItem(List=merge_5, Index=series_3, Wrap=True)  # -> graft(Item)
branch_4 = TreeBranch(Tree=geo_2, Path=item_10, MaintainPaths=True)
branch_5 = TreeBranch(Tree=geo_3, Path=item_10, MaintainPaths=True)
cluster_9 = Cluster(pln=pln_3, num=30)
preview = CustomPreview(Geometry=py3_7.groups, Material=item_11)

draw_9 = COMPASDraw(cg=py3_5.place_geos_out)  # -> rg; same code as compas_draw
cluster_10 = Cluster(pln=py3_5.place_plns_out, num=30)

# ----
# *Temporary work target
item_12 = ListItem(List=branch_3, Index=0, Wrap=True)  # disabled
debrep = DeconstructBrep(Brep=item_12)  # -> Faces, Edges, Vertices; disabled
area = Area(Geometry=debrep.Faces)  # disabled
pdecon = Deconstruct(Point=area)  # -> XComponent, YComponent, ZComponent; disabled
sort = SortList(Keys=pdecon.ZComponent, ValuesA=area)  # -> Keys, ValuesA; disabled
item_13 = ListItem(List=sort.ValuesA, Index=0, Wrap=True)  # disabled
pt_11 = Point(item_13)  # disabled

# ----
# 1. Save your stick assembly in data folder in the parent directory (Example: 201_stick_assembly.ghx)
# 
# 2. Run Docker and connect with the ROS connect component
# 
# 3. Plan for any index and send to robot using the send components.
button = Button()
compas_fab_ros_connect = COMPASFABROSConnect(connect=button)  # -> ros_client, is_connected; inputs ip: String, port: Int32, connect: Boolean
#   port ip: The ip address ROS. Defaults to 127.0.0.1.
#   port port: The port of ROS. Defaults to 9090.
#   port connect: If True, connects to ROS. If False, disconnects from ROS. Defaults to False.
#   port ros_client: The ROS client.
#   port is_connected: True if connection established.
# ---------- compas_fab_ros_connect: Python ----------
# r: compas_fab>=1.0.2
"""
Connect or disconnect to ROS.

COMPAS FAB v1.0.2
"""

import Grasshopper
from compas_ghpython import create_id
from scriptcontext import sticky as st

from compas_fab.backends import RosClient


class ROSConnect(Grasshopper.Kernel.GH_ScriptInstance):
    def RunScript(self, ip: str, port: int, connect: bool):
        ros_client = None

        ip = ip or "127.0.0.1"
        port = port or 9090

        key = create_id(ghenv.Component, "ros_client")  # noqa: F821

        if ros_client:
            st[key].close()
        if connect:
            st[key] = RosClient(ip, port)
            st[key].run(5)

        ros_client = st.get(key, None)
        is_connected = ros_client.is_connected if ros_client else False
        return (ros_client, is_connected)
# ---------- end compas_fab_ros_connect ----------
compas_fab_ros_robot = COMPASFABROSRobot(ros_client=compas_fab_ros_connect.ros_client, load=Button())  # -> robot; inputs load: Boolean
#   port ros_client: The ROS client.
#   port load: If True, loads the robot from ROS. Defaults to False.
# ---------- compas_fab_ros_robot: Python ----------
# r: compas_fab>=1.0.2
"""
Load robot directly from ROS.

COMPAS FAB v1.0.2
"""

import Grasshopper
from compas_ghpython import create_id
from scriptcontext import sticky as st

from compas.scene import SceneObject


class ROSRobot(Grasshopper.Kernel.GH_ScriptInstance):
    def RunScript(self, ros_client, load: bool):
        key = create_id(ghenv.Component, "robot")  # noqa: F821

        if ros_client and ros_client.is_connected and load:
            # Load URDF from ROS
            st[key] = ros_client.load_robot(load_geometry=True, precision=12)
            st[key].scene_object = SceneObject(item=st[key].model)

        robot = st.get(key, None)

        if robot:  # client sometimes need to be restarted, without needing to reload geometry
            robot.client = ros_client
        return robot
# ---------- end compas_fab_ros_robot ----------
panel_8 = Panel(compas_fab_ros_connect.is_connected)
panel_9 = Panel(compas_fab_ros_robot)
compas_fab_planning_scene = COMPASFABPlanningScene(robot=compas_fab_ros_robot)  # -> scene
#   port scene: A planning scene.
# ---------- compas_fab_planning_scene: Python ----------
# r: compas_fab>=1.0.2
"""
Create a planning scene.

COMPAS FAB v1.0.2
"""

import Grasshopper
from compas_ghpython import create_id
from scriptcontext import sticky as st

from compas_fab.robots import PlanningScene


class PlanningSceneComponent(Grasshopper.Kernel.GH_ScriptInstance):
    def RunScript(self, robot):
        key = create_id(ghenv.Component, "planning_scene")  # noqa: F821
        if robot:
            st[key] = PlanningScene(robot)
        return st.get(key, None)
# ---------- end compas_fab_planning_scene ----------

# ----
# TCP
panel_10 = Panel("{0.83, 0.47, 109.91}")
multiplication = Multiplication(A=panel_10, _0001=0.001)
pt_12 = Point(multiplication)
pl = ConstructPlane(Origin=pt_12, XAxis=Vector(1, 0, 0), YAxis=Vector(0, 1, 0))
pln_4 = Plane(pl)

# ----
# Change TCP place as per measurement on the Robot!
pln_5 = Plane(Plane(origin=(0.00175, 0.00129, 0.1532), x=(0.7071067812, 0.7071067812, 0), y=(-0.7071067812, 0.7071067812, 0)))  # disabled

pln_6 = Plane(Plane(origin=(-0.5000918774, 0.246579111, 0), x=(0, -1, 0), y=(1, 0, 0)))
panel_11 = Panel()
deplane = DeconstructPlane(Plane=pln_6)  # -> Origin, XAxis, YAxis, ZAxis
rev = Reverse(Vector=deplane.XAxis)
pl_3pt = Plane3Pt(PointA=panel_11)
index_always_skip_first_stick = Slider(3, range=1..10)

# ----
# Create End Effector with Stick Attached
# *Change End Effector & Different Length of stick
# type Mesh
panel_12 = Panel("""0.2
0.3
0.4""")
num = Number(panel_12)
num_2 = Number(py3_5.lengths_out)
num_3 = Number(py3_5.t_vals_out)
division = Division(A=num, B=2)
brep = Brep(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)
panel_13 = Panel(num_2)
panel_14 = Panel(num_3)
volume_2 = Volume(Geometry=brep)
X = UnitX(Factor=division)
box = CenterBox(Base=volume_2, X=expr("x/2", num), Y=expr("x/2", "0.013"), Z=expr("x/2", "0.013"))
multiplication_2 = Multiplication(A=panel_13, B="0.001")
mindex = MemberIndex(Set=num, Member=multiplication_2)  # -> flatten(Index), Count
panel_15 = Panel(mindex.Index)
move_3 = Move(Geometry=box, Motion=X)  # -> Geometry, Transform
remap = RemapNumbers(Value=panel_14, Source=Domain(0, 1), Target=multiplication_2)  # -> Mapped, Clipped
lng_2 = ListLength(List=panel_15)  # -> expr("x-1", Length)
item_14 = ListItem(List=move_3.Geometry, Index=mindex.Index, Wrap=True)
X_2 = UnitX(Factor=remap.Mapped)
min_3 = Minimum(A=index_always_skip_first_stick, B=lng_2)
rev_2 = Reverse(Vector=X_2)
current_index = Panel(min_3)
move_4 = Move(Geometry=item_14, Motion=rev_2)  # -> Geometry, Transform
brep_2 = Brep(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)
item_15 = ListItem(List=move_4.Geometry, Index=current_index, Wrap=True)
mesh_2 = Mesh(brep_2)
smesh = SimpleMesh(Brep=item_15)
merge_6 = Merge(Data1=mesh_2, Data2=smesh)  # -> flatten(Result)
mjoin_2 = MeshJoin(Meshes=merge_6)
qrmesh = QuadRemesh(Geometry=mjoin_2, Settings={aqc=True, as=50, dhe=True, gci=0, null=False, pme=2, sa=0, tqc=2000})  # disabled
preview_2 = CustomPreview(
    Geometry=mjoin_2,
    Material={diffuse=RGB(221, 160, 221), emission=RGB(66, 48, 66), shine=0.5, specular=RGB(255, 255, 255), transparency=0})

mesh_3 = Mesh(mjoin_2)
compas_fab_attached_tool = COMPASFABAttachedTool(robot=compas_fab_ros_robot, visual_mesh=mesh_3, collision_mesh=mesh_3, tcf_plane=pln_4)  # -> robot; inputs visual_mesh: Mesh, collision_mesh: Mesh
#   port visual_mesh: A visual mesh for the tool.
#   port collision_mesh: A collision mesh for the tool.
#   port tcf_plane: The frame of the tool in tool0 frame.
#   port group: The planning group to which the tool should be attached.
#   port connected_to: The link to which the tool should be connected to.
# ---------- compas_fab_attached_tool: Python ----------
# r: compas_fab>=1.0.2
"""
Attach a tool to the robot.

COMPAS FAB v1.0.2
"""

import Grasshopper
import Rhino
from compas.geometry import Frame
from compas_rhino.conversions import mesh_to_compas
from compas_rhino.conversions import plane_to_compas_frame

from compas_fab.robots import Tool


class AttachToolComponent(Grasshopper.Kernel.GH_ScriptInstance):
    def RunScript(self,
            robot,
            visual_mesh: Rhino.Geometry.Mesh,
            collision_mesh: Rhino.Geometry.Mesh,
            tcf_plane,
            group,
            connected_to):
        if robot and robot.client and robot.client.is_connected and visual_mesh:
            if not collision_mesh:
                collision_mesh = visual_mesh

            c_visual_mesh = mesh_to_compas(visual_mesh)
            c_collision_mesh = mesh_to_compas(collision_mesh)

            if not tcf_plane:
                frame = Frame.worldXY()
            else:
                frame = plane_to_compas_frame(tcf_plane)
            tool = Tool(c_visual_mesh, frame, c_collision_mesh, connected_to=connected_to)

            robot.attach_tool(tool, group)

        return robot
# ---------- end compas_fab_attached_tool ----------

brep_3 = Brep([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])
smesh_2 = SimpleMesh(Brep=brep_3)
mjoin_3 = MeshJoin(Meshes=smesh_2)
mesh_4 = Mesh(mjoin_3)

compute = Button()
load = Button()
reset = Button()
py3_8 = Python3Script(
    scene=compas_fab_planning_scene,
    robot=compas_fab_attached_tool,
    load=load,
    compute=compute,
    index=index_always_skip_first_stick,
    env=mesh_4,
    reset=reset)  # -> out, plns_out, pick_plns_out, pick_up_geos, all_sticks, sticks, results, results_list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; inputs index: Int32, env: Mesh
# ---------- py3_8: Python ----------
from compas.datastructures import Assembly, Mesh
from compas.geometry import Frame, Point, Translation, Transformation
from compas_fab.backends import RosClient
from compas_fab.robots import Tool, PlanningScene, CollisionMesh
import os, sys
import math

import traceback

import compas
from compas.data import json_load
from compas_robots import Configuration

compas.PRECISION = "12f"

# Constants
APPROACH_DISTANCE = 0.015  # Meters
group = None
start_configuration = None

# Specify the path to the assembly file and the path to the output file
path = ghenv.Component.OnPingDocument().FilePath
#parentdir = os.path.dirname(path)
parentdir = r"D:\0000_ETH_DFAB\Github\MAS-2526\08_SpatialAssemblies\StudentProjects\group_two\Wanchen"
dire = os.path.join(parentdir, "scripts")
sys.path.append(dire)
json_path = os.path.join(parentdir, "data", "stick_assembly.json")
write_path = os.path.join(parentdir, "data", "stick_assembly_with_trajectories.json")

# Import helpers
from compas_rhino import unload_modules
unload_modules("helpers")
unload_modules("J3RRY_helpers_v1")
r_path = r"D:\0000_ETH_DFAB\Github\MAS-2526\08_SpatialAssemblies\StudentProjects\group_two\J3RRY_Sticks_^o^\robot_related\scripts"
sys.path.append(r_path)

json_path = os.path.join(parentdir, "data", "stick_assembly.json")
write_path = os.path.join(parentdir, "data", "stick_assembly_with_trajectories.json")

# Import helpers
from compas_rhino import unload_modules
unload_modules("helpers")
unload_modules("J3RRY_helpers_v1")

from compas_rhino.conversions import mesh_to_compas, point_to_compas, frame_to_rhino_plane
from helpers import scale_and_move_to_point, generate_default_tolerances, calculate_pick_trajectory, calculate_place_trajectories
from scriptcontext import sticky
from J3RRY_helpers_v1 import move_and_scale


if "last_status" not in sticky or sticky["last_status"] is None:
    sticky["last_status"] = "Idle"

if "geometry" not in sticky or sticky["geometry"] is None:
    pass

SAFE_CONFIG = Configuration.from_revolute_values([math.radians(68.80), 
                                        math.radians(-70.55), 
                                        math.radians(-116.42), 
                                        math.radians(-83.80), 
                                        math.radians(98.73), 
                                        math.radians(56.93)])

if 'load' in globals() and load:
    sticky["assembly"] = None
    sticky["geometry"] = None
    sticky["results"] = {}
    
    scene.reset()
    tcm = CollisionMesh(mesh_to_compas(env), id = "table")
    scene.add_collision_mesh(tcm)
    assembly = json_load(json_path)
    scaled_assembly = scale_and_move_to_point(assembly, Point(0,0,0))

    sticky["assembly"] = scaled_assembly
    sticky["last_status"] = "Assembly loaded"
else:
    scaled_assembly = sticky.get("assembly", None)  
    if scaled_assembly:
        part = scaled_assembly.find_by_key(index)  
        all_sticks = [p.attributes.get("shape", None) for p in scaled_assembly.parts()]  
        plns_out = [frame_to_rhino_plane(p.frame) for p in scaled_assembly.parts()]  
        pick_plns_out = [frame_to_rhino_plane(p.attributes.get("pick_up_frame")) for p in scaled_assembly.parts()]  
        pick_up_geos = [p.attributes.get("pick_up_geo", None) for p in scaled_assembly.parts()]  
        sticky["geometry"] = part.attributes.get("shape", None)

# If it failed or strange, just compute more times!

if 'compute' in globals() and compute and 'index' in globals():
    results = sticky.get("results", {})
    results.pop(str(index), None)
    try:
        part = scaled_assembly.find_by_key(index)

        # define pick_frame and safe_frame
        pick_frame = part.attributes.get("pick_up_frame")
        safe_frame = Frame(
            Point(pick_frame.point.x, pick_frame.point.y, pick_frame.point.z),
            pick_frame.xaxis,
            pick_frame.yaxis
        )
        safe_frame.translate(-0.2 * safe_frame.zaxis)

        # place_frame construct
        place_frame = part.frame

        # define place_safe_frame
        place_safe_frame = Frame(
            Point(place_frame.point.x, place_frame.point.y, place_frame.point.z),
            place_frame.xaxis,
            place_frame.yaxis
        )
        place_safe_frame.translate(-0.2 * place_safe_frame.zaxis)

        tolerances = generate_default_tolerances(robot.get_configurable_joints(robot.main_group_name))

        # ---------- Pick trajectory ----------
        pick_traj, pick_config, approach_config = calculate_pick_trajectory(
            pick_frame, robot, start_config=SAFE_CONFIG
        )

        # ---------- Pick -> Safe (RRTConnect) ----------
        return_to_safe = robot.plan_motion(
            robot.constraints_from_frame(
                safe_frame,
                tolerance_position=0.05,
                tolerances_axes=[0.5, 0.5, 0.5],
                use_attached_tool_frame=True,
                group=robot.main_group_name,
            ),
            start_configuration=pick_config,
            group=robot.main_group_name,
            options=dict(
                planner_id="RRTConnect",
                avoid_collisions=True,
                timeout=380.0,  # Please don't reduce this timeout,otherwise it will failed more frequently
            ),
        )
        if not return_to_safe:
            raise Exception("Return to safe (plan_motion) failed")

        #---------- Safe -> Place_safe (RRTConnect) ----------
        to_place_safe = robot.plan_motion(
            robot.constraints_from_frame(
                place_safe_frame,
                tolerance_position=0.05,
                tolerances_axes=[0.5, 0.5, 0.5],
                use_attached_tool_frame=True,
                group=robot.main_group_name,
            ),
            start_configuration=return_to_safe.points[-1],
            group=robot.main_group_name,
            options=dict(
                planner_id="RRTConnect",
                avoid_collisions=True,
                timeout=380.0,# Please don't reduce this timeout,otherwise it will failed more frequently
            ),
        )
        

        # ---------- Place_safe -> Place_frame (Cartesian) ----------
        to_place = robot.plan_cartesian_motion(
            [place_safe_frame, place_frame],
            start_configuration=to_place_safe.points[-1],
            group=robot.main_group_name,
            options=dict(max_step=0.05),
        )
        

        # ---------- Place_frame -> Place_safe (Cartesian) ----------
        back_to_place_safe = robot.plan_cartesian_motion(
            [place_frame, place_safe_frame],
            start_configuration=to_place.points[-1],
            group=robot.main_group_name,
            options=dict(max_step=0.05),
        )
        
        # ---------- Place_safe -> Place_frame (Cartesian) ----------
        to_place_again = robot.plan_cartesian_motion(
            [place_safe_frame, place_frame],
            start_configuration=back_to_place_safe.points[-1],
            group=robot.main_group_name,
            options=dict(max_step=0.05),
        )
        
        # ---------- Place_frame -> Place_safe (Cartesian) ----------
        exit_from_place = robot.plan_cartesian_motion(
            [place_frame, place_safe_frame],
            start_configuration=to_place_again.points[-1],
            group=robot.main_group_name,
            options=dict(max_step=0.05),
        )

        # ---------- Place_safe -> Safe (RRTConnect) ----------
        back_to_safe = robot.plan_motion(
            robot.constraints_from_frame(
                safe_frame,
                tolerance_position=0.05,
                tolerances_axes=[0.5, 0.5, 0.5],
                use_attached_tool_frame=True,
                group=robot.main_group_name,
            ),
            start_configuration=exit_from_place.points[-1],
            group=robot.main_group_name,
            options=dict(
                planner_id="RRTConnect",
                avoid_collisions=True,
                timeout=380.0,# Please don't reduce this timeout,otherwise it will failed more frequently
            ),
        )

        # ---------- Combine all trajectory----------
        joined_trajectory = pick_traj.copy()
        joined_trajectory.points.extend(return_to_safe.points[1:])
        joined_trajectory.points.extend(to_place_safe.points[1:])
        joined_trajectory.points.extend(to_place.points[1:])
        joined_trajectory.points.extend(back_to_place_safe.points[1:])
        joined_trajectory.points.extend(to_place_again.points[1:])
        joined_trajectory.points.extend(exit_from_place.points[1:])
        joined_trajectory.points.extend(back_to_safe.points[1:])

        results[str(index)] = {
            "pick_frame": pick_frame,
            "safe_frame": safe_frame,
            "place_frame": place_frame,
            "place_safe_frame": place_safe_frame,
            "pick_trajectory": pick_traj,
            "joined_trajectory": joined_trajectory
        }
        sticky["results"] = results
        sticky["last_status"] = f"Computed: {index}"
        print(f"✓ Computed complete trajectory for frame {index}")

    except Exception as e:
        print(f"Failed for frame {index}: {e}")
        print(traceback.format_exc())
        sticky["last_status"] = "Error: {}".format(str(e))
results = sticky.get("results", None)
results_list = [results]
if (
    results is not None
    and str(index) in results
    and "joined_trajectory" in results[str(index)]
):
    joined_trajectory = results[str(index)]["joined_trajectory"]
else:
    joined_trajectory = None


assembly = sticky.get("assembly", None)


ghenv.Component.Message = sticky["last_status"][:35]
print(sticky["last_status"])
sticks = sticky.get("geometry", None)

if reset:
    sticky["assembly"] = None
    sticky["geometry"] = None
    sticky["results"] = {}
# ---------- end py3_8 ----------
panel_16 = Panel(py3_8.out)
number_slider_5 = Slider(0.03, range=0..0.1)
compas_draw_2 = COMPASDraw(cg=py3_8.pick_up_geos)  # -> rg; same code as compas_draw
compas_draw_3 = COMPASDraw(cg=py3_8.all_sticks)  # -> rg; same code as compas_draw
compas_draw_4 = COMPASDraw(cg=py3_8.sticks)  # -> rg; same code as compas_draw
preview_3 = CustomPreview(
    Geometry=compas_draw_4,
    Material={diffuse=RGB(221, 160, 221), emission=RGB(66, 48, 66), shine=0.5, specular=RGB(255, 255, 255), transparency=0})
cluster_11 = Cluster(pln=py3_8.plns_out, num=number_slider_5)
cluster_12 = Cluster(pln=py3_8.pick_plns_out, num=number_slider_5)

compas_fab_trajectory_visualize = COMPASFABTrajectoryVisualize(robot=compas_fab_attached_tool, trajectory=py3_8.joined_trajectory)  # -> start_configuration, configurations, fraction, time, planes, P, V, A; inputs group: String
#   port group: The planning group for which this trajectory was planned.
#   port trajectory: The calculated trajectory.
#   port start_configuration: The start configuration of the trajectory.
#   port configurations: The full configurations along the trajectory.
#   port fraction: Indicates the fraction of requested trajectory that was calculated, e.g. 1 means the full trajectory was found.
#   port time: The time which is needed to execute that trajectory at full speed.
#   port planes: The planes of the robot's end-effector.
#   port P: The positions along the trajectory
#   port V: The velocities along the trajectory
#   port A: The accelerations along the trajectory
# ---------- compas_fab_trajectory_visualize: Python ----------
# r: compas_fab>=1.0.2
"""
Visualizes a trajectory.

COMPAS FAB v1.0.2
"""

import Grasshopper
from compas_ghpython.drawing import draw_frame
from compas_ghpython.sets import list_to_ghtree


class TrajectoryVisualize(Grasshopper.Kernel.GH_ScriptInstance):
    def RunScript(self, robot, group: str, trajectory):
        start_configuration = None
        configurations = []
        fraction = 0.0
        time = 0.0

        planes = []
        positions = []
        velocities = []
        accelerations = []

        if robot and trajectory:
            group = group or robot.main_group_name

            for c in trajectory.points:
                configurations.append(
                    robot.merge_group_with_full_configuration(c, trajectory.start_configuration, group)
                )
                frame = robot.forward_kinematics(c, group, options=dict(solver="model"))
                planes.append(draw_frame(frame))
                positions.append(c.positions)
                velocities.append(c.velocities)
                accelerations.append(c.accelerations)

            start_configuration = trajectory.start_configuration
            fraction = trajectory.fraction
            time = trajectory.time_from_start

        P = list_to_ghtree(list(zip(*positions)))
        V = list_to_ghtree(list(zip(*velocities)))
        A = list_to_ghtree(list(zip(*accelerations)))

        # return outputs if you have them; here I try it for you:
        return (start_configuration, configurations, fraction, time, planes, P, V, A)
# ---------- end compas_fab_trajectory_visualize ----------
lng_3 = ListLength(List=compas_fab_trajectory_visualize.configurations)  # -> expr("x-1", Length)
cull_i_2 = CullIndex(List=compas_fab_trajectory_visualize.planes, Indices=-1, Wrap=True)
panel_17 = Panel(lng_3)
min_4 = Minimum(A=lng_3, B=Slider(0, range=0..100))
pline = PolyLine(Vertices=cull_i_2, Closed=False)
item_16 = ListItem(List=compas_fab_trajectory_visualize.configurations, Index=min_4, Wrap=True)
cluster_13 = Cluster(pln=compas_fab_trajectory_visualize.planes, num=Slider(0.03, range=0..0.1))
crv = Curve(pline)
compas_fab_robot_visualize = COMPASFABRobotVisualize(robot=compas_fab_attached_tool, configuration=item_16, show_visual=Toggle(False), show_collision=Toggle(True))  # -> visual, collision, collision_meshes, attached_meshes, frames, base_frame, ee_frame; inputs group: String, show_visual: Boolean, show_collision: Boolean, show_frames: Boolean, show_base_frame: Boolean, show_end_effector_frame: Boolean, show_cm: Boolean, show_acm: Boolean
#   port group: The planning group used for end-effector and base visualization.
#   port configuration: The robot's full configuration.
#   port show_visual: Whether or not to show the robot's visual meshes.
#   port show_collision: Whether or not to show the robot's collision meshes.
#   port show_frames: Whether or not to show the robot's joint frames.
#   port show_base_frame: Whether or not to show the robot's base frame.
#   port show_end_effector_frame: Whether or not to show the robot's end-effector frame.
#   port show_cm: Whether or not to show the collision meshes (if any).
#   port show_acm: Whether or not to show the attached collision meshes (if any).
#   port visual: Rhino meshes of the robot's visual geometry (if any).
#   port collision: Rhino meshes of the robot's collision geometry (if any).
#   port collision_meshes: Rhino meshes of the scene's collision meshes (if any).
#   port attached_meshes: Rhino meshes of the scene's attached collision meshes (if any).
#   port frames: The robot's joint frames as Rhino planes (if any).
#   port base_frame: The robot's base frame as a Rhino plane (if any).
#   port ee_frame: The robot's end-effector frame as a Rhino plane (if any).
# ---------- compas_fab_robot_visualize: Python ----------
# r: compas_fab>=1.0.2
"""
Visualizes the robot.

COMPAS FAB v1.0.2
"""

import time

import Grasshopper
from compas_ghpython import create_id
from compas_rhino.conversions import frame_to_rhino_plane
from scriptcontext import sticky as st

from compas.geometry import Frame
from compas.geometry import Transformation
from compas.scene import SceneObject
from compas_fab.backends import BackendFeatureNotSupportedError
from compas_fab.robots import PlanningScene


class RobotVisualize(Grasshopper.Kernel.GH_ScriptInstance):
    def RunScript(self,
            robot,
            group: str,
            configuration,
            show_visual: bool,
            show_collision: bool,
            show_frames: bool,
            show_base_frame: bool,
            show_end_effector_frame: bool,
            show_cm: bool,
            show_acm: bool):
        visual = None
        collision = None
        collision_meshes = None
        attached_meshes = None
        frames = None
        base_frame = None
        ee_frame = None

        if robot:
            show_visual = True if show_visual is None else show_visual
            show_cm = True if show_cm is None else show_cm
            show_acm = True if show_acm is None else show_acm
            configuration = configuration or robot.zero_configuration()

            robot.update(configuration, visual=show_visual, collision=show_collision)
            compas_frames = robot.transformed_frames(configuration, group)

            if show_visual:
                visual = robot.scene_object.draw_visual()

            if show_collision:
                collision = robot.scene_object.draw_collision()

            if show_base_frame:
                base_compas_frame = compas_frames[0]
                base_frame = frame_to_rhino_plane(base_compas_frame)

            if show_end_effector_frame:
                options = dict(solver="model")
                if robot.attached_tool:
                    options["link"] = robot.attached_tool.connected_to

                ee_compas_frame = robot.forward_kinematics(configuration, group, options=options)
                ee_frame = frame_to_rhino_plane(ee_compas_frame)

            if show_frames:
                frames = []
                for compas_frame in compas_frames[1:]:
                    frame = frame_to_rhino_plane(compas_frame)
                    frames.append(frame)

            cached_scene_key = create_id(ghenv.Component, "cached_scene")  # noqa: F821

            if show_cm or show_acm:
                cached_scene = st.get(cached_scene_key)
                if not cached_scene:
                    cached_scene = {"time": 0}

                # expire cache if the component has not been executed in the last 2 seconds
                # this allows to slide through a list of configurations
                # without triggering refreshes of the scene in the middle of it
                if time.time() - cached_scene["time"] > 2:
                    update_scene = True
                else:
                    update_scene = False

                if update_scene:
                    scene = PlanningScene(robot)
                    try:
                        scene = robot.client.get_planning_scene()
                    except BackendFeatureNotSupportedError:
                        print(
                            "The selected backend does not support collision meshes. If you need collision mesh support, use a different backend."
                        )
                        scene = None
                        show_cm = False
                        show_acm = False

                if update_scene and show_cm:
                    collision_meshes = []

                    for co in scene.world.collision_objects:
                        header = co.header
                        frame_id = header.frame_id
                        cms = co.to_collision_meshes()

                        for cm in cms:
                            if cm.frame != Frame.worldXY():
                                t = Transformation.from_frame(cm.frame)
                                mesh = cm.mesh.transformed(t)
                            else:
                                mesh = cm.mesh

                            collision_meshes.extend(SceneObject(item=mesh).draw())

                        cached_scene["cm"] = collision_meshes

                collision_meshes = cached_scene.get("cm", [])

                if update_scene and show_acm:
                    attached_meshes = []

                    for aco in scene.robot_state.attached_collision_objects:
                        for acm in aco.to_attached_collision_meshes():
                            frame_id = aco.object["header"]["frame_id"]
                            frame = robot.forward_kinematics(configuration, options=dict(link=frame_id))
                            t = Transformation.from_frame(frame)

                            # Local CM frame
                            if acm.collision_mesh.frame and acm.collision_mesh.frame != Frame.worldXY():
                                t = t * Transformation.from_frame(acm.collision_mesh.frame)

                            mesh = acm.collision_mesh.mesh.transformed(t)

                            attached_meshes.extend(SceneObject(item=mesh).draw())

                    cached_scene["acm"] = attached_meshes

                attached_meshes = cached_scene.get("acm", [])

                cached_scene["time"] = time.time()
                st[cached_scene_key] = cached_scene

        return (
            visual,
            collision,
            collision_meshes,
            attached_meshes,
            frames,
            base_frame,
            ee_frame,
        )
# ---------- end compas_fab_robot_visualize ----------
series_4 = Series(Start=0, Step=1, Count=expr("x-1", current_index))
mesh_5 = Mesh(compas_fab_robot_visualize.collision_meshes)
mesh_6 = Mesh(compas_fab_robot_visualize.collision)
item_17 = ListItem(List=mesh_5, Index=series_4, Wrap=True)

panel_18 = Panel(compas_fab_trajectory_visualize.configurations)
send_to_robot = Button()

py3_9 = Python3Script(index=index_always_skip_first_stick, tcp=pln_4, results=py3_8.results_list)  # -> out, place_pln, script; inputs index: Int32, tcp: Plane, results: list
# ---------- py3_9: Python ----------
from imp import reload
import sys
import os

# get current file path
path = ghenv.Component.OnPingDocument().FilePath
parentdir = os.path.dirname(path)
dire = os.path.join(parentdir, 'scripts')

sys.path.append(dire)

import simple_ur_script as ur
reload(ur)

import utils
reload(utils)

import simple_comm as com
reload(com)

import compas.geometry as cg
import math as m

from compas_rhino.conversions import plane_to_compas_frame, frame_to_rhino_plane
from compas.geometry import Frame, Vector
import math

# ---------- GLOBALS ----------
IO_port = 4    # close gripper
# -----------------------------


# ============================================================
# Trajectory → URScript
# ============================================================

def send_joint_trajectory(script, trajectory):
    """Append URScript moveJ motions for all trajectory points."""
    for point in trajectory.points[:-1]:
        q = point.positions
        script += ur.move_j(list(q), accel=0.25, vel=0.5, radius = 0.05)
    return script


def send_cartesian_frame(script, frame, speed=0.05):
    """Append URScript moveL to a Cartesian Frame."""
    frm = frame.copy()
    script += ur.move_l(frm, accel=0.1, vel=speed)
    return script


# ============================================================
# PICKUP
# ============================================================

def pickup_stick(script, pick_traj, pick_fr):
    """
    1. Follow approach & pick trajectory
    2. Move to pick frame
    3. Close gripper
    """
    pick = pick_fr.copy()
    # pick.point.x = -pick.point.x
    # pick.point.y = -pick.point.y

    pick.rotate(math.pi, Vector(0,0,1), (0,0,0))

    script = send_joint_trajectory(script, pick_traj)
    script = send_cartesian_frame(script, pick, speed=0.05)
    script += ur.set_digital_out(IO_port, True)  # close
    script += ur.sleep(0.5)
    script += ur.textmsg("picked")
    return script


# ============================================================
# PLACE
# ============================================================

def place_stick(script, place_traj, place_fr):
    """
    1. Follow place trajectory
    2. Move to place frame
    3. Open gripper
    """
    # place = place_fr.copy()

    """SOMETHING WRONG"""
    new_place = place_fr.copy()

    # new_place.point.x = -new_place.point.x
    # new_place.point.y = -new_place.point.y

    new_place.rotate(math.pi, Vector(0,0,1), (0,0,0))
    # Reflection
    # new_place.yaxis = -new_place.yaxis

    # Rotation
    # new_place.rotate(math.pi, new_place.yaxis, new_place.point)

    script = send_joint_trajectory(script, place_traj)
    script = send_cartesian_frame(script,new_place, speed=0.05)
    # Popup to check if glue is set
    script += ur.popup("is it done yet?", "hello")
    script += ur.set_digital_out(IO_port, False)  # open
    script += ur.sleep(0.5)
    script += ur.textmsg("placed")
    return script


# ============================================================
# MAIN PIPELINE
# ============================================================

results = results[0]

pick_frame = results[str(index)]["pick_frame"]
place_frame = results[str(index)]["frame"]
pick_trajectory = results[str(index)]["pick_trajectory"]
place_trajectory = results[str(index)]["place_trajectory"]
exit_trajectory = results[str(index)]["exit_trajectory"]

place_pln = frame_to_rhino_plane(place_frame)
script = ""

# Set TCP
script = ur.set_tcp_by_frame(plane_to_compas_frame(tcp))
# Pickup
script = pickup_stick(script, pick_trajectory, pick_frame)
# Place
script = place_stick(script, place_trajectory, place_frame)

# Exit
# script = send_joint_trajectory(script, exit_trajectory)


# finalize
script = com.concatenate_script(script)
# ---------- end py3_9 ----------
panel_19 = Panel(py3_9.script)
py3_10 = Python3Script(script=py3_9.script, ip_address="192.168.10.10", send=send_to_robot)  # -> out, a; inputs script: String, ip_address: String, send: Boolean
# ---------- py3_10: Python ----------
import simple_comm as com

if send:
    com.send_script(script,ip_address)
# ---------- end py3_10 ----------

cluster_14 = Cluster(pln=py3_9.place_pln, num=Slider(0.03, range=0..0.1))
pln_7 = Plane(Plane(origin=(1.70480611, 3.04750146, 0), x=(0.875479661, -0.483254967, 0), y=(-0.1437523509, -0.2604262098, 0.9547321357)))  # disabled
cluster_15 = Cluster(pln=pln_7, num=30)  # disabled
py3_11 = Python3Script(x=pln_7)  # -> out, a; inputs x: Plane; disabled
# ---------- py3_11: Python ----------
import math
lst = [-0.02,-2.57,-0.71,-3.36,1.55,1.93]

deg = [math.degrees(l) for l in lst]

print (deg)

from compas.geometry import Frame, Reflection
from compas_rhino.conversions import plane_to_compas_frame, frame_to_rhino_plane
place = plane_to_compas_frame(x)

new_place = place.copy()
new_place.yaxis = -place.yaxis
new_place.point += new_place.zaxis
a = new_place

print (a)
a = frame_to_rhino_plane(a)
# ---------- end py3_11 ----------
panel_20 = Panel(py3_11.a)  # disabled
cluster_16 = Cluster(pln=py3_11.a, num=30)  # disabled

# ==== cluster Cluster
pln = ClusterInput()
num = ClusterInput()
pln_2 = Plane(graft(pln))
num_2 = Number(num)
deplane = DeconstructPlane(Plane=pln_2)  # -> flatten(Origin), XAxis, YAxis, ZAxis
entwine = Entwine(Branch00=deplane.XAxis, Branch01=deplane.YAxis, Branch02=deplane.ZAxis, FlattenInputs=True)
merge = Merge(
    Data1=ColourSwatch(SwatchColor=RGB(255, 0, 0)),
    Data2=ColourSwatch(SwatchColor=RGB(0, 255, 0)),
    Data3=ColourSwatch(SwatchColor=RGB(0, 0, 255)))  # -> graft(Result)
multiplication = Multiplication(A=entwine, B=num_2)
vdisex = VectorDisplayEx(Point=deplane.Origin, Vector=multiplication, Colour=merge, Width=2)
