# Grasshopper definition assembly.ghx (Grasshopper 1.0.8)

# ---- group: grid_parameters
number_slider = Slider(2, range=0..10)
number_slider_2 = Slider(2, range=0..10)
number_slider_3 = Slider(3, range=0..10)

# ----
pt = Point(Point(0.1313875721, 0.0945869119, 0))
py3 = Python3Script(x_range=number_slider, y_range=number_slider_2, z_range=number_slider_3, offset=Slider(0, range=0..100), st_pt=pt)  # -> out, points, sticks, geometry, frames, base_plane, moved_sticks, stick_meshes; inputs x_range: Int32, y_range: Int32, z_range: Int32, offset: Double, st_pt: Point3d
# ---------- py3: Python ----------
#locate stick class file in the same folder
from compas_rhino import unload_modules
import sys
import os

#get current file path
path = ghenv.Component.OnPingDocument().FilePath
print (path)
#get parent directory of the parent directory
parentdir = os.path.dirname(path)
print (parentdir)
#get src folder which contains classes
dire = os.path.join(parentdir,'scripts')
print (dire)

sys.path.append(dire)

unload_modules('stick')
unload_modules('stickmodules')

import stick
from stick import Stick 
from stickmodules import OStickModule
from helpers import sort_sticks_by_z

from compas.geometry import Line, Point, Vector, Polyhedron
from compas.datastructures import Assembly
from compas.datastructures import Part
from compas.datastructures import Mesh
from compas import json_dump
import math

stick_width = 13.0
stick_depth = 13.0
stick_length = 200


stick_assembly = []
points = []

for x in range(x_range):
    for y in range(y_range):
        for z in range(z_range):
            grid_size = stick_length - 2*stick_depth - offset
            pt = Point(x*grid_size, y*grid_size, z*grid_size)
            points.append(pt)
            #type = 0 or 1 depending on odd or even
            #additionally type can be 2 for last item
            type_x = x%2 if x<x_range-1 else 2
            type_y = y%2 if y<y_range-1 else 2
            type_z = z%2 if z<z_range-1 else 2
            type = {"x":type_x, "y":type_y, "z":type_z}
            stick_module = OStickModule(pt, stick_length, stick_width, stick_depth, offset, type)
            stick_assembly.extend(stick_module.stick_module)



from compas_rhino.conversions import point_to_compas, frame_to_rhino_plane
from compas.geometry import Point, Frame, Vector, Transformation

c_pt = point_to_compas(st_pt)
robot_base = Frame(c_pt, -Vector(0,1,0), Vector(1,0,0) )

T = Transformation.from_frame_to_frame(Frame.worldXY(), robot_base)
moved_sticks = []
stick_meshes = []
for s in stick_assembly:
    s.frame.transform(T)
    s.axis.transform(T)
    moved_sticks.append(s)
    box = s.geometry   
    vertices, faces = box.to_vertices_and_faces(triangulated=True)
    stick_mesh = Mesh.from_vertices_and_faces(vertices,faces)
    stick_meshes.append(stick_mesh)



geometry = [s.geometry for s in moved_sticks]
frames = [frame_to_rhino_plane(s.frame) for s in moved_sticks]

base_plane = frame_to_rhino_plane(robot_base)
# ---------- end py3 ----------
draw = COMPASDraw(cg=py3.points)  # -> rg
#   port cg: The COMPAS geometry or datastructure to be drawn.
#   port rg: The Rhino geometry object.
# ---------- draw: Python ----------
# r: compas>=2.14.1
"""
Draws COMPAS geometry in Grasshopper.
"""

from typing import Any

import Grasshopper

from compas.scene import SceneObject


class CompasToRhinoGeometry(Grasshopper.Kernel.GH_ScriptInstance):
    def RunScript(self, cg):
        if not cg:
            return None

        return SceneObject(item=cg).draw()
# ---------- end draw ----------
draw_2 = COMPASDraw(cg=py3.sticks)  # -> rg; same code as draw
draw_3 = COMPASDraw(cg=py3.geometry)  # -> rg; same code as draw
py3_2 = Python3Script(sticks=py3.moved_sticks, save=Button())  # -> out, assembly; inputs sticks: list, save: Boolean
# ---------- py3_2: Python ----------
from compas import json_dump
import os, sys
from itertools import combinations
from compas_rhino import unload_modules
from compas.geometry import Line, Plane, Vector, Point

#get current file path
path = ghenv.Component.OnPingDocument().FilePath
#get parent directory of the parent directory
parentdir = os.path.dirname(path)
#get src folder which contains classes
dire = os.path.join(parentdir,'scripts')

sys.path.append(dire)

unload_modules('helpers')

from stick import Stick 

from compas.datastructures import Assembly, Part

json_path = os.path.join(parentdir, 'data', 'stick_assembly_new.json')

stick_width = 18.0
stick_depth = 18.0
stick_length = 200

sticks_data = []

assembly = Assembly()
for i, s in enumerate(sticks):
    part_name = "stick"+ str(i)
    part = Part(name = part_name, frame = s.frame)
    part.shape = s.geometry
    assembly.add_part(part)
    

    

if save:
    json_dump(data, fp=json_path, pretty=True)
# ---------- end py3_2 ----------
