# Grasshopper definition 101_brep_slicer.ghx (Grasshopper 1.0.8)

brep = Brep(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)
brep_2 = Brep(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)
py3 = Python3Script(x=brep)  # -> out, planes; inputs x: Brep
# ---------- py3: Python ----------
# venv: compas_geo
# r: compas

from compas.geometry import Brep, Vector, Plane

brep = Brep.from_native(x)

layer_height = 18.0

planes = []

for level in range(50):
    z_value = level * layer_height
    plane = Plane([0,0, z_value], Vector(0,0,1))
    curve = brep.slice(plane)
    planes.extend(curve)
# ---------- end py3 ----------
draw = COMPASDraw(cg=py3.planes)  # -> rg
#   port cg: The COMPAS geometry or datastructure to be drawn.
#   port rg: The Rhino geometry object.
# ---------- draw: Python ----------
# r: compas>=2.14.1
"""
Draws COMPAS geometry in Grasshopper.
"""

from typing import Any

import Grasshopper

from compas.scene import SceneObject


class CompasToRhinoGeometry(Grasshopper.Kernel.GH_ScriptInstance):
    def RunScript(self, cg):
        if not cg:
            return None

        return SceneObject(item=cg).draw()
# ---------- end draw ----------
list = ValueList({"single_layer": 1, "continous": 2}, selected="continous")
pt = Point(<point referenced from the Rhino model>)
py3_2 = Python3Script(curves=py3.planes, divide_interval=Slider(50, range=0..100), seam_position=pt, print_type=list)  # -> out, points, line, print_time, print_weight, mypath, contours, print_angles, print_offset, spiral; inputs curves: list, divide_interval: Int32, seam_position: Point3d
# ---------- py3_2: Python ----------
from compas.geometry import Point, Polyline, Frame, Vector, distance_point_line, Translation, closest_point_on_polyline, Line, Curve
import math

def remap(value, from_min, from_max, to_min, to_max):
    # Remap a value from one range to another
    from_range = from_max - from_min
    to_range = to_max - to_min
    scaled_value = float(value - from_min) / float(from_range)
    return to_min + (scaled_value * to_range)


class PrintPoint:
    def __init__(self, point, velocity = 18.0, air_pressure = 8.0, blend= 1.0, wait_time=0.0, toggle=True, layer_idx=None, trigger_motor_0=False, trigger_motor_1=False):
        self.point = point
        self.velocity = velocity
        self.air_pressure = air_pressure # 4.16 (flat) to 20.00 (max) layer_height 18.00 = mid(range)
        self.blend = blend
        self.wait_time = wait_time
        self.toggle = toggle
        self.layer_idx = layer_idx
        self.frame = self.get_frame()
        self.hc_set_point = 0.0134

        # NEW: color + motor setpoints
        self.rgb = None       
        self.gray_scale = None

        self.trigger_motor_0 = trigger_motor_0
        self.trigger_motor_1 = trigger_motor_1

    def get_frame(self):
        return Frame(self.point, Vector(1, -5, 0), Vector(0, -1, 0))
      
    def to_dict(self):
        return {
            "frame": self.frame,
            "point": self.point,
            "velocity": self.velocity,
            "air_pressure": self.air_pressure,
            "blend": self.blend,
            "wait_time": self.wait_time,
            "toggle": self.toggle,
            "layer_idx": self.layer_idx,
            "hc_set_point": self.hc_set_point,
            "trigger_motor_0": self.trigger_motor_0,
            "trigger_motor_1": self.trigger_motor_1

        }


class PrintPath:
    """
    A class to represent a print path consisting of multiple layers.
    ...
    Attributes
    ----------
    layers : list
        a list of layers
    prinpoints : list
        a list of printpoints
    path : Polyline
        a polyline representing the path
    """
    def __init__(self, layers, average_robot_speed =10):
        self.layers = layers
        self.printpoints = self.get_printpoints()
        self.path = Polyline([printpoint.point for printpoint in self.printpoints])
        self.average_robot_speed = average_robot_speed
        self.length = self.path.length
        self.nozzle_outer_rad = 12
        self.nozzle_inner_rad = 10.5
        self.area_nozzle = math.pi * (self.nozzle_outer_rad**2 - self.nozzle_inner_rad**2)
    
    def add_safety_point(self, vector, safety_distance = 50.0):
        vec = vector * safety_distance
        T = Translation.from_vector(vec)
        TT = Translation.from_vector(Vector(0, 0, 50))
        tail_pt = PrintPoint(self.printpoints[0].point.transformed(T), toggle = True, layer_idx = 0)
        safe_pt = PrintPoint(tail_pt.point.transformed(TT), velocity=18.0, toggle=True, layer_idx=0)
        self.printpoints.insert(0,tail_pt)
        self.printpoints.insert(0, safe_pt)
    
    #add end safety point
    def add_end_safety_point(self, vector, safety_distance = 50.0):
        vec = vector * safety_distance
        T = Translation.from_vector(vec)
        TT = Translation.from_vector(Vector(0, 0, 50))
        tail_pt = PrintPoint(self.printpoints[-1].point.transformed(T), toggle = True, layer_idx = self.printpoints[-1].layer_idx)
        safe_pt = PrintPoint(tail_pt.point.transformed(TT), velocity=18.0, toggle=True, layer_idx=self.printpoints[-1].layer_idx)
        self.printpoints.append(tail_pt)
        self.printpoints.append(safe_pt)
    
    def get_printpoints(self):
        printpoints = []
        for layer in self.layers:
            for printpoint in layer.printpoints:
                printpoints.append(printpoint)
        return printpoints
                
    def get_print_time(self):
        print_time = self.length / self.average_robot_speed
        return print_time/3600 #convert seconds to hours
    
    def get_print_weight(self, material_density = 1.27):
        length_path = self.length/10 #convert mm to cm
        volume = length_path * self.area_nozzle /100 #cm3
        grams = volume * material_density
        return grams/1000 # grams to kg
    
    def get_print_angles_and_offsets(self):
        # this function is exactly the same as the one from Nik's tutorial (but uses compas)

        vert_vec = Vector(0, 0, -1)

        print_offset = []
        print_angles = []

        # get directly the contours from the layers
        contours = [layer.path for layer in self.layers]
        # print (len(contours))
        for i, crv in enumerate(contours):
            if i == 0:
                print_angles.extend([0] * len(crv))
                print_offset.extend([0] * len(crv))

            else:
                prev_pl = contours[i - 1]
                for pt in crv:
                    # layer.path is a polyline = list of points
                    par = Point(*closest_point_on_polyline(pt, prev_pl))
                    # print(par)
                    vect = par - pt
                    ang = vect.angle(vert_vec, True)
                    print_angles.append(ang)

                    dist = par.distance_to_point(Point(pt.x, pt.y, par.z))
                    print_offset.append(dist)

        return print_angles, print_offset
    
    def build_spiral_path(self, turns_per_layer=1):
        """
        Build a single continuous polyline that ramps from layer 0 -> 1 -> 2 -> ...

        Parameters
        ----------
        turns_per_layer : int
            How many "index turns" to do per layer transition. 1 matches your original.
        use_layer_path : bool
            If True, use layer.path (if present). Otherwise use layer.printpoints.

        Returns
        -------
        Polyline
        """
        
        all_pts = []

        

        for i in range(len(self.layers) - 1):
            layer_points = self.layers[i].printpoints
            pts1 = [pp.point for pp in layer_points]
            pts2 = [pp.point for pp in self.layers[i + 1].printpoints]
            div = turns_per_layer * len(layer_points)


            for i in range(len(layer_points)):
                
                point1 = pts1[i]
                point2 = pts2[i]
            
                line = Line(point1, point2)
                a = remap(i, 0, div, 0, 1)
                point = line.point_at(a)

                all_pts.append(point)
        spiral = Polyline(all_pts)
        self.path = spiral
        self.printpoints = [PrintPoint(point) for point in spiral.points]
        return spiral


    
    def to_dict(self):
        return {i : printpoint.to_dict() for i, printpoint in enumerate(self.printpoints)}


class Layer:
    def __init__(self, printpoints, layer_idx, layer_height = 18.0):
        self.printpoints = printpoints
        self.layer_idx = layer_idx
        self.layer_height = layer_height  
        self.path = Polyline([printpoint.point for printpoint in printpoints])
    

    def simplify_path(self, epsilon=0.1):
        """
        Simplify a polyline using the Ramer-Douglas-Peucker algorithm.
        Parameters
        ----------
        polyline : compas.geometry.Polyline
            A polyline.
        Returns
        -------
        compas.geometry.Polyline
            The simplified polyline.
        
        Source
        ------
        https://en.wikipedia.org/wiki/Ramer%E2%80%93Douglas%E2%80%93Peucker_algorithm

        """
        def rdp(points, epsilon):
            dmax = 0
            index = 0
            end = len(points) - 1
            for i in range(1, end):
                d = distance_point_line(points[i], (points[0], points[end]))
                if d > dmax:
                    index = i
                    dmax = d
            if dmax > epsilon:
                results = rdp(points[:index + 1], epsilon)[:-1] + rdp(points[index:], epsilon)
            else:
                results = [points[0], points[end]]
            return results
        
        self.path = Polyline(rdp(self.path.points, epsilon))
        self.printpoints = [PrintPoint(point) for point in self.path.points]
# ---------- end py3_2 ----------
draw_2 = COMPASDraw(cg=py3_2.points)  # -> rg; same code as draw
draw_3 = COMPASDraw(cg=py3_2.line)  # -> rg; same code as draw
draw_4 = COMPASDraw(cg=py3_2.spiral)  # -> rg; same code as draw
panel = Panel(py3_2.print_time)
panel_2 = Panel(py3_2.print_weight)

# ----
# Overhang
bnd = Bounds(Numbers=flatten(py3_2.print_angles))
dedomain = DeconstructDomain(Domain=bnd)  # -> Start, End
panel_3 = Panel(dedomain.End)
gradient = Gradient(
    LowerLimit=dedomain.Start,
    UpperLimit="35",
    Parameter=py3_2.print_angles,
    stops=[0: RGB(0, 142, 0), 0.824: RGB(254, 251, 0), 1: RGB(255, 38, 0)])
preview = CustomPreview(Geometry=draw_2, Material=gradient)

bnd_2 = Bounds(Numbers=flatten(py3_2.print_offset))
dedomain_2 = DeconstructDomain(Domain=bnd_2)  # -> Start, End
panel_4 = Panel(dedomain_2.End)
gradient_2 = Gradient(
    LowerLimit=dedomain_2.Start,
    UpperLimit="10",
    Parameter=py3_2.print_offset,
    stops=[0: RGB(0, 142, 0), 0.824: RGB(254, 251, 0), 1: RGB(255, 38, 0)])
preview_2 = CustomPreview(Geometry=draw_2, Material=gradient_2)

pline = PolyLine(Vertices=draw_2, Closed=False)
# Export JSON
py3_3 = Python3Script(mypath=py3_2.mypath, save=Button())  # -> out, a; inputs save: Boolean
# ---------- py3_3: Python ----------
import sys
import os

#get current file path
path = ghenv.Component.OnPingDocument().FilePath
#get parent directory of the parent directory
parentdir = os.path.dirname(path)
#get src folder which contains classes

folderpath = os.path.join(parentdir,'send_to_robot\data')
sys.path.append(folderpath)

name = 'sample.json'
file_path = os.path.join(folderpath, name)
print(file_path)

data = mypath.to_dict()


###########################exportJSON######################################
from compas import json_dump

if save:
    json_dump(data, file_path, pretty=True)
# ---------- end py3_3 ----------
