# Grasshopper definition 104_brep_slicer_color_vici_v2.ghx (Grasshopper 1.0.8)
# plug-ins: Heteroptera, NGon 2.1

brep = Brep(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)
brep_2 = Brep(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)

# ---- group: cylinder_color test 30*60
brep_3 = Brep(<brep referenced from the Rhino model>)

# ----
py3 = Python3Script(x=brep_3)  # -> out, planes; inputs x: Brep
# ---------- py3: Python ----------
# venv: compas_geo
# r: compas

from compas.geometry import Brep, Vector, Plane

brep = Brep.from_native(x)

layer_height = 18.0

planes = []

for level in range(100):
    z_value = level * layer_height
    plane = Plane([0,0, z_value], Vector(0,0,1))
    curve = brep.slice(plane)
    planes.extend(curve)
# ---------- end py3 ----------
draw = COMPASDraw(cg=py3.planes)  # -> rg
#   port cg: The COMPAS geometry or datastructure to be drawn.
#   port rg: The Rhino geometry object.
# ---------- draw: Python ----------
# r: compas>=2.14.1
"""
Draws COMPAS geometry in Grasshopper.
"""

from typing import Any

import Grasshopper

from compas.scene import SceneObject


class CompasToRhinoGeometry(Grasshopper.Kernel.GH_ScriptInstance):
    def RunScript(self, cg):
        if not cg:
            return None

        return SceneObject(item=cg).draw()
# ---------- end draw ----------
item = ListItem(List=draw, Index=Slider(0, range=0..100), Wrap=True)
curvepoint = PointOnCurve(item, parameter=0.515)
crv_cp = CurveClosestPoint(Point=curvepoint, Curve=item)  # -> Point, Parameter, Distance
crv_cp_2 = CurveClosestPoint(Point=crv_cp.Point, Curve=draw)  # -> Point, Parameter, Distance
pt = Point(crv_cp_2.Point)
seam = Seam(Curve=draw, Seam=crv_cp_2.Parameter)
ext = ExtendCurve(Curve=seam, Type=0, Start="-30", End="-30")
curve = Curve(ext)

# ---- group: brim_offset
item_2 = ListItem(List=curve, Index=Slider(0, range=0..100), Wrap=True)
offset = OffsetCurve(Curve=item_2, Distance=Slider(28, range=0..100), Corners=1)
ins = InsertItems(List=curve, Item=offset, Indices=Slider(0, range=0..100), Wrap=True)

# ----
topoly = CurveToPolyline(Curve=ext, ToleranceDistance=Slider(1, range=0..10), ToleranceAngle=0)  # -> Polyline, Segments
py3_2 = Python3Script(curves=topoly.Polyline)  # -> out, points, line, print_time, print_weight, mypath, contours, print_angles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; inputs curves: list of Polyline
# ---------- py3_2: Python ----------
from compas.geometry import Point, Translation, distance_point_point, Polyline, Frame, Vector, closest_point_in_cloud
from compas_rhino.conversions import point_to_compas, polyline_to_compas

from compas_rhino import unload_modules
import sys
import os
import math
#get current file path
path = ghenv.Component.OnPingDocument().FilePath
#get parent directory of the parent directory
parentdir = os.path.dirname(path)
#get src folder which contains classes
dire = os.path.join(parentdir,'src')

sys.path.append(dire)
print(dire)

unload_modules('PrintClass')

from PrintClass import PrintPoint, PrintPath, Layer

def reorder_list(lst, first_index):
    return [lst[first_index]] + lst[first_index+1:] + lst[:first_index]



polys = [polyline_to_compas(crv) for crv in curves]

amplitude = 2.0
frequency = 0.5

layers = []
contours = []
for i, curve in enumerate(polys):
    print_points = []

    for j, pt in enumerate(curve.points):
        print_points.append(PrintPoint(pt,layer_idx= i))
    layers.append(Layer(print_points, layer_idx = i))



mypath = PrintPath(layers)

#mypath.add_safety_point(Vector(-1,0,0), 800.0)
#mypath.end_safety_point(Vector(0,0,1), 200.0)


points = [printpoint.point for printpoint in mypath.printpoints]
line = mypath.path

print_time = mypath.get_print_time()
print_weight = mypath.get_print_weight()
print_angles, print_offset = mypath.get_print_angles()
# ---------- end py3_2 ----------
contour = Contour(Shape=brep_3, Point=Point(0, 0, 0), Direction=Vector(0, 0, 1), Distance=Slider(18, range=0..100))
draw_2 = COMPASDraw(cg=py3_2.line)  # -> rg; same code as draw
draw_3 = COMPASDraw(cg=py3_2.first_layer)  # -> rg; same code as draw
draw_4 = COMPASDraw(cg=py3_2.points)  # -> rg; same code as draw

# ----
# Overhang
bnd = Bounds(Numbers=flatten(py3_2.print_angles))
dedomain = DeconstructDomain(Domain=bnd)  # -> Start, End
panel = Panel(dedomain.End)
gradient = Gradient(
    LowerLimit=dedomain.Start,
    UpperLimit="35",
    Parameter=py3_2.print_angles,
    stops=[0: RGB(0, 142, 0), 0.824: RGB(254, 251, 0), 1: RGB(255, 38, 0)])
preview = CustomPreview(Geometry=draw_4, Material=gradient)

bnd_2 = Bounds(Numbers=flatten(py3_2.print_offset))
dedomain_2 = DeconstructDomain(Domain=bnd_2)  # -> Start, End
panel_2 = Panel(dedomain_2.End)
gradient_2 = Gradient(
    LowerLimit=dedomain_2.Start,
    UpperLimit="10",
    Parameter=py3_2.print_offset,
    stops=[0: RGB(0, 142, 0), 0.824: RGB(254, 251, 0), 1: RGB(255, 38, 0)])
preview_2 = CustomPreview(Geometry=draw_4, Material=gradient_2)

meshpipe = MeshPipe(Curve=contour, Radius=Slider(12, range=0..100), Sides=6, Tolerance=10, Ending=0)
panel_3 = Panel(py3_2.print_angles)
panel_4 = Panel(py3_2.print_weight)
panel_5 = Panel(py3_2.print_time)

# ---- group: RGB_color
list = ValueList({"yellow": "255, 255, 0", "red": "255, 0, 0", "navy blue": "0, 0, 255", "turqois": "0, 188, 188", "purple": "128, 0, 128"}, selected="red")
list_2 = ValueList({"yellow": "255, 255, 0", "red": "255, 0, 0", "navy blue": "0, 0, 255", "turqois": "0, 188, 188", "purple": "128, 0, 128"}, selected="purple")

# ---- group: original_color
list_3 = ValueList({"yellow": "247, 181, 0", "red": "255, 45, 33", "navy blue": "0, 83, 135", "turqois": "5, 139, 140", "purple": "132, 76, 130"}, selected="navy blue")
list_4 = ValueList({"yellow": "247, 181, 0", "red": "255, 45, 33", "navy blue": "0, 83, 135", "turqois": "5, 139, 140", "purple": "132, 76, 130"}, selected="purple")

# ----
number_slider = Slider(10, range=0..10)
list_5 = ValueList({"color_1": "color1", "color_2": "color2", "mix", "transparent"}, selected="color_1")

# ----
# Export JSON
pline = PolyLine(Vertices=draw_4, Closed=False)
explode = Explode(Curve=pline, Recursive=True)  # -> Segments, Vertices
pt_2 = Point(explode.Vertices)
pt_3 = Point(explode.Vertices)
pdecon = Deconstruct(Point=pt_2)  # -> XComponent, YComponent, ZComponent
pdecon_2 = Deconstruct(Point=pt_3)  # -> XComponent, YComponent, ZComponent
pdecon_3 = Deconstruct(Point=pt_2)  # -> XComponent, YComponent, ZComponent
pdecon_4 = Deconstruct(Point=pt_3)  # -> XComponent, YComponent, ZComponent
extremums = MinMax(Number=pdecon.ZComponent)  # -> Minimum, Maximum
extremums_2 = MinMax(Number=pdecon_2.ZComponent)  # -> Minimum, Maximum
gradient_3 = Gradient(
    LowerLimit=extremums.Minimum,
    UpperLimit=extremums.Maximum,
    Parameter=pdecon_3.ZComponent,
    stops=[0.0297: RGB(0, 0, 0), 0.0942: RGB(0, 0, 0), 0.66: RGB(255, 255, 255)])
gradient_4 = Gradient(
    LowerLimit=extremums_2.Minimum,
    UpperLimit=extremums_2.Maximum,
    Parameter=pdecon_4.ZComponent,
    stops=[0: RGB(255, 255, 255), 0.824: RGB(0, 0, 0), 1: RGB(0, 0, 0)])
preview_3 = CustomPreview(Geometry=pt_2, Material=gradient_4)
py3_3 = Python3Script(
    grad_c1=gradient_3,
    grad_c2=gradient_4,
    max_color_span="300",
    start_color=list_5,
    color_length_delay_mm="4000",
    mypath=py3_2.mypath)  # -> out, bools_color_1, boools_color_2, mypath, pts_c1, pts_c2, pts_mix, pts_transparent; inputs grad_c1: list, grad_c2: list, max_color_span: Int32, start_color: String, color_length_delay_mm: Int32
# ---------- py3_3: Python ----------
import Rhino.Geometry as rg

def get_color_percentage(col):
    r,g,b = col.R, col.G, col.B
    if r != g or r!= b or g!=b:
        raise ValueError("Not a byw gradient")
    percent_of_transparent = round(r*10/255)
    percent_of_color = 10 - percent_of_transparent

    return percent_of_color
    
def get_percentage_color_tuples(gradient_c1, gradient_c2):
    percent_tuples =[]
    for color_1, color_2 in zip(gradient_c1, gradient_c2):
        perc_c1 = get_color_percentage(color_1)
        perc_c2 = get_color_percentage(color_2)
        percent_tup = (perc_c1, perc_c2)
        percent_tuples.append(percent_tup)
        #print (perc_c1, perc_c2)
    return percent_tuples

def calculate_pt_dists(pt_list):
    distances = []
    for i, pt in enumerate(pt_list):
        if i!=len(pt_list)-1:
            next_pt = print_pts[i+1]
            pt_dist = rg.Point3d.DistanceTo(pt, next_pt)
            distances.append(pt_dist)
        else:
            distances.append(distances[-1])
    return distances

def val_dist_by_percentage(val, color_span=300):
    if val == 0:
        return 10000000
    elif val == 1:
        return color_span/10*9
    elif val == 2:
        return color_span/10*8
    elif val == 3:
        return color_span/10*7
    elif val == 4:
        return color_span/10*6
    elif val == 5:
        return color_span/10*5
    elif val == 6:
        return color_span/10*4
    elif val ==7:
        return color_span/10*3
    elif val ==8:
        return color_span/10*2
    elif val == 9:
        return color_span/10
    else:
        return (color_span/20)

def calc_boolean_color(pt_dists, percent_c_tups, c_span, color1=True):
    gen_val = 0
    accum = 0
    booleans = []
    for dist, tup in zip(pt_dists, percent_c_tups):
        valc1, valc2 = tup
        if color1:
            valc = valc1
        else:
            valc = valc2

        if valc == 0:
            boolc = False
        elif valc == 10:
            boolc = True
        else:
            trig = val_dist_by_percentage(valc, c_span)
            #print (valc, trig)
            if gen_val == valc:
                accum+= dist
                if accum >= trig:
                    boolc = True
                    accum = 0
                else:
                    boolc = False
            else:
                gen_val = valc
                accum = 0
                boolc = True
            #print (accum, boolc1)
        booleans.append(boolc)
    return booleans

######---------------------------------------------------------------------
#print (len(mypath.printpoints))
print_pts = [rg.Point3d(pp.point.x, pp.point.y, pp.point.z) for pp in mypath.printpoints]

perc_color_tups = get_percentage_color_tuples(grad_c1, grad_c2)
pt_distances = calculate_pt_dists(print_pts)
bools_color_1 = calc_boolean_color(pt_distances, perc_color_tups, max_color_span)
bools_color_2 = calc_boolean_color(pt_distances, perc_color_tups, max_color_span, False)
#print (bools_color_1)

#for percentage, boolc1, boolc2 in zip(perc_color_tups, bools_color_1, bools_color_2):
#    print (percentage, boolc1, boolc2)

for pp, boolc1, boolc2 in zip(mypath.printpoints, bools_color_1, bools_color_2):
    pp.motor_106 = boolc1
    pp.motor_107 = boolc2

#####----------visualization

accum_dist=0
for i, pt_dist in enumerate(pt_distances):
    if accum_dist <= color_length_delay_mm:
        accum_dist += pt_dist
    else:
        shift_val = (i)
        break

starting_list_c1 = []
starting_list_c2 = []
print (type(start_color))
for i in range(shift_val):
    if start_color == str("color1"):
        starting_list_c1.append(True)
        starting_list_c2.append(False)
    elif start_color == str("color2"):
        starting_list_c1.append(False)
        starting_list_c2.append(True)
    elif start_color == str("mix"):
        starting_list_c1.append(True)
        starting_list_c2.append(True)
    else:
        starting_list_c1.append(False)
        starting_list_c2.append(False)

n = len(starting_list_c1)
result_bools_c1 = starting_list_c1 + (bools_color_1[:-n] if n else bools_color_1)
result_bools_c2 = starting_list_c2 + (bools_color_2[:-n] if n else bools_color_2)

pts_c1=[]
pts_c2=[]
pts_transparent=[]

pts_mix = []
for boolc1, boolc2, ppt in zip(result_bools_c1, result_bools_c2, print_pts):
    if boolc1 and boolc2:
        pts_mix.append(ppt)
    elif boolc1:
        pts_c1.append(ppt)
    elif boolc2:
        pts_c2.append(ppt)
    else:
        pts_transparent.append(ppt)

## add lead in and lead out
# ---------- end py3_3 ----------
py3_4 = Python3Script(mypath=py3_3.mypath, save=Button())  # -> out, a; inputs save: Boolean
# ---------- py3_4: Python ----------
import sys
import os

#get current file path
path = ghenv.Component.OnPingDocument().FilePath
#get parent directory of the parent directory
parentdir = os.path.dirname(path)
#get src folder which contains classes

folderpath = os.path.join(parentdir,'send_to_robot\data')
sys.path.append(folderpath)

name = 'sample.json'
file_path = os.path.join(folderpath, name)
print(file_path)

data = mypath.to_dict()


###########################exportJSON######################################
from compas import json_dump

if save:
    json_dump(data, file_path, pretty=True)
# ---------- end py3_4 ----------

pdecon_5 = Deconstruct(Point=explode.Vertices)  # -> XComponent, YComponent, ZComponent
extremums_3 = MinMax(Number=pdecon_5.ZComponent)  # -> Minimum, Maximum
gradient_5 = Gradient(
    LowerLimit=extremums_3.Minimum,
    UpperLimit=extremums_3.Maximum,
    Parameter=pdecon_5.ZComponent,
    stops=[0: RGB(255, 255, 255), 0.681: RGB(192, 0, 192), 0.886: RGB(255, 255, 255)])
gradient_6 = Gradient(
    LowerLimit=extremums_3.Minimum,
    UpperLimit=extremums_3.Maximum,
    Parameter=pdecon_5.ZComponent,
    stops=[0.0928: RGB(255, 255, 255), 0.117: RGB(0, 0, 255), 0.648: RGB(0, 192, 192), 0.664: RGB(255, 255, 255)])
gradient_7 = Gradient(
    LowerLimit=extremums_3.Minimum,
    UpperLimit=extremums_3.Maximum,
    Parameter=pdecon_5.ZComponent,
    stops=[0: RGB(255, 255, 255), 0.294: RGB(255, 0, 0), 0.577: RGB(128, 0, 128), 0.901: RGB(255, 255, 255)])
py3_5 = Python3Script(pts=pt_2, targetDist=Slider(4200, range=0..10000))  # -> out, idx; inputs pts: list of Point3d, targetDist: Int32
# ---------- py3_5: Python ----------
import Rhino.Geometry as rg

total = 0.0
cumDists = [0.0]

for i in range(1, len(pts)):
    segment_length = pts[i].DistanceTo(pts[i-1])
    total += segment_length
    cumDists.append(total)

idx = cumDists.index(
    min(cumDists, key=lambda d: abs(d - targetDist))
)
# ---------- end py3_5 ----------
item_3 = ListItem(List=pt_2, Index=py3_5.idx, Wrap=True)
series = Series(Start=0, Step=1, Count=py3_5.idx)
py3_6 = Python3Script(mypath=py3_2.mypath, rgb_list=gradient_5, delay_time=Slider(3, range=0..10), color1=list_3, color2=list_4)  # -> out, pts, cmd_pts, event_pts, command_state, cmd_target_states, mypath; inputs rgb_list: list, delay_time: Double, color1: String, color2: String
# ---------- py3_6: Python ----------
import math
from compas_rhino.conversions import point_to_rhino

# ---------- helpers ----------

def color_to_rgb(c):
    # GH sometimes gives GH_Colour (has .Value)
    if hasattr(c, "Value"):
        c = c.Value
    return (float(c.R), float(c.G), float(c.B))

def rgb_dist2(a, b):
    return (a[0]-b[0])**2 + (a[1]-b[1])**2 + (a[2]-b[2])**2

def mix_rgb(c1, c2, t=0.5):
    return (
        c1[0] * (1.0 - t) + c2[0] * t,
        c1[1] * (1.0 - t) + c2[1] * t,
        c1[2] * (1.0 - t) + c2[2] * t
    )

def closest_palette_color(rgb, palette):
    # palette: list of (state_name, rgb_tuple)
    best_name, best_rgb = palette[0]
    best_d = rgb_dist2(rgb, best_rgb)
    for name, prgb in palette[1:]:
        d = rgb_dist2(rgb, prgb)
        if d < best_d:
            best_d = d
            best_name, best_rgb = name, prgb
    return best_name, best_rgb

def find_color_change_events(printpoints):
    """Indices i where snapped state changes vs previous point."""
    if not printpoints:
        return []
    events = []
    last = printpoints[0].state
    for i in range(1, len(printpoints)):
        cur = printpoints[i].state
        if cur != last:
            events.append(i)
            last = cur
    return events

def rgb_string_to_tuple(s):
    # "255, 45, 33" -> (255, 45, 33)
    return tuple(float(x.strip()) for x in s.split(","))

def get_delay_length(delay_time_min, speed=18.0):
    """speed in units/sec, time in seconds -> length in units"""
    return speed * (delay_time_min)


def get_point_before(points_xyz, idx, length):
    """
    Find an index < idx that is approximately 'length' distance BEFORE idx along the polyline.
    points_xyz: list of (x,y,z) tuples
    """
    if idx <= 0:
        return 0

    accumulated = 0.0
    best_i = max(idx - 1, 0)
    best_err = float("inf")

    prev = points_xyz[idx]
    for i in range(idx - 1, -1, -1):
        cur = points_xyz[i]
        accumulated += math.dist(prev, cur)

        err = abs(accumulated - length)
        if err < best_err:
            best_err = err
            best_i = i

        if accumulated >= length:
            break

        prev = cur

    return best_i

def motors_from_state(state):
    # map state -> (motor_106, motor_107)
    if state == "transparent":
        return (False, False)
    if state == "motor1":
        return (True, False)
    if state == "motor2":
        return (False, True)
    if state == "mix":
        return (True, True)
    if state == "t_mix1":
        return (True, False)
    if state == "t_mix2":
        return (False, True)
    return (False, False)

# ---------- 0) inputs ----------
# mypath.printpoints : list of PrintPoint, each has .point (COMPAS Point)
# rgb_list : per-point gradient colors
# color1, color2 : strings "R, G, B"
# delay_time_min : minutes until color shows (e.g. 3.0)
# speed : units/sec (e.g. 10.0)

# ---------- 1) assign raw rgb (optional viz/debug) ----------
for pp, col in zip(mypath.printpoints, rgb_list):
    pp.rgb_raw = color_to_rgb(col)

# ---------- 2) build palette + snap ----------
c1 = rgb_string_to_tuple(color1)
c2 = rgb_string_to_tuple(color2)
c_white = (255.0, 255.0, 255.0)
c_mix = mix_rgb(c1, c2, t=0.5)
t_mix1 = mix_rgb(c1,c_white, t=0.5)
t_mix2 = mix_rgb(c2,c_white, t=0.5)

palette = [
    ("transparent", c_white),
    ("motor1", c1),
    ("motor2", c2),
    ("mix", c_mix),
    ("t_mix1", t_mix1),
    ("t_mix2", t_mix2)
]

for pp in mypath.printpoints:
    pp.state, pp.rgb = closest_palette_color(pp.rgb_raw, palette)

# ---------- 3) events (where color changes visually) ----------
events = find_color_change_events(mypath.printpoints)

# ---------- 4) compute command indices (where to activate motors with delay) ----------
flat_xyz = [(pp.point.x, pp.point.y, pp.point.z) for pp in mypath.printpoints]
#calculate the length from the time and av.speed of the print
delay_len = get_delay_length(1800, speed=18.0)  

transparency_delay = get_delay_length(30.0, speed=18.0)  
print(transparency_delay)

alternance = get_point_before(flat_xyz, 100, transparency_delay)
variation = 100-alternance

print(variation)
#ALTERNATIVE: give the length directly

cmd_indices = []
cmd_target_states = []

for i in events:
    i_cmd = get_point_before(flat_xyz, i, delay_len)
    cmd_indices.append(i_cmd)
    cmd_target_states.append(mypath.printpoints[i].state)



# ---------- 5) build a per-point command timeline ----------
n = len(mypath.printpoints)
command_state = [mypath.printpoints[0].state] * n

for i_cmd, target_state in zip(cmd_indices, cmd_target_states):
    if 0 <= i_cmd < n:
        command_state[i_cmd] = target_state

cmd_set = set(cmd_indices)
for i in range(1, n):
    if i not in cmd_set:
        command_state[i] = command_state[i - 1]

t_mix1len = []
t_mix2len = []
for i, name in enumerate(command_state):
    if name == "t_mix1":
        t_mix1len.append(i)
    if name == "t_mix2":
        if i > 1000:
            t_mix2len.append(i)


#print(t_mix1len[0],t_mix1len[-1])
#print(t_mix2len[0], t_mix2len[-1])
#print(t_mix2len)
# --- toggle helper (ON for variation, then transparent for variation, repeating) ---
def toggle_range(state_list, start, end, on_state, variation, off_state="transparent"):
    # end is inclusive index
    span = end - start + 1
    for k in range(span):
        block = k // variation         
        is_on = (block % 2 == 0)
        print(start + k)        # even blocks ON
        state_list[start + k] = on_state if is_on else off_state


# --- apply toggling to t_mix1 block ---
if t_mix1len:
    t1_start = t_mix1len[0]
    t1_end   = t_mix1len[-1]
    print("t_mix1:", t1_start, t1_end)
    toggle_range(command_state, t1_start, t1_end, "t_mix1", variation, off_state="transparent")

# --- apply toggling to t_mix2 block ---
if t_mix2len:
    t2_start = t_mix2len[0]
    t2_end   = t_mix2len[-1]
    print("t_mix2:", t2_start, t2_end)
    toggle_range(command_state, t2_start, t2_end, "t_mix2", variation, off_state="transparent")

# ---------- 6) write motor booleans + visualization outputs ----------
motor106 = []
motor107 = []
pts = []
event_pts = []
cmd_pts = []

for i, pp in enumerate(mypath.printpoints):
    st_cmd = command_state[i]
    m106, m107 = motors_from_state(st_cmd)
    pp.motor_106 = m106
    pp.motor_107 = m107
    motor106.append(m106)
    motor107.append(m107)

    p = point_to_rhino(pp.point)
    pts.append(p)
    if i in events:
        event_pts.append(p)
    if i in cmd_set:
        cmd_pts.append(p)
# ---------- end py3_6 ----------
panel_6 = Panel(series)
panel_7 = Panel(py3_6.cmd_target_states)
pt_4 = Point(py3_6.cmd_pts)
pt_5 = Point(py3_6.event_pts)
txt = Text(py3_6.command_state)
py3_7 = Python3Script(colors=gradient_3)  # -> out, states; inputs colors: list
# ---------- py3_7: Python ----------
import System.Drawing as sd

def to_gray(value):
    # Case 1: string input
    if isinstance(value, str):
        v = value.strip().lower()
        if v == "white":
            return 255
        if v == "black":
            return 0
        
        # Try parsing "r,g,b"
        parts = v.split(",")
        if len(parts) == 3:
            try:
                r, g, b = [int(p) for p in parts]
                return (r + g + b) / 3
            except:
                return None

    # Case 2: tuple or list (r,g,b)
    if isinstance(value, (list, tuple)) and len(value) == 3:
        return (value[0] + value[1] + value[2]) / 3

    # Case 3: System.Drawing.Color
    if isinstance(value, sd.Color):
        return (value.R + value.G + value.B) / 3

    return None


states = []

for c in colors:
    gray = to_gray(c)

    if gray is None:
        states.append(None)
        continue

    # Normalize to blackness (0 = white, 1 = black)
    blackness = 1.0 - (gray / 255.0)

    # Map to 0–10 states
    state = int(round(blackness * 10))

    # Clamp safety
    state = max(0, min(10, state))

    states.append(state)
# ---------- end py3_7 ----------
points = PointList(Points=pt_4, Size=number_slider)
points_2 = PointList(Points=pt_5, Size=number_slider)
tag = TextTag(Location=py3_6.pts, Text=txt)
panel_8 = Panel(py3_7.states)
cull_i = CullIndex(List=panel_8, Indices=series, Wrap=True)
# 1-10
# 
# to be remapped to on/off intervals of filament motors
cull_i_2 = CullIndex(List=pt_2, Indices=series, Wrap=True)

preview_4 = CustomPreview(Geometry=pt_2, Material=gradient_3)
tag_2 = TextTag(Location=cull_i_2, Text=cull_i)

py3_8 = Python3Script(
    grad_c1=gradient_3,
    grad_c2=gradient_4,
    max_color_span="300",
    start_color=list_5,
    color_length_delay_mm="4000",
    mypath=py3_2.mypath)  # -> out, bools_color_1, boools_color_2, mypath, pts_c1, pts_c2, pts_mix; inputs grad_c1: list, grad_c2: list, max_color_span: Int32, start_color: String, color_length_delay_mm: Int32
# ---------- py3_8: Python ----------
import Rhino.Geometry as rg

# --------------------------------------------
# Color utilities
# --------------------------------------------

_INV_255 = 1.0 / 255.0
_BIG_TRIG = 10000000  # keep identical behavior for val == 0

def get_color_percentage(col):
    """
    Expects a grayscale (black-white) color: R==G==B.
    Returns percent_of_color in [0..10] (10 = full color, 0 = white/transparent).
    """
    r, g, b = col.R, col.G, col.B
    if (r != g) or (r != b):
        raise ValueError("Not a b/w gradient")

    # identical to: round(r*10/255)
    percent_of_transparent = round(r * 10.0 * _INV_255)
    return 10 - percent_of_transparent


def get_percentage_color_tuples(gradient_c1, gradient_c2):
    """
    Build list of tuples: (perc_c1, perc_c2) for each point.
    """
    return [(get_color_percentage(c1), get_color_percentage(c2))
            for c1, c2 in zip(gradient_c1, gradient_c2)]


# --------------------------------------------
# Geometry utilities
# --------------------------------------------

def calculate_pt_dists(pt_list):
    """
    Returns distances between consecutive points.
    Last distance repeats the previous distance (same behavior as your code).
    """
    n = len(pt_list)
    if n == 0:
        return []
    if n == 1:
        return [0.0]

    dists = [0.0] * n
    for i in range(n - 1):
        dists[i] = pt_list[i].DistanceTo(pt_list[i + 1])
    dists[-1] = dists[-2]
    return dists


# --------------------------------------------
# Trigger distance mapping (same behavior)
# --------------------------------------------

def val_dist_by_percentage(val, color_span=300):
    """
    Identical mapping to your if/elif chain:
      val==0  -> 10000000
      val==1  -> 0.9*span
      val==2  -> 0.8*span
      ...
      val==9  -> 0.1*span
      else    -> span/20
    """
    if val == 0:
        return _BIG_TRIG
    if 1 <= val <= 9:
        # (10 - val)/10 * span  -> val=1 => 9/10 span, val=9 => 1/10 span
        return color_span * (10 - val) / 10.0
    return color_span / 20.0


# --------------------------------------------
# Boolean generation (both channels in one pass)
# --------------------------------------------

def calc_boolean_colors(pt_dists, percent_c_tups, c_span):
    """
    Computes both boolean lists in one loop, preserving the exact state machine
    behavior of your calc_boolean_color() for color1 and color2 independently.
    """
    gen1 = 0
    gen2 = 0
    acc1 = 0.0
    acc2 = 0.0

    bools1 = []
    bools2 = []

    for dist, (valc1, valc2) in zip(pt_dists, percent_c_tups):

        # ----- Channel 1 -----
        if valc1 == 0:
            b1 = False
        elif valc1 == 10:
            b1 = True
        else:
            trig1 = val_dist_by_percentage(valc1, c_span)
            if gen1 == valc1:
                acc1 += dist
                if acc1 >= trig1:
                    b1 = True
                    acc1 = 0.0
                else:
                    b1 = False
            else:
                gen1 = valc1
                acc1 = 0.0
                b1 = True

        # ----- Channel 2 -----
        if valc2 == 0:
            b2 = False
        elif valc2 == 10:
            b2 = True
        else:
            trig2 = val_dist_by_percentage(valc2, c_span)
            if gen2 == valc2:
                acc2 += dist
                if acc2 >= trig2:
                    b2 = True
                    acc2 = 0.0
                else:
                    b2 = False
            else:
                gen2 = valc2
                acc2 = 0.0
                b2 = True

        bools1.append(b1)
        bools2.append(b2)

    return bools1, bools2


# --------------------------------------------
# Main
# --------------------------------------------

# Build print_pts once
print_pts = [rg.Point3d(pp.point.x, pp.point.y, pp.point.z) for pp in mypath.printpoints]

# Convert gradients -> per-point percentage tuples
perc_color_tups = get_percentage_color_tuples(grad_c1, grad_c2)

# Distances between points
pt_distances = calculate_pt_dists(print_pts)

# Compute booleans for both channels efficiently
bools_color_1, bools_color_2 = calc_boolean_colors(pt_distances, perc_color_tups, max_color_span)

# Assign to motors
for pp, b1, b2 in zip(mypath.printpoints, bools_color_1, bools_color_2):
    pp.motor_106 = b1
    pp.motor_107 = b2


# --------------------------------------------
# Visualization shift (prepend start_color states)
# --------------------------------------------

# Compute how many points to shift based on a distance delay
accum_dist = 0.0
shift_val = len(pt_distances)  # safe default if delay is never exceeded
for i, d in enumerate(pt_distances):
    if accum_dist <= color_length_delay_mm:
        accum_dist += d
    else:
        shift_val = i
        break

# Convert start_color -> starting booleans once
if start_color == "color1":
    start_pair = (True, False)
elif start_color == "color2":
    start_pair = (False, True)
elif start_color == "mix":
    start_pair = (True, True)
else:
    start_pair = (False, False)

starting_list_c1 = [start_pair[0]] * shift_val
starting_list_c2 = [start_pair[1]] * shift_val

n = shift_val

# Fuse lists: prepend starting list, cut from end of computed list (same as your fusion logic)
result_bools_c1 = starting_list_c1 + (bools_color_1[:-n] if n else bools_color_1)
result_bools_c2 = starting_list_c2 + (bools_color_2[:-n] if n else bools_color_2)

# Classify points for preview
pts_c1 = []
pts_c2 = []
pts_mix = []

for b1, b2, ppt in zip(result_bools_c1, result_bools_c2, print_pts):
    if b1 and b2:
        pts_mix.append(ppt)
    elif b1:
        pts_c1.append(ppt)
    elif b2:
        pts_c2.append(ppt)
# ---------- end py3_8 ----------
panel_9 = Panel(cull_i)
panel_10 = Panel("Map to distance")
py3_9 = Python3Script(mypath=py3_8.mypath, save=Button())  # -> out, a; inputs save: Boolean; same code as py3_4
pt_6 = Point(py3_3.pts_mix)
pt_7 = Point(py3_3.pts_transparent)
pt_8 = Point(py3_3.pts_c2)
pt_9 = Point(py3_3.pts_c1)
pt_10 = Point(py3_8.pts_mix)
pt_11 = Point(py3_8.pts_c2)
pt_12 = Point(py3_8.pts_c1)
preview_5 = CustomPreview(Geometry=pt_6, Material=ColourSwatch(SwatchColor=RGB(166, 0, 255)))
preview_6 = CustomPreview(Geometry=pt_7, Material=ColourSwatch(SwatchColor=RGB(255, 255, 255)))
preview_7 = CustomPreview(Geometry=pt_8, Material=ColourSwatch(SwatchColor=RGB(255, 0, 0)))
preview_8 = CustomPreview(Geometry=pt_9, Material=ColourSwatch(SwatchColor=RGB(21, 0, 255)))
preview_9 = CustomPreview(Geometry=pt_10, Material=ColourSwatch(SwatchColor=RGB(166, 0, 255)))
preview_10 = CustomPreview(Geometry=pt_11, Material=ColourSwatch(SwatchColor=RGB(255, 0, 0)))
preview_11 = CustomPreview(Geometry=pt_12, Material=ColourSwatch(SwatchColor=RGB(21, 0, 255)))

# ----
# Colour Preview
# Base PETG colour + 2 additional mix-ins possible
mjoin = MeshJoin(Meshes=brep_3)
demesh = DeconstructMesh(Mesh=mjoin)  # -> Vertices, Faces, Colours, Normals
pdecon_6 = Deconstruct(Point=demesh.Vertices)  # -> XComponent, YComponent, ZComponent
extremums_4 = MinMax(Number=pdecon_6.ZComponent)  # -> Minimum, Maximum

gradient_8 = Gradient(
    LowerLimit=extremums_4.Minimum,
    UpperLimit=extremums_4.Maximum,
    Parameter=pdecon_6.ZComponent,
    stops=[0: RGB(255, 255, 255), 1: RGB(0, 0, 0)])

conmesh = ConstructMesh(Vertices=demesh.Vertices, Faces=demesh.Faces, Colours=gradient_8)

panel_11 = Panel(gradient_8)
argb = SplitARGB(Colour=gradient_8)  # -> Alpha, Red, Green, Blue
panel_12 = Panel(argb.Red)

# ----
# Colour Preview
demesh_2 = DeconstructMesh(Mesh=meshpipe)  # -> Vertices, Faces, Colours, Normals
pdecon_7 = Deconstruct(Point=demesh_2.Vertices)  # -> XComponent, YComponent, ZComponent
extremums_5 = MinMax(Number=flatten(pdecon_7.ZComponent))  # -> Minimum, Maximum

gradient_9 = Gradient(
    LowerLimit=extremums_5.Minimum,
    UpperLimit=extremums_5.Maximum,
    Parameter=pdecon_7.ZComponent,
    stops=[0: RGB(255, 0, 0), 0.158: RGB(255, 255, 255), 0.557: RGB(255, 0, 255), 0.924: RGB(220, 0, 40)])
gradient_10 = Gradient(
    LowerLimit=extremums_5.Minimum,
    UpperLimit=extremums_5.Maximum,
    Parameter=pdecon_7.ZComponent,
    stops=[0: RGB(204, 202, 134), 0.213: RGB(103, 127, 81), 0.478: RGB(99, 154, 136), 1: RGB(186, 192, 203)])

conmesh_2 = ConstructMesh(Vertices=demesh_2.Vertices, Faces=demesh_2.Faces, Colours=gradient_9)

mesh = Mesh(flatten(conmesh_2))
