# Grasshopper definition 105_brep_slicer_clean.ghx (Grasshopper 1.0.8)
# plug-ins: Heteroptera

brep = Brep(<brep referenced from the Rhino model>)
py3 = Python3Script(x=brep)  # -> out, planes; inputs x: Brep
# ---------- py3: Python ----------
# venv: compas_geo
# r: compas

from compas.geometry import Brep, Vector, Plane

brep = Brep.from_native(x)

layer_height = 18.0

planes = []

for level in range(100):
    z_value = level * layer_height
    plane = Plane([0,0, z_value], Vector(0,0,1))
    curve = brep.slice(plane)
    planes.extend(curve)
# ---------- end py3 ----------
draw = COMPASDraw(cg=py3.planes)  # -> rg
#   port cg: The COMPAS geometry or datastructure to be drawn.
#   port rg: The Rhino geometry object.
# ---------- draw: Python ----------
# r: compas>=2.14.1
"""
Draws COMPAS geometry in Grasshopper.
"""

from typing import Any

import Grasshopper

from compas.scene import SceneObject


class CompasToRhinoGeometry(Grasshopper.Kernel.GH_ScriptInstance):
    def RunScript(self, cg):
        if not cg:
            return None

        return SceneObject(item=cg).draw()
# ---------- end draw ----------
item = ListItem(List=draw, Index=Slider(0, range=0..100), Wrap=True)

# ---- group: Start Point position
curvepoint = PointOnCurve(item, parameter=0.444)

# ----
crv_cp = CurveClosestPoint(Point=curvepoint, Curve=item)  # -> Point, Parameter, Distance
crv_cp_2 = CurveClosestPoint(Point=crv_cp.Point, Curve=draw)  # -> Point, Parameter, Distance
pt = Point(crv_cp_2.Point)
seam = Seam(Curve=draw, Seam=crv_cp_2.Parameter)
ext = ExtendCurve(Curve=seam, Type=0, Start="-30", End="-30")
crv = Curve(ext)

# ---- group: first double layer
item_2 = ListItem(List=crv, Index=Slider(0, range=0..100), Wrap=True)
neg = Negative(Value=Slider(9, range=0..10))
offset = OffsetCurve(Curve=item_2, Distance=Slider(0, range=0..100), Corners=1)
Z = UnitZ(Factor=neg)
move = Move(Geometry=offset, Motion=Z)  # -> Geometry, Transform
ins = InsertItems(List=crv, Item=move.Geometry, Indices=Slider(0, range=0..100), Wrap=True)

# ----
topoly = CurveToPolyline(Curve=ins, ToleranceDistance=Slider(0.2, range=0..1), ToleranceAngle=0)  # -> Polyline, Segments
py3_2 = Python3Script(curves=topoly.Polyline)  # -> out, points, line, print_time, print_weight, mypath, contours, print_angles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; inputs curves: list of Polyline
# ---------- py3_2: Python ----------
from compas.geometry import Point, Translation, distance_point_point, Polyline, Frame, Vector, closest_point_in_cloud
from compas_rhino.conversions import point_to_compas, polyline_to_compas

from compas_rhino import unload_modules
import sys
import os
import math
#get current file path
path = ghenv.Component.OnPingDocument().FilePath
#get parent directory of the parent directory
parentdir = os.path.dirname(path)
#get src folder which contains classes
dire = os.path.join(parentdir,'src')

sys.path.append(dire)
print(dire)

unload_modules('PrintClass')

from PrintClass import PrintPoint, PrintPath, Layer, remap

def reorder_list(lst, first_index):
    return [lst[first_index]] + lst[first_index+1:] + lst[:first_index]



polys = [polyline_to_compas(crv) for crv in curves]

amplitude = 2.0
frequency = 0.5

layers = []
contours = []
for i, curve in enumerate(polys):
    print_points = []

    for j, pt in enumerate(curve.points):
        if i == 0: 
            print_points.append(PrintPoint(pt,layer_idx= i, velocity =7.0))
        elif i==1:
            vel = remap(j, 0, len(curve.points),7, 18)
            print_points.append(PrintPoint(pt,layer_idx= i, velocity = vel))
        else:
            print_points.append(PrintPoint(pt,layer_idx= i))
        
    layers.append(Layer(print_points, layer_idx = i))



mypath = PrintPath(layers)

# mypath.add_safety_point(Vector(-1,0,0), 800.0)
# mypath.end_safety_point(Vector(0,0,1), 200.0)

first_layer = [pp.point for pp in mypath.layers[0].printpoints]
points = [printpoint.point for printpoint in mypath.printpoints]
line = mypath.path

print_time = mypath.get_print_time()
print_weight = mypath.get_print_weight()
print_angles, print_offset = mypath.get_print_angles()
for i, (angle, dist) in enumerate(zip(print_angles, print_offset)): # bridging & overhanging
    if angle > 35.0 and dist > 18.0:
        mypath.printpoints[i].velocity = 3.6

    elif angle > 35.0:
        mypath.printpoints[i].velocity = 14.4
# ---------- end py3_2 ----------
panel = Panel(py3_2.print_angles)
draw_2 = COMPASDraw(cg=py3_2.points)  # -> rg; same code as draw
draw_3 = COMPASDraw(cg=py3_2.first_layer)  # -> rg; same code as draw

# ----
# Overhang
bnd = Bounds(Numbers=flatten(py3_2.print_angles))
dedomain = DeconstructDomain(Domain=bnd)  # -> Start, End
panel_2 = Panel(dedomain.End)
gradient = Gradient(
    LowerLimit=dedomain.Start,
    UpperLimit="35",
    Parameter=py3_2.print_angles,
    stops=[0: RGB(0, 142, 0), 0.824: RGB(254, 251, 0), 1: RGB(255, 38, 0)])
preview = CustomPreview(Geometry=draw_2, Material=gradient)

bnd_2 = Bounds(Numbers=flatten(py3_2.print_offset))
dedomain_2 = DeconstructDomain(Domain=bnd_2)  # -> Start, End
panel_3 = Panel(dedomain_2.End)
gradient_2 = Gradient(
    LowerLimit=dedomain_2.Start,
    UpperLimit="10",
    Parameter=py3_2.print_offset,
    stops=[0: RGB(0, 142, 0), 0.824: RGB(254, 251, 0), 1: RGB(255, 38, 0)])
preview_2 = CustomPreview(Geometry=draw_2, Material=gradient_2)

print_time_hr = Panel(py3_2.print_time)
print_weight_kg = Panel(py3_2.print_weight)

# ---- group: print filament
gradient_3 = Gradient(UpperLimit=1, stops=[0: RGB(255, 0, 0), 0.483: RGB(192, 0, 192), 1: RGB(255, 255, 255)])
gradient_4 = Gradient(LowerLimit=0, UpperLimit=1, stops=[0: RGB(255, 255, 0), 0.479: RGB(0, 192, 192), 1: RGB(255, 255, 255)])
gradient_5 = Gradient(LowerLimit=0, UpperLimit=1, stops=[0: RGB(0, 0, 255), 0.484: RGB(0, 192, 192), 1: RGB(255, 255, 255)])

# ---- group: visualize
gradient_6 = Gradient(
    LowerLimit=0,
    UpperLimit=1,
    stops=[0: RGB(198, 120, 120), 0.23: RGB(156, 109, 122), 0.5: RGB(183, 135, 169), 1: RGB(223, 227, 233)])
gradient_7 = Gradient(
    LowerLimit=0,
    UpperLimit=1,
    stops=[0: RGB(204, 202, 134), 0.213: RGB(103, 127, 81), 0.478: RGB(99, 154, 136), 1: RGB(186, 192, 203)])
gradient_8 = Gradient(
    LowerLimit=0,
    UpperLimit=1,
    stops=[0: RGB(53, 104, 192), 0.23: RGB(117, 190, 235), 0.5: RGB(173, 216, 230), 1: RGB(223, 227, 233)])

# ----
pdecon = Deconstruct(Point=draw_2)  # -> XComponent, YComponent, ZComponent
extremums = MinMax(Number=pdecon.ZComponent)  # -> Minimum, Maximum
list = ValueList({"yellow": "247, 181, 0", "red": "255, 45, 33", "navy blue": "0, 83, 135", "turqois": "5, 139, 140", "purple": "132, 76, 130"}, selected="navy blue")
list_2 = ValueList({"yellow": "247, 181, 0", "red": "255, 45, 33", "navy blue": "0, 83, 135", "turqois": "5, 139, 140", "purple": "132, 76, 130"}, selected="yellow")
number_slider = Slider(9, range=0..10)

gradient_9 = Gradient(
    LowerLimit=extremums.Minimum,
    UpperLimit=extremums.Maximum,
    Parameter=pdecon.ZComponent,
    stops=[0.0451: RGB(0, 0, 192), 0.456: RGB(255, 255, 0), 0.96: RGB(255, 255, 255)])

# ---- group: input for simulation
gradient_10 = Gradient(
    LowerLimit=extremums.Minimum,
    UpperLimit=extremums.Maximum,
    Parameter=pdecon.ZComponent,
    stops=[0: RGB(255, 0, 0), 0.588: RGB(255, 128, 255), 1: RGB(255, 255, 255)])
gradient_11 = Gradient(
    LowerLimit=extremums.Minimum,
    UpperLimit=extremums.Maximum,
    Parameter=pdecon.ZComponent,
    stops=[0: RGB(255, 255, 0), 0.479: RGB(0, 192, 192), 1: RGB(255, 255, 255)])
gradient_12 = Gradient(
    LowerLimit=extremums.Minimum,
    UpperLimit=extremums.Maximum,
    Parameter=pdecon.ZComponent,
    stops=[0: RGB(0, 0, 255), 0.549: RGB(255, 255, 0), 1: RGB(255, 255, 255)])

# ----
py3_3 = Python3Script(oldpath=py3_2.mypath, rgb_list=gradient_9, delay_time=Slider(180, range=0..1000), color1=list, color2=list_2)  # -> out, pts, cmd_pts, event_pts, command_state, cmd_target_states, mypath, points; inputs rgb_list: list, delay_time: Double, color1: String, color2: String
# ---------- py3_3: Python ----------
from compas.geometry import Vector
import math 
from compas_rhino.conversions import point_to_rhino
import copy

# ---------- helpers ----------

def color_to_rgb(c):
    # GH sometimes gives GH_Colour (has .Value)
    if hasattr(c, "Value"):
        c = c.Value
    return (float(c.R), float(c.G), float(c.B))

def rgb_dist2(a, b):
    return (a[0]-b[0])**2 + (a[1]-b[1])**2 + (a[2]-b[2])**2

def mix_rgb(c1, c2, t=0.5):
    return (
        c1[0] * (1.0 - t) + c2[0] * t,
        c1[1] * (1.0 - t) + c2[1] * t,
        c1[2] * (1.0 - t) + c2[2] * t
    )

def closest_palette_color(rgb, palette):
    # palette: list of (state_name, rgb_tuple)
    best_name, best_rgb = palette[0]
    best_d = rgb_dist2(rgb, best_rgb)
    for name, prgb in palette[1:]:
        d = rgb_dist2(rgb, prgb)
        if d < best_d:
            best_d = d
            best_name, best_rgb = name, prgb
    return best_name, best_rgb

def find_color_change_events(printpoints):
    """Indices i where snapped state changes vs previous point."""
    if not printpoints:
        return []
    events = []
    last = printpoints[0].state
    for i in range(1, len(printpoints)):
        cur = printpoints[i].state
        if cur != last:
            events.append(i)
            last = cur
    return events

def rgb_string_to_tuple(s):
    # "255, 45, 33" -> (255, 45, 33)
    return tuple(float(x.strip()) for x in s.split(","))

def get_delay_length(delay_time_min, speed=18.0):
    """speed in units/sec, time in minutes -> length in units"""
    return speed * (delay_time_min)


def get_point_before(points_xyz, idx, length):
    """
    Find an index < idx that is approximately 'length' distance BEFORE idx along the polyline.
    points_xyz: list of (x,y,z) tuples
    """
    if idx <= 0:
        return 0

    accumulated = 0.0
    best_i = max(idx - 1, 0)
    best_err = float("inf")

    prev = points_xyz[idx]
    for i in range(idx - 1, -1, -1):
        cur = points_xyz[i]
        accumulated += math.dist(prev, cur)

        err = abs(accumulated - length)
        if err < best_err:
            best_err = err
            best_i = i

        if accumulated >= length:
            break

        prev = cur

    return best_i

def motors_from_state(state):
    # map state -> (motor_106, motor_107)
    if state == "transparent":
        return (False, False)
    if state == "motor1":
        return (True, False)
    if state == "motor2":
        return (False, True)
    if state == "mix":
        return (True, True)
    if state == "t_mix1":
        return (True, False)
    if state == "t_mix2":
        return (False, True)
    return (False, False)

# ---------- 0) inputs ----------
# mypath.printpoints : list of PrintPoint, each has .point (COMPAS Point)
# rgb_list : per-point gradient colors
# color1, color2 : strings "R, G, B"
# delay_time_min : minutes until color shows (e.g. 3.0)
# speed : units/sec (e.g. 10.0)

# ---------- 1) assign raw rgb (optional viz/debug) ----------

mypath = copy.deepcopy(oldpath)
for pp, col in zip(mypath.printpoints, rgb_list):
    pp.rgb_raw = color_to_rgb(col)

# ---------- 2) build palette + snap ----------
c1 = rgb_string_to_tuple(color1)
c2 = rgb_string_to_tuple(color2)
c_white = (255.0, 255.0, 255.0)
c_mix = mix_rgb(c1, c2, t=0.5)
t_mix1 = mix_rgb(c1,c_white, t=0.5)
t_mix2 = mix_rgb(c2,c_white, t=0.5)

palette = [
    ("transparent", c_white),
    ("motor1", c1),
    ("motor2", c2),
    ("mix", c_mix),
    ("t_mix1", t_mix1),
    ("t_mix2", t_mix2)
]

for pp in mypath.printpoints:
    pp.state, pp.rgb = closest_palette_color(pp.rgb_raw, palette)

# ---------- 3) events (where color changes visually) ----------
events = find_color_change_events(mypath.printpoints)

# ---------- 4) compute command indices (where to activate motors with delay) ----------
flat_xyz = [(pp.point.x, pp.point.y, pp.point.z) for pp in mypath.printpoints]
#calculate the length from the time and av.speed of the print
delay_len = get_delay_length(delay_time, speed=18.0)  

#ALTERNATIVE: give the length directly

cmd_indices = []
cmd_target_states = []
for i in events:
    i_cmd = get_point_before(flat_xyz, i, delay_len)
    cmd_indices.append(i_cmd)
    cmd_target_states.append(mypath.printpoints[i].state)

# ---------- 5) build a per-point command timeline ----------
n = len(mypath.printpoints)
command_state = [mypath.printpoints[0].state] * n

for i_cmd, target_state in zip(cmd_indices, cmd_target_states):
    command_state[i_cmd] = target_state

cmd_set = set(cmd_indices)
for i in range(1, n):
    if i not in cmd_set:
        command_state[i] = command_state[i - 1]

t_mix1len = []
t_mix2len = []
for i, name in enumerate(command_state):
    if name == "t_mix1":
        t_mix1len.append(i)
    if name == "t_mix2":
        t_mix2len.append(i)

transparency_delay = get_delay_length(6 , speed=18.0)                   # 6 = Motor switching time(on / off)  counting by seconds, 18 = speed also needs to be calculated.
# print (transparency_delay)

alternance = get_point_before(flat_xyz, 100, transparency_delay)        # 100 = the value refers to the number of points calculated before 
variation = 100 - alternance
print(variation)

if t_mix1len:
    print(t_mix1len[0],t_mix1len[-1])
    change = True
    for i in range(t_mix1len[0],t_mix1len[-1]):
        if i%variation == 0:
            change = not(change)
        #print(change)
        if change:
            command_state[i] = "transparent"
        else:
            command_state[i] = "t_mix1"
if t_mix2len:
    print(t_mix2len[0], t_mix2len[-1])
    change = True
    for i in range(t_mix2len[0],t_mix2len[-1]):
        if i%variation == 0:
            change = not(change)
        #print(change)
        if change:
            command_state[i] = "transparent"
        else:
            command_state[i] = "t_mix2"



# ---------- 6) write motor booleans + visualization outputs ----------
motor106 = []
motor107 = []
pts = []
event_pts = []
cmd_pts = []

for i, pp in enumerate(mypath.printpoints):
    st_cmd = command_state[i]
    m106, m107 = motors_from_state(st_cmd)
    pp.motor_106 = m106
    pp.motor_107 = m107
    motor106.append(m106)
    motor107.append(m107)

    p = point_to_rhino(pp.point)
    pts.append(p)
    if i in events:
        event_pts.append(p)
    if i in cmd_set:
        cmd_pts.append(p)

mypath.add_safety_point(Vector(-1,0,0), 800.0)
mypath.end_safety_point(Vector(0,0,1), 200.0)
points = [printpoint.point for printpoint in mypath.printpoints]
# ---------- end py3_3 ----------
panel_4 = Panel(py3_3.cmd_target_states)
pt_2 = Point(py3_3.cmd_pts)
pt_3 = Point(py3_3.event_pts)
txt = Text(py3_3.command_state)
preview_3 = CustomPreview(Geometry=py3_3.pts, Material=gradient_9)
tag = TextTag(Location=py3_3.pts, Text=txt)
points = PointList(Points=pt_2, Size=number_slider)
points_2 = PointList(Points=pt_3, Size=number_slider)

compas_draw = COMPASDraw(cg=py3_3.points)  # -> rg; same code as draw
pline = PolyLine(Vertices=compas_draw, Closed=False)
# Export JSON
py3_4 = Python3Script(mypath=py3_3.mypath, save=Button())  # -> out, a; inputs save: Boolean
# ---------- py3_4: Python ----------
import sys
import os

#get current file path
path = ghenv.Component.OnPingDocument().FilePath
#get parent directory of the parent directory
parentdir = os.path.dirname(path)
#get src folder which contains classes

folderpath = os.path.join(parentdir,'send_to_robot\data')
sys.path.append(folderpath)

name = 'sample.json'
file_path = os.path.join(folderpath, name)
print(file_path)

data = mypath.to_dict()


###########################exportJSON######################################
from compas import json_dump

if save:
    json_dump(data, file_path, pretty=True)
# ---------- end py3_4 ----------
