# Grasshopper definition 106_brep_slicer.ghx (Grasshopper 1.0.8)
# plug-ins: Heteroptera, NGon 2.1

# ---- group: Geo_00
brep = Brep(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)

# ---- group: Input_Curve
curve = Curve([<curve referenced from the Rhino model> x103])

# ---- group: Input_BREP
brep_2 = Brep(brep)

# ---- group: Sort Curves
area = Area(Geometry=curve)  # -> Area, Centroid
deconstruct = Deconstruct(Point=area.Centroid)  # -> XComponent, YComponent, ZComponent
sort_list = SortList(Keys=deconstruct.ZComponent, ValuesA=curve)  # -> Keys, ValuesA

# ---- group: Slice Brep
py3 = Python3Script(x=brep_2)  # -> out, planes; inputs x: Brep
# ---------- py3: Python ----------
# venv: compas_geo
# r: compas

from compas.geometry import Brep, Vector, Plane

brep = Brep.from_native(x)

layer_height = 18.0

planes = []

for level in range(100):
    z_value = level * layer_height
    plane = Plane([0,0, z_value], Vector(0,0,1))
    curve = brep.slice(plane)
    planes.extend(curve)
# ---------- end py3 ----------
draw = COMPASDraw(cg=py3.planes)  # -> rg
#   port cg: The COMPAS geometry or datastructure to be drawn.
#   port rg: The Rhino geometry object.
# ---------- draw: Python ----------
# r: compas>=2.14.1
"""
Draws COMPAS geometry in Grasshopper.
"""

from typing import Any

import Grasshopper

from compas.scene import SceneObject


class CompasToRhinoGeometry(Grasshopper.Kernel.GH_ScriptInstance):
    def RunScript(self, cg):
        if not cg:
            return None

        return SceneObject(item=cg).draw()
# ---------- end draw ----------

# ----
value_list = ValueList({"BREP": 1, "CURVE": 2}, selected="CURVE")

# ---- group: Input Type
python_3_script = Python3Script(crv=sort_list.ValuesA, brep=draw, input_type=value_list)  # -> curve; inputs crv: list of Curve, brep: list of Curve, input_type: Int32
# ---------- python_3_script: Python ----------
if input_type == 2:
    curve = crv
elif input_type == 1:
    curve = brep
# ---------- end python_3_script ----------

# ---- group: Bottom Layer / Layer Height
layer_height = Slider(9, range=0..10)
neg = Negative(Value=layer_height)
Z = UnitZ(Factor=neg)

# ----
meshpipe = MeshPipe(Curve=<missing>, Radius=<missing>, Sides=6, Tolerance=10, Ending=0)
list = ValueList({"color_1": "color1", "color_2": "color2", "mix", "transparent"}, selected="color_1")

# ---- group: Seam Location
curve_2 = Curve(python_3_script)
item = ListItem(List=curve_2, Index=Slider(0, range=0..100), Wrap=True)

# ---- group: Seam Location / Curve Parameter
curvepoint = PointOnCurve(item, parameter=0.053)

# ---- group: Seam Location (continued)
crv_cp = CurveClosestPoint(Point=curvepoint, Curve=item)  # -> Point, Parameter, Distance
crv_cp_2 = CurveClosestPoint(Point=crv_cp.Point, Curve=curve_2)  # -> Point, Parameter, Distance
seam = Seam(Curve=curve_2, Seam=crv_cp_2.Parameter)
pt = Point(crv_cp_2.Point)
ext = ExtendCurve(Curve=seam, Type=0, Start="-30", End="-30")

# ---- group: Bottom Layer
crv = Curve(ext)
item_2 = ListItem(List=crv, Index=Slider(0, range=0..100), Wrap=True)
offset = OffsetCurve(Curve=item_2, Distance=Slider(0, range=0..100), Corners=1)
move = Move(Geometry=offset, Motion=Z)  # -> Geometry, Transform
ins = InsertItems(List=crv, Item=move.Geometry, Indices=Slider(0, range=0..100), Wrap=True)
topoly = CurveToPolyline(Curve=ins, ToleranceDistance=Slider(0.6, range=0..1), ToleranceAngle=0)  # -> Polyline, Segments

# ----
curve_3 = Curve(topoly.Polyline)

# ---- group: Generate Path
py3_2 = Python3Script(curves=curve_3)  # -> out, points, line, print_time, print_weight, mypath, print_angles, print_offset, first_layer, points_2; inputs curves: list of Polyline
# ---------- py3_2: Python ----------
from compas.geometry import Point, Translation, distance_point_point, Polyline, Frame, Vector, closest_point_in_cloud
from compas_rhino.conversions import point_to_compas, polyline_to_compas

from compas_rhino import unload_modules
import sys
import os
import math
#get current file path
path = ghenv.Component.OnPingDocument().FilePath
#get parent directory of the parent directory
parentdir = os.path.dirname(path)
#get src folder which contains classes
dire = os.path.join(parentdir,'src')

sys.path.append(dire)
print(dire)

unload_modules('PrintClass')

from PrintClass import PrintPoint, PrintPath, Layer, remap

def reorder_list(lst, first_index):
    return [lst[first_index]] + lst[first_index+1:] + lst[:first_index]



polys = [polyline_to_compas(crv) for crv in curves]

amplitude = 2.0
frequency = 0.5

layers = []
contours = []
for i, curve in enumerate(polys):
    print_points = []

    for j, pt in enumerate(curve.points):
        if i == 0: 
            print_points.append(PrintPoint(pt,layer_idx= i, velocity =7.0))
        elif i==1:
            vel = remap(j, 0, len(curve.points),7, 18)
            print_points.append(PrintPoint(pt,layer_idx= i, velocity = vel))
        else:
            print_points.append(PrintPoint(pt,layer_idx= i))
        
    layers.append(Layer(print_points, layer_idx = i))


mypath = PrintPath(layers)


points = [printpoint.point for printpoint in mypath.printpoints]
line = mypath.path

print_time = mypath.get_print_time()
print_weight = mypath.get_print_weight()

print_angles, print_offset = mypath.get_print_angles()
for i, (angle, dist) in enumerate(zip(print_angles, print_offset)): # bridging & overhanging
    if angle > 35.0 and dist > 18.0:
        mypath.printpoints[i].velocity = 3.6

    elif angle > 35.0:
        mypath.printpoints[i].velocity = 14.4

points = [printpoint.point for printpoint in mypath.printpoints]
# ---------- end py3_2 ----------

# ----
draw_2 = COMPASDraw(cg=py3_2.line)  # -> rg; same code as draw
draw_3 = COMPASDraw(cg=py3_2.first_layer)  # -> rg; same code as draw
draw_4 = COMPASDraw(cg=py3_2.points)  # -> rg; same code as draw

data = Data(py3_2.print_angles)
bnd = Bounds(Numbers=flatten(data))
dedomain = DeconstructDomain(Domain=bnd)  # -> Start, End
panel = Panel(dedomain.End)
gradient = Gradient(
    LowerLimit=dedomain.Start,
    UpperLimit="35",
    Parameter=data,
    stops=[0: RGB(0, 142, 0), 0.824: RGB(254, 251, 0), 1: RGB(255, 38, 0)])
preview = CustomPreview(Geometry=draw_4, Material=gradient)

data_2 = Data(py3_2.print_offset)
bnd_2 = Bounds(Numbers=flatten(data_2))
dedomain_2 = DeconstructDomain(Domain=bnd_2)  # -> Start, End
panel_2 = Panel(dedomain_2.End)
gradient_2 = Gradient(
    LowerLimit=dedomain_2.Start,
    UpperLimit="10",
    Parameter=data_2,
    stops=[0: RGB(0, 142, 0), 0.824: RGB(254, 251, 0), 1: RGB(255, 38, 0)])
preview_2 = CustomPreview(Geometry=draw_4, Material=gradient_2)

# ---- group: Sliced Path
compas_draw = COMPASDraw(cg=py3_2.points_2)  # -> rg; same code as draw
polyline = PolyLine(Vertices=compas_draw, Closed=False)

# ----
panel_3 = Panel(py3_2.print_time)
panel_4 = Panel(py3_2.print_weight)

# ---- group: Create Colour Gradient
pline = PolyLine(Vertices=draw_4, Closed=False)
explode = Explode(Curve=pline, Recursive=True)  # -> Segments, Vertices
pt_2 = Point(explode.Vertices)
pt_3 = Point(explode.Vertices)
pdecon = Deconstruct(Point=pt_3)  # -> XComponent, YComponent, ZComponent
pdecon_2 = Deconstruct(Point=pt_3)  # -> XComponent, YComponent, ZComponent
pdecon_3 = Deconstruct(Point=pt_2)  # -> XComponent, YComponent, ZComponent
pdecon_4 = Deconstruct(Point=pt_2)  # -> XComponent, YComponent, ZComponent
extremums = MinMax(Number=pdecon_3.ZComponent)  # -> Minimum, Maximum
extremums_2 = MinMax(Number=pdecon.ZComponent)  # -> Minimum, Maximum
gradient_3 = Gradient(
    LowerLimit=extremums.Minimum,
    UpperLimit=extremums.Maximum,
    Parameter=pdecon_4.ZComponent,
    stops=[0: RGB(0, 0, 0), 0.294: RGB(255, 255, 255), 0.624: RGB(0, 0, 0), 1: RGB(255, 255, 255)])
gradient_4 = Gradient(
    LowerLimit=extremums_2.Minimum,
    UpperLimit=extremums_2.Maximum,
    Parameter=pdecon_2.ZComponent,
    stops=[0: RGB(255, 255, 255), 0.705: RGB(0, 0, 0), 1: RGB(0, 0, 0)])
preview_3 = CustomPreview(Geometry=pt_2, Material=gradient_3)
preview_4 = CustomPreview(Geometry=pt_2, Material=gradient_4)

# ---- group: Analysis
# 1-10
# 
# to be remapped to on/off intervals of filament motors
number_slider = Slider(4200, range=0..10000)
py3_3 = Python3Script(pts=pt_2, targetDist=number_slider)  # -> out, idx; inputs pts: list of Point3d, targetDist: Int32
# ---------- py3_3: Python ----------
import Rhino.Geometry as rg

total = 0.0
cumDists = [0.0]

for i in range(1, len(pts)):
    segment_length = pts[i].DistanceTo(pts[i-1])
    total += segment_length
    cumDists.append(total)

idx = cumDists.index(
    min(cumDists, key=lambda d: abs(d - targetDist))
)
# ---------- end py3_3 ----------
item_3 = ListItem(List=pt_2, Index=py3_3.idx, Wrap=True)
series = Series(Start=0, Step=1, Count=py3_3.idx)
panel_5 = Panel(series)
py3_4 = Python3Script(colors=gradient_3)  # -> out, states; inputs colors: list
# ---------- py3_4: Python ----------
import System.Drawing as sd

def to_gray(value):
    # Case 1: string input
    if isinstance(value, str):
        v = value.strip().lower()
        if v == "white":
            return 255
        if v == "black":
            return 0
        
        # Try parsing "r,g,b"
        parts = v.split(",")
        if len(parts) == 3:
            try:
                r, g, b = [int(p) for p in parts]
                return (r + g + b) / 3
            except:
                return None

    # Case 2: tuple or list (r,g,b)
    if isinstance(value, (list, tuple)) and len(value) == 3:
        return (value[0] + value[1] + value[2]) / 3

    # Case 3: System.Drawing.Color
    if isinstance(value, sd.Color):
        return (value.R + value.G + value.B) / 3

    return None


states = []

for c in colors:
    gray = to_gray(c)

    if gray is None:
        states.append(None)
        continue

    # Normalize to blackness (0 = white, 1 = black)
    blackness = 1.0 - (gray / 255.0)

    # Map to 0–10 states
    state = int(round(blackness * 10))

    # Clamp safety
    state = max(0, min(10, state))

    states.append(state)
# ---------- end py3_4 ----------
cull_i = CullIndex(List=pt_2, Indices=series, Wrap=True)
panel_6 = Panel(py3_4.states)
cull_i_2 = CullIndex(List=panel_6, Indices=series, Wrap=True)
tag = TextTag(Location=cull_i, Text=cull_i_2)
panel_7 = Panel(cull_i_2)

# ---- group: Generate Tool Path
py3_5 = Python3Script(
    grad_c1=gradient_3,
    grad_c2=gradient_4,
    max_color_span="300",
    start_color=list,
    color_length_delay_mm="3000",
    oldpath=py3_2.mypath)  # -> out, bools_color_1, bools_color_2, mypath, pts_c1, pts_c2, pts_mix, pts_transparent, points; inputs grad_c1: list, grad_c2: list, max_color_span: Int32, start_color: String, color_length_delay_mm: Int32
# ---------- py3_5: Python ----------
import Rhino.Geometry as rg
from compas.geometry import Vector

import copy

from compas_rhino import unload_modules
import sys
import os

#get current file path
path = ghenv.Component.OnPingDocument().FilePath
#get parent directory of the parent directory
parentdir = os.path.dirname(path)
#get src folder which contains classes
dire = os.path.join(parentdir,'src')

sys.path.append(dire)
print(dire)

unload_modules('PrintClass')

def get_color_percentage(col):
    r,g,b = col.R, col.G, col.B
    if r != g or r!= b or g!=b:
        raise ValueError("Not a byw gradient")
    percent_of_transparent = round(r*10/255)
    percent_of_color = 10 - percent_of_transparent

    return percent_of_color
    
def get_percentage_color_tuples(gradient_c1, gradient_c2):
    percent_tuples =[]
    for color_1, color_2 in zip(gradient_c1, gradient_c2):
        perc_c1 = get_color_percentage(color_1)
        perc_c2 = get_color_percentage(color_2)
        percent_tup = (perc_c1, perc_c2)
        percent_tuples.append(percent_tup)
        #print (perc_c1, perc_c2)
    return percent_tuples

def calculate_pt_dists(pt_list):
    distances = []
    for i, pt in enumerate(pt_list):
        if i!=len(pt_list)-1:
            next_pt = print_pts[i+1]
            pt_dist = rg.Point3d.DistanceTo(pt, next_pt)
            distances.append(pt_dist)
        else:
            distances.append(distances[-1])
    return distances

def val_dist_by_percentage(val, color_span=300):
    if val == 0:
        return 10000000
    elif val == 1:
        return color_span/10*9
    elif val == 2:
        return color_span/10*8
    elif val == 3:
        return color_span/10*7
    elif val == 4:
        return color_span/10*6
    elif val == 5:
        return color_span/10*5
    elif val == 6:
        return color_span/10*4
    elif val ==7:
        return color_span/10*3
    elif val ==8:
        return color_span/10*2
    elif val == 9:
        return color_span/10
    else:
        return (color_span/20)

def calc_boolean_color(pt_dists, percent_c_tups, c_span, color1=True):
    gen_val = 0
    accum = 0
    booleans = []
    for dist, tup in zip(pt_dists, percent_c_tups):
        valc1, valc2 = tup
        if color1:
            valc = valc1
        else:
            valc = valc2

        if valc == 0:
            boolc = False
        elif valc == 10:
            boolc = True
        else:
            trig = val_dist_by_percentage(valc, c_span)
            #print (valc, trig)
            if gen_val == valc:
                accum+= dist
                if accum >= trig:
                    boolc = True
                    accum = 0
                else:
                    boolc = False
            else:
                gen_val = valc
                accum = 0
                boolc = True
            #print (accum, boolc1)
        booleans.append(boolc)
    return booleans

######---------------------------------------------------------------------
#print (len(mypath.printpoints))
mypath = copy.deepcopy(oldpath)
print_pts = [rg.Point3d(pp.point.x, pp.point.y, pp.point.z) for pp in mypath.printpoints]

perc_color_tups = get_percentage_color_tuples(grad_c1, grad_c2)
pt_distances = calculate_pt_dists(print_pts)
bools_color_1 = calc_boolean_color(pt_distances, perc_color_tups, max_color_span)
bools_color_2 = calc_boolean_color(pt_distances, perc_color_tups, max_color_span, False)
#print (bools_color_1)

for percentage, boolc1, boolc2 in zip(perc_color_tups, bools_color_1, bools_color_2):
    print (percentage, boolc1, boolc2)

for pp, boolc1, boolc2 in zip(mypath.printpoints, bools_color_1, bools_color_2):
    pp.motor_106 = boolc1
    pp.motor_107 = boolc2

#####----------visualization

accum_dist=0
for i, pt_dist in enumerate(pt_distances):
    if accum_dist <= color_length_delay_mm:
        accum_dist += pt_dist
    else:
        shift_val = (i)
        break

starting_list_c1 = []
starting_list_c2 = []
print (type(start_color))
for i in range(shift_val):
    if start_color == str("color1"):
        starting_list_c1.append(True)
        starting_list_c2.append(False)
    elif start_color == str("color2"):
        starting_list_c1.append(False)
        starting_list_c2.append(True)
    elif start_color == str("mix"):
        starting_list_c1.append(True)
        starting_list_c2.append(True)
    else:
        starting_list_c1.append(False)
        starting_list_c2.append(False)

n = len(starting_list_c1)
result_bools_c1 = starting_list_c1 + (bools_color_1[:-n] if n else bools_color_1)
result_bools_c2 = starting_list_c2 + (bools_color_2[:-n] if n else bools_color_2)

pts_c1=[]
pts_c2=[]
pts_transparent=[]
pts_mix = []

for boolc1, boolc2, ppt in zip(result_bools_c1, result_bools_c2, print_pts):
    if boolc1 and boolc2:
        pts_mix.append(ppt)
    elif boolc1:
        pts_c1.append(ppt)
    elif boolc2:
        pts_c2.append(ppt)
    else:
        pts_transparent.append(ppt)

# ## add lead in and lead out
mypath.add_safety_point(Vector(-1,0,0), 800.0)
mypath.end_safety_point(Vector(0,0,1), 200.0)

points = [printpoint.point for printpoint in mypath.printpoints]
# ---------- end py3_5 ----------

# ---- group: Final Path
compas_draw_2 = COMPASDraw(cg=py3_5.points)  # -> rg; same code as draw
polyline_2 = PolyLine(Vertices=compas_draw_2, Closed=False)

# ---- group: Colour Preview
pt_4 = Point(py3_5.pts_c1)
pt_5 = Point(py3_5.pts_c2)
pt_6 = Point(py3_5.pts_mix)
pt_7 = Point(py3_5.pts_transparent)
preview_5 = CustomPreview(Geometry=pt_4, Material=ColourSwatch(SwatchColor=RGB(21, 0, 255)))
preview_6 = CustomPreview(Geometry=pt_5, Material=ColourSwatch(SwatchColor=RGB(255, 0, 0)))
preview_7 = CustomPreview(Geometry=pt_6, Material=ColourSwatch(SwatchColor=RGB(166, 0, 255)))
preview_8 = CustomPreview(Geometry=pt_7, Material=ColourSwatch(SwatchColor=RGB(255, 255, 255)))

# ---- group: Export .JSON
py3_6 = Python3Script(mypath=py3_5.mypath, save=Button())  # -> out, a; inputs save: Boolean
# ---------- py3_6: Python ----------
import sys
import os

#get current file path
path = ghenv.Component.OnPingDocument().FilePath
#get parent directory of the parent directory
parentdir = os.path.dirname(path)
#get src folder which contains classes

folderpath = os.path.join(parentdir,'send_to_robot\data')
sys.path.append(folderpath)

name = 'geo_00_test_c.json'
file_path = os.path.join(folderpath, name)
print(file_path)

data = mypath.to_dict()


###########################exportJSON######################################
from compas import json_dump

if save:
    json_dump(data, file_path, pretty=True)
# ---------- end py3_6 ----------
